# Grasshopper definition 240521_DatabaseInterface.gh (Grasshopper 1.0.8)
# plug-ins: RhinoCodePluginGH

# EXPERIMENTAL SLICER SETUP // PRINT! ARCHITECTURE STUDIO: Authors: Max Benjamin Eschenbach
# 
# Digital Design Unit (DDU)
# Prof. Dr.-Ing. Oliver Tessmann
# Fachbereich Architektur
# Technical University of Darmstadt
# 
# 
# 
# CREDITS:
# ------------
environment_spec = Panel("""#! python3
# venv: DDU_CSC
# r: requests==2.31.0
# r: numpy==1.26.4
# r: scipy==1.13.0
# r: scikit-learn==1.4.2
# VERSION: 240517A""")

geo = Geometry(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)  # disabled
mbralignedproto = Python3Script(Geometry=geo)  # -> out, AlignedGeometry, WorldBBX, AlignedBBX; inputs Geometry: GeometryBase; disabled
# ---------- mbralignedproto: Python ----------
#! python3
# venv: DDU_CSC
# r: requests==2.31.0
# r: numpy==1.26.4
# r: scipy==1.13.0
# r: scikit-learn==1.4.2
# VERSION: 240517A


import numpy as np
from scipy.spatial import ConvexHull
from sklearn.decomposition import PCA

import System
import Rhino
import Grasshopper
import rhinoscriptsyntax as rs


class MinBBX(Grasshopper.Kernel.GH_ScriptInstance):

    def minimum_bounding_rectangle(self, points):
        # Compute the convex hull of the points
        hull = ConvexHull(points)
        hull_points = points[hull.vertices]
        # Initialize variables to keep track of the best rectangle
        min_area = float('inf')
        best_rectangle = None
        best_angle = 0
        # Loop through each edge of the convex hull
        for i in range(len(hull_points)):
            # Determine the points forming the current edge
            p1 = hull_points[i]
            p2 = hull_points[(i + 1) % len(hull_points)]
            # Calculate edge vector
            edge_vec = p2 - p1
            # Rotate the points to align this edge with the x-axis
            angle = np.arctan2(edge_vec[1], edge_vec[0])
            cos_angle = np.cos(-angle)
            sin_angle = np.sin(-angle)
            rot_matrix = np.array([[cos_angle, -sin_angle], [sin_angle, cos_angle]])
            rotated_points = np.dot(points, rot_matrix.T)
            # Compute the min/max x/y in the rotated points
            min_x = np.min(rotated_points[:, 0])
            max_x = np.max(rotated_points[:, 0])
            min_y = np.min(rotated_points[:, 1])
            max_y = np.max(rotated_points[:, 1])
            # Calculate area of the bounding rectangle
            area = (max_x - min_x) * (max_y - min_y)
            if area < min_area:
                min_area = area
                best_angle = angle
                # Create the rectangle in the rotated space and then rotate it back
                best_rectangle = np.array([
                    [min_x, min_y],
                    [max_x, min_y],
                    [max_x, max_y],
                    [min_x, max_y]
                ])
                inv_rot_matrix = np.array([[cos_angle, sin_angle], [-sin_angle, cos_angle]])
                best_rectangle = np.dot(best_rectangle, inv_rot_matrix.T)
        # return results
        return best_rectangle, best_angle

    def align_and_translate(self, points, rectangle, angle):
        cos_angle = np.cos(-angle)
        sin_angle = np.sin(-angle)
        rotation_matrix = np.array([[cos_angle, -sin_angle], [sin_angle, cos_angle]])

        rotated_rectangle = np.dot(rectangle, rotation_matrix.T)
        rotated_points = np.dot(points, rotation_matrix.T)

        # Calculate dimensions to determine the longer side
        width = np.max(rotated_rectangle[:, 0]) - np.min(rotated_rectangle[:, 0])
        height = np.max(rotated_rectangle[:, 1]) - np.min(rotated_rectangle[:, 1])
        
        # Ensure the long side is aligned with the x-axis
        if height > width:
            additional_rotation = np.array([[0, -1], [1, 0]])  # Rotate by 90 degrees
            rotated_rectangle = np.dot(rotated_rectangle, additional_rotation.T)
            rotated_points = np.dot(rotated_points, additional_rotation.T)

        # Translate so the rectangle's lower-left corner is at the origin
        min_x, min_y = rotated_rectangle.min(axis=0)
        rect_center = (np.max(rotated_rectangle, axis=0) + np.min(rotated_rectangle, axis=0)) / 2
        translated_rectangle = rotated_rectangle - rect_center
        translated_points = rotated_points - rect_center

        # Reorder the rectangle points to maintain the consistent order
        ordered_rectangle = np.array([
            [np.min(translated_rectangle[:, 0]), np.min(translated_rectangle[:, 1])],
            [np.max(translated_rectangle[:, 0]), np.min(translated_rectangle[:, 1])],
            [np.max(translated_rectangle[:, 0]), np.max(translated_rectangle[:, 1])],
            [np.min(translated_rectangle[:, 0]), np.max(translated_rectangle[:, 1])]
        ])

        return translated_points, ordered_rectangle

    def RunScript(self, Geometry: Rhino.Geometry.GeometryBase):
        # create empty outputs
        AlignedGeometry = Grasshopper.DataTree[object]()
        WorldBBX = Grasshopper.DataTree[object]()
        AlignedBBX = Grasshopper.DataTree[object]()
        # sanitize input
        if not Geometry:
            rml = ghenv.Component.RuntimeMessageLevel.Warning
            msg = 'Input Geometry failed to collect data!'
            ghenv.Component.AddRuntimeMessage(rml, msg)
            return (AlignedGeometry, Frame, XForm, WorldBBX, AlignedBBX)

        if isinstance(Geometry, Rhino.Geometry.PolylineCurve):
            pl = Geometry.ToPolyline()
            pl.RemoveNearlyEqualSubsequentPoints(Rhino.RhinoDoc.ActiveDoc.ModelAbsoluteTolerance)
            pl.MergeColinearSegments(Rhino.RhinoDoc.ActiveDoc.ModelAngleToleranceRadians, True)
            pl.ReduceSegments(Rhino.RhinoDoc.ActiveDoc.ModelAbsoluteTolerance)
            points = np.array([[p.X, p.Y] for p in pl])
            compute_3d = False
        else:
            raise RuntimeError(f'Minimum BBX not implemented for geometry of type {type(Geometry)}!')

        
        mbr, angle = self.minimum_bounding_rectangle(points)
        aligned_points, aligned_mbr = self.align_and_translate(points, mbr, angle)
        # create aligned geometry
        AlignedGeometry = [Rhino.Geometry.Point3d(p[0], p[1], 0) for p in aligned_points]
        WorldBBX = [Rhino.Geometry.Point3d(p[0], p[1], 0) for p in mbr]
        AlignedBBX = [Rhino.Geometry.Point3d(p[0], p[1], 0) for p in aligned_mbr]

        return (AlignedGeometry, WorldBBX, AlignedBBX)
# ---------- end mbralignedproto ----------
pline = PolyLine(Vertices=mbralignedproto.AlignedBBX, Closed=False)  # disabled
pline_2 = PolyLine(Vertices=mbralignedproto.WorldBBX, Closed=False)  # disabled
pline_3 = PolyLine(Vertices=mbralignedproto.AlignedGeometry, Closed=False)  # disabled

# ----
# comments & notes: RETRIEVING & FILTERING, VISUALIZING COMPONENTS
# comments & notes: Create Configuration for Database Access
baseurl = Panel("https://api.ddu.uber.space")
password = Panel("!pioneeringDDU2024@")
tokenurl = Panel("https://api.ddu.uber.space/token")
username = Panel("students")
csctoken = Python3Script(BaseURL=baseurl, TokenURL=tokenurl, Username=username, Password=password)  # -> Config; inputs BaseURL: String, TokenURL: String, Username: String, Password: String
# ---------- csctoken: Python ----------
#! python3
# venv: DDU_CSC
# r: requests==2.31.0
# r: numpy==1.26.4
# VERSION: 240517A

import json

import System
import Rhino
import Grasshopper

import requests

class CreateCSCConfig(Grasshopper.Kernel.GH_ScriptInstance):
    
    def __init__(self):
        # initialize props
        self.BASEURL = None
        self.TOKENURL = None
        self.USERNAME = None
        self.PASSWORD = None
        self.TOKEN = None

    def get_base_url(self):
        return self.__BASEURL

    def set_base_url(self, value):
        self.__BASEURL = value

    BASEURL = property(get_base_url, set_base_url, None, "Base URL Property")

    def get_token_url(self):
        return self.__TOKENURL

    def set_token_url(self, value):
        self.__TOKENURL = value

    TOKENURL = property(get_token_url, set_token_url, None, "Token URL Property")

    def get_user(self):
        return self.__USERNAME

    def set_user(self, value):
        self.__USERNAME = value

    USERNAME = property(get_user, set_user, None, "Username Property")

    def get_pass(self):
        return self.__PASSWORD

    def set_pass(self, value):
        self.__PASSWORD = value

    PASSWORD = property(get_pass, set_pass, None, "Password Property")

    def get_token(self):
        return self.__TOKEN

    def set_token(self, value):
        self.__TOKEN = value

    TOKEN = property(get_token, set_token, None, "Access Token Property")

    def slash_join(self, *args):
        """Joins together a bunch of strings using slashes."""
        return '/'.join(arg.strip('/') for arg in args)

    def _create_headers(self, token: str = ''):
        """
        Obtain correct headers for performing a request to FARO Component
        Repository API.
        """
        # if no token exists, we need to authenticate first
        if not token:
            token = self._fetch_access_token()
        # set header with authentication token
        return {'Authorization': f'Bearer {token}'}

    def _fetch_access_token(self,
                            tokenurl: str = '',
                            username: str = '',
                            password: str = ''):
        """
        Obtain an Access Token for the CSC Component API.
        """
        if not tokenurl:
            tokenurl = self.TOKENURL
        if not username:
            username = self.USERNAME
        if not password:
            password = self.PASSWORD
        # make authentication request
        print('[CSC-API] Obtaining authentication token...')
        response = requests.post(
            tokenurl,
            headers={'content-type': 'application/x-www-form-urlencoded'},
            data={'grant_type': 'password',
                  'username': username,
                  'password': password}
        )
        # store token during runtime
        token = response.json()['access_token']
        self.TOKEN = token
        return token

    def RunScript(self, BaseURL: str, TokenURL: str, Username: str, Password: str):
        
        BaseURL = str(BaseURL)
        TokenURL = str(TokenURL)
        Username = str(Username)
        Password = str(Password)

        self.BASEURL = BaseURL
        self.TOKENURL = TokenURL
        self.USERNAME = Username
        self.PASSWORD = Password

        Config = {
            'base_url': BaseURL,
            'token_url': TokenURL,
            'username': Username,
            'password': Password,
            'token': self._fetch_access_token()
        }

        return json.dumps(Config)
# ---------- end csctoken ----------
csc_config = Data(csctoken)

comments_notes = Panel("ADDING MATERIALS / COMPONENTS")

comonentid = Panel("")
material = ValueList({"corian", "concrete", "timber", "aluminium", "steel"}, selected="timber")
type = ValueList({"sheet", "rubble", "beam", "column", "profile"}, selected="beam")
materialthickness = Panel("12")
geometry = Data()
swatch = ColourSwatch(SwatchColor=RGB(207, 194, 126))
createcomponent = Python3Script(ComponentID=comonentid, Type=type, Material=material, Geometry=geometry, MaterialThickness=materialthickness)  # -> out, ComponentData; inputs ComponentID: String, Type: String, Material: String, Geometry: GeometryBase, MaterialThickness: Double, Color: Color
# ---------- createcomponent: Python ----------
#! python3
# venv: DDU_CSC
# r: requests==2.31.0
# r: numpy==1.26.4
# r: scipy==1.13.0
# r: scikit-learn==1.4.2
# VERSION: 240517A

import json
import uuid

import numpy as np
from scipy.spatial import ConvexHull
from sklearn.decomposition import PCA

import System
import Grasshopper
import Rhino


class CreateComponent(Grasshopper.Kernel.GH_ScriptInstance):

    def minimum_bounding_rectangle(self, points):
        # Compute the convex hull of the points
        hull = ConvexHull(points)
        hull_points = points[hull.vertices]
        # Initialize variables to keep track of the best rectangle
        min_area = float('inf')
        best_rectangle = None
        best_angle = 0
        # Loop through each edge of the convex hull
        for i in range(len(hull_points)):
            # Determine the points forming the current edge
            p1 = hull_points[i]
            p2 = hull_points[(i + 1) % len(hull_points)]
            # Calculate edge vector
            edge_vec = p2 - p1
            # Rotate the points to align this edge with the x-axis
            angle = np.arctan2(edge_vec[1], edge_vec[0])
            cos_angle = np.cos(-angle)
            sin_angle = np.sin(-angle)
            rot_matrix = np.array([[cos_angle, -sin_angle],
                                   [sin_angle, cos_angle]])
            rotated_points = np.dot(points, rot_matrix.T)
            # Compute the min/max x/y in the rotated points
            min_x = np.min(rotated_points[:, 0])
            max_x = np.max(rotated_points[:, 0])
            min_y = np.min(rotated_points[:, 1])
            max_y = np.max(rotated_points[:, 1])
            # Calculate area of the bounding rectangle
            area = (max_x - min_x) * (max_y - min_y)
            if area < min_area:
                min_area = area
                best_angle = angle
                # Create the rectangle in the rotated space
                # and then rotate it back
                best_rectangle = np.array([
                    [min_x, min_y],
                    [max_x, min_y],
                    [max_x, max_y],
                    [min_x, max_y]
                ])
                inv_rot_matrix = np.array([[cos_angle, sin_angle],
                                           [-sin_angle, cos_angle]])
                best_rectangle = np.dot(best_rectangle, inv_rot_matrix.T)
        # return results
        return best_rectangle, best_angle

    def transformation_matrix(self, rectangle, angle):
        # Compute the centroid of the rectangle
        centroid = np.mean(rectangle, axis=0)
        # Calculate translation to the origin
        translate_to_origin = np.eye(4)
        translate_to_origin[0, 3] = -centroid[0]
        translate_to_origin[1, 3] = -centroid[1]
        # Calculate rotation to align the long side with the x-axis
        rotate = np.eye(4)
        cos_angle = np.cos(-angle)
        sin_angle = np.sin(-angle)
        rotate[0, 0] = cos_angle
        rotate[0, 1] = -sin_angle
        rotate[1, 0] = sin_angle
        rotate[1, 1] = cos_angle
        # Combine transformations
        transformation = np.dot(rotate, translate_to_origin)
        return transformation

    def compute_pca_bounding_box(self, points):
        # normalize the data by subtracting the mean
        mean = np.mean(points, axis=0)
        centered_points = points - mean
        # apply PCA to find the principal axes
        pca = PCA(n_components=3)
        pca.fit(centered_points)
        # project the normalized points onto the PCA axes
        transformed_points = pca.transform(centered_points)
        # find the bounds along the principal axes
        min_bounds = np.min(transformed_points, axis=0)
        max_bounds = np.max(transformed_points, axis=0)
        # define the 8 corners of the bounding box in the PCA coordinate system
        corners = np.array([
            [min_bounds[0], min_bounds[1], min_bounds[2]],
            [max_bounds[0], min_bounds[1], min_bounds[2]],
            [max_bounds[0], max_bounds[1], min_bounds[2]],
            [min_bounds[0], max_bounds[1], min_bounds[2]],
            [min_bounds[0], min_bounds[1], max_bounds[2]],
            [max_bounds[0], min_bounds[1], max_bounds[2]],
            [max_bounds[0], max_bounds[1], max_bounds[2]],
            [min_bounds[0], max_bounds[1], max_bounds[2]]
        ])
        # calculate the transformation matrix to align
        # the PCA bounding box with the world axes
        extents = max_bounds - min_bounds
        sorted_indices = np.argsort(-extents)
        sorted_components = pca.components_[sorted_indices]
        # transformation matrix: Rotate back to align
        # with original axes, then translate to origin
        rotation_matrix = sorted_components
        transformation_matrix = np.eye(4)
        transformation_matrix[:3, :3] = rotation_matrix
        transformed_mean = rotation_matrix.dot(mean)
        transformation_matrix[:3, 3] = -transformed_mean
        transformation_matrix_inv = np.linalg.inv(transformation_matrix)
        # return results
        return (sorted_components,
                corners,
                transformation_matrix,
                transformation_matrix_inv)

    def rhino_xform(self, transformation_matrix):
        XForm = Rhino.Geometry.Transform.Identity
        XForm.M00 = transformation_matrix[0][0]
        XForm.M01 = transformation_matrix[0][1]
        XForm.M02 = transformation_matrix[0][2]
        XForm.M03 = transformation_matrix[0][3]
        XForm.M10 = transformation_matrix[1][0]
        XForm.M11 = transformation_matrix[1][1]
        XForm.M12 = transformation_matrix[1][2]
        XForm.M13 = transformation_matrix[1][3]
        XForm.M20 = transformation_matrix[2][0]
        XForm.M21 = transformation_matrix[2][1]
        XForm.M22 = transformation_matrix[2][2]
        XForm.M23 = transformation_matrix[2][3]
        return XForm

    def compute_minimum_bounds(self, geometry: Rhino.Geometry.GeometryBase):
        compute_3d = False
        # HANDLE BREP
        if isinstance(geometry, Rhino.Geometry.Brep):
            points = np.array([[p.Location.X,
                                p.Location.Y,
                                p.Location.Z] for p in Geometry.Vertices])
            compute_3d = True
        # HANDLE EXTRUSIONS
        elif isinstance(geometry, Rhino.Geometry.Extrusion):
            brep = geometry.ToBrep()
            points = np.array([[p.Location.X,
                                p.Location.Y,
                                p.Location.Z] for p in brep.Vertices])
            compute_3d = True
        # HANDLE MESH
        elif isinstance(geometry, Rhino.Geometry.Mesh):
            # get points
            points = np.array([[p.X, p.Y, p.Z] for p in geometry.Vertices])
            compute_3d = True
        # HANDLE POLYLINECURVE
        elif isinstance(geometry, Rhino.Geometry.PolylineCurve):
            pl = geometry.ToPolyline()
            atol = Rhino.RhinoDoc.ActiveDoc.ModelAbsoluteTolerance
            angtol = Rhino.RhinoDoc.ActiveDoc.ModelAngleToleranceRadians
            pl.RemoveNearlyEqualSubsequentPoints(atol)
            pl.MergeColinearSegments(angtol, True)
            pl.ReduceSegments(atol)
            points = np.array([[p.X, p.Y] for p in pl])
            compute_3d = False
        else:
            raise RuntimeError('Minimum BBX not implemented '
                               f'for geometry of type {type(Geometry)}!')
        # PROCESSING RESULTS FOR OUTPUT
        if compute_3d:
            # compute bbx
            (principal_axes,
             bbox_corners,
             transformation_matrix,
             transformation_matrix_inv) = self.compute_pca_bounding_box(points)
            # get xform
            XForm = self.rhino_xform(transformation_matrix)
            # create bbx and aligned bbx
            AlignedBBX = [Rhino.Geometry.Point3d(p[0], p[1], p[2])
                          for p in bbox_corners]
            # create aligned geometry
            AlignedGeometry = geometry
            AlignedGeometry.Transform(XForm)
        else:
            mbr, angle = self.minimum_bounding_rectangle(points)
            transformation_matrix = self.transformation_matrix(mbr, angle)
            # create rhino xform
            XForm = self.rhino_xform(transformation_matrix)
            # create aligned geometry
            AlignedGeometry = geometry
            AlignedGeometry.Transform(XForm)
            # create bbxes
            AlignedBBX = [Rhino.Geometry.Point3d(p[0], p[1], 0) for p in mbr]
            [pt.Transform(XForm) for pt in AlignedBBX]
        # return results
        return (AlignedBBX, AlignedGeometry)

    def validate_uuid(self, uuid_to_test: str, version: int = 4):
        """
        Check if uuid_to_test is a valid UUID.
        Returns True if uuid_to_test is a valid UUID, otherwise False.
        """
        try:
            uuid_obj = uuid.UUID(uuid_to_test, version=version)
        except ValueError:
            return False
        return str(uuid_obj) == uuid_to_test

    def RunScript(self,
            ComponentID: str,
            Type: str,
            Material: str,
            Geometry: Rhino.Geometry.GeometryBase,
            MaterialThickness: float,
            Color: System.Drawing.Color):
        # set up output trees and results tuple
        ComponentData = Grasshopper.DataTree[System.Object]()
        # sanitize input and abort if not present
        if not ComponentID:
            rml = ghenv.Component.RuntimeMessageLevel.Warning
            msg = 'Input ComponentID failed to collect data!'
            ghenv.Component.AddRuntimeMessage(rml, msg)
            return ComponentData
        elif not self.validate_uuid(ComponentID):
            rml = ghenv.Component.RuntimeMessageLevel.Error
            msg = 'Input ComponentID is not a valid UUID! Aborting...'
            ghenv.Component.AddRuntimeMessage(rml, msg)
            return ComponentData
        if not Type:
            rml = ghenv.Component.RuntimeMessageLevel.Warning
            msg = 'Input Type failed to collect data!'
            ghenv.Component.AddRuntimeMessage(rml, msg)
            return ComponentData
        if not Material:
            rml = ghenv.Component.RuntimeMessageLevel.Warning
            msg = 'Input Material failed to collect data!'
            ghenv.Component.AddRuntimeMessage(rml, msg)
            return ComponentData
        if not Color:
            rml = ghenv.Component.RuntimeMessageLevel.Remark
            msg = ('Input Color failed to collect data.'
                   'Will use Grey as default Color.')
            print(msg)
            ghenv.Component.AddRuntimeMessage(rml, msg)
            Color = System.Drawing.Color.FromArgb(255, 175, 175, 175)
        if not Geometry:
            rml = ghenv.Component.RuntimeMessageLevel.Warning
            msg = 'Input Geometry failed to collect data!'
            ghenv.Component.AddRuntimeMessage(rml, msg)
            return ComponentData
        elif not Geometry.IsValid:
            rml = ghenv.Component.RuntimeMessageLevel.Error
            msg = 'Input Geometry is invalid!'
            ghenv.Component.AddRuntimeMessage(rml, msg)
            return ComponentData
        # create component data dictionary
        COMPDATA = {
            '_id': ComponentID,
            'type': Type,
            'material': Material,
            'materialthickness': MaterialThickness,
            'geometry': {},
            'color': [Color.R, Color.G, Color.B],
            'validated': False,
            'bbx': {
                'xy': None,
                'xyz': None
            },
            'iframe': {
                'o': [0.0, 0.0, 0.0],
                'x': [1.0, 0.0, 0.0],
                'y': [0.0, 1.0, 0.0],
                'z': [0.0, 0.0, 1.0]
            }
        }
        # TYPE FILTERING
        if Type == 'rubble':
            if not isinstance(Geometry, Rhino.Geometry.Mesh):
                msg = ('The "rubble" type expects a Mesh as '
                    'geometry input! Please ensure and try again.')
                print(msg)
                raise ValueError(msg)
        elif Type == 'sheet':
            if not (isinstance(Geometry, Rhino.Geometry.PolylineCurve) or 
                    isinstance(Geometry, Rhino.Geometry.Polyline)):
                msg = ('The "sheet" type expects a polyline as '
                    'geometry input! Please ensure and try again.')
                print(msg)
                raise ValueError(msg)
            if not MaterialThickness:
                msg = ('The "sheet" type expects a value for '
                       '"MaterialThickness"! Please ensure and try again.')
                print(msg)
                raise ValueError(msg)
        # process geometry input
        # HANDLE POLYLINE AND POLYLINECURVE
        if (isinstance(Geometry, Rhino.Geometry.Polyline) or
            isinstance(Geometry, Rhino.Geometry.PolylineCurve)):
            bbx_xy, aligned_geometry = self.compute_minimum_bounds(Geometry)
            bbxdata = {
                'xy': [[pt.X, pt.Y] for pt in bbx_xy],
            }
            COMPDATA['bbx'].update(bbxdata)
            # create geometry dict
            polyline = [[p.X, p.Y] for p in aligned_geometry.ToPolyline()]
            comp_polyline = {
                'polyline': polyline
            }
            COMPDATA['geometry'].update(comp_polyline)
        # HANDLE MESH
        elif isinstance(Geometry, Rhino.Geometry.Mesh):
            Geometry.Faces.ConvertQuadsToTriangles()
            Geometry.Compact()
            # compute minimum bounding box
            bbx_xyz, aligned_geometry = self.compute_minimum_bounds(Geometry)
            # create bbx dict
            bbxdata = {
                'xyz': [[pt.X, pt.Y, pt.Z] for pt in bbx_xyz]
            }
            COMPDATA['bbx'].update(bbxdata)
            mt = bbx_xyz[0].DistanceTo(bbx_xyz[4])
            COMPDATA['materialthickness'] = mt
            # create geometry dict
            vertices = [[p.X, p.Y, p.Z] for p in aligned_geometry.Vertices]
            faces = [[f[0], f[1], f[2]] for f in aligned_geometry.Faces]
            comp_mesh = {
                'mesh': {
                    'v': vertices,
                    'f': faces
                }
            }
            COMPDATA['geometry'].update(comp_mesh)
        # HANDLE BREP
        elif isinstance(Geometry, Rhino.Geometry.Brep):
            raise RuntimeError('Geometry Processing for geometry of '
                               f'type {type(Geometry)} not implemented yet! '
                               'Please convert to Mesh and try again.')
        elif isinstance(Geometry, Rhino.Geometry.Extrusion):
            raise RuntimeError('Geometry Processing for geometry of '
                               f'type {type(Geometry)} not implemented yet! '
                               'Please convert to Mesh and try again.')
        else:
            raise RuntimeError('Geometry Processing for geometry of '
                               f'type {type(Geometry)} not implemented yet! '
                               'Please convert to Mesh and try again.')
        # create json string
        ComponentData = json.dumps(COMPDATA)
        # return output
        return ComponentData
# ---------- end createcomponent ----------
log = Panel(createcomponent.out)
componentdata = Data(createcomponent.ComponentData)

baseurl_2 = Panel("https://api.ddu.uber.space")
password_2 = Panel("!pioneeringDDU2024@")
tokenurl_2 = Panel("https://api.ddu.uber.space/token")
username_2 = Panel("students")
csctoken_2 = Python3Script(BaseURL=baseurl_2, TokenURL=tokenurl_2, Username=username_2, Password=password_2)  # -> Config; inputs BaseURL: String, TokenURL: String, Username: String, Password: String
# ---------- csctoken_2: Python ----------
#! python3
# venv: DDU_CSC
# r: requests==2.31.0
# r: numpy==1.26.4
# VERSION: 240517A

import json

import System
import Rhino
import Grasshopper

import requests

class CreateCSCConfig(Grasshopper.Kernel.GH_ScriptInstance):
    
    def __init__(self):
        # initialize props
        self.BASEURL = None
        self.TOKENURL = None
        self.USERNAME = None
        self.PASSWORD = None
        self.TOKEN = None

    def get_base_url(self):
        return self.__BASEURL

    def set_base_url(self, value):
        self.__BASEURL = value

    BASEURL = property(get_base_url, set_base_url, None, "Base URL Property")

    def get_token_url(self):
        return self.__TOKENURL

    def set_token_url(self, value):
        self.__TOKENURL = value

    TOKENURL = property(get_token_url, set_token_url, None, "Token URL Property")

    def get_user(self):
        return self.__USERNAME

    def set_user(self, value):
        self.__USERNAME = value

    USERNAME = property(get_user, set_user, None, "Username Property")

    def get_pass(self):
        return self.__PASSWORD

    def set_pass(self, value):
        self.__PASSWORD = value

    PASSWORD = property(get_pass, set_pass, None, "Password Property")

    def get_token(self):
        return self.__TOKEN

    def set_token(self, value):
        self.__TOKEN = value

    TOKEN = property(get_token, set_token, None, "Access Token Property")

    def slash_join(self, *args):
        """Joins together a bunch of strings using slashes."""
        return '/'.join(arg.strip('/') for arg in args)

    def _create_headers(self, token: str = ''):
        """
        Obtain correct headers for performing a request to FARO Component
        Repository API.
        """
        # if no token exists, we need to authenticate first
        if not token:
            token = self._fetch_access_token()
        # set header with authentication token
        return {'Authorization': f'Bearer {token}'}

    def _fetch_access_token(self,
                            tokenurl: str = '',
                            username: str = '',
                            password: str = ''):
        """
        Obtain an Access Token for the CSC Component API.
        """
        if not tokenurl:
            tokenurl = self.TOKENURL
        if not username:
            username = self.USERNAME
        if not password:
            password = self.PASSWORD
        # make authentication request
        print('[CSC-API] Obtaining authentication token...')
        response = requests.post(
            tokenurl,
            headers={'content-type': 'application/x-www-form-urlencoded'},
            data={'grant_type': 'password',
                  'username': username,
                  'password': password}
        )
        # store token during runtime
        token = response.json()['access_token']
        self.TOKEN = token
        return token

    def RunScript(self, BaseURL: str, TokenURL: str, Username: str, Password: str):
        
        BaseURL = str(BaseURL)
        TokenURL = str(TokenURL)
        Username = str(Username)
        Password = str(Password)

        self.BASEURL = BaseURL
        self.TOKENURL = TokenURL
        self.USERNAME = Username
        self.PASSWORD = Password

        config = {
            'base_url': BaseURL,
            'token_url': TokenURL,
            'username': Username,
            'password': Password,
            'token': self._fetch_access_token()
        }

        return json.dumps(config)
# ---------- end csctoken_2 ----------
csc_config_2 = Data(csctoken_2)

baseurl_3 = Panel("https://api.ddu.uber.space")
password_3 = Panel("!ddu2024@")
tokenurl_3 = Panel("https://api.ddu.uber.space/token")
username_3 = Panel("ddu")
csctoken_3 = Python3Script(BaseURL=baseurl_3, TokenURL=tokenurl_3, Username=username_3, Password=password_3)  # -> Config; inputs BaseURL: String, TokenURL: String, Username: String, Password: String
# ---------- csctoken_3: Python ----------
#! python3
# venv: DDU_CSC
# r: requests, numpy
# VERSION: 240506A

import json

import System
import Rhino
import Grasshopper

import requests

class CreateCSCConfig(Grasshopper.Kernel.GH_ScriptInstance):
    
    def __init__(self):
        # initialize props
        self.BASEURL = None
        self.TOKENURL = None
        self.USERNAME = None
        self.PASSWORD = None
        self.TOKEN = None

    def get_base_url(self):
        return self.__BASEURL

    def set_base_url(self, value):
        self.__BASEURL = value

    BASEURL = property(get_base_url, set_base_url, None, "Base URL Property")

    def get_token_url(self):
        return self.__TOKENURL

    def set_token_url(self, value):
        self.__TOKENURL = value

    TOKENURL = property(get_token_url, set_token_url, None, "Token URL Property")

    def get_user(self):
        return self.__USERNAME

    def set_user(self, value):
        self.__USERNAME = value

    USERNAME = property(get_user, set_user, None, "Username Property")

    def get_pass(self):
        return self.__PASSWORD

    def set_pass(self, value):
        self.__PASSWORD = value

    PASSWORD = property(get_pass, set_pass, None, "Password Property")

    def get_token(self):
        return self.__TOKEN

    def set_token(self, value):
        self.__TOKEN = value

    TOKEN = property(get_token, set_token, None, "Access Token Property")

    def slash_join(self, *args):
        """Joins together a bunch of strings using slashes."""
        return '/'.join(arg.strip('/') for arg in args)

    def _create_headers(self, token: str = ''):
        """
        Obtain correct headers for performing a request to FARO Component
        Repository API.
        """
        # if no token exists, we need to authenticate first
        if not token:
            token = self._fetch_access_token()
        # set header with authentication token
        return {'Authorization': f'Bearer {token}'}

    def _fetch_access_token(self,
                            tokenurl: str = '',
                            username: str = '',
                            password: str = ''):
        """
        Obtain an Access Token for the CSC Component API.
        """
        if not tokenurl:
            tokenurl = self.TOKENURL
        if not username:
            username = self.USERNAME
        if not password:
            password = self.PASSWORD
        # make authentication request
        print('[CSC-API] Obtaining authentication token...')
        response = requests.post(
            tokenurl,
            headers={'content-type': 'application/x-www-form-urlencoded'},
            data={'grant_type': 'password',
                  'username': username,
                  'password': password}
        )
        # store token during runtime
        token = response.json()['access_token']
        self.TOKEN = token
        return token

    def RunScript(self, BaseURL: str, TokenURL: str, Username: str, Password: str):
        
        BaseURL = str(BaseURL)
        TokenURL = str(TokenURL)
        Username = str(Username)
        Password = str(Password)

        self.BASEURL = BaseURL
        self.TOKENURL = TokenURL
        self.USERNAME = Username
        self.PASSWORD = Password

        Config = {
            'base_url': BaseURL,
            'token_url': TokenURL,
            'username': Username,
            'password': Password,
            'token': self._fetch_access_token()
        }

        return json.dumps(Config)
# ---------- end csctoken_3 ----------
csc_config_3 = Data(csctoken_3)

# ----
# comments & notes: Get Components from Rhino Document
button = Button()
syncwithrhinodoc = Python3Script(Sync=button)  # -> out, DocumentComponents; inputs Sync: Boolean
# ---------- syncwithrhinodoc: Python ----------
#! python3
# venv: DDU_CSC
# r: requests==2.31.0
# r: numpy==1.26.4
# VERSION: 240517A

import json

import System
import Rhino
import Grasshopper
import rhinoscriptsyntax as rs
import scriptcontext as sc


class SyncWithRhinoDoc(Grasshopper.Kernel.GH_ScriptInstance):

    LAST_SYNC = Grasshopper.DataTree[object]()

    def RunScript(self, Sync: bool):
        # set sc doc to rhino doc
        sc.doc = Rhino.RhinoDoc.ActiveDoc

        if Sync:
            lay_parent = 'CSC_COMPONENTS'
            self.LAST_SYNC = Grasshopper.DataTree[object]()
            # get layers
            if rs.IsLayer(lay_parent):
                comp_lays = rs.LayerChildren(lay_parent)
                # loop over all layers
                for i, lay in enumerate(comp_lays):
                    ghp = Grasshopper.Kernel.Data.GH_Path(i)
                    # retrieve objects on layer
                    objects = rs.ObjectsByLayer(lay)
                    for o in objects:
                        if rs.IsText(o):
                            tagplane = rs.coercegeometry(o).Plane
                            tagframe = {
                                'o': [tagplane.OriginX,
                                      tagplane.OriginY,
                                      tagplane.OriginZ],
                                'x': [tagplane.XAxis.X,
                                      tagplane.XAxis.Y,
                                      tagplane.XAxis.Z],
                                'y': [tagplane.YAxis.X,
                                      tagplane.YAxis.Y,
                                      tagplane.YAxis.Z],
                                'z': [tagplane.ZAxis.X,
                                      tagplane.ZAxis.Y,
                                      tagplane.ZAxis.Z]
                            }
                            data = rs.GetUserText(o, 'componentdata')
                            data_obj = json.loads(data)
                            data_obj['iframe'].update(tagframe)
                            data = json.dumps(data_obj)
                            self.LAST_SYNC.Add(data, ghp)
        if self.LAST_SYNC.DataCount < 1:
            rml = ghenv.Component.RuntimeMessageLevel.Warning
            msg = 'Document out of Sync or no Components in Document!'
            print(msg)
            ghenv.Component.AddRuntimeMessage(rml, msg)
        
        sc.doc = ghdoc
        return self.LAST_SYNC
# ---------- end syncwithrhinodoc ----------
log_2 = Panel(syncwithrhinodoc.out)

minbbx = Python3Script()  # -> out, AlignedGeometry, Frame, XForm, WorldBBX, AlignedBBX; inputs Geometry: GeometryBase; disabled
# ---------- minbbx: Python ----------
#! python3
# venv: DDU_CSC
# r: requests==2.31.0
# r: numpy==1.26.4
# r: scipy==1.13.0
# r: scikit-learn==1.4.2
# VERSION: 240517A

import numpy as np
from scipy.spatial import ConvexHull
from sklearn.decomposition import PCA

import System
import Rhino
import Grasshopper
import rhinoscriptsyntax as rs


class MinBBX(Grasshopper.Kernel.GH_ScriptInstance):

    def minimum_bounding_rectangle(self, points):
        # Compute the convex hull of the points
        hull = ConvexHull(points)
        hull_points = points[hull.vertices]
        # Initialize variables to keep track of the best rectangle
        min_area = float('inf')
        best_rectangle = None
        best_angle = 0
        # Loop through each edge of the convex hull
        for i in range(len(hull_points)):
            # Determine the points forming the current edge
            p1 = hull_points[i]
            p2 = hull_points[(i + 1) % len(hull_points)]
            # Calculate edge vector
            edge_vec = p2 - p1
            # Rotate the points to align this edge with the x-axis
            angle = np.arctan2(edge_vec[1], edge_vec[0])
            cos_angle = np.cos(-angle)
            sin_angle = np.sin(-angle)
            rot_matrix = np.array([[cos_angle, -sin_angle], [sin_angle, cos_angle]])
            rotated_points = np.dot(points, rot_matrix.T)
            # Compute the min/max x/y in the rotated points
            min_x = np.min(rotated_points[:, 0])
            max_x = np.max(rotated_points[:, 0])
            min_y = np.min(rotated_points[:, 1])
            max_y = np.max(rotated_points[:, 1])
            # Calculate area of the bounding rectangle
            area = (max_x - min_x) * (max_y - min_y)
            if area < min_area:
                min_area = area
                best_angle = angle
                # Create the rectangle in the rotated space and then rotate it back
                best_rectangle = np.array([
                    [min_x, min_y],
                    [max_x, min_y],
                    [max_x, max_y],
                    [min_x, max_y]
                ])
                inv_rot_matrix = np.array([[cos_angle, sin_angle], [-sin_angle, cos_angle]])
                best_rectangle = np.dot(best_rectangle, inv_rot_matrix.T)
        # return results
        return best_rectangle, best_angle

    def transformation_matrix(self, rectangle, angle):
        # Compute the centroid of the rectangle
        centroid = np.mean(rectangle, axis=0)
        # Calculate translation to the origin
        translate_to_origin = np.eye(4)
        translate_to_origin[0, 3] = -centroid[0]
        translate_to_origin[1, 3] = -centroid[1]
        # Calculate rotation to align the long side with the x-axis
        rotate = np.eye(4)
        cos_angle = np.cos(-angle)
        sin_angle = np.sin(-angle)
        rotate[0, 0] = cos_angle
        rotate[0, 1] = -sin_angle
        rotate[1, 0] = sin_angle
        rotate[1, 1] = cos_angle
        # Combine transformations
        transformation = np.dot(rotate, translate_to_origin)
        return transformation

    def apply_transformation(self, points, transform_matrix):
        # Extend 2D points to 4D homogeneous coordinates
        homogeneous_points = np.hstack([points, np.ones((points.shape[0], 1)), np.zeros((points.shape[0], 1))])
        # Multiply the points by the transformation matrix
        transformed_points = np.dot(homogeneous_points, transform_matrix.T)
        # Return the transformed points, discarding the homogeneous coordinate
        return transformed_points[:, :2]


    def compute_pca_bounding_box(self, points):
        # normalize the data by subtracting the mean
        mean = np.mean(points, axis=0)
        centered_points = points - mean
        # apply PCA to find the principal axes
        pca = PCA(n_components=3)
        pca.fit(centered_points)
        # project the normalized points onto the PCA axes
        transformed_points = pca.transform(centered_points)
        # find the bounds along the principal axes
        min_bounds = np.min(transformed_points, axis=0)
        max_bounds = np.max(transformed_points, axis=0)
        # define the 8 corners of the bounding box in the PCA coordinate system
        corners = np.array([
            [min_bounds[0], min_bounds[1], min_bounds[2]],
            [max_bounds[0], min_bounds[1], min_bounds[2]],
            [max_bounds[0], max_bounds[1], min_bounds[2]],
            [min_bounds[0], max_bounds[1], min_bounds[2]],
            [min_bounds[0], min_bounds[1], max_bounds[2]],
            [max_bounds[0], min_bounds[1], max_bounds[2]],
            [max_bounds[0], max_bounds[1], max_bounds[2]],
            [min_bounds[0], max_bounds[1], max_bounds[2]]
        ])
        # calculate the transformation matrix to align the PCA bounding box with the world axes
        extents = max_bounds - min_bounds
        sorted_indices = np.argsort(-extents)
        sorted_components = pca.components_[sorted_indices]
        # transformation matrix: Rotate back to align with original axes, then translate to origin
        rotation_matrix = sorted_components
        transformation_matrix = np.eye(4)
        transformation_matrix[:3, :3] = rotation_matrix
        transformed_mean = rotation_matrix.dot(mean)
        transformation_matrix[:3, 3] = -transformed_mean
        transformation_matrix_inv = np.linalg.inv(transformation_matrix)
        # return results
        return sorted_components, corners, transformation_matrix, transformation_matrix_inv

    def rhino_xform(self, transformation_matrix):
        XForm = Rhino.Geometry.Transform.Identity
        XForm.M00 = transformation_matrix[0][0]
        XForm.M01 = transformation_matrix[0][1]
        XForm.M02 = transformation_matrix[0][2]
        XForm.M03 = transformation_matrix[0][3]
        XForm.M10 = transformation_matrix[1][0]
        XForm.M11 = transformation_matrix[1][1]
        XForm.M12 = transformation_matrix[1][2]
        XForm.M13 = transformation_matrix[1][3]
        XForm.M20 = transformation_matrix[2][0]
        XForm.M21 = transformation_matrix[2][1]
        XForm.M22 = transformation_matrix[2][2]
        XForm.M23 = transformation_matrix[2][3]
        return XForm

    def RunScript(self, Geometry: Rhino.Geometry.GeometryBase):
        # create empty outputs
        AlignedGeometry = Grasshopper.DataTree[object]()
        Frame = Grasshopper.DataTree[object]()
        XForm = Grasshopper.DataTree[object]()
        WorldBBX = Grasshopper.DataTree[object]()
        AlignedBBX = Grasshopper.DataTree[object]()
        # sanitize input
        if not Geometry:
            rml = ghenv.Component.RuntimeMessageLevel.Warning
            msg = 'Input Geometry failed to collect data!'
            ghenv.Component.AddRuntimeMessage(rml, msg)
            return (AlignedGeometry, Frame, XForm, WorldBBX, AlignedBBX)

        compute_3d = False
        # HANDLE BREP
        if isinstance(Geometry, Rhino.Geometry.Brep):
            points = np.array([[p.Location.X, p.Location.Y, p.Location.Z] for p in Geometry.Vertices])
            compute_3d = True
        # HANDLE EXTRUSIONS
        elif isinstance(Geometry, Rhino.Geometry.Extrusion):
            brep = Geometry.ToBrep()
            points = np.array([[p.Location.X, p.Location.Y, p.Location.Z] for p in brep.Vertices])
            compute_3d = True
        # HANDLE MESH
        elif isinstance(Geometry, Rhino.Geometry.Mesh):
            # get points
            points = np.array([[p.X, p.Y, p.Z] for p in Geometry.Vertices])
            compute_3d = True
        # HANDLE POLYLINECURVE
        elif isinstance(Geometry, Rhino.Geometry.PolylineCurve):
            pl = Geometry.ToPolyline()
            pl.RemoveNearlyEqualSubsequentPoints(Rhino.RhinoDoc.ActiveDoc.ModelAbsoluteTolerance)
            pl.MergeColinearSegments(Rhino.RhinoDoc.ActiveDoc.ModelAngleToleranceRadians, True)
            pl.ReduceSegments(Rhino.RhinoDoc.ActiveDoc.ModelAbsoluteTolerance)
            points = np.array([[p.X, p.Y] for p in pl])
            compute_3d = False
        else:
            raise RuntimeError(f'Minimum BBX not implemented for geometry of type {type(Geometry)}!')

        # PROCESSING RESULTS FOR OUTPUT
        if compute_3d:
            # compute bbx
            (principal_axes,
             bbox_corners,
             transformation_matrix,
             transformation_matrix_inv) = self.compute_pca_bounding_box(points)
            # get xform
            XForm = self.rhino_xform(transformation_matrix)
            iXForm = self.rhino_xform(transformation_matrix_inv)
            # create frame
            Frame = Rhino.Geometry.Plane(
                Rhino.Geometry.Point3d(0, 0, 0),
                Rhino.Geometry.Vector3d(principal_axes[0][0],
                                        principal_axes[0][1],
                                        principal_axes[0][2]),
                Rhino.Geometry.Vector3d(principal_axes[1][0],
                                        principal_axes[1][1],
                                        principal_axes[1][2])
            )
            # create bbx and aligned bbx
            AlignedBBX = [Rhino.Geometry.Point3d(p[0], p[1], p[2]) for p in bbox_corners]
            WorldBBX = [Rhino.Geometry.Point3d(pt) for pt in AlignedBBX]
            [p.Transform(iXForm) for p in WorldBBX]
            # create aligned geometry
            AlignedGeometry = Geometry
            AlignedGeometry.Transform(XForm)
        else:
            mbr, angle = self.minimum_bounding_rectangle(points)
            transformation_matrix = self.transformation_matrix(mbr, angle)
            # create rhino xform
            XForm = self.rhino_xform(transformation_matrix)
            # create aligned geometry
            AlignedGeometry = Geometry
            AlignedGeometry.Transform(XForm)
            # create bbxes
            AlignedBBX = [Rhino.Geometry.Point3d(p[0], p[1], 0) for p in mbr]
            [pt.Transform(XForm) for pt in AlignedBBX]
            WorldBBX = [Rhino.Geometry.Point3d(p[0], p[1], 0) for p in mbr]

        return (AlignedGeometry, Frame, XForm, WorldBBX, AlignedBBX)
# ---------- end minbbx ----------

# ----
# comments & notes: Fetch a single component from the database
comonentid_2 = Panel("1d40d3ea-61b7-4504-a708-0ad21d33d945")
csc_config_4 = Data(csc_config)
fetchcomponent = Python3Script(Config=csc_config_4, ComponentID=comonentid_2)  # -> out, ComponentData; inputs Config: String, ComponentID: list of String
# ---------- fetchcomponent: Python ----------
#! python3
# venv: DDU_CSC
# r: requests==2.31.0
# r: numpy==1.26.4
# VERSION: 240517A

import json
import uuid

import requests

import System
import Grasshopper
import Rhino


class FetchComponent(Grasshopper.Kernel.GH_ScriptInstance):

    def __init__(self):
        # initialize props
        self.TOKEN = None

    def get_token(self):
        return self.__TOKEN

    def set_token(self, value):
        self.__TOKEN = value

    TOKEN = property(get_token, set_token, None, "Access Token Property")

    def slash_join(self, *args):
        """Joins together a bunch of strings using slashes."""
        return '/'.join(arg.strip('/') for arg in args)

    def _create_headers(self, token: str = ''):
        """
        Obtain correct headers for performing a request to FARO Component
        Repository API.
        """
        # if no token exists, we need to authenticate first
        if not token:
            token = self.TOKEN
        # set header with authentication token
        return {'Authorization': f'Bearer {token}'}

    def _make_request(self,
                      method: str,
                      endpoint: str,
                      params=None,
                      data=None):
        """
        Perform a request to the API
        """
        # create correct url
        url = self.slash_join(self.BASEURL, endpoint)
        # set header with authentication token
        headers = self._create_headers(token=self.TOKEN)
        # perform request
        print(f'[CSC-API] Performing {method} request using token...')
        response = requests.request(method=method,
                                    url=url,
                                    params=params,
                                    data=data,
                                    headers=headers)
        # if response has status code for Unauthorized request,
        # get new token and try again one time
        if response.status_code == 401:
            print('[CSC-API] Request failed, retrying...')
            headers = self._create_headers(token='')
            response = requests.request(method=method,
                                        url=url,
                                        params=params,
                                        data=data,
                                        headers=headers)
            if response.status_code != 200:
                raise RuntimeError(f'Request failed with status code {response.status_code}')
        return response

    def validate_uuid(self, uuid_to_test: str, version: int = 4):
        """
        Check if uuid_to_test is a valid UUID.
        Returns True if uuid_to_test is a valid UUID, otherwise False.
        """
        try:
            uuid_obj = uuid.UUID(uuid_to_test, version=version)
        except ValueError:
            return False
        return str(uuid_obj) == uuid_to_test

    def RunScript(self,
            Config: str,
            ComponentID: System.Collections.Generic.List[str]):
        # set up output trees and results tuple
        ComponentData = Grasshopper.DataTree[System.Object]()
        __Results = (
            ComponentData)
        # sanitize input and abort if not present
        if not Config:
            rml = ghenv.Component.RuntimeMessageLevel.Warning
            msg = 'Input Config failed to collect data!'
            ghenv.Component.AddRuntimeMessage(rml, msg)
            return __Results
        else:
            Config = str(Config)
            config_data = json.loads(Config)
            self.BASEURL = config_data['base_url']
            self.TOKEN = config_data['token']
        if not ComponentID:
            rml = ghenv.Component.RuntimeMessageLevel.Warning
            msg = 'Input ComponentID failed to collect data!'
            ghenv.Component.AddRuntimeMessage(rml, msg)
            return __Results
        
        ComponentID = list(ComponentID)
        for _id in ComponentID:
            if not  self.validate_uuid(_id):
                rml = ghenv.Component.RuntimeMessageLevel.Warning
                msg = f'ComponentID <{_id}> is not a valid UUID!'
                ghenv.Component.AddRuntimeMessage(rml, msg)
                return __Results

        for _id in ComponentID:
            # set endpoint
            endpoint = f'components/{_id}'
            # perform request
            response = self._make_request('GET', endpoint)
            # convert response to json data
            json_comp = response.json()
            print(f'[CSC-API] Found component {_id} on server.')
            # create datatree path
            ghp = Grasshopper.Kernel.Data.GH_Path(0)
            # add all things to the respective datatrees
            ComponentData.Add(json.dumps(json_comp), ghp)
        
        # return output trees
        return __Results
# ---------- end fetchcomponent ----------
log_3 = Panel(fetchcomponent.out)
componentdata_2 = Data(fetchcomponent.ComponentData)

# ----
# comments & notes: Fetch all components from the database
csc_config_5 = Data(csc_config)
fetchallcomponents = Python3Script(Config=csc_config_5)  # -> out, ComponentData; inputs Config: String
# ---------- fetchallcomponents: Python ----------
#! python3
# venv: DDU_CSC
# r: requests==2.31.0
# r: numpy==1.26.4
# VERSION: 240517A

import json

import requests

import System
import Grasshopper
import Rhino


class FetchAllComponents(Grasshopper.Kernel.GH_ScriptInstance):

    def __init__(self):
        # initialize props
        self.TOKEN = None

    def get_token(self):
        return self.__TOKEN

    def set_token(self, value):
        self.__TOKEN = value

    TOKEN = property(get_token, set_token, None, "Access Token Property")

    def slash_join(self, *args):
        """Joins together a bunch of strings using slashes."""
        return '/'.join(arg.strip('/') for arg in args)

    def _create_headers(self, token: str = ''):
        """
        Obtain correct headers for performing a request to FARO Component
        Repository API.
        """
        # if no token exists, we need to authenticate first
        if not token:
            token = self.TOKEN
        # set header with authentication token
        return {'Authorization': f'Bearer {token}'}

    def _make_request(self,
                      method: str,
                      endpoint: str,
                      params=None,
                      data=None):
        """
        Perform a request to the API
        """
        # create correct url
        url = self.slash_join(self.BASEURL, endpoint)
        # set header with authentication token
        headers = self._create_headers(token=self.TOKEN)
        # perform request
        print(f'[CSC-API] Performing {method} request using token...')
        response = requests.request(method=method,
                                    url=url,
                                    params=params,
                                    data=data,
                                    headers=headers)
        # if response has status code for Unauthorized request,
        # get new token and try again one time
        if response.status_code == 401:
            print('[CSC-API] Request failed, retrying...')
            headers = self._create_headers(token='')
            response = requests.request(method=method,
                                        url=url,
                                        params=params,
                                        data=data,
                                        headers=headers)
            if response.status_code != 200:
                msg = ('Request failed with status '
                       f'code {response.status_code}! Please '
                       'recompute "Config" component to '
                       'acquire new auth token.')
                print(msg)
                raise RuntimeError(msg)
        return response

    def RunScript(self, Config: str):
        # set up output trees and results tuple
        ComponentData = Grasshopper.DataTree[System.Object]()
        __Results = (ComponentData)
        # sanitize input and abort if not present
        if not Config:
            rml = ghenv.Component.RuntimeMessageLevel.Warning
            msg = 'Input CSCToken failed to collect data!'
            ghenv.Component.AddRuntimeMessage(rml, msg)
            return __Results
        else:
            Config = str(Config)
            config_data = json.loads(Config)
            self.BASEURL = config_data['base_url']
            self.TOKEN = config_data['token']
        # set endpoint
        endpoint = 'components'
        # perform request
        response = self._make_request('GET', endpoint)
        # convert response to json data
        json_comps = response.json()
        print(f'[CSC-API] Found {len(json_comps)} components on server.')
        # loop over all components and disassemble them
        for i, json_comp in enumerate(json_comps):
            # create datatree path
            ghp = Grasshopper.Kernel.Data.GH_Path(i)
            # add all things to the respective datatrees
            ComponentData.Add(json.dumps(json_comp), ghp)
        # return output trees
        return __Results
# ---------- end fetchallcomponents ----------
log_4 = Panel(fetchallcomponents.out)
componentdata_3 = Data(fetchallcomponents.ComponentData)

# ----
# comments & notes: Disassemble Component into its elements
componentdata_4 = Data(syncwithrhinodoc.DocumentComponents)
disassemblecomponent = Python3Script(ComponentData=componentdata_4)  # -> out, ID, Type, Material, Geometry, MaterialThickness, Color, BBX2D, BBX3D; inputs ComponentData: tree of String
# ---------- disassemblecomponent: Python ----------
#! python3
# venv: DDU_CSC
# r: requests==2.31.0
# r: numpy==1.26.4
# VERSION: 240517A

import json

import System
import Rhino
import Grasshopper

import rhinoscriptsyntax as rs


class DisassembleComponent(Grasshopper.Kernel.GH_ScriptInstance):

    def ComponentPolyline(self, jcomp: dict) -> Rhino.Geometry.Polyline:
        pl = Rhino.Geometry.Polyline()
        pts = [Rhino.Geometry.Point3d(pt[0], pt[1], 0.0)
               for pt in jcomp['geometry']['polyline']]
        pl.AddRange(pts)
        return pl

    def ComponentPolylineExtrusion(
            self,
            jcomp: dict) -> Rhino.Geometry.Extrusion:
        pl = Rhino.Geometry.Polyline()
        pts = [Rhino.Geometry.Point3d(pt[0], pt[1], 0.0)
               for pt in jcomp['geometry']['polyline']]
        pl.AddRange(pts)
        cxt = Rhino.Geometry.Extrusion.Create(
            pl.ToPolylineCurve(),
            Rhino.Geometry.Plane.WorldXY,
            jcomp['materialthickness'],
            True)
        return cxt

    def ComponentMesh(self, jcomp: dict) -> Rhino.Geometry.Mesh:
        mesh = Rhino.Geometry.Mesh()
        vl = jcomp['geometry']['mesh']['v']
        fl = jcomp['geometry']['mesh']['f']
        [mesh.Vertices.Add(*v) for v in vl]
        [mesh.Faces.AddFace(*f) for f in fl]
        mesh.RebuildNormals()
        mesh.UnifyNormals()
        mesh.Compact()
        return mesh

    def ComponentColor(self, jcomp: dict) -> System.Drawing.Color:
        return System.Drawing.Color.FromArgb(255, *jcomp['color'])

    def RunScript(self, ComponentData: Grasshopper.DataTree[str]):
        # set up output trees and results tuple
        ID = Grasshopper.DataTree[System.Object]()
        Type = Grasshopper.DataTree[System.Object]()
        Material = Grasshopper.DataTree[System.Object]()
        Geometry = Grasshopper.DataTree[System.Object]()
        MaterialThickness = Grasshopper.DataTree[System.Object]()
        Color = Grasshopper.DataTree[System.Object]()
        BBX2D = Grasshopper.DataTree[System.Object]()
        BBX3D = Grasshopper.DataTree[System.Object]()
        __Results = (
            ID,
            Type,
            Material,
            Geometry,
            MaterialThickness,
            Color,
            BBX2D,
            BBX3D)
        # loop over all branches
        for i in range(ComponentData.BranchCount):
            for j, comp in enumerate(ComponentData.Branches[i]):
                jcomp = json.loads(comp)
                # create datatree path
                ghp = ComponentData.Paths[i]
                # add all things to the respective datatrees
                ID.Add(jcomp['_id'], ghp)
                Type.Add(jcomp['type'], ghp)
                Material.Add(jcomp['material'], ghp)
                # process insertion frame
                try:
                    iframe = jcomp['iframe']
                    iplane = Rhino.Geometry.Plane(
                        Rhino.Geometry.Point3d(*iframe['o']),
                        Rhino.Geometry.Vector3d(*iframe['x']),
                        Rhino.Geometry.Vector3d(*iframe['y']),
                    )
                except KeyError:
                    iplane = Rhino.Geometry.Plane.WorldXY
                xform = Rhino.Geometry.Transform.PlaneToPlane(
                    Rhino.Geometry.Plane.WorldXY,
                    iplane)
                # treat geometry key in a special way because
                # it may hold mutiple geometry types
                for key in sorted(jcomp['geometry'].keys()):
                    if key == 'polyline':
                        pl = self.ComponentPolyline(jcomp)
                        # transform to iframe
                        pl.Transform(xform)
                        Geometry.Add(pl, ghp)
                    elif key == 'mesh':
                        mesh = self.ComponentMesh(jcomp)
                        # transform to iframe
                        mesh.Transform(xform)
                        Geometry.Add(mesh, ghp)
                    else:
                        raise RuntimeError('Missing implementation '
                                           f'for geometry of type "{key}"!')
                MaterialThickness.Add(jcomp['materialthickness'], ghp)
                # create system color from rgb values
                color = self.ComponentColor(jcomp)
                Color.Add(color, ghp)
                # construct bbxes
                if jcomp['bbx']['xy']:
                    bbx = Rhino.Geometry.Polyline()
                    bbx.AddRange([Rhino.Geometry.Point3d(
                        float(pt[0]),
                        float(pt[1]),
                        0.0) for pt in jcomp['bbx']['xy']])
                    bbx.Add(bbx[0])
                    # apply iframe trnsform
                    bbx.Transform(xform)
                    BBX2D.Add(bbx, ghp)
                if jcomp['bbx']['xyz']:
                    minpt = jcomp['bbx']['xyz'][0]
                    maxpt = jcomp['bbx']['xyz'][6]
                    bbx = Rhino.Geometry.BoundingBox(
                        Rhino.Geometry.Point3d(*minpt),
                        Rhino.Geometry.Point3d(*maxpt))
                    # apply iframe trnsform
                    bbx.Transform(xform)
                    BBX3D.Add(bbx, ghp)
        # return output trees
        return __Results
# ---------- end disassemblecomponent ----------
output_stream = Panel(disassemblecomponent.out)
materialthickness_2 = Data(disassemblecomponent.MaterialThickness)
geometry_2 = Data(disassemblecomponent.Geometry)
id = Data(disassemblecomponent.ID)
color = Data(disassemblecomponent.Color)
bbx2d = Data(disassemblecomponent.BBX2D)

csc_config_6 = Data(csc_config_3)
fetchallunvalidatedcomponents = Python3Script(Config=csc_config_6)  # -> out, ComponentData; inputs Config: String
# ---------- fetchallunvalidatedcomponents: Python ----------
#! python3
# venv: DDU_CSC
# r: requests==2.31.0
# VERSION: 240517A

import json

import requests

import System
import Grasshopper
import Rhino


class FetchAllUnvalidatedComponents(Grasshopper.Kernel.GH_ScriptInstance):

    def __init__(self):
        # initialize props
        self.TOKEN = None

    def get_token(self):
        return self.__TOKEN

    def set_token(self, value):
        self.__TOKEN = value

    TOKEN = property(get_token, set_token, None, "Access Token Property")

    def slash_join(self, *args):
        """Joins together a bunch of strings using slashes."""
        return '/'.join(arg.strip('/') for arg in args)

    def _create_headers(self, token: str = ''):
        """
        Obtain correct headers for performing a request to FARO Component
        Repository API.
        """
        # if no token exists, we need to authenticate first
        if not token:
            token = self.TOKEN
        # set header with authentication token
        return {'Authorization': f'Bearer {token}'}

    def _make_request(self,
                      method: str,
                      endpoint: str,
                      params=None,
                      data=None):
        """
        Perform a request to the API
        """
        # create correct url
        url = self.slash_join(self.BASEURL, endpoint)
        # set header with authentication token
        headers = self._create_headers(token=self.TOKEN)
        # perform request
        print(f'[CSC-API] Performing {method} request using token...')
        response = requests.request(method=method,
                                    url=url,
                                    params=params,
                                    data=data,
                                    headers=headers)
        # if response has status code for Unauthorized request,
        # get new token and try again one time
        if response.status_code == 401:
            print('[CSC-API] Request failed, retrying...')
            headers = self._create_headers(token='')
            response = requests.request(method=method,
                                        url=url,
                                        params=params,
                                        data=data,
                                        headers=headers)
            if response.status_code != 200:
                raise RuntimeError(f'Request failed with status code {response.status_code}')
        return response

    def RunScript(self, Config: str):
        # set up output trees and results tuple
        ComponentData = Grasshopper.DataTree[System.Object]()
        __Results = (ComponentData)
        # sanitize input and abort if not present
        if not Config:
            rml = ghenv.Component.RuntimeMessageLevel.Warning
            msg = 'Input CSCToken failed to collect data!'
            ghenv.Component.AddRuntimeMessage(rml, msg)
            return __Results
        else:
            config_data = json.loads(Config)
            self.BASEURL = config_data['base_url']
            self.TOKEN = config_data['token']
        # set endpoint
        endpoint = 'components?validated=-1'
        # perform request
        response = self._make_request('GET', endpoint)
        # convert response to json data
        json_comps = response.json()
        print(f'[CSC-API] Found {len(json_comps)} components on server.')
        # loop over all components and disassemble them
        for i, json_comp in enumerate(json_comps):
            # create datatree path
            ghp = Grasshopper.Kernel.Data.GH_Path(i)
            # add all things to the respective datatrees
            ComponentData.Add(json.dumps(json_comp), ghp)
        # return output trees
        return __Results
# ---------- end fetchallunvalidatedcomponents ----------
log_5 = Panel(fetchallunvalidatedcomponents.out)
componentdata_5 = Data(fetchallunvalidatedcomponents.ComponentData)

componentdata_6 = Data(componentdata)
csc_config_7 = Data(csc_config_2)
addcomponent = Python3Script(Config=csc_config_7, ComponentData=componentdata_6, Run=Button())  # -> out, AddedComponentData; inputs Config: String, ComponentData: String, Run: Boolean
# ---------- addcomponent: Python ----------
#! python3
# venv: DDU_CSC
# r: requests==2.31.0
# r: numpy==1.26.4
# VERSION: 240517A

import json
import uuid
from pprint import pprint

import requests

import System
import Grasshopper
import Rhino


class AddComponent(Grasshopper.Kernel.GH_ScriptInstance):

    def __init__(self):
        # initialize props
        self.TOKEN = None

    def get_token(self):
        return self.__TOKEN

    def set_token(self, value):
        self.__TOKEN = value

    TOKEN = property(get_token, set_token, None, "Access Token Property")

    def slash_join(self, *args):
        """Joins together a bunch of strings using slashes."""
        return '/'.join(arg.strip('/') for arg in args)

    def _create_headers(self, token: str = ''):
        """
        Obtain correct headers for performing a request to FARO Component
        Repository API.
        """
        # if no token exists, we need to authenticate first
        if not token:
            token = self.TOKEN
        # set header with authentication token
        return {'Authorization': f'Bearer {token}'}

    def _make_request(self,
                      method: str,
                      endpoint: str,
                      params=None,
                      data=None):
        """
        Perform a request to the API
        """
        # create correct url
        url = self.slash_join(self.BASEURL, endpoint)
        # set header with authentication token
        headers = self._create_headers(token=self.TOKEN)
        # perform request
        print(f'[CSC-API] Performing {method} request using token...')
        response = requests.request(method=method,
                                    url=url,
                                    params=params,
                                    data=data,
                                    headers=headers)
        # if response has status code for Unauthorized request,
        # get new token and try again one time
        if response.status_code == 401:
            print('[CSC-API] Request failed, retrying...')
            headers = self._create_headers(token='')
            response = requests.request(method=method,
                                        url=url,
                                        params=params,
                                        data=data,
                                        headers=headers)
            if response.status_code != 200:
                raise RuntimeError(f'Request failed with status code {response.status_code}')
        return response

    def RunScript(self, Config: str, ComponentData: str, Run: bool):
        # set up output trees and results tuple
        AddedComponentData = Grasshopper.DataTree[System.Object]()
        # sanitize input and abort if not present
        if not Config:
            rml = ghenv.Component.RuntimeMessageLevel.Warning
            msg = 'Input Config failed to collect data!'
            ghenv.Component.AddRuntimeMessage(rml, msg)
            return AddedComponentData
        else:
            config_data = json.loads(Config)
            self.BASEURL = config_data['base_url']
            self.TOKEN = config_data['token']
        if not ComponentData:
            rml = ghenv.Component.RuntimeMessageLevel.Warning
            msg = 'Input ComponentData failed to collect data!'
            ghenv.Component.AddRuntimeMessage(rml, msg)
            return AddedComponentData

        if Run:
            # set endpoint
            endpoint = '/'
            # perform request
            response = self._make_request('POST', endpoint, data=ComponentData)
            # convert response to json data
            json_comp = response.json()
            print(f'[CSC-API] Added component {json_comp["_id"]} to database.')
            AddedComponentData = json.dumps(json_comp)
        return AddedComponentData
# ---------- end addcomponent ----------
log_6 = Panel(addcomponent.out)
componentdata_7 = Data(addcomponent.AddedComponentData)

cachedata = BooleanToggle(False)
componentdata_8 = Data(componentdata_3)
tstat = TreeStatistics(Tree=componentdata_8)  # -> Paths, Length, Count
cacheddata = Data()
cacheddata_2 = Data()
cacheddata_3 = Data()
txt = Text(tstat.Paths)
comments_notes_2 = Panel("Cache Components")
dc = DataCache(LiveData=flatten(tstat.Length), CachedData=cacheddata_2, Toggle=cachedata)  # -> Data; inputs LiveData: list, CachedData: list, Toggle: Boolean
# ---------- dc: Python ----------
"""
Caches some Data by storing it as Persistent Data (aka internalising it) in a connected Param.
    Inputs:
        LiveData: The Data that should be cached (internalised) {tree, data}
        CachedData: Connect a Data Param here where the Data can be internalised {list, data}
        Toggle: If True, Data will be cached by internalising it into the Param connected to IntData. {item, boolean}
    Outputs:
        Data: If Toggle is True the internalised Data, otherwise the incoming Live-Data {list, data}}
    Remarks:
        Author: Max Eschenbach
        License: MIT License
        Version: 200705
"""
ghenv.Component.Name = "DataCache"
ghenv.Component.NickName = "DC"
ghenv.Component.Category = "Cockatoo"
ghenv.Component.SubCategory = "10 Utilities"

# GHPYTHON SDK MODE IMPORTS
from ghpythonlib.componentbase import executingcomponent as component
import Grasshopper, GhPython
import System
import Rhino
import rhinoscriptsyntax as rs

# CUSTOM IMPORTS
from scriptcontext import sticky as st

class DataCache(component):
    
    def RunScript(self, LiveData, CachedData, Toggle):
        
        # get the gh document
        ghDoc = ghenv.Component.OnPingDocument()
        
        # get the guid of this instance to ensure private sticky entries
        ig = self.InstanceGuid
        
        # define a marker for the state of caching/internalisation
        Flag = str(ig) + "___INTERNALISEDFLAG"
        if not Flag in st:
            if CachedData:
                st[Flag] = True
            else:
                st[Flag] = None
        
        # PARAM HANDLING -------------------------------------------------------
        LiveDataParam = ghenv.Component.Params.Input[0]
        CachedDataParam = ghenv.Component.Params.Input[1]
        
        # try to get the connected param, otherwise set a warning and return
        if CachedDataParam.Sources:
            CachedSrc = CachedDataParam.Sources[0]
        else:
            rmlevel = self.RuntimeMessageLevel.Warning
            ghenv.Component.AddRuntimeMessage(rmlevel, "Please connect a Data" +
                                              " Param to the IntData input!")
            return None
        
        
        # HANDLING OF CACHED DATA ----------------------------------------------
        if CachedData and Toggle:
            for i, D in enumerate(CachedData):
                if D == str(ig) + "___NONE___":
                    CachedData[i] = None
            self.Message = "Streaming CachedData"
            Data = CachedData
            return Data
        else:
            self.Message = "Streaming LiveData"
            Data = LiveData
        
        
        # CACHING OF DATA ------------------------------------------------------
        if LiveData and Toggle and not st[Flag]:
            # sanitize the none values
            for i, D in enumerate(LiveData):
                if D == None:
                    LiveData[i] = str(ig) + "___NONE___"
            # create a dotnet list and add all the data items to it
            dList = System.Collections.Generic.List[object]()
            [dList.Add(o) for o in LiveData]
            # switch the marker and set message
            st[Flag] = True
            
            # define delegate for adding persistent data between solutions
            def sln_delegate(doc):
                CachedSrc.Script_AddPersistentData(dList)
                ghenv.Component.ExpireSolution(False)
            
            # schedule new solutin using the defined delegate
            ghDoc.ScheduleSolution(1, sln_delegate)
        
        # # RESET OF CACHED DATA ON FALSE TOGGLE -------------------------------
        elif Toggle == False:
            if st[Flag] == True:
                # set the marker
                st[Flag] = None
                # clear the persistent data and set message
                CachedSrc.Script_ClearPersistentData()
                # expire the solution so everything gets updated
                CachedSrc.ExpireSolution(True)
        
        # return outputs if you have them; here I try it for you:
        return Data
# ---------- end dc ----------
dc_2 = DataCache(LiveData=flatten(txt), CachedData=cacheddata_3, Toggle=cachedata)  # -> Data; inputs LiveData: list, CachedData: list, Toggle: Boolean; same code as dc
dc_3 = DataCache(LiveData=flatten(componentdata_8), CachedData=cacheddata, Toggle=cachedata)  # -> Data; inputs LiveData: list, CachedData: list, Toggle: Boolean; same code as dc
partition = PartitionList(List=dc_3, Size=dc)
tstat_2 = TreeStatistics(Tree=partition)  # -> Paths, Length, Count
replace = ReplacePaths(Data=partition, Search=tstat_2.Paths, Replace=dc_2)
componentdata_9 = Data(replace)

resetforwarder = Button()
validate = Button()
forward = Button()

resetforwarder_button = Data(resetforwarder)
forward_button = Data(forward)
componentdata_10 = Data(componentdata_5)
py3 = Python3Script(Forward=forward_button, Reset=resetforwarder_button, N=Slider(0, range=0..100))  # -> out, M; inputs Forward: Boolean, Reset: Boolean, N: Int32
# ---------- py3: Python ----------
import scriptcontext as sc

ig = str(ghenv.Component.InstanceGuid)
if ig not in sc.sticky.keys():
    sc.sticky[ig] = N

if Forward is True:
    sc.sticky[ig] += 1
if Reset == True:
    sc.sticky[ig] = 0

M = sc.sticky[ig]
# ---------- end py3 ----------
item = ListItem(List=flatten(componentdata_10), Index=py3.M, Wrap=False)
componentdata_11 = Data(item)

componentdata_12 = Data(componentdata_11)
disassemblecomponent_2 = Python3Script(ComponentData=componentdata_12)  # -> out, ID, Type, Material, Geometry, MaterialThickness, Color, BBX2D, BBX3D; inputs ComponentData: tree of String
# ---------- disassemblecomponent_2: Python ----------
#! python3
# venv: DDU_CSC
# VERSION: 240517A

import json

import System
import Rhino
import Grasshopper

import rhinoscriptsyntax as rs


class DisassembleComponent(Grasshopper.Kernel.GH_ScriptInstance):

    def ComponentPolyline(self, jcomp: dict) -> Rhino.Geometry.Polyline:
        pl = Rhino.Geometry.Polyline()
        pts = [Rhino.Geometry.Point3d(pt[0], pt[1], 0.0)
               for pt in jcomp['geometry']['polyline']]
        pl.AddRange(pts)
        return pl

    def ComponentPolylineExtrusion(
            self,
            jcomp: dict) -> Rhino.Geometry.Extrusion:
        pl = Rhino.Geometry.Polyline()
        pts = [Rhino.Geometry.Point3d(pt[0], pt[1], 0.0)
               for pt in jcomp['geometry']['polyline']]
        pl.AddRange(pts)
        cxt = Rhino.Geometry.Extrusion.Create(
            pl.ToPolylineCurve(),
            Rhino.Geometry.Plane.WorldXY,
            jcomp['materialthickness'],
            True)
        return cxt

    def ComponentMesh(self, jcomp: dict) -> Rhino.Geometry.Mesh:
        mesh = Rhino.Geometry.Mesh()
        vl = jcomp['geometry']['mesh']['v']
        fl = jcomp['geometry']['mesh']['f']
        [mesh.Vertices.Add(*v) for v in vl]
        [mesh.Faces.AddFace(*f) for f in fl]
        mesh.RebuildNormals()
        mesh.UnifyNormals()
        mesh.Compact()
        return mesh

    def ComponentColor(self, jcomp: dict) -> System.Drawing.Color:
        return System.Drawing.Color.FromArgb(255, *jcomp['color'])

    def RunScript(self, ComponentData: Grasshopper.DataTree[str]):
        # set up output trees and results tuple
        ID = Grasshopper.DataTree[System.Object]()
        Type = Grasshopper.DataTree[System.Object]()
        Material = Grasshopper.DataTree[System.Object]()
        Geometry = Grasshopper.DataTree[System.Object]()
        MaterialThickness = Grasshopper.DataTree[System.Object]()
        Color = Grasshopper.DataTree[System.Object]()
        BBX2D = Grasshopper.DataTree[System.Object]()
        BBX3D = Grasshopper.DataTree[System.Object]()
        __Results = (
            ID,
            Type,
            Material,
            Geometry,
            MaterialThickness,
            Color,
            BBX2D,
            BBX3D)
        # loop over all branches
        for i in range(ComponentData.BranchCount):
            for j, comp in enumerate(ComponentData.Branches[i]):
                jcomp = json.loads(comp)
                # create datatree path
                ghp = ComponentData.Paths[i]
                # add all things to the respective datatrees
                ID.Add(jcomp['_id'], ghp)
                Type.Add(jcomp['type'], ghp)
                Material.Add(jcomp['material'], ghp)
                # process insertion frame
                try:
                    iframe = jcomp['iframe']
                    iplane = Rhino.Geometry.Plane(
                        Rhino.Geometry.Point3d(*iframe['o']),
                        Rhino.Geometry.Vector3d(*iframe['x']),
                        Rhino.Geometry.Vector3d(*iframe['y']),
                    )
                except KeyError:
                    iplane = Rhino.Geometry.Plane.WorldXY
                xform = Rhino.Geometry.Transform.PlaneToPlane(
                    Rhino.Geometry.Plane.WorldXY,
                    iplane)
                # treat geometry key in a special way because
                # it may hold mutiple geometry types
                for key in sorted(jcomp['geometry'].keys()):
                    if key == 'polyline':
                        pl = self.ComponentPolyline(jcomp)
                        # transform to iframe
                        pl.Transform(xform)
                        Geometry.Add(pl, ghp)
                    elif key == 'mesh':
                        mesh = self.ComponentMesh(jcomp)
                        # transform to iframe
                        mesh.Transform(xform)
                        Geometry.Add(mesh, ghp)
                    else:
                        raise RuntimeError('Missing implementation '
                                           f'for geometry of type "{key}"!')
                MaterialThickness.Add(jcomp['materialthickness'], ghp)
                # create system color from rgb values
                color = self.ComponentColor(jcomp)
                Color.Add(color, ghp)
                # construct bbxes
                if jcomp['bbx']['xy']:
                    bbx = Rhino.Geometry.Polyline()
                    bbx.AddRange([Rhino.Geometry.Point3d(
                        float(pt[0]),
                        float(pt[1]),
                        0.0) for pt in jcomp['bbx']['xy']])
                    bbx.Add(bbx[0])
                    # apply iframe trnsform
                    bbx.Transform(xform)
                    BBX2D.Add(bbx, ghp)
                if jcomp['bbx']['xyz']:
                    minpt = jcomp['bbx']['xyz'][0]
                    maxpt = jcomp['bbx']['xyz'][6]
                    bbx = Rhino.Geometry.BoundingBox(
                        Rhino.Geometry.Point3d(*minpt),
                        Rhino.Geometry.Point3d(*maxpt))
                    # apply iframe trnsform
                    bbx.Transform(xform)
                    BBX3D.Add(bbx, ghp)
        # return output trees
        return __Results
# ---------- end disassemblecomponent_2 ----------
componentid = Data(disassemblecomponent_2.ID)

comments_notes_3 = Panel("VALIDATION")
debrep = DeconstructBrep(Brep=disassemblecomponent_2.BBX3D)  # -> Faces, Edges, Vertices
data = Data(disassemblecomponent_2.Geometry)
cpl = CustomPreviewLineweights(Geometry=debrep.Edges, Thickness=Slider(2, range=0..10))  # inputs Geometry: list, Color: list of Color
# ---------- cpl: Python ----------
"""
Custom Preview with Lineweights.
    Inputs:
        Geometry: The geometry to preview. {list, GeometryBase}
        Color: The preview color per geometry item. {list, System.Drawing.Color}
        Thickness: The thickness of the wire display. {item, int}
    Remarks:
        Author: Max Eschenbach
        License: MIT License
        Version: 231122
"""

# PYTHON STANDARD LIBRARY IMPORTS
from __future__ import division, print_function
import json
import math

# GHPYTHON SDK IMPORTS
from ghpythonlib.componentbase import executingcomponent as component
import Grasshopper, GhPython
import System
import Rhino
import rhinoscriptsyntax as rs

# GHENV COMPONENT SETTINGS
ghenv.Component.Name = "CustomPreviewLineweights"
ghenv.Component.NickName = "CPL"
ghenv.Component.Category = "FindersKeepers"
ghenv.Component.SubCategory = "4 Visualisation"

class CustomPreviewLineweights(component):
    
    def __init__(self):
        super(CustomPreviewLineweights, self).__init__()
        
        self.draw_lines = System.Collections.Generic.List[Rhino.Geometry.Line]()
        self.draw_curves = []
        self.draw_color = []
        self.draw_thickness = None
    
    
    def RunScript(self, Geometry, Color, Thickness):
        
        self.draw_lines = System.Collections.Generic.List[Rhino.Geometry.Line]()
        self.draw_curves = []
        self.draw_color = None
        self.draw_thickness = None
        
        if not Color:
            self.draw_color = [System.Drawing.Color.Black]
        else:
            self.draw_color = Color
        
        if not Thickness:
            self.draw_thickness = 1
        else:
            self.draw_thickness = Thickness
        
        if Geometry:
            for i, geo in enumerate(Geometry):
                if isinstance(geo, Rhino.Geometry.Line):
                    self.draw_curves.Add(Rhino.Geometry.LineCurve(geo))
                elif isinstance(geo, Rhino.Geometry.Curve):
                    self.draw_curves.append(geo)
                elif isinstance(geo, Rhino.Geometry.LineCurve):
                    self.draw_curves.Add(geo)
                elif isinstance(geo, Rhino.Geometry.Rectangle3d):
                    self.draw_curves.append(geo.ToNurbsCurve())
                else:
                    print(type(geo))
    
    
    def get_ClippingBox(self):
        return Rhino.Geometry.BoundingBox()
    
    
    def DrawViewportWires(self, arg):
        try:
            for i, crv in enumerate(self.draw_curves):
                if i >= len(self.draw_color):
                    col = self.draw_color[-1]
                else:
                    col = self.draw_color[i]
                if not col:
                    rml = self.RuntimeMessageLevel.Remark
                    self.AddRuntimeMessage(rml, 'Expected Color, got NoneType! '
                                                 'Substituting with Black...')
                    col = System.Drawing.Color.Black
                arg.Display.DrawCurve(crv, col, self.draw_thickness)
        except Exception, e:
            rml = self.RuntimeMessageLevel.Warning
            self.AddRuntimeMessage(rml, 'Error while drawing Preview!')
            # System.Windows.Forms.MessageBox.Show(
            #                     str(e),
            #                     'Error while drawing preview!')
# ---------- end cpl ----------

dimensionz = Slider(0, range=0..500)
dimensiony = Slider(0, range=0..2000)
dimensionx = Slider(0, range=0..2000)
material_2 = ValueList({"all materials": "allmaterials", "corian", "concrete", "timber", "aluminium", "steel"}, selected="all materials")
type_2 = ValueList({"all types": "alltypes", "sheet", "rubble", "beam", "column", "profile"}, selected="all types")
componentdata_13 = Data(componentdata_9)
comments_notes_4 = Panel("Filter Components")
filtercomponents = Python3Script(
    Type=type_2,
    Material=material_2,
    DimensionX=dimensionx,
    DimensionY=dimensiony,
    DimensionZ=dimensionz,
    ComponentData=componentdata_13)  # -> out, FilteredComponentData; inputs Type: String, Material: String, DimensionX: Double, DimensionY: Double, DimensionZ: Double, ComponentData: tree of String
# ---------- filtercomponents: Python ----------
#! python3
# venv: DDU_CSC
# VERSION: 240517A

import json

import System
import Rhino
import Grasshopper

import rhinoscriptsyntax as rs


class FilterComponents(Grasshopper.Kernel.GH_ScriptInstance):
    def RunScript(self,
            Type: str,
            Material: str,
            DimensionX: float,
            DimensionY: float,
            DimensionZ: float,
            ComponentData: Grasshopper.DataTree[str]):
        
        FilteredComponentData = Grasshopper.DataTree[System.Object]()

        Type = str(Type)
        Material = str(Material)
        DimensionX = float(DimensionX)
        DimensionY = float(DimensionY)
        DimensionZ = float(DimensionZ)

        if not ComponentData:
            rml = ghenv.Component.RuntimeMessageLevel.Warning
            msg = 'Input ComponentData failed to collect data!'
            ghenv.Component.AddRuntimeMessage(rml, msg)
            return FilteredComponentData

        # loop over all branches
        for i in range(ComponentData.BranchCount):
            ghp = Grasshopper.Kernel.Data.GH_Path(i)
            for j, comp in enumerate(ComponentData.Branches[i]):
                # load component
                jcomp = json.loads(comp)
                # filter component
                if Type != 'alltypes':
                    if jcomp['type'] != Type:
                        continue
                if Material != 'allmaterials':
                    if jcomp['material'] != Material:
                        continue
                bbx = jcomp['bbx']['xyz'] if jcomp['bbx']['xyz'] else jcomp['bbx']['xy']
                if DimensionX > 0:
                    dimx = bbx[1][0] - bbx[0][0]
                    if dimx > DimensionX:
                        continue
                if DimensionY > 0:
                    dimy = bbx[2][1] - bbx[1][1]
                    if dimy > DimensionY:
                        continue
                if DimensionZ > 0:
                    if jcomp['type'] == 'sheet':
                        dimz = jcomp['materialthickness']
                    else:
                        dimz = bbx[4][3] - bbx[0][3]
                    if dimz > DimensionZ:
                        continue
                FilteredComponentData.Add(json.dumps(jcomp), ghp)
        # return results
        return FilteredComponentData
# ---------- end filtercomponents ----------
log_7 = Panel(filtercomponents.out)
componentdata_14 = Data(filtercomponents.FilteredComponentData)

validate_button = Data(validate)
csc_config_8 = Data(csc_config_3)
componentid_2 = Data(componentid)
validatecomponent = Python3Script(Config=csc_config_8, Validate=validate_button, ComponentID=componentid_2)  # -> out, ComponentData; inputs Config: String, Validate: Boolean, ComponentID: String
# ---------- validatecomponent: Python ----------
#! python3
# venv: DDU_CSC
# r: requests==2.31.0
# VERSION: 240517A

import json
import uuid

import requests

import System
import Grasshopper
import Rhino


class ValidateComponent(Grasshopper.Kernel.GH_ScriptInstance):

    def __init__(self):
        # initialize props
        self.TOKEN = None

    def get_token(self):
        return self.__TOKEN

    def set_token(self, value):
        self.__TOKEN = value

    TOKEN = property(get_token, set_token, None, "Access Token Property")

    def slash_join(self, *args):
        """Joins together a bunch of strings using slashes."""
        return '/'.join(arg.strip('/') for arg in args)

    def _create_headers(self, token: str = ''):
        """
        Obtain correct headers for performing a request to FARO Component
        Repository API.
        """
        # if no token exists, we need to authenticate first
        if not token:
            token = self.TOKEN
        # set header with authentication token
        return {'Authorization': f'Bearer {token}'}

    def _make_request(self,
                      method: str,
                      endpoint: str,
                      params=None,
                      data=None):
        """
        Perform a request to the API
        """
        # create correct url
        url = self.slash_join(self.BASEURL, endpoint)
        # set header with authentication token
        headers = self._create_headers(token=self.TOKEN)
        # perform request
        print(f'[CSC-API] Performing {method} request using token...')
        response = requests.request(method=method,
                                    url=url,
                                    params=params,
                                    data=data,
                                    headers=headers)
        # if response has status code for Unauthorized request,
        # get new token and try again one time
        if response.status_code == 401:
            print('[CSC-API] Request failed, retrying...')
            headers = self._create_headers(token='')
            response = requests.request(method=method,
                                        url=url,
                                        params=params,
                                        data=data,
                                        headers=headers)
            if response.status_code != 200:
                raise RuntimeError(f'Request failed with status code {response.status_code}')
        return response

    def validate_uuid(self, uuid_to_test: str, version: int = 4):
        """
        Check if uuid_to_test is a valid UUID.
        Returns True if uuid_to_test is a valid UUID, otherwise False.
        """
        try:
            uuid_obj = uuid.UUID(uuid_to_test, version=version)
        except ValueError:
            return False
        return str(uuid_obj) == uuid_to_test

    def RunScript(self, Config: str, Validate: bool, ComponentID: str):
        # set up output trees and results tuple
        ComponentData = Grasshopper.DataTree[System.Object]()
        # sanitize input and abort if not present
        if not Config:
            rml = ghenv.Component.RuntimeMessageLevel.Warning
            msg = 'Input Config failed to collect data!'
            ghenv.Component.AddRuntimeMessage(rml, msg)
            return ComponentData
        else:
            Config = str(Config)
            config_data = json.loads(Config)
            self.BASEURL = config_data['base_url']
            self.TOKEN = config_data['token']
        if not ComponentID:
            rml = ghenv.Component.RuntimeMessageLevel.Warning
            msg = 'Input ComponentID failed to collect data!'
            ghenv.Component.AddRuntimeMessage(rml, msg)
            return ComponentData
        ComponentID = str(ComponentID)
        if not  self.validate_uuid(ComponentID):
            rml = ghenv.Component.RuntimeMessageLevel.Warning
            msg = f'ComponentID {ComponentID} is not a valid UUID!'
            ghenv.Component.AddRuntimeMessage(rml, msg)
            return ComponentData
        if Validate is True:
            # set endpoint
            endpoint = f'validate/{ComponentID}'
            # perform request
            response = self._make_request('GET', endpoint)
            # convert response to json data
            json_comp = response.json()
            print(json_comp['validated'])
            print(f'[CSC-API] Validated component {ComponentID} on server.')
            # add all things to the respective datatrees
            ComponentData = json.dumps(json_comp)
        # return output trees
        return ComponentData
# ---------- end validatecomponent ----------
log_8 = Panel(validatecomponent.out)
componentdata_15 = Data(validatecomponent.ComponentData)

arrange_upright = BooleanToggle(False)
componentdata_16 = Data(componentdata_14)
grid_dim_y = Slider(1300, range=0..4000)
insertionpoint = Point(Point(0, 0, 0))
grid_dim_x = Slider(1300, range=0..4000)
componentdata_17 = Data(componentdata_16)
grid_dim_x_2 = Data(grid_dim_x)
grid_dim_y_2 = Data(grid_dim_y)
lng = ListLength(List=flatten(componentdata_17))
dom = ConstructDomain(DomainStart=0, DomainEnd=grid_dim_x_2)
dom_2 = ConstructDomain(DomainStart=0, DomainEnd=grid_dim_y_2)
sqrt = SquareRoot(Value=lng)
round = Round(Number=sqrt)  # -> Nearest, Floor, Ceiling
comments_notes_5 = Panel("Create Arrangement")
rectangle = Rectangle(Plane=PlaneXY(0, 0, 0), XSize=dom, YSize=dom_2, Radius=0)  # -> Rectangle, Length
area = Area(Geometry=rectangle.Rectangle)  # -> Area, Centroid
arrrec = RectangularArray(Geometry=rectangle.Rectangle, Cell=rectangle.Rectangle, XCount=round.Ceiling, YCount=round.Ceiling)  # -> Geometry, Transform
xy = XYPlane(Origin=area.Centroid)
arrange_upright_2 = Data(arrange_upright)
rotate = Rotate(Geometry=xy, Angle="0.5 * Pi", Plane=xy)  # -> Geometry, Transform
insertionpoint_2 = Point(insertionpoint)
filter = StreamFilter(Gate=arrange_upright_2, Stream0=xy, Stream1=rotate.Geometry)
split = SplitList(List=arrrec.Transform, Index=lng)  # -> ListA, ListB
xy_2 = XYPlane(Origin=insertionpoint_2)
split_2 = SplitList(List=arrrec.Geometry, Index=lng)  # -> ListA, ListB
componentdata_18 = Data(componentdata_16)
unflatten = UnflattenTree(Tree=split.ListA, Guide=componentdata_18)
unflatten_2 = UnflattenTree(Tree=split_2.ListA, Guide=componentdata_18)
transform = Transform(Geometry=filter, Transform=unflatten)
orient = Orient(Geometry=xy_2, Source=xy_2, Target=transform)  # -> Geometry, Transform
cpl_2 = CustomPreviewLineweights(Geometry=flatten(unflatten_2), Color=ColourSwatch(SwatchColor=RGB(0, 0, 0)), Thickness=Slider(1, range=0..10))  # inputs Geometry: list, Color: list of Color; same code as cpl
cellplanes = Data(orient.Geometry)
cells = Data(unflatten_2)
xform = Data(orient.Transform)

py3_2 = Python3Script()  # -> out, comp_str
# ---------- py3_2: Python ----------
import json
import os

fp = r'C:\Users\EFESTWIN\source\repos\cscscan\src\cscscan\sheets\outputdata\sheets\0cc11b73-7bfa-4561-b741-0b7e185a05a6.json'
fp = os.path.normpath(os.path.abspath(fp))

comp_str = None
with open(fp, 'r') as compfile:
    comp = json.load(compfile)
    comp_str = json.dumps(comp)
# ---------- end py3_2 ----------

# ----
# comments & notes: Disassemble Component into its elements
componentdata_19 = Data(py3_2.comp_str)
disassemblecomponent_3 = Python3Script(ComponentData=componentdata_19)  # -> out, ID, Type, Material, Geometry, MaterialThickness, Color, BBX2D, BBX3D; inputs ComponentData: tree of String; same code as disassemblecomponent_2
output_stream_2 = Panel(disassemblecomponent_3.out)
materialthickness_3 = Data(disassemblecomponent_3.MaterialThickness)
geometry_3 = Data(disassemblecomponent_3.Geometry)
bbx2d_2 = Data(disassemblecomponent_3.BBX2D)
id_2 = Data(disassemblecomponent_3.ID)
color_2 = Data(disassemblecomponent_3.Color)

# ----
# comments & notes: Transform (Move, Rotate...) Components
componentdata_20 = Data(componentdata_14)
xform_2 = Data(xform)
transformcomponent = Python3Script(ComponentData=componentdata_20, XForm=xform_2)  # -> out, XComponentData; inputs ComponentData: String, XForm: Transform
# ---------- transformcomponent: Python ----------
#! python3
# venv: DDU_CSC
# VERSION: 240517A

import json

import System
import Rhino
import Grasshopper

import rhinoscriptsyntax as rs


class TransformComponent(Grasshopper.Kernel.GH_ScriptInstance):

    def ComponentPolyline(self, jcomp: dict) -> Rhino.Geometry.Polyline:
        pl = Rhino.Geometry.Polyline()
        pts = [Rhino.Geometry.Point3d(pt[0], pt[1], 0.0)
               for pt in jcomp['geometry']['polyline']]
        pl.AddRange(pts)
        return pl

    def ComponentPolylineExtrusion(self, jcomp: dict) -> Rhino.Geometry.Extrusion:
        pl = Rhino.Geometry.Polyline()
        pts = [Rhino.Geometry.Point3d(pt[0], pt[1], 0.0)
               for pt in jcomp['geometry']['polyline']]
        pl.AddRange(pts)
        cxt = Rhino.Geometry.Extrusion.Create(
                    pl.ToPolylineCurve(),
                    Rhino.Geometry.Plane.WorldXY,
                    jcomp['materialthickness'],
                    True)
        return cxt

    def ComponentMesh(self, jcomp: dict) -> Rhino.Geometry.Mesh:
        mesh = Rhino.Geometry.Mesh()
        vl = jcomp['geometry']['mesh']['v']
        fl = jcomp['geometry']['mesh']['f']
        [mesh.Vertices.Add(*v) for v in vl]
        [mesh.Faces.AddFace(*f) for f in fl]
        mesh.RebuildNormals()
        mesh.UnifyNormals()
        mesh.Compact()
        return mesh

    def ComponentColor(self, jcomp: dict) -> System.Drawing.Color:
        return System.Drawing.Color.FromArgb(255, *jcomp['color'])

    def PlaneToFrameDict(self, plane: Rhino.Geometry.Plane) -> dict:
        iframe = {
            'o': [plane.OriginX, plane.OriginY, plane.OriginZ],
            'x': [plane.XAxis.X, plane.XAxis.Y, plane.XAxis.Z],
            'y': [plane.YAxis.X, plane.YAxis.Y, plane.YAxis.Z],
            'z': [plane.ZAxis.X, plane.ZAxis.Y, plane.ZAxis.Z]
        }
        return iframe

    def RunScript(self, ComponentData: str, XForm: Rhino.Geometry.Transform):
        # set up output trees and results tuple
        XComponentData = System.Collections.Generic.List[System.Object]()
        if not ComponentData:
            rml = ghenv.Component.RuntimeMessageLevel.Warning
            msg = 'Input ComponentData failed to collect data!'
            ghenv.Component.AddRuntimeMessage(rml, msg)
            return XComponentData
        if not XForm:
            rml = ghenv.Component.RuntimeMessageLevel.Warning
            msg = 'Input XForm failed to collect data!'
            ghenv.Component.AddRuntimeMessage(rml, msg)
            return XComponentData
        # load component json
        jcomp = json.loads(ComponentData)
        # process insertion frame
        try:
            # try to extract insertion frame
            iframe = jcomp['iframe']
            iplane = Rhino.Geometry.Plane(
                Rhino.Geometry.Point3d(*iframe['o']),
                Rhino.Geometry.Vector3d(*iframe['x']),
                Rhino.Geometry.Vector3d(*iframe['y']),
            )
        except KeyError:
            # if there is no respective key, create world xy plane
            iplane = Rhino.Geometry.Plane.WorldXY
        # transform the iframe using the input xform
        iplane.Transform(XForm)
        # replace iframe
        jcomp['iframe'] = self.PlaneToFrameDict(iplane)
        XComponentData = json.dumps(jcomp)
        return XComponentData
# ---------- end transformcomponent ----------
output_stream_3 = Panel(transformcomponent.out)
componentdata_21 = Data(transformcomponent.XComponentData)

materialthickness_4 = Data(materialthickness_3)
geometry_4 = Data(geometry_3)
id_3 = Data(id_2)
bbx2d_3 = Data(bbx2d_2)
color_3 = Data(color_2)

geometry_5 = Data(geometry_3)
area_2 = Area(Geometry=geometry_5)  # -> Area, Centroid
len = Length(Curve=geometry_5)
eval = Evaluate(F="(4 * Pi * area) / (perimeter²)", area=area_2.Area, perimeter=len)
roundness = Data(eval)

comments_notes_6 = Panel("Bake Components")
componentdata_22 = Data(componentdata_21)
bakecomponents = Python3Script(Bake=Button(), ComponentData=flatten(componentdata_22))  # inputs Bake: Boolean, ComponentData: list of String
# ---------- bakecomponents: Python ----------
#! python3
# venv: DDU_CSC
# VERSION: 240517A

import json

import System
import Rhino
import Grasshopper
import rhinoscriptsyntax as rs
import scriptcontext as sc


class BakeComponents(Grasshopper.Kernel.GH_ScriptInstance):

    def ComponentPolyline(self, jcomp: dict) -> Rhino.Geometry.Polyline:
        pl = Rhino.Geometry.Polyline()
        pts = [Rhino.Geometry.Point3d(pt[0], pt[1], 0.0)
               for pt in jcomp['geometry']['polyline']]
        pl.AddRange(pts)
        return pl

    def ComponentPolylineExtrusion(self, jcomp: dict) -> Rhino.Geometry.Extrusion:
        pl = Rhino.Geometry.Polyline()
        pts = [Rhino.Geometry.Point3d(pt[0], pt[1], 0.0)
               for pt in jcomp['geometry']['polyline']]
        pl.AddRange(pts)
        cxt = Rhino.Geometry.Extrusion.Create(
                    pl.ToPolylineCurve(),
                    Rhino.Geometry.Plane.WorldXY,
                    jcomp['materialthickness'],
                    True)
        return cxt

    def ComponentMesh(self, jcomp: dict) -> Rhino.Geometry.Mesh:
        mesh = Rhino.Geometry.Mesh()
        vl = jcomp['geometry']['mesh']['v']
        fl = jcomp['geometry']['mesh']['f']
        [mesh.Vertices.Add(*v) for v in vl]
        [mesh.Faces.AddFace(*f) for f in fl]
        mesh.RebuildNormals()
        mesh.UnifyNormals()
        mesh.Compact()
        return mesh

    def ComponentColor(self, jcomp: dict) -> System.Drawing.Color:
        return System.Drawing.Color.FromArgb(255, *jcomp['color'])

    def RunScript(self,
            Bake: bool,
            ComponentData: System.Collections.Generic.List[str]):
        # set document
        sc.doc = Rhino.RhinoDoc.ActiveDoc
        # bake toggle
        if Bake:
            for i, cd in enumerate(ComponentData):
                # create path
                ghp = Grasshopper.Kernel.Data.GH_Path(i)
                # load json component
                jcomp = json.loads(cd)
                # extract ID
                comp_id = jcomp['_id']
                # get insertion plane
                try:
                    # try to extract insertion frame
                    iframe = jcomp['iframe']
                    iplane = Rhino.Geometry.Plane(
                        Rhino.Geometry.Point3d(*iframe['o']),
                        Rhino.Geometry.Vector3d(*iframe['x']),
                        Rhino.Geometry.Vector3d(*iframe['y']),
                    )
                except KeyError:
                    # if there is no respective key, create world xy plane
                    iplane = Rhino.Geometry.Plane.WorldXY
                xform = Rhino.Geometry.Transform.PlaneToPlane(
                    Rhino.Geometry.Plane.WorldXY,
                    iplane)
                # create tag
                tag = Rhino.Geometry.TextEntity()
                tag.Text = comp_id
                tag.Plane = iplane
                # specify height in millimeters
                usf = Rhino.RhinoMath.UnitScale(
                    Rhino.UnitSystem.Millimeters,
                    sc.doc.ModelUnitSystem)
                tag.TextHeight = 10.0 * usf
                tag.Justification = Rhino.Geometry.TextJustification.MiddleCenter
                # create component polyline
                plc = self.ComponentPolyline(jcomp).ToPolylineCurve()
                plc.Transform(xform)
                # create component extrusion
                xt = self.ComponentPolylineExtrusion(jcomp)
                xt.Transform(xform)
                # add objects to document
                id_plc = sc.doc.Objects.Add(plc)
                id_tag = sc.doc.Objects.Add(tag)
                id_xt = sc.doc.Objects.Add(xt)
                # create layers if they are not present
                lay_parent = 'CSC_COMPONENTS'
                lay_name = comp_id
                layer = '::'.join([lay_parent, lay_name])
                if not rs.IsLayer(lay_parent):
                    rs.AddLayer(lay_parent)
                if not rs.IsLayer(layer):
                    rs.AddLayer(layer, self.ComponentColor(jcomp))
                # set layer to objects
                rs.ObjectLayer(id_plc, layer)
                rs.ObjectLayer(id_tag, layer)
                rs.ObjectLayer(id_xt, layer)
                # set user data
                rs.SetUserText(
                    id_tag,
                    'componentdata',
                    ComponentData[i])
                # create group
                grp = sc.doc.Groups.Add(
                    comp_id,
                    [id_tag, id_plc, id_xt])
        sc.doc = ghdoc
# ---------- end bakecomponents ----------

materialthickness_5 = Data(materialthickness_4)
comments_notes_7 = Panel("Visualize ID Tag")
id_4 = Data(id_3)
area_3 = Area(Geometry=geometry_4)  # -> Area, Centroid
Z = UnitZ(Factor=materialthickness_5)
move = Move(Geometry=area_3.Centroid, Motion=Z)  # -> Geometry, Transform
tag = TextTag3D(
    Location=move.Geometry,
    Text=id_4,
    Size=Slider(8, range=0..10),
    Colour=ColourSwatch(SwatchColor=RGB(0, 217, 255)),
    Justification=5)

geometry_6 = Data(geometry_4)
comments_notes_8 = Panel("Visualize Component")
py3_3 = Python3Script(Geo=geometry_6)  # -> out, flatten(PolylineGeo), flatten(MeshGeo); inputs Geo: GeometryBase
# ---------- py3_3: Python ----------
import Rhino

PolylineGeo = []
MeshGeo = []

if (isinstance(Geo, Rhino.Geometry.PolylineCurve) or
    isinstance(Geo, Rhino.Geometry.Polyline)):
    PolylineGeo.append(Geo)
elif (isinstance(Geo, Rhino.Geometry.Mesh)):
    MeshGeo.append(Geo)
# ---------- end py3_3 ----------
clean = CleanTree(RemoveNulls=True, RemoveInvalid=True, RemoveEmpty=True, Tree=py3_3.MeshGeo)  # -> simplify(Tree)
clean_2 = CleanTree(RemoveNulls=True, RemoveInvalid=True, RemoveEmpty=True, Tree=py3_3.PolylineGeo)  # -> simplify(Tree)
tstat_3 = TreeStatistics(Tree=clean_2)  # -> Paths, Length, Count
color_4 = Data(color_3)
materialthickness_6 = Data(materialthickness_4)
tstat_4 = TreeStatistics(Tree=clean)  # -> Paths, Length, Count
branch = TreeBranch(Tree=color_4, Path=tstat_3.Paths, MaintainPaths=True)
branch_2 = TreeBranch(Tree=materialthickness_6, Path=tstat_3.Paths, MaintainPaths=True)
branch_3 = TreeBranch(Tree=color_4, Path=tstat_4.Paths, MaintainPaths=True)
boundary = BoundarySurfaces(Edges=clean_2)
Z_2 = UnitZ(Factor=branch_2)
extr = Extrude(Base=boundary, Direction=Z_2)
preview = CustomPreview(Geometry=extr, Material=branch)
preview_2 = CustomPreview(Geometry=clean, Material=branch_3)

comments_notes_9 = Panel("Visualize Bounding Rectangle")
bbx2d_4 = Data(bbx2d_3)
cpl_3 = CustomPreviewLineweights(Geometry=flatten(bbx2d_4), Color=ColourSwatch(SwatchColor=RGB(255, 107, 107)), Thickness=Slider(2, range=0..10))  # inputs Geometry: list, Color: list of Color; same code as cpl

# ----
# comments & notes: Disassemble Component into its elements
componentdata_23 = Data(componentdata_21)
disassemblecomponent_4 = Python3Script(ComponentData=componentdata_23)  # -> out, ID, Type, Material, Geometry, MaterialThickness, Color, BBX2D, BBX3D; inputs ComponentData: tree of String; same code as disassemblecomponent_2
output_stream_4 = Panel(disassemblecomponent_4.out)
materialthickness_7 = Data(disassemblecomponent_4.MaterialThickness)
geometry_7 = Data(disassemblecomponent_4.Geometry)
bbx2d_5 = Data(disassemblecomponent_4.BBX2D)
id_5 = Data(disassemblecomponent_4.ID)
color_5 = Data(disassemblecomponent_4.Color)

panel = Panel(roundness)

materialthickness_8 = Data(materialthickness_7)
geometry_8 = Data(geometry_7)
id_6 = Data(id_5)
bbx2d_6 = Data(bbx2d_5)
color_6 = Data(color_5)

geometry_9 = Data(geometry_7)
area_4 = Area(Geometry=geometry_9)  # -> Area, Centroid
len_2 = Length(Curve=geometry_9)
eval_2 = Evaluate(F="(4 * Pi * area) / (perimeter²)", area=area_4.Area, perimeter=len_2)
roundness_2 = Data(eval_2)

materialthickness_9 = Data(materialthickness_8)
id_7 = Data(id_6)
area_5 = Area(Geometry=geometry_8)  # -> Area, Centroid
Z_3 = UnitZ(Factor=materialthickness_9)
move_2 = Move(Geometry=area_5.Centroid, Motion=Z_3)  # -> Geometry, Transform
tag_2 = TextTag3D(
    Location=move_2.Geometry,
    Text=id_7,
    Size=Slider(8, range=0..10),
    Colour=ColourSwatch(SwatchColor=RGB(0, 217, 255)),
    Justification=5)

geometry_10 = Data(geometry_8)
py3_4 = Python3Script(Geo=geometry_10)  # -> out, PolylineGeo, MeshGeo; inputs Geo: GeometryBase; same code as py3_3
clean_3 = CleanTree(RemoveNulls=True, RemoveInvalid=True, RemoveEmpty=True, Tree=py3_4.MeshGeo)  # -> simplify(Tree)
clean_4 = CleanTree(RemoveNulls=True, RemoveInvalid=True, RemoveEmpty=True, Tree=py3_4.PolylineGeo)  # -> simplify(Tree)
tstat_5 = TreeStatistics(Tree=clean_4)  # -> Paths, Length, Count
color_7 = Data(color_6)
materialthickness_10 = Data(materialthickness_8)
tstat_6 = TreeStatistics(Tree=clean_3)  # -> Paths, Length, Count
branch_4 = TreeBranch(Tree=color_7, Path=tstat_5.Paths, MaintainPaths=True)
branch_5 = TreeBranch(Tree=materialthickness_10, Path=tstat_5.Paths, MaintainPaths=True)
branch_6 = TreeBranch(Tree=color_7, Path=tstat_6.Paths, MaintainPaths=True)
boundary_2 = BoundarySurfaces(Edges=clean_4)
Z_4 = UnitZ(Factor=branch_5)
extr_2 = Extrude(Base=boundary_2, Direction=Z_4)
preview_3 = CustomPreview(Geometry=extr_2, Material=branch_4)
preview_4 = CustomPreview(Geometry=clean_3, Material=branch_6)

bbx2d_7 = Data(bbx2d_6)
cpl_4 = CustomPreviewLineweights(Geometry=flatten(bbx2d_7), Color=ColourSwatch(SwatchColor=RGB(255, 107, 107)), Thickness=Slider(2, range=0..10))  # inputs Geometry: list, Color: list of Color; same code as cpl

panel_2 = Panel(roundness_2)
