# Grasshopper definition 241214_FourierSeries_visualizer.gh (Grasshopper 1.0.8)
# plug-ins: RhinoCodePluginGH

crv = Curve(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)
trigger = Trigger(Interval=10, TimerInterval=10, Target=py3)
py3 = Python3Script(curve=crv, num_samples=Slider(200, range=0..1000), num_coeffs=Slider(16, range=0..100), run=Toggle(True))  # -> coefficients, start_points, vectors, circles, reconstructed_curve; inputs curve: Curve, num_samples: Int32, num_coeffs: Int32, run: Boolean
# ---------- py3: Python ----------
import Rhino.Geometry as rg
import cmath
import math
import scriptcontext as sc

# ANIMATION TIME
# Initialize the sticky value for time if it doesn't exist
if "time" not in sc.sticky:
    sc.sticky["time"] = 0.0

# Update time only when `run` is True
if run:
    sc.sticky["time"] += 0.002
    if sc.sticky["time"] > 1:  # Reset the time after a full cycle
        sc.sticky["time"] = 0.0
t = sc.sticky["time"]  # Use the sticky time value

if curve:
    # SAMLE CURVE
    parameters = curve.DivideByCount(num_samples, True)
    points = [curve.PointAt(param) for param in parameters]

    # CALCULATE CENTROID
    centroid = rg.Point3d(
        sum(pt.X for pt in points) / len(points),
        sum(pt.Y for pt in points) / len(points),
        sum(pt.Z for pt in points) / len(points)
    )
    
    # TRANSLATE POINTS AND CURVE TO 0,0,0
    translation = rg.Vector3d(-centroid.X, -centroid.Y, -centroid.Z)
    transformed_curve = curve.DuplicateCurve()
    transformed_curve.Translate(translation)
    translated_points = [rg.Point3d(pt.X + translation.X, pt.Y + translation.Y, pt.Z + translation.Z) for pt in points]

    # CONVERT POINTS TO COMPLEX NUMBERS
    complex_points = [complex(pt.X, pt.Y) for pt in translated_points]

    # CREATE FOURIER COEFFICIENTS
    N = len(complex_points)
    coefficients = []
    for k in range(-num_coeffs, num_coeffs + 1):
        c_k = sum(
            complex_points[t] * cmath.exp(-2j * math.pi * k * t / N) for t in range(N)
        ) / N
        coefficients.append((k, c_k))
    coefficients.sort(key=lambda x: abs(x[0]))

    # VISUALIZE COEFFICIENTS
    start_point = complex(0, 0)
    vectors = []
    start_points = [] 
    circles = []

    for freq, coeff in coefficients:

        angle = 2 * math.pi * freq * t
        end_point = start_point + coeff * cmath.exp(1j * angle)

        vector = rg.Vector3d(end_point.real - start_point.real, end_point.imag - start_point.imag, 0)
        vectors.append(vector)

        start_3d = rg.Point3d(start_point.real + centroid.X, start_point.imag + centroid.Y, 0)
        start_points.append(start_3d)

        amplitude = abs(coeff)
        circle = rg.Circle(start_3d, amplitude)
        circles.append(circle)

        start_point = end_point

    reconstruction_point = rg.Point3d(start_point.real + centroid.X, start_point.imag + centroid.Y, 0)

    # RECONSTRUCT CURVE
    reconstructed_points = []
    for t in range(N):
        z_t = 0
        for freq, coeff in coefficients:
            z_t += coeff * cmath.exp(2j * math.pi * freq * t / N)
        reconstructed_points.append(rg.Point3d(z_t.real + centroid.X, z_t.imag + centroid.Y, 0))

    reconstructed_curve = rg.Polyline(reconstructed_points + [reconstructed_points[0]])

else:
    transformed_curve = None
    coefficients = None
    vectors = None
    start_points = None
    circles = None
    reconstruction_point = None
    reconstructed_curve = None
# ---------- end py3 ----------
curve_preview = CustomCurvePreview(Curve=py3.circles, Colour=ColourSwatch(SwatchColor=RGB(144, 222, 102)))
curve_preview_2 = CustomCurvePreview(Curve=py3.reconstructed_curve, Colour=ColourSwatch(SwatchColor=RGB(0, 13, 255)))
vdisex = VectorDisplayEx(Point=py3.start_points, Vector=py3.vectors, Colour=ColourSwatch(SwatchColor=RGB(255, 255, 255)), Width=1)
panel = Panel(py3.coefficients)
