# Grasshopper definition 250825_250825_DDU_CSC_GrasshopperInterface.gh (Grasshopper 1.0.8)

geo = Geometry(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)  # disabled
mbralignedproto = Python3Script(Geometry=geo)  # -> out, AlignedGeometry, WorldBBX, AlignedBBX; inputs Geometry: GeometryBase; disabled
# ---------- mbralignedproto: Python ----------
#! python3
# venv: DDU_CSC
# r: requests==2.31.0
# r: numpy==1.26.4
# r: scipy==1.13.0
# r: scikit-learn==1.4.2


import numpy as np
from scipy.spatial import ConvexHull
from sklearn.decomposition import PCA

import System
import Rhino
import Grasshopper
import rhinoscriptsyntax as rs


class MinBBX(Grasshopper.Kernel.GH_ScriptInstance):

    def minimum_bounding_rectangle(self, points):
        # Compute the convex hull of the points
        hull = ConvexHull(points)
        hull_points = points[hull.vertices]
        # Initialize variables to keep track of the best rectangle
        min_area = float('inf')
        best_rectangle = None
        best_angle = 0
        # Loop through each edge of the convex hull
        for i in range(len(hull_points)):
            # Determine the points forming the current edge
            p1 = hull_points[i]
            p2 = hull_points[(i + 1) % len(hull_points)]
            # Calculate edge vector
            edge_vec = p2 - p1
            # Rotate the points to align this edge with the x-axis
            angle = np.arctan2(edge_vec[1], edge_vec[0])
            cos_angle = np.cos(-angle)
            sin_angle = np.sin(-angle)
            rot_matrix = np.array([[cos_angle, -sin_angle], [sin_angle, cos_angle]])
            rotated_points = np.dot(points, rot_matrix.T)
            # Compute the min/max x/y in the rotated points
            min_x = np.min(rotated_points[:, 0])
            max_x = np.max(rotated_points[:, 0])
            min_y = np.min(rotated_points[:, 1])
            max_y = np.max(rotated_points[:, 1])
            # Calculate area of the bounding rectangle
            area = (max_x - min_x) * (max_y - min_y)
            if area < min_area:
                min_area = area
                best_angle = angle
                # Create the rectangle in the rotated space and then rotate it back
                best_rectangle = np.array([
                    [min_x, min_y],
                    [max_x, min_y],
                    [max_x, max_y],
                    [min_x, max_y]
                ])
                inv_rot_matrix = np.array([[cos_angle, sin_angle], [-sin_angle, cos_angle]])
                best_rectangle = np.dot(best_rectangle, inv_rot_matrix.T)
        # return results
        return best_rectangle, best_angle

    def align_and_translate(self, points, rectangle, angle):
        cos_angle = np.cos(-angle)
        sin_angle = np.sin(-angle)
        rotation_matrix = np.array([[cos_angle, -sin_angle], [sin_angle, cos_angle]])

        rotated_rectangle = np.dot(rectangle, rotation_matrix.T)
        rotated_points = np.dot(points, rotation_matrix.T)

        # Calculate dimensions to determine the longer side
        width = np.max(rotated_rectangle[:, 0]) - np.min(rotated_rectangle[:, 0])
        height = np.max(rotated_rectangle[:, 1]) - np.min(rotated_rectangle[:, 1])
        
        # Ensure the long side is aligned with the x-axis
        if height > width:
            additional_rotation = np.array([[0, -1], [1, 0]])  # Rotate by 90 degrees
            rotated_rectangle = np.dot(rotated_rectangle, additional_rotation.T)
            rotated_points = np.dot(rotated_points, additional_rotation.T)

        # Translate so the rectangle's lower-left corner is at the origin
        min_x, min_y = rotated_rectangle.min(axis=0)
        rect_center = (np.max(rotated_rectangle, axis=0) + np.min(rotated_rectangle, axis=0)) / 2
        translated_rectangle = rotated_rectangle - rect_center
        translated_points = rotated_points - rect_center

        # Reorder the rectangle points to maintain the consistent order
        ordered_rectangle = np.array([
            [np.min(translated_rectangle[:, 0]), np.min(translated_rectangle[:, 1])],
            [np.max(translated_rectangle[:, 0]), np.min(translated_rectangle[:, 1])],
            [np.max(translated_rectangle[:, 0]), np.max(translated_rectangle[:, 1])],
            [np.min(translated_rectangle[:, 0]), np.max(translated_rectangle[:, 1])]
        ])

        return translated_points, ordered_rectangle

    def RunScript(self, Geometry: Rhino.Geometry.GeometryBase):
        # create empty outputs
        AlignedGeometry = Grasshopper.DataTree[object]()
        WorldBBX = Grasshopper.DataTree[object]()
        AlignedBBX = Grasshopper.DataTree[object]()
        # sanitize input
        if not Geometry:
            rml = ghenv.Component.RuntimeMessageLevel.Warning
            msg = 'Input Geometry failed to collect data!'
            ghenv.Component.AddRuntimeMessage(rml, msg)
            return (AlignedGeometry, Frame, XForm, WorldBBX, AlignedBBX)

        if isinstance(Geometry, Rhino.Geometry.PolylineCurve):
            pl = Geometry.ToPolyline()
            pl.RemoveNearlyEqualSubsequentPoints(Rhino.RhinoDoc.ActiveDoc.ModelAbsoluteTolerance)
            pl.MergeColinearSegments(Rhino.RhinoDoc.ActiveDoc.ModelAngleToleranceRadians, True)
            pl.ReduceSegments(Rhino.RhinoDoc.ActiveDoc.ModelAbsoluteTolerance)
            points = np.array([[p.X, p.Y] for p in pl])
            compute_3d = False
        else:
            raise RuntimeError(f'Minimum BBX not implemented for geometry of type {type(Geometry)}!')

        
        mbr, angle = self.minimum_bounding_rectangle(points)
        aligned_points, aligned_mbr = self.align_and_translate(points, mbr, angle)
        # create aligned geometry
        AlignedGeometry = [Rhino.Geometry.Point3d(p[0], p[1], 0) for p in aligned_points]
        WorldBBX = [Rhino.Geometry.Point3d(p[0], p[1], 0) for p in mbr]
        AlignedBBX = [Rhino.Geometry.Point3d(p[0], p[1], 0) for p in aligned_mbr]

        return (AlignedGeometry, WorldBBX, AlignedBBX)
# ---------- end mbralignedproto ----------
pline = PolyLine(Vertices=mbralignedproto.AlignedBBX, Closed=False)  # disabled
pline_2 = PolyLine(Vertices=mbralignedproto.WorldBBX, Closed=False)  # disabled
pline_3 = PolyLine(Vertices=mbralignedproto.AlignedGeometry, Closed=False)  # disabled

comments_notes = Panel("DEPRECATED / OUTDATED / SAFEKEEPING")

geometry = Data()  # disabled
panel = Panel("(4 * Pi * area) / (perimeter²)")  # disabled
area = Area(Geometry=geometry)  # -> Area, Centroid; disabled
len = Length(Curve=geometry)  # disabled
eval = Evaluate(F=panel, area=area.Area, perimeter=len)  # disabled
roundness = Data(eval)  # disabled
panel_2 = Panel(roundness)  # disabled

# ----
# DDU DEVELOPMENT: Authors: Max Benjamin Eschenbach
# 
# Digital Design Unit (DDU)
# Prof. Dr.-Ing. Oliver Tessmann
# Fachbereich Architektur
# Technical University of Darmstadt
# 
# CREDITS:
# ------------
# Please see: https://ddu.uber.space/credits
environment_spec = Panel("""#! python3
# venv: DDU_CSC
# r: requests==2.31.0
# r: numpy==1.26.4
# r: scipy==1.13.0
# r: scikit-learn==1.4.2""")

# ----
# DEPENDENCIES
# (PLUGINS USED)
plugins = BooleanToggle(False)
definitiondependencies = DefinitionDependencies(Toggle=plugins)  # -> Core, AddOns; inputs Toggle: Boolean
# ---------- definitiondependencies: C# ----------
#region Usings
using System;
using System.Linq;
using System.Collections;
using System.Collections.Generic;
using System.Drawing;

using Rhino;
using Rhino.Geometry;

using Grasshopper;
using Grasshopper.Kernel;
using Grasshopper.Kernel.Data;
using Grasshopper.Kernel.Types;
#endregion

public class Script_Instance : GH_ScriptInstance
{
    #region Notes
    /* 
      Members:
        RhinoDoc RhinoDocument
        GH_Document GrasshopperDocument
        IGH_Component Component
        int Iteration

      Methods (Virtual & overridable):
        Print(string text)
        Print(string format, params object[] args)
        Reflect(object obj)
        Reflect(object obj, string method_name)

    Author: Giulio Piacentino (updated by Anders Holden Deleuran , updated 2025 by Max Benjamin Eschenbach)
    License: Apache License 2.0
    Version: 250820
    */
    #endregion

    private void RunScript(bool Toggle, ref object Core, ref object AddOns)
    {   
        // set component params
        this.Component.Name = "DefinitionDependencies";
        this.Component.NickName = "DefinitionDependencies";
        this.Component.Category = "DDU_CSC";
        this.Component.SubCategory = "0 Development";

        List<string> coreLibs = new List<string>();
        List<string> addLibs = new List<string>();
        if (Toggle)
        {
            Dictionary<string, GH_AssemblyInfo> coreLibraries = new Dictionary<string, GH_AssemblyInfo>();
            Dictionary<string, GH_AssemblyInfo> addonLibraries = new Dictionary<string, GH_AssemblyInfo>();
            Dictionary<string, string> objids = new Dictionary<string, string>();
            GH_ComponentServer server = Grasshopper.Instances.ComponentServer;
            foreach (GH_DocumentObject obj in this.Component.OnPingDocument().Objects)
            {
                if (obj == (GH_DocumentObject) this.Component)
                {
                    continue;
                }
                string objid = obj.ComponentGuid.ToString();
                if (objids.ContainsKey(objid)) continue;
                GH_AssemblyInfo lib = server.FindAssemblyByObject(obj);
                if (lib == null) continue;
                if (coreLibraries.ContainsKey(lib.Id.ToString()) | addonLibraries.ContainsKey(lib.Id.ToString())) continue;
                if (lib.IsCoreLibrary) coreLibraries.Add(lib.Id.ToString(), lib);
                else addonLibraries.Add(lib.Id.ToString(), lib);
            }
            foreach(KeyValuePair<string, GH_AssemblyInfo> entry in coreLibraries)
            {
                coreLibs.Add($"{entry.Value.Name} {entry.Value.Version}");
            }
            foreach(KeyValuePair<string, GH_AssemblyInfo> entry in addonLibraries)
            {
                addLibs.Add($"{entry.Value.Name} {entry.Value.Version}");
            }
        }
        Core = coreLibs;
        AddOns = addLibs;
    }
}
# ---------- end definitiondependencies ----------
grasshoppe_core_libraries = Panel(definitiondependencies.Core)
addon_libraries = Panel(definitiondependencies.AddOns)

# ----
# SAVE GHX-COPY OF CURRENT DOCUMENT
# comments & notes: Save this File and aso save a .GHX copy of the file to the same folder as this file resides in.
# --> Please use this before pushing a new version to GitHub to make the changes somehow "trackable"
autosave_gh_and_ghx = Trigger(Interval=10000, TimerInterval=10000, Target=autosave)  # disabled
autosave = BooleanToggle(True)  # disabled
save = Button()
or = GateOr(A=save, B=autosave)
saveandsaveghx = SaveAndSaveGHX(Save=or, ArchiveFolder="00_archive")  # -> Message; inputs Save: Boolean, ArchiveFolder: String
# ---------- saveandsaveghx: C# ----------
#region Usings
using System;
using System.IO;
using System.Linq;
using System.Collections;
using System.Collections.Generic;
using System.Drawing;

using Rhino;
using Rhino.Geometry;

using Grasshopper;
using Grasshopper.Kernel;
using Grasshopper.Kernel.Data;
using Grasshopper.Kernel.Types;
#endregion

public class Script_Instance : GH_ScriptInstance
{
    #region Notes
    /* 
      Members:
        RhinoDoc RhinoDocument
        GH_Document GrasshopperDocument
        IGH_Component Component
        int Iteration

      Methods (Virtual & overridable):
        Print(string text)
        Print(string format, params object[] args)
        Reflect(object obj)
        Reflect(object obj, string method_name)

    Author: Max Eschenbach
    License: MIT License
    Version: 250820
    */
    #endregion

    private void RunScript(bool Save, string ArchiveFolder, ref object Message)
    {
        // set component params
        this.Component.Name = "SaveAndSaveGHX";
        this.Component.NickName = "SaveAndSaveGHX";
        this.Component.Category = "DDU_CSC";
        this.Component.SubCategory = "0 Development";

        // This output will tell us if the save succeeded or failed.
        // The active Grasshopper document in this scripting component context

        DataTree<string> msgOut = new DataTree<string>();
        GH_Path ghp = new GH_Path(0, 1);

        if (!Save)
        {
            return;
        }

        GH_Document doc = this.GrasshopperDocument;
        if (doc == null)
        {
            msgOut.Add("Error: GrasshopperDocument is null", ghp);
            return;
        }

        // Set current and archive filepath
        string originalFilePath = doc.FilePath;
        string ghxFilePath = originalFilePath + "x";
        string archivePath = Path.Combine(Path.GetDirectoryName(ghxFilePath), ArchiveFolder);
        string archiveFilePath = Path.Combine(archivePath, DateTime.Now.ToString("yyMMdd") + "_" + Path.GetFileName(originalFilePath));

        // Only attempt to save when 'saveTrigger' is set to true.
        if (!Save) return;
        
        // Make sure the parent directory exists
        if (!Directory.Exists(Path.GetDirectoryName(ghxFilePath)))
        {
            msgOut.Add("Error: directory does not exist", ghp);
            return;
        }

        // Make sure Archive Directory exists
        // Make sure the parent directory exists
        
        if (!Directory.Exists(Path.GetDirectoryName(archivePath)))
        {
            msgOut.Add("Error: Archive directory does not exist", ghp);
            return;
        }

        // Create a GH_DocumentIO object based on our current GH_Document.
        GH_DocumentIO io = new GH_DocumentIO(doc);
        // Save this document
        io.Save();

        // Write the current document to an XML-based .ghx file
        bool success_a = io.SaveQuiet(ghxFilePath);
        bool success_b = io.SaveQuiet(originalFilePath);
        bool success_c = io.SaveQuiet(archiveFilePath);

        if (success_a & success_b & success_c)
            msgOut.Add($"Files saved successfully:\n{ghxFilePath}\n{archiveFilePath}", ghp);
        else
        {
            if (!success_a)
                msgOut.Add($"Error: failed to save .ghx file:\n{ghxFilePath}", ghp);
            if (!success_c)
                msgOut.Add($"Error: failed to save Archive .gh file:\n{archiveFilePath}", ghp);
        }
        Message = msgOut;
    }
}
# ---------- end saveandsaveghx ----------
panel_3 = Panel(saveandsaveghx)

# ----
# VIEWCAPTURE
save_viewcapture = BooleanToggle(False)
open_viewcapture_after_saving = BooleanToggle(False)
viewcapturewidth = Slider(1920, range=0..10000)
viewcaptureheight = Slider(1080, range=0..10000)
viewcapturetofile = ViewCaptureToFile(
    Toggle=save_viewcapture,
    Width=viewcapturewidth,
    Height=viewcaptureheight,
    Grid=Toggle(False),
    WorldAxes=Toggle(False),
    CPlaneAxes=Toggle(False),
    OpenFile=open_viewcapture_after_saving)  # -> Path; inputs Toggle: Boolean, Width: Int32, Height: Int32, BackgroundColor: Color, Grid: Boolean, WorldAxes: Boolean, CPlaneAxes: Boolean, OpenFile: Boolean
# ---------- viewcapturetofile: Python ----------
# PYTHON STANDARD LIBRARY IMPORTS
import os
import datetime

# RHINO SDK IMPORTS
import System
import Rhino
import Grasshopper
import scriptcontext as sc

# GHENV COMPONENT SETTINGS
ghenv.Component.Name = "ViewCaptureToFile"
ghenv.Component.NickName = "ViewCaptureToFile"
ghenv.Component.Category = "DDU_CSC"
ghenv.Component.SubCategory = "8 Visualisation"


class ViewCaptureToFile(Grasshopper.Kernel.GH_ScriptInstance):
    """
    Author: Max Eschenbach (based on a GhPython Script by Anders Holden Deleuran)
    License: MIT License
    Version: 250820
    """

    def checkOrMakeFolder(self):
        """
        Check/makes a "Captures" folder in the GH def folder and a subfolder
        in the format 'YYMMDD'.
        """
        # construct timestamp for subfolder
        date = datetime.date.today()
        yy = str(date.year)[-2:]
        mm = str(date.month).zfill(2)
        dd = str(date.day).zfill(2)
        timestamp = yy + mm + dd
        docpath = ghdoc.Path
        if docpath:
            folder = os.path.dirname(docpath)
            captureFolder = folder + "\\Captures\\" + timestamp
            if not os.path.isdir(captureFolder):
                os.makedirs(captureFolder)
            return captureFolder

    def makeFileName(self):
        """ Make a string with the gh def name + current hourMinuteSecond """
        # Make hour minute seconds string
        n = datetime.datetime.now()
        ho, mt, sc = str(n.hour), str(n.minute), str(n.second)
        if len(ho) == 1:
            ho = "0" + ho
        if len(mt) == 1:
            mt = "0" + mt
        if len(sc) == 1:
            sc = "0" + sc
        hms = ho + mt + sc
        # Get name of GH def
        ghDef = ghdoc.Name.strip("*")
        # Concatenate and return
        fileName = ghDef + "_" + hms
        return fileName

    def captureActiveViewToFile(
            self,
            width,
            height,
            path,
            grid,
            worldAxes,
            cplaneAxes):
        """
        Captures the active view to an image file at the path.
        Path looks like this:
        "C:\\Users\\user\\Desktop\\Captures\\foo_bar.png"
        """
        # Set the script context to the current Rhino doc
        sc.doc = Rhino.RhinoDoc.ActiveDoc
        # Get the active view and set image dimensions
        activeView = sc.doc.Views.ActiveView
        # Perform the capture
        try:
            viewcap = Rhino.Display.ViewCapture()
            viewcap.DrawGrid = grid
            viewcap.DrawGridAxes = worldAxes
            viewcap.DrawAxes = cplaneAxes
            viewcap.Height = height
            viewcap.Width = width
            imageCap = viewcap.CaptureToBitmap(activeView)
            System.Drawing.Bitmap.Save(imageCap, path)
            Rhino.RhinoApp.WriteLine(path)
            sc.doc = ghdoc
            return path
        except Exception as e:
            print(e)
            sc.doc = ghdoc
            raise Exception(" Capture failed, check the path")

    def RunScript(self,
            Toggle: bool,
            Width: int,
            Height: int,
            BackgroundColor: System.Drawing.Color,
            Grid: bool,
            WorldAxes: bool,
            CPlaneAxes: bool,
            OpenFile: bool):
        # Set background color
        if BackgroundColor:
            Rhino.ApplicationSettings.AppearanceSettings.ViewportBackgroundColor = BackgroundColor
        # Capture
        Path = Grasshopper.DataTree[object]()
        if Toggle:
            if not Width:
                Width = 1920
            if not Height:
                Height = 1080
            capFolder = self.checkOrMakeFolder()
            fileName = self.makeFileName()
            try:
                path = os.path.join(capFolder, fileName + ".png")
                Path = self.captureActiveViewToFile(Width, Height, path, Grid, WorldAxes, CPlaneAxes)
                if OpenFile:
                    os.startfile(path)
            except Exception as e:
                print(e)
                raise Exception(" Capture failed, save the GH definition")
        # return outputs if you have them; here I try it for you:
        return Path
# ---------- end viewcapturetofile ----------
panel_4 = Panel(viewcapturetofile)

comments_notes_2 = Panel("VALIDATION")
debrep = DeconstructBrep()  # -> Faces, Edges, Vertices
cpl = CustomPreviewLineweights(Geometry=debrep.Edges, Thickness=Slider(2, range=0..10))  # inputs Geometry: list, Color: list of Color
# ---------- cpl: Python ----------
"""
Custom Preview with Lineweights.
    Inputs:
        Geometry: The geometry to preview. {list, GeometryBase}
        Color: The preview color per geometry item. {list, System.Drawing.Color}
        Thickness: The thickness of the wire display. {item, int}
    Remarks:
        Author: Max Eschenbach
        License: MIT License
        Version: 231122
"""

# PYTHON STANDARD LIBRARY IMPORTS
from __future__ import division, print_function
import json
import math

# GHPYTHON SDK IMPORTS
from ghpythonlib.componentbase import executingcomponent as component
import Grasshopper, GhPython
import System
import Rhino
import rhinoscriptsyntax as rs

# GHENV COMPONENT SETTINGS
ghenv.Component.Name = "CustomPreviewLineweights"
ghenv.Component.NickName = "CPL"
ghenv.Component.Category = "FindersKeepers"
ghenv.Component.SubCategory = "4 Visualisation"

class CustomPreviewLineweights(component):
    
    def __init__(self):
        super(CustomPreviewLineweights, self).__init__()
        
        self.draw_lines = System.Collections.Generic.List[Rhino.Geometry.Line]()
        self.draw_curves = []
        self.draw_color = []
        self.draw_thickness = None
    
    
    def RunScript(self, Geometry, Color, Thickness):
        
        self.draw_lines = System.Collections.Generic.List[Rhino.Geometry.Line]()
        self.draw_curves = []
        self.draw_color = None
        self.draw_thickness = None
        
        if not Color:
            self.draw_color = [System.Drawing.Color.Black]
        else:
            self.draw_color = Color
        
        if not Thickness:
            self.draw_thickness = 1
        else:
            self.draw_thickness = Thickness
        
        if Geometry:
            for i, geo in enumerate(Geometry):
                if isinstance(geo, Rhino.Geometry.Line):
                    self.draw_curves.Add(Rhino.Geometry.LineCurve(geo))
                elif isinstance(geo, Rhino.Geometry.Curve):
                    self.draw_curves.append(geo)
                elif isinstance(geo, Rhino.Geometry.LineCurve):
                    self.draw_curves.Add(geo)
                elif isinstance(geo, Rhino.Geometry.Rectangle3d):
                    self.draw_curves.append(geo.ToNurbsCurve())
                else:
                    print(type(geo))
    
    
    def get_ClippingBox(self):
        return Rhino.Geometry.BoundingBox()
    
    
    def DrawViewportWires(self, arg):
        try:
            for i, crv in enumerate(self.draw_curves):
                if i >= len(self.draw_color):
                    col = self.draw_color[-1]
                else:
                    col = self.draw_color[i]
                if not col:
                    rml = self.RuntimeMessageLevel.Remark
                    self.AddRuntimeMessage(rml, 'Expected Color, got NoneType! '
                                                 'Substituting with Black...')
                    col = System.Drawing.Color.Black
                arg.Display.DrawCurve(crv, col, self.draw_thickness)
        except Exception, e:
            rml = self.RuntimeMessageLevel.Warning
            self.AddRuntimeMessage(rml, 'Error while drawing Preview!')
            # System.Windows.Forms.MessageBox.Show(
            #                     str(e),
            #                     'Error while drawing preview!')
# ---------- end cpl ----------

comments_notes_3 = Panel("ADDING MATERIALS / COMPONENTS")

# ----
# comments & notes: Implement New Component Spec!
componentid = Panel("")
material = ValueList({"corian", "concrete", "timber", "aluminium", "steel"}, selected="timber")
type = ValueList({"sheet", "rubble", "beam", "column", "profile"}, selected="beam")
geometry_2 = Data()
createcomponent = CreateComponent(
    ComponentID=componentid,
    Type=type,
    Material=material,
    Geometry=geometry_2,
    Color=ColourSwatch(SwatchColor=RGB(207, 194, 126)))  # -> out, ComponentData; inputs ComponentID: String, Type: String, Material: String, Geometry: GeometryBase, Color: Color
# ---------- createcomponent: Python ----------
#! python3
# venv: DDU_CSC
# r: requests==2.31.0
# r: numpy==1.26.4
# r: scipy==1.13.0
# r: scikit-learn==1.4.2

import json
import uuid

import numpy as np
from scipy.spatial import ConvexHull
from sklearn.decomposition import PCA

import System
import Grasshopper
import Rhino

# GHENV COMPONENT SETTINGS
ghenv.Component.Name = "CreateComponent"
ghenv.Component.NickName = "CreateComponent"
ghenv.Component.Category = "DDU_CSC"
ghenv.Component.SubCategory = "3 Component Operations"


class CSC_CreateComponent(Grasshopper.Kernel.GH_ScriptInstance):
    """
    Author: Max Benjamin Eschenbach
    License: MIT License
    Version: 250820
    """

    def minimum_bounding_rectangle(self, points):
        # Compute the convex hull of the points
        hull = ConvexHull(points)
        hull_points = points[hull.vertices]
        # Initialize variables to keep track of the best rectangle
        min_area = float('inf')
        best_rectangle = None
        best_angle = 0
        # Loop through each edge of the convex hull
        for i in range(len(hull_points)):
            # Determine the points forming the current edge
            p1 = hull_points[i]
            p2 = hull_points[(i + 1) % len(hull_points)]
            # Calculate edge vector
            edge_vec = p2 - p1
            # Rotate the points to align this edge with the x-axis
            angle = np.arctan2(edge_vec[1], edge_vec[0])
            cos_angle = np.cos(-angle)
            sin_angle = np.sin(-angle)
            rot_matrix = np.array([[cos_angle, -sin_angle],
                                   [sin_angle, cos_angle]])
            rotated_points = np.dot(points, rot_matrix.T)
            # Compute the min/max x/y in the rotated points
            min_x = np.min(rotated_points[:, 0])
            max_x = np.max(rotated_points[:, 0])
            min_y = np.min(rotated_points[:, 1])
            max_y = np.max(rotated_points[:, 1])
            # Calculate area of the bounding rectangle
            area = (max_x - min_x) * (max_y - min_y)
            if area < min_area:
                min_area = area
                best_angle = angle
                # Create the rectangle in the rotated space
                # and then rotate it back
                best_rectangle = np.array([
                    [min_x, min_y],
                    [max_x, min_y],
                    [max_x, max_y],
                    [min_x, max_y]
                ])
                inv_rot_matrix = np.array([[cos_angle, sin_angle],
                                           [-sin_angle, cos_angle]])
                best_rectangle = np.dot(best_rectangle, inv_rot_matrix.T)
        # return results
        return best_rectangle, best_angle

    def transformation_matrix(self, rectangle, angle):
        # Compute the centroid of the rectangle
        centroid = np.mean(rectangle, axis=0)
        # Calculate translation to the origin
        translate_to_origin = np.eye(4)
        translate_to_origin[0, 3] = -centroid[0]
        translate_to_origin[1, 3] = -centroid[1]
        # Calculate rotation to align the long side with the x-axis
        rotate = np.eye(4)
        cos_angle = np.cos(-angle)
        sin_angle = np.sin(-angle)
        rotate[0, 0] = cos_angle
        rotate[0, 1] = -sin_angle
        rotate[1, 0] = sin_angle
        rotate[1, 1] = cos_angle
        # Combine transformations
        transformation = np.dot(rotate, translate_to_origin)
        return transformation

    def compute_pca_bounding_box(self, points):
        # normalize the data by subtracting the mean
        mean = np.mean(points, axis=0)
        centered_points = points - mean
        # apply PCA to find the principal axes
        pca = PCA(n_components=3)
        pca.fit(centered_points)
        # project the normalized points onto the PCA axes
        transformed_points = pca.transform(centered_points)
        # find the bounds along the principal axes
        min_bounds = np.min(transformed_points, axis=0)
        max_bounds = np.max(transformed_points, axis=0)
        # define the 8 corners of the bounding box in the PCA coordinate system
        corners = np.array([
            [min_bounds[0], min_bounds[1], min_bounds[2]],
            [max_bounds[0], min_bounds[1], min_bounds[2]],
            [max_bounds[0], max_bounds[1], min_bounds[2]],
            [min_bounds[0], max_bounds[1], min_bounds[2]],
            [min_bounds[0], min_bounds[1], max_bounds[2]],
            [max_bounds[0], min_bounds[1], max_bounds[2]],
            [max_bounds[0], max_bounds[1], max_bounds[2]],
            [min_bounds[0], max_bounds[1], max_bounds[2]]
        ])
        # calculate the transformation matrix to align
        # the PCA bounding box with the world axes
        extents = max_bounds - min_bounds
        sorted_indices = np.argsort(-extents)
        sorted_components = pca.components_[sorted_indices]
        # transformation matrix: Rotate back to align
        # with original axes, then translate to origin
        rotation_matrix = sorted_components
        transformation_matrix = np.eye(4)
        transformation_matrix[:3, :3] = rotation_matrix
        transformed_mean = rotation_matrix.dot(mean)
        transformation_matrix[:3, 3] = -transformed_mean
        transformation_matrix_inv = np.linalg.inv(transformation_matrix)
        # return results
        return (sorted_components,
                corners,
                transformation_matrix,
                transformation_matrix_inv)

    def rhino_xform(self, transformation_matrix):
        XForm = Rhino.Geometry.Transform.Identity
        XForm.M00 = transformation_matrix[0][0]
        XForm.M01 = transformation_matrix[0][1]
        XForm.M02 = transformation_matrix[0][2]
        XForm.M03 = transformation_matrix[0][3]
        XForm.M10 = transformation_matrix[1][0]
        XForm.M11 = transformation_matrix[1][1]
        XForm.M12 = transformation_matrix[1][2]
        XForm.M13 = transformation_matrix[1][3]
        XForm.M20 = transformation_matrix[2][0]
        XForm.M21 = transformation_matrix[2][1]
        XForm.M22 = transformation_matrix[2][2]
        XForm.M23 = transformation_matrix[2][3]
        return XForm

    def compute_minimum_bounds(self, geometry: Rhino.Geometry.GeometryBase):
        compute_3d = False
        # HANDLE BREP
        if isinstance(geometry, Rhino.Geometry.Brep):
            points = np.array([[p.Location.X,
                                p.Location.Y,
                                p.Location.Z] for p in Geometry.Vertices])
            compute_3d = True
        # HANDLE EXTRUSIONS
        elif isinstance(geometry, Rhino.Geometry.Extrusion):
            brep = geometry.ToBrep()
            points = np.array([[p.Location.X,
                                p.Location.Y,
                                p.Location.Z] for p in brep.Vertices])
            compute_3d = True
        # HANDLE MESH
        elif isinstance(geometry, Rhino.Geometry.Mesh):
            # get points
            points = np.array([[p.X, p.Y, p.Z] for p in geometry.Vertices])
            compute_3d = True
        # HANDLE POLYLINECURVE
        elif isinstance(geometry, Rhino.Geometry.PolylineCurve):
            pl = geometry.ToPolyline()
            atol = Rhino.RhinoDoc.ActiveDoc.ModelAbsoluteTolerance
            angtol = Rhino.RhinoDoc.ActiveDoc.ModelAngleToleranceRadians
            pl.RemoveNearlyEqualSubsequentPoints(atol)
            pl.MergeColinearSegments(angtol, True)
            pl.ReduceSegments(atol)
            points = np.array([[p.X, p.Y] for p in pl])
            compute_3d = False
        else:
            raise RuntimeError('Minimum BBX not implemented '
                               f'for geometry of type {type(Geometry)}!')
        # PROCESSING RESULTS FOR OUTPUT
        if compute_3d:
            # compute bbx
            (principal_axes,
             bbox_corners,
             transformation_matrix,
             transformation_matrix_inv) = self.compute_pca_bounding_box(points)
            # get xform
            XForm = self.rhino_xform(transformation_matrix)
            # create bbx and aligned bbx
            AlignedBBX = [Rhino.Geometry.Point3d(p[0], p[1], p[2])
                          for p in bbox_corners]
            # create aligned geometry
            AlignedGeometry = geometry
            AlignedGeometry.Transform(XForm)
        else:
            mbr, angle = self.minimum_bounding_rectangle(points)
            transformation_matrix = self.transformation_matrix(mbr, angle)
            # create rhino xform
            XForm = self.rhino_xform(transformation_matrix)
            # create aligned geometry
            AlignedGeometry = geometry
            AlignedGeometry.Transform(XForm)
            # create bbxes
            AlignedBBX = [Rhino.Geometry.Point3d(p[0], p[1], 0) for p in mbr]
            [pt.Transform(XForm) for pt in AlignedBBX]
        # return results
        return (AlignedBBX, AlignedGeometry)

    def validate_uuid(self, uuid_to_test: str, version: int = 4):
        """
        Check if uuid_to_test is a valid UUID.
        Returns True if uuid_to_test is a valid UUID, otherwise False.
        """
        try:
            uuid_obj = uuid.UUID(uuid_to_test, version=version)
        except ValueError:
            return False
        return str(uuid_obj) == uuid_to_test

    def RunScript(self,
            ComponentID: str,
            Type: str,
            Material: str,
            Geometry: Rhino.Geometry.GeometryBase,
            Color: System.Drawing.Color):
        
        # set up output trees and results tuple
        ComponentData = Grasshopper.DataTree[System.Object]()
        # sanitize input and abort if not present
        if not ComponentID:
            rml = ghenv.Component.RuntimeMessageLevel.Warning
            msg = 'Input ComponentID failed to collect data!'
            ghenv.Component.AddRuntimeMessage(rml, msg)
            return ComponentData
        elif not self.validate_uuid(ComponentID):
            rml = ghenv.Component.RuntimeMessageLevel.Error
            msg = 'Input ComponentID is not a valid UUID! Aborting...'
            ghenv.Component.AddRuntimeMessage(rml, msg)
            return ComponentData
        if not Type:
            rml = ghenv.Component.RuntimeMessageLevel.Warning
            msg = 'Input Type failed to collect data!'
            ghenv.Component.AddRuntimeMessage(rml, msg)
            return ComponentData
        if not Material:
            rml = ghenv.Component.RuntimeMessageLevel.Warning
            msg = 'Input Material failed to collect data!'
            ghenv.Component.AddRuntimeMessage(rml, msg)
            return ComponentData
        if not Color:
            rml = ghenv.Component.RuntimeMessageLevel.Remark
            msg = ('Input Color failed to collect data.'
                   'Will use Grey as default Color.')
            print(msg)
            ghenv.Component.AddRuntimeMessage(rml, msg)
            Color = System.Drawing.Color.FromArgb(255, 175, 175, 175)
        if not Geometry:
            rml = ghenv.Component.RuntimeMessageLevel.Warning
            msg = 'Input Geometry failed to collect data!'
            ghenv.Component.AddRuntimeMessage(rml, msg)
            return ComponentData
        elif not Geometry.IsValid:
            rml = ghenv.Component.RuntimeMessageLevel.Error
            msg = 'Input Geometry is invalid!'
            ghenv.Component.AddRuntimeMessage(rml, msg)
            return ComponentData
        # create component data dictionary
        COMPDATA = {
            '_id': ComponentID,
            'type': Type,
            'material': Material,
            'materialthickness': MaterialThickness,
            'geometry': {},
            'color': [Color.R, Color.G, Color.B],
            'validated': False,
            'bbx': {
                'xy': None,
                'xyz': None
            },
            'iframe': {
                'o': [0.0, 0.0, 0.0],
                'x': [1.0, 0.0, 0.0],
                'y': [0.0, 1.0, 0.0],
                'z': [0.0, 0.0, 1.0]
            }
        }
        # TYPE FILTERING
        if Type == 'rubble':
            if not isinstance(Geometry, Rhino.Geometry.Mesh):
                msg = ('The "rubble" type expects a Mesh as '
                    'geometry input! Please ensure and try again.')
                print(msg)
                raise ValueError(msg)
        elif Type == 'sheet':
            if not (isinstance(Geometry, Rhino.Geometry.PolylineCurve) or 
                    isinstance(Geometry, Rhino.Geometry.Polyline)):
                msg = ('The "sheet" type expects a polyline as '
                    'geometry input! Please ensure and try again.')
                print(msg)
                raise ValueError(msg)
            if not MaterialThickness:
                msg = ('The "sheet" type expects a value for '
                       '"MaterialThickness"! Please ensure and try again.')
                print(msg)
                raise ValueError(msg)
        # process geometry input
        # HANDLE POLYLINE AND POLYLINECURVE
        if (isinstance(Geometry, Rhino.Geometry.Polyline) or
            isinstance(Geometry, Rhino.Geometry.PolylineCurve)):
            bbx_xy, aligned_geometry = self.compute_minimum_bounds(Geometry)
            bbxdata = {
                'xy': [[pt.X, pt.Y] for pt in bbx_xy],
            }
            COMPDATA['bbx'].update(bbxdata)
            # create geometry dict
            polyline = [[p.X, p.Y] for p in aligned_geometry.ToPolyline()]
            comp_polyline = {
                'polyline': polyline
            }
            COMPDATA['geometry'].update(comp_polyline)
        # HANDLE MESH
        elif isinstance(Geometry, Rhino.Geometry.Mesh):
            Geometry.Faces.ConvertQuadsToTriangles()
            Geometry.Compact()
            # compute minimum bounding box
            bbx_xyz, aligned_geometry = self.compute_minimum_bounds(Geometry)
            # create bbx dict
            bbxdata = {
                'xyz': [[pt.X, pt.Y, pt.Z] for pt in bbx_xyz]
            }
            COMPDATA['bbx'].update(bbxdata)
            mt = bbx_xyz[0].DistanceTo(bbx_xyz[4])
            COMPDATA['materialthickness'] = mt
            # create geometry dict
            vertices = [[p.X, p.Y, p.Z] for p in aligned_geometry.Vertices]
            faces = [[f[0], f[1], f[2]] for f in aligned_geometry.Faces]
            comp_mesh = {
                'mesh': {
                    'v': vertices,
                    'f': faces
                }
            }
            COMPDATA['geometry'].update(comp_mesh)
        # HANDLE BREP
        elif isinstance(Geometry, Rhino.Geometry.Brep):
            raise RuntimeError('Geometry Processing for geometry of '
                               f'type {type(Geometry)} not implemented yet! '
                               'Please convert to Mesh and try again.')
        elif isinstance(Geometry, Rhino.Geometry.Extrusion):
            raise RuntimeError('Geometry Processing for geometry of '
                               f'type {type(Geometry)} not implemented yet! '
                               'Please convert to Mesh and try again.')
        else:
            raise RuntimeError('Geometry Processing for geometry of '
                               f'type {type(Geometry)} not implemented yet! '
                               'Please convert to Mesh and try again.')
        # create json string
        ComponentData = json.dumps(COMPDATA)
        # return output
        return ComponentData
# ---------- end createcomponent ----------
log = Panel(createcomponent.out)
componentdata = Data(createcomponent.ComponentData)

# ----
# comments & notes: Sign-In to API Backend
password = Panel("!ddu2024@")
# comments & notes: RETRIEVING & FILTERING, VISUALIZING COMPONENTS
username = Panel("ddu")
refresh = Button()
signin = SignIn(Username=username, Password=password, Refresh=refresh)  # inputs Username: String, Password: String, Refresh: Boolean
# ---------- signin: Python ----------
#! python3
# venv: DDU_CSC
# r: requests==2.31.0
# r: numpy==1.26.4
# r: scipy==1.13.0
# r: scikit-learn==1.4.2

# PYTHON STANDARD LIBRARY IMPORTS ---------------------------------------------
import time
import json
import base64
from threading import RLock

# THIRD PARTY LIBRARY IMPORTS -------------------------------------------------
import requests

# RHINO AND GH RELATED IMPORTS ------------------------------------------------
import System  # type: ignore[reportMissingImport] # NOQA
import Rhino  # type: ignore[reportMissingImport] # NOQA
import Grasshopper  # type: ignore[reportMissingImport] # NOQA
import scriptcontext as sc  # type: ignore[reportMissingImport] # NOQA

# GHENV COMPONENT SETTINGS ----------------------------------------------------
ghenv.Component.Name = 'SignIn'  # type: ignore[reportUnedfinedVariable] # NOQA
ghenv.Component.NickName = 'SignIn'  # type: ignore[reportUnedfinedVariable] # NOQA
ghenv.Component.Category = 'DDU_CSC'  # type: ignore[reportUnedfinedVariable] # NOQA
ghenv.Component.SubCategory = '1 User'  # type: ignore[reportUnedfinedVariable] # NOQA


# AuthCore - Embedded ---------------------------------------------------------

class _AuthCore(object):
    def __init__(self, base_url, leeway=30):
        self.base_url = (base_url or 'https://api.ddu.uber.space').rstrip('/')
        self.leeway = int(leeway) if leeway is not None else 30
        self._lock = RLock()
        self._token = None
        self._exp = 0
        self._username = None

    @staticmethod
    def _now():
        return int(time.time())

    @staticmethod
    def _b64url_decode(seg):
        rem = len(seg) % 4
        if rem:
            seg += '=' * (4 - rem)
        return base64.urlsafe_b64decode(seg.encode('utf-8'))

    @classmethod
    def _jwt_payload(cls, token):
        try:
            parts = token.split('.')
            if len(parts) != 3:
                return {}
            return json.loads(cls._b64url_decode(parts[1]).decode('utf-8'))
        except Exception:
            return {}

    def set_access_token(self, token, username=None):
        payload = self._jwt_payload(token)
        exp = int(payload.get('exp', 0))
        if exp <= 0:
            exp = self._now() + 3600  # 1h fallback if no exp claim
        with self._lock:
            self._token = token
            self._exp = exp
            if username:
                self._username = username

    def clear(self):
        with self._lock:
            self._token = None
            self._exp = 0
            self._username = None

    def is_valid(self):
        with self._lock:
            if not self._token or self._exp <= 0:
                return False
            return (self._now() + self.leeway) < self._exp

    def get_username(self):
        with self._lock:
            return self._username

    def auth_header(self):
        with self._lock:
            return ({'Authorization': 'Bearer ' + self._token}
                    if self._token else {})

    def authorized_get(
            self,
            path,
            params=None,
            extra_headers=None,
            timeout=20):
        if not self.is_valid():
            raise RuntimeError(
                'Access token missing or expired. Please sign in again.'
            )
        headers = self.auth_header()
        if extra_headers:
            headers.update(extra_headers)
        return requests.get(
            self.base_url + path,
            params=params,
            headers=headers,
            timeout=timeout
        )

    def authorized_post(
            self,
            path,
            json_body=None,
            extra_headers=None,
            timeout=20):
        if not self.is_valid():
            raise RuntimeError(
                'Access token missing or expired. Please sign in again.'
            )
        headers = self.auth_header()
        if extra_headers:
            headers.update(extra_headers)
        return requests.post(
            self.base_url + path,
            json=json_body,
            headers=headers,
            timeout=timeout
        )


class CSC_SignIn(Grasshopper.Kernel.GH_ScriptInstance):
    """
    Author: Max Benjamin Eschenbach
    License: MIT License
    Version: 250822
    """

    def __init__(self):
        super().__init__()
        # initialize props
        self.Component = ghenv.Component  # type: ignore[reportUnedfinedVariable] # NOQA
        self.InputParams = self.Component.Params.Input
        self.OutputParams = self.Component.Params.Output

    def _addRemark(self, msg: str = ''):
        rml = self.Component.RuntimeMessageLevel.Remark
        self.AddRuntimeMessage(rml, msg)

    def _addWarning(self, msg: str = ''):
        rml = self.Component.RuntimeMessageLevel.Warning
        self.AddRuntimeMessage(rml, msg)

    def _addError(self, msg: str = ''):
        rml = self.Component.RuntimeMessageLevel.Error
        self.AddRuntimeMessage(rml, msg)

    def get_auth_core_from_sticky(self):
        """Get AuthCore instance from sticky storage or create new one."""
        auth_core = sc.sticky.get('CSC_AuthCore')
        if auth_core is None:
            # Create new AuthCore instance with default settings
            auth_core = _AuthCore(base_url='https://api.ddu.uber.space')
            sc.sticky['CSC_AuthCore'] = auth_core
        return auth_core

    def RunScript(self, Username: str, Password: str, Refresh: bool):
        # Initialize param descriptions (this has to be done in RunScript)
        self.InputParams[0].Description = 'Your Username or E-Mail'
        self.InputParams[1].Description = 'Your password'
        self.InputParams[2].Description = (
            'Refresh toggle, press when your token expired')

        # Get or create AuthCore instance
        auth_core = self.get_auth_core_from_sticky()

        # Input validation
        if not Username or not Username.strip():
            self.Component.Message = 'Please provide username/email'
            return

        if not Password or not Password.strip():
            self.Component.Message = 'Please provide password'
            return

        username = Username.strip()
        password = Password.strip()

        try:
            if Refresh:
                # Refresh authentication - clear existing token and re-auth
                auth_core.clear()
                self.Component.Message = 'Refreshing authentication...'
            else:
                # Check if we already have a valid token
                if auth_core.is_valid():
                    current_user = auth_core.get_username()
                    self.Component.Message = (
                        f'Already signed in as: {current_user}'
                    )
                    return

                self.Component.Message = 'Signing in...'

            # Prepare login data
            login_data = {
                'username': username,
                'password': password
            }

            # Make login request
            response = requests.post(
                f'{auth_core.base_url}/auth/token',
                data=login_data,
                headers={
                    'Content-Type': 'application/x-www-form-urlencoded'
                },
                timeout=20
            )

            if response.status_code == 200:
                # Login successful
                token_data = response.json()
                access_token = token_data.get('access_token')

                if access_token:
                    # Store token in AuthCore
                    auth_core.set_access_token(access_token, username)

                    # Update sticky storage
                    sc.sticky['CSC_AuthCore'] = auth_core

                    self.Component.Message = f'Signed in as: {username}'
                else:
                    msg = 'Login failed: No token received'
                    self._addWarning(msg)
                    self.Component.Message = msg

            elif response.status_code == 401:
                msg = 'Invalid username or password'
                self._addError(msg)
                self.Component.Message = msg

            elif response.status_code == 422:
                msg = 'Invalid input data'
                self._addError(msg)
                self.Component.Message = msg

            elif response.status_code == 500:
                msg = 'Server error - please try again'
                self._addWarning(msg)
                self.Component.Message = msg

            else:
                msg = 'Login failed: {response.status_code}'
                self._addError(msg)
                self.Component.Message = msg

        except requests.exceptions.ConnectionError as e:
            msg = 'Cannot connect to server - check URL'
            self._addError(msg + f'\nFull Error: {str(e)}')
            self.Component.Message = msg

        except requests.exceptions.Timeout as e:
            msg = 'Request timeout - server may be slow'
            self._addError(msg + f'\nFull Error: {str(e)}')
            self.Component.Message = msg

        except requests.exceptions.RequestException as e:
            msg = f'Request error: {str(e)}'
            self._addError(msg)
            self.Component.Message = msg

        except Exception as e:
            self.Component.Message = f'Unexpected error: {str(e)}'
# ---------- end signin ----------

# ----
# comments & notes: Get Components from Rhino Document
button = Button()
syncwithrhinodoc = SyncWithRhinoDoc(Sync=button)  # -> out, DocumentComponents; inputs Sync: Boolean
# ---------- syncwithrhinodoc: Python ----------
#! python3
# venv: DDU_CSC
# r: requests==2.31.0
# r: numpy==1.26.4
# r: scipy==1.13.0
# r: scikit-learn==1.4.2

import json

import System
import Rhino
import Grasshopper
import rhinoscriptsyntax as rs
import scriptcontext as sc

# GHENV COMPONENT SETTINGS
ghenv.Component.Name = "SyncWithRhinoDoc"
ghenv.Component.NickName = "SyncWithRhinoDoc"
ghenv.Component.Category = "DDU_CSC"
ghenv.Component.SubCategory = "3 Component Operations"


class CSC_SyncWithRhinoDoc(Grasshopper.Kernel.GH_ScriptInstance):
    """
    Author: Max Benjamin Eschenbach
    License: MIT License
    Version: 250820
    """

    LAST_SYNC = Grasshopper.DataTree[object]()

    def RunScript(self, Sync: bool):
        # set sc doc to rhino doc
        sc.doc = Rhino.RhinoDoc.ActiveDoc

        if Sync:
            lay_parent = 'CSC_COMPONENTS'
            self.LAST_SYNC = Grasshopper.DataTree[object]()
            # get layers
            if rs.IsLayer(lay_parent):
                comp_lays = rs.LayerChildren(lay_parent)
                # loop over all layers
                for i, lay in enumerate(comp_lays):
                    ghp = Grasshopper.Kernel.Data.GH_Path(i)
                    # retrieve objects on layer
                    objects = rs.ObjectsByLayer(lay)
                    for o in objects:
                        if rs.IsText(o):
                            tagplane = rs.coercegeometry(o).Plane
                            tagframe = {
                                'o': [tagplane.OriginX,
                                      tagplane.OriginY,
                                      tagplane.OriginZ],
                                'x': [tagplane.XAxis.X,
                                      tagplane.XAxis.Y,
                                      tagplane.XAxis.Z],
                                'y': [tagplane.YAxis.X,
                                      tagplane.YAxis.Y,
                                      tagplane.YAxis.Z],
                                'z': [tagplane.ZAxis.X,
                                      tagplane.ZAxis.Y,
                                      tagplane.ZAxis.Z]
                            }
                            data = rs.GetUserText(o, 'componentdata')
                            data_obj = json.loads(data)
                            data_obj['iframe'].update(tagframe)
                            data = json.dumps(data_obj)
                            self.LAST_SYNC.Add(data, ghp)
        if self.LAST_SYNC.DataCount < 1:
            rml = ghenv.Component.RuntimeMessageLevel.Warning
            msg = 'Document out of Sync or no Components in Document!'
            print(msg)
            ghenv.Component.AddRuntimeMessage(rml, msg)
        
        sc.doc = ghdoc
        return self.LAST_SYNC
# ---------- end syncwithrhinodoc ----------
log_2 = Panel(syncwithrhinodoc.out)
panel_5 = Panel(syncwithrhinodoc.DocumentComponents)

# ----
# comments & notes: Fetch a single component or multiple components from the database
componentid_2 = Panel("01163af8-b178-4ec3-8281-19e2189ac059")
fetchcomponents = FetchComponents(ComponentID=componentid_2)  # -> ComponentData; inputs ComponentID: list of String
# ---------- fetchcomponents: Python ----------
#! python3
# venv: DDU_CSC
# r: requests==2.31.0
# r: numpy==1.26.4
# r: scipy==1.13.0
# r: scikit-learn==1.4.2

# PYTHON STANDARD LIBRARY IMPORTS ---------------------------------------------
import json
import uuid

# THIRD PARTY LIBRARY IMPORTS -------------------------------------------------
import requests

# RHINO AND GH RELATED IMPORTS ------------------------------------------------
import System  # type: ignore[reportMissingImport] # NOQA
import Grasshopper  # type: ignore[reportMissingImport] # NOQA
import Rhino  # type: ignore[reportMissingImport] # NOQA
import scriptcontext as sc  # type: ignore[reportMissingImport] # NOQA

# GHENV COMPONENT SETTINGS ----------------------------------------------------
ghenv.Component.Name = 'FetchComponents'  # type: ignore[reportUnedfinedVariable] # NOQA
ghenv.Component.NickName = 'FetchComponents'  # type: ignore[reportUnedfinedVariable] # NOQA
ghenv.Component.Category = 'DDU_CSC'  # type: ignore[reportUnedfinedVariable] # NOQA
ghenv.Component.SubCategory = '2 Catalogue Interface'  # type: ignore[reportUnedfinedVariable] # NOQA


class CSC_FetchComponents(Grasshopper.Kernel.GH_ScriptInstance):
    """
    Author: Max Benjamin Eschenbach
    License: MIT License
    Version: 250822
    """

    def __init__(self):
        super().__init__()
        # initialize props
        self.Component = ghenv.Component  # type: ignore[reportUnedfinedVariable] # NOQA
        self.InputParams = self.Component.Params.Input
        self.OutputParams = self.Component.Params.Output

    def _addRemark(self, msg: str = ''):
        rml = self.Component.RuntimeMessageLevel.Remark
        self.AddRuntimeMessage(rml, msg)

    def _addWarning(self, msg: str = ''):
        rml = self.Component.RuntimeMessageLevel.Warning
        self.AddRuntimeMessage(rml, msg)

    def _addError(self, msg: str = ''):
        rml = self.Component.RuntimeMessageLevel.Error
        self.AddRuntimeMessage(rml, msg)

    def get_auth_core_from_sticky(self):
        """Get AuthCore instance from sticky storage."""
        auth_core = sc.sticky.get('CSC_AuthCore')
        if auth_core is None:
            msg = ('No authentication found. Please use CSC_SignIn component '
                   'first.')
            self._addError(msg)
            self.Component.Message = msg
            return None
        return auth_core

    def validate_uuid(self, uuid_to_test: str, version: int = 4):
        """
        Check if uuid_to_test is a valid UUID.
        Returns True if uuid_to_test is a valid UUID, otherwise False.
        """
        try:
            uuid_obj = uuid.UUID(uuid_to_test, version=version)
        except ValueError:
            return False
        return str(uuid_obj) == uuid_to_test

    def RunScript(self, ComponentID: System.Collections.Generic.List[str]):
        # Initialize param descriptions (this has to be done in RunScript)
        self.InputParams[0].Description = 'One or many ComponentIDs to fetch'
        self.OutputParams[0].Description = (
            'The ComponentData that was fetched from the server as JSON. '
            'Use \'DisassembleComponent\' to access the individual fields '
            'ready for Grasshopper')

        # Get AuthCore instance from sticky storage
        auth_core = self.get_auth_core_from_sticky()
        if auth_core is None:
            return

        # Check if authentication is valid
        if not auth_core.is_valid():
            msg = ('Authentication expired. Please use CSC_SignIn '
                   'component to refresh.')
            self._addError(msg)
            self.Component.Message = msg
            return

        # Validate ComponentID input
        if not ComponentID:
            msg = 'Please provide ComponentID(s) to fetch.'
            self._addWarning(msg)
            self.Component.Message = msg
            return

        # Convert to list and validate UUIDs
        component_ids = list(ComponentID)
        for _id in component_ids:
            if not self.validate_uuid(_id):
                msg = f'ComponentID <{_id}> is not a valid UUID!'
                self._addWarning(msg)
                self.Component.Message = msg
                return

        try:
            self.Component.Message = (
                f'Fetching {len(component_ids)} component(s)...'
            )

            # Set up output trees and results tuple
            ComponentData = Grasshopper.DataTree[System.Object]()
            __Results = (ComponentData,)

            # Fetch each component
            for i, _id in enumerate(component_ids):
                try:
                    # Make authenticated request to fetch specific component
                    response = auth_core.authorized_get(f'/components/{_id}')

                    if response.status_code == 200:
                        # Successfully fetched component
                        json_comp = response.json()

                        # Create datatree path
                        ghp = Grasshopper.Kernel.Data.GH_Path(i)
                        # Add component data to the datatree
                        ComponentData.Add(json.dumps(json_comp), ghp)

                        self._addRemark(
                            f'Successfully fetched component {_id}'
                        )

                    elif response.status_code == 404:
                        msg = f'Component {_id} not found on server.'
                        self._addWarning(msg)
                        self.Component.Message = msg

                    elif response.status_code == 401:
                        msg = 'Authentication failed. Please sign in again.'
                        self._addError(msg)
                        self.Component.Message = msg
                        return __Results

                    elif response.status_code == 403:
                        msg = 'Access denied. Insufficient permissions.'
                        self._addError(msg)
                        self.Component.Message = msg
                        return __Results

                    elif response.status_code == 500:
                        msg = 'Server error. Please try again later.'
                        self._addWarning(msg)
                        self.Component.Message = msg

                    else:
                        msg = (f'Request failed for component {_id} with '
                               f'status code: {response.status_code}')
                        self._addError(msg)
                        self.Component.Message = msg

                except Exception as e:
                    msg = f'Error fetching component {_id}: {str(e)}'
                    self._addError(msg)
                    self.Component.Message = msg

            # Update success message
            if ComponentData.DataCount > 0:
                self.Component.Message = (
                    f'Fetched {ComponentData.DataCount} component(s)'
                )
            else:
                self.Component.Message = 'No components fetched'

            return __Results

        except requests.exceptions.ConnectionError as e:
            msg = 'Cannot connect to server. Please check your connection.'
            self._addError(msg + f'\nFull Error: {str(e)}')
            self.Component.Message = msg

        except requests.exceptions.Timeout as e:
            msg = 'Request timeout. Server may be slow.'
            self._addError(msg + f'\nFull Error: {str(e)}')
            self.Component.Message = msg

        except requests.exceptions.RequestException as e:
            msg = f'Request error: {str(e)}'
            self._addError(msg)
            self.Component.Message = msg

        except Exception as e:
            msg = f'Unexpected error: {str(e)}'
            self._addError(msg)
            self.Component.Message = msg

        # Return empty results if there was an error
        ComponentData = Grasshopper.DataTree[System.Object]()
        __Results = (ComponentData,)
        return __Results
# ---------- end fetchcomponents ----------
componentdata_2 = Data(fetchcomponents)

# ----
# SCRIPT SOURCE & USROBJ EXPORT
source_folder = Panel("..\grasshopper_userobjects_src")
dduclayprintingslicer_userobjects_folder = Panel("..\grasshopper_userobjects")
icon_path = Panel("..\resources\250820_csc_icon_24x24.png")
exportscriptsandsource = ExportScriptsAndSource(
    RunComponentAnalysis=Toggle(False),
    ExportUserObjectsAndSource=Toggle(False),
    Category="DDU_CSC",
    UserObjFolder=dduclayprintingslicer_userobjects_folder,
    SourceFolder=source_folder,
    IconPath=icon_path)  # -> out, OldScriptsDebug, CategoryDebug, VersionDebug, InfoMessages; inputs RunComponentAnalysis: Boolean, ExportUserObjectsAndSource: Boolean, Category: String, IconPath: String
# ---------- exportscriptsandsource: Python ----------
# PYTHON STANDARD LIBRARY IMPORTS ---------------------------------------------
import os

# RHINO AND GH RELATED IMPORTS ------------------------------------------------
import System  # type: ignore[reportMissingImport] # NOQA
import Rhino  # type: ignore[reportMissingImport] # NOQA
import Grasshopper  # type: ignore[reportMissingImport] # NOQA
import scriptcontext as sc  # type: ignore[reportMissingImport] # NOQA
import GhPython as ghpy  # type: ignore[reportMissingImport] # NOQA
import ScriptComponents as scomp  # type: ignore[reportMissingImport] # NOQA
import RhinoCodePluginGH as rcpgh  # type: ignore[reportMissingImport] # NOQA

# GHENV COMPONENT SETTINGS ----------------------------------------------------
ghenv.Component.Name = "ExportScriptsAndSource"  # type: ignore[reportUnedfinedVariable] # NOQA
ghenv.Component.NickName = "ExportScriptsAndSource"  # type: ignore[reportUnedfinedVariable] # NOQA
ghenv.Component.Category = "DDU_CSC"  # type: ignore[reportUnedfinedVariable] # NOQA
ghenv.Component.SubCategory = "0 Development"  # type: ignore[reportUnedfinedVariable] # NOQA


class ExportScriptsAndSource(Grasshopper.Kernel.GH_ScriptInstance):
    """
    Author: Max Benjamin Eschenbach (based on a Python Script by Anders Holden Deleuran)  # NOQA
    License: MIT License
    Version: 250822
    """

    def get_source_version(self, source):
        """
        Attempts to get the first instance of the word "version"
        (or, "Version") in a multi line string. Then attempts to extract an
        integer from this line where the word "version" exists. So format
        version YYMMDD in the docstring like so (or any other integer system):
            Version: 160121
        """
        # Get first line with version in it
        src_lower = source.lower()
        version_str = [ln for ln in src_lower.split('\n') if "version" in ln]
        if version_str:
            # Get the first substring integer and return it
            version_int = [
                int(s) for s in version_str[0].split() if s.isdigit()
            ]
            if version_int:
                return int(version_int[0])
        else:
            return None

    def process_document_objects(self, ghdocument, verbose=False):
        """
        Processes GH_Document object and return a list of all script components
        """
        # get all document objects
        comps = list(ghdocument.Objects)

        # types of python components
        ghpycomp = ghpy.Component.ZuiPythonComponent
        ipycomp = rcpgh.Components.IronPython2Component
        py3comp = rcpgh.Components.Python3Component

        # types of csharp components
        cscomp = scomp.Component_CSNET_Script
        cs9comp = rcpgh.Components.CSharpComponent

        # cluster component
        clustercomp = Grasshopper.Kernel.Special.GH_Cluster

        # extract component type strings
        ghpycomp_str = str(ghpycomp).split("'")[1]
        cscomp_str = str(cscomp).split("'")[1]
        ipycomp_str = str(ipycomp).split("'")[1]
        py3comp_str = str(py3comp).split("'")[1]
        cs9comp_str = str(cs9comp).split("'")[1]
        clustercomp_str = str(clustercomp).split("'")[1]

        # define script types
        id_ghpycomp = 'GHPY'
        id_cscomp = 'CS'
        id_ipycomp = 'IPY2'
        id_py3comp = 'PY3'
        id_cs9comp = 'CS9'

        # init dict for script component storage
        script_components = {}

        # loop over all document components
        # store all component objects in a dictionary to check
        # - are all "same" scripts the same code?
        # - are there scripts without category or version attribute?
        # - separate old from new scripts, dont export old scripts!
        for obj in comps:
            # extract basic info
            name = obj.Name
            nickname = obj.NickName
            iguid = str(obj.InstanceGuid)
            # extract type string
            objtype_str = str(obj.GetType())
            # OLD GHPYTHON COMPONENT
            if objtype_str == ghpycomp_str:
                source = obj.Code
                if source:
                    print((f'Found Source for OLD GHPY Component "{nickname}" '
                           f'({iguid})') if verbose else None)
                    scriptcomp = [id_ghpycomp, nickname, name, obj, source]
                    script_components[iguid] = scriptcomp
            # OLD C# COMPONENT
            elif objtype_str == cscomp_str:
                source = obj.ScriptSource.ScriptCode
                if source:
                    print((f'Found Source for OLD CS Component "{nickname}" '
                           f'({iguid})') if verbose else None)
                    scriptcomp = [id_cscomp, nickname, name, obj, source]
                    script_components[iguid] = scriptcomp
            # NEW C#9 COMPONENT
            elif objtype_str == cs9comp_str:
                bres, source = obj.TryGetSource()
                if bres:
                    print((f'Found Source for CS9 Component "{nickname}" '
                           f'({iguid})') if verbose else None)
                    scriptcomp = [id_cs9comp, nickname, name, obj, source]
                    script_components[iguid] = scriptcomp
            # NEW IRONPYTHON COMPONENT
            elif objtype_str == ipycomp_str:
                bres, source = obj.TryGetSource()
                if bres:
                    print((f'Found Source for IPY2 Component "{nickname}" '
                           f'({iguid})') if verbose else None)
                    scriptcomp = [id_ipycomp, nickname, name, obj, source]
                    script_components[iguid] = scriptcomp
            # NEW PYTHON3 COMPONENT
            elif objtype_str == py3comp_str:
                bres, source = obj.TryGetSource()
                if bres:
                    print((f'Found Source for PY3 Component "{nickname}" '
                           f'({iguid})') if verbose else None)
                    scriptcomp = [id_py3comp, nickname, name, obj, source]
                    script_components[iguid] = scriptcomp
            # CLUSTER COMPONENT
            elif objtype_str == clustercomp_str:
                # RECURSIVELY STEP THROUGH CLUSTERS AND LOOK FOR SCRIPTS ...
                print((f'Processing CLUSTER "{nickname}" ({name}, '
                      f'{iguid}) ...') if verbose else None)
                cluster_scripts = self.process_document_objects(
                    obj.Document(''), verbose=verbose
                )
                # add cluster script dict to main dict
                script_components.update(cluster_scripts)

        return script_components

    def process_script_components(
            self,
            script_components: dict,
            set_category: str):
        """
        Process found script components and get unique components.
        """
        unique_script_components = {}

        OldScriptsDebug = []
        CategoryDebug = []
        VersionDebug = []
        InfoMessages = []

        for iguid, values in script_components.items():
            script_type, nickname, name, obj, source = values
            category = obj.Category
            version = self.get_source_version(source)
            script_id = nickname + ' ' + name
            # NOT SEEN YET SCRIPT COMPONENTS
            if script_id not in unique_script_components:
                version_present = True
                category_match = True
                if script_type == 'GHPY':
                    OldScriptsDebug.append(
                        f'{script_type} - {nickname} ({name})')
                    OldScriptsDebug.append(
                        '    - IS AN OLD GHPYTHON SCRIPT!')
                elif script_type == 'CS':
                    OldScriptsDebug.append(
                        f'{script_type} - {nickname} ({name})')
                    OldScriptsDebug.append('    - IS AN OLD C# SCRIPT!')
                if category != set_category:
                    # create debug info messages
                    category_match = False
                    if category == 'Maths':
                        CategoryDebug.append(
                            f'{script_type} - {nickname} ({name})')
                        CategoryDebug.append(
                            f'    - HAS NO CATEGORY ({category}) (No Export)!')
                    else:
                        CategoryDebug.append(
                            f'{script_type} - {nickname} ({name})')
                        CategoryDebug.append(
                            f'    - {category} OUT OF SET CATEGORY '
                            f'{set_category} (No Export)!')
                if version is None:
                    version_present = False
                    # create debug info messages
                    VersionDebug.append(
                        ' '.join([script_type, nickname, name]))
                    VersionDebug.append('    - HAS NO VERSION! (No Export)')
                if category_match and version_present:
                    InfoMessages.append(f'{script_type} - {nickname} ({name})')
                    unique_script_components[script_id] = values
            # ALREADY SEEN SCRIPT COMPONENTS
            else:
                existing_source = unique_script_components[script_id][4]
                existing_version = self.get_source_version(existing_source)
                if version is None:
                    VersionDebug.append(f'{script_type} - {nickname} ({name})')
                    VersionDebug.append('    - HAS NO VERSION!')
                elif existing_version is None and version is not None:
                    VersionDebug.append(f'{script_type} - {nickname} ({name})')
                    VersionDebug.append(
                        f'    - VERSION {version} > ALREADY FOUND VERSION '
                        f'{existing_version}!')
                    # REPLACE FOUND "NONE" VERSION WITH NAMED VERSION!
                    raise
                elif version < existing_version:
                    VersionDebug.append(f'{script_type} - {nickname} ({name})')
                    VersionDebug.append(
                        f'    - VERSION {version} < {existing_version}! '
                        'Continuing...')
                    # REPLACE THE SOURCE OF THE LOWER VERSION
                    # WITH HIGHER VERSION SOURCE!
                    continue
                elif version > existing_version:
                    VersionDebug.append(f'{script_type} - {nickname} ({name})')
                    VersionDebug.append(
                        f'    - VERSION {version} > ALREADY FOUND VERSION '
                        f'{existing_version}!')
                    # REPLACE THE OBJECT IN DICT WITH NEWER VERSION
                    raise
        return (unique_script_components, OldScriptsDebug, CategoryDebug,
                VersionDebug, InfoMessages)

    def export_scriptcomp_usrobj(self, scriptcomp, usrobjpath, iconpath=''):
        """
        Automates the creation of a GHPython user object. Based on this thread:
        http://www.grasshopper3d.com/forum/topics/change-the-default-values-for-userobject-popup-menu
        scriptcomp = [script_type, nickname, name, obj, source]
        """
        try:
            # Make a user object
            uo = Grasshopper.Kernel.GH_UserObject()
            # Get component object
            obj = scriptcomp[3]
            # Process icon
            if iconpath:
                obj.SetIconOverride(System.Drawing.Bitmap.FromFile(iconpath))
            uo.Icon = obj.Icon_24x24
            # Set its properties based on the GHPython component properties
            uo.BaseGuid = obj.ComponentGuid
            uo.Exposure = ghenv.Component.Exposure.primary  # type: ignore[reportUnedfinedVariable] # NOQA
            uo.Description.Name = obj.Name
            uo.Description.Description = obj.Description
            uo.Description.Category = obj.Category
            uo.Description.SubCategory = obj.SubCategory
            # Set the user object data and save to file
            uo.SetDataFromObject(obj)
            uo.Path = os.path.join(
                usrobjpath, obj.Category + '_' + obj.Name + '.ghuser')
            uo.SaveToFile()
        except Exception as e:
            print(e)
            return False
        return True

    def export_scriptcomp_source(self, scriptcomp, srcpath):
        """
        Export the source code of a script component
        scriptcomp = [script_type, nickname, name, obj, source]
        """
        # Get code and lines of code
        script_type = scriptcomp[0]
        name = scriptcomp[2]
        obj = scriptcomp[3]
        source = scriptcomp[4]
        code = source.replace('\r', '')
        lines = code.splitlines()
        loc = len(lines)
        # Check/make source file folder
        srcpath = os.path.join(srcpath)
        if not os.path.isdir(srcpath):
            os.makedirs(srcpath)
        # Write code to file
        if script_type == 'PY3' or script_type == 'IPY2':
            ext = '.py'
        elif script_type == 'CS9':
            ext = '.cs'
        else:
            # DO NOT EXPORT OLD SCRIPTS!
            ext = None
        if ext:
            src_file = os.path.join(srcpath, obj.Category + '_' + name + ext)
            with open(src_file, 'w') as f:
                f.write(code)
        return loc

    def RunScript(self,
            RunComponentAnalysis: bool,
            ExportUserObjectsAndSource: bool,
            Category: str,
            UserObjFolder,
            SourceFolder,
            IconPath: str):
        # Init outputs
        OldScriptsDebug = Grasshopper.DataTree[object]()
        CategoryDebug = Grasshopper.DataTree[object]()
        VersionDebug = Grasshopper.DataTree[object]()
        InfoMessages = Grasshopper.DataTree[object]()

        # Iterate the canvas and get to the GHPython components
        grasshopper_document = ghenv.Component.OnPingDocument()  # type: ignore[reportUnedfinedVariable] # NOQA
        gh_dir = os.path.dirname(grasshopper_document.FilePath)

        usrobjpath = os.path.normpath(
            os.path.abspath(os.path.join(gh_dir, UserObjFolder)))
        srcpath = os.path.normpath(
            os.path.abspath(os.path.join(gh_dir, SourceFolder)))
        iconpath = os.path.normpath(
            os.path.abspath(os.path.join(gh_dir, IconPath)))

        if RunComponentAnalysis:
            # loop over all objects on the grasshopper canvas
            # and identify the components to export scriptsource from
            script_components = self.process_document_objects(
                grasshopper_document, verbose=False)

            # - are all "same" scripts the same code?
            # - are there scripts without category or version attribute?
            # - separate old from new scripts, dont export old scripts!
            (unique_script_components,
             OldScriptsDebug,
             CategoryDebug,
             VersionDebug,
             InfoMessages) = self.process_script_components(
                script_components, Category)

        # HERE LOOP OVER UNIQUE COMPONENTS
        if ExportUserObjectsAndSource and RunComponentAnalysis:
            # - SAVE USEROBJECT
            # - SAVE SOURCE
            for script_id, scriptcomp in unique_script_components.items():
                loc = self.export_scriptcomp_source(scriptcomp, srcpath)
                res = self.export_scriptcomp_usrobj(
                    scriptcomp, usrobjpath, iconpath)
                print(res, loc)
        elif ExportUserObjectsAndSource and not RunComponentAnalysis:
            rml = ghenv.Component.RuntimeMessageLevel.Warning  # type: ignore[reportUnedfinedVariable] # NOQA
            ghenv.Component.AddRuntimeMessage(  # type: ignore[reportUnedfinedVariable] # NOQA
                rml,
                'UserObjects and Source cannot be exported without running '
                'Component Analysis!')

        return OldScriptsDebug, CategoryDebug, VersionDebug, InfoMessages
# ---------- end exportscriptsandsource ----------
print_out = Panel(exportscriptsandsource.out)
oldscriptsdebug = Panel(exportscriptsandsource.OldScriptsDebug)
categorydebug = Panel(exportscriptsandsource.CategoryDebug)
versiondebug = Panel(exportscriptsandsource.VersionDebug)
infomessages = Panel(exportscriptsandsource.InfoMessages)

fetchallunvalidatedcomponents = FetchAllUnvalidatedComponents()  # -> out, ComponentData
# ---------- fetchallunvalidatedcomponents: Python ----------
#! python3
# venv: DDU_CSC
# r: requests==2.31.0
# r: numpy==1.26.4
# r: scipy==1.13.0
# r: scikit-learn==1.4.2

import json

import requests

import System
import Grasshopper
import Rhino

# GHENV COMPONENT SETTINGS
ghenv.Component.Name = "FetchAllUnvalidatedComponents"
ghenv.Component.NickName = "FetchAllUnvalidatedComponents"
ghenv.Component.Category = "DDU_CSC"
ghenv.Component.SubCategory = "9 Admin Actions"


class CSC_FetchAllUnvalidatedComponents(Grasshopper.Kernel.GH_ScriptInstance):
    """
    Author: Max Benjamin Eschenbach
    License: MIT License
    Version: 250820
    """

    def __init__(self):
        super().__init__()
        # initialize props
        self.TOKEN = None

    def get_token(self):
        return self.__TOKEN

    def set_token(self, value):
        self.__TOKEN = value

    TOKEN = property(get_token, set_token, None, "Access Token Property")

    def slash_join(self, *args):
        """Joins together a bunch of strings using slashes."""
        return '/'.join(arg.strip('/') for arg in args)

    def _create_headers(self, token: str = ''):
        """
        Obtain correct headers for performing a request to FARO Component
        Repository API.
        """
        # if no token exists, we need to authenticate first
        if not token:
            token = self.TOKEN
        # set header with authentication token
        return {'Authorization': f'Bearer {token}'}

    def _make_request(self,
                      method: str,
                      endpoint: str,
                      params=None,
                      data=None):
        """
        Perform a request to the API
        """
        # create correct url
        url = self.slash_join(self.BASEURL, endpoint)
        # set header with authentication token
        headers = self._create_headers(token=self.TOKEN)
        # perform request
        print(f'[CSC-API] Performing {method} request using token...')
        response = requests.request(method=method,
                                    url=url,
                                    params=params,
                                    data=data,
                                    headers=headers)
        # if response has status code for Unauthorized request,
        # get new token and try again one time
        if response.status_code == 401:
            print('[CSC-API] Request failed, retrying...')
            headers = self._create_headers(token='')
            response = requests.request(method=method,
                                        url=url,
                                        params=params,
                                        data=data,
                                        headers=headers)
            if response.status_code != 200:
                raise RuntimeError(f'Request failed with status code {response.status_code}')
        return response

    def RunScript(self):
        # set up output trees and results tuple
        ComponentData = Grasshopper.DataTree[System.Object]()
        __Results = (ComponentData)
        # sanitize input and abort if not present
        if not Config:
            rml = ghenv.Component.RuntimeMessageLevel.Warning
            msg = 'Input CSCToken failed to collect data!'
            ghenv.Component.AddRuntimeMessage(rml, msg)
            return __Results
        else:
            config_data = json.loads(Config)
            self.BASEURL = config_data['base_url']
            self.TOKEN = config_data['token']
        # set endpoint
        endpoint = 'components?validated=-1'
        # perform request
        response = self._make_request('GET', endpoint)
        # convert response to json data
        json_comps = response.json()
        print(f'[CSC-API] Found {len(json_comps)} components on server.')
        # loop over all components and disassemble them
        for i, json_comp in enumerate(json_comps):
            # create datatree path
            ghp = Grasshopper.Kernel.Data.GH_Path(i)
            # add all things to the respective datatrees
            ComponentData.Add(json.dumps(json_comp), ghp)
        # return output trees
        return __Results
# ---------- end fetchallunvalidatedcomponents ----------
log_3 = Panel(fetchallunvalidatedcomponents.out)  # disabled
componentdata_3 = Data(fetchallunvalidatedcomponents.ComponentData)

# ----
# comments & notes: Fetch all components from the database
fetchallcomponents = FetchAllComponents()  # -> ComponentData
# ---------- fetchallcomponents: Python ----------
#! python3
# venv: DDU_CSC
# r: requests==2.31.0
# r: numpy==1.26.4
# r: scipy==1.13.0
# r: scikit-learn==1.4.2

# PYTHON STANDARD LIBRARY IMPORTS ---------------------------------------------
import json

# THIRD PARTY LIBRARY IMPORTS -------------------------------------------------
import requests

# RHINO AND GH RELATED IMPORTS ------------------------------------------------
import System  # type: ignore[reportMissingImport] # NOQA
import Grasshopper  # type: ignore[reportMissingImport] # NOQA
import Rhino  # type: ignore[reportMissingImport] # NOQA
import scriptcontext as sc  # type: ignore[reportMissingImport] # NOQA

# GHENV COMPONENT SETTINGS ----------------------------------------------------
ghenv.Component.Name = 'FetchAllComponents'  # type: ignore[reportUnedfinedVariable] # NOQA
ghenv.Component.NickName = 'FetchAllComponents'  # type: ignore[reportUnedfinedVariable] # NOQA
ghenv.Component.Category = 'DDU_CSC'  # type: ignore[reportUnedfinedVariable] # NOQA
ghenv.Component.SubCategory = '2 Catalogue Interface'  # type: ignore[reportUnedfinedVariable] # NOQA


class CSC_FetchAllComponents(Grasshopper.Kernel.GH_ScriptInstance):
    """
    Author: Max Benjamin Eschenbach
    License: MIT License
    Version: 250822
    """

    def __init__(self):
        super().__init__()
        # initialize props
        self.Component = ghenv.Component  # type: ignore[reportUnedfinedVariable] # NOQA
        self.InputParams = self.Component.Params.Input
        self.OutputParams = self.Component.Params.Output

    def _addRemark(self, msg: str = ''):
        rml = self.Component.RuntimeMessageLevel.Remark
        self.AddRuntimeMessage(rml, msg)

    def _addWarning(self, msg: str = ''):
        rml = self.Component.RuntimeMessageLevel.Warning
        self.AddRuntimeMessage(rml, msg)

    def _addError(self, msg: str = ''):
        rml = self.Component.RuntimeMessageLevel.Error
        self.AddRuntimeMessage(rml, msg)

    def get_auth_core_from_sticky(self):
        """Get AuthCore instance from sticky storage."""
        auth_core = sc.sticky.get('CSC_AuthCore')
        if auth_core is None:
            msg = ('No authentication found. Please use CSC_SignIn component '
                   'first.')
            self._addError(msg)
            self.Component.Message = msg
            return None
        return auth_core

    def RunScript(self):
        # Initialize param descriptions (this has to be done in RunScript)
        self.OutputParams[0].Description = (
            'The ComponentData that was fetched from the server as JSON. '
            'Use \'DisassembleComponent\' to access the individual fields '
            'ready for Grasshopper')

        # Get AuthCore instance from sticky storage
        auth_core = self.get_auth_core_from_sticky()
        if auth_core is None:
            return

        # Check if authentication is valid
        if not auth_core.is_valid():
            msg = ('Authentication expired. Please use CSC_SignIn '
                   'component to refresh.')
            self._addError(msg)
            self.Component.Message = msg
            return

        try:
            self.Component.Message = 'Fetching components...'

            # Make authenticated request to fetch all components
            response = auth_core.authorized_get('/components')

            if response.status_code == 200:
                # Successfully fetched components
                json_comps = response.json()
                component_count = len(json_comps)

                self.Component.Message = f'Found {component_count} components'
                self._addRemark(
                    f'Successfully fetched {component_count} components'
                )

                # Set up output trees and results tuple
                ComponentData = Grasshopper.DataTree[System.Object]()
                __Results = (ComponentData,)

                # Loop over all components and add them to the data tree
                for i, json_comp in enumerate(json_comps):
                    # Create datatree path
                    ghp = Grasshopper.Kernel.Data.GH_Path(i)
                    # Add component data to the datatree
                    ComponentData.Add(json.dumps(json_comp), ghp)

                return __Results

            elif response.status_code == 401:
                msg = 'Authentication failed. Please sign in again.'
                self._addError(msg)
                self.Component.Message = msg

            elif response.status_code == 403:
                msg = 'Access denied. Insufficient permissions.'
                self._addError(msg)
                self.Component.Message = msg

            elif response.status_code == 500:
                msg = 'Server error. Please try again later.'
                self._addWarning(msg)
                self.Component.Message = msg

            else:
                msg = (f'Request failed with status code: '
                       f'{response.status_code}')
                self._addError(msg)
                self.Component.Message = msg

        except requests.exceptions.ConnectionError as e:
            msg = 'Cannot connect to server. Please check your connection.'
            self._addError(msg + f'\nFull Error: {str(e)}')
            self.Component.Message = msg

        except requests.exceptions.Timeout as e:
            msg = 'Request timeout. Server may be slow.'
            self._addError(msg + f'\nFull Error: {str(e)}')
            self.Component.Message = msg

        except requests.exceptions.RequestException as e:
            msg = f'Request error: {str(e)}'
            self._addError(msg)
            self.Component.Message = msg

        except Exception as e:
            msg = f'Unexpected error: {str(e)}'
            self._addError(msg)
            self.Component.Message = msg

        # Return empty results if there was an error
        ComponentData = Grasshopper.DataTree[System.Object]()
        __Results = (ComponentData,)
        return __Results
# ---------- end fetchallcomponents ----------
componentdata_4 = Data(fetchallcomponents)

componentdata_5 = Data(componentdata)
addcomponent = AddComponent(ComponentData=componentdata_5, Run=Button())  # -> out, AddedComponentData; inputs ComponentData: String, Run: Boolean
# ---------- addcomponent: Python ----------
#! python3
# venv: DDU_CSC
# r: requests==2.31.0
# r: numpy==1.26.4
# r: scipy==1.13.0
# r: scikit-learn==1.4.2

import json
import uuid
from pprint import pprint

import requests

import System
import Grasshopper
import Rhino

# GHENV COMPONENT SETTINGS
ghenv.Component.Name = "AddComponent"
ghenv.Component.NickName = "AddComponent"
ghenv.Component.Category = "DDU_CSC"
ghenv.Component.SubCategory = "2 Catalogue Interface"


class CSC_AddComponent(Grasshopper.Kernel.GH_ScriptInstance):
    """
    Author: Max Benjamin Eschenbach
    License: MIT License
    Version: 250820
    """

    def __init__(self):
        super().__init__()
        # initialize props
        self.TOKEN = None

    def get_token(self):
        return self.__TOKEN

    def set_token(self, value):
        self.__TOKEN = value

    TOKEN = property(get_token, set_token, None, "Access Token Property")

    def slash_join(self, *args):
        """Joins together a bunch of strings using slashes."""
        return '/'.join(arg.strip('/') for arg in args)

    def _create_headers(self, token: str = ''):
        """
        Obtain correct headers for performing a request to FARO Component
        Repository API.
        """
        # if no token exists, we need to authenticate first
        if not token:
            token = self.TOKEN
        # set header with authentication token
        return {'Authorization': f'Bearer {token}'}

    def _make_request(self,
                      method: str,
                      endpoint: str,
                      params=None,
                      data=None):
        """
        Perform a request to the API
        """
        # create correct url
        url = self.slash_join(self.BASEURL, endpoint)
        # set header with authentication token
        headers = self._create_headers(token=self.TOKEN)
        # perform request
        print(f'[CSC-API] Performing {method} request using token...')
        response = requests.request(method=method,
                                    url=url,
                                    params=params,
                                    data=data,
                                    headers=headers)
        # if response has status code for Unauthorized request,
        # get new token and try again one time
        if response.status_code == 401:
            print('[CSC-API] Request failed, retrying...')
            headers = self._create_headers(token='')
            response = requests.request(method=method,
                                        url=url,
                                        params=params,
                                        data=data,
                                        headers=headers)
            if response.status_code != 200:
                raise RuntimeError(f'Request failed with status code {response.status_code}')
        return response

    def RunScript(self, ComponentData: str, Run: bool):
        # set up output trees and results tuple
        AddedComponentData = Grasshopper.DataTree[System.Object]()
        # sanitize input and abort if not present
        if not Config:
            rml = ghenv.Component.RuntimeMessageLevel.Warning
            msg = 'Input Config failed to collect data!'
            ghenv.Component.AddRuntimeMessage(rml, msg)
            return AddedComponentData
        else:
            config_data = json.loads(Config)
            self.BASEURL = config_data['base_url']
            self.TOKEN = config_data['token']
        if not ComponentData:
            rml = ghenv.Component.RuntimeMessageLevel.Warning
            msg = 'Input ComponentData failed to collect data!'
            ghenv.Component.AddRuntimeMessage(rml, msg)
            return AddedComponentData

        if Run:
            # set endpoint
            endpoint = '/'
            # perform request
            response = self._make_request('POST', endpoint, data=ComponentData)
            # convert response to json data
            json_comp = response.json()
            print(f'[CSC-API] Added component {json_comp["_id"]} to database.')
            AddedComponentData = json.dumps(json_comp)
        return AddedComponentData
# ---------- end addcomponent ----------
log_4 = Panel(addcomponent.out)
componentdata_6 = Data(addcomponent.AddedComponentData)

cachedata = BooleanToggle(False)
componentdata_7 = Data(componentdata_4)
tstat = TreeStatistics(Tree=componentdata_7)  # -> Paths, Length, Count
cacheddata = Data()
cacheddata_2 = Data()
cacheddata_3 = Data()
txt = Text(tstat.Paths)
comments_notes_4 = Panel("Cache Components")
dc = DataCache(LiveData=flatten(tstat.Length), CachedData=cacheddata_2, Toggle=cachedata)  # -> Data; inputs LiveData: list, CachedData: list, Toggle: Boolean
# ---------- dc: Python ----------
"""
Caches some Data by storing it as Persistent Data (aka internalising it) in a connected Param.
    Inputs:
        LiveData: The Data that should be cached (internalised) {tree, data}
        CachedData: Connect a Data Param here where the Data can be internalised {list, data}
        Toggle: If True, Data will be cached by internalising it into the Param connected to IntData. {item, boolean}
    Outputs:
        Data: If Toggle is True the internalised Data, otherwise the incoming Live-Data {list, data}}
    Remarks:
        Author: Max Eschenbach
        License: MIT License
        Version: 200705
"""
ghenv.Component.Name = "DataCache"
ghenv.Component.NickName = "DC"
ghenv.Component.Category = "Cockatoo"
ghenv.Component.SubCategory = "10 Utilities"

# GHPYTHON SDK MODE IMPORTS
from ghpythonlib.componentbase import executingcomponent as component
import Grasshopper, GhPython
import System
import Rhino
import rhinoscriptsyntax as rs

# CUSTOM IMPORTS
from scriptcontext import sticky as st

class DataCache(component):
    
    def RunScript(self, LiveData, CachedData, Toggle):
        
        # get the gh document
        ghDoc = ghenv.Component.OnPingDocument()
        
        # get the guid of this instance to ensure private sticky entries
        ig = self.InstanceGuid
        
        # define a marker for the state of caching/internalisation
        Flag = str(ig) + "___INTERNALISEDFLAG"
        if not Flag in st:
            if CachedData:
                st[Flag] = True
            else:
                st[Flag] = None
        
        # PARAM HANDLING -------------------------------------------------------
        LiveDataParam = ghenv.Component.Params.Input[0]
        CachedDataParam = ghenv.Component.Params.Input[1]
        
        # try to get the connected param, otherwise set a warning and return
        if CachedDataParam.Sources:
            CachedSrc = CachedDataParam.Sources[0]
        else:
            rmlevel = self.RuntimeMessageLevel.Warning
            ghenv.Component.AddRuntimeMessage(rmlevel, "Please connect a Data" +
                                              " Param to the IntData input!")
            return None
        
        
        # HANDLING OF CACHED DATA ----------------------------------------------
        if CachedData and Toggle:
            for i, D in enumerate(CachedData):
                if D == str(ig) + "___NONE___":
                    CachedData[i] = None
            self.Message = "Streaming CachedData"
            Data = CachedData
            return Data
        else:
            self.Message = "Streaming LiveData"
            Data = LiveData
        
        
        # CACHING OF DATA ------------------------------------------------------
        if LiveData and Toggle and not st[Flag]:
            # sanitize the none values
            for i, D in enumerate(LiveData):
                if D == None:
                    LiveData[i] = str(ig) + "___NONE___"
            # create a dotnet list and add all the data items to it
            dList = System.Collections.Generic.List[object]()
            [dList.Add(o) for o in LiveData]
            # switch the marker and set message
            st[Flag] = True
            
            # define delegate for adding persistent data between solutions
            def sln_delegate(doc):
                CachedSrc.Script_AddPersistentData(dList)
                ghenv.Component.ExpireSolution(False)
            
            # schedule new solutin using the defined delegate
            ghDoc.ScheduleSolution(1, sln_delegate)
        
        # # RESET OF CACHED DATA ON FALSE TOGGLE -------------------------------
        elif Toggle == False:
            if st[Flag] == True:
                # set the marker
                st[Flag] = None
                # clear the persistent data and set message
                CachedSrc.Script_ClearPersistentData()
                # expire the solution so everything gets updated
                CachedSrc.ExpireSolution(True)
        
        # return outputs if you have them; here I try it for you:
        return Data
# ---------- end dc ----------
dc_2 = DataCache(LiveData=flatten(txt), CachedData=cacheddata_3, Toggle=cachedata)  # -> Data; inputs LiveData: list, CachedData: list, Toggle: Boolean; same code as dc
dc_3 = DataCache(LiveData=flatten(componentdata_7), CachedData=cacheddata, Toggle=cachedata)  # -> Data; inputs LiveData: list, CachedData: list, Toggle: Boolean; same code as dc
partition = PartitionList(List=dc_3, Size=dc)
tstat_2 = TreeStatistics(Tree=partition)  # -> Paths, Length, Count
replace = ReplacePaths(Data=partition, Search=tstat_2.Paths, Replace=dc_2)
componentdata_8 = Data(replace)

comments_notes_5 = Panel("Bake Components")
componentdata_9 = Data(componentdata_2)
bakecomponents = BakeComponents(Bake=Button(), ComponentData=flatten(componentdata_9))  # inputs Bake: Boolean, ComponentData: list of String
# ---------- bakecomponents: Python ----------
#! python3
# venv: DDU_CSC
# r: requests==2.31.0
# r: numpy==1.26.4
# r: scipy==1.13.0
# r: scikit-learn==1.4.2

# PYTHON STANDARD LIBRARY IMPORTS ---------------------------------------------
import json

# RHINO AND GH RELATED IMPORTS ------------------------------------------------
import System  # type: ignore[reportMissingImport] # NOQA
import Rhino  # type: ignore[reportMissingImport] # NOQA
import Grasshopper  # type: ignore[reportMissingImport] # NOQA
import rhinoscriptsyntax as rs  # type: ignore[reportMissingImport] # NOQA
import scriptcontext as sc  # type: ignore[reportMissingImport] # NOQA

# GHENV COMPONENT SETTINGS ----------------------------------------------------
ghenv.Component.Name = 'BakeComponents'  # type: ignore[reportUnedfinedVariable] # NOQA
ghenv.Component.NickName = 'BakeComponents'  # type: ignore[reportUnedfinedVariable] # NOQA
ghenv.Component.Category = 'DDU_CSC'  # type: ignore[reportUnedfinedVariable] # NOQA
ghenv.Component.SubCategory = '4 RhinoDoc Interaction'  # type: ignore[reportUnedfinedVariable] # NOQA


class CSC_BakeComponents(Grasshopper.Kernel.GH_ScriptInstance):
    """
    Author: Max Benjamin Eschenbach
    License: MIT License
    Version: 250822
    """

    def __init__(self):
        super().__init__()
        # initialize props
        self.Component = ghenv.Component  # type: ignore[reportUnedfinedVariable] # NOQA
        self.InputParams = self.Component.Params.Input
        self.OutputParams = self.Component.Params.Output

    def _addRemark(self, msg: str = ''):
        rml = self.Component.RuntimeMessageLevel.Remark
        self.AddRuntimeMessage(rml, msg)

    def _addWarning(self, msg: str = ''):
        rml = self.Component.RuntimeMessageLevel.Warning
        self.AddRuntimeMessage(rml, msg)

    def _addError(self, msg: str = ''):
        rml = self.Component.RuntimeMessageLevel.Error
        self.AddRuntimeMessage(rml, msg)

    def ComponentExtrusionProfile(
            self,
            json_comp: dict) -> Rhino.Geometry.Polyline:
        pl = Rhino.Geometry.Polyline()
        pts = [Rhino.Geometry.Point3d(pt[0], pt[1], 0.0)
               for pt in json_comp['geometry']['extrusion']['profile']]
        pl.AddRange(pts)
        return pl

    def ComponentExtrusion(
            self,
            json_comp: dict) -> Rhino.Geometry.Extrusion:
        pl = Rhino.Geometry.Polyline()
        pts = [Rhino.Geometry.Point3d(pt[0], pt[1], 0.0)
               for pt in json_comp['geometry']['extrusion']['profile']]
        pl.AddRange(pts)
        cxt = Rhino.Geometry.Extrusion.Create(
            pl.ToPolylineCurve(),
            Rhino.Geometry.Plane.WorldXY,
            json_comp['geometry']['extrusion']['height'],
            True)
        # move extrusion downwards half material
        # thickness to center it at the origin
        cxt.Translate(Rhino.Geometry.Vector3d(
            0, 0, json_comp['geometry']['extrusion']['height'] * -0.5))
        return cxt

    def ComponentMesh(self, json_comp: dict) -> Rhino.Geometry.Mesh:
        mesh = Rhino.Geometry.Mesh()
        vl = json_comp['geometry']['mesh']['v']
        fl = json_comp['geometry']['mesh']['f']
        [mesh.Vertices.Add(*v) for v in vl]
        [mesh.Faces.AddFace(*f) for f in fl]

        # Try to get mesh-specific colors first
        try:
            cl = json_comp['geometry']['mesh']['c']
            [mesh.VertexColors.Add(
                System.Drawing.Color.FromArgb(*c)) for c in cl]
        except KeyError:
            # Fallback: use component color for all vertices
            try:
                component_color = System.Drawing.Color.FromArgb(
                    255, *json_comp['color'])
                for _ in range(len(vl)):
                    mesh.VertexColors.Add(component_color)
            except (KeyError, TypeError):
                # If even component color fails, use a default gray
                default_color = System.Drawing.Color.Gray
                for _ in range(len(vl)):
                    mesh.VertexColors.Add(default_color)
                self._addWarning(
                    f'Mesh {json_comp["_id"]} using default gray color')

        mesh.RebuildNormals()
        mesh.UnifyNormals()
        mesh.Compact()
        return mesh

    def ComponentColor(self, json_comp: dict) -> System.Drawing.Color:
        return System.Drawing.Color.FromArgb(255, *json_comp['color'])

    def RunScript(self,
            Bake: bool,
            ComponentData: System.Collections.Generic.List[str]):
        # Initialize param descriptions (this has to be done in RunScript)
        self.InputParams[0].Description = 'Toggle to bake components to Rhino'
        self.InputParams[1].Description = 'Component data from FetchComponents'

        # Initialize output param descriptions
        if hasattr(self, 'OutputParams') and len(self.OutputParams) > 0:
            self.OutputParams[0].Description = 'Baking status message'

        # set document
        sc.doc = Rhino.RhinoDoc.ActiveDoc

        # bake toggle
        if Bake:
            if not ComponentData or len(ComponentData) == 0:
                msg = ('No component data provided. Please connect '
                       'FetchComponent output.')
                self._addWarning(msg)
                self.Component.Message = msg
                return

            self.Component.Message = 'Baking components...'
            baked_count = 0

            for i, cd in enumerate(ComponentData):
                try:
                    # create path (not used in baking but kept for consistency)
                    _ = Grasshopper.Kernel.Data.GH_Path(i)
                    # load json component
                    json_comp = json.loads(cd)
                    # extract ID
                    comp_id = json_comp['_id']

                    # get insertion plane
                    try:
                        # try to extract insertion frame
                        iframe = json_comp['iframe']
                        iplane = Rhino.Geometry.Plane(
                            Rhino.Geometry.Point3d(*iframe['o']),
                            Rhino.Geometry.Vector3d(*iframe['x']),
                            Rhino.Geometry.Vector3d(*iframe['y']),
                        )
                    except KeyError:
                        # if there is no respective key, create world xy plane
                        iplane = Rhino.Geometry.Plane.WorldXY

                    xform = Rhino.Geometry.Transform.PlaneToPlane(
                        Rhino.Geometry.Plane.WorldXY,
                        iplane)

                    # create tag
                    tag = Rhino.Geometry.TextEntity()
                    tag.Text = comp_id
                    tag.Plane = iplane
                    # specify height in millimeters
                    usf = Rhino.RhinoMath.UnitScale(
                        Rhino.UnitSystem.Millimeters,
                        sc.doc.ModelUnitSystem)
                    tag.TextHeight = 10.0 * usf
                    tag.Justification = (
                        Rhino.Geometry.TextJustification.MiddleCenter
                    )
                    id_tag = sc.doc.Objects.Add(tag)
                    geo_ids = [id_tag]

                    # create component geometry
                    for key in sorted(json_comp['geometry'].keys()):
                        if key == 'extrusion':
                            pl = self.ComponentExtrusionProfile(json_comp)
                            xtr = self.ComponentExtrusion(json_comp)
                            pl.Transform(xform)
                            xtr.Transform(xform)
                            geo_ids.append(
                                sc.doc.Objects.Add(pl.ToPolylineCurve()))
                            geo_ids.append(sc.doc.Objects.Add(xtr))
                        elif key == 'mesh':
                            mesh = self.ComponentMesh(json_comp)
                            # transform to iframe
                            mesh.Transform(xform)
                            geo_ids.append(sc.doc.Objects.Add(mesh))
                        elif key == 'polyline':
                            pl = self.ComponentExtrusionProfile(json_comp)
                            # transform to iframe
                            pl.Transform(xform)
                            geo_ids.append(
                                sc.doc.Objects.Add(pl.ToPolylineCurve()))
                        else:
                            msg = (f'Missing implementation for geometry '
                                   f'of type \'{key}\'!')
                            self._addWarning(msg)
                            self.Component.Message = msg
                            continue

                    # add objects to document
                    # create layers if they are not present
                    lay_parent = 'CSC_COMPONENTS'
                    lay_name = comp_id
                    layer = '::'.join([lay_parent, lay_name])
                    if not rs.IsLayer(lay_parent):
                        rs.AddLayer(lay_parent)
                    if not rs.IsLayer(layer):
                        rs.AddLayer(layer, self.ComponentColor(json_comp))

                    # set layer to objects
                    for gid in geo_ids:
                        rs.ObjectLayer(gid, layer)

                    # set user data
                    rs.SetUserText(
                        id_tag,
                        'componentdata',
                        ComponentData[i])

                    # create group
                    _ = sc.doc.Groups.Add(
                        comp_id,
                        geo_ids)

                    baked_count += 1
                    self._addRemark(
                        f'Successfully baked component {comp_id}')

                except json.JSONDecodeError as e:
                    msg = f'Failed to parse component data: {str(e)}'
                    self._addError(msg)
                    self.Component.Message = msg
                except Exception as e:
                    msg = f'Error baking component: {str(e)}'
                    self._addError(msg)
                    self.Component.Message = msg

            # Update success message
            if baked_count > 0:
                self.Component.Message = f'Baked {baked_count} component(s)'
                self._addRemark(
                    f'Successfully baked {baked_count} components')
            else:
                self.Component.Message = 'No components were baked'
                self._addWarning('No components were baked')
        else:
            self.Component.Message = 'Bake toggle is off'
            self._addRemark('Bake toggle is off - no components baked')

        # Restore original document context if needed
        # Note: ghdoc was undefined in original code
# ---------- end bakecomponents ----------

resetforwarder = Button()
validate = Button()
forward = Button()

filter = StreamFilter(Gate=resetforwarder)

resetforwarder_button = Data(resetforwarder)
forward_button = Data(forward)
componentdata_10 = Data(componentdata_3)
py3 = Python3Script(Forward=forward_button, Reset=resetforwarder_button, N=Slider(0, range=0..100))  # -> out, M; inputs Forward: Boolean, Reset: Boolean, N: Int32
# ---------- py3: Python ----------
import scriptcontext as sc

ig = str(ghenv.Component.InstanceGuid)
if ig not in sc.sticky.keys():
    sc.sticky[ig] = N

if Forward is True:
    sc.sticky[ig] += 1
if Reset == True:
    sc.sticky[ig] = 0

M = sc.sticky[ig]
# ---------- end py3 ----------
item = ListItem(List=flatten(componentdata_10), Index=py3.M, Wrap=False)
componentdata_11 = Data(item)

validate_button = Data(validate)
componentid_3 = Data()
validatecomponent = ValidateComponent(Validate=validate_button, ComponentID=componentid_3)  # -> out, ComponentData; inputs Validate: Boolean, ComponentID: String
# ---------- validatecomponent: Python ----------
#! python3
# venv: DDU_CSC
# r: requests==2.31.0
# r: numpy==1.26.4
# r: scipy==1.13.0
# r: scikit-learn==1.4.2

import json
import uuid

import requests

import System
import Grasshopper
import Rhino

# GHENV COMPONENT SETTINGS
ghenv.Component.Name = "ValidateComponent"
ghenv.Component.NickName = "ValidateComponent"
ghenv.Component.Category = "DDU_CSC"
ghenv.Component.SubCategory = "9 Admin Actions"


class CSC_ValidateComponent(Grasshopper.Kernel.GH_ScriptInstance):
    """
    Author: Max Benjamin Eschenbach
    License: MIT License
    Version: 250820
    """

    def __init__(self):
        super().__init__()
        # initialize props
        self.TOKEN = None

    def get_token(self):
        return self.__TOKEN

    def set_token(self, value):
        self.__TOKEN = value

    TOKEN = property(get_token, set_token, None, "Access Token Property")

    def slash_join(self, *args):
        """Joins together a bunch of strings using slashes."""
        return '/'.join(arg.strip('/') for arg in args)

    def _create_headers(self, token: str = ''):
        """
        Obtain correct headers for performing a request to FARO Component
        Repository API.
        """
        # if no token exists, we need to authenticate first
        if not token:
            token = self.TOKEN
        # set header with authentication token
        return {'Authorization': f'Bearer {token}'}

    def _make_request(self,
                      method: str,
                      endpoint: str,
                      params=None,
                      data=None):
        """
        Perform a request to the API
        """
        # create correct url
        url = self.slash_join(self.BASEURL, endpoint)
        # set header with authentication token
        headers = self._create_headers(token=self.TOKEN)
        # perform request
        print(f'[CSC-API] Performing {method} request using token...')
        response = requests.request(method=method,
                                    url=url,
                                    params=params,
                                    data=data,
                                    headers=headers)
        # if response has status code for Unauthorized request,
        # get new token and try again one time
        if response.status_code == 401:
            print('[CSC-API] Request failed, retrying...')
            headers = self._create_headers(token='')
            response = requests.request(method=method,
                                        url=url,
                                        params=params,
                                        data=data,
                                        headers=headers)
            if response.status_code != 200:
                raise RuntimeError(f'Request failed with status code {response.status_code}')
        return response

    def validate_uuid(self, uuid_to_test: str, version: int = 4):
        """
        Check if uuid_to_test is a valid UUID.
        Returns True if uuid_to_test is a valid UUID, otherwise False.
        """
        try:
            uuid_obj = uuid.UUID(uuid_to_test, version=version)
        except ValueError:
            return False
        return str(uuid_obj) == uuid_to_test

    def RunScript(self, Validate: bool, ComponentID: str):
        # set up output trees and results tuple
        ComponentData = Grasshopper.DataTree[System.Object]()
        # sanitize input and abort if not present
        if not Config:
            rml = ghenv.Component.RuntimeMessageLevel.Warning
            msg = 'Input Config failed to collect data!'
            ghenv.Component.AddRuntimeMessage(rml, msg)
            return ComponentData
        else:
            Config = str(Config)
            config_data = json.loads(Config)
            self.BASEURL = config_data['base_url']
            self.TOKEN = config_data['token']
        if not ComponentID:
            rml = ghenv.Component.RuntimeMessageLevel.Warning
            msg = 'Input ComponentID failed to collect data!'
            ghenv.Component.AddRuntimeMessage(rml, msg)
            return ComponentData
        ComponentID = str(ComponentID)
        if not  self.validate_uuid(ComponentID):
            rml = ghenv.Component.RuntimeMessageLevel.Warning
            msg = f'ComponentID {ComponentID} is not a valid UUID!'
            ghenv.Component.AddRuntimeMessage(rml, msg)
            return ComponentData
        if Validate is True:
            # set endpoint
            endpoint = f'validate/{ComponentID}'
            # perform request
            response = self._make_request('GET', endpoint)
            # convert response to json data
            json_comp = response.json()
            print(json_comp['validated'])
            print(f'[CSC-API] Validated component {ComponentID} on server.')
            # add all things to the respective datatrees
            ComponentData = json.dumps(json_comp)
        # return output trees
        return ComponentData
# ---------- end validatecomponent ----------
log_5 = Panel(validatecomponent.out)
componentdata_12 = Data(validatecomponent.ComponentData)

data = Data("7ca01cae-4e91-451d-bb4c-3a11e42e1c63")

# ----
# comments & notes: Filter Components that were already fetched from the Database
mindimensionx = Slider(0, range=-0.1..2000)
maxdimensiony = Slider(0, range=0..2000)
maxdimensionx = Slider(0, range=0..2000)
maxdimensionz = Slider(0, range=0..500)
mindimensiony = Slider(0, range=0..2000)
mindimensionz = Slider(0, range=0..500)
fragment = ValueList({"Any": , "Only fragments": True, "Only non-fragmnents": False}, selected="Any")
complexity = ValueList({"Any complexity": , "0", "1", "2", "3"}, selected="Any complexity")
material_2 = ValueList({"Any material": , "corian", "concrete", "timber", "aluminium", "steel"}, selected="Any material")
type_2 = ValueList({"All types": , "sheet", "rubble", "beam", "column", "profile"}, selected="All types")
componentdata_13 = Data(componentdata_8)
filtercomponents = FilterComponents(
    Type=type_2,
    Material=material_2,
    Complexity=complexity,
    Fragment=fragment,
    MinDimensionX=mindimensionx,
    MaxDimensionX=maxdimensionx,
    MinDimensionY=mindimensiony,
    MaxDimensionY=maxdimensiony,
    MinDimensionZ=mindimensionz,
    MaxDimensionZ=maxdimensionz,
    ComponentData=componentdata_13)  # -> FilterDescription, ComponentData; inputs Type: String, Material: String, Complexity: Int32, Fragment: Boolean, MinDimensionX: Double, MaxDimensionX: Double, MinDimensionY: Double, MaxDimensionY: Double, MinDimensionZ: Double, MaxDimensionZ: Double, ComponentData: tree of String
# ---------- filtercomponents: Python ----------
#! python3
# venv: DDU_CSC
# r: requests==2.31.0
# r: numpy==1.26.4
# r: scipy==1.13.0
# r: scikit-learn==1.4.2

# PYTHON STANDARD LIBRARY IMPORTS ---------------------------------------------
import json

# RHINO AND GH RELATED IMPORTS ------------------------------------------------
import System  # type: ignore[reportMissingImport] # NOQA
import Grasshopper  # type: ignore[reportMissingImport] # NOQA
import Rhino  # type: ignore[reportMissingImport] # NOQA

# GHENV COMPONENT SETTINGS ----------------------------------------------------
ghenv.Component.Name = 'FilterComponents'  # type: ignore[reportUnedfinedVariable] # NOQA
ghenv.Component.NickName = 'FilterComponents'  # type: ignore[reportUnedfinedVariable] # NOQA
ghenv.Component.Category = 'DDU_CSC'  # type: ignore[reportUnedfinedVariable] # NOQA
ghenv.Component.SubCategory = '2 Catalogue Interface'  # type: ignore[reportUnedfinedVariable] # NOQA


class CSC_FilterComponents(Grasshopper.Kernel.GH_ScriptInstance):
    """
    Author: Max Benjamin Eschenbach
    License: MIT License
    Version: 250825
    """

    def __init__(self):
        super().__init__()
        # initialize props
        self.Component = ghenv.Component  # type: ignore[reportUnedfinedVariable] # NOQA
        self.InputParams = self.Component.Params.Input
        self.OutputParams = self.Component.Params.Output

    def _addRemark(self, msg: str = ''):
        rml = self.Component.RuntimeMessageLevel.Remark
        self.AddRuntimeMessage(rml, msg)

    def _addWarning(self, msg: str = ''):
        rml = self.Component.RuntimeMessageLevel.Warning
        self.AddRuntimeMessage(rml, msg)

    def _addError(self, msg: str = ''):
        rml = self.Component.RuntimeMessageLevel.Error
        self.AddRuntimeMessage(rml, msg)

    def apply_filters(self, component_data: dict, filter_params: dict) -> bool:
        """
        Apply all filters to a single component and return True if it passes.
        """

        # Type filter
        if filter_params.get('type') and filter_params['type'].strip():
            if (component_data.get('type', '').lower() !=
                    filter_params['type'].lower()):
                return False

        # Material filter
        if filter_params.get('material') and filter_params['material'].strip():
            if (component_data.get('material', '').lower() !=
                    filter_params['material'].lower()):
                return False

        # Complexity filter
        if filter_params.get('complexity') is not None:
            if component_data.get('complexity') != filter_params['complexity']:
                return False

        # Fragment filter
        if filter_params.get('fragment') is not None:
            if component_data.get('fragment') != filter_params['fragment']:
                return False

        # Bounding box filters
        bbx = component_data.get('bbx')
        if (bbx and isinstance(bbx, list) and len(bbx) >= 2):
            bbx_min = bbx[0]
            bbx_max = bbx[1]

            # X dimension filters
            if filter_params.get('min_x') is not None:
                if bbx_max[0] < filter_params['min_x']:
                    return False
            if filter_params.get('max_x') is not None:
                if bbx_min[0] > filter_params['max_x']:
                    return False

            # Y dimension filters
            if filter_params.get('min_y') is not None:
                if bbx_max[1] < filter_params['min_y']:
                    return False
            if filter_params.get('max_y') is not None:
                if bbx_min[1] > filter_params['max_y']:
                    return False

            # Z dimension filters
            if filter_params.get('min_z') is not None:
                if bbx_max[2] < filter_params['min_z']:
                    return False
            if filter_params.get('max_z') is not None:
                if bbx_min[2] > filter_params['max_z']:
                    return False

        return True

    def generate_filter_description(self, filter_params: dict) -> str:
        """Generates a human-readable description of the applied filters."""
        description = []
        if filter_params.get('type'):
            description.append(f'\nType: {filter_params["type"]}')
        if filter_params.get('material'):
            description.append(f'\nMaterial: {filter_params["material"]}')
        if filter_params.get('complexity') is not None:
            description.append(f'\nComplexity: {filter_params["complexity"]}')
        if filter_params.get('fragment') is not None:
            description.append(f'\nFragment: {filter_params["fragment"]}')

        # Handle bounding box filters with detailed information
        bbx_filters = []
        if filter_params.get('min_x') is not None:
            bbx_filters.append(f'\nX >= {filter_params["min_x"]:.2f}')
        if filter_params.get('max_x') is not None:
            bbx_filters.append(f'\nX <= {filter_params["max_x"]:.2f}')
        if filter_params.get('min_y') is not None:
            bbx_filters.append(f'\nY >= {filter_params["min_y"]:.2f}')
        if filter_params.get('max_y') is not None:
            bbx_filters.append(f'\nY <= {filter_params["max_y"]:.2f}')
        if filter_params.get('min_z') is not None:
            bbx_filters.append(f'\nZ >= {filter_params["min_z"]:.2f}')
        if filter_params.get('max_z') is not None:
            bbx_filters.append(f'\nZ <= {filter_params["max_z"]:.2f}')

        if bbx_filters:
            description.append(f'\nBounding Box: {", ".join(bbx_filters)}')

        return f'Applied filters: {", ".join(description)}'

    def RunScript(self,
            Type: str,
            Material: str,
            Complexity: int,
            Fragment: bool,
            MinDimensionX: float,
            MaxDimensionX: float,
            MinDimensionY: float,
            MaxDimensionY: float,
            MinDimensionZ: float,
            MaxDimensionZ: float,
            ComponentData: Grasshopper.DataTree[str]):

        # Initialize param descriptions (this has to be done in RunScript)
        self.InputParams[0].Description = (
            'Component type filter (e.g., "beam", "slab", "column")'
        )
        self.InputParams[1].Description = (
            'Material type filter (e.g., "concrete", "steel", "wood")'
        )
        self.InputParams[2].Description = (
            'Complexity level filter (0-3, where 0=simple, 3=complex)'
        )
        self.InputParams[3].Description = (
            'Fragment status filter (True for fragments, False for complete)'
        )
        self.InputParams[4].Description = (
            'Minimum X dimension filter (bounding box)'
        )
        self.InputParams[5].Description = (
            'Maximum X dimension filter (bounding box)'
        )
        self.InputParams[6].Description = (
            'Minimum Y dimension filter (bounding box)'
        )
        self.InputParams[7].Description = (
            'Maximum Y dimension filter (bounding box)'
        )
        self.InputParams[8].Description = (
            'Minimum Z dimension filter (bounding box)'
        )
        self.InputParams[9].Description = (
            'Maximum Z dimension filter (bounding box)'
        )
        self.InputParams[10].Description = (
            'Component data to filter (from FetchComponents or similar)'
        )

        # Initialize output param descriptions
        self.OutputParams[0].Description = (
            'Human-readable description of the applied filters'
        )
        self.OutputParams[1].Description = (
            'Filtered ComponentData as JSON strings. Use '
            '\'DisassembleComponent\' to access the individual fields '
            'ready for Grasshopper'
        )

        # Validate input data
        if not ComponentData or ComponentData.DataCount == 0:
            msg = ('No component data provided. '
                   'Please connect ComponentData input.')
            self._addWarning(msg)
            self.Component.Message = msg

            # Return empty results
            FilterDescription = Grasshopper.DataTree[System.Object]()
            FilteredComponentData = Grasshopper.DataTree[System.Object]()
            __Results = (FilterDescription, FilteredComponentData)
            return __Results

        try:
            self.Component.Message = 'Building filter parameters...'

            # Build filter parameters dictionary
            filter_params = {}

            # Add type filter if provided
            if Type and Type.strip() and Type.lower() != 'alltypes':
                filter_params['type'] = Type.strip()

            # Add material filter if provided
            if (Material and Material.strip() and
                    Material.lower() != 'allmaterials'):
                filter_params['material'] = Material.strip()

            # Add complexity filter if provided
            if Complexity is not None:
                filter_params['complexity'] = Complexity

            # Add fragment filter if provided
            if Fragment is not None:
                filter_params['fragment'] = Fragment

            # Add bounding box filters if provided
            if MinDimensionX is not None and MinDimensionX != 0.0:
                filter_params['min_x'] = MinDimensionX
            if MaxDimensionX is not None and MaxDimensionX != 0.0:
                filter_params['max_x'] = MaxDimensionX
            if MinDimensionY is not None and MinDimensionY != 0.0:
                filter_params['min_y'] = MinDimensionY
            if MaxDimensionY is not None and MaxDimensionY != 0.0:
                filter_params['max_y'] = MaxDimensionY
            if MinDimensionZ is not None and MinDimensionZ != 0.0:
                filter_params['min_z'] = MinDimensionZ
            if MaxDimensionZ is not None and MaxDimensionZ != 0.0:
                filter_params['max_z'] = MaxDimensionZ

            # Generate human-readable filter description
            filter_description = self.generate_filter_description(
                filter_params
            )

            self.Component.Message = 'Filtering components...'

            # Set up output trees and results tuple
            FilterDescription = Grasshopper.DataTree[System.Object]()
            FilteredComponentData = Grasshopper.DataTree[System.Object]()
            __Results = (FilterDescription, FilteredComponentData)

            # Add filter description to the filter query output
            FilterDescription.Add(
                filter_description,
                Grasshopper.Kernel.Data.GH_Path(0))

            # Filter components
            filtered_count = 0
            total_count = 0

            # Loop over all branches
            for i in range(ComponentData.BranchCount):
                ghp = ComponentData.Paths[i]
                for j, comp in enumerate(ComponentData.Branches[i]):
                    total_count += 1
                    try:
                        # Load component data
                        component_data = json.loads(comp)

                        # Apply filters
                        if self.apply_filters(component_data, filter_params):
                            # Component passes all filters, add to output
                            FilteredComponentData.Add(comp, ghp)
                            filtered_count += 1

                    except json.JSONDecodeError as e:
                        msg = f'Failed to parse component data: {str(e)}'
                        self._addWarning(msg)
                        continue
                    except Exception as e:
                        msg = f'Error processing component: {str(e)}'
                        self._addWarning(msg)
                        continue

            # Update component message
            if filtered_count == 0:
                msg = 'No components match the applied filters.'
                self.Component.Message = msg
                self._addWarning(msg)
            else:
                msg = f'Filtered {filtered_count} of {total_count} components.'
                self.Component.Message = msg
                self._addRemark(
                    f'Successfully filtered {filtered_count} components '
                    f'from {total_count} total components'
                )

            return __Results

        except Exception as e:
            msg = f'Unexpected error during filtering: {str(e)}'
            self._addError(msg)
            self.Component.Message = msg

            # Return empty results if there was an error
            FilterDescription = Grasshopper.DataTree[System.Object]()
            FilteredComponentData = Grasshopper.DataTree[System.Object]()
            __Results = (FilterDescription, FilteredComponentData)
            return __Results
# ---------- end filtercomponents ----------
log_6 = Panel(filtercomponents.FilterDescription)
componentdata_14 = Data(filtercomponents.ComponentData)

# ----
# comments & notes: Fetch a subset of components from the database using filters
mindimensionx_2 = Slider(0, range=-0.1..2000)
maxdimensiony_2 = Slider(0, range=0..2000)
maxdimensionx_2 = Slider(0, range=0..2000)
maxdimensionz_2 = Slider(0, range=0..500)
mindimensionz_2 = Slider(0, range=0..500)
mindimensiony_2 = Slider(0, range=0..2000)
fragment_2 = ValueList({"Any": , "Only fragments": True, "Only non-fragmnents": False}, selected="Any")
complexity_2 = ValueList({"Any complexity": , "0", "1", "2", "3"}, selected="Any complexity")
material_3 = ValueList({"Any material": , "corian", "concrete", "timber", "aluminium", "steel"}, selected="Any material")
type_3 = ValueList({"All types": , "sheet", "rubble", "beam", "column", "profile"}, selected="All types")
fetchfilteredcomponents = FetchFilteredComponents(
    Type=type_3,
    Material=material_3,
    Complexity=complexity_2,
    Fragment=fragment_2,
    MinDimensionX=mindimensionx_2,
    MaxDimensionX=maxdimensionx_2,
    MinDimensionY=mindimensiony_2,
    MaxDimensionY=maxdimensiony_2,
    MinDimensionZ=mindimensionz_2,
    MaxDimensionZ=maxdimensionz_2)  # -> FilterDescription, ComponentData; inputs Type: String, Material: String, Complexity: Int32, Fragment: Boolean, MinDimensionX: Double, MaxDimensionX: Double, MinDimensionY: Double, MaxDimensionY: Double, MinDimensionZ: Double, MaxDimensionZ: Double
# ---------- fetchfilteredcomponents: Python ----------
#! python3
# venv: DDU_CSC
# r: requests==2.31.0
# r: numpy==1.26.4
# r: scipy==1.13.0
# r: scikit-learn==1.4.2

# PYTHON STANDARD LIBRARY IMPORTS ---------------------------------------------
import json

# THIRD PARTY LIBRARY IMPORTS -------------------------------------------------
import requests

# RHINO AND GH RELATED IMPORTS ------------------------------------------------
import System  # type: ignore[reportMissingImport] # NOQA
import Grasshopper  # type: ignore[reportMissingImport] # NOQA
import Rhino  # type: ignore[reportMissingImport] # NOQA
import scriptcontext as sc  # type: ignore[reportMissingImport] # NOQA

# GHENV COMPONENT SETTINGS ----------------------------------------------------
ghenv.Component.Name = 'FetchFilteredComponents'  # type: ignore[reportUnedfinedVariable] # NOQA
ghenv.Component.NickName = 'FetchFilteredComponents'  # type: ignore[reportUnedfinedVariable] # NOQA
ghenv.Component.Category = 'DDU_CSC'  # type: ignore[reportUnedfinedVariable] # NOQA
ghenv.Component.SubCategory = '2 Catalogue Interface'  # type: ignore[reportUnedfinedVariable] # NOQA


class CSC_FetchFilteredComponents(Grasshopper.Kernel.GH_ScriptInstance):
    """
    Author: Max Benjamin Eschenbach
    License: MIT License
    Version: 250825
    """

    def __init__(self):
        super().__init__()
        # initialize props
        self.Component = ghenv.Component  # type: ignore[reportUnedfinedVariable] # NOQA
        self.InputParams = self.Component.Params.Input
        self.OutputParams = self.Component.Params.Output

    def _addRemark(self, msg: str = ''):
        rml = self.Component.RuntimeMessageLevel.Remark
        self.AddRuntimeMessage(rml, msg)

    def _addWarning(self, msg: str = ''):
        rml = self.Component.RuntimeMessageLevel.Warning
        self.AddRuntimeMessage(rml, msg)

    def _addError(self, msg: str = ''):
        rml = self.Component.RuntimeMessageLevel.Error
        self.AddRuntimeMessage(rml, msg)

    def get_auth_core_from_sticky(self):
        """Get AuthCore instance from sticky storage."""
        auth_core = sc.sticky.get('CSC_AuthCore')
        if auth_core is None:
            msg = ('No authentication found. Please use CSC_SignIn component '
                   'first.')
            self._addError(msg)
            self.Component.Message = msg
            return None
        return auth_core

    def build_filter_query_params(self, Type, Material, Complexity, Fragment,
                                  MinDimensionX, MaxDimensionX, MinDimensionY,
                                  MaxDimensionY, MinDimensionZ, MaxDimensionZ):
        """Build query parameters for filtering components."""
        params = {}

        # Add type filter if provided
        if Type and len(Type) > 0:
            # Take the first type if multiple are provided
            type_value = Type[0] if isinstance(Type, list) else str(Type)
            if type_value and type_value.strip():
                params['comptype'] = type_value.strip()

        # Add material filter if provided
        if Material and Material.strip():
            params['material'] = Material.strip()

        # Add complexity filter if provided
        if Complexity is not None:
            params['complexity'] = Complexity

        # Add fragment filter if provided
        if Fragment is not None:
            params['fragment'] = Fragment

        # Add bounding box filters if provided
        if MinDimensionX is not None and MinDimensionX != 0.0:
            params['bbx_min_x'] = MinDimensionX
        if MaxDimensionX is not None and MaxDimensionX != 0.0:
            params['bbx_max_x'] = MaxDimensionX
        if MinDimensionY is not None and MinDimensionY != 0.0:
            params['bbx_min_y'] = MinDimensionY
        if MaxDimensionY is not None and MaxDimensionY != 0.0:
            params['bbx_max_y'] = MaxDimensionY
        if MinDimensionZ is not None and MinDimensionZ != 0.0:
            params['bbx_min_z'] = MinDimensionZ
        if MaxDimensionZ is not None and MaxDimensionZ != 0.0:
            params['bbx_max_z'] = MaxDimensionZ

        return params

    def generate_filter_description(self, filter_params: dict) -> str:
        """Generates a human-readable description of the applied filters."""
        description = []
        if filter_params.get('comptype'):
            description.append(f'\nType: {filter_params["comptype"]}')
        if filter_params.get('material'):
            description.append(f'\nMaterial: {filter_params["material"]}')
        if filter_params.get('complexity') is not None:
            description.append(f'\nComplexity: {filter_params["complexity"]}')
        if filter_params.get('fragment') is not None:
            description.append(f'\nFragment: {filter_params["fragment"]}')

        # Handle bounding box filters with detailed information
        bbx_filters = []
        if filter_params.get('bbx_min_x') is not None:
            bbx_filters.append(f'\nX >= {filter_params["bbx_min_x"]:.2f}')
        if filter_params.get('bbx_max_x') is not None:
            bbx_filters.append(f'\nX <= {filter_params["bbx_max_x"]:.2f}')
        if filter_params.get('bbx_min_y') is not None:
            bbx_filters.append(f'\nY >= {filter_params["bbx_min_y"]:.2f}')
        if filter_params.get('bbx_max_y') is not None:
            bbx_filters.append(f'\nY <= {filter_params["bbx_max_y"]:.2f}')
        if filter_params.get('bbx_min_z') is not None:
            bbx_filters.append(f'\nZ >= {filter_params["bbx_min_z"]:.2f}')
        if filter_params.get('bbx_max_z') is not None:
            bbx_filters.append(f'\nZ <= {filter_params["bbx_max_z"]:.2f}')

        if bbx_filters:
            description.append(f'\nBounding Box: {", ".join(bbx_filters)}')

        return f'Applied filters: {", ".join(description)}'

    def RunScript(self,
            Type: str,
            Material: str,
            Complexity: int,
            Fragment: bool,
            MinDimensionX: float,
            MaxDimensionX: float,
            MinDimensionY: float,
            MaxDimensionY: float,
            MinDimensionZ: float,
            MaxDimensionZ: float):
        # Initialize param descriptions (this has to be done in RunScript)
        self.InputParams[0].Description = (
            'Component type filter (e.g., "beam", "slab", "column")'
        )
        self.InputParams[1].Description = (
            'Material type filter (e.g., "concrete", "steel", "wood")'
        )
        self.InputParams[2].Description = (
            'Complexity level filter (0-3, where 0=simple, 3=complex)'
        )
        self.InputParams[3].Description = (
            'Fragment status filter (True for fragments, False for complete)'
        )
        self.InputParams[4].Description = (
            'Minimum X dimension filter (bounding box)'
        )
        self.InputParams[5].Description = (
            'Maximum X dimension filter (bounding box)'
        )
        self.InputParams[6].Description = (
            'Minimum Y dimension filter (bounding box)'
        )
        self.InputParams[7].Description = (
            'Maximum Y dimension filter (bounding box)'
        )
        self.InputParams[8].Description = (
            'Minimum Z dimension filter (bounding box)'
        )
        self.InputParams[9].Description = (
            'Maximum Z dimension filter (bounding box)'
        )

        # Initialize output param descriptions
        self.OutputParams[0].Description = (
            'Human-readable description of the applied filters and query'
        )
        self.OutputParams[1].Description = (
            'The ComponentData that was fetched from the server as JSON. '
            'Use \'DisassembleComponent\' to access the individual fields '
            'ready for Grasshopper')

        # Get AuthCore instance from sticky storage
        auth_core = self.get_auth_core_from_sticky()
        if auth_core is None:
            return

        # Check if authentication is valid
        if not auth_core.is_valid():
            msg = ('Authentication expired. Please use CSC_SignIn '
                   'component to refresh.')
            self._addError(msg)
            self.Component.Message = msg
            return

        try:
            self.Component.Message = 'Building filter query...'

            # Build filter query parameters
            filter_params = self.build_filter_query_params(
                Type, Material, Complexity, Fragment,
                MinDimensionX, MaxDimensionX, MinDimensionY,
                MaxDimensionY, MinDimensionZ, MaxDimensionZ
            )

            # Build the query string
            query_string = '&'.join([
                f'{k}={v}' for k, v in filter_params.items()
            ])
            endpoint = '/components'
            if query_string:
                endpoint += f'?{query_string}'

            # Generate human-readable filter description
            filter_description = self.generate_filter_description(
                filter_params
            )

            self.Component.Message = 'Fetching filtered components...'

            # Make authenticated request to fetch filtered components
            response = auth_core.authorized_get(endpoint)

            if response.status_code == 200:
                # Successfully fetched components
                json_comps = response.json()
                component_count = len(json_comps)

                # Show filter info in message
                filter_msg = f'Found {component_count} components.'

                self.Component.Message = filter_msg
                self._addRemark(
                    f'Successfully fetched {component_count} components '
                    f'with applied filters'
                )

                # Set up output trees and results tuple
                FilterDescription = Grasshopper.DataTree[System.Object]()
                ComponentData = Grasshopper.DataTree[System.Object]()
                __Results = (FilterDescription, ComponentData)

                # Loop over all components and add them to the data tree
                for i, json_comp in enumerate(json_comps):
                    # Create datatree path
                    ghp = Grasshopper.Kernel.Data.GH_Path(i)
                    # Add component data to the datatree
                    ComponentData.Add(json.dumps(json_comp), ghp)

                # Add filter description to the filter query output
                FilterDescription.Add(filter_description,
                                Grasshopper.Kernel.Data.GH_Path(0))

                return __Results

            elif response.status_code == 401:
                msg = 'Authentication failed. Please sign in again.'
                self._addError(msg)
                self.Component.Message = msg

            elif response.status_code == 403:
                msg = 'Access denied. Insufficient permissions.'
                self._addError(msg)
                self.Component.Message = msg

            elif response.status_code == 500:
                msg = 'Server error. Please try again later.'
                self._addWarning(msg)
                self.Component.Message = msg

            else:
                msg = (f'Request failed with status code: '
                       f'{response.status_code}')
                self._addError(msg)
                self.Component.Message = msg

        except requests.exceptions.ConnectionError as e:
            msg = 'Cannot connect to server. Please check your connection.'
            self._addError(msg + f'\nFull Error: {str(e)}')
            self.Component.Message = msg

        except requests.exceptions.Timeout as e:
            msg = 'Request timeout. Server may be slow.'
            self._addError(msg + f'\nFull Error: {str(e)}')
            self.Component.Message = msg

        except requests.exceptions.RequestException as e:
            msg = f'Request error: {str(e)}'
            self._addError(msg)
            self.Component.Message = msg

        except Exception as e:
            msg = f'Unexpected error: {str(e)}'
            self._addError(msg)
            self.Component.Message = msg

        # Return empty results if there was an error
        ComponentData = Grasshopper.DataTree[System.Object]()
        FilterDescription = Grasshopper.DataTree[System.Object]()
        __Results = (FilterDescription, ComponentData)
        return __Results
# ---------- end fetchfilteredcomponents ----------
panel_6 = Panel(fetchfilteredcomponents.FilterDescription)
componentdata_15 = Data(fetchfilteredcomponents.ComponentData)

panel_7 = Panel(data)

arrange_upright = BooleanToggle(False)
componentdata_16 = Data(componentdata_14)
grid_dim_y = Slider(1300, range=0..4000)
insertionpoint = Point(Point(0, 0, 0))
grid_dim_x = Slider(1300, range=0..4000)
componentdata_17 = Data(componentdata_16)
grid_dim_x_2 = Data(grid_dim_x)
grid_dim_y_2 = Data(grid_dim_y)
lng = ListLength(List=flatten(componentdata_17))
dom = ConstructDomain(DomainStart=0, DomainEnd=grid_dim_x_2)
dom_2 = ConstructDomain(DomainStart=0, DomainEnd=grid_dim_y_2)
sqrt = SquareRoot(Value=lng)
round = Round(Number=sqrt)  # -> Nearest, Floor, Ceiling
comments_notes_6 = Panel("Create Arrangement")
rectangle = Rectangle(Plane=PlaneXY(0, 0, 0), XSize=dom, YSize=dom_2, Radius=0)  # -> Rectangle, Length
area_2 = Area(Geometry=rectangle.Rectangle)  # -> Area, Centroid
arrrec = RectangularArray(Geometry=rectangle.Rectangle, Cell=rectangle.Rectangle, XCount=round.Ceiling, YCount=round.Ceiling)  # -> Geometry, Transform
xy = XYPlane(Origin=area_2.Centroid)
arrange_upright_2 = Data(arrange_upright)
rotate = Rotate(Geometry=xy, Angle="0.5 * Pi", Plane=xy)  # -> Geometry, Transform
insertionpoint_2 = Point(insertionpoint)
filter_2 = StreamFilter(Gate=arrange_upright_2, Stream0=xy, Stream1=rotate.Geometry)
split = SplitList(List=arrrec.Transform, Index=lng)  # -> ListA, ListB
xy_2 = XYPlane(Origin=insertionpoint_2)
split_2 = SplitList(List=arrrec.Geometry, Index=lng)  # -> ListA, ListB
componentdata_18 = Data(componentdata_16)
unflatten = UnflattenTree(Tree=split.ListA, Guide=componentdata_18)
unflatten_2 = UnflattenTree(Tree=split_2.ListA, Guide=componentdata_18)
transform = Transform(Geometry=filter_2, Transform=unflatten)
orient = Orient(Geometry=xy_2, Source=xy_2, Target=transform)  # -> Geometry, Transform
cpl_2 = CustomPreviewLineweights(Geometry=flatten(unflatten_2), Color=ColourSwatch(SwatchColor=RGB(0, 0, 0)), Thickness=Slider(1, range=0..10))  # inputs Geometry: list, Color: list of Color; same code as cpl
cellplanes = Data(orient.Geometry)
cells = Data(unflatten_2)
xform = Data(orient.Transform)

# ----
# comments & notes: Transform (Move, Rotate...) Components
componentdata_19 = Data(componentdata_14)
xform_2 = Data(xform)
transformcomponent = TransformComponent(ComponentData=componentdata_19, XForm=xform_2)  # -> out, XComponentData; inputs ComponentData: String, XForm: Transform
# ---------- transformcomponent: Python ----------
#! python3
# venv: DDU_CSC
# r: requests==2.31.0
# r: numpy==1.26.4
# r: scipy==1.13.0
# r: scikit-learn==1.4.2

# PYTHON STANDARD LIBRARY IMPORTS ---------------------------------------------
import json

# RHINO AND GH RELATED IMPORTS ------------------------------------------------
import System  # type: ignore[reportMissingImport] # NOQA
import Rhino  # type: ignore[reportMissingImport] # NOQA
import Grasshopper  # type: ignore[reportMissingImport] # NOQA

# GHENV COMPONENT SETTINGS ----------------------------------------------------
ghenv.Component.Name = 'TransformComponent'  # type: ignore[reportUnedfinedVariable] # NOQA
ghenv.Component.NickName = 'TransformComponent'  # type: ignore[reportUnedfinedVariable] # NOQA
ghenv.Component.Category = 'DDU_CSC'  # type: ignore[reportUnedfinedVariable] # NOQA
ghenv.Component.SubCategory = '3 Component Operations'  # type: ignore[reportUnedfinedVariable] # NOQA


class CSC_TransformComponent(Grasshopper.Kernel.GH_ScriptInstance):
    """
    Author: Max Benjamin Eschenbach
    License: MIT License
    Version: 250822
    Description: Transforms component insertion frames using Rhino transforms
    """

    def __init__(self):
        super().__init__()
        # initialize props
        self.Component = ghenv.Component  # type: ignore[reportUnedfinedVariable] # NOQA
        self.InputParams = self.Component.Params.Input
        self.OutputParams = self.Component.Params.Output

    def _addRemark(self, msg: str = ''):
        """Add a remark message to the component runtime messages."""
        rml = self.Component.RuntimeMessageLevel.Remark
        self.AddRuntimeMessage(rml, msg)

    def _addWarning(self, msg: str = ''):
        """Add a warning message to the component runtime messages."""
        rml = self.Component.RuntimeMessageLevel.Warning
        self.AddRuntimeMessage(rml, msg)

    def _addError(self, msg: str = ''):
        """Add an error message to the component runtime messages."""
        rml = self.Component.RuntimeMessageLevel.Error
        self.AddRuntimeMessage(rml, msg)

    def PlaneToFrameDict(self, plane: Rhino.Geometry.Plane) -> dict:
        """
        Convert a Rhino plane to a frame dictionary format.

        This method converts the plane's origin and axis vectors to the format
        expected by the component system for insertion frames.

        Args:
            plane: Rhino.Geometry.Plane object

        Returns:
            Dictionary with 'o', 'x', 'y', 'z' keys containing coordinate lists
        """
        iframe = {
            'o': [plane.OriginX, plane.OriginY, plane.OriginZ],
            'x': [plane.XAxis.X, plane.XAxis.Y, plane.XAxis.Z],
            'y': [plane.YAxis.X, plane.YAxis.Y, plane.YAxis.Z],
            'z': [plane.ZAxis.X, plane.ZAxis.Y, plane.ZAxis.Z]
        }
        return iframe

    def RunScript(self, ComponentData: str, XForm: Rhino.Geometry.Transform):
        """
        Main execution method for transforming component insertion frames.

        This method takes a component JSON string and a Rhino transform,
        applies the transform to the component's insertion frame, and
        returns the updated component data as a JSON string.

        Args:
            ComponentData: JSON string containing component data
            XForm: Rhino transform to apply to the insertion frame

        Returns:
            JSON string of the transformed component data
        """
        # Initialize param descriptions (this has to be done in RunScript)
        self.InputParams[0].Description = (
            'Component data as JSON string from previous components.'
        )
        self.InputParams[1].Description = (
            'Rhino transform to apply to the component insertion frame.'
        )

        # Initialize output param descriptions
        self.OutputParams[0].Description = (
            'Transformed component data as JSON string'
        )

        # set up output trees and results tuple
        XComponentData = System.Collections.Generic.List[System.Object]()

        # Validate input parameters
        if not ComponentData:
            msg = 'Input ComponentData failed to collect data!'
            self._addWarning(msg)
            self.Component.Message = msg
            return XComponentData

        if not XForm:
            msg = 'Input XForm failed to collect data!'
            self._addWarning(msg)
            self.Component.Message = msg
            return XComponentData

        try:
            # Load and parse component JSON data
            jcomp = json.loads(ComponentData)

            # Process insertion frame
            try:
                # Try to extract existing insertion frame from component
                iframe = jcomp['iframe']
                iplane = Rhino.Geometry.Plane(
                    Rhino.Geometry.Point3d(*iframe['o']),
                    Rhino.Geometry.Vector3d(*iframe['x']),
                    Rhino.Geometry.Vector3d(*iframe['y']),
                )
                self._addRemark(
                    'Using existing insertion frame from component'
                )
            except KeyError:
                # If there is no insertion frame,
                # create world XY plane as default
                iplane = Rhino.Geometry.Plane.WorldXY
                self._addRemark(
                    'No insertion frame found, using WorldXY plane'
                )

            # Apply the input transform to the insertion frame plane
            iplane.Transform(XForm)

            # Replace the insertion frame in the component data
            # with the transformed one
            jcomp['iframe'] = self.PlaneToFrameDict(iplane)

            # Convert back to JSON string for output
            XComponentData = json.dumps(jcomp)

            # Update component message to indicate success
            self.Component.Message = (
                'Component insertion frame transformed successfully'
            )
            self._addRemark(
                'Successfully transformed component insertion frame'
            )

            return XComponentData

        except json.JSONDecodeError as e:
            msg = f'Failed to parse component JSON data: {str(e)}'
            self._addError(msg)
            self.Component.Message = msg
            return XComponentData

        except Exception as e:
            msg = f'Unexpected error during transformation: {str(e)}'
            self._addError(msg)
            self.Component.Message = msg
            return XComponentData
# ---------- end transformcomponent ----------
output_stream = Panel(transformcomponent.out)
componentdata_20 = Data(transformcomponent.XComponentData)

number_slider = Slider(110, range=0..10000)
data_2 = Data(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)
rotate_2 = Rotate(Geometry=data_2, Angle=degrees(number_slider), Plane=PlaneXY(0, 0, 0))  # -> Geometry, Transform
xz = XZPlane(Origin=Point(0, 0, 0))
rotate_3 = Rotate(Geometry=rotate_2.Geometry, Angle=expr("x*0.3333333", degrees(number_slider)), Plane=xz)  # -> Geometry, Transform
yz = YZPlane(Origin=Point(0, 0, 0))
rotate_4 = Rotate(Geometry=rotate_3.Geometry, Angle=expr("x*0.666666666", degrees(number_slider)), Plane=yz)  # -> Geometry, Transform
minbbx = Python3Script(Geometry=rotate_4.Geometry)  # -> out, AlignedGeometry, Frame, XForm, WorldBBX, AlignedBBX; inputs Geometry: GeometryBase
# ---------- minbbx: Python ----------
#! python3
# venv: DDU_CSC
# r: requests==2.31.0
# r: numpy==1.26.4
# r: scipy==1.13.0
# r: scikit-learn==1.4.2

import numpy as np
from scipy.spatial import ConvexHull
from sklearn.decomposition import PCA

import System
import Rhino
import Grasshopper
import rhinoscriptsyntax as rs


class MinBBX(Grasshopper.Kernel.GH_ScriptInstance):

    def minimum_bounding_rectangle(self, points):
        # Compute the convex hull of the points
        hull = ConvexHull(points)
        hull_points = points[hull.vertices]
        # Initialize variables to keep track of the best rectangle
        min_area = float('inf')
        best_rectangle = None
        best_angle = 0
        # Loop through each edge of the convex hull
        for i in range(len(hull_points)):
            # Determine the points forming the current edge
            p1 = hull_points[i]
            p2 = hull_points[(i + 1) % len(hull_points)]
            # Calculate edge vector
            edge_vec = p2 - p1
            # Rotate the points to align this edge with the x-axis
            angle = np.arctan2(edge_vec[1], edge_vec[0])
            cos_angle = np.cos(-angle)
            sin_angle = np.sin(-angle)
            rot_matrix = np.array([[cos_angle, -sin_angle], [sin_angle, cos_angle]])
            rotated_points = np.dot(points, rot_matrix.T)
            # Compute the min/max x/y in the rotated points
            min_x = np.min(rotated_points[:, 0])
            max_x = np.max(rotated_points[:, 0])
            min_y = np.min(rotated_points[:, 1])
            max_y = np.max(rotated_points[:, 1])
            # Calculate area of the bounding rectangle
            area = (max_x - min_x) * (max_y - min_y)
            if area < min_area:
                min_area = area
                best_angle = angle
                # Create the rectangle in the rotated space and then rotate it back
                best_rectangle = np.array([
                    [min_x, min_y],
                    [max_x, min_y],
                    [max_x, max_y],
                    [min_x, max_y]
                ])
                inv_rot_matrix = np.array([[cos_angle, sin_angle], [-sin_angle, cos_angle]])
                best_rectangle = np.dot(best_rectangle, inv_rot_matrix.T)
        # return results
        return best_rectangle, best_angle

    def transformation_matrix(self, rectangle, angle):
        # Compute the centroid of the rectangle
        centroid = np.mean(rectangle, axis=0)
        # Calculate translation to the origin
        translate_to_origin = np.eye(4)
        translate_to_origin[0, 3] = -centroid[0]
        translate_to_origin[1, 3] = -centroid[1]
        # Calculate rotation to align the long side with the x-axis
        rotate = np.eye(4)
        cos_angle = np.cos(-angle)
        sin_angle = np.sin(-angle)
        rotate[0, 0] = cos_angle
        rotate[0, 1] = -sin_angle
        rotate[1, 0] = sin_angle
        rotate[1, 1] = cos_angle
        # Combine transformations
        transformation = np.dot(rotate, translate_to_origin)
        return transformation

    def apply_transformation(self, points, transform_matrix):
        # Extend 2D points to 4D homogeneous coordinates
        homogeneous_points = np.hstack([points, np.ones((points.shape[0], 1)), np.zeros((points.shape[0], 1))])
        # Multiply the points by the transformation matrix
        transformed_points = np.dot(homogeneous_points, transform_matrix.T)
        # Return the transformed points, discarding the homogeneous coordinate
        return transformed_points[:, :2]


    def compute_pca_bounding_box(self, points):
        # normalize the data by subtracting the mean
        mean = np.mean(points, axis=0)
        centered_points = points - mean
        # apply PCA to find the principal axes
        pca = PCA(n_components=3)
        pca.fit(centered_points)
        # project the normalized points onto the PCA axes
        transformed_points = pca.transform(centered_points)
        # find the bounds along the principal axes
        min_bounds = np.min(transformed_points, axis=0)
        max_bounds = np.max(transformed_points, axis=0)
        # define the 8 corners of the bounding box in the PCA coordinate system
        corners = np.array([
            [min_bounds[0], min_bounds[1], min_bounds[2]],
            [max_bounds[0], min_bounds[1], min_bounds[2]],
            [max_bounds[0], max_bounds[1], min_bounds[2]],
            [min_bounds[0], max_bounds[1], min_bounds[2]],
            [min_bounds[0], min_bounds[1], max_bounds[2]],
            [max_bounds[0], min_bounds[1], max_bounds[2]],
            [max_bounds[0], max_bounds[1], max_bounds[2]],
            [min_bounds[0], max_bounds[1], max_bounds[2]]
        ])
        # calculate the transformation matrix to align the PCA bounding box with the world axes
        extents = max_bounds - min_bounds
        sorted_indices = np.argsort(-extents)
        sorted_components = pca.components_[sorted_indices]
        # transformation matrix: Rotate back to align with original axes, then translate to origin
        rotation_matrix = sorted_components
        transformation_matrix = np.eye(4)
        transformation_matrix[:3, :3] = rotation_matrix
        transformed_mean = rotation_matrix.dot(mean)
        transformation_matrix[:3, 3] = -transformed_mean
        transformation_matrix_inv = np.linalg.inv(transformation_matrix)
        # return results
        return sorted_components, corners, transformation_matrix, transformation_matrix_inv

    def rhino_xform(self, transformation_matrix):
        XForm = Rhino.Geometry.Transform.Identity
        XForm.M00 = transformation_matrix[0][0]
        XForm.M01 = transformation_matrix[0][1]
        XForm.M02 = transformation_matrix[0][2]
        XForm.M03 = transformation_matrix[0][3]
        XForm.M10 = transformation_matrix[1][0]
        XForm.M11 = transformation_matrix[1][1]
        XForm.M12 = transformation_matrix[1][2]
        XForm.M13 = transformation_matrix[1][3]
        XForm.M20 = transformation_matrix[2][0]
        XForm.M21 = transformation_matrix[2][1]
        XForm.M22 = transformation_matrix[2][2]
        XForm.M23 = transformation_matrix[2][3]
        return XForm

    def RunScript(self, Geometry: Rhino.Geometry.GeometryBase):
        # create empty outputs
        AlignedGeometry = Grasshopper.DataTree[object]()
        Frame = Grasshopper.DataTree[object]()
        XForm = Grasshopper.DataTree[object]()
        WorldBBX = Grasshopper.DataTree[object]()
        AlignedBBX = Grasshopper.DataTree[object]()
        # sanitize input
        if not Geometry:
            rml = ghenv.Component.RuntimeMessageLevel.Warning
            msg = 'Input Geometry failed to collect data!'
            ghenv.Component.AddRuntimeMessage(rml, msg)
            return (AlignedGeometry, Frame, XForm, WorldBBX, AlignedBBX)

        compute_3d = False
        # HANDLE BREP
        if isinstance(Geometry, Rhino.Geometry.Brep):
            points = np.array([[p.Location.X, p.Location.Y, p.Location.Z] for p in Geometry.Vertices])
            compute_3d = True
        # HANDLE EXTRUSIONS
        elif isinstance(Geometry, Rhino.Geometry.Extrusion):
            brep = Geometry.ToBrep()
            points = np.array([[p.Location.X, p.Location.Y, p.Location.Z] for p in brep.Vertices])
            compute_3d = True
        # HANDLE MESH
        elif isinstance(Geometry, Rhino.Geometry.Mesh):
            # get points
            points = np.array([[p.X, p.Y, p.Z] for p in Geometry.Vertices])
            compute_3d = True
        # HANDLE POLYLINECURVE
        elif isinstance(Geometry, Rhino.Geometry.PolylineCurve):
            pl = Geometry.ToPolyline()
            pl.RemoveNearlyEqualSubsequentPoints(Rhino.RhinoDoc.ActiveDoc.ModelAbsoluteTolerance)
            pl.MergeColinearSegments(Rhino.RhinoDoc.ActiveDoc.ModelAngleToleranceRadians, True)
            pl.ReduceSegments(Rhino.RhinoDoc.ActiveDoc.ModelAbsoluteTolerance)
            points = np.array([[p.X, p.Y] for p in pl])
            compute_3d = False
        else:
            raise RuntimeError(f'Minimum BBX not implemented for geometry of type {type(Geometry)}!')

        # PROCESSING RESULTS FOR OUTPUT
        if compute_3d:
            # compute bbx
            (principal_axes,
             bbox_corners,
             transformation_matrix,
             transformation_matrix_inv) = self.compute_pca_bounding_box(points)
            # get xform
            XForm = self.rhino_xform(transformation_matrix)
            iXForm = self.rhino_xform(transformation_matrix_inv)
            # create frame
            Frame = Rhino.Geometry.Plane(
                Rhino.Geometry.Point3d(0, 0, 0),
                Rhino.Geometry.Vector3d(principal_axes[0][0],
                                        principal_axes[0][1],
                                        principal_axes[0][2]),
                Rhino.Geometry.Vector3d(principal_axes[1][0],
                                        principal_axes[1][1],
                                        principal_axes[1][2])
            )
            # create bbx and aligned bbx
            AlignedBBX = [Rhino.Geometry.Point3d(p[0], p[1], p[2]) for p in bbox_corners]
            WorldBBX = [Rhino.Geometry.Point3d(pt) for pt in AlignedBBX]
            [p.Transform(iXForm) for p in WorldBBX]
            # create aligned geometry
            AlignedGeometry = Geometry
            AlignedGeometry.Transform(XForm)
        else:
            mbr, angle = self.minimum_bounding_rectangle(points)
            transformation_matrix = self.transformation_matrix(mbr, angle)
            # create rhino xform
            XForm = self.rhino_xform(transformation_matrix)
            # create aligned geometry
            AlignedGeometry = Geometry
            AlignedGeometry.Transform(XForm)
            # create bbxes
            AlignedBBX = [Rhino.Geometry.Point3d(p[0], p[1], 0) for p in mbr]
            [pt.Transform(XForm) for pt in AlignedBBX]
            WorldBBX = [Rhino.Geometry.Point3d(p[0], p[1], 0) for p in mbr]

        return (AlignedGeometry, Frame, XForm, WorldBBX, AlignedBBX)
# ---------- end minbbx ----------
bbox = BoundingBox(Content=minbbx.AlignedBBX, Plane=PlaneXY(0, 0, 0), UnionBox=True)  # -> Box, Box_2
volume = Volume(Geometry=bbox.Box)  # -> Volume, Centroid
volume_2 = Volume(Geometry=minbbx.AlignedGeometry)  # -> Volume, Centroid
panel_8 = Panel(volume_2.Centroid)
panel_9 = Panel(minbbx.Frame)
panel_10 = Panel(volume.Centroid)

# ----
# comments & notes: Disassemble Component into its elements
componentdata_21 = Data(componentdata_20)
disassemblecomponent = DisassembleComponent(ComponentData=componentdata_21)  # -> ID, Type, Material, Geometry, Color, BoundingBox, Descriptors; inputs ComponentData: tree of String
# ---------- disassemblecomponent: Python ----------
#! python3
# venv: DDU_CSC
# r: requests==2.31.0
# r: numpy==1.26.4
# r: scipy==1.13.0
# r: scikit-learn==1.4.2

# PYTHON STANDARD LIBRARY IMPORTS ---------------------------------------------
import json

# RHINO AND GH RELATED IMPORTS ------------------------------------------------
import System  # type: ignore[reportMissingImport] # NOQA
import Rhino  # type: ignore[reportMissingImport] # NOQA
import Grasshopper  # type: ignore[reportMissingImport] # NOQA

# GHENV COMPONENT SETTINGS ----------------------------------------------------
ghenv.Component.Name = 'DisassembleComponent'  # type: ignore[reportUnedfinedVariable] # NOQA
ghenv.Component.NickName = 'DisassembleComponent'  # type: ignore[reportUnedfinedVariable] # NOQA
ghenv.Component.Category = 'DDU_CSC'  # type: ignore[reportUnedfinedVariable] # NOQA
ghenv.Component.SubCategory = '3 Component Operations'  # type: ignore[reportUnedfinedVariable] # NOQA


class CSC_DisassembleComponent(Grasshopper.Kernel.GH_ScriptInstance):
    """
    Author: Max Benjamin Eschenbach
    License: MIT License
    Version: 250822
    """

    def __init__(self):
        super().__init__()
        # initialize props
        self.Component = ghenv.Component  # type: ignore[reportUnedfinedVariable] # NOQA
        self.InputParams = self.Component.Params.Input
        self.OutputParams = self.Component.Params.Output

    def _addRemark(self, msg: str = ''):
        rml = self.Component.RuntimeMessageLevel.Remark
        self.AddRuntimeMessage(rml, msg)

    def _addWarning(self, msg: str = ''):
        rml = self.Component.RuntimeMessageLevel.Warning
        self.AddRuntimeMessage(rml, msg)

    def _addError(self, msg: str = ''):
        rml = self.Component.RuntimeMessageLevel.Error
        self.AddRuntimeMessage(rml, msg)

    def ComponentExtrusionProfile(
            self,
            json_comp: dict) -> Rhino.Geometry.Polyline:
        pl = Rhino.Geometry.Polyline()
        pts = [Rhino.Geometry.Point3d(pt[0], pt[1], 0.0)
               for pt in json_comp['geometry']['extrusion']['profile']]
        pl.AddRange(pts)
        return pl

    def ComponentExtrusion(
            self,
            json_comp: dict) -> Rhino.Geometry.Extrusion:
        pl = Rhino.Geometry.Polyline()
        pts = [Rhino.Geometry.Point3d(pt[0], pt[1], 0.0)
               for pt in json_comp['geometry']['extrusion']['profile']]
        pl.AddRange(pts)
        cxt = Rhino.Geometry.Extrusion.Create(
            pl.ToPolylineCurve(),
            Rhino.Geometry.Plane.WorldXY,
            json_comp['geometry']['extrusion']['height'],
            True)
        # move extrusion downwards half material
        # thickness to center it at the origin
        cxt.Translate(Rhino.Geometry.Vector3d(
            0, 0, json_comp['geometry']['extrusion']['height'] * -0.5))
        return cxt

    def ComponentMesh(self, json_comp: dict) -> Rhino.Geometry.Mesh:
        mesh = Rhino.Geometry.Mesh()
        vl = json_comp['geometry']['mesh']['v']
        fl = json_comp['geometry']['mesh']['f']
        [mesh.Vertices.Add(*v) for v in vl]
        [mesh.Faces.AddFace(*f) for f in fl]
        # Try to get mesh-specific colors first
        try:
            cl = json_comp['geometry']['mesh']['c']
            [mesh.VertexColors.Add(
                System.Drawing.Color.FromArgb(*c)) for c in cl]
        except KeyError:
            # Fallback: use component color for all vertices
            try:
                component_color = System.Drawing.Color.FromArgb(
                    255, *json_comp['color'])
                for _ in range(len(vl)):
                    mesh.VertexColors.Add(component_color)
            except (KeyError, TypeError):
                # If even component color fails, use a default gray
                default_color = System.Drawing.Color.Gray
                for _ in range(len(vl)):
                    mesh.VertexColors.Add(default_color)
                self._addWarning(
                    f'Mesh {json_comp["_id"]} using default gray color')
        mesh.RebuildNormals()
        mesh.UnifyNormals()
        mesh.Compact()
        return mesh

    def ComponentColor(self, json_comp: dict) -> System.Drawing.Color:
        return System.Drawing.Color.FromArgb(255, *json_comp['color'])

    def ComponentBoundingBox(
            self,
            json_comp: dict) -> Rhino.Geometry.BoundingBox:
        xtx = json_comp['bbx'][0]
        xty = json_comp['bbx'][1]
        xtz = json_comp['bbx'][2]
        Rhino.Geometry.BoundingBox()
        bbx = Rhino.Geometry.BoundingBox(
            -xtx * 0.5,
            -xty * 0.5,
            -xtz * 0.5,
            xtx * 0.5,
            xty * 0.5,
            xtz * 0.5
        )
        return bbx

    def RunScript(self, ComponentData: Grasshopper.DataTree[str]):
        # Initialize param descriptions (this has to be done in RunScript)
        self.InputParams[0].Description = (
            'The ComponentData that was fetched from the server as JSON.')

        # Initialize output param descriptions
        self.OutputParams[0].Description = 'Component ID (GUID)'
        self.OutputParams[1].Description = (
            'Component type (sheet, beam, slab, etc.)'
        )
        self.OutputParams[2].Description = 'Component material'
        self.OutputParams[3].Description = (
            'Rhino geometry objects (extrusion, mesh, polyline)'
        )
        self.OutputParams[4].Description = (
            'Component color as System.Drawing.Color'
        )
        self.OutputParams[5].Description = (
            'Component bounding box as Rhino.Geometry.BoundingBox'
        )
        self.OutputParams[6].Description = (
            'Component descriptors/metadata as JSON string'
        )

        try:
            # set up output trees and results tuple
            ID = Grasshopper.DataTree[System.Object]()
            Type = Grasshopper.DataTree[System.Object]()
            Material = Grasshopper.DataTree[System.Object]()
            Geometry = Grasshopper.DataTree[System.Object]()
            Color = Grasshopper.DataTree[System.Object]()
            BoundingBox = Grasshopper.DataTree[System.Object]()
            Descriptors = Grasshopper.DataTree[System.Object]()
            __Results = (
                ID,
                Type,
                Material,
                Geometry,
                Color,
                BoundingBox,
                Descriptors)

            # Validate input
            if not ComponentData or ComponentData.DataCount == 0:
                msg = ('No component data provided. Please connect '
                       'FetchComponent output.')
                self._addWarning(msg)
                self.Component.Message = msg
                return __Results

            self.Component.Message = 'Disassembling components...'

            # loop over all branches
            for i in range(ComponentData.BranchCount):
                for j, comp in enumerate(ComponentData.Branches[i]):
                    try:
                        json_comp = json.loads(comp)
                        # create datatree path
                        ghp = ComponentData.Paths[i]
                        # add directly available metadata to the
                        # respective datatrees
                        ID.Add(json_comp['_id'], ghp)
                        Type.Add(json_comp['type'], ghp)
                        Material.Add(json_comp['material'], ghp)

                        # process insertion frame
                        try:
                            iframe = json_comp['iframe']
                            iplane = Rhino.Geometry.Plane(
                                Rhino.Geometry.Point3d(*iframe['o']),
                                Rhino.Geometry.Vector3d(*iframe['x']),
                                Rhino.Geometry.Vector3d(*iframe['y']),
                            )
                        except KeyError:
                            iplane = Rhino.Geometry.Plane.WorldXY

                        xform = Rhino.Geometry.Transform.PlaneToPlane(
                            Rhino.Geometry.Plane.WorldXY,
                            iplane)

                        # treat geometry key in a special way because
                        # it may hold multiple geometry types
                        for key in sorted(json_comp['geometry'].keys()):
                            component_geometry = None
                            if key == 'extrusion':
                                xtr = self.ComponentExtrusion(json_comp)
                                # transform to iframe
                                xtr.Transform(xform)
                                # set geometry
                                component_geometry = xtr
                            elif key == 'mesh':
                                mesh = self.ComponentMesh(json_comp)
                                # transform to iframe
                                mesh.Transform(xform)
                                # set geometry
                                component_geometry = mesh
                            elif key == 'polyline':
                                pl = self.ComponentExtrusionProfile(json_comp)
                                # transform to iframe
                                pl.Transform(xform)
                                # set geometry
                                component_geometry = pl
                            else:
                                msg = (f'Missing implementation for geometry '
                                       f'of type \'{key}\'!')
                                self._addWarning(msg)
                                self.Component.Message = msg
                            # set user string
                            component_geometry.SetUserString('csc_component', comp)
                            # add to datatree
                            Geometry.Add(component_geometry, ghp)

                        # create system color from rgb values
                        color = self.ComponentColor(json_comp)
                        Color.Add(color, ghp)

                        # construct boundingbox
                        bbx = self.ComponentBoundingBox(json_comp)

                        # apply iframe transform
                        bbx.Transform(xform)
                        BoundingBox.Add(bbx, ghp)

                        # add descriptors
                        try:
                            descriptors = json_comp.get('descriptors', {})
                            Descriptors.Add(json.dumps(descriptors), ghp)
                        except KeyError:
                            # If no descriptors, add empty dict as JSON string
                            Descriptors.Add(json.dumps({}), ghp)

                    except json.JSONDecodeError as e:
                        msg = f'Failed to parse component data: {str(e)}'
                        self._addError(msg)
                        self.Component.Message = msg
                    except Exception as e:
                        msg = f'Error processing component: {str(e)}'
                        self._addError(msg)
                        self.Component.Message = msg

            # Update success message
            total_components = sum(
                len(branch) for branch in ComponentData.Branches
            )
            self.Component.Message = (
                f'Disassembled {total_components} component(s)'
            )
            self._addRemark(
                f'Successfully disassembled {total_components} components'
            )

            # return output trees
            return __Results

        except Exception as e:
            msg = f'Unexpected error during disassembly: {str(e)}'
            self._addError(msg)
            self.Component.Message = msg

            # Return empty results if there was an error
            ID = Grasshopper.DataTree[System.Object]()
            Type = Grasshopper.DataTree[System.Object]()
            Material = Grasshopper.DataTree[System.Object]()
            Geometry = Grasshopper.DataTree[System.Object]()
            Color = Grasshopper.DataTree[System.Object]()
            BoundingBox = Grasshopper.DataTree[System.Object]()
            Descriptors = Grasshopper.DataTree[System.Object]()
            __Results = (
                ID,
                Type,
                Material,
                Geometry,
                Color,
                BoundingBox,
                Descriptors)
            return __Results
# ---------- end disassemblecomponent ----------
boundingbox = Data(disassemblecomponent.BoundingBox)
geometry_3 = Data(disassemblecomponent.Geometry)
id = Data(disassemblecomponent.ID)
color = Data(disassemblecomponent.Color)

boundingbox_2 = Data(boundingbox)
geometry_4 = Data(geometry_3)
id_2 = Data(id)
color_2 = Data(color)

debox = DeconstructBox(Box=boundingbox_2)  # -> Plane, X, Y, Z
dedomain = DeconstructDomain(Domain=debox.Z)  # -> Start, End
subtraction = Subtraction(A=dedomain.End, B=dedomain.Start)
materialthickness = Data(subtraction)

geometry_5 = Data(geometry_4)
comments_notes_7 = Panel("Visualize Component")
py3_2 = Python3Script(Geo=geometry_5)  # -> out, PolylineGeo, ExtrusionGeo, MeshGeo; inputs Geo: GeometryBase
# ---------- py3_2: Python ----------
import Rhino

PolylineGeo = []
ExtrusionGeo = []
MeshGeo = []

if (isinstance(Geo, Rhino.Geometry.PolylineCurve) or
    isinstance(Geo, Rhino.Geometry.Polyline)):
    PolylineGeo.append(Geo)
elif (isinstance(Geo, Rhino.Geometry.Mesh)):
    MeshGeo.append(Geo)
elif (isinstance(Geo, Rhino.Geometry.Extrusion)):
    ExtrusionGeo.append(Geo)
# ---------- end py3_2 ----------
clean = CleanTree(RemoveNulls=True, RemoveInvalid=True, RemoveEmpty=True)  # -> simplify(Tree)
color_3 = Data(color_2)
clean_2 = CleanTree(RemoveNulls=True, RemoveInvalid=True, RemoveEmpty=True)  # -> simplify(Tree)
tstat_3 = TreeStatistics(Tree=clean)  # -> Paths, Length, Count
branch = TreeBranch(Tree=color_3, Path=tstat_3.Paths, MaintainPaths=True)
tstat_4 = TreeStatistics(Tree=clean_2)  # -> Paths, Length, Count
branch_2 = TreeBranch(Tree=color_3, Path=tstat_4.Paths, MaintainPaths=True)
preview = CustomPreview(Geometry=clean, Material=branch)
preview_2 = CustomPreview(Geometry=clean_2, Material=branch_2)

materialthickness_2 = Data(materialthickness)
comments_notes_8 = Panel("Visualize ID Tag")
id_3 = Data(id_2)
area_3 = Area(Geometry=geometry_4)  # -> Area, Centroid
Z = UnitZ(Factor=materialthickness_2)
move = Move(Geometry=area_3.Centroid, Motion=Z)  # -> Geometry, Transform
tag = TextTag3D(
    Location=move.Geometry,
    Text=id_3,
    Size=Slider(8, range=0..10),
    Colour=ColourSwatch(SwatchColor=RGB(0, 217, 255)),
    Justification=5)

comments_notes_9 = Panel("Visualize Bounding Rectangle")
bbx2d = Data(boundingbox_2)
cpl_3 = CustomPreviewLineweights(Geometry=flatten(bbx2d), Color=ColourSwatch(SwatchColor=RGB(255, 107, 107)), Thickness=Slider(2, range=0..10))  # inputs Geometry: list, Color: list of Color; same code as cpl
