# Grasshopper definition 250904_DDU_CSC_GrasshopperInterface.gh (Grasshopper 1.0.8)

# DDU DEVELOPMENT: Authors: Max Benjamin Eschenbach
# 
# Digital Design Unit (DDU)
# Prof. Dr.-Ing. Oliver Tessmann
# Fachbereich Architektur
# Technical University of Darmstadt
# 
# CREDITS:
# ------------
# Please see: https://ddu.uber.space/credits
environment_spec = Panel("""#! python3
# venv: DDU_CSC
# r: requests==2.31.0
# r: numpy==1.26.4
# r: scipy==1.13.0
# r: scikit-learn==1.4.2""")

# ----
# VIEWCAPTURE
save_viewcapture = BooleanToggle(False)
# comments & notes: RETRIEVING & FILTERING, VISUALIZING COMPONENTS
open_viewcapture_after_saving = BooleanToggle(False)
viewcapturewidth = Slider(1920, range=0..10000)
viewcaptureheight = Slider(1080, range=0..10000)
viewcapturetofile = ViewCaptureToFile(
    Toggle=save_viewcapture,
    Width=viewcapturewidth,
    Height=viewcaptureheight,
    Grid=Toggle(False),
    WorldAxes=Toggle(False),
    CPlaneAxes=Toggle(False),
    OpenFile=open_viewcapture_after_saving)  # -> Path; inputs Toggle: Boolean, Width: Int32, Height: Int32, BackgroundColor: Color, Grid: Boolean, WorldAxes: Boolean, CPlaneAxes: Boolean, OpenFile: Boolean
# ---------- viewcapturetofile: Python ----------
#! python3
# venv: DDU_CSC
# r: requests==2.31.0
# r: numpy==1.26.4
# r: scipy==1.13.0
# r: scikit-learn==1.4.2

# PYTHON STANDARD LIBRARY IMPORTS ---------------------------------------------
import os
import datetime

# RHINO AND GH RELATED IMPORTS ------------------------------------------------
import System  # type: ignore[reportMissingImport] # NOQA
import Rhino  # type: ignore[reportMissingImport] # NOQA
import Grasshopper  # type: ignore[reportMissingImport] # NOQA
import scriptcontext as sc  # type: ignore[reportMissingImport] # NOQA

# GHENV COMPONENT SETTINGS ----------------------------------------------------
ghenv.Component.Name = 'ViewCaptureToFile'  # type: ignore[reportUnedfinedVariable] # NOQA
ghenv.Component.NickName = 'ViewCaptureToFile'  # type: ignore[reportUnedfinedVariable] # NOQA
ghenv.Component.Category = 'DDU_CSC'  # type: ignore[reportUnedfinedVariable] # NOQA
ghenv.Component.SubCategory = '8 Visualisation'  # type: ignore[reportUnedfinedVariable] # NOQA


class CSC_ViewCaptureToFile(Grasshopper.Kernel.GH_ScriptInstance):
    """
    Author: Anders Holden Deleuran (updated 2025 by Max Benjamin Eschenbach)
    License: MIT License
    Version: 250902
    Description: Captures the active Rhino view to an image file
    """

    def __init__(self):
        super().__init__()
        # initialize props
        self.Component = ghenv.Component  # type: ignore[reportUnedfinedVariable] # NOQA
        self.InputParams = self.Component.Params.Input
        self.OutputParams = self.Component.Params.Output

    def _addRemark(self, msg: str = ''):
        """Add a remark message to the component runtime messages."""
        rml = self.Component.RuntimeMessageLevel.Remark
        self.AddRuntimeMessage(rml, msg)

    def _addWarning(self, msg: str = ''):
        """Add a warning message to the component runtime messages."""
        rml = self.Component.RuntimeMessageLevel.Warning
        self.AddRuntimeMessage(rml, msg)

    def _addError(self, msg: str = ''):
        """Add an error message to the component runtime messages."""
        rml = self.Component.RuntimeMessageLevel.Error
        self.AddRuntimeMessage(rml, msg)

    def checkOrMakeFolder(self):
        """
        Check/makes a "Captures" folder in the GH def folder and a subfolder
        in the format 'YYMMDD'.
        """
        # construct timestamp for subfolder
        date = datetime.date.today()
        yy = str(date.year)[-2:]
        mm = str(date.month).zfill(2)
        dd = str(date.day).zfill(2)
        timestamp = yy + mm + dd
        docpath = ghdoc.Path  # type: ignore[reportUnedfinedVariable] # NOQA
        if docpath:
            folder = os.path.dirname(docpath)
            captureFolder = folder + "\\Captures\\" + timestamp
            if not os.path.isdir(captureFolder):
                os.makedirs(captureFolder)
            return captureFolder

    def makeFileName(self):
        """ Make a string with the gh def name + current hourMinuteSecond """
        # Make hour minute seconds string
        n = datetime.datetime.now()
        ho, mt, sc = str(n.hour), str(n.minute), str(n.second)
        if len(ho) == 1:
            ho = "0" + ho
        if len(mt) == 1:
            mt = "0" + mt
        if len(sc) == 1:
            sc = "0" + sc
        hms = ho + mt + sc
        # Get name of GH def
        ghDef = ghdoc.Name.strip("*")  # type: ignore[reportUnedfinedVariable] # NOQA
        # Concatenate and return
        fileName = ghDef + "_" + hms
        return fileName

    def captureActiveViewToFile(
            self,
            width,
            height,
            path,
            grid,
            worldAxes,
            cplaneAxes):
        """
        Captures the active view to an image file at the path.
        Path looks like this:
        "C:\\Users\\user\\Desktop\\Captures\\foo_bar.png"
        """
        # Set the script context to the current Rhino doc
        sc.doc = Rhino.RhinoDoc.ActiveDoc
        # Get the active view and set image dimensions
        activeView = sc.doc.Views.ActiveView
        # Perform the capture
        try:
            viewcap = Rhino.Display.ViewCapture()
            viewcap.DrawGrid = grid
            viewcap.DrawGridAxes = worldAxes
            viewcap.DrawAxes = cplaneAxes
            viewcap.Height = height
            viewcap.Width = width
            imageCap = viewcap.CaptureToBitmap(activeView)
            System.Drawing.Bitmap.Save(imageCap, path)
            Rhino.RhinoApp.WriteLine(path)
            sc.doc = ghdoc  # type: ignore[reportUnedfinedVariable] # NOQA
            return path
        except Exception as e:
            sc.doc = ghdoc  # type: ignore[reportUnedfinedVariable] # NOQA
            raise Exception(f'Capture failed, check the path: {str(e)}')

    def RunScript(self,
            Toggle: bool,
            Width: int,
            Height: int,
            BackgroundColor: System.Drawing.Color,
            Grid: bool,
            WorldAxes: bool,
            CPlaneAxes: bool,
            OpenFile: bool):
        """
        Main execution method for capturing the active view to a file.

        Args:
            Toggle: Boolean to execute the capture operation
            Width: Image width in pixels (default: 1920)
            Height: Image height in pixels (default: 1080)
            BackgroundColor: Background color for the viewport
            Grid: Show grid in capture
            WorldAxes: Show world axes in capture
            CPlaneAxes: Show construction plane axes in capture
            OpenFile: Open the captured file after creation

        Returns:
            Path to the captured image file
        """
        # Initialize param descriptions (this has to be done in RunScript)
        self.InputParams[0].Description = (
            'Toggle to execute the view capture operation'
        )
        self.InputParams[1].Description = (
            'Image width in pixels (default: 1920 if not provided)'
        )
        self.InputParams[2].Description = (
            'Image height in pixels (default: 1080 if not provided)'
        )
        self.InputParams[3].Description = (
            'Background color for the viewport capture'
        )
        self.InputParams[4].Description = (
            'Show grid in the captured image'
        )
        self.InputParams[5].Description = (
            'Show world axes in the captured image'
        )
        self.InputParams[6].Description = (
            'Show construction plane axes in the captured image'
        )
        self.InputParams[7].Description = (
            'Open the captured file after creation'
        )

        # Initialize output param descriptions
        self.OutputParams[0].Description = (
            'Path to the captured image file'
        )

        # Set up output trees and results
        Path = Grasshopper.DataTree[System.Object]()

        if not Toggle:
            self.Component.Message = (
                'Ready to capture view (toggle to execute)'
            )
            return Path

        try:
            # Set background color if provided
            if BackgroundColor:
                settings = Rhino.ApplicationSettings.AppearanceSettings
                settings.ViewportBackgroundColor = BackgroundColor
                self._addRemark('Background color set for capture')

            # Set default dimensions if not provided
            if not Width:
                Width = 1920
            if not Height:
                Height = 1080

            self.Component.Message = 'Preparing capture...'

            # Create capture folder and filename
            capFolder = self.checkOrMakeFolder()
            fileName = self.makeFileName()
            path = os.path.join(capFolder, fileName + '.png')

            self.Component.Message = 'Capturing view...'

            # Perform the capture
            captured_path = self.captureActiveViewToFile(
                Width, Height, path, Grid, WorldAxes, CPlaneAxes
            )

            # Add to output
            ghp = Grasshopper.Kernel.Data.GH_Path(0)
            Path.Add(captured_path, ghp)

            # Open file if requested
            if OpenFile:
                os.startfile(path)
                self._addRemark('File opened after capture')

            self.Component.Message = f'View captured: {fileName}.png'
            self._addRemark(f'Successfully captured view to {captured_path}')

            return Path

        except Exception as e:
            msg = f'Capture failed: {str(e)}'
            self._addError(msg)
            self.Component.Message = msg
            return Path
# ---------- end viewcapturetofile ----------
panel = Panel(viewcapturetofile)

# ---- group: __GH_DEVELOPMENT_TOOLS__
# DEPENDENCIES
# (PLUGINS USED)
plugins = BooleanToggle(False)
definitiondependencies = DefinitionDependencies(Toggle=plugins)  # -> Core, AddOns; inputs Toggle: Boolean
# ---------- definitiondependencies: C# ----------
#region Usings
using System;
using System.Linq;
using System.Collections;
using System.Collections.Generic;
using System.Drawing;

using Rhino;
using Rhino.Geometry;

using Grasshopper;
using Grasshopper.Kernel;
using Grasshopper.Kernel.Data;
using Grasshopper.Kernel.Types;
#endregion

public class Script_Instance : GH_ScriptInstance
{
    #region Notes
    /* 
      Members:
        RhinoDoc RhinoDocument
        GH_Document GrasshopperDocument
        IGH_Component Component
        int Iteration

      Methods (Virtual & overridable):
        Print(string text)
        Print(string format, params object[] args)
        Reflect(object obj)
        Reflect(object obj, string method_name)

    Author: Giulio Piacentino (updated by Anders Holden Deleuran , updated 2025 by Max Benjamin Eschenbach)
    License: Apache License 2.0
    Version: 250820
    */
    #endregion

    private void RunScript(bool Toggle, ref object Core, ref object AddOns)
    {   
        // set component params
        this.Component.Name = "DefinitionDependencies";
        this.Component.NickName = "DefinitionDependencies";
        this.Component.Category = "DDU_CSC";
        this.Component.SubCategory = "0 Development";

        List<string> coreLibs = new List<string>();
        List<string> addLibs = new List<string>();
        if (Toggle)
        {
            Dictionary<string, GH_AssemblyInfo> coreLibraries = new Dictionary<string, GH_AssemblyInfo>();
            Dictionary<string, GH_AssemblyInfo> addonLibraries = new Dictionary<string, GH_AssemblyInfo>();
            Dictionary<string, string> objids = new Dictionary<string, string>();
            GH_ComponentServer server = Grasshopper.Instances.ComponentServer;
            foreach (GH_DocumentObject obj in this.Component.OnPingDocument().Objects)
            {
                if (obj == (GH_DocumentObject) this.Component)
                {
                    continue;
                }
                string objid = obj.ComponentGuid.ToString();
                if (objids.ContainsKey(objid)) continue;
                GH_AssemblyInfo lib = server.FindAssemblyByObject(obj);
                if (lib == null) continue;
                if (coreLibraries.ContainsKey(lib.Id.ToString()) | addonLibraries.ContainsKey(lib.Id.ToString())) continue;
                if (lib.IsCoreLibrary) coreLibraries.Add(lib.Id.ToString(), lib);
                else addonLibraries.Add(lib.Id.ToString(), lib);
            }
            foreach(KeyValuePair<string, GH_AssemblyInfo> entry in coreLibraries)
            {
                coreLibs.Add($"{entry.Value.Name} {entry.Value.Version}");
            }
            foreach(KeyValuePair<string, GH_AssemblyInfo> entry in addonLibraries)
            {
                addLibs.Add($"{entry.Value.Name} {entry.Value.Version}");
            }
        }
        Core = coreLibs;
        AddOns = addLibs;
    }
}
# ---------- end definitiondependencies ----------
grasshoppe_core_libraries = Panel(definitiondependencies.Core)
addon_libraries = Panel(definitiondependencies.AddOns)

# SAVE GHX-COPY OF CURRENT DOCUMENT
# comments & notes: Save this File and aso save a .GHX copy of the file to the same folder as this file resides in.
# --> Please use this before pushing a new version to GitHub to make the changes somehow "trackable"
autosave_gh_and_ghx = Trigger(Interval=10000, TimerInterval=10000, Target=autosave)  # disabled
autosave = BooleanToggle(True)  # disabled
save = Button()
or = GateOr(A=save, B=autosave)
saveandsaveghx = SaveAndSaveGHX(Save=or, ArchiveFolder="00_archive")  # -> Message; inputs Save: Boolean, ArchiveFolder: String
# ---------- saveandsaveghx: C# ----------
#region Usings
using System;
using System.IO;
using System.Linq;
using System.Collections;
using System.Collections.Generic;
using System.Drawing;

using Rhino;
using Rhino.Geometry;

using Grasshopper;
using Grasshopper.Kernel;
using Grasshopper.Kernel.Data;
using Grasshopper.Kernel.Types;
#endregion

public class Script_Instance : GH_ScriptInstance
{
    #region Notes
    /* 
      Members:
        RhinoDoc RhinoDocument
        GH_Document GrasshopperDocument
        IGH_Component Component
        int Iteration

      Methods (Virtual & overridable):
        Print(string text)
        Print(string format, params object[] args)
        Reflect(object obj)
        Reflect(object obj, string method_name)

    Author: Max Eschenbach
    License: MIT License
    Version: 250820
    */
    #endregion

    private void RunScript(bool Save, string ArchiveFolder, ref object Message)
    {
        // set component params
        this.Component.Name = "SaveAndSaveGHX";
        this.Component.NickName = "SaveAndSaveGHX";
        this.Component.Category = "DDU_CSC";
        this.Component.SubCategory = "0 Development";

        // This output will tell us if the save succeeded or failed.
        // The active Grasshopper document in this scripting component context

        DataTree<string> msgOut = new DataTree<string>();
        GH_Path ghp = new GH_Path(0, 1);

        if (!Save)
        {
            return;
        }

        GH_Document doc = this.GrasshopperDocument;
        if (doc == null)
        {
            msgOut.Add("Error: GrasshopperDocument is null", ghp);
            return;
        }

        // Set current and archive filepath
        string originalFilePath = doc.FilePath;
        string ghxFilePath = originalFilePath + "x";
        string archivePath = Path.Combine(Path.GetDirectoryName(ghxFilePath), ArchiveFolder);
        string archiveFilePath = Path.Combine(archivePath, DateTime.Now.ToString("yyMMdd") + "_" + Path.GetFileName(originalFilePath));

        // Only attempt to save when 'saveTrigger' is set to true.
        if (!Save) return;
        
        // Make sure the parent directory exists
        if (!Directory.Exists(Path.GetDirectoryName(ghxFilePath)))
        {
            msgOut.Add("Error: directory does not exist", ghp);
            return;
        }

        // Make sure Archive Directory exists
        // Make sure the parent directory exists
        
        if (!Directory.Exists(Path.GetDirectoryName(archivePath)))
        {
            msgOut.Add("Error: Archive directory does not exist", ghp);
            return;
        }

        // Create a GH_DocumentIO object based on our current GH_Document.
        GH_DocumentIO io = new GH_DocumentIO(doc);
        // Save this document
        io.Save();

        // Write the current document to an XML-based .ghx file
        bool success_a = io.SaveQuiet(ghxFilePath);
        bool success_b = io.SaveQuiet(originalFilePath);
        bool success_c = io.SaveQuiet(archiveFilePath);

        if (success_a & success_b & success_c)
            msgOut.Add($"Files saved successfully:\n{ghxFilePath}\n{archiveFilePath}", ghp);
        else
        {
            if (!success_a)
                msgOut.Add($"Error: failed to save .ghx file:\n{ghxFilePath}", ghp);
            if (!success_c)
                msgOut.Add($"Error: failed to save Archive .gh file:\n{archiveFilePath}", ghp);
        }
        Message = msgOut;
    }
}
# ---------- end saveandsaveghx ----------
panel_2 = Panel(saveandsaveghx)

# ----
# comments & notes: Sign-In to API Backend
username = Panel("ddu")
password = Panel("!ddu2024@")
disablecache = BooleanToggle(False)
synccache = Button()
refresh = Button()
signin = SignIn(Username=username, Password=password, Refresh=refresh, DisableCache=disablecache, ClearCache=synccache)  # -> Status; inputs Username: String, Password: String, Refresh: Boolean
# ---------- signin: Python ----------
#! python3
# venv: DDU_CSC
# r: requests==2.31.0
# r: numpy==1.26.4
# r: scipy==1.13.0
# r: scikit-learn==1.4.2

# PYTHON STANDARD LIBRARY IMPORTS ---------------------------------------------
import time
import json
import base64
import os
import hashlib
from threading import RLock
import uuid
from datetime import datetime, timedelta

# THIRD PARTY LIBRARY IMPORTS -------------------------------------------------
import requests

# RHINO AND GH RELATED IMPORTS ------------------------------------------------
import System  # type: ignore[reportMissingImport] # NOQA
import Rhino  # type: ignore[reportMissingImport] # NOQA
import Grasshopper  # type: ignore[reportMissingImport] # NOQA
import scriptcontext as sc  # type: ignore[reportMissingImport] # NOQA

# GHENV COMPONENT SETTINGS ----------------------------------------------------
ghenv.Component.Name = 'SignIn'  # type: ignore[reportUnedfinedVariable] # NOQA
ghenv.Component.NickName = 'SignIn'  # type: ignore[reportUnedfinedVariable] # NOQA
ghenv.Component.Category = 'DDU_CSC'  # type: ignore[reportUnedfinedVariable] # NOQA
ghenv.Component.SubCategory = '1 User'  # type: ignore[reportUnedfinedVariable] # NOQA

"""
Author: Max Benjamin Eschenbach
License: MIT License
Version: 250904
"""


# ComponentCache - Embedded ---------------------------------------------------

class _ComponentCache(object):
    """
    Component cache manager for efficient local storage and retrieval.

    Author: Max Benjamin Eschenbach
    License: MIT License
    """

    def __init__(self, cache_dir=None, ttl_hours=24):
        self.ttl_hours = ttl_hours
        self.cache_dir = cache_dir or self._get_default_cache_dir()
        self.components_dir = os.path.join(self.cache_dir, 'components')
        self.metadata_dir = os.path.join(self.cache_dir, 'metadata')
        self._lock = RLock()

        # Ensure cache directories exist
        self._ensure_cache_dirs()

    def _get_default_cache_dir(self):
        """Get platform-specific cache directory."""
        if os.name == 'nt':  # Windows
            appdata = os.environ.get('APPDATA', '')
            return os.path.join(appdata, 'DDU_CSC', 'cache')
        else:  # macOS/Linux
            home = os.path.expanduser('~')
            return os.path.join(home, 'Library', 'Application Support',
                                'DDU_CSC', 'cache')

    def _ensure_cache_dirs(self):
        """Create cache directories if they don't exist."""
        dirs = [self.cache_dir, self.components_dir, self.metadata_dir]
        for directory in dirs:
            if not os.path.exists(directory):
                os.makedirs(directory, exist_ok=True)

    def _get_cache_key_hash(self, cache_key):
        """Generate a safe filename from cache key."""
        return hashlib.md5(cache_key.encode('utf-8')).hexdigest()

    def _is_expired(self, timestamp_str):
        """Check if cache entry is expired based on TTL."""
        try:
            timestamp = datetime.fromisoformat(
                timestamp_str.replace('Z', '+00:00'))
            expiry = timestamp + timedelta(hours=self.ttl_hours)
            return datetime.now(timestamp.tzinfo) > expiry
        except (ValueError, TypeError):
            return True  # If we can't parse timestamp, consider expired

    def get(self, cache_key, filters=None):
        """
        Get cached data for a cache key.

        Args:
            cache_key: Cache key (e.g., 'all_components', 'component:uuid')
            filters: Optional filter parameters for metadata cache

        Returns:
            Tuple of (data, etag, is_from_cache) or
            (None, None, False) if not found
        """
        with self._lock:
            try:
                # Check metadata cache first
                metadata_file = os.path.join(
                    self.metadata_dir,
                    f"{self._get_cache_key_hash(cache_key)}.json"
                )

                if not os.path.exists(metadata_file):
                    return None, None, False

                with open(metadata_file, 'r', encoding='utf-8') as f:
                    metadata = json.load(f)

                # Check if expired
                if self._is_expired(metadata.get('cached_at', '')):
                    return None, None, False

                # Handle different cache key types
                if cache_key.startswith('component:'):
                    # Individual component
                    component_id = cache_key.split(':', 1)[1]
                    component_file = os.path.join(
                        self.components_dir, f"{component_id}.json"
                    )

                    if os.path.exists(component_file):
                        with open(component_file, 'r', encoding='utf-8') as f:
                            component_data = json.load(f)
                        return component_data, metadata.get('etag'), True

                elif (cache_key == 'all_components' or
                        cache_key.startswith('filtered:')):
                    # Collection of components
                    components = []
                    for comp_ref in metadata.get('components', []):
                        comp_id = comp_ref.get('id')
                        if comp_id:
                            comp_file = os.path.join(
                                self.components_dir, f"{comp_id}.json"
                            )
                            if os.path.exists(comp_file):
                                with open(
                                    comp_file, 'r',
                                    encoding='utf-8'
                                ) as f:
                                    components.append(json.load(f))

                    return components, metadata.get('etag'), True

                elif cache_key == 'schema:component':
                    # Schema data is stored directly in metadata
                    return metadata.get('data'), metadata.get('etag'), True

                return None, None, False

            except (IOError, json.JSONDecodeError, KeyError):
                return None, None, False

    def set(self, cache_key, data, etag=None, filters=None):
        """
        Store data in cache.

        Args:
            cache_key: Cache key
            data: Data to cache
            etag: ETag for the data
            filters: Optional filter parameters
        """
        with self._lock:
            try:
                current_time = datetime.now().isoformat()

                if cache_key.startswith('component:'):
                    # Individual component
                    component_id = cache_key.split(':', 1)[1]
                    component_file = os.path.join(
                        self.components_dir, f"{component_id}.json"
                    )

                    # Store component data
                    with open(component_file, 'w', encoding='utf-8') as f:
                        json.dump(data, f, indent=2, ensure_ascii=False)

                    # Store metadata
                    metadata = {
                        'cache_key': cache_key,
                        'cached_at': current_time,
                        'etag': etag,
                        'type': 'component'
                    }

                elif (cache_key == 'all_components' or
                        cache_key.startswith('filtered:')):
                    # Collection of components
                    components = []
                    for component in data:
                        comp_id = component.get('_id') or component.get('id')
                        if comp_id:
                            # Store individual component
                            comp_file = os.path.join(
                                self.components_dir, f"{comp_id}.json"
                            )
                            with open(comp_file, 'w', encoding='utf-8') as f:
                                json.dump(
                                    component,
                                    f,
                                    indent=2,
                                    ensure_ascii=False
                                )

                            # Add reference to metadata
                            components.append({
                                'id': comp_id,
                                'etag': component.get('etag'),
                                'lastmodified': component.get('lastmodified')
                            })

                    # Store metadata
                    metadata = {
                        'cache_key': cache_key,
                        'cached_at': current_time,
                        'etag': etag,
                        'type': 'collection',
                        'components': components,
                        'filters': filters
                    }

                elif cache_key == 'schema:component':
                    # Schema data - store directly in metadata
                    metadata = {
                        'cache_key': cache_key,
                        'cached_at': current_time,
                        'etag': etag,
                        'type': 'schema',
                        'data': data
                    }

                # Write metadata file
                metadata_file = os.path.join(
                    self.metadata_dir,
                    f"{self._get_cache_key_hash(cache_key)}.json"
                )
                with open(metadata_file, 'w', encoding='utf-8') as f:
                    json.dump(metadata, f, indent=2, ensure_ascii=False)

            except (IOError, KeyError):
                # Silently fail cache writes to not break main functionality
                pass

    def invalidate(self, pattern=None):
        """
        Invalidate cache entries.

        Args:
            pattern: Optional pattern to match cache keys (None = clear all)
        """
        with self._lock:
            try:
                if pattern is None:
                    # Clear all cache
                    for directory in [self.components_dir, self.metadata_dir]:
                        for filename in os.listdir(directory):
                            file_path = os.path.join(directory, filename)
                            if os.path.isfile(file_path):
                                os.remove(file_path)
                else:
                    # Clear specific pattern
                    pattern_hash = self._get_cache_key_hash(pattern)
                    metadata_file = os.path.join(
                        self.metadata_dir, f"{pattern_hash}.json"
                    )
                    if os.path.exists(metadata_file):
                        os.remove(metadata_file)

            except (IOError, OSError):
                pass

    def get_cache_stats(self):
        """Get cache statistics."""
        with self._lock:
            try:
                component_count = len(
                    [f for f in os.listdir(self.components_dir)
                     if f.endswith('.json')]
                )
                metadata_count = len(
                    [f for f in os.listdir(self.metadata_dir)
                     if f.endswith('.json')]
                )

                # Calculate total cache size
                total_size = 0
                for directory in [self.components_dir, self.metadata_dir]:
                    for filename in os.listdir(directory):
                        file_path = os.path.join(directory, filename)
                        if os.path.isfile(file_path):
                            total_size += os.path.getsize(file_path)

                return {
                    'component_count': component_count,
                    'metadata_count': metadata_count,
                    'total_size_bytes': total_size,
                    'cache_dir': self.cache_dir
                }
            except (IOError, OSError):
                return {
                    'component_count': 0,
                    'metadata_count': 0,
                    'total_size_bytes': 0,
                    'cache_dir': self.cache_dir
                }


# AuthCore - Embedded ---------------------------------------------------------

class _AuthCore(object):
    """
    Authorization and cache management tool that gets stored in sticky to be
    used by other CSC Grasshopper Components.

    Author: Max Benjamin Eschenbach
    License: MIT License
    """

    def __init__(self, base_url, leeway=30, disable_cache=False):
        self.base_url = (base_url or 'https://api.ddu.uber.space').rstrip('/')
        self.leeway = int(leeway) if leeway is not None else 30
        self.disable_cache = disable_cache
        self._lock = RLock()
        self._token = None
        self._exp = 0
        self._username = None
        self._cache = None if disable_cache else _ComponentCache()

    @staticmethod
    def _now():
        return int(time.time())

    @staticmethod
    def _b64url_decode(seg):
        rem = len(seg) % 4
        if rem:
            seg += '=' * (4 - rem)
        return base64.urlsafe_b64decode(seg.encode('utf-8'))

    @classmethod
    def _jwt_payload(cls, token):
        try:
            parts = token.split('.')
            if len(parts) != 3:
                return {}
            return json.loads(cls._b64url_decode(parts[1]).decode('utf-8'))
        except Exception:
            return {}

    def set_access_token(self, token, username=None):
        payload = self._jwt_payload(token)
        exp = int(payload.get('exp', 0))
        if exp <= 0:
            exp = self._now() + 3600  # 1h fallback if no exp claim
        with self._lock:
            self._token = token
            self._exp = exp
            if username:
                self._username = username

    def clear(self):
        with self._lock:
            self._token = None
            self._exp = 0
            self._username = None

    def is_valid(self):
        with self._lock:
            if not self._token or self._exp <= 0:
                return False
            return (self._now() + self.leeway) < self._exp

    def get_username(self):
        with self._lock:
            return self._username

    def auth_header(self):
        with self._lock:
            return ({'Authorization': 'Bearer ' + self._token}
                    if self._token else {})

    def authorized_get(
            self,
            path,
            params=None,
            extra_headers=None,
            timeout=20):
        if not self.is_valid():
            raise RuntimeError(
                'Access token missing or expired. Please sign in again.'
            )
        headers = self.auth_header()
        if extra_headers:
            headers.update(extra_headers)
        return requests.get(
            self.base_url + path,
            params=params,
            headers=headers,
            timeout=timeout
        )

    def authorized_post(
            self,
            path,
            json_body=None,
            files=None,
            extra_headers=None,
            timeout=60):
        if not self.is_valid():
            raise RuntimeError(
                'Access token missing or expired. Please sign in again.'
            )
        headers = self.auth_header()
        if extra_headers:
            headers.update(extra_headers)
        # Handle file uploads vs JSON requests
        if files is not None:
            # For file uploads, don't set Content-Type header
            # (let requests handle it)
            # and use data instead of json
            return requests.post(
                self.base_url + path,
                files=files,
                headers=headers,
                timeout=timeout
            )
        else:
            # For JSON requests, use json parameter
            return requests.post(
                self.base_url + path,
                json=json_body,
                headers=headers,
                timeout=timeout
            )

    def validate_uuid(self, uuid_to_test: str, version: int = 4):
        """
        Check if uuid_to_test is a valid UUID.
        Returns True if uuid_to_test is a valid UUID, otherwise False.
        """
        try:
            uuid_obj = uuid.UUID(uuid_to_test, version=version)
        except ValueError:
            return False
        return str(uuid_obj) == uuid_to_test

    # Cache Management Methods ------------------------------------------------

    def get_cache(self):
        """Get the cache instance."""
        return self._cache

    def set_cache_enabled(self, enabled):
        """Enable or disable caching."""
        with self._lock:
            self.disable_cache = not enabled
            if enabled and self._cache is None:
                self._cache = _ComponentCache()
            elif not enabled:
                self._cache = None

    def is_cache_enabled(self):
        """Check if caching is enabled."""
        return self._cache is not None

    def sync_cache(self):
        """Force cache synchronization (clear cache)."""
        if self._cache:
            self._cache.invalidate()

    def get_cache_stats(self):
        """Get cache statistics."""
        if self._cache:
            return self._cache.get_cache_stats()
        return {
            'component_count': 0,
            'metadata_count': 0,
            'total_size_bytes': 0,
            'cache_dir': 'Cache disabled'
        }

    def cached_get(
            self,
            path,
            cache_key,
            params=None,
            extra_headers=None,
            timeout=20):
        """
        Make a cached GET request with ETag support.

        Args:
            path: API path
            cache_key: Cache key for this request
            params: Query parameters
            extra_headers: Additional headers
            timeout: Request timeout

        Returns:
            Response object
        """
        if not self.is_valid():
            raise RuntimeError(
                'Access token missing or expired. Please sign in again.'
            )

        # If cache is disabled, make regular request
        if not self._cache:
            return self.authorized_get(path, params, extra_headers, timeout)

        # Check cache first
        cached_data, cached_etag, is_from_cache = self._cache.get(cache_key)

        # Prepare headers
        headers = self.auth_header()
        if extra_headers:
            headers.update(extra_headers)

        # Add conditional request header if we have cached data
        if is_from_cache and cached_etag:
            headers['If-None-Match'] = cached_etag

        # Make request
        response = requests.get(
            self.base_url + path,
            params=params,
            headers=headers,
            timeout=timeout
        )

        # Handle response
        if response.status_code == 304 and is_from_cache:
            # Not modified - return cached data
            # Create a mock response with cached data
            class MockResponse:
                def __init__(self, data, etag):
                    self.status_code = 200
                    self._data = data
                    self._etag = etag

                def json(self):
                    return self._data

                @property
                def headers(self):
                    return {'ETag': self._etag} if self._etag else {}

            return MockResponse(cached_data, cached_etag)

        elif response.status_code == 200:
            # Data changed or first request - cache the response
            try:
                data = response.json()
                etag = response.headers.get('ETag')
                self._cache.set(cache_key, data, etag, params)
            except (ValueError, KeyError):
                # If we can't parse JSON or cache, just return response
                pass

        return response

    def get_component_schema(self, force_refresh=False):
        """
        Get component schema with caching support.

        Args:
            force_refresh: Force refresh of schema even if cached

        Returns:
            Component schema dictionary or None if failed
        """
        if not self.is_valid():
            raise RuntimeError(
                'Access token missing or expired. Please sign in again.'
            )

        # If cache is disabled, make regular request
        # (schema endpoint is unprotected)
        if not self._cache:
            try:
                response = requests.get(f'{self.base_url}/schema/component')
                if response.status_code == 200:
                    return response.json()
                return None
            except Exception:
                return None

        # Check cache first (unless force refresh)
        if not force_refresh:
            cached_schema, cached_etag, is_from_cache = self._cache.get(
                'schema:component')
            if is_from_cache:
                return cached_schema

        # Make request to get schema (unprotected endpoint)
        try:
            # Prepare headers for conditional request
            headers = {}
            if not force_refresh:
                cached_schema, cached_etag, is_from_cache = self._cache.get(
                    'schema:component')
                if is_from_cache and cached_etag:
                    headers['If-None-Match'] = cached_etag

            response = requests.get(f'{self.base_url}/schema/component',
                                    headers=headers)

            if response.status_code == 304 and not force_refresh:
                # Not modified - return cached data
                cached_schema, _, is_from_cache = self._cache.get(
                    'schema:component')
                if is_from_cache:
                    return cached_schema

            elif response.status_code == 200:
                # Data changed or first request - cache the response
                try:
                    data = response.json()
                    etag = response.headers.get('ETag')
                    self._cache.set('schema:component', data, etag)
                    return data
                except (ValueError, KeyError):
                    return None

            return None
        except Exception:
            # If request fails and we have cached schema, return cached version
            if not force_refresh:
                cached_schema, _, is_from_cache = self._cache.get(
                    'schema:component')
                if is_from_cache:
                    return cached_schema
            return None


# SignIn Grasshopper Component ------------------------------------------------

class CSC_SignIn(Grasshopper.Kernel.GH_ScriptInstance):
    """
    Author: Max Benjamin Eschenbach
    License: MIT License
    """

    # Development setting - do not change!
    __HARD_RESET = False

    def __init__(self):
        super().__init__()
        # initialize props
        self.Component = ghenv.Component  # type: ignore[reportUnedfinedVariable] # NOQA
        self.InputParams = self.Component.Params.Input
        self.OutputParams = self.Component.Params.Output

    def _addRemark(self, msg: str = ''):
        rml = self.Component.RuntimeMessageLevel.Remark
        self.AddRuntimeMessage(rml, msg)

    def _addWarning(self, msg: str = ''):
        rml = self.Component.RuntimeMessageLevel.Warning
        self.AddRuntimeMessage(rml, msg)

    def _addError(self, msg: str = ''):
        rml = self.Component.RuntimeMessageLevel.Error
        self.AddRuntimeMessage(rml, msg)

    def get_auth_core_from_sticky(self):
        """Get AuthCore instance from sticky storage or create new one."""
        if not self.__HARD_RESET:
            auth_core = sc.sticky.get('CSC_AuthCore')
        else:
            auth_core = None
        if auth_core is None:
            # Create new AuthCore instance with default settings
            auth_core = _AuthCore(base_url='https://api.ddu.uber.space')
            sc.sticky['CSC_AuthCore'] = auth_core
        return auth_core

    def RunScript(self,
            Username: str,
            Password: str,
            Refresh: bool,
            DisableCache,
            ClearCache):
        # Initialize param descriptions (this has to be done in RunScript)
        self.InputParams[0].Description = 'Your Username or E-Mail'
        self.InputParams[1].Description = 'Your password'
        self.InputParams[2].Description = (
            'Refresh toggle, press when your token expired'
        )
        self.InputParams[3].Description = (
            'Disable caching (default: False - caching enabled)'
        )
        self.InputParams[4].Description = (
            'Clear cache (default: False)'
        )

        # Initialize status messages list
        status_messages = []

        # Sanitize input parameters (defaults don't work in function signature)
        if DisableCache is None:
            DisableCache = False
        if ClearCache is None:
            ClearCache = False

        # Get or create AuthCore instance
        auth_core = self.get_auth_core_from_sticky()

        # Handle cache management
        if ClearCache:
            auth_core.sync_cache()
            status_messages.append('Cache cleared')
            self.Component.Message = 'Cache cleared'
            # Return status messages
            Status = status_messages
            return (Status,)

        # Set cache enabled/disabled
        auth_core.set_cache_enabled(not DisableCache)

        # Input validation
        if not Username or not Username.strip():
            status_messages.append('Please provide username/email')
            self.Component.Message = 'Please provide username/email'
            Status = status_messages
            return (Status,)

        if not Password or not Password.strip():
            status_messages.append('Please provide password')
            self.Component.Message = 'Please provide password'
            Status = status_messages
            return (Status,)

        username = Username.strip()
        password = Password.strip()

        try:
            if Refresh:
                # Refresh authentication - clear existing token and re-auth
                auth_core.clear()
                self.Component.Message = 'Refreshing authentication...'
            else:
                # Check if we already have a valid token
                if auth_core.is_valid():
                    current_user = auth_core.get_username()
                    self.Component.Message = (
                        f'Already signed in as: {current_user}'
                    )

                    # Fetch and cache component schema
                    try:
                        schema = auth_core.get_component_schema()
                        if schema:
                            status_messages.append(
                                'Schema cached successfully')
                            self._addRemark('Schema cached successfully')
                        else:
                            status_messages.append('Failed to cache schema')
                            self._addWarning('Failed to cache schema')
                    except Exception as e:
                        status_messages.append(
                            f'Schema caching failed: {str(e)}')
                        self._addWarning(f'Schema cache failed: {str(e)}')

                    # Get cache status for output
                    cache_stats = auth_core.get_cache_stats()
                    cache_enabled = auth_core.is_cache_enabled()
                    comp_count = cache_stats["component_count"]
                    size_kb = cache_stats["total_size_bytes"] // 1024

                    # Add cache status to messages
                    cache_status = (
                        f'Cache: {"Enabled" if cache_enabled else "Disabled"}'
                        f' | Components: {comp_count} | Size: {size_kb}KB')
                    status_messages.append(cache_status)
                    Status = status_messages
                    return (Status,)

                self.Component.Message = 'Signing in...'

            # Prepare login data
            login_data = {
                'username': username,
                'password': password
            }

            # Make login request
            response = requests.post(
                f'{auth_core.base_url}/auth/token',
                data=login_data,
                headers={
                    'Content-Type': 'application/x-www-form-urlencoded'
                },
                timeout=20
            )

            if response.status_code == 200:
                # Login successful
                token_data = response.json()
                access_token = token_data.get('access_token')

                if access_token:
                    # Store token in AuthCore
                    auth_core.set_access_token(access_token, username)

                    # Update sticky storage
                    sc.sticky['CSC_AuthCore'] = auth_core

                    # Fetch and cache component schema
                    try:
                        schema = auth_core.get_component_schema()
                        if schema:
                            status_messages.append(
                                'Schema cached successfully')
                            self._addRemark('Schema cached successfully')
                        else:
                            status_messages.append('Failed to cache schema')
                            self._addWarning('Failed to cache schema')
                    except Exception as e:
                        status_messages.append(
                            f'Schema caching failed: {str(e)}')
                        self._addWarning(f'Schema cache failed: {str(e)}')

                    # Get cache status for output
                    cache_stats = auth_core.get_cache_stats()
                    cache_enabled = auth_core.is_cache_enabled()
                    comp_count = cache_stats["component_count"]
                    size_kb = cache_stats["total_size_bytes"] // 1024

                    # Add cache status to messages
                    cache_status = (
                        f'Cache: {"Enabled" if cache_enabled else "Disabled"}'
                        f' | Components: {comp_count} | Size: {size_kb}KB')
                    status_messages.append(cache_status)

                    self.Component.Message = f'Signed in as: {username}'

                    # Return status messages
                    Status = status_messages
                    return (Status,)

                else:
                    msg = 'Login failed: No token received'
                    status_messages.append(msg)
                    self._addWarning(msg)
                    self.Component.Message = msg
                    Status = status_messages
                    return (Status,)

            elif response.status_code == 401:
                msg = 'Invalid username or password'
                status_messages.append(msg)
                self._addError(msg)
                self.Component.Message = msg
                Status = status_messages
                return (Status,)

            elif response.status_code == 422:
                msg = 'Invalid input data'
                status_messages.append(msg)
                self._addError(msg)
                self.Component.Message = msg
                Status = status_messages
                return (Status,)

            elif response.status_code == 500:
                msg = 'Server error - please try again'
                status_messages.append(msg)
                self._addWarning(msg)
                self.Component.Message = msg
                Status = status_messages
                return (Status,)

            else:
                msg = f'Login failed with status code: {response.status_code}'
                status_messages.append(msg)
                self._addError(msg)
                self.Component.Message = msg
                Status = status_messages
                return (Status,)

        except requests.exceptions.ConnectionError as e:
            msg = 'Cannot connect to server - check URL'
            status_messages.append(msg)
            self._addError(msg + f'\nFull Error: {str(e)}')
            self.Component.Message = msg
            Status = status_messages
            return (Status,)

        except requests.exceptions.Timeout as e:
            msg = 'Request timeout - server may be slow'
            status_messages.append(msg)
            self._addError(msg + f'\nFull Error: {str(e)}')
            self.Component.Message = msg
            Status = status_messages
            return (Status,)

        except requests.exceptions.RequestException as e:
            msg = f'Request error: {str(e)}'
            status_messages.append(msg)
            self._addError(msg)
            self.Component.Message = msg
            Status = status_messages
            return (Status,)

        except Exception as e:
            msg = f'Unexpected error: {str(e)}'
            status_messages.append(msg)
            self.Component.Message = msg
            Status = status_messages
            return (Status,)
# ---------- end signin ----------
status_messages = Panel(signin)

comments_notes = Panel("ADDITIONAL GEOMETRY TOOLS")

# ----
# comments & notes: Get Components from Rhino Document
toggle = BooleanToggle(False)
syncwithrhinodoc = SyncWithRhinoDoc(Sync=toggle)  # -> DocumentComponents; inputs Sync: Boolean
# ---------- syncwithrhinodoc: Python ----------
#! python3
# venv: DDU_CSC
# r: requests==2.31.0
# r: numpy==1.26.4
# r: scipy==1.13.0
# r: scikit-learn==1.4.2

# PYTHON STANDARD LIBRARY IMPORTS ---------------------------------------------
import json

# RHINO AND GH RELATED IMPORTS ------------------------------------------------
import System  # type: ignore[reportMissingImport] # NOQA
import Grasshopper  # type: ignore[reportMissingImport] # NOQA
import Rhino  # type: ignore[reportMissingImport] # NOQA
import rhinoscriptsyntax as rs  # type: ignore[reportMissingImport] # NOQA
import scriptcontext as sc  # type: ignore[reportMissingImport] # NOQA

# GHENV COMPONENT SETTINGS ----------------------------------------------------
ghenv.Component.Name = 'SyncWithRhinoDoc'  # type: ignore[reportUnedfinedVariable] # NOQA
ghenv.Component.NickName = 'SyncWithRhinoDoc'  # type: ignore[reportUnedfinedVariable] # NOQA
ghenv.Component.Category = 'DDU_CSC'  # type: ignore[reportUnedfinedVariable] # NOQA
ghenv.Component.SubCategory = '4 RhinoDoc Interaction'  # type: ignore[reportUnedfinedVariable] # NOQA


class CSC_SyncWithRhinoDoc(Grasshopper.Kernel.GH_ScriptInstance):
    """
    Author: Max Benjamin Eschenbach
    License: MIT License
    Version: 250902
    """

    def __init__(self):
        super().__init__()
        # initialize props
        self.Component = ghenv.Component  # type: ignore[reportUnedfinedVariable] # NOQA
        self.InputParams = self.Component.Params.Input
        self.OutputParams = self.Component.Params.Output

    def _addRemark(self, msg: str = ''):
        rml = self.Component.RuntimeMessageLevel.Remark
        self.AddRuntimeMessage(rml, msg)

    def _addWarning(self, msg: str = ''):
        rml = self.Component.RuntimeMessageLevel.Warning
        self.AddRuntimeMessage(rml, msg)

    def _addError(self, msg: str = ''):
        rml = self.Component.RuntimeMessageLevel.Error
        self.AddRuntimeMessage(rml, msg)

    def find_objects_with_csc_component(self, doc):
        """
        Find all objects in the document that have the 'csc_component' userkey.
        Returns a list of tuples: (object, component_data, path)
        """
        objects_with_component = []
        try:
            # Get all objects in the document
            all_objects = rs.AllObjects()
            for obj in all_objects:
                if obj is None:
                    continue
                # Check if object has user strings
                usr_txt_type = rs.IsUserText(obj)
                if usr_txt_type > 0:
                    # Look for 'csc_component' userkey
                    component_data = None
                    if usr_txt_type == 1:
                        component_data = rs.GetUserText(
                            obj, 'csc_component', False)
                    elif usr_txt_type == 2:
                        component_data = rs.GetUserText(
                            obj, 'csc_component', True)
                    elif usr_txt_type == 3:
                        component_data = rs.GetUserText(
                            obj, 'csc_component', False)
                        if not component_data:
                            component_data = rs.GetUserText(
                                obj, 'csc_component', True)
                    if component_data:
                        try:
                            # Parse the JSON data
                            parsed_data = json.loads(component_data)
                            # Get the object's path for organization
                            obj_path = self.get_object_path(obj, doc)
                            objects_with_component.append(
                                (obj, parsed_data, obj_path))
                        except json.JSONDecodeError as e:
                            self._addWarning(
                                f'Invalid JSON in csc_component userstring '
                                f'for object {obj.Id}: {str(e)}'
                            )
                            continue
        except Exception as e:
            self._addError(
                f'Error searching for objects with csc_component: {str(e)}'
            )
        # return results
        return objects_with_component

    def get_object_path(self, obj, doc):
        """
        Get a descriptive path for the object (layer hierarchy, etc.)
        """
        try:
            # Try to get the layer name
            layer_index = obj.Attributes.LayerIndex
            if layer_index >= 0:
                layer = doc.Layers[layer_index]
                if layer:
                    return layer.FullPath
        except Exception:
            pass
        # Fallback to object name or type
        try:
            if hasattr(obj, 'Name') and obj.Name:
                return obj.Name
        except Exception:
            pass
        return f"Object_{obj}"

    def update_component_frame(self, obj, component_data):
        """
        Update the component's iframe based on the object's current position.
        Returns updated component data.
        """
        try:
            # Get the object's current transformation
            if hasattr(obj, 'Geometry'):
                geometry = obj.Geometry
                if hasattr(geometry, 'GetBoundingBox'):
                    bbox = geometry.GetBoundingBox(True)
                    if bbox.IsValid:
                        # Create frame based on bounding box
                        center = bbox.Center
                        x_axis = bbox.XAxis
                        y_axis = bbox.YAxis
                        z_axis = bbox.ZAxis
                        # Update the iframe in component data
                        if 'iframe' not in component_data:
                            component_data['iframe'] = {}
                        component_data['iframe'].update({
                            'o': [center.X, center.Y, center.Z],
                            'x': [x_axis.X, x_axis.Y, x_axis.Z],
                            'y': [y_axis.X, y_axis.Y, y_axis.Z],
                            'z': [z_axis.X, z_axis.Y, z_axis.Z]
                        })
                        return component_data
        except Exception as e:
            self._addWarning(
                f'Error updating frame for object {obj.Id}: {str(e)}'
            )
        return component_data

    def RunScript(self, Sync: bool):
        # Initialize param descriptions (this has to be done in RunScript)
        self.InputParams[0].Description = (
            'Trigger to sync components with Rhino document'
        )
        self.OutputParams[0].Description = (
            'DataTree containing all component data found in the document, '
            'with updated iframe information based on current object positions'
        )

        # Set scriptcontext to Rhino document
        sc.doc = Rhino.RhinoDoc.ActiveDoc

        if not Sync:
            # Return empty results if not syncing
            LAST_SYNC = Grasshopper.DataTree[System.Object]()
            __Results = (LAST_SYNC,)
            return __Results

        try:
            self.Component.Message = 'Searching for components in document...'
            # Find all objects with csc_component userkey
            objects_with_component = self.find_objects_with_csc_component(
                sc.doc
            )
            if not objects_with_component:
                msg = 'No components found in document!'
                self._addWarning(msg)
                self.Component.Message = msg
                # Return empty results
                LAST_SYNC = Grasshopper.DataTree[System.Object]()
                __Results = (LAST_SYNC,)
                return __Results
            # Create output datatree
            LAST_SYNC = Grasshopper.DataTree[System.Object]()
            # Process each component
            for i, (obj, component_data, obj_path) in enumerate(objects_with_component):
                try:
                    # Update the component's frame
                    # based on current object position
                    updated_data = self.update_component_frame(
                        obj, component_data
                    )
                    # Create datatree path
                    ghp = Grasshopper.Kernel.Data.GH_Path(i)
                    # Add updated component data to datatree
                    LAST_SYNC.Add(json.dumps(updated_data), ghp)
                    self._addRemark(
                        'Updated component '
                        f'{component_data.get("_id", "unknown")} '
                        f'from {obj_path}'
                    )
                except Exception as e:
                    msg = (
                        'Error processing component '
                        f'from {obj_path}: {str(e)}'
                    )
                    self._addWarning(msg)
                    continue

            # Update success message
            if LAST_SYNC.DataCount > 0:
                self.Component.Message = (
                    f'Synced {LAST_SYNC.DataCount} component(s)'
                )
                self._addRemark(
                    f'Successfully synced {LAST_SYNC.DataCount} '
                    'components with document'
                )
            else:
                self.Component.Message = 'No components synced'
                self._addWarning('No components were successfully synced')

            # Return results
            __Results = (LAST_SYNC,)
            return __Results

        except Exception as e:
            msg = f'Unexpected error during sync: {str(e)}'
            self._addError(msg)
            self.Component.Message = msg

            # Return empty results if there was an error
            LAST_SYNC = Grasshopper.DataTree[System.Object]()
            __Results = (LAST_SYNC,)
            return __Results

        finally:
            # Restore scriptcontext to Grasshopper document
            sc.doc = ghdoc  # type: ignore[reportUnedfinedVariable] # NOQA
# ---------- end syncwithrhinodoc ----------
componentdata = Data(syncwithrhinodoc)

# ----
# comments & notes: ADDING COMPONENTS TO THE CATALOGUE
sampleextrusiongeometry = Extrusion(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)
detailedmeshgeometry = Geometry(<mesh referenced from the Rhino model>)
samplemeshgeometry = Mesh(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)

location_latitude = Panel("49.861444")
location_longitude = Panel("8.676556")
componentid = Panel("75f30d08-aab4-4c0f-8dff-695b1c70bf0b")
complexity = ValueList({"0 (simple)": 0, "1 (normal)": 1, "2 (complex)": 2, "3 (very complex)": 3}, selected="1 (normal)")
material = ValueList({"corian", "concrete", "timber", "aluminium", "steel"}, selected="concrete")
comments_notes_2 = Panel("Create a new Component")
type = ValueList({"sheet", "rubble", "beam", "column", "profile"}, selected="rubble")
geometry = Data(samplemeshgeometry)
color = ColourSwatch(SwatchColor=RGB(168, 168, 168))
vec = VectorXYZ(XComponent=location_latitude, YComponent=location_longitude, ZComponent=0)  # -> Vector, Length
createcomponent = CreateComponent(
    ComponentID=componentid,
    Type=type,
    Material=material,
    Complexity=complexity,
    Color=color,
    Location=vec.Vector,
    Geometry=geometry)  # -> ComponentData; inputs ComponentID: String, Type: String, Material: String, Complexity: Int32, Fragment: Boolean, Assembly: Boolean, Color: Color, Location: Vector3d, Geometry: GeometryBase
#   port Complexity: Complexity level (0=simple, 1=normal, 2=complex, 3=very complex)
# ---------- createcomponent: Python ----------
#! python3
# venv: DDU_CSC
# r: requests==2.31.0
# r: numpy==1.26.4
# r: scipy==1.13.0
# r: scikit-learn==1.4.2

# PYTHON STANDARD LIBRARY IMPORTS ---------------------------------------------
import json
import uuid
import os
import platform
from datetime import datetime

# THIRD PARTY LIBRARY IMPORTS -------------------------------------------------
import numpy as np
from scipy.spatial import ConvexHull
from sklearn.decomposition import PCA

# RHINO AND GH RELATED IMPORTS ------------------------------------------------
import System  # type: ignore[reportMissingImport] # NOQA
import Grasshopper  # type: ignore[reportMissingImport] # NOQA
import Rhino  # type: ignore[reportMissingImport] # NOQA
import scriptcontext as sc  # type: ignore[reportMissingImport] # NOQA

# GHENV COMPONENT SETTINGS ----------------------------------------------------
ghenv.Component.Name = 'CreateComponent'  # type: ignore[reportUnedfinedVariable] # NOQA
ghenv.Component.NickName = 'CreateComponent'  # type: ignore[reportUnedfinedVariable] # NOQA
ghenv.Component.Category = 'DDU_CSC'  # type: ignore[reportUnedfinedVariable] # NOQA
ghenv.Component.SubCategory = '3 Component Operations'  # type: ignore[reportUnedfinedVariable] # NOQA


class CSC_CreateComponent(Grasshopper.Kernel.GH_ScriptInstance):
    """
    Author: Max Benjamin Eschenbach
    License: MIT License
    Version: 250904
    """

    def __init__(self):
        super().__init__()
        # initialize props
        self.Component = ghenv.Component  # type: ignore[reportUnedfinedVariable] # NOQA
        self.InputParams = self.Component.Params.Input
        self.OutputParams = self.Component.Params.Output

    def _addRemark(self, msg: str = ''):
        rml = self.Component.RuntimeMessageLevel.Remark
        self.AddRuntimeMessage(rml, msg)

    def _addWarning(self, msg: str = ''):
        rml = self.Component.RuntimeMessageLevel.Warning
        self.AddRuntimeMessage(rml, msg)

    def _addError(self, msg: str = ''):
        rml = self.Component.RuntimeMessageLevel.Error
        self.AddRuntimeMessage(rml, msg)

    def get_auth_core_from_sticky(self):
        """Get AuthCore instance from sticky storage."""
        auth_core = sc.sticky.get('CSC_AuthCore')
        if auth_core is None:
            self._addWarning('No authentication found. '
                             'Using hardcoded schema.')
            return None
        return auth_core

    def get_component_schema(self):
        """Get component schema from cache or fallback to hardcoded schema."""
        # Try to get schema from AuthCore cache first
        auth_core = self.get_auth_core_from_sticky()
        if auth_core and hasattr(auth_core, 'get_component_schema'):
            try:
                schema = auth_core.get_component_schema()
                if schema:
                    self._addRemark('Using cached component schema')
                    return schema
                else:
                    self._addWarning('Failed to get cached schema, '
                                     'using hardcoded schema')
            except Exception as e:
                self._addWarning(f'Error fetching cached schema: {str(e)}, '
                                 'using hardcoded schema')

        # Fallback to hardcoded schema
        self._addRemark('Using hardcoded component schema')
        return self.get_hardcoded_schema()

    def get_hardcoded_schema(self):
        """Get hardcoded component schema as fallback."""
        return {
            'type': 'object',
            'properties': {
                '_id': {'type': 'string', 'format': 'uuid'},
                'name': {'type': 'string'},
                'type': {'type': 'string'},
                'material': {'type': 'string'},
                'created': {'type': 'string', 'format': 'date-time'},
                'lastmodified': {'type': 'string', 'format': 'date-time'},
                'complexity': {'type': 'integer', 'minimum': 0, 'maximum': 3},
                'fragment': {'type': 'boolean'},
                'assembly': {'type': 'boolean'},
                'geometry': {'type': 'object'},
                'color': {'type': 'array', 'items': {'type': 'integer'}},
                'bbx': {'type': 'array', 'items': {'type': 'number'}},
                'location': {'type': 'object'},
                'descriptors': {'type': 'object'},
                'processes': {'type': 'object'},
                'iframe': {'type': 'object'},
                'pca_frame': {'type': 'object'},
                'reserved': {'type': 'string'},
                'attributes': {'type': 'object'},
                'validated': {'type': 'boolean'},
                'etag': {'type': 'string'}
            },
            'required': ['type', 'material', 'created', 'lastmodified',
                         'complexity', 'fragment', 'assembly', 'geometry',
                         'bbx', 'iframe', 'pca_frame', 'reserved', 'validated']
        }

    def validate_component_data(self, component_data, schema):
        """Validate component data against schema."""
        try:
            # Basic validation - check required fields
            required_fields = schema.get('required', [])
            missing_fields = []

            for field in required_fields:
                if field not in component_data:
                    missing_fields.append(field)

            if missing_fields:
                self._addWarning(f'Missing required fields: '
                                 f'{", ".join(missing_fields)}')
                return False

            # Type validation for key fields
            if not isinstance(component_data.get('complexity'), int):
                self._addWarning('Complexity must be an integer')
                return False

            if not isinstance(component_data.get('fragment'), bool):
                self._addWarning('Fragment must be a boolean')
                return False

            if not isinstance(component_data.get('assembly'), bool):
                self._addWarning('Assembly must be a boolean')
                return False

            # Validate optional color field
            color = component_data.get('color', [])
            if color and (not isinstance(color, list) or len(color) != 3):
                self._addWarning(
                    'Color must be a list of 3 integers [R, G, B]')
                return False

            # Validate required frame fields
            if not isinstance(component_data.get('iframe'), dict):
                self._addWarning('iframe must be a dictionary with frame data')
                return False

            if not isinstance(component_data.get('pca_frame'), dict):
                self._addWarning('pca_frame must be a dictionary with '
                                 'frame data')
                return False

            if not isinstance(component_data.get('reserved'), str):
                self._addWarning('reserved must be a string (UUID or empty)')
                return False

            return True

        except Exception as e:
            self._addWarning(f'Validation error: {str(e)}')
            return False

    def build_component_data_from_schema(
            self,
            schema,
            ComponentID: str,
            Type: str,
            Material: str,
            Complexity: int,
            Fragment: bool,
            Assembly: bool,
            Color,
            dimensions,
            location_data,
            principal_components):
        """Build component data dictionary using the actual schema."""
        current_time = datetime.utcnow().isoformat() + 'Z'
        
        # Get all properties from the schema
        properties = schema.get('properties', {})
        component_data = {}
        
        # Build component data based on schema properties
        for field_name, field_schema in properties.items():
            if field_name == '_id':
                component_data[field_name] = ComponentID
            elif field_name == 'name':
                component_data[field_name] = f'{str(Type).capitalize()} Component made from {str(Material).capitalize()}'
            elif field_name == 'type':
                component_data[field_name] = Type
            elif field_name == 'material':
                component_data[field_name] = Material
            elif field_name == 'created':
                component_data[field_name] = current_time
            elif field_name == 'lastmodified':
                component_data[field_name] = current_time
            elif field_name == 'complexity':
                component_data[field_name] = int(Complexity)
            elif field_name == 'fragment':
                component_data[field_name] = bool(Fragment)
            elif field_name == 'assembly':
                component_data[field_name] = bool(Assembly)
            elif field_name == 'geometry':
                component_data[field_name] = {}  # Will be filled later
            elif field_name == 'color':
                component_data[field_name] = [Color.R, Color.G, Color.B]
            elif field_name == 'bbx':
                component_data[field_name] = dimensions
            elif field_name == 'location':
                component_data[field_name] = location_data
            elif field_name == 'descriptors':
                component_data[field_name] = {}
            elif field_name == 'processes':
                component_data[field_name] = {}
            elif field_name == 'iframe':
                component_data[field_name] = {
                    'o': [0.0, 0.0, 0.0],
                    'x': [1.0, 0.0, 0.0],
                    'y': [0.0, 1.0, 0.0],
                    'z': [0.0, 0.0, 1.0]
                }
            elif field_name == 'pca_frame':
                component_data[field_name] = {
                    'o': [0.0, 0.0, 0.0],
                    'x': principal_components[0].tolist(),
                    'y': principal_components[1].tolist(),
                    'z': principal_components[2].tolist()
                }
            elif field_name == 'reserved':
                component_data[field_name] = ''
            elif field_name == 'attributes':
                component_data[field_name] = {}
            elif field_name == 'validated':
                component_data[field_name] = False
            elif field_name == 'etag':
                component_data[field_name] = ''
            else:
                # Handle any other fields from the schema with appropriate defaults
                field_type = field_schema.get('type', 'string')
                if field_type == 'string':
                    component_data[field_name] = ''
                elif field_type == 'integer':
                    component_data[field_name] = 0
                elif field_type == 'boolean':
                    component_data[field_name] = False
                elif field_type == 'array':
                    component_data[field_name] = []
                elif field_type == 'object':
                    component_data[field_name] = {}

        return component_data

    def center_geometry_at_origin(self, geometry):
        """
        Center extrusion at its volume centroid.
        Returns centered geometry and translation vector.
        """
        # Get the volume centroid of the geometry
        vmp = Rhino.Geometry.VolumeMassProperties.Compute(geometry)
        volume_centroid = vmp.Centroid
        if volume_centroid is None:
            # Fallback to bounding box centroid if volume centroid fails
            bbox = geometry.GetBoundingBox(True)
            volume_centroid = bbox.Center
        # Create translation vector to center
        translation_vector = -np.array([
            volume_centroid.X, volume_centroid.Y, volume_centroid.Z
        ])
        # Create centered extrusion
        centered_geometry = geometry.Duplicate()
        translation_xform = Rhino.Geometry.Transform.Translation(
            translation_vector[0], translation_vector[1], translation_vector[2]
        )
        centered_geometry.Transform(translation_xform)
        return centered_geometry, translation_vector

    def compute_minimum_bounding_box_3d(self, points):
        """
        Compute minimum bounding box for 3D points using PCA.
        Returns dimensions sorted by length (X=longest, Y=second, Z=shortest).
        """
        # Apply PCA to find principal axes
        pca = PCA(n_components=3)
        pca.fit(points)

        # Get principal components (eigenvectors)
        principal_components = pca.components_

        # Sort components by explained variance (largest first)
        explained_variance = pca.explained_variance_
        sorted_indices = np.argsort(-explained_variance)
        sorted_components = principal_components[sorted_indices]

        # Transform points to PCA space
        pca_points = np.dot(points, sorted_components.T)

        # Find bounds in PCA space
        min_bounds = np.min(pca_points, axis=0)
        max_bounds = np.max(pca_points, axis=0)

        # Compute dimensions (sorted by length: X=longest, Y=second,
        # Z=shortest)
        dimensions = max_bounds - min_bounds

        return dimensions.tolist(), sorted_components

    def minimum_bounding_rectangle(self, points):
        """
        Compute minimum bounding rectangle for 2D points.
        Returns rectangle corners and angle.
        """
        # Compute the convex hull of the points
        hull = ConvexHull(points)
        hull_points = points[hull.vertices]

        # Initialize variables to keep track of the best rectangle
        min_area = float('inf')
        best_rectangle = None
        best_angle = 0

        # Loop through each edge of the convex hull
        for i in range(len(hull_points)):
            # Determine the points forming the current edge
            p1 = hull_points[i]
            p2 = hull_points[(i + 1) % len(hull_points)]

            # Calculate edge vector
            edge_vec = p2 - p1

            # Rotate the points to align this edge with the x-axis
            angle = np.arctan2(edge_vec[1], edge_vec[0])
            cos_angle = np.cos(-angle)
            sin_angle = np.sin(-angle)
            rot_matrix = np.array([[cos_angle, -sin_angle],
                                   [sin_angle, cos_angle]])
            rotated_points = np.dot(points, rot_matrix.T)

            # Compute the min/max x/y in the rotated points
            min_x = np.min(rotated_points[:, 0])
            max_x = np.max(rotated_points[:, 0])
            min_y = np.min(rotated_points[:, 1])
            max_y = np.max(rotated_points[:, 1])

            # Calculate area of the bounding rectangle
            area = (max_x - min_x) * (max_y - min_y)

            if area < min_area:
                min_area = area
                best_angle = angle

                # Create the rectangle in the rotated space and then rotate it
                # back
                best_rectangle = np.array([
                    [min_x, min_y],
                    [max_x, min_y],
                    [max_x, max_y],
                    [min_x, max_y]
                ])

                inv_rot_matrix = np.array([
                    [cos_angle, sin_angle],
                    [-sin_angle, cos_angle]
                ])
                best_rectangle = np.dot(best_rectangle, inv_rot_matrix.T)

        return best_rectangle, best_angle

    def compute_minimum_bounding_box_2d(self, points, height):
        """
        Compute minimum axis-aligned bounding box for extrusions using the
        minimum bounding rectangle method to find optimal 2D orientation.
        """
        # Extract only X and Y coordinates for 2D analysis
        points_2d = points[:, :2]

        # Use the minimum bounding rectangle method to find optimal orientation
        mbr, optimal_angle = self.minimum_bounding_rectangle(points_2d)

        # The optimal_angle is the angle of the edge vector that gives
        # minimum area. To align this edge with the x-axis, we need to
        # rotate by -optimal_angle. This matches the logic in
        # minimum_bounding_rectangle
        cos_angle = np.cos(-optimal_angle)
        sin_angle = np.sin(-optimal_angle)

        # Rotate points to the optimal orientation
        rot_matrix = np.array([
            [cos_angle, -sin_angle],
            [sin_angle, cos_angle]
        ])
        rotated_points = np.dot(points_2d, rot_matrix.T)

        # Compute dimensions in the rotated coordinate system
        min_x = np.min(rotated_points[:, 0])
        max_x = np.max(rotated_points[:, 0])
        min_y = np.min(rotated_points[:, 1])
        max_y = np.max(rotated_points[:, 1])

        x_dim = max_x - min_x
        y_dim = max_y - min_y

        # Ensure X is the longest dimension for consistency
        if x_dim >= y_dim:
            dimensions = [x_dim, y_dim, height]
            # PCA frame aligns with the optimal orientation
            principal_components = np.array([
                [cos_angle, -sin_angle, 0],  # X axis = long axis
                [sin_angle, cos_angle, 0],   # Y axis = short axis
                [0, 0, 1]                    # Z axis stays vertical
            ])
        else:
            # Swap dimensions - the longer dimension should be X
            dimensions = [y_dim, x_dim, height]
            # Rotate by 90 degrees to make Y the X axis
            cos_angle_90 = np.cos(-optimal_angle + np.pi / 2)
            sin_angle_90 = np.sin(-optimal_angle + np.pi / 2)
            principal_components = np.array([
                [cos_angle_90, -sin_angle_90, 0],  # X axis = long axis
                [sin_angle_90, cos_angle_90, 0],   # Y axis = short axis
                [0, 0, 1]                          # Z axis stays vertical
            ])

        return dimensions, principal_components

    def rhino_xform(self, transformation_matrix) -> Rhino.Geometry.Transform:
        """
        Convert numpy transformation matrix to Rhino Transform.
        """
        XForm = Rhino.Geometry.Transform.Identity
        XForm.M00 = transformation_matrix[0][0]
        XForm.M01 = transformation_matrix[0][1]
        XForm.M02 = transformation_matrix[0][2]
        XForm.M03 = transformation_matrix[0][3]
        XForm.M10 = transformation_matrix[1][0]
        XForm.M11 = transformation_matrix[1][1]
        XForm.M12 = transformation_matrix[1][2]
        XForm.M13 = transformation_matrix[1][3]
        XForm.M20 = transformation_matrix[2][0]
        XForm.M21 = transformation_matrix[2][1]
        XForm.M22 = transformation_matrix[2][2]
        XForm.M23 = transformation_matrix[2][3]
        return XForm

    def process_geometry(self, geometry: Rhino.Geometry.GeometryBase):
        """
        Process geometry to extract points and determine if 3D.
        Returns points array and boolean indicating if 3D.
        """
        compute_3d = False
        # HANDLE BREP
        if isinstance(geometry, Rhino.Geometry.Brep):
            points = np.array([[p.Location.X,
                                p.Location.Y,
                                p.Location.Z] for p in geometry.Vertices])
            compute_3d = True
        # HANDLE EXTRUSIONS
        elif isinstance(geometry, Rhino.Geometry.Extrusion):
            brep = geometry.ToBrep()
            points = np.array([[p.Location.X,
                                p.Location.Y,
                                p.Location.Z] for p in brep.Vertices])
            compute_3d = False
        # HANDLE MESH
        elif isinstance(geometry, Rhino.Geometry.Mesh):
            points = np.array([[p.X, p.Y, p.Z] for p in geometry.Vertices])
            compute_3d = True
        # IF NOT ONE OF THESE GEOMETRY TYPES
        else:
            raise RuntimeError('Geometry processing not implemented '
                               f'for geometry of type {type(geometry)}!')
        # return results
        return points, compute_3d

    def validate_uuid(self, uuid_to_test: str, version: int = 4) -> bool:
        """
        Check if uuid_to_test is a valid UUID.
        Returns True if uuid_to_test is a valid UUID, otherwise False.
        """
        try:
            uuid_obj = uuid.UUID(uuid_to_test, version=version)
        except ValueError:
            return False
        return str(uuid_obj) == uuid_to_test

    def get_geometry_folder_path(self, component_id: str) -> str:
        """
        Get the geometry folder path for a component.
        Returns the appropriate path based on the operating system.
        """
        if platform.system() == 'Windows':
            base_path = os.path.expandvars('%APPDATA%')
            geometry_path = os.path.join(
                base_path, 'DDU_CSC', 'component_geometry', component_id
            )
        else:  # macOS and Linux
            base_path = os.path.expanduser('~')
            geometry_path = os.path.join(
                base_path, 'Library', 'Application Support', 'DDU_CSC',
                'component_geometry', component_id
            )

        return geometry_path

    def create_geometry_folder(self, component_id: str) -> str:
        """
        Create the geometry folder for a component if it doesn't exist.
        Returns the folder path.
        """
        folder_path = self.get_geometry_folder_path(component_id)
        os.makedirs(folder_path, exist_ok=True)
        return folder_path

    def reduce_mesh(
        self, mesh: Rhino.Geometry.Mesh, target_face_count: int
    ) -> Rhino.Geometry.Mesh:
        """
        Reduce a mesh to a target face count using Rhino's mesh reduction.
        Returns the reduced mesh.
        """
        reduced_mesh = mesh.Duplicate()
        reduced_mesh.Reduce(target_face_count, True, 5, False, True)
        reduced_mesh.Faces.ConvertQuadsToTriangles()
        reduced_mesh.Compact()
        return reduced_mesh

    def generate_vertex_colors_from_texture(
            self, mesh: Rhino.Geometry.Mesh) -> Rhino.Geometry.Mesh:
        """
        Generate vertex colors from texture if mesh has texture but no vertex
        colors. Returns the mesh with generated vertex colors.
        """
        try:
            # Check if mesh has texture but no vertex colors
            if (mesh.VertexColors.Count == 0 and
                    mesh.TextureCoordinates.Count > 0 and
                    mesh.Material and mesh.Material.IsValid):
                texture = mesh.Material.GetBitmapTexture()
                if texture and texture.IsValid:
                    bitmap = texture.GetBitmap()
                    if bitmap:
                        # Create a copy of the mesh to modify
                        colored_mesh = mesh.Duplicate()
                        # Generate vertex colors from texture
                        for i in range(colored_mesh.Vertices.Count):
                            if i < colored_mesh.TextureCoordinates.Count:
                                tex_coord = colored_mesh.TextureCoordinates[i]
                                # Convert UV coordinates to pixel coordinates
                                u = int(tex_coord.X * (bitmap.Width - 1))
                                v = int(tex_coord.Y * (bitmap.Height - 1))
                                # Clamp coordinates
                                u = max(0, min(u, bitmap.Width - 1))
                                v = max(0, min(v, bitmap.Height - 1))
                                # Get pixel color
                                pixel_color = bitmap.GetPixel(u, v)
                                # Add vertex color
                                colored_mesh.VertexColors.Add(pixel_color)
                            else:
                                # Fallback to white if no texture coordinate
                                colored_mesh.VertexColors.Add(
                                    System.Drawing.Color.White
                                )
                        # add remark
                        self._addRemark('Generated vertex colors from texture')
                        return colored_mesh
            # Return original mesh if no texture or already has vertex colors
            return mesh
        except Exception as e:
            self._addWarning(
                f'Failed to generate vertex colors from texture: {str(e)}'
            )
            return mesh

    def save_mesh_as_obj(
        self, mesh: Rhino.Geometry.Mesh, file_path: str,
        material_name: str = 'default_material'
    ) -> bool:
        """
        Save a mesh as OBJ file with associated MTL file.
        Handles coordinate system mapping (Rhino Z -> OBJ Y) and textures.
        Returns True if successful, False otherwise.
        """
        try:
            # Create OBJ content
            obj_content = '# OBJ file generated by DDU_CSC\n'
            mtl_filename = os.path.basename(file_path).replace('.obj', '.mtl')
            obj_content += f'mtllib {mtl_filename}\n'
            obj_content += 'o mesh\n'

            # Add vertices with coordinate system mapping (Rhino Z -> OBJ Y)
            for vertex in mesh.Vertices:
                # Map Rhino (X,Y,Z) to OBJ (X,Z,-Y) coordinate system
                obj_content += f'v {vertex.X} {vertex.Z} {-vertex.Y}\n'

            # Add vertex colors if available
            has_vertex_colors = mesh.VertexColors.Count > 0
            if has_vertex_colors:
                for color in mesh.VertexColors:
                    # Normalize colors to 0-1 range
                    r = color.R / 255.0
                    g = color.G / 255.0
                    b = color.B / 255.0
                    obj_content += f'vc {r} {g} {b}\n'

            # Add texture coordinates if mesh has them
            has_texture_coords = mesh.TextureCoordinates.Count > 0
            if has_texture_coords:
                for tex_coord in mesh.TextureCoordinates:
                    obj_content += f'vt {tex_coord.X} {tex_coord.Y}\n'

            # Add faces (OBJ uses 1-based indexing)
            for i, face in enumerate(mesh.Faces):
                if face.IsTriangle:
                    if has_vertex_colors and has_texture_coords:
                        # v/vt/vc format
                        obj_content += (
                            f'f {face.A + 1}/{face.A + 1}/{face.A + 1} '
                            f'{face.B + 1}/{face.B + 1}/{face.B + 1} '
                            f'{face.C + 1}/{face.C + 1}/{face.C + 1}\n'
                        )
                    elif has_vertex_colors:
                        # v//vc format
                        obj_content += (
                            f'f {face.A + 1}//{face.A + 1} '
                            f'{face.B + 1}//{face.B + 1} '
                            f'{face.C + 1}//{face.C + 1}\n'
                        )
                    elif has_texture_coords:
                        # v/vt format
                        obj_content += (
                            f'f {face.A + 1}/{face.A + 1} '
                            f'{face.B + 1}/{face.B + 1} '
                            f'{face.C + 1}/{face.C + 1}\n'
                        )
                    else:
                        # v format
                        obj_content += (
                            f'f {face.A + 1} {face.B + 1} {face.C + 1}\n'
                        )
                elif face.IsQuad:
                    if has_vertex_colors and has_texture_coords:
                        obj_content += (
                            f'f {face.A + 1}/{face.A + 1}/{face.A + 1} '
                            f'{face.B + 1}/{face.B + 1}/{face.B + 1} '
                            f'{face.C + 1}/{face.C + 1}/{face.C + 1} '
                            f'{face.D + 1}/{face.D + 1}/{face.D + 1}\n'
                        )
                    elif has_vertex_colors:
                        obj_content += (
                            f'f {face.A + 1}//{face.A + 1} '
                            f'{face.B + 1}//{face.B + 1} '
                            f'{face.C + 1}//{face.C + 1} '
                            f'{face.D + 1}//{face.D + 1}\n'
                        )
                    elif has_texture_coords:
                        obj_content += (
                            f'f {face.A + 1}/{face.A + 1} '
                            f'{face.B + 1}/{face.B + 1} '
                            f'{face.C + 1}/{face.C + 1} '
                            f'{face.D + 1}/{face.D + 1}\n'
                        )
                    else:
                        obj_content += (
                            f'f {face.A + 1} {face.B + 1} {face.C + 1} '
                            f'{face.D + 1}\n'
                        )

            # Write OBJ file
            with open(file_path, 'w') as f:
                f.write(obj_content)

            # Create MTL file
            mtl_path = file_path.replace('.obj', '.mtl')
            mtl_content = '# MTL file generated by DDU_CSC\n'
            mtl_content += f'newmtl {material_name}\n'
            # Default material properties
            mtl_content += 'Ka 0.2 0.2 0.2\n'  # Ambient color
            mtl_content += 'Kd 0.8 0.8 0.8\n'  # Diffuse color
            mtl_content += 'Ks 0.0 0.0 0.0\n'  # Specular color
            mtl_content += 'Ns 0.0\n'          # Specular exponent
            mtl_content += 'illum 1\n'         # Illumination model

            # Write MTL file
            with open(mtl_path, 'w') as f:
                f.write(mtl_content)

            return True

        except Exception as e:
            self._addWarning(f'Failed to save mesh as OBJ: {str(e)}')
            return False

    def process_mesh_geometry(
        self, geometry: Rhino.Geometry.Mesh, component_id: str
    ) -> tuple:
        """
        Process mesh geometry and create reduced/primitive versions if needed.
        Returns (original_mesh, reduced_mesh, primitive_mesh, files_saved)
        """
        # Get face count
        face_count = geometry.Faces.Count

        # Initialize return values
        reduced_mesh = None
        primitive_mesh = None
        files_saved = False

        # Check if geometry files already exist
        folder_path = self.get_geometry_folder_path(component_id)
        detailed_obj_path = os.path.join(folder_path, 'mesh.obj')
        reduced_obj_path = os.path.join(folder_path, 'mesh_reduced.obj')
        files_exist = (os.path.exists(detailed_obj_path) or
                       os.path.exists(reduced_obj_path))
        if files_exist:
            self._addWarning(
                f'Geometry files already exist for component {component_id}. '
                f'Skipping file saving but computing primitive geometry.'
            )

        # Generate vertex colors from texture if needed
        processed_geometry = self.generate_vertex_colors_from_texture(geometry)

        # Determine what versions to create based on face count
        if face_count > 5000:
            # Create both reduced and primitive versions
            if not files_exist:
                reduced_mesh = self.reduce_mesh(processed_geometry, 1000)
            primitive_mesh = self.reduce_mesh(processed_geometry, 350)
            files_saved = not files_exist  # Only save if files don't exist
        elif face_count > 500:
            # Create only primitive version
            primitive_mesh = self.reduce_mesh(processed_geometry, 350)
            files_saved = not files_exist  # Only save if files don't exist
        else:
            # Use original as primitive, no files saved
            primitive_mesh = processed_geometry

        # Save files if needed and files don't already exist
        if files_saved:
            try:
                folder_path = self.create_geometry_folder(component_id)

                # Save original/detailed mesh
                detailed_obj_path = os.path.join(folder_path, 'mesh.obj')
                self.save_mesh_as_obj(
                    processed_geometry, detailed_obj_path, 'detailed_material'
                )

                # Save reduced mesh if created
                if reduced_mesh is not None:
                    reduced_obj_path = os.path.join(
                        folder_path, 'mesh_reduced.obj'
                    )
                    self.save_mesh_as_obj(
                        reduced_mesh, reduced_obj_path, 'reduced_material'
                    )

                self._addRemark(f'Saved geometry files to {folder_path}')

            except Exception as e:
                self._addWarning(f'Failed to save geometry files: {str(e)}')
                files_saved = False

        return processed_geometry, reduced_mesh, primitive_mesh, files_saved

    def RunScript(self,
            ComponentID: str,
            Type: str,
            Material: str,
            Complexity: int,
            Fragment: bool,
            Assembly: bool,
            Color: System.Drawing.Color,
            Location: Rhino.Geometry.Vector3d,
            Geometry: Rhino.Geometry.GeometryBase):
        try:
            # Initialize param descriptions (this has to be done in RunScript)
            self.InputParams[0].Description = (
                'Component ID (must be a valid UUID)'
            )
            self.InputParams[1].Description = (
                'Component type (e.g., "sheet", "rubble")'
            )
            self.InputParams[2].Description = (
                'Material type (e.g., "steel", "concrete", "wood")'
            )
            self.InputParams[3].Description = (
                'Complexity level '
                '(0=simple, 1=normal, 2=complex, 3=very complex)'
            )
            self.InputParams[4].Description = (
                'Fragment status (True for fragments, False for complete)'
            )
            self.InputParams[5].Description = (
                'Assembly status (True for assemblies, False for individual)'
            )
            self.InputParams[6].Description = (
                'Location as Vector3d (X=latitude, Y=longitude, Z ignored)'
            )
            self.InputParams[7].Description = (
                'Component color (System.Drawing.Color)'
            )
            self.InputParams[8].Description = (
                'Rhino geometry object (Mesh or Extrusion for sheets, '
                'Mesh for rubble)'
            )

            # Initialize output param descriptions
            self.OutputParams[0].Description = (
                'Component data as JSON string adhering to ComponentModel '
                'structure. Contains geometry, PCA frame, bounding box, '
                'and metadata.'
            )

            # set up output trees and results tuple
            ComponentData = Grasshopper.DataTree[System.Object]()

            # Initialize schema validation
            self._addRemark('Initializing component creation with '
                            'schema validation...')

            # sanitize input and abort if not present
            if not ComponentID:
                msg = 'Input ComponentID failed to collect data!'
                self._addWarning(msg)
                self.Component.Message = msg
                return ComponentData
            elif not self.validate_uuid(ComponentID):
                msg = 'Input ComponentID is not a valid UUID! Aborting...'
                self._addError(msg)
                self.Component.Message = msg
                return ComponentData
            if not Type:
                msg = 'Input Type failed to collect data!'
                self._addWarning(msg)
                self.Component.Message = msg
                return ComponentData
            if not Material:
                msg = 'Input Material failed to collect data!'
                self._addWarning(msg)
                self.Component.Message = msg
                return ComponentData
            if Complexity is None:
                msg = 'Input Complexity failed to collect data!'
                self._addWarning(msg)
                self.Component.Message = msg
                return ComponentData
            if (not isinstance(Complexity, int) or
                    Complexity < 0 or Complexity > 3):
                msg = 'Input Complexity must be an integer between 0 and 3!'
                self._addError(msg)
                self.Component.Message = msg
                return ComponentData

            # Set defaults for Fragment and Assembly if not provided
            if Fragment is None:
                Fragment = False
            if Assembly is None:
                Assembly = False

            # Handle Location parameter (X=latitude, Y=longitude, Z ignored)
            location_data = None
            if Location is not None:
                location_data = {
                    "lat": Location.X,
                    "lon": Location.Y
                }

            if not Color:
                msg = ('Input Color failed to collect data. '
                       'Will use Grey as default Color.')
                self._addRemark(msg)
                print(msg)
                Color = System.Drawing.Color.FromArgb(255, 175, 175, 175)
            if not Geometry:
                msg = 'Input Geometry failed to collect data!'
                self._addWarning(msg)
                self.Component.Message = msg
                return ComponentData
            elif not Geometry.IsValid:
                msg = 'Input Geometry is invalid!'
                self._addError(msg)
                self.Component.Message = msg
                return ComponentData

            # TYPE FILTERING
            if Type == 'rubble':
                if not isinstance(Geometry, Rhino.Geometry.Mesh):
                    msg = ('The "rubble" type expects a Mesh as '
                           'geometry input! Please ensure and try again.')
                    print(msg)
                    raise ValueError(msg)
            elif Type == 'sheet':
                if not isinstance(
                        Geometry,
                        (Rhino.Geometry.Mesh, Rhino.Geometry.Extrusion)
                ):
                    msg = ('The "sheet" type expects a Mesh or Extrusion as '
                           'geometry input! Please ensure and try again.')
                    print(msg)
                    raise ValueError(msg)

            self.Component.Message = f'Processing {Type} component...'

            # Process geometry to extract points
            points, compute_3d = self.process_geometry(Geometry)

            # Center geometry at world origin
            (centered_geometry,
             translation_vector) = self.center_geometry_at_origin(Geometry)

            # Centered points
            centered_points = points - translation_vector

            # Compute minimum bounding box and PCA transformation
            if compute_3d:
                dimensions, principal_components = (
                    self.compute_minimum_bounding_box_3d(centered_points))
            else:
                # 2D APPROACH, i.e. used for Extrusions
                height = centered_geometry.PathStart.DistanceTo(
                    centered_geometry.PathEnd
                )
                dimensions, principal_components = (
                    self.compute_minimum_bounding_box_2d(
                        centered_points, height)
                )

            # Get component schema first
            schema = self.get_component_schema()

            # Create component data dictionary based on schema
            COMPDATA = self.build_component_data_from_schema(
                schema, ComponentID, Type, Material, Complexity, Fragment,
                Assembly, Color, dimensions, location_data,
                principal_components
            )

            # Validate component data against schema
            if not self.validate_component_data(COMPDATA, schema):
                self._addWarning('Component data validation failed, '
                                 'but continuing...')

            # Process geometry input based on type
            # HANDLE MESH
            if isinstance(Geometry, Rhino.Geometry.Mesh):
                # Process the centered geometry for mesh reduction
                # and file saving
                (original_mesh, reduced_mesh, primitive_mesh, files_saved) = (
                    self.process_mesh_geometry(centered_geometry, ComponentID)
                )

                # Use primitive mesh for JSON geometry data
                # create geometry dict for mesh with colors
                vertices = [[p.X, p.Y, p.Z]
                            for p in primitive_mesh.Vertices]
                faces = [[f[0], f[1], f[2]] for f in primitive_mesh.Faces]

                # Extract vertex colors if available
                colors = []
                if primitive_mesh.VertexColors.Count > 0:
                    colors = [[c.R, c.G, c.B]
                              for c in primitive_mesh.VertexColors]
                else:
                    # Use default color if no vertex colors
                    colors = [[Color.R, Color.G, Color.B]] * len(vertices)

                comp_mesh = {
                    'mesh': {
                        'v': vertices,
                        'f': faces,
                        'c': colors
                    }
                }
                COMPDATA['geometry'].update(comp_mesh)

            # HANDLE EXTRUSION
            elif isinstance(Geometry, Rhino.Geometry.Extrusion):
                # Get the profile curve from the CENTERED geometry and
                # convert to polyline
                if centered_geometry.ProfileCount > 1:
                    raise RuntimeError('Extrusion has more than one profile!')
                # Get first profile
                profile_curve = centered_geometry.Profile3d(0, 0.0)
                if profile_curve is None:
                    raise RuntimeError('Extrusion has no profile curve!')

                # Convert profile to polyline
                _tgpr, polyline = profile_curve.TryGetPolyline()
                if _tgpr is False:
                    polyline = profile_curve.ToPolyline(0.01, 0.01, 0, 0)
                if polyline is None:
                    raise RuntimeError(
                        'Could not convert profile curve to polyline!'
                    )

                # Extract 2D points from polyline
                profile_points = [[p.X, p.Y] for p in polyline]

                # Get extrusion height from centered geometry
                height = centered_geometry.PathStart.DistanceTo(
                    centered_geometry.PathEnd)

                comp_extrusion = {
                    'extrusion': {
                        'height': height,
                        'profile': profile_points
                    }
                }
                COMPDATA['geometry'].update(comp_extrusion)

            # HANDLE BREP
            elif isinstance(Geometry, Rhino.Geometry.Brep):
                raise RuntimeError(
                    'Geometry Processing for geometry of '
                    f'type {type(Geometry)} not implemented yet! '
                    'Please convert to Mesh and try again.')
            else:
                raise RuntimeError(
                    'Geometry Processing for geometry of '
                    f'type {type(Geometry)} not implemented yet! '
                    'Please convert to Mesh and try again.')

            # create json string
            ComponentData = json.dumps(COMPDATA)

            # Update success message
            self.Component.Message = (
                f'Successfully created {Type} component {ComponentID}'
            )
            self._addRemark(f'Created {Type} component {ComponentID}')

            # return output
            return ComponentData

        except ValueError as e:
            msg = f'Validation error: {str(e)}'
            self._addError(msg)
            self.Component.Message = msg

        except RuntimeError as e:
            msg = f'Runtime error: {str(e)}'
            self._addError(msg)
            self.Component.Message = msg

        except Exception as e:
            msg = f'Unexpected error: {str(e)}'
            self._addError(msg)
            self.Component.Message = msg

        # Return empty results if there was an error
        ComponentData = Grasshopper.DataTree[System.Object]()
        return ComponentData
# ---------- end createcomponent ----------
componentdata_2 = Data(createcomponent)

# ----
# comments & notes: Compute PCA and minimum aligned BoundingBox
samplemeshgeometry_2 = Mesh(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)
computepcaorientation = ComputePCAOrientation(Geometry=samplemeshgeometry_2)  # -> MinimumBBX, AlignedGeometry, AlignedBBX, TranslationVector, PCAXForm; inputs Geometry: GeometryBase
# ---------- computepcaorientation: Python ----------
#! python3
# venv: DDU_CSC
# r: requests==2.31.0
# r: numpy==1.26.4
# r: scipy==1.13.0
# r: scikit-learn==1.4.2

# PYTHON STANDARD LIBRARY IMPORTS ---------------------------------------------

# THIRD PARTY LIBRARY IMPORTS -------------------------------------------------
import numpy as np
from sklearn.decomposition import PCA

# RHINO AND GH RELATED IMPORTS ------------------------------------------------
import System  # type: ignore[reportMissingImport] # NOQA
import Grasshopper  # type: ignore[reportMissingImport] # NOQA
import Rhino  # type: ignore[reportMissingImport] # NOQA

# GHENV COMPONENT SETTINGS ----------------------------------------------------
ghenv.Component.Name = 'ComputePCAOrientation'  # type: ignore[reportUnedfinedVariable] # NOQA
ghenv.Component.NickName = 'ComputePCAOrientation'  # type: ignore[reportUnedfinedVariable] # NOQA
ghenv.Component.Category = 'DDU_CSC'  # type: ignore[reportUnedfinedVariable] # NOQA
ghenv.Component.SubCategory = '7 Geometry Tools'  # type: ignore[reportUnedfinedVariable] # NOQA


class CSC_ComputePCAOrientation(Grasshopper.Kernel.GH_ScriptInstance):
    """
    Author: Max Benjamin Eschenbach
    License: MIT License
    Version: 250828
    """

    def __init__(self):
        super().__init__()
        # initialize props
        self.Component = ghenv.Component  # type: ignore[reportUnedfinedVariable] # NOQA
        self.InputParams = self.Component.Params.Input
        self.OutputParams = self.Component.Params.Output

    def _addRemark(self, msg: str = ''):
        rml = self.Component.RuntimeMessageLevel.Remark
        self.AddRuntimeMessage(rml, msg)

    def _addWarning(self, msg: str = ''):
        rml = self.Component.RuntimeMessageLevel.Warning
        self.AddRuntimeMessage(rml, msg)

    def _addError(self, msg: str = ''):
        rml = self.Component.RuntimeMessageLevel.Error
        self.AddRuntimeMessage(rml, msg)

    def center_geometry_at_origin(self, geometry):
        """
        Center geometry at its volume centroid.
        Returns centered geometry and translation vector.
        """
        # Get the volume centroid of the geometry
        vmp = Rhino.Geometry.VolumeMassProperties.Compute(geometry)
        volume_centroid = vmp.Centroid
        if volume_centroid is None:
            # Fallback to bounding box centroid if volume centroid fails
            bbox = geometry.GetBoundingBox(True)
            volume_centroid = bbox.Center
        # Create translation vector to center
        translation_vector = -np.array([
            volume_centroid.X, volume_centroid.Y, volume_centroid.Z
        ])
        # Create centered geometry
        centered_geometry = geometry.Duplicate()
        translation_xform = Rhino.Geometry.Transform.Translation(
            translation_vector[0], translation_vector[1], translation_vector[2]
        )
        centered_geometry.Transform(translation_xform)
        return centered_geometry, translation_vector

    def compute_minimum_bounding_box_3d(self, points):
        """
        Compute minimum bounding box for 3D points using PCA.
        Returns dimensions sorted by length (X=longest, Y=second, Z=shortest).
        """
        # Apply PCA to find principal axes
        pca = PCA(n_components=3)
        pca.fit(points)

        # Get principal components (eigenvectors)
        principal_components = pca.components_

        # Sort components by explained variance (largest first)
        explained_variance = pca.explained_variance_
        sorted_indices = np.argsort(-explained_variance)
        sorted_components = principal_components[sorted_indices]

        # Transform points to PCA space
        pca_points = np.dot(points, sorted_components.T)

        # Find bounds in PCA space
        min_bounds = np.min(pca_points, axis=0)
        max_bounds = np.max(pca_points, axis=0)

        # Compute dimensions (sorted by length: X=longest, Y=second,
        # Z=shortest)
        dimensions = max_bounds - min_bounds

        return dimensions.tolist(), sorted_components

    def rhino_xform(self, transformation_matrix) -> Rhino.Geometry.Transform:
        """
        Convert numpy transformation matrix to Rhino Transform.
        """
        XForm = Rhino.Geometry.Transform.Identity
        XForm.M00 = transformation_matrix[0][0]
        XForm.M01 = transformation_matrix[0][1]
        XForm.M02 = transformation_matrix[0][2]
        XForm.M03 = transformation_matrix[0][3]
        XForm.M10 = transformation_matrix[1][0]
        XForm.M11 = transformation_matrix[1][1]
        XForm.M12 = transformation_matrix[1][2]
        XForm.M13 = transformation_matrix[1][3]
        XForm.M20 = transformation_matrix[2][0]
        XForm.M21 = transformation_matrix[2][1]
        XForm.M22 = transformation_matrix[2][2]
        XForm.M23 = transformation_matrix[2][3]
        return XForm

    def process_geometry(self, geometry: Rhino.Geometry.GeometryBase):
        """
        Process geometry to extract points and determine if 3D.
        Returns points array and boolean indicating if 3D.
        """
        compute_3d = False
        # HANDLE BREP
        if isinstance(geometry, Rhino.Geometry.Brep):
            points = np.array([[p.Location.X,
                                p.Location.Y,
                                p.Location.Z] for p in geometry.Vertices])
            compute_3d = True
        # HANDLE EXTRUSIONS
        elif isinstance(geometry, Rhino.Geometry.Extrusion):
            brep = geometry.ToBrep()
            points = np.array([[p.Location.X,
                                p.Location.Y,
                                p.Location.Z] for p in brep.Vertices])
            compute_3d = False
        # HANDLE MESH
        elif isinstance(geometry, Rhino.Geometry.Mesh):
            points = np.array([[p.X, p.Y, p.Z] for p in geometry.Vertices])
            compute_3d = True
        # IF NOT ONE OF THESE GEOMETRY TYPES
        else:
            raise RuntimeError('Geometry processing not implemented '
                               f'for geometry of type {type(geometry)}!')
        # return results
        return points, compute_3d

    def create_pca_transform_matrix(self, principal_components):
        """
        Create a 4x4 transformation matrix from PCA principal components.
        """
        # The principal components define the new coordinate system
        # To transform geometry TO align with this system, we need the INVERSE
        # The principal components are the new basis vectors
        # We want to rotate the geometry so it aligns with these vectors
        # This requires the inverse of the rotation matrix
        rotation_matrix = np.linalg.inv(principal_components.T)
        # Create 4x4 transformation matrix
        transform_matrix = np.eye(4)
        transform_matrix[:3, :3] = rotation_matrix
        # return results
        return transform_matrix

    def apply_pca_transform(self, geometry, principal_components):
        """
        Apply PCA transformation to geometry.
        """
        # Create transformation matrix
        transform_matrix = self.create_pca_transform_matrix(
            principal_components)
        # Convert to Rhino XForm
        xform = self.rhino_xform(transform_matrix)
        # Apply transformation
        transformed_geometry = geometry.Duplicate()
        transformed_geometry.Transform(xform)
        # return results
        return transformed_geometry

    def RunScript(self, Geometry: Rhino.Geometry.GeometryBase):
        # set up output variables
        MinimumBBX = Grasshopper.DataTree[System.Object]()
        AlignedGeometry = Grasshopper.DataTree[System.Object]()
        AlignedBBX = Grasshopper.DataTree[System.Object]()
        TranslationVector = Grasshopper.DataTree[System.Object]()
        PCAXForm = Grasshopper.DataTree[System.Object]()
        try:
            # Initialize param descriptions (this has to be done in RunScript)
            self.InputParams[0].Description = (
                'Input Rhino Geometry'
            )
            # Initialize output param descriptions
            self.OutputParams[0].Description = (
                'Minimum bounding box, obtained using PCA, '
                ' at the location of the input geometry'
            )
            self.OutputParams[1].Description = (
                'Input geometry transformed using PCA method and centered at '
                'world origin'
            )
            self.OutputParams[2].Description = (
                'Minimum bounding box transformed using the computed PCA '
                'frame, centered at the world origin'
            )
            self.OutputParams[3].Description = (
                'Translation vector that was used to move the geometry '
                'to the world origin'
            )
            self.OutputParams[4].Description = (
                'PCA frame that was used to transform the geometry '
                'converted to a Rhino XForm.'
            )
            # sanitize input and abort if not present
            self.Component.Message = None
            if not Geometry:
                msg = 'Input Geometry failed to collect data!'
                self._addWarning(msg)
                self.Component.Message = msg
                return (MinimumBBX, AlignedGeometry,
                        AlignedBBX, TranslationVector, PCAXForm)
            elif not Geometry.IsValid:
                msg = 'Input Geometry is invalid!'
                self._addError(msg)
                self.Component.Message = msg
                return (MinimumBBX, AlignedGeometry,
                        AlignedBBX, TranslationVector, PCAXForm)
            # Process geometry to extract points
            points, compute_3d = self.process_geometry(Geometry)
            # Center geometry at world origin
            (centered_geometry,
             translation_vector) = self.center_geometry_at_origin(Geometry)
            # Get Rhino translation vector
            TranslationVector = Rhino.Geometry.Vector3d(
                *translation_vector.tolist()
            )
            # Centered points
            centered_points = points - translation_vector
            # Compute minimum bounding box and PCA transformation
            dimensions, principal_components = (
                self.compute_minimum_bounding_box_3d(centered_points)
            )
            # Create PCA transformation matrix and XForm
            # The principal components define the new coordinate system
            # We want to transform the geometry TO align with this system
            pca_transform_matrix = self.create_pca_transform_matrix(
                principal_components)
            PCAXForm = self.rhino_xform(pca_transform_matrix)
            # Apply PCA transformation to centered geometry
            # This will align the geometry with its principal axes
            AlignedGeometry = self.apply_pca_transform(
                centered_geometry, principal_components)
            # Create PCA-oriented bounding box
            AlignedBBX = AlignedGeometry.GetBoundingBox(True)
            # Now "transform back" the PCA-oriented bounding box
            # NOTE: we have to convert to a Rhino.Geometry.Box for the
            # correctly applying the transformation!
            MinimumBBX = Rhino.Geometry.Box(
                AlignedGeometry.GetBoundingBox(True)
            )
            _res, invPCAXForm = PCAXForm.TryGetInverse()
            if not _res:
                raise RuntimeError('Failed to get Inverse of PCA Transform!')
            MinimumBBX.Transform(invPCAXForm)
            MinimumBBX.Transform(
                Rhino.Geometry.Transform.Translation(-TranslationVector)
            )
            # return output
            return (MinimumBBX, AlignedGeometry,
                    AlignedBBX, TranslationVector, PCAXForm)
        except ValueError as e:
            msg = f'Validation error: {str(e)}'
            self._addError(msg)
            self.Component.Message = msg
        except RuntimeError as e:
            msg = f'Runtime error: {str(e)}'
            self._addError(msg)
            self.Component.Message = msg
        # Return empty results if there was an error
        return (MinimumBBX, AlignedGeometry,
                AlignedBBX, TranslationVector, PCAXForm)
# ---------- end computepcaorientation ----------

# ----
# comments & notes: Fetch a subset of components from the database using filters
mindimensionx = Slider(0, range=-0.1..2000)
maxdimensiony = Slider(0, range=0..2000)
maxdimensionx = Slider(0, range=0..2000)
maxdimensionz = Slider(0, range=0..500)
mindimensiony = Slider(0, range=0..2000)
mindimensionz = Slider(0, range=0..500)
fragment = ValueList({"Any": , "Only fragments": True, "Only non-fragmnents": False}, selected="Only non-fragmnents")
reservedstatus = Slider(-1, range=-1..1)
complexity_2 = ValueList({"Any complexity": , "0", "1", "2", "3"}, selected="Any complexity")
material_2 = ValueList({"Any material": , "corian", "concrete", "timber", "aluminium", "steel"}, selected="Any material")
type_2 = ValueList({"All types": , "sheet", "rubble", "beam", "column", "profile"}, selected="All types")
fetchfilteredcomponents = FetchFilteredComponents(
    Type=type_2,
    Material=material_2,
    Complexity=complexity_2,
    Fragment=fragment,
    MinDimensionX=mindimensionx,
    MaxDimensionX=maxdimensionx,
    MinDimensionY=mindimensiony,
    MaxDimensionY=maxdimensiony,
    MinDimensionZ=mindimensionz,
    MaxDimensionZ=maxdimensionz,
    ReservedStatus=reservedstatus)  # -> FilterDescription, ComponentData; inputs Type: String, Material: String, Complexity: Int32, Fragment: Boolean, MinDimensionX: Double, MaxDimensionX: Double, MinDimensionY: Double, MaxDimensionY: Double, MinDimensionZ: Double, MaxDimensionZ: Double
# ---------- fetchfilteredcomponents: Python ----------
#! python3
# venv: DDU_CSC
# r: requests==2.31.0
# r: numpy==1.26.4
# r: scipy==1.13.0
# r: scikit-learn==1.4.2

# PYTHON STANDARD LIBRARY IMPORTS ---------------------------------------------
import json

# THIRD PARTY LIBRARY IMPORTS -------------------------------------------------
import requests

# RHINO AND GH RELATED IMPORTS ------------------------------------------------
import System  # type: ignore[reportMissingImport] # NOQA
import Grasshopper  # type: ignore[reportMissingImport] # NOQA
import Rhino  # type: ignore[reportMissingImport] # NOQA
import scriptcontext as sc  # type: ignore[reportMissingImport] # NOQA

# GHENV COMPONENT SETTINGS ----------------------------------------------------
ghenv.Component.Name = 'FetchFilteredComponents'  # type: ignore[reportUnedfinedVariable] # NOQA
ghenv.Component.NickName = 'FetchFilteredComponents'  # type: ignore[reportUnedfinedVariable] # NOQA
ghenv.Component.Category = 'DDU_CSC'  # type: ignore[reportUnedfinedVariable] # NOQA
ghenv.Component.SubCategory = '2 Catalogue Interface'  # type: ignore[reportUnedfinedVariable] # NOQA


class CSC_FetchFilteredComponents(Grasshopper.Kernel.GH_ScriptInstance):
    """
    Author: Max Benjamin Eschenbach
    License: MIT License
    Version: 250904
    """

    def __init__(self):
        super().__init__()
        # initialize props
        self.Component = ghenv.Component  # type: ignore[reportUnedfinedVariable] # NOQA
        self.InputParams = self.Component.Params.Input
        self.OutputParams = self.Component.Params.Output

    def _addRemark(self, msg: str = ''):
        rml = self.Component.RuntimeMessageLevel.Remark
        self.AddRuntimeMessage(rml, msg)

    def _addWarning(self, msg: str = ''):
        rml = self.Component.RuntimeMessageLevel.Warning
        self.AddRuntimeMessage(rml, msg)

    def _addError(self, msg: str = ''):
        rml = self.Component.RuntimeMessageLevel.Error
        self.AddRuntimeMessage(rml, msg)

    def get_auth_core_from_sticky(self):
        """Get AuthCore instance from sticky storage."""
        auth_core = sc.sticky.get('CSC_AuthCore')
        if auth_core is None:
            msg = ('No authentication found. Please use CSC_SignIn component '
                   'first.')
            self._addError(msg)
            self.Component.Message = msg
            return None
        return auth_core

    def build_filter_query_params(
            self,
            Type,
            Material,
            Complexity,
            Fragment,
            MinDimensionX,
            MaxDimensionX,
            MinDimensionY,
            MaxDimensionY,
            MinDimensionZ,
            MaxDimensionZ,
            ReservedStatus):
        """Build query parameters for filtering components."""
        params = {}

        # Add type filter if provided
        if Type and len(Type) > 0:
            # Take the first type if multiple are provided
            type_value = Type[0] if isinstance(Type, list) else str(Type)
            if type_value and type_value.strip():
                params['comptype'] = type_value.strip()

        # Add material filter if provided
        if Material and Material.strip():
            params['material'] = Material.strip()

        # Add complexity filter if provided
        if Complexity is not None:
            params['complexity'] = Complexity

        # Add fragment filter if provided
        if Fragment is not None:
            params['fragment'] = Fragment

        # Add reservation status filter if provided
        if ReservedStatus is not None and ReservedStatus != -1:
            if ReservedStatus == 0:
                # Fetch components that are not reserved by anyone
                params['reserved'] = 'false'
            elif ReservedStatus == 1:
                # Fetch components reserved by current user
                params['reserved'] = 'true'

        # Add bounding box filters if provided
        if MinDimensionX is not None and MinDimensionX != 0.0:
            params['bbx_min_x'] = MinDimensionX
        if MaxDimensionX is not None and MaxDimensionX != 0.0:
            params['bbx_max_x'] = MaxDimensionX
        if MinDimensionY is not None and MinDimensionY != 0.0:
            params['bbx_min_y'] = MinDimensionY
        if MaxDimensionY is not None and MaxDimensionY != 0.0:
            params['bbx_max_y'] = MaxDimensionY
        if MinDimensionZ is not None and MinDimensionZ != 0.0:
            params['bbx_min_z'] = MinDimensionZ
        if MaxDimensionZ is not None and MaxDimensionZ != 0.0:
            params['bbx_max_z'] = MaxDimensionZ

        return params

    def generate_filter_description(self, filter_params: dict) -> str:
        """Generates a human-readable description of the applied filters."""
        description = []
        if filter_params.get('comptype'):
            description.append(f'\nType: {filter_params["comptype"]}')
        if filter_params.get('material'):
            description.append(f'\nMaterial: {filter_params["material"]}')
        if filter_params.get('complexity') is not None:
            description.append(f'\nComplexity: {filter_params["complexity"]}')
        if filter_params.get('fragment') is not None:
            description.append(f'\nFragment: {filter_params["fragment"]}')

        # Add reservation status filter description
        if filter_params.get('reserved') == 'false':
            description.append('\nReservation: Not reserved by anyone')
        elif filter_params.get('reserved') == 'true':
            description.append('\nReservation: Reserved by current user')

        # Handle bounding box filters with detailed information
        bbx_filters = []
        if filter_params.get('bbx_min_x') is not None:
            bbx_filters.append(f'\nX >= {filter_params["bbx_min_x"]:.2f}')
        if filter_params.get('bbx_max_x') is not None:
            bbx_filters.append(f'\nX <= {filter_params["bbx_max_x"]:.2f}')
        if filter_params.get('bbx_min_y') is not None:
            bbx_filters.append(f'\nY >= {filter_params["bbx_min_y"]:.2f}')
        if filter_params.get('bbx_max_y') is not None:
            bbx_filters.append(f'\nY <= {filter_params["bbx_max_y"]:.2f}')
        if filter_params.get('bbx_min_z') is not None:
            bbx_filters.append(f'\nZ >= {filter_params["bbx_min_z"]:.2f}')
        if filter_params.get('bbx_max_z') is not None:
            bbx_filters.append(f'\nZ <= {filter_params["bbx_max_z"]:.2f}')

        if bbx_filters:
            description.append(f'\nBounding Box: {", ".join(bbx_filters)}')

        return f'Applied filters: {", ".join(description)}'

    def RunScript(self,
            Type: str,
            Material: str,
            Complexity: int,
            Fragment: bool,
            MinDimensionX: float,
            MaxDimensionX: float,
            MinDimensionY: float,
            MaxDimensionY: float,
            MinDimensionZ: float,
            MaxDimensionZ: float,
            ReservedStatus):
        # Initialize param descriptions (this has to be done in RunScript)
        self.InputParams[0].Description = (
            'Component type filter (e.g., "beam", "slab", "column")'
        )
        self.InputParams[1].Description = (
            'Material type filter (e.g., "concrete", "steel", "wood")'
        )
        self.InputParams[2].Description = (
            'Complexity level filter (0-3, where 0=simple, 3=complex)'
        )
        self.InputParams[3].Description = (
            'Fragment status filter (True for fragments, False for complete)'
        )
        self.InputParams[4].Description = (
            'Minimum X dimension filter (bounding box)'
        )
        self.InputParams[5].Description = (
            'Maximum X dimension filter (bounding box)'
        )
        self.InputParams[6].Description = (
            'Minimum Y dimension filter (bounding box)'
        )
        self.InputParams[7].Description = (
            'Maximum Y dimension filter (bounding box)'
        )
        self.InputParams[8].Description = (
            'Minimum Z dimension filter (bounding box)'
        )
        self.InputParams[9].Description = (
            'Maximum Z dimension filter (bounding box)'
        )
        self.InputParams[10].Description = (
            'Reservation status filter: -1=ignore, 0=not reserved, '
            '1=reserved by current user'
        )

        # Initialize output param descriptions
        self.OutputParams[0].Description = (
            'Human-readable description of the applied filters and query'
        )
        self.OutputParams[1].Description = (
            'The ComponentData that was fetched from the server as JSON. '
            'Use \'DisassembleComponent\' to access the individual fields '
            'ready for Grasshopper')

        # Get AuthCore instance from sticky storage
        auth_core = self.get_auth_core_from_sticky()
        if auth_core is None:
            return

        # Check if authentication is valid
        if not auth_core.is_valid():
            msg = ('Authentication expired. Please use CSC_SignIn '
                   'component to refresh.')
            self._addError(msg)
            self.Component.Message = msg
            return

        try:
            self.Component.Message = 'Building filter query...'

            # Build filter query parameters
            filter_params = self.build_filter_query_params(
                Type, Material, Complexity, Fragment,
                MinDimensionX, MaxDimensionX, MinDimensionY,
                MaxDimensionY, MinDimensionZ, MaxDimensionZ,
                ReservedStatus
            )

            # Build the query string
            query_string = '&'.join([
                f'{k}={v}' for k, v in filter_params.items()
            ])
            endpoint = '/components'
            if query_string:
                endpoint += f'?{query_string}'

            # Generate human-readable filter description
            filter_description = self.generate_filter_description(
                filter_params
            )

            self.Component.Message = (
                'Fetching filtered components (with cache)...'
            )

            # Create cache key based on filter parameters
            cache_key = (f'filtered:{query_string}' if query_string
                         else 'filtered:all')
            # Make cached request to fetch filtered components
            response = auth_core.cached_get(endpoint, cache_key, filter_params)

            if response.status_code == 200:
                # Successfully fetched components
                json_comps = response.json()
                component_count = len(json_comps)

                # Show filter info in message
                filter_msg = f'Found {component_count} components (cached).'

                self.Component.Message = filter_msg
                self._addRemark(
                    f'Successfully fetched {component_count} components '
                    f'with applied filters'
                )

                # Set up output trees and results tuple
                FilterDescription = Grasshopper.DataTree[System.Object]()
                ComponentData = Grasshopper.DataTree[System.Object]()
                __Results = (FilterDescription, ComponentData)

                # Loop over all components and add them to the data tree
                for i, json_comp in enumerate(json_comps):
                    # Create datatree path
                    ghp = Grasshopper.Kernel.Data.GH_Path(i)
                    # Add component data to the datatree
                    ComponentData.Add(json.dumps(json_comp), ghp)

                # Add filter description to the filter query output
                FilterDescription.Add(
                    filter_description,
                    Grasshopper.Kernel.Data.GH_Path(0)
                )

                return __Results

            elif response.status_code == 401:
                msg = 'Authentication failed. Please sign in again.'
                self._addError(msg)
                self.Component.Message = msg

            elif response.status_code == 403:
                msg = 'Access denied. Insufficient permissions.'
                self._addError(msg)
                self.Component.Message = msg

            elif response.status_code == 500:
                msg = 'Server error. Please try again later.'
                self._addWarning(msg)
                self.Component.Message = msg

            else:
                msg = (f'Request failed with status code: '
                       f'{response.status_code}')
                self._addError(msg)
                self.Component.Message = msg

        except requests.exceptions.ConnectionError as e:
            msg = 'Cannot connect to server. Please check your connection.'
            self._addError(msg + f'\nFull Error: {str(e)}')
            self.Component.Message = msg

        except requests.exceptions.Timeout as e:
            msg = 'Request timeout. Server may be slow.'
            self._addError(msg + f'\nFull Error: {str(e)}')
            self.Component.Message = msg

        except requests.exceptions.RequestException as e:
            msg = f'Request error: {str(e)}'
            self._addError(msg)
            self.Component.Message = msg

        except Exception as e:
            msg = f'Unexpected error: {str(e)}'
            self._addError(msg)
            self.Component.Message = msg

        # Return empty results if there was an error
        ComponentData = Grasshopper.DataTree[System.Object]()
        FilterDescription = Grasshopper.DataTree[System.Object]()
        __Results = (FilterDescription, ComponentData)
        return __Results
# ---------- end fetchfilteredcomponents ----------
panel_3 = Panel(fetchfilteredcomponents.FilterDescription)
componentdata_3 = Data(fetchfilteredcomponents.ComponentData)

# ----
# comments & notes: Fetch a single component or multiple components from the database
componentid_2 = Panel("01163af8-b178-4ec3-8281-19e2189ac059")
fetchcomponents = FetchComponents(ComponentID=componentid_2)  # -> ComponentData; inputs ComponentID: list of String
# ---------- fetchcomponents: Python ----------
#! python3
# venv: DDU_CSC
# r: requests==2.31.0
# r: numpy==1.26.4
# r: scipy==1.13.0
# r: scikit-learn==1.4.2

# PYTHON STANDARD LIBRARY IMPORTS ---------------------------------------------
import json

# THIRD PARTY LIBRARY IMPORTS -------------------------------------------------
import requests

# RHINO AND GH RELATED IMPORTS ------------------------------------------------
import System  # type: ignore[reportMissingImport] # NOQA
import Grasshopper  # type: ignore[reportMissingImport] # NOQA
import Rhino  # type: ignore[reportMissingImport] # NOQA
import scriptcontext as sc  # type: ignore[reportMissingImport] # NOQA

# GHENV COMPONENT SETTINGS ----------------------------------------------------
ghenv.Component.Name = 'FetchComponents'  # type: ignore[reportUnedfinedVariable] # NOQA
ghenv.Component.NickName = 'FetchComponents'  # type: ignore[reportUnedfinedVariable] # NOQA
ghenv.Component.Category = 'DDU_CSC'  # type: ignore[reportUnedfinedVariable] # NOQA
ghenv.Component.SubCategory = '2 Catalogue Interface'  # type: ignore[reportUnedfinedVariable] # NOQA


class CSC_FetchComponents(Grasshopper.Kernel.GH_ScriptInstance):
    """
    Author: Max Benjamin Eschenbach
    License: MIT License
    Version: 250904
    """

    def __init__(self):
        super().__init__()
        # initialize props
        self.Component = ghenv.Component  # type: ignore[reportUnedfinedVariable] # NOQA
        self.InputParams = self.Component.Params.Input
        self.OutputParams = self.Component.Params.Output

    def _addRemark(self, msg: str = ''):
        rml = self.Component.RuntimeMessageLevel.Remark
        self.AddRuntimeMessage(rml, msg)

    def _addWarning(self, msg: str = ''):
        rml = self.Component.RuntimeMessageLevel.Warning
        self.AddRuntimeMessage(rml, msg)

    def _addError(self, msg: str = ''):
        rml = self.Component.RuntimeMessageLevel.Error
        self.AddRuntimeMessage(rml, msg)

    def get_auth_core_from_sticky(self):
        """Get AuthCore instance from sticky storage."""
        auth_core = sc.sticky.get('CSC_AuthCore')
        if auth_core is None:
            msg = ('No authentication found. Please use CSC_SignIn component '
                   'first.')
            self._addError(msg)
            self.Component.Message = msg
            return None
        return auth_core

    def RunScript(self, ComponentID: System.Collections.Generic.List[str]):
        # Initialize param descriptions (this has to be done in RunScript)
        self.InputParams[0].Description = 'One or many ComponentIDs to fetch'
        self.OutputParams[0].Description = (
            'The ComponentData that was fetched from the server as JSON. '
            'Use \'DisassembleComponent\' to access the individual fields '
            'ready for Grasshopper')

        # Get AuthCore instance from sticky storage
        auth_core = self.get_auth_core_from_sticky()
        if auth_core is None:
            return

        # Check if authentication is valid
        if not auth_core.is_valid():
            msg = ('Authentication expired. Please use CSC_SignIn '
                   'component to refresh.')
            self._addError(msg)
            self.Component.Message = msg
            return

        # Validate ComponentID input
        if not ComponentID:
            msg = 'Please provide ComponentID(s) to fetch.'
            self._addWarning(msg)
            self.Component.Message = msg
            return

        # Convert to list and validate UUIDs
        component_ids = list(ComponentID)
        for _id in component_ids:
            if not auth_core.validate_uuid(_id):
                msg = f'ComponentID <{_id}> is not a valid UUID!'
                self._addWarning(msg)
                self.Component.Message = msg
                return

        try:
            self.Component.Message = (
                f'Fetching {len(component_ids)} component(s) (with cache)...'
            )

            # Set up output trees and results tuple
            ComponentData = Grasshopper.DataTree[System.Object]()
            __Results = (ComponentData,)

            # Fetch each component
            for i, _id in enumerate(component_ids):
                try:
                    # Make cached request to fetch specific component
                    response = auth_core.cached_get(
                        f'/components/{_id}', f'component:{_id}')

                    if response.status_code == 200:
                        # Successfully fetched component (from server or cache)
                        json_comp = response.json()

                        # Create datatree path
                        ghp = Grasshopper.Kernel.Data.GH_Path(i)
                        # Add component data to the datatree
                        ComponentData.Add(json.dumps(json_comp), ghp)

                        self._addRemark(
                            f'Successfully fetched component {_id}'
                        )

                    elif response.status_code == 404:
                        msg = f'Component {_id} not found on server.'
                        self._addWarning(msg)
                        self.Component.Message = msg

                    elif response.status_code == 401:
                        msg = 'Authentication failed. Please sign in again.'
                        self._addError(msg)
                        self.Component.Message = msg
                        return __Results

                    elif response.status_code == 403:
                        msg = 'Access denied. Insufficient permissions.'
                        self._addError(msg)
                        self.Component.Message = msg
                        return __Results

                    elif response.status_code == 500:
                        msg = 'Server error. Please try again later.'
                        self._addWarning(msg)
                        self.Component.Message = msg

                    else:
                        msg = (f'Request failed for component {_id} with '
                               f'status code: {response.status_code}')
                        self._addError(msg)
                        self.Component.Message = msg

                except Exception as e:
                    msg = f'Error fetching component {_id}: {str(e)}'
                    self._addError(msg)
                    self.Component.Message = msg

            # Update success message
            if ComponentData.DataCount > 0:
                self.Component.Message = (
                    f'Fetched {ComponentData.DataCount} component(s) (cached)'
                )
            else:
                self.Component.Message = 'No components fetched'

            return __Results

        except requests.exceptions.ConnectionError as e:
            msg = 'Cannot connect to server. Please check your connection.'
            self._addError(msg + f'\nFull Error: {str(e)}')
            self.Component.Message = msg

        except requests.exceptions.Timeout as e:
            msg = 'Request timeout. Server may be slow.'
            self._addError(msg + f'\nFull Error: {str(e)}')
            self.Component.Message = msg

        except requests.exceptions.RequestException as e:
            msg = f'Request error: {str(e)}'
            self._addError(msg)
            self.Component.Message = msg

        except Exception as e:
            msg = f'Unexpected error: {str(e)}'
            self._addError(msg)
            self.Component.Message = msg

        # Return empty results if there was an error
        ComponentData = Grasshopper.DataTree[System.Object]()
        __Results = (ComponentData,)
        return __Results
# ---------- end fetchcomponents ----------
componentdata_4 = Data(fetchcomponents)

# ---- group: __GH_DEVELOPMENT_TOOLS__
# SCRIPT SOURCE & USROBJ EXPORT
source_folder = Panel("..\grasshopper_userobjects_src")
dduclayprintingslicer_userobjects_folder = Panel("..\grasshopper_userobjects")
icon_path = Panel("..\resources\250820_csc_icon_24x24.png")
exportscriptsandsource = ExportScriptsAndSource(
    RunComponentAnalysis=Toggle(False),
    ExportUserObjectsAndSource=Toggle(False),
    Category="DDU_CSC",
    UserObjFolder=dduclayprintingslicer_userobjects_folder,
    SourceFolder=source_folder,
    IconPath=icon_path)  # -> out, OldScriptsDebug, CategoryDebug, VersionDebug, InfoMessages; inputs RunComponentAnalysis: Boolean, ExportUserObjectsAndSource: Boolean, Category: String, IconPath: String
# ---------- exportscriptsandsource: Python ----------
# PYTHON STANDARD LIBRARY IMPORTS ---------------------------------------------
import os

# RHINO AND GH RELATED IMPORTS ------------------------------------------------
import System  # type: ignore[reportMissingImport] # NOQA
import Rhino  # type: ignore[reportMissingImport] # NOQA
import Grasshopper  # type: ignore[reportMissingImport] # NOQA
import scriptcontext as sc  # type: ignore[reportMissingImport] # NOQA
import GhPython as ghpy  # type: ignore[reportMissingImport] # NOQA
import ScriptComponents as scomp  # type: ignore[reportMissingImport] # NOQA
import RhinoCodePluginGH as rcpgh  # type: ignore[reportMissingImport] # NOQA

# GHENV COMPONENT SETTINGS ----------------------------------------------------
ghenv.Component.Name = "ExportScriptsAndSource"  # type: ignore[reportUnedfinedVariable] # NOQA
ghenv.Component.NickName = "ExportScriptsAndSource"  # type: ignore[reportUnedfinedVariable] # NOQA
ghenv.Component.Category = "DDU_CSC"  # type: ignore[reportUnedfinedVariable] # NOQA
ghenv.Component.SubCategory = "0 Development"  # type: ignore[reportUnedfinedVariable] # NOQA


class ExportScriptsAndSource(Grasshopper.Kernel.GH_ScriptInstance):
    """
    Author: Max Benjamin Eschenbach (based on a Python Script by Anders Holden Deleuran)  # NOQA
    License: MIT License
    Version: 250822
    """

    def get_source_version(self, source):
        """
        Attempts to get the first instance of the word "version"
        (or, "Version") in a multi line string. Then attempts to extract an
        integer from this line where the word "version" exists. So format
        version YYMMDD in the docstring like so (or any other integer system):
            Version: 160121
        """
        # Get first line with version in it
        src_lower = source.lower()
        version_str = [ln for ln in src_lower.split('\n') if "version" in ln]
        if version_str:
            # Get the first substring integer and return it
            version_int = [
                int(s) for s in version_str[0].split() if s.isdigit()
            ]
            if version_int:
                return int(version_int[0])
        else:
            return None

    def process_document_objects(self, ghdocument, verbose=False):
        """
        Processes GH_Document object and return a list of all script components
        """
        # get all document objects
        comps = list(ghdocument.Objects)

        # types of python components
        ghpycomp = ghpy.Component.ZuiPythonComponent
        ipycomp = rcpgh.Components.IronPython2Component
        py3comp = rcpgh.Components.Python3Component

        # types of csharp components
        cscomp = scomp.Component_CSNET_Script
        cs9comp = rcpgh.Components.CSharpComponent

        # cluster component
        clustercomp = Grasshopper.Kernel.Special.GH_Cluster

        # extract component type strings
        ghpycomp_str = str(ghpycomp).split("'")[1]
        cscomp_str = str(cscomp).split("'")[1]
        ipycomp_str = str(ipycomp).split("'")[1]
        py3comp_str = str(py3comp).split("'")[1]
        cs9comp_str = str(cs9comp).split("'")[1]
        clustercomp_str = str(clustercomp).split("'")[1]

        # define script types
        id_ghpycomp = 'GHPY'
        id_cscomp = 'CS'
        id_ipycomp = 'IPY2'
        id_py3comp = 'PY3'
        id_cs9comp = 'CS9'

        # init dict for script component storage
        script_components = {}

        # loop over all document components
        # store all component objects in a dictionary to check
        # - are all "same" scripts the same code?
        # - are there scripts without category or version attribute?
        # - separate old from new scripts, dont export old scripts!
        for obj in comps:
            # extract basic info
            name = obj.Name
            nickname = obj.NickName
            iguid = str(obj.InstanceGuid)
            # extract type string
            objtype_str = str(obj.GetType())
            # OLD GHPYTHON COMPONENT
            if objtype_str == ghpycomp_str:
                source = obj.Code
                if source:
                    print((f'Found Source for OLD GHPY Component "{nickname}" '
                           f'({iguid})') if verbose else None)
                    scriptcomp = [id_ghpycomp, nickname, name, obj, source]
                    script_components[iguid] = scriptcomp
            # OLD C# COMPONENT
            elif objtype_str == cscomp_str:
                source = obj.ScriptSource.ScriptCode
                if source:
                    print((f'Found Source for OLD CS Component "{nickname}" '
                           f'({iguid})') if verbose else None)
                    scriptcomp = [id_cscomp, nickname, name, obj, source]
                    script_components[iguid] = scriptcomp
            # NEW C#9 COMPONENT
            elif objtype_str == cs9comp_str:
                bres, source = obj.TryGetSource()
                if bres:
                    print((f'Found Source for CS9 Component "{nickname}" '
                           f'({iguid})') if verbose else None)
                    scriptcomp = [id_cs9comp, nickname, name, obj, source]
                    script_components[iguid] = scriptcomp
            # NEW IRONPYTHON COMPONENT
            elif objtype_str == ipycomp_str:
                bres, source = obj.TryGetSource()
                if bres:
                    print((f'Found Source for IPY2 Component "{nickname}" '
                           f'({iguid})') if verbose else None)
                    scriptcomp = [id_ipycomp, nickname, name, obj, source]
                    script_components[iguid] = scriptcomp
            # NEW PYTHON3 COMPONENT
            elif objtype_str == py3comp_str:
                bres, source = obj.TryGetSource()
                if bres:
                    print((f'Found Source for PY3 Component "{nickname}" '
                           f'({iguid})') if verbose else None)
                    scriptcomp = [id_py3comp, nickname, name, obj, source]
                    script_components[iguid] = scriptcomp
            # CLUSTER COMPONENT
            elif objtype_str == clustercomp_str:
                # RECURSIVELY STEP THROUGH CLUSTERS AND LOOK FOR SCRIPTS ...
                print((f'Processing CLUSTER "{nickname}" ({name}, '
                      f'{iguid}) ...') if verbose else None)
                cluster_scripts = self.process_document_objects(
                    obj.Document(''), verbose=verbose
                )
                # add cluster script dict to main dict
                script_components.update(cluster_scripts)

        return script_components

    def process_script_components(
            self,
            script_components: dict,
            set_category: str):
        """
        Process found script components and get unique components.
        """
        unique_script_components = {}

        OldScriptsDebug = []
        CategoryDebug = []
        VersionDebug = []
        InfoMessages = []

        for iguid, values in script_components.items():
            script_type, nickname, name, obj, source = values
            category = obj.Category
            version = self.get_source_version(source)
            script_id = nickname + ' ' + name
            # NOT SEEN YET SCRIPT COMPONENTS
            if script_id not in unique_script_components:
                version_present = True
                category_match = True
                if script_type == 'GHPY':
                    OldScriptsDebug.append(
                        f'{script_type} - {nickname} ({name})')
                    OldScriptsDebug.append(
                        '    - IS AN OLD GHPYTHON SCRIPT!')
                elif script_type == 'CS':
                    OldScriptsDebug.append(
                        f'{script_type} - {nickname} ({name})')
                    OldScriptsDebug.append('    - IS AN OLD C# SCRIPT!')
                if category != set_category:
                    # create debug info messages
                    category_match = False
                    if category == 'Maths':
                        CategoryDebug.append(
                            f'{script_type} - {nickname} ({name})')
                        CategoryDebug.append(
                            f'    - HAS NO CATEGORY ({category}) (No Export)!')
                    else:
                        CategoryDebug.append(
                            f'{script_type} - {nickname} ({name})')
                        CategoryDebug.append(
                            f'    - {category} OUT OF SET CATEGORY '
                            f'{set_category} (No Export)!')
                if version is None:
                    version_present = False
                    # create debug info messages
                    VersionDebug.append(
                        ' '.join([script_type, nickname, name]))
                    VersionDebug.append('    - HAS NO VERSION! (No Export)')
                if category_match and version_present:
                    InfoMessages.append(f'{script_type} - {nickname} ({name})')
                    unique_script_components[script_id] = values
            # ALREADY SEEN SCRIPT COMPONENTS
            else:
                existing_source = unique_script_components[script_id][4]
                existing_version = self.get_source_version(existing_source)
                if version is None:
                    VersionDebug.append(f'{script_type} - {nickname} ({name})')
                    VersionDebug.append('    - HAS NO VERSION!')
                elif existing_version is None and version is not None:
                    VersionDebug.append(f'{script_type} - {nickname} ({name})')
                    VersionDebug.append(
                        f'    - VERSION {version} > ALREADY FOUND VERSION '
                        f'{existing_version}!')
                    # REPLACE FOUND "NONE" VERSION WITH NAMED VERSION!
                    raise
                elif version < existing_version:
                    VersionDebug.append(f'{script_type} - {nickname} ({name})')
                    VersionDebug.append(
                        f'    - VERSION {version} < {existing_version}! '
                        'Continuing...')
                    # REPLACE THE SOURCE OF THE LOWER VERSION
                    # WITH HIGHER VERSION SOURCE!
                    continue
                elif version > existing_version:
                    VersionDebug.append(f'{script_type} - {nickname} ({name})')
                    VersionDebug.append(
                        f'    - VERSION {version} > ALREADY FOUND VERSION '
                        f'{existing_version}!')
                    # REPLACE THE OBJECT IN DICT WITH NEWER VERSION
                    raise
        return (unique_script_components, OldScriptsDebug, CategoryDebug,
                VersionDebug, InfoMessages)

    def export_scriptcomp_usrobj(self, scriptcomp, usrobjpath, iconpath=''):
        """
        Automates the creation of a GHPython user object. Based on this thread:
        http://www.grasshopper3d.com/forum/topics/change-the-default-values-for-userobject-popup-menu
        scriptcomp = [script_type, nickname, name, obj, source]
        """
        try:
            # Make a user object
            uo = Grasshopper.Kernel.GH_UserObject()
            # Get component object
            obj = scriptcomp[3]
            # Process icon
            if iconpath:
                obj.SetIconOverride(System.Drawing.Bitmap.FromFile(iconpath))
            uo.Icon = obj.Icon_24x24
            # Set its properties based on the GHPython component properties
            uo.BaseGuid = obj.ComponentGuid
            uo.Exposure = ghenv.Component.Exposure.primary  # type: ignore[reportUnedfinedVariable] # NOQA
            uo.Description.Name = obj.Name
            uo.Description.Description = obj.Description
            uo.Description.Category = obj.Category
            uo.Description.SubCategory = obj.SubCategory
            # Set the user object data and save to file
            uo.SetDataFromObject(obj)
            uo.Path = os.path.join(
                usrobjpath, obj.Category + '_' + obj.Name + '.ghuser')
            uo.SaveToFile()
        except Exception as e:
            print(e)
            return False
        return True

    def export_scriptcomp_source(self, scriptcomp, srcpath):
        """
        Export the source code of a script component
        scriptcomp = [script_type, nickname, name, obj, source]
        """
        # Get code and lines of code
        script_type = scriptcomp[0]
        name = scriptcomp[2]
        obj = scriptcomp[3]
        source = scriptcomp[4]
        code = source.replace('\r', '')
        lines = code.splitlines()
        loc = len(lines)
        # Check/make source file folder
        srcpath = os.path.join(srcpath)
        if not os.path.isdir(srcpath):
            os.makedirs(srcpath)
        # Write code to file
        if script_type == 'PY3' or script_type == 'IPY2':
            ext = '.py'
        elif script_type == 'CS9':
            ext = '.cs'
        else:
            # DO NOT EXPORT OLD SCRIPTS!
            ext = None
        if ext:
            src_file = os.path.join(srcpath, obj.Category + '_' + name + ext)
            with open(src_file, 'w') as f:
                f.write(code)
        return loc

    def RunScript(self,
            RunComponentAnalysis: bool,
            ExportUserObjectsAndSource: bool,
            Category: str,
            UserObjFolder,
            SourceFolder,
            IconPath: str):
        # Init outputs
        OldScriptsDebug = Grasshopper.DataTree[object]()
        CategoryDebug = Grasshopper.DataTree[object]()
        VersionDebug = Grasshopper.DataTree[object]()
        InfoMessages = Grasshopper.DataTree[object]()

        # Iterate the canvas and get to the GHPython components
        grasshopper_document = ghenv.Component.OnPingDocument()  # type: ignore[reportUnedfinedVariable] # NOQA
        gh_dir = os.path.dirname(grasshopper_document.FilePath)

        usrobjpath = os.path.normpath(
            os.path.abspath(os.path.join(gh_dir, UserObjFolder)))
        srcpath = os.path.normpath(
            os.path.abspath(os.path.join(gh_dir, SourceFolder)))
        iconpath = os.path.normpath(
            os.path.abspath(os.path.join(gh_dir, IconPath)))

        if RunComponentAnalysis:
            # loop over all objects on the grasshopper canvas
            # and identify the components to export scriptsource from
            script_components = self.process_document_objects(
                grasshopper_document, verbose=False)

            # - are all "same" scripts the same code?
            # - are there scripts without category or version attribute?
            # - separate old from new scripts, dont export old scripts!
            (unique_script_components,
             OldScriptsDebug,
             CategoryDebug,
             VersionDebug,
             InfoMessages) = self.process_script_components(
                script_components, Category)

        # HERE LOOP OVER UNIQUE COMPONENTS
        if ExportUserObjectsAndSource and RunComponentAnalysis:
            # - SAVE USEROBJECT
            # - SAVE SOURCE
            for script_id, scriptcomp in unique_script_components.items():
                loc = self.export_scriptcomp_source(scriptcomp, srcpath)
                res = self.export_scriptcomp_usrobj(
                    scriptcomp, usrobjpath, iconpath)
                print(res, loc)
        elif ExportUserObjectsAndSource and not RunComponentAnalysis:
            rml = ghenv.Component.RuntimeMessageLevel.Warning  # type: ignore[reportUnedfinedVariable] # NOQA
            ghenv.Component.AddRuntimeMessage(  # type: ignore[reportUnedfinedVariable] # NOQA
                rml,
                'UserObjects and Source cannot be exported without running '
                'Component Analysis!')

        return OldScriptsDebug, CategoryDebug, VersionDebug, InfoMessages
# ---------- end exportscriptsandsource ----------
print_out = Panel(exportscriptsandsource.out)
oldscriptsdebug = Panel(exportscriptsandsource.OldScriptsDebug)
categorydebug = Panel(exportscriptsandsource.CategoryDebug)
versiondebug = Panel(exportscriptsandsource.VersionDebug)
infomessages = Panel(exportscriptsandsource.InfoMessages)

# ----
# comments & notes: Fetch ALL components from the database
fetchallcomponents = FetchAllComponents()  # -> ComponentData
# ---------- fetchallcomponents: Python ----------
#! python3
# venv: DDU_CSC
# r: requests==2.31.0
# r: numpy==1.26.4
# r: scipy==1.13.0
# r: scikit-learn==1.4.2

# PYTHON STANDARD LIBRARY IMPORTS ---------------------------------------------
import json

# THIRD PARTY LIBRARY IMPORTS -------------------------------------------------
import requests

# RHINO AND GH RELATED IMPORTS ------------------------------------------------
import System  # type: ignore[reportMissingImport] # NOQA
import Grasshopper  # type: ignore[reportMissingImport] # NOQA
import Rhino  # type: ignore[reportMissingImport] # NOQA
import scriptcontext as sc  # type: ignore[reportMissingImport] # NOQA

# GHENV COMPONENT SETTINGS ----------------------------------------------------
ghenv.Component.Name = 'FetchAllComponents'  # type: ignore[reportUnedfinedVariable] # NOQA
ghenv.Component.NickName = 'FetchAllComponents'  # type: ignore[reportUnedfinedVariable] # NOQA
ghenv.Component.Category = 'DDU_CSC'  # type: ignore[reportUnedfinedVariable] # NOQA
ghenv.Component.SubCategory = '2 Catalogue Interface'  # type: ignore[reportUnedfinedVariable] # NOQA


class CSC_FetchAllComponents(Grasshopper.Kernel.GH_ScriptInstance):
    """
    Author: Max Benjamin Eschenbach
    License: MIT License
    Version: 250904
    """

    def __init__(self):
        super().__init__()
        # initialize props
        self.Component = ghenv.Component  # type: ignore[reportUnedfinedVariable] # NOQA
        self.InputParams = self.Component.Params.Input
        self.OutputParams = self.Component.Params.Output

    def _addRemark(self, msg: str = ''):
        rml = self.Component.RuntimeMessageLevel.Remark
        self.AddRuntimeMessage(rml, msg)

    def _addWarning(self, msg: str = ''):
        rml = self.Component.RuntimeMessageLevel.Warning
        self.AddRuntimeMessage(rml, msg)

    def _addError(self, msg: str = ''):
        rml = self.Component.RuntimeMessageLevel.Error
        self.AddRuntimeMessage(rml, msg)

    def get_auth_core_from_sticky(self):
        """Get AuthCore instance from sticky storage."""
        auth_core = sc.sticky.get('CSC_AuthCore')
        if auth_core is None:
            msg = ('No authentication found. Please use CSC_SignIn component '
                   'first.')
            self._addError(msg)
            self.Component.Message = msg
            return None
        return auth_core

    def RunScript(self):
        # Initialize param descriptions (this has to be done in RunScript)
        self.OutputParams[0].Description = (
            'The ComponentData that was fetched from the server as JSON. '
            'Use \'DisassembleComponent\' to access the individual fields '
            'ready for Grasshopper')

        # Get AuthCore instance from sticky storage
        auth_core = self.get_auth_core_from_sticky()
        if auth_core is None:
            return

        # Check if authentication is valid
        if not auth_core.is_valid():
            msg = ('Authentication expired. Please use CSC_SignIn '
                   'component to refresh.')
            self._addError(msg)
            self.Component.Message = msg
            return

        try:
            self.Component.Message = 'Fetching components (with cache)...'

            # Make cached request to fetch all components
            response = auth_core.cached_get('/components', 'all_components')

            if response.status_code == 200:
                # Successfully fetched components
                json_comps = response.json()
                component_count = len(json_comps)

                self.Component.Message = (
                    f'Found {component_count} components (cached)'
                )
                self._addRemark(
                    f'Successfully fetched {component_count} components'
                )

                # Set up output trees and results tuple
                ComponentData = Grasshopper.DataTree[System.Object]()
                __Results = (ComponentData,)

                # Loop over all components and add them to the data tree
                for i, json_comp in enumerate(json_comps):
                    # Create datatree path
                    ghp = Grasshopper.Kernel.Data.GH_Path(i)
                    # Add component data to the datatree
                    ComponentData.Add(json.dumps(json_comp), ghp)

                return __Results

            elif response.status_code == 401:
                msg = 'Authentication failed. Please sign in again.'
                self._addError(msg)
                self.Component.Message = msg

            elif response.status_code == 403:
                msg = 'Access denied. Insufficient permissions.'
                self._addError(msg)
                self.Component.Message = msg

            elif response.status_code == 500:
                msg = 'Server error. Please try again later.'
                self._addWarning(msg)
                self.Component.Message = msg

            else:
                msg = (f'Request failed with status code: '
                       f'{response.status_code}')
                self._addError(msg)
                self.Component.Message = msg

        except requests.exceptions.ConnectionError as e:
            msg = 'Cannot connect to server. Please check your connection.'
            self._addError(msg + f'\nFull Error: {str(e)}')
            self.Component.Message = msg

        except requests.exceptions.Timeout as e:
            msg = 'Request timeout. Server may be slow.'
            self._addError(msg + f'\nFull Error: {str(e)}')
            self.Component.Message = msg

        except requests.exceptions.RequestException as e:
            msg = f'Request error: {str(e)}'
            self._addError(msg)
            self.Component.Message = msg

        except Exception as e:
            msg = f'Unexpected error: {str(e)}'
            self._addError(msg)
            self.Component.Message = msg

        # Return empty results if there was an error
        ComponentData = Grasshopper.DataTree[System.Object]()
        __Results = (ComponentData,)
        return __Results
# ---------- end fetchallcomponents ----------
componentdata_5 = Data(fetchallcomponents)

# ----
# comments & notes: Submit the created Component to the Catalogue Database
toggle_2 = BooleanToggle(False)
componentdata_6 = Data(componentdata_2)
addcomponent = AddComponent(ComponentData=componentdata_6, Run=toggle_2)  # -> AddedComponentData; inputs ComponentData: String, Run: Boolean
# ---------- addcomponent: Python ----------
#! python3
# venv: DDU_CSC
# r: requests==2.31.0
# r: numpy==1.26.4
# r: scipy==1.13.0
# r: scikit-learn==1.4.2

# PYTHON STANDARD LIBRARY IMPORTS ---------------------------------------------
import json
import os
import platform

# THIRD PARTY LIBRARY IMPORTS -------------------------------------------------
import requests

# RHINO AND GH RELATED IMPORTS ------------------------------------------------
import System  # type: ignore[reportMissingImport] # NOQA
import Grasshopper  # type: ignore[reportMissingImport] # NOQA
import Rhino  # type: ignore[reportMissingImport] # NOQA
import scriptcontext as sc  # type: ignore[reportMissingImport] # NOQA

# GHENV COMPONENT SETTINGS ----------------------------------------------------
ghenv.Component.Name = 'AddComponent'  # type: ignore[reportUnedfinedVariable] # NOQA
ghenv.Component.NickName = 'AddComponent'  # type: ignore[reportUnedfinedVariable] # NOQA
ghenv.Component.Category = 'DDU_CSC'  # type: ignore[reportUnedfinedVariable] # NOQA
ghenv.Component.SubCategory = '2 Catalogue Interface'  # type: ignore[reportUnedfinedVariable] # NOQA


class CSC_AddComponent(Grasshopper.Kernel.GH_ScriptInstance):
    """
    Author: Max Benjamin Eschenbach
    License: MIT License
    Version: 250902
    """

    def __init__(self):
        super().__init__()
        # initialize props
        self.Component = ghenv.Component  # type: ignore[reportUnedfinedVariable] # NOQA
        self.InputParams = self.Component.Params.Input
        self.OutputParams = self.Component.Params.Output

    def _addRemark(self, msg: str = ''):
        rml = self.Component.RuntimeMessageLevel.Remark
        self.AddRuntimeMessage(rml, msg)

    def _addWarning(self, msg: str = ''):
        rml = self.Component.RuntimeMessageLevel.Warning
        self.AddRuntimeMessage(rml, msg)

    def _addError(self, msg: str = ''):
        rml = self.Component.RuntimeMessageLevel.Error
        self.AddRuntimeMessage(rml, msg)

    def get_auth_core_from_sticky(self):
        """Get AuthCore instance from sticky storage."""
        auth_core = sc.sticky.get('CSC_AuthCore')
        if auth_core is None:
            msg = ('No authentication found. Please use CSC_SignIn component '
                   'first.')
            self._addError(msg)
            self.Component.Message = msg
            return None
        return auth_core

    def get_geometry_folder_path(self, component_id: str) -> str:
        """
        Get the geometry folder path for a component.
        Returns the appropriate path based on the operating system.
        """
        if platform.system() == 'Windows':
            base_path = os.path.expandvars('%APPDATA%')
            geometry_path = os.path.join(
                base_path, 'DDU_CSC', 'component_geometry', component_id
            )
        else:  # macOS and Linux
            base_path = os.path.expanduser('~')
            geometry_path = os.path.join(
                base_path, 'Library', 'Application Support', 'DDU_CSC',
                'component_geometry', component_id
            )
        return geometry_path

    def check_geometry_files(self, component_id: str) -> dict:
        """
        Check which geometry files exist for a component.
        Returns dict with file existence status.
        """
        folder_path = self.get_geometry_folder_path(component_id)
        files_status = {
            'detailed_obj': os.path.exists(
                os.path.join(folder_path, 'mesh.obj')),
            'detailed_mtl': os.path.exists(
                os.path.join(folder_path, 'mesh.mtl')),
            'reduced_obj': os.path.exists(
                os.path.join(folder_path, 'mesh_reduced.obj')),
            'reduced_mtl': os.path.exists(
                os.path.join(folder_path, 'mesh_reduced.mtl')),
            'texture': os.path.exists(
                os.path.join(folder_path, 'texture.jpg')),
            'folder_path': folder_path
        }
        return files_status

    def upload_geometry_files(
            self, auth_core, component_id: str, files_status: dict) -> bool:
        """
        Upload geometry files to the backend using the geometry routes.
        Returns True if successful, False otherwise.
        """
        try:
            folder_path = files_status['folder_path']
            upload_success = True
            # Upload detailed geometry if files exist
            if files_status['detailed_obj'] and files_status['detailed_mtl']:
                self.Component.Message = 'Uploading detailed geometry...'
                self._addRemark(
                    'Starting detailed geometry upload '
                    '(this may take a while)'
                )
                detailed_files = {
                    'mesh_file': open(os.path.join(
                        folder_path, 'mesh.obj'), 'rb'),
                    'material_file': open(os.path.join(
                        folder_path, 'mesh.mtl'), 'rb')
                }
                # Add texture file if it exists
                if files_status['texture']:
                    detailed_files['texture_file'] = open(
                        os.path.join(folder_path, 'texture.jpg'), 'rb')
                try:
                    # Use longer timeout for file uploads
                    response = auth_core.authorized_post(
                        f'/components/{component_id}/geometry/add_detailed',
                        files=detailed_files,
                        timeout=300  # 5 minutes timeout for file uploads
                    )
                    if response.status_code == 200:
                        self._addRemark(
                            'Successfully uploaded detailed geometry'
                        )
                    else:
                        self._addWarning(
                            'Failed to upload detailed '
                            f'geometry: {response.status_code}'
                        )
                        upload_success = False
                except requests.exceptions.Timeout:
                    self._addWarning(
                        'Detailed geometry upload timed out. '
                        'File may be too large or connection slow.'
                    )
                    upload_success = False
                except requests.exceptions.ConnectionError:
                    self._addWarning(
                        'Connection lost during detailed geometry upload. '
                        'Please check your internet connection.'
                    )
                    upload_success = False
                finally:
                    # Close all opened files
                    for file_obj in detailed_files.values():
                        file_obj.close()

            # Upload reduced geometry if files exist
            if (files_status['reduced_obj'] and
                    files_status['reduced_mtl'] and
                    upload_success):
                self.Component.Message = 'Uploading reduced geometry...'
                self._addRemark('Starting reduced geometry upload')
                reduced_files = {
                    'mesh_file': open(os.path.join(
                        folder_path, 'mesh_reduced.obj'), 'rb'),
                    'material_file': open(os.path.join(
                        folder_path, 'mesh_reduced.mtl'), 'rb')
                }
                # Add texture file if it exists (same texture for both)
                if files_status['texture']:
                    reduced_files['texture_file'] = open(os.path.join(
                        folder_path, 'texture.jpg'), 'rb')
                try:
                    # Use longer timeout for file uploads
                    response = auth_core.authorized_post(
                        f'/components/{component_id}/geometry/add_reduced',
                        files=reduced_files,
                        timeout=300  # 5 minutes timeout for file uploads
                    )
                    if response.status_code == 200:
                        self._addRemark(
                            'Successfully uploaded reduced geometry'
                        )
                    else:
                        self._addWarning(
                            'Failed to upload reduced '
                            f'geometry: {response.status_code}'
                        )
                        upload_success = False
                except requests.exceptions.Timeout:
                    self._addWarning(
                        'Reduced geometry upload timed out. '
                        'File may be too large or connection slow.'
                    )
                    upload_success = False
                except requests.exceptions.ConnectionError:
                    self._addWarning(
                        'Connection lost during reduced geometry upload. '
                        'Please check your internet connection.'
                    )
                    upload_success = False
                finally:
                    # Close all opened files
                    for file_obj in reduced_files.values():
                        file_obj.close()
            return upload_success
        except Exception as e:
            self._addWarning(f'Error uploading geometry files: {str(e)}')
            return False

    def RunScript(self, ComponentData: str, Run: bool):
        # Initialize param descriptions (this has to be done in RunScript)
        self.InputParams[0].Description = (
            'Component data as JSON string to add to the database')
        self.InputParams[1].Description = (
            'Toggle to execute the add operation')
        self.OutputParams[0].Description = (
            'The added component data returned from the server as JSON')

        # Set up output trees and results tuple
        AddedComponentData = Grasshopper.DataTree[System.Object]()

        # Get AuthCore instance from sticky storage
        auth_core = self.get_auth_core_from_sticky()
        if auth_core is None:
            return AddedComponentData

        # Check if authentication is valid
        if not auth_core.is_valid():
            msg = ('Authentication expired. Please use CSC_SignIn '
                   'component to refresh.')
            self._addError(msg)
            self.Component.Message = msg
            return AddedComponentData

        # Validate ComponentData input
        if not ComponentData:
            msg = 'Please provide ComponentData to add.'
            self._addWarning(msg)
            self.Component.Message = msg
            return AddedComponentData

        # Validate JSON format
        try:
            component_json = json.loads(ComponentData)
        except json.JSONDecodeError:
            msg = 'ComponentData must be valid JSON format.'
            self._addError(msg)
            self.Component.Message = msg
            return AddedComponentData

        # Extract component ID for geometry file checking
        component_id = component_json.get('_id', '')
        if not component_id:
            msg = 'Component data must contain a valid _id field.'
            self._addError(msg)
            self.Component.Message = msg
            return AddedComponentData

        # Check for geometry files
        files_status = self.check_geometry_files(component_id)
        has_geometry_files = (files_status['detailed_obj'] and
                              files_status['detailed_mtl'])

        if has_geometry_files:
            self._addRemark(
                f'Found geometry files for component {component_id}'
            )
            if files_status['reduced_obj'] and files_status['reduced_mtl']:
                self._addRemark(
                    'Found both detailed and reduced geometry files'
                )
            if files_status['texture']:
                self._addRemark('Found texture file')
        else:
            self._addRemark(
                f'No geometry files found for component {component_id}'
            )

        if not Run:
            status_msg = 'Ready to add component'
            if has_geometry_files:
                status_msg += ' with geometry files'
            status_msg += ' (toggle Run to execute)'
            self.Component.Message = status_msg
            return AddedComponentData

        try:
            self.Component.Message = 'Adding component to database...'

            # Make authenticated request to add component
            response = auth_core.authorized_post(
                '/components/add/', json_body=component_json)

            if response.status_code == 201:
                # Successfully added component
                json_comp = response.json()
                component_id = json_comp.get('_id', 'Unknown')

                # Create datatree path
                ghp = Grasshopper.Kernel.Data.GH_Path(0)
                # Add component data to the datatree
                AddedComponentData.Add(json.dumps(json_comp), ghp)

                self._addRemark(
                    f'Successfully added component {component_id} to database'
                )
                self.Component.Message = f'Added component {component_id}'

                # Upload geometry files if they exist
                if has_geometry_files:
                    self.Component.Message = 'Uploading geometry files...'
                    upload_success = self.upload_geometry_files(
                        auth_core, component_id, files_status
                    )
                    if upload_success:
                        self._addRemark(
                            'Successfully uploaded all geometry files'
                        )
                        self.Component.Message = (
                            f'Added component {component_id} with geometry'
                        )
                    else:
                        self._addWarning(
                            'Component added but some geometry uploads failed'
                        )
                        self.Component.Message = (
                            f'Added component {component_id} '
                            '(geometry upload issues)'
                        )

            elif response.status_code == 400:
                msg = 'Invalid component data format.'
                self._addError(msg)
                self.Component.Message = msg

            elif response.status_code == 401:
                msg = 'Authentication failed. Please sign in again.'
                self._addError(msg)
                self.Component.Message = msg
                return AddedComponentData

            elif response.status_code == 403:
                msg = 'Access denied. Insufficient permissions.'
                self._addError(msg)
                self.Component.Message = msg
                return AddedComponentData

            elif response.status_code == 409:
                msg = 'Component already exists with this data.'
                self._addWarning(msg)
                self.Component.Message = msg

            elif response.status_code == 422:
                msg = 'Component data validation failed.'
                self._addError(msg)
                self.Component.Message = msg

            elif response.status_code == 500:
                msg = 'Server error. Please try again later.'
                self._addWarning(msg)
                self.Component.Message = msg

            else:
                msg = (f'Request failed with status code: '
                       f'{response.status_code}')
                self._addError(msg)
                self.Component.Message = msg

            return AddedComponentData

        except requests.exceptions.ConnectionError as e:
            msg = 'Cannot connect to server. Please check your connection.'
            self._addError(msg + f'\nFull Error: {str(e)}')
            self.Component.Message = msg

        except requests.exceptions.Timeout as e:
            msg = 'Request timeout. Server may be slow.'
            self._addError(msg + f'\nFull Error: {str(e)}')
            self.Component.Message = msg

        except requests.exceptions.RequestException as e:
            msg = f'Request error: {str(e)}'
            self._addError(msg)
            self.Component.Message = msg

        except Exception as e:
            msg = f'Unexpected error: {str(e)}'
            self._addError(msg)
            self.Component.Message = msg

        # Return empty results if there was an error
        AddedComponentData = Grasshopper.DataTree[System.Object]()
        return AddedComponentData
# ---------- end addcomponent ----------
log = Panel(addcomponent)
componentdata_7 = Data(addcomponent)

comments_notes_3 = Panel("Bake Components")
componentdata_8 = Data(componentdata_4)
bakecomponents = BakeComponents(Bake=Button(), ComponentData=flatten(componentdata_8))  # inputs Bake: Boolean, ComponentData: list of String
# ---------- bakecomponents: Python ----------
#! python3
# venv: DDU_CSC
# r: requests==2.31.0
# r: numpy==1.26.4
# r: scipy==1.13.0
# r: scikit-learn==1.4.2

# PYTHON STANDARD LIBRARY IMPORTS ---------------------------------------------
import json

# RHINO AND GH RELATED IMPORTS ------------------------------------------------
import System  # type: ignore[reportMissingImport] # NOQA
import Rhino  # type: ignore[reportMissingImport] # NOQA
import Grasshopper  # type: ignore[reportMissingImport] # NOQA
import rhinoscriptsyntax as rs  # type: ignore[reportMissingImport] # NOQA
import scriptcontext as sc  # type: ignore[reportMissingImport] # NOQA

# GHENV COMPONENT SETTINGS ----------------------------------------------------
ghenv.Component.Name = 'BakeComponents'  # type: ignore[reportUnedfinedVariable] # NOQA
ghenv.Component.NickName = 'BakeComponents'  # type: ignore[reportUnedfinedVariable] # NOQA
ghenv.Component.Category = 'DDU_CSC'  # type: ignore[reportUnedfinedVariable] # NOQA
ghenv.Component.SubCategory = '4 RhinoDoc Interaction'  # type: ignore[reportUnedfinedVariable] # NOQA


class CSC_BakeComponents(Grasshopper.Kernel.GH_ScriptInstance):
    """
    Author: Max Benjamin Eschenbach
    License: MIT License
    Version: 250828
    """

    def __init__(self):
        super().__init__()
        # initialize props
        self.Component = ghenv.Component  # type: ignore[reportUnedfinedVariable] # NOQA
        self.InputParams = self.Component.Params.Input
        self.OutputParams = self.Component.Params.Output

    def _addRemark(self, msg: str = ''):
        rml = self.Component.RuntimeMessageLevel.Remark
        self.AddRuntimeMessage(rml, msg)

    def _addWarning(self, msg: str = ''):
        rml = self.Component.RuntimeMessageLevel.Warning
        self.AddRuntimeMessage(rml, msg)

    def _addError(self, msg: str = ''):
        rml = self.Component.RuntimeMessageLevel.Error
        self.AddRuntimeMessage(rml, msg)

    def ComponentExtrusionProfile(
            self,
            json_comp: dict) -> Rhino.Geometry.Polyline:
        pl = Rhino.Geometry.Polyline()
        pts = [Rhino.Geometry.Point3d(pt[0], pt[1], 0.0)
               for pt in json_comp['geometry']['extrusion']['profile']]
        pl.AddRange(pts)
        return pl

    def ComponentExtrusion(
            self,
            json_comp: dict) -> Rhino.Geometry.Extrusion:
        pl = Rhino.Geometry.Polyline()
        pts = [Rhino.Geometry.Point3d(pt[0], pt[1], 0.0)
               for pt in json_comp['geometry']['extrusion']['profile']]
        pl.AddRange(pts)
        cxt = Rhino.Geometry.Extrusion.Create(
            pl.ToPolylineCurve(),
            Rhino.Geometry.Plane.WorldXY,
            json_comp['geometry']['extrusion']['height'],
            True)
        # move extrusion downwards half material
        # thickness to center it at the origin
        cxt.Translate(Rhino.Geometry.Vector3d(
            0, 0, json_comp['geometry']['extrusion']['height'] * -0.5))
        return cxt

    def ComponentMesh(self, json_comp: dict) -> Rhino.Geometry.Mesh:
        mesh = Rhino.Geometry.Mesh()
        vl = json_comp['geometry']['mesh']['v']
        fl = json_comp['geometry']['mesh']['f']
        [mesh.Vertices.Add(*v) for v in vl]
        [mesh.Faces.AddFace(*f) for f in fl]

        # Try to get mesh-specific colors first
        try:
            cl = json_comp['geometry']['mesh']['c']
            [mesh.VertexColors.Add(
                System.Drawing.Color.FromArgb(*c)) for c in cl]
        except KeyError:
            # Fallback: use component color for all vertices
            try:
                component_color = System.Drawing.Color.FromArgb(
                    255, *json_comp['color'])
                for _ in range(len(vl)):
                    mesh.VertexColors.Add(component_color)
            except (KeyError, TypeError):
                # If even component color fails, use a default gray
                default_color = System.Drawing.Color.Gray
                for _ in range(len(vl)):
                    mesh.VertexColors.Add(default_color)
                self._addWarning(
                    f'Mesh {json_comp["_id"]} using default gray color')

        mesh.RebuildNormals()
        mesh.UnifyNormals()
        mesh.Compact()
        return mesh

    def ComponentColor(self, json_comp: dict) -> System.Drawing.Color:
        return System.Drawing.Color.FromArgb(255, *json_comp['color'])

    def RunScript(self,
            Bake: bool,
            ComponentData: System.Collections.Generic.List[str]):
        # Initialize param descriptions (this has to be done in RunScript)
        self.InputParams[0].Description = 'Toggle to bake components to Rhino'
        self.InputParams[1].Description = 'Component data from FetchComponents'

        # Initialize output param descriptions
        if hasattr(self, 'OutputParams') and len(self.OutputParams) > 0:
            self.OutputParams[0].Description = 'Baking status message'

        # set document
        sc.doc = Rhino.RhinoDoc.ActiveDoc

        # bake toggle
        if Bake:
            if not ComponentData or len(ComponentData) == 0:
                msg = ('No component data provided. Please connect '
                       'FetchComponent output.')
                self._addWarning(msg)
                self.Component.Message = msg
                return

            self.Component.Message = 'Baking components...'
            baked_count = 0

            for i, cd in enumerate(ComponentData):
                try:
                    # create path (not used in baking but kept for consistency)
                    _ = Grasshopper.Kernel.Data.GH_Path(i)
                    # load json component
                    json_comp = json.loads(cd)
                    # extract ID
                    comp_id = json_comp['_id']

                    # get insertion plane
                    try:
                        # try to extract insertion frame
                        iframe = json_comp['iframe']
                        iplane = Rhino.Geometry.Plane(
                            Rhino.Geometry.Point3d(*iframe['o']),
                            Rhino.Geometry.Vector3d(*iframe['x']),
                            Rhino.Geometry.Vector3d(*iframe['y']),
                        )
                    except KeyError:
                        # if there is no respective key, create world xy plane
                        iplane = Rhino.Geometry.Plane.WorldXY

                    xform = Rhino.Geometry.Transform.PlaneToPlane(
                        Rhino.Geometry.Plane.WorldXY,
                        iplane)

                    # create component geometry
                    geo_ids = []
                    for key in sorted(json_comp['geometry'].keys()):
                        if key == 'extrusion':
                            xtr = self.ComponentExtrusion(json_comp)
                            xtr.Transform(xform)
                            geo_ids.append(sc.doc.Objects.Add(xtr))
                        elif key == 'mesh':
                            mesh = self.ComponentMesh(json_comp)
                            # transform to iframe
                            mesh.Transform(xform)
                            geo_ids.append(sc.doc.Objects.Add(mesh))
                        else:
                            msg = (f'Missing implementation for geometry '
                                   f'of type \'{key}\'!')
                            self._addWarning(msg)
                            self.Component.Message = msg
                            continue

                    # add objects to document
                    # create layers if they are not present
                    lay_parent = 'CSC_COMPONENTS'
                    lay_name = comp_id
                    layer = '::'.join([lay_parent, lay_name])
                    if not rs.IsLayer(lay_parent):
                        rs.AddLayer(lay_parent)
                    if not rs.IsLayer(layer):
                        rs.AddLayer(layer, self.ComponentColor(json_comp))

                    # set layer and add component data as user strings
                    for gid in geo_ids:
                        rs.ObjectLayer(gid, layer)
                        # set component data as user string
                        rs.SetUserText(
                            gid,
                            'csc_component',
                            ComponentData[i])

                    # create group
                    if len(geo_ids) > 1:
                        _ = sc.doc.Groups.Add(
                            comp_id,
                            geo_ids)

                    baked_count += 1
                    self._addRemark(
                        f'Successfully baked component {comp_id}')

                except json.JSONDecodeError as e:
                    msg = f'Failed to parse component data: {str(e)}'
                    self._addError(msg)
                    self.Component.Message = msg
                except Exception as e:
                    msg = f'Error baking component: {str(e)}'
                    self._addError(msg)
                    self.Component.Message = msg

            # Update success message
            if baked_count > 0:
                self.Component.Message = f'Baked {baked_count} component(s)'
                self._addRemark(
                    f'Successfully baked {baked_count} components')
            else:
                self.Component.Message = 'No components were baked'
                self._addWarning('No components were baked')
        else:
            self.Component.Message = 'Bake toggle is off'
            self._addRemark('Bake toggle is off - no components baked')

        # Restore original document context if needed
        # Note: ghdoc was undefined in original code
# ---------- end bakecomponents ----------

# ----
# comments & notes: Filter Components that were already fetched from the Database
mindimensionx_2 = Slider(0, range=-0.1..2000)
maxdimensiony_2 = Slider(0, range=0..2000)
maxdimensionx_2 = Slider(0, range=0..2000)
maxdimensionz_2 = Slider(0, range=0..500)
mindimensiony_2 = Slider(0, range=0..2000)
mindimensionz_2 = Slider(0, range=0..500)
fragment_2 = ValueList({"Any": , "Only fragments": True, "Only non-fragmnents": False}, selected="Any")
complexity_3 = ValueList({"Any complexity": , "0", "1", "2", "3"}, selected="Any complexity")
material_3 = ValueList({"Any material": , "corian", "concrete", "timber", "aluminium", "steel"}, selected="Any material")
type_3 = ValueList({"All types": , "sheet", "rubble", "beam", "column", "profile"}, selected="All types")
componentdata_9 = Data(componentdata_5)
filtercomponents = FilterComponents(
    Type=type_3,
    Material=material_3,
    Complexity=complexity_3,
    Fragment=fragment_2,
    MinDimensionX=mindimensionx_2,
    MaxDimensionX=maxdimensionx_2,
    MinDimensionY=mindimensiony_2,
    MaxDimensionY=maxdimensiony_2,
    MinDimensionZ=mindimensionz_2,
    MaxDimensionZ=maxdimensionz_2,
    ComponentData=componentdata_9)  # -> FilterDescription, ComponentData; inputs Type: String, Material: String, Complexity: Int32, Fragment: Boolean, MinDimensionX: Double, MaxDimensionX: Double, MinDimensionY: Double, MaxDimensionY: Double, MinDimensionZ: Double, MaxDimensionZ: Double, ComponentData: tree of String
# ---------- filtercomponents: Python ----------
#! python3
# venv: DDU_CSC
# r: requests==2.31.0
# r: numpy==1.26.4
# r: scipy==1.13.0
# r: scikit-learn==1.4.2

# PYTHON STANDARD LIBRARY IMPORTS ---------------------------------------------
import json

# RHINO AND GH RELATED IMPORTS ------------------------------------------------
import System  # type: ignore[reportMissingImport] # NOQA
import Grasshopper  # type: ignore[reportMissingImport] # NOQA
import Rhino  # type: ignore[reportMissingImport] # NOQA

# GHENV COMPONENT SETTINGS ----------------------------------------------------
ghenv.Component.Name = 'FilterComponents'  # type: ignore[reportUnedfinedVariable] # NOQA
ghenv.Component.NickName = 'FilterComponents'  # type: ignore[reportUnedfinedVariable] # NOQA
ghenv.Component.Category = 'DDU_CSC'  # type: ignore[reportUnedfinedVariable] # NOQA
ghenv.Component.SubCategory = '2 Catalogue Interface'  # type: ignore[reportUnedfinedVariable] # NOQA


class CSC_FilterComponents(Grasshopper.Kernel.GH_ScriptInstance):
    """
    Author: Max Benjamin Eschenbach
    License: MIT License
    Version: 250825
    """

    def __init__(self):
        super().__init__()
        # initialize props
        self.Component = ghenv.Component  # type: ignore[reportUnedfinedVariable] # NOQA
        self.InputParams = self.Component.Params.Input
        self.OutputParams = self.Component.Params.Output

    def _addRemark(self, msg: str = ''):
        rml = self.Component.RuntimeMessageLevel.Remark
        self.AddRuntimeMessage(rml, msg)

    def _addWarning(self, msg: str = ''):
        rml = self.Component.RuntimeMessageLevel.Warning
        self.AddRuntimeMessage(rml, msg)

    def _addError(self, msg: str = ''):
        rml = self.Component.RuntimeMessageLevel.Error
        self.AddRuntimeMessage(rml, msg)

    def apply_filters(self, component_data: dict, filter_params: dict) -> bool:
        """
        Apply all filters to a single component and return True if it passes.
        """

        # Type filter
        if filter_params.get('type') and filter_params['type'].strip():
            if (component_data.get('type', '').lower() !=
                    filter_params['type'].lower()):
                return False

        # Material filter
        if filter_params.get('material') and filter_params['material'].strip():
            if (component_data.get('material', '').lower() !=
                    filter_params['material'].lower()):
                return False

        # Complexity filter
        if filter_params.get('complexity') is not None:
            if component_data.get('complexity') != filter_params['complexity']:
                return False

        # Fragment filter
        if filter_params.get('fragment') is not None:
            if component_data.get('fragment') != filter_params['fragment']:
                return False

        # Bounding box filters
        bbx = component_data.get('bbx')
        if (bbx and isinstance(bbx, list) and len(bbx) >= 2):
            bbx_min = bbx[0]
            bbx_max = bbx[1]

            # X dimension filters
            if filter_params.get('min_x') is not None:
                if bbx_max[0] < filter_params['min_x']:
                    return False
            if filter_params.get('max_x') is not None:
                if bbx_min[0] > filter_params['max_x']:
                    return False

            # Y dimension filters
            if filter_params.get('min_y') is not None:
                if bbx_max[1] < filter_params['min_y']:
                    return False
            if filter_params.get('max_y') is not None:
                if bbx_min[1] > filter_params['max_y']:
                    return False

            # Z dimension filters
            if filter_params.get('min_z') is not None:
                if bbx_max[2] < filter_params['min_z']:
                    return False
            if filter_params.get('max_z') is not None:
                if bbx_min[2] > filter_params['max_z']:
                    return False

        return True

    def generate_filter_description(self, filter_params: dict) -> str:
        """Generates a human-readable description of the applied filters."""
        description = []
        if filter_params.get('type'):
            description.append(f'\nType: {filter_params["type"]}')
        if filter_params.get('material'):
            description.append(f'\nMaterial: {filter_params["material"]}')
        if filter_params.get('complexity') is not None:
            description.append(f'\nComplexity: {filter_params["complexity"]}')
        if filter_params.get('fragment') is not None:
            description.append(f'\nFragment: {filter_params["fragment"]}')

        # Handle bounding box filters with detailed information
        bbx_filters = []
        if filter_params.get('min_x') is not None:
            bbx_filters.append(f'\nX >= {filter_params["min_x"]:.2f}')
        if filter_params.get('max_x') is not None:
            bbx_filters.append(f'\nX <= {filter_params["max_x"]:.2f}')
        if filter_params.get('min_y') is not None:
            bbx_filters.append(f'\nY >= {filter_params["min_y"]:.2f}')
        if filter_params.get('max_y') is not None:
            bbx_filters.append(f'\nY <= {filter_params["max_y"]:.2f}')
        if filter_params.get('min_z') is not None:
            bbx_filters.append(f'\nZ >= {filter_params["min_z"]:.2f}')
        if filter_params.get('max_z') is not None:
            bbx_filters.append(f'\nZ <= {filter_params["max_z"]:.2f}')

        if bbx_filters:
            description.append(f'\nBounding Box: {", ".join(bbx_filters)}')

        return f'Applied filters: {", ".join(description)}'

    def RunScript(self,
            Type: str,
            Material: str,
            Complexity: int,
            Fragment: bool,
            MinDimensionX: float,
            MaxDimensionX: float,
            MinDimensionY: float,
            MaxDimensionY: float,
            MinDimensionZ: float,
            MaxDimensionZ: float,
            ComponentData: Grasshopper.DataTree[str]):

        # Initialize param descriptions (this has to be done in RunScript)
        self.InputParams[0].Description = (
            'Component type filter (e.g., "beam", "slab", "column")'
        )
        self.InputParams[1].Description = (
            'Material type filter (e.g., "concrete", "steel", "wood")'
        )
        self.InputParams[2].Description = (
            'Complexity level filter (0-3, where 0=simple, 3=complex)'
        )
        self.InputParams[3].Description = (
            'Fragment status filter (True for fragments, False for complete)'
        )
        self.InputParams[4].Description = (
            'Minimum X dimension filter (bounding box)'
        )
        self.InputParams[5].Description = (
            'Maximum X dimension filter (bounding box)'
        )
        self.InputParams[6].Description = (
            'Minimum Y dimension filter (bounding box)'
        )
        self.InputParams[7].Description = (
            'Maximum Y dimension filter (bounding box)'
        )
        self.InputParams[8].Description = (
            'Minimum Z dimension filter (bounding box)'
        )
        self.InputParams[9].Description = (
            'Maximum Z dimension filter (bounding box)'
        )
        self.InputParams[10].Description = (
            'Component data to filter (from FetchComponents or similar)'
        )

        # Initialize output param descriptions
        self.OutputParams[0].Description = (
            'Human-readable description of the applied filters'
        )
        self.OutputParams[1].Description = (
            'Filtered ComponentData as JSON strings. Use '
            '\'DisassembleComponent\' to access the individual fields '
            'ready for Grasshopper'
        )

        # Validate input data
        if not ComponentData or ComponentData.DataCount == 0:
            msg = ('No component data provided. '
                   'Please connect ComponentData input.')
            self._addWarning(msg)
            self.Component.Message = msg

            # Return empty results
            FilterDescription = Grasshopper.DataTree[System.Object]()
            FilteredComponentData = Grasshopper.DataTree[System.Object]()
            __Results = (FilterDescription, FilteredComponentData)
            return __Results

        try:
            self.Component.Message = 'Building filter parameters...'

            # Build filter parameters dictionary
            filter_params = {}

            # Add type filter if provided
            if Type and Type.strip() and Type.lower() != 'alltypes':
                filter_params['type'] = Type.strip()

            # Add material filter if provided
            if (Material and Material.strip() and
                    Material.lower() != 'allmaterials'):
                filter_params['material'] = Material.strip()

            # Add complexity filter if provided
            if Complexity is not None:
                filter_params['complexity'] = Complexity

            # Add fragment filter if provided
            if Fragment is not None:
                filter_params['fragment'] = Fragment

            # Add bounding box filters if provided
            if MinDimensionX is not None and MinDimensionX != 0.0:
                filter_params['min_x'] = MinDimensionX
            if MaxDimensionX is not None and MaxDimensionX != 0.0:
                filter_params['max_x'] = MaxDimensionX
            if MinDimensionY is not None and MinDimensionY != 0.0:
                filter_params['min_y'] = MinDimensionY
            if MaxDimensionY is not None and MaxDimensionY != 0.0:
                filter_params['max_y'] = MaxDimensionY
            if MinDimensionZ is not None and MinDimensionZ != 0.0:
                filter_params['min_z'] = MinDimensionZ
            if MaxDimensionZ is not None and MaxDimensionZ != 0.0:
                filter_params['max_z'] = MaxDimensionZ

            # Generate human-readable filter description
            filter_description = self.generate_filter_description(
                filter_params
            )

            self.Component.Message = 'Filtering components...'

            # Set up output trees and results tuple
            FilterDescription = Grasshopper.DataTree[System.Object]()
            FilteredComponentData = Grasshopper.DataTree[System.Object]()
            __Results = (FilterDescription, FilteredComponentData)

            # Add filter description to the filter query output
            FilterDescription.Add(
                filter_description,
                Grasshopper.Kernel.Data.GH_Path(0))

            # Filter components
            filtered_count = 0
            total_count = 0

            # Loop over all branches
            for i in range(ComponentData.BranchCount):
                ghp = ComponentData.Paths[i]
                for j, comp in enumerate(ComponentData.Branches[i]):
                    total_count += 1
                    try:
                        # Load component data
                        component_data = json.loads(comp)

                        # Apply filters
                        if self.apply_filters(component_data, filter_params):
                            # Component passes all filters, add to output
                            FilteredComponentData.Add(comp, ghp)
                            filtered_count += 1

                    except json.JSONDecodeError as e:
                        msg = f'Failed to parse component data: {str(e)}'
                        self._addWarning(msg)
                        continue
                    except Exception as e:
                        msg = f'Error processing component: {str(e)}'
                        self._addWarning(msg)
                        continue

            # Update component message
            if filtered_count == 0:
                msg = 'No components match the applied filters.'
                self.Component.Message = msg
                self._addWarning(msg)
            else:
                msg = f'Filtered {filtered_count} of {total_count} components.'
                self.Component.Message = msg
                self._addRemark(
                    f'Successfully filtered {filtered_count} components '
                    f'from {total_count} total components'
                )

            return __Results

        except Exception as e:
            msg = f'Unexpected error during filtering: {str(e)}'
            self._addError(msg)
            self.Component.Message = msg

            # Return empty results if there was an error
            FilterDescription = Grasshopper.DataTree[System.Object]()
            FilteredComponentData = Grasshopper.DataTree[System.Object]()
            __Results = (FilterDescription, FilteredComponentData)
            return __Results
# ---------- end filtercomponents ----------
log_2 = Panel(filtercomponents.FilterDescription)
componentdata_10 = Data(filtercomponents.ComponentData)

arrange_upright = BooleanToggle(False)
componentdata_11 = Data(componentdata_10)
grid_dim_y = Slider(1300, range=0..4000)
insertionpoint = Point(Point(0, 0, 0))
grid_dim_x = Slider(1300, range=0..4000)
componentdata_12 = Data(componentdata_11)
grid_dim_x_2 = Data(grid_dim_x)
grid_dim_y_2 = Data(grid_dim_y)
lng = ListLength(List=flatten(componentdata_12))
dom = ConstructDomain(DomainStart=0, DomainEnd=grid_dim_x_2)
dom_2 = ConstructDomain(DomainStart=0, DomainEnd=grid_dim_y_2)
sqrt = SquareRoot(Value=lng)
round = Round(Number=sqrt)  # -> Nearest, Floor, Ceiling
comments_notes_4 = Panel("Create Arrangement")
rectangle = Rectangle(Plane=PlaneXY(0, 0, 0), XSize=dom, YSize=dom_2, Radius=0)  # -> Rectangle, Length
area = Area(Geometry=rectangle.Rectangle)  # -> Area, Centroid
arrrec = RectangularArray(Geometry=rectangle.Rectangle, Cell=rectangle.Rectangle, XCount=round.Ceiling, YCount=round.Ceiling)  # -> Geometry, Transform
xy = XYPlane(Origin=area.Centroid)
arrange_upright_2 = Data(arrange_upright)
rotate = Rotate(Geometry=xy, Angle="0.5 * Pi", Plane=xy)  # -> Geometry, Transform
insertionpoint_2 = Point(insertionpoint)
filter = StreamFilter(Gate=arrange_upright_2, Stream0=xy, Stream1=rotate.Geometry)
split = SplitList(List=arrrec.Transform, Index=lng)  # -> ListA, ListB
xy_2 = XYPlane(Origin=insertionpoint_2)
split_2 = SplitList(List=arrrec.Geometry, Index=lng)  # -> ListA, ListB
componentdata_13 = Data(componentdata_11)
unflatten = UnflattenTree(Tree=split.ListA, Guide=componentdata_13)
unflatten_2 = UnflattenTree(Tree=split_2.ListA, Guide=componentdata_13)
transform = Transform(Geometry=filter, Transform=unflatten)
orient = Orient(Geometry=xy_2, Source=xy_2, Target=transform)  # -> Geometry, Transform
cpl = CustomPreviewLineweights(Geometry=flatten(unflatten_2), Color=ColourSwatch(SwatchColor=RGB(0, 0, 0)), Thickness=Slider(1, range=0..10))  # inputs Geometry: list, Color: list of Color
# ---------- cpl: Python ----------
"""
Custom Preview with Lineweights.
    Inputs:
        Geometry: The geometry to preview. {list, GeometryBase}
        Color: The preview color per geometry item. {list, System.Drawing.Color}
        Thickness: The thickness of the wire display. {item, int}
    Remarks:
        Author: Max Eschenbach
        License: MIT License
        Version: 231122
"""

# PYTHON STANDARD LIBRARY IMPORTS
from __future__ import division, print_function
import json
import math

# GHPYTHON SDK IMPORTS
from ghpythonlib.componentbase import executingcomponent as component
import Grasshopper, GhPython
import System
import Rhino
import rhinoscriptsyntax as rs

# GHENV COMPONENT SETTINGS
ghenv.Component.Name = "CustomPreviewLineweights"
ghenv.Component.NickName = "CPL"
ghenv.Component.Category = "FindersKeepers"
ghenv.Component.SubCategory = "4 Visualisation"

class CustomPreviewLineweights(component):
    
    def __init__(self):
        super(CustomPreviewLineweights, self).__init__()
        
        self.draw_lines = System.Collections.Generic.List[Rhino.Geometry.Line]()
        self.draw_curves = []
        self.draw_color = []
        self.draw_thickness = None
    
    
    def RunScript(self, Geometry, Color, Thickness):
        
        self.draw_lines = System.Collections.Generic.List[Rhino.Geometry.Line]()
        self.draw_curves = []
        self.draw_color = None
        self.draw_thickness = None
        
        if not Color:
            self.draw_color = [System.Drawing.Color.Black]
        else:
            self.draw_color = Color
        
        if not Thickness:
            self.draw_thickness = 1
        else:
            self.draw_thickness = Thickness
        
        if Geometry:
            for i, geo in enumerate(Geometry):
                if isinstance(geo, Rhino.Geometry.Line):
                    self.draw_curves.Add(Rhino.Geometry.LineCurve(geo))
                elif isinstance(geo, Rhino.Geometry.Curve):
                    self.draw_curves.append(geo)
                elif isinstance(geo, Rhino.Geometry.LineCurve):
                    self.draw_curves.Add(geo)
                elif isinstance(geo, Rhino.Geometry.Rectangle3d):
                    self.draw_curves.append(geo.ToNurbsCurve())
                else:
                    print(type(geo))
    
    
    def get_ClippingBox(self):
        return Rhino.Geometry.BoundingBox()
    
    
    def DrawViewportWires(self, arg):
        try:
            for i, crv in enumerate(self.draw_curves):
                if i >= len(self.draw_color):
                    col = self.draw_color[-1]
                else:
                    col = self.draw_color[i]
                if not col:
                    rml = self.RuntimeMessageLevel.Remark
                    self.AddRuntimeMessage(rml, 'Expected Color, got NoneType! '
                                                 'Substituting with Black...')
                    col = System.Drawing.Color.Black
                arg.Display.DrawCurve(crv, col, self.draw_thickness)
        except Exception, e:
            rml = self.RuntimeMessageLevel.Warning
            self.AddRuntimeMessage(rml, 'Error while drawing Preview!')
            # System.Windows.Forms.MessageBox.Show(
            #                     str(e),
            #                     'Error while drawing preview!')
# ---------- end cpl ----------
cellplanes = Data(orient.Geometry)
cells = Data(unflatten_2)
xform = Data(orient.Transform)

# ----
# comments & notes: Transform (Move, Rotate...) Components by modifying the iframe attribute
componentdata_14 = Data(componentdata_10)
xform_2 = Data(xform)
transformcomponent = TransformComponent(ComponentData=componentdata_14, XForm=xform_2)  # -> out, XComponentData; inputs ComponentData: String, XForm: Transform
# ---------- transformcomponent: Python ----------
#! python3
# venv: DDU_CSC
# r: requests==2.31.0
# r: numpy==1.26.4
# r: scipy==1.13.0
# r: scikit-learn==1.4.2

# PYTHON STANDARD LIBRARY IMPORTS ---------------------------------------------
import json

# RHINO AND GH RELATED IMPORTS ------------------------------------------------
import System  # type: ignore[reportMissingImport] # NOQA
import Rhino  # type: ignore[reportMissingImport] # NOQA
import Grasshopper  # type: ignore[reportMissingImport] # NOQA

# GHENV COMPONENT SETTINGS ----------------------------------------------------
ghenv.Component.Name = 'TransformComponent'  # type: ignore[reportUnedfinedVariable] # NOQA
ghenv.Component.NickName = 'TransformComponent'  # type: ignore[reportUnedfinedVariable] # NOQA
ghenv.Component.Category = 'DDU_CSC'  # type: ignore[reportUnedfinedVariable] # NOQA
ghenv.Component.SubCategory = '3 Component Operations'  # type: ignore[reportUnedfinedVariable] # NOQA


class CSC_TransformComponent(Grasshopper.Kernel.GH_ScriptInstance):
    """
    Author: Max Benjamin Eschenbach
    License: MIT License
    Version: 250822
    Description: Transforms component insertion frames using Rhino transforms
    """

    def __init__(self):
        super().__init__()
        # initialize props
        self.Component = ghenv.Component  # type: ignore[reportUnedfinedVariable] # NOQA
        self.InputParams = self.Component.Params.Input
        self.OutputParams = self.Component.Params.Output

    def _addRemark(self, msg: str = ''):
        """Add a remark message to the component runtime messages."""
        rml = self.Component.RuntimeMessageLevel.Remark
        self.AddRuntimeMessage(rml, msg)

    def _addWarning(self, msg: str = ''):
        """Add a warning message to the component runtime messages."""
        rml = self.Component.RuntimeMessageLevel.Warning
        self.AddRuntimeMessage(rml, msg)

    def _addError(self, msg: str = ''):
        """Add an error message to the component runtime messages."""
        rml = self.Component.RuntimeMessageLevel.Error
        self.AddRuntimeMessage(rml, msg)

    def PlaneToFrameDict(self, plane: Rhino.Geometry.Plane) -> dict:
        """
        Convert a Rhino plane to a frame dictionary format.

        This method converts the plane's origin and axis vectors to the format
        expected by the component system for insertion frames.

        Args:
            plane: Rhino.Geometry.Plane object

        Returns:
            Dictionary with 'o', 'x', 'y', 'z' keys containing coordinate lists
        """
        iframe = {
            'o': [plane.OriginX, plane.OriginY, plane.OriginZ],
            'x': [plane.XAxis.X, plane.XAxis.Y, plane.XAxis.Z],
            'y': [plane.YAxis.X, plane.YAxis.Y, plane.YAxis.Z],
            'z': [plane.ZAxis.X, plane.ZAxis.Y, plane.ZAxis.Z]
        }
        return iframe

    def RunScript(self, ComponentData: str, XForm: Rhino.Geometry.Transform):
        """
        Main execution method for transforming component insertion frames.

        This method takes a component JSON string and a Rhino transform,
        applies the transform to the component's insertion frame, and
        returns the updated component data as a JSON string.

        Args:
            ComponentData: JSON string containing component data
            XForm: Rhino transform to apply to the insertion frame

        Returns:
            JSON string of the transformed component data
        """
        # Initialize param descriptions (this has to be done in RunScript)
        self.InputParams[0].Description = (
            'Component data as JSON string from previous components.'
        )
        self.InputParams[1].Description = (
            'Rhino transform to apply to the component insertion frame.'
        )

        # Initialize output param descriptions
        self.OutputParams[0].Description = (
            'Transformed component data as JSON string'
        )

        # set up output trees and results tuple
        XComponentData = System.Collections.Generic.List[System.Object]()

        # Validate input parameters
        if not ComponentData:
            msg = 'Input ComponentData failed to collect data!'
            self._addWarning(msg)
            self.Component.Message = msg
            return XComponentData

        if not XForm:
            msg = 'Input XForm failed to collect data!'
            self._addWarning(msg)
            self.Component.Message = msg
            return XComponentData

        try:
            # Load and parse component JSON data
            jcomp = json.loads(ComponentData)

            # Process insertion frame
            try:
                # Try to extract existing insertion frame from component
                iframe = jcomp['iframe']
                iplane = Rhino.Geometry.Plane(
                    Rhino.Geometry.Point3d(*iframe['o']),
                    Rhino.Geometry.Vector3d(*iframe['x']),
                    Rhino.Geometry.Vector3d(*iframe['y']),
                )
                self._addRemark(
                    'Using existing insertion frame from component'
                )
            except KeyError:
                # If there is no insertion frame,
                # create world XY plane as default
                iplane = Rhino.Geometry.Plane.WorldXY
                self._addRemark(
                    'No insertion frame found, using WorldXY plane'
                )

            # Apply the input transform to the insertion frame plane
            iplane.Transform(XForm)

            # Replace the insertion frame in the component data
            # with the transformed one
            jcomp['iframe'] = self.PlaneToFrameDict(iplane)

            # Convert back to JSON string for output
            XComponentData = json.dumps(jcomp)

            # Update component message to indicate success
            self.Component.Message = (
                'Component insertion frame transformed successfully'
            )
            self._addRemark(
                'Successfully transformed component insertion frame'
            )

            return XComponentData

        except json.JSONDecodeError as e:
            msg = f'Failed to parse component JSON data: {str(e)}'
            self._addError(msg)
            self.Component.Message = msg
            return XComponentData

        except Exception as e:
            msg = f'Unexpected error during transformation: {str(e)}'
            self._addError(msg)
            self.Component.Message = msg
            return XComponentData
# ---------- end transformcomponent ----------
output_stream = Panel(transformcomponent.out)
componentdata_15 = Data(transformcomponent.XComponentData)

# ----
# comments & notes: Disassemble Component into its elements
componentdata_16 = Data(componentdata_15)
disassemblecomponent = DisassembleComponent(ComponentData=componentdata_16)  # -> ID, Type, Material, PrimitiveGeometry, Color, BoundingBox, Descriptors; inputs ComponentData: tree of String
# ---------- disassemblecomponent: Python ----------
#! python3
# venv: DDU_CSC
# r: requests==2.31.0
# r: numpy==1.26.4
# r: scipy==1.13.0
# r: scikit-learn==1.4.2

# PYTHON STANDARD LIBRARY IMPORTS ---------------------------------------------
import json

# RHINO AND GH RELATED IMPORTS ------------------------------------------------
import System  # type: ignore[reportMissingImport] # NOQA
import Rhino  # type: ignore[reportMissingImport] # NOQA
import Grasshopper  # type: ignore[reportMissingImport] # NOQA

# GHENV COMPONENT SETTINGS ----------------------------------------------------
ghenv.Component.Name = 'DisassembleComponent'  # type: ignore[reportUnedfinedVariable] # NOQA
ghenv.Component.NickName = 'DisassembleComponent'  # type: ignore[reportUnedfinedVariable] # NOQA
ghenv.Component.Category = 'DDU_CSC'  # type: ignore[reportUnedfinedVariable] # NOQA
ghenv.Component.SubCategory = '3 Component Operations'  # type: ignore[reportUnedfinedVariable] # NOQA


class CSC_DisassembleComponent(Grasshopper.Kernel.GH_ScriptInstance):
    """
    Author: Max Benjamin Eschenbach
    License: MIT License
    Version: 250828
    """

    def __init__(self):
        super().__init__()
        # initialize props
        self.Component = ghenv.Component  # type: ignore[reportUnedfinedVariable] # NOQA
        self.InputParams = self.Component.Params.Input
        self.OutputParams = self.Component.Params.Output

    def _addRemark(self, msg: str = ''):
        rml = self.Component.RuntimeMessageLevel.Remark
        self.AddRuntimeMessage(rml, msg)

    def _addWarning(self, msg: str = ''):
        rml = self.Component.RuntimeMessageLevel.Warning
        self.AddRuntimeMessage(rml, msg)

    def _addError(self, msg: str = ''):
        rml = self.Component.RuntimeMessageLevel.Error
        self.AddRuntimeMessage(rml, msg)

    def ComponentExtrusionProfile(
            self,
            json_comp: dict) -> Rhino.Geometry.Polyline:
        pl = Rhino.Geometry.Polyline()
        pts = [Rhino.Geometry.Point3d(pt[0], pt[1], 0.0)
               for pt in json_comp['geometry']['extrusion']['profile']]
        pl.AddRange(pts)
        return pl

    def ComponentExtrusion(
            self,
            json_comp: dict) -> Rhino.Geometry.Extrusion:
        pl = Rhino.Geometry.Polyline()
        pts = [Rhino.Geometry.Point3d(pt[0], pt[1], 0.0)
               for pt in json_comp['geometry']['extrusion']['profile']]
        pl.AddRange(pts)
        cxt = Rhino.Geometry.Extrusion.Create(
            pl.ToPolylineCurve(),
            Rhino.Geometry.Plane.WorldXY,
            json_comp['geometry']['extrusion']['height'],
            True)
        # move extrusion downwards half material
        # thickness to center it at the origin
        cxt.Translate(Rhino.Geometry.Vector3d(
            0, 0, json_comp['geometry']['extrusion']['height'] * -0.5))
        return cxt

    def ComponentMesh(self, json_comp: dict) -> Rhino.Geometry.Mesh:
        mesh = Rhino.Geometry.Mesh()
        vl = json_comp['geometry']['mesh']['v']
        fl = json_comp['geometry']['mesh']['f']
        [mesh.Vertices.Add(*v) for v in vl]
        [mesh.Faces.AddFace(*f) for f in fl]
        # Try to get mesh-specific colors first
        try:
            cl = json_comp['geometry']['mesh']['c']
            [mesh.VertexColors.Add(
                System.Drawing.Color.FromArgb(*c)) for c in cl]
        except KeyError:
            # Fallback: use component color for all vertices
            try:
                component_color = System.Drawing.Color.FromArgb(
                    255, *json_comp['color'])
                for _ in range(len(vl)):
                    mesh.VertexColors.Add(component_color)
            except (KeyError, TypeError):
                # If even component color fails, use a default gray
                default_color = System.Drawing.Color.Gray
                for _ in range(len(vl)):
                    mesh.VertexColors.Add(default_color)
                self._addWarning(
                    f'Mesh {json_comp["_id"]} using default gray color')
        mesh.RebuildNormals()
        mesh.UnifyNormals()
        mesh.Compact()
        return mesh

    def ComponentColor(self, json_comp: dict) -> System.Drawing.Color:
        return System.Drawing.Color.FromArgb(255, *json_comp['color'])

    def ComponentBoundingBox(
            self,
            json_comp: dict) -> Rhino.Geometry.BoundingBox:
        xtx = json_comp['bbx'][0]
        xty = json_comp['bbx'][1]
        xtz = json_comp['bbx'][2]
        Rhino.Geometry.BoundingBox()
        bbx = Rhino.Geometry.BoundingBox(
            -xtx * 0.5,
            -xty * 0.5,
            -xtz * 0.5,
            xtx * 0.5,
            xty * 0.5,
            xtz * 0.5
        )
        return bbx

    def RunScript(self, ComponentData: Grasshopper.DataTree[str]):
        # Initialize param descriptions (this has to be done in RunScript)
        self.InputParams[0].Description = (
            'The ComponentData that was fetched from the server as JSON.')

        # Initialize output param descriptions
        self.OutputParams[0].Description = 'Component ID (GUID)'
        self.OutputParams[1].Description = (
            'Component type (sheet, beam, slab, etc.)'
        )
        self.OutputParams[2].Description = 'Component material'
        self.OutputParams[3].Description = (
            'Rhino geometry objects (extrusion, mesh, polyline)'
        )
        self.OutputParams[4].Description = (
            'Component color as System.Drawing.Color'
        )
        self.OutputParams[5].Description = (
            'Component bounding box as Rhino.Geometry.BoundingBox'
        )
        self.OutputParams[6].Description = (
            'Component descriptors/metadata as JSON string'
        )

        try:
            # set up output trees and results tuple
            ID = Grasshopper.DataTree[System.Object]()
            Type = Grasshopper.DataTree[System.Object]()
            Material = Grasshopper.DataTree[System.Object]()
            PrimitiveGeometry = Grasshopper.DataTree[System.Object]()
            Color = Grasshopper.DataTree[System.Object]()
            BoundingBox = Grasshopper.DataTree[System.Object]()
            Descriptors = Grasshopper.DataTree[System.Object]()
            __Results = (
                ID,
                Type,
                Material,
                PrimitiveGeometry,
                Color,
                BoundingBox,
                Descriptors)

            # Validate input
            if not ComponentData or ComponentData.DataCount == 0:
                msg = ('No component data provided. Please connect '
                       'FetchComponent output.')
                self._addWarning(msg)
                self.Component.Message = msg
                return __Results

            self.Component.Message = 'Disassembling components...'

            # loop over all branches
            for i in range(ComponentData.BranchCount):
                for j, comp in enumerate(ComponentData.Branches[i]):
                    try:
                        json_comp = json.loads(comp)
                        # create datatree path
                        ghp = ComponentData.Paths[i]
                        # add directly available metadata to the
                        # respective datatrees
                        ID.Add(json_comp['_id'], ghp)
                        Type.Add(json_comp['type'], ghp)
                        Material.Add(json_comp['material'], ghp)

                        # process insertion frame
                        try:
                            iframe = json_comp['iframe']
                            iplane = Rhino.Geometry.Plane(
                                Rhino.Geometry.Point3d(*iframe['o']),
                                Rhino.Geometry.Vector3d(*iframe['x']),
                                Rhino.Geometry.Vector3d(*iframe['y']),
                            )
                        except KeyError:
                            iplane = Rhino.Geometry.Plane.WorldXY

                        xform = Rhino.Geometry.Transform.PlaneToPlane(
                            Rhino.Geometry.Plane.WorldXY,
                            iplane)

                        # treat geometry key in a special way because
                        # it may hold multiple geometry types
                        for key in sorted(json_comp['geometry'].keys()):
                            component_geometry = None
                            if key == 'extrusion':
                                xtr = self.ComponentExtrusion(json_comp)
                                # transform to iframe
                                xtr.Transform(xform)
                                # set geometry
                                component_geometry = xtr
                            elif key == 'mesh':
                                mesh = self.ComponentMesh(json_comp)
                                # transform to iframe
                                mesh.Transform(xform)
                                # set geometry
                                component_geometry = mesh
                            elif key == 'polyline':
                                pl = self.ComponentExtrusionProfile(json_comp)
                                # transform to iframe
                                pl.Transform(xform)
                                # set geometry
                                component_geometry = pl
                            else:
                                msg = (f'Missing implementation for geometry '
                                       f'of type \'{key}\'!')
                                self._addWarning(msg)
                                self.Component.Message = msg
                            # set user string
                            component_geometry.SetUserString(
                                'csc_component',
                                comp
                            )
                            # add to datatree
                            PrimitiveGeometry.Add(component_geometry, ghp)

                        # create system color from rgb values
                        color = self.ComponentColor(json_comp)
                        Color.Add(color, ghp)

                        # construct boundingbox
                        bbx = self.ComponentBoundingBox(json_comp)

                        # apply iframe transform
                        bbx.Transform(xform)
                        BoundingBox.Add(bbx, ghp)

                        # add descriptors
                        try:
                            descriptors = json_comp.get('descriptors', {})
                            Descriptors.Add(json.dumps(descriptors), ghp)
                        except KeyError:
                            # If no descriptors, add empty dict as JSON string
                            Descriptors.Add(json.dumps({}), ghp)

                    except json.JSONDecodeError as e:
                        msg = f'Failed to parse component data: {str(e)}'
                        self._addError(msg)
                        self.Component.Message = msg
                    except Exception as e:
                        msg = f'Error processing component: {str(e)}'
                        self._addError(msg)
                        self.Component.Message = msg

            # Update success message
            total_components = sum(
                len(branch) for branch in ComponentData.Branches
            )
            self.Component.Message = (
                f'Disassembled {total_components} component(s)'
            )
            self._addRemark(
                f'Successfully disassembled {total_components} components'
            )

            # return output trees
            return __Results

        except Exception as e:
            msg = f'Unexpected error during disassembly: {str(e)}'
            self._addError(msg)
            self.Component.Message = msg

            # Return empty results if there was an error
            ID = Grasshopper.DataTree[System.Object]()
            Type = Grasshopper.DataTree[System.Object]()
            Material = Grasshopper.DataTree[System.Object]()
            PrimitiveGeometry = Grasshopper.DataTree[System.Object]()
            Color = Grasshopper.DataTree[System.Object]()
            BoundingBox = Grasshopper.DataTree[System.Object]()
            Descriptors = Grasshopper.DataTree[System.Object]()
            __Results = (
                ID,
                Type,
                Material,
                PrimitiveGeometry,
                Color,
                BoundingBox,
                Descriptors)
            return __Results
# ---------- end disassemblecomponent ----------
primitivegeometrygeometry = Data(disassemblecomponent.PrimitiveGeometry)
boundingbox = Data(disassemblecomponent.BoundingBox)
id = Data(disassemblecomponent.ID)
color_2 = Data(disassemblecomponent.Color)

# ----
# comments & notes: Fetch reduced or detailed Geometry, either by ID, JSON String or Geometry (with userstring-attached json string)
number_slider = Slider(118, range=0..500)
panel_4 = Panel("376c5967-3abd-48a8-941d-60d92b2c339b")
componentdata_17 = Data(componentdata_15)
geometry_2 = Data(primitivegeometrygeometry)
item = ListItem(List=flatten(geometry_2), Index=number_slider, Wrap=True)
item_2 = ListItem(List=flatten(componentdata_17), Index=number_slider, Wrap=True)
fetchgeometry = FetchGeometry(Input=item_2, Detailed=Toggle(False))  # -> Geometry, GeometryType, ComponentID; inputs Detailed: Boolean
# ---------- fetchgeometry: Python ----------
#! python3
# venv: DDU_CSC
# r: requests==2.31.0
# r: numpy==1.26.4
# r: scipy==1.13.0
# r: scikit-learn==1.4.2

# PYTHON STANDARD LIBRARY IMPORTS ---------------------------------------------
import json
import math

# THIRD PARTY LIBRARY IMPORTS -------------------------------------------------
import requests

# RHINO AND GH RELATED IMPORTS ------------------------------------------------
import System  # type: ignore[reportMissingImport] # NOQA
import Grasshopper  # type: ignore[reportMissingImport] # NOQA
import Rhino  # type: ignore[reportMissingImport] # NOQA
import scriptcontext as sc  # type: ignore[reportMissingImport] # NOQA
import Rhino.Geometry as rg  # type: ignore[reportMissingImport] # NOQA

# GHENV COMPONENT SETTINGS ----------------------------------------------------
ghenv.Component.Name = 'FetchGeometry'  # type: ignore[reportUnedfinedVariable] # NOQA
ghenv.Component.NickName = 'FetchGeometry'  # type: ignore[reportUnedfinedVariable] # NOQA
ghenv.Component.Category = 'DDU_CSC'  # type: ignore[reportUnedfinedVariable] # NOQA
ghenv.Component.SubCategory = '2 Catalogue Interface'  # type: ignore[reportUnedfinedVariable] # NOQA


class CSC_FetchGeometry(Grasshopper.Kernel.GH_ScriptInstance):
    """
    Author: Max Benjamin Eschenbach
    License: MIT License
    Version: 250828

    Fetches reduced or detailed geometry from the CSC API.
    Input can be:
    - A geometry object with 'csc_component' userstring containing
      component JSON
    - A JSON string directly
    - Just the component _id

    Outputs the fetched geometry (detailed if detailed=True,
    otherwise reduced)
    Falls back to primitive geometry if no additional geometry exists.
    """

    def __init__(self):
        super().__init__()
        # initialize props
        self.Component = ghenv.Component  # type: ignore[reportUnedfinedVariable] # NOQA
        self.InputParams = self.Component.Params.Input
        self.OutputParams = self.Component.Params.Output

    def _addRemark(self, msg: str = ''):
        rml = self.Component.RuntimeMessageLevel.Remark
        self.AddRuntimeMessage(rml, msg)

    def _addWarning(self, msg: str = ''):
        rml = self.Component.RuntimeMessageLevel.Warning
        self.AddRuntimeMessage(rml, msg)

    def _addError(self, msg: str = ''):
        rml = self.Component.RuntimeMessageLevel.Error
        self.AddRuntimeMessage(rml, msg)

    def get_auth_core_from_sticky(self):
        """Get AuthCore instance from sticky storage."""
        auth_core = sc.sticky.get('CSC_AuthCore')
        if auth_core is None:
            msg = ('No authentication found. Please use CSC_SignIn component '
                   'first.')
            self._addError(msg)
            self.Component.Message = msg
            return None
        return auth_core

    def extract_component_data(self, input_data):
        """
        Extract component data from various input types:
        """
        try:
            # Check if it's a geometry object with userstring
            if (hasattr(input_data, 'UserStringCount') and
                    input_data.UserStringCount > 0):
                key = 'csc_component'
                value = input_data.GetUserString(key)
                if value:
                    try:
                        # Parse the JSON string to get the _id
                        comp_data = json.loads(value)
                        return comp_data
                    except json.JSONDecodeError:
                        self._addWarning(
                            'Invalid JSON in csc_component userstring'
                        )
                        pass
            # Check if it's a string that could be JSON
            if isinstance(input_data, str):
                input_str = input_data.strip()
                # Try to parse as JSON
                try:
                    comp_data = json.loads(input_str)
                    return comp_data
                except json.JSONDecodeError:
                    # Not JSON, might be just a string
                    pass
        except Exception as e:
            self._addWarning(f'Error extracting ComponentData: {str(e)}')
        return None

    def extract_component_id(self, comp_data):
        """
        Extract component data from various input types:
        - Geometry object with 'csc_component' userstring
        - JSON string
        - Direct component ID
        """
        try:
            # Check if it's a string that could be JSON
            if isinstance(comp_data, str):
                input_str = comp_data.strip()
                auth_core = self.get_auth_core_from_sticky()
                # Check if it's a valid UUID first
                if auth_core.validate_uuid(input_str):
                    return input_str
            # Parse the JSON string to get the _id
            elif '_id' in comp_data:
                return comp_data['_id']
        except Exception as e:
            self._addWarning(f'Error extracting component ID: {str(e)}')
        return None

    def fetch_geometry_from_api(self, auth_core, component_id, detailed=False):
        """
        Fetch geometry from the API based on detailed flag.
        Returns the geometry data or None if failed.
        """
        try:
            if detailed:
                # Try to fetch detailed geometry first
                response = auth_core.authorized_get(
                    f'/components/{component_id}/geometry_detailed')
                if response.status_code == 200:
                    return {
                        'type': 'detailed',
                        'data': response.text,
                        'format': 'obj'
                    }
                elif response.status_code == 404:
                    # Detailed geometry not available, fall back to reduced
                    self._addRemark(
                        f'Detailed geometry not available for {component_id}, '
                        f'trying reduced...')
                    return self.fetch_geometry_from_api(
                        auth_core,
                        component_id,
                        detailed=False
                    )
                else:
                    self._addWarning(
                        f'Failed to fetch detailed '
                        f'geometry: {response.status_code}')
                    return None
            else:
                # Try to fetch reduced geometry first
                response = auth_core.authorized_get(
                    f'/components/{component_id}/geometry_reduced')
                if response.status_code == 200:
                    return {
                        'type': 'reduced',
                        'data': response.text,
                        'format': 'obj'
                    }
                elif response.status_code == 404:
                    # Reduced geometry not available, fall back to primitive
                    self._addRemark(
                        f'Reduced geometry not available '
                        f'for {component_id}, using primitive...'
                    )
                    return None
                else:
                    self._addWarning(
                        f'Failed to fetch reduced '
                        f'geometry: {response.status_code}'
                    )
                    return None

        except Exception as e:
            self._addError(f'Error fetching geometry from API: {str(e)}')
            return None

    def convert_obj_to_mesh(self, obj_content):
        """
        Convert OBJ file content to Rhino.Geometry.Mesh.
        Returns the mesh object or None if conversion fails.
        """
        try:
            # Parse OBJ content
            vertices = []
            faces = []
            normals = []
            lines = obj_content.strip().split('\n')
            for line in lines:
                line = line.strip()
                if not line or line.startswith('#'):
                    continue
                parts = line.split()
                if not parts:
                    continue
                if parts[0] == 'v':  # vertex
                    if len(parts) >= 4:
                        x = float(parts[1])
                        y = float(parts[2])
                        z = float(parts[3])
                        vertices.append(rg.Point3d(x, y, z))
                elif parts[0] == 'vn':  # vertex normal
                    if len(parts) >= 4:
                        nx = float(parts[1])
                        ny = float(parts[2])
                        nz = float(parts[3])
                        normals.append(rg.Vector3d(nx, ny, nz))
                elif parts[0] == 'f':  # face
                    if len(parts) >= 4:
                        face_vertices = []
                        for i in range(1, len(parts)):
                            # Handle different OBJ face formats
                            # (v, v/vt, v//vn, v/vt/vn)
                            vertex_part = parts[i].split('/')[0]
                            if vertex_part:
                                # OBJ is 1-indexed
                                vertex_index = int(vertex_part) - 1
                                if 0 <= vertex_index < len(vertices):
                                    face_vertices.append(vertex_index)
                        if len(face_vertices) >= 3:
                            faces.append(face_vertices)
            if not vertices or not faces:
                self._addWarning(
                    'No valid vertices or faces found in OBJ data'
                )
                return None
            # Create mesh
            mesh = rg.Mesh()
            # Add vertices
            for vertex in vertices:
                mesh.Vertices.Add(vertex)
            # Add faces
            for face in faces:
                if len(face) == 3:
                    mesh.Faces.AddFace(face[0], face[1], face[2])
                elif len(face) == 4:
                    mesh.Faces.AddFace(face[0], face[1], face[2], face[3])
                else:
                    # Triangulate polygon faces
                    for i in range(1, len(face) - 1):
                        mesh.Faces.AddFace(face[0], face[i], face[i + 1])
            # Add normals if available
            if normals and len(normals) == len(vertices):
                mesh.Normals.Clear()
                for normal in normals:
                    mesh.Normals.Add(normal)
                mesh.Normals.ComputeNormals()
            else:
                mesh.Normals.ComputeNormals()
            # rotate around x-axis to normalize for Rhino
            mesh.Rotate(
                (math.pi / 2),
                rg.Plane.WorldXY.XAxis,
                rg.Point3d(0, 0, 0)
            )
            # Compute mesh properties
            mesh.Compact()
            return mesh

        except Exception as e:
            self._addError(f'Error converting OBJ to mesh: {str(e)}')
            return None

    def fetch_primitive_geometry(self, auth_core, component_id):
        """
        Fetch the primitive geometry stored in the component JSON.
        Returns the geometry data or None if failed.
        """
        try:
            response = auth_core.authorized_get(
                f'/components/{component_id}/geometry'
            )
            if response.status_code == 200:
                comp_data = response.json()
                if 'geometry' in comp_data:
                    return {
                        'type': 'primitive',
                        'data': comp_data['geometry'],
                        'format': 'json'
                    }
                else:
                    self._addWarning(
                        f'No geometry data found in component {component_id}'
                    )
                    return None
            else:
                self._addWarning(
                    f'Failed to fetch component '
                    f'geometry: {response.status_code}'
                )
                return None

        except Exception as e:
            self._addError(f'Error fetching primitive geometry: {str(e)}')
            return None

    def primitive_mesh(self, mesh_data: dict) -> Rhino.Geometry.Mesh:
        # Handle mesh with vertices and faces
        if 'v' in mesh_data and 'f' in mesh_data:
            vertices = mesh_data['v']
            faces = mesh_data['f']
            if not vertices or not faces:
                return None
            mesh = rg.Mesh()
            # Add vertices
            for vertex in vertices:
                if len(vertex) >= 3:
                    x, y, z = (
                        float(vertex[0]),
                        float(vertex[1]),
                        float(vertex[2])
                    )
                    mesh.Vertices.Add(rg.Point3d(x, y, z))
            # Add faces
            for face in faces:
                if len(face) >= 3:
                    if len(face) == 3:
                        mesh.Faces.AddFace(face[0], face[1], face[2])
                    elif len(face) == 4:
                        mesh.Faces.AddFace(face[0], face[1], face[2], face[3])
            # Add colors if available
            if 'c' in mesh_data and len(mesh_data['c']) == len(vertices):
                colors = mesh_data['c']
                for i, color in enumerate(colors):
                    if i < mesh.Vertices.Count and len(color) >= 3:
                        r, g, b = int(color[0]), int(color[1]), int(color[2])
                        mesh.VertexColors.Add(r, g, b)

            mesh.Normals.ComputeNormals()
            mesh.Compact()
            return mesh

    def primitive_extrusion(
        self,
        extrusion_data: dict
    ) -> Rhino.Geometry.Extrusion:
        pl = Rhino.Geometry.Polyline()
        pts = [Rhino.Geometry.Point3d(pt[0], pt[1], 0.0)
               for pt in extrusion_data['profile']]
        pl.AddRange(pts)
        cxt = Rhino.Geometry.Extrusion.Create(
            pl.ToPolylineCurve(),
            Rhino.Geometry.Plane.WorldXY,
            extrusion_data['height'],
            True)
        # move extrusion downwards half material
        # thickness to center it at the origin
        cxt.Translate(Rhino.Geometry.Vector3d(
            0, 0, extrusion_data['height'] * -0.5))
        return cxt

    def construct_primitive_geometry(self, geometry_data):
        """
        Construct primitive geometry data.
        Handles different primitive geometry types from component JSON.
        """
        try:
            if not isinstance(geometry_data, dict):
                self._addWarning('Primitive geometry data is not a dictionary')
                return None

            # Check for mesh data
            if 'mesh' in geometry_data:
                mesh_data = geometry_data['mesh']
                mesh_geometry = self.primitive_mesh(mesh_data)
                return mesh_geometry

            # Check for extrusion data
            elif 'extrusion' in geometry_data:
                extrusion_data = geometry_data['extrusion']
                extrusion_geometry = self.primitive_extrusion(extrusion_data)
                return extrusion_geometry

            # Check for other primitive types
            else:
                self._addWarning('Unsupported primitive geometry type')
                return None

        except Exception as e:
            self._addError(f'Error constructing primitive geometry: {str(e)}')
            return None

    def iframe_to_xform(self, iframe) -> Rhino.Geometry.Transform:
        """
        Converts a component iframe to a Rhino 4x4 transformation matrix.
        """
        # Extract origin and vectors
        origin = iframe['o']
        x_vec = iframe['x']
        y_vec = iframe['y']
        z_vec = iframe['z']
        # Create 4x4 transformation matrix
        transform_matrix = [
            [x_vec[0], y_vec[0], z_vec[0], origin[0]],
            [x_vec[1], y_vec[1], z_vec[1], origin[1]],
            [x_vec[2], y_vec[2], z_vec[2], origin[2]],
            [0.0, 0.0, 0.0, 1.0]
        ]
        # Convert to Rhino Transform
        XForm = Rhino.Geometry.Transform.Identity
        XForm.M00 = transform_matrix[0][0]
        XForm.M01 = transform_matrix[0][1]
        XForm.M02 = transform_matrix[0][2]
        XForm.M03 = transform_matrix[0][3]
        XForm.M10 = transform_matrix[1][0]
        XForm.M11 = transform_matrix[1][1]
        XForm.M12 = transform_matrix[1][2]
        XForm.M13 = transform_matrix[1][3]
        XForm.M20 = transform_matrix[2][0]
        XForm.M21 = transform_matrix[2][1]
        XForm.M22 = transform_matrix[2][2]
        XForm.M23 = transform_matrix[2][3]
        return XForm

    def fetch_component_data(self, auth_core, component_id):
        """
        Fetch the full component data from the API.
        Returns the component data or None if failed.
        """
        try:
            response = auth_core.authorized_get(
                f'/components/{component_id}'
            )
            if response.status_code == 200:
                return response.json()
            else:
                self._addWarning(
                    f'Failed to fetch component data: '
                    f'{response.status_code}'
                )
                return None
        except Exception as e:
            self._addError(f'Error fetching component data: {str(e)}')
            return None

    def set_component_data_as_user_string(
            self,
            geometry_object,
            component_data
    ):
        """
        Set the component data as a user string to the geometry object.
        """
        try:
            if hasattr(geometry_object, 'SetUserString'):
                # Convert component data to JSON string
                component_json = json.dumps(component_data)
                geometry_object.SetUserString('csc_component', component_json)
                self._addRemark(
                    'Component data set as user string to geometry'
                )
            else:
                self._addWarning(
                    'Geometry object does not support user strings'
                )
        except Exception as e:
            self._addWarning(f'Failed to set user string: {str(e)}')

    def RunScript(self, Input, Detailed: bool):
        # Initialize param descriptions (this has to be done in RunScript)
        self.InputParams[0].Description = (
            'Input can be:\n'
            '- A geometry object with \'csc_component\' userstring\n'
            '- A JSON string containing component data\n'
            '- Just the component _id'
        )
        self.InputParams[1].Description = (
            'True for detailed geometry, False for reduced'
        )
        self.OutputParams[0].Description = (
            'Fetched geometry as Rhino.Geometry.GeometryBase'
        )
        self.OutputParams[1].Description = (
            'Geometry type: detailed, reduced, or primitive'
        )
        self.OutputParams[2].Description = 'Component ID that was processed'

        # Get AuthCore instance from sticky storage
        auth_core = self.get_auth_core_from_sticky()
        if auth_core is None:
            return

        # Check if authentication is valid
        if not auth_core.is_valid():
            msg = ('Authentication expired. Please use CSC_SignIn '
                   'component to refresh.')
            self._addError(msg)
            self.Component.Message = msg
            return

        # Input validation
        if not Input:
            msg = 'Please provide input data.'
            self._addWarning(msg)
            self.Component.Message = msg
            return

        # Set up output trees and results tuple
        GeometryData = Grasshopper.DataTree[System.Object]()
        GeometryType = Grasshopper.DataTree[str]()
        ComponentID = Grasshopper.DataTree[str]()
        __Results = (GeometryData, GeometryType, ComponentID)

        try:
            self.Component.Message = 'Processing input...'

            # Extract component ID from input
            # (could be from userstring, JSON, or direct ID)
            component_id = None
            component_data = None
            # First try to extract component data from input
            component_data = self.extract_component_data(Input)
            if component_data:
                component_id = self.extract_component_id(component_data)
            else:
                # If no component data, try to extract just the ID
                component_id = self.extract_component_id(Input)

            if not component_id:
                msg = 'Could not extract component ID from input.'
                self._addError(msg)
                self.Component.Message = msg
                return

            # Validate component ID
            if not auth_core.validate_uuid(component_id):
                msg = f'Component ID <{component_id}> is not a valid UUID!'
                self._addError(msg)
                self.Component.Message = msg
                return

            # Ensure we have full component data (fetch if we only had an ID)
            no_prev_transformation = False
            if not component_data:
                self._addRemark(
                    f'Fetching full component data for {component_id}...')
                no_prev_transformation = True
                component_data = self.fetch_component_data(
                    auth_core,
                    component_id
                )
                if not component_data:
                    msg = f'Failed to fetch component data for {component_id}'
                    self._addError(msg)
                    self.Component.Message = msg
                    return __Results

            self.Component.Message = (
                f'Fetching geometry for component {component_id}...'
            )

            # Try to fetch geometry from API first
            geometry_data = self.fetch_geometry_from_api(
                auth_core,
                component_id,
                Detailed)

            # If API geometry not available, fall back to primitive
            if not geometry_data:
                self._addRemark(
                    f'Falling back to primitive geometry for {component_id}'
                )
                geometry_data = self.fetch_primitive_geometry(
                    auth_core,
                    component_id
                )

                if not geometry_data:
                    msg = f'No geometry available for component {component_id}'
                    self._addError(msg)
                    self.Component.Message = msg
                    return __Results

            # Create datatree paths
            ghp = Grasshopper.Kernel.Data.GH_Path(0)

            # Process geometry based on format
            if geometry_data['format'] == 'obj':
                # Convert OBJ to mesh
                geometry_object = self.convert_obj_to_mesh(
                    geometry_data['data']
                )
                if not geometry_object:
                    self._addError('Failed to convert OBJ to mesh')
                    return __Results
            else:
                # Construct primitive geometry
                geometry_object = self.construct_primitive_geometry(
                    geometry_data['data']
                )
                if not geometry_object:
                    self._addError('Failed to construct primitive geometry')
                    return __Results

            # Apply transformation if iframe data is available
            if not no_prev_transformation and component_data and 'iframe' in component_data:
                xform = self.iframe_to_xform(component_data['iframe'])
                geometry_object.Transform(xform)
            else:
                self._addWarning(
                    'No previous transformation applied, '
                    'input was only ComponentID!'
                )

            # Set component data as user string
            self.set_component_data_as_user_string(
                geometry_object,
                component_data
            )

            # Add to outputs
            GeometryData.Add(geometry_object, ghp)
            GeometryType.Add(geometry_data['type'], ghp)
            ComponentID.Add(component_id, ghp)

            # Update success message
            self.Component.Message = (
                f'Successfully fetched {geometry_data["type"]} '
                f'geometry for {component_id}'
            )

            self._addRemark(
                f'Fetched {geometry_data["type"]} geometry '
                f'for component {component_id}'
            )

            return __Results

        except requests.exceptions.ConnectionError as e:
            msg = 'Cannot connect to server. Please check your connection.'
            self._addError(msg + f'\nFull Error: {str(e)}')
            self.Component.Message = msg

        except requests.exceptions.Timeout as e:
            msg = 'Request timeout. Server may be slow.'
            self._addError(msg + f'\nFull Error: {str(e)}')
            self.Component.Message = msg

        except requests.exceptions.RequestException as e:
            msg = f'Request error: {str(e)}'
            self._addError(msg)
            self.Component.Message = msg

        except Exception as e:
            msg = f'Unexpected error: {str(e)}'
            self._addError(msg)
            self.Component.Message = msg

        return __Results
# ---------- end fetchgeometry ----------
panel_5 = Panel(fetchgeometry.ComponentID)
panel_6 = Panel(fetchgeometry.GeometryType)
geometry_3 = Data(fetchgeometry.Geometry)

boundingbox_2 = Data(boundingbox)
geometry_4 = Data(primitivegeometrygeometry)
id_2 = Data(id)
color_3 = Data(color_2)

debox = DeconstructBox(Box=boundingbox_2)  # -> Plane, X, Y, Z
dedomain = DeconstructDomain(Domain=debox.Z)  # -> Start, End
subtraction = Subtraction(A=dedomain.End, B=dedomain.Start)
materialthickness = Data(subtraction)

geometry_5 = Data(geometry_4)
comments_notes_5 = Panel("Visualize Component")
py3 = Python3Script(Geo=geometry_5)  # -> out, PolylineGeo, ExtrusionGeo, MeshGeo; inputs Geo: GeometryBase
# ---------- py3: Python ----------
import Rhino

PolylineGeo = []
ExtrusionGeo = []
MeshGeo = []

if (isinstance(Geo, Rhino.Geometry.PolylineCurve) or
    isinstance(Geo, Rhino.Geometry.Polyline)):
    PolylineGeo.append(Geo)
elif (isinstance(Geo, Rhino.Geometry.Mesh)):
    MeshGeo.append(Geo)
elif (isinstance(Geo, Rhino.Geometry.Extrusion)):
    ExtrusionGeo.append(Geo)
# ---------- end py3 ----------
clean = CleanTree(RemoveNulls=True, RemoveInvalid=True, RemoveEmpty=True, Tree=py3.MeshGeo)  # -> simplify(Tree)
color_4 = Data(color_3)
clean_2 = CleanTree(RemoveNulls=True, RemoveInvalid=True, RemoveEmpty=True, Tree=py3.ExtrusionGeo)  # -> simplify(Tree)
tstat = TreeStatistics(Tree=clean)  # -> Paths, Length, Count
branch = TreeBranch(Tree=color_4, Path=tstat.Paths, MaintainPaths=True)
tstat_2 = TreeStatistics(Tree=clean_2)  # -> Paths, Length, Count
branch_2 = TreeBranch(Tree=color_4, Path=tstat_2.Paths, MaintainPaths=True)
preview = CustomPreview(Geometry=clean, Material=branch)
preview_2 = CustomPreview(Geometry=clean_2, Material=branch_2)

materialthickness_2 = Data(materialthickness)
comments_notes_6 = Panel("Visualize ID Tag")
id_3 = Data(id_2)
area_2 = Area(Geometry=geometry_4)  # -> Area, Centroid
Z = UnitZ(Factor=materialthickness_2)
move = Move(Geometry=area_2.Centroid, Motion=Z)  # -> Geometry, Transform
tag = TextTag3D(
    Location=move.Geometry,
    Text=id_3,
    Size=Slider(8, range=0..10),
    Colour=ColourSwatch(SwatchColor=RGB(0, 217, 255)),
    Justification=5)

comments_notes_7 = Panel("Visualize Bounding Rectangle")
bbx2d = Data(boundingbox_2)
cpl_2 = CustomPreviewLineweights(Geometry=flatten(bbx2d), Color=ColourSwatch(SwatchColor=RGB(255, 107, 107)), Thickness=Slider(2, range=0..10))  # inputs Geometry: list, Color: list of Color; same code as cpl
