# Grasshopper definition DDU_CSC_ReleaseWorkflow.gh (Grasshopper 1.0.8)

# DDU DEVELOPMENT: Authors: Max Benjamin Eschenbach
# 
# Digital Design Unit (DDU)
# Prof. Dr.-Ing. Oliver Tessmann
# Fachbereich Architektur
# Technical University of Darmstadt
# 
# CREDITS:
# ------------
# Please see: https://ddu.uber.space/credits
environment_spec = Panel("""#! python3
# venv: DDU_CSC
# r: requests==2.31.0
# r: numpy==1.26.4
# r: scipy==1.13.0
# r: scikit-learn==1.4.2""")

# ---- group: __GH_DEVELOPMENT_TOOLS__
# DEPENDENCIES
# (PLUGINS USED)
plugins = BooleanToggle(False)
definitiondependencies = DefinitionDependencies(Toggle=plugins)  # -> Core, AddOns; inputs Toggle: Boolean
# ---------- definitiondependencies: C# ----------
#region Usings
using System;
using System.Linq;
using System.Collections;
using System.Collections.Generic;
using System.Drawing;

using Rhino;
using Rhino.Geometry;

using Grasshopper;
using Grasshopper.Kernel;
using Grasshopper.Kernel.Data;
using Grasshopper.Kernel.Types;
#endregion

public class Script_Instance : GH_ScriptInstance
{
    #region Notes
    /* 
      Members:
        RhinoDoc RhinoDocument
        GH_Document GrasshopperDocument
        IGH_Component Component
        int Iteration

      Methods (Virtual & overridable):
        Print(string text)
        Print(string format, params object[] args)
        Reflect(object obj)
        Reflect(object obj, string method_name)

    Author: Giulio Piacentino (updated by Anders Holden Deleuran , updated 2025 by Max Benjamin Eschenbach)
    License: Apache License 2.0
    Version: 250820
    */
    #endregion

    private void RunScript(bool Toggle, ref object Core, ref object AddOns)
    {   
        // set component params
        this.Component.Name = "DefinitionDependencies";
        this.Component.NickName = "DefinitionDependencies";
        this.Component.Category = "DDU_CSC";
        this.Component.SubCategory = "0 Development";

        List<string> coreLibs = new List<string>();
        List<string> addLibs = new List<string>();
        if (Toggle)
        {
            Dictionary<string, GH_AssemblyInfo> coreLibraries = new Dictionary<string, GH_AssemblyInfo>();
            Dictionary<string, GH_AssemblyInfo> addonLibraries = new Dictionary<string, GH_AssemblyInfo>();
            Dictionary<string, string> objids = new Dictionary<string, string>();
            GH_ComponentServer server = Grasshopper.Instances.ComponentServer;
            foreach (GH_DocumentObject obj in this.Component.OnPingDocument().Objects)
            {
                if (obj == (GH_DocumentObject) this.Component)
                {
                    continue;
                }
                string objid = obj.ComponentGuid.ToString();
                if (objids.ContainsKey(objid)) continue;
                GH_AssemblyInfo lib = server.FindAssemblyByObject(obj);
                if (lib == null) continue;
                if (coreLibraries.ContainsKey(lib.Id.ToString()) | addonLibraries.ContainsKey(lib.Id.ToString())) continue;
                if (lib.IsCoreLibrary) coreLibraries.Add(lib.Id.ToString(), lib);
                else addonLibraries.Add(lib.Id.ToString(), lib);
            }
            foreach(KeyValuePair<string, GH_AssemblyInfo> entry in coreLibraries)
            {
                coreLibs.Add($"{entry.Value.Name} {entry.Value.Version}");
            }
            foreach(KeyValuePair<string, GH_AssemblyInfo> entry in addonLibraries)
            {
                addLibs.Add($"{entry.Value.Name} {entry.Value.Version}");
            }
        }
        Core = coreLibs;
        AddOns = addLibs;
    }
}
# ---------- end definitiondependencies ----------
grasshoppe_core_libraries = Panel(definitiondependencies.Core)
addon_libraries = Panel(definitiondependencies.AddOns)

# SAVE GHX-COPY OF CURRENT DOCUMENT
# comments & notes: Save this File and aso save a .GHX copy of the file to the same folder as this file resides in.
# --> Please use this before pushing a new version to GitHub to make the changes somehow "trackable"
autosave_gh_and_ghx = Trigger(Interval=10000, TimerInterval=10000, Target=autosave)  # disabled
autosave = BooleanToggle(True)  # disabled
save = Button()
or = GateOr(A=save, B=autosave)
saveandsaveghx = SaveAndSaveGHX(Save=or, ArchiveFolder="00_archive")  # -> Message; inputs Save: Boolean, ArchiveFolder: String
# ---------- saveandsaveghx: C# ----------
#region Usings
using System;
using System.IO;
using System.Linq;
using System.Collections;
using System.Collections.Generic;
using System.Drawing;

using Rhino;
using Rhino.Geometry;

using Grasshopper;
using Grasshopper.Kernel;
using Grasshopper.Kernel.Data;
using Grasshopper.Kernel.Types;
#endregion

public class Script_Instance : GH_ScriptInstance
{
    #region Notes
    /* 
      Members:
        RhinoDoc RhinoDocument
        GH_Document GrasshopperDocument
        IGH_Component Component
        int Iteration

      Methods (Virtual & overridable):
        Print(string text)
        Print(string format, params object[] args)
        Reflect(object obj)
        Reflect(object obj, string method_name)

    Author: Max Eschenbach
    License: MIT License
    Version: 250820
    */
    #endregion

    private void RunScript(bool Save, string ArchiveFolder, ref object Message)
    {
        // set component params
        this.Component.Name = "SaveAndSaveGHX";
        this.Component.NickName = "SaveAndSaveGHX";
        this.Component.Category = "DDU_CSC";
        this.Component.SubCategory = "0 Development";

        // This output will tell us if the save succeeded or failed.
        // The active Grasshopper document in this scripting component context

        DataTree<string> msgOut = new DataTree<string>();
        GH_Path ghp = new GH_Path(0, 1);

        if (!Save)
        {
            return;
        }

        GH_Document doc = this.GrasshopperDocument;
        if (doc == null)
        {
            msgOut.Add("Error: GrasshopperDocument is null", ghp);
            return;
        }

        // Set current and archive filepath
        string originalFilePath = doc.FilePath;
        string ghxFilePath = originalFilePath + "x";
        string archivePath = Path.Combine(Path.GetDirectoryName(ghxFilePath), ArchiveFolder);
        string archiveFilePath = Path.Combine(archivePath, DateTime.Now.ToString("yyMMdd") + "_" + Path.GetFileName(originalFilePath));

        // Only attempt to save when 'saveTrigger' is set to true.
        if (!Save) return;
        
        // Make sure the parent directory exists
        if (!Directory.Exists(Path.GetDirectoryName(ghxFilePath)))
        {
            msgOut.Add("Error: directory does not exist", ghp);
            return;
        }

        // Make sure Archive Directory exists
        // Make sure the parent directory exists
        
        if (!Directory.Exists(Path.GetDirectoryName(archivePath)))
        {
            msgOut.Add("Error: Archive directory does not exist", ghp);
            return;
        }

        // Create a GH_DocumentIO object based on our current GH_Document.
        GH_DocumentIO io = new GH_DocumentIO(doc);
        // Save this document
        io.Save();

        // Write the current document to an XML-based .ghx file
        bool success_a = io.SaveQuiet(ghxFilePath);
        bool success_b = io.SaveQuiet(originalFilePath);
        bool success_c = io.SaveQuiet(archiveFilePath);

        if (success_a & success_b & success_c)
            msgOut.Add($"Files saved successfully:\n{ghxFilePath}\n{archiveFilePath}", ghp);
        else
        {
            if (!success_a)
                msgOut.Add($"Error: failed to save .ghx file:\n{ghxFilePath}", ghp);
            if (!success_c)
                msgOut.Add($"Error: failed to save Archive .gh file:\n{archiveFilePath}", ghp);
        }
        Message = msgOut;
    }
}
# ---------- end saveandsaveghx ----------
panel = Panel(saveandsaveghx)

# SCRIPT SOURCE & USROBJ EXPORT
source_folder = Panel("..\grasshopper_userobjects_src")
dduclayprintingslicer_userobjects_folder = Panel("..\grasshopper_userobjects")
icon_path = Panel("..\resources\250820_csc_icon_24x24.png")
exportscriptsandsource = ExportScriptsAndSource(
    RunComponentAnalysis=Toggle(False),
    ExportUserObjectsAndSource=Toggle(False),
    Category="DDU_CSC",
    UserObjFolder=dduclayprintingslicer_userobjects_folder,
    SourceFolder=source_folder,
    IconPath=icon_path)  # -> out, OldScriptsDebug, CategoryDebug, VersionDebug, InfoMessages; inputs RunComponentAnalysis: Boolean, ExportUserObjectsAndSource: Boolean, Category: String, IconPath: String
# ---------- exportscriptsandsource: Python ----------
# PYTHON STANDARD LIBRARY IMPORTS ---------------------------------------------
import os

# RHINO AND GH RELATED IMPORTS ------------------------------------------------
import System  # type: ignore[reportMissingImport] # NOQA
import Rhino  # type: ignore[reportMissingImport] # NOQA
import Grasshopper  # type: ignore[reportMissingImport] # NOQA
import scriptcontext as sc  # type: ignore[reportMissingImport] # NOQA
import GhPython as ghpy  # type: ignore[reportMissingImport] # NOQA
import ScriptComponents as scomp  # type: ignore[reportMissingImport] # NOQA
import RhinoCodePluginGH as rcpgh  # type: ignore[reportMissingImport] # NOQA

# GHENV COMPONENT SETTINGS ----------------------------------------------------
ghenv.Component.Name = "ExportScriptsAndSource"  # type: ignore[reportUnedfinedVariable] # NOQA
ghenv.Component.NickName = "ExportScriptsAndSource"  # type: ignore[reportUnedfinedVariable] # NOQA
ghenv.Component.Category = "DDU_CSC"  # type: ignore[reportUnedfinedVariable] # NOQA
ghenv.Component.SubCategory = "0 Development"  # type: ignore[reportUnedfinedVariable] # NOQA


class ExportScriptsAndSource(Grasshopper.Kernel.GH_ScriptInstance):
    """
    Author: Max Benjamin Eschenbach (based on a Python Script by Anders Holden Deleuran)  # NOQA
    License: MIT License
    Version: 250822
    """

    def get_source_version(self, source):
        """
        Attempts to get the first instance of the word "version"
        (or, "Version") in a multi line string. Then attempts to extract an
        integer from this line where the word "version" exists. So format
        version YYMMDD in the docstring like so (or any other integer system):
            Version: 160121
        """
        # Get first line with version in it
        src_lower = source.lower()
        version_str = [ln for ln in src_lower.split('\n') if "version" in ln]
        if version_str:
            # Get the first substring integer and return it
            version_int = [
                int(s) for s in version_str[0].split() if s.isdigit()
            ]
            if version_int:
                return int(version_int[0])
        else:
            return None

    def process_document_objects(self, ghdocument, verbose=False):
        """
        Processes GH_Document object and return a list of all script components
        """
        # get all document objects
        comps = list(ghdocument.Objects)

        # types of python components
        ghpycomp = ghpy.Component.ZuiPythonComponent
        ipycomp = rcpgh.Components.IronPython2Component
        py3comp = rcpgh.Components.Python3Component

        # types of csharp components
        cscomp = scomp.Component_CSNET_Script
        cs9comp = rcpgh.Components.CSharpComponent

        # cluster component
        clustercomp = Grasshopper.Kernel.Special.GH_Cluster

        # extract component type strings
        ghpycomp_str = str(ghpycomp).split("'")[1]
        cscomp_str = str(cscomp).split("'")[1]
        ipycomp_str = str(ipycomp).split("'")[1]
        py3comp_str = str(py3comp).split("'")[1]
        cs9comp_str = str(cs9comp).split("'")[1]
        clustercomp_str = str(clustercomp).split("'")[1]

        # define script types
        id_ghpycomp = 'GHPY'
        id_cscomp = 'CS'
        id_ipycomp = 'IPY2'
        id_py3comp = 'PY3'
        id_cs9comp = 'CS9'

        # init dict for script component storage
        script_components = {}

        # loop over all document components
        # store all component objects in a dictionary to check
        # - are all "same" scripts the same code?
        # - are there scripts without category or version attribute?
        # - separate old from new scripts, dont export old scripts!
        for obj in comps:
            # extract basic info
            name = obj.Name
            nickname = obj.NickName
            iguid = str(obj.InstanceGuid)
            # extract type string
            objtype_str = str(obj.GetType())
            # OLD GHPYTHON COMPONENT
            if objtype_str == ghpycomp_str:
                source = obj.Code
                if source:
                    print((f'Found Source for OLD GHPY Component "{nickname}" '
                           f'({iguid})') if verbose else None)
                    scriptcomp = [id_ghpycomp, nickname, name, obj, source]
                    script_components[iguid] = scriptcomp
            # OLD C# COMPONENT
            elif objtype_str == cscomp_str:
                source = obj.ScriptSource.ScriptCode
                if source:
                    print((f'Found Source for OLD CS Component "{nickname}" '
                           f'({iguid})') if verbose else None)
                    scriptcomp = [id_cscomp, nickname, name, obj, source]
                    script_components[iguid] = scriptcomp
            # NEW C#9 COMPONENT
            elif objtype_str == cs9comp_str:
                bres, source = obj.TryGetSource()
                if bres:
                    print((f'Found Source for CS9 Component "{nickname}" '
                           f'({iguid})') if verbose else None)
                    scriptcomp = [id_cs9comp, nickname, name, obj, source]
                    script_components[iguid] = scriptcomp
            # NEW IRONPYTHON COMPONENT
            elif objtype_str == ipycomp_str:
                bres, source = obj.TryGetSource()
                if bres:
                    print((f'Found Source for IPY2 Component "{nickname}" '
                           f'({iguid})') if verbose else None)
                    scriptcomp = [id_ipycomp, nickname, name, obj, source]
                    script_components[iguid] = scriptcomp
            # NEW PYTHON3 COMPONENT
            elif objtype_str == py3comp_str:
                bres, source = obj.TryGetSource()
                if bres:
                    print((f'Found Source for PY3 Component "{nickname}" '
                           f'({iguid})') if verbose else None)
                    scriptcomp = [id_py3comp, nickname, name, obj, source]
                    script_components[iguid] = scriptcomp
            # CLUSTER COMPONENT
            elif objtype_str == clustercomp_str:
                # RECURSIVELY STEP THROUGH CLUSTERS AND LOOK FOR SCRIPTS ...
                print((f'Processing CLUSTER "{nickname}" ({name}, '
                      f'{iguid}) ...') if verbose else None)
                cluster_scripts = self.process_document_objects(
                    obj.Document(''), verbose=verbose
                )
                # add cluster script dict to main dict
                script_components.update(cluster_scripts)

        return script_components

    def process_script_components(
            self,
            script_components: dict,
            set_category: str):
        """
        Process found script components and get unique components.
        """
        unique_script_components = {}

        OldScriptsDebug = []
        CategoryDebug = []
        VersionDebug = []
        InfoMessages = []

        for iguid, values in script_components.items():
            script_type, nickname, name, obj, source = values
            category = obj.Category
            version = self.get_source_version(source)
            script_id = nickname + ' ' + name
            # NOT SEEN YET SCRIPT COMPONENTS
            if script_id not in unique_script_components:
                version_present = True
                category_match = True
                if script_type == 'GHPY':
                    OldScriptsDebug.append(
                        f'{script_type} - {nickname} ({name})')
                    OldScriptsDebug.append(
                        '    - IS AN OLD GHPYTHON SCRIPT!')
                elif script_type == 'CS':
                    OldScriptsDebug.append(
                        f'{script_type} - {nickname} ({name})')
                    OldScriptsDebug.append('    - IS AN OLD C# SCRIPT!')
                if category != set_category:
                    # create debug info messages
                    category_match = False
                    if category == 'Maths':
                        CategoryDebug.append(
                            f'{script_type} - {nickname} ({name})')
                        CategoryDebug.append(
                            f'    - HAS NO CATEGORY ({category}) (No Export)!')
                    else:
                        CategoryDebug.append(
                            f'{script_type} - {nickname} ({name})')
                        CategoryDebug.append(
                            f'    - {category} OUT OF SET CATEGORY '
                            f'{set_category} (No Export)!')
                if version is None:
                    version_present = False
                    # create debug info messages
                    VersionDebug.append(
                        ' '.join([script_type, nickname, name]))
                    VersionDebug.append('    - HAS NO VERSION! (No Export)')
                if category_match and version_present:
                    InfoMessages.append(f'{script_type} - {nickname} ({name})')
                    unique_script_components[script_id] = values
            # ALREADY SEEN SCRIPT COMPONENTS
            else:
                existing_source = unique_script_components[script_id][4]
                existing_version = self.get_source_version(existing_source)
                if version is None:
                    VersionDebug.append(f'{script_type} - {nickname} ({name})')
                    VersionDebug.append('    - HAS NO VERSION!')
                elif existing_version is None and version is not None:
                    VersionDebug.append(f'{script_type} - {nickname} ({name})')
                    VersionDebug.append(
                        f'    - VERSION {version} > ALREADY FOUND VERSION '
                        f'{existing_version}!')
                    # REPLACE FOUND "NONE" VERSION WITH NAMED VERSION!
                    raise
                elif version < existing_version:
                    VersionDebug.append(f'{script_type} - {nickname} ({name})')
                    VersionDebug.append(
                        f'    - VERSION {version} < {existing_version}! '
                        'Continuing...')
                    # REPLACE THE SOURCE OF THE LOWER VERSION
                    # WITH HIGHER VERSION SOURCE!
                    continue
                elif version > existing_version:
                    VersionDebug.append(f'{script_type} - {nickname} ({name})')
                    VersionDebug.append(
                        f'    - VERSION {version} > ALREADY FOUND VERSION '
                        f'{existing_version}!')
                    # REPLACE THE OBJECT IN DICT WITH NEWER VERSION
                    raise
        return (unique_script_components, OldScriptsDebug, CategoryDebug,
                VersionDebug, InfoMessages)

    def export_scriptcomp_usrobj(self, scriptcomp, usrobjpath, iconpath=''):
        """
        Automates the creation of a GHPython user object. Based on this thread:
        http://www.grasshopper3d.com/forum/topics/change-the-default-values-for-userobject-popup-menu
        scriptcomp = [script_type, nickname, name, obj, source]
        """
        try:
            # Make a user object
            uo = Grasshopper.Kernel.GH_UserObject()
            # Get component object
            obj = scriptcomp[3]
            # Process icon
            if iconpath:
                obj.SetIconOverride(System.Drawing.Bitmap.FromFile(iconpath))
            uo.Icon = obj.Icon_24x24
            # Set its properties based on the GHPython component properties
            uo.BaseGuid = obj.ComponentGuid
            uo.Exposure = ghenv.Component.Exposure.primary  # type: ignore[reportUnedfinedVariable] # NOQA
            uo.Description.Name = obj.Name
            uo.Description.Description = obj.Description
            uo.Description.Category = obj.Category
            uo.Description.SubCategory = obj.SubCategory
            # Set the user object data and save to file
            uo.SetDataFromObject(obj)
            uo.Path = os.path.join(
                usrobjpath, obj.Category + '_' + obj.Name + '.ghuser')
            uo.SaveToFile()
        except Exception as e:
            print(e)
            return False
        return True

    def export_scriptcomp_source(self, scriptcomp, srcpath):
        """
        Export the source code of a script component
        scriptcomp = [script_type, nickname, name, obj, source]
        """
        # Get code and lines of code
        script_type = scriptcomp[0]
        name = scriptcomp[2]
        obj = scriptcomp[3]
        source = scriptcomp[4]
        code = source.replace('\r', '')
        lines = code.splitlines()
        loc = len(lines)
        # Check/make source file folder
        srcpath = os.path.join(srcpath)
        if not os.path.isdir(srcpath):
            os.makedirs(srcpath)
        # Write code to file
        if script_type == 'PY3' or script_type == 'IPY2':
            ext = '.py'
        elif script_type == 'CS9':
            ext = '.cs'
        else:
            # DO NOT EXPORT OLD SCRIPTS!
            ext = None
        if ext:
            src_file = os.path.join(srcpath, obj.Category + '_' + name + ext)
            with open(src_file, 'w') as f:
                f.write(code)
        return loc

    def RunScript(self,
            RunComponentAnalysis: bool,
            ExportUserObjectsAndSource: bool,
            Category: str,
            UserObjFolder,
            SourceFolder,
            IconPath: str):
        # Init outputs
        OldScriptsDebug = Grasshopper.DataTree[object]()
        CategoryDebug = Grasshopper.DataTree[object]()
        VersionDebug = Grasshopper.DataTree[object]()
        InfoMessages = Grasshopper.DataTree[object]()

        # Iterate the canvas and get to the GHPython components
        grasshopper_document = ghenv.Component.OnPingDocument()  # type: ignore[reportUnedfinedVariable] # NOQA
        gh_dir = os.path.dirname(grasshopper_document.FilePath)

        usrobjpath = os.path.normpath(
            os.path.abspath(os.path.join(gh_dir, UserObjFolder)))
        srcpath = os.path.normpath(
            os.path.abspath(os.path.join(gh_dir, SourceFolder)))
        iconpath = os.path.normpath(
            os.path.abspath(os.path.join(gh_dir, IconPath)))

        if RunComponentAnalysis:
            # loop over all objects on the grasshopper canvas
            # and identify the components to export scriptsource from
            script_components = self.process_document_objects(
                grasshopper_document, verbose=False)

            # - are all "same" scripts the same code?
            # - are there scripts without category or version attribute?
            # - separate old from new scripts, dont export old scripts!
            (unique_script_components,
             OldScriptsDebug,
             CategoryDebug,
             VersionDebug,
             InfoMessages) = self.process_script_components(
                script_components, Category)

        # HERE LOOP OVER UNIQUE COMPONENTS
        if ExportUserObjectsAndSource and RunComponentAnalysis:
            # - SAVE USEROBJECT
            # - SAVE SOURCE
            for script_id, scriptcomp in unique_script_components.items():
                loc = self.export_scriptcomp_source(scriptcomp, srcpath)
                res = self.export_scriptcomp_usrobj(
                    scriptcomp, usrobjpath, iconpath)
                print(res, loc)
        elif ExportUserObjectsAndSource and not RunComponentAnalysis:
            rml = ghenv.Component.RuntimeMessageLevel.Warning  # type: ignore[reportUnedfinedVariable] # NOQA
            ghenv.Component.AddRuntimeMessage(  # type: ignore[reportUnedfinedVariable] # NOQA
                rml,
                'UserObjects and Source cannot be exported without running '
                'Component Analysis!')

        return OldScriptsDebug, CategoryDebug, VersionDebug, InfoMessages
# ---------- end exportscriptsandsource ----------
print_out = Panel(exportscriptsandsource.out)
oldscriptsdebug = Panel(exportscriptsandsource.OldScriptsDebug)
categorydebug = Panel(exportscriptsandsource.CategoryDebug)
versiondebug = Panel(exportscriptsandsource.VersionDebug)
infomessages = Panel(exportscriptsandsource.InfoMessages)

# CREATE RELEASE FILES
release_folder = Panel("..\grasshopper_release")
toggle = BooleanToggle(False)
createreleasefiles = CreateReleaseFiles(Run=Button(), RmGroupName="__GH_DEVELOPMENT_TOOLS__", ReleasePath=release_folder, Filename="DDU_CSC_ReleaseTest")  # -> Success, Removed, SavedFilePath, Status; inputs Run: Boolean, RmGroupName: String, ReleasePath: String, Filename: String
# ---------- createreleasefiles: Python ----------
#! python3
# venv: DDU_CSC
# r: requests==2.31.0
# r: numpy==1.26.4
# r: scipy==1.13.0
# r: scikit-learn==1.4.2

# PYTHON STANDARD LIBRARY IMPORTS ---------------------------------------------
import os
from datetime import datetime

# RHINO AND GH RELATED IMPORTS ------------------------------------------------
import System  # type: ignore[reportMissingImport] # NOQA
import Grasshopper  # type: ignore[reportMissingImport] # NOQA
import Rhino  # type: ignore[reportMissingImport] # NOQA
import scriptcontext as sc  # type: ignore[reportMissingImport] # NOQA

# GHENV COMPONENT SETTINGS ----------------------------------------------------
ghenv.Component.Name = 'CreateReleaseFiles'  # type: ignore[reportUnedfinedVariable] # NOQA
ghenv.Component.NickName = 'CreateReleaseFiles'  # type: ignore[reportUnedfinedVariable] # NOQA
ghenv.Component.Category = 'DDU_CSC'  # type: ignore[reportUnedfinedVariable] # NOQA
ghenv.Component.SubCategory = '0 Development'  # type: ignore[reportUnedfinedVariable] # NOQA


class CSC_CreateReleaseFiles(Grasshopper.Kernel.GH_ScriptInstance):
    """
    Author: Max Benjamin Eschenbach
    License: MIT License
    Version: 250909

    This component can be used to create a Grasshopper release file in a 
    separate folder.

    It creates a copy of the current Grasshopper document in
    memory, removes all components that belong to a specified group (i.e.
    development components), and saves the modified document to a specified
    folder.

    The folder path can be relative, i.e. "..\grasshopper_release".

    The filename can be specified, otherwise a timestamp-based filename will be
    generated.

    """

    def __init__(self):
        super().__init__()
        # initialize props
        self.Component = ghenv.Component  # type: ignore[reportUnedfinedVariable] # NOQA
        self.InputParams = self.Component.Params.Input
        self.OutputParams = self.Component.Params.Output

    def _addRemark(self, msg: str = ''):
        """Add a remark message to the component."""
        rml = self.Component.RuntimeMessageLevel.Remark
        self.AddRuntimeMessage(rml, msg)

    def _addWarning(self, msg: str = ''):
        """Add a warning message to the component."""
        rml = self.Component.RuntimeMessageLevel.Warning
        self.AddRuntimeMessage(rml, msg)

    def _addError(self, msg: str = ''):
        """Add an error message to the component."""
        rml = self.Component.RuntimeMessageLevel.Error
        self.AddRuntimeMessage(rml, msg)

    def copy_document(self, source_doc):
        """
        Create a copy of the Grasshopper document in memory.

        Args:
            source_doc: The source Grasshopper document to copy

        Returns:
            GH_Document: A copy of the source document, or None if failed
        """
        try:
            if source_doc is None:
                self._addError('Source document is None')
                return None

            # Use the DuplicateDocument method to create a copy
            duplicate_doc = Grasshopper.Kernel.GH_Document.DuplicateDocument(
                source_doc
            )

            if duplicate_doc is None:
                self._addError('Failed to duplicate the document')
                return None

            self._addRemark('Successfully created document copy')
            return duplicate_doc

        except Exception as e:
            self._addError(f'Error copying document: {str(e)}')
            return None

    def find_groups_and_objects(self, doc, group_name):
        """
        Find all groups and objects in the document with the specified name.
        """
        # get type for groups as string for verification
        grouptype = Grasshopper.Kernel.Special.GH_Group
        grouptype_str = str(grouptype).split("'")[1]
        doc_objects = doc.Objects
        # loop over all document objects
        target_groups = []
        target_objects = []
        try:
            for doc_obj in doc_objects:
                # ensure mathcing group name
                if doc_obj.NickName == group_name:
                    # ensure matching type
                    if str(doc_obj.GetType()) == grouptype_str:
                        target_groups.append(doc_obj)
                        for grp_obj in doc_obj.Objects():
                            target_objects.append(grp_obj)
        except Exception as e:
            self._addError(f'Error finding groups and objects: {str(e)}')
            return None, None
        # return target groups and objects
        return target_groups, target_objects

    def remove_objects_from_doc(self, doc, objects, groups=None):
        """
        Remove objects from the document.
        """
        components_removed = 0
        try:
            # loop over objects and remove them
            for obj in objects:
                doc.RemoveObject(obj, True)
                components_removed += 1
            # loop over groups and remove them
            if groups:
                for grp in groups:
                    doc.RemoveObject(grp, True)
                    components_removed += 1
        except Exception as e:
            self._addError(f'Error removing objects from document: {str(e)}')
            return 0
        # return number of components removed
        return components_removed

    def save_document(self, doc, save_path, filename=None):
        """
        Save the Grasshopper document to the specified path.

        Args:
            doc: The Grasshopper document to save
            save_path: The folder path where to save the document
            filename: Optional filename
                      (if None, generates timestamp-basedname)

        Returns:
            bool: True if successful, False otherwise
        """
        try:
            if doc is None:
                self._addError('Document is None, cannot save')
                return False, ''

            if not save_path:
                self._addError('Save path is empty')
                return False, ''

            # Handle relative paths - get the current GH
            # document directory as base
            current_doc = self.Component.OnPingDocument()
            if current_doc and current_doc.FilePath:
                current_dir = os.path.dirname(current_doc.FilePath)
                # Convert relative path to absolute path
                if not os.path.isabs(save_path):
                    save_path = os.path.normpath(
                        os.path.join(current_dir, save_path)
                    )
            else:
                # If no current document, use current working directory
                save_path = os.path.abspath(os.path.normpath(save_path))

            # Ensure the save directory exists
            if not os.path.exists(save_path):
                try:
                    os.makedirs(save_path, exist_ok=True)
                    self._addRemark(f'Created directory: {save_path}')
                except Exception as e:
                    self._addError(
                        f'Failed to create directory {save_path}: '
                        f'{str(e)}'
                    )
                    return False, ''

            # Generate filename if not provided
            if not filename:
                timestamp = datetime.now().strftime('%y%m%d_%H%M%S')
                filename = f'{timestamp}_ReleaseFile.gh'

            # Ensure filename has .gh extension
            if not filename.endswith('.gh'):
                filename += '.gh'

            # Create full file path
            full_path = os.path.join(save_path, filename)

            # Use GH_DocumentIO to save the document
            # (following SaveAndSaveGHX pattern)
            doc_io = Grasshopper.Kernel.GH_DocumentIO(doc)

            # Save the document
            success = doc_io.SaveQuiet(full_path)

            if success:
                self._addRemark(f'Document saved successfully: {full_path}')
                return True, full_path
            else:
                self._addError(f'Failed to save document to: {full_path}')
                return False, ''
        except Exception as e:
            self._addError(f'Error saving document: {str(e)}')
            return False, ''

    def validate_inputs(self, group_name, save_path):
        """
        Validate the input parameters.

        Args:
            group_name: The name of the group to remove
            save_path: The path where to save the document

        Returns:
            bool: True if inputs are valid, False otherwise
        """
        if not group_name or not group_name.strip():
            self._addError('Group name cannot be empty')
            return False

        if not save_path or not save_path.strip():
            self._addError('Save path cannot be empty')
            return False

        # Check if save path is valid
        try:
            # Handle relative paths - get the current
            # GH document directory as base
            current_doc = self.Component.OnPingDocument()
            if current_doc and current_doc.FilePath:
                current_dir = os.path.dirname(current_doc.FilePath)
                # Convert relative path to absolute path
                if not os.path.isabs(save_path):
                    normalized_path = os.path.normpath(
                        os.path.join(current_dir, save_path)
                    )
                else:
                    normalized_path = os.path.normpath(save_path)
            else:
                # If no current document, use current working directory
                normalized_path = os.path.abspath(os.path.normpath(save_path))
            # Check if the parent directory exists or can be created
            parent_dir = os.path.dirname(normalized_path)
            if parent_dir and not os.path.exists(parent_dir):
                # Try to create the parent directory
                try:
                    os.makedirs(parent_dir, exist_ok=True)
                except Exception:
                    self._addError(f'Cannot create directory: {parent_dir}')
                    return False
        except Exception as e:
            self._addError(f'Invalid save path: {str(e)}')
            return False

        return True

    def RunScript(self,
            Run: bool,
            RmGroupName: str,
            ReleasePath: str,
            Filename: str):
        """
        Main execution method for the component.

        Args:
            Run: Boolean trigger to Run the operation
            RmGroupName: Name of the group to remove components from
            ReleasePath: Path where to save the modified document
            Filename: Optional filename for the saved document
        """
        # Initialize param descriptions# Initialize param descriptions
        self.InputParams[0].Description = (
            'Run the document copy, object removal, and save operation'
        )
        self.InputParams[1].Description = (
            'Name of the group(s) to remove for relese file'
        )
        self.InputParams[2].Description = (
            'Folder path where to save the modified release document'
        )
        self.InputParams[3].Description = (
            'Optional filename for the saved document '
            '(without .gh extension)'
        )

        # Initialize output param descriptions
        self.OutputParams[0].Description = (
            'Success status of the operation (True/False)'
        )
        self.OutputParams[1].Description = (
            'Number of components removed'
        )
        self.OutputParams[2].Description = (
            'Full path of the saved document'
        )
        self.OutputParams[3].Description = (
            'Status message describing the operation result'
        )

        try:
            # Initialize output variables
            success = False
            components_removed = 0
            saved_file_path = ''
            status_message = ''

            # Check if execution is requested
            if not Run:
                status_message = 'Run is False - operation not performed'
                self.Component.Message = status_message
                return (success, components_removed, saved_file_path,
                        status_message)

            # Validate inputs
            if not self.validate_inputs(RmGroupName, ReleasePath):
                status_message = 'Input validation failed'
                self.Component.Message = status_message
                return (success, components_removed, saved_file_path,
                        status_message)

            # Get the current Grasshopper document
            current_doc = self.Component.OnPingDocument()
            if current_doc is None:
                status_message = 'No active Grasshopper document found'
                self._addError(status_message)
                self.Component.Message = status_message
                return (success, components_removed, saved_file_path,
                        status_message)

            # Step 1: Copy the current document
            self.Component.Message = 'Copying document...'
            copied_doc = self.copy_document(current_doc)
            if copied_doc is None:
                status_message = 'Failed to copy document'
                self.Component.Message = status_message
                return (success, components_removed, saved_file_path,
                        status_message)

            # Step 2: Find the specified group
            self.Component.Message = 'Finding groups...'
            target_groups, target_objects = self.find_groups_and_objects(
                copied_doc,
                RmGroupName
            )
            if target_groups is None or target_objects is None:
                status_message = 'Failed to find groups and objects'
                self.Component.Message = status_message
                return (success, components_removed, saved_file_path,
                        status_message)

            # Step 3: Remove components from the group
            self.Component.Message = 'Removing components...'
            components_removed = self.remove_objects_from_doc(
                copied_doc,
                target_objects,
                target_groups
            )
            if components_removed == 0:
                status_message = (
                    f'No components were removed from group "{RmGroupName}"'
                )
                self._addWarning(status_message)
            else:
                status_message = (
                    f'Removed {components_removed} components from group '
                    f'"{RmGroupName}"'
                )
            # Step 4: Save the modified document
            self.Component.Message = 'Saving document...'
            save_success, saved_file_path = self.save_document(
                copied_doc,
                ReleasePath,
                Filename
            )
            if save_success:
                saved_file_path = os.path.normpath(
                    os.path.abspath(saved_file_path)
                )
                success = True
                status_message += f' and saved to: {saved_file_path}'
                self.Component.Message = 'Operation completed successfully'
            else:
                status_message += ' but failed to save document'
                self.Component.Message = 'Save operation failed'

            return (success, components_removed, saved_file_path,
                    status_message)

        except Exception as e:
            error_msg = f'Unexpected error: {str(e)}'
            self._addError(error_msg)
            self.Component.Message = 'Operation failed'
            return (False, 0, '', error_msg)
# ---------- end createreleasefiles ----------
panel_2 = Panel(createreleasefiles.Success)
panel_3 = Panel(createreleasefiles.Removed)
panel_4 = Panel(createreleasefiles.SavedFilePath)
panel_5 = Panel(createreleasefiles.Status)
