# Grasshopper definition DDU_CSC_GrasshopperInterface_0.5.0.0-beta-9.gh (Grasshopper 1.0.8)

sampleextrusiongeometry = Extrusion(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)
samplescanmarkerpoints = Point([Point(-88.93215678, -1125.011089, 0), Point(0, 0, 0), Point(-403.5884569, 465.9235145, 0)])
extrusionmeshmultitest = Mesh(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)
detailedmeshgeometry = Geometry(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)
samplemarkerpoints = Point([<point referenced from the Rhino model> x3])
lowresscanmesh = Mesh(<mesh referenced from the Rhino model>)

# ----
# VIEWCAPTURE
save_viewcapture = BooleanToggle(False)
# Example 01:
# - Fetching Components
# - Arranging Components / Applying Transformations
# - Diassemble Components
open_viewcapture_after_saving = BooleanToggle(False)
viewcapturewidth = Slider(1920, range=0..10000)
viewcaptureheight = Slider(1080, range=0..10000)
viewcapturetofile = ViewCaptureToFile(
    Toggle=save_viewcapture,
    Width=viewcapturewidth,
    Height=viewcaptureheight,
    Grid=Toggle(False),
    WorldAxes=Toggle(False),
    CPlaneAxes=Toggle(False),
    OpenFile=open_viewcapture_after_saving)  # -> Path; inputs Toggle: Boolean, Width: Int32, Height: Int32, BackgroundColor: Color, Grid: Boolean, WorldAxes: Boolean, CPlaneAxes: Boolean, OpenFile: Boolean
# ---------- viewcapturetofile: Python ----------
#! python3
# -*- coding: utf-8 -*-
# venv: DDU_CSC
print('ENV OK!')
# r: charset_normalizer
# r: requests
# r: numpy
# r: scipy
# r: scikit-learn
# r: robust-laplacian
# r: potpourri3d

# PYTHON STANDARD LIBRARY IMPORTS ---------------------------------------------
import os  # NOQA
import datetime  # NOQA

# RHINO AND GH RELATED IMPORTS ------------------------------------------------
import System  # NOQA
import Rhino  # NOQA
import Grasshopper  # NOQA
import scriptcontext as sc  # NOQA

# GHENV COMPONENT SETTINGS ----------------------------------------------------
ghenv.Component.Name = 'ViewCaptureToFile'  # NOQA
ghenv.Component.NickName = 'ViewCaptureToFile'  # NOQA
ghenv.Component.Category = 'DDU_CSC'  # NOQA
ghenv.Component.SubCategory = '8 Visualization'  # NOQA
ghenv.Component.Description = (  # NOQA
    'Captures the active Rhino viewport to an image file (PNG). Supports '
    'custom dimensions, background colors, and visibility options for '
    'grid/axes. Creates organized capture folders with timestamps.'
)


class CSC_ViewCaptureToFile(Grasshopper.Kernel.GH_ScriptInstance):
    """
    Author: Anders Holden Deleuran (updated 2025 by Max Benjamin Eschenbach)
    License: MIT License
    Version: 260609
    """

    def __init__(self):
        super().__init__()
        # initialize props
        self.Component = ghenv.Component  # NOQA
        self.InputParams = self.Component.Params.Input
        self.OutputParams = self.Component.Params.Output

    def _addRemark(self, msg: str = ''):
        """Add a remark message to the component runtime messages."""
        rml = self.Component.RuntimeMessageLevel.Remark
        self.AddRuntimeMessage(rml, msg)

    def _addWarning(self, msg: str = ''):
        """Add a warning message to the component runtime messages."""
        rml = self.Component.RuntimeMessageLevel.Warning
        self.AddRuntimeMessage(rml, msg)

    def _addError(self, msg: str = ''):
        """Add an error message to the component runtime messages."""
        rml = self.Component.RuntimeMessageLevel.Error
        self.AddRuntimeMessage(rml, msg)

    def checkOrMakeFolder(self):
        """
        Check/makes a "Captures" folder in the GH def folder and a subfolder
        in the format 'YYMMDD'.
        """
        # get ghdoc
        ghdoc = self.Component.OnPingDocument()
        # construct timestamp for subfolder
        date = datetime.date.today()
        yy = str(date.year)[-2:]
        mm = str(date.month).zfill(2)
        dd = str(date.day).zfill(2)
        timestamp = yy + mm + dd
        docpath = ghdoc.Path  # NOQA
        if docpath:
            folder = os.path.dirname(docpath)
            captureFolder = folder + "\\Captures\\" + timestamp
            if not os.path.isdir(captureFolder):
                os.makedirs(captureFolder)
            return captureFolder

    def makeFileName(self):
        """ Make a string with the gh def name + current hourMinuteSecond """
        # Make hour minute seconds string
        n = datetime.datetime.now()
        ho, mt, sc = str(n.hour), str(n.minute), str(n.second)
        if len(ho) == 1:
            ho = "0" + ho
        if len(mt) == 1:
            mt = "0" + mt
        if len(sc) == 1:
            sc = "0" + sc
        hms = ho + mt + sc
        # Get name of GH def
        ghDef = ghdoc.Name.strip("*")  # NOQA
        # Concatenate and return
        fileName = ghDef + "_" + hms
        return fileName

    def captureActiveViewToFile(
            self,
            width,
            height,
            path,
            grid,
            worldAxes,
            cplaneAxes):
        """
        Captures the active view to an image file at the path.
        Path looks like this:
        "C:\\Users\\user\\Desktop\\Captures\\foo_bar.png"
        """
        # Set the script context to the current Rhino doc
        sc.doc = Rhino.RhinoDoc.ActiveDoc
        # define ghdoc
        ghdoc = self.Component.OnPingDocument()
        # Get the active view and set image dimensions
        activeView = sc.doc.Views.ActiveView
        # Perform the capture
        try:
            viewcap = Rhino.Display.ViewCapture()
            viewcap.DrawGrid = grid
            viewcap.DrawGridAxes = worldAxes
            viewcap.DrawAxes = cplaneAxes
            viewcap.Height = height
            viewcap.Width = width
            imageCap = viewcap.CaptureToBitmap(activeView)
            System.Drawing.Bitmap.Save(imageCap, path)
            Rhino.RhinoApp.WriteLine(path)
            sc.doc = ghdoc  # NOQA
            return path
        except Exception as e:
            sc.doc = ghdoc  # NOQA
            raise Exception(f'Capture failed, check the path: {str(e)}')

    def RunScript(self,
            Toggle: bool,
            Width: int,
            Height: int,
            BackgroundColor: System.Drawing.Color,
            Grid: bool,
            WorldAxes: bool,
            CPlaneAxes: bool,
            OpenFile: bool):
        """
        Main execution method for capturing the active view to a file.

        Args:
            Toggle: Boolean to execute the capture operation
            Width: Image width in pixels (default: 1920)
            Height: Image height in pixels (default: 1080)
            BackgroundColor: Background color for the viewport
            Grid: Show grid in capture
            WorldAxes: Show world axes in capture
            CPlaneAxes: Show construction plane axes in capture
            OpenFile: Open the captured file after creation

        Returns:
            Path to the captured image file
        """
        # Initialize param descriptions (this has to be done in RunScript)
        self.InputParams[0].Description = (
            'Toggle to execute the view capture operation'
        )
        self.InputParams[1].Description = (
            'Image width in pixels (default: 1920 if not provided)'
        )
        self.InputParams[2].Description = (
            'Image height in pixels (default: 1080 if not provided)'
        )
        self.InputParams[3].Description = (
            'Background color for the viewport capture'
        )
        self.InputParams[4].Description = (
            'Show grid in the captured image'
        )
        self.InputParams[5].Description = (
            'Show world axes in the captured image'
        )
        self.InputParams[6].Description = (
            'Show construction plane axes in the captured image'
        )
        self.InputParams[7].Description = (
            'Open the captured file after creation'
        )

        # Initialize output param descriptions
        self.OutputParams[0].Description = (
            'Path to the captured image file'
        )

        # Set up output trees and results
        Path = Grasshopper.DataTree[System.Object]()

        if not Toggle:
            self.Component.Message = (
                'Ready to capture view (toggle to execute)'
            )
            return Path

        try:
            # Set background color if provided
            if BackgroundColor:
                settings = Rhino.ApplicationSettings.AppearanceSettings
                settings.ViewportBackgroundColor = BackgroundColor
                self._addRemark('Background color set for capture')

            # Set default dimensions if not provided
            if not Width:
                Width = 1920
            if not Height:
                Height = 1080

            self.Component.Message = 'Preparing capture...'

            # Create capture folder and filename
            capFolder = self.checkOrMakeFolder()
            fileName = self.makeFileName()
            path = os.path.join(capFolder, fileName + '.png')

            self.Component.Message = 'Capturing view...'

            # Perform the capture
            captured_path = self.captureActiveViewToFile(
                Width, Height, path, Grid, WorldAxes, CPlaneAxes
            )

            # Add to output
            ghp = Grasshopper.Kernel.Data.GH_Path(0)
            Path.Add(captured_path, ghp)

            # Open file if requested
            if OpenFile:
                os.startfile(path)
                self._addRemark('File opened after capture')

            self.Component.Message = f'View captured: {fileName}.png'
            self._addRemark(f'Successfully captured view to {captured_path}')

            return Path

        except Exception as e:
            msg = f'Capture failed: {str(e)}'
            self._addError(msg)
            self.Component.Message = msg
            return Path
# ---------- end viewcapturetofile ----------
panel = Panel(viewcapturetofile)

# ----
# 1 -> CREATE PUBLIC DEV FILE
# comments & notes: Use this to create a public version without secrets from this development file. The component will create an in-memory copy of the GH Document, then clear all Panels which names are in "ClearPanelNames" and then save the document to the DevelopmentPath.
panel_names_to_clear = Panel("""DDU_CSC_Username
DDU_CSC_Password""")
development_folder = Panel("..\grasshopper_development")
filename = Panel("DDU_CSC_GrasshopperInterface_DEV_PUBLIC")
run = Button()
createpublicdevelopmentfile = CreatePublicDevelopmentFile(Run=run, ClearPanelNames=panel_names_to_clear, DevelopmentPath=development_folder, Filename=filename)  # -> out, Success, SavedFilePath, Status; inputs Run: Boolean, ClearPanelNames: list of String, DevelopmentPath: String, Filename: String
# ---------- createpublicdevelopmentfile: Python ----------
#! python3
# -*- coding: utf-8 -*-
# venv: DDU_CSC
print('ENV OK!')
# r: charset_normalizer
# r: requests

# PYTHON STANDARD LIBRARY IMPORTS ---------------------------------------------
import os  # NOQA
from datetime import datetime  # NOQA

# RHINO AND GH RELATED IMPORTS ------------------------------------------------
import System  # NOQA
import Grasshopper  # NOQA
import Rhino  # NOQA
import scriptcontext as sc  # NOQA

# GHENV COMPONENT SETTINGS ----------------------------------------------------
ghenv.Component.Name = 'CreatePublicDevelopmentFile'  # NOQA
ghenv.Component.NickName = 'CreatePublicDevelopmentFile'  # NOQA
ghenv.Component.Category = 'DDU_CSC'  # NOQA
ghenv.Component.SubCategory = '0 Development'  # NOQA
ghenv.Component.Description = (  # NOQA
    """
    This component can be used to create a sanitized Grasshopper
    development file in a specified folder.

    It creates a copy of the current Grasshopper document in
    memory, removes all components that belong to a specified group (i.e.
    developmclears specified panels containing sensitive information,
    and saves the modified document to a specified folder.

    The folder path can be relative, i.e. "..\\grasshopper_release".

    The filename can be specified, otherwise a timestamp-based filename will be
    generated.
    """
)


class CSC_CreatePublicDevelopmentFile(Grasshopper.Kernel.GH_ScriptInstance):
    """
    Author: Max Benjamin Eschenbach
    License: MIT License
    Version: 260609
    """

    def __init__(self):
        """Initialize this component and set component parameters."""
        super().__init__()
        # initialize props
        self.Component = ghenv.Component  # NOQA
        self.InputParams = self.Component.Params.Input
        self.OutputParams = self.Component.Params.Output

    def _addRemark(self, msg: str = ''):
        """Add a remark message to the component."""
        rml = self.Component.RuntimeMessageLevel.Remark
        self.AddRuntimeMessage(rml, msg)

    def _addWarning(self, msg: str = ''):
        """Add a warning message to the component."""
        rml = self.Component.RuntimeMessageLevel.Warning
        self.AddRuntimeMessage(rml, msg)

    def _addError(self, msg: str = ''):
        """Add an error message to the component."""
        rml = self.Component.RuntimeMessageLevel.Error
        self.AddRuntimeMessage(rml, msg)

    def BeforeRunScript(self):
        """Performs some setup actions."""
        # Initialize input param descriptions
        self.InputParams[0].Description = (
            'Run the document copy, object removal, and save operation'
        )
        self.InputParams[1].Description = (
            'List of names of optional GH_Panel objects to clear,'
            ' (i.e. for passwords)'
        )
        self.InputParams[2].Description = (
            'Folder path where to save the modified development document'
        )
        self.InputParams[3].Description = (
            'Optional filename for the saved document '
            '(without .gh extension)'
        )
        # Initialize output param descriptions
        i = 0
        if self.OutputParams[0].Name == 'out':
            i += 1
        self.OutputParams[0+i].Description = (
            'Success status of the operation (True/False)'
        )
        self.OutputParams[1+i].Description = (
            'Full path of the saved document'
        )
        self.OutputParams[2+i].Description = (
            'Status message describing the operation result'
        )

    def copy_document(self, source_doc):
        """
        Create a copy of the Grasshopper document in memory.

        Args:
            source_doc: The source Grasshopper document to copy

        Returns:
            GH_Document: A copy of the source document, or None if failed
        """
        try:
            if source_doc is None:
                self._addError('Source document is None')
                return None

            # Use the DuplicateDocument method to create a copy
            duplicate_doc = Grasshopper.Kernel.GH_Document.DuplicateDocument(
                source_doc
            )

            if duplicate_doc is None:
                self._addError('Failed to duplicate the document')
                return None

            self._addRemark('Successfully created document copy')
            return duplicate_doc

        except Exception as e:
            self._addError(f'Error copying document: {str(e)}')
            return None

    def clear_panels(self, doc, target_panels):
        """
        Clear all GH_Panel instances in the document with one of the specified
        names.
        """
        panels_cleared = 0
        try:
            # loop over target panels and clear them
            for panel in target_panels:
                # UserText property holds the panel contents so we clear it
                panel.UserText = ''
                # we clear the volatile data as well
                panel.ClearData()
                panels_cleared += 1
        except Exception as e:
            self._addError(f'Error clearing panels: {str(e)}')
            return panels_cleared
        # return target groups and objects
        return panels_cleared

    def find_panels_to_clear(self, doc, panel_names=[]):
        """
        Find all panels in the document with the specified name.
        """
        # get type for panels as string for verification
        paneltype = Grasshopper.Kernel.Special.GH_Panel
        paneltype_str = str(paneltype).split("'")[1]
        # loop over all document objects
        doc_objects = doc.Objects
        target_panels = []
        try:
            for doc_obj in doc_objects:
                # ensure matching panel name
                if panel_names and doc_obj.NickName in panel_names:
                    # ensure matching type
                    if str(doc_obj.GetType()) == paneltype_str:
                        target_panels.append(doc_obj)
        except Exception as e:
            self._addError(f'Error finding panels: {str(e)}')
            return None
        # return target panels
        return target_panels

    def save_document(self, doc, save_path, filename=None):
        """
        Save the Grasshopper document to the specified path.

        Args:
            doc: The Grasshopper document to save
            save_path: The folder path where to save the document
            filename: Optional filename
                      (if None, generates timestamp-basedname)

        Returns:
            bool: True if successful, False otherwise
        """
        try:
            if doc is None:
                self._addError('Document is None, cannot save')
                return False, ''

            if not save_path:
                self._addError('Save path is empty')
                return False, ''

            # Handle relative paths - get the current GH
            # document directory as base
            current_doc = self.Component.OnPingDocument()
            if current_doc and current_doc.FilePath:
                current_dir = os.path.dirname(current_doc.FilePath)
                # Convert relative path to absolute path
                if not os.path.isabs(save_path):
                    save_path = os.path.normpath(
                        os.path.join(current_dir, save_path)
                    )
            else:
                # If no current document, use current working directory
                save_path = os.path.abspath(os.path.normpath(save_path))

            # Ensure the save directory exists
            if not os.path.exists(save_path):
                try:
                    os.makedirs(save_path, exist_ok=True)
                    self._addRemark(f'Created directory: {save_path}')
                except Exception as e:
                    self._addError(
                        f'Failed to create directory {save_path}: '
                        f'{str(e)}'
                    )
                    return False, ''

            # Generate filename if not provided
            if not filename:
                timestamp = datetime.now().strftime('%y%m%d_%H%M%S')
                filename = f'{timestamp}_ReleaseFile.gh'

            # Ensure filename has .gh extension
            if not filename.endswith('.gh'):
                filename += '.gh'

            # Create full file path
            full_path = os.path.join(save_path, filename)

            # Use GH_DocumentIO to save the document
            # (following SaveAndSaveGHX pattern)
            doc_io = Grasshopper.Kernel.GH_DocumentIO(doc)

            # Save the document
            success = doc_io.SaveQuiet(full_path)

            if success:
                self._addRemark(f'Document saved successfully: {full_path}')
                return True, full_path
            else:
                self._addError(f'Failed to save document to: {full_path}')
                return False, ''
        except Exception as e:
            self._addError(f'Error saving document: {str(e)}')
            return False, ''

    def validate_inputs(self, clear_panel_names, save_path):
        """
        Validate the input parameters.

        Args:
            save_path: The path where to save the document

        Returns:
            bool: True if inputs are valid, False otherwise
        """
        if not save_path or not save_path.strip():
            self._addError('Save path cannot be empty')
            return False

        if not clear_panel_names:
            clear_panel_names = []
        for cpn in clear_panel_names:
            if not isinstance(cpn, str):
                self._addError('ClearPanelNames contains non-string')
                return False

        # Check if save path is valid
        try:
            # Handle relative paths - get the current
            # GH document directory as base
            current_doc = self.Component.OnPingDocument()
            if current_doc and current_doc.FilePath:
                current_dir = os.path.dirname(current_doc.FilePath)
                # Convert relative path to absolute path
                if not os.path.isabs(save_path):
                    normalized_path = os.path.normpath(
                        os.path.join(current_dir, save_path)
                    )
                else:
                    normalized_path = os.path.normpath(save_path)
            else:
                # If no current document, use current working directory
                normalized_path = os.path.abspath(os.path.normpath(save_path))
            # Check if the parent directory exists or can be created
            parent_dir = os.path.dirname(normalized_path)
            if parent_dir and not os.path.exists(parent_dir):
                # Try to create the parent directory
                try:
                    os.makedirs(parent_dir, exist_ok=True)
                except Exception:
                    self._addError(f'Cannot create directory: {parent_dir}')
                    return False
        except Exception as e:
            self._addError(f'Invalid save path: {str(e)}')
            return False

        return True

    def RunScript(self,
            Run: bool,
            ClearPanelNames: System.Collections.Generic.List[str],
            DevelopmentPath: str,
            Filename: str):

        # Initialize output variables
        success = False
        saved_file_path = ''
        status_message = ''

        # Check if execution is requested
        if not Run:
            status_message = 'Run is False - operation not performed'
            self.Component.Message = status_message
            return (success, saved_file_path,
                    status_message)

        # Validate inputs
        if not self.validate_inputs(
                ClearPanelNames, DevelopmentPath):
            status_message = 'Input validation failed'
            self.Component.Message = status_message
            return (success, saved_file_path,
                    status_message)

        # Get the current Grasshopper document
        current_doc = self.Component.OnPingDocument()
        if current_doc is None:
            status_message = 'No active Grasshopper document found'
            self._addError(status_message)
            self.Component.Message = status_message
            return (success, saved_file_path,
                    status_message)

        # Step 1: Copy the current document
        self.Component.Message = 'Copying document...'
        copied_doc = self.copy_document(current_doc)
        if copied_doc is None:
            status_message = 'Failed to copy document'
            self.Component.Message = status_message
            return (success, saved_file_path,
                    status_message)

        # Step 2: Find the panels to clear
        self.Component.Message = 'Finding groups...'
        target_panels = self.find_panels_to_clear(
            copied_doc, ClearPanelNames
        )

        # Step 3: Clear Panels if ClearPanelNames were supplied
        if target_panels:
            self.Component.Message = 'Clearing Panels...'
            panels_cleared = self.clear_panels(copied_doc, target_panels)
            if panels_cleared == 0:
                status_message = ('No panels have been cleared!')
                self._addWarning(status_message)

        # Step 4: Save the modified document
        self.Component.Message = 'Saving document...'
        save_success, saved_file_path = self.save_document(
            copied_doc,
            DevelopmentPath,
            Filename
        )
        if save_success:
            saved_file_path = os.path.normpath(
                os.path.abspath(saved_file_path)
            )
            success = True
            status_message += (
                f'\n Saved development file to: {saved_file_path}'
            )
            self.Component.Message = 'Operation completed successfully'
        else:
            status_message += '\n Failed to save document!'
            self.Component.Message = 'Save operation failed'

        # set message
        self.Component.Message = 'Operation completed successfully'
        # return results
        return (success, saved_file_path, status_message)
# ---------- end createpublicdevelopmentfile ----------
status_message_stream = Panel(createpublicdevelopmentfile.Status)
success_message = Panel(createpublicdevelopmentfile.Success)
filepath_of_saved_release_file = Panel(createpublicdevelopmentfile.SavedFilePath)

# ---- group: __DDU_CSC_EXAMPLE_04__
# comments & notes: Fetch a subset of components from the database using filters. Here we are fetching the 'mineral_composite_panels' dataset.
# 
# NOTE: ReservedStatus = -1 means we ignore reservations entirely
# Step 2
fragment = ValueList({"Any": , "Only fragments": True, "Only non-fragmnents": False}, selected="Any")
maxdimensiony = Slider(0, range=0..2000)
mindimensionx = Slider(0, range=-0.1..2000)
maxdimensionx = Slider(0, range=0..2000)
maxdimensionz = Slider(0, range=0..500)
mindimensiony = Slider(0, range=0..2000)
mindimensionz = Slider(0, range=0..500)
# Example 05:
# - Fetch all corian sheet components
# - Get radial signature descriptors
# - Concatenate with simple descriptors to get a 100-dimensional vector
# - Embed into 2 or 3 dimensional space using dimensionality reduction
# - Visualize the embeddings in 2D / 3D space
reservedstatus = Slider(-1, range=-1..1)
complexity = ValueList({"Any complexity": , "0", "1", "2", "3"}, selected="Any complexity")
dataset = Panel("mineral_composite_panels")
material = ValueList({"Any material": , "corian", "concrete", "timber", "aluminium", "steel"}, selected="Any material")
type = ValueList({"All types": , "panel", "beam", "column", "slab", "rubble", "brick", "pipe", "profile", "connector", "other"}, selected="All types")
fetchfilteredcomponents = FetchFilteredComponents(
    Type=type,
    Material=material,
    Dataset=dataset,
    Complexity=complexity,
    Fragment=fragment,
    MinDimensionX=mindimensionx,
    MaxDimensionX=maxdimensionx,
    MinDimensionY=mindimensiony,
    MaxDimensionY=maxdimensiony,
    MinDimensionZ=mindimensionz,
    MaxDimensionZ=maxdimensionz,
    ReservedStatus=reservedstatus)  # -> FilterDescription, ComponentData; inputs Type: String, Material: String, Dataset: String, Complexity: Int32, Fragment: Boolean, MinDimensionX: Double, MaxDimensionX: Double, MinDimensionY: Double, MaxDimensionY: Double, MinDimensionZ: Double, MaxDimensionZ: Double
# ---------- fetchfilteredcomponents: Python ----------
#! python3
# -*- coding: utf-8 -*-
# venv: DDU_CSC
print('ENV OK!')
# r: charset_normalizer
# r: requests

# PYTHON STANDARD LIBRARY IMPORTS ---------------------------------------------
import json  # NOQA

# THIRD PARTY LIBRARY IMPORTS -------------------------------------------------
import requests  # NOQA

# RHINO AND GH RELATED IMPORTS ------------------------------------------------
import System  # NOQA
import Grasshopper  # NOQA
import Rhino  # NOQA
import scriptcontext as sc  # NOQA

# GHENV COMPONENT SETTINGS ----------------------------------------------------
ghenv.Component.Name = 'FetchFilteredComponents'  # NOQA
ghenv.Component.NickName = 'FetchFilteredComponents'  # NOQA
ghenv.Component.Category = 'DDU_CSC'  # NOQA
ghenv.Component.SubCategory = '2 Catalog Interface'  # NOQA
ghenv.Component.Description = (  # NOQA
    'Fetches identities (with their current snapshot) from the remote '
    'Catalog based on filter criteria (type, material, dataset, complexity, '
    'fragment, bounding box dimensions). Mirrors the web catalog filter '
    'menu and returns passport JSON ({identity, snapshots[]}) results.'
)


class CSC_FetchFilteredComponents(Grasshopper.Kernel.GH_ScriptInstance):
    """
    Author: Max Benjamin Eschenbach
    License: MIT License
    Version: 260908
    """

    def __init__(self):
        """Initialize this component and set component parameters."""
        super().__init__()
        # initialize props
        self.Component = ghenv.Component  # NOQA
        self.InputParams = self.Component.Params.Input
        self.OutputParams = self.Component.Params.Output

    def _addRemark(self, msg: str = ''):
        """Add a remark message to the component."""
        rml = self.Component.RuntimeMessageLevel.Remark
        self.AddRuntimeMessage(rml, msg)

    def _addWarning(self, msg: str = ''):
        """Add a warning message to the component."""
        rml = self.Component.RuntimeMessageLevel.Warning
        self.AddRuntimeMessage(rml, msg)

    def _addError(self, msg: str = ''):
        """Add an error message to the component."""
        rml = self.Component.RuntimeMessageLevel.Error
        self.AddRuntimeMessage(rml, msg)

    def BeforeRunScript(self):
        """Perform some setup actions."""
        # Initialize input param descriptions
        self.InputParams[0].Description = (
            'Component type filter (e.g., "beam", "slab", "column")'
        )
        self.InputParams[1].Description = (
            'Material type filter (e.g., "concrete", "steel", "wood")'
        )
        self.InputParams[2].Description = (
            'Dataset name filter (e.g., "sas_cita_scans", '
            '"mineral_composite_sheets")'
        )
        self.InputParams[3].Description = (
            'Complexity level filter (0-3, where 0=simple, 3=complex)'
        )
        self.InputParams[4].Description = (
            'Fragment status filter (True for fragments, False for complete)'
        )
        self.InputParams[5].Description = (
            'Minimum X dimension filter (bounding box)'
        )
        self.InputParams[6].Description = (
            'Maximum X dimension filter (bounding box)'
        )
        self.InputParams[7].Description = (
            'Minimum Y dimension filter (bounding box)'
        )
        self.InputParams[8].Description = (
            'Maximum Y dimension filter (bounding box)'
        )
        self.InputParams[9].Description = (
            'Minimum Z dimension filter (bounding box)'
        )
        self.InputParams[10].Description = (
            'Maximum Z dimension filter (bounding box)'
        )
        self.InputParams[11].Description = (
            'Reservation status filter: -1=ignore, 0=not reserved, '
            '1=reserved by current user'
        )
        # Initialize output param descriptions
        i = 0
        if self.OutputParams[0].Name == 'out':
            i += 1
        self.OutputParams[0+i].Description = (
            'Human-readable description of the applied filters and query'
        )
        self.OutputParams[1+i].Description = (
            'Passport JSON per entry ({identity, snapshots[]}) fetched from '
            'the server. Use \'DisassembleComponent\' to access the individual '
            'fields ready for Grasshopper')

    def get_auth_core_from_sticky(self):
        """Get AuthCore instance from sticky storage."""
        auth_core = sc.sticky.get('CSC_AuthCore')
        if auth_core is None:
            msg = ('No authentication found. Please use CSC_Session component '
                   'first.')
            self._addError(msg)
            self.Component.Message = msg
            return None
        return auth_core

    def build_filter_query_params(
            self,
            Type,
            Material,
            Dataset,
            Complexity,
            Fragment,
            MinDimensionX,
            MaxDimensionX,
            MinDimensionY,
            MaxDimensionY,
            MinDimensionZ,
            MaxDimensionZ,
            ReservedStatus):
        """
        Build query parameters for filtering identities.

        Mirrors the web catalog filter menu
        (ComponentOverviewFilterMenu): comptype, material, dataset,
        complexity, fragment, and bounding box dimensions. ``validated``
        is left to the server default (validated-only), matching the web.
        Adds a reservation-status filter on top (not part of the web
        catalog filter menu): 1=reserved by current user, 0=not reserved.
        """
        params = {}

        # Add type filter if provided
        if Type and len(Type) > 0:
            # Take the first type if multiple are provided
            type_value = Type[0] if isinstance(Type, list) else str(Type)
            if type_value and type_value.strip():
                params['comptype'] = type_value.strip()

        # Add material filter if provided
        if Material and Material.strip():
            params['material'] = Material.strip()

        # Add dataset filter if provided
        if Dataset and Dataset.strip():
            params['dataset'] = Dataset.strip()

        # Add complexity filter if provided
        if Complexity is not None:
            params['complexity'] = Complexity

        # Add fragment filter if provided (web sends 'true'/'false')
        if Fragment is not None:
            params['fragment'] = 'true' if Fragment else 'false'

        # Add reservation status filter if provided
        # (backend: reserved=true -> reserved by current user,
        #  reserved=false -> not reserved by anyone)
        if ReservedStatus is not None and ReservedStatus != -1:
            if ReservedStatus == 0:
                params['reserved'] = 'false'
            elif ReservedStatus == 1:
                params['reserved'] = 'true'

        # Add bounding box filters if provided
        if MinDimensionX is not None and MinDimensionX != 0.0:
            params['bbx_min_x'] = MinDimensionX
        if MaxDimensionX is not None and MaxDimensionX != 0.0:
            params['bbx_max_x'] = MaxDimensionX
        if MinDimensionY is not None and MinDimensionY != 0.0:
            params['bbx_min_y'] = MinDimensionY
        if MaxDimensionY is not None and MaxDimensionY != 0.0:
            params['bbx_max_y'] = MaxDimensionY
        if MinDimensionZ is not None and MinDimensionZ != 0.0:
            params['bbx_min_z'] = MinDimensionZ
        if MaxDimensionZ is not None and MaxDimensionZ != 0.0:
            params['bbx_max_z'] = MaxDimensionZ

        return params

    def generate_filter_description(self, filter_params: dict) -> str:
        """Generates a human-readable description of the applied filters."""
        description = []
        if filter_params.get('comptype'):
            description.append(f'\nType: {filter_params["comptype"]}')
        if filter_params.get('material'):
            description.append(f'\nMaterial: {filter_params["material"]}')
        if filter_params.get('dataset'):
            description.append(f'\nDataset: {filter_params["dataset"]}')
        if filter_params.get('complexity') is not None:
            description.append(f'\nComplexity: {filter_params["complexity"]}')
        if filter_params.get('fragment') is not None:
            description.append(f'\nFragment: {filter_params["fragment"]}')

        # Add reservation status filter description
        if filter_params.get('reserved') == 'false':
            description.append('\nReservation: Not reserved by anyone')
        elif filter_params.get('reserved') == 'true':
            description.append('\nReservation: Reserved by current user')

        # Handle bounding box filters with detailed information
        bbx_filters = []
        if filter_params.get('bbx_min_x') is not None:
            bbx_filters.append(f'\nX >= {filter_params["bbx_min_x"]:.2f}')
        if filter_params.get('bbx_max_x') is not None:
            bbx_filters.append(f'\nX <= {filter_params["bbx_max_x"]:.2f}')
        if filter_params.get('bbx_min_y') is not None:
            bbx_filters.append(f'\nY >= {filter_params["bbx_min_y"]:.2f}')
        if filter_params.get('bbx_max_y') is not None:
            bbx_filters.append(f'\nY <= {filter_params["bbx_max_y"]:.2f}')
        if filter_params.get('bbx_min_z') is not None:
            bbx_filters.append(f'\nZ >= {filter_params["bbx_min_z"]:.2f}')
        if filter_params.get('bbx_max_z') is not None:
            bbx_filters.append(f'\nZ <= {filter_params["bbx_max_z"]:.2f}')

        if bbx_filters:
            description.append(f'\nBounding Box: {", ".join(bbx_filters)}')

        return f'Applied filters: {", ".join(description)}'

    def RunScript(self,
            Type: str,
            Material: str,
            Dataset: str,
            Complexity: int,
            Fragment: bool,
            MinDimensionX: float,
            MaxDimensionX: float,
            MinDimensionY: float,
            MaxDimensionY: float,
            MinDimensionZ: float,
            MaxDimensionZ: float,
            ReservedStatus):

        # Get AuthCore instance from sticky storage
        auth_core = self.get_auth_core_from_sticky()
        if auth_core is None:
            return

        # Check if authentication is valid
        if not auth_core.is_valid():
            msg = ('Authentication expired. Please use CSC_Session '
                   'component to refresh.')
            self._addError(msg)
            self.Component.Message = msg
            return

        try:
            self.Component.Message = 'Building filter query...'

            # Build filter query parameters (parity with web filter menu)
            filter_params = self.build_filter_query_params(
                Type, Material, Dataset, Complexity, Fragment,
                MinDimensionX, MaxDimensionX, MinDimensionY,
                MaxDimensionY, MinDimensionZ, MaxDimensionZ,
                ReservedStatus
            )

            # Request params: filters + passport expansion (identity+snapshot)
            request_params = dict(filter_params)
            request_params['expand'] = 'current_snapshot'

            # Generate human-readable filter description
            filter_description = self.generate_filter_description(
                filter_params
            )

            self.Component.Message = (
                'Fetching filtered identities (with cache)...'
            )

            # Unified catalog cache (same identity/snapshot store as
            # FetchAllComponents and FetchComponents).
            response = auth_core.cached_list_identities(request_params)

            if response.status_code == 200:
                # Successfully fetched passport entries
                json_comps = response.json()
                component_count = len(json_comps)

                # Show filter info in message
                filter_msg = f'Found {component_count} components (cached).'

                self.Component.Message = filter_msg
                self._addRemark(
                    f'Successfully fetched {component_count} components '
                    f'with applied filters'
                )

                # Set up output trees and results tuple
                FilterDescription = Grasshopper.DataTree[System.Object]()
                ComponentData = Grasshopper.DataTree[System.Object]()
                __Results = (FilterDescription, ComponentData)

                # Loop over all passport entries and add them to the data tree
                for i, json_comp in enumerate(json_comps):
                    # Create datatree path
                    ghp = Grasshopper.Kernel.Data.GH_Path(0, i)
                    # Add passport JSON to the datatree
                    ComponentData.Add(
                        auth_core.passport_json_string(json_comp), ghp)

                # Add filter description to the filter query output
                FilterDescription.Add(
                    filter_description,
                    Grasshopper.Kernel.Data.GH_Path(0)
                )

                return __Results

            elif response.status_code == 401:
                msg = 'Authentication failed. Please sign in again.'
                self._addError(msg)
                self.Component.Message = msg

            elif response.status_code == 403:
                msg = 'Access denied. Insufficient permissions.'
                self._addError(msg)
                self.Component.Message = msg

            elif response.status_code == 500:
                msg = 'Server error. Please try again later.'
                self._addWarning(msg)
                self.Component.Message = msg

            else:
                msg = (f'Request failed with status code: '
                       f'{response.status_code}')
                self._addError(msg)
                self.Component.Message = msg

        except requests.exceptions.ConnectionError as e:
            msg = 'Cannot connect to server. Please check your connection.'
            self._addError(msg + f'\nFull Error: {str(e)}')
            self.Component.Message = msg

        except requests.exceptions.Timeout as e:
            msg = 'Request timeout. Server may be slow.'
            self._addError(msg + f'\nFull Error: {str(e)}')
            self.Component.Message = msg

        except requests.exceptions.RequestException as e:
            msg = f'Request error: {str(e)}'
            self._addError(msg)
            self.Component.Message = msg

        except Exception as e:
            msg = f'Unexpected error: {str(e)}'
            self._addError(msg)
            self.Component.Message = msg

        # Return empty results if there was an error
        ComponentData = Grasshopper.DataTree[System.Object]()
        FilterDescription = Grasshopper.DataTree[System.Object]()
        __Results = (FilterDescription, ComponentData)
        return __Results
# ---------- end fetchfilteredcomponents ----------
panel_2 = Panel(fetchfilteredcomponents.FilterDescription)
componentdata = Data(fetchfilteredcomponents.ComponentData)

# ---- group: __DDU_CSC_EXAMPLE_01__
# __DEVELOPMENT_CREDITS__: Authors: Max Benjamin Eschenbach
# Constributors: Alessandro Garruto
# 
# Digital Design Unit (DDU)
# Prof. Dr.-Ing. Oliver Tessmann
# Fachbereich Architektur
# Technical University of Darmstadt
# 
# CREDITS:
# ------------
# Please see: https://2ndchances.build/credits
# Step 1
# comments & notes: Create new User Session and sign in
# 
# (Add your credentials!)
ddu_csc_username = Panel("")
# ENVIRONMENT SPEC: # -*- coding: utf-8 -*-
# #! python3
# # venv: DDU_CSC
# print('ENV OK!')
# # r: charset_normalizer
# # r: requests
# # r: numpy
# # r: scipy
# # r: scikit-learn
# # r: robust-laplacian
# # r: potpourri3d
ddu_csc_password = Panel("")
disablecache = BooleanToggle(False)
clearcache = Button()
refresh = Button()
csc_session = Session(Username=ddu_csc_username, Password=ddu_csc_password, Refresh=refresh, DisableCache=disablecache, ClearCache=clearcache)  # -> Status; inputs Username: String, Password: String, Refresh: Boolean, DisableCache: Boolean, ClearCache: Boolean
# ---------- csc_session: Python ----------
#! python3
# -*- coding: utf-8 -*-
# venv: DDU_CSC
print('ENV OK!')
# r: charset_normalizer
# r: requests

# PYTHON STANDARD LIBRARY IMPORTS ---------------------------------------------
import time  # NOQA
import json  # NOQA
import base64  # NOQA
import os  # NOQA
import hashlib  # NOQA
import pickle  # NOQA
import math  # NOQA
import struct  # NOQA
from threading import RLock  # NOQA
import uuid  # NOQA
from datetime import datetime, timedelta  # NOQA

# THIRD PARTY LIBRARY IMPORTS -------------------------------------------------
import requests  # NOQA

# RHINO AND GH RELATED IMPORTS ------------------------------------------------
import System  # NOQA
import Rhino  # NOQA
import Grasshopper  # NOQA
import scriptcontext as sc  # NOQA

# GHENV COMPONENT SETTINGS ----------------------------------------------------
ghenv.Component.Name = 'Session'  # NOQA
ghenv.Component.NickName = 'CSC_Session'  # NOQA
ghenv.Component.Category = 'DDU_CSC'  # NOQA
ghenv.Component.SubCategory = '1 User'  # NOQA
ghenv.Component.Description = (  # NOQA
    'Handles user authentication with the remote API, manages access '
    'tokens, and provides a unified catalog cache (identities and '
    'snapshots stored independently, mesh PLY geometry cached per '
    'snapshot). Stores authentication state in scriptcontext.sticky.'
)

"""
Author: Max Benjamin Eschenbach
License: MIT License
Version: 260908
"""


def _compute_passport_etag(identity_doc, snapshot_docs):
    """Match backend ``_compute_passport_etag`` (identity + snapshot rows)."""
    parts = [identity_doc.get('lastmodified', '')]
    for doc in sorted(
            snapshot_docs or [],
            key=lambda row: str(row.get('_id', ''))):
        parts.append(str(doc.get('etag', '')))
    return hashlib.sha256('::'.join(parts).encode('utf-8')).hexdigest()


def _passport_cache_key(identity_id, snapshots=None):
    """Stable cache key for a passport GET variant."""
    if not snapshots or snapshots == 'current':
        return f'passport:{identity_id}:current'
    if snapshots == 'all':
        return f'passport:{identity_id}:all'
    if isinstance(snapshots, (list, tuple)):
        joined = ','.join(sorted(str(item) for item in snapshots))
        digest = hashlib.md5(joined.encode('utf-8')).hexdigest()[:16]
        return f'passport:{identity_id}:ids:{digest}'
    return f'passport:{identity_id}:custom'


def primary_snapshot_from_passport(passport):
    """Return the first snapshot from a passport payload."""
    if not isinstance(passport, dict):
        return None
    snapshots = passport.get('snapshots') or []
    if snapshots and isinstance(snapshots[0], dict):
        return snapshots[0]
    legacy = passport.get('snapshot')
    if isinstance(legacy, dict):
        return legacy
    return None


def normalize_passport_payload(passport):
    """
    Ensure passport-shaped dicts use {identity, snapshots[]}.

    Accepts legacy {identity, snapshot} list rows and normalizes them.
    """
    if not isinstance(passport, dict):
        return passport
    identity = passport.get('identity')
    if not isinstance(identity, dict):
        return passport

    snapshots = passport.get('snapshots')
    if isinstance(snapshots, list) and snapshots:
        out = {'identity': identity, 'snapshots': snapshots}
    else:
        legacy = passport.get('snapshot')
        if isinstance(legacy, dict):
            out = {'identity': identity, 'snapshots': [legacy]}
        else:
            return passport

    if 'reserved_by_username' in passport:
        out['reserved_by_username'] = passport['reserved_by_username']
    return out


def _query_cache_key(params):
    """Stable cache key for a GET /identities query parameter dict."""
    if not params:
        return 'query:identities'
    items = sorted((str(k), str(v)) for k, v in params.items())
    payload = '&'.join(f'{k}={v}' for k, v in items)
    return 'query:' + hashlib.md5(payload.encode('utf-8')).hexdigest()


class _CachedResponse(object):
    """Minimal response wrapper for cache hits (status 200 + JSON body)."""

    def __init__(self, data, etag=None, status_code=200):
        self.status_code = status_code
        self._data = data
        self._etag = etag

    def json(self):
        return self._data

    @property
    def headers(self):
        return {'ETag': self._etag} if self._etag else {}


# ComponentCache - Embedded ---------------------------------------------------

class _ComponentCache(object):
    """
    Component cache manager for efficient local storage and retrieval.

    Author: Max Benjamin Eschenbach
    License: MIT License
    """

    def __init__(self, cache_dir=None, ttl_hours=24):
        self.ttl_hours = ttl_hours
        self.cache_dir = cache_dir or self._get_default_cache_dir()
        self.components_dir = os.path.join(self.cache_dir, 'components')
        self.identities_dir = os.path.join(self.cache_dir, 'identities')
        self.snapshots_dir = os.path.join(self.cache_dir, 'snapshots')
        self.designs_dir = os.path.join(self.cache_dir, 'designs')
        self.metadata_dir = os.path.join(self.cache_dir, 'metadata')
        self.geometry_dir = os.path.join(self.cache_dir, 'component_geometry')
        self._lock = RLock()

        # Ensure cache directories exist
        self._ensure_cache_dirs()

    def _get_default_cache_dir(self):
        """Get platform-specific cache directory."""
        if os.name == 'nt':  # Windows
            appdata = os.environ.get('APPDATA', '')
            return os.path.join(appdata, 'DDU_CSC', 'cache')
        else:  # macOS/Linux
            home = os.path.expanduser('~')
            return os.path.join(
                home, 'Library', 'Application Support', 'DDU_CSC', 'cache'
            )

    def _ensure_cache_dirs(self):
        """Create cache directories if they don't exist."""
        dirs = [
            self.cache_dir, self.components_dir, self.identities_dir,
            self.snapshots_dir, self.designs_dir, self.metadata_dir,
            self.geometry_dir
        ]
        for directory in dirs:
            if not os.path.exists(directory):
                os.makedirs(directory, exist_ok=True)

    def _get_cache_key_hash(self, cache_key):
        """Generate a safe filename from cache key."""
        return hashlib.md5(cache_key.encode('utf-8')).hexdigest()

    def _is_expired(self, timestamp_str):
        """Check if cache entry is expired based on TTL."""
        try:
            timestamp = datetime.fromisoformat(
                timestamp_str.replace('Z', '+00:00'))
            expiry = timestamp + timedelta(hours=self.ttl_hours)
            return datetime.now(timestamp.tzinfo) > expiry
        except (ValueError, TypeError):
            return True  # If we can't parse timestamp, consider expired

    def get(self, cache_key, filters=None):
        """
        Get cached data for a cache key.

        Args:
            cache_key: Cache key (e.g., 'all_components', 'component:uuid')
            filters: Optional filter parameters for metadata cache

        Returns:
            Tuple of (data, etag, is_from_cache) or
            (None, None, False) if not found
        """
        # Try binary cache first
        return self.get_binary(cache_key)

    def set(self, cache_key, data, etag=None, filters=None):
        """
        Store data in cache.

        Args:
            cache_key: Cache key
            data: Data to cache
            etag: ETag for the data
            filters: Optional filter parameters
        """
        # Use binary cache
        self.set_binary(cache_key, data, etag, filters)

    def _write_metadata(self, cache_key, metadata):
        metadata_file = os.path.join(
            self.metadata_dir,
            f"{self._get_cache_key_hash(cache_key)}.json"
        )
        with open(metadata_file, 'w', encoding='utf-8') as f:
            json.dump(metadata, f, indent=2, ensure_ascii=False)

    def _read_metadata(self, cache_key):
        metadata_file = os.path.join(
            self.metadata_dir,
            f"{self._get_cache_key_hash(cache_key)}.json"
        )
        if not os.path.exists(metadata_file):
            return None
        with open(metadata_file, 'r', encoding='utf-8') as f:
            metadata = json.load(f)
        if self._is_expired(metadata.get('cached_at', '')):
            return None
        return metadata

    # Identity / snapshot catalog cache (v0.5) -------------------------------

    def set_identity(self, identity_id, identity_doc):
        """Store one identity document (keyed by identity id)."""
        with self._lock:
            try:
                cache_key = f'identity:{identity_id}'
                identity_file = os.path.join(
                    self.identities_dir, f'{identity_id}.pkl'
                )
                with open(identity_file, 'wb') as f:
                    pickle.dump(identity_doc, f)
                self._write_metadata(cache_key, {
                    'cache_key': cache_key,
                    'cached_at': datetime.now().isoformat(),
                    'etag': identity_doc.get('lastmodified'),
                    'type': 'identity',
                    'current_snapshot_id': identity_doc.get(
                        'current_snapshot_id'),
                })
            except (IOError, pickle.PickleError):
                pass

    def get_identity(self, identity_id):
        """Return (identity_doc, etag, is_cached)."""
        with self._lock:
            try:
                cache_key = f'identity:{identity_id}'
                metadata = self._read_metadata(cache_key)
                if metadata is None:
                    return None, None, False
                identity_file = os.path.join(
                    self.identities_dir, f'{identity_id}.pkl'
                )
                if not os.path.exists(identity_file):
                    return None, None, False
                with open(identity_file, 'rb') as f:
                    identity_doc = pickle.load(f)
                return identity_doc, metadata.get('etag'), True
            except (IOError, pickle.PickleError, KeyError):
                return None, None, False

    def set_snapshot(self, snapshot_id, snapshot_doc):
        """Store one snapshot document (keyed by snapshot id)."""
        with self._lock:
            try:
                cache_key = f'snapshot:{snapshot_id}'
                snapshot_file = os.path.join(
                    self.snapshots_dir, f'{snapshot_id}.pkl'
                )
                with open(snapshot_file, 'wb') as f:
                    pickle.dump(snapshot_doc, f)
                self._write_metadata(cache_key, {
                    'cache_key': cache_key,
                    'cached_at': datetime.now().isoformat(),
                    'etag': snapshot_doc.get('etag'),
                    'type': 'snapshot',
                    'identity_id': snapshot_doc.get('identity_id'),
                })
            except (IOError, pickle.PickleError):
                pass

    def get_snapshot(self, snapshot_id):
        """Return (snapshot_doc, etag, is_cached)."""
        with self._lock:
            try:
                cache_key = f'snapshot:{snapshot_id}'
                metadata = self._read_metadata(cache_key)
                if metadata is None:
                    return None, None, False
                snapshot_file = os.path.join(
                    self.snapshots_dir, f'{snapshot_id}.pkl'
                )
                if not os.path.exists(snapshot_file):
                    return None, None, False
                with open(snapshot_file, 'rb') as f:
                    snapshot_doc = pickle.load(f)
                return snapshot_doc, metadata.get('etag'), True
            except (IOError, pickle.PickleError, KeyError):
                return None, None, False

    def ingest_passport_row(self, row):
        """
        Store identity + snapshot(s) from one passport row.

        Accepts {identity, snapshots[]} and list rows {identity, snapshot}.
        Returns the identity id when stored, else None.
        """
        if not isinstance(row, dict):
            return None
        identity = row.get('identity')
        if not isinstance(identity, dict):
            return None
        identity_id = identity.get('_id') or identity.get('id')
        if not identity_id:
            return None

        stored_any = False
        snapshots = row.get('snapshots') or []
        if isinstance(snapshots, list) and snapshots:
            for snapshot in snapshots:
                if not isinstance(snapshot, dict):
                    continue
                snapshot_id = snapshot.get('_id') or snapshot.get('id')
                if not snapshot_id:
                    continue
                self.set_snapshot(snapshot_id, snapshot)
                stored_any = True
        else:
            snapshot = row.get('snapshot')
            if isinstance(snapshot, dict):
                snapshot_id = snapshot.get('_id') or snapshot.get('id')
                if snapshot_id:
                    self.set_snapshot(snapshot_id, snapshot)
                    stored_any = True

        if not stored_any:
            return None

        self.set_identity(identity_id, identity)
        return identity_id

    def ingest_passport_rows(self, rows):
        """Store many passport rows; return ordered identity ids."""
        identity_ids = []
        for row in rows or []:
            identity_id = self.ingest_passport_row(row)
            if identity_id:
                identity_ids.append(identity_id)
        return identity_ids

    def assemble_passport(self, identity_id):
        """
        Build {identity, snapshots:[current]} from cached documents.

        Uses identity.current_snapshot_id to pick the snapshot.
        """
        identity_doc, _, identity_ok = self.get_identity(identity_id)
        if not identity_ok or not identity_doc:
            return None
        snapshot_id = identity_doc.get('current_snapshot_id')
        if not snapshot_id:
            return None
        snapshot_doc, _, snapshot_ok = self.get_snapshot(snapshot_id)
        if not snapshot_ok or not snapshot_doc:
            return None
        return {
            'identity': identity_doc,
            'snapshots': [snapshot_doc],
        }

    def set_query(self, query_key, identity_ids, etag=None, params=None):
        """Store list-query metadata (identity id index + list ETag)."""
        with self._lock:
            try:
                self._write_metadata(query_key, {
                    'cache_key': query_key,
                    'cached_at': datetime.now().isoformat(),
                    'etag': etag,
                    'type': 'query',
                    'identity_ids': list(identity_ids),
                    'params': params,
                })
            except (IOError, TypeError):
                pass

    def get_query(self, query_key):
        """Return (identity_ids, etag, is_cached) for a list query."""
        with self._lock:
            try:
                metadata = self._read_metadata(query_key)
                if metadata is None:
                    return None, None, False
                return (
                    metadata.get('identity_ids') or [],
                    metadata.get('etag'),
                    True,
                )
            except (IOError, KeyError):
                return None, None, False

    def assemble_passport_list(self, identity_ids):
        """Build passport rows from cached identity/snapshot documents."""
        rows = []
        for identity_id in identity_ids or []:
            passport = self.assemble_passport(identity_id)
            if passport:
                rows.append(passport)
        return rows

    def invalidate(self, pattern=None):
        """
        Invalidate cache entries.

        Args:
            pattern: Optional pattern to match cache keys (None = clear all)
        """
        with self._lock:
            try:
                if pattern is None:
                    # Clear all cache
                    for directory in [
                            self.components_dir,
                            self.identities_dir,
                            self.snapshots_dir,
                            self.metadata_dir,
                            self.geometry_dir
                    ]:
                        if os.path.exists(directory):
                            for filename in os.listdir(directory):
                                file_path = os.path.join(directory, filename)
                                if os.path.isfile(file_path):
                                    os.remove(file_path)
                                elif os.path.isdir(file_path):
                                    # Remove subdirectories
                                    # (geometry type folders)
                                    import shutil
                                    shutil.rmtree(
                                        file_path,
                                        ignore_errors=True
                                    )
                else:
                    # Clear specific pattern
                    pattern_hash = self._get_cache_key_hash(pattern)
                    metadata_file = os.path.join(
                        self.metadata_dir, f"{pattern_hash}.json"
                    )
                    if os.path.exists(metadata_file):
                        os.remove(metadata_file)

            except (IOError, OSError):
                pass

    def get_cache_stats(self):
        """Get cache statistics."""
        with self._lock:
            try:
                component_count = len(
                    [f for f in os.listdir(self.components_dir)
                     if f.endswith('.pkl')]
                )
                identity_count = len(
                    [f for f in os.listdir(self.identities_dir)
                     if f.endswith('.pkl')]
                )
                snapshot_count = len(
                    [f for f in os.listdir(self.snapshots_dir)
                     if f.endswith('.pkl')]
                )
                metadata_count = len(
                    [f for f in os.listdir(self.metadata_dir)
                     if f.endswith('.json')]
                )

                # Calculate total cache size
                total_size = 0
                for directory in [
                        self.components_dir, self.identities_dir,
                        self.snapshots_dir, self.metadata_dir
                ]:
                    for filename in os.listdir(directory):
                        file_path = os.path.join(directory, filename)
                        if os.path.isfile(file_path):
                            total_size += os.path.getsize(file_path)

                # Calculate geometry cache stats
                geometry_count = 0
                geometry_size = 0
                if os.path.exists(self.geometry_dir):
                    for root, dirs, files in os.walk(self.geometry_dir):
                        for file in files:
                            if file.endswith('.pkl'):
                                geometry_count += 1
                                file_path = os.path.join(root, file)
                                if os.path.isfile(file_path):
                                    geometry_size += os.path.getsize(file_path)

                # Calculate design cache stats
                design_count = 0
                design_size = 0
                if os.path.exists(self.designs_dir):
                    for filename in os.listdir(self.designs_dir):
                        if filename.endswith('.pkl'):
                            design_count += 1
                            file_path = os.path.join(
                                self.designs_dir, filename)
                            if os.path.isfile(file_path):
                                design_size += os.path.getsize(file_path)

                return {
                    'component_count': component_count,
                    'identity_count': identity_count,
                    'snapshot_count': snapshot_count,
                    'metadata_count': metadata_count,
                    'geometry_count': geometry_count,
                    'design_count': design_count,
                    'total_size_bytes': (total_size + geometry_size +
                                         design_size),
                    'geometry_size_bytes': geometry_size,
                    'design_size_bytes': design_size,
                    'cache_dir': self.cache_dir
                }
            except (IOError, OSError):
                return {
                    'component_count': 0,
                    'identity_count': 0,
                    'snapshot_count': 0,
                    'metadata_count': 0,
                    'geometry_count': 0,
                    'design_count': 0,
                    'total_size_bytes': 0,
                    'geometry_size_bytes': 0,
                    'design_size_bytes': 0,
                    'cache_dir': self.cache_dir
                }

    def get_binary(self, cache_key):
        """
        Get cached data from binary cache.

        Args:
            cache_key: Cache key (e.g., 'component:uuid')

        Returns:
            Tuple of (data, etag, is_from_cache) or
            (None, None, False) if not found
        """
        with self._lock:
            try:
                # Check metadata cache first
                metadata_file = os.path.join(
                    self.metadata_dir,
                    f"{self._get_cache_key_hash(cache_key)}.json"
                )

                if not os.path.exists(metadata_file):
                    return None, None, False

                with open(metadata_file, 'r', encoding='utf-8') as f:
                    metadata = json.load(f)

                # Check if expired
                if self._is_expired(metadata.get('cached_at', '')):
                    return None, None, False

                # Handle different cache key types
                if cache_key.startswith('component:'):
                    # Individual component
                    component_id = cache_key.split(':', 1)[1]
                    component_file = os.path.join(
                        self.components_dir, f"{component_id}.pkl"
                    )

                    if os.path.exists(component_file):
                        with open(component_file, 'rb') as f:
                            component_data = pickle.load(f)
                        return component_data, metadata.get('etag'), True

                elif cache_key.startswith('design:'):
                    # Individual design
                    design_id = cache_key.split(':', 1)[1]
                    design_file = os.path.join(
                        self.designs_dir, f"{design_id}.pkl"
                    )

                    if os.path.exists(design_file):
                        with open(design_file, 'rb') as f:
                            design_data = pickle.load(f)
                        return design_data, metadata.get('etag'), True

                elif cache_key == 'schema:create_identity':
                    # Schema data is stored directly in metadata
                    return metadata.get('data'), metadata.get('etag'), True

                elif cache_key == 'schema:design':
                    # Schema data is stored directly in metadata
                    return metadata.get('data'), metadata.get('etag'), True

                return None, None, False

            except (IOError, pickle.PickleError, KeyError):
                return None, None, False

    def set_binary(self, cache_key, data, etag=None, filters=None):
        """
        Store data in binary cache.

        Args:
            cache_key: Cache key
            data: Data to cache
            etag: ETag for the data
            filters: Optional filter parameters
        """
        with self._lock:
            try:
                current_time = datetime.now().isoformat()
                # Guards against unhandled cache keys (avoids referencing an
                # unassigned ``metadata`` at the write step below).
                metadata = None

                if cache_key.startswith('component:'):
                    # Individual component
                    component_id = cache_key.split(':', 1)[1]
                    component_file = os.path.join(
                        self.components_dir, f"{component_id}.pkl"
                    )

                    # Store component data as pickle
                    with open(component_file, 'wb') as f:
                        pickle.dump(data, f)

                    # Store metadata
                    metadata = {
                        'cache_key': cache_key,
                        'cached_at': current_time,
                        'etag': etag,
                        'type': 'component'
                    }

                elif cache_key.startswith('design:'):
                    # Individual design
                    design_id = cache_key.split(':', 1)[1]
                    design_file = os.path.join(
                        self.designs_dir, f"{design_id}.pkl"
                    )

                    # Store design data as pickle
                    with open(design_file, 'wb') as f:
                        pickle.dump(data, f)

                    # Store metadata
                    metadata = {
                        'cache_key': cache_key,
                        'cached_at': current_time,
                        'etag': etag,
                        'type': 'design'
                    }

                elif cache_key == 'schema:create_identity':
                    # Schema data - store directly in metadata
                    metadata = {
                        'cache_key': cache_key,
                        'cached_at': current_time,
                        'etag': etag,
                        'type': 'schema',
                        'data': data
                    }

                elif cache_key == 'schema:design':
                    # Schema data - store directly in metadata
                    metadata = {
                        'cache_key': cache_key,
                        'cached_at': current_time,
                        'etag': etag,
                        'type': 'schema',
                        'data': data
                    }

                # Unhandled cache key: nothing to persist, bail out safely
                if metadata is None:
                    return

                # Write metadata file
                metadata_file = os.path.join(
                    self.metadata_dir,
                    f"{self._get_cache_key_hash(cache_key)}.json"
                )
                with open(metadata_file, 'w', encoding='utf-8') as f:
                    json.dump(metadata, f, indent=2, ensure_ascii=False)

            except (IOError, pickle.PickleError, KeyError):
                # Silently fail cache writes to not break main functionality
                pass

    def get_mesh_binary(self, snapshot_id, primitive_index, resolution):
        """
        Get one cached snapshot-primitive mesh from binary cache.

        Args:
            snapshot_id: Snapshot UUID
            primitive_index: Index into the snapshot geometry.meshes array
            resolution: 'reduced' or 'detailed'

        Returns:
            Tuple of (mesh, etag, is_from_cache) or (None, None, False)
        """
        with self._lock:
            try:
                cache_key = (
                    f'mesh:{resolution}:{snapshot_id}:{primitive_index}'
                )
                metadata_file = os.path.join(
                    self.metadata_dir,
                    f"{self._get_cache_key_hash(cache_key)}.json"
                )

                if not os.path.exists(metadata_file):
                    return None, None, False

                with open(metadata_file, 'r', encoding='utf-8') as f:
                    metadata = json.load(f)

                # Check if expired
                if self._is_expired(metadata.get('cached_at', '')):
                    return None, None, False

                # Get mesh file path
                mesh_file = os.path.join(
                    self.geometry_dir,
                    resolution,
                    f"{snapshot_id}_{primitive_index}.pkl"
                )

                if os.path.exists(mesh_file):
                    with open(mesh_file, 'rb') as f:
                        mesh_json = pickle.load(f)
                    mesh = Rhino.Geometry.Mesh.FromJSON(mesh_json)
                    if mesh:
                        return mesh, metadata.get('etag'), True

                return None, None, False

            except (IOError, pickle.PickleError, KeyError):
                return None, None, False

    def set_mesh_binary(
            self, snapshot_id, primitive_index, resolution, mesh, etag):
        """
        Cache one snapshot-primitive mesh as binary (mesh ToJSON pickle).

        Args:
            snapshot_id: Snapshot UUID
            primitive_index: Index into the snapshot geometry.meshes array
            resolution: 'reduced' or 'detailed'
            mesh: Rhino.Geometry.Mesh object (already parsed from PLY)
            etag: ETag from server response
        """
        with self._lock:
            try:
                current_time = datetime.now().isoformat()
                cache_key = (
                    f'mesh:{resolution}:{snapshot_id}:{primitive_index}'
                )

                # Create geometry subdirectory
                geometry_subdir = os.path.join(
                    self.geometry_dir, resolution
                )
                os.makedirs(geometry_subdir, exist_ok=True)

                # Convert mesh to JSON string using ToJSON
                options = Rhino.FileIO.SerializationOptions()
                options.WriteUserData = True
                options.WriteRenderMeshes = True
                options.WriteAnalysisMeshes = True
                mesh_json = mesh.ToJSON(options)

                # Store JSON string as pickle
                mesh_file = os.path.join(
                    geometry_subdir,
                    f"{snapshot_id}_{primitive_index}.pkl"
                )
                with open(mesh_file, 'wb') as f:
                    pickle.dump(mesh_json, f)

                # Store metadata
                metadata = {
                    'cache_key': cache_key,
                    'cached_at': current_time,
                    'etag': etag,
                    'type': 'mesh',
                    'resolution': resolution,
                    'snapshot_id': snapshot_id,
                    'primitive_index': primitive_index
                }

                metadata_file = os.path.join(
                    self.metadata_dir,
                    f"{self._get_cache_key_hash(cache_key)}.json"
                )
                with open(metadata_file, 'w', encoding='utf-8') as f:
                    json.dump(metadata, f, indent=2, ensure_ascii=False)

            except (IOError, pickle.PickleError, KeyError):
                # Silently fail cache writes to not break main functionality
                pass

    def get_point_cloud_binary(self, snapshot_id, primitive_index):
        """
        Get one cached snapshot point cloud from binary cache.

        Returns:
            Tuple of (point_cloud, etag, is_from_cache) or
            (None, None, False)
        """
        with self._lock:
            try:
                cache_key = (
                    f'point_cloud:{snapshot_id}:{primitive_index}'
                )
                metadata_file = os.path.join(
                    self.metadata_dir,
                    f"{self._get_cache_key_hash(cache_key)}.json"
                )

                if not os.path.exists(metadata_file):
                    return None, None, False

                with open(metadata_file, 'r', encoding='utf-8') as f:
                    metadata = json.load(f)

                if self._is_expired(metadata.get('cached_at', '')):
                    return None, None, False

                cloud_file = os.path.join(
                    self.geometry_dir,
                    'point_cloud',
                    f"{snapshot_id}_{primitive_index}.pkl"
                )

                if os.path.exists(cloud_file):
                    with open(cloud_file, 'rb') as f:
                        cloud_json = pickle.load(f)
                    loaded = Rhino.Runtime.CommonObject.FromJSON(cloud_json)
                    if isinstance(loaded, Rhino.Geometry.PointCloud):
                        return loaded, metadata.get('etag'), True

                return None, None, False

            except (IOError, pickle.PickleError, KeyError, TypeError):
                return None, None, False

    def set_point_cloud_binary(
            self, snapshot_id, primitive_index, cloud, etag):
        """
        Cache one snapshot point cloud as binary (ToJSON pickle).
        """
        with self._lock:
            try:
                current_time = datetime.now().isoformat()
                cache_key = (
                    f'point_cloud:{snapshot_id}:{primitive_index}'
                )

                geometry_subdir = os.path.join(
                    self.geometry_dir, 'point_cloud'
                )
                os.makedirs(geometry_subdir, exist_ok=True)

                options = Rhino.FileIO.SerializationOptions()
                options.WriteUserData = True
                cloud_json = cloud.ToJSON(options)

                cloud_file = os.path.join(
                    geometry_subdir,
                    f"{snapshot_id}_{primitive_index}.pkl"
                )
                with open(cloud_file, 'wb') as f:
                    pickle.dump(cloud_json, f)

                metadata = {
                    'cache_key': cache_key,
                    'cached_at': current_time,
                    'etag': etag,
                    'type': 'point_cloud',
                    'snapshot_id': snapshot_id,
                    'primitive_index': primitive_index
                }

                metadata_file = os.path.join(
                    self.metadata_dir,
                    f"{self._get_cache_key_hash(cache_key)}.json"
                )
                with open(metadata_file, 'w', encoding='utf-8') as f:
                    json.dump(metadata, f, indent=2, ensure_ascii=False)

            except (IOError, pickle.PickleError, KeyError):
                pass


def _parse_ply_binary_to_mesh(ply_bytes):
    """
    Parse a binary_little_endian PLY (CSC canonical, Rhino Z-up) into a
    single Rhino.Geometry.Mesh. Supports float/double vertex coords,
    optional uchar red/green/blue, and a face list (uchar count + int
    indices). No coordinate rotation is applied (PLY is already Z-up).
    Returns the mesh or None on failure.
    """
    try:
        if not ply_bytes:
            return None

        # Locate end of (ascii) header
        marker = b'end_header\n'
        header_end = ply_bytes.find(marker)
        if header_end == -1:
            print('PLY: missing end_header')
            return None
        header_text = ply_bytes[:header_end].decode('ascii', 'ignore')
        body = ply_bytes[header_end + len(marker):]

        if 'binary_little_endian' not in header_text:
            print('PLY: only binary_little_endian supported')
            return None

        # Parse header elements/properties
        _type_fmt = {
            'char': 'b', 'int8': 'b',
            'uchar': 'B', 'uint8': 'B',
            'short': 'h', 'int16': 'h',
            'ushort': 'H', 'uint16': 'H',
            'int': 'i', 'int32': 'i',
            'uint': 'I', 'uint32': 'I',
            'float': 'f', 'float32': 'f',
            'double': 'd', 'float64': 'd',
        }
        _type_size = {
            'b': 1, 'B': 1, 'h': 2, 'H': 2,
            'i': 4, 'I': 4, 'f': 4, 'd': 8,
        }

        vertex_count = 0
        face_count = 0
        vertex_props = []  # list of (fmt_char, name)
        face_list = None  # (count_fmt, index_fmt)
        current = None
        for raw_line in header_text.splitlines():
            line = raw_line.strip()
            if not line:
                continue
            tok = line.split()
            if tok[0] == 'element':
                current = tok[1]
                if current == 'vertex':
                    vertex_count = int(tok[2])
                elif current == 'face':
                    face_count = int(tok[2])
            elif tok[0] == 'property':
                if tok[1] == 'list':
                    count_fmt = _type_fmt.get(tok[2], 'B')
                    index_fmt = _type_fmt.get(tok[3], 'i')
                    face_list = (count_fmt, index_fmt)
                elif current == 'vertex':
                    fmt = _type_fmt.get(tok[1])
                    if fmt:
                        vertex_props.append((fmt, tok[2]))

        if face_list is None:
            face_list = ('B', 'i')

        # Read vertices
        vertex_struct = struct.Struct(
            '<' + ''.join(f for f, _ in vertex_props)
        )
        names = [n for _, n in vertex_props]
        ix = names.index('x') if 'x' in names else 0
        iy = names.index('y') if 'y' in names else 1
        iz = names.index('z') if 'z' in names else 2
        has_color = ('red' in names and 'green' in names and
                     'blue' in names)
        if has_color:
            ir = names.index('red')
            ig = names.index('green')
            ib = names.index('blue')

        mesh = Rhino.Geometry.Mesh()
        offset = 0
        vsize = vertex_struct.size
        colors = []
        for _ in range(vertex_count):
            vals = vertex_struct.unpack_from(body, offset)
            offset += vsize
            mesh.Vertices.Add(
                float(vals[ix]), float(vals[iy]), float(vals[iz])
            )
            if has_color:
                colors.append(
                    (int(vals[ir]), int(vals[ig]), int(vals[ib]))
                )

        # Read faces
        count_fmt, index_fmt = face_list
        count_struct = struct.Struct('<' + count_fmt)
        count_size = _type_size[count_fmt]
        index_size = _type_size[index_fmt]
        for _ in range(face_count):
            (n,) = count_struct.unpack_from(body, offset)
            offset += count_size
            idx_struct = struct.Struct('<' + index_fmt * n)
            indices = idx_struct.unpack_from(body, offset)
            offset += index_size * n
            if n == 3:
                mesh.Faces.AddFace(indices[0], indices[1], indices[2])
            elif n == 4:
                mesh.Faces.AddFace(
                    indices[0], indices[1], indices[2], indices[3]
                )
            elif n > 4:
                for k in range(1, n - 1):
                    mesh.Faces.AddFace(
                        indices[0], indices[k], indices[k + 1]
                    )

        if has_color and len(colors) == mesh.Vertices.Count:
            for r, g, b in colors:
                mesh.VertexColors.Add(r, g, b)

        mesh.Normals.ComputeNormals()
        mesh.Compact()
        return mesh

    except Exception as e:
        print(f'Error parsing PLY: {str(e)}')
        return None


def _parse_ply_binary_to_point_cloud(ply_bytes):
    """
    Parse a binary_little_endian point-cloud PLY (vertices only, optional
    uchar rgb) into a Rhino.Geometry.PointCloud.
    """
    try:
        if not ply_bytes:
            return None

        marker = b'end_header\n'
        header_end = ply_bytes.find(marker)
        if header_end == -1:
            print('PLY point cloud: missing end_header')
            return None
        header_text = ply_bytes[:header_end].decode('ascii', 'ignore')
        body = ply_bytes[header_end + len(marker):]

        if 'binary_little_endian' not in header_text:
            print('PLY point cloud: only binary_little_endian supported')
            return None

        _type_fmt = {
            'char': 'b', 'int8': 'b',
            'uchar': 'B', 'uint8': 'B',
            'short': 'h', 'int16': 'h',
            'ushort': 'H', 'uint16': 'H',
            'int': 'i', 'int32': 'i',
            'uint': 'I', 'uint32': 'I',
            'float': 'f', 'float32': 'f',
            'double': 'd', 'float64': 'd',
        }

        vertex_count = 0
        vertex_props = []
        current = None
        for raw_line in header_text.splitlines():
            line = raw_line.strip()
            if not line:
                continue
            tok = line.split()
            if tok[0] == 'element':
                current = tok[1]
                if current == 'vertex':
                    vertex_count = int(tok[2])
            elif tok[0] == 'property' and current == 'vertex':
                if tok[1] != 'list':
                    fmt = _type_fmt.get(tok[1])
                    if fmt:
                        vertex_props.append((fmt, tok[2]))

        if vertex_count <= 0 or not vertex_props:
            return None

        vertex_struct = struct.Struct(
            '<' + ''.join(f for f, _ in vertex_props)
        )
        names = [n for _, n in vertex_props]
        ix = names.index('x') if 'x' in names else 0
        iy = names.index('y') if 'y' in names else 1
        iz = names.index('z') if 'z' in names else 2
        has_color = ('red' in names and 'green' in names and
                     'blue' in names)
        if has_color:
            ir = names.index('red')
            ig = names.index('green')
            ib = names.index('blue')

        cloud = Rhino.Geometry.PointCloud()
        offset = 0
        vsize = vertex_struct.size
        for _ in range(vertex_count):
            vals = vertex_struct.unpack_from(body, offset)
            offset += vsize
            point = Rhino.Geometry.Point3d(
                float(vals[ix]), float(vals[iy]), float(vals[iz]))
            if has_color:
                cloud.Add(
                    point,
                    System.Drawing.Color.FromArgb(
                        int(vals[ir]), int(vals[ig]), int(vals[ib])))
            else:
                cloud.Add(point)

        return cloud if cloud.Count > 0 else None

    except Exception as e:
        print(f'Error parsing point cloud PLY: {str(e)}')
        return None


# AuthCore - Embedded ---------------------------------------------------------

class _AuthCore(object):
    """
    Authorization and cache management tool that gets stored in sticky to be
    used by other CSC Grasshopper Components.

    Author: Max Benjamin Eschenbach
    License: MIT License
    """

    def __init__(self, base_url, leeway=30, disable_cache=False):
        self.base_url = (base_url or 'https://api.2ndchances.build').rstrip('/')
        self.leeway = int(leeway) if leeway is not None else 30
        self.disable_cache = disable_cache
        self._lock = RLock()
        self._token = None
        self._exp = 0
        self._username = None
        self._cache = None if disable_cache else _ComponentCache()

    @staticmethod
    def _now():
        return int(time.time())

    @staticmethod
    def _b64url_decode(seg):
        rem = len(seg) % 4
        if rem:
            seg += '=' * (4 - rem)
        return base64.urlsafe_b64decode(seg.encode('utf-8'))

    @classmethod
    def _jwt_payload(cls, token):
        try:
            parts = token.split('.')
            if len(parts) != 3:
                return {}
            return json.loads(cls._b64url_decode(parts[1]).decode('utf-8'))
        except Exception:
            return {}

    def set_access_token(self, token, username=None):
        payload = self._jwt_payload(token)
        exp = int(payload.get('exp', 0))
        if exp <= 0:
            exp = self._now() + 3600  # 1h fallback if no exp claim
        with self._lock:
            self._token = token
            self._exp = exp
            if username:
                self._username = username

    def clear(self):
        with self._lock:
            self._token = None
            self._exp = 0
            self._username = None

    def is_valid(self):
        with self._lock:
            if not self._token or self._exp <= 0:
                return False
            return (self._now() + self.leeway) < self._exp

    def get_username(self):
        with self._lock:
            return self._username

    def auth_header(self):
        with self._lock:
            return ({'Authorization': 'Bearer ' + self._token}
                    if self._token else {})

    def authorized_get(
            self,
            path,
            params=None,
            extra_headers=None,
            timeout=20):
        if not self.is_valid():
            raise RuntimeError(
                'Access token missing or expired. Please sign in again.'
            )
        headers = self.auth_header()
        if extra_headers:
            headers.update(extra_headers)
        return requests.get(
            self.base_url + path,
            params=params,
            headers=headers,
            timeout=timeout
        )

    def authorized_post(
            self,
            path,
            json_body=None,
            files=None,
            extra_headers=None,
            timeout=60):
        if not self.is_valid():
            raise RuntimeError(
                'Access token missing or expired. Please sign in again.'
            )
        headers = self.auth_header()
        if extra_headers:
            headers.update(extra_headers)
        # Handle file uploads vs JSON requests
        if files is not None:
            # For file uploads, don't set Content-Type header
            # (let requests handle it)
            # and use data instead of json
            return requests.post(
                self.base_url + path,
                files=files,
                headers=headers,
                timeout=timeout
            )
        else:
            # For JSON requests, use json parameter
            return requests.post(
                self.base_url + path,
                json=json_body,
                headers=headers,
                timeout=timeout
            )

    def validate_uuid(self, uuid_to_test: str, version: int = 4):
        """
        Check if uuid_to_test is a valid UUID.
        Returns True if uuid_to_test is a valid UUID, otherwise False.
        """
        try:
            uuid_obj = uuid.UUID(uuid_to_test, version=version)
        except ValueError:
            return False
        return str(uuid_obj) == uuid_to_test

    def resolve_identity_id_from_input(self, value):
        """
        Resolve an identity UUID from a raw UUID string or passport JSON.
        """
        if value is None:
            return None
        text = str(value).strip()
        if not text:
            return None
        if self.validate_uuid(text):
            return text
        try:
            data = value if isinstance(value, dict) else json.loads(text)
        except (TypeError, ValueError, json.JSONDecodeError):
            return None
        if not isinstance(data, dict):
            return None
        identity = data.get('identity')
        if not isinstance(identity, dict):
            return None
        identity_id = identity.get('_id') or identity.get('id')
        if identity_id and self.validate_uuid(str(identity_id)):
            return str(identity_id)
        return None

    def primary_snapshot(self, passport):
        """Return the first snapshot from a passport payload."""
        return primary_snapshot_from_passport(passport)

    def normalize_passport_output(self, passport):
        """Return {identity, snapshots[]} for downstream GH components."""
        return normalize_passport_payload(passport)

    def passport_json_string(self, passport):
        """
        Serialize one passport row in the canonical
        {identity, snapshots[]} shape.
        """
        return json.dumps(self.normalize_passport_output(passport))

    # Cache Management Methods ------------------------------------------------

    def get_cache(self):
        """Get the cache instance."""
        return self._cache

    def set_cache_enabled(self, enabled):
        """Enable or disable caching."""
        with self._lock:
            self.disable_cache = not enabled
            if enabled and self._cache is None:
                self._cache = _ComponentCache()
            elif not enabled:
                self._cache = None

    def is_cache_enabled(self):
        """Check if caching is enabled."""
        return self._cache is not None

    def sync_cache(self):
        """Force cache synchronization (clear cache)."""
        if self._cache:
            self._cache.invalidate()

    def get_cache_stats(self):
        """Get cache statistics."""
        if self._cache:
            return self._cache.get_cache_stats()
        return {
            'component_count': 0,
            'metadata_count': 0,
            'total_size_bytes': 0,
            'cache_dir': 'Cache disabled'
        }

    def cached_get(
            self,
            path,
            cache_key,
            params=None,
            extra_headers=None,
            timeout=20):
        """
        Make a cached GET request with ETag support.

        Args:
            path: API path
            cache_key: Cache key for this request
            params: Query parameters
            extra_headers: Additional headers
            timeout: Request timeout

        Returns:
            Response object
        """
        if not self.is_valid():
            raise RuntimeError(
                'Access token missing or expired. Please sign in again.'
            )

        # If cache is disabled, make regular request
        if not self._cache:
            return self.authorized_get(path, params, extra_headers, timeout)

        # Check cache first
        cached_data, cached_etag, is_from_cache = self._cache.get(cache_key)

        # Prepare headers
        headers = self.auth_header()
        if extra_headers:
            headers.update(extra_headers)

        # Add conditional request header if we have cached data
        if is_from_cache and cached_etag:
            headers['If-None-Match'] = cached_etag

        # Make request
        response = requests.get(
            self.base_url + path,
            params=params,
            headers=headers,
            timeout=timeout
        )

        # Handle response
        if response.status_code == 304 and is_from_cache:
            return _CachedResponse(cached_data, cached_etag)

        elif response.status_code == 200:
            # Data changed or first request - cache the response.
            # Cache writes must never break the fetch, so swallow any
            # parse/serialise/IO error and just return the live response.
            try:
                data = response.json()
                etag = response.headers.get('ETag')
                self._cache.set(cache_key, data, etag, params)
            except Exception:
                pass

        return response

    def cached_list_identities(
            self,
            params=None,
            extra_headers=None,
            timeout=60):
        """
        Fetch GET /identities with unified identity/snapshot caching.

        List responses store per-identity and per-snapshot documents plus a
        lightweight query index (identity ids + list ETag). A 304 reassembles
        passport rows from the individual caches.
        """
        if not self.is_valid():
            raise RuntimeError(
                'Access token missing or expired. Please sign in again.'
            )

        params = dict(params or {})
        query_key = _query_cache_key(params)

        if not self._cache:
            return self.authorized_get(
                '/identities', params, extra_headers, timeout)

        identity_ids, query_etag, has_query = self._cache.get_query(
            query_key)

        headers = self.auth_header()
        if extra_headers:
            headers.update(extra_headers)
        if has_query and query_etag:
            headers['If-None-Match'] = query_etag

        response = requests.get(
            self.base_url + '/identities',
            params=params,
            headers=headers,
            timeout=timeout
        )

        if response.status_code == 304:
            if has_query and identity_ids:
                rows = self._cache.assemble_passport_list(identity_ids)
                if rows:
                    return _CachedResponse(rows, query_etag)
            # Stale query index ? refetch without conditional header
            headers = self.auth_header()
            if extra_headers:
                headers.update(extra_headers)
            response = requests.get(
                self.base_url + '/identities',
                params=params,
                headers=headers,
                timeout=timeout
            )

        if response.status_code == 200:
            try:
                data = response.json()
                if isinstance(data, list):
                    stored_ids = self._cache.ingest_passport_rows(data)
                    list_etag = response.headers.get('ETag')
                    self._cache.set_query(
                        query_key, stored_ids, list_etag, params)
            except Exception:
                pass

        return response

    def cached_get_passport(
            self,
            identity_id,
            snapshots=None,
            extra_headers=None,
            timeout=20):
        """
        Fetch GET /identities/{id}/compose with caching.

        ``snapshots``: None/'current' (default), 'all', or a list of snapshot
        UUID strings. Passport ETag matches the backend; 304 returns cached
        body when available.
        """
        if not self.is_valid():
            raise RuntimeError(
                'Access token missing or expired. Please sign in again.'
            )

        params = {}
        if snapshots == 'all':
            params['snapshots'] = 'all'
        elif isinstance(snapshots, (list, tuple)) and snapshots:
            params['snapshots'] = ','.join(str(item) for item in snapshots)

        path = f'/identities/{identity_id}/compose'
        cache_key = _passport_cache_key(identity_id, snapshots)
        use_current_assembly = (
            not snapshots or snapshots == 'current'
        )

        cached_body = None
        cached_etag = None
        if self._cache:
            if use_current_assembly:
                cached_body = self._cache.assemble_passport(identity_id)
            else:
                cached_body, cached_etag, cached_ok = self._cache.get(
                    cache_key,
                )
                if not cached_ok:
                    cached_body = None
                    cached_etag = None

            if cached_body and isinstance(cached_body.get('identity'), dict):
                snapshot_docs = cached_body.get('snapshots') or []
                cached_etag = _compute_passport_etag(
                    cached_body['identity'],
                    snapshot_docs,
                )

        if not self._cache:
            return self.authorized_get(
                path, params or None, extra_headers, timeout)

        headers = self.auth_header()
        if extra_headers:
            headers.update(extra_headers)
        if cached_etag:
            headers['If-None-Match'] = cached_etag

        response = requests.get(
            self.base_url + path,
            headers=headers,
            params=params or None,
            timeout=timeout,
        )

        if response.status_code == 304:
            if cached_body:
                return _CachedResponse(cached_body, cached_etag)
            headers = self.auth_header()
            if extra_headers:
                headers.update(extra_headers)
            response = requests.get(
                self.base_url + path,
                headers=headers,
                params=params or None,
                timeout=timeout,
            )

        if response.status_code == 200:
            try:
                data = response.json()
                if self._cache:
                    etag = response.headers.get('ETag')
                    if not etag and isinstance(data.get('identity'), dict):
                        etag = _compute_passport_etag(
                            data['identity'],
                            data.get('snapshots') or [],
                        )
                    if not use_current_assembly:
                        self._cache.set(cache_key, data, etag)
                    self._cache.ingest_passport_row(data)
            except Exception:
                pass

        return response

    def cached_get_snapshot_mesh(self, snapshot_id, primitive_index,
                                 resolution, timeout=60):
        """
        Fetch one snapshot-primitive mesh PLY with ETag caching.

        Args:
            snapshot_id: Snapshot UUID
            primitive_index: Index into the snapshot geometry.meshes array
            resolution: 'reduced' or 'detailed'
            timeout: Request timeout

        Returns:
            Tuple of (mesh, etag, is_from_cache). ``mesh`` is None when the
            requested resolution is unavailable (404) or on parse/transport
            error, signalling the caller to fall back to inline geometry.
        """
        if not self.is_valid():
            raise RuntimeError(
                'Access token missing or expired. Please sign in again.'
            )

        path = (
            f'/snapshots/{snapshot_id}/meshes/'
            f'{primitive_index}/{resolution}'
        )

        # If cache is disabled, fetch + parse without caching
        if not self._cache:
            response = self.authorized_get(path, timeout=timeout)
            if response.status_code == 200:
                mesh = _parse_ply_binary_to_mesh(response.content)
                etag = response.headers.get('ETag')
                return mesh, etag, False
            return None, None, False

        # Check binary cache first
        (cached_mesh,
         cached_etag,
         is_from_cache) = self._cache.get_mesh_binary(
            snapshot_id, primitive_index, resolution)

        # Prepare headers (conditional request when we have cached data)
        headers = self.auth_header()
        if is_from_cache and cached_etag:
            headers['If-None-Match'] = cached_etag

        response = requests.get(
            self.base_url + path,
            headers=headers,
            timeout=timeout
        )

        if response.status_code == 304 and is_from_cache:
            # Not modified - return cached mesh
            return cached_mesh, cached_etag, True

        if response.status_code == 200:
            mesh = _parse_ply_binary_to_mesh(response.content)
            etag = response.headers.get('ETag')
            if mesh is not None:
                try:
                    self._cache.set_mesh_binary(
                        snapshot_id, primitive_index, resolution, mesh, etag
                    )
                except (ValueError, KeyError):
                    pass
            return mesh, etag, False

        # 404 / other -> unavailable; caller falls back to inline geometry
        return None, None, False

    def cached_get_snapshot_point_cloud(self, snapshot_id, primitive_index,
                                        timeout=60):
        """
        Fetch one snapshot point-cloud PLY with ETag caching.

        Returns a Rhino PointCloud or None when unavailable. Callers keep
        the object return (unlike cached_get_snapshot_mesh) so Bake /
        Fetch / PassportToD2P stay unchanged.
        """
        if not self.is_valid():
            raise RuntimeError(
                'Access token missing or expired. Please sign in again.'
            )

        path = (
            f'/snapshots/{snapshot_id}/point_clouds/'
            f'{primitive_index}.ply'
        )

        if not self._cache:
            response = self.authorized_get(path, timeout=timeout)
            if response.status_code == 200:
                return _parse_ply_binary_to_point_cloud(response.content)
            return None

        (cached_cloud,
         cached_etag,
         is_from_cache) = self._cache.get_point_cloud_binary(
            snapshot_id, primitive_index)

        headers = self.auth_header()
        if is_from_cache and cached_etag:
            headers['If-None-Match'] = cached_etag

        response = requests.get(
            self.base_url + path,
            headers=headers,
            timeout=timeout
        )

        if response.status_code == 304 and is_from_cache:
            return cached_cloud

        if response.status_code == 200:
            cloud = _parse_ply_binary_to_point_cloud(response.content)
            etag = response.headers.get('ETag')
            if cloud is not None:
                try:
                    self._cache.set_point_cloud_binary(
                        snapshot_id, primitive_index, cloud, etag
                    )
                except (ValueError, KeyError):
                    pass
            return cloud

        return None

    def get_create_identity_schema(self, force_refresh=False):
        """
        Get CreateComponentRequest JSON Schema (POST /identities).

        Args:
            force_refresh: Force refresh of schema even if cached

        Returns:
            Schema dictionary or None if failed
        """
        cache_key = 'schema:create_identity'
        endpoint = '/schema/create-identity'

        if not self.base_url:
            raise RuntimeError(
                'Base URL not configured. Please sign in first.')

        if not self._cache:
            try:
                response = requests.get(f'{self.base_url}{endpoint}')
                if response.status_code == 200:
                    return response.json()
                return None
            except Exception:
                return None

        if not force_refresh:
            cached_schema, cached_etag, is_from_cache = self._cache.get(
                cache_key)
            if is_from_cache:
                return cached_schema

        try:
            headers = {}
            if not force_refresh:
                cached_schema, cached_etag, is_from_cache = self._cache.get(
                    cache_key)
                if is_from_cache and cached_etag:
                    headers['If-None-Match'] = cached_etag

            response = requests.get(
                f'{self.base_url}{endpoint}',
                headers=headers,
            )

            if response.status_code == 304 and not force_refresh:
                cached_schema, _, is_from_cache = self._cache.get(cache_key)
                if is_from_cache:
                    return cached_schema

            elif response.status_code == 200:
                try:
                    data = response.json()
                    etag = response.headers.get('ETag')
                    self._cache.set(cache_key, data, etag)
                    return data
                except (ValueError, KeyError):
                    return None

            return None
        except Exception:
            if not force_refresh:
                cached_schema, _, is_from_cache = self._cache.get(cache_key)
                if is_from_cache:
                    return cached_schema
            return None

    def get_design_schema(self, force_refresh=False):
        """
        Get design schema with caching support.

        Args:
            force_refresh: Force refresh of schema even if cached

        Returns:
            Design schema dictionary or None if failed
        """
        # Schema endpoints are unprotected, so we can access without auth
        # But we still need to check if we have a valid base_url
        if not self.base_url:
            raise RuntimeError(
                'Base URL not configured. Please sign in first.')

        # If cache is disabled, make regular request
        # (schema endpoint is unprotected)
        if not self._cache:
            try:
                response = requests.get(f'{self.base_url}/schema/design')
                if response.status_code == 200:
                    return response.json()
                return None
            except Exception:
                return None

        # Check cache first (unless force refresh)
        if not force_refresh:
            cached_schema, cached_etag, is_from_cache = self._cache.get(
                'schema:design')
            if is_from_cache:
                return cached_schema

        # Make request to get schema (unprotected endpoint)
        try:
            # Prepare headers for conditional request
            headers = {}
            if not force_refresh:
                cached_schema, cached_etag, is_from_cache = self._cache.get(
                    'schema:design')
                if is_from_cache and cached_etag:
                    headers['If-None-Match'] = cached_etag

            response = requests.get(f'{self.base_url}/schema/design',
                                    headers=headers)

            if response.status_code == 304 and not force_refresh:
                # Not modified - return cached data
                cached_schema, _, is_from_cache = self._cache.get(
                    'schema:design')
                if is_from_cache:
                    return cached_schema

            elif response.status_code == 200:
                # Data changed or first request - cache the response
                try:
                    data = response.json()
                    etag = response.headers.get('ETag')
                    self._cache.set('schema:design', data, etag)
                    return data
                except (ValueError, KeyError):
                    return None

            return None
        except Exception:
            # If request fails and we have cached schema, return cached version
            if not force_refresh:
                cached_schema, _, is_from_cache = self._cache.get(
                    'schema:design')
                if is_from_cache:
                    return cached_schema
            return None


class CSC_Session(Grasshopper.Kernel.GH_ScriptInstance):
    """
    Author: Max Benjamin Eschenbach
    License: MIT License
    """

    # Development setting - do not change!
    __HARD_RESET = False

    def __init__(self):
        """Initialize this component and set component parameters."""
        super().__init__()
        # initialize props
        self.Component = ghenv.Component  # type: ignore[reportUnedfinedVariable] # NOQA
        self.InputParams = self.Component.Params.Input
        self.OutputParams = self.Component.Params.Output

    def _addRemark(self, msg: str = ''):
        """Add a remark message to the component."""
        rml = self.Component.RuntimeMessageLevel.Remark
        self.AddRuntimeMessage(rml, msg)

    def _addWarning(self, msg: str = ''):
        """Add a warning message to the component."""
        rml = self.Component.RuntimeMessageLevel.Warning
        self.AddRuntimeMessage(rml, msg)

    def _addError(self, msg: str = ''):
        """Add an error message to the component."""
        rml = self.Component.RuntimeMessageLevel.Error
        self.AddRuntimeMessage(rml, msg)

    def BeforeRunScript(self):
        """Perform some setup actions."""
        # Initialize input param descriptions
        self.InputParams[0].Description = 'Your Username or E-Mail'
        self.InputParams[1].Description = 'Your password'
        self.InputParams[2].Description = (
            'Refresh toggle, press when your token expired'
        )
        self.InputParams[3].Description = (
            'Disable caching (default: False - caching enabled)'
        )
        self.InputParams[4].Description = (
            'Clear cache (default: False)'
        )
        # Initialize output param descriptions
        i = 0
        if self.OutputParams[0].Name == 'out':
            i += 1
        self.OutputParams[0+i].Description = (
            'Status Message'
        )

    def get_auth_core_from_sticky(self):
        """Get AuthCore instance from sticky storage or create new one."""
        if not self.__HARD_RESET:
            auth_core = sc.sticky.get('CSC_AuthCore')
        else:
            auth_core = None
        if auth_core is None:
            # Create new AuthCore instance with default settings
            auth_core = _AuthCore(
                base_url='https://api.2ndchances.build'
            )
            sc.sticky['CSC_AuthCore'] = auth_core
        return auth_core

    def RunScript(self,
            Username: str,
            Password: str,
            Refresh: bool,
            DisableCache: bool,
            ClearCache: bool):
        # Initialize status messages list
        status_messages = []

        # Sanitize input parameters (defaults don't work in function signature)
        if DisableCache is None:
            DisableCache = False
        if ClearCache is None:
            ClearCache = False

        # Get or create AuthCore instance
        auth_core = self.get_auth_core_from_sticky()

        # Handle cache management
        if ClearCache:
            auth_core.sync_cache()
            status_messages.append('Cache cleared')
            self.Component.Message = 'Cache cleared'
            # Return status messages
            Status = status_messages
            return (Status,)

        # Set cache enabled/disabled
        auth_core.set_cache_enabled(not DisableCache)

        # Input validation
        if not Username or not Username.strip():
            status_messages.append('Please provide username/email')
            self.Component.Message = 'Please provide username/email'
            Status = status_messages
            return (Status,)

        if not Password or not Password.strip():
            status_messages.append('Please provide password')
            self.Component.Message = 'Please provide password'
            Status = status_messages
            return (Status,)

        username = Username.strip()
        password = Password.strip()

        try:
            if Refresh:
                # Refresh authentication - clear existing token and re-auth
                auth_core.clear()
                self.Component.Message = 'Refreshing authentication...'
            else:
                # Check if we already have a valid token
                if auth_core.is_valid():
                    current_user = auth_core.get_username()
                    self.Component.Message = (
                        f'Already signed in as: {current_user}'
                    )

                    # Fetch and cache create-identity schema
                    try:
                        schema = auth_core.get_create_identity_schema()
                        if schema:
                            status_messages.append(
                                'Create-identity schema cached')
                            self._addRemark(
                                'Create-identity schema cached successfully'
                            )
                        else:
                            status_messages.append('Failed to cache schema')
                            self._addWarning(
                                'Failed to cache create-identity schema'
                            )
                    except Exception as e:
                        status_messages.append(
                            f'Schema caching failed: {str(e)}')
                        self._addWarning(f'Schema cache failed: {str(e)}')

                    # Get cache status for output
                    cache_stats = auth_core.get_cache_stats()
                    cache_enabled = auth_core.is_cache_enabled()
                    comp_count = cache_stats["component_count"]
                    geometry_count = cache_stats["geometry_count"]
                    design_count = cache_stats["design_count"]
                    size_kb = cache_stats["total_size_bytes"] // 1024
                    geometry_size_kb = (
                        cache_stats["geometry_size_bytes"] // 1024
                    )
                    design_size_kb = (
                        cache_stats["design_size_bytes"] // 1024
                    )

                    # Add cache status to messages
                    cache_status = (
                        'Cache: '
                        f'{"Enabled" if cache_enabled else "Disabled"}\n'
                        f' | Components: {comp_count}\n'
                        f' | Geometry: {geometry_count} files\n'
                        f' | Designs: {design_count} files\n'
                        f' | Size: {size_kb} kB\n'
                        f' | Geometry: {geometry_size_kb} kB\n'
                        f' | Designs: {design_size_kb} kB\n')
                    status_messages.append(cache_status)
                    Status = status_messages
                    return (Status,)

                self.Component.Message = 'Signing in...'

            # Prepare login data
            login_data = {
                'username': username,
                'password': password
            }

            # Make login request
            response = requests.post(
                f'{auth_core.base_url}/auth/token',
                data=login_data,
                headers={
                    'Content-Type': 'application/x-www-form-urlencoded'
                },
                timeout=20
            )

            if response.status_code == 200:
                # Login successful
                token_data = response.json()
                access_token = token_data.get('access_token')

                if access_token:
                    # Store token in AuthCore
                    auth_core.set_access_token(access_token, username)

                    # Update sticky storage
                    sc.sticky['CSC_AuthCore'] = auth_core

                    # Fetch and cache create-identity schema
                    try:
                        schema = auth_core.get_create_identity_schema()
                        if schema:
                            status_messages.append(
                                'Create-identity schema cached')
                            self._addRemark(
                                'Create-identity schema cached successfully'
                            )
                        else:
                            status_messages.append('Failed to cache schema')
                            self._addWarning(
                                'Failed to cache create-identity schema'
                            )
                    except Exception as e:
                        status_messages.append(
                            f'Schema caching failed: {str(e)}')
                        self._addWarning(f'Schema cache failed: {str(e)}')

                    # Get cache status for output
                    cache_stats = auth_core.get_cache_stats()
                    cache_enabled = auth_core.is_cache_enabled()
                    comp_count = cache_stats["component_count"]
                    geometry_count = cache_stats["geometry_count"]
                    design_count = cache_stats["design_count"]
                    size_kb = cache_stats["total_size_bytes"] // 1024
                    geometry_size_kb = (
                        cache_stats["geometry_size_bytes"] // 1024
                    )
                    design_size_kb = (
                        cache_stats["design_size_bytes"] // 1024
                    )

                    # Add cache status to messages
                    cache_status = (
                        f'Cache: '
                        f'{"Enabled" if cache_enabled else "Disabled"}\n'
                        f' | Components: {comp_count}\n'
                        f' | Geometry: {geometry_count} files\n'
                        f' | Designs: {design_count} files\n'
                        f' | Size: {size_kb} kB\n'
                        f' | Geometry: {geometry_size_kb} kB\n'
                        f' | Designs: {design_size_kb} kB\n')
                    status_messages.append(cache_status)

                    self.Component.Message = f'Signed in as: {username}'

                    # Return status messages
                    Status = status_messages
                    return (Status,)

                else:
                    msg = 'Login failed: No token received'
                    status_messages.append(msg)
                    self._addWarning(msg)
                    self.Component.Message = msg
                    Status = status_messages
                    return (Status,)

            elif response.status_code == 401:
                msg = 'Invalid username or password'
                status_messages.append(msg)
                self._addError(msg)
                self.Component.Message = msg
                Status = status_messages
                return (Status,)

            elif response.status_code == 422:
                msg = 'Invalid input data'
                status_messages.append(msg)
                self._addError(msg)
                self.Component.Message = msg
                Status = status_messages
                return (Status,)

            elif response.status_code == 500:
                msg = 'Server error - please try again'
                status_messages.append(msg)
                self._addWarning(msg)
                self.Component.Message = msg
                Status = status_messages
                return (Status,)

            else:
                msg = f'Login failed with status code: {response.status_code}'
                status_messages.append(msg)
                self._addError(msg)
                self.Component.Message = msg
                Status = status_messages
                return (Status,)

        except requests.exceptions.ConnectionError as e:
            msg = 'Cannot connect to server - check URL'
            status_messages.append(msg)
            self._addError(msg + f'\nFull Error: {str(e)}')
            self.Component.Message = msg
            Status = status_messages
            return (Status,)

        except requests.exceptions.Timeout as e:
            msg = 'Request timeout - server may be slow'
            status_messages.append(msg)
            self._addError(msg + f'\nFull Error: {str(e)}')
            self.Component.Message = msg
            Status = status_messages
            return (Status,)

        except requests.exceptions.RequestException as e:
            msg = f'Request error: {str(e)}'
            status_messages.append(msg)
            self._addError(msg)
            self.Component.Message = msg
            Status = status_messages
            return (Status,)

        except Exception as e:
            msg = f'Unexpected error: {str(e)}'
            status_messages.append(msg)
            self.Component.Message = msg
            Status = status_messages
            return (Status,)
# ---------- end csc_session ----------
status_messages = Panel(csc_session)

# ---- group: __DDU_CSC_EXAMPLE_04__
# Step 1
# comments & notes: Create new User Session and sign in
# 
# (Add your credentials!)
ddu_csc_username_2 = Panel("")
ddu_csc_password_2 = Panel("")
disablecache_2 = BooleanToggle(False)
clearcache_2 = Button()
refresh_2 = Button()
csc_session_2 = Session(
    Username=ddu_csc_username_2,
    Password=ddu_csc_password_2,
    Refresh=refresh_2,
    DisableCache=disablecache_2,
    ClearCache=clearcache_2)  # -> Status; inputs Username: String, Password: String, Refresh: Boolean, DisableCache: Boolean, ClearCache: Boolean; same code as csc_session
status_messages_2 = Panel(csc_session_2)

# ---- group: __DDU_CSC_EXAMPLE_01__
# comments & notes: Fetch a subset of components from the database using filters. Here we are fetching the 'schoenes_neues_feld' dataset.
# 
# NOTE: ReservedStatus = -1 means we ignore reservations entirely
# Step 2
fragment_2 = ValueList({"Any": , "Only fragments": True, "Only non-fragmnents": False}, selected="Any")
mindimensionx_2 = Slider(0, range=-0.1..2000)
maxdimensiony_2 = Slider(0, range=0..2000)
maxdimensionx_2 = Slider(0, range=0..2000)
maxdimensionz_2 = Slider(0, range=0..500)
mindimensiony_2 = Slider(0, range=0..2000)
mindimensionz_2 = Slider(0, range=0..500)
reservedstatus_2 = Slider(-1, range=-1..1)
complexity_2 = ValueList({"Any complexity": , "0", "1", "2", "3"}, selected="Any complexity")
dataset_2 = Panel("schoenes_neues_feld")
material_2 = ValueList({"Any material": , "corian", "concrete", "timber", "aluminium", "steel"}, selected="Any material")
type_2 = ValueList({"All types": , "panel", "beam", "column", "slab", "rubble", "brick", "pipe", "profile", "connector", "other"}, selected="All types")
fetchfilteredcomponents_2 = FetchFilteredComponents(
    Type=type_2,
    Material=material_2,
    Dataset=dataset_2,
    Complexity=complexity_2,
    Fragment=fragment_2,
    MinDimensionX=mindimensionx_2,
    MaxDimensionX=maxdimensionx_2,
    MinDimensionY=mindimensiony_2,
    MaxDimensionY=maxdimensiony_2,
    MinDimensionZ=mindimensionz_2,
    MaxDimensionZ=maxdimensionz_2,
    ReservedStatus=reservedstatus_2)  # -> FilterDescription, ComponentData; inputs Type: String, Material: String, Dataset: String, Complexity: Int32, Fragment: Boolean, MinDimensionX: Double, MaxDimensionX: Double, MinDimensionY: Double, MaxDimensionY: Double, MinDimensionZ: Double, MaxDimensionZ: Double; same code as fetchfilteredcomponents
panel_3 = Panel(fetchfilteredcomponents_2.FilterDescription)
componentdata_2 = Data(fetchfilteredcomponents_2.ComponentData)

# ---- group: __DDU_CSC_EXAMPLE_02__
# Example 02:
# - Fetching single components
# - Fetching more detailed geometry
# - Retrieving ComponentData from geometry
# Step 1
# comments & notes: Create new User Session and sign in
# 
# (Add your credentials!)
ddu_csc_username_3 = Panel("")
ddu_csc_password_3 = Panel("")
disablecache_3 = BooleanToggle(False)
clearcache_3 = Button()
refresh_3 = Button()
csc_session_3 = Session(
    Username=ddu_csc_username_3,
    Password=ddu_csc_password_3,
    Refresh=refresh_3,
    DisableCache=disablecache_3,
    ClearCache=clearcache_3)  # -> Status; inputs Username: String, Password: String, Refresh: Boolean, DisableCache: Boolean, ClearCache: Boolean; same code as csc_session
status_messages_3 = Panel(csc_session_3)

# ---- group: __DDU_CSC_EXAMPLE_05__
# Step 1
# comments & notes: Create new User Session and sign in
# 
# (Add your credentials!)
ddu_csc_username_4 = Panel("")
ddu_csc_password_4 = Panel("")
disablecache_4 = BooleanToggle(False)
clearcache_4 = Button()
refresh_4 = Button()
csc_session_4 = Session(
    Username=ddu_csc_username_4,
    Password=ddu_csc_password_4,
    Refresh=refresh_4,
    DisableCache=disablecache_4,
    ClearCache=clearcache_4)  # -> Status; inputs Username: String, Password: String, Refresh: Boolean, DisableCache: Boolean, ClearCache: Boolean; same code as csc_session
status_messages_4 = Panel(csc_session_4)

# Step 2
fragment_3 = ValueList({"Any": , "Only fragments": True, "Only non-fragmnents": False}, selected="Any")
dataset_3 = Panel("mineral_composite_panels")
maxdimensiony_3 = Slider(0, range=0..2000)
mindimensionx_3 = Slider(0, range=-0.1..2000)
maxdimensionx_3 = Slider(0, range=0..2000)
maxdimensionz_3 = Slider(0, range=0..500)
mindimensiony_3 = Slider(0, range=0..2000)
mindimensionz_3 = Slider(0, range=0..500)
reservedstatus_3 = Slider(-1, range=-1..1)
complexity_3 = ValueList({"Any complexity": , "0", "1", "2", "3"}, selected="Any complexity")
material_3 = ValueList({"Any material": , "corian", "concrete", "timber", "aluminium", "steel"}, selected="Any material")
type_3 = ValueList({"All types": , "panel", "beam", "column", "slab", "rubble", "brick", "pipe", "profile", "connector", "other"}, selected="All types")
fetchfilteredcomponents_3 = FetchFilteredComponents(
    Type=type_3,
    Material=material_3,
    Dataset=dataset_3,
    Complexity=complexity_3,
    Fragment=fragment_3,
    MinDimensionX=mindimensionx_3,
    MaxDimensionX=maxdimensionx_3,
    MinDimensionY=mindimensiony_3,
    MaxDimensionY=maxdimensiony_3,
    MinDimensionZ=mindimensionz_3,
    MaxDimensionZ=maxdimensionz_3,
    ReservedStatus=reservedstatus_3)  # -> FilterDescription, ComponentData; inputs Type: String, Material: String, Dataset: String, Complexity: Int32, Fragment: Boolean, MinDimensionX: Double, MaxDimensionX: Double, MinDimensionY: Double, MaxDimensionY: Double, MinDimensionZ: Double, MaxDimensionZ: Double; same code as fetchfilteredcomponents
panel_4 = Panel(fetchfilteredcomponents_3.FilterDescription)
componentdata_3 = Data(fetchfilteredcomponents_3.ComponentData)

# ---- group: __DDU_CSC_EXAMPLE_03__
# Step 1
# comments & notes: Create new User Session and sign in
# 
# (Add your credentials!)
ddu_csc_username_5 = Panel("")
ddu_csc_password_5 = Panel("")
disablecache_5 = BooleanToggle(False)
clearcache_5 = Button()
refresh_5 = Button()
csc_session_5 = Session(
    Username=ddu_csc_username_5,
    Password=ddu_csc_password_5,
    Refresh=refresh_5,
    DisableCache=disablecache_5,
    ClearCache=clearcache_5)  # -> Status; inputs Username: String, Password: String, Refresh: Boolean, DisableCache: Boolean, ClearCache: Boolean; same code as csc_session
status_messages_5 = Panel(csc_session_5)

# Step 2
# Example 04:
# - Fetching all components of a certain type
# - Filter the already fetched components by dimensions (faster if you already have fetched components)
# - Disassemble the components to get individual fields and properties
componentid = Panel("243df186-9e30-4b19-95aa-17d7d88976f9")
fetchcomponents = FetchComponents(ComponentID=componentid)  # -> ComponentData; inputs ComponentID: list of String
# ---------- fetchcomponents: Python ----------
#! python3
# -*- coding: utf-8 -*-
# venv: DDU_CSC
print('ENV OK!')
# r: charset_normalizer
# r: requests

# PYTHON STANDARD LIBRARY IMPORTS ---------------------------------------------
import json  # NOQA

# THIRD PARTY LIBRARY IMPORTS -------------------------------------------------
import requests  # NOQA

# RHINO AND GH RELATED IMPORTS ------------------------------------------------
import System  # NOQA
import Grasshopper  # NOQA
import Rhino  # NOQA
import scriptcontext as sc  # NOQA

# GHENV COMPONENT SETTINGS ----------------------------------------------------
ghenv.Component.Name = 'FetchComponents'  # NOQA
ghenv.Component.NickName = 'FetchComponents'  # NOQA
ghenv.Component.Category = 'DDU_CSC'  # NOQA
ghenv.Component.SubCategory = '2 Catalog Interface'  # NOQA
ghenv.Component.Description = (  # NOQA
    'Fetches specific identities (with their current snapshot) from the '
    'remote Catalog by their identity IDs. Supports caching and returns '
    'passport JSON ({identity, snapshots[]}) with error handling for missing '
    'identities.'
)


class CSC_FetchComponents(Grasshopper.Kernel.GH_ScriptInstance):
    """
    Author: Max Benjamin Eschenbach
    License: MIT License
    Version: 260908
    """

    def __init__(self):
        """Initialize this component and set component parameters."""
        super().__init__()
        # initialize props
        self.Component = ghenv.Component  # NOQA
        self.InputParams = self.Component.Params.Input
        self.OutputParams = self.Component.Params.Output

    def _addRemark(self, msg: str = ''):
        """Add a remark message to the component."""
        rml = self.Component.RuntimeMessageLevel.Remark
        self.AddRuntimeMessage(rml, msg)

    def _addWarning(self, msg: str = ''):
        """Add a warning message to the component."""
        rml = self.Component.RuntimeMessageLevel.Warning
        self.AddRuntimeMessage(rml, msg)

    def _addError(self, msg: str = ''):
        """Add an error message to the component."""
        rml = self.Component.RuntimeMessageLevel.Error
        self.AddRuntimeMessage(rml, msg)

    def BeforeRunScript(self):
        """Perform some setup actions."""
        # Initialize input param descriptions
        self.InputParams[0].Description = (
            'One or many identity IDs (UUIDs) to fetch'
        )
        # Initialize output param descriptions
        i = 0
        if self.OutputParams[0].Name == 'out':
            i += 1
        self.OutputParams[0+i].Description = (
            'Passport JSON per entry ({identity, snapshots[]}) fetched from '
            'the server. Use \'DisassembleComponent\' to access the individual '
            'fields ready for Grasshopper'
        )

    def get_auth_core_from_sticky(self):
        """Get AuthCore instance from sticky storage."""
        auth_core = sc.sticky.get('CSC_AuthCore')
        if auth_core is None:
            msg = ('No authentication found. Please use CSC_Session component '
                   'first.')
            self._addError(msg)
            self.Component.Message = msg
            return None
        return auth_core

    def RunScript(self, ComponentID: list[str]):
        # Get AuthCore instance from sticky storage
        auth_core = self.get_auth_core_from_sticky()
        if auth_core is None:
            return

        # Check if authentication is valid
        if not auth_core.is_valid():
            msg = ('Authentication expired. Please use CSC_Session '
                   'component to refresh.')
            self._addError(msg)
            self.Component.Message = msg
            return

        # Validate identity ID input
        if not ComponentID:
            msg = 'Please provide identity ID(s) to fetch.'
            self._addWarning(msg)
            self.Component.Message = msg
            return

        # Convert to list and validate UUIDs
        component_ids = list(ComponentID)
        for _id in component_ids:
            if not auth_core.validate_uuid(_id):
                msg = f'Identity ID <{_id}> is not a valid UUID!'
                self._addWarning(msg)
                self.Component.Message = msg
                return

        try:
            self.Component.Message = (
                f'Fetching {len(component_ids)} component(s) (with cache)...'
            )

            # Set up output trees and results tuple
            ComponentData = Grasshopper.DataTree[System.Object]()
            __Results = (ComponentData,)

            # Fetch each identity's current-snapshot passport
            for i, _id in enumerate(component_ids):
                try:
                    # Unified catalog cache (identity + snapshot stored
                    # independently, passport assembled on read).
                    response = auth_core.cached_get_passport(_id)

                    if response.status_code == 200:
                        # Successfully fetched passport (from server or cache)
                        json_comp = response.json()

                        # Create datatree path
                        ghp = Grasshopper.Kernel.Data.GH_Path(i)
                        # Add canonical passport JSON to the datatree
                        ComponentData.Add(
                            auth_core.passport_json_string(json_comp), ghp)

                        self._addRemark(
                            f'Successfully fetched component {_id}'
                        )

                    elif response.status_code == 404:
                        msg = f'Identity {_id} not found on server.'
                        self._addWarning(msg)
                        self.Component.Message = msg

                    elif response.status_code == 401:
                        msg = 'Authentication failed. Please sign in again.'
                        self._addError(msg)
                        self.Component.Message = msg
                        return __Results

                    elif response.status_code == 403:
                        msg = 'Access denied. Insufficient permissions.'
                        self._addError(msg)
                        self.Component.Message = msg
                        return __Results

                    elif response.status_code == 500:
                        msg = 'Server error. Please try again later.'
                        self._addWarning(msg)
                        self.Component.Message = msg

                    else:
                        msg = (f'Request failed for component {_id} with '
                               f'status code: {response.status_code}')
                        self._addError(msg)
                        self.Component.Message = msg

                except Exception as e:
                    msg = f'Error fetching component {_id}: {str(e)}'
                    self._addError(msg)
                    self.Component.Message = msg

            # Update success message
            if ComponentData.DataCount > 0:
                self.Component.Message = (
                    f'Fetched {ComponentData.DataCount} component(s) (cached)'
                )
            else:
                self.Component.Message = 'No components fetched'

            return __Results

        except requests.exceptions.ConnectionError as e:
            msg = 'Cannot connect to server. Please check your connection.'
            self._addError(msg + f'\nFull Error: {str(e)}')
            self.Component.Message = msg

        except requests.exceptions.Timeout as e:
            msg = 'Request timeout. Server may be slow.'
            self._addError(msg + f'\nFull Error: {str(e)}')
            self.Component.Message = msg

        except requests.exceptions.RequestException as e:
            msg = f'Request error: {str(e)}'
            self._addError(msg)
            self.Component.Message = msg

        except Exception as e:
            msg = f'Unexpected error: {str(e)}'
            self._addError(msg)
            self.Component.Message = msg

        # Return empty results if there was an error
        ComponentData = Grasshopper.DataTree[System.Object]()
        __Results = (ComponentData,)
        return __Results
# ---------- end fetchcomponents ----------
componentdata_4 = Data(fetchcomponents)

# ----
# comments & notes: Create UUIDs on request
button = Button()
createuuid = CreateUUID(Refresh=button)  # -> UUID; inputs Refresh: Boolean
# ---------- createuuid: Python ----------
#! python3
# -*- coding: utf-8 -*-
# venv: DDU_CSC
print('ENV OK!')
# r: charset_normalizer
# r: requests

# PYTHON STANDARD LIBRARY IMPORTS ---------------------------------------------
import uuid  # NOQA

# RHINO AND GH RELATED IMPORTS ------------------------------------------------
import System  # NOQA
import Rhino  # NOQA
import Grasshopper  # NOQA
from scriptcontext import sticky as st  # NOQA

# GHENV COMPONENT SETTINGS ----------------------------------------------------
ghenv.Component.Name = 'CreateUUID'  # NOQA
ghenv.Component.NickName = 'CreateUUID'  # NOQA
ghenv.Component.Category = 'DDU_CSC'  # NOQA
ghenv.Component.SubCategory = '3 Component Operations'  # NOQA
ghenv.Component.Description = (  # NOQA
    'Creates new UUIDs on request.'
)


class CSC_CreateUUID(Grasshopper.Kernel.GH_ScriptInstance):
    """
    Author: Max Benjamin Eschenbach
    License: MIT License
    Version: 260609
    """

    def __init__(self):
        """Initialize this component and set component parameters."""
        super().__init__()
        # initialize props
        self.Component = ghenv.Component  # NOQA
        self.InputParams = self.Component.Params.Input
        self.OutputParams = self.Component.Params.Output

    def _addRemark(self, msg: str = ''):
        """Add a remark message to the component."""
        rml = self.Component.RuntimeMessageLevel.Remark
        self.AddRuntimeMessage(rml, msg)

    def _addWarning(self, msg: str = ''):
        """Add a warning message to the component."""
        rml = self.Component.RuntimeMessageLevel.Warning
        self.AddRuntimeMessage(rml, msg)

    def _addError(self, msg: str = ''):
        """Add an error message to the component."""
        rml = self.Component.RuntimeMessageLevel.Error
        self.AddRuntimeMessage(rml, msg)

    def BeforeRunScript(self):
        """Perform some setup actions."""
        # Initialize input param descriptions
        self.InputParams[0].Description = (
            'If set to True, generates a new UUID'
        )
        # Initialize output param descriptions
        i = 0
        if self.OutputParams[0].Name == 'out':
            i += 1
        self.OutputParams[0+i].Description = (
            'The current UUID'
        )

    def _updateComponent(self):
        """Updates this component using callback mechanism"""
        # Define callback action
        def callBack(e):
            st_key = f'{self.Component.InstanceGuid}__CreateUUIDComponent'
            new_uuid = uuid.uuid4()
            st[st_key] = new_uuid
            self.Component.ExpireSolution(False)  # NOQA
            return
        # Get grasshopper document
        ghDoc = ghenv.Component.OnPingDocument()  # NOQA
        # Schedule this component to expire
        ghDoc.ScheduleSolution(
            1,
            Grasshopper.Kernel.GH_Document.GH_ScheduleDelegate(callBack)
        )
        return False

    def RunScript(self, Refresh: bool):
        st_key = f'{self.Component.InstanceGuid}__CreateUUIDComponent'
        if Refresh or st_key not in st.keys():
            create_new_uuid = True
        else:
            create_new_uuid = False
        if create_new_uuid:
            create_new_uuid = self._updateComponent()
        return st[st_key]
# ---------- end createuuid ----------
componentid_2 = Panel(createuuid)

# ---- group: __DDU_CSC_EXAMPLE_08__
# Step 1.1
# Example 09:
# - Still in development: Multi Snapshot Retrieval
latitude_longitude_string_i_e_from_googl = Panel("49.861254, 8.674743")  # "Latitude/Longitude String (i.e. from Google Maps)"
comments_notes = Panel("ExFeld Geolocation")
convertgeolocation = ConvertGeoLocation(LatLonString=latitude_longitude_string_i_e_from_googl)  # -> Lat, Lon, Vec; inputs LatLonString: String
# ---------- convertgeolocation: Python ----------
#! python3
# -*- coding: utf-8 -*-
# venv: DDU_CSC
print('ENV OK!')
# r: charset_normalizer
# r: requests

# RHINO AND GH RELATED IMPORTS ------------------------------------------------
import System  # NOQA
import Grasshopper  # NOQA
import Rhino  # NOQA
import scriptcontext as sc  # NOQA

# GHENV COMPONENT SETTINGS ----------------------------------------------------
ghenv.Component.Name = 'ConvertGeoLocation'  # NOQA
ghenv.Component.NickName = 'ConvertGeoLocation'  # NOQA
ghenv.Component.Category = 'DDU_CSC'  # NOQA
ghenv.Component.SubCategory = '6 Data Tools'  # NOQA
ghenv.Component.Description = (  # NOQA
    'Converts a latitude, longitude string (i.e. from Google Maps) '
    'to its individual components. Example input: "12.1231321, 9.1231231312" '
    'Returns the location as individual numbers and as vector.'
)


class CSC_ConvertGeoLocation(Grasshopper.Kernel.GH_ScriptInstance):
    """
    Author: Max Benjamin Eschenbach
    License: MIT License
    Version: 260609
    """

    def __init__(self):
        """Initialize this component and set component parameters."""
        super().__init__()
        # initialize props
        self.Component = ghenv.Component  # NOQA
        self.InputParams = self.Component.Params.Input
        self.OutputParams = self.Component.Params.Output

    def _addRemark(self, msg: str = ''):
        """Add a remark message to the component."""
        rml = self.Component.RuntimeMessageLevel.Remark
        self.AddRuntimeMessage(rml, msg)

    def _addWarning(self, msg: str = ''):
        """Add a warning message to the component."""
        rml = self.Component.RuntimeMessageLevel.Warning
        self.AddRuntimeMessage(rml, msg)

    def _addError(self, msg: str = ''):
        """Add an error message to the component."""
        rml = self.Component.RuntimeMessageLevel.Error
        self.AddRuntimeMessage(rml, msg)

    def BeforeRunScript(self):
        """Perform some setup actions."""
        # Initialize input param descriptions
        self.InputParams[0].Description = (
            'Latitude, Longitude string, e.g. "12.1231321, 9.1231231312" '
        )
        # Initialize output param descriptions
        i = 0
        if self.OutputParams[0].Name == 'out':
            i += 1
        self.OutputParams[0+i].Description = (
            'Latitude component of the input string as float.'
        )
        self.OutputParams[1+i].Description = (
            'Longitude component of the input string as float.'
        )
        self.OutputParams[2+i].Description = (
            'Vector with lat/lon as X/Y.'
        )

    def RunScript(self, LatLonString: str):
        Lat = Grasshopper.DataTree[object]()
        Lon = Grasshopper.DataTree[object]()
        Vec = Grasshopper.DataTree[object]()
        _Results = [Lat, Lon, Vec]
        if not LatLonString:
            msg = 'Parameter LatLonString failed to collect data!'
            self._addWarning(msg)
            return _Results
        parts = LatLonString.split(',')
        if len(parts) > 2:
            msg = f'Splitting of Lat/Lon string failed! Raw result is {parts}...'
            self._addError(msg)
            return _Results
        Lat = float(parts[0].strip())
        Lon = float(parts[1].strip())
        Vec = Rhino.Geometry.Vector3d(Lat, Lon, 0)
        _Results = [Lat, Lon, Vec]
        return _Results
# ---------- end convertgeolocation ----------
location = Data(convertgeolocation.Vec)

# ---- group: __DDU_CSC_EXAMPLE_07__
# Step 1
# comments & notes: Here we fetch a Transmitted ID from a QR Code Scan.
# 
# Use https://ddu.uber.space/transmit-id on your smartphone to scan a QR code and transmit the ID!
button_2 = Button()
fetchtransmittedid = FetchTransmittedID(Refresh=button_2)  # -> ComponentID
# ---------- fetchtransmittedid: Python ----------
#! python3
# -*- coding: utf-8 -*-
# venv: DDU_CSC
print('ENV OK!')
# r: charset_normalizer
# r: requests

# PYTHON STANDARD LIBRARY IMPORTS ---------------------------------------------
import json  # NOQA

# THIRD PARTY LIBRARY IMPORTS -------------------------------------------------
import requests  # NOQA

# RHINO AND GH RELATED IMPORTS ------------------------------------------------
import System  # NOQA
import Grasshopper  # NOQA
import Rhino  # NOQA
import scriptcontext as sc  # NOQA

# GHENV COMPONENT SETTINGS ----------------------------------------------------
ghenv.Component.Name = 'FetchTransmittedID'  # NOQA
ghenv.Component.NickName = 'FetchTransmittedID'  # NOQA
ghenv.Component.Category = 'DDU_CSC'  # NOQA
ghenv.Component.SubCategory = '2 Catalog Interface'  # NOQA
ghenv.Component.Description = (  # NOQA
    'Fetches the currently pending transmitted component ID for the signed-in '
    'user from the Catalog backend. Uses the existing CSC_Session '
    'authentication state.'
)


class CSC_FetchTransmittedID(Grasshopper.Kernel.GH_ScriptInstance):
    """
    Author: Max Benjamin Eschenbach
    License: MIT License
    Version: 260609
    """

    def __init__(self):
        """Initialize this component and set component parameters."""
        super().__init__()
        # initialize props
        self.Component = ghenv.Component  # NOQA
        self.InputParams = self.Component.Params.Input
        self.OutputParams = self.Component.Params.Output

    def _addRemark(self, msg: str = ''):
        """Add a remark message to the component."""
        rml = self.Component.RuntimeMessageLevel.Remark
        self.AddRuntimeMessage(rml, msg)

    def _addWarning(self, msg: str = ''):
        """Add a warning message to the component."""
        rml = self.Component.RuntimeMessageLevel.Warning
        self.AddRuntimeMessage(rml, msg)

    def _addError(self, msg: str = ''):
        """Add an error message to the component."""
        rml = self.Component.RuntimeMessageLevel.Error
        self.AddRuntimeMessage(rml, msg)

    def BeforeRunScript(self):
        """Perform some setup actions."""
        # Initialize output param descriptions
        i = 0
        if self.OutputParams[0].Name == 'out':
            i += 1
        self.OutputParams[0+i].Description = (
            'The currently pending transmitted ComponentID. Empty if none is '
            'pending.'
        )

    def get_auth_core_from_sticky(self):
        """Get AuthCore instance from sticky storage."""
        auth_core = sc.sticky.get('CSC_AuthCore')
        if auth_core is None:
            msg = ('No authentication found. Please use CSC_Session component '
                   'first.')
            self._addError(msg)
            self.Component.Message = msg
            return None
        return auth_core

    def RunScript(self, Refresh):
        component_id = Grasshopper.DataTree[object]()

        # Get AuthCore instance from sticky storage
        auth_core = self.get_auth_core_from_sticky()
        if auth_core is None:
            return component_id

        # Check if authentication is valid
        if not auth_core.is_valid():
            msg = ('Authentication expired. Please use CSC_Session '
                   'component to refresh.')
            self._addError(msg)
            self.Component.Message = msg
            return component_id

        try:
            self.Component.Message = 'Fetching transmitted ID...'

            response = auth_core.authorized_get('/component_id_transmission')

            if response.status_code == 200:
                payload = response.json()
                pending = payload.get('pending')

                if pending and isinstance(pending, dict):
                    component_id = str(pending.get('identity_id', '') or '')
                    self.Component.Message = 'Pending transmitted ID found'
                    self._addRemark(
                        f'Fetched pending transmitted ID: {component_id}'
                    )
                else:
                    self.Component.Message = 'No transmitted ID pending'
                    self._addRemark(
                        'No pending transmitted component ID for this user.'
                    )

                return component_id

            elif response.status_code == 401:
                msg = 'Authentication failed. Please sign in again.'
                self._addError(msg)
                self.Component.Message = msg

            elif response.status_code == 403:
                msg = 'Access denied. Insufficient permissions.'
                self._addError(msg)
                self.Component.Message = msg

            elif response.status_code == 500:
                msg = 'Server error. Please try again later.'
                self._addWarning(msg)
                self.Component.Message = msg

            else:
                msg = (f'Request failed with status code: '
                       f'{response.status_code}')
                self._addError(msg)
                self.Component.Message = msg

        except requests.exceptions.ConnectionError as e:
            msg = 'Cannot connect to server. Please check your connection.'
            self._addError(msg + f'\nFull Error: {str(e)}')
            self.Component.Message = msg

        except requests.exceptions.Timeout as e:
            msg = 'Request timeout. Server may be slow.'
            self._addError(msg + f'\nFull Error: {str(e)}')
            self.Component.Message = msg

        except requests.exceptions.RequestException as e:
            msg = f'Request error: {str(e)}'
            self._addError(msg)
            self.Component.Message = msg

        except Exception as e:
            msg = f'Unexpected error: {str(e)}'
            self._addError(msg)
            self.Component.Message = msg

        return component_id
# ---------- end fetchtransmittedid ----------
componentid_3 = Panel(fetchtransmittedid)

# Step 1.1
# comments & notes: Here we convert a lat/lon string to a location vector. You can get lat/lon from Google Maps (or similar services).
# 
# If you're at DDU, just leave it as it is. The pre-set value is the location of the DDU lab.
latitude_longitude_string_i_e_from_googl_2 = Panel("49.861444, 8.676556")  # "Latitude/Longitude String (i.e. from Google Maps)"
convertgeolocation_2 = ConvertGeoLocation(LatLonString=latitude_longitude_string_i_e_from_googl_2)  # -> Lat, Lon, Vec; inputs LatLonString: String; same code as convertgeolocation
location_2 = Data(convertgeolocation_2.Vec)

# ---- group: __DDU_CSC_EXAMPLE_02__
# Step 2
# comments & notes: Fetch a single component or multiple components from the catalogue using its ID.
# 
# NOTE: Also see the web interface component detail page. You can copy the ID of any component there directly as a GH-Panel!
# Example 03:
# - Fetching single components
# - Baking components
# - Sync components back to GH doc
# - Diassemble components
componentid_4 = Panel("6df1899a-6569-494b-a765-bca686f6d589")
fetchcomponents_2 = FetchComponents(ComponentID=componentid_4)  # -> ComponentData; inputs ComponentID: list of String; same code as fetchcomponents
componentdata_5 = Data(fetchcomponents_2)

# ----
# comments & notes: Compute PCA and minimum aligned BoundingBox
samplemeshgeometry = Mesh(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)
pcloud = PointCloud(samplemeshgeometry)
# comments & notes: DEVELOPMENT:
# ADDITIONAL GEOMETRY TOOLS
computepcaorientation = ComputePCAOrientation(Geometry=[samplemeshgeometry, pcloud])  # -> ObjectOrientedBBX, AlignedGeometry, AlignedBBX, TranslationVector, PCAXForm; inputs Geometry: GeometryBase
# ---------- computepcaorientation: Python ----------
#! python3
# -*- coding: utf-8 -*-
# venv: DDU_CSC
print('ENV OK!')
# r: charset_normalizer
# r: requests
# r: numpy
# r: scipy
# r: scikit-learn

# PYTHON STANDARD LIBRARY IMPORTS ---------------------------------------------

# THIRD PARTY LIBRARY IMPORTS -------------------------------------------------
import numpy as np  # NOQA
from scipy.spatial import ConvexHull  # NOQA
from sklearn.decomposition import PCA  # NOQA

# RHINO AND GH RELATED IMPORTS ------------------------------------------------
import System  # NOQA
import Grasshopper  # NOQA
import Rhino  # NOQA

# One PCA sample per this many mm of triangle area (3D mesh path).
REFERENCE_FACE_AREA_MM2 = 100.0

# GHENV COMPONENT SETTINGS ----------------------------------------------------
ghenv.Component.Name = 'ComputePCAOrientation'  # NOQA
ghenv.Component.NickName = 'ComputePCAOrientation'  # NOQA
ghenv.Component.Category = 'DDU_CSC'  # NOQA
ghenv.Component.SubCategory = '7 Geometry Tools'  # NOQA
ghenv.Component.Description = (  # NOQA
    'Computes PCA orientation for input geometry. 3D meshes and breps use '
    'face-area-weighted sampling before PCA; point clouds use their sample '
    'points; extrusions use a 2D minimum bounding rectangle. Returns OBB, '
    'aligned geometry, translation vector, and PCA transformation matrix.'
)


class CSC_ComputePCAOrientation(Grasshopper.Kernel.GH_ScriptInstance):
    """
    Author: Max Benjamin Eschenbach
    License: MIT License
    Version: 260826
    """

    def __init__(self):
        """Initialize this component and set component parameters."""
        super().__init__()
        # initialize props
        self.Component = ghenv.Component  # NOQA
        self.InputParams = self.Component.Params.Input
        self.OutputParams = self.Component.Params.Output

    def _addRemark(self, msg: str = ''):
        """Add a remark message to the component."""
        rml = self.Component.RuntimeMessageLevel.Remark
        self.AddRuntimeMessage(rml, msg)

    def _addWarning(self, msg: str = ''):
        """Add a warning message to the component."""
        rml = self.Component.RuntimeMessageLevel.Warning
        self.AddRuntimeMessage(rml, msg)

    def _addError(self, msg: str = ''):
        """Add an error message to the component."""
        rml = self.Component.RuntimeMessageLevel.Error
        self.AddRuntimeMessage(rml, msg)

    def BeforeRunScript(self):
        """Perform some setup actions."""
        # Initialize input param descriptions
        self.InputParams[0].Description = (
            'Input Rhino Geometry (Mesh, Brep, Extrusion, or PointCloud)'
        )
        # Initialize output param descriptions
        i = 0
        if self.OutputParams[0].Name == 'out':
            i += 1
        self.OutputParams[0+i].Description = (
            'Object oriented bounding box, obtained using PCA, '
            ' at the location of the input geometry'
        )
        self.OutputParams[1+i].Description = (
            'Input geometry transformed using PCA method and centered at '
            'world origin'
        )
        self.OutputParams[2+i].Description = (
            'Object oriented bounding box transformed using the computed '
            'PCA frame, centered at the world origin'
        )
        self.OutputParams[3+i].Description = (
            'Translation vector that was used to move the geometry '
            'to the world origin'
        )
        self.OutputParams[4+i].Description = (
            'PCA frame that was used to transform the geometry '
            'converted to a Rhino XForm.'
        )

    def center_geometry_at_origin(self, geometry):
        """
        Center geometry at its centroid.
        Returns centered geometry and translation vector.
        """
        if isinstance(geometry, Rhino.Geometry.PointCloud):
            if geometry.Count == 0:
                raise RuntimeError('Point cloud is empty')
            bbox = geometry.GetBoundingBox(True)
            volume_centroid = bbox.Center
        else:
            vmp = Rhino.Geometry.VolumeMassProperties.Compute(geometry)
            volume_centroid = vmp.Centroid
            if volume_centroid is None:
                bbox = geometry.GetBoundingBox(True)
                volume_centroid = bbox.Center
        translation_vector = -np.array([
            volume_centroid.X, volume_centroid.Y, volume_centroid.Z
        ])
        centered_geometry = geometry.Duplicate()
        translation_xform = Rhino.Geometry.Transform.Translation(
            translation_vector[0], translation_vector[1], translation_vector[2]
        )
        centered_geometry.Transform(translation_xform)
        return centered_geometry, translation_vector

    def _triangle_area(self, v0, v1, v2):
        return float(0.5 * np.linalg.norm(np.cross(v1 - v0, v2 - v0)))

    def sample_points_area_weighted_from_mesh(
            self,
            mesh,
            reference_face_area=REFERENCE_FACE_AREA_MM2,
            min_samples_per_face=1):
        """
        Build a PCA point cloud by repeating face centroids weighted by area.
        """
        vertices = np.array(
            [[v.X, v.Y, v.Z] for v in mesh.Vertices],
            dtype=np.float64,
        )
        if mesh.Faces.Count == 0:
            return vertices

        samples = []
        ref_area = max(reference_face_area, 1e-6)
        for face_idx in range(mesh.Faces.Count):
            face = mesh.Faces[face_idx]
            if face.IsTriangle:
                triangles = [[face.A, face.B, face.C]]
            elif face.IsQuad:
                triangles = [
                    [face.A, face.B, face.C],
                    [face.A, face.C, face.D],
                ]
            else:
                continue

            for tri in triangles:
                v0, v1, v2 = (
                    vertices[tri[0]], vertices[tri[1]], vertices[tri[2]]
                )
                area = self._triangle_area(v0, v1, v2)
                count = max(
                    min_samples_per_face,
                    int(round(area / ref_area)),
                )
                centroid = (v0 + v1 + v2) / 3.0
                samples.extend([centroid] * count)

        if not samples:
            return vertices
        return np.vstack(samples)

    def sample_points_for_pca_3d(self, geometry):
        """
        Collect area-weighted PCA samples from mesh or brep geometry.
        NOTE: Currently not used due to very long runtime
        """
        if isinstance(geometry, Rhino.Geometry.Mesh):
            return self.sample_points_area_weighted_from_mesh(geometry)

        if isinstance(geometry, Rhino.Geometry.Brep):
            mp = Rhino.Geometry.MeshingParameters.Default
            brep_meshes = Rhino.Geometry.Mesh.CreateFromBrep(geometry, mp)
            if brep_meshes:
                chunks = [
                    self.sample_points_area_weighted_from_mesh(m)
                    for m in brep_meshes
                ]
                return np.vstack(chunks)

            return np.array(
                [[p.Location.X, p.Location.Y, p.Location.Z]
                 for p in geometry.Vertices],
                dtype=np.float64,
            )

        raise RuntimeError(
            'Area-weighted 3D sampling not implemented for geometry of type '
            f'{type(geometry)}!'
        )

    def compute_obb_3d(self, points):
        """
        Compute object oriented bounding box for 3D points using PCA.
        Returns unsorted dimensions and bounding box origin.
        """
        pca = PCA(n_components=3)
        pca.fit(points)
        principal_components = pca.components_

        det = np.linalg.det(principal_components)
        if det < 0:
            principal_components[2] = -principal_components[2]

        pca_points = np.dot(points, principal_components.T)
        min_bounds = np.min(pca_points, axis=0)
        max_bounds = np.max(pca_points, axis=0)
        dimensions = max_bounds - min_bounds
        bbx_origin = (min_bounds + max_bounds) / 2.0

        return dimensions.tolist(), principal_components, bbx_origin.tolist()

    def minimum_bounding_rectangle(self, points):
        """
        Compute minimum bounding rectangle for 2D points.
        Returns rectangle corners and angle.
        """
        hull = ConvexHull(points)
        hull_points = points[hull.vertices]

        min_area = float('inf')
        best_rectangle = None
        best_angle = 0

        for i in range(len(hull_points)):
            p1 = hull_points[i]
            p2 = hull_points[(i + 1) % len(hull_points)]
            edge_vec = p2 - p1
            angle = np.arctan2(edge_vec[1], edge_vec[0])
            cos_angle = np.cos(-angle)
            sin_angle = np.sin(-angle)
            rot_matrix = np.array([[cos_angle, -sin_angle],
                                   [sin_angle, cos_angle]])
            rotated_points = np.dot(points, rot_matrix.T)

            min_x = np.min(rotated_points[:, 0])
            max_x = np.max(rotated_points[:, 0])
            min_y = np.min(rotated_points[:, 1])
            max_y = np.max(rotated_points[:, 1])
            area = (max_x - min_x) * (max_y - min_y)

            if area < min_area:
                min_area = area
                best_angle = angle
                best_rectangle = np.array([
                    [min_x, min_y],
                    [max_x, min_y],
                    [max_x, max_y],
                    [min_x, max_y]
                ])
                inv_rot_matrix = np.array([
                    [cos_angle, sin_angle],
                    [-sin_angle, cos_angle]
                ])
                best_rectangle = np.dot(best_rectangle, inv_rot_matrix.T)

        return best_rectangle, best_angle

    def compute_obb_2d(self, points, height):
        """
        Compute OBB for extrusions using minimum bounding rectangle in XY.
        Returns unsorted dimensions and bounding box origin.
        """
        points_2d = points[:, :2]
        mbr, optimal_angle = self.minimum_bounding_rectangle(points_2d)

        cos_angle = np.cos(-optimal_angle)
        sin_angle = np.sin(-optimal_angle)
        rot_matrix = np.array([
            [cos_angle, -sin_angle],
            [sin_angle, cos_angle]
        ])
        rotated_points = np.dot(points_2d, rot_matrix.T)

        min_x = np.min(rotated_points[:, 0])
        max_x = np.max(rotated_points[:, 0])
        min_y = np.min(rotated_points[:, 1])
        max_y = np.max(rotated_points[:, 1])

        x_dim = max_x - min_x
        y_dim = max_y - min_y
        bbx_center_2d = [(min_x + max_x) / 2.0, (min_y + max_y) / 2.0]

        min_z = np.min(points[:, 2])
        max_z = np.max(points[:, 2])
        z_center = (min_z + max_z) / 2.0
        bbx_origin_2d = [bbx_center_2d[0], bbx_center_2d[1], z_center]

        if x_dim >= y_dim:
            dimensions = [x_dim, y_dim, height]
            principal_components = np.array([
                [cos_angle, -sin_angle, 0],
                [sin_angle, cos_angle, 0],
                [0, 0, 1]
            ])
        else:
            dimensions = [y_dim, x_dim, height]
            cos_angle_90 = np.cos(-optimal_angle + np.pi / 2)
            sin_angle_90 = np.sin(-optimal_angle + np.pi / 2)
            principal_components = np.array([
                [cos_angle_90, -sin_angle_90, 0],
                [sin_angle_90, cos_angle_90, 0],
                [0, 0, 1]
            ])

        return dimensions, principal_components, bbx_origin_2d

    def rhino_xform(self, transformation_matrix) -> Rhino.Geometry.Transform:
        """
        Convert numpy transformation matrix to Rhino Transform.
        """
        XForm = Rhino.Geometry.Transform.Identity
        XForm.M00 = transformation_matrix[0][0]
        XForm.M01 = transformation_matrix[0][1]
        XForm.M02 = transformation_matrix[0][2]
        XForm.M03 = transformation_matrix[0][3]
        XForm.M10 = transformation_matrix[1][0]
        XForm.M11 = transformation_matrix[1][1]
        XForm.M12 = transformation_matrix[1][2]
        XForm.M13 = transformation_matrix[1][3]
        XForm.M20 = transformation_matrix[2][0]
        XForm.M21 = transformation_matrix[2][1]
        XForm.M22 = transformation_matrix[2][2]
        XForm.M23 = transformation_matrix[2][3]
        return XForm

    def process_geometry(self, geometry: Rhino.Geometry.GeometryBase):
        """
        Process geometry to extract points and determine if 3D.
        Returns points array and boolean indicating if 3D.
        """
        compute_3d = False
        # HANDLE BREP
        if isinstance(geometry, Rhino.Geometry.Brep):
            points = np.array([[p.Location.X,
                                p.Location.Y,
                                p.Location.Z] for p in geometry.Vertices])
            compute_3d = True
        # HANDLE EXTRUSIONS
        elif isinstance(geometry, Rhino.Geometry.Extrusion):
            brep = geometry.ToBrep()
            points = np.array([[p.Location.X,
                                p.Location.Y,
                                p.Location.Z] for p in brep.Vertices])
            compute_3d = False
        # HANDLE MESH
        elif isinstance(geometry, Rhino.Geometry.Mesh):
            points = np.array([[p.X, p.Y, p.Z] for p in geometry.Vertices])
            compute_3d = True
        elif isinstance(geometry, Rhino.Geometry.PointCloud):
            if geometry.Count == 0:
                raise RuntimeError('Point cloud is empty')
            points = np.array([
                [geometry[i].Location.X,
                 geometry[i].Location.Y,
                 geometry[i].Location.Z]
                for i in range(geometry.Count)
            ])
            compute_3d = True
        else:
            raise RuntimeError('Geometry processing not implemented '
                               f'for geometry of type {type(geometry)}!')
        # return results
        return points, compute_3d

    def create_pca_transform_matrix(self, principal_components):
        """
        Create a 4x4 transformation matrix from PCA principal components.
        """
        # The principal components define the new coordinate system
        # To transform geometry TO align with this system, we need the INVERSE
        # The principal components are the new basis vectors
        # We want to rotate the geometry so it aligns with these vectors
        # This requires the inverse of the rotation matrix
        rotation_matrix = np.linalg.inv(principal_components.T)
        # Create 4x4 transformation matrix
        transform_matrix = np.eye(4)
        transform_matrix[:3, :3] = rotation_matrix
        # return results
        return transform_matrix

    def apply_pca_transform(self, geometry, principal_components):
        """
        Apply PCA transformation to geometry.
        """
        # Create transformation matrix
        transform_matrix = self.create_pca_transform_matrix(
            principal_components)
        # Convert to Rhino XForm
        xform = self.rhino_xform(transform_matrix)
        # Apply transformation
        transformed_geometry = geometry.Duplicate()
        transformed_geometry.Transform(xform)
        # return results
        return transformed_geometry

    def RunScript(self, Geometry: Rhino.Geometry.GeometryBase):
        # set up output variables
        ObjectOrientedBBX = Grasshopper.DataTree[System.Object]()
        AlignedGeometry = Grasshopper.DataTree[System.Object]()
        AlignedBBX = Grasshopper.DataTree[System.Object]()
        TranslationVector = Grasshopper.DataTree[System.Object]()
        PCAXForm = Grasshopper.DataTree[System.Object]()
        try:
            # sanitize input and abort if not present
            self.Component.Message = None
            if not Geometry:
                msg = 'Input Geometry failed to collect data!'
                self._addWarning(msg)
                return (ObjectOrientedBBX, AlignedGeometry,
                        AlignedBBX, TranslationVector, PCAXForm)
            elif not Geometry.IsValid:
                msg = 'Input Geometry is invalid!'
                self._addError(msg)
                return (ObjectOrientedBBX, AlignedGeometry,
                        AlignedBBX, TranslationVector, PCAXForm)
            # Center geometry at world origin
            (centered_geometry,
             translation_vector) = self.center_geometry_at_origin(Geometry)
            # Process geometry to extract points
            centered_points, compute_3d = self.process_geometry(
                centered_geometry
            )
            # Get Rhino translation vector
            TranslationVector = Rhino.Geometry.Vector3d(
                *translation_vector.tolist()
            )
            if compute_3d:
                # centered_points = self.sample_points_for_pca_3d(
                #     centered_geometry
                # )
                dimensions, principal_components, bbx_origin = (
                    self.compute_obb_3d(centered_points)
                )
            else:
                height = centered_geometry.PathStart.DistanceTo(
                    centered_geometry.PathEnd
                )
                dimensions, principal_components, bbx_origin = (
                    self.compute_obb_2d(centered_points, height)
                )
            # Create PCA transformation matrix and XForm
            # The principal components define the new coordinate system
            # We want to transform the geometry TO align with this system
            pca_transform_matrix = self.create_pca_transform_matrix(
                principal_components)
            PCAXForm = self.rhino_xform(pca_transform_matrix)
            # Apply PCA transformation to centered geometry
            # This will align the geometry with its principal axes
            AlignedGeometry = self.apply_pca_transform(
                centered_geometry, principal_components)
            # Create PCA-oriented bounding box
            AlignedBBX = AlignedGeometry.GetBoundingBox(True)
            # Now "transform back" the PCA-oriented bounding box
            # NOTE: we have to convert to a Rhino.Geometry.Box for the
            # correctly applying the transformation!
            ObjectOrientedBBX = Rhino.Geometry.Box(
                AlignedGeometry.GetBoundingBox(True)
            )
            _res, invPCAXForm = PCAXForm.TryGetInverse()
            if not _res:
                raise RuntimeError('Failed to get Inverse of PCA Transform!')
            ObjectOrientedBBX.Transform(invPCAXForm)
            ObjectOrientedBBX.Transform(
                Rhino.Geometry.Transform.Translation(-TranslationVector)
            )
            # return output
            return (ObjectOrientedBBX, AlignedGeometry,
                    AlignedBBX, TranslationVector, PCAXForm)
        except ValueError as e:
            msg = f'Validation error: {str(e)}'
            self._addError(msg)
        except RuntimeError as e:
            msg = f'Runtime error: {str(e)}'
            self._addError(msg)
        # Return empty results if there was an error
        return (ObjectOrientedBBX, AlignedGeometry,
                AlignedBBX, TranslationVector, PCAXForm)
# ---------- end computepcaorientation ----------

# ----
# comments & notes: Create a new Session by logging in to the Backend
ddu_csc_username_6 = Panel("")
ddu_csc_password_6 = Panel("")
disablecache_6 = BooleanToggle(False)
clearcache_6 = Button()
refresh_6 = Button()
csc_session_6 = Session(
    Username=ddu_csc_username_6,
    Password=ddu_csc_password_6,
    Refresh=refresh_6,
    DisableCache=disablecache_6,
    ClearCache=clearcache_6)  # -> Status; inputs Username: String, Password: String, Refresh: Boolean, DisableCache: Boolean, ClearCache: Boolean; same code as csc_session
status_messages_6 = Panel(csc_session_6)

# ----
# comments & notes: Find the largest area quadrilateral in a boundary Polyline
number_slider = Slider(53, range=0..100)
reducedmeshgeometry = Mesh(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)
pt = ConstructPoint(XCoordinate=0, YCoordinate=0, ZCoordinate=number_slider)
xy = XYPlane(Origin=pt)
sec = MeshPlane(Mesh=reducedmeshgeometry, Plane=xy)
boundary_polyline = Data(sec)
maxinscribedquad = MaxInscribedQuad(Curves=boundary_polyline, MaxIter=Slider(25, range=1..200), Starts=Slider(64, range=0..100))  # -> Quads, Areas; inputs Curves: list of Polyline, MaxIter: Int32, Tolerance: Double, Starts: Int32, Seed: Int32
# ---------- maxinscribedquad: C# ----------
#region Usings
using System;
using System.Linq;
using System.Collections;
using System.Collections.Generic;
using System.Drawing;

using Rhino;
using Rhino.Geometry;

using Grasshopper;
using Grasshopper.Kernel;
using Grasshopper.Kernel.Data;
using Grasshopper.Kernel.Types;
#endregion

public class Script_Instance : GH_ScriptInstance
{
    #region Notes
    /* 
      Members:
        RhinoDoc RhinoDocument
        GH_Document GrasshopperDocument
        IGH_Component Component
        int Iteration

      Methods (Virtual & overridable):
        Print(string text)
        Print(string format, params object[] args)
        Reflect(object obj)
        Reflect(object obj, string method_name)

        Author: Max Benjamin Eschenbach, Alessandro Garruto
        License: MIT License
        Version: 251102
    */
    #endregion

    private void RunScript(
		List<Polyline> Curves,
		int MaxIter,
		double Tolerance,
		int Starts,
		int Seed,
		ref object Quads,
		ref object Areas)
    {
        // Set component params
        this.Component.Name = "MaxInscribedQuad";
        this.Component.NickName = "MaxInscribedQuad";
        this.Component.Category = "DDU_CSC";
        this.Component.SubCategory = "7 Geometry Tools";
        this.Component.Description = (
            "Finds a maximum-area inscribed 4-point polygon (quadrilateral) inside each input closed polyline.\n" +
            "Method 0: pure Rhino (default)\n"
        );

        // Initialize input param descriptions
        if (this.Component.Params.Input.Count > 0)
            this.Component.Params.Input[0].Description = "Closed boundary polylines (PolylineCurve). Each is processed independently.";
        if (this.Component.Params.Input.Count > 2)
            this.Component.Params.Input[1].Description = "Maximum iterations for the optimizer.";
        if (this.Component.Params.Input.Count > 3)
            this.Component.Params.Input[2].Description = "Containment tolerance for inside checks (default 0.01).";
        if (this.Component.Params.Input.Count > 4)
            this.Component.Params.Input[3].Description = "Multi-start count; more starts improves quality (default 64).";
        if (this.Component.Params.Input.Count > 5)
            this.Component.Params.Input[4].Description = "Random seed for reproducibility (default 42).";

        // Initialize output param descriptions
        int i = 0;
        if (this.Component.Params.Output.Count > 0 && this.Component.Params.Output[0].Name == "out")
            i += 1;
        if (this.Component.Params.Output.Count > 0 + i)
            this.Component.Params.Output[0 + i].Description = "List of best inscribed quadrilaterals (Polyline).";
        if (this.Component.Params.Output.Count > 1 + i)
            this.Component.Params.Output[1 + i].Description = "Area of each quadrilateral.";

        // Process inputs
        if (Curves == null)
        {
            this.AddRuntimeMessage(
                GH_RuntimeMessageLevel.Warning,
                "Input Parameter Curves failed to collect Data!"
            );
            Quads = new Grasshopper.DataTree<System.Object>();
            Areas = new Grasshopper.DataTree<System.Object>();
            return;
        }
        if (MaxIter <= 0 | MaxIter == null)
            MaxIter = 150;
        if (Tolerance <= 0 | Tolerance == null)
            Tolerance = 0.01;
        if (Starts <= 0 | Starts == null)
            Starts = 64;
        if (Seed == 0 | Seed == null)
            Seed = 42;

        List<Polyline> quads = new List<Polyline>();
        List<double> areas = new List<double>();

        foreach (Polyline c in Curves)
        {
            PolylineCurve curve = c.ToPolylineCurve();
            if (curve == null || !curve.IsValid || !curve.IsClosed)
            {
                quads.Add(null);
                areas.Add(0.0);
                continue;
            }

            Polyline q;
            double a;
            BestQuad(curve, Tolerance, Starts, MaxIter, Seed, out q, out a);
            quads.Add(q);
            areas.Add(a);
        }

        Quads = quads;
        Areas = areas;
    }

    private static Plane FitPlaneForPolyline(PolylineCurve pl)
    {
        Plane plane;
        bool ok = pl.TryGetPlane(out plane);
        if (ok)
            return plane;

        Point3d[] pts = new Point3d[pl.PointCount];
        for (int i = 0; i < pl.PointCount; i++)
        {
            pts[i] = pl.Point(i);
        }
        PlaneFitResult pfr = Plane.FitPlaneToPoints(pts, out plane);
        bool ok2 = (int) pfr >= 0;
        return ok2 ? plane : Plane.WorldXY;
    }

    private static Point3d PointAtU(PolylineCurve plCurve, double u)
    {
        u = u % 1.0;
        double length = plCurve.GetLength();
        double s = u * length;
        double t;
        bool ok = plCurve.LengthParameter(s, out t);
        return ok ? plCurve.PointAt(t) : plCurve.PointAtStart;
    }

    private static double PolygonAreaXY(List<Point3d> pts)
    {
        double s = 0.0;
        int n = pts.Count;
        for (int i = 0; i < n; i++)
        {
            int j = (i + 1) % n;
            s += pts[i].X * pts[j].Y - pts[i].Y * pts[j].X;
        }
        return 0.5 * Math.Abs(s);
    }

    private static List<Point3d> SimpleQuad(List<Point3d> pts)
    {
        double cx = pts.Sum(p => p.X) / 4.0;
        double cy = pts.Sum(p => p.Y) / 4.0;
        List<Tuple<double, Point3d>> angPts = new List<Tuple<double, Point3d>>();
        foreach (Point3d p in pts)
        {
            double angle = Math.Atan2(p.Y - cy, p.X - cx);
            angPts.Add(Tuple.Create(angle, p));
        }
        angPts.Sort((a, b) => a.Item1.CompareTo(b.Item1));
        return angPts.Select(t => t.Item2).ToList();
    }

    private static bool SegmentInside(Curve curve, Plane plane, Point3d p, Point3d q, double Tolerance, int samples = 7)
    {
        for (int i = 0; i < samples; i++)
        {
            double a = (samples == 1) ? 0.0 : (double)i / (double)(samples - 1);
            Point3d m = new Point3d(
                p.X * (1 - a) + q.X * a,
                p.Y * (1 - a) + q.Y * a,
                p.Z * (1 - a) + q.Z * a
            );
            PointContainment rel = curve.Contains(m, plane, Tolerance);
            if (rel != PointContainment.Inside && rel != PointContainment.Coincident)
                return false;
        }
        return true;
    }

    private double QuadAreaIfValid(PolylineCurve curve, Plane plane, PolylineCurve pl, List<double> uvec, double Tolerance)
    {
        List<double> us = new List<double>(uvec.Select(u => u % 1.0));
        us.Sort();
        List<Point3d> pts = us.Select(u => PointAtU(pl, u)).ToList();
        List<Point3d> quad = SimpleQuad(pts);
        for (int i = 0; i < 4; i++)
        {
            int j = (i + 1) % 4;
            if (!SegmentInside(curve, plane, quad[i], quad[j], Tolerance))
                return 0.0;
        }
        return PolygonAreaXY(quad);
    }

    private Tuple<List<double>, double> ImproveUvec(PolylineCurve curve, Plane plane, PolylineCurve pl, List<double> uvec, double Tolerance, double delta, int iters = 1)
    {
        List<double> u = new List<double>(uvec);
        double best = QuadAreaIfValid(curve, plane, pl, u, Tolerance);
        for (int iter = 0; iter < iters; iter++)
        {
            for (int k = 0; k < 4; k++)
            {
                bool improved = true;
                while (improved)
                {
                    improved = false;
                    foreach (double step in new double[] { -delta, delta })
                    {
                        List<double> cand = new List<double>(u);
                        cand[k] = (cand[k] + step) % 1.0;
                        double a = QuadAreaIfValid(curve, plane, pl, cand, Tolerance);
                        if (a > best)
                        {
                            best = a;
                            u = cand;
                            improved = true;
                            break;
                        }
                    }
                }
            }
        }
        return Tuple.Create(u, best);
    }

    private void BestQuad(PolylineCurve curve, double tol, int Starts, int MaxIter, int Seed, out Polyline quad, out double area)
    {
        quad = null;
        area = 0.0;

        if (curve == null || !curve.IsValid || !curve.IsClosed)
            return;

        Plane plane = FitPlaneForPolyline(curve);
        PolylineCurve pl = curve;

        Random rng = new Random(Seed);
        double phi = (Math.Sqrt(5.0) - 1.0) * 0.5;
        List<List<double>> seeds = new List<List<double>>();

        double baseU = rng.NextDouble();
        for (int i = 0; i < Math.Max(1, Starts); i++)
        {
            double u1 = (baseU + i * phi) % 1.0;
            double u2 = (u1 + 0.25 + (0.03 * ((i * 3) % 5))) % 1.0;
            double u3 = (u1 + 0.50 + (0.07 * ((i * 5) % 7))) % 1.0;
            double u4 = (u1 + 0.75 + (0.11 * ((i * 7) % 11))) % 1.0;
            seeds.Add(new List<double> { u1, u2, u3, u4 });
        }

        double bestArea = 0.0;
        List<double> bestU = null;

        foreach (List<double> seedU in seeds)
        {
            double a0 = QuadAreaIfValid(curve, plane, pl, seedU, tol);
            if (a0 <= 0.0)
                continue;

            List<double> u = new List<double>(seedU);
            double a = a0;
            double delta = 0.08;
            int levels = Math.Max(1, Math.Min(6, MaxIter / 50));

            for (int lvl = 0; lvl < levels; lvl++)
            {
                var result = ImproveUvec(curve, plane, pl, u, tol, delta, iters: 1 + lvl);
                u = result.Item1;
                a = result.Item2;
                delta *= 0.35;
            }

            if (a > bestArea)
            {
                bestArea = a;
                bestU = u;
            }
        }

        if (bestU == null || bestArea <= 0.0)
            return;

        List<double> us = new List<double>(bestU.Select(ui => ui % 1.0));
        us.Sort();
        List<Point3d> pts = us.Select(u => PointAtU(pl, u)).ToList();
        List<Point3d> quadPts = SimpleQuad(pts);
        quadPts.Add(quadPts[0]);
        quad = new Polyline(quadPts);
        area = bestArea;
    }
}
# ---------- end maxinscribedquad ----------
maxinquads = Data(maxinscribedquad.Quads)

# ----
# comments & notes: Find the largest "flat" side of a mesh with a clustering/sampling approach
distancetolerance = Slider(2, range=0.01..20)
angletolerance = Slider(5, range=0.01..20)
reducedmeshgeometry_2 = Mesh(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)
findlargestflatside = FindLargestFlatSide(
    InputMesh=reducedmeshgeometry_2,
    AngleTolerance=angletolerance,
    DistanceTolerance=distancetolerance,
    FaceCountThreshold=Slider(20000, range=100..25000))  # -> FlatPlane, Points; inputs InputMesh: Mesh, AngleTolerance: Double, DistanceTolerance: Double, FaceCountThreshold: Int32, MaxSamples: Int32
# ---------- findlargestflatside: C# ----------
#region Usings
using System;
using System.Linq;
using System.Collections;
using System.Collections.Generic;
using System.Drawing;

using Rhino;
using Rhino.Geometry;

using Grasshopper;
using Grasshopper.Kernel;
using Grasshopper.Kernel.Data;
using Grasshopper.Kernel.Types;
#endregion

public class Script_Instance : GH_ScriptInstance
{
    #region Notes
    /* 
      Members:
        RhinoDoc RhinoDocument
        GH_Document GrasshopperDocument
        IGH_Component Component
        int Iteration

      Methods (Virtual & overridable):
        Print(string text)
        Print(string format, params object[] args)
        Reflect(object obj)
        Reflect(object obj, string method_name)

        Author: Max Benjamin Eschenbach, Alessandro Garruto
        License: MIT License
        Version: 251102
    */
    #endregion

    private void RunScript(
		Mesh InputMesh,
		double AngleTolerance,
		double DistanceTolerance,
		int FaceCountThreshold,
		int MaxSamples,
		ref object FlatPlane,
		ref object Points)
    {
        // GHENV COMPONENT SETTINGS
        this.Component.Name = "FindLargestFlatSide";
        this.Component.NickName = "FindLargestFlatSide";
        this.Component.Category = "DDU_CSC";
        this.Component.SubCategory = "7 Geometry Tools";
        this.Component.Description = (
            "Finds the largest flat side of a mesh using optimized algorithm. " +
            "Uses normal clustering and early termination heuristics for performance.");
        // Initialize input param descriptions
        this.Component.Params.Input[0].Description = (
            "Input Mesh for finding the largest flat side."
        );
        this.Component.Params.Input[1].Description = (
            "Angle tolerance for clustering normals."
        );
        this.Component.Params.Input[2].Description = (
            "Distance tolerance"
        );
        this.Component.Params.Input[3].Description = (
            "Face count threshold for large meshes. Meshes with face count " +
            "above this value will be processed by sampling a subset of vertices.\n" +
            "Defaults to 15.000"
        );
        this.Component.Params.Input[4].Description = (
            "Maximum points to sample for the fallback algorithm.\n" +
            "Defaults to 5.000"
        );

        // Initialize output param descriptions
        int opi = 0;
        if (this.Component.Params.Output[0].Name == "out")
            opi = 1;
        this.Component.Params.Input[0+opi].Description = (
            "Flattest Plane found. Normal always points AWAY from the Mesh."
        );
        this.Component.Params.Input[1+opi].Description = (
            "Final Points that were used to fit the flat plane."
        );

        // Validation
        if (InputMesh == null || !InputMesh.IsValid)
        {
            this.AddRuntimeMessage(GH_RuntimeMessageLevel.Warning, 
                "Input Parameter Mesh failed to collect Data!");
            FlatPlane = new Grasshopper.DataTree<Plane>();
            Points = new Grasshopper.DataTree<Point3d>();
            return;
        }
        
        if (AngleTolerance <= 0)
            AngleTolerance = 3.0;
        
        if (DistanceTolerance <= 0)
            DistanceTolerance = 1.0;
        
        if (FaceCountThreshold <= 0)
            FaceCountThreshold = 10000;
        
        if (MaxSamples <= 0)
            MaxSamples = 5000;

        double angleTolRad = RhinoMath.ToRadians(AngleTolerance);
        
        // Ensure face and vertex normals are computed
        InputMesh.FaceNormals.ComputeFaceNormals();
        InputMesh.Normals.ComputeNormals();
        
        int faceCount = InputMesh.Faces.Count;
        var vertices = InputMesh.Vertices;
        var vertexNormals = InputMesh.Normals;
        var faceNormals = InputMesh.FaceNormals;
        
        // Precompute all face data
        var faceData = new List<FaceData>(faceCount);
        for (int i = 0; i < faceCount; i++)
        {
            var face = InputMesh.Faces[i];
            var p1 = vertices[face.A];
            var p2 = vertices[face.B];
            var p3 = vertices[face.C];
            
            var plane = new Plane(p1, p2, p3);
            var normal = faceNormals[i];
            
            faceData.Add(new FaceData
            {
                Index = i,
                Face = face,
                Plane = plane,
                Normal = normal,
                Vertices = face.IsQuad 
                    ? new[] { face.A, face.B, face.C, face.D }
                    : new[] { face.A, face.B, face.C }
            });
        }
        
        int maxPointsFound = 0;
        Plane bestPlane = Plane.WorldXY;
        HashSet<int> bestPointsIndices = new HashSet<int>();
        int vertexCount = vertices.Count;
        
        // DECISION: Use sampling directly for large meshes, clustering for smaller ones
        if (faceCount > FaceCountThreshold)
        {
            // Very large mesh: Use sampling approach directly
            int sampleSize = Math.Min(MaxSamples, faceCount);
            var sampledBest = FindBestFromSample(
                faceData,
                vertices,
                angleTolRad,
                DistanceTolerance,
                sampleSize);
            
            maxPointsFound = sampledBest.PointsCount;
            bestPointsIndices = sampledBest.Points;
            bestPlane = sampledBest.Plane;
        }
        else
        {
            // Small to medium mesh: Use clustering approach
            var normalClusters = ClusterFacesByNormal(faceData, angleTolRad);
            
            // Early termination threshold
            // If we find a cluster covering >80% of vertices, we can stop
            double earlyTermThreshold = 0.8 * vertexCount;
            
            // Process clusters instead of individual faces
            foreach (var cluster in normalClusters)
            {
                if (cluster.Count == 0) continue;
                
                // Use the first face in cluster as representative
                var baseFaceData = faceData[cluster[0]];
                var basePlane = baseFaceData.Plane;
                var baseNormal = baseFaceData.Normal;
                
                var currentPointsIndices = new HashSet<int>();
                
                // Check all faces in this cluster
                foreach (int faceIdx in cluster)
                {
                    var otherFaceData = faceData[faceIdx];
                    var otherNormal = otherFaceData.Normal;
                    
                    // Verify normal alignment (should be true for same cluster, but verify)
                    double angle = Vector3d.VectorAngle(baseNormal, otherNormal);
                    bool isParallel = (angle < angleTolRad) || 
                                     (angle > (Math.PI - angleTolRad));
                    
                    if (isParallel)
                    {
                        // Check distance for all vertices of this face
                        bool allInTolerance = true;
                        foreach (int vIdx in otherFaceData.Vertices)
                        {
                            double dist = basePlane.DistanceTo(vertices[vIdx]);
                            if (Math.Abs(dist) > DistanceTolerance)
                            {
                                allInTolerance = false;
                                break;
                            }
                        }
                        
                        if (allInTolerance)
                        {
                            foreach (int vIdx in otherFaceData.Vertices)
                                currentPointsIndices.Add(vIdx);
                        }
                    }
                }
                
                // Check if this cluster is better
                if (currentPointsIndices.Count > maxPointsFound)
                {
                    maxPointsFound = currentPointsIndices.Count;
                    bestPointsIndices = new HashSet<int>(currentPointsIndices);
                    bestPlane = basePlane;
                    
                    // Early termination check
                    if (maxPointsFound >= earlyTermThreshold)
                        break;
                }
            }
        }
        
        // Convert indices to points
        var finalPoints = new List<Point3d>();
        var finalNormals = new List<Vector3d>();
        foreach (int idx in bestPointsIndices)
        {
            finalPoints.Add(vertices[idx]);
            finalNormals.Add(vertexNormals[idx]);
        }
        
        // Fit plane to all found points for better accuracy
        if (finalPoints.Count > 2)
        {
            Plane fittedPlane;
            PlaneFitResult pfr = Plane.FitPlaneToPoints(finalPoints, out fittedPlane);
            if ((int) pfr >= 0)
            {
                bestPlane = fittedPlane;
                var ptX = finalPoints.Select(pt => pt.X);
                var ptY = finalPoints.Select(pt => pt.Y);
                var ptZ = finalPoints.Select(pt => pt.Z);
                Point3d ptCentroid = new Point3d(
                    ptX.Sum() / ptX.Count(),
                    ptY.Sum() / ptY.Count(),
                    ptZ.Sum() / ptZ.Count()
                );
                bestPlane.Origin = ptCentroid;
                var vX = finalNormals.Select(v => v.X);
                var vY = finalNormals.Select(v => v.Y);
                var vZ = finalNormals.Select(v => v.Z);
                Vector3d avgNormal = new Vector3d(
                    vX.Sum() / vX.Count(),
                    vY.Sum() / vY.Count(),
                    vZ.Sum() / vZ.Count()
                );
                avgNormal.Unitize();
                double dp = avgNormal * bestPlane.Normal;
                if (dp < 0)
                {
                    bestPlane.Flip();
                }
            }
        }
        
        FlatPlane = bestPlane;
        Points = finalPoints;
    }
    
    // Cluster faces by normal direction using spatial hashing
    private List<List<int>> ClusterFacesByNormal(List<FaceData> faceData, double angleTol)
    {
        // Use a dictionary to group faces by quantized normal direction
        // This creates buckets of similar normals
        var clusters = new Dictionary<string, List<int>>();
        
        foreach (var fd in faceData)
        {
            // Quantize normal to create hash key
            // Round to nearest 5 degrees to create buckets
            var normal = fd.Normal;
            int quantizedX = (int)(Math.Round(normal.X / angleTol) * angleTol * 1000);
            int quantizedY = (int)(Math.Round(normal.Y / angleTol) * angleTol * 1000);
            int quantizedZ = (int)(Math.Round(normal.Z / angleTol) * angleTol * 1000);
            
            // Also consider opposite direction (flip normal)
            string key1 = $"{quantizedX},{quantizedY},{quantizedZ}";
            string key2 = $"{-quantizedX},{-quantizedY},{-quantizedZ}";
            
            if (!clusters.ContainsKey(key1))
            {
                // Check if opposite key exists
                if (clusters.ContainsKey(key2))
                {
                    clusters[key2].Add(fd.Index);
                }
                else
                {
                    clusters[key1] = new List<int> { fd.Index };
                }
            }
            else
            {
                clusters[key1].Add(fd.Index);
            }
        }
        
        return clusters.Values.ToList();
    }
    
    // Sample-based search for very large meshes
    private (HashSet<int> Points, int PointsCount, Plane Plane) FindBestFromSample(
        List<FaceData> faceData,
        Rhino.Geometry.Collections.MeshVertexList vertices,
        double angleTol,
        double distTol,
        int sampleSize)
    {
        var random = new Random(42); // Fixed seed for reproducibility
        var sampled = faceData.OrderBy(x => random.Next()).Take(sampleSize).ToList();

        int maxPoints = 0;
        HashSet<int> bestPoints = new HashSet<int>();
        Plane bestPlane = Plane.WorldXY;

        foreach (var baseFace in sampled)
        {
            var currentPoints = new HashSet<int>();

            foreach (var otherFace in faceData)
            {
                double angle = Vector3d.VectorAngle(baseFace.Normal, otherFace.Normal);
                bool isParallel = (angle < angleTol) || (angle > (Math.PI - angleTol));

                if (isParallel)
                {
                    bool allInTol = true;
                    foreach (int vIdx in otherFace.Vertices)
                    {
                        Point3d vertex = vertices[vIdx];
                        double dist = Math.Abs(baseFace.Plane.DistanceTo(vertex));
                        if (dist > distTol)
                        {
                            allInTol = false;
                            break;
                        }
                    }

                    if (allInTol)
                    {
                        foreach (int vIdx in otherFace.Vertices)
                            currentPoints.Add(vIdx);
                    }
                }
            }

            if (currentPoints.Count > maxPoints)
            {
                maxPoints = currentPoints.Count;
                bestPoints = new HashSet<int>(currentPoints);
                bestPlane = baseFace.Plane;
            }
        }

        return (bestPoints, maxPoints, bestPlane);
    }
    
    private class FaceData
    {
        public int Index;
        public MeshFace Face;
        public Plane Plane;
        public Vector3d Normal;
        public int[] Vertices;
    }
}
# ---------- end findlargestflatside ----------
pflip = FlipPlane(Plane=findlargestflatside.FlatPlane, ReverseX=False, ReverseY=False, SwapAxes=True)
xy_2 = XYPlane(Origin=Point(0, 0, 0))
orient = Orient(Geometry=reducedmeshgeometry_2, Source=pflip, Target=xy_2)  # -> Geometry, Transform

# ---- group: __DDU_CSC_EXAMPLE_08__
steelfixture = Panel("7ebdd53b-27e4-4098-a3e5-f000790fd7c5")
steelfixture_2 = Mesh(<mesh referenced from the Rhino model>)

smallrubble = Panel("f69f1858-e132-49cc-9474-416947ea797b")
smallrubble_2 = Mesh(<mesh referenced from the Rhino model>)

# Example 08:
# - Creating a new snapshot for an existing identity in the catalog
bigrubble = Panel("243df186-9e30-4b19-95aa-17d7d88976f9")
bigrubble_2 = Mesh(<mesh referenced from the Rhino model>)

# ---- group: __DDU_CSC_EXAMPLE_09__
# Step 1
# comments & notes: Create new User Session and sign in
# 
# (Add your credentials!)
ddu_csc_username_7 = Panel("")
ddu_csc_password_7 = Panel("")
disablecache_7 = BooleanToggle(False)
clearcache_7 = Button()
refresh_7 = Button()
csc_session_7 = Session(
    Username=ddu_csc_username_7,
    Password=ddu_csc_password_7,
    Refresh=refresh_7,
    DisableCache=disablecache_7,
    ClearCache=clearcache_7)  # -> Status; inputs Username: String, Password: String, Refresh: Boolean, DisableCache: Boolean, ClearCache: Boolean; same code as csc_session
status_messages_7 = Panel(csc_session_7)

# ----
# comments & notes: Sync Components from Rhino document.
toggle = BooleanToggle(False)
# comments & notes: DEVELOPMENT:
# CREATING AND FETCHING DESIGNS MADE OUT OF COMPONENTS
syncwithrhinodoc = SyncWithRhinoDoc(Sync=toggle)  # -> DocumentComponents; inputs Sync: Boolean
# ---------- syncwithrhinodoc: Python ----------
#! python3
# -*- coding: utf-8 -*-
# venv: DDU_CSC
print('ENV OK!')
# r: charset_normalizer
# r: requests

# PYTHON STANDARD LIBRARY IMPORTS ---------------------------------------------
import json  # NOQA

# RHINO AND GH RELATED IMPORTS ------------------------------------------------
import System  # NOQA
import Grasshopper  # NOQA
import Rhino  # NOQA
import rhinoscriptsyntax as rs  # NOQA
import scriptcontext as sc  # NOQA

# GHENV COMPONENT SETTINGS ----------------------------------------------------
ghenv.Component.Name = 'SyncWithRhinoDoc'  # NOQA
ghenv.Component.NickName = 'SyncWithRhinoDoc'  # NOQA
ghenv.Component.Category = 'DDU_CSC'  # NOQA
ghenv.Component.SubCategory = '4 RhinoDoc Interaction'  # NOQA
ghenv.Component.Description = (  # NOQA
    'Scans the active Rhino document for objects with csc_component user '
    'data (passport JSON) and updates snapshot.iframe based on text tag '
    'planes or combined geometry bounds.'
)


class CSC_SyncWithRhinoDoc(Grasshopper.Kernel.GH_ScriptInstance):
    """
    Author: Max Benjamin Eschenbach
    License: MIT License
    Version: 260908
    """

    def __init__(self):
        """Initialize this component and set component parameters."""
        super().__init__()
        # initialize props
        self.Component = ghenv.Component  # NOQA
        self.InputParams = self.Component.Params.Input
        self.OutputParams = self.Component.Params.Output

    def _addRemark(self, msg: str = ''):
        """Add a remark message to the component."""
        rml = self.Component.RuntimeMessageLevel.Remark
        self.AddRuntimeMessage(rml, msg)

    def _addWarning(self, msg: str = ''):
        """Add a warning message to the component."""
        rml = self.Component.RuntimeMessageLevel.Warning
        self.AddRuntimeMessage(rml, msg)

    def _addError(self, msg: str = ''):
        """Add an error message to the component."""
        rml = self.Component.RuntimeMessageLevel.Error
        self.AddRuntimeMessage(rml, msg)

    def BeforeRunScript(self):
        """Perform some setup actions."""
        # Initialize input param descriptions
        self.InputParams[0].Description = (
            'Trigger to sync components with Rhino document'
        )
        # Initialize output param descriptions
        i = 0
        if self.OutputParams[0].Name == 'out':
            i += 1
        self.OutputParams[0+i].Description = (
            'DataTree of passport JSON ({identity, snapshot}) found in the '
            'document, with snapshot.iframe updated from object positions'
        )

    def find_objects_with_csc_component(self, doc):
        """
        Find all objects in the document that have the 'csc_component' userkey.
        Also find text tags that are grouped with these components.
        Groups objects by identity._id to handle multiple meshes correctly.
        Returns a list of tuples: (identity_id, passport, objects_list,
                                   combined_path)
        """
        components_dict = {}
        try:
            # Get all objects in the document
            all_objects = doc.Objects
            for obj in all_objects:
                if obj is None:
                    continue
                # Check if object has user strings
                usr_txt_type = rs.IsUserText(obj)
                if usr_txt_type > 0:
                    # Look for 'csc_component' userkey
                    component_data = None
                    if usr_txt_type == 1:
                        component_data = rs.GetUserText(
                            obj, 'csc_component', False)
                    elif usr_txt_type == 2:
                        component_data = rs.GetUserText(
                            obj, 'csc_component', True)
                    elif usr_txt_type == 3:
                        component_data = rs.GetUserText(
                            obj, 'csc_component', False)
                        if not component_data:
                            component_data = rs.GetUserText(
                                obj, 'csc_component', True)
                    if component_data:
                        try:
                            passport = json.loads(component_data)
                            identity = passport.get('identity')
                            if not isinstance(identity, dict):
                                self._addWarning(
                                    f'Invalid passport JSON for object '
                                    f'{obj.Id}: missing identity'
                                )
                                continue
                            identity_id = identity.get('_id', 'unknown')
                            if identity_id not in components_dict:
                                components_dict[identity_id] = {
                                    'passport': passport,
                                    'objects': [],
                                    'paths': []
                                }
                            obj_path = self.get_object_path(obj, doc)
                            components_dict[identity_id]['objects'].append(obj)
                            components_dict[identity_id]['paths'].append(
                                obj_path)
                        except json.JSONDecodeError as e:
                            self._addWarning(
                                f'Invalid JSON in csc_component userstring '
                                f'for object {obj.Id}: {str(e)}'
                            )
                            continue

            for identity_id, data in components_dict.items():
                groups = doc.Groups
                for i in range(groups.Count):
                    group = groups[i]
                    if (group and isinstance(group.Name, str) and
                            group.Name.startswith(identity_id)):
                        # Get all objects in this specific group instance
                        group_objects = rs.ObjectsByGroup(group.Name)
                        for obj_id in group_objects:
                            obj = rs.coercegeometry(obj_id)
                            if obj and rs.IsText(obj):
                                # This is a text tag for our component
                                obj_path = self.get_object_path(obj, doc)
                                data['objects'].append(obj)
                                data['paths'].append(obj_path)
                                self._addRemark(
                                    'Found text tag for identity '
                                    f'{identity_id}'
                                )

        except Exception as e:
            self._addError(
                f'Error searching for objects with csc_component: {str(e)}'
            )

        # Convert to list format for compatibility
        components_list = []
        for identity_id, data in components_dict.items():
            combined_path = ' | '.join(data['paths'])
            components_list.append((
                identity_id,
                data['passport'],
                data['objects'],
                combined_path
            ))

        return components_list

    def get_object_path(self, obj, doc):
        """
        Get a descriptive path for the object (layer hierarchy, etc.)
        """
        try:
            # Try to get the layer name
            layer_index = obj.Attributes.LayerIndex
            if layer_index >= 0:
                layer = doc.Layers[layer_index]
                if layer:
                    return layer.FullPath
        except Exception:
            pass
        # Fallback to object name or type
        try:
            if hasattr(obj, 'Name') and obj.Name:
                return obj.Name
        except Exception:
            pass
        return f"Object_{obj}"

    def update_component_frame(self, objects_list, passport):
        """
        Update snapshot.iframe from a text tag plane when available,
        otherwise from the combined bounding box of all objects.
        Returns updated passport JSON.
        """
        try:
            if not objects_list:
                return passport

            snapshots = passport.get('snapshots') or []
            snapshot = snapshots[0] if snapshots else None
            if not isinstance(snapshot, dict):
                return passport

            for obj in objects_list:
                if rs.IsText(obj):
                    try:
                        tagplane = rs.TextObjectPlane(obj)
                        tagframe = {
                            'o': [tagplane.OriginX,
                                  tagplane.OriginY,
                                  tagplane.OriginZ],
                            'x': [tagplane.XAxis.X,
                                  tagplane.XAxis.Y,
                                  tagplane.XAxis.Z],
                            'y': [tagplane.YAxis.X,
                                  tagplane.YAxis.Y,
                                  tagplane.YAxis.Z],
                            'z': [tagplane.ZAxis.X,
                                  tagplane.ZAxis.Y,
                                  tagplane.ZAxis.Z]
                        }
                        snapshot['iframe'] = tagframe
                        passport['snapshots'] = [snapshot]
                        return passport
                    except Exception as e:
                        self._addWarning(
                            f'Error extracting plane from text tag: {str(e)}'
                        )
                        continue

            combined_bbox = None
            for obj in objects_list:
                if hasattr(obj, 'Geometry'):
                    geometry = obj.Geometry
                    if hasattr(geometry, 'GetBoundingBox'):
                        bbox = geometry.GetBoundingBox(True)
                        if bbox.IsValid:
                            if combined_bbox is None:
                                combined_bbox = bbox
                            else:
                                combined_bbox = (
                                    Rhino.Geometry.BoundingBox.Union(
                                        combined_bbox, bbox))

            combined_bbox = Rhino.Geometry.Box(combined_bbox)
            if combined_bbox and combined_bbox.IsValid:
                center = combined_bbox.Center
                x_axis = combined_bbox.Plane.XAxis
                y_axis = combined_bbox.Plane.YAxis
                z_axis = combined_bbox.Plane.ZAxis
                snapshot['iframe'] = {
                    'o': [center.X, center.Y, center.Z],
                    'x': [x_axis.X, x_axis.Y, x_axis.Z],
                    'y': [y_axis.X, y_axis.Y, y_axis.Z],
                    'z': [z_axis.X, z_axis.Y, z_axis.Z]
                }
                passport['snapshots'] = [snapshot]
                return passport
        except Exception as e:
            self._addWarning(
                f'Error updating frame for component: {str(e)}'
            )
        return passport

    def RunScript(self, Sync: bool):
        # init outputs
        DocumentComponents = Grasshopper.DataTree[str]()
        if not Sync:
            # Return empty results if not syncing
            self.Component.Message = 'Sync Toggle is False'
            return DocumentComponents
        try:
            # Set scriptcontext to Rhino document
            sc.doc = Rhino.RhinoDoc.ActiveDoc

            self.Component.Message = 'Searching for components in document...'
            # Find all objects with csc_component userkey
            objects_with_component = self.find_objects_with_csc_component(
                sc.doc
            )
            if not objects_with_component:
                msg = 'No components found in document!'
                self._addWarning(msg)
                self.Component.Message = msg
                # Return empty results
                return DocumentComponents
            # Create output datatree
            # Process each component (now grouped by component ID)
            for i, (identity_id, passport, objects_list,
                    combined_path) in enumerate(objects_with_component):
                try:
                    updated_passport = self.update_component_frame(
                        objects_list, passport)
                    ghp = Grasshopper.Kernel.Data.GH_Path(i)
                    DocumentComponents.Add(json.dumps(updated_passport), ghp)

                    object_count = len(objects_list)
                    if object_count == 1:
                        self._addRemark(
                            f'Updated identity {identity_id} '
                            f'from {combined_path}'
                        )
                    else:
                        self._addRemark(
                            f'Updated identity {identity_id} '
                            f'({object_count} objects) from {combined_path}'
                        )
                except Exception as e:
                    msg = (
                        f'Error processing identity {identity_id} '
                        f'from {combined_path}: {str(e)}'
                    )
                    self._addWarning(msg)
                    continue

            # Update success message
            if DocumentComponents.DataCount > 0:
                self.Component.Message = (
                    f'Synced {DocumentComponents.DataCount} component(s)'
                )
                self._addRemark(
                    f'Successfully synced {DocumentComponents.DataCount} '
                    'components with document'
                )
            else:
                self.Component.Message = 'No components synced'
                self._addWarning('No components were successfully synced')

            # Return results
            return DocumentComponents

        except Exception as e:
            msg = f'Unexpected error during sync: {str(e)}'
            self._addError(msg)
            self.Component.Message = msg

            # Return empty results if there was an error
            return DocumentComponents

        finally:
            # Restore scriptcontext to Grasshopper document
            sc.doc = self.Component.OnPingDocument()
# ---------- end syncwithrhinodoc ----------
componentdata_6 = Data(syncwithrhinodoc)

comments_notes_2 = Panel("AdditionalGeometry as Meshes")
spa_sampledesign_connectors = Geometry([<mesh referenced from the Rhino model> x15])

# ---- group: __DDU_CSC_EXAMPLE_09__
# Step 2
# comments & notes: Fetch a single component or multiple components from the catalogue using its ID.
componentid_5 = Panel("243df186-9e30-4b19-95aa-17d7d88976f9")
fetchcomponents_3 = FetchComponents(ComponentID=componentid_5)  # -> ComponentData; inputs ComponentID: list of String; same code as fetchcomponents
componentdata_7 = Data(fetchcomponents_3)

# ---- group: __DDU_CSC_EXAMPLE_10__
# Example 10:
# - Still in development: D2P Components Interface
# Step 1
# comments & notes: Create new User Session and sign in
# 
# (Add your credentials!)
ddu_csc_username_8 = Panel("")
ddu_csc_password_8 = Panel("")
disablecache_8 = BooleanToggle(False)
clearcache_8 = Button()
refresh_8 = Button()
csc_session_8 = Session(
    Username=ddu_csc_username_8,
    Password=ddu_csc_password_8,
    Refresh=refresh_8,
    DisableCache=disablecache_8,
    ClearCache=clearcache_8)  # -> Status; inputs Username: String, Password: String, Refresh: Boolean, DisableCache: Boolean, ClearCache: Boolean; same code as csc_session
status_messages_8 = Panel(csc_session_8)

# ----
# comments & notes: Fetch ALL components from the catalogue
fetchallcomponents = FetchAllComponents()  # -> ComponentData
# ---------- fetchallcomponents: Python ----------
#! python3
# -*- coding: utf-8 -*-
# venv: DDU_CSC
print('ENV OK!')
# r: charset_normalizer
# r: requests

# PYTHON STANDARD LIBRARY IMPORTS ---------------------------------------------
import json  # NOQA

# THIRD PARTY LIBRARY IMPORTS -------------------------------------------------
import requests  # NOQA

# RHINO AND GH RELATED IMPORTS ------------------------------------------------
import System  # NOQA
import Grasshopper  # NOQA
import Rhino  # NOQA
import scriptcontext as sc  # NOQA

# GHENV COMPONENT SETTINGS ----------------------------------------------------
ghenv.Component.Name = 'FetchAllComponents'  # NOQA
ghenv.Component.NickName = 'FetchAllComponents'  # NOQA
ghenv.Component.Category = 'DDU_CSC'  # NOQA
ghenv.Component.SubCategory = '2 Catalog Interface'  # NOQA
ghenv.Component.Description = (  # NOQA
    'Fetches all catalog identities (joined with their current snapshot) '
    'from the remote Catalog API via GET /identities with caching support. '
    'Returns each entry as a passport JSON string ({identity, snapshots[]}).'
)


class CSC_FetchAllComponents(Grasshopper.Kernel.GH_ScriptInstance):
    """
    Author: Max Benjamin Eschenbach
    License: MIT License
    Version: 260908
    """

    def __init__(self):
        """Initialize this component and set component parameters."""
        super().__init__()
        # initialize props
        self.Component = ghenv.Component  # NOQA
        self.InputParams = self.Component.Params.Input
        self.OutputParams = self.Component.Params.Output

    def _addRemark(self, msg: str = ''):
        """Add a remark message to the component."""
        rml = self.Component.RuntimeMessageLevel.Remark
        self.AddRuntimeMessage(rml, msg)

    def _addWarning(self, msg: str = ''):
        """Add a warning message to the component."""
        rml = self.Component.RuntimeMessageLevel.Warning
        self.AddRuntimeMessage(rml, msg)

    def _addError(self, msg: str = ''):
        """Add an error message to the component."""
        rml = self.Component.RuntimeMessageLevel.Error
        self.AddRuntimeMessage(rml, msg)

    def BeforeRunScript(self):
        """Perform some setup actions."""
        # Initialize output param descriptions
        i = 0
        if self.OutputParams[0].Name == 'out':
            i += 1
        self.OutputParams[0+i].Description = (
            'Passport JSON per entry ({identity, snapshots[]}) fetched from '
            'GET /identities. Use \'DisassembleComponent\' to access the '
            'individual fields ready for Grasshopper'
        )

    def get_auth_core_from_sticky(self):
        """Get AuthCore instance from sticky storage."""
        auth_core = sc.sticky.get('CSC_AuthCore')
        if auth_core is None:
            msg = ('No authentication found. Please use CSC_Session component '
                   'first.')
            self._addError(msg)
            self.Component.Message = msg
            return None
        return auth_core

    def RunScript(self):
        # Get AuthCore instance from sticky storage
        auth_core = self.get_auth_core_from_sticky()
        if auth_core is None:
            return

        # Check if authentication is valid
        if not auth_core.is_valid():
            msg = ('Authentication expired. Please use CSC_Session '
                   'component to refresh.')
            self._addError(msg)
            self.Component.Message = msg
            return

        try:
            self.Component.Message = 'Fetching identities (with cache)...'

            # Unified catalog cache: stores identity + snapshot independently
            # and reassembles passport rows (no separate all_identities blob).
            response = auth_core.cached_list_identities(
                {'expand': 'current_snapshot'},
            )

            if response.status_code == 200:
                # Successfully fetched identities (from server or cache)
                json_comps = response.json()
                component_count = len(json_comps)

                self.Component.Message = (
                    f'Found {component_count} components (cached)'
                )
                self._addRemark(
                    f'Successfully fetched {component_count} components'
                )

                # Set up output trees and results tuple
                ComponentData = Grasshopper.DataTree[System.Object]()
                __Results = (ComponentData,)

                # Loop over all passport entries and add them to the data tree
                for i, json_comp in enumerate(json_comps):
                    # Create datatree path
                    ghp = Grasshopper.Kernel.Data.GH_Path(0, i)
                    # Add canonical passport JSON to the datatree
                    ComponentData.Add(
                        auth_core.passport_json_string(json_comp), ghp)

                return __Results

            elif response.status_code == 401:
                msg = 'Authentication failed. Please sign in again.'
                self._addError(msg)
                self.Component.Message = msg

            elif response.status_code == 403:
                msg = 'Access denied. Insufficient permissions.'
                self._addError(msg)
                self.Component.Message = msg

            elif response.status_code == 500:
                msg = 'Server error. Please try again later.'
                self._addWarning(msg)
                self.Component.Message = msg

            else:
                msg = (f'Request failed with status code: '
                       f'{response.status_code}')
                self._addError(msg)
                self.Component.Message = msg

        except requests.exceptions.ConnectionError as e:
            msg = 'Cannot connect to server. Please check your connection.'
            self._addError(msg + f'\nFull Error: {str(e)}')
            self.Component.Message = msg

        except requests.exceptions.Timeout as e:
            msg = 'Request timeout. Server may be slow.'
            self._addError(msg + f'\nFull Error: {str(e)}')
            self.Component.Message = msg

        except requests.exceptions.RequestException as e:
            msg = f'Request error: {str(e)}'
            self._addError(msg)
            self.Component.Message = msg

        except Exception as e:
            msg = f'Unexpected error: {str(e)}'
            self._addError(msg)
            self.Component.Message = msg

        # Return empty results if there was an error
        ComponentData = Grasshopper.DataTree[System.Object]()
        __Results = (ComponentData,)
        return __Results
# ---------- end fetchallcomponents ----------
componentdata_8 = Data(fetchallcomponents)

# ---- group: __DDU_CSC_EXAMPLE_07__
samplereinforcementpolyline = Geometry([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])
createreinforcement = CreateReinforcement(Polyline=samplereinforcementpolyline, Spec="BSt 42/50", Diameter="10")  # -> out, ReinforcementJson; inputs Spec: String, Diameter: Double
# ---------- createreinforcement: Python ----------
#! python3
# -*- coding: utf-8 -*-
# venv: DDU_CSC
print('ENV OK!')
# r: charset_normalizer
# r: requests

# PYTHON STANDARD LIBRARY IMPORTS ---------------------------------------------
import json  # NOQA

# RHINO AND GH RELATED IMPORTS ------------------------------------------------
import System  # NOQA
import Grasshopper  # NOQA
import Rhino  # NOQA
import scriptcontext as sc  # NOQA

# GHENV COMPONENT SETTINGS ----------------------------------------------------
ghenv.Component.Name = 'CreateReinforcement'  # NOQA
ghenv.Component.NickName = 'CreateReinforcement'  # NOQA
ghenv.Component.Category = 'DDU_CSC'  # NOQA
ghenv.Component.SubCategory = '7 Geometry Tools'  # NOQA
ghenv.Component.Description = (  # NOQA
    'Builds one inline reinforcement bar JSON object '
    '({spec, diameter, points}) for CreateComponentIdentity / '
    'CreateComponentSnapshot.'
)


class CSC_CreateReinforcement(Grasshopper.Kernel.GH_ScriptInstance):
    """
    Author: Max Benjamin Eschenbach
    License: MIT License
    Version: 260610
    """

    def __init__(self):
        """Initialize this component and set component parameters."""
        super().__init__()
        self.Component = ghenv.Component  # NOQA
        self.InputParams = self.Component.Params.Input
        self.OutputParams = self.Component.Params.Output

    def _addRemark(self, msg: str = ''):
        rml = self.Component.RuntimeMessageLevel.Remark
        self.AddRuntimeMessage(rml, msg)

    def _addWarning(self, msg: str = ''):
        rml = self.Component.RuntimeMessageLevel.Warning
        self.AddRuntimeMessage(rml, msg)

    def _addError(self, msg: str = ''):
        rml = self.Component.RuntimeMessageLevel.Error
        self.AddRuntimeMessage(rml, msg)

    def BeforeRunScript(self):
        self.InputParams[0].Description = (
            'Open centerline as Polyline or PolylineCurve '
            '(no curve conversion / retessellation)'
        )
        self.InputParams[1].Description = (
            'Reinforcement steel specification (e.g. B500B)'
        )
        self.InputParams[2].Description = (
            'Bar diameter in millimeters'
        )
        i = 0
        if self.OutputParams[0].Name == 'out':
            i += 1
        self.OutputParams[0 + i].Description = (
            'SnapshotReinforcement JSON string for geometry.reinforcements[]'
        )

    def extract_open_polyline_points(self, geometry):
        """Return [[x,y,z], ...] from an open Polyline or PolylineCurve."""
        if geometry is None:
            raise ValueError('Polyline input is required')

        if isinstance(geometry, Rhino.Geometry.Polyline):
            pl = geometry
        elif isinstance(geometry, Rhino.Geometry.PolylineCurve):
            pl = geometry.ToPolyline()
        elif isinstance(geometry, Rhino.Geometry.Curve):
            ok, pl = geometry.TryGetPolyline()
            if not ok or pl is None:
                raise ValueError(
                    'Input must be an open Polyline or PolylineCurve'
                )
        else:
            raise ValueError(
                'Input must be an open Polyline or PolylineCurve'
            )

        if pl.Count < 2:
            raise ValueError('Reinforcement centerline needs at least 2 points')
        if pl.IsClosed:
            raise ValueError('Reinforcement centerline must be open')

        return [[float(p.X), float(p.Y), float(p.Z)] for p in pl]

    def RunScript(self, Polyline, Spec: str, Diameter: float):
        ReinforcementJson = ''

        try:
            if Polyline is None:
                self._addWarning('Polyline input failed to collect data')
                return ReinforcementJson

            spec = (Spec or '').strip()
            if not spec:
                self._addError('Spec must be a non-empty string')
                return ReinforcementJson

            try:
                diameter = float(Diameter)
            except (TypeError, ValueError):
                self._addError('Diameter must be a number')
                return ReinforcementJson
            if diameter <= 0:
                self._addError('Diameter must be greater than zero')
                return ReinforcementJson

            points = self.extract_open_polyline_points(Polyline)
            payload = {
                'spec': spec,
                'diameter': diameter,
                'points': points,
            }
            ReinforcementJson = json.dumps(payload)
            self.Component.Message = (
                f'Reinforcement {spec} Ø{diameter:g} mm, '
                f'{len(points)} points'
            )
            return ReinforcementJson

        except ValueError as e:
            self._addError(str(e))
            return ReinforcementJson
        except Exception as e:
            self._addError(f'Unexpected error: {e}')
            raise e
# ---------- end createreinforcement ----------

# ---- group: __DDU_CSC_EXAMPLE_10__
# Step 2
componentid_6 = Panel("6df1899a-6569-494b-a765-bca686f6d589")
componentid_7 = Panel("243df186-9e30-4b19-95aa-17d7d88976f9")
fetchcomponents_4 = FetchComponents(ComponentID=componentid_6)  # -> ComponentData; inputs ComponentID: list of String; same code as fetchcomponents
componentdata_9 = Data(fetchcomponents_4)

# ---- group: __DDU_CSC_EXAMPLE_06__
# Step 2
# comments & notes: Create some Voronoi Cells that we will use as our target "Design Shapes".
# 
# You can play with the Random Seed to get different cell arrangements (randomized).
x_extents = Slider(2500, range=100..3000)
y_extents = Slider(1000, range=100..3000)
dom = ConstructDomain(DomainStart="0", DomainEnd=x_extents)
dom_2 = ConstructDomain(DomainStart="0", DomainEnd=y_extents)
cellcount = Slider(16, range=10..1000)
randomseed = Slider(2637, range=0..10000)
rectangle = Rectangle(Plane=PlaneXY(0, 0, 0), XSize=dom, YSize=dom_2, Radius=0)  # -> Rectangle, Length
boundary = BoundarySurfaces(Edges=rectangle.Rectangle)
popgeo = PopulateGeometry(Geometry=boundary, Count=cellcount, Seed=randomseed)
voronoi = Voronoi(Points=popgeo, BruteForceOverride=False)
rint = RegionIntersection(CurvesA=voronoi, CurvesB=graft(rectangle.Rectangle))  # -> flatten(Result)
curvepreviewlw = CurvePreviewLW(Curves=flatten(rint), Thickness="2")  # inputs Curves: list of Curve, Colors: list of Color, Thickness: list of Int32
# ---------- curvepreviewlw: C# ----------
#region Usings
using System;
using System.Linq;
using System.Collections;
using System.Collections.Generic;
using System.Drawing;

using Rhino;
using Rhino.Geometry;

using Grasshopper;
using Grasshopper.Kernel;
using Grasshopper.Kernel.Data;
using Grasshopper.Kernel.Types;
#endregion

public class Script_Instance : GH_ScriptInstance
{
    #region Notes
    /* 
      Members:
        RhinoDoc RhinoDocument
        GH_Document GrasshopperDocument
        IGH_Component Component
        int Iteration

      Methods (Virtual & overridable):
        Print(string text)
        Print(string format, params object[] args)
        Reflect(object obj)
        Reflect(object obj, string method_name)

        Author: Max Benjamin Eschenbach
        License: MIT License
        Version: 260609
    */
    #endregion

    List<Curve> drawCurves;
    List<Color> drawColors;
    List<int> drawThickness;

    private void RunScript(
		List<Curve> Curves,
		List<Color> Colors,
		List<int> Thickness)
    {
        // set component params
        this.Component.Name = "CurvePreviewLW";
        this.Component.NickName = "CurvePreviewLW";
        this.Component.Category = "DDU_CSC";
        this.Component.SubCategory = "8 Visualization";
        this.Component.Description = (
            "Render curves with custom LineWeights."
        );

        this.drawCurves = new List<Curve>();   
        this.drawColors = new List<Color>();
        this.drawThickness = new List<int>();

        if (Curves == null) return;
        if (Colors == null) this.drawColors = new List<Color>{Color.Black};
        else this.drawColors = Colors;

        if (Thickness == null) this.drawThickness = new List<int>{1};
        else this.drawThickness = Thickness;

        for (int i = 0; i < Curves.Count; i++)
        {
            if (Curves[i] != null)
            {
                this.drawCurves.Add(Curves[i]);
            }
            else
            {
                continue;
            }
            if (Colors == null || i >= Colors.Count || Colors[i] == null)
            {
                this.drawColors.Add(drawColors.Last());
            }
            else
            {
                this.drawColors.Add(Colors[i]);
            }
            if (Thickness == null || i >= Thickness.Count || Thickness[i] == null)
            {
                this.drawThickness.Add(drawThickness.Last());
            }
            else
            {
                this.drawThickness.Add(Thickness[i]);
            }
        }
    }

    override public void DrawViewportWires(IGH_PreviewArgs args)
    {
        if (this.drawCurves != null)
        {
            try
            {
                for (int i = 0; i < this.drawCurves.Count; i++)
                {
                    args.Display.DrawCurve(
                        this.drawCurves[i],
                        this.drawColors[i],
                        this.drawThickness[i]
                    );
                }
                
            }
            catch (Exception e)
            {
                this.AddRuntimeMessage(GH_RuntimeMessageLevel.Warning, "Error while drawing Preview!");
                this.Print(e.ToString());
            }
        }
        else
        {
            return;
        }
    }
}
# ---------- end curvepreviewlw ----------
designshapes = Data(rint)

# Example 06:
# - Fetch all corian sheet components
# - Get radial signature descriptors
# - Create voronoi cells as an example "demand" of design shapes
# - Compute radial signature descriptors for design shapes
# - Match catalog to design shapes either with greedy or optimal assignment
# Step 1
# comments & notes: Create new User Session and sign in
# 
# (Add your credentials!)
ddu_csc_username_9 = Panel("")
ddu_csc_password_9 = Panel("")
disablecache_9 = BooleanToggle(False)
clearcache_9 = Button()
refresh_9 = Button()
csc_session_9 = Session(
    Username=ddu_csc_username_9,
    Password=ddu_csc_password_9,
    Refresh=refresh_9,
    DisableCache=disablecache_9,
    ClearCache=clearcache_9)  # -> Status; inputs Username: String, Password: String, Refresh: Boolean, DisableCache: Boolean, ClearCache: Boolean; same code as csc_session
status_messages_9 = Panel(csc_session_9)

# Step 3
mindimensionx_4 = Slider(0, range=-0.1..2000)
maxdimensionx_4 = Slider(0, range=0..2000)
maxdimensiony_4 = Slider(0, range=0..2000)
maxdimensionz_4 = Slider(0, range=0..500)
mindimensiony_4 = Slider(0, range=0..2000)
mindimensionz_4 = Slider(0, range=0..500)
reservedstatus_4 = Slider(-1, range=-1..1)
fragment_4 = ValueList({"Any": , "Only fragments": True, "Only non-fragmnents": False}, selected="Any")
dataset_4 = Panel("mineral_composite_panels")
complexity_4 = ValueList({"Any complexity": , "0", "1", "2", "3"}, selected="Any complexity")
material_4 = ValueList({"Any material": , "corian", "concrete", "timber", "aluminium", "steel"}, selected="Any material")
type_4 = ValueList({"All types": , "panel", "beam", "column", "slab", "rubble", "brick", "pipe", "profile", "connector", "other"}, selected="All types")
fetchfilteredcomponents_4 = FetchFilteredComponents(
    Type=type_4,
    Material=material_4,
    Dataset=dataset_4,
    Complexity=complexity_4,
    Fragment=fragment_4,
    MinDimensionX=mindimensionx_4,
    MaxDimensionX=maxdimensionx_4,
    MinDimensionY=mindimensiony_4,
    MaxDimensionY=maxdimensiony_4,
    MinDimensionZ=mindimensionz_4,
    MaxDimensionZ=maxdimensionz_4,
    ReservedStatus=reservedstatus_4)  # -> FilterDescription, ComponentData; inputs Type: String, Material: String, Dataset: String, Complexity: Int32, Fragment: Boolean, MinDimensionX: Double, MaxDimensionX: Double, MinDimensionY: Double, MaxDimensionY: Double, MinDimensionZ: Double, MaxDimensionZ: Double; same code as fetchfilteredcomponents
panel_5 = Panel(fetchfilteredcomponents_4.FilterDescription)
componentdata_10 = Data(fetchfilteredcomponents_4.ComponentData)

# ---- group: __DDU_CSC_EXAMPLE_07__
# Example 07:
# - Creating a new, (derived) component identity in the catalog
samplemeshgeometry_2 = Mesh(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)

# ----
# comments & notes: Create a new Design by supplying (transformed) components as well as (optional) AdditionalGeometry as Meshes
componentdata_11 = Data(flatten(componentdata_6))
additionalgeometry = Mesh(spa_sampledesign_connectors)
designdescription = Panel("Just a simple example design used for testing purposes.")
designname = Panel("My Example Design 02")
createdesign = CreateDesign(
    DesignName=designname,
    DesignDescription=designdescription,
    ComponentData=componentdata_11,
    AdditionalGeometry=additionalgeometry)  # -> DesignData; inputs DesignName: String, DesignDescription: String, ComponentData: list of String, AdditionalGeometry: list of Mesh
# ---------- createdesign: Python ----------
#! python3
# -*- coding: utf-8 -*-
# venv: DDU_CSC
print('ENV OK!')
# r: charset_normalizer
# r: requests

# PYTHON STANDARD LIBRARY IMPORTS ---------------------------------------------
import json  # NOQA
import uuid  # NOQA
from datetime import datetime  # NOQA
from typing import List, Dict, Any, Optional  # NOQA

# RHINO AND GH RELATED IMPORTS ------------------------------------------------
import System  # NOQA
import Grasshopper  # NOQA
import Rhino  # NOQA
import scriptcontext as sc  # NOQA

# GHENV COMPONENT SETTINGS ----------------------------------------------------
ghenv.Component.Name = 'CreateDesign'  # NOQA
ghenv.Component.NickName = 'CreateDesign'  # NOQA
ghenv.Component.Category = 'DDU_CSC'  # NOQA
ghenv.Component.SubCategory = '3 Component Operations'  # NOQA
ghenv.Component.Description = (  # NOQA
    'Creates a design JSON string from passport JSON ({identity, snapshot}), '
    'ready for posting to the Catalog. Pins each placement to a specific '
    'snapshot and stores the design insertion iframe. Does NOT post '
    'the design - only generates the JSON string.'
)


class CSC_CreateDesign(Grasshopper.Kernel.GH_ScriptInstance):
    """
    Author: Max Benjamin Eschenbach
    License: MIT License
    Version: 260908
    """

    def __init__(self):
        """Initialize this component and set component parameters."""
        super().__init__()
        # initialize props
        self.Component = ghenv.Component  # NOQA
        self.InputParams = self.Component.Params.Input
        self.OutputParams = self.Component.Params.Output

    def _addRemark(self, msg: str = ''):
        """Add a remark message to the component."""
        rml = self.Component.RuntimeMessageLevel.Remark
        self.AddRuntimeMessage(rml, msg)

    def _addWarning(self, msg: str = ''):
        """Add a warning message to the component."""
        rml = self.Component.RuntimeMessageLevel.Warning
        self.AddRuntimeMessage(rml, msg)

    def _addError(self, msg: str = ''):
        """Add an error message to the component."""
        rml = self.Component.RuntimeMessageLevel.Error
        self.AddRuntimeMessage(rml, msg)

    def BeforeRunScript(self):
        """Perform some setup actions."""
        # Initialize input param descriptions
        self.InputParams[0].Description = (
            'Design name (mandatory)'
        )
        self.InputParams[1].Description = (
            'Design description (optional)'
        )
        self.InputParams[2].Description = (
            'List of passport JSON strings ({identity, snapshot}) with '
            'snapshot.iframe set to the design placement frame'
        )
        self.InputParams[3].Description = (
            'AdditionalGeometry (List of Mesh)'
        )
        # Initialize output param descriptions
        i = 0
        if self.OutputParams[0].Name == 'out':
            i += 1
        self.OutputParams[0+i].Description = (
            'Design JSON string ready for posting'
        )

    def _get_hardcoded_schema(self):
        """Get hardcoded design schema fallback."""
        return {
            "type": "object",
            "properties": {
                "_id": {"type": "string"},
                "name": {"type": "string"},
                "description": {"type": "string"},
                "created": {"type": "string"},
                "lastmodified": {"type": "string"},
                "components": {
                    "type": "array",
                    "items": {
                        "type": "object",
                        "properties": {
                            "snapshot": {"type": "string"},
                            "iframe": {
                                "type": "object",
                                "properties": {
                                    "o": {"type": "array",
                                          "items": {"type": "number"}},
                                    "x": {"type": "array",
                                          "items": {"type": "number"}},
                                    "y": {"type": "array",
                                          "items": {"type": "number"}},
                                    "z": {"type": "array",
                                          "items": {"type": "number"}}
                                },
                                "required": ["o", "x", "y", "z"]
                            }
                        },
                        "required": ["snapshot", "iframe"]
                    }
                },
                "additional_geometry": {
                    "type": "array",
                    "items": {
                        "type": "object",
                        "properties": {
                            "_id": {"type": "string"},
                            "name": {"type": "string"},
                            "iframe": {
                                "type": "object",
                                "properties": {
                                    "o": {"type": "array",
                                          "items": {"type": "number"}},
                                    "x": {"type": "array",
                                          "items": {"type": "number"}},
                                    "y": {"type": "array",
                                          "items": {"type": "number"}},
                                    "z": {"type": "array",
                                          "items": {"type": "number"}}
                                },
                                "required": ["o", "x", "y", "z"]
                            },
                            "geometry": {
                                "type": "object",
                                "properties": {
                                    "meshes": {
                                        "type": "array",
                                        "items": {
                                            "type": "object",
                                            "properties": {
                                                "v": {
                                                    "type": "array",
                                                    "items": {
                                                        "type": "array",
                                                        "items": {
                                                            "type": "number"}
                                                    }
                                                },
                                                "f": {
                                                    "type": "array",
                                                    "items": {
                                                        "type": "array",
                                                        "items": {
                                                            "type": "integer"}
                                                    }
                                                },
                                                "c": {
                                                    "type": "array",
                                                    "items": {
                                                        "type": "array",
                                                        "items": {
                                                            "type": "integer"}
                                                    }
                                                }
                                            },
                                            "required": ["v", "f"]
                                        }
                                    }
                                },
                                "required": ["meshes"]
                            }
                        },
                        "required": ["_id", "iframe", "geometry"]
                    }
                }
            },
            "required": ["_id", "created", "lastmodified",
                         "components", "additional_geometry"]
        }

    def _compute_mesh_centroid(self, mesh):
        try:
            vmp = Rhino.Geometry.VolumeMassProperties.Compute(mesh)
            if vmp and vmp.Centroid:
                return vmp.Centroid
        except Exception:
            pass
        bbox = mesh.GetBoundingBox(True)
        return bbox.Center

    def _center_mesh_at_origin(self, mesh):
        centered = mesh.Duplicate()
        c = self._compute_mesh_centroid(centered)
        xform = Rhino.Geometry.Transform.Translation(-c.X, -c.Y, -c.Z)
        centered.Transform(xform)
        return centered, c

    def _reduce_mesh_for_design(self, mesh):
        """Reduce mesh if faces > 350, targeting ~250 faces."""
        try:
            faces = mesh.Faces.Count
            if faces > 350:
                reduced = mesh.Duplicate()
                # Parameters mirror CreateComponent.reduce_mesh behavior
                reduced.Reduce(250, True, 5, False, True)
                reduced.Faces.ConvertQuadsToTriangles()
                reduced.Compact()
                return reduced
            return mesh
        except Exception:
            return mesh

    def _mesh_to_meshes_geometry(self, mesh):
        """
        Convert a Rhino mesh to geometry.meshes entry (single-item array).
        Returns a dictionary with a single mesh entry.
        """
        try:
            vertices = [[p.X, p.Y, p.Z] for p in mesh.Vertices]
            faces = [[f[0], f[1], f[2]] for f in mesh.Faces]
            return {
                'meshes': [{
                    'v': vertices,
                    'f': faces
                }]
            }
        except Exception:
            return {'meshes': []}

    def get_auth_core_from_sticky(self):
        """Get AuthCore instance from sticky storage."""
        auth_core = sc.sticky.get('CSC_AuthCore')
        if auth_core is None:
            self._addWarning('No authentication found. '
                             'Using hardcoded schema.')
            return None
        return auth_core

    def get_design_schema(self):
        """Get design schema from cache or fallback to hardcoded schema."""
        # Try to get schema from AuthCore cache first
        auth_core = self.get_auth_core_from_sticky()
        if auth_core and hasattr(auth_core, 'get_design_schema'):
            try:
                schema = auth_core.get_design_schema()
                if schema:
                    self._addRemark('Using cached design schema')
                    return schema
                else:
                    self._addWarning('Failed to get cached schema, '
                                     'using hardcoded schema')
            except Exception as e:
                self._addWarning(f'Error fetching cached schema: {str(e)}, '
                                 'using hardcoded schema')

        # Fallback to hardcoded schema
        self._addRemark('Using hardcoded design schema')
        return self._get_hardcoded_schema()

    def _validate_iframe(self, iframe, label='iframe') -> bool:
        """Validate an insertion-frame dict."""
        if not isinstance(iframe, dict):
            self._addWarning(f'{label} must be a dictionary')
            return False
        for field in ('o', 'x', 'y', 'z'):
            if field not in iframe:
                self._addWarning(f'{label} missing {field} field')
                return False
            if (not isinstance(iframe[field], list) or
                    len(iframe[field]) != 3):
                self._addWarning(f'{label} {field} must be 3D vector')
                return False
        return True

    def validate_passport_data(self, passport_data: Dict[str, Any]) -> bool:
        """Validate passport JSON for design placement."""
        try:
            if not isinstance(passport_data, dict):
                self._addWarning('Passport data must be a dictionary')
                return False

            snapshots = passport_data.get('snapshots') or []
            snapshot = snapshots[0] if snapshots else None
            if not isinstance(snapshot, dict):
                self._addWarning('Passport missing snapshot object')
                return False

            snapshot_id = snapshot.get('_id') or snapshot.get('id')
            if not snapshot_id:
                self._addWarning('Passport snapshot missing _id field')
                return False

            iframe = snapshot.get('iframe')
            if iframe is None:
                self._addWarning('Passport snapshot missing iframe field')
                return False

            return self._validate_iframe(iframe, 'Passport snapshot iframe')
        except Exception as e:
            self._addWarning(f'Error validating passport: {str(e)}')
            return False

    def create_design_payload(self, design_name: str, design_description: str,
                              component_data_list: List[str],
                              additional_meshes=None
                              ) -> Optional[Dict[str, Any]]:
        """Create design payload from component data and additional meshes."""
        try:
            # Warm design schema cache (fallback used when offline)
            self.get_design_schema()

            # Parse and validate passport JSON
            components = []
            for i, passport_json in enumerate(component_data_list):
                try:
                    passport_data = json.loads(passport_json)
                    if not self.validate_passport_data(passport_data):
                        self._addWarning(f'Invalid passport at index {i}')
                        continue
                    snapshot = passport_data['snapshot']
                    snapshot_id = snapshot.get('_id') or snapshot.get('id')
                    iframe = snapshot['iframe']
                    components.append(
                        {'snapshot': snapshot_id, 'iframe': iframe}
                    )
                except Exception as e:
                    self._addWarning(
                        f'Error processing passport {i}: {str(e)}'
                    )
                    continue

            if not components:
                self._addError('No valid components found')
                return None

            # Build additional_geometry entries
            additional_geometry = []
            if additional_meshes:
                try:
                    for idx, m in enumerate(additional_meshes):
                        if m is None:
                            continue
                        if not isinstance(m, Rhino.Geometry.Mesh):
                            self._addWarning(
                                'AdditionalGeometry contains '
                                'non-mesh; skipping'
                            )
                            continue
                        centered, centroid = self._center_mesh_at_origin(m)
                        primitive = self._reduce_mesh_for_design(centered)
                        geom = self._mesh_to_meshes_geometry(primitive)
                        iframe = {
                            'o': [centroid.X, centroid.Y, centroid.Z],
                            'x': [1.0, 0.0, 0.0],
                            'y': [0.0, 1.0, 0.0],
                            'z': [0.0, 0.0, 1.0]
                        }
                        additional_geometry.append({
                            '_id': str(uuid.uuid4()),
                            'iframe': iframe,
                            'geometry': geom
                        })
                except Exception as e:
                    self._addWarning(
                        f'Error processing AdditionalGeometry: {str(e)}'
                    )

            # Generate timestamps
            current_time = datetime.utcnow().isoformat() + 'Z'

            # Create design payload (client supplies UUID)
            design_payload = {
                '_id': str(uuid.uuid4()),
                'name': design_name,
                'description': design_description,
                'created': current_time,
                'lastmodified': current_time,
                'components': components,
                'additional_geometry': additional_geometry
            }

            return design_payload

        except Exception as e:
            self._addError(f'Error creating design payload: {str(e)}')
            return None

    def RunScript(self,
            DesignName: str,
            DesignDescription: str,
            ComponentData: System.Collections.Generic.List[str],
            AdditionalGeometry: System.Collections.Generic.List[Rhino.Geometry.Mesh]):
        # Init outputs
        DesignJSON = Grasshopper.DataTree[str]()

        # Validate DesignName (mandatory)
        if not DesignName or not DesignName.strip():
            msg = 'Design name is mandatory and cannot be empty.'
            self._addWarning(msg)
            self.Component.Message = msg
            return DesignJSON

        # Set DesignDescription fallback
        if not DesignDescription:
            DesignDescription = 'No description provided.'

        # Validate ComponentData
        if not ComponentData:
            msg = 'Input ComponentData failed to collect data!'
            self._addWarning(msg)
            self.Component.Message = msg
            return DesignJSON

        try:
            # Create design payload
            design_payload = self.create_design_payload(
                DesignName.strip(),
                DesignDescription.strip(),
                ComponentData,
                AdditionalGeometry
            )

            if design_payload is None:
                return DesignJSON

            # Convert to JSON string
            DesignJSON = json.dumps(design_payload, indent=2)

            add_count = len(design_payload.get('additional_geometry', []))
            self.Component.Message = (
                f'Design created: {len(design_payload["components"])} '
                f'components, {add_count} add. geom.'
            )

            return DesignJSON

        except Exception as e:
            msg = f'Unexpected error: {str(e)}'
            self._addError(msg)
            self.Component.Message = msg
# ---------- end createdesign ----------
designdata = Data(createdesign)

# ----
# comments & notes: Fetch a design from the catalogue
designid = Panel("1fdb374c-18a9-4d23-8888-d4d8192657ef")
fetchdesign = FetchDesign(DesignID=designid)  # -> DesignData, ComponentData, AdditionalGeometryData, AdditionalGeometry; inputs DesignID: String
# ---------- fetchdesign: Python ----------
#! python3
# -*- coding: utf-8 -*-
# venv: DDU_CSC
print('ENV OK!')
# r: charset_normalizer
# r: requests

# PYTHON STANDARD LIBRARY IMPORTS ---------------------------------------------
import json  # NOQA
import numpy as np  # NOQA

# THIRD PARTY LIBRARY IMPORTS -------------------------------------------------
import requests  # NOQA

# RHINO AND GH RELATED IMPORTS ------------------------------------------------
import System  # NOQA
import Grasshopper  # NOQA
import Rhino  # NOQA
import scriptcontext as sc  # NOQA

# GHENV COMPONENT SETTINGS ----------------------------------------------------
ghenv.Component.Name = 'FetchDesign'  # NOQA
ghenv.Component.NickName = 'FetchDesign'  # NOQA
ghenv.Component.Category = 'DDU_CSC'  # NOQA
ghenv.Component.SubCategory = '2 Catalog Interface'  # NOQA
ghenv.Component.Description = (  # NOQA
    'Fetches a design from the remote Catalog along with all pinned snapshot '
    'placements. Resolves each snapshot reference to passport JSON '
    '({identity, snapshot}) and overwrites snapshot.iframe with the design '
    'insertion frame. Uses caching for optimal performance.'
)


class CSC_FetchDesign(Grasshopper.Kernel.GH_ScriptInstance):
    """
    Author: Max Benjamin Eschenbach
    License: MIT License
    Version: 260908
    """

    def __init__(self):
        """Initialize this component and set component parameters."""
        super().__init__()
        # initialize props
        self.Component = ghenv.Component  # NOQA
        self.InputParams = self.Component.Params.Input
        self.OutputParams = self.Component.Params.Output

    def _addRemark(self, msg: str = ''):
        """Add a remark message to the component."""
        rml = self.Component.RuntimeMessageLevel.Remark
        self.AddRuntimeMessage(rml, msg)

    def _addWarning(self, msg: str = ''):
        """Add a warning message to the component."""
        rml = self.Component.RuntimeMessageLevel.Warning
        self.AddRuntimeMessage(rml, msg)

    def _addError(self, msg: str = ''):
        """Add an error message to the component."""
        rml = self.Component.RuntimeMessageLevel.Error
        self.AddRuntimeMessage(rml, msg)

    def BeforeRunScript(self):
        """Perform some setup actions."""
        # Initialize input param descriptions
        self.InputParams[0].Description = (
            'Design ID to fetch'
        )
        # Initialize output param descriptions
        i = 0
        if self.OutputParams[0].Name == 'out':
            i += 1
        self.OutputParams[0+i].Description = (
            'Design JSON string'
        )
        self.OutputParams[1+i].Description = (
            'Passport JSON per placement ({identity, snapshot}) with '
            'snapshot.iframe set from the design'
        )
        self.OutputParams[2+i].Description = (
            'Additional geometry items (list of JSON strings)'
        )
        self.OutputParams[3+i].Description = (
            'Additional geometry as Rhino meshes'
        )

    def get_auth_core_from_sticky(self):
        """Get AuthCore instance from sticky storage."""
        auth_core = sc.sticky.get('CSC_AuthCore')
        if auth_core is None:
            msg = ('No authentication found. Please use CSC_Session component '
                   'first.')
            self._addError(msg)
            self.Component.Message = msg
            return None
        return auth_core

    def create_additional_geometry_mesh(self, geometry_data, item_id):
        """
        Create Rhino mesh from additional geometry data.

        Args:
            geometry_data: Additional geometry data dictionary
            item_id: ID of the additional geometry item

        Returns:
            List of Rhino.Geometry.Mesh objects
        """
        meshes = []

        try:
            # Check if geometry has meshes array
            if ('meshes' in geometry_data and
                    isinstance(geometry_data['meshes'], list)):
                for i, mesh_data in enumerate(geometry_data['meshes']):
                    vl = mesh_data.get('v') or mesh_data.get('vertices')
                    fl = mesh_data.get('f') or mesh_data.get('faces')
                    if vl and fl:
                        mesh = Rhino.Geometry.Mesh()

                        # Add vertices
                        [mesh.Vertices.Add(*v) for v in vl]
                        # Add faces
                        [mesh.Faces.AddFace(*f) for f in fl]

                        # Try to get mesh-specific colors
                        try:
                            cl = mesh_data['c']
                            [mesh.VertexColors.Add(
                                System.Drawing.Color.FromArgb(*c))
                             for c in cl]
                        except KeyError:
                            # Use default gray color
                            default_color = System.Drawing.Color.Gray
                            for _ in range(len(vl)):
                                mesh.VertexColors.Add(default_color)

                        # Set user strings for identification
                        mesh.SetUserString('csc_additional_geometry', item_id)
                        mesh.SetUserString('csc_mesh_index', str(i))

                        # Rebuild normals and compact
                        mesh.RebuildNormals()
                        mesh.UnifyNormals()
                        mesh.Compact()

                        meshes.append(mesh)

        except Exception as e:
            self._addWarning(
                f'Error creating mesh for additional geometry {item_id}: '
                f'{str(e)}')

        return meshes

    def fetch_passport_for_snapshot(self, auth_core, snapshot_id, iframe):
        """
        Resolve a design snapshot reference to passport JSON with the design
        insertion frame applied to snapshot.iframe.
        """
        snap_response = auth_core.cached_get(
            f'/snapshots/{snapshot_id}',
            f'snapshot:{snapshot_id}')

        if snap_response.status_code != 200:
            self._addWarning(
                f'Failed to fetch snapshot {snapshot_id}: '
                f'{snap_response.status_code}')
            return None

        snapshot_doc = snap_response.json()
        identity_id = snapshot_doc.get('identity_id')
        if not identity_id:
            self._addWarning(
                f'Snapshot {snapshot_id} missing identity_id')
            return None

        passport_response = auth_core.cached_get(
            f'/identities/{identity_id}/compose',
            f'passport:{identity_id}:{snapshot_id}',
            params={'snapshot_id': snapshot_id})

        if passport_response.status_code != 200:
            self._addWarning(
                f'Failed to fetch passport for snapshot {snapshot_id}: '
                f'{passport_response.status_code}')
            return None

        passport = passport_response.json()
        identity = passport.get('identity')
        snapshots = passport.get('snapshots') or []
        snapshot = snapshots[0] if snapshots else None
        if not isinstance(identity, dict) or not isinstance(snapshot, dict):
            self._addWarning(
                f'Invalid passport payload for snapshot {snapshot_id}')
            return None

        updated_snapshot = dict(snapshot)
        updated_snapshot['iframe'] = iframe
        return {'identity': identity, 'snapshot': updated_snapshot}

    def _additional_geometry_id(self, item):
        """Return additional geometry item id (_id or legacy id)."""
        return item.get('_id') or item.get('id') or 'unknown'

    def RunScript(self, DesignID: str):
        # Init outputs
        DesignData = Grasshopper.DataTree[str]()
        ComponentData = Grasshopper.DataTree[str]()
        AdditionalGeometryData = Grasshopper.DataTree[str]()
        AdditionalGeometry = Grasshopper.DataTree[System.Object]()

        # Get AuthCore instance from sticky storage
        auth_core = self.get_auth_core_from_sticky()
        if auth_core is None:
            return (DesignData, ComponentData, AdditionalGeometryData,
                    AdditionalGeometry)

        # Check if authentication is valid
        if not auth_core.is_valid():
            msg = ('Authentication expired. Please use CSC_Session '
                   'component to refresh.')
            self._addError(msg)
            self.Component.Message = msg
            return (DesignData, ComponentData, AdditionalGeometryData,
                    AdditionalGeometry)

        # Validate DesignID input
        if not DesignID or not DesignID.strip():
            msg = 'Please provide a Design ID to fetch.'
            self._addWarning(msg)
            self.Component.Message = msg
            return (DesignData, ComponentData, AdditionalGeometryData,
                    AdditionalGeometry)

        design_id = DesignID.strip()

        # Validate UUID format
        if not auth_core.validate_uuid(design_id):
            msg = f'Invalid Design ID format: {design_id}'
            self._addError(msg)
            self.Component.Message = msg
            return (DesignData, ComponentData, AdditionalGeometryData,
                    AdditionalGeometry)

        try:
            # Fetch design using cached_get
            response = auth_core.cached_get(
                f'/designs/{design_id}', f'design:{design_id}')

            if response.status_code == 200:
                design_data = response.json()
                self._addRemark(f'Successfully fetched design: {design_id}')

                # Resolve pinned snapshot placements to passport JSON
                components_data = []
                if 'components' in design_data:
                    for comp_ref in design_data['components']:
                        snapshot_id = comp_ref.get('snapshot')
                        iframe = comp_ref.get('iframe')

                        if snapshot_id and iframe:
                            passport = self.fetch_passport_for_snapshot(
                                auth_core, snapshot_id, iframe)
                            if passport:
                                components_data.append(passport)
                        else:
                            self._addWarning(
                                'Invalid snapshot reference in design')

                # Extract additional geometry from design
                additional_geometry_data = []
                additional_geometry_meshes = []
                if 'additional_geometry' in design_data:
                    additional_geometry_data = design_data[
                        'additional_geometry']

                    # Create Rhino meshes for additional geometry
                    for item in additional_geometry_data:
                        item_id = self._additional_geometry_id(item)
                        geometry_data = item.get('geometry', {})
                        iframe = item.get('iframe', {})

                        # Create meshes from geometry data
                        meshes = self.create_additional_geometry_mesh(
                            geometry_data, item_id)

                        # Apply iframe transformation to each mesh
                        if iframe and meshes:
                            try:
                                # Create transformation matrix from iframe
                                o = np.array(iframe['o'])
                                x = np.array(iframe['x'])
                                y = np.array(iframe['y'])
                                z = np.array(iframe['z'])

                                # Create 4x4 transformation matrix
                                transform_matrix = np.array([
                                    [x[0], y[0], z[0], o[0]],
                                    [x[1], y[1], z[1], o[1]],
                                    [x[2], y[2], z[2], o[2]],
                                    [0, 0, 0, 1]
                                ])

                                # Convert to Rhino transform
                                rhino_transform = Rhino.Geometry.Transform()
                                for i in range(4):
                                    for j in range(4):
                                        rhino_transform[i, j] = (
                                            float(transform_matrix[i, j]))

                                # Apply transformation to each mesh
                                for mesh in meshes:
                                    mesh.Transform(rhino_transform)

                            except Exception as e:
                                self._addWarning(
                                    f'Error applying iframe transformation to '
                                    f'additional geometry {item_id}: {str(e)}')

                        additional_geometry_meshes.extend(meshes)

                # Set outputs
                design_json = json.dumps(design_data, indent=2)
                components_json = [json.dumps(c, indent=2)
                                   for c in components_data]
                additional_geometry_json = [
                    json.dumps(item, indent=2)
                    for item in additional_geometry_data]

                DesignData = design_json
                ComponentData = components_json
                AdditionalGeometryData = additional_geometry_json
                AdditionalGeometry = additional_geometry_meshes

                self.Component.Message = (
                    f'Design fetched: {len(components_data)} snapshots, '
                    f'{len(additional_geometry_data)} additional geometry '
                    f'items')

                return (DesignData, ComponentData, AdditionalGeometryData,
                        AdditionalGeometry)

            elif response.status_code == 404:
                msg = f'Design not found: {design_id}'
                self._addError(msg)
                self.Component.Message = msg
                return (DesignData, ComponentData, AdditionalGeometryData,
                        AdditionalGeometry)

            elif response.status_code == 401:
                msg = 'Authentication failed. Please sign in again.'
                self._addError(msg)
                self.Component.Message = msg
                return (DesignData, ComponentData, AdditionalGeometryData,
                        AdditionalGeometry)

            else:
                msg = f'Failed to fetch design: {response.status_code}'
                self._addError(msg)
                self.Component.Message = msg
                return (DesignData, ComponentData, AdditionalGeometryData,
                        AdditionalGeometry)

        except requests.exceptions.RequestException as e:
            msg = f'Network error: {str(e)}'
            self._addError(msg)
            self.Component.Message = msg
            return (DesignData, ComponentData, AdditionalGeometryData,
                    AdditionalGeometry)

        except Exception as e:
            msg = f'Unexpected error: {str(e)}'
            self._addError(msg)
            self.Component.Message = msg
            return (DesignData, ComponentData, AdditionalGeometryData,
                    AdditionalGeometry)
# ---------- end fetchdesign ----------
additionalgeometrydata = Data(fetchdesign.AdditionalGeometryData)
additionalgeometry_2 = Data(fetchdesign.AdditionalGeometry)
componentdata_12 = Data(fetchdesign.ComponentData)
designdata_2 = Data(fetchdesign.DesignData)

# ---- group: __DDU_CSC_EXAMPLE_08__
# Step 2
component_name = Panel("Schoenes Neues Feld 03")
snapshotid_optional_will_be_generated_at = Panel("")  # "SnapshotID (optional, will be generated at runtime if not set)"
complexity_5 = ValueList({"0 (simple)": 0, "1 (average)": 1, "2 (complex)": 2, "3 (very complex)": 3}, selected="1 (average)")
clearlocalstorage = Button()
fragment_5 = BooleanToggle(True)
assembly = BooleanToggle(False)
color = ColourSwatch(SwatchColor=RGB(189, 189, 189))
identityid = Data(steelfixture)
geometry = Data(steelfixture_2)
location_3 = Data(location)
createcomponentsnapshot = CreateComponentSnapshot(
    ClearLocalStorage=clearlocalstorage,
    IdentityID=identityid,
    SnapshotID=snapshotid_optional_will_be_generated_at,
    Name=component_name,
    Complexity=complexity_5,
    Fragment=fragment_5,
    Assembly=assembly,
    Color=color,
    Location=location_3,
    Geometry=geometry)  # -> SnapshotData; inputs ClearLocalStorage: Boolean, IdentityID: String, SnapshotID: String, Name: String, Complexity: Int32, Fragment: Boolean, Assembly: Boolean, Color: Color, Location: Vector3d, Geometry: list of GeometryBase, MarkerPoints: list of Point3d, Virtual: Boolean, Reinforcements: list
# ---------- createcomponentsnapshot: Python ----------
#! python3
# -*- coding: utf-8 -*-
# venv: DDU_CSC
print('ENV OK!')
# r: charset_normalizer
# r: requests
# r: numpy
# r: scipy
# r: scikit-learn

# PYTHON STANDARD LIBRARY IMPORTS ---------------------------------------------
import json  # NOQA
import struct  # NOQA
import uuid  # NOQA
import os  # NOQA
import platform  # NOQA

# THIRD PARTY LIBRARY IMPORTS -------------------------------------------------
import numpy as np  # NOQA
from scipy.spatial import ConvexHull  # NOQA
from sklearn.decomposition import PCA  # NOQA

# RHINO AND GH RELATED IMPORTS ------------------------------------------------
import System  # NOQA
import Grasshopper  # NOQA
import Rhino  # NOQA
import scriptcontext as sc  # NOQA

# One PCA sample per this many mm of triangle area (3D mesh path).
REFERENCE_FACE_AREA_MM2 = 100.0

# Inline JSON preview cap; full cloud staged as PLY above this count.
POINT_CLOUD_INLINE_MAX = 5000
POINT_CLOUD_STAGING_THRESHOLD = 5000

# GHENV COMPONENT SETTINGS ----------------------------------------------------
ghenv.Component.Name = 'CreateComponentSnapshot'  # NOQA
ghenv.Component.NickName = 'CreateComponentSnapshot'  # NOQA
ghenv.Component.Category = 'DDU_CSC'  # NOQA
ghenv.Component.SubCategory = '3 Component Operations'  # NOQA
ghenv.Component.Description = (  # NOQA
    'Builds a POST /identities/{id}/snapshots payload (CreateSnapshotRequest) '
    'from Rhino geometry for an existing identity. Computes PCA orientation, '
    'mesh reduction, stages mesh PLY under '
    'pending_snapshot_assets/{snapshot_id}/meshes/<i>/ and point cloud PLY '
    'under .../point_clouds/<i>.ply.'
)


class CSC_CreateComponentSnapshot(Grasshopper.Kernel.GH_ScriptInstance):
    """
    Author: Max Benjamin Eschenbach
    License: MIT License
    Version: 260826
    """

    def __init__(self):
        """Initialize this component and set component parameters."""
        super().__init__()
        # initialize props
        self.Component = ghenv.Component  # NOQA
        self.InputParams = self.Component.Params.Input
        self.OutputParams = self.Component.Params.Output

    def _addRemark(self, msg: str = ''):
        """Add a remark message to the component."""
        rml = self.Component.RuntimeMessageLevel.Remark
        self.AddRuntimeMessage(rml, msg)

    def _addWarning(self, msg: str = ''):
        """Add a warning message to the component."""
        rml = self.Component.RuntimeMessageLevel.Warning
        self.AddRuntimeMessage(rml, msg)

    def _addError(self, msg: str = ''):
        """Add an error message to the component."""
        rml = self.Component.RuntimeMessageLevel.Error
        self.AddRuntimeMessage(rml, msg)

    def BeforeRunScript(self):
        """Perform some setup actions."""
        # Initialize input param descriptions
        self.InputParams[0].Description = (
            'If True, clears pending_snapshot_assets staging '
            '(does not affect Session API cache)'
        )
        self.InputParams[1].Description = (
            'Existing identity UUID to attach the new snapshot to'
        )
        self.InputParams[2].Description = (
            'New snapshot UUID (optional; auto-generated when empty)'
        )
        self.InputParams[3].Description = (
            'Snapshot display name (optional; '
            'inherits current name when empty)'
        )
        self.InputParams[4].Description = (
            'Complexity level '
            '(0=simple, 1=normal, 2=complex, 3=very complex)'
        )
        self.InputParams[5].Description = (
            'Fragment status (True for fragments, False for complete)'
        )
        self.InputParams[6].Description = (
            'Assembly status (True for assemblies, False for individual)'
        )
        self.InputParams[7].Description = (
            'Component color (System.Drawing.Color)'
        )
        self.InputParams[8].Description = (
            'Location as Vector3d (X=latitude, Y=longitude, Z ignored)'
        )
        self.InputParams[9].Description = (
            'Rhino geometry — single Mesh, Extrusion, or PointCloud, or a '
            'list of Meshes and/or PointClouds. Extrusion is single-object '
            'only.'
        )
        self.InputParams[10].Description = (
            'Marker points as list of Point3d objects'
        )
        self.InputParams[11].Description = (
            'Optional condition grade. Integer in {0, 1, 2, 3}. '
            'Leave unconnected for unknown.'
        )
        self.InputParams[12].Description = (
            'Optional free-text notes for the new snapshot (max 5000)'
        )
        self.InputParams[13].Description = (
            'Count of identical physical items (integer >= 1, default 1)'
        )
        self.InputParams[14].Description = (
            'Virtual snapshot flag (True = proposal/hypothetical state)'
        )
        if len(self.InputParams) > 15:
            self.InputParams[15].Description = (
                'Optional reinforcement JSON strings from CreateReinforcement '
                '(one or many; merged into geometry.reinforcements)'
            )
        i = 0
        if self.OutputParams[0].Name == 'out':
            i += 1
        self.OutputParams[0+i].Description = (
            'CreateSnapshotRequest JSON plus identity_id for '
            'POST /identities/{id}/snapshots'
        )

    def get_auth_core_from_sticky(self):
        """Get AuthCore instance from sticky storage."""
        auth_core = sc.sticky.get('CSC_AuthCore')
        if auth_core is None:
            self._addWarning(
                'No authentication found. Using hardcoded snapshot schema.'
            )
            return None
        return auth_core

    def get_snapshot_payload_schema(self):
        """Get CreateSnapshotRequest schema from Session cache or fallback."""
        auth_core = self.get_auth_core_from_sticky()
        if auth_core and hasattr(auth_core, 'get_create_snapshot_schema'):
            try:
                schema = auth_core.get_create_snapshot_schema()
                if schema:
                    self._addRemark('Using cached create-snapshot schema')
                    return schema
            except Exception as e:
                self._addWarning(
                    f'Error fetching create-snapshot schema: {e}; '
                    'using hardcoded fallback'
                )

        self._addRemark('Using hardcoded create-snapshot schema')
        return self.get_hardcoded_snapshot_schema()

    def get_hardcoded_snapshot_schema(self):
        """Minimal CreateSnapshotRequest schema when Session is unavailable."""
        return {
            'type': 'object',
            'required': [
                'complexity', 'fragment', 'assembly', 'geometry', 'bbx',
                'bbx_origin', 'iframe', 'pca_frame',
            ],
            'properties': {
                '_id': {'type': 'string'},
                'identity_id': {'type': 'string'},
                'name': {'type': 'string'},
                'complexity': {'type': 'integer'},
                'fragment': {'type': 'boolean'},
                'assembly': {'type': 'boolean'},
                'virtual': {'type': 'boolean'},
                'geometry': {'type': 'object'},
                'color': {'type': 'array'},
                'bbx': {'type': 'array'},
                'bbx_origin': {'type': 'array'},
                'location': {'type': 'object'},
                'iframe': {'type': 'object'},
                'pca_frame': {'type': 'object'},
                'validated': {'type': 'boolean'},
                'marker_points': {'type': 'array'},
                'notes': {'type': 'string'},
                'quantity': {'type': 'integer'},
            },
        }

    def validate_snapshot_payload(self, payload, schema):
        """Validate snapshot payload against schema required fields."""
        try:
            required_fields = schema.get('required', [])
            missing_fields = [
                field for field in required_fields if field not in payload
            ]
            if missing_fields:
                self._addError(
                    f'Missing required fields: {", ".join(missing_fields)}'
                )
                return False

            if not payload.get('identity_id'):
                self._addError('identity_id must be present')
                return False
            if not self.validate_uuid(payload.get('identity_id', '')):
                self._addError('identity_id must be a valid UUID')
                return False
            if payload.get('_id') and not self.validate_uuid(payload['_id']):
                self._addError('_id must be a valid snapshot UUID')
                return False

            if not isinstance(payload.get('complexity'), int):
                self._addError('complexity must be an integer')
                return False
            if not isinstance(payload.get('fragment'), bool):
                self._addError('fragment must be a boolean')
                return False
            if not isinstance(payload.get('assembly'), bool):
                self._addError('assembly must be a boolean')
                return False

            color = payload.get('color', [])
            if color and (not isinstance(color, list) or len(color) != 3):
                self._addError('color must be a list of 3 integers [R, G, B]')
                return False

            if not isinstance(payload.get('iframe'), dict):
                self._addError('iframe must be a frame object')
                return False
            if not isinstance(payload.get('pca_frame'), dict):
                self._addError('pca_frame must be a frame object')
                return False

            geometry = payload.get('geometry') or {}
            if not (
                geometry.get('meshes')
                or geometry.get('extrusions')
                or geometry.get('point_clouds')
            ):
                self._addError(
                    'geometry must include meshes, extrusions, or point_clouds'
                )
                return False

            return True

        except Exception as e:
            self._addError(f'Validation error: {str(e)}')
            return False

    def normalize_reinforcement_json_input(self, reinforcements_input):
        """Flatten optional reinforcement JSON input to a list of strings."""
        entries = []
        if reinforcements_input is None:
            return entries

        if isinstance(reinforcements_input, str):
            raw = reinforcements_input.strip()
            if raw:
                entries.append(raw)
            return entries

        if isinstance(
            reinforcements_input,
            Grasshopper.Kernel.Data.GH_Structure
        ):
            for obj in reinforcements_input.AllData(True):
                if obj is None:
                    continue
                raw = str(obj).strip()
                if raw:
                    entries.append(raw)
            return entries

        try:
            for item in reinforcements_input:
                if item is None:
                    continue
                raw = str(item).strip()
                if raw:
                    entries.append(raw)
        except TypeError:
            raw = str(reinforcements_input).strip()
            if raw:
                entries.append(raw)
        return entries

    def build_centered_reinforcements(
            self,
            reinforcements_input,
            translation_vector):
        """Parse reinforcement JSON strings and apply centering translation."""
        json_entries = self.normalize_reinforcement_json_input(
            reinforcements_input)
        if not json_entries:
            return []

        tx = float(translation_vector[0])
        ty = float(translation_vector[1])
        tz = float(translation_vector[2])
        centered = []

        for idx, raw in enumerate(json_entries):
            try:
                data = json.loads(raw)
            except (TypeError, ValueError) as exc:
                self._addWarning(
                    f'Reinforcement {idx}: invalid JSON ({exc})'
                )
                continue
            if not isinstance(data, dict):
                self._addWarning(
                    f'Reinforcement {idx}: expected JSON object'
                )
                continue

            spec = str(data.get('spec', '')).strip()
            diameter = data.get('diameter')
            points = data.get('points')
            if not spec:
                self._addWarning(f'Reinforcement {idx}: spec is required')
                continue
            try:
                diameter = float(diameter)
            except (TypeError, ValueError):
                self._addWarning(
                    f'Reinforcement {idx}: diameter must be a number'
                )
                continue
            if diameter <= 0:
                self._addWarning(
                    f'Reinforcement {idx}: diameter must be > 0'
                )
                continue
            if not isinstance(points, list) or len(points) < 2:
                self._addWarning(
                    f'Reinforcement {idx}: at least 2 points required'
                )
                continue

            centered_points = []
            valid = True
            for pt in points:
                if (not isinstance(pt, (list, tuple))
                        or len(pt) != 3):
                    self._addWarning(
                        f'Reinforcement {idx}: invalid point {pt}'
                    )
                    valid = False
                    break
                centered_points.append([
                    float(pt[0]) + tx,
                    float(pt[1]) + ty,
                    float(pt[2]) + tz,
                ])
            if not valid:
                continue

            centered.append({
                'spec': spec,
                'diameter': diameter,
                'points': centered_points,
            })

        return centered

    def build_snapshot_payload(
            self,
            snapshot_id: str,
            identity_id: str,
            name: str,
            complexity: int,
            fragment: bool,
            assembly: bool,
            color,
            dimensions,
            location_data,
            principal_components,
            condition,
            notes,
            quantity,
            virtual: bool):
        """
        Build POST /identities/{{id}}/snapshots JSON
        (CreateSnapshotRequest).
        """
        payload = {
            '_id': snapshot_id,
            'identity_id': identity_id,
            'complexity': int(complexity),
            'fragment': bool(fragment),
            'assembly': bool(assembly),
            'virtual': bool(virtual),
            'geometry': {},
            'color': [color.R, color.G, color.B],
            'bbx': dimensions,
            'bbx_origin': [0.0, 0.0, 0.0],
            'location': location_data or {'lat': 0.0, 'lon': 0.0},
            'descriptors': {},
            'processes': {},
            'iframe': {
                'o': [0.0, 0.0, 0.0],
                'x': [1.0, 0.0, 0.0],
                'y': [0.0, 1.0, 0.0],
                'z': [0.0, 0.0, 1.0],
            },
            'pca_frame': {
                'o': [0.0, 0.0, 0.0],
                'x': principal_components[0].tolist(),
                'y': principal_components[1].tolist(),
                'z': principal_components[2].tolist(),
            },
            'validated': False,
        }

        trimmed_name = (name or '').strip()
        if trimmed_name:
            payload['name'] = trimmed_name

        if condition is not None:
            payload['condition'] = condition

        trimmed_notes = (notes or '').strip()
        if trimmed_notes:
            payload['notes'] = trimmed_notes[:5000]

        try:
            qty = int(quantity) if quantity is not None else 1
        except (TypeError, ValueError):
            qty = 1
        qty = max(1, min(999_999, qty))
        if qty != 1:
            payload['quantity'] = qty

        return payload

    def mesh_to_inline_primitive(self, mesh, default_rgb):
        """SnapshotMesh dict (vertices/faces/colors, Rhino Z-up)."""
        vertices = [[p.X, p.Y, p.Z] for p in mesh.Vertices]
        faces = []
        for face in mesh.Faces:
            if face.IsTriangle:
                faces.append([face.A, face.B, face.C])
            elif face.IsQuad:
                faces.append([face.A, face.B, face.C])
                faces.append([face.A, face.C, face.D])

        if mesh.VertexColors.Count > 0:
            colors = [
                [mesh.VertexColors[i].R, mesh.VertexColors[i].G,
                 mesh.VertexColors[i].B]
                for i in range(mesh.Vertices.Count)
            ]
        else:
            colors = [list(default_rgb)] * len(vertices)

        return {
            'vertices': vertices,
            'faces': faces,
            'colors': colors,
        }

    def save_rhino_mesh_as_ply_binary(self, mesh, file_path, default_rgb):
        """Write binary little-endian PLY (Rhino Z-up) with per-vertex RGB."""
        vertices = []
        colors = []
        has_vc = mesh.VertexColors.Count > 0
        for i in range(mesh.Vertices.Count):
            v = mesh.Vertices[i]
            vertices.append((v.X, v.Y, v.Z))
            if has_vc and i < mesh.VertexColors.Count:
                c = mesh.VertexColors[i]
                colors.append((c.R, c.G, c.B))
            else:
                colors.append(default_rgb)

        faces = []
        for face in mesh.Faces:
            if face.IsTriangle:
                faces.append((face.A, face.B, face.C))
            elif face.IsQuad:
                faces.append((face.A, face.B, face.C))
                faces.append((face.A, face.C, face.D))

        header = (
            'ply\n'
            'format binary_little_endian 1.0\n'
            f'element vertex {len(vertices)}\n'
            'property float x\n'
            'property float y\n'
            'property float z\n'
            'property uchar red\n'
            'property uchar green\n'
            'property uchar blue\n'
            f'element face {len(faces)}\n'
            'property list uchar int vertex_indices\n'
            'end_header\n'
        )

        os.makedirs(os.path.dirname(file_path), exist_ok=True)
        with open(file_path, 'wb') as handle:
            handle.write(header.encode('ascii'))
            for (x, y, z), (r, g, b) in zip(vertices, colors):
                handle.write(struct.pack('<fffBBB', x, y, z, r, g, b))
            for tri in faces:
                handle.write(struct.pack('<Biii', 3, tri[0], tri[1], tri[2]))

    def point_cloud_to_inline_primitive(
            self,
            cloud,
            max_points: int = POINT_CLOUD_INLINE_MAX):
        """Build inline point_cloud primitive with optional subsampling."""
        count = cloud.Count
        if count == 0:
            raise RuntimeError('Point cloud is empty')

        if count > max_points:
            step = count / float(max_points)
            indices = [
                min(int(round(i * step)), count - 1)
                for i in range(max_points)
            ]
        else:
            indices = list(range(count))

        points = []
        colors = []
        has_colors = False
        for i in indices:
            item = cloud[i]
            loc = item.Location
            points.append([loc.X, loc.Y, loc.Z])
            color = item.Color
            if color.IsEmpty:
                colors.append([128, 128, 128])
            else:
                has_colors = True
                colors.append([color.R, color.G, color.B])

        result = {'points': points}
        if has_colors:
            result['colors'] = colors
        return result

    def save_rhino_point_cloud_as_ply_binary(self, cloud, file_path):
        """Write binary little-endian PLY (vertices only) from a PointCloud."""
        vertices = []
        colors = []
        for i in range(cloud.Count):
            item = cloud[i]
            loc = item.Location
            vertices.append((loc.X, loc.Y, loc.Z))
            color = item.Color
            if color.IsEmpty:
                colors.append((128, 128, 128))
            else:
                colors.append((color.R, color.G, color.B))

        header = (
            'ply\n'
            'format binary_little_endian 1.0\n'
            f'element vertex {len(vertices)}\n'
            'property float x\n'
            'property float y\n'
            'property float z\n'
            'property uchar red\n'
            'property uchar green\n'
            'property uchar blue\n'
            'end_header\n'
        )

        os.makedirs(os.path.dirname(file_path), exist_ok=True)
        with open(file_path, 'wb') as handle:
            handle.write(header.encode('ascii'))
            for (x, y, z), (r, g, b) in zip(vertices, colors):
                handle.write(struct.pack('<fffBBB', x, y, z, r, g, b))

    def center_geometry_at_origin(self, geometry):
        """
        Center geometry at its centroid.
        Returns centered geometry and translation vector.
        """
        if isinstance(geometry, Rhino.Geometry.PointCloud):
            if geometry.Count == 0:
                raise RuntimeError('Point cloud is empty')
            bbox = geometry.GetBoundingBox(True)
            volume_centroid = bbox.Center
        else:
            # Get the volume centroid of the geometry
            vmp = Rhino.Geometry.VolumeMassProperties.Compute(geometry)
            volume_centroid = vmp.Centroid
            if volume_centroid is None:
                # Fallback to bounding box centroid if volume centroid fails
                bbox = geometry.GetBoundingBox(True)
                volume_centroid = bbox.Center
        # Create translation vector to center
        translation_vector = -np.array([
            volume_centroid.X, volume_centroid.Y, volume_centroid.Z
        ])
        # Create centered extrusion
        centered_geometry = geometry.Duplicate()
        translation_xform = Rhino.Geometry.Transform.Translation(
            translation_vector[0], translation_vector[1], translation_vector[2]
        )
        centered_geometry.Transform(translation_xform)
        return centered_geometry, translation_vector

    def _triangle_area(self, v0, v1, v2):
        return float(0.5 * np.linalg.norm(np.cross(v1 - v0, v2 - v0)))

    def sample_points_area_weighted_from_mesh(
            self,
            mesh,
            reference_face_area=REFERENCE_FACE_AREA_MM2,
            min_samples_per_face=1):
        """
        Build a PCA point cloud by repeating face centroids weighted by area.
        """
        vertices = np.array(
            [[v.X, v.Y, v.Z] for v in mesh.Vertices],
            dtype=np.float64,
        )
        if mesh.Faces.Count == 0:
            return vertices

        samples = []
        ref_area = max(reference_face_area, 1e-6)
        for face_idx in range(mesh.Faces.Count):
            face = mesh.Faces[face_idx]
            if face.IsTriangle:
                triangles = [[face.A, face.B, face.C]]
            elif face.IsQuad:
                triangles = [
                    [face.A, face.B, face.C],
                    [face.A, face.C, face.D],
                ]
            else:
                continue

            for tri in triangles:
                v0, v1, v2 = (
                    vertices[tri[0]], vertices[tri[1]], vertices[tri[2]]
                )
                area = self._triangle_area(v0, v1, v2)
                count = max(
                    min_samples_per_face,
                    int(round(area / ref_area)),
                )
                centroid = (v0 + v1 + v2) / 3.0
                samples.extend([centroid] * count)

        if not samples:
            return vertices
        return np.vstack(samples)

    def sample_points_for_pca_3d(self, geometry):
        """
        Collect area-weighted PCA samples from mesh or brep geometry.
        NOTE: CUrrently not used due to long runtime
        """
        if isinstance(geometry, Rhino.Geometry.Mesh):
            return self.sample_points_area_weighted_from_mesh(geometry)

        if isinstance(geometry, Rhino.Geometry.Brep):
            mp = Rhino.Geometry.MeshingParameters.Default
            brep_meshes = Rhino.Geometry.Mesh.CreateFromBrep(geometry, mp)
            if brep_meshes:
                chunks = [
                    self.sample_points_area_weighted_from_mesh(m)
                    for m in brep_meshes
                ]
                return np.vstack(chunks)

            return np.array(
                [[p.Location.X, p.Location.Y, p.Location.Z]
                 for p in geometry.Vertices],
                dtype=np.float64,
            )

        raise RuntimeError(
            'Area-weighted 3D sampling not implemented for geometry of type '
            f'{type(geometry)}!'
        )

    def compute_obb_3d(self, points):
        """
        Compute object oriented bounding box for 3D points using PCA.
        Returns unsorted dimensions and bounding box origin.
        """
        # Apply PCA to find principal axes
        pca = PCA(n_components=3)
        pca.fit(points)

        # Get principal components (eigenvectors)
        principal_components = pca.components_

        # Ensure right-handed coordinate system
        # Check if determinant is positive (right-handed)
        det = np.linalg.det(principal_components)
        if det < 0:
            # Flip the third component to ensure right-handedness
            principal_components[2] = -principal_components[2]

        # Transform points to PCA space using original component order
        pca_points = np.dot(points, principal_components.T)

        # Find bounds in PCA space
        min_bounds = np.min(pca_points, axis=0)
        max_bounds = np.max(pca_points, axis=0)

        # Compute unsorted dimensions (keep original PCA axis order)
        dimensions = max_bounds - min_bounds

        # Find bounding box center in PCA space
        # Since component is centered at origin, bbx_origin is just the
        # bounding box center in PCA space
        bbx_origin = (min_bounds + max_bounds) / 2.0

        return dimensions.tolist(), principal_components, bbx_origin.tolist()

    def minimum_bounding_rectangle(self, points):
        """
        Compute minimum bounding rectangle for 2D points.
        Returns rectangle corners and angle.
        """
        # Compute the convex hull of the points
        hull = ConvexHull(points)
        hull_points = points[hull.vertices]

        # Initialize variables to keep track of the best rectangle
        min_area = float('inf')
        best_rectangle = None
        best_angle = 0

        # Loop through each edge of the convex hull
        for i in range(len(hull_points)):
            # Determine the points forming the current edge
            p1 = hull_points[i]
            p2 = hull_points[(i + 1) % len(hull_points)]

            # Calculate edge vector
            edge_vec = p2 - p1

            # Rotate the points to align this edge with the x-axis
            angle = np.arctan2(edge_vec[1], edge_vec[0])
            cos_angle = np.cos(-angle)
            sin_angle = np.sin(-angle)
            rot_matrix = np.array([[cos_angle, -sin_angle],
                                   [sin_angle, cos_angle]])
            rotated_points = np.dot(points, rot_matrix.T)

            # Compute the min/max x/y in the rotated points
            min_x = np.min(rotated_points[:, 0])
            max_x = np.max(rotated_points[:, 0])
            min_y = np.min(rotated_points[:, 1])
            max_y = np.max(rotated_points[:, 1])

            # Calculate area of the bounding rectangle
            area = (max_x - min_x) * (max_y - min_y)

            if area < min_area:
                min_area = area
                best_angle = angle

                # Create the rectangle in the rotated space and then rotate it
                # back
                best_rectangle = np.array([
                    [min_x, min_y],
                    [max_x, min_y],
                    [max_x, max_y],
                    [min_x, max_y]
                ])

                inv_rot_matrix = np.array([
                    [cos_angle, sin_angle],
                    [-sin_angle, cos_angle]
                ])
                best_rectangle = np.dot(best_rectangle, inv_rot_matrix.T)

        return best_rectangle, best_angle

    def compute_obb_2d(self, points, height):
        """
        Compute object oriented bounding box for extrusions using the
        minimum bounding rectangle method to find optimal 2D orientation.
        Returns unsorted dimensions and bounding box origin.
        """
        # Extract only X and Y coordinates for 2D analysis
        points_2d = points[:, :2]

        # Use the minimum bounding rectangle method to find optimal orientation
        mbr, optimal_angle = self.minimum_bounding_rectangle(points_2d)

        # The optimal_angle is the angle of the edge vector that gives
        # minimum area. To align this edge with the x-axis, we need to
        # rotate by -optimal_angle. This matches the logic in
        # minimum_bounding_rectangle
        cos_angle = np.cos(-optimal_angle)
        sin_angle = np.sin(-optimal_angle)

        # Rotate points to the optimal orientation
        rot_matrix = np.array([
            [cos_angle, -sin_angle],
            [sin_angle, cos_angle]
        ])
        rotated_points = np.dot(points_2d, rot_matrix.T)

        # Compute dimensions in the rotated coordinate system
        min_x = np.min(rotated_points[:, 0])
        max_x = np.max(rotated_points[:, 0])
        min_y = np.min(rotated_points[:, 1])
        max_y = np.max(rotated_points[:, 1])

        x_dim = max_x - min_x
        y_dim = max_y - min_y

        # Find bounding box center in rotated 2D space
        bbx_center_2d = [(min_x + max_x) / 2.0, (min_y + max_y) / 2.0]

        # Find Z center (since component is centered, this should be near 0)
        min_z = np.min(points[:, 2])
        max_z = np.max(points[:, 2])
        z_center = (min_z + max_z) / 2.0

        # Since component is centered at origin, bbx_origin is the bounding
        # box center in rotated 2D space + Z center
        bbx_origin_2d = [bbx_center_2d[0], bbx_center_2d[1], z_center]

        # Ensure X is the longest dimension for consistency
        if x_dim >= y_dim:
            dimensions = [x_dim, y_dim, height]
            # PCA frame aligns with the optimal orientation
            principal_components = np.array([
                [cos_angle, -sin_angle, 0],  # X axis = long axis
                [sin_angle, cos_angle, 0],   # Y axis = short axis
                [0, 0, 1]                    # Z axis stays vertical
            ])
        else:
            # Swap dimensions - the longer dimension should be X
            dimensions = [y_dim, x_dim, height]
            # Rotate by 90 degrees to make Y the X axis
            cos_angle_90 = np.cos(-optimal_angle + np.pi / 2)
            sin_angle_90 = np.sin(-optimal_angle + np.pi / 2)
            principal_components = np.array([
                [cos_angle_90, -sin_angle_90, 0],  # X axis = long axis
                [sin_angle_90, cos_angle_90, 0],   # Y axis = short axis
                [0, 0, 1]                          # Z axis stays vertical
            ])

        return dimensions, principal_components, bbx_origin_2d

    def rhino_xform(self, transformation_matrix) -> Rhino.Geometry.Transform:
        """
        Convert numpy transformation matrix to Rhino Transform.
        """
        XForm = Rhino.Geometry.Transform.Identity
        XForm.M00 = transformation_matrix[0][0]
        XForm.M01 = transformation_matrix[0][1]
        XForm.M02 = transformation_matrix[0][2]
        XForm.M03 = transformation_matrix[0][3]
        XForm.M10 = transformation_matrix[1][0]
        XForm.M11 = transformation_matrix[1][1]
        XForm.M12 = transformation_matrix[1][2]
        XForm.M13 = transformation_matrix[1][3]
        XForm.M20 = transformation_matrix[2][0]
        XForm.M21 = transformation_matrix[2][1]
        XForm.M22 = transformation_matrix[2][2]
        XForm.M23 = transformation_matrix[2][3]
        return XForm

    def process_geometry(self, geometry: Rhino.Geometry.GeometryBase):
        """
        Process geometry to extract points and determine if 3D.
        Returns points array and boolean indicating if 3D.
        """
        compute_3d = False
        # HANDLE BREP
        if isinstance(geometry, Rhino.Geometry.Brep):
            points = np.array([[p.Location.X,
                                p.Location.Y,
                                p.Location.Z] for p in geometry.Vertices])
            compute_3d = True
        # HANDLE EXTRUSIONS
        elif isinstance(geometry, Rhino.Geometry.Extrusion):
            brep = geometry.ToBrep()
            points = np.array([[p.Location.X,
                                p.Location.Y,
                                p.Location.Z] for p in brep.Vertices])
            compute_3d = False
        # HANDLE MESH
        elif isinstance(geometry, Rhino.Geometry.Mesh):
            points = np.array([[p.X, p.Y, p.Z] for p in geometry.Vertices])
            compute_3d = True
        # HANDLE POINT CLOUD
        elif isinstance(geometry, Rhino.Geometry.PointCloud):
            points = np.array([
                [geometry[i].Location.X,
                 geometry[i].Location.Y,
                 geometry[i].Location.Z]
                for i in range(geometry.Count)
            ])
            compute_3d = True
        # IF NOT ONE OF THESE GEOMETRY TYPES
        else:
            raise RuntimeError('Geometry processing not implemented '
                               f'for geometry of type {type(geometry)}!')
        # return results
        return points, compute_3d

    def validate_uuid(self, uuid_to_test: str, version: int = 4) -> bool:
        """
        Check if uuid_to_test is a valid UUID.
        Returns True if uuid_to_test is a valid UUID, otherwise False.
        """
        try:
            uuid_obj = uuid.UUID(uuid_to_test, version=version)
        except ValueError:
            return False
        return str(uuid_obj) == uuid_to_test

    def get_pending_assets_root(self) -> str:
        """Root directory for staged identity mesh PLY files."""
        if platform.system() == 'Windows':
            base_path = os.path.expandvars('%APPDATA%')
            return os.path.join(
                base_path,
                'DDU_CSC',
                'pending_snapshot_assets'
            )
        base_path = os.path.expanduser('~')
        return os.path.join(
            base_path, 'Library', 'Application Support', 'DDU_CSC',
            'pending_snapshot_assets',
        )

    def get_snapshot_assets_dir(self, snapshot_id: str) -> str:
        return os.path.join(self.get_pending_assets_root(), snapshot_id)

    def get_mesh_primitive_dir(
            self,
            snapshot_id: str,
            primitive_index: int
    ) -> str:
        return os.path.join(
            self.get_snapshot_assets_dir(snapshot_id),
            'meshes',
            str(primitive_index),
        )

    def get_point_cloud_staged_path(
            self,
            snapshot_id: str,
            primitive_index: int) -> str:
        return os.path.join(
            self.get_snapshot_assets_dir(snapshot_id),
            'point_clouds',
            f'{primitive_index}.ply',
        )

    def write_staging_manifest(
            self,
            identity_id: str,
            snapshot_id: str,
            mesh_primitives: dict = None,
            point_cloud_primitives: dict = None):
        """Write manifest.json for AddComponentSnapshot upload handoff."""
        manifest = {
            'identity_id': identity_id,
            'snapshot_id': snapshot_id,
            'coordinate_frame': 'rhino_z_up',
        }
        if mesh_primitives:
            manifest['mesh_primitives'] = mesh_primitives
        if point_cloud_primitives:
            manifest['point_cloud_primitives'] = point_cloud_primitives
        assets_dir = self.get_snapshot_assets_dir(snapshot_id)
        os.makedirs(assets_dir, exist_ok=True)
        manifest_path = os.path.join(assets_dir, 'manifest.json')
        with open(manifest_path, 'w', encoding='utf-8') as handle:
            json.dump(manifest, handle, indent=2)

    def clear_pending_snapshot_assets_directory(self):
        """Clear all staged pending_snapshot_assets (not Session cache)."""
        try:
            assets_dir = self.get_pending_assets_root()
            if os.path.exists(assets_dir):
                import shutil
                shutil.rmtree(assets_dir, ignore_errors=True)
                os.makedirs(assets_dir, exist_ok=True)
                self._addRemark(
                    f'Cleared pending_snapshot_assets: {assets_dir}'
                )
                return True
            self._addRemark('pending_snapshot_assets does not exist yet')
            return True
        except Exception as e:
            self._addWarning(
                f'Failed to clear pending_snapshot_assets: {str(e)}'
            )
            return False

    def reduce_mesh(
        self, mesh: Rhino.Geometry.Mesh, target_face_count: int
    ) -> Rhino.Geometry.Mesh:
        """
        Reduce a mesh to a target face count using Rhino's mesh reduction.
        Returns the reduced mesh.
        """
        reduced_mesh = mesh.Duplicate()
        reduced_mesh.Reduce(target_face_count, True, 5, False, True)
        reduced_mesh.Faces.ConvertQuadsToTriangles()
        reduced_mesh.Compact()
        return reduced_mesh

    def _stage_mesh_ply_files(
            self,
            snapshot_id: str,
            primitive_index: int,
            detailed_mesh,
            reduced_mesh,
            default_rgb,
            mesh_primitive_threshold: int,
            mesh_reduced_threshold: int,
            mesh_reduced_target: int,
            mesh_primitive_target: int):
        """
        Reduce meshes if needed and write detailed.ply / reduced.ply for one
        primitive index. Returns (primitive_mesh, resolutions_on_disk).
        """
        if detailed_mesh is None:
            return None, []

        face_count = detailed_mesh.Faces.Count
        reduced = None
        primitive = detailed_mesh
        resolutions = []

        primitive_dir = self.get_mesh_primitive_dir(
            snapshot_id, primitive_index)
        detailed_path = os.path.join(primitive_dir, 'detailed.ply')
        reduced_path = os.path.join(primitive_dir, 'reduced.ply')

        if os.path.exists(detailed_path) or os.path.exists(reduced_path):
            self._addWarning(
                f'PLY files already exist for snapshot {snapshot_id} '
                f'primitive {primitive_index}; skipping overwrite.'
            )
            if face_count > mesh_reduced_threshold:
                primitive = self.reduce_mesh(
                    detailed_mesh, mesh_primitive_target)
            elif face_count > mesh_primitive_threshold:
                primitive = self.reduce_mesh(
                    detailed_mesh, mesh_primitive_target)
            return primitive, []

        save_detailed = face_count > mesh_primitive_target
        save_reduced = face_count > mesh_reduced_threshold

        if face_count > mesh_reduced_threshold:
            reduced = self.reduce_mesh(detailed_mesh, mesh_reduced_target)
            primitive = self.reduce_mesh(detailed_mesh, mesh_primitive_target)
        elif face_count > mesh_primitive_threshold:
            primitive = self.reduce_mesh(detailed_mesh, mesh_primitive_target)

        try:
            if save_detailed:
                self.save_rhino_mesh_as_ply_binary(
                    detailed_mesh, detailed_path, default_rgb)
                resolutions.append('detailed')
            if save_reduced and reduced is not None:
                self.save_rhino_mesh_as_ply_binary(
                    reduced, reduced_path, default_rgb)
                resolutions.append('reduced')
            if resolutions:
                self._addRemark(
                    f'Staged PLY for primitive {primitive_index}: '
                    f'{", ".join(resolutions)}'
                )
        except Exception as e:
            self._addWarning(f'Failed to stage PLY files: {str(e)}')
            resolutions = []

        return primitive, resolutions

    def process_mesh_geometry(
        self,
        geometry: Rhino.Geometry.Mesh,
        snapshot_id: str,
        default_rgb,
        mesh_primitive_threshold: int = 8000,
        mesh_reduced_threshold: int = 15000,
        mesh_reduced_target: int = 10000,
        mesh_primitive_target: int = 500,
    ) -> tuple:
        """
        Returns (original, reduced, primitive_mesh, mesh_primitives dict).
        """
        primitive_mesh, resolutions = self._stage_mesh_ply_files(
            snapshot_id,
            0,
            geometry,
            None,
            default_rgb,
            mesh_primitive_threshold,
            mesh_reduced_threshold,
            mesh_reduced_target,
            mesh_primitive_target,
        )
        mesh_primitives = {}
        if resolutions:
            mesh_primitives['0'] = resolutions
        reduced_mesh = None
        if geometry.Faces.Count > mesh_reduced_threshold:
            reduced_mesh = self.reduce_mesh(geometry, mesh_reduced_target)
        return geometry, reduced_mesh, primitive_mesh, mesh_primitives

    def process_multiple_meshes_geometry(
            self,
            meshes,
            snapshot_id,
            default_rgb,
            mesh_primitive_threshold: int = 8000,
            mesh_reduced_threshold: int = 15000,
            mesh_reduced_target: int = 10000,
            mesh_primitive_target: int = 500):
        """Returns (primitive_meshes, mesh_primitives dict)."""
        if not meshes:
            return [], {}

        primitive_meshes = []
        mesh_primitives = {}

        for index, mesh in enumerate(meshes):
            if mesh is None:
                primitive_meshes.append(None)
                continue
            primitive_mesh, resolutions = self._stage_mesh_ply_files(
                snapshot_id,
                index,
                mesh,
                None,
                default_rgb,
                mesh_primitive_threshold,
                mesh_reduced_threshold,
                mesh_reduced_target,
                mesh_primitive_target,
            )
            primitive_meshes.append(primitive_mesh)
            if resolutions:
                mesh_primitives[str(index)] = resolutions

        return primitive_meshes, mesh_primitives

    def _stage_point_cloud_ply(
            self,
            snapshot_id: str,
            primitive_index: int,
            cloud,
            staging_threshold: int = POINT_CLOUD_STAGING_THRESHOLD):
        """Stage full PLY when point count exceeds inline preview cap."""
        if cloud is None or cloud.Count == 0:
            return {}

        if cloud.Count <= staging_threshold:
            return {}

        ply_path = self.get_point_cloud_staged_path(
            snapshot_id, primitive_index)
        if os.path.exists(ply_path):
            self._addWarning(
                f'Point cloud PLY already exists for snapshot {snapshot_id} '
                f'primitive {primitive_index}; skipping overwrite.'
            )
            return {}

        try:
            self.save_rhino_point_cloud_as_ply_binary(cloud, ply_path)
            self._addRemark(
                f'Staged point cloud PLY for primitive {primitive_index}'
            )
            return {str(primitive_index): ['ply']}
        except Exception as e:
            self._addWarning(f'Failed to stage point cloud PLY: {str(e)}')
            return {}

    def process_point_cloud_geometry(
            self,
            cloud: Rhino.Geometry.PointCloud,
            snapshot_id: str,
            staging_threshold: int = POINT_CLOUD_STAGING_THRESHOLD):
        """Returns (original, inline_cloud, point_cloud_primitives dict)."""
        staged = self._stage_point_cloud_ply(
            snapshot_id, 0, cloud, staging_threshold)
        return cloud, cloud, staged

    def process_multiple_point_clouds_geometry(
            self,
            clouds,
            snapshot_id: str,
            staging_threshold: int = POINT_CLOUD_STAGING_THRESHOLD):
        """Returns (clouds, point_cloud_primitives dict)."""
        if not clouds:
            return [], {}

        point_cloud_primitives = {}
        for index, cloud in enumerate(clouds):
            if cloud is None:
                continue
            staged = self._stage_point_cloud_ply(
                snapshot_id, index, cloud, staging_threshold)
            point_cloud_primitives.update(staged)

        return clouds, point_cloud_primitives

    def compute_pca_for_multiple_point_clouds(self, clouds):
        """
        Compute PCA for multiple point clouds as a whole assembly.
        Returns dimensions, principal components, translation vector,
        and bbx_origin.
        """
        if not clouds or len(clouds) == 0:
            return None, None, None, None

        all_points = []
        for cloud in clouds:
            if cloud is None:
                continue
            for i in range(cloud.Count):
                loc = cloud[i].Location
                all_points.append([loc.X, loc.Y, loc.Z])

        if not all_points:
            return None, None, None, None

        points_array = np.array(all_points)
        centroid = np.mean(points_array, axis=0)
        translation_vector = -centroid
        centered_points = points_array + translation_vector
        dimensions, principal_components, bbx_origin = (
            self.compute_obb_3d(centered_points)
        )
        return dimensions, principal_components, translation_vector, bbx_origin

    def compute_pca_for_multiple_meshes(self, meshes):
        """
        Compute PCA for multiple meshes as a whole assembly.
        Centers the assembly at origin before computing PCA.
        Returns dimensions, principal components, translation vector,
        and bbx_origin.
        """
        if not meshes or len(meshes) == 0:
            return None, None, None, None

        all_points = []
        for mesh in meshes:
            if mesh is None:
                continue
            for vertex in mesh.Vertices:
                all_points.append([vertex.X, vertex.Y, vertex.Z])

        if not all_points:
            return None, None, None, None

        points_array = np.array(all_points)

        # Center the assembly at origin (like single meshes)
        # Compute centroid of all points
        centroid = np.mean(points_array, axis=0)
        translation_vector = -centroid

        # Center the points
        centered_points = points_array + translation_vector

        # Compute PCA for the centered combined geometry
        dimensions, principal_components, bbx_origin = (
            self.compute_obb_3d(centered_points)
        )

        return dimensions, principal_components, translation_vector, bbx_origin

    def compute_pca_for_first_geometry_only(self, geometries):
        """
        Compute PCA from geometry at index 0 (Mesh or PointCloud).
        The same translation is applied to every item in the list.
        """
        first_geom = geometries[0]
        if first_geom is None:
            raise ValueError(
                'Geometry at index 0 must be set for multiple inputs '
                'when Assembly=False.'
            )
        centered_geom, translation_vector = (
            self.center_geometry_at_origin(first_geom)
        )
        centered_points, _ = self.process_geometry(centered_geom)
        dimensions, principal_components, bbx_origin = (
            self.compute_obb_3d(centered_points)
        )
        return dimensions, principal_components, translation_vector, bbx_origin

    def compute_pca_for_mixed_geometry(self, geometries):
        """
        Compute PCA from combined mesh vertices and point-cloud points.
        Used when Assembly=True and the geometry list mixes types.
        """
        all_points = []
        for geom in geometries:
            if geom is None:
                continue
            if isinstance(geom, Rhino.Geometry.Mesh):
                for vertex in geom.Vertices:
                    all_points.append([vertex.X, vertex.Y, vertex.Z])
            elif isinstance(geom, Rhino.Geometry.PointCloud):
                for i in range(geom.Count):
                    loc = geom[i].Location
                    all_points.append([loc.X, loc.Y, loc.Z])

        if not all_points:
            return None, None, None, None

        points_array = np.array(all_points)
        centroid = np.mean(points_array, axis=0)
        translation_vector = -centroid
        centered_points = points_array + translation_vector
        dimensions, principal_components, bbx_origin = (
            self.compute_obb_3d(centered_points)
        )
        return dimensions, principal_components, translation_vector, bbx_origin

    def process_mixed_geometry_list(
            self,
            geometries,
            snapshot_id: str,
            default_rgb,
            translation_vector,
            mesh_primitive_threshold: int,
            mesh_reduced_threshold: int,
            mesh_reduced_target: int,
            mesh_primitive_target: int,
            point_cloud_staging_threshold: int = POINT_CLOUD_STAGING_THRESHOLD):  # NOQA
        """
        Center, stage, and build inline primitives for a multi-item geometry
        list that may contain Meshes and/or PointClouds.
        """
        mesh_primitives = {}
        point_cloud_primitives = {}
        meshes_data = []
        point_clouds_data = []
        mesh_index = 0
        point_cloud_index = 0

        translation_xform = Rhino.Geometry.Transform.Translation(
            translation_vector[0],
            translation_vector[1],
            translation_vector[2],
        )

        for geom in geometries:
            if geom is None:
                continue

            centered = geom.Duplicate()
            centered.Transform(translation_xform)

            if isinstance(geom, Rhino.Geometry.Mesh):
                primitive_mesh, resolutions = self._stage_mesh_ply_files(
                    snapshot_id,
                    mesh_index,
                    centered,
                    None,
                    default_rgb,
                    mesh_primitive_threshold,
                    mesh_reduced_threshold,
                    mesh_reduced_target,
                    mesh_primitive_target,
                )
                if resolutions:
                    mesh_primitives[str(mesh_index)] = resolutions
                meshes_data.append(
                    self.mesh_to_inline_primitive(
                        primitive_mesh or centered,
                        default_rgb,
                    )
                )
                mesh_index += 1
            elif isinstance(geom, Rhino.Geometry.PointCloud):
                staged = self._stage_point_cloud_ply(
                    snapshot_id,
                    point_cloud_index,
                    centered,
                    point_cloud_staging_threshold,
                )
                point_cloud_primitives.update(staged)
                point_clouds_data.append(
                    self.point_cloud_to_inline_primitive(
                        centered,
                        max_points=POINT_CLOUD_INLINE_MAX,
                    )
                )
                point_cloud_index += 1
            else:
                raise RuntimeError(
                    'Mixed geometry lists support Mesh and PointCloud only; '
                    f'got {type(geom).__name__}'
                )

        geometry = {}
        if meshes_data:
            geometry['meshes'] = meshes_data
        if point_clouds_data:
            geometry['point_clouds'] = point_clouds_data
        return geometry, mesh_primitives, point_cloud_primitives

    def RunScript(self,
            ClearLocalStorage: bool,
            IdentityID: str,
            SnapshotID: str,
            Name: str,
            Complexity: int,
            Fragment: bool,
            Assembly: bool,
            Color: System.Drawing.Color,
            Location: Rhino.Geometry.Vector3d,
            Geometry: System.Collections.Generic.List[Rhino.Geometry.GeometryBase],
            MarkerPoints: System.Collections.Generic.List[Rhino.Geometry.Point3d],
            Condition,
            Notes,
            Quantity,
            Virtual: bool,
            Reinforcements: System.Collections.Generic.List[object]):

        # MESH REDUCTION SETTINGS
        # If mesh has tc above this but below reduced threshold,
        # only the primitive version will be computed
        MESH_PRIMITIVE_THRESHOLD = 8000
        # If mesh has tc above this, reduced and primitive versions
        # will be created
        MESH_REDUCED_THRESHOLD = 15000
        # target tc for reduced mesh
        MESH_REDUCED_TARGET = 10000
        # target tc for primitive mesh
        MESH_PRIMITIVE_TARGET = 500

        SnapshotData = Grasshopper.DataTree[System.Object]()
        try:
            if ClearLocalStorage:
                self._addRemark(
                    'Clearing pending_snapshot_assets directory...'
                )
                if self.clear_pending_snapshot_assets_directory():
                    self.Component.Message = (
                        'Local storage cleared successfully'
                    )
                else:
                    self.Component.Message = 'Failed to clear local storage'
                return SnapshotData

            self._addRemark(
                'Initializing snapshot create '
                'payload with schema validation...'
            )

            if not IdentityID:
                msg = 'Input IdentityID failed to collect data!'
                self._addWarning(msg)
                return SnapshotData
            elif not self.validate_uuid(IdentityID):
                msg = 'Input IdentityID is not a valid UUID! Aborting...'
                self._addError(msg)
                return SnapshotData

            if not SnapshotID:
                SnapshotID = str(uuid.uuid4())
                self._addRemark(f'Generated snapshot UUID: {SnapshotID}')
            elif not self.validate_uuid(SnapshotID):
                msg = 'Input SnapshotID is not a valid UUID! Aborting...'
                self._addError(msg)
                return SnapshotData

            if Complexity is None:
                msg = 'Input Complexity failed to collect data!'
                self._addWarning(msg)
                return SnapshotData
            if (not isinstance(Complexity, int) or
                    Complexity < 0 or Complexity > 3):
                msg = 'Input Complexity must be an integer between 0 and 3!'
                self._addError(msg)
                return SnapshotData

            if Fragment is None:
                Fragment = False
            if Assembly is None:
                Assembly = False
            if Virtual is None:
                Virtual = False

            location_data = None
            if Location is not None:
                location_data = {
                    'lat': Location.X,
                    'lon': Location.Y,
                }

            if Condition is not None:
                try:
                    Condition = int(Condition)
                except Exception:
                    self._addWarning(
                        'Input Condition must be an integer in '
                        '{0, 1, 2, 3}. Ignoring provided value: '
                        f'{Condition!r}.'
                    )
                    Condition = None
                if Condition not in (0, 1, 2, 3):
                    self._addWarning(
                        'Input Condition must be in {0, 1, 2, 3}. '
                        f'Ignoring out-of-range value: {Condition}.'
                    )
                    Condition = None

            if Notes is not None:
                Notes = str(Notes)
            if Quantity is not None:
                try:
                    Quantity = int(Quantity)
                except (TypeError, ValueError):
                    self._addWarning(
                        'Input Quantity must be an '
                        f'integer; ignoring {Quantity!r}'
                    )
                    Quantity = 1
                if Quantity < 1 or Quantity > 999_999:
                    self._addWarning(
                        'Input Quantity must be between 1 and 999999; using 1'
                    )
                    Quantity = 1

            if not Color:
                msg = ('Input Color failed to collect data. '
                       'Will use Grey as default Color.')
                self._addRemark(msg)
                Color = System.Drawing.Color.FromArgb(255, 175, 175, 175)
            if not Geometry:
                msg = 'Input Geometry failed to collect data!'
                self._addWarning(msg)
                return SnapshotData

            # TYPE FILTERING
            if not Geometry or len(Geometry) == 0:
                msg = 'Input Geometry is invalid!'
                self._addError(msg)
                return SnapshotData

            is_mixed_geometry = False
            is_point_cloud_assembly = False

            # Check if single or multiple objects
            if len(Geometry) == 1:
                # Single object validation
                single_geometry = Geometry[0]
                if not isinstance(
                    single_geometry,
                    (Rhino.Geometry.Mesh,
                     Rhino.Geometry.Extrusion,
                     Rhino.Geometry.PointCloud)
                ):
                    msg = (
                        'Expected a Mesh, Extrusion, or PointCloud '
                        'as geometry input! Please ensure and try again.'
                    )
                    raise ValueError(msg)
            else:
                non_null = [g for g in Geometry if g is not None]
                if not non_null:
                    msg = 'Input Geometry contains only null entries!'
                    raise ValueError(msg)
                for i, geom in enumerate(Geometry):
                    if geom is not None and not isinstance(
                            geom,
                            (Rhino.Geometry.Mesh,
                             Rhino.Geometry.PointCloud)):
                        msg = (
                            f'Geometry at index {i} must be Mesh or '
                            f'PointCloud; got {type(geom).__name__}.'
                        )
                        raise ValueError(msg)
                has_mesh = any(
                    isinstance(g, Rhino.Geometry.Mesh) for g in non_null)
                has_point_cloud = any(
                    isinstance(g, Rhino.Geometry.PointCloud) for g in non_null)
                is_mixed_geometry = has_mesh and has_point_cloud
                is_point_cloud_assembly = has_point_cloud and not has_mesh

            self.Component.Message = 'Processing snapshot...'
            default_rgb = (Color.R, Color.G, Color.B)

            # Process geometry to extract points and compute PCA
            if len(Geometry) == 1:
                # Handle single geometry (existing logic)
                single_geometry = Geometry[0]
                # Center geometry at world origin FIRST
                (centered_geometry, translation_vector) = (
                    self.center_geometry_at_origin(single_geometry)
                )
                centered_points, compute_3d = self.process_geometry(
                    centered_geometry
                )
                if compute_3d:
                    # centered_points = self.sample_points_for_pca_3d(
                    #     centered_geometry
                    # )
                    dimensions, principal_components, bbx_origin = (
                        self.compute_obb_3d(centered_points))
                else:
                    # 2D APPROACH, i.e. used for Extrusions
                    height = centered_geometry.PathStart.DistanceTo(
                        centered_geometry.PathEnd
                    )
                    dimensions, principal_components, bbx_origin = (
                        self.compute_obb_2d(
                            centered_points, height)
                    )
            else:
                if Assembly:
                    if is_mixed_geometry:
                        (dimensions, principal_components,
                         translation_vector, bbx_origin) = (
                            self.compute_pca_for_mixed_geometry(Geometry))
                    elif is_point_cloud_assembly:
                        (dimensions, principal_components,
                         translation_vector, bbx_origin) = (
                            self.compute_pca_for_multiple_point_clouds(
                                Geometry))
                    else:
                        (dimensions, principal_components,
                         translation_vector, bbx_origin) = (
                            self.compute_pca_for_multiple_meshes(Geometry))
                else:
                    (dimensions, principal_components, translation_vector,
                     bbx_origin) = (
                        self.compute_pca_for_first_geometry_only(Geometry))
                centered_geometry = None
                compute_3d = True

            schema = self.get_snapshot_payload_schema()

            # Process marker points - apply same transformation as geometry
            marker_points_data = []
            if MarkerPoints and len(MarkerPoints) > 0:
                for point in MarkerPoints:
                    if point is not None:
                        # Apply the same translation vector used for
                        # centering geometry
                        transformed_point = [
                            point.X + translation_vector[0],
                            point.Y + translation_vector[1],
                            point.Z + translation_vector[2]
                        ]
                        marker_points_data.append(transformed_point)

            payload = self.build_snapshot_payload(
                SnapshotID, IdentityID, Name, Complexity,
                Fragment, Assembly, Color, dimensions, location_data,
                principal_components, Condition, Notes, Quantity, Virtual,
            )
            payload['bbx_origin'] = bbx_origin
            if marker_points_data:
                payload['marker_points'] = marker_points_data

            mesh_primitives = {}
            point_cloud_primitives = {}

            # Process geometry input based on type
            if len(Geometry) == 1:
                # HANDLE SINGLE GEOMETRY
                single_geometry = Geometry[0]
                if isinstance(single_geometry, Rhino.Geometry.Mesh):
                    # Process single mesh
                    (_original_mesh,
                     _reduced_mesh,
                     primitive_mesh,
                     staged) = self.process_mesh_geometry(
                        centered_geometry,
                        SnapshotID,
                        default_rgb,
                        mesh_primitive_threshold=MESH_PRIMITIVE_THRESHOLD,
                        mesh_reduced_threshold=MESH_REDUCED_THRESHOLD,
                        mesh_reduced_target=MESH_REDUCED_TARGET,
                        mesh_primitive_target=MESH_PRIMITIVE_TARGET,
                    )
                    mesh_primitives.update(staged)
                    payload['geometry'] = {
                        'meshes': [
                            self.mesh_to_inline_primitive(
                                primitive_mesh, default_rgb)
                        ],
                    }

                elif isinstance(single_geometry, Rhino.Geometry.Extrusion):
                    # Handle single extrusion (existing logic)
                    # Get the profile curve from the CENTERED geometry and
                    # convert to polyline
                    if centered_geometry.ProfileCount > 1:
                        raise RuntimeError(
                            'Extrusion has more than one profile!'
                        )
                    # Get first profile
                    profile_curve = centered_geometry.Profile3d(0, 0.0)
                    if profile_curve is None:
                        raise RuntimeError('Extrusion has no profile curve!')

                    # Convert profile to polyline
                    _tgpr, polyline = profile_curve.TryGetPolyline()
                    if _tgpr is False:
                        polyline = profile_curve.ToPolyline(0.01, 0.01, 0, 0)
                    if polyline is None:
                        raise RuntimeError(
                            'Failed to convert profile curve to polyline!'
                        )

                    # Get height
                    height = centered_geometry.PathStart.DistanceTo(
                        centered_geometry.PathEnd)

                    payload['geometry'] = {
                        'extrusions': [{
                            'profile': [[p.X, p.Y] for p in polyline],
                            'height': height,
                        }],
                    }

                elif isinstance(single_geometry, Rhino.Geometry.PointCloud):
                    (_original_cloud,
                     _inline_cloud,
                     staged) = self.process_point_cloud_geometry(
                        centered_geometry,
                        SnapshotID,
                        staging_threshold=POINT_CLOUD_STAGING_THRESHOLD,
                    )
                    point_cloud_primitives.update(staged)
                    payload['geometry'] = {
                        'point_clouds': [
                            self.point_cloud_to_inline_primitive(
                                centered_geometry,
                                max_points=POINT_CLOUD_INLINE_MAX,
                            )
                        ],
                    }
            else:
                geometry_data, staged_meshes, staged_point_clouds = (
                    self.process_mixed_geometry_list(
                        Geometry,
                        SnapshotID,
                        default_rgb,
                        translation_vector,
                        mesh_primitive_threshold=MESH_PRIMITIVE_THRESHOLD,
                        mesh_reduced_threshold=MESH_REDUCED_THRESHOLD,
                        mesh_reduced_target=MESH_REDUCED_TARGET,
                        mesh_primitive_target=MESH_PRIMITIVE_TARGET,
                        point_cloud_staging_threshold=(
                            POINT_CLOUD_STAGING_THRESHOLD
                        ),
                    )
                )
                payload['geometry'] = geometry_data
                mesh_primitives.update(staged_meshes)
                point_cloud_primitives.update(staged_point_clouds)

            centered_reinforcements = self.build_centered_reinforcements(
                Reinforcements,
                translation_vector,
            )
            if centered_reinforcements:
                payload['geometry']['reinforcements'] = centered_reinforcements

            if mesh_primitives or point_cloud_primitives:
                self.write_staging_manifest(
                    IdentityID,
                    SnapshotID,
                    mesh_primitives=mesh_primitives or None,
                    point_cloud_primitives=point_cloud_primitives or None,
                )

            if not self.validate_snapshot_payload(payload, schema):
                self._addWarning(
                    'Snapshot payload validation failed, but continuing...'
                )

            SnapshotData = json.dumps(payload)

            self.Component.Message = (
                f'Built snapshot payload {SnapshotID} '
                f'for identity {IdentityID}'
            )
            self._addRemark(
                f'Created snapshot payload {SnapshotID}'
            )

            return SnapshotData

        except ValueError as e:
            msg = f'Validation error: {str(e)}'
            self._addError(msg)

        except RuntimeError as e:
            msg = f'Runtime error: {str(e)}'
            self._addError(msg)

        except Exception as e:
            msg = f'Unexpected error: {str(e)}'
            self._addError(msg)
            raise e

        return SnapshotData
# ---------- end createcomponentsnapshot ----------
snapshotdata = Data(createcomponentsnapshot)

# ----
source_folder = Panel("..\grasshopper_userobjects_xml")

# ----
# comments & notes: Arrange Components in a Grid
spacing = Slider(150, range=0..1000)
componentdata_13 = Data(componentdata_8)
insertionpoint = Point(Point(2500, 0, 0))
createarrangement = CreateArrangement(ComponentData=componentdata_13, Spacing=spacing, InsertionPoint=insertionpoint)  # -> GridCells, GridPlanes, XForms; inputs ComponentData: tree, Spacing: Double, InsertionPoint: Point3d
# ---------- createarrangement: Python ----------
#! python3
# -*- coding: utf-8 -*-
# venv: DDU_CSC
print('ENV OK!')
# r: charset_normalizer
# r: requests

# PYTHON STANDARD LIBRARY IMPORTS ---------------------------------------------
import json  # NOQA
import math  # NOQA

# RHINO AND GH RELATED IMPORTS ------------------------------------------------
import System  # NOQA
import Rhino  # NOQA
import Grasshopper  # NOQA

# GHENV COMPONENT SETTINGS ----------------------------------------------------
ghenv.Component.Name = 'CreateArrangement'  # NOQA
ghenv.Component.NickName = 'CreateArrangement'  # NOQA
ghenv.Component.Category = 'DDU_CSC'  # NOQA
ghenv.Component.SubCategory = '8 Visualization'  # NOQA
ghenv.Component.Description = (  # NOQA
    'Arranges components in an even square grid based on their snapshot '
    'bounding boxes. Calculates grid cell size from the largest component '
    'dimension.'
)


class CSC_CreateArrangement(Grasshopper.Kernel.GH_ScriptInstance):
    """
    Author: Max Benjamin Eschenbach
    License: MIT License
    Version: 260908
    """

    def __init__(self):
        """Initialize this component and set component parameters."""
        super().__init__()
        # initialize props
        self.Component = ghenv.Component  # NOQA
        self.InputParams = self.Component.Params.Input
        self.OutputParams = self.Component.Params.Output

    def _addRemark(self, msg: str = ''):
        """Add a remark message to the component."""
        rml = self.Component.RuntimeMessageLevel.Remark
        self.AddRuntimeMessage(rml, msg)

    def _addWarning(self, msg: str = ''):
        """Add a warning message to the component."""
        rml = self.Component.RuntimeMessageLevel.Warning
        self.AddRuntimeMessage(rml, msg)

    def _addError(self, msg: str = ''):
        """Add an error message to the component."""
        rml = self.Component.RuntimeMessageLevel.Error
        self.AddRuntimeMessage(rml, msg)

    def BeforeRunScript(self):
        """Perform some setup actions."""
        # Initialize input param descriptions
        self.InputParams[0].Description = (
            'Passport JSON strings ({identity, snapshots[]})'
        )
        self.InputParams[1].Description = (
            'Additional spacing between grid cells'
        )
        self.InputParams[2].Description = (
            'Insertion point (starting corner of grid)'
        )
        # Initialize output param descriptions
        i = 0
        if self.OutputParams[0].Name == 'out':
            i += 1
        self.OutputParams[0+i].Description = (
            'Grid cell outlines as polylines'
        )
        self.OutputParams[1+i].Description = (
            'XY planes at center of each grid cell'
        )
        self.OutputParams[2+i].Description = (
            'Transformations from world origin to grid cell planes'
        )

    def _primary_snapshot(self, passport):
        """Return the first snapshot from a passport payload."""
        if not isinstance(passport, dict):
            return {}
        snapshots = passport.get('snapshots') or []
        if snapshots and isinstance(snapshots[0], dict):
            return snapshots[0]
        legacy = passport.get('snapshot')
        if isinstance(legacy, dict):
            return legacy
        return {}

    def extract_bounding_box_dimensions(self, component_data):
        """
        Extract bounding box dimensions from passport JSON.

        Args:
            component_data: Passport JSON string or dict
                ({identity, snapshots[]})

        Returns:
            Tuple of (xtx, xty, xtz) dimensions or None
        """
        try:
            if isinstance(component_data, dict):
                passport = component_data
            elif isinstance(component_data, str):
                passport = json.loads(component_data.strip())
            else:
                passport = json.loads(str(component_data))
            snapshot = self._primary_snapshot(passport)
            bbx = snapshot.get('bbx')
            if isinstance(bbx, (list, tuple)) and len(bbx) >= 3:
                return float(bbx[0]), float(bbx[1]), float(bbx[2])
            return None
        except (json.JSONDecodeError, KeyError, TypeError, ValueError):
            return None

    def calculate_grid_size(self, count: int):
        """
        Calculate grid dimensions for a square grid.

        Returns:
            Tuple of (grid_size_x, grid_size_y, cells_needed)
        """
        grid_size = int(math.ceil(math.sqrt(count)))
        cells_needed = grid_size * grid_size
        return grid_size, grid_size, cells_needed

    def create_grid_cell_polyline(
            self, cell_size: float,
            center_point: Rhino.Geometry.Point3d):
        """
        Create a square cell polyline centered at given point.

        Args:
            cell_size: Size of the grid cell
            center_point: Center point of the cell

        Returns:
            Polyline outlining the cell
        """
        half_size = cell_size * 0.5

        # Create corners relative to center
        x_min = center_point.X - half_size
        x_max = center_point.X + half_size
        y_min = center_point.Y - half_size
        y_max = center_point.Y + half_size
        z = center_point.Z

        corners = [
            Rhino.Geometry.Point3d(x_min, y_min, z),
            Rhino.Geometry.Point3d(x_max, y_min, z),
            Rhino.Geometry.Point3d(x_max, y_max, z),
            Rhino.Geometry.Point3d(x_min, y_max, z),
            Rhino.Geometry.Point3d(x_min, y_min, z)
        ]

        return Rhino.Geometry.Polyline(corners)

    def RunScript(self,
            ComponentData: Grasshopper.DataTree[object],
            Spacing: float,
            InsertionPoint: Rhino.Geometry.Point3d):

        # Default values for optional parameters
        if Spacing is None:
            Spacing = 100.0
        if InsertionPoint is None:
            InsertionPoint = Rhino.Geometry.Point3d(0.0, 0.0, 0.0)

        # Set up output trees
        GridCells = Grasshopper.DataTree[Rhino.Geometry.Polyline]()
        GridPlanes = Grasshopper.DataTree[Rhino.Geometry.Plane]()
        XForm = Grasshopper.DataTree[Rhino.Geometry.Transform]()

        # Validate input
        if not ComponentData or ComponentData.DataCount == 0:
            msg = 'No component data provided'
            self._addWarning(msg)
            self.Component.Message = msg
            return GridCells, GridPlanes, XForm

        try:
            # Extract bounding box dimensions for all components
            all_dimensions = []
            paths = []
            for i, branch in enumerate(ComponentData.Branches):
                branch_path = ComponentData.Paths[i]
                for comp_data in branch:
                    if comp_data is None:
                        continue
                    dims = self.extract_bounding_box_dimensions(comp_data)
                    if dims:
                        all_dimensions.append(dims)
                        paths.append(branch_path)
            if not all_dimensions:
                msg = 'No valid bounding boxes in component data'
                self._addWarning(msg)
                self.Component.Message = msg
                return GridCells, GridPlanes, XForm
            # Find the largest x and y dimensions to determine grid cell size
            max_x_dim = max(dims[0] for dims in all_dimensions)
            max_y_dim = max(dims[1] for dims in all_dimensions)
            cell_size = max(max_x_dim, max_y_dim) + Spacing
            # Calculate grid layout
            comp_count = len(all_dimensions)
            grid_x, grid_y, cells_needed = self.calculate_grid_size(comp_count)
            # Adjust to fit exact number of components
            arranged_count = min(comp_count, cells_needed)
            # Create grid cells
            for i in range(arranged_count):
                # Calculate grid position (row, col)
                row = i // grid_x
                col = i % grid_x
                # Calculate center point for this cell
                center_x = InsertionPoint.X + col * cell_size + cell_size * 0.5
                center_y = InsertionPoint.Y + row * cell_size + cell_size * 0.5
                cell_center = Rhino.Geometry.Point3d(
                    center_x,
                    center_y,
                    InsertionPoint.Z
                )
                # Create grid cell outline
                grid_cell = self.create_grid_cell_polyline(
                    cell_size, cell_center)
                GridCells.Add(grid_cell, paths[i])
                # Create plane at center of grid cell
                grid_plane = Rhino.Geometry.Plane(
                    cell_center,
                    Rhino.Geometry.Vector3d.XAxis,
                    Rhino.Geometry.Vector3d.YAxis
                )
                GridPlanes.Add(grid_plane, paths[i])

                # Create transform from world origin to grid cell plane
                world_plane = Rhino.Geometry.Plane.WorldXY
                xform = Rhino.Geometry.Transform.PlaneToPlane(
                    world_plane, grid_plane)
                XForm.Add(xform, paths[i])

            # Update component message
            if arranged_count < comp_count:
                self._addWarning(
                    f'Arranged {arranged_count} of {comp_count} components')
            else:
                self._addRemark(
                    f'Arranged {arranged_count} components in '
                    f'{grid_x}x{grid_y} grid')

            return GridCells, GridPlanes, XForm

        except Exception as e:
            msg = f'Error arranging components: {str(e)}'
            self._addError(msg)
            self.Component.Message = msg
            return GridCells, GridPlanes, XForm
# ---------- end createarrangement ----------
xform = Data(createarrangement.XForms)

# ---- group: __DDU_CSC_EXAMPLE_07__
# ParentIdentity: IMPORTANT: Here goes the UUID of the parent component (the component that your new, cut to shape piece was made from!)
parentidentity = Panel("")

# Step 2
# comments & notes: Here we create a new component identity (locally).
# 
# Most of the fields are already pre-set for you.
# You need to adjust:
# - Name
# - Dataset
# - Color
# - Parent Identity ID if applicable(Important!)
component_name_2 = Panel("Reinforcement Test 01")
complexity_6 = ValueList({"0 (simple)": 0, "1 (average)": 1, "2 (complex)": 2, "3 (very complex)": 3}, selected="2 (complex)")
clearlocalstorage_2 = Button()
material_5 = ValueList({"corian", "concrete", "timber", "aluminium", "steel"}, selected="concrete")
transmittedidentityid = Data(componentid_2)
type_5 = ValueList({"panel", "beam", "column", "slab", "rubble", "brick", "pipe", "profile", "connector", "other"}, selected="rubble")
fragment_6 = BooleanToggle(True)
assembly_2 = BooleanToggle(False)
color_2 = ColourSwatch(SwatchColor=RGB(189, 189, 189))
location_4 = Data(location_2)
geometry_2 = Data(samplemeshgeometry_2)
createcomponentidentity = CreateComponentIdentity(
    ClearLocalStorage=clearlocalstorage_2,
    IdentityID=transmittedidentityid,
    Name=component_name_2,
    Type=type_5,
    Material=material_5,
    Dataset="demo",
    Complexity=complexity_6,
    Fragment=fragment_6,
    Assembly=assembly_2,
    Color=color_2,
    Location=location_4,
    Geometry=geometry_2,
    ParentIdentity=parentidentity,
    Reinforcements=createreinforcement.ReinforcementJson)  # -> ComponentData; inputs ClearLocalStorage: Boolean, IdentityID: String, Name: String, Type: String, Material: String, Dataset: String, Complexity: Int32, Fragment: Boolean, Assembly: Boolean, Color: Color, Location: Vector3d, Geometry: list of GeometryBase, MarkerPoints: list of Point3d, Reinforcements: list
# ---------- createcomponentidentity: Python ----------
#! python3
# -*- coding: utf-8 -*-
# venv: DDU_CSC
print('ENV OK!')
# r: charset_normalizer
# r: requests
# r: numpy
# r: scipy
# r: scikit-learn

# PYTHON STANDARD LIBRARY IMPORTS ---------------------------------------------
import json  # NOQA
import struct  # NOQA
import uuid  # NOQA
import os  # NOQA
import platform  # NOQA

# THIRD PARTY LIBRARY IMPORTS -------------------------------------------------
import numpy as np  # NOQA
from scipy.spatial import ConvexHull  # NOQA
from sklearn.decomposition import PCA  # NOQA

# RHINO AND GH RELATED IMPORTS ------------------------------------------------
import System  # NOQA
import Grasshopper  # NOQA
import Rhino  # NOQA
import scriptcontext as sc  # NOQA

# One PCA sample per this many mm of triangle area (3D mesh path).
REFERENCE_FACE_AREA_MM2 = 100.0

# Inline JSON preview cap; full cloud staged as PLY above this count.
POINT_CLOUD_INLINE_MAX = 5000
POINT_CLOUD_STAGING_THRESHOLD = 5000

# GHENV COMPONENT SETTINGS ----------------------------------------------------
ghenv.Component.Name = 'CreateComponentIdentity'  # NOQA
ghenv.Component.NickName = 'CreateComponentIdentity'  # NOQA
ghenv.Component.Category = 'DDU_CSC'  # NOQA
ghenv.Component.SubCategory = '3 Component Operations'  # NOQA
ghenv.Component.Description = (  # NOQA
    'Builds a POST /identities payload (CreateComponentRequest) from Rhino '
    'geometry. Computes PCA orientation, mesh reduction, stages binary PLY '
    'mesh files under pending_identity_assets/{identity_id}/meshes/<i>/ and '
    'point cloud PLY files under .../point_clouds/<i>.ply.'
)


class CSC_CreateComponentIdentity(Grasshopper.Kernel.GH_ScriptInstance):
    """
    Author: Max Benjamin Eschenbach
    License: MIT License
    Version: 260826
    """

    def __init__(self):
        """Initialize this component and set component parameters."""
        super().__init__()
        # initialize props
        self.Component = ghenv.Component  # NOQA
        self.InputParams = self.Component.Params.Input
        self.OutputParams = self.Component.Params.Output

    def _addRemark(self, msg: str = ''):
        """Add a remark message to the component."""
        rml = self.Component.RuntimeMessageLevel.Remark
        self.AddRuntimeMessage(rml, msg)

    def _addWarning(self, msg: str = ''):
        """Add a warning message to the component."""
        rml = self.Component.RuntimeMessageLevel.Warning
        self.AddRuntimeMessage(rml, msg)

    def _addError(self, msg: str = ''):
        """Add an error message to the component."""
        rml = self.Component.RuntimeMessageLevel.Error
        self.AddRuntimeMessage(rml, msg)

    def BeforeRunScript(self):
        """Perform some setup actions."""
        # Initialize input param descriptions
        self.InputParams[0].Description = (
            'If True, clears pending_identity_assets staging '
            '(does not affect Session API cache)'
        )
        self.InputParams[1].Description = (
            'Identity ID from physical tag (valid UUID)'
        )
        self.InputParams[2].Description = (
            'Component Name (e.g. My Beam 01)'
        )
        self.InputParams[3].Description = (
            'Component type (e.g., "panel", "rubble"). Must be one of '
            'the values exposed by the backend component type enum.'
        )
        self.InputParams[4].Description = (
            'Material type (e.g., "steel", "concrete", "wood")'
        )
        self.InputParams[5].Description = (
            'Dataset that this component belongs to '
            '(i.e. my_rubble_dataset)'
        )
        self.InputParams[6].Description = (
            'Complexity level '
            '(0=simple, 1=normal, 2=complex, 3=very complex)'
        )
        self.InputParams[7].Description = (
            'Fragment status (True for fragments, False for complete)'
        )
        self.InputParams[8].Description = (
            'Assembly status (True for assemblies, False for individual)'
        )
        self.InputParams[9].Description = (
            'Component color (System.Drawing.Color)'
        )
        self.InputParams[10].Description = (
            'Location as Vector3d (X=latitude, Y=longitude, Z ignored)'
        )
        self.InputParams[11].Description = (
            'Rhino geometry — Mesh, Extrusion, or PointCloud. Lists may '
            'mix Meshes and PointClouds. Extrusion is single-object only. '
            'Panel type: Mesh or Extrusion; rubble: Mesh or PointCloud.'
        )
        self.InputParams[12].Description = (
            'Marker points as list of Point3d objects for component '
            'identification and positioning'
        )
        self.InputParams[13].Description = (
            'Optional condition grade. Integer in {0, 1, 2, 3}: '
            '0=destroyed/retired, 1=poor, 2=average, 3=good. '
            'Leave unconnected for "unknown".'
        )
        self.InputParams[14].Description = (
            'Optional ISO-8601 UTC timestamp for when the component was '
            'originally manufactured (e.g. "1998-06-01T00:00:00Z").'
        )
        self.InputParams[15].Description = (
            'Optional precision qualifier for ManufacturedAt. One of '
            '"exact", "month", "year", "unknown".'
        )
        self.InputParams[16].Description = (
            'Optional short text describing where the component was '
            'salvaged from (e.g. building name, demolition site).'
        )
        self.InputParams[17].Description = (
            'Optional ISO-8601 UTC timestamp for when the component was '
            'salvaged (e.g. "2024-11-03T00:00:00Z").'
        )
        self.InputParams[18].Description = (
            'Optional parent identity UUID (lineage after split/merge)'
        )
        self.InputParams[19].Description = (
            'Optional free-text notes for the initial snapshot (max 5000)'
        )
        self.InputParams[20].Description = (
            'Count of identical physical items (integer >= 1, default 1)'
        )
        if len(self.InputParams) > 21:
            self.InputParams[21].Description = (
                'Optional reinforcement JSON strings from CreateReinforcement '
                '(one or many; merged into geometry.reinforcements)'
            )
        # Initialize output param descriptions
        i = 0
        if self.OutputParams[0].Name == 'out':
            i += 1
        self.OutputParams[0+i].Description = (
            'CreateComponentRequest JSON for POST /identities '
            '(inline geometry + staged mesh and point-cloud PLY manifest)'
        )

    def get_auth_core_from_sticky(self):
        """Get AuthCore instance from sticky storage."""
        auth_core = sc.sticky.get('CSC_AuthCore')
        if auth_core is None:
            self._addWarning(
                'No authentication found. Using hardcoded create schema.'
            )
            return None
        return auth_core

    def get_create_payload_schema(self):
        """Get CreateComponentRequest schema from Session cache or fallback."""
        auth_core = self.get_auth_core_from_sticky()
        if auth_core and hasattr(auth_core, 'get_create_identity_schema'):
            try:
                schema = auth_core.get_create_identity_schema()
                if schema:
                    self._addRemark('Using cached create-identity schema')
                    return schema
                self._addWarning(
                    'Failed to get cached create-identity schema; '
                    'using hardcoded fallback'
                )
            except Exception as e:
                self._addWarning(
                    f'Error fetching create-identity schema: {e}; '
                    'using hardcoded fallback'
                )

        self._addRemark('Using hardcoded create-identity schema')
        return self.get_hardcoded_create_schema()

    def get_hardcoded_create_schema(self):
        """
        Minimal CreateComponentRequest schema when Session is unavailable.
        """
        return {
            'type': 'object',
            'required': [
                'type', 'material', 'dataset', 'complexity', 'fragment',
                'assembly', 'geometry', 'bbx', 'bbx_origin', 'iframe',
                'pca_frame',
            ],
            'properties': {
                '_id': {'type': 'string'},
                'name': {'type': 'string'},
                'type': {'type': 'string'},
                'material': {'type': 'string'},
                'dataset': {'type': 'string'},
                'complexity': {'type': 'integer'},
                'fragment': {'type': 'boolean'},
                'assembly': {'type': 'boolean'},
                'geometry': {'type': 'object'},
                'color': {'type': 'array'},
                'bbx': {'type': 'array'},
                'bbx_origin': {'type': 'array'},
                'location': {'type': 'object'},
                'iframe': {'type': 'object'},
                'pca_frame': {'type': 'object'},
                'validated': {'type': 'boolean'},
                'marker_points': {'type': 'array'},
                'parent_identities': {'type': 'array'},
                'notes': {'type': 'string'},
                'quantity': {'type': 'integer'},
            },
        }

    def validate_create_payload(self, payload, schema):
        """Validate create payload against schema required fields."""
        try:
            required_fields = schema.get('required', [])
            missing_fields = [
                field for field in required_fields if field not in payload
            ]
            if missing_fields:
                self._addError(
                    f'Missing required fields: {", ".join(missing_fields)}'
                )
                return False

            if not isinstance(payload.get('complexity'), int):
                self._addError('complexity must be an integer')
                return False
            if not isinstance(payload.get('fragment'), bool):
                self._addError('fragment must be a boolean')
                return False
            if not isinstance(payload.get('assembly'), bool):
                self._addError('assembly must be a boolean')
                return False

            color = payload.get('color', [])
            if color and (not isinstance(color, list) or len(color) != 3):
                self._addError('color must be a list of 3 integers [R, G, B]')
                return False

            if not isinstance(payload.get('iframe'), dict):
                self._addError('iframe must be a frame object')
                return False
            if not isinstance(payload.get('pca_frame'), dict):
                self._addError('pca_frame must be a frame object')
                return False

            geometry = payload.get('geometry') or {}
            if not (
                geometry.get('meshes')
                or geometry.get('extrusions')
                or geometry.get('point_clouds')
            ):
                self._addError(
                    'geometry must include meshes, extrusions, or point_clouds'
                )
                return False

            return True

        except Exception as e:
            self._addError(f'Validation error: {str(e)}')
            return False

    def normalize_reinforcement_json_input(self, reinforcements_input):
        """Flatten optional reinforcement JSON input to a list of strings."""
        entries = []
        if reinforcements_input is None:
            return entries

        if isinstance(reinforcements_input, str):
            raw = reinforcements_input.strip()
            if raw:
                entries.append(raw)
            return entries

        if isinstance(
            reinforcements_input,
            Grasshopper.Kernel.Data.GH_Structure
        ):
            for obj in reinforcements_input.AllData(True):
                if obj is None:
                    continue
                raw = str(obj).strip()
                if raw:
                    entries.append(raw)
            return entries

        try:
            for item in reinforcements_input:
                if item is None:
                    continue
                raw = str(item).strip()
                if raw:
                    entries.append(raw)
        except TypeError:
            raw = str(reinforcements_input).strip()
            if raw:
                entries.append(raw)
        return entries

    def build_centered_reinforcements(
            self,
            reinforcements_input,
            translation_vector):
        """Parse reinforcement JSON strings and apply centering translation."""
        json_entries = self.normalize_reinforcement_json_input(
            reinforcements_input)
        if not json_entries:
            return []

        tx = float(translation_vector[0])
        ty = float(translation_vector[1])
        tz = float(translation_vector[2])
        centered = []

        for idx, raw in enumerate(json_entries):
            try:
                data = json.loads(raw)
            except (TypeError, ValueError) as exc:
                self._addWarning(
                    f'Reinforcement {idx}: invalid JSON ({exc})'
                )
                continue
            if not isinstance(data, dict):
                self._addWarning(
                    f'Reinforcement {idx}: expected JSON object'
                )
                continue

            spec = str(data.get('spec', '')).strip()
            diameter = data.get('diameter')
            points = data.get('points')
            if not spec:
                self._addWarning(f'Reinforcement {idx}: spec is required')
                continue
            try:
                diameter = float(diameter)
            except (TypeError, ValueError):
                self._addWarning(
                    f'Reinforcement {idx}: diameter must be a number'
                )
                continue
            if diameter <= 0:
                self._addWarning(
                    f'Reinforcement {idx}: diameter must be > 0'
                )
                continue
            if not isinstance(points, list) or len(points) < 2:
                self._addWarning(
                    f'Reinforcement {idx}: at least 2 points required'
                )
                continue

            centered_points = []
            valid = True
            for pt in points:
                if (not isinstance(pt, (list, tuple))
                        or len(pt) != 3):
                    self._addWarning(
                        f'Reinforcement {idx}: invalid point {pt}'
                    )
                    valid = False
                    break
                centered_points.append([
                    float(pt[0]) + tx,
                    float(pt[1]) + ty,
                    float(pt[2]) + tz,
                ])
            if not valid:
                continue

            centered.append({
                'spec': spec,
                'diameter': diameter,
                'points': centered_points,
            })

        return centered

    def build_create_payload(
            self,
            identity_id: str,
            name: str,
            component_type: str,
            material: str,
            dataset: str,
            complexity: int,
            fragment: bool,
            assembly: bool,
            color,
            dimensions,
            location_data,
            principal_components,
            condition,
            manufactured_at,
            manufactured_precision,
            salvage_source,
            salvaged_at,
            parent_identity,
            notes,
            quantity):
        """Build POST /identities JSON body (CreateComponentRequest)."""
        payload = {
            '_id': identity_id,
            'type': component_type,
            'material': material,
            'dataset': dataset,
            'complexity': int(complexity),
            'fragment': bool(fragment),
            'assembly': bool(assembly),
            'geometry': {},
            'color': [color.R, color.G, color.B],
            'bbx': dimensions,
            'bbx_origin': [0.0, 0.0, 0.0],
            'location': location_data or {'lat': 0.0, 'lon': 0.0},
            'descriptors': {},
            'processes': {},
            'attributes': {},
            'iframe': {
                'o': [0.0, 0.0, 0.0],
                'x': [1.0, 0.0, 0.0],
                'y': [0.0, 1.0, 0.0],
                'z': [0.0, 0.0, 1.0],
            },
            'pca_frame': {
                'o': [0.0, 0.0, 0.0],
                'x': principal_components[0].tolist(),
                'y': principal_components[1].tolist(),
                'z': principal_components[2].tolist(),
            },
            'validated': False,
        }

        trimmed_name = (name or '').strip()
        if trimmed_name:
            payload['name'] = trimmed_name

        if condition is not None:
            payload['condition'] = condition
        if manufactured_at:
            payload['manufactured_at'] = manufactured_at
        if manufactured_precision:
            payload['manufactured_precision'] = manufactured_precision
        if salvage_source:
            payload['salvage_source'] = salvage_source
        if salvaged_at:
            payload['salvaged_at'] = salvaged_at
        if parent_identity:
            payload['parent_identities'] = [parent_identity]

        trimmed_notes = (notes or '').strip()
        if trimmed_notes:
            payload['notes'] = trimmed_notes[:5000]

        try:
            qty = int(quantity) if quantity is not None else 1
        except (TypeError, ValueError):
            qty = 1
        qty = max(1, min(999_999, qty))
        if qty != 1:
            payload['quantity'] = qty

        return payload

    def mesh_to_inline_primitive(self, mesh, default_rgb):
        """SnapshotMesh dict (vertices/faces/colors, Rhino Z-up)."""
        vertices = [[p.X, p.Y, p.Z] for p in mesh.Vertices]
        faces = []
        for face in mesh.Faces:
            if face.IsTriangle:
                faces.append([face.A, face.B, face.C])
            elif face.IsQuad:
                faces.append([face.A, face.B, face.C])
                faces.append([face.A, face.C, face.D])

        if mesh.VertexColors.Count > 0:
            colors = [
                [mesh.VertexColors[i].R, mesh.VertexColors[i].G,
                 mesh.VertexColors[i].B]
                for i in range(mesh.Vertices.Count)
            ]
        else:
            colors = [list(default_rgb)] * len(vertices)

        return {
            'vertices': vertices,
            'faces': faces,
            'colors': colors,
        }

    def save_rhino_mesh_as_ply_binary(self, mesh, file_path, default_rgb):
        """Write binary little-endian PLY (Rhino Z-up) with per-vertex RGB."""
        vertices = []
        colors = []
        has_vc = mesh.VertexColors.Count > 0
        for i in range(mesh.Vertices.Count):
            v = mesh.Vertices[i]
            vertices.append((v.X, v.Y, v.Z))
            if has_vc and i < mesh.VertexColors.Count:
                c = mesh.VertexColors[i]
                colors.append((c.R, c.G, c.B))
            else:
                colors.append(default_rgb)

        faces = []
        for face in mesh.Faces:
            if face.IsTriangle:
                faces.append((face.A, face.B, face.C))
            elif face.IsQuad:
                faces.append((face.A, face.B, face.C))
                faces.append((face.A, face.C, face.D))

        header = (
            'ply\n'
            'format binary_little_endian 1.0\n'
            f'element vertex {len(vertices)}\n'
            'property float x\n'
            'property float y\n'
            'property float z\n'
            'property uchar red\n'
            'property uchar green\n'
            'property uchar blue\n'
            f'element face {len(faces)}\n'
            'property list uchar int vertex_indices\n'
            'end_header\n'
        )

        os.makedirs(os.path.dirname(file_path), exist_ok=True)
        with open(file_path, 'wb') as handle:
            handle.write(header.encode('ascii'))
            for (x, y, z), (r, g, b) in zip(vertices, colors):
                handle.write(struct.pack('<fffBBB', x, y, z, r, g, b))
            for tri in faces:
                handle.write(struct.pack('<Biii', 3, tri[0], tri[1], tri[2]))

    def point_cloud_to_inline_primitive(
            self,
            cloud,
            max_points: int = POINT_CLOUD_INLINE_MAX):
        """Build inline point_cloud primitive with optional subsampling."""
        count = cloud.Count
        if count == 0:
            raise RuntimeError('Point cloud is empty')

        if count > max_points:
            step = count / float(max_points)
            indices = [
                min(int(round(i * step)), count - 1)
                for i in range(max_points)
            ]
        else:
            indices = list(range(count))

        points = []
        colors = []
        has_colors = False
        for i in indices:
            item = cloud[i]
            loc = item.Location
            points.append([loc.X, loc.Y, loc.Z])
            color = item.Color
            if color.IsEmpty:
                colors.append([128, 128, 128])
            else:
                has_colors = True
                colors.append([color.R, color.G, color.B])

        result = {'points': points}
        if has_colors:
            result['colors'] = colors
        return result

    def save_rhino_point_cloud_as_ply_binary(self, cloud, file_path):
        """Write binary little-endian PLY (vertices only) from a PointCloud."""
        vertices = []
        colors = []
        for i in range(cloud.Count):
            item = cloud[i]
            loc = item.Location
            vertices.append((loc.X, loc.Y, loc.Z))
            color = item.Color
            if color.IsEmpty:
                colors.append((128, 128, 128))
            else:
                colors.append((color.R, color.G, color.B))

        header = (
            'ply\n'
            'format binary_little_endian 1.0\n'
            f'element vertex {len(vertices)}\n'
            'property float x\n'
            'property float y\n'
            'property float z\n'
            'property uchar red\n'
            'property uchar green\n'
            'property uchar blue\n'
            'end_header\n'
        )

        os.makedirs(os.path.dirname(file_path), exist_ok=True)
        with open(file_path, 'wb') as handle:
            handle.write(header.encode('ascii'))
            for (x, y, z), (r, g, b) in zip(vertices, colors):
                handle.write(struct.pack('<fffBBB', x, y, z, r, g, b))

    def center_geometry_at_origin(self, geometry):
        """
        Center geometry at its centroid.
        Returns centered geometry and translation vector.
        """
        if isinstance(geometry, Rhino.Geometry.PointCloud):
            if geometry.Count == 0:
                raise RuntimeError('Point cloud is empty')
            bbox = geometry.GetBoundingBox(True)
            volume_centroid = bbox.Center
        else:
            # Get the volume centroid of the geometry
            vmp = Rhino.Geometry.VolumeMassProperties.Compute(geometry)
            volume_centroid = vmp.Centroid
            if volume_centroid is None:
                # Fallback to bounding box centroid if volume centroid fails
                bbox = geometry.GetBoundingBox(True)
                volume_centroid = bbox.Center
        # Create translation vector to center
        translation_vector = -np.array([
            volume_centroid.X, volume_centroid.Y, volume_centroid.Z
        ])
        # Create centered extrusion
        centered_geometry = geometry.Duplicate()
        translation_xform = Rhino.Geometry.Transform.Translation(
            translation_vector[0], translation_vector[1], translation_vector[2]
        )
        centered_geometry.Transform(translation_xform)
        return centered_geometry, translation_vector

    def _triangle_area(self, v0, v1, v2):
        return float(0.5 * np.linalg.norm(np.cross(v1 - v0, v2 - v0)))

    def sample_points_area_weighted_from_mesh(
            self,
            mesh,
            reference_face_area=REFERENCE_FACE_AREA_MM2,
            min_samples_per_face=1):
        """
        Build a PCA point cloud by repeating face centroids weighted by area.
        """
        vertices = np.array(
            [[v.X, v.Y, v.Z] for v in mesh.Vertices],
            dtype=np.float64,
        )
        if mesh.Faces.Count == 0:
            return vertices

        samples = []
        ref_area = max(reference_face_area, 1e-6)
        for face_idx in range(mesh.Faces.Count):
            face = mesh.Faces[face_idx]
            if face.IsTriangle:
                triangles = [[face.A, face.B, face.C]]
            elif face.IsQuad:
                triangles = [
                    [face.A, face.B, face.C],
                    [face.A, face.C, face.D],
                ]
            else:
                continue

            for tri in triangles:
                v0, v1, v2 = (
                    vertices[tri[0]], vertices[tri[1]], vertices[tri[2]]
                )
                area = self._triangle_area(v0, v1, v2)
                count = max(
                    min_samples_per_face,
                    int(round(area / ref_area)),
                )
                centroid = (v0 + v1 + v2) / 3.0
                samples.extend([centroid] * count)

        if not samples:
            return vertices
        return np.vstack(samples)

    def sample_points_for_pca_3d(self, geometry):
        """
        Collect area-weighted PCA samples from mesh or brep geometry.
        NOTE: CUrrently not used due to long runtime
        """
        if isinstance(geometry, Rhino.Geometry.Mesh):
            return self.sample_points_area_weighted_from_mesh(geometry)

        if isinstance(geometry, Rhino.Geometry.Brep):
            mp = Rhino.Geometry.MeshingParameters.Default
            brep_meshes = Rhino.Geometry.Mesh.CreateFromBrep(geometry, mp)
            if brep_meshes:
                chunks = [
                    self.sample_points_area_weighted_from_mesh(m)
                    for m in brep_meshes
                ]
                return np.vstack(chunks)

            return np.array(
                [[p.Location.X, p.Location.Y, p.Location.Z]
                 for p in geometry.Vertices],
                dtype=np.float64,
            )

        raise RuntimeError(
            'Area-weighted 3D sampling not implemented for geometry of type '
            f'{type(geometry)}!'
        )

    def compute_obb_3d(self, points):
        """
        Compute object oriented bounding box for 3D points using PCA.
        Returns unsorted dimensions and bounding box origin.
        """
        # Apply PCA to find principal axes
        pca = PCA(n_components=3)
        pca.fit(points)

        # Get principal components (eigenvectors)
        principal_components = pca.components_

        # Ensure right-handed coordinate system
        # Check if determinant is positive (right-handed)
        det = np.linalg.det(principal_components)
        if det < 0:
            # Flip the third component to ensure right-handedness
            principal_components[2] = -principal_components[2]

        # Transform points to PCA space using original component order
        pca_points = np.dot(points, principal_components.T)

        # Find bounds in PCA space
        min_bounds = np.min(pca_points, axis=0)
        max_bounds = np.max(pca_points, axis=0)

        # Compute unsorted dimensions (keep original PCA axis order)
        dimensions = max_bounds - min_bounds

        # Find bounding box center in PCA space
        # Since component is centered at origin, bbx_origin is just the
        # bounding box center in PCA space
        bbx_origin = (min_bounds + max_bounds) / 2.0

        return dimensions.tolist(), principal_components, bbx_origin.tolist()

    def minimum_bounding_rectangle(self, points):
        """
        Compute minimum bounding rectangle for 2D points.
        Returns rectangle corners and angle.
        """
        # Compute the convex hull of the points
        hull = ConvexHull(points)
        hull_points = points[hull.vertices]

        # Initialize variables to keep track of the best rectangle
        min_area = float('inf')
        best_rectangle = None
        best_angle = 0

        # Loop through each edge of the convex hull
        for i in range(len(hull_points)):
            # Determine the points forming the current edge
            p1 = hull_points[i]
            p2 = hull_points[(i + 1) % len(hull_points)]

            # Calculate edge vector
            edge_vec = p2 - p1

            # Rotate the points to align this edge with the x-axis
            angle = np.arctan2(edge_vec[1], edge_vec[0])
            cos_angle = np.cos(-angle)
            sin_angle = np.sin(-angle)
            rot_matrix = np.array([[cos_angle, -sin_angle],
                                   [sin_angle, cos_angle]])
            rotated_points = np.dot(points, rot_matrix.T)

            # Compute the min/max x/y in the rotated points
            min_x = np.min(rotated_points[:, 0])
            max_x = np.max(rotated_points[:, 0])
            min_y = np.min(rotated_points[:, 1])
            max_y = np.max(rotated_points[:, 1])

            # Calculate area of the bounding rectangle
            area = (max_x - min_x) * (max_y - min_y)

            if area < min_area:
                min_area = area
                best_angle = angle

                # Create the rectangle in the rotated space and then rotate it
                # back
                best_rectangle = np.array([
                    [min_x, min_y],
                    [max_x, min_y],
                    [max_x, max_y],
                    [min_x, max_y]
                ])

                inv_rot_matrix = np.array([
                    [cos_angle, sin_angle],
                    [-sin_angle, cos_angle]
                ])
                best_rectangle = np.dot(best_rectangle, inv_rot_matrix.T)

        return best_rectangle, best_angle

    def compute_obb_2d(self, points, height):
        """
        Compute object oriented bounding box for extrusions using the
        minimum bounding rectangle method to find optimal 2D orientation.
        Returns unsorted dimensions and bounding box origin.
        """
        # Extract only X and Y coordinates for 2D analysis
        points_2d = points[:, :2]

        # Use the minimum bounding rectangle method to find optimal orientation
        mbr, optimal_angle = self.minimum_bounding_rectangle(points_2d)

        # The optimal_angle is the angle of the edge vector that gives
        # minimum area. To align this edge with the x-axis, we need to
        # rotate by -optimal_angle. This matches the logic in
        # minimum_bounding_rectangle
        cos_angle = np.cos(-optimal_angle)
        sin_angle = np.sin(-optimal_angle)

        # Rotate points to the optimal orientation
        rot_matrix = np.array([
            [cos_angle, -sin_angle],
            [sin_angle, cos_angle]
        ])
        rotated_points = np.dot(points_2d, rot_matrix.T)

        # Compute dimensions in the rotated coordinate system
        min_x = np.min(rotated_points[:, 0])
        max_x = np.max(rotated_points[:, 0])
        min_y = np.min(rotated_points[:, 1])
        max_y = np.max(rotated_points[:, 1])

        x_dim = max_x - min_x
        y_dim = max_y - min_y

        # Find bounding box center in rotated 2D space
        bbx_center_2d = [(min_x + max_x) / 2.0, (min_y + max_y) / 2.0]

        # Find Z center (since component is centered, this should be near 0)
        min_z = np.min(points[:, 2])
        max_z = np.max(points[:, 2])
        z_center = (min_z + max_z) / 2.0

        # Since component is centered at origin, bbx_origin is the bounding
        # box center in rotated 2D space + Z center
        bbx_origin_2d = [bbx_center_2d[0], bbx_center_2d[1], z_center]

        # Ensure X is the longest dimension for consistency
        if x_dim >= y_dim:
            dimensions = [x_dim, y_dim, height]
            # PCA frame aligns with the optimal orientation
            principal_components = np.array([
                [cos_angle, -sin_angle, 0],  # X axis = long axis
                [sin_angle, cos_angle, 0],   # Y axis = short axis
                [0, 0, 1]                    # Z axis stays vertical
            ])
        else:
            # Swap dimensions - the longer dimension should be X
            dimensions = [y_dim, x_dim, height]
            # Rotate by 90 degrees to make Y the X axis
            cos_angle_90 = np.cos(-optimal_angle + np.pi / 2)
            sin_angle_90 = np.sin(-optimal_angle + np.pi / 2)
            principal_components = np.array([
                [cos_angle_90, -sin_angle_90, 0],  # X axis = long axis
                [sin_angle_90, cos_angle_90, 0],   # Y axis = short axis
                [0, 0, 1]                          # Z axis stays vertical
            ])

        return dimensions, principal_components, bbx_origin_2d

    def rhino_xform(self, transformation_matrix) -> Rhino.Geometry.Transform:
        """
        Convert numpy transformation matrix to Rhino Transform.
        """
        XForm = Rhino.Geometry.Transform.Identity
        XForm.M00 = transformation_matrix[0][0]
        XForm.M01 = transformation_matrix[0][1]
        XForm.M02 = transformation_matrix[0][2]
        XForm.M03 = transformation_matrix[0][3]
        XForm.M10 = transformation_matrix[1][0]
        XForm.M11 = transformation_matrix[1][1]
        XForm.M12 = transformation_matrix[1][2]
        XForm.M13 = transformation_matrix[1][3]
        XForm.M20 = transformation_matrix[2][0]
        XForm.M21 = transformation_matrix[2][1]
        XForm.M22 = transformation_matrix[2][2]
        XForm.M23 = transformation_matrix[2][3]
        return XForm

    def process_geometry(self, geometry: Rhino.Geometry.GeometryBase):
        """
        Process geometry to extract points and determine if 3D.
        Returns points array and boolean indicating if 3D.
        """
        compute_3d = False
        # HANDLE BREP
        if isinstance(geometry, Rhino.Geometry.Brep):
            points = np.array([[p.Location.X,
                                p.Location.Y,
                                p.Location.Z] for p in geometry.Vertices])
            compute_3d = True
        # HANDLE EXTRUSIONS
        elif isinstance(geometry, Rhino.Geometry.Extrusion):
            brep = geometry.ToBrep()
            points = np.array([[p.Location.X,
                                p.Location.Y,
                                p.Location.Z] for p in brep.Vertices])
            compute_3d = False
        # HANDLE MESH
        elif isinstance(geometry, Rhino.Geometry.Mesh):
            points = np.array([[p.X, p.Y, p.Z] for p in geometry.Vertices])
            compute_3d = True
        # HANDLE POINT CLOUD
        elif isinstance(geometry, Rhino.Geometry.PointCloud):
            points = np.array([
                [geometry[i].Location.X,
                 geometry[i].Location.Y,
                 geometry[i].Location.Z]
                for i in range(geometry.Count)
            ])
            compute_3d = True
        # IF NOT ONE OF THESE GEOMETRY TYPES
        else:
            raise RuntimeError('Geometry processing not implemented '
                               f'for geometry of type {type(geometry)}!')
        # return results
        return points, compute_3d

    def validate_uuid(self, uuid_to_test: str, version: int = 4) -> bool:
        """
        Check if uuid_to_test is a valid UUID.
        Returns True if uuid_to_test is a valid UUID, otherwise False.
        """
        try:
            uuid_obj = uuid.UUID(uuid_to_test, version=version)
        except ValueError:
            return False
        return str(uuid_obj) == uuid_to_test

    def get_pending_assets_root(self) -> str:
        """Root directory for staged identity mesh PLY files."""
        if platform.system() == 'Windows':
            base_path = os.path.expandvars('%APPDATA%')
            return os.path.join(
                base_path,
                'DDU_CSC',
                'pending_identity_assets'
            )
        base_path = os.path.expanduser('~')
        return os.path.join(
            base_path, 'Library', 'Application Support', 'DDU_CSC',
            'pending_identity_assets',
        )

    def get_identity_assets_dir(self, identity_id: str) -> str:
        return os.path.join(self.get_pending_assets_root(), identity_id)

    def get_mesh_primitive_dir(
            self,
            identity_id: str,
            primitive_index: int
    ) -> str:
        return os.path.join(
            self.get_identity_assets_dir(identity_id),
            'meshes',
            str(primitive_index),
        )

    def get_point_cloud_staged_path(
            self,
            identity_id: str,
            primitive_index: int) -> str:
        return os.path.join(
            self.get_identity_assets_dir(identity_id),
            'point_clouds',
            f'{primitive_index}.ply',
        )

    def write_staging_manifest(
            self,
            identity_id: str,
            mesh_primitives: dict = None,
            point_cloud_primitives: dict = None):
        """Write manifest.json for AddComponent upload handoff."""
        manifest = {
            'identity_id': identity_id,
            'coordinate_frame': 'rhino_z_up',
        }
        if mesh_primitives:
            manifest['mesh_primitives'] = mesh_primitives
        if point_cloud_primitives:
            manifest['point_cloud_primitives'] = point_cloud_primitives
        assets_dir = self.get_identity_assets_dir(identity_id)
        os.makedirs(assets_dir, exist_ok=True)
        manifest_path = os.path.join(assets_dir, 'manifest.json')
        with open(manifest_path, 'w', encoding='utf-8') as handle:
            json.dump(manifest, handle, indent=2)

    def clear_pending_identity_assets_directory(self):
        """Clear all staged pending_identity_assets (not Session cache)."""
        try:
            assets_dir = self.get_pending_assets_root()
            if os.path.exists(assets_dir):
                import shutil
                shutil.rmtree(assets_dir, ignore_errors=True)
                os.makedirs(assets_dir, exist_ok=True)
                self._addRemark(
                    f'Cleared pending_identity_assets: {assets_dir}'
                )
                return True
            self._addRemark('pending_identity_assets does not exist yet')
            return True
        except Exception as e:
            self._addWarning(
                f'Failed to clear pending_identity_assets: {str(e)}'
            )
            return False

    def reduce_mesh(
        self, mesh: Rhino.Geometry.Mesh, target_face_count: int
    ) -> Rhino.Geometry.Mesh:
        """
        Reduce a mesh to a target face count using Rhino's mesh reduction.
        Returns the reduced mesh.
        """
        reduced_mesh = mesh.Duplicate()
        reduced_mesh.Reduce(target_face_count, True, 5, False, True)
        reduced_mesh.Faces.ConvertQuadsToTriangles()
        reduced_mesh.Compact()
        return reduced_mesh

    def _stage_mesh_ply_files(
            self,
            identity_id: str,
            primitive_index: int,
            detailed_mesh,
            reduced_mesh,
            default_rgb,
            mesh_primitive_threshold: int,
            mesh_reduced_threshold: int,
            mesh_reduced_target: int,
            mesh_primitive_target: int):
        """
        Reduce meshes if needed and write detailed.ply / reduced.ply for one
        primitive index. Returns (primitive_mesh, resolutions_on_disk).
        """
        if detailed_mesh is None:
            return None, []

        face_count = detailed_mesh.Faces.Count
        reduced = None
        primitive = detailed_mesh
        resolutions = []

        primitive_dir = self.get_mesh_primitive_dir(
            identity_id, primitive_index)
        detailed_path = os.path.join(primitive_dir, 'detailed.ply')
        reduced_path = os.path.join(primitive_dir, 'reduced.ply')

        if os.path.exists(detailed_path) or os.path.exists(reduced_path):
            self._addWarning(
                f'PLY files already exist for identity {identity_id} '
                f'primitive {primitive_index}; skipping overwrite.'
            )
            if face_count > mesh_reduced_threshold:
                primitive = self.reduce_mesh(
                    detailed_mesh, mesh_primitive_target)
            elif face_count > mesh_primitive_threshold:
                primitive = self.reduce_mesh(
                    detailed_mesh, mesh_primitive_target)
            return primitive, []

        save_detailed = face_count > mesh_primitive_target
        save_reduced = face_count > mesh_reduced_threshold

        if face_count > mesh_reduced_threshold:
            reduced = self.reduce_mesh(detailed_mesh, mesh_reduced_target)
            primitive = self.reduce_mesh(detailed_mesh, mesh_primitive_target)
        elif face_count > mesh_primitive_threshold:
            primitive = self.reduce_mesh(detailed_mesh, mesh_primitive_target)

        try:
            if save_detailed:
                self.save_rhino_mesh_as_ply_binary(
                    detailed_mesh, detailed_path, default_rgb)
                resolutions.append('detailed')
            if save_reduced and reduced is not None:
                self.save_rhino_mesh_as_ply_binary(
                    reduced, reduced_path, default_rgb)
                resolutions.append('reduced')
            if resolutions:
                self._addRemark(
                    f'Staged PLY for primitive {primitive_index}: '
                    f'{", ".join(resolutions)}'
                )
        except Exception as e:
            self._addWarning(f'Failed to stage PLY files: {str(e)}')
            resolutions = []

        return primitive, resolutions

    def process_mesh_geometry(
        self,
        geometry: Rhino.Geometry.Mesh,
        identity_id: str,
        default_rgb,
        mesh_primitive_threshold: int = 8000,
        mesh_reduced_threshold: int = 15000,
        mesh_reduced_target: int = 10000,
        mesh_primitive_target: int = 500,
    ) -> tuple:
        """
        Returns (original, reduced, primitive_mesh, mesh_primitives dict).
        """
        primitive_mesh, resolutions = self._stage_mesh_ply_files(
            identity_id,
            0,
            geometry,
            None,
            default_rgb,
            mesh_primitive_threshold,
            mesh_reduced_threshold,
            mesh_reduced_target,
            mesh_primitive_target,
        )
        mesh_primitives = {}
        if resolutions:
            mesh_primitives['0'] = resolutions
        reduced_mesh = None
        if geometry.Faces.Count > mesh_reduced_threshold:
            reduced_mesh = self.reduce_mesh(geometry, mesh_reduced_target)
        return geometry, reduced_mesh, primitive_mesh, mesh_primitives

    def process_multiple_meshes_geometry(
            self,
            meshes,
            identity_id,
            default_rgb,
            mesh_primitive_threshold: int = 8000,
            mesh_reduced_threshold: int = 15000,
            mesh_reduced_target: int = 10000,
            mesh_primitive_target: int = 500):
        """Returns (primitive_meshes, mesh_primitives dict)."""
        if not meshes:
            return [], {}

        primitive_meshes = []
        mesh_primitives = {}

        for index, mesh in enumerate(meshes):
            if mesh is None:
                primitive_meshes.append(None)
                continue
            primitive_mesh, resolutions = self._stage_mesh_ply_files(
                identity_id,
                index,
                mesh,
                None,
                default_rgb,
                mesh_primitive_threshold,
                mesh_reduced_threshold,
                mesh_reduced_target,
                mesh_primitive_target,
            )
            primitive_meshes.append(primitive_mesh)
            if resolutions:
                mesh_primitives[str(index)] = resolutions

        return primitive_meshes, mesh_primitives

    def _stage_point_cloud_ply(
            self,
            identity_id: str,
            primitive_index: int,
            cloud,
            staging_threshold: int = POINT_CLOUD_STAGING_THRESHOLD):
        """Stage full PLY when point count exceeds inline preview cap."""
        if cloud is None or cloud.Count == 0:
            return {}

        if cloud.Count <= staging_threshold:
            return {}

        ply_path = self.get_point_cloud_staged_path(
            identity_id, primitive_index)
        if os.path.exists(ply_path):
            self._addWarning(
                f'Point cloud PLY already exists for identity {identity_id} '
                f'primitive {primitive_index}; skipping overwrite.'
            )
            return {}

        try:
            self.save_rhino_point_cloud_as_ply_binary(cloud, ply_path)
            self._addRemark(
                f'Staged point cloud PLY for primitive {primitive_index}'
            )
            return {str(primitive_index): ['ply']}
        except Exception as e:
            self._addWarning(f'Failed to stage point cloud PLY: {str(e)}')
            return {}

    def process_point_cloud_geometry(
            self,
            cloud: Rhino.Geometry.PointCloud,
            identity_id: str,
            staging_threshold: int = POINT_CLOUD_STAGING_THRESHOLD):
        """Returns (original, inline_cloud, point_cloud_primitives dict)."""
        staged = self._stage_point_cloud_ply(
            identity_id, 0, cloud, staging_threshold)
        return cloud, cloud, staged

    def process_multiple_point_clouds_geometry(
            self,
            clouds,
            identity_id: str,
            staging_threshold: int = POINT_CLOUD_STAGING_THRESHOLD):
        """Returns (clouds, point_cloud_primitives dict)."""
        if not clouds:
            return [], {}

        point_cloud_primitives = {}
        for index, cloud in enumerate(clouds):
            if cloud is None:
                continue
            staged = self._stage_point_cloud_ply(
                identity_id, index, cloud, staging_threshold)
            point_cloud_primitives.update(staged)

        return clouds, point_cloud_primitives

    def compute_pca_for_multiple_point_clouds(self, clouds):
        """
        Compute PCA for multiple point clouds as a whole assembly.
        Returns dimensions, principal components, translation vector,
        and bbx_origin.
        """
        if not clouds or len(clouds) == 0:
            return None, None, None, None

        all_points = []
        for cloud in clouds:
            if cloud is None:
                continue
            for i in range(cloud.Count):
                loc = cloud[i].Location
                all_points.append([loc.X, loc.Y, loc.Z])

        if not all_points:
            return None, None, None, None

        points_array = np.array(all_points)
        centroid = np.mean(points_array, axis=0)
        translation_vector = -centroid
        centered_points = points_array + translation_vector
        dimensions, principal_components, bbx_origin = (
            self.compute_obb_3d(centered_points)
        )
        return dimensions, principal_components, translation_vector, bbx_origin

    def compute_pca_for_multiple_meshes(self, meshes):
        """
        Compute PCA for multiple meshes as a whole assembly.
        Centers the assembly at origin before computing PCA.
        Returns dimensions, principal components, translation vector,
        and bbx_origin.
        """
        if not meshes or len(meshes) == 0:
            return None, None, None, None

        # Collect area-weighted samples from all meshes
        sample_chunks = []
        for mesh in meshes:
            if mesh is None:
                continue
            # sample_chunks.append(
            #     self.sample_points_area_weighted_from_mesh(mesh)
            # )
            sample_chunks.append(mesh.Vertices)

        if not sample_chunks:
            return None, None, None, None

        points_array = np.vstack(sample_chunks)

        # Center the assembly at origin (like single meshes)
        # Compute centroid of all points
        centroid = np.mean(points_array, axis=0)
        translation_vector = -centroid

        # Center the points
        centered_points = points_array + translation_vector

        # Compute PCA for the centered combined geometry
        dimensions, principal_components, bbx_origin = (
            self.compute_obb_3d(centered_points)
        )

        return dimensions, principal_components, translation_vector, bbx_origin

    def compute_pca_for_first_geometry_only(self, geometries):
        """
        Compute PCA from geometry at index 0 (Mesh or PointCloud).
        The same translation is applied to every item in the list.
        """
        first_geom = geometries[0]
        if first_geom is None:
            raise ValueError(
                'Geometry at index 0 must be set for multiple inputs '
                'when Assembly=False.'
            )
        centered_geom, translation_vector = (
            self.center_geometry_at_origin(first_geom)
        )
        centered_points, _ = self.process_geometry(centered_geom)
        dimensions, principal_components, bbx_origin = (
            self.compute_obb_3d(centered_points)
        )
        return dimensions, principal_components, translation_vector, bbx_origin

    def compute_pca_for_mixed_geometry(self, geometries):
        """
        Compute PCA from combined mesh vertices and point-cloud points.
        Used when Assembly=True and the geometry list mixes types.
        """
        all_points = []
        for geom in geometries:
            if geom is None:
                continue
            if isinstance(geom, Rhino.Geometry.Mesh):
                for vertex in geom.Vertices:
                    all_points.append([vertex.X, vertex.Y, vertex.Z])
            elif isinstance(geom, Rhino.Geometry.PointCloud):
                for i in range(geom.Count):
                    loc = geom[i].Location
                    all_points.append([loc.X, loc.Y, loc.Z])

        if not all_points:
            return None, None, None, None

        points_array = np.array(all_points)
        centroid = np.mean(points_array, axis=0)
        translation_vector = -centroid
        centered_points = points_array + translation_vector
        dimensions, principal_components, bbx_origin = (
            self.compute_obb_3d(centered_points)
        )
        return dimensions, principal_components, translation_vector, bbx_origin

    def process_mixed_geometry_list(
            self,
            geometries,
            identity_id: str,
            default_rgb,
            translation_vector,
            mesh_primitive_threshold: int,
            mesh_reduced_threshold: int,
            mesh_reduced_target: int,
            mesh_primitive_target: int,
            point_cloud_staging_threshold: int = POINT_CLOUD_STAGING_THRESHOLD):  # NOQA
        """
        Center, stage, and build inline primitives for a multi-item geometry
        list that may contain Meshes and/or PointClouds.
        """
        mesh_primitives = {}
        point_cloud_primitives = {}
        meshes_data = []
        point_clouds_data = []
        mesh_index = 0
        point_cloud_index = 0

        translation_xform = Rhino.Geometry.Transform.Translation(
            translation_vector[0],
            translation_vector[1],
            translation_vector[2],
        )

        for geom in geometries:
            if geom is None:
                continue

            centered = geom.Duplicate()
            centered.Transform(translation_xform)

            if isinstance(geom, Rhino.Geometry.Mesh):
                primitive_mesh, resolutions = self._stage_mesh_ply_files(
                    identity_id,
                    mesh_index,
                    centered,
                    None,
                    default_rgb,
                    mesh_primitive_threshold,
                    mesh_reduced_threshold,
                    mesh_reduced_target,
                    mesh_primitive_target,
                )
                if resolutions:
                    mesh_primitives[str(mesh_index)] = resolutions
                meshes_data.append(
                    self.mesh_to_inline_primitive(
                        primitive_mesh or centered,
                        default_rgb,
                    )
                )
                mesh_index += 1
            elif isinstance(geom, Rhino.Geometry.PointCloud):
                staged = self._stage_point_cloud_ply(
                    identity_id,
                    point_cloud_index,
                    centered,
                    point_cloud_staging_threshold,
                )
                point_cloud_primitives.update(staged)
                point_clouds_data.append(
                    self.point_cloud_to_inline_primitive(
                        centered,
                        max_points=POINT_CLOUD_INLINE_MAX,
                    )
                )
                point_cloud_index += 1
            else:
                raise RuntimeError(
                    'Mixed geometry lists support Mesh and PointCloud only; '
                    f'got {type(geom).__name__}'
                )

        geometry = {}
        if meshes_data:
            geometry['meshes'] = meshes_data
        if point_clouds_data:
            geometry['point_clouds'] = point_clouds_data
        return geometry, mesh_primitives, point_cloud_primitives

    def RunScript(self,
            ClearLocalStorage: bool,
            IdentityID: str,
            Name: str,
            Type: str,
            Material: str,
            Dataset: str,
            Complexity: int,
            Fragment: bool,
            Assembly: bool,
            Color: System.Drawing.Color,
            Location: Rhino.Geometry.Vector3d,
            Geometry: System.Collections.Generic.List[Rhino.Geometry.GeometryBase],
            MarkerPoints: System.Collections.Generic.List[Rhino.Geometry.Point3d],
            Condition,
            ManufacturedAt,
            ManufacturedPrecision,
            SalvageSource,
            SalvagedAt,
            ParentIdentity,
            Quantity,
            Notes,
            Reinforcements: System.Collections.Generic.List[object]):

        # MESH REDUCTION SETTINGS
        # If mesh has tc above this but below reduced threshold,
        # only the primitive version will be computed
        MESH_PRIMITIVE_THRESHOLD = 8000
        # If mesh has tc above this, reduced and primitive versions
        # will be created
        MESH_REDUCED_THRESHOLD = 15000
        # target tc for reduced mesh
        MESH_REDUCED_TARGET = 10000
        # target tc for primitive mesh
        MESH_PRIMITIVE_TARGET = 500

        # set up output trees and results tuple
        ComponentData = Grasshopper.DataTree[System.Object]()
        try:
            # Handle ClearLocalStorage input
            if ClearLocalStorage:
                self._addRemark(
                    'Clearing pending_identity_assets directory...'
                )
                if self.clear_pending_identity_assets_directory():
                    self.Component.Message = (
                        'Local storage cleared successfully'
                    )
                else:
                    self.Component.Message = 'Failed to clear local storage'
                return ComponentData

            # Initialize schema validation
            self._addRemark(
                'Initializing identity create payload '
                'with schema validation...'
            )

            if not IdentityID:
                msg = 'Input IdentityID failed to collect data!'
                self._addWarning(msg)
                return ComponentData
            elif not self.validate_uuid(IdentityID):
                msg = 'Input IdentityID is not a valid UUID! Aborting...'
                self._addError(msg)
                return ComponentData
            if not Name:
                msg = (
                    'Input Name failed to collect data. '
                    'Using auto-generated name!'
                )
                self._addRemark(msg)
                Name = ''
            if not Type:
                msg = 'Input Type failed to collect data!'
                self._addWarning(msg)
                return ComponentData
            if not Material:
                msg = 'Input Material failed to collect data!'
                self._addWarning(msg)
                return ComponentData
            if not Dataset:
                msg = 'Input Dataset failed to collect data!'
                self._addWarning(msg)
                return ComponentData
            if Complexity is None:
                msg = 'Input Complexity failed to collect data!'
                self._addWarning(msg)
                return ComponentData
            if (not isinstance(Complexity, int) or
                    Complexity < 0 or Complexity > 3):
                msg = 'Input Complexity must be an integer between 0 and 3!'
                self._addError(msg)
                return ComponentData

            # Set defaults for Fragment and Assembly if not provided
            if Fragment is None:
                Fragment = False
            if Assembly is None:
                Assembly = False

            # Handle Location parameter (X=latitude, Y=longitude, Z ignored)
            location_data = None
            if Location is not None:
                location_data = {
                    "lat": Location.X,
                    "lon": Location.Y
                }

            # ---------------------------------------------------------------
            # Provenance / lineage inputs (all optional). Validate here and
            # drop to None on invalid values with a warning, so the
            # component still creates (backend treats missing as null).
            # ---------------------------------------------------------------
            if Condition is not None:
                try:
                    Condition = int(Condition)
                except Exception:
                    self._addWarning(
                        'Input Condition must be an integer in '
                        '{0, 1, 2, 3}. Ignoring provided value: '
                        f'{Condition!r}.'
                    )
                    Condition = None
                else:
                    if Condition not in (0, 1, 2, 3):
                        self._addWarning(
                            'Input Condition must be in {0, 1, 2, 3}. '
                            f'Ignoring out-of-range value: {Condition}.'
                        )
                        Condition = None

            if ManufacturedAt is not None:
                ManufacturedAt = str(ManufacturedAt).strip()
                if ManufacturedAt == '':
                    ManufacturedAt = None

            if ManufacturedPrecision is not None:
                ManufacturedPrecision = str(ManufacturedPrecision).strip()
                if ManufacturedPrecision == '':
                    ManufacturedPrecision = None
                elif ManufacturedPrecision not in (
                    'exact', 'month', 'year', 'unknown'
                ):
                    self._addWarning(
                        'Input ManufacturedPrecision must be one of '
                        '"exact", "month", "year", "unknown". Ignoring '
                        f'provided value: {ManufacturedPrecision!r}.'
                    )
                    ManufacturedPrecision = None

            if SalvageSource is not None:
                SalvageSource = str(SalvageSource).strip()
                if SalvageSource == '':
                    SalvageSource = None

            if SalvagedAt is not None:
                SalvagedAt = str(SalvagedAt).strip()
                if SalvagedAt == '':
                    SalvagedAt = None

            if ParentIdentity is not None:
                ParentIdentity = str(ParentIdentity).strip()
                if ParentIdentity == '':
                    ParentIdentity = None
                elif not self.validate_uuid(ParentIdentity):
                    self._addWarning(
                        'Input ParentIdentity must be a valid UUID. '
                        f'Ignoring provided value: {ParentIdentity!r}.'
                    )
                    ParentIdentity = None

            if Notes is not None:
                Notes = str(Notes)
            if Quantity is not None:
                try:
                    Quantity = int(Quantity)
                except (TypeError, ValueError):
                    self._addWarning(
                        'Input Quantity must be an integer;'
                        f'ignoring {Quantity!r}'
                    )
                    Quantity = 1
                if Quantity < 1 or Quantity > 999_999:
                    self._addWarning(
                        'Input Quantity must be between 1 and 999999; using 1'
                    )
                    Quantity = 1

            if not Color:
                msg = ('Input Color failed to collect data. '
                       'Will use Grey as default Color.')
                self._addRemark(msg)
                print(msg)
                Color = System.Drawing.Color.FromArgb(255, 175, 175, 175)
            if not Geometry:
                msg = 'Input Geometry failed to collect data!'
                self._addWarning(msg)
                return ComponentData

            # TYPE FILTERING
            if not Geometry or len(Geometry) == 0:
                msg = 'Input Geometry is invalid!'
                self._addError(msg)
                return ComponentData

            is_mixed_geometry = False
            is_point_cloud_assembly = False

            # Check if single or multiple objects
            if len(Geometry) == 1:
                # Single object validation
                single_geometry = Geometry[0]
                if Type == 'rubble':
                    if not isinstance(
                            single_geometry,
                            (Rhino.Geometry.Mesh, Rhino.Geometry.PointCloud)):
                        msg = (
                            'The "rubble" type expects a Mesh or PointCloud '
                            'as geometry input! Please ensure and try again.'
                        )
                        raise ValueError(msg)
                elif Type == 'panel':
                    if not isinstance(
                            single_geometry,
                            (Rhino.Geometry.Mesh, Rhino.Geometry.Extrusion)
                    ):
                        msg = (
                            'The "panel" type expects a Mesh or Extrusion '
                            'as geometry input! Please ensure and try '
                            'again.'
                        )
                        raise ValueError(msg)
            else:
                non_null = [g for g in Geometry if g is not None]
                if not non_null:
                    msg = 'Input Geometry contains only null entries!'
                    raise ValueError(msg)
                for i, geom in enumerate(Geometry):
                    if geom is not None and not isinstance(
                            geom,
                            (Rhino.Geometry.Mesh,
                             Rhino.Geometry.PointCloud)):
                        msg = (
                            f'Geometry at index {i} must be Mesh or '
                            f'PointCloud; got {type(geom).__name__}.'
                        )
                        raise ValueError(msg)
                has_mesh = any(
                    isinstance(g, Rhino.Geometry.Mesh) for g in non_null)
                has_point_cloud = any(
                    isinstance(g, Rhino.Geometry.PointCloud) for g in non_null)
                is_mixed_geometry = has_mesh and has_point_cloud
                is_point_cloud_assembly = has_point_cloud and not has_mesh

            self.Component.Message = f'Processing {Type} identity...'
            default_rgb = (Color.R, Color.G, Color.B)

            # Process geometry to extract points and compute PCA
            if len(Geometry) == 1:
                # Handle single geometry (existing logic)
                single_geometry = Geometry[0]
                # Center geometry at world origin FIRST
                (centered_geometry, translation_vector) = (
                    self.center_geometry_at_origin(single_geometry)
                )
                centered_points, compute_3d = self.process_geometry(
                    centered_geometry
                )
                if compute_3d:
                    # centered_points = self.sample_points_for_pca_3d(
                    #     centered_geometry
                    # )
                    dimensions, principal_components, bbx_origin = (
                        self.compute_obb_3d(centered_points))
                else:
                    # 2D APPROACH, i.e. used for Extrusions
                    height = centered_geometry.PathStart.DistanceTo(
                        centered_geometry.PathEnd
                    )
                    dimensions, principal_components, bbx_origin = (
                        self.compute_obb_2d(
                            centered_points, height)
                    )
            else:
                if Assembly:
                    if is_mixed_geometry:
                        (dimensions, principal_components,
                         translation_vector, bbx_origin) = (
                            self.compute_pca_for_mixed_geometry(Geometry))
                    elif is_point_cloud_assembly:
                        (dimensions, principal_components,
                         translation_vector, bbx_origin) = (
                            self.compute_pca_for_multiple_point_clouds(
                                Geometry))
                    else:
                        (dimensions, principal_components,
                         translation_vector, bbx_origin) = (
                            self.compute_pca_for_multiple_meshes(Geometry))
                else:
                    (dimensions, principal_components, translation_vector,
                     bbx_origin) = (
                        self.compute_pca_for_first_geometry_only(Geometry))
                centered_geometry = None
                compute_3d = True

            schema = self.get_create_payload_schema()

            # Process marker points - apply same transformation as geometry
            marker_points_data = []
            if MarkerPoints and len(MarkerPoints) > 0:
                for point in MarkerPoints:
                    if point is not None:
                        # Apply the same translation vector used for
                        # centering geometry
                        transformed_point = [
                            point.X + translation_vector[0],
                            point.Y + translation_vector[1],
                            point.Z + translation_vector[2]
                        ]
                        marker_points_data.append(transformed_point)

            payload = self.build_create_payload(
                IdentityID, Name, Type, Material, Dataset, Complexity,
                Fragment, Assembly, Color, dimensions, location_data,
                principal_components, Condition, ManufacturedAt,
                ManufacturedPrecision, SalvageSource, SalvagedAt,
                ParentIdentity, Notes, Quantity,
            )
            payload['bbx_origin'] = bbx_origin
            if marker_points_data:
                payload['marker_points'] = marker_points_data

            mesh_primitives = {}
            point_cloud_primitives = {}

            # Process geometry input based on type
            if len(Geometry) == 1:
                # HANDLE SINGLE GEOMETRY
                single_geometry = Geometry[0]
                if isinstance(single_geometry, Rhino.Geometry.Mesh):
                    # Process single mesh
                    (_original_mesh,
                     _reduced_mesh,
                     primitive_mesh,
                     staged) = self.process_mesh_geometry(
                        centered_geometry,
                        IdentityID,
                        default_rgb,
                        mesh_primitive_threshold=MESH_PRIMITIVE_THRESHOLD,
                        mesh_reduced_threshold=MESH_REDUCED_THRESHOLD,
                        mesh_reduced_target=MESH_REDUCED_TARGET,
                        mesh_primitive_target=MESH_PRIMITIVE_TARGET,
                    )
                    mesh_primitives.update(staged)
                    payload['geometry'] = {
                        'meshes': [
                            self.mesh_to_inline_primitive(
                                primitive_mesh, default_rgb)
                        ],
                    }

                elif isinstance(single_geometry, Rhino.Geometry.Extrusion):
                    # Handle single extrusion (existing logic)
                    # Get the profile curve from the CENTERED geometry and
                    # convert to polyline
                    if centered_geometry.ProfileCount > 1:
                        raise RuntimeError(
                            'Extrusion has more than one profile!'
                        )
                    # Get first profile
                    profile_curve = centered_geometry.Profile3d(0, 0.0)
                    if profile_curve is None:
                        raise RuntimeError('Extrusion has no profile curve!')

                    # Convert profile to polyline
                    _tgpr, polyline = profile_curve.TryGetPolyline()
                    if _tgpr is False:
                        polyline = profile_curve.ToPolyline(0.01, 0.01, 0, 0)
                    if polyline is None:
                        raise RuntimeError(
                            'Failed to convert profile curve to polyline!'
                        )

                    # Get height
                    height = centered_geometry.PathStart.DistanceTo(
                        centered_geometry.PathEnd)

                    payload['geometry'] = {
                        'extrusions': [{
                            'profile': [[p.X, p.Y] for p in polyline],
                            'height': height,
                        }],
                    }

                elif isinstance(single_geometry, Rhino.Geometry.PointCloud):
                    (_original_cloud,
                     _inline_cloud,
                     staged) = self.process_point_cloud_geometry(
                        centered_geometry,
                        IdentityID,
                        staging_threshold=POINT_CLOUD_STAGING_THRESHOLD,
                    )
                    point_cloud_primitives.update(staged)
                    payload['geometry'] = {
                        'point_clouds': [
                            self.point_cloud_to_inline_primitive(
                                centered_geometry,
                                max_points=POINT_CLOUD_INLINE_MAX,
                            )
                        ],
                    }
            else:
                geometry_data, staged_meshes, staged_point_clouds = (
                    self.process_mixed_geometry_list(
                        Geometry,
                        IdentityID,
                        default_rgb,
                        translation_vector,
                        mesh_primitive_threshold=MESH_PRIMITIVE_THRESHOLD,
                        mesh_reduced_threshold=MESH_REDUCED_THRESHOLD,
                        mesh_reduced_target=MESH_REDUCED_TARGET,
                        mesh_primitive_target=MESH_PRIMITIVE_TARGET,
                        point_cloud_staging_threshold=(
                            POINT_CLOUD_STAGING_THRESHOLD
                        ),
                    )
                )
                payload['geometry'] = geometry_data
                mesh_primitives.update(staged_meshes)
                point_cloud_primitives.update(staged_point_clouds)

            centered_reinforcements = self.build_centered_reinforcements(
                Reinforcements,
                translation_vector,
            )
            if centered_reinforcements:
                payload['geometry']['reinforcements'] = centered_reinforcements

            if mesh_primitives or point_cloud_primitives:
                self.write_staging_manifest(
                    IdentityID,
                    mesh_primitives=mesh_primitives or None,
                    point_cloud_primitives=point_cloud_primitives or None,
                )

            if not self.validate_create_payload(payload, schema):
                self._addWarning(
                    'Create payload validation failed, but continuing...'
                )

            ComponentData = json.dumps(payload)

            self.Component.Message = (
                f'Built create payload for identity {IdentityID}'
            )
            self._addRemark(f'Created {Type} identity payload {IdentityID}')

            # return output
            return ComponentData

        except ValueError as e:
            msg = f'Validation error: {str(e)}'
            self._addError(msg)

        except RuntimeError as e:
            msg = f'Runtime error: {str(e)}'
            self._addError(msg)

        except Exception as e:
            msg = f'Unexpected error: {str(e)}'
            self._addError(msg)
            raise e

        return ComponentData
# ---------- end createcomponentidentity ----------
componentdata_14 = Data(createcomponentidentity)

# ---- group: __DDU_CSC_EXAMPLE_09__
# comments & notes: List all snapshot versions for one identity (id and name)
componentdata_15 = Data(componentdata_7)
number_slider_2 = Slider(1, range=0..5)
listidentitysnapshots = ListIdentitySnapshots(Input=componentdata_15)  # -> SnapshotID, SnapshotName
# ---------- listidentitysnapshots: Python ----------
#! python3
# -*- coding: utf-8 -*-
# venv: DDU_CSC
print('ENV OK!')
# r: charset_normalizer
# r: requests

# PYTHON STANDARD LIBRARY IMPORTS ---------------------------------------------
import json  # NOQA

# THIRD PARTY LIBRARY IMPORTS -------------------------------------------------
import requests  # NOQA

# RHINO AND GH RELATED IMPORTS ------------------------------------------------
import System  # NOQA
import Grasshopper  # NOQA
import Rhino  # NOQA
import scriptcontext as sc  # NOQA

# GHENV COMPONENT SETTINGS ----------------------------------------------------
ghenv.Component.Name = 'ListIdentitySnapshots'  # NOQA
ghenv.Component.NickName = 'ListIdentitySnapshots'  # NOQA
ghenv.Component.Category = 'DDU_CSC'  # NOQA
ghenv.Component.SubCategory = '2 Catalog Interface'  # NOQA
ghenv.Component.Description = (  # NOQA
    'Lists all snapshots for one identity (id and name). Input can '
    'be an identity UUID or passport JSON ({identity, snapshots[]}).'
)


class CSC_ListIdentitySnapshots(Grasshopper.Kernel.GH_ScriptInstance):
    """
    Author: Max Benjamin Eschenbach
    License: MIT License
    Version: 260908
    """

    def __init__(self):
        """Initialize this component and set component parameters."""
        super().__init__()
        self.Component = ghenv.Component  # NOQA
        self.InputParams = self.Component.Params.Input
        self.OutputParams = self.Component.Params.Output

    def _addRemark(self, msg: str = ''):
        rml = self.Component.RuntimeMessageLevel.Remark
        self.AddRuntimeMessage(rml, msg)

    def _addWarning(self, msg: str = ''):
        rml = self.Component.RuntimeMessageLevel.Warning
        self.AddRuntimeMessage(rml, msg)

    def _addError(self, msg: str = ''):
        rml = self.Component.RuntimeMessageLevel.Error
        self.AddRuntimeMessage(rml, msg)

    def BeforeRunScript(self):
        self.InputParams[0].Description = (
            'Identity UUID or passport JSON ({identity, snapshots[]})'
        )
        i = 0
        if self.OutputParams[0].Name == 'out':
            i += 1
        self.OutputParams[0 + i].Description = 'Snapshot UUIDs (ordered by version)'
        self.OutputParams[1 + i].Description = 'Snapshot names (parallel to SnapshotID)'

    def get_auth_core_from_sticky(self):
        auth_core = sc.sticky.get('CSC_AuthCore')
        if auth_core is None:
            msg = ('No authentication found. Please use CSC_Session component '
                   'first.')
            self._addError(msg)
            self.Component.Message = msg
            return None
        return auth_core

    def RunScript(self, Input):
        SnapshotID = Grasshopper.DataTree[str]()
        SnapshotName = Grasshopper.DataTree[str]()

        auth_core = self.get_auth_core_from_sticky()
        if auth_core is None:
            return SnapshotID, SnapshotName

        if not auth_core.is_valid():
            msg = ('Authentication expired. Please use CSC_Session '
                   'component to refresh.')
            self._addError(msg)
            self.Component.Message = msg
            return SnapshotID, SnapshotName

        if Input is None or (isinstance(Input, str) and not str(Input).strip()):
            msg = 'Please provide an identity UUID or passport JSON.'
            self._addWarning(msg)
            self.Component.Message = msg
            return SnapshotID, SnapshotName

        identity_id = auth_core.resolve_identity_id_from_input(Input)
        if not identity_id:
            msg = 'Input is not a valid identity UUID or passport JSON.'
            self._addError(msg)
            self.Component.Message = msg
            return SnapshotID, SnapshotName

        try:
            self.Component.Message = (
                f'Listing snapshots for identity {identity_id}...'
            )
            response = auth_core.authorized_get(
                f'/identities/{identity_id}/snapshots'
            )

            if response.status_code == 200:
                rows = response.json()
                if not isinstance(rows, list):
                    msg = 'Unexpected response from snapshot list endpoint.'
                    self._addError(msg)
                    self.Component.Message = msg
                    return SnapshotID, SnapshotName

                path = Grasshopper.Kernel.Data.GH_Path(0)
                for row in rows:
                    if not isinstance(row, dict):
                        continue
                    snap_id = str(row.get('_id') or '')
                    name = str(row.get('name') or '')
                    if snap_id:
                        SnapshotID.Add(snap_id, path)
                        SnapshotName.Add(name, path)

                self.Component.Message = (
                    f'Listed {SnapshotID.DataCount} snapshot(s)'
                )
                return SnapshotID, SnapshotName

            if response.status_code == 401:
                msg = 'Authentication failed. Please sign in again.'
            elif response.status_code == 404:
                msg = f'Identity {identity_id} not found.'
            else:
                msg = f'Request failed with status code: {response.status_code}'
            self._addError(msg)
            self.Component.Message = msg

        except requests.exceptions.ConnectionError as e:
            msg = 'Cannot connect to server. Please check your connection.'
            self._addError(msg + f'\nFull Error: {str(e)}')
            self.Component.Message = msg
        except requests.exceptions.Timeout as e:
            msg = 'Request timeout. Server may be slow.'
            self._addError(msg + f'\nFull Error: {str(e)}')
            self.Component.Message = msg
        except Exception as e:
            msg = f'Unexpected error: {str(e)}'
            self._addError(msg)
            self.Component.Message = msg

        return SnapshotID, SnapshotName
# ---------- end listidentitysnapshots ----------
item = ListItem(List=listidentitysnapshots.SnapshotName, Index=number_slider_2, Wrap=False)
item_2 = ListItem(List=listidentitysnapshots.SnapshotID, Index=number_slider_2, Wrap=False)
snapshotid = Data(item_2)
panel_6 = Panel(item)

# ---- group: __DDU_CSC_EXAMPLE_03__
# Step 3
# comments & notes: Bake Components to the Rhino Document.
# 
# NOTE: If you bake using the component, the geometry will be grouped with a text tag that is used to infer the transformations happening in the Rhino document. Without text tag, this will be lost!
button_3 = Button()
componentdata_16 = Data(componentdata_4)
# Step 4
# comments & notes: Transform (move, rotate) the baked component(s) in the Rhino doc!
# 
# Make sure to also transform the text tag!
bakecomponents = BakeComponents(Bake=button_3, ComponentData=componentdata_16)  # inputs Bake: Boolean, ComponentData: list of String
# ---------- bakecomponents: Python ----------
#! python3
# -*- coding: utf-8 -*-
# venv: DDU_CSC
print('ENV OK!')
# r: charset_normalizer
# r: requests

# PYTHON STANDARD LIBRARY IMPORTS ---------------------------------------------
import json  # NOQA

# RHINO AND GH RELATED IMPORTS ------------------------------------------------
import System  # NOQA
import Rhino  # NOQA
import Grasshopper  # NOQA
import rhinoscriptsyntax as rs  # NOQA
import scriptcontext as sc  # NOQA

# GHENV COMPONENT SETTINGS ----------------------------------------------------
ghenv.Component.Name = 'BakeComponents'  # NOQA
ghenv.Component.NickName = 'BakeComponents'  # NOQA
ghenv.Component.Category = 'DDU_CSC'  # NOQA
ghenv.Component.SubCategory = '4 RhinoDoc Interaction'  # NOQA
ghenv.Component.Description = (  # NOQA
    'Bakes passport entries ({identity, snapshots[]}) into the Rhino document '
    'as actual geometry. Creates layers, groups, and attaches the full '
    'passport JSON as user text. Prioritizes cached PLY meshes and point '
    'clouds over inline snapshot primitives.'
)


class CSC_BakeComponents(Grasshopper.Kernel.GH_ScriptInstance):
    """
    Author: Max Benjamin Eschenbach
    License: MIT License
    Version: 260908
    """

    def __init__(self):
        """Initialize this component and set component parameters."""
        super().__init__()
        # initialize props
        self.Component = ghenv.Component  # NOQA
        self.InputParams = self.Component.Params.Input
        self.OutputParams = self.Component.Params.Output

    def _addRemark(self, msg: str = ''):
        """Add a remark message to the component."""
        rml = self.Component.RuntimeMessageLevel.Remark
        self.AddRuntimeMessage(rml, msg)

    def _addWarning(self, msg: str = ''):
        """Add a warning message to the component."""
        rml = self.Component.RuntimeMessageLevel.Warning
        self.AddRuntimeMessage(rml, msg)

    def _addError(self, msg: str = ''):
        """Add an error message to the component."""
        rml = self.Component.RuntimeMessageLevel.Error
        self.AddRuntimeMessage(rml, msg)

    def BeforeRunScript(self):
        """Perform some setup actions."""
        # Initialize input param descriptions
        self.InputParams[0].Description = (
            'Toggle to bake components to Rhino'
        )
        self.InputParams[1].Description = (
            'Passport JSON strings ({identity, snapshots[]}) from fetch '
            'components'
        )

    def ComponentExtrusions(
            self,
            geometry: dict) -> list[Rhino.Geometry.Extrusion]:
        """Create capped extrusions from geometry.extrusions list."""
        extrusions = []
        tol = Rhino.RhinoMath.SqrtEpsilon
        for extr in geometry.get('extrusions', []) or []:
            profile = extr.get('profile') or []
            if len(profile) < 3:
                continue

            pts = [Rhino.Geometry.Point3d(pt[0], pt[1], 0.0)
                   for pt in profile]
            if len(pts) >= 2 and pts[0].DistanceTo(pts[-1]) <= tol:
                pts = pts[:-1]
            if len(pts) < 3:
                continue

            pl = Rhino.Geometry.Polyline()
            pl.AddRange(pts)
            if not pl.IsClosed:
                pl.Add(pl[0])

            height = float(extr.get('height', 0))
            if height <= 0:
                continue

            cxt = Rhino.Geometry.Extrusion.Create(
                pl.ToPolylineCurve(),
                Rhino.Geometry.Plane.WorldXY,
                height,
                True)
            if cxt is None:
                continue

            cxt.Translate(Rhino.Geometry.Vector3d(0, 0, height * -0.5))
            extrusions.append(cxt)
        return extrusions

    def build_inline_mesh(self, mesh_data, default_color):
        """Build a Rhino mesh from an inline SnapshotMesh."""
        vertices = mesh_data.get('vertices')
        faces = mesh_data.get('faces')
        if not vertices or not faces:
            return None
        mesh = Rhino.Geometry.Mesh()
        for v in vertices:
            mesh.Vertices.Add(float(v[0]), float(v[1]), float(v[2]))
        for f in faces:
            if len(f) == 3:
                mesh.Faces.AddFace(f[0], f[1], f[2])
            elif len(f) == 4:
                mesh.Faces.AddFace(f[0], f[1], f[2], f[3])
        colors = mesh_data.get('colors')
        if colors and len(colors) == len(vertices):
            for c in colors:
                mesh.VertexColors.Add(int(c[0]), int(c[1]), int(c[2]))
        elif default_color:
            try:
                r, g, b = default_color
                for _ in range(len(vertices)):
                    mesh.VertexColors.Add(int(r), int(g), int(b))
            except (ValueError, TypeError):
                pass
        mesh.Normals.ComputeNormals()
        mesh.Compact()
        return mesh

    def ComponentMeshes(
            self,
            geometry: dict,
            snapshot_color,
            identity_id: str) -> list[Rhino.Geometry.Mesh]:
        """Create meshes from snapshot.geometry.meshes inline primitives."""
        meshes = []
        for idx, mesh_data in enumerate(geometry.get('meshes', []) or []):
            mesh = self.build_inline_mesh(mesh_data, snapshot_color)
            if mesh is None:
                self._addWarning(
                    f'Inline mesh {idx} in identity {identity_id} is invalid')
                continue
            meshes.append(mesh)
        return meshes

    def ComponentColor(self, snapshot: dict) -> System.Drawing.Color:
        color = snapshot.get('color') or [110, 110, 110]
        return System.Drawing.Color.FromArgb(255, *color)

    def get_auth_core_from_sticky(self):
        """Get AuthCore instance from sticky storage."""
        auth_core = sc.sticky.get('CSC_AuthCore')
        if auth_core is None:
            self._addWarning(
                'No authentication found. Using primitive geometry only.'
            )
            return None
        return auth_core

    def fetch_snapshot_meshes(self, auth_core, snapshot):
        """
        Fetch snapshot meshes via the unified PLY cache (detailed, then
        reduced), falling back to inline snapshot.geometry.meshes primitives.
        """
        if not auth_core:
            return None

        snapshot_id = snapshot.get('_id')
        geometry = snapshot.get('geometry', {}) or {}
        inline_meshes = geometry.get('meshes', []) or []
        if not snapshot_id or not inline_meshes:
            return None

        res_map = snapshot.get('mesh_ply_resolutions', {}) or {}
        default_color = snapshot.get('color') or [110, 110, 110]
        meshes = []

        for i in range(len(inline_meshes)):
            mesh = None
            available = res_map.get(str(i), []) or []
            for resolution in ('detailed', 'reduced'):
                if resolution in available:
                    m, _etag, _from_cache = auth_core.cached_get_snapshot_mesh(
                        snapshot_id, i, resolution)
                    if m is not None:
                        mesh = m
                        break
            if mesh is None:
                mesh = self.build_inline_mesh(inline_meshes[i], default_color)
            if mesh is not None:
                meshes.append(mesh)

        return meshes if meshes else None

    def build_inline_point_cloud(self, pc_data):
        """Build a Rhino point cloud from one inline SnapshotPointCloud."""
        if not isinstance(pc_data, dict):
            return None
        cloud = Rhino.Geometry.PointCloud()
        pts = pc_data.get('points', []) or []
        cl = pc_data.get('colors')
        if not pts:
            return None
        if cl and len(cl) == len(pts):
            for p, c in zip(pts, cl):
                cloud.Add(
                    Rhino.Geometry.Point3d(p[0], p[1], p[2]),
                    System.Drawing.Color.FromArgb(*c))
        else:
            for p in pts:
                cloud.Add(Rhino.Geometry.Point3d(p[0], p[1], p[2]))
        return cloud if cloud.Count > 0 else None

    def ComponentPointClouds(
            self,
            geometry: dict) -> list[Rhino.Geometry.PointCloud]:
        """Create point clouds from geometry.point_clouds inline primitives."""
        clouds = []
        for idx, pc_data in enumerate(geometry.get('point_clouds', []) or []):
            cloud = self.build_inline_point_cloud(pc_data)
            if cloud is None:
                self._addWarning(
                    f'Inline point cloud {idx} is invalid or empty')
                continue
            clouds.append(cloud)
        return clouds

    def fetch_snapshot_point_clouds(self, auth_core, snapshot):
        """
        Fetch snapshot point clouds via PLY when available, falling back to
        inline snapshot.geometry.point_clouds primitives.
        """
        geometry = snapshot.get('geometry', {}) or {}
        inline_pcs = geometry.get('point_clouds', []) or []
        if not inline_pcs:
            return None

        snapshot_id = snapshot.get('_id')
        clouds = []

        for i in range(len(inline_pcs)):
            cloud = None
            if auth_core and snapshot_id:
                try:
                    cloud = auth_core.cached_get_snapshot_point_cloud(
                        snapshot_id, i)
                except Exception as e:
                    self._addWarning(
                        'Point cloud PLY fetch failed '
                        f'for index {i}: {str(e)}')
            if cloud is None:
                cloud = self.build_inline_point_cloud(inline_pcs[i])
            if cloud is not None:
                clouds.append(cloud)

        return clouds if clouds else None

    def RunScript(self,
            Bake: bool,
            ComponentData: System.Collections.Generic.List[str]):
        # bake toggle
        if Bake:
            if not ComponentData or len(ComponentData) == 0:
                msg = ('No component data provided. Please connect '
                       'FetchComponent output.')
                self._addWarning(msg)
                self.Component.Message = msg
                return

            self.Component.Message = 'Baking components...'
            baked_count = 0

            # Get AuthCore for cached geometry
            auth_core = self.get_auth_core_from_sticky()

            # set document
            sc.doc = Rhino.RhinoDoc.ActiveDoc

            for i, cd in enumerate(ComponentData):
                comp_id = f'item {i}'
                try:
                    passport = json.loads(cd)
                    identity = passport.get('identity')
                    snapshots = passport.get('snapshots') or []
                    snapshot = snapshots[0] if snapshots else None
                    if (not isinstance(identity, dict) or
                            not isinstance(snapshot, dict)):
                        msg = (
                            f'Invalid passport JSON at index {i}: '
                            'expected {{identity, snapshot}}'
                        )
                        self._addWarning(msg)
                        continue

                    identity_id = identity.get('_id')
                    if not identity_id:
                        self._addWarning(
                            f'Missing identity._id in passport at index {i}')
                        continue
                    comp_id = identity_id

                    # determine unique group name (groups must be unique)
                    # use suffix indexing: <uuid>_1, <uuid>_2, ...
                    base_group_name = identity_id
                    idx = 1
                    existing_names = set()
                    for grp in sc.doc.Groups:
                        try:
                            existing_names.add(grp.Name)
                        except Exception:
                            continue
                    while True:
                        candidate = f'{base_group_name}_{idx}'
                        if candidate not in existing_names:
                            group_name = candidate
                            break
                        idx += 1

                    # get insertion plane from snapshot
                    try:
                        iframe = snapshot['iframe']
                        iplane = Rhino.Geometry.Plane(
                            Rhino.Geometry.Point3d(*iframe['o']),
                            Rhino.Geometry.Vector3d(*iframe['x']),
                            Rhino.Geometry.Vector3d(*iframe['y']),
                        )
                    except (KeyError, TypeError):
                        iplane = Rhino.Geometry.Plane.WorldXY

                    xform = Rhino.Geometry.Transform.PlaneToPlane(
                        Rhino.Geometry.Plane.WorldXY,
                        iplane)

                    cached_meshes = self.fetch_snapshot_meshes(
                        auth_core, snapshot)
                    geometry = snapshot.get('geometry', {}) or {}

                    # create component geometry
                    geo_ids = []

                    for xtr in self.ComponentExtrusions(geometry):
                        try:
                            xtr.Transform(xform)
                            geo_id = sc.doc.Objects.Add(xtr)
                            if geo_id != System.Guid.Empty:
                                geo_ids.append(geo_id)
                        except Exception as e:
                            self._addWarning(
                                f'Error baking extrusion: {str(e)}')

                    meshes = cached_meshes or self.ComponentMeshes(
                        geometry,
                        snapshot.get('color'),
                        identity_id)
                    for j, mesh in enumerate(meshes):
                        try:
                            mesh_copy = mesh.Duplicate() if cached_meshes else mesh  # NOQA
                            if mesh_copy and mesh_copy.IsValid:
                                mesh_copy.Transform(xform)
                                geo_id = sc.doc.Objects.Add(mesh_copy)
                                if geo_id != System.Guid.Empty:
                                    geo_ids.append(geo_id)
                                    rs.SetUserText(
                                        geo_id,
                                        'csc_mesh_index',
                                        str(j))
                                else:
                                    self._addWarning(
                                        f'Failed to add mesh {j} to document')
                            else:
                                self._addWarning(
                                    f'Invalid mesh {j} for '
                                    f'identity {identity_id}')
                        except Exception as e:
                            self._addWarning(
                                f'Error processing mesh {j}: {str(e)}')

                    point_clouds = self.fetch_snapshot_point_clouds(
                        auth_core, snapshot)
                    if point_clouds is None:
                        point_clouds = self.ComponentPointClouds(geometry)
                    for j, cloud in enumerate(point_clouds):
                        try:
                            cloud_copy = cloud.Duplicate()
                            if cloud_copy and cloud_copy.Count > 0:
                                cloud_copy.Transform(xform)
                                geo_id = sc.doc.Objects.Add(cloud_copy)
                                if geo_id != System.Guid.Empty:
                                    geo_ids.append(geo_id)
                                    rs.SetUserText(
                                        geo_id,
                                        'csc_point_cloud_index',
                                        str(j))
                                else:
                                    self._addWarning(
                                        f'Failed to add point cloud '
                                        f'{j} to document')
                            else:
                                self._addWarning(
                                    f'Invalid point cloud {j} for identity '
                                    f'{identity_id}')
                        except Exception as e:
                            self._addWarning(
                                f'Error processing point cloud {j}: {str(e)}')

                    for key in sorted(geometry.keys()):
                        if key in (
                                'meshes', 'extrusions', 'point_clouds',
                                'marker_points', 'reinforcements'):
                            continue
                        msg = (f'Missing implementation for geometry '
                               f'of type \'{key}\'!')
                        self._addWarning(msg)

                    if not geo_ids:
                        self._addWarning(
                            f'No geometry baked for identity {identity_id}')
                        continue

                    # add objects to document
                    # create layers if they are not present
                    lay_parent = 'CSC_COMPONENTS'
                    lay_name = identity_id
                    layer = '::'.join([lay_parent, lay_name])
                    if not rs.IsLayer(lay_parent):
                        rs.AddLayer(lay_parent)
                    if not rs.IsLayer(layer):
                        rs.AddLayer(layer, self.ComponentColor(snapshot))

                    # set layer and add component data as user strings
                    for gid in geo_ids:
                        rs.ObjectLayer(gid, layer)
                        # set component data as user string
                        rs.SetUserText(
                            gid,
                            'csc_component',
                            ComponentData[i])

                    # create tag
                    tag = Rhino.Geometry.TextEntity()
                    tag.Text = identity_id
                    tag.Plane = iplane
                    # specify height in millimeters
                    usf = Rhino.RhinoMath.UnitScale(
                        Rhino.UnitSystem.Millimeters,
                        sc.doc.ModelUnitSystem)
                    tag.TextHeight = 10.0 * usf
                    tag.Justification = (
                        Rhino.Geometry.TextJustification.MiddleCenter
                    )
                    id_tag = sc.doc.Objects.Add(tag)
                    # add tag to geometry IDs for grouping
                    if id_tag != System.Guid.Empty:
                        geo_ids.append(id_tag)

                    # set layer to tag
                    rs.ObjectLayer(id_tag, layer)

                    # create group with unique name
                    if len(geo_ids) > 1:
                        _ = sc.doc.Groups.Add(
                            group_name,
                            geo_ids)

                    baked_count += 1
                    object_count = len(geo_ids)
                    if object_count == 1:
                        self._addRemark(
                            f'Successfully baked component {comp_id}')
                    else:
                        self._addRemark(
                            f'Successfully baked component {comp_id} '
                            f'({object_count} objects)')

                except json.JSONDecodeError as e:
                    msg = (
                        f'Failed to parse component data for {comp_id}: '
                        f'{str(e)}'
                    )
                    self._addError(msg)
                    self.Component.Message = msg
                except Exception as e:
                    msg = f'Error baking component: {str(e)}'
                    self._addError(msg)
                    self.Component.Message = msg

            # Update success message
            if baked_count > 0:
                self.Component.Message = f'Baked {baked_count} component(s)'
                self._addRemark(
                    f'Successfully baked {baked_count} components')
            else:
                self.Component.Message = 'No components were baked'
                self._addWarning('No components were baked')
            # restore document context
            sc.doc = self.Component.OnPingDocument()
        else:
            self.Component.Message = 'Bake toggle is off'
            self._addRemark('Bake toggle is off - no components baked')
# ---------- end bakecomponents ----------

# ---- group: __DDU_CSC_EXAMPLE_04__
# comments & notes: Filter Components that were already fetched from the Catalogue.
# 
# In this case:
# - Only panels with X maximum of 500.0 and Y between 200.0 and 300.0
# Step 3
fragment_7 = ValueList({"Any": , "Only fragments": True, "Only non-fragmnents": False}, selected="Any")
maxdimensiony_5 = Slider(260, range=0..2000)
mindimensionx_5 = Slider(200, range=-0.1..2000)
maxdimensionx_5 = Slider(500, range=0..2000)
maxdimensionz_5 = Slider(0, range=0..500)
mindimensionz_5 = Slider(0, range=0..500)
mindimensiony_5 = Slider(245, range=0..2000)
complexity_7 = ValueList({"Any complexity": , "0", "1", "2", "3"}, selected="Any complexity")
dataset_5 = Panel("")
material_6 = ValueList({"Any material": , "corian", "concrete", "timber", "aluminium", "steel"}, selected="Any material")
type_6 = ValueList({"All types": , "panel", "beam", "column", "slab", "rubble", "brick", "pipe", "profile", "connector", "other"}, selected="All types")
componentdata_17 = Data(componentdata)
filtercomponents = FilterComponents(
    Type=type_6,
    Material=material_6,
    Dataset=dataset_5,
    Complexity=complexity_7,
    Fragment=fragment_7,
    MinDimensionX=mindimensionx_5,
    MaxDimensionX=maxdimensionx_5,
    MinDimensionY=mindimensiony_5,
    MaxDimensionY=maxdimensiony_5,
    MinDimensionZ=mindimensionz_5,
    MaxDimensionZ=maxdimensionz_5,
    ComponentData=componentdata_17)  # -> FilterDescription, ComponentData; inputs Type: String, Material: String, Dataset: String, Complexity: Int32, Fragment: Boolean, MinDimensionX: Double, MaxDimensionX: Double, MinDimensionY: Double, MaxDimensionY: Double, MinDimensionZ: Double, MaxDimensionZ: Double, ComponentData: tree of String
# ---------- filtercomponents: Python ----------
#! python3
# -*- coding: utf-8 -*-
# venv: DDU_CSC
print('ENV OK!')
# r: charset_normalizer
# r: requests

# PYTHON STANDARD LIBRARY IMPORTS ---------------------------------------------
import json  # NOQA

# RHINO AND GH RELATED IMPORTS ------------------------------------------------
import System  # NOQA
import Grasshopper  # NOQA
import Rhino  # NOQA

# GHENV COMPONENT SETTINGS ----------------------------------------------------
ghenv.Component.Name = 'FilterComponents'  # NOQA
ghenv.Component.NickName = 'FilterComponents'  # NOQA
ghenv.Component.Category = 'DDU_CSC'  # NOQA
ghenv.Component.SubCategory = '2 Catalog Interface'  # NOQA
ghenv.Component.Description = (  # NOQA
    'Filters a list of passport JSON entries ({identity, snapshot}) based on '
    'various criteria (type, material, dataset, complexity, fragment, '
    'bounding box dimensions). Works with local passport data from fetch '
    'components.'
)


class CSC_FilterComponents(Grasshopper.Kernel.GH_ScriptInstance):
    """
    Author: Max Benjamin Eschenbach
    License: MIT License
    Version: 260908
    """

    def __init__(self):
        """Initialize this component and set component parameters."""
        super().__init__()
        # initialize props
        self.Component = ghenv.Component  # NOQA
        self.InputParams = self.Component.Params.Input
        self.OutputParams = self.Component.Params.Output

    def _addRemark(self, msg: str = ''):
        """Add a remark message to the component."""
        rml = self.Component.RuntimeMessageLevel.Remark
        self.AddRuntimeMessage(rml, msg)

    def _addWarning(self, msg: str = ''):
        """Add a warning message to the component."""
        rml = self.Component.RuntimeMessageLevel.Warning
        self.AddRuntimeMessage(rml, msg)

    def _addError(self, msg: str = ''):
        """Add an error message to the component."""
        rml = self.Component.RuntimeMessageLevel.Error
        self.AddRuntimeMessage(rml, msg)

    def BeforeRunScript(self):
        """Perform some setup actions."""
        # Initialize input param descriptions
        self.InputParams[0].Description = (
            'Component type filter (e.g., "beam", "slab", "column")'
        )
        self.InputParams[1].Description = (
            'Material type filter (e.g., "concrete", "steel", "wood")'
        )
        self.InputParams[2].Description = (
            'Dataset name filter (e.g., "sas_cita_scans", '
            '"mineral_composite_sheets")'
        )
        self.InputParams[3].Description = (
            'Complexity level filter (0-3, where 0=simple, 3=complex)'
        )
        self.InputParams[4].Description = (
            'Fragment status filter (True for fragments, False for complete)'
        )
        self.InputParams[5].Description = (
            'Minimum X dimension filter (bounding box)'
        )
        self.InputParams[6].Description = (
            'Maximum X dimension filter (bounding box)'
        )
        self.InputParams[7].Description = (
            'Minimum Y dimension filter (bounding box)'
        )
        self.InputParams[8].Description = (
            'Maximum Y dimension filter (bounding box)'
        )
        self.InputParams[9].Description = (
            'Minimum Z dimension filter (bounding box)'
        )
        self.InputParams[10].Description = (
            'Maximum Z dimension filter (bounding box)'
        )
        self.InputParams[11].Description = (
            'Passport JSON strings to filter ({identity, snapshot}), e.g. '
            'from FetchAllComponents, FetchComponents, or '
            'FetchFilteredComponents'
        )
        # Initialize output param descriptions
        i = 0
        if self.OutputParams[0].Name == 'out':
            i += 1
        self.OutputParams[0+i].Description = (
            'Human-readable description of the applied filters'
        )
        self.OutputParams[1+i].Description = (
            'Filtered passport JSON strings ({identity, snapshot}). Use '
            '\'DisassembleComponent\' to access the individual fields '
            'ready for Grasshopper'
        )

    def apply_filters(self, passport: dict, filter_params: dict) -> bool:
        """
        Apply all filters to a single passport entry and return True if it
        passes. Identity fields (type, material, dataset) and snapshot
        fields (complexity, fragment, bbx) are evaluated separately.
        """
        identity = passport.get('identity') or {}
        snapshots = passport.get('snapshots') or []
        snapshot = snapshots[0] if snapshots else {}

        # Type filter (identity)
        if filter_params.get('type') and filter_params['type'].strip():
            if (identity.get('type', '').lower() !=
                    filter_params['type'].lower()):
                return False

        # Material filter (identity)
        if filter_params.get('material') and filter_params['material'].strip():
            if (identity.get('material', '').lower() !=
                    filter_params['material'].lower()):
                return False

        # Dataset filter (identity)
        if filter_params.get('dataset') and filter_params['dataset'].strip():
            if (identity.get('dataset', '').lower() !=
                    filter_params['dataset'].lower()):
                return False

        # Complexity filter (snapshot)
        if filter_params.get('complexity') is not None:
            if snapshot.get('complexity') != filter_params['complexity']:
                return False

        # Fragment filter (snapshot)
        if filter_params.get('fragment') is not None:
            if snapshot.get('fragment') != filter_params['fragment']:
                return False

        # Bounding box filters (snapshot)
        # Note: bbx is stored as [X, Y, Z] where X, Y, Z are dimensions
        bbx = snapshot.get('bbx')
        if (bbx and isinstance(bbx, list) and len(bbx) >= 3):
            bbx_x = bbx[0]
            bbx_y = bbx[1]
            bbx_z = bbx[2]

            # X dimension filters
            if filter_params.get('min_x') is not None:
                if bbx_x < filter_params['min_x']:
                    return False
            if filter_params.get('max_x') is not None:
                if bbx_x > filter_params['max_x']:
                    return False

            # Y dimension filters
            if filter_params.get('min_y') is not None:
                if bbx_y < filter_params['min_y']:
                    return False
            if filter_params.get('max_y') is not None:
                if bbx_y > filter_params['max_y']:
                    return False

            # Z dimension filters
            if filter_params.get('min_z') is not None:
                if bbx_z < filter_params['min_z']:
                    return False
            if filter_params.get('max_z') is not None:
                if bbx_z > filter_params['max_z']:
                    return False

        return True

    def generate_filter_description(self, filter_params: dict) -> str:
        """Generates a human-readable description of the applied filters."""
        description = []
        if filter_params.get('type'):
            description.append(f'\nType: {filter_params["type"]}')
        if filter_params.get('material'):
            description.append(f'\nMaterial: {filter_params["material"]}')
        if filter_params.get('dataset'):
            description.append(f'\nDataset: {filter_params["dataset"]}')
        if filter_params.get('complexity') is not None:
            description.append(f'\nComplexity: {filter_params["complexity"]}')
        if filter_params.get('fragment') is not None:
            description.append(f'\nFragment: {filter_params["fragment"]}')

        # Handle bounding box filters with detailed information
        bbx_filters = []
        if filter_params.get('min_x') is not None:
            bbx_filters.append(f'\nX >= {filter_params["min_x"]:.2f}')
        if filter_params.get('max_x') is not None:
            bbx_filters.append(f'\nX <= {filter_params["max_x"]:.2f}')
        if filter_params.get('min_y') is not None:
            bbx_filters.append(f'\nY >= {filter_params["min_y"]:.2f}')
        if filter_params.get('max_y') is not None:
            bbx_filters.append(f'\nY <= {filter_params["max_y"]:.2f}')
        if filter_params.get('min_z') is not None:
            bbx_filters.append(f'\nZ >= {filter_params["min_z"]:.2f}')
        if filter_params.get('max_z') is not None:
            bbx_filters.append(f'\nZ <= {filter_params["max_z"]:.2f}')

        if bbx_filters:
            description.append(f'\nBounding Box: {", ".join(bbx_filters)}')

        return f'Applied filters: {", ".join(description)}'

    def RunScript(self,
            Type: str,
            Material: str,
            Dataset: str,
            Complexity: int,
            Fragment: bool,
            MinDimensionX: float,
            MaxDimensionX: float,
            MinDimensionY: float,
            MaxDimensionY: float,
            MinDimensionZ: float,
            MaxDimensionZ: float,
            ComponentData: Grasshopper.DataTree[str]):
        # Validate input data
        if not ComponentData or ComponentData.DataCount == 0:
            msg = ('No passport data provided. '
                   'Please connect ComponentData input.')
            self._addWarning(msg)
            self.Component.Message = msg

            # Return empty results
            FilterDescription = Grasshopper.DataTree[System.Object]()
            FilteredComponentData = Grasshopper.DataTree[System.Object]()
            __Results = (FilterDescription, FilteredComponentData)
            return __Results

        try:
            self.Component.Message = 'Building filter parameters...'

            # Build filter parameters dictionary
            filter_params = {}

            # Add type filter if provided
            if Type and Type.strip() and Type.lower() != 'alltypes':
                filter_params['type'] = Type.strip()

            # Add material filter if provided
            if (Material and Material.strip() and
                    Material.lower() != 'allmaterials'):
                filter_params['material'] = Material.strip()

            # Add dataset filter if provided
            if (Dataset and Dataset.strip() and
                    Dataset.lower() != 'alldatasets'):
                filter_params['dataset'] = Dataset.strip()

            # Add complexity filter if provided
            if Complexity is not None:
                filter_params['complexity'] = Complexity

            # Add fragment filter if provided
            if Fragment is not None:
                filter_params['fragment'] = Fragment

            # Add bounding box filters if provided
            if MinDimensionX is not None and MinDimensionX != 0.0:
                filter_params['min_x'] = MinDimensionX
            if MaxDimensionX is not None and MaxDimensionX != 0.0:
                filter_params['max_x'] = MaxDimensionX
            if MinDimensionY is not None and MinDimensionY != 0.0:
                filter_params['min_y'] = MinDimensionY
            if MaxDimensionY is not None and MaxDimensionY != 0.0:
                filter_params['max_y'] = MaxDimensionY
            if MinDimensionZ is not None and MinDimensionZ != 0.0:
                filter_params['min_z'] = MinDimensionZ
            if MaxDimensionZ is not None and MaxDimensionZ != 0.0:
                filter_params['max_z'] = MaxDimensionZ

            # Generate human-readable filter description
            filter_description = self.generate_filter_description(
                filter_params
            )

            self.Component.Message = 'Filtering components...'

            # Set up output trees and results tuple
            FilterDescription = Grasshopper.DataTree[System.Object]()
            FilteredComponentData = Grasshopper.DataTree[System.Object]()
            __Results = (FilterDescription, FilteredComponentData)

            # Add filter description to the filter query output
            FilterDescription.Add(
                filter_description,
                Grasshopper.Kernel.Data.GH_Path(0))

            # Filter components
            filtered_count = 0
            total_count = 0

            # Loop over all branches
            for i in range(ComponentData.BranchCount):
                ghp = ComponentData.Paths[i]
                for j, comp in enumerate(ComponentData.Branches[i]):
                    total_count += 1
                    try:
                        # Load passport JSON
                        passport = json.loads(comp)
                        identity = passport.get('identity')
                        snapshots = passport.get('snapshots') or []
                        snapshot = snapshots[0] if snapshots else None
                        if not isinstance(identity, dict) or not isinstance(
                                snapshot, dict):
                            self._addWarning(
                                'Skipping entry: not passport JSON '
                                '({identity, snapshot})')
                            continue

                        # Apply filters
                        if self.apply_filters(passport, filter_params):
                            # Entry passes all filters, add to output
                            FilteredComponentData.Add(comp, ghp)
                            filtered_count += 1

                    except json.JSONDecodeError as e:
                        msg = f'Failed to parse passport JSON: {str(e)}'
                        self._addWarning(msg)
                        continue
                    except Exception as e:
                        msg = f'Error processing component: {str(e)}'
                        self._addWarning(msg)
                        continue

            # Update component message
            if filtered_count == 0:
                msg = 'No components match the applied filters.'
                self.Component.Message = msg
                self._addWarning(msg)
            else:
                msg = f'Filtered {filtered_count} of {total_count} components.'
                self.Component.Message = msg
                self._addRemark(
                    f'Successfully filtered {filtered_count} components '
                    f'from {total_count} total components'
                )

            return __Results

        except Exception as e:
            msg = f'Unexpected error during filtering: {str(e)}'
            self._addError(msg)
            self.Component.Message = msg

            # Return empty results if there was an error
            FilterDescription = Grasshopper.DataTree[System.Object]()
            FilteredComponentData = Grasshopper.DataTree[System.Object]()
            __Results = (FilterDescription, FilteredComponentData)
            return __Results
# ---------- end filtercomponents ----------
log = Panel(filtercomponents.FilterDescription)
componentdata_18 = Data(filtercomponents.ComponentData)

# ---- group: __DDU_CSC_EXAMPLE_02__
# Step 3
# comments & notes: Fetch reduced Geometry, either by ID, JSON String or Geometry (with userstring-attached json string)
# 
# NOTE: This may take some time to load, especially for multiple objects and/or high-res (detailed) meshes!
# comments & notes: You can check for reduced (default, already pretty detailed!) or detailed (=original resolution) meshes.
componentdata_19 = Data(componentdata_5)
fetchreducedgeometry = FetchReducedGeometry(Input=componentdata_19)  # -> Geometry, GeometryType, ComponentID
# ---------- fetchreducedgeometry: Python ----------
#! python3
# -*- coding: utf-8 -*-
# venv: DDU_CSC
print('ENV OK!')
# r: charset_normalizer
# r: requests

# PYTHON STANDARD LIBRARY IMPORTS ---------------------------------------------
import json  # NOQA

# THIRD PARTY LIBRARY IMPORTS -------------------------------------------------
import requests  # NOQA

# RHINO AND GH RELATED IMPORTS ------------------------------------------------
import System  # NOQA
import Grasshopper  # NOQA
import Rhino  # NOQA
import scriptcontext as sc  # NOQA
import Rhino.Geometry as rg  # NOQA

# GHENV COMPONENT SETTINGS ----------------------------------------------------
ghenv.Component.Name = 'FetchReducedGeometry'  # NOQA
ghenv.Component.NickName = 'FetchReducedGeometry'  # NOQA
ghenv.Component.Category = 'DDU_CSC'  # NOQA
ghenv.Component.SubCategory = '2 Catalog Interface'  # NOQA
ghenv.Component.Description = (  # NOQA
    'Fetches the reduced (catalog default) snapshot geometry as binary PLY '
    'from the CSC API, with ETag caching.\n'
    'Input can be:\n'
    '- Geometry carrying the \'csc_component\' passport userstring\n'
    '- A passport JSON string ({identity, snapshots[]})\n'
    '- A raw identity_id (resolves the current snapshot)\n'
    '- A raw snapshot_id\n\n'
    'Falls back to the inline snapshot geometry (primitive meshes) when no '
    'reduced PLY is available. Point clouds have no reduced PLY; the inline '
    'preview (at most 5000 points) is returned instead.'
)


class CSC_FetchReducedGeometry(Grasshopper.Kernel.GH_ScriptInstance):
    """
    Author: Max Benjamin Eschenbach
    License: MIT License
    Version: 260908
    """

    # Resolution preference chain (reduced only; inline fallback otherwise)
    resolution_chain = ['reduced']
    # Point clouds have no reduced PLY; always use the inline preview.
    fetch_point_cloud_ply = False

    def __init__(self):
        """Initialize this component and set component parameters."""
        super().__init__()
        # initialize props
        self.Component = ghenv.Component  # NOQA
        self.InputParams = self.Component.Params.Input
        self.OutputParams = self.Component.Params.Output

    def _addRemark(self, msg: str = ''):
        """Add a remark message to the component."""
        rml = self.Component.RuntimeMessageLevel.Remark
        self.AddRuntimeMessage(rml, msg)

    def _addWarning(self, msg: str = ''):
        """Add a warning message to the component."""
        rml = self.Component.RuntimeMessageLevel.Warning
        self.AddRuntimeMessage(rml, msg)

    def _addError(self, msg: str = ''):
        """Add an error message to the component."""
        rml = self.Component.RuntimeMessageLevel.Error
        self.AddRuntimeMessage(rml, msg)

    def BeforeRunScript(self):
        """Perform some setup actions."""
        # Initialize input param descriptions
        self.InputParams[0].Description = (
            'Input can be:\n'
            '- Geometry with the \'csc_component\' passport userstring\n'
            '- A passport JSON string ({identity, snapshots[]})\n'
            '- A raw identity_id (resolves current snapshot)\n'
            '- A raw snapshot_id'
        )
        # Initialize output param descriptions
        i = 0
        if self.OutputParams[0].Name == 'out':
            i += 1
        self.OutputParams[0+i].Description = (
            'Fetched reduced geometry as Rhino meshes and point clouds '
            '(one object per snapshot primitive)'
        )
        self.OutputParams[1+i].Description = (
            'Per-primitive source: reduced (mesh PLY) or primitive '
            '(inline fallback, including point-cloud previews)'
        )
        self.OutputParams[2+i].Description = (
            'Snapshot ID that was processed'
        )

    def get_auth_core_from_sticky(self):
        """Get AuthCore instance from sticky storage."""
        auth_core = sc.sticky.get('CSC_AuthCore')
        if auth_core is None:
            msg = ('No authentication found. Please use CSC_Session component '
                   'first.')
            self._addError(msg)
            self.Component.Message = msg
            return None
        return auth_core

    def parse_json_safe(self, value):
        """Parse a JSON string, returning None on failure."""
        try:
            return json.loads(value)
        except (json.JSONDecodeError, TypeError):
            return None

    def normalize_passport(self, obj):
        """
        Classify a parsed JSON object into canonical passport
        {identity, snapshots[]}, or None.
        """
        if not isinstance(obj, dict):
            return None
        identity = obj.get('identity') or {}
        snaps = obj.get('snapshots') or []
        if snaps and isinstance(snaps[0], dict):
            return {'identity': identity, 'snapshots': snaps}
        snap = obj.get('snapshot')
        if isinstance(snap, dict):
            return {'identity': identity, 'snapshots': [snap]}
        # Bare snapshot document
        if 'geometry' in obj and 'identity_id' in obj:
            return {'identity': {}, 'snapshots': [obj]}
        return None

    def primary_snapshot(self, passport):
        """Return the snapshot row used for geometry fetch."""
        if not isinstance(passport, dict):
            return None
        snaps = passport.get('snapshots') or []
        if snaps and isinstance(snaps[0], dict):
            return snaps[0]
        return None

    def fetch_passport_by_identity(self, auth_core, identity_id):
        """Fetch {identity, snapshots[]} for an identity's current snapshot."""
        try:
            resp = auth_core.cached_get_passport(identity_id)
            if resp.status_code == 200:
                return auth_core.normalize_passport_output(resp.json())
        except Exception as e:
            self._addWarning(f'Identity passport fetch failed: {str(e)}')
        return None

    def fetch_passport_by_snapshot(self, auth_core, snapshot_id):
        """Build minimal passport from a bare snapshot document."""
        try:
            resp = auth_core.authorized_get(f'/snapshots/{snapshot_id}')
            if resp.status_code == 200:
                return {'identity': {}, 'snapshots': [resp.json()]}
        except Exception as e:
            self._addWarning(f'Snapshot fetch failed: {str(e)}')
        return None

    def resolve_passport(self, auth_core, Input):
        """
        Resolve the input into canonical passport {identity, snapshots[]}.
        Returns (passport_or_None, input_is_geometry).
        """
        input_is_geometry = isinstance(Input, rg.GeometryBase)

        # Geometry carrying the passport userstring
        if (hasattr(Input, 'UserStringCount') and
                Input.UserStringCount > 0):
            value = Input.GetUserString('csc_component')
            if value:
                passport = self.normalize_passport(
                    self.parse_json_safe(value))
                if passport:
                    return passport, input_is_geometry

        # String input: passport JSON, identity doc, or raw UUID
        if isinstance(Input, str):
            s = Input.strip()
            obj = self.parse_json_safe(s)
            if obj is not None:
                passport = self.normalize_passport(obj)
                if passport:
                    return passport, input_is_geometry
                # Identity document with a current snapshot pointer
                if (isinstance(obj, dict) and obj.get('_id') and
                        obj.get('current_snapshot_id')):
                    passport = self.fetch_passport_by_identity(
                        auth_core, obj['_id'])
                    if passport:
                        return passport, input_is_geometry
                return None, input_is_geometry
            # Not JSON: treat as a raw UUID (identity first, then snapshot)
            if auth_core.validate_uuid(s):
                passport = self.fetch_passport_by_identity(auth_core, s)
                if passport:
                    return passport, input_is_geometry
                passport = self.fetch_passport_by_snapshot(auth_core, s)
                if passport:
                    return passport, input_is_geometry

        return None, input_is_geometry

    def build_inline_mesh(self, mesh_data, default_color):
        """Build a Rhino mesh from an inline SnapshotMesh (Rhino Z-up)."""
        vertices = mesh_data.get('vertices')
        faces = mesh_data.get('faces')
        if not vertices or not faces:
            return None
        mesh = rg.Mesh()
        for v in vertices:
            mesh.Vertices.Add(float(v[0]), float(v[1]), float(v[2]))
        for f in faces:
            if len(f) == 3:
                mesh.Faces.AddFace(f[0], f[1], f[2])
            elif len(f) == 4:
                mesh.Faces.AddFace(f[0], f[1], f[2], f[3])
        colors = mesh_data.get('colors')
        if colors and len(colors) == len(vertices):
            for c in colors:
                mesh.VertexColors.Add(int(c[0]), int(c[1]), int(c[2]))
        elif default_color:
            try:
                r, g, b = default_color
                for _ in range(len(vertices)):
                    mesh.VertexColors.Add(int(r), int(g), int(b))
            except (ValueError, TypeError):
                pass
        mesh.Normals.ComputeNormals()
        mesh.Compact()
        return mesh

    def iframe_xform(self, snapshot):
        """Build the world->iframe transform from the snapshot iframe."""
        iframe = snapshot.get('iframe')
        if not iframe:
            return None
        try:
            plane = rg.Plane(
                rg.Point3d(*iframe['o']),
                rg.Vector3d(*iframe['x']),
                rg.Vector3d(*iframe['y']),
            )
            return rg.Transform.PlaneToPlane(rg.Plane.WorldXY, plane)
        except (KeyError, TypeError):
            return None

    def fetch_primitive_meshes(self, auth_core, snapshot):
        """
        Fetch one mesh per snapshot mesh primitive, preferring the PLY
        resolution chain and falling back to inline geometry.
        Returns a list of (mesh, source) tuples.
        """
        snapshot_id = snapshot.get('_id')
        geometry = snapshot.get('geometry', {}) or {}
        inline_meshes = geometry.get('meshes', []) or []
        res_map = snapshot.get('mesh_ply_resolutions', {}) or {}
        default_color = snapshot.get('color') or [110, 110, 110]

        results = []
        for i in range(len(inline_meshes)):
            available = res_map.get(str(i), []) or []
            mesh = None
            source = None
            for resolution in self.resolution_chain:
                if resolution in available:
                    m, _etag, _from_cache = (
                        auth_core.cached_get_snapshot_mesh(
                            snapshot_id, i, resolution)
                    )
                    if m is not None:
                        mesh = m
                        source = resolution
                        break
            if mesh is None:
                mesh = self.build_inline_mesh(inline_meshes[i], default_color)
                source = 'primitive'
            if mesh is not None:
                results.append((mesh, source))
        return results

    def build_inline_point_cloud(self, pc_data):
        """Build a Rhino point cloud from one inline SnapshotPointCloud."""
        if not isinstance(pc_data, dict):
            return None
        pts = pc_data.get('points', []) or []
        if not pts:
            return None
        cloud = rg.PointCloud()
        colors = pc_data.get('colors')
        if colors and len(colors) == len(pts):
            for p, c in zip(pts, colors):
                cloud.Add(
                    rg.Point3d(float(p[0]), float(p[1]), float(p[2])),
                    System.Drawing.Color.FromArgb(*[int(v) for v in c]),
                )
        else:
            for p in pts:
                cloud.Add(rg.Point3d(float(p[0]), float(p[1]), float(p[2])))
        return cloud if cloud.Count > 0 else None

    def fetch_primitive_point_clouds(self, auth_core, snapshot):
        """
        Fetch one point cloud per snapshot primitive.

        FetchReduced uses the inline preview only (no reduced PLY exists).
        FetchDetailed prefers the full PLY, then the inline preview.
        Returns a list of (cloud, source) tuples.
        """
        geometry = snapshot.get('geometry', {}) or {}
        inline_pcs = geometry.get('point_clouds', []) or []
        snapshot_id = snapshot.get('_id')
        results = []
        for i in range(len(inline_pcs)):
            cloud = None
            source = None
            if self.fetch_point_cloud_ply and auth_core and snapshot_id:
                try:
                    cloud = auth_core.cached_get_snapshot_point_cloud(
                        snapshot_id, i)
                    if cloud is not None:
                        source = 'detailed'
                except Exception as e:
                    self._addWarning(
                        'Point cloud PLY fetch failed '
                        f'for index {i}: {str(e)}')
            if cloud is None:
                cloud = self.build_inline_point_cloud(inline_pcs[i])
                source = 'primitive'
            if cloud is not None:
                results.append((cloud, source))
        return results

    def collect_fetched_geometry(self, auth_core, snapshot):
        """
        Return meshes then point clouds as
        (geometry, source, kind, index) tuples.
        """
        items = []
        for i, (mesh, source) in enumerate(
                self.fetch_primitive_meshes(auth_core, snapshot)):
            items.append((mesh, source, 'mesh', i))
        for i, (cloud, source) in enumerate(
                self.fetch_primitive_point_clouds(auth_core, snapshot)):
            items.append((cloud, source, 'point_cloud', i))
        return items

    def select_fetched_geometry(self, Input, input_is_geometry, items):
        """
        If the input geometry carries a primitive index, return only that
        primitive of the matching kind.
        """
        if not (input_is_geometry and hasattr(Input, 'GetUserString')):
            return items
        if isinstance(Input, rg.PointCloud):
            raw = Input.GetUserString('csc_point_cloud_index')
            if raw:
                try:
                    idx = int(raw)
                except (TypeError, ValueError):
                    return items
                filtered = [
                    item for item in items
                    if item[2] == 'point_cloud' and item[3] == idx
                ]
                return filtered or items
            return items
        raw = Input.GetUserString('csc_mesh_index')
        if raw:
            try:
                idx = int(raw)
            except (TypeError, ValueError):
                return items
            filtered = [
                item for item in items
                if item[2] == 'mesh' and item[3] == idx
            ]
            return filtered or items
        return items

    def RunScript(self, Input):
        # Get AuthCore instance from sticky storage
        auth_core = self.get_auth_core_from_sticky()
        if auth_core is None:
            return

        # Check if authentication is valid
        if not auth_core.is_valid():
            msg = ('Authentication expired. Please use CSC_Session '
                   'component to refresh.')
            self._addError(msg)
            self.Component.Message = msg
            return

        # Input validation
        if not Input:
            msg = 'Please provide input data.'
            self._addWarning(msg)
            self.Component.Message = msg
            return

        # Set up outputs
        GeometryData = System.Collections.Generic.List[System.Object]()
        GeometrySource = System.Collections.Generic.List[str]()
        SnapshotID = System.Collections.Generic.List[str]()
        __Results = (GeometryData, GeometrySource, SnapshotID)

        try:
            self.Component.Message = 'Processing input...'

            passport, input_is_geometry = self.resolve_passport(
                auth_core, Input)
            snapshot = self.primary_snapshot(passport)
            if not passport or not snapshot:
                msg = 'Could not resolve a snapshot from input.'
                self._addError(msg)
                self.Component.Message = msg
                return __Results
            snapshot_id = snapshot.get('_id')
            if not snapshot_id or not auth_core.validate_uuid(snapshot_id):
                msg = f'Snapshot ID <{snapshot_id}> is not a valid UUID!'
                self._addError(msg)
                self.Component.Message = msg
                return __Results

            self.Component.Message = (
                f'Fetching reduced geometry for snapshot {snapshot_id}...'
            )

            items = self.collect_fetched_geometry(auth_core, snapshot)
            if not items:
                msg = f'No geometry available for snapshot {snapshot_id}'
                self._addError(msg)
                self.Component.Message = msg
                return __Results

            # Apply the iframe transform to position geometry in the document
            xform = self.iframe_xform(snapshot)
            if xform is not None:
                for geom, _source, _kind, _idx in items:
                    geom.Transform(xform)

            passport_json = auth_core.passport_json_string(passport)
            for geom, _source, kind, idx in items:
                if hasattr(geom, 'SetUserString'):
                    geom.SetUserString('csc_component', passport_json)
                    if kind == 'mesh':
                        geom.SetUserString('csc_mesh_index', str(idx))
                    else:
                        geom.SetUserString(
                            'csc_point_cloud_index', str(idx))

            selected = self.select_fetched_geometry(
                Input, input_is_geometry, items)
            for geom, source, _kind, _idx in selected:
                GeometryData.Add(geom)
                GeometrySource.Add(source)

            SnapshotID.Add(snapshot_id)

            mesh_count = sum(
                1 for _g, _s, kind, _i in selected if kind == 'mesh')
            pc_count = sum(
                1 for _g, _s, kind, _i in selected
                if kind == 'point_cloud')
            self.Component.Message = (
                f'Fetched reduced geometry ({mesh_count} mesh(es), '
                f'{pc_count} point cloud(s)) for {snapshot_id}'
            )
            self._addRemark(
                f'Fetched reduced geometry ({mesh_count} mesh(es), '
                f'{pc_count} point cloud(s)) for snapshot {snapshot_id}'
            )

            return __Results

        except requests.exceptions.ConnectionError as e:
            msg = 'Cannot connect to server. Please check your connection.'
            self._addError(msg + f'\nFull Error: {str(e)}')
            self.Component.Message = msg

        except requests.exceptions.Timeout as e:
            msg = 'Request timeout. Server may be slow.'
            self._addError(msg + f'\nFull Error: {str(e)}')
            self.Component.Message = msg

        except requests.exceptions.RequestException as e:
            msg = f'Request error: {str(e)}'
            self._addError(msg)
            self.Component.Message = msg

        except Exception as e:
            msg = f'Unexpected error: {str(e)}'
            self._addError(msg)
            self.Component.Message = msg

        return __Results
# ---------- end fetchreducedgeometry ----------
panel_7 = Panel(fetchreducedgeometry.ComponentID)
panel_8 = Panel(fetchreducedgeometry.GeometryType)
geometry_3 = Data(fetchreducedgeometry.Geometry)

# ---- group: __DDU_CSC_EXAMPLE_10__
# comments & notes: List all snapshot versions for one identity (id and name)
componentdata_20 = Data(componentdata_9)
fetchallsnapshots = FetchAllSnapshots(Input=componentdata_20)  # -> ComposeData
# ---------- fetchallsnapshots: Python ----------
#! python3
# -*- coding: utf-8 -*-
# venv: DDU_CSC
print('ENV OK!')
# r: charset_normalizer
# r: requests

# PYTHON STANDARD LIBRARY IMPORTS ---------------------------------------------
import json  # NOQA

# THIRD PARTY LIBRARY IMPORTS -------------------------------------------------
import requests  # NOQA

# RHINO AND GH RELATED IMPORTS ------------------------------------------------
import System  # NOQA
import Grasshopper  # NOQA
import Rhino  # NOQA
import scriptcontext as sc  # NOQA

# GHENV COMPONENT SETTINGS ----------------------------------------------------
ghenv.Component.Name = 'FetchAllSnapshots'  # NOQA
ghenv.Component.NickName = 'FetchAllSnapshots'  # NOQA
ghenv.Component.Category = 'DDU_CSC'  # NOQA
ghenv.Component.SubCategory = '2 Catalog Interface'  # NOQA
ghenv.Component.Description = (  # NOQA
    'Fetches passport JSON with every snapshot for one identity '
    '({identity, snapshots[]}). Input can be an identity UUID or passport '
    'JSON.'
)


class CSC_FetchAllSnapshots(Grasshopper.Kernel.GH_ScriptInstance):
    """
    Author: Max Benjamin Eschenbach
    License: MIT License
    Version: 260908
    """

    def __init__(self):
        super().__init__()
        self.Component = ghenv.Component  # NOQA
        self.InputParams = self.Component.Params.Input
        self.OutputParams = self.Component.Params.Output

    def _addRemark(self, msg: str = ''):
        rml = self.Component.RuntimeMessageLevel.Remark
        self.AddRuntimeMessage(rml, msg)

    def _addWarning(self, msg: str = ''):
        rml = self.Component.RuntimeMessageLevel.Warning
        self.AddRuntimeMessage(rml, msg)

    def _addError(self, msg: str = ''):
        rml = self.Component.RuntimeMessageLevel.Error
        self.AddRuntimeMessage(rml, msg)

    def BeforeRunScript(self):
        self.InputParams[0].Description = (
            'Identity UUID or passport JSON ({identity, snapshots[]})'
        )
        i = 0
        if self.OutputParams[0].Name == 'out':
            i += 1
        self.OutputParams[0 + i].Description = (
            'Passport JSON string: {identity, snapshots[]} with every version'
        )

    def get_auth_core_from_sticky(self):
        auth_core = sc.sticky.get('CSC_AuthCore')
        if auth_core is None:
            msg = ('No authentication found. Please use CSC_Session component '
                   'first.')
            self._addError(msg)
            self.Component.Message = msg
            return None
        return auth_core

    def RunScript(self, Input):
        Passport = ''

        auth_core = self.get_auth_core_from_sticky()
        if auth_core is None:
            return Passport

        if not auth_core.is_valid():
            msg = ('Authentication expired. Please use CSC_Session '
                   'component to refresh.')
            self._addError(msg)
            self.Component.Message = msg
            return Passport

        if Input is None or (isinstance(Input, str) and not str(Input).strip()):
            msg = 'Please provide an identity UUID or passport JSON.'
            self._addWarning(msg)
            self.Component.Message = msg
            return Passport

        identity_id = auth_core.resolve_identity_id_from_input(Input)
        if not identity_id:
            msg = 'Input is not a valid identity UUID or passport JSON.'
            self._addError(msg)
            self.Component.Message = msg
            return Passport

        try:
            self.Component.Message = (
                f'Fetching all snapshots for identity {identity_id}...'
            )
            response = auth_core.cached_get_passport(
                identity_id,
                snapshots='all',
            )

            if response.status_code == 200:
                data = response.json()
                Passport = auth_core.passport_json_string(data)
                count = len(data.get('snapshots') or [])
                self.Component.Message = (
                    f'Fetched passport with {count} snapshot(s)'
                )
                return Passport

            if response.status_code == 401:
                msg = 'Authentication failed. Please sign in again.'
            elif response.status_code == 404:
                msg = f'Identity {identity_id} not found.'
            else:
                msg = f'Request failed with status code: {response.status_code}'
            self._addError(msg)
            self.Component.Message = msg

        except requests.exceptions.ConnectionError as e:
            msg = 'Cannot connect to server. Please check your connection.'
            self._addError(msg + f'\nFull Error: {str(e)}')
            self.Component.Message = msg
        except requests.exceptions.Timeout as e:
            msg = 'Request timeout. Server may be slow.'
            self._addError(msg + f'\nFull Error: {str(e)}')
            self.Component.Message = msg
        except Exception as e:
            msg = f'Unexpected error: {str(e)}'
            self._addError(msg)
            self.Component.Message = msg

        return Passport
# ---------- end fetchallsnapshots ----------
componentdata_21 = Data(fetchallsnapshots)

# ---- group: __DDU_CSC_EXAMPLE_01__
# comments & notes: We create a grid to display the components in an ordered fashion. This creates the grid based on the component bounding boxes.
# 
# NOTE: The component does NOT transform the components, it only puts out the tranformation to be applied.
# Step 3
spacing_2 = Slider(150, range=0..1000)
insertionpoint_2 = Point(Point(0, 0, 0))
componentdata_22 = Data(componentdata_2)
createarrangement_2 = CreateArrangement(ComponentData=componentdata_22, Spacing=spacing_2, InsertionPoint=insertionpoint_2)  # -> GridCells, GridPlanes, XForms; inputs ComponentData: tree, Spacing: Double, InsertionPoint: Point3d; same code as createarrangement
xform_2 = Data(createarrangement_2.XForms)
curvepreviewlw_2 = CurvePreviewLW(Curves=flatten(createarrangement_2.GridCells), Thickness=1)  # inputs Curves: list of Curve, Colors: list of Color, Thickness: list of Int32; same code as curvepreviewlw

# ----
# comments & notes: Submit the created Design to the Catalogue
toggle_2 = BooleanToggle(False)
designdata_3 = Data(designdata)
adddesign = AddDesign(DesignData=designdata_3, Run=toggle_2)  # -> AddedDesignData; inputs DesignData: String, Run: Boolean
# ---------- adddesign: Python ----------
#! python3
# -*- coding: utf-8 -*-
# venv: DDU_CSC
print('ENV OK!')
# r: charset_normalizer
# r: requests

# PYTHON STANDARD LIBRARY IMPORTS ---------------------------------------------
import json  # NOQA

# THIRD PARTY LIBRARY IMPORTS -------------------------------------------------
import requests  # NOQA

# RHINO AND GH RELATED IMPORTS ------------------------------------------------
import System  # NOQA
import Grasshopper  # NOQA
import Rhino  # NOQA
import scriptcontext as sc  # NOQA

# GHENV COMPONENT SETTINGS ----------------------------------------------------
ghenv.Component.Name = 'AddDesign'  # NOQA
ghenv.Component.NickName = 'AddDesign'  # NOQA
ghenv.Component.Category = 'DDU_CSC'  # NOQA
ghenv.Component.SubCategory = '2 Catalog Interface'  # NOQA
ghenv.Component.Description = (  # NOQA
    'Adds a new design to the remote database. Takes design data (JSON), '
    'validates it, and makes an authenticated POST request to add the design '
    'to the Catalog. Designs pin specific snapshots and may embed '
    'additional geometry directly in the JSON.'
)


class CSC_AddDesign(Grasshopper.Kernel.GH_ScriptInstance):
    """
    Author: Max Benjamin Eschenbach
    License: MIT License
    Version: 260609
    """

    def __init__(self):
        """Initialize this component and set component parameters."""
        super().__init__()
        # initialize props
        self.Component = ghenv.Component  # NOQA
        self.InputParams = self.Component.Params.Input
        self.OutputParams = self.Component.Params.Output

    def _addRemark(self, msg: str = ''):
        """Add a remark message to the component."""
        rml = self.Component.RuntimeMessageLevel.Remark
        self.AddRuntimeMessage(rml, msg)

    def _addWarning(self, msg: str = ''):
        """Add a warning message to the component."""
        rml = self.Component.RuntimeMessageLevel.Warning
        self.AddRuntimeMessage(rml, msg)

    def _addError(self, msg: str = ''):
        """Add an error message to the component."""
        rml = self.Component.RuntimeMessageLevel.Error
        self.AddRuntimeMessage(rml, msg)

    def BeforeRunScript(self):
        """Perform some setup actions."""
        # Initialize input param descriptions
        self.InputParams[0].Description = (
            'Design data as JSON string to add to the database'
        )
        self.InputParams[1].Description = (
            'Toggle to execute the add operation'
        )
        # Initialize output param descriptions
        i = 0
        if self.OutputParams[0].Name == 'out':
            i += 1
        self.OutputParams[0+i].Description = (
            'The added design data returned from the server as JSON'
        )

    def get_auth_core_from_sticky(self):
        """Get AuthCore instance from sticky storage."""
        auth_core = sc.sticky.get('CSC_AuthCore')
        if auth_core is None:
            msg = ('No authentication found. Please use CSC_Session component '
                   'first.')
            self._addError(msg)
            self.Component.Message = msg
            return None
        return auth_core

    def RunScript(self, DesignData: str, Run: bool):
        # Set up output trees and results tuple
        AddedDesignData = Grasshopper.DataTree[System.Object]()

        # Get AuthCore instance from sticky storage
        auth_core = self.get_auth_core_from_sticky()
        if auth_core is None:
            return AddedDesignData

        # Check if authentication is valid
        if not auth_core.is_valid():
            msg = ('Authentication expired. Please use CSC_Session '
                   'component to refresh.')
            self._addError(msg)
            self.Component.Message = msg
            return AddedDesignData

        # Validate DesignData input
        if not DesignData:
            msg = 'Input parameter DesignData failed to collect data'
            self._addWarning(msg)
            return AddedDesignData

        # Validate JSON format
        try:
            design_json = json.loads(DesignData)
        except json.JSONDecodeError:
            msg = 'DesignData must be valid JSON format.'
            self._addError(msg)
            return AddedDesignData

        # Extract design ID for validation
        design_id = design_json.get('_id', '')
        if not design_id:
            msg = 'Design data must contain a valid _id field.'
            self._addError(msg)
            return AddedDesignData

        # Validate required fields for design creation
        required_fields = [
            'name', 'created', 'lastmodified', 'components'
        ]
        missing_fields = []
        for field in required_fields:
            if field not in design_json:
                missing_fields.append(field)

        if missing_fields:
            fields_str = ", ".join(missing_fields)
            msg = f'Design data missing required fields: {fields_str}'
            self._addError(msg)
            return AddedDesignData

        # Validate components structure
        components = design_json.get('components', [])
        if not isinstance(components, list):
            msg = 'Design components must be a list.'
            self._addError(msg)
            return AddedDesignData

        if len(components) == 0:
            msg = 'Design must contain at least one component.'
            self._addError(msg)
            return AddedDesignData

        # Validate each component entry
        for i, comp in enumerate(components):
            if not isinstance(comp, dict):
                msg = f'Component at index {i} must be a dictionary.'
                self._addError(msg)
                return AddedDesignData

            if 'snapshot' not in comp:
                msg = f'Component at index {i} missing "snapshot" field.'
                self._addError(msg)
                return AddedDesignData

            if 'iframe' not in comp:
                msg = f'Component at index {i} missing "iframe" field.'
                self._addError(msg)
                return AddedDesignData

            # Validate iframe structure
            iframe = comp['iframe']
            if not isinstance(iframe, dict):
                msg = f'Component at index {i} iframe must be a dictionary.'
                self._addError(msg)
                return AddedDesignData

            required_iframe_fields = ['o', 'x', 'y', 'z']
            for field in required_iframe_fields:
                if field not in iframe:
                    msg = (
                        f'Component at index {i} iframe missing {field} field.'
                    )
                    self._addError(msg)
                    self.Component.Message = msg
                    return AddedDesignData

                if (not isinstance(iframe[field], list) or
                        len(iframe[field]) != 3):
                    msg = (f'Component at index {i} iframe {field} must '
                           'be 3D vector')
                    self._addError(msg)
                    return AddedDesignData

        # Validate additional_geometry if present
        additional_geometry = design_json.get('additional_geometry', [])
        if not isinstance(additional_geometry, list):
            msg = 'Design additional_geometry must be a list.'
            self._addError(msg)
            return AddedDesignData

        if len(additional_geometry) > 25:
            msg = 'Design cannot have more than 25 additional geometries.'
            self._addError(msg)
            return AddedDesignData

        # Validate each additional geometry entry
        for i, ag in enumerate(additional_geometry):
            if not isinstance(ag, dict):
                msg = f'Additional geometry at index {i} must be a dictionary.'
                self._addError(msg)
                return AddedDesignData

            ag_id = ag.get('_id') or ag.get('id')
            if not ag_id:
                msg = (f'Additional geometry at index {i} missing "_id" '
                       'field.')
                self._addError(msg)
                return AddedDesignData

            if 'iframe' not in ag:
                msg = (f'Additional geometry at index {i} missing '
                       '"iframe" field.')
                self._addError(msg)
                return AddedDesignData

            if 'geometry' not in ag:
                msg = (f'Additional geometry at index {i} missing '
                       '"geometry" field.')
                self._addError(msg)
                return AddedDesignData

            # Validate iframe structure for additional geometry
            iframe = ag['iframe']
            if not isinstance(iframe, dict):
                msg = (f'Additional geometry at index {i} iframe must be '
                       'a dictionary.')
                self._addError(msg)
                return AddedDesignData

            required_iframe_fields = ['o', 'x', 'y', 'z']
            for field in required_iframe_fields:
                if field not in iframe:
                    msg = (f'Additional geometry at index {i} iframe missing '
                           f'{field} field.')
                    self._addError(msg)
                    return AddedDesignData

                if (not isinstance(iframe[field], list) or
                        len(iframe[field]) != 3):
                    msg = (f'Additional geometry at index {i} iframe {field} '
                           'must be 3D vector.')
                    self._addError(msg)
                    return AddedDesignData

        # Check payload size (rough estimate)
        try:
            payload_size = len(json.dumps(design_json))
            if payload_size > 10 * 1024 * 1024:  # 10MB
                msg = 'Design payload exceeds 10MB limit.'
                self._addError(msg)
                self.Component.Message = msg
                return AddedDesignData
        except Exception:
            pass  # Skip size check if serialization fails

        if not Run:
            status_msg = (f'Ready to add design with {len(components)} '
                          'snapshot placements')
            if additional_geometry:
                status_msg += (f' and {len(additional_geometry)} additional '
                               'geometries')
            status_msg += ' (toggle Run to execute)'
            self.Component.Message = status_msg
            return AddedDesignData

        try:
            self.Component.Message = 'Adding design to database...'

            # Make authenticated request to add design
            response = auth_core.authorized_post(
                '/designs', json_body=design_json)

            if response.status_code == 201:
                # Successfully added design
                json_design = response.json()
                design_id = json_design.get('_id', 'Unknown')

                # Create datatree path
                ghp = Grasshopper.Kernel.Data.GH_Path(0)
                # Add design data to the datatree
                AddedDesignData.Add(json.dumps(json_design), ghp)

                self._addRemark(
                    f'Successfully added design {design_id} to database'
                )
                self.Component.Message = f'Added design {design_id}'

            elif response.status_code == 400:
                msg = 'Invalid design data format.'
                self._addError(msg)
                self.Component.Message = msg

            elif response.status_code == 401:
                msg = 'Authentication failed. Please sign in again.'
                self._addError(msg)
                self.Component.Message = msg
                return AddedDesignData

            elif response.status_code == 403:
                msg = 'Access denied. Insufficient permissions.'
                self._addError(msg)
                self.Component.Message = msg
                return AddedDesignData

            elif response.status_code == 409:
                msg = 'Design already exists with this data.'
                self._addWarning(msg)
                self.Component.Message = msg

            elif response.status_code == 413:
                msg = 'Design payload exceeds 10MB limit.'
                self._addError(msg)
                self.Component.Message = msg

            elif response.status_code == 422:
                # Try to get detailed validation error from response
                try:
                    error_detail = response.json()
                    if 'detail' in error_detail:
                        if isinstance(error_detail['detail'], list):
                            # Pydantic validation errors
                            validation_errors = []
                            for error in error_detail['detail']:
                                field = error.get('loc', ['unknown'])[-1]
                                message = error.get('msg', 'validation error')
                                validation_errors.append(f"{field}: {message}")
                            errors_str = '\n'.join(validation_errors)
                            msg = (f'Design data validation failed:\n'
                                   f'{errors_str}')
                        else:
                            detail = error_detail["detail"]
                            msg = (f'Design data validation failed: '
                                   f'{detail}')
                    else:
                        msg = (f'Design data validation failed: '
                               f'{error_detail}')
                except (json.JSONDecodeError, KeyError):
                    msg = 'Design data validation failed.'
                self._addError(msg)
                self.Component.Message = msg

            elif response.status_code == 500:
                msg = 'Server error. Please try again later.'
                self._addWarning(msg)
                self.Component.Message = msg

            else:
                msg = (f'Request failed with status code: '
                       f'{response.status_code}')
                self._addError(msg)
                self.Component.Message = msg

            return AddedDesignData

        except requests.exceptions.ConnectionError as e:
            msg = 'Cannot connect to server. Please check your connection.'
            self._addError(msg + f'\nFull Error: {str(e)}')
            self.Component.Message = msg

        except requests.exceptions.Timeout as e:
            msg = 'Request timeout. Server may be slow.'
            self._addError(msg + f'\nFull Error: {str(e)}')
            self.Component.Message = msg

        except requests.exceptions.RequestException as e:
            msg = f'Request error: {str(e)}'
            self._addError(msg)
            self.Component.Message = msg

        except Exception as e:
            msg = f'Unexpected error: {str(e)}'
            self._addError(msg)
            self.Component.Message = msg

        # Return empty results if there was an error
        AddedDesignData = Grasshopper.DataTree[System.Object]()
        return AddedDesignData
# ---------- end adddesign ----------

# ----
# comments & notes: Transform (Move, Rotate...) Components by modifying the iframe attribute
componentdata_23 = Data(componentdata_8)
xform_3 = Data(xform)
transformcomponent = TransformComponent(ComponentData=componentdata_23, XForm=xform_3)  # -> XComponentData; inputs ComponentData: String, XForm: Transform
# ---------- transformcomponent: Python ----------
#! python3
# -*- coding: utf-8 -*-
# venv: DDU_CSC
print('ENV OK!')
# r: charset_normalizer
# r: requests

# PYTHON STANDARD LIBRARY IMPORTS ---------------------------------------------
import json  # NOQA

# RHINO AND GH RELATED IMPORTS ------------------------------------------------
import System  # NOQA
import Rhino  # NOQA
import Grasshopper  # NOQA

# GHENV COMPONENT SETTINGS ----------------------------------------------------
ghenv.Component.Name = 'TransformComponent'  # NOQA
ghenv.Component.NickName = 'TransformComponent'  # NOQA
ghenv.Component.Category = 'DDU_CSC'  # NOQA
ghenv.Component.SubCategory = '3 Component Operations'  # NOQA
ghenv.Component.Description = (  # NOQA
    'Applies a Rhino transformation to the iframe (insertion frame) of a '
    'component snapshot in passport JSON ({identity, snapshot}). Updates the '
    'snapshot coordinate system based on the applied transformation.'
)


class CSC_TransformComponent(Grasshopper.Kernel.GH_ScriptInstance):
    """
    Author: Max Benjamin Eschenbach
    License: MIT License
    Version: 260908
    """

    def __init__(self):
        """Initialize this component and set component parameters."""
        super().__init__()
        # initialize props
        self.Component = ghenv.Component  # NOQA
        self.InputParams = self.Component.Params.Input
        self.OutputParams = self.Component.Params.Output

    def _addRemark(self, msg: str = ''):
        """Add a remark message to the component."""
        rml = self.Component.RuntimeMessageLevel.Remark
        self.AddRuntimeMessage(rml, msg)

    def _addWarning(self, msg: str = ''):
        """Add a warning message to the component."""
        rml = self.Component.RuntimeMessageLevel.Warning
        self.AddRuntimeMessage(rml, msg)

    def _addError(self, msg: str = ''):
        """Add an error message to the component."""
        rml = self.Component.RuntimeMessageLevel.Error
        self.AddRuntimeMessage(rml, msg)

    def BeforeRunScript(self):
        """Perform some setup actions."""
        # Initialize input param descriptions
        self.InputParams[0].Description = (
            'Passport JSON string ({identity, snapshot}) from previous '
            'components.'
        )
        self.InputParams[1].Description = (
            'Rhino transform to apply to the snapshot insertion frame.'
        )
        # Initialize output param descriptions
        i = 0
        if self.OutputParams[0].Name == 'out':
            i += 1
        self.OutputParams[0+i].Description = (
            'Transformed passport JSON string ({identity, snapshot})!'
        )

    def PlaneToFrameDict(self, plane: Rhino.Geometry.Plane) -> dict:
        """
        Convert a Rhino plane to a frame dictionary format.

        This method converts the plane's origin and axis vectors to the format
        expected by the component system for insertion frames.

        Args:
            plane: Rhino.Geometry.Plane object

        Returns:
            Dictionary with 'o', 'x', 'y', 'z' keys containing coordinate lists
        """
        iframe = {
            'o': [plane.OriginX, plane.OriginY, plane.OriginZ],
            'x': [plane.XAxis.X, plane.XAxis.Y, plane.XAxis.Z],
            'y': [plane.YAxis.X, plane.YAxis.Y, plane.YAxis.Z],
            'z': [plane.ZAxis.X, plane.ZAxis.Y, plane.ZAxis.Z]
        }
        return iframe

    def RunScript(self, ComponentData: str, XForm: Rhino.Geometry.Transform):
        # set up output trees and results tuple
        XComponentData = System.Collections.Generic.List[System.Object]()
        # reset message
        self.Component.Message = ''
        # Validate input parameters
        if not ComponentData:
            msg = 'Input ComponentData failed to collect data!'
            self._addWarning(msg)
            self.Component.Message = msg
            return XComponentData

        if not XForm:
            msg = 'Input XForm failed to collect data!'
            self._addWarning(msg)
            self.Component.Message = msg
            return XComponentData

        try:
            # Load and parse passport JSON ({identity, snapshot})
            jcomp = json.loads(ComponentData)
            snapshots = jcomp.get('snapshots') or []
            snapshot = snapshots[0] if snapshots else None
            if not isinstance(snapshot, dict):
                msg = 'Passport JSON has no snapshots to transform!'
                self._addError(msg)
                self.Component.Message = msg
                return XComponentData

            # Process insertion frame
            try:
                # Try to extract existing insertion frame from snapshot
                iframe = snapshot['iframe']
                iplane = Rhino.Geometry.Plane(
                    Rhino.Geometry.Point3d(*iframe['o']),
                    Rhino.Geometry.Vector3d(*iframe['x']),
                    Rhino.Geometry.Vector3d(*iframe['y']),
                )
                self._addRemark(
                    'Using existing insertion frame from snapshot'
                )
            except (KeyError, TypeError):
                # If there is no insertion frame,
                # create world XY plane as default
                iplane = Rhino.Geometry.Plane.WorldXY
                self._addRemark(
                    'No insertion frame found, using WorldXY plane'
                )

            # Apply the input transform to the insertion frame plane
            iplane.Transform(XForm)

            # Replace the insertion frame in the snapshot
            # with the transformed one
            snapshot['iframe'] = self.PlaneToFrameDict(iplane)

            # Convert back to JSON string for output
            XComponentData = json.dumps(jcomp)

            return XComponentData

        except json.JSONDecodeError as e:
            msg = f'Failed to parse component JSON data: {str(e)}'
            self._addError(msg)
            self.Component.Message = msg
            return XComponentData

        except Exception as e:
            msg = f'Unexpected error during transformation: {str(e)}'
            self._addError(msg)
            self.Component.Message = msg
            return XComponentData
# ---------- end transformcomponent ----------
componentdata_24 = Data(transformcomponent)

# ---- group: __DDU_CSC_EXAMPLE_06__
# Step 2.1
# comments & notes: Optional: Offset the design shapes, making the "demanded" geometry larger.
# 
# This can increase the chances of finding components that are large enough to fit the entire cell.
number_slider_3 = Slider(0, range=0..500)
designshapes_2 = Data(designshapes)
offset = OffsetCurve(Curve=designshapes_2, Distance=number_slider_3, Corners=1)  # -> flatten(Curve)
designshapes_offset = Data(offset)

# ---- group: __DDU_CSC_EXAMPLE_10__
# comments & notes: Convert the composite component data including all snapshots to a D2P in-memory Component
panel_9 = Panel("all")
componentdata_25 = Data(componentdata_21)
passporttod2p = PassportToD2P(ComponentData=componentdata_25, MeshMode=panel_9, CloudMode="all", SnapshotScope="all")  # -> D2PComponent; inputs ComponentData: tree of String
# ---------- passporttod2p: Python ----------
#! python3
# -*- coding: utf-8 -*-
# venv: DDU_CSC
print('ENV OK!')
# r: charset_normalizer
# r: requests
# r: d2p-core-py

# PYTHON STANDARD LIBRARY IMPORTS ---------------------------------------------
import json  # NOQA

# D2P WRAPPER IMPORTS ---------------------------------------------------------
from d2p_core import ComponentType, GHComponent, Member, Settings  # NOQA

# RHINO AND GH RELATED IMPORTS ------------------------------------------------
import System  # NOQA
import Rhino  # NOQA
import Grasshopper  # NOQA
import scriptcontext as sc  # NOQA

# GHENV COMPONENT SETTINGS ----------------------------------------------------
ghenv.Component.Name = 'PassportToD2P'  # NOQA
ghenv.Component.NickName = 'PassportToD2P'  # NOQA
ghenv.Component.Category = 'DDU_CSC'  # NOQA
ghenv.Component.SubCategory = '9 D2P Components Interface'  # NOQA
ghenv.Component.Description = (  # NOQA
    'Converts CSC passport JSON into an in-memory D2P GHComponent. Geometry '
    'is registered as a nested Member tree via SetMember (D2P ParentMember '
    '+ : layer paths). Every baked component gets id_<identity> and '
    'snap_<snapshot> shells so layer paths stay consistent for single- and '
    'multi-snapshot passport and distinct across catalog identities. '
    'Optional Parent prefixes ShortName for D2P child naming. CSC '
    'identity/snapshot metadata is stored on the component label user text. '
    'MeshMode: best | inline | reduced | detailed | all. '
    'CloudMode: best | inline | detailed | all (optional; defaults to '
    'MeshMode, with reduced mapped to inline). '
    'SnapshotScope: current | all.'
)

# CSC identity type -> D2P component type id (2-letter convention)
_TYPE_ID_MAP = {
    'panel': 'PN',
    'beam': 'BM',
    'column': 'CL',
    'slab': 'SB',
    'rubble': 'RB',
    'brick': 'BR',
    'pipe': 'PP',
    'profile': 'PR',
    'connector': 'CN',
    'other': 'OT',
}

# Mesh resolution preference for MeshMode=best (highest fidelity first)
_MESH_BEST_CHAIN = ('detailed', 'reduced', 'inline')
# Point clouds have no reduced PLY; best prefers the full cloud then inline.
_CLOUD_BEST_CHAIN = ('detailed', 'inline')


class _MemberTree:
    """
    Builds a D2P-native member hierarchy (shell parents + geometry leaves).

    Children are attached with SetMember so the wrapper can unwrap Python
    Member objects and so ParentMember / nested DynamicMembers stay in
    sync (same pattern as D2P.Core.Utility.Members.FindMembers).
    """

    def __init__(self, component, layer_color):
        self._component = component
        self._color = layer_color
        self._shells = {}
        self.has_members = False

    def _attach(self, member, parent=None):
        if parent is not None:
            parent.SetMember(member)
        else:
            self._component.SetMember(member)
        self.has_members = True
        return member

    def _shell(self, key, layer_name, parent=None):
        if key in self._shells:
            return self._shells[key]
        member = Member(self._component, layer_name, self._color)
        self._shells[key] = member
        return self._attach(member, parent)

    def add_leaf(self, path_segments, geometry):
        if geometry is None or not path_segments:
            return
        parent = None
        for i, segment in enumerate(path_segments[:-1]):
            key = tuple(path_segments[:i + 1])
            parent = self._shell(key, segment, parent)
        leaf = Member(
            self._component, path_segments[-1], self._color)
        leaf.SetObject(geometry)
        self._attach(leaf, parent)

    def add_leaf_many(self, path_segments, geometries):
        if not geometries or not path_segments:
            return
        parent = None
        for i, segment in enumerate(path_segments[:-1]):
            key = tuple(path_segments[:i + 1])
            parent = self._shell(key, segment, parent)
        leaf = Member(
            self._component, path_segments[-1], self._color)
        leaf.SetObjects(geometries)
        self._attach(leaf, parent)


class CSC_PassportToD2P(Grasshopper.Kernel.GH_ScriptInstance):
    """
    Author: Max Benjamin Eschenbach
    License: MIT License
    Version: 260908

    D2P member layer taxonomy (SetMember tree)
    -----------------------------------------
    Shell members group geometry; leaves hold Rhino geometry.
    Nested members are attached with SetMember (sets ParentMember).

    Every member path always starts with catalog identity, then snapshot:

        id_<8> -> snap_<8> -> Mesh -> 00 -> detailed
        id_<8> -> snap_<8> -> PointCloud -> 00 -> detailed
        id_<8> -> snap_<8> -> Extrusion -> 00

    id_* distinguishes catalog identities when baking (D2P shares type
    root layers across instances). snap_* is always present so single- and
    multi-snapshot passport share the same depth.

    D2P component naming (optional Parent input)
    --------------------------------------------
    ShortName = parent.ShortName + NameDelimiter + snapshot.name
    (same rule as D2P CreateComponent). Does NOT use CSC parent_identities.
    """

    def __init__(self):
        """Initialize this component and set component parameters."""
        super().__init__()
        self.Component = ghenv.Component  # NOQA
        self.InputParams = self.Component.Params.Input
        self.OutputParams = self.Component.Params.Output

    def _addRemark(self, msg: str = ''):
        rml = self.Component.RuntimeMessageLevel.Remark
        self.AddRuntimeMessage(rml, msg)

    def _addWarning(self, msg: str = ''):
        rml = self.Component.RuntimeMessageLevel.Warning
        self.AddRuntimeMessage(rml, msg)

    def _addError(self, msg: str = ''):
        rml = self.Component.RuntimeMessageLevel.Error
        self.AddRuntimeMessage(rml, msg)

    def BeforeRunScript(self):
        self.InputParams[0].Description = (
            'Passport JSON ({identity, snapshot} or future {snapshots[]}) '
            'from CSC catalog components.'
        )
        if self.InputParams.Count > 1:
            self.InputParams[1].Description = (
                "Mesh resolution: 'best' (default), 'inline', 'reduced', "
                "'detailed', or 'all' (register every available variant "
                'as separate leaf members).'
            )
        if self.InputParams.Count > 2:
            self.InputParams[4].Description = (
                "Point-cloud resolution: 'best' (default), 'inline', "
                "'detailed', or 'all'. 'reduced' is accepted as an alias "
                'for inline (no reduced point-cloud PLY exists). Empty '
                'inherits MeshMode (reduced maps to inline).'
            )
        if self.InputParams.Count > 3:
            self.InputParams[2].Description = (
                "Snapshot scope: 'current' (default) uses snapshots[0] "
                "only; 'all' includes every passport.snapshots[] entry. "
                'Each snapshot is always under a snap_* member shell.'
            )
        if self.InputParams.Count > 4:
            delim = Settings.NameDelimiter
            self.InputParams[3].Description = (
                'Optional D2P parent component (Generic) or parent ShortName '
                f'(text). Child ShortName becomes parent{delim}name '
                'for D2P parent-child retrieval. '
                'Ignores CSC parent_identities.'
            )
        i = 0
        if self.OutputParams[0].Name == 'out':
            i += 1
        self.OutputParams[0 + i].Description = (
            'In-memory D2P GHComponent (.NET IComponentBase) per passport '
            'entry. RetrieveGeometry accepts layer segments such as id_, '
            'snap_, Mesh, 00, or detailed (recursive).'
        )

    def _normalize_mode(self, value: str, allowed: tuple, default: str) -> str:
        key = (value or default).strip().lower()
        if key in allowed:
            return key
        self._addWarning(
            f'Unknown mode {value!r}, using {default!r}'
        )
        return default

    def _type_id(self, identity_type: str) -> str:
        key = (identity_type or 'other').strip().lower()
        if key in _TYPE_ID_MAP:
            return _TYPE_ID_MAP[key]
        if len(key) >= 2:
            return key[:2].upper()
        return 'OT'

    def _type_name(self, identity_type: str) -> str:
        key = (identity_type or 'other').strip().lower()
        return key.replace('_', ' ').title() or 'Other'

    def _snapshot_id(self, snapshot: dict) -> str:
        return str(snapshot.get('_id') or snapshot.get('id') or '')

    def _snapshot_color(self, snapshot: dict) -> tuple:
        color = snapshot.get('color') or [110, 110, 110]
        try:
            return (int(color[0]), int(color[1]), int(color[2]))
        except (TypeError, ValueError, IndexError):
            return (110, 110, 110)

    def _iframe_plane(self, snapshot: dict) -> Rhino.Geometry.Plane:
        try:
            iframe = snapshot['iframe']
            return Rhino.Geometry.Plane(
                Rhino.Geometry.Point3d(*iframe['o']),
                Rhino.Geometry.Vector3d(*iframe['x']),
                Rhino.Geometry.Vector3d(*iframe['y']),
            )
        except (KeyError, TypeError):
            return Rhino.Geometry.Plane.WorldXY

    def _iframe_transform(self, snapshot: dict) -> Rhino.Geometry.Transform:
        iplane = self._iframe_plane(snapshot)
        return Rhino.Geometry.Transform.PlaneToPlane(
            Rhino.Geometry.Plane.WorldXY,
            iplane,
        )

    def _identity_scope_label(self, identity: dict) -> str:
        iid = str(
            identity.get('_id') or identity.get('id') or ''
        ).replace('-', '')
        if not iid:
            return 'id_unknown'
        return f'id_{iid[:8]}'

    def _snapshot_scope_label(self, snapshot: dict) -> str:
        sid = self._snapshot_id(snapshot).replace('-', '')
        if not sid:
            return 'snap_unknown'
        return f'snap_{sid[:8]}'

    def _geometry_path(
            self,
            identity_label: str,
            snapshot_label: str,
            kind: str,
            index: int,
            source: str = None) -> list:
        path = [identity_label, snapshot_label, kind, f'{index:02d}']
        if source:
            path.append(source)
        return path

    def _resolve_parent_short_name(self, parent) -> str:
        if parent is None:
            return ''
        if isinstance(parent, str):
            return parent.strip()
        if hasattr(parent, 'ShortName'):
            name = parent.ShortName
            if name:
                return str(name)
        if hasattr(parent, 'NetObj'):
            net = parent.NetObj
            if hasattr(net, 'ShortName') and net.ShortName:
                return str(net.ShortName)
        text = str(parent).strip()
        return text if text and text != 'None' else ''

    def _child_short_name(self, base_name: str, parent) -> str:
        parent_name = self._resolve_parent_short_name(parent)
        if not parent_name:
            return base_name
        delimiter = Settings.NameDelimiter
        if delimiter in base_name:
            self._addRemark(
                f'ShortName {base_name!r} contains D2P name delimiter '
                f'{delimiter!r}; parent-child retrieval may be ambiguous'
            )
        return f'{parent_name}{delimiter}{base_name}'

    def _attach_csc_metadata(
            self,
            component,
            identity: dict,
            snapshot: dict,
            passport_json: str = None):
        try:
            label = component.Label
            base_objects = list(label.BaseObjects)
            if not base_objects:
                return
            attrs = base_objects[0].Attributes
            identity_id = identity.get('_id') or identity.get('id')
            if identity_id:
                attrs.SetUserString('csc_identity_id', str(identity_id))
            snapshot_id = self._snapshot_id(snapshot)
            if snapshot_id:
                attrs.SetUserString('csc_snapshot_id', snapshot_id)
            parent_identities = identity.get('parent_identities')
            if parent_identities:
                attrs.SetUserString(
                    'csc_parent_identities',
                    json.dumps(parent_identities),
                )
            if identity.get('type') is not None:
                attrs.SetUserString('csc_type', str(identity.get('type')))
            if identity.get('material') is not None:
                attrs.SetUserString(
                    'csc_material', str(identity.get('material')))
            if snapshot.get('assembly') is not None:
                attrs.SetUserString(
                    'csc_assembly', str(bool(snapshot['assembly'])))
            if snapshot.get('fragment') is not None:
                attrs.SetUserString(
                    'csc_fragment', str(bool(snapshot['fragment'])))
            if passport_json:
                attrs.SetUserString('csc_component', passport_json)
        except Exception as e:
            self._addWarning(f'Could not attach CSC metadata to label: {e}')

    def _iter_snapshot_blocks(self, passport: dict, snapshot_scope: str):
        """Yield snapshot dicts from passport.snapshots[]."""
        snapshots = passport.get('snapshots') or []
        if not isinstance(snapshots, list):
            snapshots = []

        if snapshot_scope == 'all':
            for snap in snapshots:
                if isinstance(snap, dict):
                    yield snap
            return

        if snapshots and isinstance(snapshots[0], dict):
            yield snapshots[0]

    def _get_auth_core(self):
        return sc.sticky.get('CSC_AuthCore')

    def _build_inline_mesh(self, mesh_data: dict, default_color: tuple):
        vertices = mesh_data.get('vertices')
        faces = mesh_data.get('faces')
        if not vertices or not faces:
            return None

        mesh = Rhino.Geometry.Mesh()
        for v in vertices:
            mesh.Vertices.Add(float(v[0]), float(v[1]), float(v[2]))
        for f in faces:
            if len(f) == 3:
                mesh.Faces.AddFace(f[0], f[1], f[2])
            elif len(f) == 4:
                mesh.Faces.AddFace(f[0], f[1], f[2], f[3])

        colors = mesh_data.get('colors')
        if colors:
            for c in colors:
                mesh.VertexColors.Add(int(c[0]), int(c[1]), int(c[2]))
        else:
            r, g, b = default_color
            for _ in range(len(vertices)):
                mesh.VertexColors.Add(r, g, b)

        mesh.Normals.ComputeNormals()
        mesh.Compact()
        return mesh

    def _fetch_ply_mesh(self, auth_core, snapshot_id: str,
                        mesh_index: int, resolution: str):
        if not auth_core:
            return None
        mesh, _etag, _cached = auth_core.cached_get_snapshot_mesh(
            snapshot_id, mesh_index, resolution)
        return mesh

    def _mesh_sources_for_index(
            self,
            mesh_mode: str,
            ply_available: list,
            inline_available: bool) -> list:
        ply_set = {r.strip().lower() for r in (ply_available or [])}

        if mesh_mode == 'all':
            sources = []
            if inline_available:
                sources.append('inline')
            for res in ('reduced', 'detailed'):
                if res in ply_set:
                    sources.append(res)
            return sources

        if mesh_mode in ('reduced', 'detailed'):
            if mesh_mode in ply_set:
                return [mesh_mode]
            if inline_available and mesh_mode == 'reduced':
                return ['inline']
            return []

        if mesh_mode == 'inline':
            return ['inline'] if inline_available else []

        for res in _MESH_BEST_CHAIN:
            if res == 'inline' and inline_available:
                return ['inline']
            if res in ply_set:
                return [res]
        return ['inline'] if inline_available else []

    def _resolve_cloud_mode(self, cloud_mode, mesh_mode: str) -> str:
        """
        CloudMode when set; otherwise inherit MeshMode (reduced -> inline).
        """
        if cloud_mode is None or (
                isinstance(cloud_mode, str) and not cloud_mode.strip()):
            if mesh_mode == 'reduced':
                return 'inline'
            return mesh_mode
        return self._normalize_mode(
            str(cloud_mode),
            ('best', 'inline', 'reduced', 'detailed', 'all'),
            'best',
        )

    def _fetch_ply_point_cloud(self, auth_core, snapshot_id: str, index: int):
        if not auth_core:
            return None
        return auth_core.cached_get_snapshot_point_cloud(
            snapshot_id, index)

    def _cloud_sources_for_index(
            self,
            cloud_mode: str,
            inline_available: bool) -> list:
        if cloud_mode == 'all':
            sources = []
            if inline_available:
                sources.append('inline')
            sources.append('detailed')
            return sources
        if cloud_mode in ('inline', 'reduced'):
            return ['inline'] if inline_available else []
        if cloud_mode == 'detailed':
            return ['detailed']
        sources = []
        for res in _CLOUD_BEST_CHAIN:
            if res == 'inline' and inline_available:
                sources.append('inline')
            elif res == 'detailed':
                sources.append('detailed')
        if not sources and inline_available:
            return ['inline']
        return sources

    def _build_extrusion(self, extr: dict):
        tol = Rhino.RhinoMath.SqrtEpsilon
        profile = extr.get('profile') or []
        if len(profile) < 3:
            return None

        pts = [Rhino.Geometry.Point3d(pt[0], pt[1], 0.0) for pt in profile]
        if len(pts) >= 2 and pts[0].DistanceTo(pts[-1]) <= tol:
            pts = pts[:-1]
        if len(pts) < 3:
            return None

        pl = Rhino.Geometry.Polyline()
        pl.AddRange(pts)
        if not pl.IsClosed:
            pl.Add(pl[0])

        height = float(extr.get('height', 0))
        if height <= 0:
            return None

        cxt = Rhino.Geometry.Extrusion.Create(
            pl.ToPolylineCurve(),
            Rhino.Geometry.Plane.WorldXY,
            height,
            True,
        )
        if cxt is None:
            return None

        cxt.Translate(Rhino.Geometry.Vector3d(0, 0, height * -0.5))
        return cxt

    def _build_point_cloud(self, pc_data: dict):
        cloud = Rhino.Geometry.PointCloud()
        pts = pc_data.get('points', [])
        if not pts:
            return None
        cl = pc_data.get('colors')
        if cl and len(cl) == len(pts):
            for p, c in zip(pts, cl):
                cloud.Add(
                    Rhino.Geometry.Point3d(p[0], p[1], p[2]),
                    System.Drawing.Color.FromArgb(*c),
                )
        else:
            for p in pts:
                cloud.Add(Rhino.Geometry.Point3d(p[0], p[1], p[2]))
        return cloud

    def _build_marker_points(self, geometry: dict) -> list:
        points = []
        for point_data in geometry.get('marker_points', []) or []:
            if isinstance(point_data, list) and len(point_data) >= 3:
                points.append(
                    Rhino.Geometry.Point(
                        float(point_data[0]),
                        float(point_data[1]),
                        float(point_data[2]),
                    )
                )
        return points

    def _build_members_for_snapshot(
            self,
            tree: _MemberTree,
            snapshot: dict,
            identity_label: str,
            snapshot_label: str,
            identity_id: str,
            mesh_mode: str,
            cloud_mode: str,
            auth_core):
        geometry = snapshot.get('geometry', {}) or {}
        if not geometry:
            return

        snapshot_color = self._snapshot_color(snapshot)
        xform = self._iframe_transform(snapshot)
        snapshot_id = self._snapshot_id(snapshot)
        res_map = snapshot.get('mesh_ply_resolutions', {}) or {}
        inline_meshes = geometry.get('meshes', []) or []

        for idx, extr in enumerate(geometry.get('extrusions', []) or []):
            xtr = self._build_extrusion(extr)
            if xtr is None:
                continue
            xtr.Transform(xform)
            tree.add_leaf(
                self._geometry_path(
                    identity_label, snapshot_label, 'Extrusion', idx),
                xtr,
            )

        for idx, mesh_data in enumerate(inline_meshes):
            ply_available = res_map.get(str(idx), []) or []
            inline_ok = bool(
                mesh_data.get('vertices') and mesh_data.get('faces'))
            for source in self._mesh_sources_for_index(
                    mesh_mode, ply_available, inline_ok):
                mesh = None
                if source == 'inline':
                    mesh = self._build_inline_mesh(mesh_data, snapshot_color)
                elif snapshot_id and auth_core:
                    mesh = self._fetch_ply_mesh(
                        auth_core, snapshot_id, idx, source)
                if mesh is None:
                    if source != 'inline':
                        self._addRemark(
                            f'PLY {source} unavailable for mesh {idx} '
                            f'({snapshot_id or identity_id})')
                    continue
                mesh.Transform(xform)
                tree.add_leaf(
                    self._geometry_path(
                        identity_label, snapshot_label,
                        'Mesh', idx, source),
                    mesh,
                )

        for idx, pc_data in enumerate(geometry.get('point_clouds', []) or []):
            inline_ok = bool(
                isinstance(pc_data, dict)
                and (pc_data.get('points') or [])
            )
            placed = False
            for source in self._cloud_sources_for_index(
                    cloud_mode, inline_ok):
                if cloud_mode == 'best' and placed:
                    break
                cloud = None
                if source == 'inline':
                    cloud = self._build_point_cloud(pc_data)
                elif snapshot_id and auth_core:
                    try:
                        cloud = self._fetch_ply_point_cloud(
                            auth_core, snapshot_id, idx)
                    except Exception as e:
                        self._addWarning(
                            'Point cloud PLY fetch failed '
                            f'for index {idx}: {str(e)}')
                if cloud is None:
                    if source != 'inline':
                        self._addRemark(
                            f'PLY detailed unavailable for point cloud '
                            f'{idx} ({snapshot_id or identity_id})')
                    continue
                cloud.Transform(xform)
                tree.add_leaf(
                    self._geometry_path(
                        identity_label, snapshot_label,
                        'PointCloud', idx, source),
                    cloud,
                )
                placed = True

        markers = self._build_marker_points(geometry)
        if markers:
            for pt in markers:
                pt.Transform(xform)
            tree.add_leaf_many(
                self._geometry_path(
                    identity_label, snapshot_label, 'Marker', 0),
                markers,
            )

    def _passport_to_d2p(
            self,
            passport: dict,
            mesh_mode: str,
            snapshot_scope: str,
            parent=None,
            passport_json: str = None,
            cloud_mode: str = 'best'):
        identity = passport.get('identity') or {}
        snapshots = list(self._iter_snapshot_blocks(passport, snapshot_scope))
        if not identity or not snapshots:
            raise ValueError(
                'Passport JSON missing identity or snapshot data')

        primary = snapshots[0]
        identity_type = identity.get('type') or 'other'
        type_id = self._type_id(identity_type)
        type_name = self._type_name(identity_type)
        layer_color = self._snapshot_color(primary)
        component_type = ComponentType(
            type_id,
            type_name,
            LabelSize=2.5,
            LayerColor=layer_color,
        )

        base_name = str(
            primary.get('name') or identity.get('_id') or 'Component')
        short_name = self._child_short_name(base_name, parent)
        plane = self._iframe_plane(primary)
        component = GHComponent(component_type, short_name, plane)

        self._attach_csc_metadata(
            component, identity, primary, passport_json)

        identity_label = self._identity_scope_label(identity)
        auth_core = self._get_auth_core()
        ply_needed = (
            mesh_mode in ('best', 'reduced', 'detailed', 'all')
            or cloud_mode in ('best', 'detailed', 'all')
        )
        if ply_needed and not auth_core:
            self._addRemark(
                'No CSC_AuthCore in sticky; PLY resolutions unavailable'
            )

        tree = _MemberTree(component, layer_color)
        for snapshot in snapshots:
            self._build_members_for_snapshot(
                tree,
                snapshot,
                identity_label,
                self._snapshot_scope_label(snapshot),
                identity.get('_id') or 'unknown',
                mesh_mode,
                cloud_mode,
                auth_core,
            )

        if not tree.has_members:
            self._addWarning(
                f'No geometry members created for {short_name} '
                f'({identity.get("_id")})'
            )

        return component

    def RunScript(self,
            ComponentData: Grasshopper.DataTree[str],
            MeshMode,
            CloudMode,
            SnapshotScope,
            Parent):
        Component = Grasshopper.DataTree[System.Object]()
        self.Component.Message = ''

        mesh_mode = self._normalize_mode(
            MeshMode,
            ('best', 'inline', 'reduced', 'detailed', 'all'),
            'best',
        )
        cloud_mode = self._resolve_cloud_mode(CloudMode, mesh_mode)
        snapshot_scope = self._normalize_mode(
            SnapshotScope,
            ('current', 'all'),
            'current',
        )

        if not ComponentData or ComponentData.DataCount == 0:
            msg = 'Input ComponentData failed to collect data!'
            self._addWarning(msg)
            self.Component.Message = msg
            return Component

        converted = 0
        try:
            self.Component.Message = 'Converting passport to D2P...'

            for i in range(ComponentData.BranchCount):
                ghp = ComponentData.Paths[i]
                for comp_json in ComponentData.Branches[i]:
                    if not comp_json:
                        self._addWarning('Empty passport entry, skipping')
                        continue
                    try:
                        passport = json.loads(comp_json)
                        d2p_component = self._passport_to_d2p(
                            passport,
                            mesh_mode,
                            snapshot_scope,
                            Parent,
                            comp_json,
                            cloud_mode,
                        )
                        Component.Add(d2p_component.NetObj, ghp)
                        converted += 1
                    except json.JSONDecodeError as e:
                        self._addError(f'Failed to parse passport JSON: {e}')
                    except Exception as e:
                        self._addError(
                            f'Failed to convert passport entry: {e}'
                        )

            self.Component.Message = (
                f'Converted {converted} passport entr'
                f'{"y" if converted == 1 else "ies"} to D2P'
            )
            if converted:
                self._addRemark(
                    f'Successfully converted {converted} component(s) '
                    f'(mesh={mesh_mode}, cloud={cloud_mode}, '
                    f'snapshots={snapshot_scope})'
                )
            return Component

        except Exception as e:
            msg = f'Unexpected error during conversion: {e}'
            self._addError(msg)
            self.Component.Message = msg
            return Component
# ---------- end passporttod2p ----------

# ---- group: __DDU_CSC_EXAMPLE_09__
# comments & notes: Fetch all snapshots for a given identity
componentdata_26 = Data(componentdata_7)
fetchallsnapshots_2 = FetchAllSnapshots(Input=componentdata_26)  # -> PassportData; same code as fetchallsnapshots
passportdata = Data(fetchallsnapshots_2)

# comments & notes: Fetch a specific snapshot by ID for a given identity input
componentdata_27 = Data(componentdata_7)
snapshotid_2 = Data(snapshotid)
fetchsnapshot = FetchSnapshot(Input=componentdata_27, SnapshotID=snapshotid_2)  # -> PassportData
# ---------- fetchsnapshot: Python ----------
#! python3
# -*- coding: utf-8 -*-
# venv: DDU_CSC
print('ENV OK!')
# r: charset_normalizer
# r: requests

# PYTHON STANDARD LIBRARY IMPORTS ---------------------------------------------
import json  # NOQA

# THIRD PARTY LIBRARY IMPORTS -------------------------------------------------
import requests  # NOQA

# RHINO AND GH RELATED IMPORTS ------------------------------------------------
import System  # NOQA
import Grasshopper  # NOQA
import Rhino  # NOQA
import scriptcontext as sc  # NOQA

# GHENV COMPONENT SETTINGS ----------------------------------------------------
ghenv.Component.Name = 'FetchSnapshot'  # NOQA
ghenv.Component.NickName = 'FetchSnapshot'  # NOQA
ghenv.Component.Category = 'DDU_CSC'  # NOQA
ghenv.Component.SubCategory = '2 Catalog Interface'  # NOQA
ghenv.Component.Description = (  # NOQA
    'Fetches passport JSON for one identity and a specific snapshot '
    '({identity, snapshots:[one]}). Identity input can be a UUID or passport '
    'JSON.'
)


class CSC_FetchSnapshot(Grasshopper.Kernel.GH_ScriptInstance):
    """
    Author: Max Benjamin Eschenbach
    License: MIT License
    Version: 260908
    """

    def __init__(self):
        super().__init__()
        self.Component = ghenv.Component  # NOQA
        self.InputParams = self.Component.Params.Input
        self.OutputParams = self.Component.Params.Output

    def _addRemark(self, msg: str = ''):
        rml = self.Component.RuntimeMessageLevel.Remark
        self.AddRuntimeMessage(rml, msg)

    def _addWarning(self, msg: str = ''):
        rml = self.Component.RuntimeMessageLevel.Warning
        self.AddRuntimeMessage(rml, msg)

    def _addError(self, msg: str = ''):
        rml = self.Component.RuntimeMessageLevel.Error
        self.AddRuntimeMessage(rml, msg)

    def BeforeRunScript(self):
        self.InputParams[0].Description = (
            'Identity UUID or passport JSON ({identity, snapshots[]})'
        )
        self.InputParams[1].Description = 'Snapshot UUID to fetch'
        i = 0
        if self.OutputParams[0].Name == 'out':
            i += 1
        self.OutputParams[0 + i].Description = (
            'Passport JSON string: {identity, snapshots:[requested snapshot]}'
        )

    def get_auth_core_from_sticky(self):
        auth_core = sc.sticky.get('CSC_AuthCore')
        if auth_core is None:
            msg = ('No authentication found. Please use CSC_Session component '
                   'first.')
            self._addError(msg)
            self.Component.Message = msg
            return None
        return auth_core

    def RunScript(self, Input, SnapshotID):
        Passport = ''

        auth_core = self.get_auth_core_from_sticky()
        if auth_core is None:
            return Passport

        if not auth_core.is_valid():
            msg = ('Authentication expired. Please use CSC_Session '
                   'component to refresh.')
            self._addError(msg)
            self.Component.Message = msg
            return Passport

        if Input is None or (isinstance(Input, str) and not str(Input).strip()):
            msg = 'Please provide an identity UUID or passport JSON.'
            self._addWarning(msg)
            self.Component.Message = msg
            return Passport

        snapshot_id = str(SnapshotID or '').strip()
        if not snapshot_id or not auth_core.validate_uuid(snapshot_id):
            msg = 'Please provide a valid snapshot UUID.'
            self._addError(msg)
            self.Component.Message = msg
            return Passport

        identity_id = auth_core.resolve_identity_id_from_input(Input)
        if not identity_id:
            msg = 'Input is not a valid identity UUID or passport JSON.'
            self._addError(msg)
            self.Component.Message = msg
            return Passport

        try:
            self.Component.Message = (
                f'Fetching snapshot {snapshot_id} for identity {identity_id}...'
            )
            response = auth_core.cached_get_passport(
                identity_id,
                snapshots=[snapshot_id],
            )

            if response.status_code == 200:
                data = response.json()
                Passport = auth_core.passport_json_string(data)
                self.Component.Message = 'Fetched passport for snapshot'
                return Passport

            if response.status_code == 401:
                msg = 'Authentication failed. Please sign in again.'
            elif response.status_code == 404:
                msg = (
                    f'Identity {identity_id} or snapshot {snapshot_id} '
                    'not found.'
                )
            else:
                msg = f'Request failed with status code: {response.status_code}'
            self._addError(msg)
            self.Component.Message = msg

        except requests.exceptions.ConnectionError as e:
            msg = 'Cannot connect to server. Please check your connection.'
            self._addError(msg + f'\nFull Error: {str(e)}')
            self.Component.Message = msg
        except requests.exceptions.Timeout as e:
            msg = 'Request timeout. Server may be slow.'
            self._addError(msg + f'\nFull Error: {str(e)}')
            self.Component.Message = msg
        except Exception as e:
            msg = f'Unexpected error: {str(e)}'
            self._addError(msg)
            self.Component.Message = msg

        return Passport
# ---------- end fetchsnapshot ----------
passportdata_2 = Data(fetchsnapshot)

# ---- group: __DDU_CSC_EXAMPLE_08__
snapshotdata_2 = Data(snapshotdata)
addcomponentsnapshot = AddComponentSnapshot(SnapshotData=snapshotdata_2, Run=Toggle(False))  # -> AddedComponentData; inputs SnapshotData: String, Run: Boolean
# ---------- addcomponentsnapshot: Python ----------
#! python3
# -*- coding: utf-8 -*-
# venv: DDU_CSC
print('ENV OK!')
# r: charset_normalizer
# r: requests

# PYTHON STANDARD LIBRARY IMPORTS ---------------------------------------------
import json  # NOQA
import os  # NOQA
import platform  # NOQA
import uuid  # NOQA

# THIRD PARTY LIBRARY IMPORTS -------------------------------------------------
import requests  # NOQA

# RHINO AND GH RELATED IMPORTS ------------------------------------------------
import System  # NOQA
import Grasshopper  # NOQA
import Rhino  # NOQA
import scriptcontext as sc  # NOQA

# GHENV COMPONENT SETTINGS ----------------------------------------------------
ghenv.Component.Name = 'AddComponentSnapshot'  # NOQA
ghenv.Component.NickName = 'AddComponentSnapshot'  # NOQA
ghenv.Component.Category = 'DDU_CSC'  # NOQA
ghenv.Component.SubCategory = '2 Catalog Interface'  # NOQA
ghenv.Component.Description = (  # NOQA
    'Creates a new snapshot for an existing identity via '
    'POST /identities/{id}/snapshots. Accepts CreateSnapshotRequest JSON '
    'from CreateComponentSnapshot and uploads staged mesh and point-cloud '
    'PLY files from pending_snapshot_assets/{snapshot_id}/.'
)


class CSC_AddComponentSnapshot(Grasshopper.Kernel.GH_ScriptInstance):
    """
    Author: Max Benjamin Eschenbach
    License: MIT License
    Version: 260908
    """

    def __init__(self):
        super().__init__()
        self.Component = ghenv.Component  # NOQA
        self.InputParams = self.Component.Params.Input
        self.OutputParams = self.Component.Params.Output

    def _addRemark(self, msg: str = ''):
        rml = self.Component.RuntimeMessageLevel.Remark
        self.AddRuntimeMessage(rml, msg)

    def _addWarning(self, msg: str = ''):
        rml = self.Component.RuntimeMessageLevel.Warning
        self.AddRuntimeMessage(rml, msg)

    def _addError(self, msg: str = ''):
        rml = self.Component.RuntimeMessageLevel.Error
        self.AddRuntimeMessage(rml, msg)

    def BeforeRunScript(self):
        self.InputParams[0].Description = (
            'CreateSnapshotRequest JSON from CreateComponentSnapshot'
        )
        self.InputParams[1].Description = (
            'Toggle to execute the snapshot create operation'
        )
        i = 0
        if self.OutputParams[0].Name == 'out':
            i += 1
        self.OutputParams[0+i].Description = (
            'Passport response JSON ({identity, snapshot}) after create'
        )

    def get_auth_core_from_sticky(self):
        auth_core = sc.sticky.get('CSC_AuthCore')
        if auth_core is None:
            msg = ('No authentication found. Please use CSC_Session component '
                   'first.')
            self._addError(msg)
            self.Component.Message = msg
            return None
        return auth_core

    def get_pending_assets_root(self) -> str:
        if platform.system() == 'Windows':
            base_path = os.path.expandvars('%APPDATA%')
            return os.path.join(
                base_path, 'DDU_CSC', 'pending_snapshot_assets')
        base_path = os.path.expanduser('~')
        return os.path.join(
            base_path, 'Library', 'Application Support', 'DDU_CSC',
            'pending_snapshot_assets',
        )

    def get_snapshot_assets_dir(self, snapshot_id: str) -> str:
        return os.path.join(self.get_pending_assets_root(), snapshot_id)

    def load_staging_manifest(self, snapshot_id: str):
        manifest_path = os.path.join(
            self.get_snapshot_assets_dir(snapshot_id),
            'manifest.json',
        )
        if not os.path.isfile(manifest_path):
            return None
        try:
            with open(manifest_path, 'r', encoding='utf-8') as handle:
                return json.load(handle)
        except (OSError, json.JSONDecodeError) as exc:
            self._addWarning(f'Failed to read staging manifest: {exc}')
            return None

    def check_staged_ply_files(self, snapshot_id: str, manifest: dict) -> dict:
        assets_dir = self.get_snapshot_assets_dir(snapshot_id)
        mesh_primitives = manifest.get('mesh_primitives') or {}
        pending = []
        missing = []

        for index_str, resolutions in mesh_primitives.items():
            if not isinstance(resolutions, list):
                continue
            for resolution in resolutions:
                rel_path = os.path.join(
                    'meshes', str(index_str), f'{resolution}.ply')
                full_path = os.path.join(assets_dir, rel_path)
                entry = {
                    'primitive_index': str(index_str),
                    'resolution': resolution,
                    'path': full_path,
                }
                if os.path.isfile(full_path):
                    pending.append(entry)
                else:
                    missing.append(entry)

        return {
            'assets_dir': assets_dir,
            'pending': pending,
            'missing': missing,
        }

    def check_staged_point_cloud_ply_files(
            self,
            snapshot_id: str,
            manifest: dict) -> dict:
        assets_dir = self.get_snapshot_assets_dir(snapshot_id)
        point_cloud_primitives = manifest.get('point_cloud_primitives') or {}
        pending = []
        missing = []

        for index_str, markers in point_cloud_primitives.items():
            if not markers:
                continue
            rel_path = os.path.join('point_clouds', f'{index_str}.ply')
            full_path = os.path.join(assets_dir, rel_path)
            entry = {
                'primitive_index': str(index_str),
                'path': full_path,
            }
            if os.path.isfile(full_path):
                pending.append(entry)
            else:
                missing.append(entry)

        return {
            'assets_dir': assets_dir,
            'pending': pending,
            'missing': missing,
        }

    def validate_snapshot_payload(self, payload: dict) -> list:
        errors = []
        required_fields = [
            'complexity', 'fragment', 'assembly', 'geometry', 'bbx',
            'bbx_origin', 'iframe', 'pca_frame',
        ]
        for field in required_fields:
            if field not in payload:
                errors.append(f'missing required field: {field}')

        identity_id = payload.get('identity_id', '')
        if not identity_id:
            errors.append('payload must contain identity_id')
        elif not self._validate_uuid(identity_id):
            errors.append('identity_id must be a valid UUID')

        snapshot_id = payload.get('_id', '')
        if not snapshot_id:
            errors.append('payload must contain _id (snapshot UUID)')
        elif not self._validate_uuid(snapshot_id):
            errors.append('_id must be a valid snapshot UUID')

        geometry = payload.get('geometry') or {}
        if not (
            geometry.get('meshes')
            or geometry.get('extrusions')
            or geometry.get('point_clouds')
        ):
            errors.append(
                'geometry must include meshes, extrusions, or point_clouds'
            )

        return errors

    def _validate_uuid(self, uuid_to_test: str, version: int = 4) -> bool:
        try:
            uuid_obj = uuid.UUID(uuid_to_test, version=version)
        except ValueError:
            return False
        return str(uuid_obj) == uuid_to_test

    def upload_staged_ply_files(
            self,
            auth_core,
            snapshot_id: str,
            staged_files: list) -> bool:
        if not staged_files:
            return True

        upload_success = True
        headers = auth_core.auth_header()

        for entry in staged_files:
            primitive_index = entry['primitive_index']
            resolution = entry['resolution']
            file_path = entry['path']
            self.Component.Message = (
                f'Uploading PLY primitive {primitive_index} ({resolution})...'
            )

            try:
                with open(file_path, 'rb') as handle:
                    response = requests.put(
                        auth_core.base_url + (
                            f'/snapshots/{snapshot_id}/meshes/'
                            f'{primitive_index}/{resolution}'
                        ),
                        files={
                            'mesh_file': (
                                os.path.basename(file_path),
                                handle,
                                'application/octet-stream',
                            ),
                        },
                        headers=headers,
                        timeout=300,
                    )
            except requests.exceptions.Timeout:
                self._addWarning(
                    f'PLY upload timed out for primitive {primitive_index}.'
                )
                upload_success = False
                continue
            except requests.exceptions.ConnectionError:
                self._addWarning(
                    f'Connection lost uploading primitive {primitive_index}.'
                )
                upload_success = False
                continue
            except OSError as exc:
                self._addWarning(
                    f'Could not read staged PLY {file_path}: {exc}'
                )
                upload_success = False
                continue

            if response.status_code == 200:
                self._addRemark(
                    f'Uploaded {resolution} PLY for '
                    f'primitive {primitive_index}'
                )
            else:
                detail = response.text
                try:
                    detail = response.json().get('detail', detail)
                except (json.JSONDecodeError, AttributeError):
                    pass
                self._addWarning(
                    f'Failed to upload {resolution} PLY '
                    f'({response.status_code}): {detail}'
                )
                upload_success = False

        return upload_success

    def upload_staged_point_cloud_ply_files(
            self,
            auth_core,
            snapshot_id: str,
            staged_files: list) -> bool:
        if not staged_files:
            return True

        upload_success = True
        headers = auth_core.auth_header()

        for entry in staged_files:
            primitive_index = entry['primitive_index']
            file_path = entry['path']
            self.Component.Message = (
                f'Uploading point cloud PLY primitive {primitive_index}...'
            )

            try:
                with open(file_path, 'rb') as handle:
                    response = requests.put(
                        auth_core.base_url + (
                            f'/snapshots/{snapshot_id}/point_clouds/'
                            f'{primitive_index}.ply'
                        ),
                        files={
                            'point_cloud_file': (
                                os.path.basename(file_path),
                                handle,
                                'application/octet-stream',
                            ),
                        },
                        headers=headers,
                        timeout=300,
                    )
            except requests.exceptions.Timeout:
                self._addWarning(
                    f'Point cloud upload timed out for primitive '
                    f'{primitive_index}.'
                )
                upload_success = False
                continue
            except requests.exceptions.ConnectionError:
                self._addWarning(
                    f'Connection lost uploading point cloud primitive '
                    f'{primitive_index}.'
                )
                upload_success = False
                continue
            except OSError as exc:
                self._addWarning(
                    f'Could not read staged point cloud PLY {file_path}: {exc}'
                )
                upload_success = False
                continue

            if response.status_code == 200:
                self._addRemark(
                    f'Uploaded point cloud PLY for primitive {primitive_index}'
                )
            else:
                detail = response.text
                try:
                    detail = response.json().get('detail', detail)
                except (json.JSONDecodeError, AttributeError):
                    pass
                self._addWarning(
                    f'Failed to upload point cloud PLY '
                    f'({response.status_code}): {detail}'
                )
                upload_success = False

        return upload_success

    def _format_http_error(self, response) -> str:
        try:
            error_detail = response.json()
            if 'detail' in error_detail:
                detail = error_detail['detail']
                if isinstance(detail, list):
                    lines = []
                    for error in detail:
                        field = error.get('loc', ['unknown'])[-1]
                        message = error.get('msg', 'validation error')
                        lines.append(f'{field}: {message}')
                    return (
                        'Snapshot payload validation failed:\n'
                        + '\n'.join(lines)
                    )
                return f'Snapshot payload validation failed: {detail}'
            return f'Request failed: {error_detail}'
        except (json.JSONDecodeError, KeyError, AttributeError):
            return f'Request failed with status code {response.status_code}'

    def RunScript(self, SnapshotData: str, Run: bool):
        AddedSnapshotData = Grasshopper.DataTree[System.Object]()

        auth_core = self.get_auth_core_from_sticky()
        if auth_core is None:
            return AddedSnapshotData

        if not auth_core.is_valid():
            msg = ('Authentication expired. Please use CSC_Session '
                   'component to refresh.')
            self._addError(msg)
            self.Component.Message = msg
            return AddedSnapshotData

        if not SnapshotData:
            msg = 'Please provide CreateSnapshotRequest JSON.'
            self._addWarning(msg)
            self.Component.Message = msg
            return AddedSnapshotData

        try:
            payload = json.loads(SnapshotData)
        except json.JSONDecodeError:
            msg = 'SnapshotData must be valid JSON format.'
            self._addError(msg)
            self.Component.Message = msg
            return AddedSnapshotData

        validation_errors = self.validate_snapshot_payload(payload)
        if validation_errors:
            msg = 'Snapshot payload validation errors:\n' + '\n'.join(
                validation_errors)
            self._addError(msg)
            self.Component.Message = 'Validation failed'
            return AddedSnapshotData

        identity_id = payload['identity_id']
        snapshot_id = payload['_id']
        geometry = payload.get('geometry') or {}
        has_meshes = bool(geometry.get('meshes'))
        has_point_clouds = bool(geometry.get('point_clouds'))

        manifest = self.load_staging_manifest(snapshot_id)
        staged_mesh_status = None
        staged_point_cloud_status = None
        if manifest:
            if manifest.get('identity_id') != identity_id:
                self._addWarning(
                    'Manifest identity_id does not match payload identity_id'
                )
            if has_meshes:
                staged_mesh_status = self.check_staged_ply_files(
                    snapshot_id, manifest)
                if staged_mesh_status['pending']:
                    self._addRemark(
                        f'Found {len(staged_mesh_status["pending"])} staged '
                        f'mesh PLY file(s)'
                    )
                if staged_mesh_status['missing']:
                    missing_names = [
                        f'{item["primitive_index"]}/{item["resolution"]}.ply'
                        for item in staged_mesh_status['missing']
                    ]
                    self._addWarning(
                        'Manifest lists missing mesh PLY files: '
                        + ', '.join(missing_names)
                    )
            if has_point_clouds:
                staged_point_cloud_status = (
                    self.check_staged_point_cloud_ply_files(
                        snapshot_id, manifest))
                if staged_point_cloud_status['pending']:
                    self._addRemark(
                        f'Found {len(staged_point_cloud_status["pending"])} '
                        f'staged point cloud PLY file(s)'
                    )
                if staged_point_cloud_status['missing']:
                    missing_names = [
                        f'point_clouds/{item["primitive_index"]}.ply'
                        for item in staged_point_cloud_status['missing']
                    ]
                    self._addWarning(
                        'Manifest lists missing point cloud PLY files: '
                        + ', '.join(missing_names)
                    )
        elif has_meshes or has_point_clouds:
            self._addRemark(
                f'No staging manifest for snapshot {snapshot_id}; '
                'inline geometry primitives only'
            )

        pending_asset_count = 0
        if staged_mesh_status:
            pending_asset_count += len(staged_mesh_status['pending'])
        if staged_point_cloud_status:
            pending_asset_count += len(staged_point_cloud_status['pending'])

        if not Run:
            status_msg = (
                f'Ready to create snapshot {snapshot_id} '
                f'for identity {identity_id}'
            )
            if pending_asset_count:
                status_msg += (
                    f' with {pending_asset_count} staged PLY file(s)'
                )
            status_msg += ' (toggle Run to execute)'
            self.Component.Message = status_msg
            return AddedSnapshotData

        request_body = dict(payload)
        request_body.pop('identity_id', None)

        try:
            self.Component.Message = 'Creating snapshot version...'

            response = auth_core.authorized_post(
                f'/identities/{identity_id}/snapshots',
                json_body=request_body,
            )

            if response.status_code == 201:
                passport = response.json()
                snapshots = passport.get('snapshots') or []
                snapshot_doc = snapshots[0] if snapshots else {}
                created_snapshot_id = snapshot_doc.get('_id', snapshot_id)

                ghp = Grasshopper.Kernel.Data.GH_Path(0)
                AddedSnapshotData.Add(json.dumps(passport), ghp)

                self._addRemark(
                    f'Created snapshot {created_snapshot_id} '
                    f'for identity {identity_id}'
                )
                self.Component.Message = (
                    f'Created snapshot {created_snapshot_id}'
                )

                upload_issues = False
                if staged_mesh_status and staged_mesh_status['pending']:
                    self.Component.Message = (
                        'Uploading staged mesh PLY files...'
                    )
                    if not self.upload_staged_ply_files(
                            auth_core,
                            created_snapshot_id,
                            staged_mesh_status['pending'],
                    ):
                        upload_issues = True
                if (
                    staged_point_cloud_status
                    and staged_point_cloud_status['pending']
                ):
                    self.Component.Message = (
                        'Uploading staged point cloud PLY files...'
                    )
                    if not self.upload_staged_point_cloud_ply_files(
                            auth_core,
                            created_snapshot_id,
                            staged_point_cloud_status['pending'],
                    ):
                        upload_issues = True
                if upload_issues:
                    self._addWarning(
                        'Snapshot created but some staged PLY uploads failed'
                    )
                elif pending_asset_count:
                    self.Component.Message = (
                        f'Created snapshot {created_snapshot_id} with PLY'
                    )

                return AddedSnapshotData

            if response.status_code in (400, 422):
                msg = self._format_http_error(response)
                self._addError(msg)
                self.Component.Message = 'Create failed (validation)'
                return AddedSnapshotData

            if response.status_code == 401:
                msg = 'Authentication failed. Please sign in again.'
                self._addError(msg)
                self.Component.Message = msg
                return AddedSnapshotData

            if response.status_code == 403:
                msg = 'Access denied. Insufficient permissions.'
                self._addError(msg)
                self.Component.Message = msg
                return AddedSnapshotData

            if response.status_code == 404:
                msg = f'Identity {identity_id} not found.'
                self._addWarning(msg)
                self.Component.Message = msg
                return AddedSnapshotData

            if response.status_code == 409:
                msg = 'Snapshot already exists or version conflict.'
                self._addWarning(msg)
                self.Component.Message = msg
                return AddedSnapshotData

            if response.status_code == 500:
                msg = 'Server error. Please try again later.'
                self._addWarning(msg)
                self.Component.Message = msg
                return AddedSnapshotData

            msg = self._format_http_error(response)
            self._addError(msg)
            self.Component.Message = msg
            return AddedSnapshotData

        except requests.exceptions.ConnectionError as exc:
            msg = 'Cannot connect to server. Please check your connection.'
            self._addError(msg + f'\nFull Error: {str(exc)}')
            self.Component.Message = msg

        except requests.exceptions.Timeout as exc:
            msg = 'Request timeout. Server may be slow.'
            self._addError(msg + f'\nFull Error: {str(exc)}')
            self.Component.Message = msg

        except requests.exceptions.RequestException as exc:
            msg = f'Request error: {str(exc)}'
            self._addError(msg)
            self.Component.Message = msg

        except Exception as exc:
            msg = f'Unexpected error: {str(exc)}'
            self._addError(msg)
            self.Component.Message = msg

        return AddedSnapshotData
# ---------- end addcomponentsnapshot ----------
componentdata_28 = Data(addcomponentsnapshot)

# ---- group: __DDU_CSC_EXAMPLE_07__
# Step 3
# comments & notes: Finally, if CreateComponentIdentity runs without errors, we can submit the created Component to the Catalog!
# 
# Set the Toggle to True to execute the upload.
toggle_3 = BooleanToggle(False)
componentdata_29 = Data(componentdata_14)
addcomponentidentity = AddComponentIdentity(ComponentData=componentdata_29, Run=toggle_3)  # -> AddedComponentData; inputs ComponentData: String, Run: Boolean
# ---------- addcomponentidentity: Python ----------
#! python3
# -*- coding: utf-8 -*-
# venv: DDU_CSC
print('ENV OK!')
# r: charset_normalizer
# r: requests

# PYTHON STANDARD LIBRARY IMPORTS ---------------------------------------------
import json  # NOQA
import os  # NOQA
import platform  # NOQA
import uuid  # NOQA

# THIRD PARTY LIBRARY IMPORTS -------------------------------------------------
import requests  # NOQA

# RHINO AND GH RELATED IMPORTS ------------------------------------------------
import System  # NOQA
import Grasshopper  # NOQA
import Rhino  # NOQA
import scriptcontext as sc  # NOQA

# GHENV COMPONENT SETTINGS ----------------------------------------------------
ghenv.Component.Name = 'AddComponentIdentity'  # NOQA
ghenv.Component.NickName = 'AddComponentIdentity'  # NOQA
ghenv.Component.Category = 'DDU_CSC'  # NOQA
ghenv.Component.SubCategory = '2 Catalog Interface'  # NOQA
ghenv.Component.Description = (  # NOQA
    'Creates a catalog identity and version-0 snapshot via POST /identities. '
    'Accepts CreateComponentRequest JSON from CreateComponentIdentity, '
    'uploads staged mesh and point-cloud PLY files from '
    'pending_identity_assets/, and optionally consumes a pending '
    'transmitted component ID.'
)


class CSC_AddComponentIdentity(Grasshopper.Kernel.GH_ScriptInstance):
    """
    Author: Max Benjamin Eschenbach
    License: MIT License
    Version: 260908
    """

    def __init__(self):
        """Initialize this component and set component parameters."""
        super().__init__()
        # initialize props
        self.Component = ghenv.Component  # NOQA
        self.InputParams = self.Component.Params.Input
        self.OutputParams = self.Component.Params.Output

    def _addRemark(self, msg: str = ''):
        """Add a remark message to the component."""
        rml = self.Component.RuntimeMessageLevel.Remark
        self.AddRuntimeMessage(rml, msg)

    def _addWarning(self, msg: str = ''):
        """Add a warning message to the component."""
        rml = self.Component.RuntimeMessageLevel.Warning
        self.AddRuntimeMessage(rml, msg)

    def _addError(self, msg: str = ''):
        """Add an error message to the component."""
        rml = self.Component.RuntimeMessageLevel.Error
        self.AddRuntimeMessage(rml, msg)

    def BeforeRunScript(self):
        """Perform some setup actions."""
        # Initialize input param descriptions
        self.InputParams[0].Description = (
            'CreateComponentRequest JSON from CreateComponentIdentity'
        )
        self.InputParams[1].Description = (
            'Toggle to execute the create operation'
        )
        # Initialize output param descriptions
        i = 0
        if self.OutputParams[0].Name == 'out':
            i += 1
        self.OutputParams[0+i].Description = (
            'Passport response JSON ({identity, snapshot}) '
            'from POST /identities'
        )

    def get_auth_core_from_sticky(self):
        """Get AuthCore instance from sticky storage."""
        auth_core = sc.sticky.get('CSC_AuthCore')
        if auth_core is None:
            msg = ('No authentication found. Please use CSC_Session component '
                   'first.')
            self._addError(msg)
            self.Component.Message = msg
            return None
        return auth_core

    def get_pending_assets_root(self) -> str:
        """
        Get the geometry folder path for a component.
        Returns the appropriate path based on the operating system.
        """
        if platform.system() == 'Windows':
            base_path = os.path.expandvars('%APPDATA%')
            return os.path.join(
                base_path, 'DDU_CSC', 'pending_identity_assets')
        base_path = os.path.expanduser('~')
        return os.path.join(
            base_path, 'Library', 'Application Support', 'DDU_CSC',
            'pending_identity_assets',
        )

    def get_identity_assets_dir(self, identity_id: str) -> str:
        return os.path.join(self.get_pending_assets_root(), identity_id)

    def load_staging_manifest(self, identity_id: str):
        manifest_path = os.path.join(
            self.get_identity_assets_dir(identity_id),
            'manifest.json',
        )
        if not os.path.isfile(manifest_path):
            return None
        try:
            with open(manifest_path, 'r', encoding='utf-8') as handle:
                return json.load(handle)
        except (OSError, json.JSONDecodeError) as exc:
            self._addWarning(f'Failed to read staging manifest: {exc}')
            return None

    def check_staged_ply_files(self, identity_id: str, manifest: dict) -> dict:
        assets_dir = self.get_identity_assets_dir(identity_id)
        mesh_primitives = manifest.get('mesh_primitives') or {}
        pending = []
        missing = []

        for index_str, resolutions in mesh_primitives.items():
            if not isinstance(resolutions, list):
                continue
            for resolution in resolutions:
                rel_path = os.path.join(
                    'meshes', str(index_str), f'{resolution}.ply')
                full_path = os.path.join(assets_dir, rel_path)
                entry = {
                    'primitive_index': str(index_str),
                    'resolution': resolution,
                    'path': full_path,
                }
                if os.path.isfile(full_path):
                    pending.append(entry)
                else:
                    missing.append(entry)

        return {
            'assets_dir': assets_dir,
            'pending': pending,
            'missing': missing,
        }

    def check_staged_point_cloud_ply_files(
            self,
            identity_id: str,
            manifest: dict) -> dict:
        assets_dir = self.get_identity_assets_dir(identity_id)
        point_cloud_primitives = manifest.get('point_cloud_primitives') or {}
        pending = []
        missing = []

        for index_str, markers in point_cloud_primitives.items():
            if not markers:
                continue
            rel_path = os.path.join('point_clouds', f'{index_str}.ply')
            full_path = os.path.join(assets_dir, rel_path)
            entry = {
                'primitive_index': str(index_str),
                'path': full_path,
            }
            if os.path.isfile(full_path):
                pending.append(entry)
            else:
                missing.append(entry)

        return {
            'assets_dir': assets_dir,
            'pending': pending,
            'missing': missing,
        }

    def validate_create_payload(self, payload: dict) -> list:
        errors = []
        required_fields = [
            'type', 'material', 'dataset', 'complexity', 'fragment',
            'assembly', 'geometry', 'bbx', 'bbx_origin', 'iframe',
            'pca_frame',
        ]
        for field in required_fields:
            if field not in payload:
                errors.append(f'missing required field: {field}')

        identity_id = payload.get('_id', '')
        if not identity_id:
            errors.append('payload must contain a valid _id (identity UUID)')
        elif not self._validate_uuid(identity_id):
            errors.append('_id must be a valid UUID')

        if 'complexity' in payload and not isinstance(payload['complexity'], int):  # NOQA
            errors.append('complexity must be an integer')
        if 'fragment' in payload and not isinstance(payload['fragment'], bool):
            errors.append('fragment must be a boolean')
        if 'assembly' in payload and not isinstance(payload['assembly'], bool):
            errors.append('assembly must be a boolean')
        if 'dataset' in payload and not isinstance(payload['dataset'], str):
            errors.append('dataset must be a string')

        for axis_field in ('bbx', 'bbx_origin'):
            values = payload.get(axis_field)
            if values is not None:
                if (not isinstance(values, list) or len(values) != 3 or
                        not all(isinstance(x, (int, float)) for x in values)):
                    errors.append(f'{axis_field} must be a list of 3 numbers')

        for frame_field in ('iframe', 'pca_frame'):
            if frame_field in payload and not isinstance(
                    payload[frame_field], dict):
                errors.append(f'{frame_field} must be a frame object')

        color = payload.get('color')
        if color is not None:
            if (not isinstance(color, list) or len(color) != 3 or
                    not all(isinstance(x, int) and 0 <= x <= 255 for x in color)):  # NOQA
                errors.append('color must be a list of 3 integers (0-255)')

        geometry = payload.get('geometry') or {}
        if not geometry:
            errors.append('geometry must be present')
        elif not (
            geometry.get('meshes')
            or geometry.get('extrusions')
            or geometry.get('point_clouds')
        ):
            errors.append(
                'geometry must include meshes, extrusions, or point_clouds'
            )

        return errors

    def _validate_uuid(self, uuid_to_test: str, version: int = 4) -> bool:
        try:
            uuid_obj = uuid.UUID(uuid_to_test, version=version)
        except ValueError:
            return False
        return str(uuid_obj) == uuid_to_test

    def upload_staged_ply_files(
            self,
            auth_core,
            snapshot_id: str,
            identity_id: str,
            staged_files: list) -> bool:
        if not staged_files:
            return True

        upload_success = True
        headers = auth_core.auth_header()

        for entry in staged_files:
            primitive_index = entry['primitive_index']
            resolution = entry['resolution']
            file_path = entry['path']
            self.Component.Message = (
                f'Uploading PLY primitive {primitive_index} ({resolution})...'
            )
            self._addRemark(
                f'Uploading {os.path.basename(file_path)} for snapshot '
                f'{snapshot_id}'
            )

            try:
                with open(file_path, 'rb') as handle:
                    response = requests.put(
                        auth_core.base_url + (
                            f'/snapshots/{snapshot_id}/meshes/'
                            f'{primitive_index}/{resolution}'
                        ),
                        files={
                            'mesh_file': (
                                os.path.basename(file_path),
                                handle,
                                'application/octet-stream',
                            ),
                        },
                        headers=headers,
                        timeout=300,
                    )
            except requests.exceptions.Timeout:
                self._addWarning(
                    f'PLY upload timed out for primitive {primitive_index} '
                    f'({resolution}).'
                )
                upload_success = False
                continue
            except requests.exceptions.ConnectionError:
                self._addWarning(
                    f'Connection lost uploading primitive {primitive_index} '
                    f'({resolution}).'
                )
                upload_success = False
                continue
            except OSError as exc:
                self._addWarning(
                    f'Could not read staged PLY {file_path}: {exc}'
                )
                upload_success = False
                continue

            if response.status_code == 200:
                self._addRemark(
                    f'Uploaded {resolution} PLY '
                    f'for primitive {primitive_index}'
                )
            else:
                detail = response.text
                try:
                    detail = response.json().get('detail', detail)
                except (json.JSONDecodeError, AttributeError):
                    pass
                self._addWarning(
                    f'Failed to upload {resolution} PLY for primitive '
                    f'{primitive_index} ({response.status_code}): {detail}'
                )
                upload_success = False

        if upload_success:
            self._addRemark(
                'All staged mesh PLY files uploaded '
                f'for identity {identity_id}'
            )
        return upload_success

    def upload_staged_point_cloud_ply_files(
            self,
            auth_core,
            snapshot_id: str,
            identity_id: str,
            staged_files: list) -> bool:
        if not staged_files:
            return True

        upload_success = True
        headers = auth_core.auth_header()

        for entry in staged_files:
            primitive_index = entry['primitive_index']
            file_path = entry['path']
            self.Component.Message = (
                f'Uploading point cloud PLY primitive {primitive_index}...'
            )
            self._addRemark(
                f'Uploading point cloud {os.path.basename(file_path)} for '
                f'snapshot {snapshot_id}'
            )

            try:
                with open(file_path, 'rb') as handle:
                    response = requests.put(
                        auth_core.base_url + (
                            f'/snapshots/{snapshot_id}/point_clouds/'
                            f'{primitive_index}.ply'
                        ),
                        files={
                            'point_cloud_file': (
                                os.path.basename(file_path),
                                handle,
                                'application/octet-stream',
                            ),
                        },
                        headers=headers,
                        timeout=300,
                    )
            except requests.exceptions.Timeout:
                self._addWarning(
                    f'Point cloud upload timed out for primitive '
                    f'{primitive_index}.'
                )
                upload_success = False
                continue
            except requests.exceptions.ConnectionError:
                self._addWarning(
                    f'Connection lost uploading point cloud primitive '
                    f'{primitive_index}.'
                )
                upload_success = False
                continue
            except OSError as exc:
                self._addWarning(
                    f'Could not read staged point cloud PLY {file_path}: {exc}'
                )
                upload_success = False
                continue

            if response.status_code == 200:
                self._addRemark(
                    f'Uploaded point cloud PLY for primitive {primitive_index}'
                )
            else:
                detail = response.text
                try:
                    detail = response.json().get('detail', detail)
                except (json.JSONDecodeError, AttributeError):
                    pass
                self._addWarning(
                    f'Failed to upload point cloud PLY for primitive '
                    f'{primitive_index} ({response.status_code}): {detail}'
                )
                upload_success = False

        if upload_success:
            self._addRemark(
                f'All staged point cloud PLY files uploaded for identity '
                f'{identity_id}'
            )
        return upload_success

    def _format_http_error(self, response) -> str:
        try:
            error_detail = response.json()
            if 'detail' in error_detail:
                detail = error_detail['detail']
                if isinstance(detail, list):
                    lines = []
                    for error in detail:
                        field = error.get('loc', ['unknown'])[-1]
                        message = error.get('msg', 'validation error')
                        lines.append(f'{field}: {message}')
                    return (
                        'Create payload validation '
                        'failed:\n' + '\n'.join(lines)
                    )
                return f'Create payload validation failed: {detail}'
            return f'Request failed: {error_detail}'
        except (json.JSONDecodeError, KeyError, AttributeError):
            return f'Request failed with status code {response.status_code}'

    def RunScript(self, ComponentData: str, Run: bool):
        # Set up output trees and results tuple
        AddedComponentData = Grasshopper.DataTree[System.Object]()

        # Get AuthCore instance from sticky storage
        auth_core = self.get_auth_core_from_sticky()
        if auth_core is None:
            return AddedComponentData

        # Check if authentication is valid
        if not auth_core.is_valid():
            msg = ('Authentication expired. Please use CSC_Session '
                   'component to refresh.')
            self._addError(msg)
            self.Component.Message = msg
            return AddedComponentData

        # Validate ComponentData input
        if not ComponentData:
            msg = 'Please provide CreateComponentRequest JSON to add.'
            self._addWarning(msg)
            self.Component.Message = msg
            return AddedComponentData

        # Validate JSON format
        try:
            payload = json.loads(ComponentData)
        except json.JSONDecodeError:
            msg = 'ComponentData must be valid JSON format.'
            self._addError(msg)
            self.Component.Message = msg
            return AddedComponentData

        validation_errors = self.validate_create_payload(payload)
        if validation_errors:
            msg = 'Create payload validation errors:\n' + '\n'.join(
                validation_errors)
            self._addError(msg)
            self.Component.Message = 'Validation failed'
            return AddedComponentData

        identity_id = payload['_id']
        geometry = payload.get('geometry') or {}
        has_meshes = bool(geometry.get('meshes'))
        has_point_clouds = bool(geometry.get('point_clouds'))

        manifest = self.load_staging_manifest(identity_id)
        staged_mesh_status = None
        staged_point_cloud_status = None
        if manifest:
            if has_meshes:
                staged_mesh_status = self.check_staged_ply_files(
                    identity_id, manifest)
                if staged_mesh_status['pending']:
                    self._addRemark(
                        f'Found {len(staged_mesh_status["pending"])} staged '
                        f'mesh PLY file(s) for identity {identity_id}'
                    )
                if staged_mesh_status['missing']:
                    missing_names = [
                        f'{item["primitive_index"]}/{item["resolution"]}.ply'
                        for item in staged_mesh_status['missing']
                    ]
                    self._addWarning(
                        'Manifest lists missing mesh PLY files: '
                        + ', '.join(missing_names)
                    )
            if has_point_clouds:
                staged_point_cloud_status = (
                    self.check_staged_point_cloud_ply_files(
                        identity_id, manifest))
                if staged_point_cloud_status['pending']:
                    self._addRemark(
                        f'Found {len(staged_point_cloud_status["pending"])} '
                        f'staged point cloud PLY file(s) for identity '
                        f'{identity_id}'
                    )
                if staged_point_cloud_status['missing']:
                    missing_names = [
                        f'point_clouds/{item["primitive_index"]}.ply'
                        for item in staged_point_cloud_status['missing']
                    ]
                    self._addWarning(
                        'Manifest lists missing point cloud PLY files: '
                        + ', '.join(missing_names)
                    )
        elif has_meshes or has_point_clouds:
            self._addRemark(
                f'No staging manifest for identity {identity_id}; '
                'inline geometry primitives only'
            )

        pending_asset_count = 0
        if staged_mesh_status:
            pending_asset_count += len(staged_mesh_status['pending'])
        if staged_point_cloud_status:
            pending_asset_count += len(staged_point_cloud_status['pending'])

        if not Run:
            status_msg = f'Ready to create identity {identity_id}'
            if pending_asset_count:
                status_msg += f' with {pending_asset_count} staged PLY file(s)'
            status_msg += ' (toggle Run to execute)'
            self.Component.Message = status_msg
            return AddedComponentData

        try:
            self.Component.Message = 'Creating identity and snapshot...'

            response = auth_core.authorized_post(
                '/identities',
                json_body=payload,
            )

            if response.status_code == 201:
                passport = response.json()
                identity_doc = passport.get('identity') or {}
                snapshots = passport.get('snapshots') or []
                snapshot_doc = snapshots[0] if snapshots else {}
                created_identity_id = identity_doc.get('_id', identity_id)
                snapshot_id = snapshot_doc.get('_id', '')

                # Create datatree path and add component to tree
                ghp = Grasshopper.Kernel.Data.GH_Path(0)
                AddedComponentData.Add(json.dumps(passport), ghp)

                self._addRemark(
                    f'Created identity {created_identity_id} '
                    f'(snapshot {snapshot_id})'
                )
                self.Component.Message = (
                    f'Created identity {created_identity_id}'
                )

                # Consume pending transmitted ID after successful DB insert.
                # This is intentionally non-fatal for AddComponent: if consume
                # fails, we keep the added component result and only warn.
                try:
                    consume_response = auth_core.authorized_post(
                        '/component_id_transmission/consume',
                        json_body={'identity_id': created_identity_id},
                    )
                    if consume_response.status_code == 200:
                        consume_payload = consume_response.json()
                        if consume_payload.get('consumed', False):
                            self._addRemark(
                                'Consumed pending transmitted ID after create.'
                            )
                        else:
                            self._addRemark(
                                'No matching transmitted ID to consume.'
                            )
                    else:
                        self._addWarning(
                            'Identity created, but transmitted ID consume '
                            f'failed ({consume_response.status_code}).'
                        )
                except Exception as exc:
                    self._addWarning(
                        'Identity created, but transmitted '
                        'ID consume errored: '
                        f'{str(exc)}'
                    )

                upload_issues = False
                if (
                    snapshot_id
                    and staged_mesh_status
                    and staged_mesh_status['pending']
                ):
                    self.Component.Message = (
                        'Uploading staged mesh PLY files...'
                    )
                    if not self.upload_staged_ply_files(
                            auth_core,
                            snapshot_id,
                            created_identity_id,
                            staged_mesh_status['pending'],
                    ):
                        upload_issues = True
                if (
                    snapshot_id
                    and staged_point_cloud_status
                    and staged_point_cloud_status['pending']
                ):
                    self.Component.Message = (
                        'Uploading staged point cloud PLY files...'
                    )
                    if not self.upload_staged_point_cloud_ply_files(
                            auth_core,
                            snapshot_id,
                            created_identity_id,
                            staged_point_cloud_status['pending'],
                    ):
                        upload_issues = True
                if upload_issues:
                    self._addWarning(
                        'Identity created but some staged PLY uploads failed'
                    )
                    self.Component.Message = (
                        f'Created identity {created_identity_id} '
                        '(PLY upload issues)'
                    )
                elif pending_asset_count:
                    self.Component.Message = (
                        f'Created identity {created_identity_id} with PLY'
                    )

                return AddedComponentData

            if response.status_code in (400, 422):
                msg = self._format_http_error(response)
                self._addError(msg)
                self.Component.Message = 'Create failed (validation)'
                return AddedComponentData

            if response.status_code == 401:
                msg = 'Authentication failed. Please sign in again.'
                self._addError(msg)
                self.Component.Message = msg
                return AddedComponentData

            if response.status_code == 403:
                msg = 'Access denied. Insufficient permissions.'
                self._addError(msg)
                self.Component.Message = msg
                return AddedComponentData

            if response.status_code == 409:
                msg = 'Identity already exists with this _id.'
                self._addWarning(msg)
                self.Component.Message = msg
                return AddedComponentData

            if response.status_code == 500:
                msg = 'Server error. Please try again later.'
                self._addWarning(msg)
                self.Component.Message = msg
                return AddedComponentData

            msg = self._format_http_error(response)
            self._addError(msg)
            self.Component.Message = msg
            return AddedComponentData

        except requests.exceptions.ConnectionError as exc:
            msg = 'Cannot connect to server. Please check your connection.'
            self._addError(msg + f'\nFull Error: {str(exc)}')
            self.Component.Message = msg

        except requests.exceptions.Timeout as exc:
            msg = 'Request timeout. Server may be slow.'
            self._addError(msg + f'\nFull Error: {str(exc)}')
            self.Component.Message = msg

        except requests.exceptions.RequestException as exc:
            msg = f'Request error: {str(exc)}'
            self._addError(msg)
            self.Component.Message = msg

        except Exception as exc:
            msg = f'Unexpected error: {str(exc)}'
            self._addError(msg)
            self.Component.Message = msg

        return AddedComponentData
# ---------- end addcomponentidentity ----------
componentdata_30 = Data(addcomponentidentity)

# ---- group: __DDU_CSC_EXAMPLE_02__
# Step 4
# comments & notes: Get ComponentData from Geometry again
geometry_4 = Data(geometry_3)
getcomponentdata = GetComponentData(Geometry=geometry_4)  # -> ComponentData; inputs Geometry: list of GeometryBase
# ---------- getcomponentdata: Python ----------
#! python3
# -*- coding: utf-8 -*-
# venv: DDU_CSC
print('ENV OK!')
# r: charset_normalizer
# r: requests

# PYTHON STANDARD LIBRARY IMPORTS ---------------------------------------------
import json  # NOQA

# RHINO AND GH RELATED IMPORTS ------------------------------------------------
import System  # NOQA
import Rhino  # NOQA
import Grasshopper  # NOQA

# GHENV COMPONENT SETTINGS ----------------------------------------------------
ghenv.Component.Name = 'GetComponentData'  # NOQA
ghenv.Component.NickName = 'GetComponentData'  # NOQA
ghenv.Component.Category = 'DDU_CSC'  # NOQA
ghenv.Component.SubCategory = '3 Component Operations'  # NOQA
ghenv.Component.Description = (  # NOQA
    'Extracts the csc_component passport data ({identity, snapshot} JSON '
    'string) from Rhino geometry objects. Safely retrieves and parses the '
    'passport data stored as user strings.'
)


class CSC_GetComponentData(Grasshopper.Kernel.GH_ScriptInstance):
    """
    Author: Max Benjamin Eschenbach
    License: MIT License
    Version: 260908
    """

    def __init__(self):
        """Initialize this component and set component parameters."""
        super().__init__()
        # initialize props
        self.Component = ghenv.Component  # NOQA
        self.InputParams = self.Component.Params.Input
        self.OutputParams = self.Component.Params.Output

    def _addRemark(self, msg: str = ''):
        """Add a remark message to the component."""
        rml = self.Component.RuntimeMessageLevel.Remark
        self.AddRuntimeMessage(rml, msg)

    def _addWarning(self, msg: str = ''):
        """Add a warning message to the component."""
        rml = self.Component.RuntimeMessageLevel.Warning
        self.AddRuntimeMessage(rml, msg)

    def _addError(self, msg: str = ''):
        """Add an error message to the component."""
        rml = self.Component.RuntimeMessageLevel.Error
        self.AddRuntimeMessage(rml, msg)

    def BeforeRunScript(self):
        """Perform some setup actions."""
        # Initialize input param descriptions
        self.InputParams[0].Description = (
            'Geometry objects with the \'csc_component\' passport userdata'
        )
        # Initialize output param descriptions
        i = 0
        if self.OutputParams[0].Name == 'out':
            i += 1
        self.OutputParams[0+i].Description = (
            'Passport JSON strings ({identity, snapshot}) extracted from '
            'geometry userdata'
        )

    def extract_component_data_from_geometry(self, geometry):
        """
        Extract passport data ({identity, snapshot}) from geometry userdata.

        Args:
            geometry: Rhino geometry object with userdata

        Returns:
            Passport dictionary or None
        """
        try:
            if hasattr(geometry, 'GetUserString'):
                userdata = geometry.GetUserString('csc_component')
                if userdata:
                    return json.loads(userdata)
                else:
                    self._addWarning('No csc_component userdata found')
            else:
                self._addWarning('Geometry object does not support userdata')
        except json.JSONDecodeError as e:
            self._addError(f'Invalid JSON in userdata: {str(e)}')
        except Exception as e:
            self._addError(f'Error extracting component data: {str(e)}')
        return None

    def RunScript(self,
            Geometry: System.Collections.Generic.List[Rhino.Geometry.GeometryBase]):
        # Set up output tree
        ComponentData = Grasshopper.DataTree[System.Object]()

        # Validate input
        if not Geometry:
            msg = 'Input geometry failed to collect data!'
            self._addWarning(msg)
            self.Component.Message = msg
            return ComponentData

        try:
            # Handle single geometry or list of geometries
            successful_extractions = 0

            for i, geo in enumerate(Geometry):
                if geo is None:
                    self._addWarning(f'Geometry at index {i} is None, '
                                     f'skipping')
                    continue

                # Extract passport data
                passport = self.extract_component_data_from_geometry(geo)
                if passport:
                    # Add to output
                    ComponentData.Add(
                        json.dumps(passport),
                        Grasshopper.Kernel.Data.GH_Path(i)
                    )
                    successful_extractions += 1
                    self._addRemark(f'Successfully extracted passport data '
                                    f'from geometry {i}')
                else:
                    # Add empty string to maintain data tree structure
                    ComponentData.Add(
                        '',
                        Grasshopper.Kernel.Data.GH_Path(i)
                    )
                    self._addWarning(f'Failed to extract passport data '
                                     f'from geometry {i}')

            # Update success message
            if successful_extractions == 0:
                msg = 'No passport data found in any geometry objects'
                self._addError(msg)
                self.Component.Message = msg
            elif successful_extractions == len(Geometry):
                self._addRemark(f'Extracted passport data from '
                                f'{successful_extractions} out of '
                                f'{len(Geometry)} geometry objects')
            else:
                self._addWarning('Some geometry objects did not contain '
                                 'valid passport data')

            return ComponentData

        except Exception as e:
            msg = f'Unexpected error: {str(e)}'
            self._addError(msg)
            return ComponentData
# ---------- end getcomponentdata ----------

# ---- group: __DDU_CSC_EXAMPLE_01__
# Step 4
# comments & notes: With this component we can apply any transformation (moving, rotating etc.) defined as a XForm (Rhino Transformation) to the components.
# 
# NOTE: This does not alter the components itself, it just tells the system where and how to place them. We do NOT change the catalogue!
componentdata_31 = Data(componentdata_2)
xform_4 = Data(xform_2)
transformcomponent_2 = TransformComponent(ComponentData=componentdata_31, XForm=xform_4)  # -> XComponentData; inputs ComponentData: String, XForm: Transform; same code as transformcomponent
componentdata_32 = Data(transformcomponent_2)

# ---- group: __DDU_CSC_EXAMPLE_04__
# Step 4
# comments & notes: Disassemble the synced components. See how the transformations from the Rhino document are applied?
componentdata_33 = Data(componentdata_18)
disassemblecomponent = DisassembleComponent(ComponentData=componentdata_33)  # -> ID, Name, Type, Material, Color, Location, BoundingBox, PCAFrame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; inputs ComponentData: tree of String
# ---------- disassemblecomponent: Python ----------
#! python3
# -*- coding: utf-8 -*-
# venv: DDU_CSC
print('ENV OK!')
# r: charset_normalizer
# r: requests

# PYTHON STANDARD LIBRARY IMPORTS ---------------------------------------------
import json  # NOQA

# RHINO AND GH RELATED IMPORTS ------------------------------------------------
import System  # NOQA
import Rhino  # NOQA
import Grasshopper  # NOQA
import scriptcontext as sc  # NOQA

# GHENV COMPONENT SETTINGS ----------------------------------------------------
ghenv.Component.Name = 'DisassembleComponent'  # NOQA
ghenv.Component.NickName = 'DisassembleComponent'  # NOQA
ghenv.Component.Category = 'DDU_CSC'  # NOQA
ghenv.Component.SubCategory = '3 Component Operations'  # NOQA
ghenv.Component.Description = (  # NOQA
    'Parses passport JSON ({identity, snapshots[]}) and outputs individual '
    'fields as Grasshopper-native types. Reconstructs geometry, bounding '
    'boxes, PCA frames, and metadata from the identity/snapshot pair. '
    'Point clouds prefer the full PLY via Session cache, then the inline '
    'preview.'
)


class CSC_DisassembleComponent(Grasshopper.Kernel.GH_ScriptInstance):
    """
    Author: Max Benjamin Eschenbach
    License: MIT License
    Version: 260908
    """

    def __init__(self):
        """Initialize this component and set component parameters."""
        super().__init__()
        # initialize props
        self.Component = ghenv.Component  # NOQA
        self.InputParams = self.Component.Params.Input
        self.OutputParams = self.Component.Params.Output

    def _addRemark(self, msg: str = ''):
        """Add a remark message to the component."""
        rml = self.Component.RuntimeMessageLevel.Remark
        self.AddRuntimeMessage(rml, msg)

    def _addWarning(self, msg: str = ''):
        """Add a warning message to the component."""
        rml = self.Component.RuntimeMessageLevel.Warning
        self.AddRuntimeMessage(rml, msg)

    def _addError(self, msg: str = ''):
        """Add an error message to the component."""
        rml = self.Component.RuntimeMessageLevel.Error
        self.AddRuntimeMessage(rml, msg)

    def BeforeRunScript(self):
        """Perform some setup actions."""
        # Initialize input param descriptions
        self.InputParams[0].Description = (
            'Passport JSON ({identity, snapshots[]}) fetched from the server.'
        )
        # Initialize output param descriptions
        i = 0
        if self.OutputParams[0].Name == 'out':
            i += 1
        self.OutputParams[0+i].Description = (
            'Identity ID (GUID)'
        )
        self.OutputParams[1+i].Description = (
            'Snapshot name (e.g. My Component 01)'
        )
        self.OutputParams[2+i].Description = (
            'Component type (panel, beam, slab, etc.)'
        )
        self.OutputParams[3+i].Description = (
            'Component material'
        )
        self.OutputParams[4+i].Description = (
            'Snapshot color as System.Drawing.Color'
        )
        self.OutputParams[5+i].Description = (
            'Snapshot location as Point3d (X=latitude, Y=longitude, Z=0)'
        )
        self.OutputParams[6+i].Description = (
            'Snapshot bounding box as Rhino.Geometry.BoundingBox'
        )
        self.OutputParams[7+i].Description = (
            'Snapshot PCA frame at world origin as Rhino.Geometry.Plane'
        )
        self.OutputParams[8+i].Description = (
            'Snapshot descriptors/metadata as JSON string'
        )
        self.OutputParams[9+i].Description = (
            'Rhino geometry objects (extrusions, meshes, point clouds). '
            'Point clouds prefer full PLY when Session is signed in, '
            'else the inline preview.'
        )
        self.OutputParams[10+i].Description = (
            'Marker points as list of Point3d objects'
        )
        self.OutputParams[11+i].Description = (
            'Identity attributes as JSON string'
        )
        self.OutputParams[12+i].Description = (
            'Snapshot condition grade (0=destroyed/retired, 1=poor, '
            '2=average, 3=good)'
        )
        self.OutputParams[13+i].Description = (
            'Component manufacturing date as ISO-8601 UTC timestamp'
        )
        self.OutputParams[14+i].Description = (
            'Precision qualifier for ManufacturedAt (exact, month, year, '
            'unknown)'
        )
        self.OutputParams[15+i].Description = (
            'Component salvage source (e.g. building name, site)'
        )
        self.OutputParams[16+i].Description = (
            'Component salvage date as ISO-8601 UTC timestamp'
        )
        self.OutputParams[17+i].Description = (
            'Parent identity IDs (GUIDs) this identity was derived from'
        )
        if len(self.OutputParams) > 18 + i:
            self.OutputParams[18+i].Description = (
                'Reinforcement JSON strings ({spec, diameter, points}) in '
                'iframe space; one per bar, same format as CreateReinforcement'
            )

    def ComponentExtrusions(
            self,
            geometry: dict) -> list[Rhino.Geometry.Extrusion]:
        """Create capped extrusions from geometry.extrusions list."""
        extrusions = []
        tol = Rhino.RhinoMath.SqrtEpsilon
        for extr in geometry.get('extrusions', []) or []:
            profile = extr.get('profile') or []
            if len(profile) < 3:
                continue

            pts = [Rhino.Geometry.Point3d(pt[0], pt[1], 0.0)
                   for pt in profile]
            # Stored profiles are open; drop a duplicate closing vertex
            if len(pts) >= 2 and pts[0].DistanceTo(pts[-1]) <= tol:
                pts = pts[:-1]
            if len(pts) < 3:
                continue

            pl = Rhino.Geometry.Polyline()
            pl.AddRange(pts)
            if not pl.IsClosed:
                pl.Add(pl[0])

            height = float(extr.get('height', 0))
            if height <= 0:
                continue

            cxt = Rhino.Geometry.Extrusion.Create(
                pl.ToPolylineCurve(),
                Rhino.Geometry.Plane.WorldXY,
                height,
                True)
            if cxt is None:
                continue

            # move extrusion downwards half material
            # thickness to center it at the origin
            cxt.Translate(Rhino.Geometry.Vector3d(0, 0, height * -0.5))
            extrusions.append(cxt)
        return extrusions

    def ComponentMeshes(
            self,
            geometry: dict,
            snapshot_color,
            identity_id: str) -> list[Rhino.Geometry.Mesh]:
        """Create multiple meshes from geometry.meshes field."""
        meshes = []
        for idx, mesh_data in enumerate(geometry.get('meshes', []) or []):
            mesh = Rhino.Geometry.Mesh()
            vl = mesh_data['vertices']
            fl = mesh_data['faces']
            [mesh.Vertices.Add(*v) for v in vl]
            [mesh.Faces.AddFace(*f) for f in fl]
            # Try to get mesh-specific colors first
            cl = mesh_data.get('colors')
            if cl:
                [mesh.VertexColors.Add(
                    System.Drawing.Color.FromArgb(*c)) for c in cl]
            else:
                # Fallback: use snapshot color for all vertices
                try:
                    component_color = System.Drawing.Color.FromArgb(
                        255, *snapshot_color)
                    for _ in range(len(vl)):
                        mesh.VertexColors.Add(component_color)
                except (KeyError, TypeError):
                    # If even snapshot color fails, use a default gray
                    default_color = System.Drawing.Color.Gray
                    for _ in range(len(vl)):
                        mesh.VertexColors.Add(default_color)
                    self._addWarning(
                        f'Mesh {idx} in identity {identity_id} '
                        f'using default gray color')
            mesh.RebuildNormals()
            mesh.UnifyNormals()
            mesh.Compact()
            meshes.append(mesh)
        return meshes

    def get_auth_core_from_sticky(self):
        """Return Session AuthCore when signed in; None otherwise."""
        return sc.sticky.get('CSC_AuthCore')

    def build_inline_point_cloud(self, pc_data):
        """Build a Rhino point cloud from one inline SnapshotPointCloud."""
        if not isinstance(pc_data, dict):
            return None
        pts = pc_data.get('points', []) or []
        if not pts:
            return None
        cloud = Rhino.Geometry.PointCloud()
        colors = pc_data.get('colors')
        if colors and len(colors) == len(pts):
            for p, c in zip(pts, colors):
                cloud.Add(
                    Rhino.Geometry.Point3d(p[0], p[1], p[2]),
                    System.Drawing.Color.FromArgb(*c))
        else:
            for p in pts:
                cloud.Add(Rhino.Geometry.Point3d(p[0], p[1], p[2]))
        return cloud if cloud.Count > 0 else None

    def fetch_snapshot_point_clouds(self, auth_core, snapshot):
        """
        Prefer full point-cloud PLY via Session cache, then inline preview.

        Returns a list of (cloud, primitive_index) tuples so
        csc_point_cloud_index stays aligned with snapshot.geometry.
        """
        geometry = snapshot.get('geometry', {}) or {}
        inline_pcs = geometry.get('point_clouds', []) or []
        snapshot_id = snapshot.get('_id')
        results = []
        for i in range(len(inline_pcs)):
            cloud = None
            if auth_core and snapshot_id:
                try:
                    cloud = auth_core.cached_get_snapshot_point_cloud(
                        snapshot_id, i)
                except Exception as e:
                    self._addWarning(
                        'Point cloud PLY fetch failed '
                        f'for index {i}: {str(e)}')
            if cloud is None:
                cloud = self.build_inline_point_cloud(inline_pcs[i])
            if cloud is not None:
                results.append((cloud, i))
            else:
                self._addWarning(
                    f'Point cloud {i} is invalid or empty')
        return results

    def ComponentReinforcementJson(
            self,
            geometry: dict,
            identity_id: str,
            xform: Rhino.Geometry.Transform) -> list[str]:
        """Parse geometry.reinforcements into CreateReinforcement JSON strings."""
        json_strings = []
        for idx, bar in enumerate(geometry.get('reinforcements', []) or []):
            if not isinstance(bar, dict):
                self._addWarning(
                    f'Reinforcement {idx} in identity {identity_id}: '
                    'expected object'
                )
                continue

            spec = str(bar.get('spec', '')).strip()
            if not spec:
                self._addWarning(
                    f'Reinforcement {idx} in identity {identity_id}: '
                    'missing spec'
                )
                continue

            try:
                diameter = float(bar.get('diameter', 0))
            except (TypeError, ValueError):
                self._addWarning(
                    f'Reinforcement {idx} in identity {identity_id}: '
                    'invalid diameter'
                )
                continue
            if diameter <= 0:
                self._addWarning(
                    f'Reinforcement {idx} in identity {identity_id}: '
                    'diameter must be > 0'
                )
                continue

            points = bar.get('points') or []
            if not isinstance(points, list) or len(points) < 2:
                self._addWarning(
                    f'Reinforcement {idx} in identity {identity_id}: '
                    'needs at least 2 points'
                )
                continue

            iframe_points = []
            valid = True
            for pt in points:
                if (not isinstance(pt, (list, tuple))
                        or len(pt) != 3):
                    self._addWarning(
                        f'Reinforcement {idx} in identity {identity_id}: '
                        f'invalid point {pt}'
                    )
                    valid = False
                    break
                point = Rhino.Geometry.Point3d(
                    float(pt[0]), float(pt[1]), float(pt[2]))
                point.Transform(xform)
                iframe_points.append([point.X, point.Y, point.Z])
            if not valid or len(iframe_points) < 2:
                continue

            json_strings.append(json.dumps({
                'spec': spec,
                'diameter': diameter,
                'points': iframe_points,
            }))
        return json_strings

    def ComponentColor(self, snapshot: dict) -> System.Drawing.Color:
        color = snapshot.get('color') or [110, 110, 110]
        return System.Drawing.Color.FromArgb(255, *color)

    def ComponentBoundingBox(
            self,
            snapshot: dict) -> Rhino.Geometry.BoundingBox:
        xtx = snapshot['bbx'][0]
        xty = snapshot['bbx'][1]
        xtz = snapshot['bbx'][2]

        # Get bbx_origin (center of bounding box in PCA space)
        bbx_origin = snapshot.get('bbx_origin', [0.0, 0.0, 0.0])

        # Create bounding box at bbx_origin in PCA space
        bbx = Rhino.Geometry.BoundingBox(
            bbx_origin[0] - xtx * 0.5,
            bbx_origin[1] - xty * 0.5,
            bbx_origin[2] - xtz * 0.5,
            bbx_origin[0] + xtx * 0.5,
            bbx_origin[1] + xty * 0.5,
            bbx_origin[2] + xtz * 0.5
        )

        # Convert bounding box to Box for transformation
        bbx = Rhino.Geometry.Box(bbx)

        # Transform from PCA space back to original component space
        try:
            pca_frame = snapshot.get('pca_frame', {})
            if pca_frame:
                # Create PCA frame plane at world origin
                pca_origin = Rhino.Geometry.Point3d(
                    *pca_frame.get('o', [0, 0, 0]))
                pca_x = Rhino.Geometry.Vector3d(
                    *pca_frame.get('x', [1, 0, 0]))
                pca_y = Rhino.Geometry.Vector3d(
                    *pca_frame.get('y', [0, 1, 0]))

                pca_plane = Rhino.Geometry.Plane(pca_origin, pca_x, pca_y)

                # Create forward transform (from PCA space to original space)
                pca_transform = (
                    Rhino.Geometry.Transform.PlaneToPlane(
                        Rhino.Geometry.Plane.WorldXY, pca_plane))

                bbx.Transform(pca_transform)

        except (KeyError, TypeError, ValueError) as e:
            # If PCA frame is missing or invalid, use bounding box as-is
            self._addWarning(f'Could not apply PCA frame transform: {str(e)}')

        return bbx

    def ComponentPCAPlane(self, snapshot: dict) -> Rhino.Geometry.Plane:
        """Get PCA plane at world origin from snapshot data."""
        try:
            pca_frame = snapshot.get('pca_frame', {})
            if pca_frame:
                pca_x = Rhino.Geometry.Vector3d(
                    *pca_frame.get('x', [1, 0, 0]))
                pca_y = Rhino.Geometry.Vector3d(
                    *pca_frame.get('y', [0, 1, 0]))
                return Rhino.Geometry.Plane(
                    Rhino.Geometry.Point3d.Origin, pca_x, pca_y)
            else:
                return Rhino.Geometry.Plane.WorldXY
        except (KeyError, TypeError, ValueError):
            return Rhino.Geometry.Plane.WorldXY

    def RunScript(self, ComponentData: Grasshopper.DataTree[str]):
        # set up output trees and results tuple
        ID = Grasshopper.DataTree[System.Object]()
        Name = Grasshopper.DataTree[System.Object]()
        Type = Grasshopper.DataTree[System.Object]()
        Material = Grasshopper.DataTree[System.Object]()
        Color = Grasshopper.DataTree[System.Object]()
        Location = Grasshopper.DataTree[System.Object]()
        BoundingBox = Grasshopper.DataTree[System.Object]()
        PCAFrame = Grasshopper.DataTree[System.Object]()
        Descriptors = Grasshopper.DataTree[System.Object]()
        PrimitiveGeometry = Grasshopper.DataTree[System.Object]()
        MarkerPoints = Grasshopper.DataTree[System.Object]()
        Attributes = Grasshopper.DataTree[System.Object]()
        Condition = Grasshopper.DataTree[System.Object]()
        ManufacturedAt = Grasshopper.DataTree[System.Object]()
        ManufacturedPrecision = Grasshopper.DataTree[System.Object]()
        SalvageSource = Grasshopper.DataTree[System.Object]()
        SalvagedAt = Grasshopper.DataTree[System.Object]()
        ParentComponent = Grasshopper.DataTree[System.Object]()
        ReinforcementJson = Grasshopper.DataTree[System.Object]()
        __Results = (
            ID,
            Name,
            Type,
            Material,
            Color,
            Location,
            BoundingBox,
            PCAFrame,
            Descriptors,
            PrimitiveGeometry,
            MarkerPoints,
            Attributes,
            Condition,
            ManufacturedAt,
            ManufacturedPrecision,
            SalvageSource,
            SalvagedAt,
            ParentComponent,
            ReinforcementJson)
        try:
            # Validate input
            if not ComponentData or ComponentData.DataCount == 0:
                msg = ('Input ComponentData failed to collect Data')
                self._addWarning(msg)
                self.Component.Message = msg
                return __Results

            self.Component.Message = 'Disassembling components...'
            auth_core = self.get_auth_core_from_sticky()

            # loop over all branches
            for i in range(ComponentData.BranchCount):
                ghp = ComponentData.Paths[i]
                for j, comp in enumerate(ComponentData.Branches[i]):
                    try:
                        passport = json.loads(comp)
                        identity = passport.get('identity') or {}
                        snapshots = passport.get('snapshots') or []
                        snapshot = (
                            snapshots[0] if snapshots else {}
                        )
                        if not identity or not snapshot:
                            self._addWarning(
                                'Passport JSON missing identity/snapshots, '
                                'skipping entry')
                            continue

                        identity_id = identity.get('_id')

                        # add directly available metadata to the
                        # respective datatrees
                        ID.Add(identity_id, ghp)
                        Name.Add(snapshot.get('name'), ghp)
                        Type.Add(identity.get('type'), ghp)
                        Material.Add(identity.get('material'), ghp)

                        # create system color from snapshot rgb values
                        color = self.ComponentColor(snapshot)
                        Color.Add(color, ghp)

                        # process location data
                        try:
                            location_data = snapshot.get('location', {}) or {}
                            if ('lat' in location_data and
                                    'lon' in location_data):
                                location_point = Rhino.Geometry.Point3d(
                                    location_data['lat'],
                                    location_data['lon'],
                                    0.0
                                )
                            else:
                                location_point = Rhino.Geometry.Point3d(
                                    0.0, 0.0, 0.0)
                        except (KeyError, TypeError):
                            location_point = Rhino.Geometry.Point3d(
                                0.0, 0.0, 0.0)
                        Location.Add(location_point, ghp)

                        # process insertion frame
                        try:
                            iframe = snapshot['iframe']
                            iplane = Rhino.Geometry.Plane(
                                Rhino.Geometry.Point3d(*iframe['o']),
                                Rhino.Geometry.Vector3d(*iframe['x']),
                                Rhino.Geometry.Vector3d(*iframe['y']),
                            )
                        except (KeyError, TypeError):
                            iplane = Rhino.Geometry.Plane.WorldXY

                        xform = Rhino.Geometry.Transform.PlaneToPlane(
                            Rhino.Geometry.Plane.WorldXY,
                            iplane)

                        # treat geometry block in a special way because
                        # it may hold multiple representations
                        geometry = snapshot.get('geometry', {}) or {}
                        for key in sorted(geometry.keys()):
                            if key == 'extrusions':
                                for xtr in self.ComponentExtrusions(geometry):
                                    # transform to iframe
                                    xtr.Transform(xform)
                                    # set user string
                                    xtr.SetUserString('csc_component', comp)
                                    # add to datatree
                                    PrimitiveGeometry.Add(xtr, ghp)
                            elif key == 'meshes':
                                # Handle multiple meshes
                                meshes = self.ComponentMeshes(
                                    geometry,
                                    snapshot.get('color'),
                                    identity_id)
                                for mesh_idx, mesh in enumerate(meshes):
                                    # transform to iframe
                                    mesh.Transform(xform)
                                    # set user string with mesh index
                                    mesh.SetUserString('csc_component', comp)
                                    mesh.SetUserString('csc_mesh_index',
                                                       str(mesh_idx))
                                    # add to datatree
                                    PrimitiveGeometry.Add(mesh, ghp)
                            elif key == 'point_clouds':
                                clouds = self.fetch_snapshot_point_clouds(
                                    auth_core, snapshot)
                                for cloud, cloud_idx in clouds:
                                    cloud.Transform(xform)
                                    cloud.SetUserString(
                                        'csc_component', comp)
                                    cloud.SetUserString(
                                        'csc_point_cloud_index',
                                        str(cloud_idx))
                                    PrimitiveGeometry.Add(cloud, ghp)
                            elif key in ('marker_points', 'reinforcements'):
                                # handled separately below
                                continue
                            else:
                                msg = (f'Missing implementation for geometry '
                                       f'of type \'{key}\'!')
                                self._addWarning(msg)

                        # construct boundingbox
                        bbx = self.ComponentBoundingBox(snapshot)

                        # apply iframe transform
                        bbx.Transform(xform)
                        BoundingBox.Add(bbx, ghp)

                        # get PCA plane at world origin
                        pca_plane = self.ComponentPCAPlane(snapshot)
                        # apply iframe transform to PCA plane
                        pca_plane.Transform(xform)
                        PCAFrame.Add(pca_plane, ghp)

                        # add descriptors
                        descriptors = snapshot.get('descriptors', {}) or {}
                        Descriptors.Add(json.dumps(descriptors), ghp)

                        # process marker points (now nested under geometry)
                        try:
                            marker_points_data = geometry.get(
                                'marker_points', []) or []
                            marker_points_list = []
                            for point_data in marker_points_data:
                                if (isinstance(point_data, list) and
                                        len(point_data) >= 3):
                                    marker_point = Rhino.Geometry.Point3d(
                                        point_data[0],
                                        point_data[1],
                                        point_data[2]
                                    )
                                    # apply iframe transform to marker point
                                    marker_point.Transform(xform)
                                    marker_points_list.append(marker_point)
                        except (KeyError, TypeError, IndexError):
                            # If no marker points or invalid format, add empty
                            # list
                            marker_points_list = []
                        if marker_points_list:
                            MarkerPoints.AddRange(marker_points_list, ghp)

                        for bar_json in self.ComponentReinforcementJson(
                                geometry, identity_id, xform):
                            ReinforcementJson.Add(bar_json, ghp)

                        # process attributes (identity-level)
                        attributes = identity.get('attributes', {}) or {}
                        Attributes.Add(json.dumps(attributes), ghp)

                        # snapshot-level state
                        if snapshot.get('condition') is not None:
                            Condition.Add(snapshot['condition'], ghp)

                        # identity-level provenance
                        if identity.get('manufactured_at') is not None:
                            ManufacturedAt.Add(
                                identity['manufactured_at'], ghp)
                        if identity.get('manufactured_precision') is not None:
                            ManufacturedPrecision.Add(
                                identity['manufactured_precision'], ghp)
                        if identity.get('salvage_source') is not None:
                            SalvageSource.Add(identity['salvage_source'], ghp)
                        if identity.get('salvaged_at') is not None:
                            SalvagedAt.Add(identity['salvaged_at'], ghp)
                        parent_identities = identity.get('parent_identities')
                        if parent_identities:
                            ParentComponent.AddRange(parent_identities, ghp)

                    except json.JSONDecodeError as e:
                        msg = f'Failed to parse passport data: {str(e)}'
                        self._addError(msg)
                    except Exception as e:
                        msg = f'Error processing component: {str(e)}'
                        self._addError(msg)

            # Update success message
            total_components = sum(
                len(branch) for branch in ComponentData.Branches
            )
            self.Component.Message = (
                f'Disassembled {total_components} component(s)'
            )
            self._addRemark(
                f'Successfully disassembled {total_components} components'
            )

            # return output trees
            return __Results

        except Exception as e:
            msg = f'Unexpected error during disassembly: {str(e)}'
            self._addError(msg)
            return __Results
# ---------- end disassemblecomponent ----------
manufacturedprecision = Data(disassemblecomponent.ManufacturedPrecision)
primitivegeometry = Data(disassemblecomponent.PrimitiveGeometry)
parentcomponent = Data(disassemblecomponent.ParentComponent)
manufacturedat = Data(disassemblecomponent.ManufacturedAt)
salvagesource = Data(disassemblecomponent.SalvageSource)
boundingbox = Data(disassemblecomponent.BoundingBox)
markerpoints = Data(disassemblecomponent.MarkerPoints)
descriptors = Data(disassemblecomponent.Descriptors)
salvagedat = Data(disassemblecomponent.SalvagedAt)
pcaframe = Data(disassemblecomponent.PCAFrame)
attributes = Data(disassemblecomponent.Attributes)
condition = Data(disassemblecomponent.Condition)
location_5 = Data(disassemblecomponent.Location)
material_7 = Data(disassemblecomponent.Material)
type_7 = Data(disassemblecomponent.Type)
color_3 = Data(disassemblecomponent.Color)
id = Data(disassemblecomponent.ID)
name = Data(disassemblecomponent.Name)

# ----
# comments & notes: Disassemble Component into its elements
componentdata_34 = Data(componentdata_24)
disassemblecomponent_2 = DisassembleComponent(ComponentData=componentdata_34)  # -> ID, Name, Type, Material, Color, Location, BoundingBox, PCAFrame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; inputs ComponentData: tree of String; same code as disassemblecomponent
manufacturedprecision_2 = Data(disassemblecomponent_2.ManufacturedPrecision)
primitivegeometry_2 = Data(disassemblecomponent_2.PrimitiveGeometry)
parentcomponent_2 = Data(disassemblecomponent_2.ParentComponent)
manufacturedat_2 = Data(disassemblecomponent_2.ManufacturedAt)
salvagesource_2 = Data(disassemblecomponent_2.SalvageSource)
boundingbox_2 = Data(disassemblecomponent_2.BoundingBox)
markerpoints_2 = Data(disassemblecomponent_2.MarkerPoints)
descriptors_2 = Data(disassemblecomponent_2.Descriptors)
salvagedat_2 = Data(disassemblecomponent_2.SalvagedAt)
pcaframe_2 = Data(disassemblecomponent_2.PCAFrame)
attributes_2 = Data(disassemblecomponent_2.Attributes)
condition_2 = Data(disassemblecomponent_2.Condition)
location_6 = Data(disassemblecomponent_2.Location)
material_8 = Data(disassemblecomponent_2.Material)
id_2 = Data(disassemblecomponent_2.ID)
name_2 = Data(disassemblecomponent_2.Name)
type_8 = Data(disassemblecomponent_2.Type)
color_4 = Data(disassemblecomponent_2.Color)

# ---- group: __DDU_CSC_EXAMPLE_05__
# Step 3.1
# comments & notes: Get radial shape signature distances with medium (32 rays) resolution.
panel_10 = Panel("radial_distance_32")
componentdata_35 = Data(componentdata_3)
getdescriptor = GetDescriptor(Input=componentdata_35, DescriptorKey=panel_10)  # -> DescriptorValues; inputs Input: list, DescriptorKey: String
# ---------- getdescriptor: Python ----------
#! python3
# -*- coding: utf-8 -*-
# venv: DDU_CSC
print('ENV OK!')
# r: charset_normalizer
# r: requests

# PYTHON STANDARD LIBRARY IMPORTS ---------------------------------------------
import json  # NOQA

# RHINO AND GH RELATED IMPORTS ------------------------------------------------
import System  # NOQA
import Grasshopper  # NOQA
import Rhino  # NOQA

# GHENV COMPONENT SETTINGS ----------------------------------------------------
ghenv.Component.Name = 'GetDescriptor'  # NOQA
ghenv.Component.NickName = 'GetDescriptor'  # NOQA
ghenv.Component.Category = 'DDU_CSC'  # NOQA
ghenv.Component.SubCategory = '6 Data Tools'  # NOQA
ghenv.Component.Description = (  # NOQA
    'Retrieves a specific descriptor from multiple passport inputs '
    '({identity, snapshot}). Accepts passport JSON strings or geometries '
    'with the csc_component userdata. Returns descriptor values for the '
    'specified key from snapshot.descriptors. Handles single values, lists, '
    'and nested lists by mapping them to appropriate Grasshopper data '
    'structures with input indices as the first path level.'
)


class CSC_GetDescriptor(Grasshopper.Kernel.GH_ScriptInstance):
    """
    Author: Max Benjamin Eschenbach
    License: MIT License
    Version: 260908
    """

    def __init__(self):
        """Initialize this component and set component parameters."""
        super().__init__()
        # initialize props
        self.Component = ghenv.Component  # NOQA
        self.InputParams = self.Component.Params.Input
        self.OutputParams = self.Component.Params.Output

    def _addRemark(self, msg: str = ''):
        """Add a remark message to the component."""
        rml = self.Component.RuntimeMessageLevel.Remark
        self.AddRuntimeMessage(rml, msg)

    def _addWarning(self, msg: str = ''):
        """Add a warning message to the component."""
        rml = self.Component.RuntimeMessageLevel.Warning
        self.AddRuntimeMessage(rml, msg)

    def _addError(self, msg: str = ''):
        """Add an error message to the component."""
        rml = self.Component.RuntimeMessageLevel.Error
        self.AddRuntimeMessage(rml, msg)

    def BeforeRunScript(self):
        """Perform some setup actions."""
        # Set "No type hint"
        self.InputParams[0].TypeHints.Select(System.Object)
        self.Component.VariableParameterMaintenance()
        # Initialize input param descriptions
        self.InputParams[0].Description = (
            'List of passport JSON strings ({identity, snapshot}) OR '
            'geometries with the \'csc_component\' passport userdata'
        )
        self.InputParams[1].Description = (
            'Key string to retrieve from snapshot.descriptors'
        )
        # Initialize output param descriptions
        i = 0
        if self.OutputParams[0].Name == 'out':
            i += 1
        self.OutputParams[0+i].Description = (
            'Descriptor value for the specified key, or empty if not found'
        )

    def extract_passport_from_geometry(self, geometry):
        """
        Extract passport data ({identity, snapshot}) from geometry userdata.

        Args:
            geometry: Rhino geometry object with userdata

        Returns:
            Passport dictionary or None
        """
        try:
            if hasattr(geometry, 'GetUserString'):
                userdata = geometry.GetUserString('csc_component')
                if userdata:
                    return json.loads(userdata)
        except Exception as e:
            self._addWarning(f'Could not extract passport data: {str(e)}')
        return None

    def get_descriptor_value(self, passport, descriptor_key):
        """
        Extract descriptor value from snapshot.descriptors using the key.

        Args:
            passport: Passport dictionary ({identity, snapshot})
            descriptor_key: String key to look for in descriptors

        Returns:
            Descriptor value or None if not found
        """
        try:
            snapshots = (
                passport.get('snapshots')
                if isinstance(passport, dict)
                else None
            )
            snapshot = (
                snapshots[0]
                if isinstance(snapshots, list) and snapshots
                else None
            )
            if not isinstance(snapshot, dict):
                self._addWarning('Passport JSON has no snapshots')
                return None

            descriptors = snapshot.get('descriptors')
            if isinstance(descriptors, dict) and descriptor_key in descriptors:
                return descriptors[descriptor_key]

            self._addWarning(
                f'Descriptor key "{descriptor_key}" not found in '
                'snapshot.descriptors')
            return None
        except Exception as e:
            self._addError(f'Error extracting descriptor: {str(e)}')
            return None

    def convert_descriptor_to_gh_data(self, descriptor_value):
        """
        Convert descriptor value to appropriate Grasshopper data structure.

        Args:
            descriptor_value: The descriptor value (always float values)

        Returns:
            Grasshopper DataTree with appropriate structure
        """
        result_tree = Grasshopper.DataTree[System.Object]()

        if descriptor_value is None:
            return result_tree

        # Single float value
        if isinstance(descriptor_value, (int, float)):
            ghp = Grasshopper.Kernel.Data.GH_Path(0)
            result_tree.Add(float(descriptor_value), ghp)

        # List of floats
        elif isinstance(descriptor_value, list):
            if len(descriptor_value) == 0:
                return result_tree

            # Check if it's a list of lists (2D)
            if all(isinstance(item, list) for item in descriptor_value):
                # Check if it's 3D (list of lists of lists)
                is_3d = all(isinstance(sublist_item, list)
                            for sublist in descriptor_value
                            for sublist_item in sublist)
                if is_3d:
                    # 3D structure: [[[1,2],[3,4]], [[5,6],[7,8]]]
                    # Paths: (0;0), (0;1), (1;0), (1;1)
                    for i, sublist in enumerate(descriptor_value):
                        for j, inner_list in enumerate(sublist):
                            ghp = Grasshopper.Kernel.Data.GH_Path(i, j)
                            for value in inner_list:
                                result_tree.Add(float(value), ghp)
                else:
                    # 2D structure: [[1,2,3], [9,8,7]]
                    # Paths: (0) for first sublist, (1) for second sublist
                    for i, sublist in enumerate(descriptor_value):
                        ghp = Grasshopper.Kernel.Data.GH_Path(i)
                        for value in sublist:
                            result_tree.Add(float(value), ghp)
            else:
                # Simple list of floats: [1,2,3]
                # Single branch: (0)
                path = Grasshopper.Kernel.Data.GH_Path(0)
                for value in descriptor_value:
                    result_tree.Add(float(value), path)
        else:
            # Fallback for other types
            ghp = Grasshopper.Kernel.Data.GH_Path(0)
            result_tree.Add(float(descriptor_value), ghp)

        return result_tree

    def RunScript(self,
            Input: System.Collections.Generic.List[object],
            DescriptorKey: str):
        # set up output trees and results tuple
        DescriptorValues = Grasshopper.DataTree[System.Object]()
        try:
            # Validate inputs
            if not Input:
                msg = 'No input provided'
                self._addWarning(msg)
                self.Component.Message = msg
                return DescriptorValues

            if not DescriptorKey:
                msg = 'No descriptor key provided'
                self._addWarning(msg)
                self.Component.Message = msg
                return DescriptorValues

            self.Component.Message = 'Processing inputs...'

            # Process each input item
            input_list = list(Input)
            for input_index, input_item in enumerate(input_list):
                # Determine input type and extract passport data
                passport = None

                # Check if input is a passport JSON string
                if isinstance(input_item, str):
                    try:
                        passport = json.loads(input_item)
                        self._addRemark(
                            f'Input {input_index} detected as passport JSON')
                    except json.JSONDecodeError:
                        msg = (f'Input {input_index} is not valid passport '
                               'JSON!')
                        self._addError(msg)
                        continue
                else:
                    # Input is geometry - extract passport from userdata
                    passport = self.extract_passport_from_geometry(input_item)
                    if not passport:
                        msg = (f'Could not extract passport data from '
                               f'input {input_index}!')
                        self._addError(msg)
                        continue

                    self._addRemark(
                        f'Input {input_index} detected as geometry with '
                        'passport userdata')

                # Extract descriptor value
                try:
                    descriptor_value = self.get_descriptor_value(
                        passport, DescriptorKey)

                    if descriptor_value is not None:
                        # Convert descriptor to appropriate Grasshopper data
                        converted_tree = self.convert_descriptor_to_gh_data(
                            descriptor_value)

                        # Merge the converted tree into the output
                        for i in range(converted_tree.BranchCount):
                            original_path = converted_tree.Path(i)
                            # get runcount for first GH Tree index
                            rc = self.Component.RunCount - 1
                            # Prepend input index to the path
                            new_path = Grasshopper.Kernel.Data.GH_Path(
                                0,
                                rc,
                                input_index,
                                *original_path.Indices)
                            branch_data = converted_tree.Branch(i)
                            for item in branch_data:
                                DescriptorValues.Add(item, new_path)

                        self._addRemark(
                            f'Successfully extracted descriptor '
                            f'"{DescriptorKey}" from input {input_index}'
                        )
                    else:
                        # Descriptor not found
                        msg = (f'Descriptor "{DescriptorKey}" not found in '
                               f'input {input_index}')
                        self._addWarning(msg)

                except Exception as e:
                    msg = (f'Error extracting descriptor from input '
                           f'{input_index}: {str(e)}')
                    self._addError(msg)

            # Update success message
            self.Component.Message = f'Processed {len(input_list)} input(s)'

            # return output trees
            return DescriptorValues

        except Exception as e:
            msg = f'Unexpected error during descriptor extraction: {str(e)}'
            self._addError(msg)
            return DescriptorValues
# ---------- end getdescriptor ----------
radial_distance_32 = Data(getdescriptor)

# Step 3.2
# comments & notes: Get radial shape signature tangent vectors with medium (32 rays) resolution.
panel_11 = Panel("radial_tangent_32")
componentdata_36 = Data(componentdata_3)
getdescriptor_2 = GetDescriptor(Input=componentdata_36, DescriptorKey=panel_11)  # -> DescriptorValues; inputs Input: list, DescriptorKey: String
# ---------- getdescriptor_2: Python ----------
#! python3
# -*- coding: utf-8 -*-
# venv: DDU_CSC
print('ENV OK!')
# r: charset_normalizer
# r: requests

# PYTHON STANDARD LIBRARY IMPORTS ---------------------------------------------
import json  # NOQA

# RHINO AND GH RELATED IMPORTS ------------------------------------------------
import System  # NOQA
import Grasshopper  # NOQA
import Rhino  # NOQA

# GHENV COMPONENT SETTINGS ----------------------------------------------------
ghenv.Component.Name = 'GetDescriptor'  # NOQA
ghenv.Component.NickName = 'GetDescriptor'  # NOQA
ghenv.Component.Category = 'DDU_CSC'  # NOQA
ghenv.Component.SubCategory = '6 Data Tools'  # NOQA
ghenv.Component.Description = (  # NOQA
    'Retrieves a specific descriptor from multiple passport inputs '
    '({identity, snapshot}). Accepts passport JSON strings or geometries '
    'with the csc_component userdata. Returns descriptor values for the '
    'specified key from snapshot.descriptors. Handles single values, lists, '
    'and nested lists by mapping them to appropriate Grasshopper data '
    'structures with input indices as the first path level.'
)


class CSC_GetDescriptor(Grasshopper.Kernel.GH_ScriptInstance):
    """
    Author: Max Benjamin Eschenbach
    License: MIT License
    Version: 260908
    """

    def __init__(self):
        """Initialize this component and set component parameters."""
        super().__init__()
        # initialize props
        self.Component = ghenv.Component  # NOQA
        self.InputParams = self.Component.Params.Input
        self.OutputParams = self.Component.Params.Output

    def _addRemark(self, msg: str = ''):
        """Add a remark message to the component."""
        rml = self.Component.RuntimeMessageLevel.Remark
        self.AddRuntimeMessage(rml, msg)

    def _addWarning(self, msg: str = ''):
        """Add a warning message to the component."""
        rml = self.Component.RuntimeMessageLevel.Warning
        self.AddRuntimeMessage(rml, msg)

    def _addError(self, msg: str = ''):
        """Add an error message to the component."""
        rml = self.Component.RuntimeMessageLevel.Error
        self.AddRuntimeMessage(rml, msg)

    def BeforeRunScript(self):
        """Perform some setup actions."""
        # Set "No type hint"
        self.InputParams[0].TypeHints.Select(System.Object)
        self.Component.VariableParameterMaintenance()
        # Initialize input param descriptions
        self.InputParams[0].Description = (
            'List of passport JSON strings ({identity, snapshot}) OR '
            'geometries with the \'csc_component\' passport userdata'
        )
        self.InputParams[1].Description = (
            'Key string to retrieve from snapshot.descriptors'
        )
        # Initialize output param descriptions
        i = 0
        if self.OutputParams[0].Name == 'out':
            i += 1
        self.OutputParams[0+i].Description = (
            'Descriptor value for the specified key, or empty if not found'
        )

    def extract_passport_from_geometry(self, geometry):
        """
        Extract passport data ({identity, snapshot}) from geometry userdata.

        Args:
            geometry: Rhino geometry object with userdata

        Returns:
            Passport dictionary or None
        """
        try:
            if hasattr(geometry, 'GetUserString'):
                userdata = geometry.GetUserString('csc_component')
                if userdata:
                    return json.loads(userdata)
        except Exception as e:
            self._addWarning(f'Could not extract passport data: {str(e)}')
        return None

    def get_descriptor_value(self, passport, descriptor_key):
        """
        Extract descriptor value from snapshot.descriptors using the key.

        Args:
            passport: Passport dictionary ({identity, snapshot})
            descriptor_key: String key to look for in descriptors

        Returns:
            Descriptor value or None if not found
        """
        try:
            snapshots = (
                passport.get('snapshots')
                if isinstance(passport, dict)
                else None
            )
            snapshot = (
                snapshots[0]
                if isinstance(snapshots, list) and snapshots
                else None
            )
            if not isinstance(snapshot, dict):
                self._addWarning('Passport JSON has no snapshots')
                return None

            descriptors = snapshot.get('descriptors')
            if isinstance(descriptors, dict) and descriptor_key in descriptors:
                return descriptors[descriptor_key]

            self._addWarning(
                f'Descriptor key "{descriptor_key}" not found in '
                'snapshot.descriptors')
            return None
        except Exception as e:
            self._addError(f'Error extracting descriptor: {str(e)}')
            return None

    def convert_descriptor_to_gh_data(self, descriptor_value):
        """
        Convert descriptor value to appropriate Grasshopper data structure.

        Args:
            descriptor_value: The descriptor value (always float values)

        Returns:
            Grasshopper DataTree with appropriate structure
        """
        result_tree = Grasshopper.DataTree[System.Object]()

        if descriptor_value is None:
            return result_tree

        # Single float value
        if isinstance(descriptor_value, (int, float)):
            ghp = Grasshopper.Kernel.Data.GH_Path(0)
            result_tree.Add(float(descriptor_value), ghp)

        # List of floats
        elif isinstance(descriptor_value, list):
            if len(descriptor_value) == 0:
                return result_tree

            # Check if it's a list of lists (2D)
            if all(isinstance(item, list) for item in descriptor_value):
                # Check if it's 3D (list of lists of lists)
                is_3d = all(isinstance(sublist_item, list)
                            for sublist in descriptor_value
                            for sublist_item in sublist)
                if is_3d:
                    # 3D structure: [[[1,2],[3,4]], [[5,6],[7,8]]]
                    # Paths: (0;0), (0;1), (1;0), (1;1)
                    for i, sublist in enumerate(descriptor_value):
                        for j, inner_list in enumerate(sublist):
                            ghp = Grasshopper.Kernel.Data.GH_Path(i, j)
                            for value in inner_list:
                                result_tree.Add(float(value), ghp)
                else:
                    # 2D structure: [[1,2,3], [9,8,7]]
                    # Paths: (0) for first sublist, (1) for second sublist
                    for i, sublist in enumerate(descriptor_value):
                        ghp = Grasshopper.Kernel.Data.GH_Path(i)
                        for value in sublist:
                            result_tree.Add(float(value), ghp)
            else:
                # Simple list of floats: [1,2,3]
                # Single branch: (0)
                path = Grasshopper.Kernel.Data.GH_Path(0)
                for value in descriptor_value:
                    result_tree.Add(float(value), path)
        else:
            # Fallback for other types
            ghp = Grasshopper.Kernel.Data.GH_Path(0)
            result_tree.Add(float(descriptor_value), ghp)

        return result_tree

    def RunScript(self, Input: list[object], DescriptorKey: str):
        # set up output trees and results tuple
        DescriptorValues = Grasshopper.DataTree[System.Object]()
        try:
            # Validate inputs
            if not Input:
                msg = 'No input provided'
                self._addWarning(msg)
                self.Component.Message = msg
                return DescriptorValues

            if not DescriptorKey:
                msg = 'No descriptor key provided'
                self._addWarning(msg)
                self.Component.Message = msg
                return DescriptorValues

            self.Component.Message = 'Processing inputs...'

            # Process each input item
            input_list = list(Input)
            for input_index, input_item in enumerate(input_list):
                # Determine input type and extract passport data
                passport = None

                # Check if input is a passport JSON string
                if isinstance(input_item, str):
                    try:
                        passport = json.loads(input_item)
                        self._addRemark(
                            f'Input {input_index} detected as passport JSON')
                    except json.JSONDecodeError:
                        msg = (f'Input {input_index} is not valid passport '
                               'JSON!')
                        self._addError(msg)
                        continue
                else:
                    # Input is geometry - extract passport from userdata
                    passport = self.extract_passport_from_geometry(input_item)
                    if not passport:
                        msg = (f'Could not extract passport data from '
                               f'input {input_index}!')
                        self._addError(msg)
                        continue

                    self._addRemark(
                        f'Input {input_index} detected as geometry with '
                        'passport userdata')

                # Extract descriptor value
                try:
                    descriptor_value = self.get_descriptor_value(
                        passport, DescriptorKey)

                    if descriptor_value is not None:
                        # Convert descriptor to appropriate Grasshopper data
                        converted_tree = self.convert_descriptor_to_gh_data(
                            descriptor_value)

                        # Merge the converted tree into the output
                        for i in range(converted_tree.BranchCount):
                            original_path = converted_tree.Path(i)
                            # get runcount for first GH Tree index
                            rc = self.Component.RunCount - 1
                            # Prepend input index to the path
                            new_path = Grasshopper.Kernel.Data.GH_Path(
                                0,
                                rc,
                                input_index,
                                *original_path.Indices)
                            branch_data = converted_tree.Branch(i)
                            for item in branch_data:
                                DescriptorValues.Add(item, new_path)

                        self._addRemark(
                            f'Successfully extracted descriptor '
                            f'"{DescriptorKey}" from input {input_index}'
                        )
                    else:
                        # Descriptor not found
                        msg = (f'Descriptor "{DescriptorKey}" not found in '
                               f'input {input_index}')
                        self._addWarning(msg)

                except Exception as e:
                    msg = (f'Error extracting descriptor from input '
                           f'{input_index}: {str(e)}')
                    self._addError(msg)

            # Update success message
            self.Component.Message = f'Processed {len(input_list)} input(s)'

            # return output trees
            return DescriptorValues

        except Exception as e:
            msg = f'Unexpected error during descriptor extraction: {str(e)}'
            self._addError(msg)
            return DescriptorValues
# ---------- end getdescriptor_2 ----------
radial_tangent_32 = Data(getdescriptor_2)

# Step 3.3
# comments & notes: Get simple shape descriptors by their key.
# boxscore = 0 means the component is a perfect box
# boxscore = 100 means it is anything but a box
# comments & notes: Get simple shape descriptors by their key.
# linescore = 0 means the component is a perfect line
# linescore = 100 means it is anything but a line
# comments & notes: Get simple shape descriptors by their key.
# linescore = 0 means the component is a perfect line
# linescore = 100 means it is anything but a line
# comments & notes: Get simple shape descriptors by their key.
# linescore = 0 means the component is a perfect line
# linescore = 100 means it is anything but a line
panel_12 = Panel("boxscore")
componentdata_37 = Data(componentdata_3)
componentdata_38 = Data(componentdata_3)
componentdata_39 = Data(componentdata_3)
componentdata_40 = Data(componentdata_3)
getdescriptor_3 = GetDescriptor(Input=componentdata_37, DescriptorKey=panel_12)  # -> DescriptorValues; inputs Input: list, DescriptorKey: String; same code as getdescriptor_2
getdescriptor_4 = GetDescriptor(Input=componentdata_38, DescriptorKey="linescore")  # -> DescriptorValues; inputs Input: list, DescriptorKey: String; same code as getdescriptor_2
getdescriptor_5 = GetDescriptor(Input=componentdata_39, DescriptorKey="spherescore")  # -> DescriptorValues; inputs Input: list, DescriptorKey: String; same code as getdescriptor_2
getdescriptor_6 = GetDescriptor(Input=componentdata_40, DescriptorKey="planescore")  # -> DescriptorValues; inputs Input: list, DescriptorKey: String; same code as getdescriptor_2
spherescore = Data(getdescriptor_5)
boxscore = Data(getdescriptor_3)
linescore = Data(getdescriptor_4)
planescore = Data(getdescriptor_6)

# ---- group: __DDU_CSC_EXAMPLE_06__
# Step 2.2
# comments & notes: Compute the radial signature for the design shapes.
# 
# Algorithmically, this is exactly the same as the process that runs on the server and pre-computes this signature for the components in the catalog.
resolution = Slider(64, range=0..100)
designshapes_3 = Data(designshapes_offset)
radialsignature = RadialSignature(Curves=designshapes_3, Resolution=resolution)  # -> Distances, Tangents, IntersectionPoints, Rays, RestPositionCurve, RestPositionFrame, RestPositionAngle, RestPositionTransform; inputs Curves: list, Resolution: Int32, RestPositionAlign: Boolean, NumAngles: Int32
# ---------- radialsignature: Python ----------
#! python3
# -*- coding: utf-8 -*-
# venv: DDU_CSC
print('ENV OK!')
# r: charset_normalizer
# r: requests
# r: numpy

# PYTHON STANDARD LIBRARY IMPORTS ---------------------------------------------

# THIRD PARTY LIBRARY IMPORTS -------------------------------------------------
import numpy as np  # NOQA

# RHINO AND GH RELATED IMPORTS ------------------------------------------------
import System  # NOQA
import Grasshopper  # NOQA
import Rhino  # NOQA

# GHENV COMPONENT SETTINGS ----------------------------------------------------
ghenv.Component.Name = 'RadialSignature'  # NOQA
ghenv.Component.NickName = 'RadialSignature'  # NOQA
ghenv.Component.Category = 'DDU_CSC'  # NOQA
ghenv.Component.SubCategory = '7 Geometry Tools'  # NOQA
ghenv.Component.Description = (  # NOQA
    'Radial shape signature for planar boundary curves: rotates each curve '
    'into its canonical rest position (min-bbox-edge orientation), casts '
    'N evenly spaced rays from the centroid, and returns the distance to '
    'the first boundary intersection together with the boundary tangent '
    'at that intersection. Mirrors the backend `radial_signature` module.'
)


# -----------------------------------------------------------------------------
# PURE GEOMETRY HELPERS (port of apps/descriptors/radial_signature.py)
# -----------------------------------------------------------------------------
# Kept as module-level functions so they can be unit-tested / reused without
# the Grasshopper component shell, and so they stay numerically identical to
# the backend reference implementation.

_COINCIDENT_EPS: float = 1e-9
_DEFAULT_REST_ANGLES: int = 180


def _as_profile_array(profile) -> np.ndarray:
    """Validate and return an (M, 2) float array of profile points."""
    P = np.asarray(profile, dtype=np.float64)
    if P.ndim != 2 or P.shape[1] != 2:
        raise ValueError(
            f'profile must be a sequence of [x, y] pairs, got shape {P.shape}'
        )
    if len(P) < 3:
        raise ValueError(
            f'profile must have at least 3 points, got {len(P)}'
        )
    # Drop a duplicate closing vertex if present; the polyline is always
    # treated as an implicit closed polygon.
    if np.allclose(P[0], P[-1]):
        P = P[:-1]
        if len(P) < 3:
            raise ValueError(
                'profile collapses to fewer than 3 unique points'
            )
    return P


def _polygon_centroid_2d(profile: np.ndarray) -> np.ndarray:
    """Shoelace area-weighted centroid of a closed 2D polygon."""
    x, y = profile[:, 0], profile[:, 1]
    xn = np.roll(x, -1)
    yn = np.roll(y, -1)
    cross = x * yn - xn * y
    area2 = cross.sum()
    if abs(area2) < _COINCIDENT_EPS:
        return profile.mean(axis=0)
    cx = ((x + xn) * cross).sum() / (3.0 * area2)
    cy = ((y + yn) * cross).sum() / (3.0 * area2)
    return np.array([cx, cy], dtype=np.float64)


def _rotation_matrix_2d(angle_rad: float) -> np.ndarray:
    c, s = np.cos(angle_rad), np.sin(angle_rad)
    return np.array([[c, -s], [s, c]], dtype=np.float64)


def _rest_position(profile: np.ndarray,
                   num_angles: int = _DEFAULT_REST_ANGLES):
    """
    Rotate a planar polygon into its canonical rest orientation.

    Faithful port of the legacy C# `RestPosition` routine: for each of
    ``num_angles`` sample angles in [0, pi), rotate the centered profile and
    measure the absolute distance from the origin to each of the four
    axis-aligned bbox edges (|ymin|, |xmax|, |ymax|, |xmin|). The sample
    that produces the smallest such distance, combined with a 90 degree
    correction indexed by which edge was closest, defines the canonical
    rotation.

    Returns:
        rotated: (M, 2) rotated & centered profile
        centroid: (2,) centroid that was subtracted from the input
        angle_deg: rotation applied to the centered profile, degrees
    """
    if num_angles < 1:
        raise ValueError(f'num_angles must be >= 1, got {num_angles}')

    centroid = _polygon_centroid_2d(profile)
    centered = profile - centroid

    step_deg = 180.0 / num_angles
    min_edge_distances = np.empty(num_angles, dtype=np.float64)
    min_edge_corners = np.empty(num_angles, dtype=np.int64)
    for i in range(num_angles):
        ang_rad = np.deg2rad(i * step_deg)
        R = _rotation_matrix_2d(ang_rad)
        Q = centered @ R.T
        xmin, ymin = Q.min(axis=0)
        xmax, ymax = Q.max(axis=0)
        edges = np.array([abs(ymin), abs(xmax), abs(ymax), abs(xmin)])
        j = int(np.argmin(edges))
        min_edge_distances[i] = edges[j]
        min_edge_corners[i] = j

    best_sample = int(np.argmin(min_edge_distances))
    corner = int(min_edge_corners[best_sample])
    angle_deg = -(corner * 90.0) + best_sample * step_deg
    angle_rad = np.deg2rad(angle_deg)
    R_final = _rotation_matrix_2d(angle_rad)
    rotated = centered @ R_final.T
    return rotated, centroid, float(angle_deg)


def _ray_polyline_distances_and_tangents(profile: np.ndarray,
                                         directions: np.ndarray):
    """
    For each ray, return (distance, unit tangent) of the first boundary hit.

    Rays originate at (0, 0). Segments are the closed polygon edges
    p_i -> p_(i+1 mod M). Returns NaN where no forward hit exists.
    """
    A = profile                       # (M, 2) segment starts
    B = np.roll(profile, -1, axis=0)  # (M, 2) segment ends
    D = B - A                         # (M, 2) segment vectors

    seg_len = np.linalg.norm(D, axis=1)
    valid_seg = seg_len > _COINCIDENT_EPS
    T = np.full_like(D, np.nan)
    T[valid_seg] = D[valid_seg] / seg_len[valid_seg, None]

    R = directions  # (N, 2)
    # denom[n, m] = R[n] x D[m]
    denom = R[:, 0:1] * D[None, :, 1] - R[:, 1:2] * D[None, :, 0]
    A_cross_D = A[:, 0] * D[:, 1] - A[:, 1] * D[:, 0]
    A_cross_R = (A[None, :, 0] * R[:, 1:2]
                 - A[None, :, 1] * R[:, 0:1])

    safe = (np.abs(denom) > _COINCIDENT_EPS) & valid_seg[None, :]
    denom_safe = np.where(safe, denom, 1.0)

    t = A_cross_D[None, :] / denom_safe
    s = A_cross_R / denom_safe

    hit = (
        safe
        & (t >= 0.0)
        & (s >= -_COINCIDENT_EPS)
        & (s <= 1.0 + _COINCIDENT_EPS)
    )

    t_masked = np.where(hit, t, np.inf)
    best_seg = np.argmin(t_masked, axis=1)
    best_t = t_masked[np.arange(len(R)), best_seg]

    miss = ~np.isfinite(best_t)
    distances = np.where(miss, np.nan, best_t)
    tangents = T[best_seg]
    tangents[miss] = np.nan
    return distances, tangents


def _compute_radial_signature(profile, num_rays: int,
                              rest_align: bool = True,
                              num_rest_angles: int = _DEFAULT_REST_ANGLES):
    """
    Compute distances & tangents for one polygon profile.

    Returns:
        distances: (N,) ndarray
        tangents: (N, 2) ndarray
        centroid: (2,) ndarray (the one that was subtracted)
        angle_deg: float rotation applied to reach rest (0.0 if not aligned)
    """
    if num_rays < 3:
        raise ValueError(f'num_rays must be >= 3, got {num_rays}')

    P = _as_profile_array(profile)
    if rest_align:
        P_rest, centroid, angle_deg = _rest_position(
            P, num_angles=num_rest_angles)
    else:
        centroid = _polygon_centroid_2d(P)
        P_rest = P - centroid
        angle_deg = 0.0

    angles = np.arange(num_rays) * (2.0 * np.pi / num_rays)
    directions = np.column_stack([np.cos(angles), np.sin(angles)])
    distances, tangents = _ray_polyline_distances_and_tangents(
        P_rest, directions)
    return distances, tangents, centroid, angle_deg


class CSC_RadialSignature(Grasshopper.Kernel.GH_ScriptInstance):
    """
    Author: Max Benjamin Eschenbach
    License: MIT License
    Version: 260609
    """

    def __init__(self):
        """Initialize this component and set component parameters."""
        super().__init__()
        self.Component = ghenv.Component  # NOQA
        self.InputParams = self.Component.Params.Input
        self.OutputParams = self.Component.Params.Output

    def _addRemark(self, msg: str = ''):
        rml = self.Component.RuntimeMessageLevel.Remark
        self.AddRuntimeMessage(rml, msg)

    def _addWarning(self, msg: str = ''):
        rml = self.Component.RuntimeMessageLevel.Warning
        self.AddRuntimeMessage(rml, msg)

    def _addError(self, msg: str = ''):
        rml = self.Component.RuntimeMessageLevel.Error
        self.AddRuntimeMessage(rml, msg)

    def BeforeRunScript(self):
        """Describe inputs & outputs."""
        self.InputParams[0].Description = (
            'Closed planar boundary curve(s) to describe. Polylines are '
            'used verbatim; other curves are approximated to polylines '
            'using the document tolerance.'
        )
        self.InputParams[1].Description = (
            'Number of rays cast from the centroid. Default 64. '
            'Must be >= 3.'
        )
        self.InputParams[2].Description = (
            'If True (default), rotate each profile into its canonical '
            'rest position (minimum bbox edge distance) before ray '
            'casting. If False, use the curve as-is (still centered).'
        )
        self.InputParams[3].Description = (
            'Number of rotation samples used for rest-position search '
            'over [0, pi). Default 180 (1 degree steps). Must be >= 1.'
        )
        # Output descriptions -- skip the hidden "out" param if present.
        i = 1 if self.OutputParams[0].Name == 'out' else 0
        self.OutputParams[0 + i].Description = (
            'Tree of distances from the centroid to the first boundary '
            'intersection for each ray. One branch per input curve.'
        )
        self.OutputParams[1 + i].Description = (
            'Tree of unit tangent vectors of the boundary at each ray '
            'hit, expressed in world coordinates on the curve plane.'
        )
        self.OutputParams[2 + i].Description = (
            'Tree of intersection points in world coordinates, one '
            'branch per input curve. Useful for visualising the signature.'
        )
        self.OutputParams[3 + i].Description = (
            'Tree of rays (as Lines) in world coordinates, one branch '
            'per input curve. Useful for visualisation.'
        )
        self.OutputParams[4 + i].Description = (
            'Input curves transformed into their rest position: centroid '
            'at world origin, canonical rest axes aligned with World XY. '
            'This is exactly the geometry the signature is computed on.'
        )
        self.OutputParams[5 + i].Description = (
            'List of rest-position planes, one per input curve. Origin '
            'is the centroid on the input curve plane; X/Y are aligned '
            'with the canonical orientation used by the signature.'
        )
        self.OutputParams[6 + i].Description = (
            'List of rotation angles (degrees) applied to reach rest '
            'position, one per input curve.'
        )
        self.OutputParams[7 + i].Description = (
            'Transform mapping world coordinates into the rest frame '
            '(origin at centroid; World XY only if RestPositionAlign is '
            'True). Apply to any other geometry to see it in the same '
            'frame as the rest curve.'
        )

    def _curve_to_polyline_and_plane(self, curve):
        """Return (polyline_points_3d, curve_plane) or (None, None).

        Falls back to ``Plane.WorldXY`` for non-planar or degenerate curves
        and adds a warning.
        """
        if curve is None:
            return None, None

        tol = Rhino.RhinoDoc.ActiveDoc.ModelAbsoluteTolerance
        if tol is None or tol <= 0.0:
            tol = 1e-3

        # Fetch an actual Polyline -- exact for polylines / polygons, an
        # approximation otherwise (angle-based to preserve curvature).
        ok, pl = curve.TryGetPolyline()
        if not ok or pl is None or pl.Count < 3:
            pc = curve.ToPolyline(
                0,           # mainSegmentCount (0 = auto)
                0,           # subSegmentCount
                0.1,         # maxAngleRadians (~5.7 deg chord deviation)
                0.0,         # maxChordLengthRatio
                0.0,         # maxAspectRatio
                tol,         # tolerance
                0.0,         # minEdgeLength
                0.0,         # maxEdgeLength
                True,        # keepStartPoint
            )
            if pc is None:
                return None, None
            pl = pc.ToPolyline()
            if pl is None or pl.Count < 3:
                return None, None

        ok_plane, plane = curve.TryGetPlane(tol)
        if not ok_plane:
            self._addWarning(
                'Curve is not planar within tolerance; falling back to '
                'World XY. Consider supplying a planar curve.'
            )
            plane = Rhino.Geometry.Plane.WorldXY

        return pl, plane

    def _project_polyline_to_plane(self, polyline, plane):
        """Project polyline vertices to the curve's plane. Returns (M, 2)."""
        xform = Rhino.Geometry.Transform.PlaneToPlane(
            plane, Rhino.Geometry.Plane.WorldXY)
        pts_2d = []
        for p in polyline:
            q = Rhino.Geometry.Point3d(p)
            q.Transform(xform)
            pts_2d.append([q.X, q.Y])
        return np.asarray(pts_2d, dtype=np.float64)

    def _rest_frame_in_world(self, plane, centroid_xy, rest_angle_deg):
        """Build a Rhino.Geometry.Plane placed at the rest-position origin.

        The plane's origin is the 3D centroid; its X/Y axes correspond to
        the rest-aligned 2D frame rotated back into world coordinates.
        """
        # Rest frame in curve-plane coordinates: origin is the centroid,
        # axes are rotated by ``rest_angle_deg`` around +Z relative to the
        # curve plane. Since a point ``q`` in the original 2D frame maps
        # to ``R * (q - c)`` in the rest frame, the inverse mapping back
        # to the curve plane is a rotation by ``-rest_angle_deg``.
        theta = np.deg2rad(-rest_angle_deg)
        c, s = float(np.cos(theta)), float(np.sin(theta))
        x_axis_xy = np.array([c, s, 0.0])
        y_axis_xy = np.array([-s, c, 0.0])

        origin_xy = Rhino.Geometry.Point3d(
            float(centroid_xy[0]), float(centroid_xy[1]), 0.0)
        xform = Rhino.Geometry.Transform.PlaneToPlane(
            Rhino.Geometry.Plane.WorldXY, plane)
        origin_3d = Rhino.Geometry.Point3d(origin_xy)
        origin_3d.Transform(xform)

        x_vec_3d = Rhino.Geometry.Vector3d(*x_axis_xy)
        y_vec_3d = Rhino.Geometry.Vector3d(*y_axis_xy)
        x_vec_3d.Transform(xform)
        y_vec_3d.Transform(xform)

        return Rhino.Geometry.Plane(origin_3d, x_vec_3d, y_vec_3d)

    def _xy_point_to_world(self, xform_to_plane, x, y):
        """Map a point in the curve-plane XY frame to world coordinates."""
        p = Rhino.Geometry.Point3d(float(x), float(y), 0.0)
        p.Transform(xform_to_plane)
        return p

    def _xy_vector_to_world(self, xform_to_plane, vx, vy):
        """Map a vector in the curve-plane XY frame to world coordinates."""
        v = Rhino.Geometry.Vector3d(float(vx), float(vy), 0.0)
        v.Transform(xform_to_plane)
        return v

    def RunScript(self,
            Curves: System.Collections.Generic.List[object],
            Resolution: int,
            RestPositionAlign: bool,
            NumAngles: int):
        # Keep list-access behavior by default. If the current input list
        # (which may represent one incoming branch) has multiple curves,
        # switch to explicit tree output keyed by run count + item index.
        multi_input = bool(Curves) and len(Curves) > 1
        if multi_input:
            Distances = Grasshopper.DataTree[System.Object]()
            Tangents = Grasshopper.DataTree[System.Object]()
            IntersectionPoints = Grasshopper.DataTree[System.Object]()
            Rays = Grasshopper.DataTree[System.Object]()
            RestPositionCurve = Grasshopper.DataTree[System.Object]()
            RestPositionFrame = Grasshopper.DataTree[System.Object]()
            RestPositionAngle = Grasshopper.DataTree[System.Object]()
            RestPositionTransform = Grasshopper.DataTree[System.Object]()
        else:
            Distances = []
            Tangents = []
            IntersectionPoints = []
            Rays = []
            RestPositionCurve = []
            RestPositionFrame = []
            RestPositionAngle = []
            RestPositionTransform = []
        __Results = (
            Distances, Tangents, IntersectionPoints, Rays,
            RestPositionCurve, RestPositionFrame,
            RestPositionAngle, RestPositionTransform,
        )

        # Defaults
        if Resolution is None:
            Resolution = 64
        if RestPositionAlign is None:
            RestPositionAlign = True
        if NumAngles is None:
            NumAngles = _DEFAULT_REST_ANGLES

        # Input validation
        if not Curves:
            msg = 'No curves provided'
            self._addWarning(msg)
            self.Component.Message = msg
            return __Results

        try:
            Resolution = int(Resolution)
        except (TypeError, ValueError):
            self._addError(
                f'Resolution must be an integer, got {Resolution!r}')
            return __Results
        if Resolution < 3:
            self._addError(f'Resolution must be >= 3, got {Resolution}')
            return __Results

        try:
            NumAngles = int(NumAngles)
        except (TypeError, ValueError):
            self._addError(
                f'NumAngles must be an integer, got '
                f'{NumAngles!r}')
            return __Results
        if NumAngles < 1:
            self._addError(
                f'NumAngles must be >= 1, got '
                f'{NumAngles}')
            return __Results

        self.Component.Message = f'N={Resolution}'

        successes = 0
        rc = self.Component.RunCount - 1
        for branch_idx, curve in enumerate(Curves):
            path = Grasshopper.Kernel.Data.GH_Path(rc, branch_idx)

            polyline, plane = self._curve_to_polyline_and_plane(curve)
            if polyline is None or plane is None:
                self._addWarning(
                    f'Curve #{branch_idx}: could not build polyline; skipped')
                continue

            try:
                profile_xy = self._project_polyline_to_plane(polyline, plane)
                distances, tangents, centroid_xy, angle_deg = (
                    _compute_radial_signature(
                        profile_xy,
                        num_rays=Resolution,
                        rest_align=bool(RestPositionAlign),
                        num_rest_angles=NumAngles,
                    )
                )
            except ValueError as exc:
                self._addWarning(
                    f'Curve #{branch_idx}: {exc}; skipped')
                continue

            if np.any(np.isnan(distances)):
                missed = int(np.isnan(distances).sum())
                self._addWarning(
                    f'Curve #{branch_idx}: {missed}/{Resolution} rays did '
                    f'not hit the boundary (centroid outside profile or '
                    f'non-simple polygon); skipped'
                )
                continue

            # Map results back to world coordinates.
            # In the rest frame: hit point = t * (cos a, sin a);
            # tangent = (tx, ty). The rest frame itself lives on the
            # curve plane at ``centroid_xy``, rotated by rest_angle_deg.
            # Build a combined transform 2D(rest) -> 2D(curve) -> world.
            rest_frame_curve = Rhino.Geometry.Plane(
                Rhino.Geometry.Point3d(
                    float(centroid_xy[0]), float(centroid_xy[1]), 0.0),
                Rhino.Geometry.Vector3d.XAxis,
                Rhino.Geometry.Vector3d.YAxis,
            )
            # Rotate the rest plane's X/Y by -rest_angle_deg so that a
            # point expressed in the rest frame maps back to the same
            # location in the curve-plane XY frame.
            theta = np.deg2rad(-angle_deg)
            c, s = float(np.cos(theta)), float(np.sin(theta))
            rest_x = Rhino.Geometry.Vector3d(c, s, 0.0)
            rest_y = Rhino.Geometry.Vector3d(-s, c, 0.0)
            rest_frame_curve = Rhino.Geometry.Plane(
                rest_frame_curve.Origin, rest_x, rest_y)

            xform_curve_to_world = Rhino.Geometry.Transform.PlaneToPlane(
                Rhino.Geometry.Plane.WorldXY, plane)

            # Combined mapper: 2D rest frame -> 3D world.
            def to_world_point(xr, yr):
                # Into curve XY frame first...
                px = rest_frame_curve.Origin.X + c * xr - s * yr
                py = rest_frame_curve.Origin.Y + s * xr + c * yr
                # ...then lift to world via the curve plane.
                p = Rhino.Geometry.Point3d(float(px), float(py), 0.0)
                p.Transform(xform_curve_to_world)
                return p

            def to_world_vector(vxr, vyr):
                vx = c * vxr - s * vyr
                vy = s * vxr + c * vyr
                v = Rhino.Geometry.Vector3d(float(vx), float(vy), 0.0)
                v.Transform(xform_curve_to_world)
                return v

            # Rays in the rest frame: origin (0, 0), direction (cos, sin).
            ray_angles = np.arange(Resolution) * (2.0 * np.pi / Resolution)
            ray_dirs = np.column_stack(
                [np.cos(ray_angles), np.sin(ray_angles)])

            world_origin = to_world_point(0.0, 0.0)

            distance_values = []
            tangent_values = []
            hit_points = []
            ray_lines = []
            for k in range(Resolution):
                t = float(distances[k])
                dx, dy = float(ray_dirs[k, 0]), float(ray_dirs[k, 1])
                hit_world = to_world_point(t * dx, t * dy)
                tx, ty = float(tangents[k, 0]), float(tangents[k, 1])
                tan_world = to_world_vector(tx, ty)

                distance_values.append(t)
                tangent_values.append(tan_world)
                hit_points.append(hit_world)
                ray_lines.append(
                    Rhino.Geometry.Line(world_origin, hit_world))

            if multi_input:
                Distances.AddRange(distance_values, path)
                Tangents.AddRange(tangent_values, path)
                IntersectionPoints.AddRange(hit_points, path)
                Rays.AddRange(ray_lines, path)
            else:
                Distances.extend(distance_values)
                Tangents.extend(tangent_values)
                IntersectionPoints.extend(hit_points)
                Rays.extend(ray_lines)

            # Rest-position frame expressed in world coordinates: origin
            # at the 3D centroid on the curve plane, X/Y axes aligned with
            # the canonical orientation picked by the rest-position search.
            rest_frame_world = self._rest_frame_in_world(
                plane, centroid_xy, angle_deg)

            # World -> rest-frame transform. Applying this to the input
            # curve moves it so its centroid sits at the world origin and
            # its rest-aligned axes coincide with the World XY axes -- i.e.
            # exactly what the signature "sees" internally.
            if RestPositionAlign:
                # Full rest-position transform: center + canonical orientation
                # into World XY.
                xform_world_to_rest = Rhino.Geometry.Transform.PlaneToPlane(
                    rest_frame_world, Rhino.Geometry.Plane.WorldXY)
            else:
                # No rest-position rotation: keep the curve orientation as-is
                # in world coordinates and only center it at the origin.
                xform_world_to_rest = Rhino.Geometry.Transform.Translation(
                    Rhino.Geometry.Vector3d(
                        -rest_frame_world.Origin.X,
                        -rest_frame_world.Origin.Y,
                        -rest_frame_world.Origin.Z,
                    )
                )
            rest_curve = curve.DuplicateCurve()
            rest_curve.Transform(xform_world_to_rest)

            if multi_input:
                RestPositionCurve.Add(rest_curve, path)
                RestPositionFrame.Add(rest_frame_world, path)
                RestPositionAngle.Add(float(angle_deg), path)
                RestPositionTransform.Add(xform_world_to_rest, path)
            else:
                RestPositionCurve.append(rest_curve)
                RestPositionFrame.append(rest_frame_world)
                RestPositionAngle.append(float(angle_deg))
                RestPositionTransform.append(xform_world_to_rest)

            successes += 1

        if successes == 0:
            self._addWarning('No curves produced a valid signature')
            self.Component.Message = 'no output'
        else:
            self.Component.Message = (
                f'N = {Resolution}')
            self._addRemark(
                f'Computed radial signature for {successes} curve(s) '
                f'at resolution N={Resolution}'
            )

        return __Results
# ---------- end radialsignature ----------
designshapes_restpositiontransform = Data(radialsignature.RestPositionTransform)
designshapes_distances = Data(radialsignature.Distances)
designshapes_tangents = Data(radialsignature.Tangents)

# ----
# comments & notes: DEVELOPMENT:
# UPDATING SCRIPTS & USEROBJECTS FROM API
# comments & notes: Check for updates and update all CSC Grasshopper components in the current document. Also download the latest version of all UserObjects and install them.
# 
# NOTE: Checking and installation can take some time!
toggle_4 = BooleanToggle(False)
csc_update = Update(CheckForUpdates=Toggle(False), InstallUpdates=toggle_4)  # -> Status
# ---------- csc_update: Python ----------
#! python3
# -*- coding: utf-8 -*-
# venv: DDU_CSC
print('ENV OK!')
# r: charset_normalizer
# r: requests

# PYTHON STANDARD LIBRARY IMPORTS ---------------------------------------------
import os  # NOQA
import re  # NOQA
import glob  # NOQA
from pathlib import Path  # NOQA

# THIRD PARTY LIBRARY IMPORTS -------------------------------------------------
import requests  # NOQA

# RHINO AND GH RELATED IMPORTS ------------------------------------------------
import System  # NOQA
import Grasshopper  # NOQA
import Rhino  # NOQA
import scriptcontext as sc  # NOQA
import GhPython as ghpy  # NOQA
import ScriptComponents as scomp  # NOQA
import RhinoCodePluginGH as rcpgh  # NOQA

# GHENV COMPONENT SETTINGS ----------------------------------------------------
ghenv.Component.Name = 'Update'  # NOQA
ghenv.Component.NickName = 'CSC_Update'  # NOQA
ghenv.Component.Category = 'DDU_CSC'  # NOQA
ghenv.Component.SubCategory = '0 Development'  # NOQA
ghenv.Component.Description = (  # NOQA
    'Updates component sources and userobjects in document from server.\n'
    'NOTE: CheckForUpdates must be True to check for updates AND to '
    'install updates! Switch on both to update everything.\n'
    'UPDATE_CHANNEL is a hardcoded GitHub branch name (default: main). '
    'It must match the remote branch exactly.'
)

# GitHub branch to pull sources and UserObjects from. Must match the remote
# branch name exactly (e.g. 'main', 'develop', 'feature/foo').
UPDATE_CHANNEL = 'main'

# Matches an actual version declaration - the word "version", a ":" or "=",
# then the number. The separator is required so prose such as 'creates a
# version-0 snapshot' in a component description cannot be mistaken for a
# version declaration. Keep this comment free of literal declarations, they
# would be picked up before the real one below.
VERSION_DECLARATION_RE = re.compile(
    r'version\s*[:=]\s*(\d+(?:\.\d+)?[a-zA-Z]?)')

# Components that were renamed or split. Their sources no longer exist on the
# server, so they can only be reported - not updated in place.
RENAMED_COMPONENTS = {
    'AddComponent': 'AddComponentIdentity',
    'ArrangeComponents': 'CreateArrangement',
    'CreateComponent': 'CreateComponentIdentity / CreateComponentSnapshot',
    'FetchGeometry': 'FetchReducedGeometry / FetchDetailedGeometry',
}


class CSC_Update(Grasshopper.Kernel.GH_ScriptInstance):
    """
    Author: Max Benjamin Eschenbach
    License: MIT License
    Version: 260908.3
    """

    def __init__(self):
        """Initialize this component and set component parameters."""
        super().__init__()
        # initialize props
        self.Component = ghenv.Component  # NOQA
        self.InputParams = self.Component.Params.Input
        self.OutputParams = self.Component.Params.Output

    def _addRemark(self, msg: str = ''):
        """Add a remark message to the component."""
        rml = self.Component.RuntimeMessageLevel.Remark
        self.AddRuntimeMessage(rml, msg)

    def _addWarning(self, msg: str = ''):
        """Add a warning message to the component."""
        rml = self.Component.RuntimeMessageLevel.Warning
        self.AddRuntimeMessage(rml, msg)

    def _addError(self, msg: str = ''):
        """Add an error message to the component."""
        rml = self.Component.RuntimeMessageLevel.Error
        self.AddRuntimeMessage(rml, msg)

    def BeforeRunScript(self):
        """Perform some setup actions."""
        # Initialize input param descriptions
        self.InputParams[0].Description = (
            'Toggle to check for updates on the server.'
        )
        self.InputParams[1].Description = (
            'Toggle to install updates from server.'
        )
        # Initialize output param descriptions
        i = 0
        if self.OutputParams[0].Name == 'out':
            i += 1
        self.OutputParams[0+i].Description = (
            'Status messages about the update process.'
        )

    def get_auth_core_from_sticky(self):
        """Get AuthCore instance from sticky storage."""
        auth_core = sc.sticky.get('CSC_AuthCore')
        if auth_core is None:
            msg = ('No authentication found. Please use CSC_Session component '
                   'first.')
            self._addError(msg)
            self.Component.Message = msg
            return None
        return auth_core

    def _channel_params(self):
        """Query params selecting the GitHub update channel (branch)."""
        return {'channel': UPDATE_CHANNEL}

    def get_source_version(self, source):
        """
        Attempts to find the first version declaration in a multi line string,
        i.e. the word "version" (or, "Version") followed by ":" or "=" and a
        version number. Lines that merely mention the word "version" are
        ignored.
        Supports formats like:
            Version: 160121
            Version: 251009.1
            Version: 251009a
        """
        for line in source.lower().split('\n'):
            version_match = VERSION_DECLARATION_RE.search(line)
            if version_match:
                return self.parse_version_string(version_match.group(1))
        return None

    def parse_version_string(self, version_str):
        """
        Parse a version string into a comparable format.
        Handles formats like: 251009, 251009.1, 251009a

        Returns a tuple that can be used for comparison:
        - (251009,) for "251009"
        - (251009, 1) for "251009.1"
        - (251009, 0, 'a') for "251009a"
        """
        # Split into base number and suffix
        match = re.match(r'(\d+)(?:\.(\d+))?([a-zA-Z]*)', version_str)
        if not match:
            return None

        base_num = int(match.group(1))
        dot_num = int(match.group(2)) if match.group(2) else 0
        letter_suffix = match.group(3).lower() if match.group(3) else ''

        # Convert letter to number for comparison (a=1, b=2, etc.)
        letter_num = ord(letter_suffix) - ord('a') + 1 if letter_suffix else 0

        return (base_num, dot_num, letter_num)

    def compare_versions(self, version1, version2):
        """
        Compare two version tuples.

        Returns:
            -1 if version1 < version2
             0 if version1 == version2
             1 if version1 > version2
        """
        if version1 is None and version2 is None:
            return 0
        if version1 is None:
            return -1
        if version2 is None:
            return 1

        # Compare tuple elements in order
        for i in range(max(len(version1), len(version2))):
            v1_elem = version1[i] if i < len(version1) else 0
            v2_elem = version2[i] if i < len(version2) else 0

            if v1_elem < v2_elem:
                return -1
            elif v1_elem > v2_elem:
                return 1

        return 0

    def expand_path(self, path):
        """
        Expand environment variables in a path string.
        Handles %APPDATA%, %USERPROFILE%, %TEMP%, etc.
        """
        if not path:
            return path
        return os.path.expandvars(path)

    def replace_scriptcomp_source(
            self, old_script_comp_values, new_source):
        """
        Replaces source code of gh scriptable components.
        """
        # extract data
        script_type, nickname, name, obj, source = old_script_comp_values
        # check for type and decide action
        if (script_type == "PY3" or
                script_type == 'IPY2' or
                script_type == 'CS9'):
            # set the source code
            obj.SetSource(new_source)
            # infer component param inputs from RunScript signature
            obj.SetParametersFromScript()
            # call parameter maintenance helper
            obj.VariableParameterMaintenance()
            rml = obj.RuntimeMessageLevel.Warning
            msg = 'My source just got replaced with a new version!'
            obj.AddRuntimeMessage(rml, msg)
        elif script_type == 'GHPY':
            return False
        elif script_type == 'CS':
            return False
        return True

    def process_document_objects(self, ghdocument, verbose=False):
        """
        Processes GH_Document object and return a list of all script components
        """
        # get all document objects
        comps = list(ghdocument.Objects)

        # types of python components
        ghpycomp = ghpy.Component.ZuiPythonComponent
        ipycomp = rcpgh.Components.IronPython2Component
        py3comp = rcpgh.Components.Python3Component

        # types of csharp components
        cscomp = scomp.Component_CSNET_Script
        cs9comp = rcpgh.Components.CSharpComponent

        # cluster component
        clustercomp = Grasshopper.Kernel.Special.GH_Cluster

        # extract component type strings
        ghpycomp_str = str(ghpycomp).split("'")[1]
        cscomp_str = str(cscomp).split("'")[1]
        ipycomp_str = str(ipycomp).split("'")[1]
        py3comp_str = str(py3comp).split("'")[1]
        cs9comp_str = str(cs9comp).split("'")[1]
        clustercomp_str = str(clustercomp).split("'")[1]

        # define script types
        id_ghpycomp = 'GHPY'
        id_cscomp = 'CS'
        id_ipycomp = 'IPY2'
        id_py3comp = 'PY3'
        id_cs9comp = 'CS9'

        # init dict for script component storage
        script_components = {}

        # loop over all document components
        # store all component objects in a dictionary to check
        # - are all "same" scripts the same code?
        # - are there scripts without category or version attribute?
        # - separate old from new scripts, dont export old scripts!
        for obj in comps:
            # extract basic info
            name = obj.Name
            nickname = obj.NickName
            iguid = str(obj.InstanceGuid)
            # extract type string
            objtype_str = str(obj.GetType())
            # OLD GHPYTHON COMPONENT
            if objtype_str == ghpycomp_str:
                source = obj.Code
                if source:
                    if verbose:
                        print(
                            (f'Found Source for OLD GHPY Component '
                             f'"{nickname}" ({iguid})'))
                    scriptcomp = [id_ghpycomp, nickname, name, obj, source]
                    script_components[iguid] = scriptcomp
            # OLD C# COMPONENT
            elif objtype_str == cscomp_str:
                source = obj.ScriptSource.ScriptCode
                if source:
                    if verbose:
                        print(
                            (f'Found Source for OLD CS Component "{nickname}" '
                             f'({iguid})'))
                    scriptcomp = [id_cscomp, nickname, name, obj, source]
                    script_components[iguid] = scriptcomp
            # NEW C#9 COMPONENT
            elif objtype_str == cs9comp_str:
                bres, source = obj.TryGetSource()
                if bres:
                    if verbose:
                        print((f'Found Source for CS9 Component "{nickname}" '
                               f'({iguid})'))
                    scriptcomp = [id_cs9comp, nickname, name, obj, source]
                    script_components[iguid] = scriptcomp
            # NEW IRONPYTHON COMPONENT
            elif objtype_str == ipycomp_str:
                bres, source = obj.TryGetSource()
                if bres:
                    if verbose:
                        print((f'Found Source for IPY2 Component "{nickname}" '
                               f'({iguid})'))
                    scriptcomp = [id_ipycomp, nickname, name, obj, source]
                    script_components[iguid] = scriptcomp
            # NEW PYTHON3 COMPONENT
            elif objtype_str == py3comp_str:
                bres, source = obj.TryGetSource()
                if bres:
                    if verbose:
                        print((f'Found Source for PY3 Component "{nickname}" '
                               f'({iguid})'))
                    scriptcomp = [id_py3comp, nickname, name, obj, source]
                    script_components[iguid] = scriptcomp
            # CLUSTER COMPONENT
            elif objtype_str == clustercomp_str:
                # RECURSIVELY STEP THROUGH CLUSTERS AND LOOK FOR SCRIPTS ...
                if verbose:
                    print((f'Processing CLUSTER "{nickname}" ({name}, '
                           f'{iguid}) ...'))
                cluster_scripts = self.process_document_objects(
                    obj.Document(''), verbose=verbose
                )
                # add cluster script dict to main dict
                script_components.update(cluster_scripts)
        # return results
        return script_components

    def process_script_components(
            self,
            script_components: dict,
            set_category: str):
        """
        Process found script components and get matching components.
        """
        versioned_script_components = []
        for iguid, values in script_components.items():
            # extract data from dict object
            script_type, nickname, name, obj, source = values
            category = obj.Category
            version = self.get_source_version(source)
            category_match = category == set_category
            version_present = version is not None
            if category_match and version_present:
                versioned_script_components.append((iguid, values))
        return versioned_script_components

    def get_userobjects_dir(self):
        """Get platform-specific UserObjects directory."""
        dir = Grasshopper.Folders.DefaultUserObjectFolder
        return dir

    def get_api_source_versions(self, auth_core):
        """Get source versions from API."""
        api_src_versions = {}
        response = auth_core.authorized_get(
            '/ghinterface/src_names',
            params=self._channel_params(),
            timeout=90
        )
        if response.status_code == 200:
            api_src_files_json = response.json()
            for file_tuple in api_src_files_json:
                name = file_tuple[0]
                version = file_tuple[1]
                if not version:
                    # Source file without a version declaration. Skip it
                    # instead of failing the whole update check.
                    print(f'{name} has no version on server, skipping!')
                    continue
                api_src_versions[name] = tuple(version)
        elif response.status_code == 404:
            msg = (
                f'Update channel "{UPDATE_CHANNEL}" was not found on GitHub. '
                'The branch name must match exactly.'
            )
            self._addError(msg)
            self.Component.Message = msg
            return None
        elif response.status_code == 401:
            msg = 'Authentication failed. Please sign in again.'
            self._addError(msg)
            self.Component.Message = msg
            return None
        elif response.status_code == 403:
            msg = 'Access denied. Insufficient permissions.'
            self._addError(msg)
            self.Component.Message = msg
            return None
        elif response.status_code == 500:
            msg = 'Server error. Please try again later.'
            self._addError(msg)
            self.Component.Message = msg
            return None
        else:
            msg = (f'Request failed with status code: '
                   f'{response.status_code}')
            try:
                detail = response.json().get('detail')
                if detail:
                    msg = f'{msg}: {detail}'
            except Exception:
                pass
            self._addError(msg)
            self.Component.Message = msg
            return None
        return api_src_versions

    def get_api_userobject_names(self, auth_core):
        """Get userobject names from API."""
        api_uo_names = []
        response = auth_core.authorized_get(
            '/ghinterface/userobject_names',
            params=self._channel_params(),
            timeout=60
        )
        if response.status_code == 200:
            api_uo_names = list(response.json())
        elif response.status_code == 404:
            msg = (
                f'Update channel "{UPDATE_CHANNEL}" was not found on GitHub. '
                'The branch name must match exactly.'
            )
            self._addError(msg)
            self.Component.Message = msg
            return None
        elif response.status_code == 401:
            msg = 'Authentication failed. Please sign in again.'
            self._addError(msg)
            self.Component.Message = msg
            return None
        elif response.status_code == 403:
            msg = 'Access denied. Insufficient permissions.'
            self._addError(msg)
            self.Component.Message = msg
            return None
        elif response.status_code == 500:
            msg = 'Server error. Please try again later.'
            self._addError(msg)
            self.Component.Message = msg
            return None
        else:
            msg = (f'Request failed with status code: '
                   f'{response.status_code}')
            self._addError(msg)
            self.Component.Message = msg
            return None
        return api_uo_names

    def get_api_source_file_text(self, auth_core, full_name):
        """Get source file from API."""
        response = auth_core.authorized_get(
            f'/ghinterface/src/{full_name}',
            params=self._channel_params(),
            timeout=60
        )
        if response.status_code == 200:
            return response.text
        elif response.status_code == 404:
            msg = 'Source file not found.'
            self._addError(msg)
            self.Component.Message = msg
            return None
        elif response.status_code == 401:
            msg = 'Authentication failed. Please sign in again.'
            self._addError(msg)
            self.Component.Message = msg
            return None
        elif response.status_code == 403:
            msg = 'Access denied. Insufficient permissions.'
            self._addError(msg)
            self.Component.Message = msg
            return None
        elif response.status_code == 500:
            msg = 'Server error. Please try again later.'
            self._addError(msg)
            self.Component.Message = msg
            return None
        else:
            msg = (f'Request failed with status code: '
                   f'{response.status_code}')
            self._addError(msg)
            self.Component.Message = msg
            return None

    def get_api_userobject_bytes(self, auth_core, uo_name):
        """Get userobject bytes from API."""
        response = auth_core.authorized_get(
            f'/ghinterface/userobject/{uo_name}',
            params=self._channel_params(),
            timeout=60
        )
        if response.status_code == 200:
            return response.content
        elif response.status_code == 404:
            msg = 'Userobject not found.'
            self._addError(msg)
            self.Component.Message = msg
            return None
        elif response.status_code == 401:
            msg = 'Authentication failed. Please sign in again.'
            self._addError(msg)
            self.Component.Message = msg
            return None
        elif response.status_code == 403:
            msg = 'Access denied. Insufficient permissions.'
            self._addError(msg)
            self.Component.Message = msg
            return None
        elif response.status_code == 500:
            msg = 'Server error. Please try again later.'
            self._addError(msg)
            self.Component.Message = msg
            return None
        else:
            msg = (f'Request failed with status code: '
                   f'{response.status_code}')
            self._addError(msg)
            self.Component.Message = msg
            return None

    def RunScript(self, CheckForUpdates, InstallUpdates):
        # hardcoded category of the components to update
        CATEGORY = 'DDU_CSC'
        # init output tree for status messages
        Status = Grasshopper.DataTree[System.Object]()
        # Get AuthCore instance from sticky storage
        auth_core = self.get_auth_core_from_sticky()
        if auth_core is None:
            return Status
        if UPDATE_CHANNEL != 'main':
            channel_msg = (
                f'UPDATE_CHANNEL is "{UPDATE_CHANNEL}" (not main). '
                'Branch name must match the GitHub remote exactly.'
            )
            self._addWarning(channel_msg)
            Status.Add(channel_msg)
        # Check if authentication is valid
        if not auth_core.is_valid():
            msg = ('Authentication expired. Please use CSC_Session '
                   'component to refresh.')
            self._addError(msg)
            self.Component.Message = msg
            Status.Add(msg)
            return Status
        msg = (
            'Toggle CheckForUpdates to True to check for updates on the '
            'server.'
        )
        self.Component.Message = msg
        try:
            if CheckForUpdates:
                msg = f'Using GitHub update channel: {UPDATE_CHANNEL}'
                self._addRemark(msg)
                Status.Add(msg)
                msg = (
                    f'Searching current document for {CATEGORY} script '
                    'components...'
                )
                self.Component.Message = msg
                # loop through the document to find all script components
                doc = self.Component.OnPingDocument()
                script_components = self.process_script_components(
                    self.process_document_objects(doc),
                    CATEGORY
                )
                msg = (
                    f'Found {len(script_components)} {CATEGORY} script '
                    'components in current document (including duplicates).'
                )
                self._addRemark(msg)
                Status.Add(msg)
                # make request to fetch all source file names and versions
                msg = (
                    f'Checking Server for updates '
                    f'(channel: {UPDATE_CHANNEL})...'
                )
                self.Component.Message = msg
                api_src_versions = self.get_api_source_versions(auth_core)
                if api_src_versions is None:
                    msg = 'Failed to get source versions from server.'
                    self._addError(msg)
                    self.Component.Message = msg
                    Status.Add(msg)
                    return Status
                msg = (f'Found {len(api_src_versions)} unique script '
                       'component source files on server.')
                self._addRemark(msg)
                Status.Add(msg)

                # loop over scripts in document
                scripts_to_update = []
                unmatched_names = []
                for iguid, values in script_components:
                    script_type, nickname, name, obj, current_source = values
                    current_version = self.get_source_version(current_source)
                    full_name = CATEGORY + '_' + name
                    if full_name not in api_src_versions:
                        print(f'{full_name} not found on server!')
                        if name not in unmatched_names:
                            unmatched_names.append(name)
                        continue
                    api_version = api_src_versions[full_name]
                    vc = self.compare_versions(
                        api_version,
                        current_version
                    )
                    if vc == -1:
                        print(
                            f'!! --> {name} {api_version} '
                            f'< {current_version}!'
                        )
                        msg = (
                            f'{name} {api_version} < {current_version}! '
                            'Is this a dev file? That should '
                            'not happen otherwise! Proceed with caution!'
                        )
                        self._addWarning(msg)
                        Status.Add(msg)
                        continue
                    elif vc == 0:
                        print(f'{name} {api_version} == {current_version}')
                    elif vc == 1:
                        print(f'{name} {api_version} > {current_version}')
                        scripts_to_update.append((iguid, values))
                if unmatched_names:
                    details = ', '.join([
                        (f'{n} (replaced by {RENAMED_COMPONENTS[n]})'
                         if n in RENAMED_COMPONENTS else n)
                        for n in sorted(unmatched_names)
                    ])
                    msg = (
                        f'{len(unmatched_names)} {CATEGORY} components in '
                        'this document have no source on the server and '
                        f'cannot be updated in place: {details}. Replace '
                        'them with the current components from the toolbar.'
                    )
                    self._addWarning(msg)
                    Status.Add(msg)
                if not scripts_to_update:
                    msg = 'No scripts in document need updating!'
                    self._addRemark(msg)
                    self.Component.Message = msg
                    Status.Add(msg)
                else:
                    msg = (
                        f'Found {len(scripts_to_update)} script '
                        'components that need updating.'
                    )
                    self._addRemark(msg)
                    Status.Add(msg)

                # check for installed userobjects
                uo_dir = self.get_userobjects_dir()
                uo_mask = os.path.join(uo_dir, '**', 'DDU_CSC_*.ghuser')
                installed_uos = [os.path.normpath(p) for p in glob.glob(
                    os.path.normpath(uo_mask),
                    recursive=True
                )]
                if installed_uos:
                    uo_install_dir = os.path.dirname(installed_uos[0])
                else:
                    uo_install_dir = os.path.join(uo_dir, CATEGORY)
                installed_uo_paths = {
                    os.path.splitext(os.path.basename(p))[0]: p
                    for p in installed_uos
                }
                installed_uo_names = list(installed_uo_paths.keys())
                msg = f'Found {len(installed_uos)} installed UserObjects.'
                self._addRemark(msg)
                Status.Add(msg)

                # check for userobjects on server
                api_uo_names = self.get_api_userobject_names(auth_core)
                if api_uo_names is None:
                    msg = 'Failed to get userobject names from server.'
                    self._addError(msg)
                    self.Component.Message = msg
                    Status.Add(msg)
                    return Status
                msg = f'Found {len(api_uo_names)} UserObjects on server.'
                self._addRemark(msg)
                Status.Add(msg)

                # identify missing userobjects on disk
                set_installed_uo_names = set(installed_uo_names)
                missing_uo_names = [
                    uo for uo in api_uo_names
                    if uo not in set_installed_uo_names
                ]
                stale_uo_names = [
                    uo for uo in set_installed_uo_names
                    if uo not in api_uo_names
                ]
                if missing_uo_names:
                    msg = (
                        f'Found {len(missing_uo_names)} UserObjects that '
                        'are not installed! Run InstallUpdates to install'
                        'them.'
                    )
                    self._addRemark(msg)
                    Status.Add(msg)
                if stale_uo_names:
                    msg = (
                        f'Found {len(stale_uo_names)} stale UserObjects not '
                        'on server (will be deleted on InstallUpdates): '
                        f'{", ".join(sorted(stale_uo_names))}'
                    )
                    self._addWarning(msg)
                    Status.Add(msg)
                msg = (
                    'Toggle InstallUpdates to True to install updates from '
                    'server.'
                )
                self.Component.Message = msg
            if InstallUpdates:
                if not CheckForUpdates:
                    msg = 'CheckForUpdates must be True to install updates!'
                    self._addWarning(msg)
                    Status.Add(msg)
                    return Status

                # loop over scripts that need updates
                if len(scripts_to_update) > 0:
                    for iguid, values in scripts_to_update:
                        (script_type,
                         nickname,
                         name,
                         obj,
                         current_source) = values
                        full_name = CATEGORY + '_' + name
                        new_source = self.get_api_source_file_text(
                            auth_core,
                            full_name
                        )
                        if new_source is None:
                            msg = (
                                f'Failed to get source file {full_name} '
                                'from server.'
                            )
                            self._addError(msg)
                            self.Component.Message = msg
                            Status.Add(msg)
                            return Status
                        res = self.replace_scriptcomp_source(
                            values,
                            new_source
                        )
                        if not res:
                            msg = (
                                f'Failed to replace source for {nickname} '
                                'with new version! Please contact support '
                                '(lol)'
                            )
                            self._addError(msg)
                            self.Component.Message = msg
                            Status.Add(msg)
                            return Status
                        msg = (
                            f'Replaced source for {nickname} with new version!'
                        )
                        self._addRemark(msg)
                        Status.Add(msg)
                        self.Component.Message = msg

                # currently, we need to install/replace all userobjects
                # since we can't check userobjects file versions
                # TODO: add userobject file version checking
                # first, we delete all stale user objects, using the actual
                # path each userobject was discovered at (they may live in
                # different subfolders due to the recursive glob)
                deleted_stale = 0
                for uo_name in stale_uo_names:
                    stale_file = (
                        installed_uo_paths.get(uo_name) or
                        os.path.join(uo_install_dir, uo_name + '.ghuser')
                    )
                    try:
                        os.remove(stale_file)
                        deleted_stale += 1
                    except OSError as e:
                        msg = (
                            f'Could not delete stale UserObject {uo_name}: '
                            f'{str(e)}'
                        )
                        self._addWarning(msg)
                        Status.Add(msg)
                if stale_uo_names:
                    msg = (
                        f'Deleted {deleted_stale} of {len(stale_uo_names)} '
                        'stale UserObject files.'
                    )
                    self._addRemark(msg)
                    Status.Add(msg)
                missing_uo_names = api_uo_names
                # loop over missing userobjects and save them
                written_uo_files = []
                for uo_name in missing_uo_names:
                    # get new userobject bytes from api server
                    new_uo_bytes = self.get_api_userobject_bytes(
                        auth_core,
                        uo_name
                    )
                    if new_uo_bytes is None:
                        msg = (
                            f'Failed to get userobject {uo_name} from server.'
                        )
                        self._addError(msg)
                        self.Component.Message = msg
                        Status.Add(msg)
                        return Status
                    os.makedirs(uo_install_dir, exist_ok=True)
                    out_file = Path(
                        os.path.join(uo_install_dir, uo_name + '.ghuser')
                    )
                    with open(out_file, 'wb') as f:
                        f.write(new_uo_bytes)
                    written_uo_files.append(str(out_file.resolve()))
                msg = f'Installed {len(written_uo_files)} UserObject files!'
                self._addRemark(msg)
                Status.Add(msg)
                msg = 'All updates installed successfully!'
                self._addRemark(msg)
                self.Component.Message = msg
                Status.Add(msg)

        except requests.exceptions.ConnectionError as e:
            msg = 'Cannot connect to server. Please check your connection.'
            self._addError(msg + f'\nFull Error: {str(e)}')
            self.Component.Message = msg

        except requests.exceptions.Timeout as e:
            msg = 'Request timeout. Server may be slow.'
            self._addError(msg + f'\nFull Error: {str(e)}')
            self.Component.Message = msg

        except requests.exceptions.RequestException as e:
            msg = f'Request error: {str(e)}'
            self._addError(msg)
            self.Component.Message = msg

        except Exception as e:
            msg = f'Unexpected error: {str(e)}'
            self._addError(msg)
            self.Component.Message = msg

        # return status message
        return Status
# ---------- end csc_update ----------
panel_13 = Panel(csc_update)

# ---- group: __DDU_CSC_EXAMPLE_09__
passportdata_3 = Data(passportdata_2)
disassemblecomponent_3 = DisassembleComponent(ComponentData=passportdata_3)  # -> ID, Name, Type, Material, Color, Location, BoundingBox, PCAFrame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; inputs ComponentData: tree of String; same code as disassemblecomponent
manufacturedprecision_3 = Data(disassemblecomponent_3.ManufacturedPrecision)
primitivegeometry_3 = Data(disassemblecomponent_3.PrimitiveGeometry)
parentcomponent_3 = Data(disassemblecomponent_3.ParentComponent)
manufacturedat_3 = Data(disassemblecomponent_3.ManufacturedAt)
salvagesource_3 = Data(disassemblecomponent_3.SalvageSource)
boundingbox_3 = Data(disassemblecomponent_3.BoundingBox)
markerpoints_3 = Data(disassemblecomponent_3.MarkerPoints)
descriptors_3 = Data(disassemblecomponent_3.Descriptors)
salvagedat_3 = Data(disassemblecomponent_3.SalvagedAt)
pcaframe_3 = Data(disassemblecomponent_3.PCAFrame)
attributes_3 = Data(disassemblecomponent_3.Attributes)
condition_3 = Data(disassemblecomponent_3.Condition)
location_7 = Data(disassemblecomponent_3.Location)
material_9 = Data(disassemblecomponent_3.Material)
id_3 = Data(disassemblecomponent_3.ID)
name_3 = Data(disassemblecomponent_3.Name)
type_9 = Data(disassemblecomponent_3.Type)
color_5 = Data(disassemblecomponent_3.Color)

# ---- group: __DDU_CSC_EXAMPLE_03__
# Step 5
# comments & notes: Sync Components from Rhino document.
# 
# NOTE: If you transform the components within your Rhino document, transformations will be carried over, as long as the attached TextTag is transformed equally!
# comments & notes: Activate the Toggle to Synchornize!
toggle_5 = BooleanToggle(False)
syncwithrhinodoc_2 = SyncWithRhinoDoc(Sync=toggle_5)  # -> DocumentComponents; inputs Sync: Boolean; same code as syncwithrhinodoc
componentdata_41 = Data(syncwithrhinodoc_2)

# ---- group: __DDU_CSC_EXAMPLE_06__
# Step 3.3
# comments & notes: Disassemble the components to get the primitive geometry
componentdata_42 = Data(componentdata_10)
disassemblecomponent_4 = DisassembleComponent(ComponentData=componentdata_42)  # -> ID, Name, Type, Material, Color, Location, BoundingBox, PCAFrame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; inputs ComponentData: tree of String; same code as disassemblecomponent
manufacturedprecision_4 = Data(disassemblecomponent_4.ManufacturedPrecision)
primitivegeometry_4 = Data(disassemblecomponent_4.PrimitiveGeometry)
parentcomponent_4 = Data(disassemblecomponent_4.ParentComponent)
manufacturedat_4 = Data(disassemblecomponent_4.ManufacturedAt)
salvagesource_4 = Data(disassemblecomponent_4.SalvageSource)
boundingbox_4 = Data(disassemblecomponent_4.BoundingBox)
markerpoints_4 = Data(disassemblecomponent_4.MarkerPoints)
descriptors_4 = Data(disassemblecomponent_4.Descriptors)
salvagedat_4 = Data(disassemblecomponent_4.SalvagedAt)
pcaframe_4 = Data(disassemblecomponent_4.PCAFrame)
attributes_4 = Data(disassemblecomponent_4.Attributes)
condition_4 = Data(disassemblecomponent_4.Condition)
location_8 = Data(disassemblecomponent_4.Location)
material_10 = Data(disassemblecomponent_4.Material)
type_10 = Data(disassemblecomponent_4.Type)
color_6 = Data(disassemblecomponent_4.Color)
id_4 = Data(disassemblecomponent_4.ID)
name_4 = Data(disassemblecomponent_4.Name)

# Step 3.1
# comments & notes: Get radial shape signature distances with medium (32 rays) resolution.
panel_14 = Panel("radial_distance_64")
componentdata_43 = Data(componentdata_10)
getdescriptor_7 = GetDescriptor(Input=componentdata_43, DescriptorKey=panel_14)  # -> DescriptorValues; inputs Input: list, DescriptorKey: String; same code as getdescriptor_2
radial_distance_64 = Data(getdescriptor_7)

# Step 3.2
# comments & notes: Get radial shape signature tangent vectors with medium (32 rays) resolution.
panel_15 = Panel("radial_tangent_64")
componentdata_44 = Data(componentdata_10)
getdescriptor_8 = GetDescriptor(Input=componentdata_44, DescriptorKey=panel_15)  # -> DescriptorValues; inputs Input: list, DescriptorKey: String; same code as getdescriptor_2
radial_tangent_64 = Data(getdescriptor_8)

# ---- group: __DDU_CSC_EXAMPLE_05__
# Step 4
# comments & notes: Disassemble the components to get the primitive geometry
componentdata_45 = Data(componentdata_3)
disassemblecomponent_5 = DisassembleComponent(ComponentData=componentdata_45)  # -> ID, Name, Type, Material, Color, Location, BoundingBox, PCAFrame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; inputs ComponentData: tree of String; same code as disassemblecomponent
manufacturedprecision_5 = Data(disassemblecomponent_5.ManufacturedPrecision)
primitivegeometry_5 = Data(disassemblecomponent_5.PrimitiveGeometry)
parentcomponent_5 = Data(disassemblecomponent_5.ParentComponent)
manufacturedat_5 = Data(disassemblecomponent_5.ManufacturedAt)
salvagesource_5 = Data(disassemblecomponent_5.SalvageSource)
boundingbox_5 = Data(disassemblecomponent_5.BoundingBox)
markerpoints_5 = Data(disassemblecomponent_5.MarkerPoints)
descriptors_5 = Data(disassemblecomponent_5.Descriptors)
salvagedat_5 = Data(disassemblecomponent_5.SalvagedAt)
pcaframe_5 = Data(disassemblecomponent_5.PCAFrame)
attributes_5 = Data(disassemblecomponent_5.Attributes)
condition_5 = Data(disassemblecomponent_5.Condition)
location_9 = Data(disassemblecomponent_5.Location)
material_11 = Data(disassemblecomponent_5.Material)
id_5 = Data(disassemblecomponent_5.ID)
name_5 = Data(disassemblecomponent_5.Name)
type_11 = Data(disassemblecomponent_5.Type)
color_7 = Data(disassemblecomponent_5.Color)

# ---- group: __DDU_CSC_EXAMPLE_01__
# Step 5
# comments & notes: To view all data about the components, we can use DisassembleComponent. This also gives us the Primitive Geometry representation.
componentdata_46 = Data(componentdata_32)
disassemblecomponent_6 = DisassembleComponent(ComponentData=componentdata_46)  # -> ID, Name, Type, Material, Color, Location, BoundingBox, PCAFrame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; inputs ComponentData: tree of String; same code as disassemblecomponent
manufacturedprecision_6 = Data(disassemblecomponent_6.ManufacturedPrecision)
primitivegeometry_6 = Data(disassemblecomponent_6.PrimitiveGeometry)
parentcomponent_6 = Data(disassemblecomponent_6.ParentComponent)
manufacturedat_6 = Data(disassemblecomponent_6.ManufacturedAt)
salvagesource_6 = Data(disassemblecomponent_6.SalvageSource)
boundingbox_6 = Data(disassemblecomponent_6.BoundingBox)
markerpoints_6 = Data(disassemblecomponent_6.MarkerPoints)
descriptors_6 = Data(disassemblecomponent_6.Descriptors)
salvagedat_6 = Data(disassemblecomponent_6.SalvagedAt)
pcaframe_6 = Data(disassemblecomponent_6.PCAFrame)
attributes_6 = Data(disassemblecomponent_6.Attributes)
condition_6 = Data(disassemblecomponent_6.Condition)
location_10 = Data(disassemblecomponent_6.Location)
material_12 = Data(disassemblecomponent_6.Material)
type_12 = Data(disassemblecomponent_6.Type)
color_8 = Data(disassemblecomponent_6.Color)
id_6 = Data(disassemblecomponent_6.ID)
name_6 = Data(disassemblecomponent_6.Name)

# ----
# Step 3.1
primitivegeometry_7 = Data(primitivegeometry_2)
txt = Text(primitivegeometry_7)
tmatch = MatchText(Text=txt, Pattern="*Extrusion*", Case=True)
dispatch = Dispatch(List=primitivegeometry_7, DispatchPattern=tmatch)  # -> ListA, ListB
lng = ListLength(List=flatten(dispatch.ListB))
random = Random(Range=lng, Number=1, Seed=2, Integers=True)
item_3 = ListItem(List=flatten(dispatch.ListB), Index=random, Wrap=True)
random_primitivegeometry = Data(item_3)
inputdata = Data(random_primitivegeometry)
fetchreducedgeometry_2 = FetchReducedGeometry(Input=inputdata)  # -> Geometry, GeometryType, SnapshotID; same code as fetchreducedgeometry
panel_16 = Panel(fetchreducedgeometry_2.SnapshotID)
panel_17 = Panel(fetchreducedgeometry_2.GeometryType)
geometry_5 = Data(fetchreducedgeometry_2.Geometry)

# ---- group: __DDU_CSC_EXAMPLE_03__
# Step 6
# comments & notes: Disassemble the synced components. See how the transformations from the Rhino document are applied?
componentdata_47 = Data(componentdata_41)
disassemblecomponent_7 = DisassembleComponent(ComponentData=componentdata_47)  # -> ID, Name, Type, Material, Color, Location, BoundingBox, PCAFrame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; inputs ComponentData: tree of String; same code as disassemblecomponent
manufacturedprecision_7 = Data(disassemblecomponent_7.ManufacturedPrecision)
primitivegeometry_8 = Data(disassemblecomponent_7.PrimitiveGeometry)
parentcomponent_7 = Data(disassemblecomponent_7.ParentComponent)
manufacturedat_7 = Data(disassemblecomponent_7.ManufacturedAt)
salvagesource_7 = Data(disassemblecomponent_7.SalvageSource)
boundingbox_7 = Data(disassemblecomponent_7.BoundingBox)
markerpoints_7 = Data(disassemblecomponent_7.MarkerPoints)
descriptors_7 = Data(disassemblecomponent_7.Descriptors)
salvagedat_7 = Data(disassemblecomponent_7.SalvagedAt)
pcaframe_7 = Data(disassemblecomponent_7.PCAFrame)
attributes_7 = Data(disassemblecomponent_7.Attributes)
condition_7 = Data(disassemblecomponent_7.Condition)
material_13 = Data(disassemblecomponent_7.Material)
location_11 = Data(disassemblecomponent_7.Location)
type_13 = Data(disassemblecomponent_7.Type)
id_7 = Data(disassemblecomponent_7.ID)
name_7 = Data(disassemblecomponent_7.Name)
color_9 = Data(disassemblecomponent_7.Color)

# ----
# comments & notes: Generic JSON Disassembly Tools to Access additional attributes (metadata from scanning, etc.)
number_slider_4 = Slider(103, range=0..500)
attributes_8 = Data(attributes_2)
item_4 = ListItem(List=flatten(attributes_8), Index=number_slider_4, Wrap=True)
jsonkeys = JSONKeys(JSON=item_4)  # -> Keys, KeyTypes, KeyPaths; inputs JSON: String, MaxDepth: Int32
# ---------- jsonkeys: Python ----------
#! python3
# -*- coding: utf-8 -*-
# venv: DDU_CSC
print('ENV OK!')
# r: charset_normalizer
# r: requests

# PYTHON STANDARD LIBRARY IMPORTS ---------------------------------------------
import json  # NOQA

# RHINO AND GH RELATED IMPORTS ------------------------------------------------
import System  # NOQA
import Grasshopper  # NOQA
import Rhino  # NOQA

# GHENV COMPONENT SETTINGS ----------------------------------------------------
ghenv.Component.Name = 'JSONKeys'  # NOQA
ghenv.Component.NickName = 'JSONKeys'  # NOQA
ghenv.Component.Category = 'DDU_CSC'  # NOQA
ghenv.Component.SubCategory = '6 Data Tools'  # NOQA
ghenv.Component.Description = (  # NOQA
    'Extracts all keys and their paths from a JSON string up to a specified '
    'maximum depth. Returns keys, types, and full dot-notation paths as '
    'separate data trees.'
)


class CSC_JSONKeys(Grasshopper.Kernel.GH_ScriptInstance):
    """
    Author: Max Benjamin Eschenbach
    License: MIT License
    Version: 260609
    """

    def __init__(self):
        """Initialize this component and set component parameters."""
        super().__init__()
        # initialize props
        self.Component = ghenv.Component  # NOQA
        self.InputParams = self.Component.Params.Input
        self.OutputParams = self.Component.Params.Output

    def _addRemark(self, msg: str = ''):
        """Add a remark message to the component."""
        rml = self.Component.RuntimeMessageLevel.Remark
        self.AddRuntimeMessage(rml, msg)

    def _addWarning(self, msg: str = ''):
        """Add a warning message to the component."""
        rml = self.Component.RuntimeMessageLevel.Warning
        self.AddRuntimeMessage(rml, msg)

    def _addError(self, msg: str = ''):
        """Add an error message to the component."""
        rml = self.Component.RuntimeMessageLevel.Error
        self.AddRuntimeMessage(rml, msg)

    def BeforeRunScript(self):
        """Perform some setup actions."""
        # Initialize input param descriptions
        self.InputParams[0].Description = (
            'JSON string to extract keys from'
        )
        self.InputParams[1].Description = (
            'Maximum depth to traverse in the JSON structure (default: 5)'
        )
        # Initialize output param descriptions
        i = 0
        if self.OutputParams[0].Name == 'out':
            i += 1
        self.OutputParams[0+i].Description = (
            'List of all available keys in the JSON structure'
        )
        self.OutputParams[1+i].Description = (
            'Data types for each key '
            '(object, array, string, number, boolean, null)'
        )
        self.OutputParams[2+i].Description = (
            'Full dot-notation paths for each key '
            '(e.g., "descriptors.material.type")'
        )

    def get_json_type(self, value):
        """Get the JSON type of a value."""
        if isinstance(value, dict):
            return 'object'
        elif isinstance(value, list):
            return 'array'
        elif isinstance(value, bool):
            return 'boolean'
        elif isinstance(value, (int, float)):
            return 'number'
        elif isinstance(value, str):
            return 'string'
        elif value is None:
            return 'null'
        else:
            return 'unknown'

    def extract_keys_recursive(self, data, prefix='', max_depth=5,
                               current_depth=0):
        """Recursively extract all keys from JSON data."""
        keys = []
        key_types = []
        key_paths = []

        if current_depth >= max_depth:
            return keys, key_types, key_paths

        if isinstance(data, dict):
            for key, value in data.items():
                current_path = f'{prefix}.{key}' if prefix else key
                keys.append(key)
                key_types.append(self.get_json_type(value))
                key_paths.append(current_path)

                # Recursively process nested objects and arrays
                if (isinstance(value, (dict, list)) and
                        current_depth < max_depth - 1):
                    nested_keys, nested_types, nested_paths = (
                        self.extract_keys_recursive(
                            value, current_path, max_depth, current_depth + 1
                        )
                    )
                    keys.extend(nested_keys)
                    key_types.extend(nested_types)
                    key_paths.extend(nested_paths)

        elif isinstance(data, list):
            for i, item in enumerate(data):
                current_path = f'{prefix}[{i}]' if prefix else f'[{i}]'
                keys.append(f'[{i}]')
                key_types.append(self.get_json_type(item))
                key_paths.append(current_path)

                # Recursively process nested objects and arrays
                if (isinstance(item, (dict, list)) and
                        current_depth < max_depth - 1):
                    nested_keys, nested_types, nested_paths = (
                        self.extract_keys_recursive(
                            item, current_path, max_depth, current_depth + 1
                        )
                    )
                    keys.extend(nested_keys)
                    key_types.extend(nested_types)
                    key_paths.extend(nested_paths)

        return keys, key_types, key_paths

    def RunScript(self, JSON: str, MaxDepth: int):
        # set up output trees and results tuple
        Keys = Grasshopper.DataTree[System.Object]()
        KeyTypes = Grasshopper.DataTree[System.Object]()
        KeyPaths = Grasshopper.DataTree[System.Object]()
        __Results = (Keys, KeyTypes, KeyPaths)
        try:
            # Validate input
            if not JSON:
                msg = 'No JSON input provided'
                self._addWarning(msg)
                self.Component.Message = msg
                return __Results

            # Set default max depth if not provided
            if MaxDepth is None or MaxDepth < 1:
                MaxDepth = 5

            self.Component.Message = 'Extracting JSON keys...'

            # Parse JSON
            try:
                json_data = json.loads(JSON)
            except json.JSONDecodeError as e:
                msg = f'Invalid JSON format: {str(e)}'
                self._addError(msg)
                return __Results

            # Extract keys recursively
            keys, key_types, key_paths = self.extract_keys_recursive(
                json_data, max_depth=MaxDepth
            )

            # Add results to data trees
            if keys:
                for i, key in enumerate(keys):
                    Keys.Add(key)
                    KeyTypes.Add(
                        key_types[i] if i < len(key_types) else 'unknown'
                    )
                    KeyPaths.Add(key_paths[i] if i < len(key_paths) else key)
            else:
                # If no keys found, add empty results
                Keys.Add('')
                KeyTypes.Add('')
                KeyPaths.Add('')

            # Update success message
            total_keys = len(keys)
            self.Component.Message = f'Extracted {total_keys} key(s)'
            self._addRemark(
                f'Successfully extracted {total_keys} keys from JSON'
            )

            # return output trees
            return __Results

        except Exception as e:
            msg = f'Unexpected error during key extraction: {str(e)}'
            self._addError(msg)
            # Return empty results if there was an error
            return __Results
# ---------- end jsonkeys ----------
jsongetvalue = JSONGetValue(JSON=item_4, KeyPath=jsonkeys.KeyPaths)  # -> Value, ValueType, Success, Error; inputs JSON: String, KeyPath: String, DefaultValue: String
# ---------- jsongetvalue: Python ----------
#! python3
# -*- coding: utf-8 -*-
# venv: DDU_CSC
print('ENV OK!')
# r: charset_normalizer
# r: requests

# PYTHON STANDARD LIBRARY IMPORTS ---------------------------------------------
import json  # NOQA

# RHINO AND GH RELATED IMPORTS ------------------------------------------------
import System  # NOQA
import Grasshopper  # NOQA
import Rhino  # NOQA

# GHENV COMPONENT SETTINGS ----------------------------------------------------
ghenv.Component.Name = 'JSONGetValue'  # NOQA
ghenv.Component.NickName = 'JSONGetValue'  # NOQA
ghenv.Component.Category = 'DDU_CSC'  # NOQA
ghenv.Component.SubCategory = '6 Data Tools'  # NOQA
ghenv.Component.Description = (  # NOQA
    'Extracts a specific value from a JSON string using dot-notation key '
    'paths (e.g., "geometry.meshes[0].v"). Converts JSON values to '
    'appropriate native Grasshopper data types where possible.'
)


class CSC_JSONGetValue(Grasshopper.Kernel.GH_ScriptInstance):
    """
    Author: Max Benjamin Eschenbach
    License: MIT License
    Version: 260609
    """

    def __init__(self):
        """Initialize this component and set component parameters."""
        super().__init__()
        # initialize props
        self.Component = ghenv.Component  # NOQA
        self.InputParams = self.Component.Params.Input
        self.OutputParams = self.Component.Params.Output

    def _addRemark(self, msg: str = ''):
        """Add a remark message to the component."""
        rml = self.Component.RuntimeMessageLevel.Remark
        self.AddRuntimeMessage(rml, msg)

    def _addWarning(self, msg: str = ''):
        """Add a warning message to the component."""
        rml = self.Component.RuntimeMessageLevel.Warning
        self.AddRuntimeMessage(rml, msg)

    def _addError(self, msg: str = ''):
        """Add an error message to the component."""
        rml = self.Component.RuntimeMessageLevel.Error
        self.AddRuntimeMessage(rml, msg)

    def BeforeRunScript(self):
        """Perform some setup actions."""
        # Initialize input param descriptions
        self.InputParams[0].Description = (
            'JSON string to extract value from'
        )
        self.InputParams[1].Description = (
            'Dot-notation path to the desired value '
            '(e.g., "descriptors.material.type")'
        )
        self.InputParams[2].Description = (
            'Default value to return if key path is not found (optional)'
        )
        # Initialize output param descriptions
        i = 0
        if self.OutputParams[0].Name == 'out':
            i += 1
        self.OutputParams[0+i].Description = (
            'Extracted value converted to appropriate Grasshopper type'
        )
        self.OutputParams[1+i].Description = (
            'Data type of the extracted value '
            '(string, number, boolean, object, array, null)'
        )
        self.OutputParams[2+i].Description = (
            'True if extraction was successful, False otherwise'
        )
        self.OutputParams[3+i].Description = (
            'Error message if extraction failed, empty string if successful'
        )

    def get_value_by_path(self, data, path):
        """Get value from JSON data using dot-notation path."""
        if not path:
            return data, 'root'

        # Parse path to handle both dot notation and array indices
        parts = self.parse_path(path)

        current = data
        for part in parts:
            if isinstance(part, int):
                # Array index
                if isinstance(current, list) and 0 <= part < len(current):
                    current = current[part]
                else:
                    raise IndexError(f'Array index {part} out of range')
            else:
                # Object key
                if isinstance(current, dict) and part in current:
                    current = current[part]
                else:
                    raise KeyError(f'Key "{part}" not found')

        return current, self.get_json_type(current)

    def parse_path(self, path):
        """Parse a path string into a list of keys and indices."""
        parts = []
        current_part = ''
        i = 0

        while i < len(path):
            char = path[i]

            if char == '.':
                # End of current part
                if current_part:
                    parts.append(current_part)
                    current_part = ''
            elif char == '[':
                # Start of array index
                if current_part:
                    parts.append(current_part)
                    current_part = ''
                # Find the closing bracket
                j = i + 1
                while j < len(path) and path[j] != ']':
                    j += 1
                if j < len(path):
                    # Extract the index
                    index_str = path[i+1:j]
                    try:
                        index = int(index_str)
                        parts.append(index)
                        i = j  # Skip to after the closing bracket
                    except ValueError:
                        raise ValueError(f'Invalid array index: {index_str}')
                else:
                    raise ValueError('Unclosed array bracket')
            else:
                current_part += char

            i += 1

        # Add the last part if any
        if current_part:
            parts.append(current_part)

        return parts

    def get_json_type(self, value):
        """Get the JSON type of a value."""
        if isinstance(value, dict):
            return 'object'
        elif isinstance(value, list):
            return 'array'
        elif isinstance(value, bool):
            return 'boolean'
        elif isinstance(value, (int, float)):
            return 'number'
        elif isinstance(value, str):
            return 'string'
        elif value is None:
            return 'null'
        else:
            return 'unknown'

    def convert_to_gh_type(self, value, value_type):
        """Convert value to appropriate Grasshopper type."""
        if value_type == 'boolean':
            return bool(value)
        elif value_type == 'number':
            if isinstance(value, int):
                return int(value)
            else:
                return float(value)
        elif value_type == 'string':
            return str(value)
        elif value_type == 'null':
            return None
        elif value_type == 'object':
            return json.dumps(value)
        elif value_type == 'array':
            # Convert array to Grasshopper-compatible list
            return self.convert_array_to_gh_list(value)
        else:
            return str(value)

    def convert_array_to_gh_list(self, array_value):
        """Convert JSON array to Grasshopper-compatible list."""
        if not isinstance(array_value, list):
            return array_value

        converted_list = []
        for item in array_value:
            # Recursively convert each item in the array
            item_type = self.get_json_type(item)
            converted_item = self.convert_to_gh_type(item, item_type)
            converted_list.append(converted_item)

        return converted_list

    def RunScript(self, JSON: str, KeyPath: str, DefaultValue: str):
        # set up output trees and results tuple
        Value = Grasshopper.DataTree[System.Object]()
        ValueType = Grasshopper.DataTree[System.Object]()
        Success = Grasshopper.DataTree[System.Object]()
        Error = Grasshopper.DataTree[System.Object]()
        __Results = (Value, ValueType, Success, Error)
        try:
            # Validate input
            if not JSON:
                msg = 'No JSON input provided'
                self._addWarning(msg)
                self.Component.Message = msg
                Value.Add('')
                ValueType.Add('')
                Success.Add(False)
                Error.Add(msg)
                return __Results

            if not KeyPath:
                msg = 'No key path provided'
                self._addWarning(msg)
                self.Component.Message = msg
                default_val = DefaultValue if DefaultValue else ''
                if isinstance(default_val, list):
                    Value.AddRange(default_val)
                else:
                    Value.Add(default_val)
                ValueType.Add('')
                Success.Add(False)
                Error.Add(msg)
                return __Results

            self.Component.Message = 'Extracting JSON value...'

            # Parse JSON
            try:
                json_data = json.loads(JSON)
            except json.JSONDecodeError as e:
                msg = f'Invalid JSON format: {str(e)}'
                self._addError(msg)
                self.Component.Message = msg
                default_val = DefaultValue if DefaultValue else ''
                if isinstance(default_val, list):
                    Value.AddRange(default_val)
                else:
                    Value.Add(default_val)
                ValueType.Add('')
                Success.Add(False)
                Error.Add(msg)
                return __Results

            # Extract value by path
            try:
                extracted_value, value_type = self.get_value_by_path(
                    json_data, KeyPath
                )

                # Convert to appropriate GH type
                converted_value = self.convert_to_gh_type(
                    extracted_value, value_type
                )

                # Add results - check if it's a collection for proper GH
                # handling
                if isinstance(converted_value, list):
                    Value.AddRange(converted_value)
                else:
                    Value.Add(converted_value)
                ValueType.Add(value_type)
                Success.Add(True)
                Error.Add('')

                # Update success message
                self.Component.Message = f'Extracted: {value_type}'
                self._addRemark(
                    f'Successfully extracted {value_type} value from path: '
                    f'{KeyPath}'
                )

            except KeyError as e:
                msg = f'Key path not found: {str(e)}'
                self._addWarning(msg)
                self.Component.Message = msg
                default_val = DefaultValue if DefaultValue else ''
                if isinstance(default_val, list):
                    Value.AddRange(default_val)
                else:
                    Value.Add(default_val)
                ValueType.Add('')
                Success.Add(False)
                Error.Add(msg)

            except Exception as e:
                msg = f'Error extracting value: {str(e)}'
                self._addError(msg)
                self.Component.Message = msg
                default_val = DefaultValue if DefaultValue else ''
                if isinstance(default_val, list):
                    Value.AddRange(default_val)
                else:
                    Value.Add(default_val)
                ValueType.Add('')
                Success.Add(False)
                Error.Add(msg)

            # return output trees
            return __Results

        except Exception as e:
            msg = f'Unexpected error during value extraction: {str(e)}'
            self._addError(msg)
            # Return empty results if there was an error
            return __Results
# ---------- end jsongetvalue ----------
panel_18 = Panel(jsongetvalue.Value)

# ---- group: __DDU_CSC_EXAMPLE_05__
# Step 5
# comments & notes: Concatenate all descriptor values.
# We use path shifting to align the DataTree paths.
radial_tangent_32_2 = Data(radial_tangent_32)
radial_distance_32_2 = Data(radial_distance_32)
spherescore_2 = Data(spherescore)
planescore_2 = Data(planescore)
linescore_2 = Data(linescore)
boxscore_2 = Data(boxscore)
pshift = ShiftPaths(Data=boxscore_2, Offset="-2")
pshift_2 = ShiftPaths(Data=linescore_2, Offset="-2")
pshift_3 = ShiftPaths(Data=radial_distance_32_2, Offset="-2")
pshift_4 = ShiftPaths(Data=radial_tangent_32_2, Offset="-2")
pshift_5 = ShiftPaths(Data=planescore_2, Offset="-2")
pshift_6 = ShiftPaths(Data=spherescore_2, Offset="-2")
merge = Merge(Data1=pshift_3, Data2=pshift_4, Data3=pshift, Data4=pshift_2, Data5=pshift_5, Data6=pshift_6)
descriptordata = Data(merge)

# ---- group: __DDU_CSC_EXAMPLE_06__
# Step 4.1
# comments & notes: We also combine the values from the server-side-computed radial signature of the components in the catalog.
# 
# The data arrives in grasshopper slightly differently. This has technical reasons and explaining them here would be a bit much ;-)
# 
# Again, what matters: 192 numeric values per shape that are able to describe the form. In the same format and order (!) as the 192 numeric values for our design shapes.
radial_distance_64_2 = Data(radial_distance_64)
radial_tangent_64_2 = Data(radial_tangent_64)
item_5 = ListItem(List=radial_tangent_64_2, Index=0, Wrap=True)  # -> Item, Item1
pshift_7 = ShiftPaths(Data=item_5.Item1, Offset=-1)
pshift_8 = ShiftPaths(Data=item_5.Item, Offset=-1)
panel_19 = Panel("""0
1
2""")
weave = Weave(Pattern=panel_19, Stream0=radial_distance_64_2, Stream1=pshift_8, Stream2=pshift_7, NullGaps=False)
pshift_9 = ShiftPaths(Data=weave, Offset=-2)
catalogshapes_radialsignature = Data(pshift_9)

# Step 4.1
# comments & notes: Here we combine the values of the radial signature. This is a rather data-structure-centric operation.
# 
# You don't necessarily need to understand it fully. What matters is our result - in this case:
# 
# 192 numeric values per shape that are able to describe the form.
designshapes_distances_2 = Data(designshapes_distances)
designshapes_tangents_2 = Data(designshapes_tangents)
devec = DeconstructVector(Vector=designshapes_tangents_2)  # -> XComponent, YComponent, ZComponent
panel_20 = Panel("""0
1
2""")
weave_2 = Weave(Pattern=panel_20, Stream0=designshapes_distances_2, Stream1=devec.XComponent, Stream2=devec.YComponent, NullGaps=False)
designshapes_radialsignature = Data(weave_2)

# Step 3.4
# comments & notes: Extract Extrusion Profile curves.
primitivegeometry_9 = Data(primitivegeometry_4)
extrusionprofile = ExtrusionProfile(ExtrusionGeometry=primitivegeometry_9)  # -> ProfileCurve; inputs ExtrusionGeometry: Extrusion, ProfileIndex: Int32, ProfileParameter: Double
# ---------- extrusionprofile: Python ----------
#! python3
# -*- coding: utf-8 -*-
# venv: DDU_CSC
print('ENV OK!')
# r: charset_normalizer
# r: requests

# PYTHON STANDARD LIBRARY IMPORTS ---------------------------------------------

# RHINO AND GH RELATED IMPORTS ------------------------------------------------
import System  # type: ignore[reportMissingImport] # NOQA
import Grasshopper  # type: ignore[reportMissingImport] # NOQA
import Rhino  # type: ignore[reportMissingImport] # NOQA
import scriptcontext as sc  # type: ignore[reportMissingImport] # NOQA

# GHENV COMPONENT SETTINGS ----------------------------------------------------
ghenv.Component.Name = 'ExtrusionProfile'  # type: ignore[reportUnedfinedVariable] # NOQA
ghenv.Component.NickName = 'ExtrusionProfile'  # type: ignore[reportUnedfinedVariable] # NOQA
ghenv.Component.Category = 'DDU_CSC'  # type: ignore[reportUnedfinedVariable] # NOQA
ghenv.Component.SubCategory = '7 Geometry Tools'  # type: ignore[reportUnedfinedVariable] # NOQA
ghenv.Component.Description = (  # type: ignore[reportUnedfinedVariable] # NOQA
    'Extract the profile curves of an Extrusion.'
)


class CSC_ExtrusionProfile(Grasshopper.Kernel.GH_ScriptInstance):
    """
    Author: Max Benjamin Eschenbach
    License: MIT License
    Version: 260609
    """

    def __init__(self):
        """Initialize this component and set component parameters."""
        super().__init__()
        # initialize props
        self.Component = ghenv.Component  # type: ignore[reportUnedfinedVariable] # NOQA
        self.InputParams = self.Component.Params.Input
        self.OutputParams = self.Component.Params.Output

    def _addRemark(self, msg: str = ''):
        """Add a remark message to the component."""
        rml = self.Component.RuntimeMessageLevel.Remark
        self.AddRuntimeMessage(rml, msg)

    def _addWarning(self, msg: str = ''):
        """Add a warning message to the component."""
        rml = self.Component.RuntimeMessageLevel.Warning
        self.AddRuntimeMessage(rml, msg)

    def _addError(self, msg: str = ''):
        """Add an error message to the component."""
        rml = self.Component.RuntimeMessageLevel.Error
        self.AddRuntimeMessage(rml, msg)

    def BeforeRunScript(self):
        """Perform some setup actions."""
        # Initialize input param descriptions
        self.InputParams[0].Description = (
            'A Rhino.Geometry.Extrusion to extract '
            'the profile curve from'
        )
        self.InputParams[1].Description = (
            'Index of the profile curve to extract. '
            'The outer profile has index 0.'
        )
        self.InputParams[2].Description = (
            'A relative parameter controlling which profile is returned. '
            '0 = bottom profile and 1 = top profile.'
        )
        # Initialize output param descriptions
        i = 0
        if self.OutputParams[0].Name == 'out':
            i += 1
        self.OutputParams[0+i].Description = (
            'The extracted profile curve.'
        )

    def RunScript(self,
            ExtrusionGeometry: Rhino.Geometry.Extrusion,
            ProfileIndex: int,
            ProfileParameter: float):
        # init outputs
        ProfileCurve = Grasshopper.DataTree[System.Object]()
        # defaults
        if not ExtrusionGeometry:
            self._addWarning(
                'Input Parameter ExtrusionGeometry failed to collect data.'
            )
            self.Component.Message = ('No Profile extracted.')
            return ProfileCurve
        if ProfileIndex is None:
            ProfileIndex = 0
        elif ProfileIndex < ExtrusionGeometry.ProfileCount - 1:
            self._addError('Input Parameter ProfileIndex is out of range!')
            return ProfileCurve
        elif ProfileIndex > ExtrusionGeometry.ProfileCount - 1:
            self._addError('Input Parameter ProfileIndex is out of range!')
            return ProfileCurve
        if ProfileParameter is None:
            ProfileParameter = 0.5
        elif ProfileParameter < 0:
            self._addWarning(
                'ProfileParameter was set to 0.0! '
                'Must be >= 0.0 and <= 1.0!'
            )
            ProfileParameter = 0.0
        elif ProfileParameter > 1:
            self._addWarning(
                'ProfileParameter was set to 1.0! '
                'Must be >= 0.0 and <= 1.0!'
            )
            ProfileParameter = 0.0
        # finally extract profile curve
        ProfileCurve = ExtrusionGeometry.Profile3d(0, 0.5)
        self.Component.Message = (
            f'Extrusion Profile at i = {ProfileIndex} | s = {ProfileParameter}'
        )
        # return results
        return ProfileCurve
# ---------- end extrusionprofile ----------
profilecurve = Data(extrusionprofile)

# ---- group: __DDU_CSC_EXAMPLE_05__
embeddingdimensions = Slider(2, range=2..6)
t_sne_or_pca = ValueList({"T-SNE": 0, "PCA": 1}, selected="T-SNE")

# Step 6
# comments & notes: Choose between two dimension-reduction techniques: T-SNE (stochastic) or PCA (fully deterministic).
# Switch to see the difference visualized!
# 
# You may also choose the number of dimensions for the embedded space (2 - 6) and look at the visualization results.
# 
# Can you make an educated guess how we map the dimensions for visualization?
descriptordata_2 = Data(descriptordata)
gate = StreamGate(Stream=descriptordata_2, Gate=t_sne_or_pca)  # -> Target0, Target1
descriptordata_3 = Data(gate.Target0)
descriptordata_4 = Data(gate.Target1)

# ---- group: __DDU_CSC_EXAMPLE_06__
# Step 5
# comments & notes: Here we use an assignment algorithm to find the most fitting parts from our catalog (CatalogShapes) for our DesignShapes.
# 
# This algorithm works with the 192 numeric values we have acquired in the last steps.
# 
# There is a Greedy (fast) option and the famous Hungarian (optimal) version.
catalogshapes_radialsignature_2 = Data(catalogshapes_radialsignature)
algorithm = ValueList({"Greedy": "greedy", "Hungarian": "hungarian"}, selected="Greedy")
designshapes_radialsignature_2 = Data(designshapes_radialsignature)
assignmentpoints = AssignmentPoints(DesignPts=designshapes_radialsignature_2, LibraryPts=catalogshapes_radialsignature_2, Algorithm=algorithm)  # -> Assignment, Cost; inputs DesignPts: tree of Double, LibraryPts: tree of Double, Weights: list of Double, ScaleFactor: Double, Algorithm: String
# ---------- assignmentpoints: Python ----------
#! python3
# -*- coding: utf-8 -*-
# venv: DDU_CSC
print('ENV OK!')
# r: charset_normalizer
# r: requests
# r: numpy
# r: scipy

# THIRD PARTY LIBRARY IMPORTS -------------------------------------------------
import numpy as np  # NOQA
from scipy.optimize import linear_sum_assignment  # NOQA

# RHINO AND GH RELATED IMPORTS ------------------------------------------------
import System  # NOQA
import Grasshopper  # NOQA
import Rhino  # NOQA

# GHENV COMPONENT SETTINGS ----------------------------------------------------
ghenv.Component.Name = 'AssignmentPoints'  # NOQA
ghenv.Component.NickName = 'AssignmentPoints'  # NOQA
ghenv.Component.Category = 'DDU_CSC'  # NOQA
ghenv.Component.SubCategory = '5 Matchmaking Tools'  # NOQA
ghenv.Component.Description = (  # NOQA
    'Solve point-to-point assignment between DesignPts and LibraryPts. '
    'Supports Greedy assignment (default, FullCircle-compatible) and '
    'Hungarian assignment (SciPy).'
)


def _weighted_euclidean_distance(pt1, pt2, weights):
    p1 = np.asarray(pt1, dtype=np.float64)
    p2 = np.asarray(pt2, dtype=np.float64)
    w = np.asarray(weights, dtype=np.float64)
    return float(np.sqrt(np.sum(w * np.square(p2 - p1))))


class CSC_AssignmentPoints(Grasshopper.Kernel.GH_ScriptInstance):
    """
    Author: Max Benjamin Eschenbach
    License: MIT License
    Version: 260609
    """

    def __init__(self):
        super().__init__()
        self.Component = ghenv.Component  # NOQA
        self.InputParams = self.Component.Params.Input
        self.OutputParams = self.Component.Params.Output

    def _addRemark(self, msg=''):
        self.AddRuntimeMessage(self.Component.RuntimeMessageLevel.Remark, msg)

    def _addWarning(self, msg=''):
        self.AddRuntimeMessage(self.Component.RuntimeMessageLevel.Warning, msg)

    def _addError(self, msg=''):
        self.AddRuntimeMessage(self.Component.RuntimeMessageLevel.Error, msg)

    def BeforeRunScript(self):
        self.InputParams[0].Description = (
            'Design points as DataTree of Numbers. Each branch is one point.'
        )
        self.InputParams[1].Description = (
            'Library points as DataTree of Numbers. Each branch is one point.'
        )
        self.InputParams[2].Description = (
            'Weights for weighted Euclidean distance. Optional; defaults to '
            '1.0 in each dimension.'
        )
        self.InputParams[3].Description = (
            'Scale factor used by Hungarian mode before optimization. '
            'Optional; default 1e3. Ignored by Greedy mode.'
        )
        self.InputParams[4].Description = (
            "Algorithm selector. Optional; defaults to 'greedy'. "
            "Accepted values: 'greedy', 'hungarian'."
        )

        i = 1 if self.OutputParams[0].Name == 'out' else 0
        self.OutputParams[0 + i].Description = (
            'Assignment tree. Branch i contains selected library index for '
            'design point i.'
        )
        self.OutputParams[1 + i].Description = (
            'Assignment cost tree. Branch i contains the cost value for '
            'design point i.'
        )

    def _collect_tree_branches(self, tree):
        if tree is None or tree.DataCount == 0:
            return []
        return [list(tree.Branch(path)) for path in tree.Paths]

    def _normalize_algorithm(self, algorithm):
        if algorithm is None:
            return 'greedy'
        alg = str(algorithm).strip().lower()
        if alg in ('', 'greedy', 'g'):
            return 'greedy'
        if alg in ('hungarian', 'hungary', 'h', 'scipy'):
            return 'hungarian'
        return None

    def _build_cost_matrices(self, design_branches, library_branches, weights):
        n = len(design_branches)
        m = len(library_branches)
        costs = np.zeros((m, m), dtype=np.float64)
        for i in range(m):
            if i >= n:
                continue
            for j in range(m):
                costs[i, j] = _weighted_euclidean_distance(
                    design_branches[i], library_branches[j], weights
                )
        return costs

    def _run_greedy(self, costs):
        m = int(costs.shape[0])
        selected = np.zeros(m, dtype=np.int32)
        assignment = np.full(m, -1, dtype=np.int32)

        for i in range(m):
            min_cost = float('inf')
            sel = -1
            for j in range(m):
                c = float(costs[i, j])
                if c < min_cost and selected[j] == 0:
                    min_cost = c
                    sel = j
            if sel < 0:
                raise ValueError('Greedy assignment failed to select a column')
            selected[sel] = 1
            assignment[i] = sel
        return assignment

    def _run_hungarian(self, costs, scale_factor):
        scaled = np.asarray(
            np.floor(costs * float(scale_factor)),
            dtype=np.int64,
        )
        rows, cols = linear_sum_assignment(scaled)
        assignment = np.full(scaled.shape[0], -1, dtype=np.int32)
        assignment[rows] = cols.astype(np.int32)
        if np.any(assignment < 0):
            raise ValueError('Hungarian assignment did not cover all rows')
        return assignment

    def RunScript(self,
            DesignPts: Grasshopper.DataTree[float],
            LibraryPts: Grasshopper.DataTree[float],
            Weights: System.Collections.Generic.List[float],
            ScaleFactor: float,
            Algorithm: str):
        Assignment = Grasshopper.DataTree[System.Object]()
        Cost = Grasshopper.DataTree[System.Object]()
        __Results = (Assignment, Cost)

        self.Component.Message = None

        design_branches = self._collect_tree_branches(DesignPts)
        library_branches = self._collect_tree_branches(LibraryPts)
        n = len(design_branches)
        m = len(library_branches)

        if n == 0:
            self._addWarning('DesignPts failed to collect data!')
            self.Component.Message = 'no design data'
            return __Results
        if m == 0:
            self._addWarning('LibraryPts failed to collect data!')
            self.Component.Message = 'no library data'
            return __Results
        if n > m:
            self._addError(
                'Number of DesignPts needs to be smaller than number of '
                'LibraryPts!'
            )
            return __Results

        dim = len(design_branches[0])
        if dim == 0:
            self._addError('DesignPts branches are empty')
            return __Results

        for i, b in enumerate(design_branches):
            if len(b) != dim:
                self._addError(
                    f'DesignPts branch #{i} has dimension {len(b)}; '
                    f'expected {dim}.'
                )
                return __Results
        for j, b in enumerate(library_branches):
            if len(b) != dim:
                self._addError(
                    f'LibraryPts branch #{j} has dimension {len(b)}; '
                    f'expected {dim}.'
                )
                return __Results

        if not Weights or len(Weights) == 0:
            weights = np.ones(dim, dtype=np.float64)
        else:
            if len(Weights) != dim:
                self._addError(
                    f'Weights length ({len(Weights)}) does not match point '
                    f'dimension ({dim}).'
                )
                return __Results
            weights = np.asarray([float(w) for w in Weights], dtype=np.float64)

        algorithm = self._normalize_algorithm(Algorithm)
        if algorithm is None:
            self._addError(
                "Invalid Algorithm value. Use 'greedy' or 'hungarian'."
            )
            return __Results

        if ScaleFactor is None:
            ScaleFactor = 1e3
        try:
            scale_factor = float(ScaleFactor)
        except (TypeError, ValueError):
            self._addError(f'ScaleFactor must be numeric, got {ScaleFactor!r}')
            return __Results
        if not np.isfinite(scale_factor) or scale_factor <= 0.0:
            self._addError(f'ScaleFactor must be > 0, got {scale_factor}')
            return __Results

        try:
            real_costs = self._build_cost_matrices(
                design_branches, library_branches, weights
            )
            if algorithm == 'hungarian':
                assignment = self._run_hungarian(real_costs, scale_factor)
                self.Component.Message = 'Hungarian Algorithm'
            else:
                assignment = self._run_greedy(real_costs)
                self.Component.Message = 'Greedy Algorithm'
        except Exception as exc:
            self._addError(f'Assignment failed: {exc}')
            return __Results

        for i in range(n):
            path = Grasshopper.Kernel.Data.GH_Path(i)
            j = int(assignment[i])
            Assignment.Add(j, path)
            Cost.Add(float(real_costs[i, j]), path)

        self._addRemark(
            f'Assigned {n} design points to {m} library points using '
            f'{algorithm}.'
        )
        return __Results
# ---------- end assignmentpoints ----------
assignment = Data(assignmentpoints.Assignment)
panel_21 = Panel(assignment)

# ----
# comments & notes: Apply (inverse) PCA Frame to Component and store the transformation in iframe aswell!
geometry_6 = Data(geometry_5)
applypcaframe = ApplyPCAFrame(Input=geometry_6)  # -> Output
# ---------- applypcaframe: Python ----------
#! python3
# -*- coding: utf-8 -*-
# venv: DDU_CSC
print('ENV OK!')
# r: charset_normalizer
# r: requests

# PYTHON STANDARD LIBRARY IMPORTS ---------------------------------------------
import json  # NOQA

# RHINO AND GH RELATED IMPORTS ------------------------------------------------
import System  # NOQA
import Rhino  # NOQA
import Grasshopper  # NOQA

# GHENV COMPONENT SETTINGS ----------------------------------------------------
ghenv.Component.Name = 'ApplyPCAFrame'  # NOQA
ghenv.Component.NickName = 'ApplyPCAFrame'  # NOQA
ghenv.Component.Category = 'DDU_CSC'  # NOQA
ghenv.Component.SubCategory = '3 Component Operations'  # NOQA
ghenv.Component.Description = (  # NOQA
    'Applies an inverse PCA transformation to align geometry or passport data '
    'with the world coordinate system. Takes either passport JSON '
    '({identity, snapshots[]}) or Rhino geometry and transforms it to align '
    'with the world XY plane using the snapshot pca_frame.'
)


class CSC_ApplyPCAFrame(Grasshopper.Kernel.GH_ScriptInstance):
    """
    Author: Max Benjamin Eschenbach
    License: MIT License
    Version: 260908
    """

    def __init__(self):
        """Initialize this component and set component parameters."""
        super().__init__()
        # initialize props
        self.Component = ghenv.Component  # NOQA
        self.InputParams = self.Component.Params.Input
        self.OutputParams = self.Component.Params.Output

    def _addRemark(self, msg: str = ''):
        """Add a remark message to the component."""
        rml = self.Component.RuntimeMessageLevel.Remark
        self.AddRuntimeMessage(rml, msg)

    def _addWarning(self, msg: str = ''):
        """Add a warning message to the component."""
        rml = self.Component.RuntimeMessageLevel.Warning
        self.AddRuntimeMessage(rml, msg)

    def _addError(self, msg: str = ''):
        """Add an error message to the component."""
        rml = self.Component.RuntimeMessageLevel.Error
        self.AddRuntimeMessage(rml, msg)

    def BeforeRunScript(self):
        """Perform some setup actions."""
        # Initialize input param descriptions
        self.InputParams[0].Description = (
            'Passport JSON string ({identity, snapshots[]}) '
            'or geometry objects with the \'csc_component\' passport userdata'
        )
        # Set "No type hint"
        self.InputParams[0].TypeHints.Select(System.Object)
        self.Component.VariableParameterMaintenance()
        # Initialize output param descriptions
        i = 0
        if self.OutputParams[0].Name == 'out':
            i += 1
        self.OutputParams[0+i].Description = (
            'Transformed passport JSON (if input was JSON) or '
            'transformed geometry with updated passport userdata '
            '(if input was geometry)'
        )

    def PlaneToFrameDict(self, plane: Rhino.Geometry.Plane) -> dict:
        """
        Convert a Rhino plane to a frame dictionary format.

        Args:
            plane: Rhino.Geometry.Plane object

        Returns:
            Dictionary with 'o', 'x', 'y', 'z' keys containing coordinate lists
        """
        iframe = {
            'o': [plane.OriginX, plane.OriginY, plane.OriginZ],
            'x': [plane.XAxis.X, plane.XAxis.Y, plane.XAxis.Z],
            'y': [plane.YAxis.X, plane.YAxis.Y, plane.YAxis.Z],
            'z': [plane.ZAxis.X, plane.ZAxis.Y, plane.ZAxis.Z]
        }
        return iframe

    def FrameDictToPlane(self, frame_dict: dict) -> Rhino.Geometry.Plane:
        """
        Convert a frame dictionary to a Rhino plane.

        Args:
            frame_dict: Dictionary with 'o', 'x', 'y' keys

        Returns:
            Rhino.Geometry.Plane object
        """
        origin = Rhino.Geometry.Point3d(*frame_dict.get('o', [0, 0, 0]))
        x_axis = Rhino.Geometry.Vector3d(*frame_dict.get('x', [1, 0, 0]))
        y_axis = Rhino.Geometry.Vector3d(*frame_dict.get('y', [0, 1, 0]))
        return Rhino.Geometry.Plane(origin, x_axis, y_axis)

    def normalize_passport(self, passport):
        """
        Normalize passport input to canonical {identity, snapshots[]}.

        Accepts legacy {identity, snapshot} payloads.
        """
        if not isinstance(passport, dict):
            return None
        identity = passport.get('identity') or {}
        snapshots = passport.get('snapshots') or []
        if snapshots and isinstance(snapshots[0], dict):
            return {'identity': identity, 'snapshots': list(snapshots)}
        legacy = passport.get('snapshot')
        if isinstance(legacy, dict):
            return {'identity': identity, 'snapshots': [legacy]}
        return None

    def extract_component_data_from_geometry(self, geometry):
        """
        Extract passport data ({identity, snapshots[]}) from geometry userdata.

        Args:
            geometry: Rhino geometry object with userdata

        Returns:
            Passport dictionary or None
        """
        try:
            userdata = geometry.GetUserString('csc_component')
            if userdata:
                return json.loads(userdata)
        except Exception as e:
            self._addWarning(f'Could not extract passport data: {str(e)}')
        return None

    def apply_pca_transform_to_geometry(self, geometry, pca_transform):
        """
        Apply PCA transform to geometry object.

        Args:
            geometry: Rhino geometry object
            pca_transform: Rhino transform

        Returns:
            Transformed geometry object
        """
        try:
            if hasattr(geometry, 'Transform'):
                geometry.Transform(pca_transform)
            elif hasattr(geometry, 'Duplicate'):
                # For objects that don't support Transform directly
                transformed_geometry = geometry.Duplicate()
                transformed_geometry.Transform(pca_transform)
                return transformed_geometry
        except Exception as e:
            self._addWarning(f'Could not transform geometry: {str(e)}')
        return geometry

    def RunScript(self, Input):
        # Set up output tree
        Output = Grasshopper.DataTree[System.Object]()

        # Validate input
        if not Input:
            msg = 'Input failed to collect data!'
            self._addWarning(msg)
            self.Component.Message = msg
            return Output

        try:
            self.Component.Message = 'Processing input...'

            # Determine input type and extract passport data
            passport = None
            geometry_objects = []
            input_is_geometry = False

            # Check if input is a passport JSON string
            if isinstance(Input, str):
                try:
                    passport = json.loads(Input)
                    self._addRemark('Input detected as passport JSON')
                except json.JSONDecodeError:
                    msg = 'Input is not valid passport JSON!'
                    self._addError(msg)
                    self.Component.Message = msg
                    return Output
            else:
                # Input is geometry - extract passport data from userdata
                input_is_geometry = True
                geometry_objects = (Input if isinstance(Input, list)
                                    else [Input])

                # Try to extract passport data from first geometry object
                passport = self.extract_component_data_from_geometry(
                    geometry_objects[0])
                if not passport:
                    msg = ('Could not extract passport data from '
                           'geometry userdata!')
                    self._addError(msg)
                    self.Component.Message = msg
                    return Output

                passport = self.extract_component_data_from_geometry(
                    geometry_objects[0])
                if not passport:
                    msg = ('Could not extract passport data from '
                           'geometry userdata!')
                    self._addError(msg)
                    self.Component.Message = msg
                    return Output

                self._addRemark('Input detected as geometry with '
                                'passport userdata')

            passport = self.normalize_passport(passport)
            if not passport:
                msg = 'Passport JSON is missing identity/snapshots!'
                self._addError(msg)
                self.Component.Message = msg
                return Output

            snapshots = passport.get('snapshots') or []
            snapshot = snapshots[0] if snapshots else None
            if not isinstance(snapshot, dict):
                msg = 'Passport JSON has no snapshots!'
                self._addError(msg)
                self.Component.Message = msg
                return Output

            # Extract PCA frame from the snapshot
            try:
                pca_frame = snapshot['pca_frame']
                pca_plane = self.FrameDictToPlane(pca_frame)

                # Create inverse PCA transform (from PCA space to world space)
                pca_transform = Rhino.Geometry.Transform.PlaneToPlane(
                    pca_plane, Rhino.Geometry.Plane.WorldXY)

                self._addRemark('PCA frame found, creating inverse transform')
            except KeyError:
                msg = 'Snapshot does not contain pca_frame!'
                self._addError(msg)
                self.Component.Message = msg
                return Output

            # Default identity frame
            DEFAULT_FRAME = {
                'o': [0.0, 0.0, 0.0],
                'x': [1.0, 0.0, 0.0],
                'y': [0.0, 1.0, 0.0],
                'z': [0.0, 0.0, 1.0]
            }

            # Build transformed passport; update primary snapshot only
            transformed_snapshot = dict(snapshot)
            snapshots_out = list(snapshots)
            snapshots_out[0] = transformed_snapshot
            transformed_passport = {
                'identity': passport.get('identity'),
                'snapshots': snapshots_out,
            }

            # Update iframe to preserve translation but update orientation
            try:
                # Get existing iframe or create default
                original_iframe = transformed_snapshot.get(
                    'iframe', DEFAULT_FRAME)

                # Convert iframe to plane
                iframe_plane = self.FrameDictToPlane(original_iframe)

                # Apply the SAME transformations to the iframe plane that we
                # apply to the geometry
                # For JSON input, just apply inverse PCA
                if not input_is_geometry:
                    iframe_plane.Transform(pca_transform)
                    transformed_snapshot['iframe'] = (
                        self.PlaneToFrameDict(iframe_plane))

                self._addRemark('Updated iframe with PCA orientation')
            except Exception as e:
                self._addWarning(f'Could not update iframe: {str(e)}')

            # Handle output based on input type
            if input_is_geometry:
                # For geometry input, we need to:
                # 1. Transform back to original space (inverse iframe)
                # 2. Apply PCA transformation
                # 3. Apply iframe transformation again
                try:
                    # Get the original iframe
                    original_iframe = snapshot.get('iframe', DEFAULT_FRAME)

                    # Convert iframe to plane
                    iframe_plane = self.FrameDictToPlane(original_iframe)

                    # Create iframe transform (from original space to world
                    # space)
                    iframe_transform = (
                        Rhino.Geometry.Transform.PlaneToPlane(
                            Rhino.Geometry.Plane.WorldXY, iframe_plane))

                    # Create inverse iframe transform (from world space to
                    # original space)
                    inverse_iframe_transform = (
                        Rhino.Geometry.Transform.PlaneToPlane(
                            iframe_plane, Rhino.Geometry.Plane.WorldXY))

                    # Apply the SAME transformations to the iframe plane that
                    # we apply to the geometry
                    compound_iframe_plane = self.FrameDictToPlane(
                        original_iframe)
                    compound_iframe_plane.Transform(inverse_iframe_transform)
                    compound_iframe_plane.Transform(pca_transform)

                    # Update the snapshot with the transformed iframe
                    transformed_snapshot['iframe'] = (
                        self.PlaneToFrameDict(compound_iframe_plane))

                    # Transform geometry objects: inverse iframe -> PCA ->
                    # iframe
                    for geometry in geometry_objects:
                        # Step 1: Transform back to original space
                        geometry.Transform(inverse_iframe_transform)

                        # Step 2: Apply PCA transformation
                        transformed_geometry = (
                            self.apply_pca_transform_to_geometry(
                                geometry, pca_transform))

                        # Step 3: Apply iframe transformation again
                        transformed_geometry.Transform(iframe_transform)

                        # Update userdata with transformed passport data
                        if hasattr(transformed_geometry, 'SetUserString'):
                            transformed_geometry.SetUserString(
                                'csc_component',
                                json.dumps(transformed_passport))
                        Output = transformed_geometry

                    self._addRemark(f'Transformed {len(geometry_objects)} '
                                    'geometry objects with PCA and iframe')
                except Exception as e:
                    self._addWarning(
                        f'Could not apply iframe transform: {str(e)}')
                    # Fallback to just PCA transformation
                    for geometry in geometry_objects:
                        transformed_geometry = (
                            self.apply_pca_transform_to_geometry(
                                geometry, pca_transform))

                        if hasattr(transformed_geometry, 'SetUserString'):
                            transformed_geometry.SetUserString(
                                'csc_component',
                                json.dumps(transformed_passport))

                        Output = transformed_geometry
                    self._addRemark(f'Transformed {len(geometry_objects)} '
                                    'geometry objects with PCA only')
            else:
                # Output transformed passport data as JSON
                Output = json.dumps(transformed_passport)
                self._addRemark('Output transformed passport JSON')

            # Update success message
            if input_is_geometry:
                self.Component.Message = (
                    f'Successfully applied PCA frame to '
                    f'{len(geometry_objects)} geometry objects'
                )
            else:
                self.Component.Message = ('Successfully applied PCA frame '
                                          'to passport JSON')

            return Output

        except Exception as e:
            msg = f'Unexpected error: {str(e)}'
            self._addError(msg)
            self.Component.Message = msg
            return Output
# ---------- end applypcaframe ----------
preview = CustomPreview(
    Geometry=applypcaframe,
    Material={diffuse=RGB(221, 160, 221), emission=RGB(66, 48, 66), shine=0.5, specular=RGB(255, 255, 255), transparency=0})

# ---- group: __DDU_CSC_EXAMPLE_06__
# Step 6
# comments & notes: Finally, we use the assignment indices to get the assigned data tree branches from the catalog.
# 
# Then we use the inverse of our DesignShapes RestPosition transformation to transform the catalog shapes into the "best" orientation for the respective Design Shapes.
catalogshapes_profilecurves = Data(profilecurve)
assignment_2 = Data(assignment)
id_8 = Data(id_4)
tstat = TreeStatistics(Tree=catalogshapes_profilecurves)  # -> Paths, Length, Count
designshapes_restpositiontransform_2 = Data(designshapes_restpositiontransform)
tstat_2 = TreeStatistics(Tree=id_8)  # -> Paths, Length, Count
item_6 = ListItem(List=tstat.Paths, Index=assignment_2, Wrap=True)
item_7 = ListItem(List=tstat_2.Paths, Index=assignment_2, Wrap=True)
inverse = InverseTransform(Transform=designshapes_restpositiontransform_2)
branch = TreeBranch(Tree=catalogshapes_profilecurves, Path=item_6, MaintainPaths=True)
branch_2 = TreeBranch(Tree=id_8, Path=item_7, MaintainPaths=True)
ids_of_assigned_components = Panel(branch_2)
transform = Transform(Geometry=branch, Transform=inverse)
catalogshapes_atdesignshapelocation = Data(transform)
curvepreviewlw_3 = CurvePreviewLW(Curves=flatten(transform), Colors=ColourSwatch(SwatchColor=RGB(242, 0, 255)), Thickness=Slider(2, range=0..10))  # inputs Curves: list of Curve, Colors: list of Color, Thickness: list of Int32; same code as curvepreviewlw

# ---- group: __DDU_CSC_EXAMPLE_05__
# Step 6.1
# comments & notes: Compute t-SNE (t-Stochastic Nearest Neighbor Embedding). It is primarily a dimension-reduction technique for embedding multidimensional vectors (i.e. descriptors).
# 
# We can use this to visualize similarity between components (given a multidimensional descriptor).
descriptordata_5 = Data(descriptordata_3)
embeddingdimensions_2 = Data(embeddingdimensions)
computetsne = ComputeTSNE(
    Data=descriptordata_5,
    Components=embeddingdimensions_2,
    EarlyExaggeration=Slider(12, range=0..100),
    Method=Slider(1, range=0..1),
    RandomSeed=Slider(1234, range=0..100000000))  # -> EmbedddedData; inputs Data: tree of Double, Components: Int32, Perplexity: Int32, EarlyExaggeration: Double, LearningRate: Double, Iterations: Int32, Method: Int32, Initialization: Int32, RandomSeed: Int32
# ---------- computetsne: Python ----------
#! python3
# -*- coding: utf-8 -*-
# venv: DDU_CSC
print('ENV OK!')
# r: charset_normalizer
# r: requests
# r: numpy
# r: scipy
# r: scikit-learn

# PYTHON STANDARD LIBRARY IMPORTS ---------------------------------------------

# THIRD PARTY LIBRARY IMPORTS -------------------------------------------------
import numpy as np  # NOQA
from sklearn.manifold import TSNE  # NOQA

# RHINO AND GH RELATED IMPORTS ------------------------------------------------
import System  # NOQA
import Grasshopper  # NOQA
import Rhino  # NOQA

# GHENV COMPONENT SETTINGS ----------------------------------------------------
ghenv.Component.Name = 'ComputeTSNE'  # NOQA
ghenv.Component.NickName = 'ComputeTSNE'  # NOQA
ghenv.Component.Category = 'DDU_CSC'  # NOQA
ghenv.Component.SubCategory = '6 Data Tools'  # NOQA
ghenv.Component.Description = (  # NOQA
    'Computes T-distributed Stochastic Neighbor Embedding.'
)


class CSC_ComputeTSNE(Grasshopper.Kernel.GH_ScriptInstance):
    """
    Author: Max Benjamin Eschenbach
    License: MIT License
    Version: 260609
    """

    def __init__(self):
        """Initialize this component and set component parameters."""
        super().__init__()
        # initialize props
        self.Component = ghenv.Component  # NOQA
        self.InputParams = self.Component.Params.Input
        self.OutputParams = self.Component.Params.Output

    def _addRemark(self, msg: str = ''):
        """Add a remark message to the component."""
        rml = self.Component.RuntimeMessageLevel.Remark
        self.AddRuntimeMessage(rml, msg)

    def _addWarning(self, msg: str = ''):
        """Add a warning message to the component."""
        rml = self.Component.RuntimeMessageLevel.Warning
        self.AddRuntimeMessage(rml, msg)

    def _addError(self, msg: str = ''):
        """Add an error message to the component."""
        rml = self.Component.RuntimeMessageLevel.Error
        self.AddRuntimeMessage(rml, msg)

    def BeforeRunScript(self):
        """Perform some setup actions."""
        # Initialize input param descriptions
        self.InputParams[0].Description = (
            'Data to be reduced using t-SNE as a DataTree, where '
            'each Branch represents one DataPoint.'
        )
        self.InputParams[1].Description = (
            'Dimension of the embedded space.'
        )
        self.InputParams[2].Description = (
            'The perplexity is related to the number of nearest neighbors '
            'that are used in other manifold learning algorithms. '
            'Consider selecting a value between 5 and 50. Defaults to 30.'
        )
        self.InputParams[3].Description = (
            'Controls how tight natural clusters in the original space '
            'are in the embedded space and how much space will be '
            'between them.'
            'Defaults to 12.'
        )
        self.InputParams[4].Description = (
            'The learning rate for t-SNE is usually in the range '
            '(10.0, 1000.0).'
            'Defaults to 200.'
        )
        self.InputParams[5].Description = (
            'Maximum number of iterations for the optimization. '
            'Should be at least 250.'
            'Defaults to 1000.'
        )
        self.InputParams[6].Description = (
            'Barnes-Hut approximation (0) runs in O(NlogN) time. '
            'Exact method (1) will run on the slower, but exact, '
            'algorithm in O(N^2) time.'
            'Defaults to 0.'
        )
        self.InputParams[7].Description = (
            'Initialization method. Random (0) or PCA (1).'
            'Defaults to 0.'
        )
        self.InputParams[8].Description = (
            'Determines the random number generator. Pass an int for '
            'reproducible results across multiple function calls. '
            'Note that different initializations might result in '
            'different local minima of the cost function.'
            'Defaults to None.'
        )
        # Initialize output param descriptions
        i = 0
        if self.OutputParams[0].Name == 'out':
            i += 1
        self.OutputParams[0+i].Description = (
                'The transformed data as a DataTree, where each Branch '
                'represents one embeddedDataPoint.'
            )

    def RunScript(self,
            Data: Grasshopper.DataTree[float],
            Components: int,
            Perplexity: int,
            EarlyExaggeration: float,
            LearningRate: float,
            Iterations: int,
            Method: int,
            Initialization: int,
            RandomSeed: int):
        # set up output variables
        EmbedddedData = Grasshopper.DataTree[System.Object]()
        try:
            # sanitize input and abort if not present
            self.Component.Message = None
            if not Data or Data.DataCount == 0:
                msg = 'Input Data failed to collect data!'
                self._addWarning(msg)
                return EmbedddedData

            # set defaults for parameters if not provided
            if not Components:
                Components = 2
            if not Perplexity:
                Perplexity = 30
            if not EarlyExaggeration:
                EarlyExaggeration = 12.0
            if not LearningRate:
                LearningRate = 200.0
            if not Iterations:
                Iterations = 1000
            if not Method:
                Method = 0
            if not Initialization:
                Initialization = 0
            if not RandomSeed:
                RandomSeed = 0

            # convert method string
            if Method <= 0:
                method_str = "barnes_hut"
            else:
                method_str = "exact"
            if Initialization <= 0:
                init_str = "random"
            else:
                init_str = "pca"

            # convert all datatree branches to numpy array
            np_data = np.array([np.array(Data.Branch(p)) for p in Data.Paths])

            # initialize t-SNE solver class
            tsne = TSNE(n_components=Components,
                        perplexity=Perplexity,
                        early_exaggeration=EarlyExaggeration,
                        learning_rate=LearningRate,
                        n_iter=Iterations,
                        random_state=RandomSeed,
                        method=method_str,
                        init=init_str)

            # run t-SNE solver on incoming data
            tsne_result = tsne.fit_transform(np_data)

            # loop over all branches and add embedded data to output tree
            for i in range(len(Data.Branches)):
                EmbedddedData.AddRange(
                    [float(x) for x in tsne_result[i]],
                    Data.Paths[i]
                )

            # return output
            return EmbedddedData

        except Exception as e:
            msg = f'Unexpected error during t-SNE computation: {str(e)}'
            self._addError(msg)
            return EmbedddedData
# ---------- end computetsne ----------
embedddeddata = Data(computetsne)

# Step 6.2
# comments & notes: Use PCA (Principal Component Analysis) to reduce dimensions of a multidimensional vector (i.e. descriptor).
# 
# NOTE: This algorithm is deterministic and always yields the same results on the same input data!
descriptordata_6 = Data(descriptordata_4)
embeddingdimensions_3 = Data(embeddingdimensions)
computepca = ComputePCA(Data=descriptordata_6, Components=embeddingdimensions_3)  # -> EmbedddedData; inputs Data: tree of Double, Components: Int32
# ---------- computepca: Python ----------
#! python3
# -*- coding: utf-8 -*-
# venv: DDU_CSC
print('ENV OK!')
# r: charset_normalizer
# r: requests
# r: numpy
# r: scipy
# r: scikit-learn

# PYTHON STANDARD LIBRARY IMPORTS ---------------------------------------------

# THIRD PARTY LIBRARY IMPORTS -------------------------------------------------
import numpy as np  # NOQA
from sklearn.decomposition import PCA  # NOQA

# RHINO AND GH RELATED IMPORTS ------------------------------------------------
import System  # NOQA
import Grasshopper  # NOQA
import Rhino  # NOQA

# GHENV COMPONENT SETTINGS ----------------------------------------------------
ghenv.Component.Name = 'ComputePCA'  # NOQA
ghenv.Component.NickName = 'ComputePCA'  # NOQA
ghenv.Component.Category = 'DDU_CSC'  # NOQA
ghenv.Component.SubCategory = '6 Data Tools'  # NOQA
ghenv.Component.Description = (  # NOQA
    'Computes principal component analysis (PCA) for dimensionality reduction'
)


class CSC_ComputePCA(Grasshopper.Kernel.GH_ScriptInstance):
    """
    Author: Max Benjamin Eschenbach
    License: MIT License
    Version: 260609
    """

    def __init__(self):
        """Initialize this component and set component parameters."""
        super().__init__()
        # initialize props
        self.Component = ghenv.Component  # NOQA
        self.InputParams = self.Component.Params.Input
        self.OutputParams = self.Component.Params.Output

    def _addRemark(self, msg: str = ''):
        """Add a remark message to the component."""
        rml = self.Component.RuntimeMessageLevel.Remark
        self.AddRuntimeMessage(rml, msg)

    def _addWarning(self, msg: str = ''):
        """Add a warning message to the component."""
        rml = self.Component.RuntimeMessageLevel.Warning
        self.AddRuntimeMessage(rml, msg)

    def _addError(self, msg: str = ''):
        """Add an error message to the component."""
        rml = self.Component.RuntimeMessageLevel.Error
        self.AddRuntimeMessage(rml, msg)

    def BeforeRunScript(self):
        """Perform some setup actions."""
        # Initialize input param descriptions
        self.InputParams[0].Description = (
            'Data to be reduced using PCA as a DataTree, where '
            'each Branch represents one DataPoint.'
        )
        self.InputParams[1].Description = (
            'Dimension of the embedded space.'
        )
        # Initialize output param descriptions
        i = 0
        if self.OutputParams[0].Name == 'out':
            i += 1
        self.OutputParams[0+i].Description = (
                'The transformed data as a DataTree, where each Branch '
                'represents one embedded DataPoint.'
            )

    def RunScript(self, Data: Grasshopper.DataTree[float], Components: int):
        # set up output variables
        EmbedddedData = Grasshopper.DataTree[System.Object]()
        try:
            # sanitize input and abort if not present
            self.Component.Message = None
            if not Data or Data.DataCount == 0:
                msg = 'Input Data failed to collect data!'
                self._addWarning(msg)
                return EmbedddedData

            # set defaults for parameters if not provided
            if not Components:
                Components = 2

            # convert all datatree branches to numpy array
            np_data = np.array([np.array(Data.Branch(p)) for p in Data.Paths])

            # initialize t-SNE solver class
            data_reduced = PCA(n_components=Components).fit_transform(np_data)

            # loop over all branches and add embedded data to output tree
            for i in range(len(Data.Branches)):
                EmbedddedData.AddRange(
                    [float(x) for x in data_reduced[i]],
                    Data.Paths[i]
                )

            # return output
            return EmbedddedData

        except Exception as e:
            msg = f'Unexpected error during PCA computation: {str(e)}'
            self._addError(msg)
            return EmbedddedData
# ---------- end computepca ----------
embedddeddata_2 = Data(computepca)

# Step 6.3
# comments & notes: Here we just filter the output stream according to the user setting, then forward to visualization.
tsne_embedddeddata = Data(embedddeddata)
pca_embedddeddata = Data(embedddeddata_2)
t_sne_or_pca_2 = Data(t_sne_or_pca)
filter = StreamFilter(Gate=t_sne_or_pca_2, Stream0=tsne_embedddeddata, Stream1=pca_embedddeddata)
embedddeddata_3 = Data(filter)

# Step 7
# comments & notes: Visualize the Embeddings in 2D/3D space.
# 
# You may play with the scale factor to see different densities of clustering.
scalefactor = Slider(15000, range=1..50000)
embedddeddata_4 = Data(embedddeddata_3)
primitivegeometry_10 = Data(primitivegeometry_5)
visualizeembedding = VisualizeEmbedding(EmbeddedData=embedddeddata_4, Geometry=primitivegeometry_10, ScaleFactor=scalefactor)  # -> LayoutGeometry, LayoutPoints, Colors, XForm; inputs EmbeddedData: tree of Double, Geometry: tree, ScaleFactor: Double
# ---------- visualizeembedding: Python ----------
#! python3
# -*- coding: utf-8 -*-
# venv: DDU_CSC
print('ENV OK!')
# r: charset_normalizer
# r: requests
# r: numpy

# PYTHON STANDARD LIBRARY IMPORTS ---------------------------------------------

# THIRD PARTY LIBRARY IMPORTS -------------------------------------------------
import numpy as np  # NOQA

# RHINO AND GH RELATED IMPORTS ------------------------------------------------
import System  # NOQA
import System.Drawing  # NOQA
import Grasshopper  # NOQA
import Rhino  # NOQA

# GHENV COMPONENT SETTINGS ----------------------------------------------------
ghenv.Component.Name = 'VisualizeEmbedding'  # NOQA
ghenv.Component.NickName = 'VisualizeEmbedding'  # NOQA
ghenv.Component.Category = 'DDU_CSC'  # NOQA
ghenv.Component.SubCategory = '8 Visualization'  # NOQA
ghenv.Component.Description = (  # NOQA
    'Visualizes a low-dimensional embedding (e.g. from PCA or t-SNE) by '
    'placing the associated input geometry at its embedding coordinate. '
    'Supports 1D, 2D and 3D layouts; when the embedding has more than 3 '
    'dimensions the remaining dimensions (4, 5, 6) are mapped to RGB colour '
    'channels. Each embedding dimension is min-max normalised to '
    '[0, ScaleFactor] per axis so the whole layout fits within the given '
    'extent.'
)

_EPS: float = 1e-12


def _minmax_normalise(values: np.ndarray) -> np.ndarray:
    """Column-wise min-max normalise a (N, D) array to [0, 1].

    Columns whose range is below ``_EPS`` collapse to 0.5 (centre) so the
    layout does not explode along a constant axis.
    """
    V = np.asarray(values, dtype=np.float64)
    if V.ndim != 2:
        raise ValueError(
            f'expected a 2D (N, D) array, got shape {V.shape}'
        )
    v_min = V.min(axis=0)
    v_max = V.max(axis=0)
    v_range = v_max - v_min

    out = np.empty_like(V)
    for d in range(V.shape[1]):
        if v_range[d] < _EPS:
            out[:, d] = 0.5
        else:
            out[:, d] = (V[:, d] - v_min[d]) / v_range[d]
    return out


def _embedding_to_layout(values: np.ndarray, scale: float):
    """
    Map a (N, D) embedding to layout points and optional RGB colours.

    Returns:
        points: (N, 3) float array in world units
        colors: (N, 3) uint8 array in [0, 255] (RGB)
        dims_used_pos: int, how many embedding dims were used for position
        dims_used_col: int, how many embedding dims were used for colour
    """
    normed = _minmax_normalise(values)
    n, d = normed.shape

    points = np.zeros((n, 3), dtype=np.float64)
    dims_used_pos = min(d, 3)
    for ax in range(dims_used_pos):
        points[:, ax] = normed[:, ax] * float(scale)

    colors = np.full((n, 3), 128, dtype=np.int32)
    dims_used_col = max(0, min(d - 3, 3))
    for ch in range(dims_used_col):
        colors[:, ch] = np.clip(
            np.round(normed[:, 3 + ch] * 255.0), 0, 255
        ).astype(np.int32)

    return points, colors, dims_used_pos, dims_used_col


def _geometry_bbox(geometry):
    """
    Return the world-aligned bounding box of a piece of geometry, or
    ``None`` if one cannot be computed.
    """
    if geometry is None:
        return None

    if hasattr(geometry, 'GetBoundingBox'):
        bbox = geometry.GetBoundingBox(True)
        if bbox is not None and bbox.IsValid:
            return bbox

    if isinstance(geometry, Rhino.Geometry.Point3d):
        return Rhino.Geometry.BoundingBox(geometry, geometry)

    return None


def _branch_anchor(geometries) -> Rhino.Geometry.Point3d:
    """
    Return the combined bounding-box centre of all geometries in a branch.

    All valid items in the branch contribute to one union bounding box;
    the centre of that union is used as the shared anchor so every
    geometry in the branch receives the same translation and their
    relative arrangement is preserved.
    """
    union = Rhino.Geometry.BoundingBox.Empty
    any_valid = False
    for geo in geometries:
        bbox = _geometry_bbox(geo)
        if bbox is None:
            continue
        union.Union(bbox)
        any_valid = True

    if not any_valid or not union.IsValid:
        raise ValueError(
            'cannot determine an anchor point: no geometry in branch '
            'has a valid bounding box'
        )
    return union.Center


class CSC_VisualizeEmbedding(Grasshopper.Kernel.GH_ScriptInstance):
    """
    Author: Max Benjamin Eschenbach
    License: MIT License
    Version: 260609
    """

    def __init__(self):
        """Initialize this component and set component parameters."""
        super().__init__()
        self.Component = ghenv.Component  # NOQA
        self.InputParams = self.Component.Params.Input
        self.OutputParams = self.Component.Params.Output

    def _addRemark(self, msg: str = ''):
        rml = self.Component.RuntimeMessageLevel.Remark
        self.AddRuntimeMessage(rml, msg)

    def _addWarning(self, msg: str = ''):
        rml = self.Component.RuntimeMessageLevel.Warning
        self.AddRuntimeMessage(rml, msg)

    def _addError(self, msg: str = ''):
        rml = self.Component.RuntimeMessageLevel.Error
        self.AddRuntimeMessage(rml, msg)

    def BeforeRunScript(self):
        """Describe inputs & outputs."""
        self.InputParams[0].Description = (
            'Embedded data as a DataTree where each branch represents one '
            'embedded datapoint and its items are the coordinates in the '
            'embedding space (e.g. output of ComputePCA or ComputeTSNE). '
            'Supports any number of dimensions; dimensions beyond the third '
            'are mapped to RGB colour channels.'
        )
        self.InputParams[1].Description = (
            'Geometry to place in the layout as a DataTree. One branch '
            'represents one datapoint; each branch may contain one or '
            'more geometries that are translated together as a rigid '
            'group (sharing a combined bounding-box anchor). Branch order '
            'must match the branch order of EmbeddedData.'
        )
        self.InputParams[2].Description = (
            'Total extent of the layout in world units. Each embedding '
            'dimension is min-max normalised to [0, ScaleFactor] before '
            'being used as a world-space coordinate. Default: 1000.0.'
        )

        # Output descriptions -- skip the hidden "out" param if present.
        i = 1 if self.OutputParams[0].Name == 'out' else 0
        self.OutputParams[0 + i].Description = (
            'Input geometry translated from its bounding-box centre to the '
            'corresponding embedding point in world coordinates.'
        )
        self.OutputParams[1 + i].Description = (
            'Embedding points in world coordinates, one per datapoint. '
            'For 1D embeddings Y = Z = 0; for 2D embeddings Z = 0.'
        )
        self.OutputParams[2 + i].Description = (
            'Per-datapoint RGB colour derived from embedding dimensions '
            '4, 5 and 6 (if present), each normalised to [0, 255]. Missing '
            'channels default to 128 (mid-grey), so low-dimensional '
            'embeddings still produce a usable colour output.'
        )
        self.OutputParams[3 + i].Description = (
            'The translation transform applied to each input geometry '
            '(useful to transform additional geometry into the same layout).'
        )

    def RunScript(self,
            EmbeddedData: Grasshopper.DataTree[float],
            Geometry: Grasshopper.DataTree[object],
            ScaleFactor: float):

        # init outputs
        LayoutGeometry = Grasshopper.DataTree[System.Object]()
        LayoutPoints = Grasshopper.DataTree[System.Object]()
        Colors = Grasshopper.DataTree[System.Object]()
        XForm = Grasshopper.DataTree[System.Object]()
        __Results = (LayoutGeometry, LayoutPoints, Colors, XForm)

        self.Component.Message = None

        # input validation
        if EmbeddedData is None or EmbeddedData.DataCount == 0:
            msg = 'EmbeddedData failed to collect data!'
            self._addWarning(msg)
            self.Component.Message = msg
            return __Results

        if Geometry is None or Geometry.DataCount == 0:
            msg = 'Geometry failed to collect data!'
            self._addWarning(msg)
            self.Component.Message = msg
            return __Results

        if ScaleFactor is None:
            ScaleFactor = 1000.0
        try:
            ScaleFactor = float(ScaleFactor)
        except (TypeError, ValueError):
            self._addError(
                f'ScaleFactor must be a number, got {ScaleFactor!r}')
            return __Results
        if not np.isfinite(ScaleFactor) or ScaleFactor <= 0.0:
            self._addError(
                f'ScaleFactor must be > 0, got {ScaleFactor}')
            return __Results

        # collect embedding values into a dense (N, D) array
        paths = list(EmbeddedData.Paths)
        branches = [list(EmbeddedData.Branch(p)) for p in paths]
        n_points = len(branches)

        if n_points < 2:
            self._addError(
                f'Need at least 2 embedded datapoints to build a layout, '
                f'got {n_points}'
            )
            return __Results

        dims = [len(b) for b in branches]
        n_dims = max(dims) if dims else 0
        if n_dims < 1:
            self._addError('EmbeddedData branches are empty')
            return __Results
        if min(dims) != n_dims:
            self._addWarning(
                f'EmbeddedData branches have non-uniform dimensionality '
                f'(min={min(dims)}, max={n_dims}); missing values will be '
                f'treated as 0.0'
            )

        values = np.zeros((n_points, n_dims), dtype=np.float64)
        for i, b in enumerate(branches):
            for j, v in enumerate(b):
                try:
                    values[i, j] = float(v)
                except (TypeError, ValueError):
                    values[i, j] = 0.0

        # Collect geometry branches; each branch == one datapoint
        geo_paths = list(Geometry.Paths)
        geo_branches = [list(Geometry.Branch(p)) for p in geo_paths]
        n_geo = len(geo_branches)

        if n_geo != n_points:
            self._addWarning(
                f'Geometry branch count ({n_geo}) does not match '
                f'EmbeddedData branch count ({n_points}); the shorter of '
                f'the two will be used.'
            )
        n_use = min(n_points, n_geo)

        # Compute layout
        try:
            points, colors_rgb, dims_pos, dims_col = _embedding_to_layout(
                values, ScaleFactor
            )
        except ValueError as exc:
            self._addError(f'Could not compute layout: {exc}')
            return __Results

        # Emit per-datapoint results
        successes = 0
        rc = self.Component.RunCount - 1
        for i in range(n_use):
            path = Grasshopper.Kernel.Data.GH_Path(rc, i)
            branch = [g for g in geo_branches[i] if g is not None]

            if not branch:
                self._addWarning(
                    f'Datapoint #{i}: geometry branch is empty or all '
                    f'None; skipped')
                continue

            try:
                anchor = _branch_anchor(branch)
            except ValueError as exc:
                self._addWarning(
                    f'Datapoint #{i}: {exc}; skipped')
                continue

            target = Rhino.Geometry.Point3d(
                float(points[i, 0]),
                float(points[i, 1]),
                float(points[i, 2]),
            )
            translation = Rhino.Geometry.Vector3d(
                target.X - anchor.X,
                target.Y - anchor.Y,
                target.Z - anchor.Z,
            )
            xform = Rhino.Geometry.Transform.Translation(translation)

            moved_items = []
            for j, geo in enumerate(branch):
                try:
                    moved = (geo.Duplicate()
                             if hasattr(geo, 'Duplicate') else geo)
                    if hasattr(moved, 'Transform'):
                        moved.Transform(xform)
                    else:
                        self._addWarning(
                            f'Datapoint #{i}, item #{j}: geometry does '
                            f'not support Transform; emitting original '
                            f'geometry unchanged'
                        )
                    moved_items.append(moved)
                except Exception as exc:
                    self._addWarning(
                        f'Datapoint #{i}, item #{j}: transform failed '
                        f'({exc}); skipped')
                    continue

            if not moved_items:
                self._addWarning(
                    f'Datapoint #{i}: no item transformed successfully; '
                    f'skipped')
                continue

            color = System.Drawing.Color.FromArgb(
                255,
                int(colors_rgb[i, 0]),
                int(colors_rgb[i, 1]),
                int(colors_rgb[i, 2]),
            )

            LayoutGeometry.AddRange(moved_items, path)
            LayoutPoints.Add(target, path)
            Colors.Add(color, path)
            XForm.Add(xform, path)
            successes += 1

        if successes == 0:
            self._addWarning('No datapoints produced valid output')
            self.Component.Message = 'no output'
        else:
            parts = ['']
            if dims_pos == 1:
                parts = ['1D layout']
            elif dims_pos == 2:
                parts = ['2D layout']
            elif dims_pos == 3:
                parts = ['3D layout']
            if dims_col > 0:
                parts.append(f'+{dims_col}ch colour')
                self.Component.Message = ' | '.join(parts)
            else:
                self.Component.Message = parts[0]
            self._addRemark(
                f'Placed {successes} geometry object(s) using '
                f'{dims_pos} position dim(s) and {dims_col} colour dim(s) '
                f'out of {n_dims} embedding dim(s).'
            )

        return __Results
# ---------- end visualizeembedding ----------
preview_2 = CustomPreview(Geometry=visualizeembedding.LayoutGeometry, Material=visualizeembedding.Colors)

# ----
# comments & notes: Fetch DETAILED Geometry, either by ID, JSON String or Geometry (with userstring-attached json string)
# Step 3.2
componentdata_48 = Data(componentdata_24)

# ----
# comments & notes: DEVELOPMENT:
# RETRIEVING & FILTERING, VISUALIZING COMPONENTS
dispatch_2 = Dispatch(List=componentdata_48, DispatchPattern=tmatch)  # -> ListA, ListB

lng_2 = ListLength(List=flatten(dispatch_2.ListB))
random_2 = Random(Range=lng_2, Number=1, Seed=2, Integers=True)
item_8 = ListItem(List=flatten(dispatch_2.ListB), Index=random_2, Wrap=True)
random_componentdata = Data(item_8)
inputdata_2 = Data(random_componentdata)
fetchdetailedgeometry = FetchDetailedGeometry(Input=inputdata_2)  # -> Geometry, GeometryType, SnapshotID
# ---------- fetchdetailedgeometry: Python ----------
#! python3
# -*- coding: utf-8 -*-
# venv: DDU_CSC
print('ENV OK!')
# r: charset_normalizer
# r: requests

# PYTHON STANDARD LIBRARY IMPORTS ---------------------------------------------
import json  # NOQA

# THIRD PARTY LIBRARY IMPORTS -------------------------------------------------
import requests  # NOQA

# RHINO AND GH RELATED IMPORTS ------------------------------------------------
import System  # NOQA
import Grasshopper  # NOQA
import Rhino  # NOQA
import scriptcontext as sc  # NOQA
import Rhino.Geometry as rg  # NOQA

# GHENV COMPONENT SETTINGS ----------------------------------------------------
ghenv.Component.Name = 'FetchDetailedGeometry'  # NOQA
ghenv.Component.NickName = 'FetchDetailedGeometry'  # NOQA
ghenv.Component.Category = 'DDU_CSC'  # NOQA
ghenv.Component.SubCategory = '2 Catalog Interface'  # NOQA
ghenv.Component.Description = (  # NOQA
    'Fetches the detailed (high fidelity) snapshot geometry as binary PLY '
    'from the CSC API, with ETag caching.\n'
    'Input can be:\n'
    '- Geometry carrying the \'csc_component\' passport userstring\n'
    '- A passport JSON string ({identity, snapshots[]})\n'
    '- A raw identity_id (resolves the current snapshot)\n'
    '- A raw snapshot_id\n\n'
    'Falls back to reduced PLY, then to the inline snapshot geometry '
    '(primitive meshes), when no detailed PLY is available. Point clouds '
    'prefer the full PLY, then the inline preview.'
)


class CSC_FetchDetailedGeometry(Grasshopper.Kernel.GH_ScriptInstance):
    """
    Author: Max Benjamin Eschenbach
    License: MIT License
    Version: 260908
    """

    # Resolution preference chain (detailed, then reduced; inline otherwise)
    resolution_chain = ['detailed', 'reduced']
    # Point clouds: full PLY first, then the inline preview.
    fetch_point_cloud_ply = True

    def __init__(self):
        """Initialize this component and set component parameters."""
        super().__init__()
        # initialize props
        self.Component = ghenv.Component  # NOQA
        self.InputParams = self.Component.Params.Input
        self.OutputParams = self.Component.Params.Output

    def _addRemark(self, msg: str = ''):
        """Add a remark message to the component."""
        rml = self.Component.RuntimeMessageLevel.Remark
        self.AddRuntimeMessage(rml, msg)

    def _addWarning(self, msg: str = ''):
        """Add a warning message to the component."""
        rml = self.Component.RuntimeMessageLevel.Warning
        self.AddRuntimeMessage(rml, msg)

    def _addError(self, msg: str = ''):
        """Add an error message to the component."""
        rml = self.Component.RuntimeMessageLevel.Error
        self.AddRuntimeMessage(rml, msg)

    def BeforeRunScript(self):
        """Perform some setup actions."""
        # Initialize input param descriptions
        self.InputParams[0].Description = (
            'Input can be:\n'
            '- Geometry with the \'csc_component\' passport userstring\n'
            '- A passport JSON string ({identity, snapshots[]})\n'
            '- A raw identity_id (resolves current snapshot)\n'
            '- A raw snapshot_id'
        )
        # Initialize output param descriptions
        i = 0
        if self.OutputParams[0].Name == 'out':
            i += 1
        self.OutputParams[0+i].Description = (
            'Fetched detailed geometry as Rhino meshes and point clouds '
            '(one object per snapshot primitive)'
        )
        self.OutputParams[1+i].Description = (
            'Per-primitive source: detailed/reduced (mesh PLY), detailed '
            '(point-cloud PLY), or primitive (inline fallback)'
        )
        self.OutputParams[2+i].Description = (
            'Snapshot ID that was processed'
        )

    def get_auth_core_from_sticky(self):
        """Get AuthCore instance from sticky storage."""
        auth_core = sc.sticky.get('CSC_AuthCore')
        if auth_core is None:
            msg = ('No authentication found. Please use CSC_Session component '
                   'first.')
            self._addError(msg)
            self.Component.Message = msg
            return None
        return auth_core

    def parse_json_safe(self, value):
        """Parse a JSON string, returning None on failure."""
        try:
            return json.loads(value)
        except (json.JSONDecodeError, TypeError):
            return None

    def normalize_passport(self, obj):
        """
        Classify a parsed JSON object into canonical passport
        {identity, snapshots[]}, or None.
        """
        if not isinstance(obj, dict):
            return None
        identity = obj.get('identity') or {}
        snaps = obj.get('snapshots') or []
        if snaps and isinstance(snaps[0], dict):
            return {'identity': identity, 'snapshots': snaps}
        snap = obj.get('snapshot')
        if isinstance(snap, dict):
            return {'identity': identity, 'snapshots': [snap]}
        # Bare snapshot document
        if 'geometry' in obj and 'identity_id' in obj:
            return {'identity': {}, 'snapshots': [obj]}
        return None

    def primary_snapshot(self, passport):
        """Return the snapshot row used for geometry fetch."""
        if not isinstance(passport, dict):
            return None
        snaps = passport.get('snapshots') or []
        if snaps and isinstance(snaps[0], dict):
            return snaps[0]
        return None

    def fetch_passport_by_identity(self, auth_core, identity_id):
        """Fetch {identity, snapshots[]} for an identity's current snapshot."""
        try:
            resp = auth_core.cached_get_passport(identity_id)
            if resp.status_code == 200:
                return auth_core.normalize_passport_output(resp.json())
        except Exception as e:
            self._addWarning(f'Identity passport fetch failed: {str(e)}')
        return None

    def fetch_passport_by_snapshot(self, auth_core, snapshot_id):
        """Build minimal passport from a bare snapshot document."""
        try:
            resp = auth_core.authorized_get(f'/snapshots/{snapshot_id}')
            if resp.status_code == 200:
                return {'identity': {}, 'snapshots': [resp.json()]}
        except Exception as e:
            self._addWarning(f'Snapshot fetch failed: {str(e)}')
        return None

    def resolve_passport(self, auth_core, Input):
        """
        Resolve the input into canonical passport {identity, snapshots[]}.
        Returns (passport_or_None, input_is_geometry).
        """
        input_is_geometry = isinstance(Input, rg.GeometryBase)

        # Geometry carrying the passport userstring
        if (hasattr(Input, 'UserStringCount') and
                Input.UserStringCount > 0):
            value = Input.GetUserString('csc_component')
            if value:
                passport = self.normalize_passport(
                    self.parse_json_safe(value))
                if passport:
                    return passport, input_is_geometry

        # String input: passport JSON, identity doc, or raw UUID
        if isinstance(Input, str):
            s = Input.strip()
            obj = self.parse_json_safe(s)
            if obj is not None:
                passport = self.normalize_passport(obj)
                if passport:
                    return passport, input_is_geometry
                # Identity document with a current snapshot pointer
                if (isinstance(obj, dict) and obj.get('_id') and
                        obj.get('current_snapshot_id')):
                    passport = self.fetch_passport_by_identity(
                        auth_core, obj['_id'])
                    if passport:
                        return passport, input_is_geometry
                return None, input_is_geometry
            # Not JSON: treat as a raw UUID (identity first, then snapshot)
            if auth_core.validate_uuid(s):
                passport = self.fetch_passport_by_identity(auth_core, s)
                if passport:
                    return passport, input_is_geometry
                passport = self.fetch_passport_by_snapshot(auth_core, s)
                if passport:
                    return passport, input_is_geometry

        return None, input_is_geometry

    def build_inline_mesh(self, mesh_data, default_color):
        """Build a Rhino mesh from an inline SnapshotMesh (Rhino Z-up)."""
        vertices = mesh_data.get('vertices')
        faces = mesh_data.get('faces')
        if not vertices or not faces:
            return None
        mesh = rg.Mesh()
        for v in vertices:
            mesh.Vertices.Add(float(v[0]), float(v[1]), float(v[2]))
        for f in faces:
            if len(f) == 3:
                mesh.Faces.AddFace(f[0], f[1], f[2])
            elif len(f) == 4:
                mesh.Faces.AddFace(f[0], f[1], f[2], f[3])
        colors = mesh_data.get('colors')
        if colors and len(colors) == len(vertices):
            for c in colors:
                mesh.VertexColors.Add(int(c[0]), int(c[1]), int(c[2]))
        elif default_color:
            try:
                r, g, b = default_color
                for _ in range(len(vertices)):
                    mesh.VertexColors.Add(int(r), int(g), int(b))
            except (ValueError, TypeError):
                pass
        mesh.Normals.ComputeNormals()
        mesh.Compact()
        return mesh

    def iframe_xform(self, snapshot):
        """Build the world->iframe transform from the snapshot iframe."""
        iframe = snapshot.get('iframe')
        if not iframe:
            return None
        try:
            plane = rg.Plane(
                rg.Point3d(*iframe['o']),
                rg.Vector3d(*iframe['x']),
                rg.Vector3d(*iframe['y']),
            )
            return rg.Transform.PlaneToPlane(rg.Plane.WorldXY, plane)
        except (KeyError, TypeError):
            return None

    def fetch_primitive_meshes(self, auth_core, snapshot):
        """
        Fetch one mesh per snapshot mesh primitive, preferring the PLY
        resolution chain and falling back to inline geometry.
        Returns a list of (mesh, source) tuples.
        """
        snapshot_id = snapshot.get('_id')
        geometry = snapshot.get('geometry', {}) or {}
        inline_meshes = geometry.get('meshes', []) or []
        res_map = snapshot.get('mesh_ply_resolutions', {}) or {}
        default_color = snapshot.get('color') or [110, 110, 110]

        results = []
        for i in range(len(inline_meshes)):
            available = res_map.get(str(i), []) or []
            mesh = None
            source = None
            for resolution in self.resolution_chain:
                if resolution in available:
                    m, _etag, _from_cache = (
                        auth_core.cached_get_snapshot_mesh(
                            snapshot_id, i, resolution)
                    )
                    if m is not None:
                        mesh = m
                        source = resolution
                        break
            if mesh is None:
                mesh = self.build_inline_mesh(inline_meshes[i], default_color)
                source = 'primitive'
            if mesh is not None:
                results.append((mesh, source))
        return results

    def build_inline_point_cloud(self, pc_data):
        """Build a Rhino point cloud from one inline SnapshotPointCloud."""
        if not isinstance(pc_data, dict):
            return None
        pts = pc_data.get('points', []) or []
        if not pts:
            return None
        cloud = rg.PointCloud()
        colors = pc_data.get('colors')
        if colors and len(colors) == len(pts):
            for p, c in zip(pts, colors):
                cloud.Add(
                    rg.Point3d(float(p[0]), float(p[1]), float(p[2])),
                    System.Drawing.Color.FromArgb(*[int(v) for v in c]),
                )
        else:
            for p in pts:
                cloud.Add(rg.Point3d(float(p[0]), float(p[1]), float(p[2])))
        return cloud if cloud.Count > 0 else None

    def fetch_primitive_point_clouds(self, auth_core, snapshot):
        """
        Fetch one point cloud per snapshot primitive.

        FetchReduced uses the inline preview only (no reduced PLY exists).
        FetchDetailed prefers the full PLY, then the inline preview.
        Returns a list of (cloud, source) tuples.
        """
        geometry = snapshot.get('geometry', {}) or {}
        inline_pcs = geometry.get('point_clouds', []) or []
        snapshot_id = snapshot.get('_id')
        results = []
        for i in range(len(inline_pcs)):
            cloud = None
            source = None
            if self.fetch_point_cloud_ply and auth_core and snapshot_id:
                try:
                    cloud = auth_core.cached_get_snapshot_point_cloud(
                        snapshot_id, i)
                    if cloud is not None:
                        source = 'detailed'
                except Exception as e:
                    self._addWarning(
                        'Point cloud PLY fetch failed '
                        f'for index {i}: {str(e)}')
            if cloud is None:
                cloud = self.build_inline_point_cloud(inline_pcs[i])
                source = 'primitive'
            if cloud is not None:
                results.append((cloud, source))
        return results

    def collect_fetched_geometry(self, auth_core, snapshot):
        """
        Return meshes then point clouds as
        (geometry, source, kind, index) tuples.
        """
        items = []
        for i, (mesh, source) in enumerate(
                self.fetch_primitive_meshes(auth_core, snapshot)):
            items.append((mesh, source, 'mesh', i))
        for i, (cloud, source) in enumerate(
                self.fetch_primitive_point_clouds(auth_core, snapshot)):
            items.append((cloud, source, 'point_cloud', i))
        return items

    def select_fetched_geometry(self, Input, input_is_geometry, items):
        """
        If the input geometry carries a primitive index, return only that
        primitive of the matching kind.
        """
        if not (input_is_geometry and hasattr(Input, 'GetUserString')):
            return items
        if isinstance(Input, rg.PointCloud):
            raw = Input.GetUserString('csc_point_cloud_index')
            if raw:
                try:
                    idx = int(raw)
                except (TypeError, ValueError):
                    return items
                filtered = [
                    item for item in items
                    if item[2] == 'point_cloud' and item[3] == idx
                ]
                return filtered or items
            return items
        raw = Input.GetUserString('csc_mesh_index')
        if raw:
            try:
                idx = int(raw)
            except (TypeError, ValueError):
                return items
            filtered = [
                item for item in items
                if item[2] == 'mesh' and item[3] == idx
            ]
            return filtered or items
        return items

    def RunScript(self, Input):
        # Get AuthCore instance from sticky storage
        auth_core = self.get_auth_core_from_sticky()
        if auth_core is None:
            return

        # Check if authentication is valid
        if not auth_core.is_valid():
            msg = ('Authentication expired. Please use CSC_Session '
                   'component to refresh.')
            self._addError(msg)
            self.Component.Message = msg
            return

        # Input validation
        if not Input:
            msg = 'Please provide input data.'
            self._addWarning(msg)
            self.Component.Message = msg
            return

        # Set up outputs
        GeometryData = System.Collections.Generic.List[System.Object]()
        GeometrySource = System.Collections.Generic.List[str]()
        SnapshotID = System.Collections.Generic.List[str]()
        __Results = (GeometryData, GeometrySource, SnapshotID)

        try:
            self.Component.Message = 'Processing input...'

            passport, input_is_geometry = self.resolve_passport(
                auth_core, Input)
            snapshot = self.primary_snapshot(passport)
            if not passport or not snapshot:
                msg = 'Could not resolve a snapshot from input.'
                self._addError(msg)
                self.Component.Message = msg
                return __Results
            snapshot_id = snapshot.get('_id')
            if not snapshot_id or not auth_core.validate_uuid(snapshot_id):
                msg = f'Snapshot ID <{snapshot_id}> is not a valid UUID!'
                self._addError(msg)
                self.Component.Message = msg
                return __Results

            self.Component.Message = (
                f'Fetching detailed geometry for snapshot {snapshot_id}...'
            )

            items = self.collect_fetched_geometry(auth_core, snapshot)
            if not items:
                msg = f'No geometry available for snapshot {snapshot_id}'
                self._addError(msg)
                self.Component.Message = msg
                return __Results

            # Apply the iframe transform to position geometry in the document
            xform = self.iframe_xform(snapshot)
            if xform is not None:
                for geom, _source, _kind, _idx in items:
                    geom.Transform(xform)

            passport_json = auth_core.passport_json_string(passport)
            for geom, _source, kind, idx in items:
                if hasattr(geom, 'SetUserString'):
                    geom.SetUserString('csc_component', passport_json)
                    if kind == 'mesh':
                        geom.SetUserString('csc_mesh_index', str(idx))
                    else:
                        geom.SetUserString(
                            'csc_point_cloud_index', str(idx))

            selected = self.select_fetched_geometry(
                Input, input_is_geometry, items)
            for geom, source, _kind, _idx in selected:
                GeometryData.Add(geom)
                GeometrySource.Add(source)

            SnapshotID.Add(snapshot_id)

            mesh_count = sum(
                1 for _g, _s, kind, _i in selected if kind == 'mesh')
            pc_count = sum(
                1 for _g, _s, kind, _i in selected
                if kind == 'point_cloud')
            self.Component.Message = (
                f'Fetched detailed geometry ({mesh_count} mesh(es), '
                f'{pc_count} point cloud(s)) for {snapshot_id}'
            )
            self._addRemark(
                f'Fetched detailed geometry ({mesh_count} mesh(es), '
                f'{pc_count} point cloud(s)) for snapshot {snapshot_id}'
            )

            return __Results

        except requests.exceptions.ConnectionError as e:
            msg = 'Cannot connect to server. Please check your connection.'
            self._addError(msg + f'\nFull Error: {str(e)}')
            self.Component.Message = msg

        except requests.exceptions.Timeout as e:
            msg = 'Request timeout. Server may be slow.'
            self._addError(msg + f'\nFull Error: {str(e)}')
            self.Component.Message = msg

        except requests.exceptions.RequestException as e:
            msg = f'Request error: {str(e)}'
            self._addError(msg)
            self.Component.Message = msg

        except Exception as e:
            msg = f'Unexpected error: {str(e)}'
            self._addError(msg)
            self.Component.Message = msg

        return __Results
# ---------- end fetchdetailedgeometry ----------
panel_22 = Panel(fetchdetailedgeometry.SnapshotID)
panel_23 = Panel(fetchdetailedgeometry.GeometryType)
geometry_7 = Data(fetchdetailedgeometry.Geometry)

# ----
# comments & notes: Get ComponentData from Geometry UserData
geometry_8 = Data(geometry_7)
getcomponentdata_2 = GetComponentData(Geometry=geometry_8)  # -> ComponentData; inputs Geometry: list of GeometryBase; same code as getcomponentdata
