# Grasshopper definition DDU_CSC_GrasshopperInterface_0.6.4.4.gh (Grasshopper 1.0.8)
# Copyright: 2025

sampleextrusiongeometry = Extrusion(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)
samplescanmarkerpoints = Point([Point(-88.93215678, -1125.011089, 0), Point(0, 0, 0), Point(-403.5884569, 465.9235145, 0)])
extrusionmeshmultitest = Mesh(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)
detailedmeshgeometry = Geometry(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)
samplemarkerpoints = Point([<point referenced from the Rhino model> x3])
lowresscanmesh = Mesh(<mesh referenced from the Rhino model>)

# ----
# 1 -> CREATE PUBLIC DEV FILE
# comments & notes: Use this to create a public version without secrets from this development file. The component will create an in-memory copy of the GH Document, then clear all Panels which names are in "ClearPanelNames" and then save the document to the DevelopmentPath.
panel_names_to_clear = Panel("""DDU_CSC_Username
DDU_CSC_Password
DDU_CSC_Local_Repo_Folder""")
development_folder = Panel("..\grasshopper_development")
filename = Panel("DDU_CSC_GrasshopperInterface_DEV_PUBLIC")
run = Button()
createpublicdevelopmentfile = CreatePublicDevelopmentFile(Run=run, ClearPanelNames=panel_names_to_clear, DevelopmentPath=development_folder, Filename=filename)  # -> out, Success, SavedFilePath, Status; inputs Run: Boolean, ClearPanelNames: list of String, DevelopmentPath: String, Filename: String
# ---------- createpublicdevelopmentfile: Python ----------
#! python3
# -*- coding: utf-8 -*-
# venv: DDU_CSC
print('ENV OK!')
# r: charset_normalizer
# r: requests

# PYTHON STANDARD LIBRARY IMPORTS ---------------------------------------------
import os  # NOQA
from datetime import datetime  # NOQA

# RHINO AND GH RELATED IMPORTS ------------------------------------------------
import System  # NOQA
import Grasshopper  # NOQA
import Rhino  # NOQA
import scriptcontext as sc  # NOQA

# GHENV COMPONENT SETTINGS ----------------------------------------------------
ghenv.Component.Name = 'CreatePublicDevelopmentFile'  # NOQA
ghenv.Component.NickName = 'CreatePublicDevelopmentFile'  # NOQA
ghenv.Component.Category = 'DDU_CSC'  # NOQA
ghenv.Component.SubCategory = '0 Development'  # NOQA
ghenv.Component.Description = (  # NOQA
    """
    This component can be used to create a sanitized Grasshopper
    development file in a specified folder.

    It creates a copy of the current Grasshopper document in
    memory, removes all components that belong to a specified group (i.e.
    developmclears specified panels containing sensitive information,
    and saves the modified document to a specified folder.

    The folder path can be relative, i.e. "..\\grasshopper_release".

    The filename can be specified, otherwise a timestamp-based filename will be
    generated.
    """
)


class CSC_CreatePublicDevelopmentFile(Grasshopper.Kernel.GH_ScriptInstance):
    """
    Author: Max Benjamin Eschenbach
    License: MIT License
    Version: 261102
    """

    def __init__(self):
        """Initialize this component and set component parameters."""
        super().__init__()
        # initialize props
        self.Component = ghenv.Component  # NOQA
        self.InputParams = self.Component.Params.Input
        self.OutputParams = self.Component.Params.Output

    def _addRemark(self, msg: str = ''):
        """Add a remark message to the component."""
        rml = self.Component.RuntimeMessageLevel.Remark
        self.AddRuntimeMessage(rml, msg)

    def _addWarning(self, msg: str = ''):
        """Add a warning message to the component."""
        rml = self.Component.RuntimeMessageLevel.Warning
        self.AddRuntimeMessage(rml, msg)

    def _addError(self, msg: str = ''):
        """Add an error message to the component."""
        rml = self.Component.RuntimeMessageLevel.Error
        self.AddRuntimeMessage(rml, msg)

    def BeforeRunScript(self):
        """Performs some setup actions."""
        # Initialize input param descriptions
        self.InputParams[0].Description = (
            'Run the document copy, object removal, and save operation'
        )
        self.InputParams[1].Description = (
            'List of names of optional GH_Panel objects to clear,'
            ' (i.e. for passwords)'
        )
        self.InputParams[2].Description = (
            'Folder path where to save the modified development document'
        )
        self.InputParams[3].Description = (
            'Optional filename for the saved document '
            '(without .gh extension)'
        )
        # Initialize output param descriptions
        i = 0
        if self.OutputParams[0].Name == 'out':
            i += 1
        self.OutputParams[0+i].Description = (
            'Success status of the operation (True/False)'
        )
        self.OutputParams[1+i].Description = (
            'Full path of the saved document'
        )
        self.OutputParams[2+i].Description = (
            'Status message describing the operation result'
        )

    def copy_document(self, source_doc):
        """
        Create a copy of the Grasshopper document in memory.

        Args:
            source_doc: The source Grasshopper document to copy

        Returns:
            GH_Document: A copy of the source document, or None if failed
        """
        try:
            if source_doc is None:
                self._addError('Source document is None')
                return None

            # Use the DuplicateDocument method to create a copy
            duplicate_doc = Grasshopper.Kernel.GH_Document.DuplicateDocument(
                source_doc
            )

            if duplicate_doc is None:
                self._addError('Failed to duplicate the document')
                return None

            self._addRemark('Successfully created document copy')
            return duplicate_doc

        except Exception as e:
            self._addError(f'Error copying document: {str(e)}')
            return None

    def clear_panels(self, doc, target_panels):
        """
        Clear all GH_Panel instances in the document with one of the specified
        names.
        """
        panels_cleared = 0
        try:
            # loop over target panels and clear them
            for panel in target_panels:
                # UserText property holds the panel contents so we clear it
                panel.UserText = ''
                # we clear the volatile data as well
                panel.ClearData()
                panels_cleared += 1
        except Exception as e:
            self._addError(f'Error clearing panels: {str(e)}')
            return panels_cleared
        # return target groups and objects
        return panels_cleared

    def find_panels_to_clear(self, doc, panel_names=[]):
        """
        Find all panels in the document with the specified name.
        """
        # get type for panels as string for verification
        paneltype = Grasshopper.Kernel.Special.GH_Panel
        paneltype_str = str(paneltype).split("'")[1]
        # loop over all document objects
        doc_objects = doc.Objects
        target_panels = []
        try:
            for doc_obj in doc_objects:
                # ensure matching panel name
                if panel_names and doc_obj.NickName in panel_names:
                    # ensure matching type
                    if str(doc_obj.GetType()) == paneltype_str:
                        target_panels.append(doc_obj)
        except Exception as e:
            self._addError(f'Error finding panels: {str(e)}')
            return None
        # return target panels
        return target_panels

    def save_document(self, doc, save_path, filename=None):
        """
        Save the Grasshopper document to the specified path.

        Args:
            doc: The Grasshopper document to save
            save_path: The folder path where to save the document
            filename: Optional filename
                      (if None, generates timestamp-basedname)

        Returns:
            bool: True if successful, False otherwise
        """
        try:
            if doc is None:
                self._addError('Document is None, cannot save')
                return False, ''

            if not save_path:
                self._addError('Save path is empty')
                return False, ''

            # Handle relative paths - get the current GH
            # document directory as base
            current_doc = self.Component.OnPingDocument()
            if current_doc and current_doc.FilePath:
                current_dir = os.path.dirname(current_doc.FilePath)
                # Convert relative path to absolute path
                if not os.path.isabs(save_path):
                    save_path = os.path.normpath(
                        os.path.join(current_dir, save_path)
                    )
            else:
                # If no current document, use current working directory
                save_path = os.path.abspath(os.path.normpath(save_path))

            # Ensure the save directory exists
            if not os.path.exists(save_path):
                try:
                    os.makedirs(save_path, exist_ok=True)
                    self._addRemark(f'Created directory: {save_path}')
                except Exception as e:
                    self._addError(
                        f'Failed to create directory {save_path}: '
                        f'{str(e)}'
                    )
                    return False, ''

            # Generate filename if not provided
            if not filename:
                timestamp = datetime.now().strftime('%y%m%d_%H%M%S')
                filename = f'{timestamp}_ReleaseFile.gh'

            # Ensure filename has .gh extension
            if not filename.endswith('.gh'):
                filename += '.gh'

            # Create full file path
            full_path = os.path.join(save_path, filename)

            # Use GH_DocumentIO to save the document
            # (following SaveAndSaveGHX pattern)
            doc_io = Grasshopper.Kernel.GH_DocumentIO(doc)

            # Save the document
            success = doc_io.SaveQuiet(full_path)

            if success:
                self._addRemark(f'Document saved successfully: {full_path}')
                return True, full_path
            else:
                self._addError(f'Failed to save document to: {full_path}')
                return False, ''
        except Exception as e:
            self._addError(f'Error saving document: {str(e)}')
            return False, ''

    def validate_inputs(self, clear_panel_names, save_path):
        """
        Validate the input parameters.

        Args:
            save_path: The path where to save the document

        Returns:
            bool: True if inputs are valid, False otherwise
        """
        if not save_path or not save_path.strip():
            self._addWarning('Save path cannot be empty')
            return False

        if not clear_panel_names:
            clear_panel_names = []
        for cpn in clear_panel_names:
            if not isinstance(cpn, str):
                self._addError('ClearPanelNames contains non-string')
                return False

        # Check if save path is valid
        try:
            # Handle relative paths - get the current
            # GH document directory as base
            current_doc = self.Component.OnPingDocument()
            if current_doc and current_doc.FilePath:
                current_dir = os.path.dirname(current_doc.FilePath)
                # Convert relative path to absolute path
                if not os.path.isabs(save_path):
                    normalized_path = os.path.normpath(
                        os.path.join(current_dir, save_path)
                    )
                else:
                    normalized_path = os.path.normpath(save_path)
            else:
                # If no current document, use current working directory
                normalized_path = os.path.abspath(os.path.normpath(save_path))
            # Check if the parent directory exists or can be created
            parent_dir = os.path.dirname(normalized_path)
            if parent_dir and not os.path.exists(parent_dir):
                # Try to create the parent directory
                try:
                    os.makedirs(parent_dir, exist_ok=True)
                except Exception:
                    self._addError(f'Cannot create directory: {parent_dir}')
                    return False
        except Exception as e:
            self._addError(f'Invalid save path: {str(e)}')
            return False

        return True

    def RunScript(self,
            Run: bool,
            ClearPanelNames: list[str],
            DevelopmentPath: str,
            Filename: str):

        # Initialize output variables
        success = False
        saved_file_path = ''
        status_message = ''

        # Check if execution is requested
        if not Run:
            status_message = 'Run is False - operation not performed'
            self.Component.Message = status_message
            return (success, saved_file_path,
                    status_message)

        # Validate inputs
        if not self.validate_inputs(
                ClearPanelNames, DevelopmentPath):
            status_message = 'Input validation failed'
            self.Component.Message = status_message
            return (success, saved_file_path,
                    status_message)

        # Get the current Grasshopper document
        current_doc = self.Component.OnPingDocument()
        if current_doc is None:
            status_message = 'No active Grasshopper document found'
            self._addError(status_message)
            self.Component.Message = status_message
            return (success, saved_file_path,
                    status_message)

        # Step 1: Copy the current document
        self.Component.Message = 'Copying document...'
        copied_doc = self.copy_document(current_doc)
        if copied_doc is None:
            status_message = 'Failed to copy document'
            self.Component.Message = status_message
            return (success, saved_file_path,
                    status_message)

        # Step 2: Find the panels to clear
        self.Component.Message = 'Finding groups...'
        target_panels = self.find_panels_to_clear(
            copied_doc, ClearPanelNames
        )

        # Step 3: Clear Panels if ClearPanelNames were supplied
        if target_panels:
            self.Component.Message = 'Clearing Panels...'
            panels_cleared = self.clear_panels(copied_doc, target_panels)
            if panels_cleared == 0:
                status_message = ('No panels have been cleared!')
                self._addWarning(status_message)

        # Step 4: Save the modified document
        self.Component.Message = 'Saving document...'
        save_success, saved_file_path = self.save_document(
            copied_doc,
            DevelopmentPath,
            Filename
        )
        if save_success:
            saved_file_path = os.path.normpath(
                os.path.abspath(saved_file_path)
            )
            success = True
            status_message += (
                f'\n Saved development file to: {saved_file_path}'
            )
            self.Component.Message = 'Operation completed successfully'
        else:
            status_message += '\n Failed to save document!'
            self.Component.Message = 'Save operation failed'

        # set message
        self.Component.Message = 'Operation completed successfully'
        # return results
        return (success, saved_file_path, status_message)
# ---------- end createpublicdevelopmentfile ----------
saveandsaveghx = SaveAndSaveGHX(Save=Button(), ArchiveFolder="00_archive")  # -> out, Message; inputs Save: Boolean, ArchiveFolder: String
# ---------- saveandsaveghx: C# ----------
#region Usings
using System;
using System.IO;
using System.Linq;
using System.Collections;
using System.Collections.Generic;
using System.Drawing;

using Rhino;
using Rhino.Geometry;

using Grasshopper;
using Grasshopper.Kernel;
using Grasshopper.Kernel.Data;
using Grasshopper.Kernel.Types;
#endregion

public class Script_Instance : GH_ScriptInstance
{
    #region Notes
    /* 
      Members:
        RhinoDoc RhinoDocument
        GH_Document GrasshopperDocument
        IGH_Component Component
        int Iteration

      Methods (Virtual & overridable):
        Print(string text)
        Print(string format, params object[] args)
        Reflect(object obj)
        Reflect(object obj, string method_name)

    Author: Max Benjamin Eschenbach
    License: MIT License
    Version: 261009
    */
    #endregion

    private void RunScript(bool Save, string ArchiveFolder, ref object Message)
    {
        // set component params
        this.Component.Name = "SaveAndSaveGHX";
        this.Component.NickName = "SaveAndSaveGHX";
        this.Component.Category = "DDU_CSC";
        this.Component.SubCategory = "0 Development";
        this.Component.Description = (
            "Saves the current Grasshopper document in multiple formats: .gh (binary), " +
            ".ghx (XML), and creates timestamped archive copies. Handles directory " +
            "creation and error reporting.");

        // This output will tell us if the save succeeded or failed.
        // The active Grasshopper document in this scripting component context

        DataTree<string> msgOut = new DataTree<string>();
        GH_Path ghp = new GH_Path(0, 1);

        if (!Save)
        {
            return;
        }

        GH_Document doc = this.GrasshopperDocument;
        if (doc == null)
        {
            msgOut.Add("Error: GrasshopperDocument is null", ghp);
            return;
        }

        // Set current and archive filepath
        string originalFilePath = doc.FilePath;
        string ghxFilePath = originalFilePath + "x";
        string archivePath = Path.Combine(Path.GetDirectoryName(ghxFilePath), ArchiveFolder);
        string archiveFilePath = Path.Combine(archivePath, DateTime.Now.ToString("yyMMdd") + "_" + Path.GetFileName(originalFilePath));

        // Only attempt to save when 'saveTrigger' is set to true.
        if (!Save) return;
        
        // Make sure the parent directory exists
        if (!Directory.Exists(Path.GetDirectoryName(ghxFilePath)))
        {
            msgOut.Add("Error: directory does not exist", ghp);
            return;
        }

        // Make sure Archive Directory exists
        // Make sure the parent directory exists
        
        if (!Directory.Exists(Path.GetDirectoryName(archivePath)))
        {
            msgOut.Add("Error: Archive directory does not exist", ghp);
            return;
        }

        // Create a GH_DocumentIO object based on our current GH_Document.
        GH_DocumentIO io = new GH_DocumentIO(doc);
        // Save this document
        io.Save();

        // Write the current document to an XML-based .ghx file
        bool success_a = io.SaveQuiet(ghxFilePath);
        bool success_b = io.SaveQuiet(originalFilePath);
        bool success_c = io.SaveQuiet(archiveFilePath);

        if (success_a & success_b & success_c)
            msgOut.Add($"Files saved successfully:\n{ghxFilePath}\n{archiveFilePath}", ghp);
        else
        {
            if (!success_a)
                msgOut.Add($"Error: failed to save .ghx file:\n{ghxFilePath}", ghp);
            if (!success_c)
                msgOut.Add($"Error: failed to save Archive .gh file:\n{archiveFilePath}", ghp);
        }
        Message = msgOut;
    }
}
# ---------- end saveandsaveghx ----------
panel = Panel(saveandsaveghx.Message)
status_message_stream = Panel(createpublicdevelopmentfile.Status)
success_message = Panel(createpublicdevelopmentfile.Success)
filepath_of_saved_release_file = Panel(createpublicdevelopmentfile.SavedFilePath)

# ----
# VIEWCAPTURE
save_viewcapture = BooleanToggle(False)
# Example 01:
# - Fetching Components
# - Arranging Components / Applying Transformations
# - Diassemble Components
# __DEVELOPMENT_CREDITS__: Authors: Max Benjamin Eschenbach
# Contributors: Alessandro Garruto
# 
# Digital Design Unit (DDU)
# Prof. Dr.-Ing. Oliver Tessmann
# Fachbereich Architektur
# Technical University of Darmstadt
# 
# CREDITS:
# ------------
# Please see: https://2ndchances.build/credits
open_viewcapture_after_saving = BooleanToggle(False)
viewcapturewidth = Slider(1920, range=0..10000)
viewcaptureheight = Slider(1080, range=0..10000)
viewcapturetofile = ViewCaptureToFile(
    Toggle=save_viewcapture,
    Width=viewcapturewidth,
    Height=viewcaptureheight,
    Grid=Toggle(False),
    WorldAxes=Toggle(False),
    CPlaneAxes=Toggle(False),
    OpenFile=open_viewcapture_after_saving)  # -> Path; inputs Toggle: Boolean, Width: Int32, Height: Int32, BackgroundColor: Color, Grid: Boolean, WorldAxes: Boolean, CPlaneAxes: Boolean, OpenFile: Boolean
# ---------- viewcapturetofile: Python ----------
#! python3
# -*- coding: utf-8 -*-
# venv: DDU_CSC
# r: charset_normalizer
print('ENV OK!')

# PYTHON STANDARD LIBRARY IMPORTS ---------------------------------------------
import os  # NOQA
import datetime  # NOQA

# RHINO AND GH RELATED IMPORTS ------------------------------------------------
import System  # NOQA
import Rhino  # NOQA
import Grasshopper  # NOQA
import scriptcontext as sc  # NOQA

# GHENV COMPONENT SETTINGS ----------------------------------------------------
ghenv.Component.Name = 'ViewCaptureToFile'  # NOQA
ghenv.Component.NickName = 'ViewCaptureToFile'  # NOQA
ghenv.Component.Category = 'DDU_CSC'  # NOQA
ghenv.Component.SubCategory = '8 Visualization'  # NOQA
ghenv.Component.Description = (  # NOQA
    'Captures the active Rhino viewport to an image file (PNG). Supports '
    'custom dimensions, background colors, and visibility options for '
    'grid/axes. Creates organized capture folders with timestamps.'
)

# OPTIONAL HELPERS: they never block the component (decisions 8.112, 8.113) ---
try:
    from csc_gh.ports import ensure_outputs
    from csc_gh.messages import set_state
except ImportError:
    ensure_outputs = set_state = None

OUTPUTS = [
    ('Path', 'Path',
     'Path to the captured image file'),
]


def empty_outputs():
    """What RunScript returns when it stops early or has no result: an empty
    Grasshopper tree per output (never '' or None)."""
    if not OUTPUTS:
        return None
    trees = tuple(Grasshopper.DataTree[System.Object]() for _ in OUTPUTS)
    return trees[0] if len(trees) == 1 else trees


class CSC_ViewCaptureToFile(Grasshopper.Kernel.GH_ScriptInstance):
    """
    Author: Anders Holden Deleuran (updated 2025 by Max Benjamin Eschenbach)
    License: MIT License
    Version: 261102
    """

    _outputs_ready = True       # set by BeforeRunScript (8.112)
    _outputs_note = None

    def __init__(self):
        super().__init__()
        # initialize props
        self.Component = ghenv.Component  # NOQA
        self.InputParams = self.Component.Params.Input
        self.OutputParams = self.Component.Params.Output

    def _addRemark(self, msg: str = ''):
        """Add a remark message to the component runtime messages."""
        rml = self.Component.RuntimeMessageLevel.Remark
        self.AddRuntimeMessage(rml, msg)

    def _addWarning(self, msg: str = ''):
        """Add a warning message to the component runtime messages."""
        rml = self.Component.RuntimeMessageLevel.Warning
        self.AddRuntimeMessage(rml, msg)

    def _addError(self, msg: str = ''):
        """Add an error message to the component runtime messages."""
        rml = self.Component.RuntimeMessageLevel.Error
        self.AddRuntimeMessage(rml, msg)

    def checkOrMakeFolder(self):
        """
        Check/makes a "Captures" folder in the GH def folder and a subfolder
        in the format 'YYMMDD'.
        """
        # get ghdoc
        ghdoc = self.Component.OnPingDocument()
        # construct timestamp for subfolder
        date = datetime.date.today()
        yy = str(date.year)[-2:]
        mm = str(date.month).zfill(2)
        dd = str(date.day).zfill(2)
        timestamp = yy + mm + dd
        docpath = ghdoc.Path  # NOQA
        if docpath:
            folder = os.path.dirname(docpath)
            captureFolder = folder + "\\Captures\\" + timestamp
            if not os.path.isdir(captureFolder):
                os.makedirs(captureFolder)
            return captureFolder

    def makeFileName(self):
        """ Make a string with the gh def name + current hourMinuteSecond """
        # Make hour minute seconds string
        n = datetime.datetime.now()
        ho, mt, sc = str(n.hour), str(n.minute), str(n.second)
        if len(ho) == 1:
            ho = "0" + ho
        if len(mt) == 1:
            mt = "0" + mt
        if len(sc) == 1:
            sc = "0" + sc
        hms = ho + mt + sc
        # Get name of GH def
        ghDef = ghdoc.Name.strip("*")  # NOQA
        # Concatenate and return
        fileName = ghDef + "_" + hms
        return fileName

    def captureActiveViewToFile(
            self,
            width,
            height,
            path,
            grid,
            worldAxes,
            cplaneAxes):
        """
        Captures the active view to an image file at the path.
        Path looks like this:
        "C:\\Users\\user\\Desktop\\Captures\\foo_bar.png"
        """
        # Set the script context to the current Rhino doc
        sc.doc = Rhino.RhinoDoc.ActiveDoc
        # define ghdoc
        ghdoc = self.Component.OnPingDocument()
        # Get the active view and set image dimensions
        activeView = sc.doc.Views.ActiveView
        # Perform the capture
        try:
            viewcap = Rhino.Display.ViewCapture()
            viewcap.DrawGrid = grid
            viewcap.DrawGridAxes = worldAxes
            viewcap.DrawAxes = cplaneAxes
            viewcap.Height = height
            viewcap.Width = width
            imageCap = viewcap.CaptureToBitmap(activeView)
            System.Drawing.Bitmap.Save(imageCap, path)
            Rhino.RhinoApp.WriteLine(path)
            sc.doc = ghdoc  # NOQA
            return path
        except Exception as e:
            sc.doc = ghdoc  # NOQA
            raise Exception(f'Capture failed, check the path: {str(e)}')

    def _state(self, text=''):
        """The one short state under the component (decision 8.113)."""
        if set_state is not None:
            set_state(self.Component, text)

    def _stop(self):
        """True when RunScript has to return early: the outputs were just
        updated (says why)."""
        if self._outputs_note:
            self._addRemark(self._outputs_note)
        return not self._outputs_ready

    def _check_outputs(self):
        """Make the outputs match OUTPUTS before the script runs (8.112)."""
        self._outputs_ready, self._outputs_note = True, None
        if ensure_outputs is None:
            self._outputs_note = (
                'output check skipped: CSC library not installed')
            return
        status = ensure_outputs(self.Component, OUTPUTS)
        self._outputs_ready, self._outputs_note = status.ready, status.remark

    def BeforeRunScript(self):
        """Perform some setup actions."""
        self._check_outputs()

    def RunScript(self,
            Toggle: bool,
            Width: int,
            Height: int,
            BackgroundColor: System.Drawing.Color,
            Grid: bool,
            WorldAxes: bool,
            CPlaneAxes: bool,
            OpenFile: bool):
        """
        Main execution method for capturing the active view to a file.

        Args:
            Toggle: Boolean to execute the capture operation
            Width: Image width in pixels (default: 1920)
            Height: Image height in pixels (default: 1080)
            BackgroundColor: Background color for the viewport
            Grid: Show grid in capture
            WorldAxes: Show world axes in capture
            CPlaneAxes: Show construction plane axes in capture
            OpenFile: Open the captured file after creation

        Returns:
            Path to the captured image file
        """
        if self._stop():
            return empty_outputs()
        # Initialize param descriptions (this has to be done in RunScript)
        self.InputParams[0].Description = (
            'Toggle to execute the view capture operation'
        )
        self.InputParams[1].Description = (
            'Image width in pixels (default: 1920 if not provided)'
        )
        self.InputParams[2].Description = (
            'Image height in pixels (default: 1080 if not provided)'
        )
        self.InputParams[3].Description = (
            'Background color for the viewport capture'
        )
        self.InputParams[4].Description = (
            'Show grid in the captured image'
        )
        self.InputParams[5].Description = (
            'Show world axes in the captured image'
        )
        self.InputParams[6].Description = (
            'Show construction plane axes in the captured image'
        )
        self.InputParams[7].Description = (
            'Open the captured file after creation'
        )

        # Set up output trees and results
        Path = Grasshopper.DataTree[System.Object]()

        if not Toggle:
            self._state('Toggle is off')
            return Path

        try:
            # Set background color if provided
            if BackgroundColor:
                settings = Rhino.ApplicationSettings.AppearanceSettings
                settings.ViewportBackgroundColor = BackgroundColor
                self._addRemark('Background color set for capture')

            # Set default dimensions if not provided
            if not Width:
                Width = 1920
            if not Height:
                Height = 1080


            # Create capture folder and filename
            capFolder = self.checkOrMakeFolder()
            fileName = self.makeFileName()
            path = os.path.join(capFolder, fileName + '.png')


            # Perform the capture
            captured_path = self.captureActiveViewToFile(
                Width, Height, path, Grid, WorldAxes, CPlaneAxes
            )

            # Add to output
            ghp = Grasshopper.Kernel.Data.GH_Path(0)
            Path.Add(captured_path, ghp)

            # Open file if requested
            if OpenFile:
                os.startfile(path)
                self._addRemark('File opened after capture')

            self._state(f'Captured {fileName}.png')
            self._addRemark(f'Successfully captured view to {captured_path}')

            return Path

        except Exception as e:
            msg = f'Capture failed: {str(e)}'
            self._addError(msg)
            return Path
# ---------- end viewcapturetofile ----------
panel_2 = Panel(viewcapturetofile)

# ---- group: __DDU_CSC_EXAMPLE_04__
# comments & notes: Fetch a subset of components from the database using filters. Here we are fetching the 'mineral_composite_panels' dataset.
# 
# NOTE: ReservedStatus = -1 means we ignore reservations entirely
# Step 2
fitsizeb = Slider(0, range=0..2000)
fitsizec = Slider(0, range=0..500)
# Example 05:
# - Fetch all corian sheet components
# - Get radial signature descriptors
# - Concatenate with simple descriptors to get a 100-dimensional vector
# - Embed into 2 or 3 dimensional space using dimensionality reduction
# - Visualize the embeddings in 2D / 3D space
fittolerance = Panel("10%")
originalfunction = ValueList({"Any function": , "Beam (IfcBeam)": "IfcBeam", "Column (IfcColumn)": "IfcColumn", "Slab (IfcSlab)": "IfcSlab", "Plate / Panel (IfcPlate)": "IfcPlate", "Wall (IfcWall)": "IfcWall", "Member (IfcMember)": "IfcMember", "Pipe (IfcPipeSegment)": "IfcPipeSegment", "Duct (IfcDuctSegment)": "IfcDuctSegment", "Footing (IfcFooting)": "IfcFooting", "Window (IfcWindow)": "IfcWindow", "Door / gate (IfcDoor)": "IfcDoor", "Stair (IfcStair)": "IfcStair", "Railing / balustrade (IfcRailing)": "IfcRailing", "Accessory / Connector (IfcDiscreteAccessory)": "IfcDiscreteAccessory", "Element part (IfcBuildingElementPart)": "IfcBuildingElementPart", "Unknown (IfcBuildingElementProxy)": "IfcBuildingElementProxy", "Debris (CscDebris)": "CscDebris"}, selected="Any function")
material = ValueList({"Any material": , "Concrete (concrete)": "concrete", "Autoclaved aerated concrete (autoclaved_aerated_concrete)": "autoclaved_aerated_concrete", "Fired clay (fired_clay)": "fired_clay", "Calcium silicate (calcium_silicate)": "calcium_silicate", "Ceramic (ceramic)": "ceramic", "Natural stone (natural_stone)": "natural_stone", "Mixed mineral (mineral_mixture)": "mineral_mixture", "Gypsum (gypsum)": "gypsum", "Glass (glass)": "glass"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}, selected="Any material")
complexity = ValueList({"Any complexity": , "0", "1", "2", "3"}, selected="Any complexity")
fragment = ValueList({"Any": , "Only fragments": True, "Only non-fragmnents": False}, selected="Any")
shapeclass = ValueList({"Any shape": , "Linear (linear)": "linear", "Planar (planar)": "planar", "Block (block)": "block", "Irregular (irregular)": "irregular", "Composite (composite)": "composite"}, selected="Any shape")
materialclass = ValueList({"Any MaterialClass": , "Concrete (17 01 01)": "17 01 01", "Bricks (17 01 02)": "17 01 02", "Tiles and ceramics (17 01 03)": "17 01 03", "Mineral mixtures, hazardous (17 01 06*)": "17 01 06*", "Mineral mixtures (17 01 07)": "17 01 07", "Wood (17 02 01)": "17 02 01", "Glass (17 02 02)": "17 02 02", "Plastic (17 02 03)": "17 02 03", "Glass, plastic, wood, hazardous (17 02 04*)": "17 02 04*"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}, selected="Any MaterialClass")
circulation = ValueList({"Active (default)": "active", "Exited": "exited", "All \"all": "All "all""}, selected="Active (default)")
fitmode = ValueList({"Any Fit": , "About this size": "about", "Can hold this size": "can_hold"}, selected="Any Fit")
fitsizea = Slider(0, range=-0.1..2000)
mindimensionx = Slider(0, range=-0.1..2000)
maxdimensiony = Slider(0, range=0..2000)
mindimensionz = Slider(0, range=0..500)
reservedstatus = Slider(-1, range=-1..1)
dataset = Panel("mineral_composite_panels")
maxdimensionx = Slider(0, range=0..2000)
mindimensiony = Slider(0, range=0..2000)
maxdimensionz = Slider(0, range=0..500)
merge = Merge(Data1=fitsizea, Data2=fitsizeb, Data3=fitsizec)
fitsize = Data(merge)
fetchfilteredcomponents = FetchFilteredComponents(
    OriginalFunction=originalfunction,
    Material=material,
    Dataset=dataset,
    Complexity=complexity,
    Fragment=fragment,
    MinDimensionX=mindimensionx,
    MaxDimensionX=maxdimensionx,
    MinDimensionY=mindimensiony,
    MaxDimensionY=maxdimensiony,
    MinDimensionZ=mindimensionz,
    MaxDimensionZ=maxdimensionz,
    ReservedStatus=reservedstatus,
    ShapeClass=shapeclass,
    MaterialClass=materialclass,
    Circulation=circulation,
    FitMode=fitmode,
    FitSize=fitsize,
    FitTolerance=fittolerance)  # -> FilterDescription, ComponentPassport, Fit, DistanceKm; inputs OriginalFunction: String, Material: String, Dataset: String, Complexity: Int32, Fragment: Boolean, MinDimensionX: Double, MaxDimensionX: Double, MinDimensionY: Double, MaxDimensionY: Double, MinDimensionZ: Double, MaxDimensionZ: Double, ShapeClass: String, MaterialClass: String, Circulation: String, FitMode: String, FitSize: list, FitTolerance: String, NearPoint: Vector3d, NearLayer: String, RadiusKm: Double
# ---------- fetchfilteredcomponents: Python ----------
#! python3
# -*- coding: utf-8 -*-
# venv: DDU_CSC
# r: charset_normalizer
# r: requests==2.32.5
# r: numpy==2.0.2
print('ENV OK!')

# PYTHON STANDARD LIBRARY IMPORTS ---------------------------------------------
import json  # NOQA

# THIRD PARTY LIBRARY IMPORTS -------------------------------------------------
import requests  # NOQA

# RHINO AND GH RELATED IMPORTS ------------------------------------------------
import System  # NOQA
import Grasshopper  # NOQA
import Rhino  # NOQA
import scriptcontext as sc  # NOQA

# GHENV COMPONENT SETTINGS ----------------------------------------------------
ghenv.Component.Name = 'FetchFilteredComponents'  # NOQA
ghenv.Component.NickName = 'FetchFilteredComponents'  # NOQA
ghenv.Component.Category = 'DDU_CSC'  # NOQA
ghenv.Component.SubCategory = '2 Catalog Interface'  # NOQA
ghenv.Component.Description = (  # NOQA
    'Fetches identities (with their current snapshot) from the remote '
    'Catalog based on filter criteria (original function, material, '
    'dataset, complexity, fragment, bounding box dimensions, shape class, '
    'material class, circulation) and, like the web filter menu, the '
    'dimension search (FitMode about or can_hold, FitSize, FitTolerance) '
    'and the near search (NearPoint, NearLayer, RadiusKm). Returns '
    'component passport JSON ({identity, snapshots[]}) results, with the '
    'match (Fit, per cent) and the distance (DistanceKm) of each when '
    'those searches are set.'
)

# CSC LIBRARY (decision 8.111) ----------------------------------------------
CSC_GH_MINIMUM = '261022'
LIBRARY_PROBLEM = None
try:
    import csc_gh
    csc_gh.require(CSC_GH_MINIMUM)
    from csc_gh.read import (fetch_filter_params, fit_percent,  # NOQA
                             distance_km, fit_mode_of)
except ImportError:
    LIBRARY_PROBLEM = (
        'CSC library 261022 too old or missing: run CSC_Update, '
        'then restart Rhino')

# OPTIONAL HELPERS: they never block the component (decisions 8.112, 8.113) ---
try:
    from csc_gh.ports import ensure_outputs
    from csc_gh.messages import set_state
except ImportError:
    ensure_outputs = set_state = None

OUTPUTS = [
    ('FilterDescription', 'FilterDescription',
     'Human-readable description of the applied filters and query'),
    ('ComponentPassport', 'ComponentPassport',
     "Component passport JSON per entry ({identity, snapshots[]}) fetched from the server. Use 'DisassembleComponent' to access the individual fields ready for Grasshopper"),
    ('Fit', 'Fit',
     'Dimension search: per result, the deviation in per cent (FitMode '
     'about: the largest relative deviation of the three sorted sides) or '
     'the waste in per cent of the element (FitMode can_hold). Empty without '
     'FitMode and FitSize. Same paths as ComponentPassport'),
    ('DistanceKm', 'DistanceKm',
     'Near search: per result, the distance in km from NearPoint to the '
     'element (on NearLayer). Empty without NearPoint. Same paths as '
     'ComponentPassport'),
]


def empty_outputs():
    """What RunScript returns when it stops early or has no result: an empty
    Grasshopper tree per output (never '' or None)."""
    if not OUTPUTS:
        return None
    trees = tuple(Grasshopper.DataTree[System.Object]() for _ in OUTPUTS)
    return trees[0] if len(trees) == 1 else trees


class CSC_FetchFilteredComponents(Grasshopper.Kernel.GH_ScriptInstance):
    """
    Author: Max Benjamin Eschenbach
    License: MIT License
    Version: 261102
    """

    _outputs_ready = True       # set by BeforeRunScript (8.112)
    _outputs_note = None

    def __init__(self):
        """Initialize this component and set component parameters."""
        super().__init__()
        # initialize props
        self.Component = ghenv.Component  # NOQA
        self.InputParams = self.Component.Params.Input
        self.OutputParams = self.Component.Params.Output

    def _addRemark(self, msg: str = ''):
        """Add a remark message to the component."""
        rml = self.Component.RuntimeMessageLevel.Remark
        self.AddRuntimeMessage(rml, msg)

    def _addWarning(self, msg: str = ''):
        """Add a warning message to the component."""
        rml = self.Component.RuntimeMessageLevel.Warning
        self.AddRuntimeMessage(rml, msg)

    def _addError(self, msg: str = ''):
        """Add an error message to the component."""
        rml = self.Component.RuntimeMessageLevel.Error
        self.AddRuntimeMessage(rml, msg)

    def _state(self, text=''):
        """The one short state under the component (decision 8.113)."""
        if set_state is not None:
            set_state(self.Component, text)

    def _stop(self):
        """True when RunScript has to return early: the library is missing or
        too old, or the outputs were just updated (says why)."""
        if LIBRARY_PROBLEM:
            self._addError(LIBRARY_PROBLEM)
            return True
        if self._outputs_note:
            self._addRemark(self._outputs_note)
        return not self._outputs_ready

    def _check_outputs(self):
        """Make the outputs match OUTPUTS before the script runs (8.112)."""
        self._outputs_ready, self._outputs_note = True, None
        if ensure_outputs is None:
            self._outputs_note = (
                'output check skipped: CSC library not installed')
            return
        status = ensure_outputs(self.Component, OUTPUTS)
        self._outputs_ready, self._outputs_note = status.ready, status.remark

    def BeforeRunScript(self):
        """Perform some setup actions."""
        # Initialize input param descriptions
        descriptions = [
            'Original function filter, an IFC class (e.g. IfcBeam, '
            'IfcColumn, IfcSlab, IfcPlate, CscDebris)',
            'Material filter, a material id (e.g. concrete, steel, timber)',
            'Dataset name filter (e.g., "beyond_debris", '
            '"mineral_composite_sheets")',
            'Complexity level filter (0-3, where 0=simple, 3=complex)',
            'Fragment status filter (True for fragments, False for complete)',
            'Minimum X dimension filter (bounding box, longest side)',
            'Maximum X dimension filter (bounding box)',
            'Minimum Y dimension filter (bounding box)',
            'Maximum Y dimension filter (bounding box)',
            'Minimum Z dimension filter (bounding box, shortest side)',
            'Maximum Z dimension filter (bounding box)',
            'Reservation status filter: -1=ignore, 0=not reserved, '
            '1=reserved by current user',
            'Shape class filter: linear, planar, block, irregular or '
            'composite (derived by the server)',
            'Material class filter, a List of Waste code (e.g. 17 01 01)',
            'Circulation: active (default: in circulation, in place or '
            'deinstalled), in_place (still in the works), deinstalled, '
            'exited or all',
            'Dimension search: about (every side of the element within '
            'FitTolerance of FitSize) or can_hold (every side of the element '
            'at least FitSize: an element to cut your part from). Empty = no '
            'dimension search',
            'The asked size in mm, three numbers in any order (a list of '
            'three numbers, or one Point3d / Vector3d with X, Y, Z). The way '
            'an element lies does not matter: the sides are compared largest to '
            'smallest. Needs FitMode',
            'Only for about: a percentage or millimetres as text, 10% or '
            '50mm (a bare number is per cent). Default 10%. can_hold takes '
            'none',
            'Near search: a point with X = latitude and Y = longitude (a '
            'Point3d or Vector3d, as the PlaceLocation of Origin). Empty = no '
            'near search. The results are sorted by distance',
            'Near search: current (where the element is now, default) or '
            'origin (the building it came from)',
            'Near search: only elements within this many km. Empty = every '
            'element with a point on the layer, nearest first',
        ]
        for index, text_ in enumerate(descriptions):
            if index < len(self.InputParams):
                self.InputParams[index].Description = text_
        # Initialize output param descriptions
        self._check_outputs()
        if LIBRARY_PROBLEM is None:
            csc_gh.dev_reload(globals())

    def get_auth_core_from_sticky(self):
        """Get AuthCore instance from sticky storage."""
        auth_core = sc.sticky.get('CSC_AuthCore')
        if auth_core is None:
            msg = ('No authentication found. Please use CSC_Session component '
                   'first.')
            self._addWarning(msg)
            return None
        return auth_core

    def build_filter_query_params(
            self,
            OriginalFunction,
            Material,
            Dataset,
            Complexity,
            Fragment,
            MinDimensionX,
            MaxDimensionX,
            MinDimensionY,
            MaxDimensionY,
            MinDimensionZ,
            MaxDimensionZ,
            ReservedStatus,
            ShapeClass,
            MaterialClass,
            Circulation,
            FitMode=None,
            FitSize=None,
            FitTolerance=None,
            NearPoint=None,
            NearLayer=None,
            RadiusKm=None):
        """
        Build query parameters for GET /identities (csc_read).

        Mirrors the web catalog filter menu: original function, material,
        dataset, complexity, fragment, bounding box, shape class, material
        class and circulation. ``status`` is left to the server default
        (published only), matching the web. Adds a reservation-status filter
        on top: 1=reserved by current user, 0=not reserved. The dimension
        search (FitMode, FitSize, FitTolerance) and the near search
        (NearPoint, NearLayer, RadiusKm) are the web's "Fits" and "Near"
        filters; a value that cannot be used raises ``ValueError``.
        """
        function = OriginalFunction
        if isinstance(function, (list, tuple)):
            function = function[0] if function else None
        return fetch_filter_params(
            original_function=function,
            material=Material, dataset=Dataset, complexity=Complexity,
            fragment=Fragment, reserved=ReservedStatus,
            shape_class=ShapeClass, material_class=MaterialClass,
            circulation=Circulation,
            bbx={'min_x': MinDimensionX, 'max_x': MaxDimensionX,
                 'min_y': MinDimensionY, 'max_y': MaxDimensionY,
                 'min_z': MinDimensionZ, 'max_z': MaxDimensionZ},
            fit_mode=FitMode, fit_size=FitSize, fit_tolerance=FitTolerance,
            near_point=NearPoint, near_layer=NearLayer, radius_km=RadiusKm)

    def generate_filter_description(self, filter_params: dict) -> str:
        """Generates a human-readable description of the applied filters."""
        description = []
        for key, label in (('original_function', 'Original function'),
                           ('material', 'Material'),
                           ('dataset', 'Dataset'),
                           ('shape_class', 'Shape class'),
                           ('material_class', 'Material class'),
                           ('circulation', 'Circulation')):
            if filter_params.get(key):
                description.append(f'\n{label}: {filter_params[key]}')
        if filter_params.get('complexity') is not None:
            description.append(f'\nComplexity: {filter_params["complexity"]}')
        if filter_params.get('fragment') is not None:
            description.append(f'\nFragment: {filter_params["fragment"]}')
        if filter_params.get('reserved') == 'false':
            description.append('\nReservation: Not reserved by anyone')
        elif filter_params.get('reserved') == 'true':
            description.append('\nReservation: Reserved by current user')
        bbx_filters = []
        for axis in 'xyz':
            for kind, sign in (('min', '>='), ('max', '<=')):
                value = filter_params.get(f'bbx_{kind}_{axis}')
                if value is not None:
                    bbx_filters.append(
                        f'\n{axis.upper()} {sign} {float(value):.2f}')
        if bbx_filters:
            description.append(f'\nBounding Box: {", ".join(bbx_filters)}')
        if filter_params.get('fit_mode') == 'about':
            description.append(
                f'\nFit: about {filter_params["fit_size"]} mm, within '
                f'{filter_params["fit_tol"]}')
        elif filter_params.get('fit_mode') == 'can_hold':
            description.append(
                f'\nFit: can hold {filter_params["fit_size"]} mm')
        if 'near_lat' in filter_params:
            reach = (f', within {filter_params["radius_km"]} km'
                     if 'radius_km' in filter_params else ', nearest first')
            description.append(
                f'\nNear: {filter_params["near_lat"]}, '
                f'{filter_params["near_lon"]} '
                f'({filter_params.get("near_layer", "current")} location)'
                f'{reach}')
        return f'Applied filters: {", ".join(description)}'

    def RunScript(self,
            OriginalFunction: str,
            Material: str,
            Dataset: str,
            Complexity: int,
            Fragment: bool,
            MinDimensionX: float,
            MaxDimensionX: float,
            MinDimensionY: float,
            MaxDimensionY: float,
            MinDimensionZ: float,
            MaxDimensionZ: float,
            ReservedStatus,
            ShapeClass: str,
            MaterialClass: str,
            Circulation: str,
            FitMode: str,
            FitSize: list[object],
            FitTolerance: str,
            NearPoint: Rhino.Geometry.Vector3d,
            NearLayer: str,
            RadiusKm: float):

        if self._stop():
            return empty_outputs()
        if not ShapeClass or ShapeClass == '':
            ShapeClass = None
        if not MaterialClass or MaterialClass == '':
            MaterialClass = None
        if not Circulation or Circulation == '':
            Circulation = None

        # Get AuthCore instance from sticky storage
        auth_core = self.get_auth_core_from_sticky()
        if auth_core is None:
            return empty_outputs()

        # Check if authentication is valid
        if not auth_core.is_valid():
            msg = ('Authentication expired. Please use CSC_Session '
                   'component to refresh.')
            self._addWarning(msg)
            return empty_outputs()

        try:

            # Build filter query parameters (parity with web filter menu)
            try:
                filter_params = self.build_filter_query_params(
                    OriginalFunction, Material, Dataset, Complexity,
                    Fragment, MinDimensionX, MaxDimensionX, MinDimensionY,
                    MaxDimensionY, MinDimensionZ, MaxDimensionZ,
                    ReservedStatus, ShapeClass, MaterialClass, Circulation,
                    FitMode, FitSize, FitTolerance, NearPoint, NearLayer,
                    RadiusKm
                )
            except ValueError as e:
                # a size, tolerance, point or layer that cannot be used
                self._addWarning(str(e))
                return empty_outputs()
            for note in getattr(filter_params, 'notes', ()):
                self._addRemark(note)
            searched = ('fit_mode' in filter_params
                        or 'near_lat' in filter_params)
            if FitTolerance and fit_mode_of(FitMode) == 'can_hold':
                self._addRemark('FitTolerance is ignored: can_hold takes '
                                'none')

            # Request params: filters + passport expansion (identity+snapshot)
            request_params = dict(filter_params)
            request_params['expand'] = 'current_snapshot'

            # Generate human-readable filter description
            filter_description = self.generate_filter_description(
                filter_params
            )


            # Unified catalog cache (same identity/snapshot store as
            # FetchAllComponents and FetchComponents).
            # a list with a fit or a distance is read from the server each
            # time: the cache keeps the pieces, not the match of this query
            if searched:
                response = auth_core.authorized_get(
                    '/identities', request_params, timeout=60)
            else:
                response = auth_core.cached_list_identities(request_params)

            if response.status_code == 200:
                # Successfully fetched passport entries
                json_comps = response.json()
                component_count = len(json_comps)

                self._state(f'{component_count} found')

                self._addRemark(
                    f'Successfully fetched {component_count} components '
                    f'with applied filters'
                )

                # Set up output trees and results tuple
                FilterDescription = Grasshopper.DataTree[System.Object]()
                ComponentPassport = Grasshopper.DataTree[System.Object]()
                Fit = Grasshopper.DataTree[System.Object]()
                DistanceKm = Grasshopper.DataTree[System.Object]()
                __Results = (FilterDescription, ComponentPassport, Fit,
                             DistanceKm)

                # Loop over all passport entries and add them to the data tree
                for i, json_comp in enumerate(json_comps):
                    # Create datatree path
                    ghp = Grasshopper.Kernel.Data.GH_Path(0, i)
                    # Add passport JSON to the datatree
                    ComponentPassport.Add(
                        auth_core.passport_json_string(json_comp), ghp)
                    # the match and the distance sit beside the passport on
                    # the same path (empty trees without those searches)
                    match = fit_percent(json_comp)
                    if match is not None:
                        Fit.Add(match, ghp)
                    far = distance_km(json_comp)
                    if far is not None:
                        DistanceKm.Add(far, ghp)

                # Add filter description to the filter query output
                FilterDescription.Add(
                    filter_description,
                    Grasshopper.Kernel.Data.GH_Path(0)
                )

                return __Results

            elif response.status_code == 401:
                msg = 'Authentication failed. Please sign in again.'
                self._addError(msg)

            elif response.status_code == 403:
                msg = 'Access denied. Insufficient permissions.'
                self._addError(msg)

            elif response.status_code == 500:
                msg = 'Server error. Please try again later.'
                self._addWarning(msg)

            else:
                msg = (f'Request failed with status code: '
                       f'{response.status_code}')
                self._addError(msg)

        except requests.exceptions.ConnectionError as e:
            msg = 'Cannot connect to server. Please check your connection.'
            self._addError(msg + f'\nFull Error: {str(e)}')

        except requests.exceptions.Timeout as e:
            msg = 'Request timeout. Server may be slow.'
            self._addError(msg + f'\nFull Error: {str(e)}')

        except requests.exceptions.RequestException as e:
            msg = f'Request error: {str(e)}'
            self._addError(msg)

        except Exception as e:
            msg = f'Unexpected error: {str(e)}'
            self._addError(msg)

        # Return empty results if there was an error
        ComponentPassport = Grasshopper.DataTree[System.Object]()
        FilterDescription = Grasshopper.DataTree[System.Object]()
        Fit = Grasshopper.DataTree[System.Object]()
        DistanceKm = Grasshopper.DataTree[System.Object]()
        __Results = (FilterDescription, ComponentPassport, Fit, DistanceKm)
        return __Results
# ---------- end fetchfilteredcomponents ----------
panel_3 = Panel(fetchfilteredcomponents.FilterDescription)
componentpassport = Data(fetchfilteredcomponents.ComponentPassport)

# ---- group: __DDU_CSC_EXAMPLE_01__
# ENVIRONMENT SPEC: # -*- coding: utf-8 -*-
# #! python3
# # venv: DDU_CSC
# print('ENV OK!')
# # r: charset_normalizer
# # r: requests
# # r: numpy
# comments & notes: Fetch a subset of components from the database using filters. Here we are fetching the 'schoenes_neues_feld' dataset.
# 
# NOTE: ReservedStatus = -1 means we ignore reservations entirely
# ENVIRONMENT SPEC: # -*- coding: utf-8 -*-
# #! python3
# # venv: DDU_CSC_MATCH
# print('ENV OK!')
# # r: charset_normalizer
# # r: numpy
# # r: scipy
# # r: scikit-learn
# # r: trimesh
# # r: networkx
# Step 2
originalfunction_2 = ValueList({"Any function": , "Beam (IfcBeam)": "IfcBeam", "Column (IfcColumn)": "IfcColumn", "Slab (IfcSlab)": "IfcSlab", "Plate / Panel (IfcPlate)": "IfcPlate", "Wall (IfcWall)": "IfcWall", "Member (IfcMember)": "IfcMember", "Pipe (IfcPipeSegment)": "IfcPipeSegment", "Duct (IfcDuctSegment)": "IfcDuctSegment", "Footing (IfcFooting)": "IfcFooting", "Window (IfcWindow)": "IfcWindow", "Door / gate (IfcDoor)": "IfcDoor", "Stair (IfcStair)": "IfcStair", "Railing / balustrade (IfcRailing)": "IfcRailing", "Accessory / Connector (IfcDiscreteAccessory)": "IfcDiscreteAccessory", "Element part (IfcBuildingElementPart)": "IfcBuildingElementPart", "Unknown (IfcBuildingElementProxy)": "IfcBuildingElementProxy", "Debris (CscDebris)": "CscDebris"}, selected="Any function")
material_2 = ValueList({"Any material": , "Concrete (concrete)": "concrete", "Autoclaved aerated concrete (autoclaved_aerated_concrete)": "autoclaved_aerated_concrete", "Fired clay (fired_clay)": "fired_clay", "Calcium silicate (calcium_silicate)": "calcium_silicate", "Ceramic (ceramic)": "ceramic", "Natural stone (natural_stone)": "natural_stone", "Mixed mineral (mineral_mixture)": "mineral_mixture", "Gypsum (gypsum)": "gypsum", "Glass (glass)": "glass"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}, selected="Any material")
complexity_2 = ValueList({"Any complexity": , "0", "1", "2", "3"}, selected="Any complexity")
fragment_2 = ValueList({"Any": , "Only fragments": True, "Only non-fragmnents": False}, selected="Any")
shapeclass_2 = ValueList({"Any shape": , "Linear (linear)": "linear", "Planar (planar)": "planar", "Block (block)": "block", "Irregular (irregular)": "irregular", "Composite (composite)": "composite"}, selected="Any shape")
materialclass_2 = ValueList({"Any MaterialClass": , "Concrete (17 01 01)": "17 01 01", "Bricks (17 01 02)": "17 01 02", "Tiles and ceramics (17 01 03)": "17 01 03", "Mineral mixtures, hazardous (17 01 06*)": "17 01 06*", "Mineral mixtures (17 01 07)": "17 01 07", "Wood (17 02 01)": "17 02 01", "Glass (17 02 02)": "17 02 02", "Plastic (17 02 03)": "17 02 03", "Glass, plastic, wood, hazardous (17 02 04*)": "17 02 04*"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}, selected="Any MaterialClass")
circulation_2 = ValueList({"Active (default)": "active", "Exited": "exited", "All \"all": "All "all""}, selected="Active (default)")
fitmode_2 = ValueList({"Any Fit": , "About this size": "about", "Can hold this size": "can_hold"}, selected="Any Fit")
fitsizea_2 = Slider(0, range=-0.1..2000)
fitsizeb_2 = Slider(0, range=0..2000)
fitsizec_2 = Slider(0, range=0..500)
# Example 02:
# - Fetching single components
# - Fetching more detailed geometry
# - Retrieving ComponentData from geometry
fittolerance_2 = Panel("10%")
dataset_2 = Panel("schoenes_neues_feld")
mindimensionx_2 = Slider(0, range=-0.1..2000)
maxdimensionx_2 = Slider(0, range=0..2000)
mindimensiony_2 = Slider(0, range=0..2000)
maxdimensiony_2 = Slider(0, range=0..2000)
mindimensionz_2 = Slider(0, range=0..500)
maxdimensionz_2 = Slider(0, range=0..500)
reservedstatus_2 = Slider(-1, range=-1..1)
merge_2 = Merge(Data1=fitsizea_2, Data2=fitsizeb_2, Data3=fitsizec_2)
fitsize_2 = Data(merge_2)
fetchfilteredcomponents_2 = FetchFilteredComponents(
    Material=material_2,
    Dataset=dataset_2,
    Complexity=complexity_2,
    Fragment=fragment_2,
    MinDimensionX=mindimensionx_2,
    MaxDimensionX=maxdimensionx_2,
    MinDimensionY=mindimensiony_2,
    MaxDimensionY=maxdimensiony_2,
    MinDimensionZ=mindimensionz_2,
    MaxDimensionZ=maxdimensionz_2,
    ReservedStatus=reservedstatus_2,
    ShapeClass=shapeclass_2,
    MaterialClass=materialclass_2,
    Circulation=circulation_2,
    FitMode=fitmode_2,
    FitSize=fitsize_2,
    FitTolerance=fittolerance_2)  # -> FilterDescription, ComponentPassport, Fit, DistanceKm; inputs OriginalFunction: String, Material: String, Dataset: String, Complexity: Int32, Fragment: Boolean, MinDimensionX: Double, MaxDimensionX: Double, MinDimensionY: Double, MaxDimensionY: Double, MinDimensionZ: Double, MaxDimensionZ: Double, ShapeClass: String, MaterialClass: String, Circulation: String, FitMode: String, FitSize: list, FitTolerance: String, NearPoint: Vector3d, NearLayer: String, RadiusKm: Double; same code as fetchfilteredcomponents
panel_4 = Panel(fetchfilteredcomponents_2.FilterDescription)
componentpassport_2 = Data(fetchfilteredcomponents_2.ComponentPassport)

# ----
# Step 2
originalfunction_3 = ValueList({"Any function": , "Beam (IfcBeam)": "IfcBeam", "Column (IfcColumn)": "IfcColumn", "Slab (IfcSlab)": "IfcSlab", "Plate / Panel (IfcPlate)": "IfcPlate", "Wall (IfcWall)": "IfcWall", "Member (IfcMember)": "IfcMember", "Pipe (IfcPipeSegment)": "IfcPipeSegment", "Duct (IfcDuctSegment)": "IfcDuctSegment", "Footing (IfcFooting)": "IfcFooting", "Window (IfcWindow)": "IfcWindow", "Door / gate (IfcDoor)": "IfcDoor", "Stair (IfcStair)": "IfcStair", "Railing / balustrade (IfcRailing)": "IfcRailing", "Accessory / Connector (IfcDiscreteAccessory)": "IfcDiscreteAccessory", "Element part (IfcBuildingElementPart)": "IfcBuildingElementPart", "Unknown (IfcBuildingElementProxy)": "IfcBuildingElementProxy", "Debris (CscDebris)": "CscDebris"}, selected="Any function")
material_3 = ValueList({"Any material": , "Concrete (concrete)": "concrete", "Autoclaved aerated concrete (autoclaved_aerated_concrete)": "autoclaved_aerated_concrete", "Fired clay (fired_clay)": "fired_clay", "Calcium silicate (calcium_silicate)": "calcium_silicate", "Ceramic (ceramic)": "ceramic", "Natural stone (natural_stone)": "natural_stone", "Mixed mineral (mineral_mixture)": "mineral_mixture", "Gypsum (gypsum)": "gypsum", "Glass (glass)": "glass"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}, selected="Any material")
complexity_3 = ValueList({"Any complexity": , "0", "1", "2", "3"}, selected="Any complexity")
fragment_3 = ValueList({"Any": , "Only fragments": True, "Only non-fragmnents": False}, selected="Any")
shapeclass_3 = ValueList({"Any shape": , "Linear (linear)": "linear", "Planar (planar)": "planar", "Block (block)": "block", "Irregular (irregular)": "irregular", "Composite (composite)": "composite"}, selected="Any shape")
materialclass_3 = ValueList({"Any MaterialClass": , "Concrete (17 01 01)": "17 01 01", "Bricks (17 01 02)": "17 01 02", "Tiles and ceramics (17 01 03)": "17 01 03", "Mineral mixtures, hazardous (17 01 06*)": "17 01 06*", "Mineral mixtures (17 01 07)": "17 01 07", "Wood (17 02 01)": "17 02 01", "Glass (17 02 02)": "17 02 02", "Plastic (17 02 03)": "17 02 03", "Glass, plastic, wood, hazardous (17 02 04*)": "17 02 04*"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}, selected="Any MaterialClass")
circulation_3 = ValueList({"Active (default)": "active", "Exited": "exited", "All \"all": "All "all""}, selected="Active (default)")
mindimensionx_3 = Slider(0, range=-0.1..2000)
maxdimensionx_3 = Slider(0, range=0..2000)
mindimensiony_3 = Slider(0, range=0..2000)
maxdimensiony_3 = Slider(0, range=0..2000)
mindimensionz_3 = Slider(0, range=0..500)
maxdimensionz_3 = Slider(0, range=0..500)
reservedstatus_3 = Slider(-1, range=-1..1)
fitsizeb_3 = Slider(0, range=0..2000)
fitsizec_3 = Slider(0, range=0..500)
dataset_3 = Panel("mineral_composite_panels")
fittolerance_3 = Panel("10%")
fitsizea_3 = Slider(0, range=-0.1..2000)
fitmode_3 = ValueList({"Any Fit": , "About this size": "about", "Can hold this size": "can_hold"}, selected="Any Fit")
merge_3 = Merge(Data1=fitsizea_3, Data2=fitsizeb_3, Data3=fitsizec_3)
fitsize_3 = Data(merge_3)
fetchfilteredcomponents_3 = FetchFilteredComponents(
    OriginalFunction=originalfunction_3,
    Material=material_3,
    Dataset=dataset_3,
    Complexity=complexity_3,
    Fragment=fragment_3,
    MinDimensionX=mindimensionx_3,
    MaxDimensionX=maxdimensionx_3,
    MinDimensionY=mindimensiony_3,
    MaxDimensionY=maxdimensiony_3,
    MinDimensionZ=mindimensionz_3,
    MaxDimensionZ=maxdimensionz_3,
    ReservedStatus=reservedstatus_3,
    ShapeClass=shapeclass_3,
    MaterialClass=materialclass_3,
    Circulation=circulation_3,
    FitMode=fitmode_3,
    FitSize=fitsize_3,
    FitTolerance=fittolerance_3)  # -> FilterDescription, ComponentPassport, Fit, DistanceKm; inputs OriginalFunction: String, Material: String, Dataset: String, Complexity: Int32, Fragment: Boolean, MinDimensionX: Double, MaxDimensionX: Double, MinDimensionY: Double, MaxDimensionY: Double, MinDimensionZ: Double, MaxDimensionZ: Double, ShapeClass: String, MaterialClass: String, Circulation: String, FitMode: String, FitSize: list, FitTolerance: String, NearPoint: Vector3d, NearLayer: String, RadiusKm: Double; same code as fetchfilteredcomponents
panel_5 = Panel(fetchfilteredcomponents_3.FilterDescription)
componentpassport_3 = Data(fetchfilteredcomponents_3.ComponentPassport)

# ---- group: __DDU_CSC_EXAMPLE_02__
# Step 2
# comments & notes: Fetch a single component or multiple components from the catalogue using its ID.
# 
# NOTE: Also see the web interface component detail page. You can copy the ID of any component there directly as a GH-Panel!
# Example 03:
# - Fetching single components
# - Baking components
# - Sync components back to GH doc
# - Diassemble components
componentid = Panel("243df186-9e30-4b19-95aa-17d7d88976f9")
fetchcomponents = FetchComponents(IdentityID=componentid)  # -> ComponentPassport; inputs IdentityID: list
# ---------- fetchcomponents: Python ----------
#! python3
# -*- coding: utf-8 -*-
# venv: DDU_CSC
print('ENV OK!')
# r: charset_normalizer
# r: requests

# PYTHON STANDARD LIBRARY IMPORTS ---------------------------------------------
import json  # NOQA

# THIRD PARTY LIBRARY IMPORTS -------------------------------------------------
import requests  # NOQA

# RHINO AND GH RELATED IMPORTS ------------------------------------------------
import System  # NOQA
import Grasshopper  # NOQA
import Rhino  # NOQA
import scriptcontext as sc  # NOQA

# GHENV COMPONENT SETTINGS ----------------------------------------------------
ghenv.Component.Name = 'FetchComponents'  # NOQA
ghenv.Component.NickName = 'FetchComponents'  # NOQA
ghenv.Component.Category = 'DDU_CSC'  # NOQA
ghenv.Component.SubCategory = '2 Catalog Interface'  # NOQA
ghenv.Component.Description = (  # NOQA
    'Fetches specific identities (with their current snapshot) from the '
    'remote Catalog by their identity IDs. Supports caching and returns '
    'component passport JSON ({identity, snapshots[]}) with error handling for missing '
    'identities.'
)

# OPTIONAL HELPERS: they never block the component (decisions 8.112, 8.113) ---
try:
    from csc_gh.ports import ensure_outputs
    from csc_gh.messages import set_state
except ImportError:
    ensure_outputs = set_state = None

OUTPUTS = [
    ('ComponentPassport', 'ComponentPassport',
     "Component passport JSON per entry ({identity, snapshots[]}) fetched from the server. Use 'DisassembleComponent' to access the individual fields ready for Grasshopper"),
]


def empty_outputs():
    """What RunScript returns when it stops early or has no result: an empty
    Grasshopper tree per output (never '' or None)."""
    if not OUTPUTS:
        return None
    trees = tuple(Grasshopper.DataTree[System.Object]() for _ in OUTPUTS)
    return trees[0] if len(trees) == 1 else trees


class CSC_FetchComponents(Grasshopper.Kernel.GH_ScriptInstance):
    """
    Author: Max Benjamin Eschenbach
    License: MIT License
    Version: 261102
    """

    _outputs_ready = True       # set by BeforeRunScript (8.112)
    _outputs_note = None

    def __init__(self):
        """Initialize this component and set component parameters."""
        super().__init__()
        # initialize props
        self.Component = ghenv.Component  # NOQA
        self.InputParams = self.Component.Params.Input
        self.OutputParams = self.Component.Params.Output

    def _addRemark(self, msg: str = ''):
        """Add a remark message to the component."""
        rml = self.Component.RuntimeMessageLevel.Remark
        self.AddRuntimeMessage(rml, msg)

    def _addWarning(self, msg: str = ''):
        """Add a warning message to the component."""
        rml = self.Component.RuntimeMessageLevel.Warning
        self.AddRuntimeMessage(rml, msg)

    def _addError(self, msg: str = ''):
        """Add an error message to the component."""
        rml = self.Component.RuntimeMessageLevel.Error
        self.AddRuntimeMessage(rml, msg)

    def _state(self, text=''):
        """The one short state under the component (decision 8.113)."""
        if set_state is not None:
            set_state(self.Component, text)

    def _stop(self):
        """True when RunScript has to return early: the outputs were just
        updated (says why)."""
        if self._outputs_note:
            self._addRemark(self._outputs_note)
        return not self._outputs_ready

    def _check_outputs(self):
        """Make the outputs match OUTPUTS before the script runs (8.112)."""
        self._outputs_ready, self._outputs_note = True, None
        if ensure_outputs is None:
            self._outputs_note = (
                'output check skipped: CSC library not installed')
            return
        status = ensure_outputs(self.Component, OUTPUTS)
        self._outputs_ready, self._outputs_note = status.ready, status.remark

    def BeforeRunScript(self):
        """Perform some setup actions."""
        # Initialize input param descriptions
        self.InputParams[0].Description = (
            'One or many identity IDs (UUIDs) to fetch'
        )
        # Initialize output param descriptions
        self._check_outputs()

    def get_auth_core_from_sticky(self):
        """Get AuthCore instance from sticky storage."""
        auth_core = sc.sticky.get('CSC_AuthCore')
        if auth_core is None:
            msg = ('No authentication found. Please use CSC_Session component '
                   'first.')
            self._addWarning(msg)
            return None
        return auth_core

    def RunScript(self, IdentityID: list[object]):
        # Get AuthCore instance from sticky storage
        if self._stop():
            return empty_outputs()
        auth_core = self.get_auth_core_from_sticky()
        if auth_core is None:
            return empty_outputs()

        # Check if authentication is valid
        if not auth_core.is_valid():
            msg = ('Authentication expired. Please use CSC_Session '
                   'component to refresh.')
            self._addWarning(msg)
            return empty_outputs()

        # Validate identity ID input
        if not IdentityID:
            msg = 'Please provide identity ID(s) to fetch.'
            self._addWarning(msg)
            return empty_outputs()

        # Convert to list and validate UUIDs
        component_ids = list(IdentityID)
        for _id in component_ids:
            if not auth_core.validate_uuid(_id):
                msg = f'Identity ID <{_id}> is not a valid UUID!'
                self._addWarning(msg)
                return empty_outputs()

        try:

            # Set up output trees and results tuple
            ComponentPassport = Grasshopper.DataTree[System.Object]()
            __Results = (ComponentPassport,)

            # Fetch each identity's current-snapshot passport
            for i, _id in enumerate(component_ids):
                try:
                    # Unified catalog cache (identity + snapshot stored
                    # independently, passport assembled on read).
                    response = auth_core.cached_get_passport(_id)

                    if response.status_code == 200:
                        # Successfully fetched passport (from server or cache)
                        json_comp = response.json()

                        # Create datatree path
                        ghp = Grasshopper.Kernel.Data.GH_Path(i)
                        # Add canonical passport JSON to the datatree
                        ComponentPassport.Add(
                            auth_core.passport_json_string(json_comp), ghp)

                        self._addRemark(
                            f'Successfully fetched component {_id}'
                        )

                    elif response.status_code == 404:
                        msg = f'Identity {_id} not found on server.'
                        self._addWarning(msg)

                    elif response.status_code == 401:
                        msg = 'Authentication failed. Please sign in again.'
                        self._addError(msg)
                        return __Results

                    elif response.status_code == 403:
                        msg = 'Access denied. Insufficient permissions.'
                        self._addError(msg)
                        return __Results

                    elif response.status_code == 500:
                        msg = 'Server error. Please try again later.'
                        self._addWarning(msg)

                    else:
                        msg = (f'Request failed for component {_id} with '
                               f'status code: {response.status_code}')
                        self._addError(msg)

                except Exception as e:
                    msg = f'Error fetching component {_id}: {str(e)}'
                    self._addError(msg)

            # Update success message
            if ComponentPassport.DataCount > 0:
                self._state(f'{ComponentPassport.DataCount} fetched')
            else:
                self._state('Nothing fetched')

            return __Results

        except requests.exceptions.ConnectionError as e:
            msg = 'Cannot connect to server. Please check your connection.'
            self._addError(msg + f'\nFull Error: {str(e)}')

        except requests.exceptions.Timeout as e:
            msg = 'Request timeout. Server may be slow.'
            self._addError(msg + f'\nFull Error: {str(e)}')

        except requests.exceptions.RequestException as e:
            msg = f'Request error: {str(e)}'
            self._addError(msg)

        except Exception as e:
            msg = f'Unexpected error: {str(e)}'
            self._addError(msg)

        # Return empty results if there was an error
        ComponentPassport = Grasshopper.DataTree[System.Object]()
        __Results = (ComponentPassport,)
        return __Results
# ---------- end fetchcomponents ----------
componentpassport_4 = Data(fetchcomponents)

# ---- group: __DDU_CSC_EXAMPLE_03__
# Step 2
# Example 04:
# - Fetching all components of a certain dataset
# - Filter the already fetched components by dimensions (faster if you already have fetched components)
# - Disassemble the components to get individual fields and properties
componentid_2 = Panel("243df186-9e30-4b19-95aa-17d7d88976f9")
fetchcomponents_2 = FetchComponents(IdentityID=componentid_2)  # -> ComponentPassport; inputs IdentityID: list; same code as fetchcomponents
componentpassport_5 = Data(fetchcomponents_2)

# ---- group: __DDU_CSC_EXAMPLE_08__
# Step 1.1
# Example 09:
# - Still in development: Multi Snapshot Retrieval
latitude_longitude_string_i_e_from_googl = Panel("49.861254, 8.674743")  # "Latitude/Longitude String (i.e. from Google Maps)"
comments_notes = Panel("ExFeld Geolocation")
convertgeolocation = ConvertGeoLocation(LatLonString=latitude_longitude_string_i_e_from_googl)  # -> Lat, Lon, Vec; inputs LatLonString: String
# ---------- convertgeolocation: Python ----------
#! python3
# -*- coding: utf-8 -*-
# venv: DDU_CSC
print('ENV OK!')
# r: charset_normalizer
# r: requests

# RHINO AND GH RELATED IMPORTS ------------------------------------------------
import System  # NOQA
import Grasshopper  # NOQA
import Rhino  # NOQA
import scriptcontext as sc  # NOQA

# GHENV COMPONENT SETTINGS ----------------------------------------------------
ghenv.Component.Name = 'ConvertGeoLocation'  # NOQA
ghenv.Component.NickName = 'ConvertGeoLocation'  # NOQA
ghenv.Component.Category = 'DDU_CSC'  # NOQA
ghenv.Component.SubCategory = '6 Data Tools'  # NOQA
ghenv.Component.Description = (  # NOQA
    'Converts a latitude, longitude string (i.e. from Google Maps) '
    'to its individual components. Example input: "12.1231321, 9.1231231312" '
    'Returns the location as individual numbers and as vector.'
)

# OPTIONAL HELPERS: they never block the component (decisions 8.112, 8.113) ---
try:
    from csc_gh.ports import ensure_outputs
    from csc_gh.messages import set_state, waits_for_data
except ImportError:
    ensure_outputs = set_state = waits_for_data = None

OUTPUTS = [
    ('Lat', 'Lat',
     'Latitude component of the input string as float.'),
    ('Lon', 'Lon',
     'Longitude component of the input string as float.'),
    ('Vec', 'Vec',
     'Vector with lat/lon as X/Y.'),
]


def empty_outputs():
    """What RunScript returns when it stops early or has no result: an empty
    Grasshopper tree per output (never '' or None)."""
    if not OUTPUTS:
        return None
    trees = tuple(Grasshopper.DataTree[System.Object]() for _ in OUTPUTS)
    return trees[0] if len(trees) == 1 else trees


def null_outputs():
    """One null per output: an item of an item-access component that has no
    result keeps its slot (decision 8.186)."""
    if len(OUTPUTS) <= 1:
        return None
    return tuple(None for _ in OUTPUTS)


class CSC_ConvertGeoLocation(Grasshopper.Kernel.GH_ScriptInstance):
    """
    Author: Max Benjamin Eschenbach
    License: MIT License
    Version: 261102
    """

    _outputs_ready = True       # set by BeforeRunScript (8.112)
    _outputs_note = None

    def __init__(self):
        """Initialize this component and set component parameters."""
        super().__init__()
        # initialize props
        self.Component = ghenv.Component  # NOQA
        self.InputParams = self.Component.Params.Input
        self.OutputParams = self.Component.Params.Output

    def _addRemark(self, msg: str = ''):
        """Add a remark message to the component."""
        rml = self.Component.RuntimeMessageLevel.Remark
        self.AddRuntimeMessage(rml, msg)

    def _addWarning(self, msg: str = ''):
        """Add a warning message to the component."""
        rml = self.Component.RuntimeMessageLevel.Warning
        self.AddRuntimeMessage(rml, msg)

    def _addError(self, msg: str = ''):
        """Add an error message to the component."""
        rml = self.Component.RuntimeMessageLevel.Error
        self.AddRuntimeMessage(rml, msg)

    def _state(self, text=''):
        """The one short state under the component (decision 8.113)."""
        if set_state is not None:
            set_state(self.Component, text)

    def _no_result(self, *ports):
        """The result of an iteration without one (decision 8.186): empty
        outputs when the inputs in ``ports`` carry no data at all (the
        component waits for data; no ports: a list or tree input is empty),
        else a null in the slot of this item, so the outputs stay one to one
        with the input list."""
        if not ports or (waits_for_data is not None
                         and waits_for_data(self, ports)):
            return empty_outputs()
        return null_outputs()

    def _stop(self):
        """True when RunScript has to return early: the outputs were just
        updated (says why)."""
        if self._outputs_note:
            self._addRemark(self._outputs_note)
        return not self._outputs_ready

    def _check_outputs(self):
        """Make the outputs match OUTPUTS before the script runs (8.112)."""
        self._outputs_ready, self._outputs_note = True, None
        if ensure_outputs is None:
            self._outputs_note = (
                'output check skipped: CSC library not installed')
            return
        status = ensure_outputs(self.Component, OUTPUTS)
        self._outputs_ready, self._outputs_note = status.ready, status.remark

    def BeforeRunScript(self):
        """Perform some setup actions."""
        # Initialize input param descriptions
        self.InputParams[0].Description = (
            'Latitude, Longitude string, e.g. "12.1231321, 9.1231231312" '
        )
        # Initialize output param descriptions
        self._check_outputs()

    def RunScript(self, LatLonString: str):
        if self._stop():
            return empty_outputs()
        Lat = Grasshopper.DataTree[object]()
        Lon = Grasshopper.DataTree[object]()
        Vec = Grasshopper.DataTree[object]()
        _Results = [Lat, Lon, Vec]
        if not LatLonString:
            msg = 'Parameter LatLonString failed to collect data!'
            self._addWarning(msg)
            return self._no_result('LatLonString')
        parts = LatLonString.split(',')
        if len(parts) > 2:
            msg = f'Splitting of Lat/Lon string failed! Raw result is {parts}...'
            self._addError(msg)
            return null_outputs()
        Lat = float(parts[0].strip())
        Lon = float(parts[1].strip())
        Vec = Rhino.Geometry.Vector3d(Lat, Lon, 0)
        _Results = [Lat, Lon, Vec]
        return _Results
# ---------- end convertgeolocation ----------
location = Data(convertgeolocation.Vec)

# ---- group: __DDU_CSC_EXAMPLE_02__
# Step 1
disablecache = BooleanToggle(False)
clearcache = Button()
signout = Button()
signin = Button()
csc_session = Session(SignIn=signin, SignOut=signout, DisableCache=disablecache, ClearCache=clearcache)  # -> Status; inputs Username: String, Password: String, SignIn: Boolean, SignOut: Boolean, DisableCache: Boolean, ClearCache: Boolean
# ---------- csc_session: Python ----------
#! python3
# -*- coding: utf-8 -*-
# venv: DDU_CSC
# r: charset_normalizer
# r: requests==2.32.5
# r: numpy==2.0.2
print('ENV OK!')

# PYTHON STANDARD LIBRARY IMPORTS ---------------------------------------------
import time  # NOQA
import json  # NOQA
import base64  # NOQA
import os  # NOQA
import hashlib  # NOQA
import pickle  # NOQA
import math  # NOQA
import struct  # NOQA
from threading import RLock  # NOQA
import uuid  # NOQA
from datetime import datetime, timedelta  # NOQA

# THIRD PARTY LIBRARY IMPORTS -------------------------------------------------
import requests  # NOQA

# RHINO AND GH RELATED IMPORTS ------------------------------------------------
import System  # NOQA
import Rhino  # NOQA
import Grasshopper  # NOQA
import scriptcontext as sc  # NOQA

# GHENV COMPONENT SETTINGS ----------------------------------------------------
ghenv.Component.Name = 'Session'  # NOQA
ghenv.Component.NickName = 'CSC_Session'  # NOQA
ghenv.Component.Category = 'DDU_CSC'  # NOQA
ghenv.Component.SubCategory = '1 User'  # NOQA
ghenv.Component.Description = (  # NOQA
    'Handles user authentication with the remote API (server address '
    'input; SignIn opens the browser, or connect Username and Password), '
    'manages access tokens, keeps one connection alive for all '
    'requests and provides a unified catalog cache (identities and '
    'snapshots stored independently, mesh PLY geometry cached per '
    'snapshot). Stores authentication state in scriptcontext.sticky.'
)

"""
Author: Max Benjamin Eschenbach
License: MIT License
Version: 261102
"""

# Sent as X-CSC-Client on every request so the backend can tell which
# UserObjects release is calling (spec 7.4).
CSC_CLIENT = 'gh-userobjects/0.6.4.4'

# The server of a fresh session; the Server input of this component changes it.
DEFAULT_SERVER = 'https://api.2ndchances.build'

# CSC LIBRARY (decision 8.111) ----------------------------------------------
CSC_GH_MINIMUM = '261020'
LIBRARY_PROBLEM = None
try:
    import csc_gh
    csc_gh.require(CSC_GH_MINIMUM)
    from csc_gh.rhino import (mesh_from_ply, point_cloud_from_ply)  # NOQA
    from csc_gh import signin as csc_signin  # NOQA
except ImportError:
    csc_signin = None
    LIBRARY_PROBLEM = (
        'CSC library 261020 too old or missing: run CSC_Update, '
        'then restart Rhino')

# OPTIONAL HELPERS: they never block the component (decisions 8.112, 8.113) ---
try:
    from csc_gh.ports import ensure_outputs
    from csc_gh.messages import set_state
except ImportError:
    ensure_outputs = set_state = None

OUTPUTS = [
    ('Status', 'Status',
     'Status Message'),
]


def empty_outputs():
    """What RunScript returns when it stops early or has no result: an empty
    Grasshopper tree per output (never '' or None)."""
    if not OUTPUTS:
        return None
    trees = tuple(Grasshopper.DataTree[System.Object]() for _ in OUTPUTS)
    return trees[0] if len(trees) == 1 else trees


def is_windows():
    """The sign-in without a password is Windows only (DPAPI)."""
    return os.name == 'nt'


def open_browser(url):
    """Open an address in the default browser (the sign-in page)."""
    if is_windows() and hasattr(os, 'startfile'):
        os.startfile(url)
        return
    import webbrowser
    webbrowser.open(url)


class CSCClientOutdated(RuntimeError):
    """The server answered 426: this UserObjects release is too old."""


def server_url(value):
    """A server address as typed (``localhost:8010``, a full URL, empty =
    the default) as a URL without a trailing slash."""
    value = (value or '').strip()
    if not value:
        return DEFAULT_SERVER
    if '://' not in value:
        host = value.split('/')[0].lower()
        host = (host.split(']')[0] + ']' if host.startswith('[')
                else host.split(':')[0])
        local = host in ('localhost', '127.0.0.1', '[::1]')
        value = ('http://' if local else 'https://') + value
    return value.rstrip('/')


def outdated_message(response):
    """The sentence of a 426 answer: the server's reason and the fix."""
    try:
        detail = response.json().get('detail')
    except Exception:
        detail = None
    detail = detail or 'this UserObjects release is older than the server needs'
    if 'CSC_Update' not in str(detail):
        detail = f'{detail}: update the UserObjects with CSC_Update'
    return f'Server refused this client (426): {detail}'


def _compute_passport_etag(identity_doc, snapshot_docs):
    """Match backend ``_compute_passport_etag`` (identity + snapshot rows)."""
    parts = [identity_doc.get('lastmodified', '')]
    for doc in sorted(
            snapshot_docs or [],
            key=lambda row: str(row.get('_id', ''))):
        parts.append(str(doc.get('etag', '')))
    return hashlib.sha256('::'.join(parts).encode('utf-8')).hexdigest()


def _passport_cache_key(identity_id, snapshots=None):
    """Stable cache key for a passport GET variant."""
    if not snapshots or snapshots == 'current':
        return f'passport:{identity_id}:current'
    if snapshots == 'all':
        return f'passport:{identity_id}:all'
    if isinstance(snapshots, (list, tuple)):
        joined = ','.join(sorted(str(item) for item in snapshots))
        digest = hashlib.md5(joined.encode('utf-8')).hexdigest()[:16]
        return f'passport:{identity_id}:ids:{digest}'
    return f'passport:{identity_id}:custom'


def primary_snapshot_from_passport(passport):
    """Return the first snapshot from a passport payload."""
    if not isinstance(passport, dict):
        return None
    snapshots = passport.get('snapshots') or []
    if snapshots and isinstance(snapshots[0], dict):
        return snapshots[0]
    legacy = passport.get('snapshot')
    if isinstance(legacy, dict):
        return legacy
    return None


def normalize_passport_payload(passport):
    """
    Ensure passport-shaped dicts use {identity, snapshots[]}.

    Accepts legacy {identity, snapshot} list rows and normalizes them.
    """
    if not isinstance(passport, dict):
        return passport
    identity = passport.get('identity')
    if not isinstance(identity, dict):
        return passport

    snapshots = passport.get('snapshots')
    if isinstance(snapshots, list) and snapshots:
        out = {'identity': identity, 'snapshots': snapshots}
    else:
        legacy = passport.get('snapshot')
        if isinstance(legacy, dict):
            out = {'identity': identity, 'snapshots': [legacy]}
        else:
            return passport

    if 'reserved_by_username' in passport:
        out['reserved_by_username'] = passport['reserved_by_username']
    return out


def _query_cache_key(params):
    """Stable cache key for a GET /identities query parameter dict."""
    if not params:
        return 'query:identities'
    items = sorted((str(k), str(v)) for k, v in params.items())
    payload = '&'.join(f'{k}={v}' for k, v in items)
    return 'query:' + hashlib.md5(payload.encode('utf-8')).hexdigest()


class _CachedResponse(object):
    """Minimal response wrapper for cache hits (status 200 + JSON body)."""

    def __init__(self, data, etag=None, status_code=200):
        self.status_code = status_code
        self._data = data
        self._etag = etag

    def json(self):
        return self._data

    @property
    def headers(self):
        return {'ETag': self._etag} if self._etag else {}


# ComponentCache - Embedded ---------------------------------------------------

class _ComponentCache(object):
    """
    Component cache manager for efficient local storage and retrieval.

    Author: Max Benjamin Eschenbach
    License: MIT License
    """

    def __init__(self, cache_dir=None, ttl_hours=24):
        self.ttl_hours = ttl_hours
        self.cache_dir = cache_dir or self._get_default_cache_dir()
        self.components_dir = os.path.join(self.cache_dir, 'components')
        self.identities_dir = os.path.join(self.cache_dir, 'identities')
        self.snapshots_dir = os.path.join(self.cache_dir, 'snapshots')
        self.metadata_dir = os.path.join(self.cache_dir, 'metadata')
        self.geometry_dir = os.path.join(self.cache_dir, 'component_geometry')
        self._lock = RLock()

        # Ensure cache directories exist
        self._ensure_cache_dirs()
        # A cache written by another client release is not trusted: purge
        # it once when the release changes (0.5 documents differ from 0.6)
        self._purge_on_client_change()

    def _get_default_cache_dir(self):
        """Get platform-specific cache directory."""
        if os.name == 'nt':  # Windows
            appdata = os.environ.get('APPDATA', '')
            return os.path.join(appdata, 'DDU_CSC', 'cache')
        else:  # macOS/Linux
            home = os.path.expanduser('~')
            return os.path.join(
                home, 'Library', 'Application Support', 'DDU_CSC', 'cache'
            )

    def _ensure_cache_dirs(self):
        """Create cache directories if they don't exist."""
        dirs = [
            self.cache_dir, self.components_dir, self.identities_dir,
            self.snapshots_dir, self.metadata_dir, self.geometry_dir
        ]
        for directory in dirs:
            if not os.path.exists(directory):
                os.makedirs(directory, exist_ok=True)

    def _purge_on_client_change(self):
        """Empty the cache once when CSC_CLIENT changed since it was written."""
        stamp = os.path.join(self.cache_dir, 'client_release.txt')
        try:
            with open(stamp, 'r', encoding='utf-8') as f:
                written_by = f.read().strip()
        except (IOError, OSError):
            written_by = ''
        if written_by == CSC_CLIENT:
            return
        if written_by or os.listdir(self.metadata_dir):
            self.invalidate()
        try:
            with open(stamp, 'w', encoding='utf-8') as f:
                f.write(CSC_CLIENT)
        except (IOError, OSError):
            pass

    def _get_cache_key_hash(self, cache_key):
        """Generate a safe filename from cache key."""
        return hashlib.md5(cache_key.encode('utf-8')).hexdigest()

    def _is_expired(self, timestamp_str):
        """Check if cache entry is expired based on TTL."""
        try:
            timestamp = datetime.fromisoformat(
                timestamp_str.replace('Z', '+00:00'))
            expiry = timestamp + timedelta(hours=self.ttl_hours)
            return datetime.now(timestamp.tzinfo) > expiry
        except (ValueError, TypeError):
            return True  # If we can't parse timestamp, consider expired

    def get(self, cache_key, filters=None):
        """
        Get cached data for a cache key.

        Args:
            cache_key: Cache key (e.g., 'all_components', 'component:uuid')
            filters: Optional filter parameters for metadata cache

        Returns:
            Tuple of (data, etag, is_from_cache) or
            (None, None, False) if not found
        """
        # Try binary cache first
        return self.get_binary(cache_key)

    def set(self, cache_key, data, etag=None, filters=None):
        """
        Store data in cache.

        Args:
            cache_key: Cache key
            data: Data to cache
            etag: ETag for the data
            filters: Optional filter parameters
        """
        # Use binary cache
        self.set_binary(cache_key, data, etag, filters)

    def _write_metadata(self, cache_key, metadata):
        metadata_file = os.path.join(
            self.metadata_dir,
            f"{self._get_cache_key_hash(cache_key)}.json"
        )
        with open(metadata_file, 'w', encoding='utf-8') as f:
            json.dump(metadata, f, indent=2, ensure_ascii=False)

    def _read_metadata(self, cache_key):
        metadata_file = os.path.join(
            self.metadata_dir,
            f"{self._get_cache_key_hash(cache_key)}.json"
        )
        if not os.path.exists(metadata_file):
            return None
        with open(metadata_file, 'r', encoding='utf-8') as f:
            metadata = json.load(f)
        if self._is_expired(metadata.get('cached_at', '')):
            return None
        return metadata

    # Identity / snapshot catalog cache (v0.5) -------------------------------

    def set_identity(self, identity_id, identity_doc):
        """Store one identity document (keyed by identity id)."""
        with self._lock:
            try:
                cache_key = f'identity:{identity_id}'
                identity_file = os.path.join(
                    self.identities_dir, f'{identity_id}.pkl'
                )
                with open(identity_file, 'wb') as f:
                    pickle.dump(identity_doc, f)
                self._write_metadata(cache_key, {
                    'cache_key': cache_key,
                    'cached_at': datetime.now().isoformat(),
                    'etag': identity_doc.get('lastmodified'),
                    'type': 'identity',
                    'current_snapshot_id': identity_doc.get(
                        'current_snapshot_id'),
                })
            except (IOError, pickle.PickleError):
                pass

    def get_identity(self, identity_id):
        """Return (identity_doc, etag, is_cached)."""
        with self._lock:
            try:
                cache_key = f'identity:{identity_id}'
                metadata = self._read_metadata(cache_key)
                if metadata is None:
                    return None, None, False
                identity_file = os.path.join(
                    self.identities_dir, f'{identity_id}.pkl'
                )
                if not os.path.exists(identity_file):
                    return None, None, False
                with open(identity_file, 'rb') as f:
                    identity_doc = pickle.load(f)
                return identity_doc, metadata.get('etag'), True
            except (IOError, pickle.PickleError, KeyError):
                return None, None, False

    def set_snapshot(self, snapshot_id, snapshot_doc):
        """Store one snapshot document (keyed by snapshot id)."""
        with self._lock:
            try:
                cache_key = f'snapshot:{snapshot_id}'
                snapshot_file = os.path.join(
                    self.snapshots_dir, f'{snapshot_id}.pkl'
                )
                with open(snapshot_file, 'wb') as f:
                    pickle.dump(snapshot_doc, f)
                self._write_metadata(cache_key, {
                    'cache_key': cache_key,
                    'cached_at': datetime.now().isoformat(),
                    'etag': snapshot_doc.get('etag'),
                    'type': 'snapshot',
                    'identity_id': snapshot_doc.get('identity_id'),
                })
            except (IOError, pickle.PickleError):
                pass

    def get_snapshot(self, snapshot_id):
        """Return (snapshot_doc, etag, is_cached)."""
        with self._lock:
            try:
                cache_key = f'snapshot:{snapshot_id}'
                metadata = self._read_metadata(cache_key)
                if metadata is None:
                    return None, None, False
                snapshot_file = os.path.join(
                    self.snapshots_dir, f'{snapshot_id}.pkl'
                )
                if not os.path.exists(snapshot_file):
                    return None, None, False
                with open(snapshot_file, 'rb') as f:
                    snapshot_doc = pickle.load(f)
                return snapshot_doc, metadata.get('etag'), True
            except (IOError, pickle.PickleError, KeyError):
                return None, None, False

    def ingest_passport_row(self, row):
        """
        Store identity + snapshot(s) from one passport row.

        Accepts {identity, snapshots[]} and list rows {identity, snapshot}.
        Returns the identity id when stored, else None.
        """
        if not isinstance(row, dict):
            return None
        identity = row.get('identity')
        if not isinstance(identity, dict):
            return None
        identity_id = identity.get('_id') or identity.get('id')
        if not identity_id:
            return None

        stored_any = False
        snapshots = row.get('snapshots') or []
        if isinstance(snapshots, list) and snapshots:
            for snapshot in snapshots:
                if not isinstance(snapshot, dict):
                    continue
                snapshot_id = snapshot.get('_id') or snapshot.get('id')
                if not snapshot_id:
                    continue
                self.set_snapshot(snapshot_id, snapshot)
                stored_any = True
        else:
            snapshot = row.get('snapshot')
            if isinstance(snapshot, dict):
                snapshot_id = snapshot.get('_id') or snapshot.get('id')
                if snapshot_id:
                    self.set_snapshot(snapshot_id, snapshot)
                    stored_any = True

        if not stored_any:
            return None

        self.set_identity(identity_id, identity)
        return identity_id

    def ingest_passport_rows(self, rows):
        """Store many passport rows; return ordered identity ids."""
        identity_ids = []
        for row in rows or []:
            identity_id = self.ingest_passport_row(row)
            if identity_id:
                identity_ids.append(identity_id)
        return identity_ids

    def assemble_passport(self, identity_id):
        """
        Build {identity, snapshots:[current]} from cached documents.

        Uses identity.current_snapshot_id to pick the snapshot.
        """
        identity_doc, _, identity_ok = self.get_identity(identity_id)
        if not identity_ok or not identity_doc:
            return None
        snapshot_id = identity_doc.get('current_snapshot_id')
        if not snapshot_id:
            return None
        snapshot_doc, _, snapshot_ok = self.get_snapshot(snapshot_id)
        if not snapshot_ok or not snapshot_doc:
            return None
        return {
            'identity': identity_doc,
            'snapshots': [snapshot_doc],
        }

    def set_query(self, query_key, identity_ids, etag=None, params=None):
        """Store list-query metadata (identity id index + list ETag)."""
        with self._lock:
            try:
                self._write_metadata(query_key, {
                    'cache_key': query_key,
                    'cached_at': datetime.now().isoformat(),
                    'etag': etag,
                    'type': 'query',
                    'identity_ids': list(identity_ids),
                    'params': params,
                })
            except (IOError, TypeError):
                pass

    def get_query(self, query_key):
        """Return (identity_ids, etag, is_cached) for a list query."""
        with self._lock:
            try:
                metadata = self._read_metadata(query_key)
                if metadata is None:
                    return None, None, False
                return (
                    metadata.get('identity_ids') or [],
                    metadata.get('etag'),
                    True,
                )
            except (IOError, KeyError):
                return None, None, False

    def assemble_passport_list(self, identity_ids):
        """Build passport rows from cached identity/snapshot documents."""
        rows = []
        for identity_id in identity_ids or []:
            passport = self.assemble_passport(identity_id)
            if passport:
                rows.append(passport)
        return rows

    def invalidate(self, pattern=None):
        """
        Invalidate cache entries.

        Args:
            pattern: Optional pattern to match cache keys (None = clear all)
        """
        with self._lock:
            try:
                if pattern is None:
                    # Clear all cache
                    for directory in [
                            self.components_dir,
                            self.identities_dir,
                            self.snapshots_dir,
                            self.metadata_dir,
                            self.geometry_dir
                    ]:
                        if os.path.exists(directory):
                            for filename in os.listdir(directory):
                                file_path = os.path.join(directory, filename)
                                if os.path.isfile(file_path):
                                    os.remove(file_path)
                                elif os.path.isdir(file_path):
                                    # Remove subdirectories
                                    # (geometry type folders)
                                    import shutil
                                    shutil.rmtree(
                                        file_path,
                                        ignore_errors=True
                                    )
                else:
                    # Clear specific pattern
                    pattern_hash = self._get_cache_key_hash(pattern)
                    metadata_file = os.path.join(
                        self.metadata_dir, f"{pattern_hash}.json"
                    )
                    if os.path.exists(metadata_file):
                        os.remove(metadata_file)

            except (IOError, OSError):
                pass

    def get_cache_stats(self):
        """Get cache statistics."""
        with self._lock:
            try:
                component_count = len(
                    [f for f in os.listdir(self.components_dir)
                     if f.endswith('.pkl')]
                )
                identity_count = len(
                    [f for f in os.listdir(self.identities_dir)
                     if f.endswith('.pkl')]
                )
                snapshot_count = len(
                    [f for f in os.listdir(self.snapshots_dir)
                     if f.endswith('.pkl')]
                )
                metadata_count = len(
                    [f for f in os.listdir(self.metadata_dir)
                     if f.endswith('.json')]
                )

                # Calculate total cache size
                total_size = 0
                for directory in [
                        self.components_dir, self.identities_dir,
                        self.snapshots_dir, self.metadata_dir
                ]:
                    for filename in os.listdir(directory):
                        file_path = os.path.join(directory, filename)
                        if os.path.isfile(file_path):
                            total_size += os.path.getsize(file_path)

                # Calculate geometry cache stats
                geometry_count = 0
                geometry_size = 0
                if os.path.exists(self.geometry_dir):
                    for root, dirs, files in os.walk(self.geometry_dir):
                        for file in files:
                            if file.endswith('.pkl'):
                                geometry_count += 1
                                file_path = os.path.join(root, file)
                                if os.path.isfile(file_path):
                                    geometry_size += os.path.getsize(file_path)

                return {
                    'component_count': component_count,
                    'identity_count': identity_count,
                    'snapshot_count': snapshot_count,
                    'metadata_count': metadata_count,
                    'geometry_count': geometry_count,
                    'total_size_bytes': total_size + geometry_size,
                    'geometry_size_bytes': geometry_size,
                    'cache_dir': self.cache_dir
                }
            except (IOError, OSError):
                return {
                    'component_count': 0,
                    'identity_count': 0,
                    'snapshot_count': 0,
                    'metadata_count': 0,
                    'geometry_count': 0,
                    'total_size_bytes': 0,
                    'geometry_size_bytes': 0,
                    'cache_dir': self.cache_dir
                }

    def get_binary(self, cache_key):
        """
        Get cached data from binary cache.

        Args:
            cache_key: Cache key (e.g., 'component:uuid')

        Returns:
            Tuple of (data, etag, is_from_cache) or
            (None, None, False) if not found
        """
        with self._lock:
            try:
                # Check metadata cache first
                metadata_file = os.path.join(
                    self.metadata_dir,
                    f"{self._get_cache_key_hash(cache_key)}.json"
                )

                if not os.path.exists(metadata_file):
                    return None, None, False

                with open(metadata_file, 'r', encoding='utf-8') as f:
                    metadata = json.load(f)

                # Check if expired
                if self._is_expired(metadata.get('cached_at', '')):
                    return None, None, False

                # Handle different cache key types
                if cache_key.startswith('component:'):
                    # Individual component
                    component_id = cache_key.split(':', 1)[1]
                    component_file = os.path.join(
                        self.components_dir, f"{component_id}.pkl"
                    )

                    if os.path.exists(component_file):
                        with open(component_file, 'rb') as f:
                            component_data = pickle.load(f)
                        return component_data, metadata.get('etag'), True

                elif cache_key == 'schema:create_identity':
                    # Schema data is stored directly in metadata
                    return metadata.get('data'), metadata.get('etag'), True

                return None, None, False

            except (IOError, pickle.PickleError, KeyError):
                return None, None, False

    def set_binary(self, cache_key, data, etag=None, filters=None):
        """
        Store data in binary cache.

        Args:
            cache_key: Cache key
            data: Data to cache
            etag: ETag for the data
            filters: Optional filter parameters
        """
        with self._lock:
            try:
                current_time = datetime.now().isoformat()
                # Guards against unhandled cache keys (avoids referencing an
                # unassigned ``metadata`` at the write step below).
                metadata = None

                if cache_key.startswith('component:'):
                    # Individual component
                    component_id = cache_key.split(':', 1)[1]
                    component_file = os.path.join(
                        self.components_dir, f"{component_id}.pkl"
                    )

                    # Store component data as pickle
                    with open(component_file, 'wb') as f:
                        pickle.dump(data, f)

                    # Store metadata
                    metadata = {
                        'cache_key': cache_key,
                        'cached_at': current_time,
                        'etag': etag,
                        'type': 'component'
                    }

                elif cache_key == 'schema:create_identity':
                    # Schema data - store directly in metadata
                    metadata = {
                        'cache_key': cache_key,
                        'cached_at': current_time,
                        'etag': etag,
                        'type': 'schema',
                        'data': data
                    }

                # Unhandled cache key: nothing to persist, bail out safely
                if metadata is None:
                    return

                # Write metadata file
                metadata_file = os.path.join(
                    self.metadata_dir,
                    f"{self._get_cache_key_hash(cache_key)}.json"
                )
                with open(metadata_file, 'w', encoding='utf-8') as f:
                    json.dump(metadata, f, indent=2, ensure_ascii=False)

            except (IOError, pickle.PickleError, KeyError):
                # Silently fail cache writes to not break main functionality
                pass

    def get_mesh_binary(self, snapshot_id, primitive_index, resolution):
        """
        Get one cached snapshot-primitive mesh from binary cache.

        Args:
            snapshot_id: Snapshot UUID
            primitive_index: Index into the snapshot geometry.meshes array
            resolution: 'reduced' or 'detailed'

        Returns:
            Tuple of (mesh, etag, is_from_cache) or (None, None, False)
        """
        with self._lock:
            try:
                cache_key = (
                    f'mesh:{resolution}:{snapshot_id}:{primitive_index}'
                )
                metadata_file = os.path.join(
                    self.metadata_dir,
                    f"{self._get_cache_key_hash(cache_key)}.json"
                )

                if not os.path.exists(metadata_file):
                    return None, None, False

                with open(metadata_file, 'r', encoding='utf-8') as f:
                    metadata = json.load(f)

                # Check if expired
                if self._is_expired(metadata.get('cached_at', '')):
                    return None, None, False

                # Get mesh file path
                mesh_file = os.path.join(
                    self.geometry_dir,
                    resolution,
                    f"{snapshot_id}_{primitive_index}.pkl"
                )

                if os.path.exists(mesh_file):
                    with open(mesh_file, 'rb') as f:
                        mesh_json = pickle.load(f)
                    mesh = Rhino.Geometry.Mesh.FromJSON(mesh_json)
                    if mesh:
                        return mesh, metadata.get('etag'), True

                return None, None, False

            except (IOError, pickle.PickleError, KeyError):
                return None, None, False

    def set_mesh_binary(
            self, snapshot_id, primitive_index, resolution, mesh, etag):
        """
        Cache one snapshot-primitive mesh as binary (mesh ToJSON pickle).

        Args:
            snapshot_id: Snapshot UUID
            primitive_index: Index into the snapshot geometry.meshes array
            resolution: 'reduced' or 'detailed'
            mesh: Rhino.Geometry.Mesh object (already parsed from PLY)
            etag: ETag from server response
        """
        with self._lock:
            try:
                current_time = datetime.now().isoformat()
                cache_key = (
                    f'mesh:{resolution}:{snapshot_id}:{primitive_index}'
                )

                # Create geometry subdirectory
                geometry_subdir = os.path.join(
                    self.geometry_dir, resolution
                )
                os.makedirs(geometry_subdir, exist_ok=True)

                # Convert mesh to JSON string using ToJSON
                options = Rhino.FileIO.SerializationOptions()
                options.WriteUserData = True
                options.WriteRenderMeshes = True
                options.WriteAnalysisMeshes = True
                mesh_json = mesh.ToJSON(options)

                # Store JSON string as pickle
                mesh_file = os.path.join(
                    geometry_subdir,
                    f"{snapshot_id}_{primitive_index}.pkl"
                )
                with open(mesh_file, 'wb') as f:
                    pickle.dump(mesh_json, f)

                # Store metadata
                metadata = {
                    'cache_key': cache_key,
                    'cached_at': current_time,
                    'etag': etag,
                    'type': 'mesh',
                    'resolution': resolution,
                    'snapshot_id': snapshot_id,
                    'primitive_index': primitive_index
                }

                metadata_file = os.path.join(
                    self.metadata_dir,
                    f"{self._get_cache_key_hash(cache_key)}.json"
                )
                with open(metadata_file, 'w', encoding='utf-8') as f:
                    json.dump(metadata, f, indent=2, ensure_ascii=False)

            except (IOError, pickle.PickleError, KeyError):
                # Silently fail cache writes to not break main functionality
                pass

    def get_point_cloud_binary(self, snapshot_id, primitive_index):
        """
        Get one cached snapshot point cloud from binary cache.

        Returns:
            Tuple of (point_cloud, etag, is_from_cache) or
            (None, None, False)
        """
        with self._lock:
            try:
                cache_key = (
                    f'point_cloud:{snapshot_id}:{primitive_index}'
                )
                metadata_file = os.path.join(
                    self.metadata_dir,
                    f"{self._get_cache_key_hash(cache_key)}.json"
                )

                if not os.path.exists(metadata_file):
                    return None, None, False

                with open(metadata_file, 'r', encoding='utf-8') as f:
                    metadata = json.load(f)

                if self._is_expired(metadata.get('cached_at', '')):
                    return None, None, False

                cloud_file = os.path.join(
                    self.geometry_dir,
                    'point_cloud',
                    f"{snapshot_id}_{primitive_index}.pkl"
                )

                if os.path.exists(cloud_file):
                    with open(cloud_file, 'rb') as f:
                        cloud_json = pickle.load(f)
                    loaded = Rhino.Runtime.CommonObject.FromJSON(cloud_json)
                    if isinstance(loaded, Rhino.Geometry.PointCloud):
                        return loaded, metadata.get('etag'), True

                return None, None, False

            except (IOError, pickle.PickleError, KeyError, TypeError):
                return None, None, False

    def set_point_cloud_binary(
            self, snapshot_id, primitive_index, cloud, etag):
        """
        Cache one snapshot point cloud as binary (ToJSON pickle).
        """
        with self._lock:
            try:
                current_time = datetime.now().isoformat()
                cache_key = (
                    f'point_cloud:{snapshot_id}:{primitive_index}'
                )

                geometry_subdir = os.path.join(
                    self.geometry_dir, 'point_cloud'
                )
                os.makedirs(geometry_subdir, exist_ok=True)

                options = Rhino.FileIO.SerializationOptions()
                options.WriteUserData = True
                cloud_json = cloud.ToJSON(options)

                cloud_file = os.path.join(
                    geometry_subdir,
                    f"{snapshot_id}_{primitive_index}.pkl"
                )
                with open(cloud_file, 'wb') as f:
                    pickle.dump(cloud_json, f)

                metadata = {
                    'cache_key': cache_key,
                    'cached_at': current_time,
                    'etag': etag,
                    'type': 'point_cloud',
                    'snapshot_id': snapshot_id,
                    'primitive_index': primitive_index
                }

                metadata_file = os.path.join(
                    self.metadata_dir,
                    f"{self._get_cache_key_hash(cache_key)}.json"
                )
                with open(metadata_file, 'w', encoding='utf-8') as f:
                    json.dump(metadata, f, indent=2, ensure_ascii=False)

            except (IOError, pickle.PickleError, KeyError):
                pass


def _parse_ply_binary_to_mesh(ply_bytes):
    """
    Parse a binary_little_endian PLY (CSC canonical, Rhino Z-up) into a
    single Rhino.Geometry.Mesh: numpy parse (csc_ply), then the Rhino build
    chosen by MESH_BUILD_MODE (csc_rhino). No coordinate rotation is applied.
    Returns the mesh or None on failure.
    """
    try:
        if not ply_bytes:
            return None
        return mesh_from_ply(ply_bytes)
    except Exception as e:
        print(f'Error parsing PLY: {str(e)}')
        return None


def _parse_ply_binary_to_point_cloud(ply_bytes):
    """
    Parse a binary_little_endian point-cloud PLY (vertices only, optional
    uchar rgb) into a Rhino.Geometry.PointCloud.
    """
    try:
        if not ply_bytes:
            return None
        return point_cloud_from_ply(ply_bytes)
    except Exception as e:
        print(f'Error parsing point cloud PLY: {str(e)}')
        return None


# AuthCore - Embedded ---------------------------------------------------------

class _AuthCore(object):
    """
    Authorization and cache management tool that gets stored in sticky to be
    used by other CSC Grasshopper Components.

    Author: Max Benjamin Eschenbach
    License: MIT License
    """

    CLIENT = CSC_CLIENT

    def __init__(self, base_url, leeway=30, disable_cache=False):
        self.base_url = server_url(base_url)
        self.leeway = int(leeway) if leeway is not None else 30
        # one connection pool for every request of the session (8.92)
        self._http = requests.Session()
        self.disable_cache = disable_cache
        self._lock = RLock()
        self._token = None
        self._exp = 0
        self._username = None
        # the sign-in without a password (8.168 f): the refresh token lives in
        # memory and, on Windows, encrypted with DPAPI under %APPDATA%; the
        # credentials of a password sign-in live in memory only, to sign in
        # again when the token runs out
        self._refresh = None
        self._credentials = None
        self._computer = None
        self.store_problem = None
        self._cache = None if disable_cache else _ComponentCache()

    @staticmethod
    def _now():
        return int(time.time())

    def _send(self, method, url, **kwargs):
        """One request over the shared connection. A 426 (this release is
        too old for the server) raises CSCClientOutdated with the server's
        sentence, so every component shows the fix and not a bare status."""
        response = self._http.request(method, url, **kwargs)
        if response.status_code == 426:
            raise CSCClientOutdated(outdated_message(response))
        return response

    def set_base_url(self, url):
        """Point the session at another server: login and cache of the old
        one are dropped. Returns True when the address changed."""
        url = server_url(url)
        with self._lock:
            if url == self.base_url:
                return False
            self.base_url = url
            self._token = None
            self._exp = 0
            self._username = None
            self._refresh = None
            self._credentials = None
        self.sync_cache()
        return True

    @staticmethod
    def _b64url_decode(seg):
        rem = len(seg) % 4
        if rem:
            seg += '=' * (4 - rem)
        return base64.urlsafe_b64decode(seg.encode('utf-8'))

    @classmethod
    def _jwt_payload(cls, token):
        try:
            parts = token.split('.')
            if len(parts) != 3:
                return {}
            return json.loads(cls._b64url_decode(parts[1]).decode('utf-8'))
        except Exception:
            return {}

    def set_access_token(self, token, username=None):
        payload = self._jwt_payload(token)
        exp = int(payload.get('exp', 0))
        if exp <= 0:
            exp = self._now() + 3600  # 1h fallback if no exp claim
        with self._lock:
            self._token = token
            self._exp = exp
            if username:
                self._username = username

    def clear(self):
        with self._lock:
            self._token = None
            self._exp = 0
            self._username = None
            self._refresh = None
            self._credentials = None

    # RENEWING THE ACCESS TOKEN (8.168 f) --------------------------------
    def post_form(self, url, data, headers, timeout):
        """A form POST over the shared connection (the sign-in module)."""
        return self._send('POST', url, data=data, headers=headers,
                          timeout=timeout)

    def remember_credentials(self, username, password):
        """Keep the Username and Password of a sign-in in memory, to sign in
        again once when a call answers 401 or the token ran out."""
        with self._lock:
            self._credentials = (username, password)

    def _persist_refresh(self):
        """Write the refresh token, encrypted for this Windows user. The
        server replaced the old one, so a stored copy that cannot be replaced
        is deleted: it would be dead."""
        if not is_windows() or csc_signin is None or not self._refresh:
            return
        path = csc_signin.store_path()
        try:
            csc_signin.save_entry(path, self.base_url, self._refresh,
                                  csc_signin.dpapi_protect, self._computer)
            self.store_problem = None
        except Exception as error:
            self.store_problem = str(error)
            try:
                csc_signin.delete_entry(path, self.base_url)
            except Exception:
                pass

    def _forget_stored(self):
        if is_windows() and csc_signin is not None:
            try:
                csc_signin.delete_entry(csc_signin.store_path(),
                                        self.base_url)
            except Exception:
                pass

    def take_tokens(self, tokens, computer=None):
        """Use the tokens of a sign-in or a refresh: the JWT for the calls,
        the refresh token kept (memory and the encrypted file)."""
        with self._lock:
            self.set_access_token(tokens.access_token)
            self._refresh = tokens.refresh_token
            if computer:
                self._computer = computer
            self._persist_refresh()

    def fetch_username(self):
        try:
            who = self.authorized_get('/users/me', timeout=10)
            if who.status_code == 200:
                with self._lock:
                    self._username = who.json().get('username')
        except Exception:
            pass

    def _refresh_now(self):
        # another Rhino of this Windows user may have rotated the stored
        # token since this one read it: use the newest, or the server would
        # see the old one again and end the sign-in (reuse of a rotated token)
        if is_windows():
            latest = csc_signin.load_entry(
                csc_signin.store_path(), self.base_url,
                csc_signin.dpapi_unprotect)
            if latest and latest != self._refresh:
                self._refresh = latest
        tokens = csc_signin.refresh_access(
            self.post_form, self.base_url, self._refresh,
            self.client_header())
        self.take_tokens(tokens)

    def _password_login(self):
        username, password = self._credentials
        try:
            response = self._send(
                'POST', f'{self.base_url}/auth/token',
                data={'username': username, 'password': password},
                headers={'Content-Type': 'application/x-www-form-urlencoded',
                         **self.client_header()}, timeout=20)
        except CSCClientOutdated:
            raise
        except Exception:
            return False
        if response.status_code != 200:
            return False
        token = response.json().get('access_token')
        if not token:
            return False
        self.set_access_token(token, username)
        return True

    def renew(self, force=False):
        """A new access token without asking the user: through the refresh
        token of a stored sign-in, else with the Username and Password of this
        session. True when there is a token now. One try, no loop."""
        with self._lock:
            if not force and self.is_valid():
                return True
            if self._refresh and csc_signin is not None:
                try:
                    self._refresh_now()
                    return True
                except CSCClientOutdated:
                    raise
                except csc_signin.SignInError as error:
                    if error.dead:
                        self._refresh = None
                        self._forget_stored()
                except Exception:
                    pass            # the server is not reachable: try the rest
            if self._credentials:
                return self._password_login()
            return False

    def sign_in_stored(self):
        """The stored sign-in of this server (Windows): True when it gave a
        token, False when there is none, ``SignInError`` when the server will
        not take it (it is deleted then)."""
        with self._lock:
            if not self._refresh:
                self._refresh = csc_signin.load_entry(
                    csc_signin.store_path(), self.base_url,
                    csc_signin.dpapi_unprotect)
            if not self._refresh:
                return False
            try:
                self._refresh_now()
                return True
            except csc_signin.SignInError as error:
                if error.dead:
                    self._refresh = None
                    self._forget_stored()
                raise

    def sign_out(self):
        """SignOut: revoke the sign-in on the server, delete the stored one,
        forget this session. The sentence says what happened."""
        with self._lock:
            refresh = self._refresh
            if not refresh and is_windows() and csc_signin is not None:
                refresh = csc_signin.load_entry(
                    csc_signin.store_path(), self.base_url,
                    csc_signin.dpapi_unprotect)
            message = 'Signed out.'
            if refresh and csc_signin is not None:
                try:
                    if not csc_signin.revoke_refresh(
                            self.post_form, self.base_url, refresh,
                            self.client_header()):
                        message += (' The server did not confirm: revoke '
                                    'this computer under Settings, Access '
                                    'tokens.')
                except Exception:
                    message += (' The server could not be reached: revoke '
                                'this computer under Settings, Access '
                                'tokens.')
            self._forget_stored()
            self.clear()
        return message

    def is_valid(self):
        with self._lock:
            if not self._token or self._exp <= 0:
                return False
            return (self._now() + self.leeway) < self._exp

    def get_username(self):
        with self._lock:
            return self._username

    def client_header(self):
        return {'X-CSC-Client': self.CLIENT}

    def auth_header(self):
        headers = self.client_header()
        with self._lock:
            if self._token:
                headers['Authorization'] = 'Bearer ' + self._token
        return headers

    def authorized_get(
            self,
            path,
            params=None,
            extra_headers=None,
            timeout=20):
        return self._authorized(
            'GET', path, params=params, extra_headers=extra_headers,
            timeout=timeout)

    def authorized_post(
            self,
            path,
            json_body=None,
            files=None,
            extra_headers=None,
            timeout=60,
            params=None,
            data=None):
        return self._authorized(
            'POST', path, json_body=json_body, files=files, data=data,
            params=params, extra_headers=extra_headers, timeout=timeout)

    def authorized_put(
            self,
            path,
            files=None,
            json_body=None,
            extra_headers=None,
            timeout=300,
            params=None,
            data=None):
        """PUT, e.g. a mesh PLY as multipart ``files``: the uploads of the
        Add components use the shared connection too."""
        return self._authorized(
            'PUT', path, json_body=json_body, files=files, data=data,
            params=params, extra_headers=extra_headers, timeout=timeout)

    def _authorized(
            self,
            method,
            path,
            params=None,
            json_body=None,
            files=None,
            data=None,
            extra_headers=None,
            timeout=60):
        if not self.is_valid() and not self.renew():
            raise RuntimeError(
                'Access token missing or expired. Please sign in again.'
            )
        response = self._request(
            method, path, params, json_body, files, data, extra_headers,
            timeout)
        if response.status_code == 401 and self.renew(force=True):
            # one new sign-in (refresh token, else the password) and the call
            # again, once; an uploaded file is read from its start
            for part in (files or {}).values():
                handle = part[1] if isinstance(part, (tuple, list)) \
                    and len(part) > 1 else part
                if hasattr(handle, 'seek'):
                    try:
                        handle.seek(0)
                    except Exception:
                        pass
            response = self._request(
                method, path, params, json_body, files, data, extra_headers,
                timeout)
        return response

    def _request(self, method, path, params, json_body, files, data,
                 extra_headers, timeout):
        headers = self.auth_header()
        if extra_headers:
            headers.update(extra_headers)
        kwargs = {'headers': headers, 'timeout': timeout}
        if params is not None:
            kwargs['params'] = params
        if files is not None:
            # multipart: requests sets the Content-Type with its boundary
            kwargs['files'] = files
            if data is not None:
                kwargs['data'] = data
        elif json_body is not None:
            kwargs['json'] = json_body
        elif data is not None:
            kwargs['data'] = data
        return self._send(method, self.base_url + path, **kwargs)

    def validate_uuid(self, uuid_to_test: str, version: int = 4):
        """
        Check if uuid_to_test is a valid UUID.
        Returns True if uuid_to_test is a valid UUID, otherwise False.
        """
        try:
            uuid_obj = uuid.UUID(uuid_to_test, version=version)
        except ValueError:
            return False
        return str(uuid_obj) == uuid_to_test

    def resolve_identity_id_from_input(self, value):
        """
        Resolve an identity UUID from a raw UUID string or passport JSON.
        """
        if value is None:
            return None
        text = str(value).strip()
        if not text:
            return None
        if self.validate_uuid(text):
            return text
        try:
            data = value if isinstance(value, dict) else json.loads(text)
        except (TypeError, ValueError, json.JSONDecodeError):
            return None
        if not isinstance(data, dict):
            return None
        identity = data.get('identity')
        if not isinstance(identity, dict):
            return None
        identity_id = identity.get('_id') or identity.get('id')
        if identity_id and self.validate_uuid(str(identity_id)):
            return str(identity_id)
        return None

    def primary_snapshot(self, passport):
        """Return the first snapshot from a passport payload."""
        return primary_snapshot_from_passport(passport)

    def normalize_passport_output(self, passport):
        """Return {identity, snapshots[]} for downstream GH components."""
        return normalize_passport_payload(passport)

    def passport_json_string(self, passport):
        """
        Serialize one passport row in the canonical
        {identity, snapshots[]} shape.
        """
        return json.dumps(self.normalize_passport_output(passport))

    # Cache Management Methods ------------------------------------------------

    def get_cache(self):
        """Get the cache instance."""
        return self._cache

    def set_cache_enabled(self, enabled):
        """Enable or disable caching."""
        with self._lock:
            self.disable_cache = not enabled
            if enabled and self._cache is None:
                self._cache = _ComponentCache()
            elif not enabled:
                self._cache = None

    def is_cache_enabled(self):
        """Check if caching is enabled."""
        return self._cache is not None

    def sync_cache(self):
        """Force cache synchronization (clear cache)."""
        if self._cache:
            self._cache.invalidate()

    def get_cache_stats(self):
        """Get cache statistics."""
        if self._cache:
            return self._cache.get_cache_stats()
        return {
            'component_count': 0,
            'metadata_count': 0,
            'total_size_bytes': 0,
            'cache_dir': 'Cache disabled'
        }

    def cached_get(
            self,
            path,
            cache_key,
            params=None,
            extra_headers=None,
            timeout=20):
        """
        Make a cached GET request with ETag support.

        Args:
            path: API path
            cache_key: Cache key for this request
            params: Query parameters
            extra_headers: Additional headers
            timeout: Request timeout

        Returns:
            Response object
        """
        if not self.is_valid():
            raise RuntimeError(
                'Access token missing or expired. Please sign in again.'
            )

        # If cache is disabled, make regular request
        if not self._cache:
            return self.authorized_get(path, params, extra_headers, timeout)

        # Check cache first
        cached_data, cached_etag, is_from_cache = self._cache.get(cache_key)

        # Prepare headers
        headers = self.auth_header()
        if extra_headers:
            headers.update(extra_headers)

        # Add conditional request header if we have cached data
        if is_from_cache and cached_etag:
            headers['If-None-Match'] = cached_etag

        # Make request
        response = self._send('GET', 
            self.base_url + path,
            params=params,
            headers=headers,
            timeout=timeout
        )

        # Handle response
        if response.status_code == 304 and is_from_cache:
            return _CachedResponse(cached_data, cached_etag)

        elif response.status_code == 200:
            # Data changed or first request - cache the response.
            # Cache writes must never break the fetch, so swallow any
            # parse/serialise/IO error and just return the live response.
            try:
                data = response.json()
                etag = response.headers.get('ETag')
                self._cache.set(cache_key, data, etag, params)
            except Exception:
                pass

        return response

    def cached_list_identities(
            self,
            params=None,
            extra_headers=None,
            timeout=60):
        """
        Fetch GET /identities with unified identity/snapshot caching.

        List responses store per-identity and per-snapshot documents plus a
        lightweight query index (identity ids + list ETag). A 304 reassembles
        passport rows from the individual caches.
        """
        if not self.is_valid():
            raise RuntimeError(
                'Access token missing or expired. Please sign in again.'
            )

        params = dict(params or {})
        query_key = _query_cache_key(params)

        if not self._cache:
            return self.authorized_get(
                '/identities', params, extra_headers, timeout)

        identity_ids, query_etag, has_query = self._cache.get_query(
            query_key)

        headers = self.auth_header()
        if extra_headers:
            headers.update(extra_headers)
        if has_query and query_etag:
            headers['If-None-Match'] = query_etag

        response = self._send('GET', 
            self.base_url + '/identities',
            params=params,
            headers=headers,
            timeout=timeout
        )

        if response.status_code == 304:
            if has_query and identity_ids:
                rows = self._cache.assemble_passport_list(identity_ids)
                if rows:
                    return _CachedResponse(rows, query_etag)
            # Stale query index ? refetch without conditional header
            headers = self.auth_header()
            if extra_headers:
                headers.update(extra_headers)
            response = self._send('GET', 
                self.base_url + '/identities',
                params=params,
                headers=headers,
                timeout=timeout
            )

        if response.status_code == 200:
            try:
                data = response.json()
                if isinstance(data, list):
                    stored_ids = self._cache.ingest_passport_rows(data)
                    list_etag = response.headers.get('ETag')
                    self._cache.set_query(
                        query_key, stored_ids, list_etag, params)
            except Exception:
                pass

        return response

    def cached_get_passport(
            self,
            identity_id,
            snapshots=None,
            extra_headers=None,
            timeout=20):
        """
        Fetch GET /identities/{id}/compose with caching.

        ``snapshots``: None/'current' (default), 'all', or a list of snapshot
        UUID strings. Passport ETag matches the backend; 304 returns cached
        body when available.
        """
        if not self.is_valid():
            raise RuntimeError(
                'Access token missing or expired. Please sign in again.'
            )

        params = {}
        if snapshots == 'all':
            params['snapshots'] = 'all'
        elif isinstance(snapshots, (list, tuple)) and snapshots:
            params['snapshots'] = ','.join(str(item) for item in snapshots)

        path = f'/identities/{identity_id}/compose'
        cache_key = _passport_cache_key(identity_id, snapshots)
        use_current_assembly = (
            not snapshots or snapshots == 'current'
        )

        cached_body = None
        cached_etag = None
        if self._cache:
            if use_current_assembly:
                cached_body = self._cache.assemble_passport(identity_id)
            else:
                cached_body, cached_etag, cached_ok = self._cache.get(
                    cache_key,
                )
                if not cached_ok:
                    cached_body = None
                    cached_etag = None

            if cached_body and isinstance(cached_body.get('identity'), dict):
                snapshot_docs = cached_body.get('snapshots') or []
                cached_etag = _compute_passport_etag(
                    cached_body['identity'],
                    snapshot_docs,
                )

        if not self._cache:
            return self.authorized_get(
                path, params or None, extra_headers, timeout)

        headers = self.auth_header()
        if extra_headers:
            headers.update(extra_headers)
        if cached_etag:
            headers['If-None-Match'] = cached_etag

        response = self._send('GET', 
            self.base_url + path,
            headers=headers,
            params=params or None,
            timeout=timeout,
        )

        if response.status_code == 304:
            if cached_body:
                return _CachedResponse(cached_body, cached_etag)
            headers = self.auth_header()
            if extra_headers:
                headers.update(extra_headers)
            response = self._send('GET', 
                self.base_url + path,
                headers=headers,
                params=params or None,
                timeout=timeout,
            )

        if response.status_code == 200:
            try:
                data = response.json()
                if self._cache:
                    etag = response.headers.get('ETag')
                    if not etag and isinstance(data.get('identity'), dict):
                        etag = _compute_passport_etag(
                            data['identity'],
                            data.get('snapshots') or [],
                        )
                    if not use_current_assembly:
                        self._cache.set(cache_key, data, etag)
                    self._cache.ingest_passport_row(data)
            except Exception:
                pass

        return response

    def cached_get_snapshot_mesh(self, snapshot_id, primitive_index,
                                 resolution, timeout=60):
        """
        Fetch one snapshot-primitive mesh PLY with ETag caching.

        Args:
            snapshot_id: Snapshot UUID
            primitive_index: Index into the snapshot geometry.meshes array
            resolution: 'reduced' or 'detailed'
            timeout: Request timeout

        Returns:
            Tuple of (mesh, etag, is_from_cache). ``mesh`` is None when the
            requested resolution is unavailable (404) or on parse/transport
            error, signalling the caller to fall back to inline geometry.
        """
        if not self.is_valid():
            raise RuntimeError(
                'Access token missing or expired. Please sign in again.'
            )

        path = (
            f'/snapshots/{snapshot_id}/meshes/'
            f'{primitive_index}/{resolution}'
        )

        # If cache is disabled, fetch + parse without caching
        if not self._cache:
            response = self.authorized_get(path, timeout=timeout)
            if response.status_code == 200:
                mesh = _parse_ply_binary_to_mesh(response.content)
                etag = response.headers.get('ETag')
                return mesh, etag, False
            return None, None, False

        # Check binary cache first
        (cached_mesh,
         cached_etag,
         is_from_cache) = self._cache.get_mesh_binary(
            snapshot_id, primitive_index, resolution)

        # Prepare headers (conditional request when we have cached data)
        headers = self.auth_header()
        if is_from_cache and cached_etag:
            headers['If-None-Match'] = cached_etag

        response = self._send('GET', 
            self.base_url + path,
            headers=headers,
            timeout=timeout
        )

        if response.status_code == 304 and is_from_cache:
            # Not modified - return cached mesh
            return cached_mesh, cached_etag, True

        if response.status_code == 200:
            mesh = _parse_ply_binary_to_mesh(response.content)
            etag = response.headers.get('ETag')
            if mesh is not None:
                try:
                    self._cache.set_mesh_binary(
                        snapshot_id, primitive_index, resolution, mesh, etag
                    )
                except (ValueError, KeyError):
                    pass
            return mesh, etag, False

        # 404 / other -> unavailable; caller falls back to inline geometry
        return None, None, False

    def cached_get_snapshot_point_cloud(self, snapshot_id, primitive_index,
                                        timeout=60):
        """
        Fetch one snapshot point-cloud PLY with ETag caching.

        Returns a Rhino PointCloud or None when unavailable. Callers keep
        the object return (unlike cached_get_snapshot_mesh) so Bake /
        Fetch / PassportToD2P stay unchanged.
        """
        if not self.is_valid():
            raise RuntimeError(
                'Access token missing or expired. Please sign in again.'
            )

        path = (
            f'/snapshots/{snapshot_id}/point_clouds/'
            f'{primitive_index}.ply'
        )

        if not self._cache:
            response = self.authorized_get(path, timeout=timeout)
            if response.status_code == 200:
                return _parse_ply_binary_to_point_cloud(response.content)
            return None

        (cached_cloud,
         cached_etag,
         is_from_cache) = self._cache.get_point_cloud_binary(
            snapshot_id, primitive_index)

        headers = self.auth_header()
        if is_from_cache and cached_etag:
            headers['If-None-Match'] = cached_etag

        response = self._send('GET', 
            self.base_url + path,
            headers=headers,
            timeout=timeout
        )

        if response.status_code == 304 and is_from_cache:
            return cached_cloud

        if response.status_code == 200:
            cloud = _parse_ply_binary_to_point_cloud(response.content)
            etag = response.headers.get('ETag')
            if cloud is not None:
                try:
                    self._cache.set_point_cloud_binary(
                        snapshot_id, primitive_index, cloud, etag
                    )
                except (ValueError, KeyError):
                    pass
            return cloud

        return None

    def get_create_identity_schema(self, force_refresh=False):
        """
        Get CreateComponentRequest JSON Schema (POST /identities).

        Args:
            force_refresh: Force refresh of schema even if cached

        Returns:
            Schema dictionary or None if failed
        """
        cache_key = 'schema:create_identity'
        endpoint = '/schema/create-identity'

        if not self.base_url:
            raise RuntimeError(
                'Base URL not configured. Please sign in first.')

        if not self._cache:
            try:
                response = self._send('GET', f'{self.base_url}{endpoint}',
                                        headers=self.client_header())
                if response.status_code == 200:
                    return response.json()
                return None
            except Exception:
                return None

        if not force_refresh:
            cached_schema, cached_etag, is_from_cache = self._cache.get(
                cache_key)
            if is_from_cache:
                return cached_schema

        try:
            headers = self.client_header()
            if not force_refresh:
                cached_schema, cached_etag, is_from_cache = self._cache.get(
                    cache_key)
                if is_from_cache and cached_etag:
                    headers['If-None-Match'] = cached_etag

            response = self._send('GET', 
                f'{self.base_url}{endpoint}',
                headers=headers,
            )

            if response.status_code == 304 and not force_refresh:
                cached_schema, _, is_from_cache = self._cache.get(cache_key)
                if is_from_cache:
                    return cached_schema

            elif response.status_code == 200:
                try:
                    data = response.json()
                    etag = response.headers.get('ETag')
                    self._cache.set(cache_key, data, etag)
                    return data
                except (ValueError, KeyError):
                    return None

            return None
        except Exception:
            if not force_refresh:
                cached_schema, _, is_from_cache = self._cache.get(cache_key)
                if is_from_cache:
                    return cached_schema
            return None

class CSC_Session(Grasshopper.Kernel.GH_ScriptInstance):
    """
    Author: Max Benjamin Eschenbach
    License: MIT License
    """

    # Development setting - do not change!
    __HARD_RESET = False

    def __init__(self):
        """Initialize this component and set component parameters."""
        super().__init__()
        # initialize props
        self.Component = ghenv.Component  # type: ignore[reportUnedfinedVariable] # NOQA
        self.InputParams = self.Component.Params.Input
        self.OutputParams = self.Component.Params.Output

    def _addRemark(self, msg: str = ''):
        """Add a remark message to the component."""
        rml = self.Component.RuntimeMessageLevel.Remark
        self.AddRuntimeMessage(rml, msg)

    def _addWarning(self, msg: str = ''):
        """Add a warning message to the component."""
        rml = self.Component.RuntimeMessageLevel.Warning
        self.AddRuntimeMessage(rml, msg)

    def _addError(self, msg: str = ''):
        """Add an error message to the component."""
        rml = self.Component.RuntimeMessageLevel.Error
        self.AddRuntimeMessage(rml, msg)

    _outputs_ready = True       # set by BeforeRunScript (8.112)
    _outputs_note = None

    def _state(self, text=''):
        """The one short state under the component (decision 8.113)."""
        if set_state is not None:
            set_state(self.Component, text)

    def _stop(self):
        """True when RunScript has to return early: the library is missing or
        too old, or the outputs were just updated (says why)."""
        if LIBRARY_PROBLEM:
            self._addError(LIBRARY_PROBLEM)
            return True
        if self._outputs_note:
            self._addRemark(self._outputs_note)
        return not self._outputs_ready

    def _check_outputs(self):
        """Make the outputs match OUTPUTS before the script runs (8.112)."""
        self._outputs_ready, self._outputs_note = True, None
        if ensure_outputs is None:
            self._outputs_note = (
                'output check skipped: CSC library not installed')
            return
        status = ensure_outputs(self.Component, OUTPUTS)
        self._outputs_ready, self._outputs_note = status.ready, status.remark

    def BeforeRunScript(self):
        """Perform some setup actions."""
        # Initialize input param descriptions
        self.InputParams[0].Description = 'Your Username or E-Mail'
        self.InputParams[1].Description = 'Your password'
        self.InputParams[2].Description = (
            'Button: sign in with the browser, without a password (Windows). '
            'Connected Username and Password are used first'
        )
        self.InputParams[3].Description = (
            'Button: sign out, delete the stored sign-in and revoke it on '
            'the server'
        )
        self.InputParams[4].Description = (
            'Disable caching (default: False - caching enabled)'
        )
        self.InputParams[5].Description = (
            'Clear cache (default: False)'
        )
        if len(self.InputParams) > 6:
            self.InputParams[6].Description = (
                'Server address, e.g. https://api.2ndchances.build or '
                'localhost:8010 (default: the CSC server; changing it signs '
                'you out and clears the cache)'
            )
        # Initialize output param descriptions
        self._check_outputs()
        if LIBRARY_PROBLEM is None:
            csc_gh.dev_reload(globals())

    def get_auth_core_from_sticky(self):
        """Get AuthCore instance from sticky storage or create new one."""
        if not self.__HARD_RESET:
            auth_core = sc.sticky.get('CSC_AuthCore')
        else:
            auth_core = None
        if auth_core is not None and \
                getattr(auth_core, 'CLIENT', None) != CSC_CLIENT:
            # Left in sticky by an older release: its methods do not send
            # X-CSC-Client. Replace it, keeping the login and settings.
            old = auth_core
            auth_core = _AuthCore(
                base_url=getattr(old, 'base_url', None),
                leeway=getattr(old, 'leeway', 30),
                disable_cache=getattr(old, 'disable_cache', False),
            )
            auth_core._token = getattr(old, '_token', None)
            auth_core._exp = getattr(old, '_exp', 0)
            auth_core._username = getattr(old, '_username', None)
            auth_core._refresh = getattr(old, '_refresh', None)
            auth_core._credentials = getattr(old, '_credentials', None)
            sc.sticky['CSC_AuthCore'] = auth_core
        if auth_core is None:
            # Create new AuthCore instance with default settings
            auth_core = _AuthCore(
                base_url='https://api.2ndchances.build'
            )
            sc.sticky['CSC_AuthCore'] = auth_core
        return auth_core

    # THE SIGN-IN WITHOUT A PASSWORD (decision 8.168 f) ----------------------
    def _schedule_expire(self):
        """A callback for the flow thread: ask Grasshopper to solve this
        component again, on the UI thread, between solutions."""
        component = self.Component
        document = component.OnPingDocument()
        if document is None:
            return

        def call_back(_document):
            component.ExpireSolution(False)  # NOQA

        document.ScheduleSolution(
            1, Grasshopper.Kernel.GH_Document.GH_ScheduleDelegate(call_back))

    def _ready_status(self, auth_core, status_messages):
        """The schema, the cache and the server, as the status of a session
        that is signed in."""
        try:
            schema = auth_core.get_create_identity_schema()
            if schema:
                status_messages.append('Create-identity schema cached')
                self._addRemark('Create-identity schema cached successfully')
            else:
                status_messages.append('Failed to cache schema')
                self._addWarning('Failed to cache create-identity schema')
        except Exception as e:
            status_messages.append(f'Schema caching failed: {str(e)}')
            self._addWarning(f'Schema cache failed: {str(e)}')
        cache_stats = auth_core.get_cache_stats()
        cache_enabled = auth_core.is_cache_enabled()
        comp_count = cache_stats["component_count"]
        geometry_count = cache_stats["geometry_count"]
        size_kb = cache_stats["total_size_bytes"] // 1024
        geometry_size_kb = cache_stats["geometry_size_bytes"] // 1024
        status_messages.append(
            'Cache: '
            f'{"Enabled" if cache_enabled else "Disabled"}\n'
            f' | Components: {comp_count}\n'
            f' | Geometry: {geometry_count} files\n'
            f' | Size: {size_kb} kB\n'
            f' | Geometry: {geometry_size_kb} kB\n'
            f' | Server: {auth_core.base_url}\n')
        return (status_messages,)

    def _fail(self, status_messages, msg, error=True):
        status_messages.append(msg)
        if error:
            self._addError(msg)
        else:
            self._addWarning(msg)
        return (status_messages,)

    def _sign_out(self, auth_core, status_messages):
        """SignOut: the stored sign-in is deleted here and revoked on the
        server; this session is signed out."""
        flow = sc.sticky.pop('CSC_SignInFlow', None)
        if flow is not None:
            flow.cancel()
        message = auth_core.sign_out()
        status_messages.append(message)
        return (status_messages,)

    def _without_password(self, auth_core, sign_in, status_messages):
        """No Username and Password: the sign-in of the browser. Order: the
        session that is signed in, the sign-in in progress, the stored
        sign-in of this server, SignIn, else what to press."""
        windows = is_windows()
        flow = sc.sticky.get('CSC_SignInFlow')
        if flow is not None and flow.server != auth_core.base_url:
            flow.cancel()
            sc.sticky.pop('CSC_SignInFlow', None)
            flow = None
        if flow is not None:
            if flow.state == 'waiting':
                minutes = max(1, (flow.seconds_left() + 59) // 60)
                status_messages.append(
                    'Waiting for the browser: allow Grasshopper on the CSC '
                    f'page ({minutes} min left)')
                return (status_messages,)
            sc.sticky.pop('CSC_SignInFlow', None)
            if flow.state == 'done':
                auth_core.take_tokens(flow.tokens, flow.computer)
                auth_core.fetch_username()
                sc.sticky['CSC_AuthCore'] = auth_core
                status_messages.append(
                    f'Signed in as {auth_core.get_username() or "you"} '
                    '(the sign-in renews itself)')
                return self._ready_status(auth_core, status_messages)
            return self._fail(status_messages, flow.error or 'Sign-in failed')
        if auth_core.is_valid():
            return self._ready_status(auth_core, status_messages)
        has_stored = windows and csc_signin.has_entry(
            csc_signin.store_path(), auth_core.base_url)
        if sign_in and not windows:
            return self._fail(status_messages, csc_signin.none_text(False),
                              error=False)
        if csc_signin.choose_sign_in(None, None, has_stored, windows) \
                == 'stored':
            try:
                if auth_core.sign_in_stored():
                    auth_core.fetch_username()
                    sc.sticky['CSC_AuthCore'] = auth_core
                    status_messages.append(
                        f'Signed in as {auth_core.get_username() or "you"} '
                        '(stored sign-in, renews itself)')
                    return self._ready_status(auth_core, status_messages)
            except CSCClientOutdated as e:
                return self._fail(status_messages, str(e))
            except csc_signin.SignInError as e:
                return self._fail(status_messages, str(e))
            except Exception as e:
                return self._fail(
                    status_messages,
                    f'Cannot reach the server ({e}): the stored sign-in is '
                    'kept, try again', error=False)
        if sign_in:
            return self._start_sign_in(auth_core, status_messages)
        status_messages.append(csc_signin.none_text(windows))
        return (status_messages,)

    def _start_sign_in(self, auth_core, status_messages):
        flow = csc_signin.SignInFlow(
            auth_core.base_url, auth_core.post_form, open_browser,
            on_done=self._schedule_expire, headers=auth_core.client_header())
        try:
            flow.start()
        except Exception as e:
            return self._fail(status_messages,
                              f'The sign-in could not be started: {e}')
        sc.sticky['CSC_SignInFlow'] = flow
        status_messages.append(
            'Browser opened: allow Grasshopper on the CSC page. If it did '
            f'not open, go to {flow.url}')
        return (status_messages,)

    def RunScript(self,
            Username: str,
            Password: str,
            SignIn: bool,
            SignOut: bool,
            DisableCache: bool,
            ClearCache: bool,
            Server):
        # Initialize status messages list
        if self._stop():
            return empty_outputs()
        status_messages = []

        # Sanitize input parameters (defaults don't work in function signature)
        if DisableCache is None:
            DisableCache = False
        if ClearCache is None:
            ClearCache = False

        # Get or create AuthCore instance
        auth_core = self.get_auth_core_from_sticky()

        # The server of this session (8.93): a new address drops the login
        if Server is not None and str(Server).strip():
            if auth_core.set_base_url(Server):
                status_messages.append(
                    f'Server changed to {auth_core.base_url}: signed out')

        # Handle cache management
        if ClearCache:
            auth_core.sync_cache()
            status_messages.append('Cache cleared')
            # Return status messages
            Status = status_messages
            return (Status,)

        # Set cache enabled/disabled
        auth_core.set_cache_enabled(not DisableCache)

        if SignOut:
            return self._sign_out(auth_core, status_messages)

        # The order of the ways to sign in (8.168 f): connected Username and
        # Password win (also the way on macOS); else the stored sign-in of
        # this server; else SignIn, else the status says what to press.
        have_username = bool(Username and Username.strip())
        have_password = bool(Password and Password.strip())
        if not have_username and not have_password:
            return self._without_password(
                auth_core, bool(SignIn), status_messages)

        # Input validation
        if not have_username:
            status_messages.append('Please provide username/email')
            Status = status_messages
            return (Status,)

        if not have_password:
            status_messages.append('Please provide password')
            Status = status_messages
            return (Status,)

        username = Username.strip()
        password = Password.strip()

        try:
            # Check if we already have a valid token (it renews itself, also
            # with these credentials, when it runs out)
            if auth_core.is_valid():
                auth_core.remember_credentials(username, password)
                return self._ready_status(auth_core, status_messages)

            # Prepare login data
            login_data = {
                'username': username,
                'password': password
            }

            # Make login request
            response = auth_core._send(
                'POST',
                f'{auth_core.base_url}/auth/token',
                data=login_data,
                headers={
                    'Content-Type': 'application/x-www-form-urlencoded',
                    **auth_core.client_header(),
                },
                timeout=20
            )

            if response.status_code == 200:
                # Login successful
                token_data = response.json()
                access_token = token_data.get('access_token')

                if access_token:
                    # Store token in AuthCore
                    auth_core.set_access_token(access_token, username)
                    auth_core.remember_credentials(username, password)

                    # Update sticky storage
                    sc.sticky['CSC_AuthCore'] = auth_core

                    return self._ready_status(auth_core, status_messages)

                else:
                    msg = 'Login failed: No token received'
                    status_messages.append(msg)
                    self._addWarning(msg)
                    Status = status_messages
                    return (Status,)

            elif response.status_code == 401:
                msg = 'Invalid username or password'
                status_messages.append(msg)
                self._addError(msg)
                Status = status_messages
                return (Status,)

            elif response.status_code == 422:
                msg = 'Invalid input data'
                status_messages.append(msg)
                self._addError(msg)
                Status = status_messages
                return (Status,)

            elif response.status_code == 500:
                msg = 'Server error - please try again'
                status_messages.append(msg)
                self._addWarning(msg)
                Status = status_messages
                return (Status,)

            else:
                msg = f'Login failed with status code: {response.status_code}'
                status_messages.append(msg)
                self._addError(msg)
                Status = status_messages
                return (Status,)

        except CSCClientOutdated as e:
            msg = str(e)
            status_messages.append(msg)
            self._addError(msg)
            Status = status_messages
            return (Status,)

        except requests.exceptions.ConnectionError as e:
            msg = 'Cannot connect to server - check URL'
            status_messages.append(msg)
            self._addError(msg + f'\nFull Error: {str(e)}')
            Status = status_messages
            return (Status,)

        except requests.exceptions.Timeout as e:
            msg = 'Request timeout - server may be slow'
            status_messages.append(msg)
            self._addError(msg + f'\nFull Error: {str(e)}')
            Status = status_messages
            return (Status,)

        except requests.exceptions.RequestException as e:
            msg = f'Request error: {str(e)}'
            status_messages.append(msg)
            self._addError(msg)
            Status = status_messages
            return (Status,)

        except Exception as e:
            msg = f'Unexpected error: {str(e)}'
            status_messages.append(msg)
            Status = status_messages
            return (Status,)
# ---------- end csc_session ----------
status_messages = Panel(csc_session)

# ---- group: __DDU_CSC_EXAMPLE_05__
# Step 1
disablecache_2 = BooleanToggle(False)
clearcache_2 = Button()
signin_2 = Button()
signout_2 = Button()
csc_session_2 = Session(SignIn=signin_2, SignOut=signout_2, DisableCache=disablecache_2, ClearCache=clearcache_2)  # -> Status; inputs Username: String, Password: String, SignIn: Boolean, SignOut: Boolean, DisableCache: Boolean, ClearCache: Boolean; same code as csc_session
status_messages_2 = Panel(csc_session_2)

# ----
# comments & notes: List all snapshot versions for one identity (id and name)
componentid_3 = Panel("243df186-9e30-4b19-95aa-17d7d88976f9")
identityid = Data(componentid_3)
listidentitysnapshots = ListIdentitySnapshots(Input=identityid)  # -> SnapshotID, SnapshotName
# ---------- listidentitysnapshots: Python ----------
#! python3
# -*- coding: utf-8 -*-
# venv: DDU_CSC
print('ENV OK!')
# r: charset_normalizer
# r: requests

# PYTHON STANDARD LIBRARY IMPORTS ---------------------------------------------
import json  # NOQA

# THIRD PARTY LIBRARY IMPORTS -------------------------------------------------
import requests  # NOQA

# RHINO AND GH RELATED IMPORTS ------------------------------------------------
import System  # NOQA
import Grasshopper  # NOQA
import Rhino  # NOQA
import scriptcontext as sc  # NOQA

# GHENV COMPONENT SETTINGS ----------------------------------------------------
ghenv.Component.Name = 'ListIdentitySnapshots'  # NOQA
ghenv.Component.NickName = 'ListIdentitySnapshots'  # NOQA
ghenv.Component.Category = 'DDU_CSC'  # NOQA
ghenv.Component.SubCategory = '2 Catalog Interface'  # NOQA
ghenv.Component.Description = (  # NOQA
    'Lists all snapshots for one identity (id and name). Input can '
    'be an identity UUID or component passport JSON ({identity, snapshots[]}).'
)

# OPTIONAL HELPERS: they never block the component (decisions 8.112, 8.113) ---
try:
    from csc_gh.ports import ensure_outputs
    from csc_gh.messages import set_state, waits_for_data
except ImportError:
    ensure_outputs = set_state = waits_for_data = None

OUTPUTS = [
    ('SnapshotID', 'SnapshotID',
     'Snapshot UUIDs (ordered by version)'),
    ('SnapshotName', 'SnapshotName',
     'Snapshot names (parallel to SnapshotID)'),
]


def empty_outputs():
    """What RunScript returns when it stops early or has no result: an empty
    Grasshopper tree per output (never '' or None)."""
    if not OUTPUTS:
        return None
    trees = tuple(Grasshopper.DataTree[System.Object]() for _ in OUTPUTS)
    return trees[0] if len(trees) == 1 else trees


def null_outputs():
    """One null per output: an item of an item-access component that has no
    result keeps its slot (decision 8.186)."""
    if len(OUTPUTS) <= 1:
        return None
    return tuple(None for _ in OUTPUTS)


class CSC_ListIdentitySnapshots(Grasshopper.Kernel.GH_ScriptInstance):
    """
    Author: Max Benjamin Eschenbach
    License: MIT License
    Version: 261102
    """

    _outputs_ready = True       # set by BeforeRunScript (8.112)
    _outputs_note = None

    def __init__(self):
        """Initialize this component and set component parameters."""
        super().__init__()
        self.Component = ghenv.Component  # NOQA
        self.InputParams = self.Component.Params.Input
        self.OutputParams = self.Component.Params.Output

    def _addRemark(self, msg: str = ''):
        rml = self.Component.RuntimeMessageLevel.Remark
        self.AddRuntimeMessage(rml, msg)

    def _addWarning(self, msg: str = ''):
        rml = self.Component.RuntimeMessageLevel.Warning
        self.AddRuntimeMessage(rml, msg)

    def _addError(self, msg: str = ''):
        rml = self.Component.RuntimeMessageLevel.Error
        self.AddRuntimeMessage(rml, msg)

    def _state(self, text=''):
        """The one short state under the component (decision 8.113)."""
        if set_state is not None:
            set_state(self.Component, text)

    def _no_result(self, *ports):
        """The result of an iteration without one (decision 8.186): empty
        outputs when the inputs in ``ports`` carry no data at all (the
        component waits for data; no ports: a list or tree input is empty),
        else a null in the slot of this item, so the outputs stay one to one
        with the input list."""
        if not ports or (waits_for_data is not None
                         and waits_for_data(self, ports)):
            return empty_outputs()
        return null_outputs()

    def _stop(self):
        """True when RunScript has to return early: the outputs were just
        updated (says why)."""
        if self._outputs_note:
            self._addRemark(self._outputs_note)
        return not self._outputs_ready

    def _check_outputs(self):
        """Make the outputs match OUTPUTS before the script runs (8.112)."""
        self._outputs_ready, self._outputs_note = True, None
        if ensure_outputs is None:
            self._outputs_note = (
                'output check skipped: CSC library not installed')
            return
        status = ensure_outputs(self.Component, OUTPUTS)
        self._outputs_ready, self._outputs_note = status.ready, status.remark

    def BeforeRunScript(self):
        self.InputParams[0].Description = (
            'Identity UUID or component passport JSON ({identity, snapshots[]})'
        )
        self._check_outputs()

    def get_auth_core_from_sticky(self):
        auth_core = sc.sticky.get('CSC_AuthCore')
        if auth_core is None:
            msg = ('No authentication found. Please use CSC_Session component '
                   'first.')
            self._addWarning(msg)
            return None
        return auth_core

    def RunScript(self, Input):
        if self._stop():
            return empty_outputs()
        SnapshotID = Grasshopper.DataTree[str]()
        SnapshotName = Grasshopper.DataTree[str]()

        auth_core = self.get_auth_core_from_sticky()
        if auth_core is None:
            return SnapshotID, SnapshotName

        if not auth_core.is_valid():
            msg = ('Authentication expired. Please use CSC_Session '
                   'component to refresh.')
            self._addWarning(msg)
            return SnapshotID, SnapshotName

        if Input is None or (isinstance(Input, str) and not str(Input).strip()):
            msg = 'Please provide an identity UUID or component passport JSON.'
            self._addWarning(msg)
            return self._no_result('Input')

        identity_id = auth_core.resolve_identity_id_from_input(Input)
        if not identity_id:
            msg = 'Input is not a valid identity UUID or component passport JSON.'
            self._addError(msg)
            return null_outputs()

        try:
            response = auth_core.authorized_get(
                f'/identities/{identity_id}/snapshots'
            )

            if response.status_code == 200:
                rows = response.json()
                if not isinstance(rows, list):
                    msg = 'Unexpected response from snapshot list endpoint.'
                    self._addError(msg)
                    return null_outputs()

                path = Grasshopper.Kernel.Data.GH_Path(0)
                for row in rows:
                    if not isinstance(row, dict):
                        continue
                    snap_id = str(row.get('_id') or '')
                    name = str(row.get('name') or '')
                    if snap_id:
                        SnapshotID.Add(snap_id, path)
                        SnapshotName.Add(name, path)

                self._state(f'{SnapshotID.DataCount} snapshot(s)')
                return SnapshotID, SnapshotName

            if response.status_code == 401:
                msg = 'Authentication failed. Please sign in again.'
            elif response.status_code == 404:
                msg = f'Identity {identity_id} not found.'
            else:
                msg = f'Request failed with status code: {response.status_code}'
            self._addError(msg)

        except requests.exceptions.ConnectionError as e:
            msg = 'Cannot connect to server. Please check your connection.'
            self._addError(msg + f'\nFull Error: {str(e)}')
            return null_outputs()
        except requests.exceptions.Timeout as e:
            msg = 'Request timeout. Server may be slow.'
            self._addError(msg + f'\nFull Error: {str(e)}')
            return null_outputs()
        except Exception as e:
            msg = f'Unexpected error: {str(e)}'
            self._addError(msg)
            return null_outputs()

        return SnapshotID, SnapshotName
# ---------- end listidentitysnapshots ----------
number_slider = Slider(0, range=0..5)
item = ListItem(List=listidentitysnapshots.SnapshotName, Index=number_slider, Wrap=False)
item_2 = ListItem(List=listidentitysnapshots.SnapshotID, Index=number_slider, Wrap=False)
snapshotid = Data(item_2)
panel_6 = Panel(item)

# ---- group: __DDU_CSC_EXAMPLE_03__
# Step 1
disablecache_3 = BooleanToggle(False)
clearcache_3 = Button()
signout_3 = Button()
signin_3 = Button()
csc_session_3 = Session(SignIn=signin_3, SignOut=signout_3, DisableCache=disablecache_3, ClearCache=clearcache_3)  # -> Status; inputs Username: String, Password: String, SignIn: Boolean, SignOut: Boolean, DisableCache: Boolean, ClearCache: Boolean; same code as csc_session
status_messages_3 = Panel(csc_session_3)

# ---- group: __DDU_CSC_EXAMPLE_04__
# Step 1
disablecache_4 = BooleanToggle(False)
clearcache_4 = Button()
signout_4 = Button()
signin_4 = Button()
csc_session_4 = Session(SignIn=signin_4, SignOut=signout_4, DisableCache=disablecache_4, ClearCache=clearcache_4)  # -> Status; inputs Username: String, Password: String, SignIn: Boolean, SignOut: Boolean, DisableCache: Boolean, ClearCache: Boolean; same code as csc_session
status_messages_4 = Panel(csc_session_4)

# ----
disablecache_5 = BooleanToggle(False)
clearcache_5 = Button()
signout_5 = Button()
signin_5 = Button()
csc_session_5 = Session(SignIn=signin_5, SignOut=signout_5, DisableCache=disablecache_5, ClearCache=clearcache_5)  # -> Status; inputs Username: String, Password: String, SignIn: Boolean, SignOut: Boolean, DisableCache: Boolean, ClearCache: Boolean; same code as csc_session
status_messages_5 = Panel(csc_session_5)

# ----
# comments & notes: Compute PCA and minimum aligned BoundingBox
samplemeshgeometry = Mesh(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)
pcloud = PointCloud(samplemeshgeometry)
# comments & notes: DEVELOPMENT:
# ADDITIONAL GEOMETRY TOOLS
computepcaorientation = ComputePCAOrientation(Geometry=[samplemeshgeometry, pcloud])  # -> ObjectOrientedBBX, AlignedGeometry, AlignedBBX, TranslationVector, PCAXForm; inputs Geometry: GeometryBase
# ---------- computepcaorientation: Python ----------
#! python3
# -*- coding: utf-8 -*-
# venv: DDU_CSC_MATCH
# r: charset_normalizer
# r: numpy==2.0.2
# r: scipy==1.13.1
# r: scikit-learn==1.6.1
print('ENV OK!')

# PYTHON STANDARD LIBRARY IMPORTS ---------------------------------------------

# THIRD PARTY LIBRARY IMPORTS -------------------------------------------------
import numpy as np  # NOQA
from scipy.spatial import ConvexHull  # NOQA
from sklearn.decomposition import PCA  # NOQA

# RHINO AND GH RELATED IMPORTS ------------------------------------------------
import System  # NOQA
import Grasshopper  # NOQA
import Rhino  # NOQA

# One PCA sample per this many mm of triangle area (3D mesh path).
REFERENCE_FACE_AREA_MM2 = 100.0

# GHENV COMPONENT SETTINGS ----------------------------------------------------
ghenv.Component.Name = 'ComputePCAOrientation'  # NOQA
ghenv.Component.NickName = 'ComputePCAOrientation'  # NOQA
ghenv.Component.Category = 'DDU_CSC'  # NOQA
ghenv.Component.SubCategory = '7 Geometry Tools'  # NOQA
ghenv.Component.Description = (  # NOQA
    'Computes PCA orientation for input geometry. 3D meshes and breps use '
    'face-area-weighted sampling before PCA; point clouds use their sample '
    'points; extrusions use a 2D minimum bounding rectangle. Returns OBB, '
    'aligned geometry, translation vector, and PCA transformation matrix.'
)

# OPTIONAL HELPERS: they never block the component (decisions 8.112, 8.113) ---
try:
    from csc_gh.ports import ensure_outputs
    from csc_gh.messages import set_state, waits_for_data
except ImportError:
    ensure_outputs = set_state = waits_for_data = None

OUTPUTS = [
    ('ObjectOrientedBBX', 'ObjectOrientedBBX',
     'Object oriented bounding box, obtained using PCA,  at the location of the input geometry'),
    ('AlignedGeometry', 'AlignedGeometry',
     'Input geometry transformed using PCA method and centered at world origin'),
    ('AlignedBBX', 'AlignedBBX',
     'Object oriented bounding box transformed using the computed PCA frame, centered at the world origin'),
    ('TranslationVector', 'TranslationVector',
     'Translation vector that was used to move the geometry to the world origin'),
    ('PCAXForm', 'PCAXForm',
     'PCA frame that was used to transform the geometry converted to a Rhino XForm.'),
]


def empty_outputs():
    """What RunScript returns when it stops early or has no result: an empty
    Grasshopper tree per output (never '' or None)."""
    if not OUTPUTS:
        return None
    trees = tuple(Grasshopper.DataTree[System.Object]() for _ in OUTPUTS)
    return trees[0] if len(trees) == 1 else trees


def null_outputs():
    """One null per output: an item of an item-access component that has no
    result keeps its slot (decision 8.186)."""
    if len(OUTPUTS) <= 1:
        return None
    return tuple(None for _ in OUTPUTS)


class CSC_ComputePCAOrientation(Grasshopper.Kernel.GH_ScriptInstance):
    """
    Author: Max Benjamin Eschenbach
    License: MIT License
    Version: 261102
    """

    _outputs_ready = True       # set by BeforeRunScript (8.112)
    _outputs_note = None

    def __init__(self):
        """Initialize this component and set component parameters."""
        super().__init__()
        # initialize props
        self.Component = ghenv.Component  # NOQA
        self.InputParams = self.Component.Params.Input
        self.OutputParams = self.Component.Params.Output

    def _addRemark(self, msg: str = ''):
        """Add a remark message to the component."""
        rml = self.Component.RuntimeMessageLevel.Remark
        self.AddRuntimeMessage(rml, msg)

    def _addWarning(self, msg: str = ''):
        """Add a warning message to the component."""
        rml = self.Component.RuntimeMessageLevel.Warning
        self.AddRuntimeMessage(rml, msg)

    def _addError(self, msg: str = ''):
        """Add an error message to the component."""
        rml = self.Component.RuntimeMessageLevel.Error
        self.AddRuntimeMessage(rml, msg)

    def _state(self, text=''):
        """The one short state under the component (decision 8.113)."""
        if set_state is not None:
            set_state(self.Component, text)

    def _no_result(self, *ports):
        """The result of an iteration without one (decision 8.186): empty
        outputs when the inputs in ``ports`` carry no data at all (the
        component waits for data; no ports: a list or tree input is empty),
        else a null in the slot of this item, so the outputs stay one to one
        with the input list."""
        if not ports or (waits_for_data is not None
                         and waits_for_data(self, ports)):
            return empty_outputs()
        return null_outputs()

    def _stop(self):
        """True when RunScript has to return early: the outputs were just
        updated (says why)."""
        if self._outputs_note:
            self._addRemark(self._outputs_note)
        return not self._outputs_ready

    def _check_outputs(self):
        """Make the outputs match OUTPUTS before the script runs (8.112)."""
        self._outputs_ready, self._outputs_note = True, None
        if ensure_outputs is None:
            self._outputs_note = (
                'output check skipped: CSC library not installed')
            return
        status = ensure_outputs(self.Component, OUTPUTS)
        self._outputs_ready, self._outputs_note = status.ready, status.remark

    def BeforeRunScript(self):
        """Perform some setup actions."""
        # Initialize input param descriptions
        self.InputParams[0].Description = (
            'Input Rhino Geometry (Mesh, Brep, Extrusion, or PointCloud)'
        )
        # Initialize output param descriptions
        self._check_outputs()

    def center_geometry_at_origin(self, geometry):
        """
        Center geometry at its centroid.
        Returns centered geometry and translation vector.
        """
        if isinstance(geometry, Rhino.Geometry.PointCloud):
            if geometry.Count == 0:
                raise RuntimeError('Point cloud is empty')
            bbox = geometry.GetBoundingBox(True)
            volume_centroid = bbox.Center
        else:
            vmp = Rhino.Geometry.VolumeMassProperties.Compute(geometry)
            volume_centroid = vmp.Centroid
            if volume_centroid is None:
                bbox = geometry.GetBoundingBox(True)
                volume_centroid = bbox.Center
        translation_vector = -np.array([
            volume_centroid.X, volume_centroid.Y, volume_centroid.Z
        ])
        centered_geometry = geometry.Duplicate()
        translation_xform = Rhino.Geometry.Transform.Translation(
            translation_vector[0], translation_vector[1], translation_vector[2]
        )
        centered_geometry.Transform(translation_xform)
        return centered_geometry, translation_vector

    def _triangle_area(self, v0, v1, v2):
        return float(0.5 * np.linalg.norm(np.cross(v1 - v0, v2 - v0)))

    def sample_points_area_weighted_from_mesh(
            self,
            mesh,
            reference_face_area=REFERENCE_FACE_AREA_MM2,
            min_samples_per_face=1):
        """
        Build a PCA point cloud by repeating face centroids weighted by area.
        """
        vertices = np.array(
            [[v.X, v.Y, v.Z] for v in mesh.Vertices],
            dtype=np.float64,
        )
        if mesh.Faces.Count == 0:
            return vertices

        samples = []
        ref_area = max(reference_face_area, 1e-6)
        for face_idx in range(mesh.Faces.Count):
            face = mesh.Faces[face_idx]
            if face.IsTriangle:
                triangles = [[face.A, face.B, face.C]]
            elif face.IsQuad:
                triangles = [
                    [face.A, face.B, face.C],
                    [face.A, face.C, face.D],
                ]
            else:
                continue

            for tri in triangles:
                v0, v1, v2 = (
                    vertices[tri[0]], vertices[tri[1]], vertices[tri[2]]
                )
                area = self._triangle_area(v0, v1, v2)
                count = max(
                    min_samples_per_face,
                    int(round(area / ref_area)),
                )
                centroid = (v0 + v1 + v2) / 3.0
                samples.extend([centroid] * count)

        if not samples:
            return vertices
        return np.vstack(samples)

    def sample_points_for_pca_3d(self, geometry):
        """
        Collect area-weighted PCA samples from mesh or brep geometry.
        NOTE: Currently not used due to very long runtime
        """
        if isinstance(geometry, Rhino.Geometry.Mesh):
            return self.sample_points_area_weighted_from_mesh(geometry)

        if isinstance(geometry, Rhino.Geometry.Brep):
            mp = Rhino.Geometry.MeshingParameters.Default
            brep_meshes = Rhino.Geometry.Mesh.CreateFromBrep(geometry, mp)
            if brep_meshes:
                chunks = [
                    self.sample_points_area_weighted_from_mesh(m)
                    for m in brep_meshes
                ]
                return np.vstack(chunks)

            return np.array(
                [[p.Location.X, p.Location.Y, p.Location.Z]
                 for p in geometry.Vertices],
                dtype=np.float64,
            )

        raise RuntimeError(
            'Area-weighted 3D sampling not implemented for geometry of type '
            f'{type(geometry)}!'
        )

    def compute_obb_3d(self, points):
        """
        Compute object oriented bounding box for 3D points using PCA.
        Returns unsorted dimensions and bounding box origin.
        """
        pca = PCA(n_components=3)
        pca.fit(points)
        principal_components = pca.components_

        det = np.linalg.det(principal_components)
        if det < 0:
            principal_components[2] = -principal_components[2]

        pca_points = np.dot(points, principal_components.T)
        min_bounds = np.min(pca_points, axis=0)
        max_bounds = np.max(pca_points, axis=0)
        dimensions = max_bounds - min_bounds
        bbx_origin = (min_bounds + max_bounds) / 2.0

        return dimensions.tolist(), principal_components, bbx_origin.tolist()

    def minimum_bounding_rectangle(self, points):
        """
        Compute minimum bounding rectangle for 2D points.
        Returns rectangle corners and angle.
        """
        hull = ConvexHull(points)
        hull_points = points[hull.vertices]

        min_area = float('inf')
        best_rectangle = None
        best_angle = 0

        for i in range(len(hull_points)):
            p1 = hull_points[i]
            p2 = hull_points[(i + 1) % len(hull_points)]
            edge_vec = p2 - p1
            angle = np.arctan2(edge_vec[1], edge_vec[0])
            cos_angle = np.cos(-angle)
            sin_angle = np.sin(-angle)
            rot_matrix = np.array([[cos_angle, -sin_angle],
                                   [sin_angle, cos_angle]])
            rotated_points = np.dot(points, rot_matrix.T)

            min_x = np.min(rotated_points[:, 0])
            max_x = np.max(rotated_points[:, 0])
            min_y = np.min(rotated_points[:, 1])
            max_y = np.max(rotated_points[:, 1])
            area = (max_x - min_x) * (max_y - min_y)

            if area < min_area:
                min_area = area
                best_angle = angle
                best_rectangle = np.array([
                    [min_x, min_y],
                    [max_x, min_y],
                    [max_x, max_y],
                    [min_x, max_y]
                ])
                inv_rot_matrix = np.array([
                    [cos_angle, sin_angle],
                    [-sin_angle, cos_angle]
                ])
                best_rectangle = np.dot(best_rectangle, inv_rot_matrix.T)

        return best_rectangle, best_angle

    def compute_obb_2d(self, points, height):
        """
        Compute OBB for extrusions using minimum bounding rectangle in XY.
        Returns unsorted dimensions and bounding box origin.
        """
        points_2d = points[:, :2]
        mbr, optimal_angle = self.minimum_bounding_rectangle(points_2d)

        cos_angle = np.cos(-optimal_angle)
        sin_angle = np.sin(-optimal_angle)
        rot_matrix = np.array([
            [cos_angle, -sin_angle],
            [sin_angle, cos_angle]
        ])
        rotated_points = np.dot(points_2d, rot_matrix.T)

        min_x = np.min(rotated_points[:, 0])
        max_x = np.max(rotated_points[:, 0])
        min_y = np.min(rotated_points[:, 1])
        max_y = np.max(rotated_points[:, 1])

        x_dim = max_x - min_x
        y_dim = max_y - min_y
        bbx_center_2d = [(min_x + max_x) / 2.0, (min_y + max_y) / 2.0]

        min_z = np.min(points[:, 2])
        max_z = np.max(points[:, 2])
        z_center = (min_z + max_z) / 2.0
        bbx_origin_2d = [bbx_center_2d[0], bbx_center_2d[1], z_center]

        if x_dim >= y_dim:
            dimensions = [x_dim, y_dim, height]
            principal_components = np.array([
                [cos_angle, -sin_angle, 0],
                [sin_angle, cos_angle, 0],
                [0, 0, 1]
            ])
        else:
            dimensions = [y_dim, x_dim, height]
            cos_angle_90 = np.cos(-optimal_angle + np.pi / 2)
            sin_angle_90 = np.sin(-optimal_angle + np.pi / 2)
            principal_components = np.array([
                [cos_angle_90, -sin_angle_90, 0],
                [sin_angle_90, cos_angle_90, 0],
                [0, 0, 1]
            ])

        return dimensions, principal_components, bbx_origin_2d

    def rhino_xform(self, transformation_matrix) -> Rhino.Geometry.Transform:
        """
        Convert numpy transformation matrix to Rhino Transform.
        """
        XForm = Rhino.Geometry.Transform.Identity
        XForm.M00 = transformation_matrix[0][0]
        XForm.M01 = transformation_matrix[0][1]
        XForm.M02 = transformation_matrix[0][2]
        XForm.M03 = transformation_matrix[0][3]
        XForm.M10 = transformation_matrix[1][0]
        XForm.M11 = transformation_matrix[1][1]
        XForm.M12 = transformation_matrix[1][2]
        XForm.M13 = transformation_matrix[1][3]
        XForm.M20 = transformation_matrix[2][0]
        XForm.M21 = transformation_matrix[2][1]
        XForm.M22 = transformation_matrix[2][2]
        XForm.M23 = transformation_matrix[2][3]
        return XForm

    def process_geometry(self, geometry: Rhino.Geometry.GeometryBase):
        """
        Process geometry to extract points and determine if 3D.
        Returns points array and boolean indicating if 3D.
        """
        compute_3d = False
        # HANDLE BREP
        if isinstance(geometry, Rhino.Geometry.Brep):
            points = np.array([[p.Location.X,
                                p.Location.Y,
                                p.Location.Z] for p in geometry.Vertices])
            compute_3d = True
        # HANDLE EXTRUSIONS
        elif isinstance(geometry, Rhino.Geometry.Extrusion):
            brep = geometry.ToBrep()
            points = np.array([[p.Location.X,
                                p.Location.Y,
                                p.Location.Z] for p in brep.Vertices])
            compute_3d = False
        # HANDLE MESH
        elif isinstance(geometry, Rhino.Geometry.Mesh):
            points = np.array([[p.X, p.Y, p.Z] for p in geometry.Vertices])
            compute_3d = True
        elif isinstance(geometry, Rhino.Geometry.PointCloud):
            if geometry.Count == 0:
                raise RuntimeError('Point cloud is empty')
            points = np.array([
                [geometry[i].Location.X,
                 geometry[i].Location.Y,
                 geometry[i].Location.Z]
                for i in range(geometry.Count)
            ])
            compute_3d = True
        else:
            raise RuntimeError('Geometry processing not implemented '
                               f'for geometry of type {type(geometry)}!')
        # return results
        return points, compute_3d

    def create_pca_transform_matrix(self, principal_components):
        """
        Create a 4x4 transformation matrix from PCA principal components.
        """
        # The principal components define the new coordinate system
        # To transform geometry TO align with this system, we need the INVERSE
        # The principal components are the new basis vectors
        # We want to rotate the geometry so it aligns with these vectors
        # This requires the inverse of the rotation matrix
        rotation_matrix = np.linalg.inv(principal_components.T)
        # Create 4x4 transformation matrix
        transform_matrix = np.eye(4)
        transform_matrix[:3, :3] = rotation_matrix
        # return results
        return transform_matrix

    def apply_pca_transform(self, geometry, principal_components):
        """
        Apply PCA transformation to geometry.
        """
        # Create transformation matrix
        transform_matrix = self.create_pca_transform_matrix(
            principal_components)
        # Convert to Rhino XForm
        xform = self.rhino_xform(transform_matrix)
        # Apply transformation
        transformed_geometry = geometry.Duplicate()
        transformed_geometry.Transform(xform)
        # return results
        return transformed_geometry

    def RunScript(self, Geometry: Rhino.Geometry.GeometryBase):
        # set up output variables
        if self._stop():
            return empty_outputs()
        ObjectOrientedBBX = Grasshopper.DataTree[System.Object]()
        AlignedGeometry = Grasshopper.DataTree[System.Object]()
        AlignedBBX = Grasshopper.DataTree[System.Object]()
        TranslationVector = Grasshopper.DataTree[System.Object]()
        PCAXForm = Grasshopper.DataTree[System.Object]()
        try:
            # sanitize input and abort if not present
            if not Geometry:
                msg = 'Input Geometry failed to collect data!'
                self._addWarning(msg)
                return self._no_result('Geometry')
            elif not Geometry.IsValid:
                msg = 'Input Geometry is invalid!'
                self._addError(msg)
                return null_outputs()
            # Center geometry at world origin
            (centered_geometry,
             translation_vector) = self.center_geometry_at_origin(Geometry)
            # Process geometry to extract points
            centered_points, compute_3d = self.process_geometry(
                centered_geometry
            )
            # Get Rhino translation vector
            TranslationVector = Rhino.Geometry.Vector3d(
                *translation_vector.tolist()
            )
            if compute_3d:
                # centered_points = self.sample_points_for_pca_3d(
                #     centered_geometry
                # )
                dimensions, principal_components, bbx_origin = (
                    self.compute_obb_3d(centered_points)
                )
            else:
                height = centered_geometry.PathStart.DistanceTo(
                    centered_geometry.PathEnd
                )
                dimensions, principal_components, bbx_origin = (
                    self.compute_obb_2d(centered_points, height)
                )
            # Create PCA transformation matrix and XForm
            # The principal components define the new coordinate system
            # We want to transform the geometry TO align with this system
            pca_transform_matrix = self.create_pca_transform_matrix(
                principal_components)
            PCAXForm = self.rhino_xform(pca_transform_matrix)
            # Apply PCA transformation to centered geometry
            # This will align the geometry with its principal axes
            AlignedGeometry = self.apply_pca_transform(
                centered_geometry, principal_components)
            # Create PCA-oriented bounding box
            AlignedBBX = AlignedGeometry.GetBoundingBox(True)
            # Now "transform back" the PCA-oriented bounding box
            # NOTE: we have to convert to a Rhino.Geometry.Box for the
            # correctly applying the transformation!
            ObjectOrientedBBX = Rhino.Geometry.Box(
                AlignedGeometry.GetBoundingBox(True)
            )
            _res, invPCAXForm = PCAXForm.TryGetInverse()
            if not _res:
                raise RuntimeError('Failed to get Inverse of PCA Transform!')
            ObjectOrientedBBX.Transform(invPCAXForm)
            ObjectOrientedBBX.Transform(
                Rhino.Geometry.Transform.Translation(-TranslationVector)
            )
            # return output
            return (ObjectOrientedBBX, AlignedGeometry,
                    AlignedBBX, TranslationVector, PCAXForm)
        except ValueError as e:
            msg = f'Validation error: {str(e)}'
            self._addError(msg)
            return null_outputs()
        except RuntimeError as e:
            msg = f'Runtime error: {str(e)}'
            self._addError(msg)
            return null_outputs()
        # Return empty results if there was an error
        return (ObjectOrientedBBX, AlignedGeometry,
                AlignedBBX, TranslationVector, PCAXForm)
# ---------- end computepcaorientation ----------

# ---- group: __DDU_CSC_EXAMPLE_01__
# Step 1
# comments & notes: Create new user session by signing  in to your account. Press the "SignIn" button to open your browser.
# 
# As a Fallback, you can use the panels to supply username/password (unsafe, not recommended!)
disablecache_6 = BooleanToggle(False)
clearcache_6 = Button()
signin_6 = Button()
signout_6 = Button()
csc_session_6 = Session(SignIn=signin_6, SignOut=signout_6, DisableCache=disablecache_6, ClearCache=clearcache_6)  # -> Status; inputs Username: String, Password: String, SignIn: Boolean, SignOut: Boolean, DisableCache: Boolean, ClearCache: Boolean; same code as csc_session
status_messages_6 = Panel(csc_session_6)

# ----
# comments & notes: Find the largest area quadrilateral in a boundary Polyline
number_slider_2 = Slider(53, range=0..100)
reducedmeshgeometry = Mesh(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)
pt = ConstructPoint(XCoordinate=0, YCoordinate=0, ZCoordinate=number_slider_2)
xy = XYPlane(Origin=pt)
sec = MeshPlane(Mesh=reducedmeshgeometry, Plane=xy)
boundary_polyline = Data(sec)
maxinscribedquad = MaxInscribedQuad(Curves=boundary_polyline, MaxIter=Slider(25, range=1..200), Starts=Slider(64, range=0..100))  # -> Quads, Areas; inputs Curves: list of Polyline, MaxIter: Int32, Tolerance: Double, Starts: Int32, Seed: Int32
# ---------- maxinscribedquad: C# ----------
#region Usings
using System;
using System.Linq;
using System.Collections;
using System.Collections.Generic;
using System.Drawing;

using Rhino;
using Rhino.Geometry;

using Grasshopper;
using Grasshopper.Kernel;
using Grasshopper.Kernel.Data;
using Grasshopper.Kernel.Types;
#endregion

public class Script_Instance : GH_ScriptInstance
{
    #region Notes
    /* 
      Members:
        RhinoDoc RhinoDocument
        GH_Document GrasshopperDocument
        IGH_Component Component
        int Iteration

      Methods (Virtual & overridable):
        Print(string text)
        Print(string format, params object[] args)
        Reflect(object obj)
        Reflect(object obj, string method_name)

        Author: Max Benjamin Eschenbach, Alessandro Garruto
        License: MIT License
        Version: 251102
    */
    #endregion

    private void RunScript(
		List<Polyline> Curves,
		int MaxIter,
		double Tolerance,
		int Starts,
		int Seed,
		ref object Quads,
		ref object Areas)
    {
        // Set component params
        this.Component.Name = "MaxInscribedQuad";
        this.Component.NickName = "MaxInscribedQuad";
        this.Component.Category = "DDU_CSC";
        this.Component.SubCategory = "7 Geometry Tools";
        this.Component.Description = (
            "Finds a maximum-area inscribed 4-point polygon (quadrilateral) inside each input closed polyline.\n" +
            "Method 0: pure Rhino (default)\n"
        );

        // Initialize input param descriptions
        if (this.Component.Params.Input.Count > 0)
            this.Component.Params.Input[0].Description = "Closed boundary polylines (PolylineCurve). Each is processed independently.";
        if (this.Component.Params.Input.Count > 2)
            this.Component.Params.Input[1].Description = "Maximum iterations for the optimizer.";
        if (this.Component.Params.Input.Count > 3)
            this.Component.Params.Input[2].Description = "Containment tolerance for inside checks (default 0.01).";
        if (this.Component.Params.Input.Count > 4)
            this.Component.Params.Input[3].Description = "Multi-start count; more starts improves quality (default 64).";
        if (this.Component.Params.Input.Count > 5)
            this.Component.Params.Input[4].Description = "Random seed for reproducibility (default 42).";

        // Initialize output param descriptions
        int i = 0;
        if (this.Component.Params.Output.Count > 0 && this.Component.Params.Output[0].Name == "out")
            i += 1;
        if (this.Component.Params.Output.Count > 0 + i)
            this.Component.Params.Output[0 + i].Description = "List of best inscribed quadrilaterals (Polyline).";
        if (this.Component.Params.Output.Count > 1 + i)
            this.Component.Params.Output[1 + i].Description = "Area of each quadrilateral.";

        // Process inputs
        if (Curves == null)
        {
            this.AddRuntimeMessage(
                GH_RuntimeMessageLevel.Warning,
                "Input Parameter Curves failed to collect Data!"
            );
            Quads = new Grasshopper.DataTree<System.Object>();
            Areas = new Grasshopper.DataTree<System.Object>();
            return;
        }
        if (MaxIter <= 0 | MaxIter == null)
            MaxIter = 150;
        if (Tolerance <= 0 | Tolerance == null)
            Tolerance = 0.01;
        if (Starts <= 0 | Starts == null)
            Starts = 64;
        if (Seed == 0 | Seed == null)
            Seed = 42;

        List<Polyline> quads = new List<Polyline>();
        List<double> areas = new List<double>();

        foreach (Polyline c in Curves)
        {
            PolylineCurve curve = c.ToPolylineCurve();
            if (curve == null || !curve.IsValid || !curve.IsClosed)
            {
                quads.Add(null);
                areas.Add(0.0);
                continue;
            }

            Polyline q;
            double a;
            BestQuad(curve, Tolerance, Starts, MaxIter, Seed, out q, out a);
            quads.Add(q);
            areas.Add(a);
        }

        Quads = quads;
        Areas = areas;
    }

    private static Plane FitPlaneForPolyline(PolylineCurve pl)
    {
        Plane plane;
        bool ok = pl.TryGetPlane(out plane);
        if (ok)
            return plane;

        Point3d[] pts = new Point3d[pl.PointCount];
        for (int i = 0; i < pl.PointCount; i++)
        {
            pts[i] = pl.Point(i);
        }
        PlaneFitResult pfr = Plane.FitPlaneToPoints(pts, out plane);
        bool ok2 = (int) pfr >= 0;
        return ok2 ? plane : Plane.WorldXY;
    }

    private static Point3d PointAtU(PolylineCurve plCurve, double u)
    {
        u = u % 1.0;
        double length = plCurve.GetLength();
        double s = u * length;
        double t;
        bool ok = plCurve.LengthParameter(s, out t);
        return ok ? plCurve.PointAt(t) : plCurve.PointAtStart;
    }

    private static double PolygonAreaXY(List<Point3d> pts)
    {
        double s = 0.0;
        int n = pts.Count;
        for (int i = 0; i < n; i++)
        {
            int j = (i + 1) % n;
            s += pts[i].X * pts[j].Y - pts[i].Y * pts[j].X;
        }
        return 0.5 * Math.Abs(s);
    }

    private static List<Point3d> SimpleQuad(List<Point3d> pts)
    {
        double cx = pts.Sum(p => p.X) / 4.0;
        double cy = pts.Sum(p => p.Y) / 4.0;
        List<Tuple<double, Point3d>> angPts = new List<Tuple<double, Point3d>>();
        foreach (Point3d p in pts)
        {
            double angle = Math.Atan2(p.Y - cy, p.X - cx);
            angPts.Add(Tuple.Create(angle, p));
        }
        angPts.Sort((a, b) => a.Item1.CompareTo(b.Item1));
        return angPts.Select(t => t.Item2).ToList();
    }

    private static bool SegmentInside(Curve curve, Plane plane, Point3d p, Point3d q, double Tolerance, int samples = 7)
    {
        for (int i = 0; i < samples; i++)
        {
            double a = (samples == 1) ? 0.0 : (double)i / (double)(samples - 1);
            Point3d m = new Point3d(
                p.X * (1 - a) + q.X * a,
                p.Y * (1 - a) + q.Y * a,
                p.Z * (1 - a) + q.Z * a
            );
            PointContainment rel = curve.Contains(m, plane, Tolerance);
            if (rel != PointContainment.Inside && rel != PointContainment.Coincident)
                return false;
        }
        return true;
    }

    private double QuadAreaIfValid(PolylineCurve curve, Plane plane, PolylineCurve pl, List<double> uvec, double Tolerance)
    {
        List<double> us = new List<double>(uvec.Select(u => u % 1.0));
        us.Sort();
        List<Point3d> pts = us.Select(u => PointAtU(pl, u)).ToList();
        List<Point3d> quad = SimpleQuad(pts);
        for (int i = 0; i < 4; i++)
        {
            int j = (i + 1) % 4;
            if (!SegmentInside(curve, plane, quad[i], quad[j], Tolerance))
                return 0.0;
        }
        return PolygonAreaXY(quad);
    }

    private Tuple<List<double>, double> ImproveUvec(PolylineCurve curve, Plane plane, PolylineCurve pl, List<double> uvec, double Tolerance, double delta, int iters = 1)
    {
        List<double> u = new List<double>(uvec);
        double best = QuadAreaIfValid(curve, plane, pl, u, Tolerance);
        for (int iter = 0; iter < iters; iter++)
        {
            for (int k = 0; k < 4; k++)
            {
                bool improved = true;
                while (improved)
                {
                    improved = false;
                    foreach (double step in new double[] { -delta, delta })
                    {
                        List<double> cand = new List<double>(u);
                        cand[k] = (cand[k] + step) % 1.0;
                        double a = QuadAreaIfValid(curve, plane, pl, cand, Tolerance);
                        if (a > best)
                        {
                            best = a;
                            u = cand;
                            improved = true;
                            break;
                        }
                    }
                }
            }
        }
        return Tuple.Create(u, best);
    }

    private void BestQuad(PolylineCurve curve, double tol, int Starts, int MaxIter, int Seed, out Polyline quad, out double area)
    {
        quad = null;
        area = 0.0;

        if (curve == null || !curve.IsValid || !curve.IsClosed)
            return;

        Plane plane = FitPlaneForPolyline(curve);
        PolylineCurve pl = curve;

        Random rng = new Random(Seed);
        double phi = (Math.Sqrt(5.0) - 1.0) * 0.5;
        List<List<double>> seeds = new List<List<double>>();

        double baseU = rng.NextDouble();
        for (int i = 0; i < Math.Max(1, Starts); i++)
        {
            double u1 = (baseU + i * phi) % 1.0;
            double u2 = (u1 + 0.25 + (0.03 * ((i * 3) % 5))) % 1.0;
            double u3 = (u1 + 0.50 + (0.07 * ((i * 5) % 7))) % 1.0;
            double u4 = (u1 + 0.75 + (0.11 * ((i * 7) % 11))) % 1.0;
            seeds.Add(new List<double> { u1, u2, u3, u4 });
        }

        double bestArea = 0.0;
        List<double> bestU = null;

        foreach (List<double> seedU in seeds)
        {
            double a0 = QuadAreaIfValid(curve, plane, pl, seedU, tol);
            if (a0 <= 0.0)
                continue;

            List<double> u = new List<double>(seedU);
            double a = a0;
            double delta = 0.08;
            int levels = Math.Max(1, Math.Min(6, MaxIter / 50));

            for (int lvl = 0; lvl < levels; lvl++)
            {
                var result = ImproveUvec(curve, plane, pl, u, tol, delta, iters: 1 + lvl);
                u = result.Item1;
                a = result.Item2;
                delta *= 0.35;
            }

            if (a > bestArea)
            {
                bestArea = a;
                bestU = u;
            }
        }

        if (bestU == null || bestArea <= 0.0)
            return;

        List<double> us = new List<double>(bestU.Select(ui => ui % 1.0));
        us.Sort();
        List<Point3d> pts = us.Select(u => PointAtU(pl, u)).ToList();
        List<Point3d> quadPts = SimpleQuad(pts);
        quadPts.Add(quadPts[0]);
        quad = new Polyline(quadPts);
        area = bestArea;
    }
}
# ---------- end maxinscribedquad ----------
maxinquads = Data(maxinscribedquad.Quads)

# ----
# comments & notes: Find the largest "flat" side of a mesh with a clustering/sampling approach
distancetolerance = Slider(2, range=0.01..20)
angletolerance = Slider(5, range=0.01..20)
reducedmeshgeometry_2 = Mesh(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)
findlargestflatside = FindLargestFlatSide(
    InputMesh=reducedmeshgeometry_2,
    AngleTolerance=angletolerance,
    DistanceTolerance=distancetolerance,
    FaceCountThreshold=Slider(20000, range=100..25000))  # -> FlatPlane, Points; inputs InputMesh: Mesh, AngleTolerance: Double, DistanceTolerance: Double, FaceCountThreshold: Int32, MaxSamples: Int32
# ---------- findlargestflatside: C# ----------
#region Usings
using System;
using System.Linq;
using System.Collections;
using System.Collections.Generic;
using System.Drawing;

using Rhino;
using Rhino.Geometry;

using Grasshopper;
using Grasshopper.Kernel;
using Grasshopper.Kernel.Data;
using Grasshopper.Kernel.Types;
#endregion

public class Script_Instance : GH_ScriptInstance
{
    #region Notes
    /* 
      Members:
        RhinoDoc RhinoDocument
        GH_Document GrasshopperDocument
        IGH_Component Component
        int Iteration

      Methods (Virtual & overridable):
        Print(string text)
        Print(string format, params object[] args)
        Reflect(object obj)
        Reflect(object obj, string method_name)

        Author: Max Benjamin Eschenbach, Alessandro Garruto
        License: MIT License
        Version: 251102
    */
    #endregion

    private void RunScript(
		Mesh InputMesh,
		double AngleTolerance,
		double DistanceTolerance,
		int FaceCountThreshold,
		int MaxSamples,
		ref object FlatPlane,
		ref object Points)
    {
        // GHENV COMPONENT SETTINGS
        this.Component.Name = "FindLargestFlatSide";
        this.Component.NickName = "FindLargestFlatSide";
        this.Component.Category = "DDU_CSC";
        this.Component.SubCategory = "7 Geometry Tools";
        this.Component.Description = (
            "Finds the largest flat side of a mesh using optimized algorithm. " +
            "Uses normal clustering and early termination heuristics for performance.");
        // Initialize input param descriptions
        this.Component.Params.Input[0].Description = (
            "Input Mesh for finding the largest flat side."
        );
        this.Component.Params.Input[1].Description = (
            "Angle tolerance for clustering normals."
        );
        this.Component.Params.Input[2].Description = (
            "Distance tolerance"
        );
        this.Component.Params.Input[3].Description = (
            "Face count threshold for large meshes. Meshes with face count " +
            "above this value will be processed by sampling a subset of vertices.\n" +
            "Defaults to 15.000"
        );
        this.Component.Params.Input[4].Description = (
            "Maximum points to sample for the fallback algorithm.\n" +
            "Defaults to 5.000"
        );

        // Initialize output param descriptions
        int opi = 0;
        if (this.Component.Params.Output[0].Name == "out")
            opi = 1;
        this.Component.Params.Input[0+opi].Description = (
            "Flattest Plane found. Normal always points AWAY from the Mesh."
        );
        this.Component.Params.Input[1+opi].Description = (
            "Final Points that were used to fit the flat plane."
        );

        // Validation
        if (InputMesh == null || !InputMesh.IsValid)
        {
            this.AddRuntimeMessage(GH_RuntimeMessageLevel.Warning, 
                "Input Parameter Mesh failed to collect Data!");
            FlatPlane = new Grasshopper.DataTree<Plane>();
            Points = new Grasshopper.DataTree<Point3d>();
            return;
        }
        
        if (AngleTolerance <= 0)
            AngleTolerance = 3.0;
        
        if (DistanceTolerance <= 0)
            DistanceTolerance = 1.0;
        
        if (FaceCountThreshold <= 0)
            FaceCountThreshold = 10000;
        
        if (MaxSamples <= 0)
            MaxSamples = 5000;

        double angleTolRad = RhinoMath.ToRadians(AngleTolerance);
        
        // Ensure face and vertex normals are computed
        InputMesh.FaceNormals.ComputeFaceNormals();
        InputMesh.Normals.ComputeNormals();
        
        int faceCount = InputMesh.Faces.Count;
        var vertices = InputMesh.Vertices;
        var vertexNormals = InputMesh.Normals;
        var faceNormals = InputMesh.FaceNormals;
        
        // Precompute all face data
        var faceData = new List<FaceData>(faceCount);
        for (int i = 0; i < faceCount; i++)
        {
            var face = InputMesh.Faces[i];
            var p1 = vertices[face.A];
            var p2 = vertices[face.B];
            var p3 = vertices[face.C];
            
            var plane = new Plane(p1, p2, p3);
            var normal = faceNormals[i];
            
            faceData.Add(new FaceData
            {
                Index = i,
                Face = face,
                Plane = plane,
                Normal = normal,
                Vertices = face.IsQuad 
                    ? new[] { face.A, face.B, face.C, face.D }
                    : new[] { face.A, face.B, face.C }
            });
        }
        
        int maxPointsFound = 0;
        Plane bestPlane = Plane.WorldXY;
        HashSet<int> bestPointsIndices = new HashSet<int>();
        int vertexCount = vertices.Count;
        
        // DECISION: Use sampling directly for large meshes, clustering for smaller ones
        if (faceCount > FaceCountThreshold)
        {
            // Very large mesh: Use sampling approach directly
            int sampleSize = Math.Min(MaxSamples, faceCount);
            var sampledBest = FindBestFromSample(
                faceData,
                vertices,
                angleTolRad,
                DistanceTolerance,
                sampleSize);
            
            maxPointsFound = sampledBest.PointsCount;
            bestPointsIndices = sampledBest.Points;
            bestPlane = sampledBest.Plane;
        }
        else
        {
            // Small to medium mesh: Use clustering approach
            var normalClusters = ClusterFacesByNormal(faceData, angleTolRad);
            
            // Early termination threshold
            // If we find a cluster covering >80% of vertices, we can stop
            double earlyTermThreshold = 0.8 * vertexCount;
            
            // Process clusters instead of individual faces
            foreach (var cluster in normalClusters)
            {
                if (cluster.Count == 0) continue;
                
                // Use the first face in cluster as representative
                var baseFaceData = faceData[cluster[0]];
                var basePlane = baseFaceData.Plane;
                var baseNormal = baseFaceData.Normal;
                
                var currentPointsIndices = new HashSet<int>();
                
                // Check all faces in this cluster
                foreach (int faceIdx in cluster)
                {
                    var otherFaceData = faceData[faceIdx];
                    var otherNormal = otherFaceData.Normal;
                    
                    // Verify normal alignment (should be true for same cluster, but verify)
                    double angle = Vector3d.VectorAngle(baseNormal, otherNormal);
                    bool isParallel = (angle < angleTolRad) || 
                                     (angle > (Math.PI - angleTolRad));
                    
                    if (isParallel)
                    {
                        // Check distance for all vertices of this face
                        bool allInTolerance = true;
                        foreach (int vIdx in otherFaceData.Vertices)
                        {
                            double dist = basePlane.DistanceTo(vertices[vIdx]);
                            if (Math.Abs(dist) > DistanceTolerance)
                            {
                                allInTolerance = false;
                                break;
                            }
                        }
                        
                        if (allInTolerance)
                        {
                            foreach (int vIdx in otherFaceData.Vertices)
                                currentPointsIndices.Add(vIdx);
                        }
                    }
                }
                
                // Check if this cluster is better
                if (currentPointsIndices.Count > maxPointsFound)
                {
                    maxPointsFound = currentPointsIndices.Count;
                    bestPointsIndices = new HashSet<int>(currentPointsIndices);
                    bestPlane = basePlane;
                    
                    // Early termination check
                    if (maxPointsFound >= earlyTermThreshold)
                        break;
                }
            }
        }
        
        // Convert indices to points
        var finalPoints = new List<Point3d>();
        var finalNormals = new List<Vector3d>();
        foreach (int idx in bestPointsIndices)
        {
            finalPoints.Add(vertices[idx]);
            finalNormals.Add(vertexNormals[idx]);
        }
        
        // Fit plane to all found points for better accuracy
        if (finalPoints.Count > 2)
        {
            Plane fittedPlane;
            PlaneFitResult pfr = Plane.FitPlaneToPoints(finalPoints, out fittedPlane);
            if ((int) pfr >= 0)
            {
                bestPlane = fittedPlane;
                var ptX = finalPoints.Select(pt => pt.X);
                var ptY = finalPoints.Select(pt => pt.Y);
                var ptZ = finalPoints.Select(pt => pt.Z);
                Point3d ptCentroid = new Point3d(
                    ptX.Sum() / ptX.Count(),
                    ptY.Sum() / ptY.Count(),
                    ptZ.Sum() / ptZ.Count()
                );
                bestPlane.Origin = ptCentroid;
                var vX = finalNormals.Select(v => v.X);
                var vY = finalNormals.Select(v => v.Y);
                var vZ = finalNormals.Select(v => v.Z);
                Vector3d avgNormal = new Vector3d(
                    vX.Sum() / vX.Count(),
                    vY.Sum() / vY.Count(),
                    vZ.Sum() / vZ.Count()
                );
                avgNormal.Unitize();
                double dp = avgNormal * bestPlane.Normal;
                if (dp < 0)
                {
                    bestPlane.Flip();
                }
            }
        }
        
        FlatPlane = bestPlane;
        Points = finalPoints;
    }
    
    // Cluster faces by normal direction using spatial hashing
    private List<List<int>> ClusterFacesByNormal(List<FaceData> faceData, double angleTol)
    {
        // Use a dictionary to group faces by quantized normal direction
        // This creates buckets of similar normals
        var clusters = new Dictionary<string, List<int>>();
        
        foreach (var fd in faceData)
        {
            // Quantize normal to create hash key
            // Round to nearest 5 degrees to create buckets
            var normal = fd.Normal;
            int quantizedX = (int)(Math.Round(normal.X / angleTol) * angleTol * 1000);
            int quantizedY = (int)(Math.Round(normal.Y / angleTol) * angleTol * 1000);
            int quantizedZ = (int)(Math.Round(normal.Z / angleTol) * angleTol * 1000);
            
            // Also consider opposite direction (flip normal)
            string key1 = $"{quantizedX},{quantizedY},{quantizedZ}";
            string key2 = $"{-quantizedX},{-quantizedY},{-quantizedZ}";
            
            if (!clusters.ContainsKey(key1))
            {
                // Check if opposite key exists
                if (clusters.ContainsKey(key2))
                {
                    clusters[key2].Add(fd.Index);
                }
                else
                {
                    clusters[key1] = new List<int> { fd.Index };
                }
            }
            else
            {
                clusters[key1].Add(fd.Index);
            }
        }
        
        return clusters.Values.ToList();
    }
    
    // Sample-based search for very large meshes
    private (HashSet<int> Points, int PointsCount, Plane Plane) FindBestFromSample(
        List<FaceData> faceData,
        Rhino.Geometry.Collections.MeshVertexList vertices,
        double angleTol,
        double distTol,
        int sampleSize)
    {
        var random = new Random(42); // Fixed seed for reproducibility
        var sampled = faceData.OrderBy(x => random.Next()).Take(sampleSize).ToList();

        int maxPoints = 0;
        HashSet<int> bestPoints = new HashSet<int>();
        Plane bestPlane = Plane.WorldXY;

        foreach (var baseFace in sampled)
        {
            var currentPoints = new HashSet<int>();

            foreach (var otherFace in faceData)
            {
                double angle = Vector3d.VectorAngle(baseFace.Normal, otherFace.Normal);
                bool isParallel = (angle < angleTol) || (angle > (Math.PI - angleTol));

                if (isParallel)
                {
                    bool allInTol = true;
                    foreach (int vIdx in otherFace.Vertices)
                    {
                        Point3d vertex = vertices[vIdx];
                        double dist = Math.Abs(baseFace.Plane.DistanceTo(vertex));
                        if (dist > distTol)
                        {
                            allInTol = false;
                            break;
                        }
                    }

                    if (allInTol)
                    {
                        foreach (int vIdx in otherFace.Vertices)
                            currentPoints.Add(vIdx);
                    }
                }
            }

            if (currentPoints.Count > maxPoints)
            {
                maxPoints = currentPoints.Count;
                bestPoints = new HashSet<int>(currentPoints);
                bestPlane = baseFace.Plane;
            }
        }

        return (bestPoints, maxPoints, bestPlane);
    }
    
    private class FaceData
    {
        public int Index;
        public MeshFace Face;
        public Plane Plane;
        public Vector3d Normal;
        public int[] Vertices;
    }
}
# ---------- end findlargestflatside ----------
pflip = FlipPlane(Plane=findlargestflatside.FlatPlane, ReverseX=False, ReverseY=False, SwapAxes=True)
xy_2 = XYPlane(Origin=Point(0, 0, 0))
orient = Orient(Geometry=reducedmeshgeometry_2, Source=pflip, Target=xy_2)  # -> Geometry, Transform

# ---- group: __DDU_CSC_EXAMPLE_11__
# Step 2
componentid_4 = Panel("6df1899a-6569-494b-a765-bca686f6d589")
componentid_5 = Panel("243df186-9e30-4b19-95aa-17d7d88976f9")
fetchcomponents_3 = FetchComponents(IdentityID=componentid_5)  # -> ComponentPassport; inputs IdentityID: list; same code as fetchcomponents
componentpassport_6 = Data(fetchcomponents_3)

# ---- group: __DDU_CSC_EXAMPLE_09__
# Step 2
# comments & notes: Fetch a single component or multiple components from the catalogue using its ID.
componentid_6 = Panel("243df186-9e30-4b19-95aa-17d7d88976f9")
fetchcomponents_4 = FetchComponents(IdentityID=componentid_6)  # -> ComponentPassport; inputs IdentityID: list; same code as fetchcomponents
componentpassport_7 = Data(fetchcomponents_4)

# ---- group: __DDU_CSC_EXAMPLE_07__
# Step 1.1
# comments & notes: Here we convert a lat/lon string to a location vector. You can get lat/lon from Google Maps (or similar services).
# 
# If you're at DDU, just leave it as it is. The pre-set value is the location of the DDU lab.
latitude_longitude_string_i_e_from_googl_2 = Panel("49.861444, 8.676556")  # "Latitude/Longitude String (i.e. from Google Maps)"
convertgeolocation_2 = ConvertGeoLocation(LatLonString=latitude_longitude_string_i_e_from_googl_2)  # -> Lat, Lon, Vec; inputs LatLonString: String; same code as convertgeolocation
location_2 = Data(convertgeolocation_2.Vec)

# ---- group: __DDU_CSC_EXAMPLE_11__
# Step 1
disablecache_7 = BooleanToggle(False)
clearcache_7 = Button()
# Example 11:
# - Still in development: D2P Components Interface
signin_7 = Button()
signout_7 = Button()
csc_session_7 = Session(SignIn=signin_7, SignOut=signout_7, DisableCache=disablecache_7, ClearCache=clearcache_7)  # -> Status; inputs Username: String, Password: String, SignIn: Boolean, SignOut: Boolean, DisableCache: Boolean, ClearCache: Boolean; same code as csc_session
status_messages_7 = Panel(csc_session_7)

# ----
# Step 1
# comments & notes: Create new User Session and sign in
# 
# (Add your credentials!)
disablecache_8 = BooleanToggle(False)
clearcache_8 = Button()
# Example 10:
# - Adding Evidence to a snapshot
signin_8 = Button()
signout_8 = Button()
csc_session_8 = Session(SignIn=signin_8, SignOut=signout_8, DisableCache=disablecache_8, ClearCache=clearcache_8)  # -> Status; inputs Username: String, Password: String, SignIn: Boolean, SignOut: Boolean, DisableCache: Boolean, ClearCache: Boolean; same code as csc_session
status_messages_8 = Panel(csc_session_8)

# ---- group: __DDU_CSC_EXAMPLE_09__
# Step 1
disablecache_9 = BooleanToggle(False)
clearcache_9 = Button()
signout_9 = Button()
signin_9 = Button()
csc_session_9 = Session(SignIn=signin_9, SignOut=signout_9, DisableCache=disablecache_9, ClearCache=clearcache_9)  # -> Status; inputs Username: String, Password: String, SignIn: Boolean, SignOut: Boolean, DisableCache: Boolean, ClearCache: Boolean; same code as csc_session
status_messages_9 = Panel(csc_session_9)

# ----
# comments & notes: Fetch ALL components from the catalogue
fetchallcomponents = FetchAllComponents()  # -> ComponentPassport
# ---------- fetchallcomponents: Python ----------
#! python3
# -*- coding: utf-8 -*-
# venv: DDU_CSC
print('ENV OK!')
# r: charset_normalizer
# r: requests

# PYTHON STANDARD LIBRARY IMPORTS ---------------------------------------------
import json  # NOQA

# THIRD PARTY LIBRARY IMPORTS -------------------------------------------------
import requests  # NOQA

# RHINO AND GH RELATED IMPORTS ------------------------------------------------
import System  # NOQA
import Grasshopper  # NOQA
import Rhino  # NOQA
import scriptcontext as sc  # NOQA

# GHENV COMPONENT SETTINGS ----------------------------------------------------
ghenv.Component.Name = 'FetchAllComponents'  # NOQA
ghenv.Component.NickName = 'FetchAllComponents'  # NOQA
ghenv.Component.Category = 'DDU_CSC'  # NOQA
ghenv.Component.SubCategory = '2 Catalog Interface'  # NOQA
ghenv.Component.Description = (  # NOQA
    'Fetches all catalog identities (joined with their current snapshot) '
    'from the remote Catalog API via GET /identities with caching support. '
    'Returns each entry as a component passport JSON string ({identity, snapshots[]}).'
)

# OPTIONAL HELPERS: they never block the component (decisions 8.112, 8.113) ---
try:
    from csc_gh.ports import ensure_outputs
    from csc_gh.messages import set_state
except ImportError:
    ensure_outputs = set_state = None

OUTPUTS = [
    ('ComponentPassport', 'ComponentPassport',
     "Component passport JSON per entry ({identity, snapshots[]}) fetched from GET /identities. Use 'DisassembleComponent' to access the individual fields ready for Grasshopper"),
]


def empty_outputs():
    """What RunScript returns when it stops early or has no result: an empty
    Grasshopper tree per output (never '' or None)."""
    if not OUTPUTS:
        return None
    trees = tuple(Grasshopper.DataTree[System.Object]() for _ in OUTPUTS)
    return trees[0] if len(trees) == 1 else trees


class CSC_FetchAllComponents(Grasshopper.Kernel.GH_ScriptInstance):
    """
    Author: Max Benjamin Eschenbach
    License: MIT License
    Version: 261102
    """

    _outputs_ready = True       # set by BeforeRunScript (8.112)
    _outputs_note = None

    def __init__(self):
        """Initialize this component and set component parameters."""
        super().__init__()
        # initialize props
        self.Component = ghenv.Component  # NOQA
        self.InputParams = self.Component.Params.Input
        self.OutputParams = self.Component.Params.Output

    def _addRemark(self, msg: str = ''):
        """Add a remark message to the component."""
        rml = self.Component.RuntimeMessageLevel.Remark
        self.AddRuntimeMessage(rml, msg)

    def _addWarning(self, msg: str = ''):
        """Add a warning message to the component."""
        rml = self.Component.RuntimeMessageLevel.Warning
        self.AddRuntimeMessage(rml, msg)

    def _addError(self, msg: str = ''):
        """Add an error message to the component."""
        rml = self.Component.RuntimeMessageLevel.Error
        self.AddRuntimeMessage(rml, msg)

    def _state(self, text=''):
        """The one short state under the component (decision 8.113)."""
        if set_state is not None:
            set_state(self.Component, text)

    def _stop(self):
        """True when RunScript has to return early: the outputs were just
        updated (says why)."""
        if self._outputs_note:
            self._addRemark(self._outputs_note)
        return not self._outputs_ready

    def _check_outputs(self):
        """Make the outputs match OUTPUTS before the script runs (8.112)."""
        self._outputs_ready, self._outputs_note = True, None
        if ensure_outputs is None:
            self._outputs_note = (
                'output check skipped: CSC library not installed')
            return
        status = ensure_outputs(self.Component, OUTPUTS)
        self._outputs_ready, self._outputs_note = status.ready, status.remark

    def BeforeRunScript(self):
        """Perform some setup actions."""
        # Initialize output param descriptions
        self._check_outputs()

    def get_auth_core_from_sticky(self):
        """Get AuthCore instance from sticky storage."""
        auth_core = sc.sticky.get('CSC_AuthCore')
        if auth_core is None:
            msg = ('No authentication found. Please use CSC_Session component '
                   'first.')
            self._addWarning(msg)
            return None
        return auth_core

    def RunScript(self):
        # Get AuthCore instance from sticky storage
        if self._stop():
            return empty_outputs()
        auth_core = self.get_auth_core_from_sticky()
        if auth_core is None:
            return empty_outputs()

        # Check if authentication is valid
        if not auth_core.is_valid():
            msg = ('Authentication expired. Please use CSC_Session '
                   'component to refresh.')
            self._addWarning(msg)
            return empty_outputs()

        try:

            # Unified catalog cache: stores identity + snapshot independently
            # and reassembles passport rows (no separate all_identities blob).
            response = auth_core.cached_list_identities(
                {'expand': 'current_snapshot'},
            )

            if response.status_code == 200:
                # Successfully fetched identities (from server or cache)
                json_comps = response.json()
                component_count = len(json_comps)
                self._state(f'{component_count} fetched')

                self._addRemark(
                    f'Successfully fetched {component_count} components'
                )

                # Set up output trees and results tuple
                ComponentPassport = Grasshopper.DataTree[System.Object]()
                __Results = (ComponentPassport,)

                # Loop over all passport entries and add them to the data tree
                for i, json_comp in enumerate(json_comps):
                    # Create datatree path
                    ghp = Grasshopper.Kernel.Data.GH_Path(0, i)
                    # Add canonical passport JSON to the datatree
                    ComponentPassport.Add(
                        auth_core.passport_json_string(json_comp), ghp)

                return __Results

            elif response.status_code == 401:
                msg = 'Authentication failed. Please sign in again.'
                self._addError(msg)

            elif response.status_code == 403:
                msg = 'Access denied. Insufficient permissions.'
                self._addError(msg)

            elif response.status_code == 500:
                msg = 'Server error. Please try again later.'
                self._addWarning(msg)

            else:
                msg = (f'Request failed with status code: '
                       f'{response.status_code}')
                self._addError(msg)

        except requests.exceptions.ConnectionError as e:
            msg = 'Cannot connect to server. Please check your connection.'
            self._addError(msg + f'\nFull Error: {str(e)}')

        except requests.exceptions.Timeout as e:
            msg = 'Request timeout. Server may be slow.'
            self._addError(msg + f'\nFull Error: {str(e)}')

        except requests.exceptions.RequestException as e:
            msg = f'Request error: {str(e)}'
            self._addError(msg)

        except Exception as e:
            msg = f'Unexpected error: {str(e)}'
            self._addError(msg)

        # Return empty results if there was an error
        ComponentPassport = Grasshopper.DataTree[System.Object]()
        __Results = (ComponentPassport,)
        return __Results
# ---------- end fetchallcomponents ----------
componentpassport_8 = Data(fetchallcomponents)

# ---- group: __DDU_CSC_EXAMPLE_08__
# Step 1
# comments & notes: Create new User Session and sign in
# 
# (Add your credentials!)
disablecache_10 = BooleanToggle(False)
clearcache_10 = Button()
# Example 08:
# - Creating a new snapshot for an existing identity in the catalog
signin_10 = Button()
signout_10 = Button()
csc_session_10 = Session(SignIn=signin_10, SignOut=signout_10, DisableCache=disablecache_10, ClearCache=clearcache_10)  # -> Status; inputs Username: String, Password: String, SignIn: Boolean, SignOut: Boolean, DisableCache: Boolean, ClearCache: Boolean; same code as csc_session
status_messages_10 = Panel(csc_session_10)

smallrubble = Panel("f69f1858-e132-49cc-9474-416947ea797b")
smallrubble_2 = Mesh(<mesh referenced from the Rhino model>)

bigrubble = Panel("243df186-9e30-4b19-95aa-17d7d88976f9")
bigrubble_2 = Mesh(<mesh referenced from the Rhino model>)

steelfixture = Panel("7ebdd53b-27e4-4098-a3e5-f000790fd7c5")
steelfixture_2 = Mesh(<mesh referenced from the Rhino model>)

# ---- group: __DDU_CSC_EXAMPLE_06__
# Step 3
fitsizeb_4 = Slider(0, range=0..2000)
fitsizec_4 = Slider(0, range=0..500)
fittolerance_4 = Panel("10%")
originalfunction_4 = ValueList({"Any function": , "Beam (IfcBeam)": "IfcBeam", "Column (IfcColumn)": "IfcColumn", "Slab (IfcSlab)": "IfcSlab", "Plate / Panel (IfcPlate)": "IfcPlate", "Wall (IfcWall)": "IfcWall", "Member (IfcMember)": "IfcMember", "Pipe (IfcPipeSegment)": "IfcPipeSegment", "Duct (IfcDuctSegment)": "IfcDuctSegment", "Footing (IfcFooting)": "IfcFooting", "Window (IfcWindow)": "IfcWindow", "Door / gate (IfcDoor)": "IfcDoor", "Stair (IfcStair)": "IfcStair", "Railing / balustrade (IfcRailing)": "IfcRailing", "Accessory / Connector (IfcDiscreteAccessory)": "IfcDiscreteAccessory", "Element part (IfcBuildingElementPart)": "IfcBuildingElementPart", "Unknown (IfcBuildingElementProxy)": "IfcBuildingElementProxy", "Debris (CscDebris)": "CscDebris"}, selected="Any function")
material_4 = ValueList({"Any material": , "Concrete (concrete)": "concrete", "Autoclaved aerated concrete (autoclaved_aerated_concrete)": "autoclaved_aerated_concrete", "Fired clay (fired_clay)": "fired_clay", "Calcium silicate (calcium_silicate)": "calcium_silicate", "Ceramic (ceramic)": "ceramic", "Natural stone (natural_stone)": "natural_stone", "Mixed mineral (mineral_mixture)": "mineral_mixture", "Gypsum (gypsum)": "gypsum", "Glass (glass)": "glass"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}, selected="Any material")
complexity_4 = ValueList({"Any complexity": , "0", "1", "2", "3"}, selected="Any complexity")
fragment_4 = ValueList({"Any": , "Only fragments": True, "Only non-fragmnents": False}, selected="Any")
shapeclass_4 = ValueList({"Any shape": , "Linear (linear)": "linear", "Planar (planar)": "planar", "Block (block)": "block", "Irregular (irregular)": "irregular", "Composite (composite)": "composite"}, selected="Any shape")
materialclass_4 = ValueList({"Any MaterialClass": , "Concrete (17 01 01)": "17 01 01", "Bricks (17 01 02)": "17 01 02", "Tiles and ceramics (17 01 03)": "17 01 03", "Mineral mixtures, hazardous (17 01 06*)": "17 01 06*", "Mineral mixtures (17 01 07)": "17 01 07", "Wood (17 02 01)": "17 02 01", "Glass (17 02 02)": "17 02 02", "Plastic (17 02 03)": "17 02 03", "Glass, plastic, wood, hazardous (17 02 04*)": "17 02 04*"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}, selected="Any MaterialClass")
circulation_4 = ValueList({"Active (default)": "active", "Exited": "exited", "All \"all": "All "all""}, selected="Active (default)")
fitmode_4 = ValueList({"Any Fit": , "About this size": "about", "Can hold this size": "can_hold"}, selected="Any Fit")
fitsizea_4 = Slider(0, range=-0.1..2000)
mindimensionx_4 = Slider(0, range=-0.1..2000)
maxdimensiony_4 = Slider(0, range=0..2000)
mindimensionz_4 = Slider(0, range=0..500)
dataset_4 = Panel("mineral_composite_panels")
maxdimensionx_4 = Slider(0, range=0..2000)
mindimensiony_4 = Slider(0, range=0..2000)
maxdimensionz_4 = Slider(0, range=0..500)
reservedstatus_4 = Slider(-1, range=-1..1)
merge_4 = Merge(Data1=fitsizea_4, Data2=fitsizeb_4, Data3=fitsizec_4)
fitsize_4 = Data(merge_4)
fetchfilteredcomponents_4 = FetchFilteredComponents(
    OriginalFunction=originalfunction_4,
    Material=material_4,
    Dataset=dataset_4,
    Complexity=complexity_4,
    Fragment=fragment_4,
    MinDimensionX=mindimensionx_4,
    MaxDimensionX=maxdimensionx_4,
    MinDimensionY=mindimensiony_4,
    MaxDimensionY=maxdimensiony_4,
    MinDimensionZ=mindimensionz_4,
    MaxDimensionZ=maxdimensionz_4,
    ReservedStatus=reservedstatus_4,
    ShapeClass=shapeclass_4,
    MaterialClass=materialclass_4,
    Circulation=circulation_4,
    FitMode=fitmode_4,
    FitSize=fitsize_4,
    FitTolerance=fittolerance_4)  # -> FilterDescription, ComponentPassport, Fit, DistanceKm; inputs OriginalFunction: String, Material: String, Dataset: String, Complexity: Int32, Fragment: Boolean, MinDimensionX: Double, MaxDimensionX: Double, MinDimensionY: Double, MaxDimensionY: Double, MinDimensionZ: Double, MaxDimensionZ: Double, ShapeClass: String, MaterialClass: String, Circulation: String, FitMode: String, FitSize: list, FitTolerance: String, NearPoint: Vector3d, NearLayer: String, RadiusKm: Double; same code as fetchfilteredcomponents
panel_7 = Panel(fetchfilteredcomponents_4.FilterDescription)
componentpassport_9 = Data(fetchfilteredcomponents_4.ComponentPassport)

# ---- group: __DDU_CSC_EXAMPLE_07__
# Step 1
# comments & notes: Create new User Session and sign in
# 
# (Add your credentials!)
disablecache_11 = BooleanToggle(False)
clearcache_11 = Button()
signin_11 = Button()
signout_11 = Button()
csc_session_11 = Session(SignIn=signin_11, SignOut=signout_11, DisableCache=disablecache_11, ClearCache=clearcache_11)  # -> Status; inputs Username: String, Password: String, SignIn: Boolean, SignOut: Boolean, DisableCache: Boolean, ClearCache: Boolean; same code as csc_session
status_messages_11 = Panel(csc_session_11)

# ---- group: __DDU_CSC_EXAMPLE_06__
# Step 2
# comments & notes: Create some Voronoi Cells that we will use as our target "Design Shapes".
# 
# You can play with the Random Seed to get different cell arrangements (randomized).
x_extents = Slider(2500, range=100..3000)
y_extents = Slider(1000, range=100..3000)
dom = ConstructDomain(DomainStart="0", DomainEnd=x_extents)
dom_2 = ConstructDomain(DomainStart="0", DomainEnd=y_extents)
cellcount = Slider(16, range=10..1000)
randomseed = Slider(2637, range=0..10000)
rectangle = Rectangle(Plane=PlaneXY(0, 0, 0), XSize=dom, YSize=dom_2, Radius=0)  # -> Rectangle, Length
boundary = BoundarySurfaces(Edges=rectangle.Rectangle)
popgeo = PopulateGeometry(Geometry=boundary, Count=cellcount, Seed=randomseed)
voronoi = Voronoi(Points=popgeo, BruteForceOverride=False)
rint = RegionIntersection(CurvesA=voronoi, CurvesB=graft(rectangle.Rectangle))  # -> flatten(Result)
curvepreviewlw = CurvePreviewLW(Curves=flatten(rint), Thickness="2")  # inputs Curves: list of Curve, Colors: list of Color, Thickness: list of Int32
# ---------- curvepreviewlw: C# ----------
#region Usings
using System;
using System.Linq;
using System.Collections;
using System.Collections.Generic;
using System.Drawing;

using Rhino;
using Rhino.Geometry;

using Grasshopper;
using Grasshopper.Kernel;
using Grasshopper.Kernel.Data;
using Grasshopper.Kernel.Types;
#endregion

public class Script_Instance : GH_ScriptInstance
{
    #region Notes
    /* 
      Members:
        RhinoDoc RhinoDocument
        GH_Document GrasshopperDocument
        IGH_Component Component
        int Iteration

      Methods (Virtual & overridable):
        Print(string text)
        Print(string format, params object[] args)
        Reflect(object obj)
        Reflect(object obj, string method_name)

        Author: Max Benjamin Eschenbach
        License: MIT License
        Version: 260609
    */
    #endregion

    List<Curve> drawCurves;
    List<Color> drawColors;
    List<int> drawThickness;

    private void RunScript(
		List<Curve> Curves,
		List<Color> Colors,
		List<int> Thickness)
    {
        // set component params
        this.Component.Name = "CurvePreviewLW";
        this.Component.NickName = "CurvePreviewLW";
        this.Component.Category = "DDU_CSC";
        this.Component.SubCategory = "8 Visualization";
        this.Component.Description = (
            "Render curves with custom LineWeights."
        );

        this.drawCurves = new List<Curve>();   
        this.drawColors = new List<Color>();
        this.drawThickness = new List<int>();

        if (Curves == null) return;
        if (Colors == null) this.drawColors = new List<Color>{Color.Black};
        else this.drawColors = Colors;

        if (Thickness == null) this.drawThickness = new List<int>{1};
        else this.drawThickness = Thickness;

        for (int i = 0; i < Curves.Count; i++)
        {
            if (Curves[i] != null)
            {
                this.drawCurves.Add(Curves[i]);
            }
            else
            {
                continue;
            }
            if (Colors == null || i >= Colors.Count || Colors[i] == null)
            {
                this.drawColors.Add(drawColors.Last());
            }
            else
            {
                this.drawColors.Add(Colors[i]);
            }
            if (Thickness == null || i >= Thickness.Count || Thickness[i] == null)
            {
                this.drawThickness.Add(drawThickness.Last());
            }
            else
            {
                this.drawThickness.Add(Thickness[i]);
            }
        }
    }

    override public void DrawViewportWires(IGH_PreviewArgs args)
    {
        if (this.drawCurves != null)
        {
            try
            {
                for (int i = 0; i < this.drawCurves.Count; i++)
                {
                    args.Display.DrawCurve(
                        this.drawCurves[i],
                        this.drawColors[i],
                        this.drawThickness[i]
                    );
                }
                
            }
            catch (Exception e)
            {
                this.AddRuntimeMessage(GH_RuntimeMessageLevel.Warning, "Error while drawing Preview!");
                this.Print(e.ToString());
            }
        }
        else
        {
            return;
        }
    }
}
# ---------- end curvepreviewlw ----------
designshapes = Data(rint)

# Step 1
# comments & notes: Create new User Session and sign in
# 
# (Add your credentials!)
disablecache_12 = BooleanToggle(False)
clearcache_12 = Button()
# Example 06:
# - Fetch all corian sheet components
# - Get radial signature descriptors
# - Create voronoi cells as an example "demand" of design shapes
# - Compute radial signature descriptors for design shapes
# - Match catalog to design shapes either with greedy or optimal assignment
signin_12 = Button()
signout_12 = Button()
csc_session_12 = Session(SignIn=signin_12, SignOut=signout_12, DisableCache=disablecache_12, ClearCache=clearcache_12)  # -> Status; inputs Username: String, Password: String, SignIn: Boolean, SignOut: Boolean, DisableCache: Boolean, ClearCache: Boolean; same code as csc_session
status_messages_12 = Panel(csc_session_12)

# ---- group: __DDU_CSC_EXAMPLE_07__
actorkind = ValueList({"CSC user account (user)": "user", "Person (person)": "person", "Organization (organization)": "organization"}, selected="Person (person)")
actorrole = ValueList({"Operator (operator)": "operator", "Supervisor (supervisor)": "supervisor", "Laboratory (laboratory)": "laboratory", "Client (client)": "client", "Witness (witness)": "witness"}, selected="Operator (operator)")
actor = Actor(Kind=actorkind, Name="Franklin Re-Usevelt", Role=actorrole, Me=Toggle(False))  # -> Actor; inputs Kind: String, UserID: String, Name: String, Organization: String, OrganizationROR: String, ORCID: String, Email: String, Role: String, Me: Boolean
# ---------- actor: Python ----------
#! python3
# -*- coding: utf-8 -*-
# venv: DDU_CSC
# r: charset_normalizer
# r: numpy==2.0.2
print('ENV OK!')

# PYTHON STANDARD LIBRARY IMPORTS ---------------------------------------------
import json  # NOQA
import time  # NOQA

# RHINO AND GH RELATED IMPORTS ------------------------------------------------
import System  # NOQA
import Rhino  # NOQA
import Grasshopper  # NOQA
import scriptcontext as sc  # NOQA

# GHENV COMPONENT SETTINGS ----------------------------------------------------
ghenv.Component.Name = 'Actor'  # NOQA
ghenv.Component.NickName = 'Actor'  # NOQA
ghenv.Component.Category = 'DDU_CSC'  # NOQA
ghenv.Component.SubCategory = '3 Component Operations'  # NOQA
ghenv.Component.Description = (  # NOQA
    'Builds one actor (a person or an organization, optionally a '
    'catalog account) as JSON for Origin or an evidence record. Kind is '
    'guessed when empty: a user id makes a user, only an organization '
    'an organization, else a person. With Me set to true the actor is the '
    'signed-in account (sign in with the Session component first): its '
    'id, name, organization, ROR and ORCID come from the profile in the '
    'web settings, the role from Role or else the profile\'s default role; '
    'any input you fill in overrides the profile value.'
)

# CSC LIBRARY (decision 8.111) ----------------------------------------------
CSC_GH_MINIMUM = '261102'
LIBRARY_PROBLEM = None
try:
    import csc_gh
    csc_gh.require(CSC_GH_MINIMUM)
    from csc_gh.build import (BuildError, MissingInput, actor, actor_from_profile, cached_profile)  # NOQA
    from csc_gh.upload import (http_error_text)  # NOQA
    from csc_gh.messages import (waits_for_data)  # NOQA
except ImportError:
    LIBRARY_PROBLEM = (
        'CSC library 261102 too old or missing: run CSC_Update, '
        'then restart Rhino')

NOT_SIGNED_IN = ('Me needs a signed-in session: sign in with the Session '
                 'component first')

# OPTIONAL HELPERS: they never block the component (decisions 8.112, 8.113) ---
try:
    from csc_gh.ports import ensure_outputs
    from csc_gh.messages import set_state
except ImportError:
    ensure_outputs = set_state = None

OUTPUTS = [
    ('Actor', 'Actor',
     'Actor JSON (a fragment of the API payload)'),
]


def empty_outputs():
    """What RunScript returns when it stops early or has no result: an empty
    Grasshopper tree per output (never '' or None)."""
    if not OUTPUTS:
        return None
    trees = tuple(Grasshopper.DataTree[System.Object]() for _ in OUTPUTS)
    return trees[0] if len(trees) == 1 else trees


def null_outputs():
    """One null per output: an item of an item-access component that has no
    result keeps its slot (decision 8.186)."""
    if len(OUTPUTS) <= 1:
        return None
    return tuple(None for _ in OUTPUTS)


class CSC_Actor(Grasshopper.Kernel.GH_ScriptInstance):
    """
    Author: Max Benjamin Eschenbach
    License: MIT License
    Version: 261102
    """

    _outputs_ready = True       # set by BeforeRunScript (8.112)
    _outputs_note = None

    def __init__(self):
        """Initialize this component and set component parameters."""
        super().__init__()
        self.Component = ghenv.Component  # NOQA
        self.InputParams = self.Component.Params.Input
        self.OutputParams = self.Component.Params.Output

    def _addRemark(self, msg: str = ''):
        rml = self.Component.RuntimeMessageLevel.Remark
        self.AddRuntimeMessage(rml, msg)

    def _addWarning(self, msg: str = ''):
        rml = self.Component.RuntimeMessageLevel.Warning
        self.AddRuntimeMessage(rml, msg)

    def _addError(self, msg: str = ''):
        rml = self.Component.RuntimeMessageLevel.Error
        self.AddRuntimeMessage(rml, msg)

    def _state(self, text=''):
        """The one short state under the component (decision 8.113)."""
        if set_state is not None:
            set_state(self.Component, text)

    def _no_result(self, *ports):
        """The result of an iteration without one (decision 8.186): empty
        outputs when the inputs in ``ports`` carry no data at all (the
        component waits for data; no ports: a list or tree input is empty),
        else a null in the slot of this item, so the outputs stay one to one
        with the input list."""
        if not ports or (waits_for_data is not None
                         and waits_for_data(self, ports)):
            return empty_outputs()
        return null_outputs()

    def _stop(self):
        """True when RunScript has to return early: the library is missing or
        too old, or the outputs were just updated (says why)."""
        if LIBRARY_PROBLEM:
            self._addError(LIBRARY_PROBLEM)
            return True
        if self._outputs_note:
            self._addRemark(self._outputs_note)
        return not self._outputs_ready

    def _check_outputs(self):
        """Make the outputs match OUTPUTS before the script runs (8.112)."""
        self._outputs_ready, self._outputs_note = True, None
        if ensure_outputs is None:
            self._outputs_note = (
                'output check skipped: CSC library not installed')
            return
        status = ensure_outputs(self.Component, OUTPUTS)
        self._outputs_ready, self._outputs_note = status.ready, status.remark

    def BeforeRunScript(self):
        """Perform some setup actions."""
        self.InputParams[0].Description = (
            'user, person or organization (empty: guessed)'
        )
        self.InputParams[1].Description = (
            'Id of a catalog account (kind user)'
        )
        self.InputParams[2].Description = (
            'Name of a person (shown to signed-in users only)'
        )
        self.InputParams[3].Description = (
            'Organization, e.g. a laboratory or contractor'
        )
        self.InputParams[4].Description = (
            'ROR identifier of the organization'
        )
        self.InputParams[5].Description = (
            'ORCID of a person'
        )
        self.InputParams[6].Description = (
            'E-mail address (shown to moderators only)'
        )
        self.InputParams[7].Description = (
            'operator, supervisor, laboratory, client or witness (with Me: '
            'empty takes the default role of your profile)'
        )
        self.InputParams[8].Description = (
            'True: the actor is the signed-in account, filled from its '
            'profile (name, organization, ROR, ORCID); what you fill in '
            'overrides it. Needs the Session component signed in'
        )
        # Initialize output param descriptions
        self._check_outputs()
        if LIBRARY_PROBLEM is None:
            csc_gh.dev_reload(globals())

    def read_profile(self):
        """The profile of the signed-in account (``GET /users/me``), read at
        most once a minute per server and user."""
        auth_core = sc.sticky.get('CSC_AuthCore')
        if auth_core is None or not auth_core.is_valid():
            raise BuildError(NOT_SIGNED_IN)

        def fetch():
            response = auth_core.authorized_get('/users/me')
            if response.status_code == 401:
                raise BuildError(NOT_SIGNED_IN)
            if response.status_code != 200:
                raise BuildError(http_error_text(
                    response, 'Reading the profile'))
            return response.json()

        key = (auth_core.base_url, auth_core.get_username())
        return cached_profile(sc.sticky, key, fetch, time.time())

    def RunScript(self,
            Kind: str,
            UserID: str,
            Name: str,
            Organization: str,
            OrganizationROR: str,
            ORCID: str,
            Email: str,
            Role: str,
            Me: bool):
        if self._stop():
            return empty_outputs()
        Actor = empty_outputs()
        try:
            if Me:
                profile = self.read_profile()
                fragment = actor_from_profile(
                    profile, Kind, UserID, Name, Organization,
                    OrganizationROR, ORCID, Email, Role)
                own_id = str(profile.get('_id') or profile.get('id') or '')
                if fragment.get('user_id') != own_id:
                    self._addWarning(
                        'UserID differs from the signed-in account: the '
                        'actor names another account, with your profile '
                        'values for everything you did not fill in')
            else:
                fragment = actor(Kind, UserID, Name, Organization,
                                 OrganizationROR, ORCID, Email, Role)
            Actor = json.dumps(fragment)
            return Actor
        except MissingInput as error:
            self._addWarning(str(error))
            return self._no_result(*error.ports)
        except BuildError as error:
            self._addError(str(error))
            return null_outputs()
        except Exception as error:
            msg = f'Unexpected error: {error}'
            self._addError(msg)
            return null_outputs()
        return Actor
# ---------- end actor ----------
actor_2 = Data(actor)

# ---- group: __DDU_CSC_EXAMPLE_08__
component_name = Panel("Schoenes Neues Feld 03")
fragment_5 = BooleanToggle(True)
color = ColourSwatch(SwatchColor=RGB(189, 189, 189))
location_3 = Data(location)
snapshotmetadata = SnapshotMetadata(Name=component_name, Fragment=fragment_5, Color=color, Location=location_3)  # -> SnapshotMetadata; inputs Name: String, Fragment: Boolean, Quantity: Int32, Color: Color, Location: Vector3d, Notes: String, EffectiveFrom: String, ShapeClass: String, Complexity: Int32, EffectiveFromPrecision: String
# ---------- snapshotmetadata: Python ----------
#! python3
# -*- coding: utf-8 -*-
# venv: DDU_CSC
# r: charset_normalizer
# r: numpy==2.0.2
print('ENV OK!')

# PYTHON STANDARD LIBRARY IMPORTS ---------------------------------------------
import json  # NOQA

# RHINO AND GH RELATED IMPORTS ------------------------------------------------
import System  # NOQA
import Rhino  # NOQA
import Grasshopper  # NOQA

# GHENV COMPONENT SETTINGS ----------------------------------------------------
ghenv.Component.Name = 'SnapshotMetadata'  # NOQA
ghenv.Component.NickName = 'SnapshotMetadata'  # NOQA
ghenv.Component.Category = 'DDU_CSC'  # NOQA
ghenv.Component.SubCategory = '3 Component Operations'  # NOQA
ghenv.Component.Description = (  # NOQA
    'Builds the fields of one recorded state (name, fragment, quantity, '
    'colour, location, notes, start date) as JSON for '
    'CreateComponentSnapshot / CreateComponentIdentity. Shape class and '
    'complexity are derived by the server; set them only to override.'
)

# CSC LIBRARY (decision 8.111) ----------------------------------------------
CSC_GH_MINIMUM = '261102'
LIBRARY_PROBLEM = None
try:
    import csc_gh
    csc_gh.require(CSC_GH_MINIMUM)
    from csc_gh.build import (BuildError, snapshot_metadata)  # NOQA
    from csc_gh.messages import (waits_for_data)  # NOQA
except ImportError:
    LIBRARY_PROBLEM = (
        'CSC library 261102 too old or missing: run CSC_Update, '
        'then restart Rhino')

# OPTIONAL HELPERS: they never block the component (decisions 8.112, 8.113) ---
try:
    from csc_gh.ports import ensure_outputs
    from csc_gh.messages import set_state
except ImportError:
    ensure_outputs = set_state = None

OUTPUTS = [
    ('SnapshotMetadata', 'SnapshotMetadata',
     'SnapshotMetadata JSON (a fragment of the API payload)'),
]


def empty_outputs():
    """What RunScript returns when it stops early or has no result: an empty
    Grasshopper tree per output (never '' or None)."""
    if not OUTPUTS:
        return None
    trees = tuple(Grasshopper.DataTree[System.Object]() for _ in OUTPUTS)
    return trees[0] if len(trees) == 1 else trees


def null_outputs():
    """One null per output: an item of an item-access component that has no
    result keeps its slot (decision 8.186)."""
    if len(OUTPUTS) <= 1:
        return None
    return tuple(None for _ in OUTPUTS)


class CSC_SnapshotMetadata(Grasshopper.Kernel.GH_ScriptInstance):
    """
    Author: Max Benjamin Eschenbach
    License: MIT License
    Version: 261102
    """

    _outputs_ready = True       # set by BeforeRunScript (8.112)
    _outputs_note = None

    def __init__(self):
        """Initialize this component and set component parameters."""
        super().__init__()
        self.Component = ghenv.Component  # NOQA
        self.InputParams = self.Component.Params.Input
        self.OutputParams = self.Component.Params.Output

    def _addRemark(self, msg: str = ''):
        rml = self.Component.RuntimeMessageLevel.Remark
        self.AddRuntimeMessage(rml, msg)

    def _addWarning(self, msg: str = ''):
        rml = self.Component.RuntimeMessageLevel.Warning
        self.AddRuntimeMessage(rml, msg)

    def _addError(self, msg: str = ''):
        rml = self.Component.RuntimeMessageLevel.Error
        self.AddRuntimeMessage(rml, msg)

    def _state(self, text=''):
        """The one short state under the component (decision 8.113)."""
        if set_state is not None:
            set_state(self.Component, text)

    def _no_result(self, *ports):
        """The result of an iteration without one (decision 8.186): empty
        outputs when the inputs in ``ports`` carry no data at all (the
        component waits for data; no ports: a list or tree input is empty),
        else a null in the slot of this item, so the outputs stay one to one
        with the input list."""
        if not ports or (waits_for_data is not None
                         and waits_for_data(self, ports)):
            return empty_outputs()
        return null_outputs()

    def _stop(self):
        """True when RunScript has to return early: the library is missing or
        too old, or the outputs were just updated (says why)."""
        if LIBRARY_PROBLEM:
            self._addError(LIBRARY_PROBLEM)
            return True
        if self._outputs_note:
            self._addRemark(self._outputs_note)
        return not self._outputs_ready

    def _check_outputs(self):
        """Make the outputs match OUTPUTS before the script runs (8.112)."""
        self._outputs_ready, self._outputs_note = True, None
        if ensure_outputs is None:
            self._outputs_note = (
                'output check skipped: CSC library not installed')
            return
        status = ensure_outputs(self.Component, OUTPUTS)
        self._outputs_ready, self._outputs_note = status.ready, status.remark

    def BeforeRunScript(self):
        """Perform some setup actions."""
        self.InputParams[0].Description = (
            'Name of the component (empty: its catalog number)'
        )
        self.InputParams[1].Description = (
            'The element is a fragment of a bigger one'
        )
        self.InputParams[2].Description = (
            'Number of identical elements (default 1)'
        )
        self.InputParams[3].Description = (
            'Colour of the element'
        )
        self.InputParams[4].Description = (
            'Latitude (X) and longitude (Y)'
        )
        self.InputParams[5].Description = (
            'Free text (up to 5000 characters)'
        )
        self.InputParams[6].Description = (
            'When this state started (empty: now; 2024-05-03, ...)'
        )
        self.InputParams[7].Description = (
            'Override: linear, planar, block, irregular or composite'
        )
        self.InputParams[8].Description = (
            'Override: 0 to 3'
        )
        self.InputParams[9].Description = (
            'exact, day, month, year or unknown (empty: from '
            'EffectiveFrom)'
        )
        # Initialize output param descriptions
        self._check_outputs()
        if LIBRARY_PROBLEM is None:
            csc_gh.dev_reload(globals())

    def RunScript(self,
            Name: str,
            Fragment: bool,
            Quantity: int,
            Color: System.Drawing.Color,
            Location: Rhino.Geometry.Vector3d,
            Notes: str,
            EffectiveFrom: str,
            ShapeClass: str,
            Complexity: int,
            EffectiveFromPrecision: str):
        if self._stop():
            return empty_outputs()
        SnapshotMetadata = empty_outputs()
        if not EffectiveFromPrecision or EffectiveFromPrecision == '':
            EffectiveFromPrecision = None
        try:
            rgb_value = None
            if Color is not None:
                rgb_value = [Color.R, Color.G, Color.B]
            lat = lon = None
            if Location is not None:
                lat, lon = Location.X, Location.Y
            fragment = snapshot_metadata(
                Name, Fragment, Quantity, rgb_value, lat, lon, Notes, EffectiveFrom,
                EffectiveFromPrecision, ShapeClass, Complexity)
            SnapshotMetadata = json.dumps(fragment)
            return SnapshotMetadata
        except BuildError as error:
            self._addError(str(error))
            return null_outputs()
        except Exception as error:
            msg = f'Unexpected error: {error}'
            self._addError(msg)
            return null_outputs()
        return SnapshotMetadata
# ---------- end snapshotmetadata ----------
snapshotmetadata_2 = Data(snapshotmetadata)

# ----
source_folder = Panel("..\grasshopper_userobjects_xml")

# ----
# comments & notes: Arrange Components in a Grid
spacing = Slider(150, range=0..1000)
componentpassport_10 = Data(componentpassport_8)
insertionpoint = Point(Point(2500, 0, 0))
createarrangement = CreateArrangement(ComponentPassport=componentpassport_10, Spacing=spacing, InsertionPoint=insertionpoint)  # -> GridCells, GridPlanes, XForms; inputs ComponentPassport: tree, Spacing: Double, InsertionPoint: Point3d
# ---------- createarrangement: Python ----------
#! python3
# -*- coding: utf-8 -*-
# venv: DDU_CSC
print('ENV OK!')
# r: charset_normalizer
# r: requests

# PYTHON STANDARD LIBRARY IMPORTS ---------------------------------------------
import json  # NOQA
import math  # NOQA

# RHINO AND GH RELATED IMPORTS ------------------------------------------------
import System  # NOQA
import Rhino  # NOQA
import Grasshopper  # NOQA

# GHENV COMPONENT SETTINGS ----------------------------------------------------
ghenv.Component.Name = 'CreateArrangement'  # NOQA
ghenv.Component.NickName = 'CreateArrangement'  # NOQA
ghenv.Component.Category = 'DDU_CSC'  # NOQA
ghenv.Component.SubCategory = '8 Visualization'  # NOQA
ghenv.Component.Description = (  # NOQA
    'Arranges components in an even square grid based on their snapshot '
    'bounding boxes. Calculates grid cell size from the largest component '
    'dimension.'
)

# OPTIONAL HELPERS: they never block the component (decisions 8.112, 8.113) ---
try:
    from csc_gh.ports import ensure_outputs
    from csc_gh.messages import set_state
except ImportError:
    ensure_outputs = set_state = None

OUTPUTS = [
    ('GridCells', 'GridCells',
     'Grid cell outlines as polylines'),
    ('GridPlanes', 'GridPlanes',
     'XY planes at center of each grid cell'),
    ('XForms', 'XForms',
     'Transformations from world origin to grid cell planes'),
]


def empty_outputs():
    """What RunScript returns when it stops early or has no result: an empty
    Grasshopper tree per output (never '' or None)."""
    if not OUTPUTS:
        return None
    trees = tuple(Grasshopper.DataTree[System.Object]() for _ in OUTPUTS)
    return trees[0] if len(trees) == 1 else trees


class CSC_CreateArrangement(Grasshopper.Kernel.GH_ScriptInstance):
    """
    Author: Max Benjamin Eschenbach
    License: MIT License
    Version: 261102
    """

    _outputs_ready = True       # set by BeforeRunScript (8.112)
    _outputs_note = None

    def __init__(self):
        """Initialize this component and set component parameters."""
        super().__init__()
        # initialize props
        self.Component = ghenv.Component  # NOQA
        self.InputParams = self.Component.Params.Input
        self.OutputParams = self.Component.Params.Output

    def _addRemark(self, msg: str = ''):
        """Add a remark message to the component."""
        rml = self.Component.RuntimeMessageLevel.Remark
        self.AddRuntimeMessage(rml, msg)

    def _addWarning(self, msg: str = ''):
        """Add a warning message to the component."""
        rml = self.Component.RuntimeMessageLevel.Warning
        self.AddRuntimeMessage(rml, msg)

    def _addError(self, msg: str = ''):
        """Add an error message to the component."""
        rml = self.Component.RuntimeMessageLevel.Error
        self.AddRuntimeMessage(rml, msg)

    def _state(self, text=''):
        """The one short state under the component (decision 8.113)."""
        if set_state is not None:
            set_state(self.Component, text)

    def _stop(self):
        """True when RunScript has to return early: the outputs were just
        updated (says why)."""
        if self._outputs_note:
            self._addRemark(self._outputs_note)
        return not self._outputs_ready

    def _check_outputs(self):
        """Make the outputs match OUTPUTS before the script runs (8.112)."""
        self._outputs_ready, self._outputs_note = True, None
        if ensure_outputs is None:
            self._outputs_note = (
                'output check skipped: CSC library not installed')
            return
        status = ensure_outputs(self.Component, OUTPUTS)
        self._outputs_ready, self._outputs_note = status.ready, status.remark

    def BeforeRunScript(self):
        """Perform some setup actions."""
        # Initialize input param descriptions
        self.InputParams[0].Description = (
            'Component passport JSON strings ({identity, snapshots[]})'
        )
        self.InputParams[1].Description = (
            'Additional spacing between grid cells'
        )
        self.InputParams[2].Description = (
            'Insertion point (starting corner of grid)'
        )
        # Initialize output param descriptions
        self._check_outputs()

    def _primary_snapshot(self, passport):
        """Return the first snapshot from a passport payload."""
        if not isinstance(passport, dict):
            return {}
        snapshots = passport.get('snapshots') or []
        if snapshots and isinstance(snapshots[0], dict):
            return snapshots[0]
        legacy = passport.get('snapshot')
        if isinstance(legacy, dict):
            return legacy
        return {}

    def extract_bounding_box_dimensions(self, component_data):
        """
        Extract bounding box dimensions from passport JSON.

        Args:
            component_data: Passport JSON string or dict
                ({identity, snapshots[]})

        Returns:
            Tuple of (xtx, xty, xtz) dimensions or None
        """
        try:
            if isinstance(component_data, dict):
                passport = component_data
            elif isinstance(component_data, str):
                passport = json.loads(component_data.strip())
            else:
                passport = json.loads(str(component_data))
            snapshot = self._primary_snapshot(passport)
            bbx = snapshot.get('bbx')
            if isinstance(bbx, (list, tuple)) and len(bbx) >= 3:
                return float(bbx[0]), float(bbx[1]), float(bbx[2])
            return None
        except (json.JSONDecodeError, KeyError, TypeError, ValueError):
            return None

    def calculate_grid_size(self, count: int):
        """
        Calculate grid dimensions for a square grid.

        Returns:
            Tuple of (grid_size_x, grid_size_y, cells_needed)
        """
        grid_size = int(math.ceil(math.sqrt(count)))
        cells_needed = grid_size * grid_size
        return grid_size, grid_size, cells_needed

    def create_grid_cell_polyline(
            self, cell_size: float,
            center_point: Rhino.Geometry.Point3d):
        """
        Create a square cell polyline centered at given point.

        Args:
            cell_size: Size of the grid cell
            center_point: Center point of the cell

        Returns:
            Polyline outlining the cell
        """
        half_size = cell_size * 0.5

        # Create corners relative to center
        x_min = center_point.X - half_size
        x_max = center_point.X + half_size
        y_min = center_point.Y - half_size
        y_max = center_point.Y + half_size
        z = center_point.Z

        corners = [
            Rhino.Geometry.Point3d(x_min, y_min, z),
            Rhino.Geometry.Point3d(x_max, y_min, z),
            Rhino.Geometry.Point3d(x_max, y_max, z),
            Rhino.Geometry.Point3d(x_min, y_max, z),
            Rhino.Geometry.Point3d(x_min, y_min, z)
        ]

        return Rhino.Geometry.Polyline(corners)

    def RunScript(self,
            ComponentPassport: Grasshopper.DataTree[object],
            Spacing: float,
            InsertionPoint: Rhino.Geometry.Point3d):

        # Default values for optional parameters
        if self._stop():
            return empty_outputs()
        if Spacing is None:
            Spacing = 100.0
        if InsertionPoint is None:
            InsertionPoint = Rhino.Geometry.Point3d(0.0, 0.0, 0.0)

        # Set up output trees
        GridCells = Grasshopper.DataTree[Rhino.Geometry.Polyline]()
        GridPlanes = Grasshopper.DataTree[Rhino.Geometry.Plane]()
        XForm = Grasshopper.DataTree[Rhino.Geometry.Transform]()

        # Validate input
        if not ComponentPassport or ComponentPassport.DataCount == 0:
            msg = 'No component data provided'
            self._addWarning(msg)
            return GridCells, GridPlanes, XForm

        try:
            # Extract bounding box dimensions for all components
            all_dimensions = []
            paths = []
            for i, branch in enumerate(ComponentPassport.Branches):
                branch_path = ComponentPassport.Paths[i]
                for comp_data in branch:
                    if comp_data is None:
                        continue
                    dims = self.extract_bounding_box_dimensions(comp_data)
                    if dims:
                        all_dimensions.append(dims)
                        paths.append(branch_path)
            if not all_dimensions:
                msg = 'No valid bounding boxes in component data'
                self._addWarning(msg)
                return GridCells, GridPlanes, XForm
            # Find the largest x and y dimensions to determine grid cell size
            max_x_dim = max(dims[0] for dims in all_dimensions)
            max_y_dim = max(dims[1] for dims in all_dimensions)
            cell_size = max(max_x_dim, max_y_dim) + Spacing
            # Calculate grid layout
            comp_count = len(all_dimensions)
            grid_x, grid_y, cells_needed = self.calculate_grid_size(comp_count)
            # Adjust to fit exact number of components
            arranged_count = min(comp_count, cells_needed)
            # Create grid cells
            for i in range(arranged_count):
                # Calculate grid position (row, col)
                row = i // grid_x
                col = i % grid_x
                # Calculate center point for this cell
                center_x = InsertionPoint.X + col * cell_size + cell_size * 0.5
                center_y = InsertionPoint.Y + row * cell_size + cell_size * 0.5
                cell_center = Rhino.Geometry.Point3d(
                    center_x,
                    center_y,
                    InsertionPoint.Z
                )
                # Create grid cell outline
                grid_cell = self.create_grid_cell_polyline(
                    cell_size, cell_center)
                GridCells.Add(grid_cell, paths[i])
                # Create plane at center of grid cell
                grid_plane = Rhino.Geometry.Plane(
                    cell_center,
                    Rhino.Geometry.Vector3d.XAxis,
                    Rhino.Geometry.Vector3d.YAxis
                )
                GridPlanes.Add(grid_plane, paths[i])

                # Create transform from world origin to grid cell plane
                world_plane = Rhino.Geometry.Plane.WorldXY
                xform = Rhino.Geometry.Transform.PlaneToPlane(
                    world_plane, grid_plane)
                XForm.Add(xform, paths[i])

            # Update component message
            if arranged_count < comp_count:
                self._addWarning(
                    f'Arranged {arranged_count} of {comp_count} components')
            else:
                self._addRemark(
                    f'Arranged {arranged_count} components in '
                    f'{grid_x}x{grid_y} grid')

            return GridCells, GridPlanes, XForm

        except Exception as e:
            msg = f'Error arranging components: {str(e)}'
            self._addError(msg)
            return GridCells, GridPlanes, XForm
# ---------- end createarrangement ----------
xform = Data(createarrangement.XForms)

# ---- group: __DDU_CSC_EXAMPLE_03__
# Step 3
# comments & notes: Bake Components to the Rhino Document.
# 
# NOTE: If you bake using the component, the geometry will be grouped with a text tag that is used to infer the transformations happening in the Rhino document. Without text tag, this will be lost!
detaillevel = ValueList({"Original (default)": original, "Reduced": recuced, "Preview": preview}, selected="Preview")
componentpassport_11 = Data(componentpassport_5)
# comments & notes: Transform (move, rotate) the baked component(s) in the Rhino doc!
# 
# Make sure to also transform the text tag!
bakecomponents = BakeComponents(Bake=Button(), ComponentPassport=componentpassport_11, DetailLevel=detaillevel, WithComponentPassport=Toggle(True))  # inputs Bake: Boolean, ComponentPassport: list, DetailLevel: String, WithComponentPassport: Boolean
# ---------- bakecomponents: Python ----------
#! python3
# -*- coding: utf-8 -*-
# venv: DDU_CSC
# r: charset_normalizer
# r: numpy==2.0.2
print('ENV OK!')

# PYTHON STANDARD LIBRARY IMPORTS ---------------------------------------------
import json  # NOQA

# RHINO AND GH RELATED IMPORTS ------------------------------------------------
import System  # NOQA
import Rhino  # NOQA
import Grasshopper  # NOQA
import scriptcontext as sc  # NOQA

# GHENV COMPONENT SETTINGS ----------------------------------------------------
ghenv.Component.Name = 'BakeComponents'  # NOQA
ghenv.Component.NickName = 'BakeComponents'  # NOQA
ghenv.Component.Category = 'DDU_CSC'  # NOQA
ghenv.Component.SubCategory = '4 RhinoDoc Interaction'  # NOQA
ghenv.Component.Description = (  # NOQA
    'Bakes component passports ({identity, snapshots[]}) into the Rhino document: the '
    'meshes, point clouds and authored shapes of an element in its canonical '
    'orientation (frame applied, centred at the origin) or where its '
    'csc_placement puts it, plus one text tag per element at the plane of the '
    'canonical element. The tag carries the user text csc_identity_id, '
    'csc_snapshot_id, csc_placement (and csc_component, the component passport). Move '
    'the group in Rhino, then read it back with SyncWithRhinoDoc. Nothing '
    'is written to the server.'
)

# CSC LIBRARY (decision 8.111) ----------------------------------------------
CSC_GH_MINIMUM = '261005'
LIBRARY_PROBLEM = None
try:
    import csc_gh
    csc_gh.require(CSC_GH_MINIMUM)
    from csc_gh.read import (load_passport, parts)  # NOQA
    from csc_gh.convention import (ConventionError)  # NOQA
    from csc_gh.doc import (bake_level, bake_piece, piece_items)  # NOQA
except ImportError:
    LIBRARY_PROBLEM = (
        'CSC library 261005 too old or missing: run CSC_Update, '
        'then restart Rhino')

# OPTIONAL HELPERS: they never block the component (decisions 8.112, 8.113) ---
try:
    from csc_gh.ports import ensure_outputs
    from csc_gh.messages import set_state
except ImportError:
    ensure_outputs = set_state = None

OUTPUTS = [
    # (no outputs)
]


def empty_outputs():
    """What RunScript returns when it stops early or has no result: an empty
    Grasshopper tree per output (never '' or None)."""
    if not OUTPUTS:
        return None
    trees = tuple(Grasshopper.DataTree[System.Object]() for _ in OUTPUTS)
    return trees[0] if len(trees) == 1 else trees


class CSC_BakeComponents(Grasshopper.Kernel.GH_ScriptInstance):
    """
    Author: Max Benjamin Eschenbach
    License: MIT License
    Version: 261102
    """

    _outputs_ready = True       # set by BeforeRunScript (8.112)
    _outputs_note = None

    def __init__(self):
        """Initialize this component and set component parameters."""
        super().__init__()
        # initialize props
        self.Component = ghenv.Component  # NOQA
        self.InputParams = self.Component.Params.Input
        self.OutputParams = self.Component.Params.Output

    def _addRemark(self, msg: str = ''):
        """Add a remark message to the component."""
        rml = self.Component.RuntimeMessageLevel.Remark
        self.AddRuntimeMessage(rml, msg)

    def _addWarning(self, msg: str = ''):
        """Add a warning message to the component."""
        rml = self.Component.RuntimeMessageLevel.Warning
        self.AddRuntimeMessage(rml, msg)

    def _addError(self, msg: str = ''):
        """Add an error message to the component."""
        rml = self.Component.RuntimeMessageLevel.Error
        self.AddRuntimeMessage(rml, msg)

    def _state(self, text=''):
        """The one short state under the component (decision 8.113)."""
        if set_state is not None:
            set_state(self.Component, text)

    def _stop(self):
        """True when RunScript has to return early: the library is missing or
        too old, or the outputs were just updated (says why)."""
        if LIBRARY_PROBLEM:
            self._addError(LIBRARY_PROBLEM)
            return True
        if self._outputs_note:
            self._addRemark(self._outputs_note)
        return not self._outputs_ready

    def _check_outputs(self):
        """Make the outputs match OUTPUTS before the script runs (8.112)."""
        self._outputs_ready, self._outputs_note = True, None
        if ensure_outputs is None:
            self._outputs_note = (
                'output check skipped: CSC library not installed')
            return
        status = ensure_outputs(self.Component, OUTPUTS)
        self._outputs_ready, self._outputs_note = status.ready, status.remark

    def BeforeRunScript(self):
        """Perform some setup actions."""
        self.InputParams[0].Description = (
            'Toggle to bake components to Rhino'
        )
        self.InputParams[1].Description = (
            'Component passport JSON strings ({identity, snapshots[]}) from the fetch '
            'components. An element with a csc_placement (TransformComponent, '
            'ApplyFrame) is baked there, any other in its canonical '
            'orientation at the origin. Its snapshot needs a frame.'
        )
        self.InputParams[2].Description = (
            "Mesh level: 'original' (default, the full mesh, else reduced), "
            "'reduced' or 'preview' (the inline preview). Point clouds: the "
            'full cloud unless preview.'
        )
        self.InputParams[3].Description = (
            'Write the component passport JSON on the tag as csc_component '
            '(default true): SyncWithRhinoDoc then needs no sign-in. False '
            'keeps the document small; the component passport is fetched by id.'
        )
        self._check_outputs()
        if LIBRARY_PROBLEM is None:
            csc_gh.dev_reload(globals())

    def RunScript(self,
            Bake: bool,
            ComponentPassport: list[object],
            DetailLevel: str,
            WithComponentPassport: bool):
        if self._stop():
            return empty_outputs()
        if not Bake:
            self._state('Bake is off')
            self._addRemark('Bake toggle is off - no components baked')
            return empty_outputs()
        if not ComponentPassport or len(ComponentPassport) == 0:
            msg = ('No component data provided. Please connect '
                   'FetchComponent output.')
            self._addWarning(msg)
            return empty_outputs()
        try:
            level = bake_level(DetailLevel)
        except ValueError as error:
            self._addError(str(error))
            return empty_outputs()
        with_passport = True if WithComponentPassport is None else bool(WithComponentPassport)

        auth_core = sc.sticky.get('CSC_AuthCore')
        if auth_core is None and level != 'preview':
            self._addWarning('No signed-in Session: the preview geometry is '
                             'baked instead of the PLY levels.')
            level = 'preview'

        doc = Rhino.RhinoDoc.ActiveDoc
        baked = 0
        record = doc.BeginUndoRecord('Bake CSC components')
        try:
            for index, text in enumerate(ComponentPassport):
                passport = load_passport(text)
                if passport is None:
                    self._addWarning(f'Item {index} is not component passport JSON '
                                     '({identity, snapshots[]})')
                    continue
                identity, snapshot = parts(passport)
                label = (identity or {}).get('_id') or f'item {index}'
                try:
                    items = piece_items(auth_core, snapshot, level,
                                        self._addWarning)
                    result = bake_piece(doc, passport, items, with_passport,
                                        self._addWarning)
                    baked += 1
                    self._addRemark(
                        f'Baked {label} ({len(result["ids"])} objects and '
                        'a tag)')
                except ConventionError as error:
                    self._addWarning(f'{label}: {error}')
                except Exception as error:
                    self._addError(f'Error baking {label}: {error}')
        finally:
            if record:
                doc.EndUndoRecord(record)
        doc.Views.Redraw()

        if baked > 0:
            self._state(f'Baked {baked}')
        else:
            self._addWarning('No components were baked')
# ---------- end bakecomponents ----------

# ---- group: __DDU_CSC_EXAMPLE_07__
# Step 2
originkind = ValueList({"Deinstalled (deinstallation)": "deinstallation", "Recovered from demolition (demolition)": "demolition", "Production offcut (offcut)": "offcut", "Surplus (surplus)": "surplus", "Unknown (unknown)": "unknown"}, selected="Production offcut (offcut)")
location_4 = Data(location_2)
actor_3 = Data(actor_2)
origin = Origin(
    Kind=originkind,
    At="2026",
    PlaceName="Digital Design Unit",
    PlaceAddress="El Lissitzky Str. 1, Darmstadt",
    PlaceLocation=location_4,
    PerformedBy=actor_3)  # -> Origin; inputs Kind: String, At: String, AtPrecision: String, PlaceName: String, PlaceAddress: String, PlaceLocation: Vector3d, WorkName: String, WorkYear: String, WorkUse: String, WorkMethod: String, Method: String, PerformedBy: list, Notes: String, PositionInWork: String, Planned: Boolean
# ---------- origin: Python ----------
#! python3
# -*- coding: utf-8 -*-
# venv: DDU_CSC
# r: charset_normalizer
# r: numpy==2.0.2
print('ENV OK!')

# PYTHON STANDARD LIBRARY IMPORTS ---------------------------------------------
import json  # NOQA

# RHINO AND GH RELATED IMPORTS ------------------------------------------------
import System  # NOQA
import Rhino  # NOQA
import Grasshopper  # NOQA

# GHENV COMPONENT SETTINGS ----------------------------------------------------
ghenv.Component.Name = 'Origin'  # NOQA
ghenv.Component.NickName = 'Origin'  # NOQA
ghenv.Component.Category = 'DDU_CSC'  # NOQA
ghenv.Component.SubCategory = '3 Component Operations'  # NOQA
ghenv.Component.Description = (  # NOQA
    'Builds the origin of a component, how it entered circulation '
    '(deinstallation, demolition, offcut, surplus or unknown), as JSON '
    'for IdentityMetadata. Dates: 2024, 2024-05, 2024-05-03 or '
    '2024-05-03T14:30:00Z; the precision follows the text. Planned marks '
    'an element that is still in place (not yet deinstalled), At is then the '
    'planned date or empty.'
)

# CSC LIBRARY (decision 8.111) ----------------------------------------------
CSC_GH_MINIMUM = '261102'
LIBRARY_PROBLEM = None
try:
    import csc_gh
    csc_gh.require(CSC_GH_MINIMUM)
    from csc_gh.build import (BuildError, MissingInput, origin)  # NOQA
    from csc_gh.messages import (waits_for_data)  # NOQA
except ImportError:
    LIBRARY_PROBLEM = (
        'CSC library 261102 too old or missing: run CSC_Update, '
        'then restart Rhino')

# OPTIONAL HELPERS: they never block the component (decisions 8.112, 8.113) ---
try:
    from csc_gh.ports import ensure_outputs
    from csc_gh.messages import set_state
except ImportError:
    ensure_outputs = set_state = None

OUTPUTS = [
    ('Origin', 'Origin',
     'Origin JSON (a fragment of the API payload)'),
]


def empty_outputs():
    """What RunScript returns when it stops early or has no result: an empty
    Grasshopper tree per output (never '' or None)."""
    if not OUTPUTS:
        return None
    trees = tuple(Grasshopper.DataTree[System.Object]() for _ in OUTPUTS)
    return trees[0] if len(trees) == 1 else trees


def null_outputs():
    """One null per output: an item of an item-access component that has no
    result keeps its slot (decision 8.186)."""
    if len(OUTPUTS) <= 1:
        return None
    return tuple(None for _ in OUTPUTS)


class CSC_Origin(Grasshopper.Kernel.GH_ScriptInstance):
    """
    Author: Max Benjamin Eschenbach
    License: MIT License
    Version: 261102
    """

    _outputs_ready = True       # set by BeforeRunScript (8.112)
    _outputs_note = None

    def __init__(self):
        """Initialize this component and set component parameters."""
        super().__init__()
        self.Component = ghenv.Component  # NOQA
        self.InputParams = self.Component.Params.Input
        self.OutputParams = self.Component.Params.Output

    def _addRemark(self, msg: str = ''):
        rml = self.Component.RuntimeMessageLevel.Remark
        self.AddRuntimeMessage(rml, msg)

    def _addWarning(self, msg: str = ''):
        rml = self.Component.RuntimeMessageLevel.Warning
        self.AddRuntimeMessage(rml, msg)

    def _addError(self, msg: str = ''):
        rml = self.Component.RuntimeMessageLevel.Error
        self.AddRuntimeMessage(rml, msg)

    def _state(self, text=''):
        """The one short state under the component (decision 8.113)."""
        if set_state is not None:
            set_state(self.Component, text)

    def _no_result(self, *ports):
        """The result of an iteration without one (decision 8.186): empty
        outputs when the inputs in ``ports`` carry no data at all (the
        component waits for data; no ports: a list or tree input is empty),
        else a null in the slot of this item, so the outputs stay one to one
        with the input list."""
        if not ports or (waits_for_data is not None
                         and waits_for_data(self, ports)):
            return empty_outputs()
        return null_outputs()

    def _stop(self):
        """True when RunScript has to return early: the library is missing or
        too old, or the outputs were just updated (says why)."""
        if LIBRARY_PROBLEM:
            self._addError(LIBRARY_PROBLEM)
            return True
        if self._outputs_note:
            self._addRemark(self._outputs_note)
        return not self._outputs_ready

    def _check_outputs(self):
        """Make the outputs match OUTPUTS before the script runs (8.112)."""
        self._outputs_ready, self._outputs_note = True, None
        if ensure_outputs is None:
            self._outputs_note = (
                'output check skipped: CSC library not installed')
            return
        status = ensure_outputs(self.Component, OUTPUTS)
        self._outputs_ready, self._outputs_note = status.ready, status.remark

    def BeforeRunScript(self):
        """Perform some setup actions."""
        self.InputParams[0].Description = (
            'deinstallation, demolition, offcut, surplus or unknown'
        )
        self.InputParams[1].Description = (
            'When the element entered circulation (2024, 2024-05, ...)'
        )
        self.InputParams[2].Description = (
            'exact, day, month, year or unknown (empty: from At)'
        )
        self.InputParams[3].Description = (
            'Name of the place, e.g. a building or site'
        )
        self.InputParams[4].Description = (
            'Address of the place'
        )
        self.InputParams[5].Description = (
            'Latitude (X) and longitude (Y) of the place'
        )
        self.InputParams[6].Description = (
            'Name of the construction work the element came from (deinstallation '
            '/ demolition only)'
        )
        self.InputParams[7].Description = (
            'Year the work was built'
        )
        self.InputParams[8].Description = (
            'Use of the work'
        )
        self.InputParams[9].Description = (
            'monolithic, prefabricated, mixed or unknown'
        )
        self.InputParams[10].Description = (
            'How the element was recovered'
        )
        self.InputParams[11].Description = (
            'Actor JSON of who did it (from Actor)'
        )
        self.InputParams[12].Description = (
            'Free text'
        )
        self.InputParams[13].Description = (
            'Where in the construction work the element sat, e.g. a floor '
            'or an axis (deinstallation / demolition only)'
        )
        if len(self.InputParams) > 14:      # an instance from before Planned
            self.InputParams[14].Description = (
                'True while the element is still in place: identified in its '
                'works, not yet deinstalled (deinstallation / demolition '
                'only). At is then the planned date, or empty'
            )
        self._check_outputs()
        if LIBRARY_PROBLEM is None:
            csc_gh.dev_reload(globals())

    def RunScript(self,
            Kind: str,
            At: str,
            AtPrecision: str,
            PlaceName: str,
            PlaceAddress: str,
            PlaceLocation: Rhino.Geometry.Vector3d,
            WorkName: str,
            WorkYear: str,
            WorkUse: str,
            WorkMethod: str,
            Method: str,
            PerformedBy: list[object],
            Notes: str,
            PositionInWork: str,
            Planned: bool):
        if self._stop():
            return empty_outputs()
        Origin = empty_outputs()
        if not PositionInWork or PositionInWork == '':
            PositionInWork = None
        try:
            lat = lon = None
            if PlaceLocation is not None:
                lat, lon = PlaceLocation.X, PlaceLocation.Y
            fragment = origin(Kind, At, AtPrecision, PlaceName, PlaceAddress, lat,
                              lon, WorkName, WorkYear, WorkUse, WorkMethod, Method,
                              list(PerformedBy or []), Notes,
                              PositionInWork, bool(Planned))
            Origin = json.dumps(fragment)
            return Origin
        except MissingInput as error:
            self._addWarning(str(error))
            return self._no_result(*error.ports)
        except BuildError as error:
            self._addError(str(error))
            return null_outputs()
        except Exception as error:
            self._addError(f'Unexpected error: {error}')
            return null_outputs()
        return Origin
# ---------- end origin ----------
origin_2 = Data(origin)

# ---- group: __DDU_CSC_EXAMPLE_09__
# comments & notes: List all snapshot versions for one identity (id and name)
componentpassport_12 = Data(componentpassport_7)
number_slider_3 = Slider(1, range=0..5)
listidentitysnapshots_2 = ListIdentitySnapshots(Input=componentpassport_12)  # -> SnapshotID, SnapshotName; same code as listidentitysnapshots
item_3 = ListItem(List=listidentitysnapshots_2.SnapshotName, Index=number_slider_3, Wrap=False)
item_4 = ListItem(List=listidentitysnapshots_2.SnapshotID, Index=number_slider_3, Wrap=False)
snapshotid_2 = Data(item_4)
panel_8 = Panel(item_3)

# ---- group: __DDU_CSC_EXAMPLE_11__
# comments & notes: List all snapshot versions for one identity (id and name)
componentpassport_13 = Data(componentpassport_6)
fetchallsnapshots = FetchAllSnapshots(Input=componentpassport_13)  # -> ComponentPassport
# ---------- fetchallsnapshots: Python ----------
#! python3
# -*- coding: utf-8 -*-
# venv: DDU_CSC
print('ENV OK!')
# r: charset_normalizer
# r: requests

# PYTHON STANDARD LIBRARY IMPORTS ---------------------------------------------
import json  # NOQA

# THIRD PARTY LIBRARY IMPORTS -------------------------------------------------
import requests  # NOQA

# RHINO AND GH RELATED IMPORTS ------------------------------------------------
import System  # NOQA
import Grasshopper  # NOQA
import Rhino  # NOQA
import scriptcontext as sc  # NOQA

# GHENV COMPONENT SETTINGS ----------------------------------------------------
ghenv.Component.Name = 'FetchAllSnapshots'  # NOQA
ghenv.Component.NickName = 'FetchAllSnapshots'  # NOQA
ghenv.Component.Category = 'DDU_CSC'  # NOQA
ghenv.Component.SubCategory = '2 Catalog Interface'  # NOQA
ghenv.Component.Description = (  # NOQA
    'Fetches component passport JSON with every snapshot for one identity '
    '({identity, snapshots[]}). Input can be an identity UUID or component passport '
    'JSON.'
)

# OPTIONAL HELPERS: they never block the component (decisions 8.112, 8.113) ---
try:
    from csc_gh.ports import ensure_outputs
    from csc_gh.messages import set_state, waits_for_data
except ImportError:
    ensure_outputs = set_state = waits_for_data = None

OUTPUTS = [
    ('ComponentPassport', 'ComponentPassport',
     'Component passport JSON string: {identity, snapshots[]} with every version'),
]


def empty_outputs():
    """What RunScript returns when it stops early or has no result: an empty
    Grasshopper tree per output (never '' or None)."""
    if not OUTPUTS:
        return None
    trees = tuple(Grasshopper.DataTree[System.Object]() for _ in OUTPUTS)
    return trees[0] if len(trees) == 1 else trees


def null_outputs():
    """One null per output: an item of an item-access component that has no
    result keeps its slot (decision 8.186)."""
    if len(OUTPUTS) <= 1:
        return None
    return tuple(None for _ in OUTPUTS)


class CSC_FetchAllSnapshots(Grasshopper.Kernel.GH_ScriptInstance):
    """
    Author: Max Benjamin Eschenbach
    License: MIT License
    Version: 261102
    """

    _outputs_ready = True       # set by BeforeRunScript (8.112)
    _outputs_note = None

    def __init__(self):
        super().__init__()
        self.Component = ghenv.Component  # NOQA
        self.InputParams = self.Component.Params.Input
        self.OutputParams = self.Component.Params.Output

    def _addRemark(self, msg: str = ''):
        rml = self.Component.RuntimeMessageLevel.Remark
        self.AddRuntimeMessage(rml, msg)

    def _addWarning(self, msg: str = ''):
        rml = self.Component.RuntimeMessageLevel.Warning
        self.AddRuntimeMessage(rml, msg)

    def _addError(self, msg: str = ''):
        rml = self.Component.RuntimeMessageLevel.Error
        self.AddRuntimeMessage(rml, msg)

    def _state(self, text=''):
        """The one short state under the component (decision 8.113)."""
        if set_state is not None:
            set_state(self.Component, text)

    def _no_result(self, *ports):
        """The result of an iteration without one (decision 8.186): empty
        outputs when the inputs in ``ports`` carry no data at all (the
        component waits for data; no ports: a list or tree input is empty),
        else a null in the slot of this item, so the outputs stay one to one
        with the input list."""
        if not ports or (waits_for_data is not None
                         and waits_for_data(self, ports)):
            return empty_outputs()
        return null_outputs()

    def _stop(self):
        """True when RunScript has to return early: the outputs were just
        updated (says why)."""
        if self._outputs_note:
            self._addRemark(self._outputs_note)
        return not self._outputs_ready

    def _check_outputs(self):
        """Make the outputs match OUTPUTS before the script runs (8.112)."""
        self._outputs_ready, self._outputs_note = True, None
        if ensure_outputs is None:
            self._outputs_note = (
                'output check skipped: CSC library not installed')
            return
        status = ensure_outputs(self.Component, OUTPUTS)
        self._outputs_ready, self._outputs_note = status.ready, status.remark

    def BeforeRunScript(self):
        self.InputParams[0].Description = (
            'Identity UUID or component passport JSON ({identity, snapshots[]})'
        )
        self._check_outputs()

    def get_auth_core_from_sticky(self):
        auth_core = sc.sticky.get('CSC_AuthCore')
        if auth_core is None:
            msg = ('No authentication found. Please use CSC_Session component '
                   'first.')
            self._addWarning(msg)
            return None
        return auth_core

    def RunScript(self, Input):
        if self._stop():
            return empty_outputs()
        ComponentPassport = empty_outputs()

        auth_core = self.get_auth_core_from_sticky()
        if auth_core is None:
            return ComponentPassport

        if not auth_core.is_valid():
            msg = ('Authentication expired. Please use CSC_Session '
                   'component to refresh.')
            self._addWarning(msg)
            return ComponentPassport

        if Input is None or (isinstance(Input, str) and not str(Input).strip()):
            msg = 'Please provide an identity UUID or component passport JSON.'
            self._addWarning(msg)
            return self._no_result('Input')

        identity_id = auth_core.resolve_identity_id_from_input(Input)
        if not identity_id:
            msg = 'Input is not a valid identity UUID or component passport JSON.'
            self._addError(msg)
            return null_outputs()

        try:
            response = auth_core.cached_get_passport(
                identity_id,
                snapshots='all',
            )

            if response.status_code == 200:
                data = response.json()
                ComponentPassport = auth_core.passport_json_string(data)
                count = len(data.get('snapshots') or [])
                self._state(f'{count} snapshot(s)')
                return ComponentPassport

            if response.status_code == 401:
                msg = 'Authentication failed. Please sign in again.'
            elif response.status_code == 404:
                msg = f'Identity {identity_id} not found.'
            else:
                msg = f'Request failed with status code: {response.status_code}'
            self._addError(msg)

        except requests.exceptions.ConnectionError as e:
            msg = 'Cannot connect to server. Please check your connection.'
            self._addError(msg + f'\nFull Error: {str(e)}')
            return null_outputs()
        except requests.exceptions.Timeout as e:
            msg = 'Request timeout. Server may be slow.'
            self._addError(msg + f'\nFull Error: {str(e)}')
            return null_outputs()
        except Exception as e:
            msg = f'Unexpected error: {str(e)}'
            self._addError(msg)
            return null_outputs()

        return ComponentPassport
# ---------- end fetchallsnapshots ----------
componentpassport_14 = Data(fetchallsnapshots)

# ---- group: __DDU_CSC_EXAMPLE_02__
# Step 3
# comments & notes: Fetch reduced Geometry, either by ID, JSON String or Geometry (with userstring-attached json string)
# 
# NOTE: This may take some time to load, especially for multiple objects and/or high-res (detailed) meshes!
# comments & notes: You can check for reduced (default, already pretty detailed!) or detailed (=original resolution) meshes.
componentpassport_15 = Data(componentpassport_4)
fetchreducedgeometry = FetchReducedGeometry(Input=componentpassport_15)  # -> GeometryData, GeometrySource, SnapshotID
# ---------- fetchreducedgeometry: Python ----------
#! python3
# -*- coding: utf-8 -*-
# venv: DDU_CSC
# r: charset_normalizer
# r: requests==2.32.5
# r: numpy==2.0.2
print('ENV OK!')

# PYTHON STANDARD LIBRARY IMPORTS ---------------------------------------------
import json  # NOQA

# THIRD PARTY LIBRARY IMPORTS -------------------------------------------------
import requests  # NOQA

# RHINO AND GH RELATED IMPORTS ------------------------------------------------
import System  # NOQA
import Grasshopper  # NOQA
import Rhino  # NOQA
import scriptcontext as sc  # NOQA
import Rhino.Geometry as rg  # NOQA

# GHENV COMPONENT SETTINGS ----------------------------------------------------
ghenv.Component.Name = 'FetchReducedGeometry'  # NOQA
ghenv.Component.NickName = 'FetchReducedGeometry'  # NOQA
ghenv.Component.Category = 'DDU_CSC'  # NOQA
ghenv.Component.SubCategory = '2 Catalog Interface'  # NOQA
ghenv.Component.Description = (  # NOQA
    'Fetches the reduced (catalog default) snapshot geometry as binary PLY '
    'from the CSC API, with ETag caching.\n'
    'Input can be:\n'
    '- Geometry carrying the \'csc_component\' user text\n'
    '- A component passport JSON string ({identity, snapshots[]})\n'
    '- A raw identity_id (resolves the current snapshot)\n'
    '- A raw snapshot_id\n\n'
    'Falls back to the inline snapshot geometry (preview meshes) when no '
    'reduced PLY is available. Point clouds have no reduced PLY; the inline '
    'preview (at most 1000 points) is returned instead. An element that has '
    'only an authored shape (a box or prism, no scan) is built from its '
    'parameters.'
)


# CSC LIBRARY (decision 8.111) ----------------------------------------------
CSC_GH_MINIMUM = '261102'
LIBRARY_PROBLEM = None
try:
    import csc_gh
    csc_gh.require(CSC_GH_MINIMUM)
    from csc_gh.read import (authored_only, drawable_proxies, placement_of)  # NOQA
    from csc_gh.rhino import (placement_transform, proxy_to_rhino)  # NOQA
    from csc_gh.messages import (waits_for_data)  # NOQA
except ImportError:
    LIBRARY_PROBLEM = (
        'CSC library 261102 too old or missing: run CSC_Update, '
        'then restart Rhino')



# the file names of the server are detailed / reduced; the levels are named
# Original / Reduced / Preview (decision 8.23)
LEVEL_NAMES = {'detailed': 'original', 'reduced': 'reduced'}

# OPTIONAL HELPERS: they never block the component (decisions 8.112, 8.113) ---
try:
    from csc_gh.ports import ensure_outputs
    from csc_gh.messages import set_state
except ImportError:
    ensure_outputs = set_state = None

OUTPUTS = [
    ('GeometryData', 'GeometryData',
     'Fetched reduced geometry as Rhino meshes and point clouds (one object per snapshot primitive)'),
    ('GeometrySource', 'GeometrySource',
     'Per-primitive source: reduced (mesh PLY), preview (inline fallback, including point-cloud previews) or authored (a shape built from its parameters)'),
    ('SnapshotID', 'SnapshotID',
     'Snapshot ID that was processed'),
]


def empty_outputs():
    """What RunScript returns when it stops early or has no result: an empty
    Grasshopper tree per output (never '' or None)."""
    if not OUTPUTS:
        return None
    trees = tuple(Grasshopper.DataTree[System.Object]() for _ in OUTPUTS)
    return trees[0] if len(trees) == 1 else trees


def null_outputs():
    """One null per output: an item of an item-access component that has no
    result keeps its slot (decision 8.186)."""
    if len(OUTPUTS) <= 1:
        return None
    return tuple(None for _ in OUTPUTS)


class CSC_FetchReducedGeometry(Grasshopper.Kernel.GH_ScriptInstance):
    """
    Author: Max Benjamin Eschenbach
    License: MIT License
    Version: 261102
    """

    # Resolution preference chain (reduced only; inline fallback otherwise)
    resolution_chain = ['reduced']
    # Point clouds have no reduced PLY; always use the inline preview.
    fetch_point_cloud_ply = False

    _outputs_ready = True       # set by BeforeRunScript (8.112)
    _outputs_note = None

    def __init__(self):
        """Initialize this component and set component parameters."""
        super().__init__()
        # initialize props
        self.Component = ghenv.Component  # NOQA
        self.InputParams = self.Component.Params.Input
        self.OutputParams = self.Component.Params.Output

    def _addRemark(self, msg: str = ''):
        """Add a remark message to the component."""
        rml = self.Component.RuntimeMessageLevel.Remark
        self.AddRuntimeMessage(rml, msg)

    def _addWarning(self, msg: str = ''):
        """Add a warning message to the component."""
        rml = self.Component.RuntimeMessageLevel.Warning
        self.AddRuntimeMessage(rml, msg)

    def _addError(self, msg: str = ''):
        """Add an error message to the component."""
        rml = self.Component.RuntimeMessageLevel.Error
        self.AddRuntimeMessage(rml, msg)

    def _state(self, text=''):
        """The one short state under the component (decision 8.113)."""
        if set_state is not None:
            set_state(self.Component, text)

    def _no_result(self, *ports):
        """The result of an iteration without one (decision 8.186): empty
        outputs when the inputs in ``ports`` carry no data at all (the
        component waits for data; no ports: a list or tree input is empty),
        else a null in the slot of this item, so the outputs stay one to one
        with the input list."""
        if not ports or (waits_for_data is not None
                         and waits_for_data(self, ports)):
            return empty_outputs()
        return null_outputs()

    def _stop(self):
        """True when RunScript has to return early: the library is missing or
        too old, or the outputs were just updated (says why)."""
        if LIBRARY_PROBLEM:
            self._addError(LIBRARY_PROBLEM)
            return True
        if self._outputs_note:
            self._addRemark(self._outputs_note)
        return not self._outputs_ready

    def _check_outputs(self):
        """Make the outputs match OUTPUTS before the script runs (8.112)."""
        self._outputs_ready, self._outputs_note = True, None
        if ensure_outputs is None:
            self._outputs_note = (
                'output check skipped: CSC library not installed')
            return
        status = ensure_outputs(self.Component, OUTPUTS)
        self._outputs_ready, self._outputs_note = status.ready, status.remark

    def BeforeRunScript(self):
        """Perform some setup actions."""
        # Initialize input param descriptions
        self.InputParams[0].Description = (
            'Input can be:\n'
            '- Geometry with the \'csc_component\' user text\n'
            '- A component passport JSON string ({identity, snapshots[]})\n'
            '- A raw identity_id (resolves current snapshot)\n'
            '- A raw snapshot_id'
        )
        # Initialize output param descriptions
        self._check_outputs()
        if LIBRARY_PROBLEM is None:
            csc_gh.dev_reload(globals())

    def get_auth_core_from_sticky(self):
        """Get AuthCore instance from sticky storage."""
        auth_core = sc.sticky.get('CSC_AuthCore')
        if auth_core is None:
            msg = ('No authentication found. Please use CSC_Session component '
                   'first.')
            self._addWarning(msg)
            return None
        return auth_core

    def parse_json_safe(self, value):
        """Parse a JSON string, returning None on failure."""
        try:
            return json.loads(value)
        except (json.JSONDecodeError, TypeError):
            return None

    def normalize_passport(self, obj):
        """
        Classify a parsed JSON object into canonical passport
        {identity, snapshots[]}, or None.
        """
        if not isinstance(obj, dict):
            return None
        identity = obj.get('identity') or {}
        snaps = obj.get('snapshots') or []
        if snaps and isinstance(snaps[0], dict):
            return {'identity': identity, 'snapshots': snaps}
        snap = obj.get('snapshot')
        if isinstance(snap, dict):
            return {'identity': identity, 'snapshots': [snap]}
        # Bare snapshot document
        if 'geometry' in obj and 'identity_id' in obj:
            return {'identity': {}, 'snapshots': [obj]}
        return None

    def primary_snapshot(self, passport):
        """Return the snapshot row used for geometry fetch."""
        if not isinstance(passport, dict):
            return None
        snaps = passport.get('snapshots') or []
        if snaps and isinstance(snaps[0], dict):
            return snaps[0]
        return None

    def fetch_passport_by_identity(self, auth_core, identity_id):
        """Fetch {identity, snapshots[]} for an identity's current snapshot."""
        try:
            resp = auth_core.cached_get_passport(identity_id)
            if resp.status_code == 200:
                return auth_core.normalize_passport_output(resp.json())
        except Exception as e:
            self._addWarning(
                'Fetching the component passport of the identity failed: '
                f'{str(e)}')
        return None

    def fetch_passport_by_snapshot(self, auth_core, snapshot_id):
        """Build minimal passport from a bare snapshot document."""
        try:
            resp = auth_core.authorized_get(f'/snapshots/{snapshot_id}')
            if resp.status_code == 200:
                return {'identity': {}, 'snapshots': [resp.json()]}
        except Exception as e:
            self._addWarning(f'Snapshot fetch failed: {str(e)}')
        return None

    def resolve_passport(self, auth_core, Input):
        """
        Resolve the input into canonical passport {identity, snapshots[]}.
        Returns (passport_or_None, input_is_geometry).
        """
        input_is_geometry = isinstance(Input, rg.GeometryBase)

        # Geometry carrying the passport userstring
        if (hasattr(Input, 'UserStringCount') and
                Input.UserStringCount > 0):
            value = Input.GetUserString('csc_component')
            if value:
                passport = self.normalize_passport(
                    self.parse_json_safe(value))
                if passport:
                    return passport, input_is_geometry

        # String input: passport JSON, identity doc, or raw UUID
        if isinstance(Input, str):
            s = Input.strip()
            obj = self.parse_json_safe(s)
            if obj is not None:
                passport = self.normalize_passport(obj)
                if passport:
                    return passport, input_is_geometry
                # Identity document with a current snapshot pointer
                if (isinstance(obj, dict) and obj.get('_id') and
                        obj.get('current_snapshot_id')):
                    passport = self.fetch_passport_by_identity(
                        auth_core, obj['_id'])
                    if passport:
                        return passport, input_is_geometry
                return None, input_is_geometry
            # Not JSON: treat as a raw UUID (identity first, then snapshot)
            if auth_core.validate_uuid(s):
                passport = self.fetch_passport_by_identity(auth_core, s)
                if passport:
                    return passport, input_is_geometry
                passport = self.fetch_passport_by_snapshot(auth_core, s)
                if passport:
                    return passport, input_is_geometry

        return None, input_is_geometry

    def build_inline_mesh(self, mesh_data, default_color):
        """Build a Rhino mesh from an inline SnapshotMesh (Rhino Z-up)."""
        vertices = mesh_data.get('vertices')
        faces = mesh_data.get('faces')
        if not vertices or not faces:
            return None
        mesh = rg.Mesh()
        for v in vertices:
            mesh.Vertices.Add(float(v[0]), float(v[1]), float(v[2]))
        for f in faces:
            if len(f) == 3:
                mesh.Faces.AddFace(f[0], f[1], f[2])
            elif len(f) == 4:
                mesh.Faces.AddFace(f[0], f[1], f[2], f[3])
        colors = mesh_data.get('colors')
        if colors and len(colors) == len(vertices):
            for c in colors:
                mesh.VertexColors.Add(int(c[0]), int(c[1]), int(c[2]))
        elif default_color:
            try:
                r, g, b = default_color
                for _ in range(len(vertices)):
                    mesh.VertexColors.Add(int(r), int(g), int(b))
            except (ValueError, TypeError):
                pass
        mesh.Normals.ComputeNormals()
        mesh.Compact()
        return mesh

    def placement_xform(self, passport):
        """The client-side placement of the piece (csc_placement, set by
        TransformComponent) as a transform of the stored geometry."""
        placed = placement_of(passport)
        return placement_transform(placed) if placed else None

    def fetch_authored_proxies(self, snapshot):
        """Authored shapes of a piece that has no mesh and no point cloud
        (a web-authored box, a migrated extrusion), built from the proxy
        parameters and placement; ``[(geometry, 'authored', index)]``."""
        results = []
        if not authored_only(snapshot):
            return results
        for index, proxy in drawable_proxies(snapshot):
            if (proxy.get('fit') or {}).get('method') != 'authored':
                continue
            shape = proxy_to_rhino(proxy)
            if shape is not None:
                results.append((shape, 'authored', index))
        return results

    def fetch_primitive_meshes(self, auth_core, snapshot):
        """
        Fetch one mesh per snapshot mesh primitive, preferring the PLY
        resolution chain and falling back to inline geometry.
        Returns a list of (mesh, source) tuples.
        """
        snapshot_id = snapshot.get('_id')
        geometry = snapshot.get('geometry', {}) or {}
        inline_meshes = geometry.get('meshes', []) or []
        res_map = snapshot.get('mesh_ply_resolutions', {}) or {}
        default_color = snapshot.get('color') or [110, 110, 110]

        results = []
        for i in range(len(inline_meshes)):
            available = res_map.get(str(i), []) or []
            mesh = None
            source = None
            for resolution in self.resolution_chain:
                if resolution in available:
                    m, _etag, _from_cache = (
                        auth_core.cached_get_snapshot_mesh(
                            snapshot_id, i, resolution)
                    )
                    if m is not None:
                        mesh = m
                        source = LEVEL_NAMES.get(resolution, resolution)
                        break
            if mesh is None:
                mesh = self.build_inline_mesh(inline_meshes[i], default_color)
                source = 'preview'
            if mesh is not None:
                results.append((mesh, source))
        return results

    def build_inline_point_cloud(self, pc_data):
        """Build a Rhino point cloud from one inline SnapshotPointCloud."""
        if not isinstance(pc_data, dict):
            return None
        pts = pc_data.get('points', []) or []
        if not pts:
            return None
        cloud = rg.PointCloud()
        colors = pc_data.get('colors')
        if colors and len(colors) == len(pts):
            for p, c in zip(pts, colors):
                cloud.Add(
                    rg.Point3d(float(p[0]), float(p[1]), float(p[2])),
                    System.Drawing.Color.FromArgb(*[int(v) for v in c]),
                )
        else:
            for p in pts:
                cloud.Add(rg.Point3d(float(p[0]), float(p[1]), float(p[2])))
        return cloud if cloud.Count > 0 else None

    def fetch_primitive_point_clouds(self, auth_core, snapshot):
        """
        Fetch one point cloud per snapshot primitive.

        FetchReduced uses the inline preview only (no reduced PLY exists).
        FetchDetailed prefers the full PLY, then the inline preview.
        Returns a list of (cloud, source) tuples.
        """
        geometry = snapshot.get('geometry', {}) or {}
        inline_pcs = geometry.get('point_clouds', []) or []
        snapshot_id = snapshot.get('_id')
        results = []
        for i in range(len(inline_pcs)):
            cloud = None
            source = None
            if self.fetch_point_cloud_ply and auth_core and snapshot_id:
                try:
                    cloud = auth_core.cached_get_snapshot_point_cloud(
                        snapshot_id, i)
                    if cloud is not None:
                        source = 'original'
                except Exception as e:
                    self._addWarning(
                        'Point cloud PLY fetch failed '
                        f'for index {i}: {str(e)}')
            if cloud is None:
                cloud = self.build_inline_point_cloud(inline_pcs[i])
                source = 'preview'
            if cloud is not None:
                results.append((cloud, source))
        return results

    def collect_fetched_geometry(self, auth_core, snapshot):
        """
        Return meshes, then point clouds, then authored shapes as
        (geometry, source, kind, index) tuples.
        """
        items = []
        for i, (mesh, source) in enumerate(
                self.fetch_primitive_meshes(auth_core, snapshot)):
            items.append((mesh, source, 'mesh', i))
        for i, (cloud, source) in enumerate(
                self.fetch_primitive_point_clouds(auth_core, snapshot)):
            items.append((cloud, source, 'point_cloud', i))
        for shape, source, index in self.fetch_authored_proxies(snapshot):
            items.append((shape, source, 'proxy', index))
        return items

    def select_fetched_geometry(self, Input, input_is_geometry, items):
        """
        If the input geometry carries a primitive index, return only that
        primitive of the matching kind.
        """
        if not (input_is_geometry and hasattr(Input, 'GetUserString')):
            return items
        if isinstance(Input, rg.PointCloud):
            raw = Input.GetUserString('csc_point_cloud_index')
            if raw:
                try:
                    idx = int(raw)
                except (TypeError, ValueError):
                    return items
                filtered = [
                    item for item in items
                    if item[2] == 'point_cloud' and item[3] == idx
                ]
                return filtered or items
            return items
        raw = Input.GetUserString('csc_proxy_index')
        if raw:
            try:
                idx = int(raw)
            except (TypeError, ValueError):
                return items
            filtered = [
                item for item in items
                if item[2] == 'proxy' and item[3] == idx
            ]
            return filtered or items
        raw = Input.GetUserString('csc_mesh_index')
        if raw:
            try:
                idx = int(raw)
            except (TypeError, ValueError):
                return items
            filtered = [
                item for item in items
                if item[2] == 'mesh' and item[3] == idx
            ]
            return filtered or items
        return items

    def RunScript(self, Input):
        # Get AuthCore instance from sticky storage
        if self._stop():
            return empty_outputs()
        auth_core = self.get_auth_core_from_sticky()
        if auth_core is None:
            return empty_outputs()

        # Check if authentication is valid
        if not auth_core.is_valid():
            msg = ('Authentication expired. Please use CSC_Session '
                   'component to refresh.')
            self._addWarning(msg)
            return empty_outputs()

        # Input validation
        if not Input:
            msg = 'Please provide input data.'
            self._addWarning(msg)
            return self._no_result('Input')

        # Set up outputs
        GeometryData = System.Collections.Generic.List[System.Object]()
        GeometrySource = System.Collections.Generic.List[str]()
        SnapshotID = System.Collections.Generic.List[str]()
        __Results = (GeometryData, GeometrySource, SnapshotID)

        try:

            passport, input_is_geometry = self.resolve_passport(
                auth_core, Input)
            snapshot = self.primary_snapshot(passport)
            if not passport or not snapshot:
                msg = 'Could not resolve a snapshot from input.'
                self._addError(msg)
                return null_outputs()
            snapshot_id = snapshot.get('_id')
            if not snapshot_id or not auth_core.validate_uuid(snapshot_id):
                msg = f'Snapshot ID <{snapshot_id}> is not a valid UUID!'
                self._addError(msg)
                return null_outputs()


            items = self.collect_fetched_geometry(auth_core, snapshot)
            if not items:
                msg = f'No geometry available for snapshot {snapshot_id}'
                self._addWarning(msg)
                return __Results

            # Position the geometry by the piece's client-side placement
            xform = self.placement_xform(passport)
            if xform is not None:
                for geom, _source, _kind, _idx in items:
                    geom.Transform(xform)

            passport_json = auth_core.passport_json_string(passport)
            for geom, _source, kind, idx in items:
                if hasattr(geom, 'SetUserString'):
                    geom.SetUserString('csc_component', passport_json)
                    if kind == 'mesh':
                        geom.SetUserString('csc_mesh_index', str(idx))
                    elif kind == 'proxy':
                        geom.SetUserString('csc_proxy_index', str(idx))
                    else:
                        geom.SetUserString(
                            'csc_point_cloud_index', str(idx))

            selected = self.select_fetched_geometry(
                Input, input_is_geometry, items)
            for geom, source, _kind, _idx in selected:
                GeometryData.Add(geom)
                GeometrySource.Add(source)

            SnapshotID.Add(snapshot_id)

            mesh_count = sum(
                1 for _g, _s, kind, _i in selected if kind == 'mesh')
            pc_count = sum(
                1 for _g, _s, kind, _i in selected
                if kind == 'point_cloud')
            self._addRemark(
                f'Fetched reduced geometry ({mesh_count} mesh(es), '
                f'{pc_count} point cloud(s)) for snapshot {snapshot_id}'
            )

            return __Results

        except requests.exceptions.ConnectionError as e:
            msg = 'Cannot connect to server. Please check your connection.'
            self._addError(msg + f'\nFull Error: {str(e)}')
            return null_outputs()

        except requests.exceptions.Timeout as e:
            msg = 'Request timeout. Server may be slow.'
            self._addError(msg + f'\nFull Error: {str(e)}')
            return null_outputs()

        except requests.exceptions.RequestException as e:
            msg = f'Request error: {str(e)}'
            self._addError(msg)
            return null_outputs()

        except Exception as e:
            msg = f'Unexpected error: {str(e)}'
            self._addError(msg)
            return null_outputs()

        return __Results
# ---------- end fetchreducedgeometry ----------
panel_9 = Panel(fetchreducedgeometry.GeometrySource)
panel_10 = Panel(fetchreducedgeometry.SnapshotID)
geometry = Data(fetchreducedgeometry.GeometryData)

# ---- group: __DDU_CSC_EXAMPLE_04__
# comments & notes: Filter Components that were already fetched from the Catalogue.
# 
# In this case:
# - Only panels with X maximum of 500.0 and Y between 200.0 and 300.0
# Step 3
originalfunction_5 = ValueList({"Any function": , "Beam (IfcBeam)": "IfcBeam", "Column (IfcColumn)": "IfcColumn", "Slab (IfcSlab)": "IfcSlab", "Plate / Panel (IfcPlate)": "IfcPlate", "Wall (IfcWall)": "IfcWall", "Member (IfcMember)": "IfcMember", "Pipe (IfcPipeSegment)": "IfcPipeSegment", "Duct (IfcDuctSegment)": "IfcDuctSegment", "Footing (IfcFooting)": "IfcFooting", "Window (IfcWindow)": "IfcWindow", "Door / gate (IfcDoor)": "IfcDoor", "Stair (IfcStair)": "IfcStair", "Railing / balustrade (IfcRailing)": "IfcRailing", "Accessory / Connector (IfcDiscreteAccessory)": "IfcDiscreteAccessory", "Element part (IfcBuildingElementPart)": "IfcBuildingElementPart", "Unknown (IfcBuildingElementProxy)": "IfcBuildingElementProxy", "Debris (CscDebris)": "CscDebris"}, selected="Any function")
material_5 = ValueList({"Any material": , "Concrete (concrete)": "concrete", "Autoclaved aerated concrete (autoclaved_aerated_concrete)": "autoclaved_aerated_concrete", "Fired clay (fired_clay)": "fired_clay", "Calcium silicate (calcium_silicate)": "calcium_silicate", "Ceramic (ceramic)": "ceramic", "Natural stone (natural_stone)": "natural_stone", "Mixed mineral (mineral_mixture)": "mineral_mixture", "Gypsum (gypsum)": "gypsum", "Glass (glass)": "glass"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}, selected="Any material")
complexity_5 = ValueList({"Any complexity": , "0", "1", "2", "3"}, selected="Any complexity")
fragment_6 = ValueList({"Any": , "Only fragments": True, "Only non-fragmnents": False}, selected="Any")
shapeclass_5 = ValueList({"Any shape": , "Linear (linear)": "linear", "Planar (planar)": "planar", "Block (block)": "block", "Irregular (irregular)": "irregular", "Composite (composite)": "composite"}, selected="Any shape")
materialclass_5 = ValueList({"Any MaterialClass": , "Concrete (17 01 01)": "17 01 01", "Bricks (17 01 02)": "17 01 02", "Tiles and ceramics (17 01 03)": "17 01 03", "Mineral mixtures, hazardous (17 01 06*)": "17 01 06*", "Mineral mixtures (17 01 07)": "17 01 07", "Wood (17 02 01)": "17 02 01", "Glass (17 02 02)": "17 02 02", "Plastic (17 02 03)": "17 02 03", "Glass, plastic, wood, hazardous (17 02 04*)": "17 02 04*"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}, selected="Any MaterialClass")
dataset_5 = Panel("")
mindimensionx_5 = Slider(200, range=-0.1..2000)
maxdimensionx_5 = Slider(500, range=0..2000)
mindimensiony_5 = Slider(245, range=0..2000)
maxdimensiony_5 = Slider(260, range=0..2000)
mindimensionz_5 = Slider(0, range=0..500)
maxdimensionz_5 = Slider(0, range=0..500)
componentpassport_16 = Data(componentpassport)
filtercomponents = FilterComponents(
    OriginalFunction=originalfunction_5,
    Material=material_5,
    Dataset=dataset_5,
    Complexity=complexity_5,
    Fragment=fragment_6,
    MinDimensionX=mindimensionx_5,
    MaxDimensionX=maxdimensionx_5,
    MinDimensionY=mindimensiony_5,
    MaxDimensionY=maxdimensiony_5,
    MinDimensionZ=mindimensionz_5,
    MaxDimensionZ=maxdimensionz_5,
    ShapeClass=shapeclass_5,
    MaterialClass=materialclass_5,
    ComponentPassport=componentpassport_16)  # -> FilterDescription, FilteredComponentPassports; inputs OriginalFunction: String, Material: String, Dataset: String, Complexity: Int32, Fragment: Boolean, MinDimensionX: Double, MaxDimensionX: Double, MinDimensionY: Double, MaxDimensionY: Double, MinDimensionZ: Double, MaxDimensionZ: Double, ShapeClass: String, MaterialClass: String, ComponentPassport: tree
# ---------- filtercomponents: Python ----------
#! python3
# -*- coding: utf-8 -*-
# venv: DDU_CSC
# r: charset_normalizer
# r: numpy==2.0.2
print('ENV OK!')

# PYTHON STANDARD LIBRARY IMPORTS ---------------------------------------------
import json  # NOQA

# RHINO AND GH RELATED IMPORTS ------------------------------------------------
import System  # NOQA
import Grasshopper  # NOQA
import Rhino  # NOQA

# GHENV COMPONENT SETTINGS ----------------------------------------------------
ghenv.Component.Name = 'FilterComponents'  # NOQA
ghenv.Component.NickName = 'FilterComponents'  # NOQA
ghenv.Component.Category = 'DDU_CSC'  # NOQA
ghenv.Component.SubCategory = '2 Catalog Interface'  # NOQA
ghenv.Component.Description = (  # NOQA
    'Filters a list of component passport JSON entries ({identity, snapshots[]}) based '
    'on various criteria (original function, material, dataset, complexity, '
    'fragment, bounding box dimensions, shape class, material class). Works '
    'with local component passport data from fetch components.'
)

# CSC LIBRARY (decision 8.111) ----------------------------------------------
CSC_GH_MINIMUM = '261005'
LIBRARY_PROBLEM = None
try:
    import csc_gh
    csc_gh.require(CSC_GH_MINIMUM)
    from csc_gh.read import (passes_filters)  # NOQA
except ImportError:
    LIBRARY_PROBLEM = (
        'CSC library 261005 too old or missing: run CSC_Update, '
        'then restart Rhino')

# OPTIONAL HELPERS: they never block the component (decisions 8.112, 8.113) ---
try:
    from csc_gh.ports import ensure_outputs
    from csc_gh.messages import set_state
except ImportError:
    ensure_outputs = set_state = None

OUTPUTS = [
    ('FilterDescription', 'FilterDescription',
     'Human-readable description of the applied filters'),
    ('FilteredComponentPassports', 'FilteredComponentPassports',
     "Filtered component passport JSON strings ({identity, snapshots[]}). Use 'DisassembleComponent' to access the individual fields ready for Grasshopper"),
]


def empty_outputs():
    """What RunScript returns when it stops early or has no result: an empty
    Grasshopper tree per output (never '' or None)."""
    if not OUTPUTS:
        return None
    trees = tuple(Grasshopper.DataTree[System.Object]() for _ in OUTPUTS)
    return trees[0] if len(trees) == 1 else trees


class CSC_FilterComponents(Grasshopper.Kernel.GH_ScriptInstance):
    """
    Author: Max Benjamin Eschenbach
    License: MIT License
    Version: 261102
    """

    _outputs_ready = True       # set by BeforeRunScript (8.112)
    _outputs_note = None

    def __init__(self):
        """Initialize this component and set component parameters."""
        super().__init__()
        # initialize props
        self.Component = ghenv.Component  # NOQA
        self.InputParams = self.Component.Params.Input
        self.OutputParams = self.Component.Params.Output

    def _addRemark(self, msg: str = ''):
        """Add a remark message to the component."""
        rml = self.Component.RuntimeMessageLevel.Remark
        self.AddRuntimeMessage(rml, msg)

    def _addWarning(self, msg: str = ''):
        """Add a warning message to the component."""
        rml = self.Component.RuntimeMessageLevel.Warning
        self.AddRuntimeMessage(rml, msg)

    def _addError(self, msg: str = ''):
        """Add an error message to the component."""
        rml = self.Component.RuntimeMessageLevel.Error
        self.AddRuntimeMessage(rml, msg)

    def _state(self, text=''):
        """The one short state under the component (decision 8.113)."""
        if set_state is not None:
            set_state(self.Component, text)

    def _stop(self):
        """True when RunScript has to return early: the library is missing or
        too old, or the outputs were just updated (says why)."""
        if LIBRARY_PROBLEM:
            self._addError(LIBRARY_PROBLEM)
            return True
        if self._outputs_note:
            self._addRemark(self._outputs_note)
        return not self._outputs_ready

    def _check_outputs(self):
        """Make the outputs match OUTPUTS before the script runs (8.112)."""
        self._outputs_ready, self._outputs_note = True, None
        if ensure_outputs is None:
            self._outputs_note = (
                'output check skipped: CSC library not installed')
            return
        status = ensure_outputs(self.Component, OUTPUTS)
        self._outputs_ready, self._outputs_note = status.ready, status.remark

    def BeforeRunScript(self):
        """Perform some setup actions."""
        # Initialize input param descriptions
        descriptions = [
            'Original function filter, an IFC class (e.g. IfcBeam, '
            'IfcColumn, IfcSlab, IfcPlate, CscDebris)',
            'Material filter, a material id (e.g. concrete, steel, timber)',
            'Dataset name filter (e.g., "beyond_debris", '
            '"mineral_composite_sheets")',
            'Complexity level filter (0-3, where 0=simple, 3=complex)',
            'Fragment status filter (True for fragments, False for complete)',
            'Minimum X dimension filter (bounding box, longest side)',
            'Maximum X dimension filter (bounding box)',
            'Minimum Y dimension filter (bounding box)',
            'Maximum Y dimension filter (bounding box)',
            'Minimum Z dimension filter (bounding box, shortest side)',
            'Maximum Z dimension filter (bounding box)',
            'Shape class filter: linear, planar, block, irregular or '
            'composite',
            'Material class filter, a List of Waste code (e.g. 17 01 01)',
            'Component passport JSON strings to filter ({identity, snapshots[]}), '
            'e.g. from FetchAllComponents, FetchComponents, or '
            'FetchFilteredComponents',
        ]
        for index, text_ in enumerate(descriptions):
            if index < len(self.InputParams):
                self.InputParams[index].Description = text_
        # Initialize output param descriptions
        self._check_outputs()
        if LIBRARY_PROBLEM is None:
            csc_gh.dev_reload(globals())

    def apply_filters(self, passport: dict, filter_params: dict) -> bool:
        """
        Apply all filters to a single passport entry (csc_read): identity
        fields (original function, material, dataset, material class) and
        snapshot fields (shape class, complexity, fragment, bbx).
        """
        bbx = {key: filter_params.get(key) for key in (
            'min_x', 'max_x', 'min_y', 'max_y', 'min_z', 'max_z')}
        return passes_filters(
            passport,
            original_function=filter_params.get('original_function'),
            material=filter_params.get('material'),
            dataset=filter_params.get('dataset'),
            complexity=filter_params.get('complexity'),
            fragment=filter_params.get('fragment'),
            shape_class=filter_params.get('shape_class'),
            material_class=filter_params.get('material_class'),
            bbx=bbx)

    def generate_filter_description(self, filter_params: dict) -> str:
        """Generates a human-readable description of the applied filters."""
        description = []
        if filter_params.get('original_function'):
            description.append(
                f'\nOriginal function: {filter_params["original_function"]}')
        if filter_params.get('shape_class'):
            description.append(
                f'\nShape class: {filter_params["shape_class"]}')
        if filter_params.get('material_class'):
            description.append(
                f'\nMaterial class: {filter_params["material_class"]}')
        if filter_params.get('material'):
            description.append(f'\nMaterial: {filter_params["material"]}')
        if filter_params.get('dataset'):
            description.append(f'\nDataset: {filter_params["dataset"]}')
        if filter_params.get('complexity') is not None:
            description.append(f'\nComplexity: {filter_params["complexity"]}')
        if filter_params.get('fragment') is not None:
            description.append(f'\nFragment: {filter_params["fragment"]}')

        # Handle bounding box filters with detailed information
        bbx_filters = []
        if filter_params.get('min_x') is not None:
            bbx_filters.append(f'\nX >= {filter_params["min_x"]:.2f}')
        if filter_params.get('max_x') is not None:
            bbx_filters.append(f'\nX <= {filter_params["max_x"]:.2f}')
        if filter_params.get('min_y') is not None:
            bbx_filters.append(f'\nY >= {filter_params["min_y"]:.2f}')
        if filter_params.get('max_y') is not None:
            bbx_filters.append(f'\nY <= {filter_params["max_y"]:.2f}')
        if filter_params.get('min_z') is not None:
            bbx_filters.append(f'\nZ >= {filter_params["min_z"]:.2f}')
        if filter_params.get('max_z') is not None:
            bbx_filters.append(f'\nZ <= {filter_params["max_z"]:.2f}')

        if bbx_filters:
            description.append(f'\nBounding Box: {", ".join(bbx_filters)}')

        return f'Applied filters: {", ".join(description)}'

    def RunScript(self,
            OriginalFunction: str,
            Material: str,
            Dataset: str,
            Complexity: int,
            Fragment: bool,
            MinDimensionX: float,
            MaxDimensionX: float,
            MinDimensionY: float,
            MaxDimensionY: float,
            MinDimensionZ: float,
            MaxDimensionZ: float,
            ShapeClass: str,
            MaterialClass: str,
            ComponentPassport: Grasshopper.DataTree[object]):
        # Validate input data
        if self._stop():
            return empty_outputs()
        if not ComponentPassport or ComponentPassport.DataCount == 0:
            msg = ('No component passport data provided. '
                   'Please connect ComponentPassport input.')
            self._addWarning(msg)

            # Return empty results
            FilterDescription = Grasshopper.DataTree[System.Object]()
            FilteredComponentPassports = Grasshopper.DataTree[System.Object]()
            __Results = (FilterDescription, FilteredComponentPassports)
            return __Results

        try:

            # Build filter parameters dictionary
            filter_params = {}

            # Add original function filter if provided
            if (OriginalFunction and OriginalFunction.strip()
                    and OriginalFunction.lower() != 'alltypes'):
                filter_params['original_function'] = OriginalFunction.strip()

            if ShapeClass and ShapeClass.strip():
                filter_params['shape_class'] = ShapeClass.strip()
            if MaterialClass and MaterialClass.strip():
                filter_params['material_class'] = MaterialClass.strip()

            # Add material filter if provided
            if (Material and Material.strip() and
                    Material.lower() != 'allmaterials'):
                filter_params['material'] = Material.strip()

            # Add dataset filter if provided
            if (Dataset and Dataset.strip() and
                    Dataset.lower() != 'alldatasets'):
                filter_params['dataset'] = Dataset.strip()

            # Add complexity filter if provided
            if Complexity is not None:
                filter_params['complexity'] = Complexity

            # Add fragment filter if provided
            if Fragment is not None:
                filter_params['fragment'] = Fragment

            # Add bounding box filters if provided
            if MinDimensionX is not None and MinDimensionX != 0.0:
                filter_params['min_x'] = MinDimensionX
            if MaxDimensionX is not None and MaxDimensionX != 0.0:
                filter_params['max_x'] = MaxDimensionX
            if MinDimensionY is not None and MinDimensionY != 0.0:
                filter_params['min_y'] = MinDimensionY
            if MaxDimensionY is not None and MaxDimensionY != 0.0:
                filter_params['max_y'] = MaxDimensionY
            if MinDimensionZ is not None and MinDimensionZ != 0.0:
                filter_params['min_z'] = MinDimensionZ
            if MaxDimensionZ is not None and MaxDimensionZ != 0.0:
                filter_params['max_z'] = MaxDimensionZ

            # Generate human-readable filter description
            filter_description = self.generate_filter_description(
                filter_params
            )


            # Set up output trees and results tuple
            FilterDescription = Grasshopper.DataTree[System.Object]()
            FilteredComponentPassports = Grasshopper.DataTree[System.Object]()
            __Results = (FilterDescription, FilteredComponentPassports)

            # Add filter description to the filter query output
            FilterDescription.Add(
                filter_description,
                Grasshopper.Kernel.Data.GH_Path(0))

            # Filter components
            filtered_count = 0
            total_count = 0

            # Loop over all branches
            for i in range(ComponentPassport.BranchCount):
                ghp = ComponentPassport.Paths[i]
                for j, comp in enumerate(ComponentPassport.Branches[i]):
                    total_count += 1
                    try:
                        # Load passport JSON
                        passport = json.loads(comp)
                        identity = passport.get('identity')
                        snapshots = passport.get('snapshots') or []
                        snapshot = snapshots[0] if snapshots else None
                        if not isinstance(identity, dict) or not isinstance(
                                snapshot, dict):
                            self._addWarning(
                                'Skipping entry: not component passport JSON '
                                '({identity, snapshot})')
                            continue

                        # Apply filters
                        if self.apply_filters(passport, filter_params):
                            # Entry passes all filters, add to output
                            FilteredComponentPassports.Add(comp, ghp)
                            filtered_count += 1

                    except json.JSONDecodeError as e:
                        msg = f'Failed to parse component passport JSON: {str(e)}'
                        self._addWarning(msg)
                        continue
                    except Exception as e:
                        msg = f'Error processing component: {str(e)}'
                        self._addWarning(msg)
                        continue

            # Update component message
            if filtered_count == 0:
                msg = 'No components match the applied filters.'
                self._addWarning(msg)
            else:
                msg = f'Filtered {filtered_count} of {total_count} components.'
                self._addRemark(
                    f'Successfully filtered {filtered_count} components '
                    f'from {total_count} total components'
                )

            return __Results

        except Exception as e:
            msg = f'Unexpected error during filtering: {str(e)}'
            self._addError(msg)

            # Return empty results if there was an error
            FilterDescription = Grasshopper.DataTree[System.Object]()
            FilteredComponentPassports = Grasshopper.DataTree[System.Object]()
            __Results = (FilterDescription, FilteredComponentPassports)
            return __Results
# ---------- end filtercomponents ----------
log = Panel(filtercomponents.FilterDescription)
componentpassport_17 = Data(filtercomponents.FilteredComponentPassports)

# ----
samplereinforcementpolyline = Geometry([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])
snapshotid_3 = Data(snapshotid)
reinforcementlayout = ReinforcementLayout(Curves=samplereinforcementpolyline, Spec="BSt 42/50", Diameter="10", SnapshotID=snapshotid_3)  # -> Evidence; inputs Curves: list of Curve, Spec: list, Diameter: list of Double, SnapshotID: String, Basis: String, ObservedAt: String, DocumentTitle: String, DocumentDate: String, DocumentReference: String, InstrumentKind: String, InstrumentModel: String, AccuracyNote: String, Notes: String, DocumentUrl: String, DocumentRetrievedAt: String, ComponentPassport: String
# ---------- reinforcementlayout: Python ----------
#! python3
# -*- coding: utf-8 -*-
# venv: DDU_CSC
# r: charset_normalizer
# r: numpy==2.0.2
print('ENV OK!')

# PYTHON STANDARD LIBRARY IMPORTS ---------------------------------------------
import json  # NOQA

# RHINO AND GH RELATED IMPORTS ------------------------------------------------
import System  # NOQA
import Rhino  # NOQA
import Grasshopper  # NOQA

# GHENV COMPONENT SETTINGS ----------------------------------------------------
ghenv.Component.Name = 'ReinforcementLayout'  # NOQA
ghenv.Component.NickName = 'ReinforcementLayout'  # NOQA
ghenv.Component.Category = 'DDU_CSC'  # NOQA
ghenv.Component.SubCategory = '7 Geometry Tools'  # NOQA
ghenv.Component.Description = (  # NOQA
    'Builds one evidence record of method reinforcement_layout from bar '
    'centrelines (curves), steel grades and diameters: where the '
    'reinforcement of a component lies, known from a drawing, a scan or an '
    'exposed bar. A layout belongs to one version of the component: its '
    'curves are in the stored coordinates (millimetres) of that version, '
    'named by SnapshotID. Curves drawn on an element that was moved (ApplyFrame, '
    'TransformComponent) need the ComponentPassport of that element: its '
    'placement is undone and its snapshot is used. Document units are '
    'taken as millimetres (1:1); a document in another unit gets a warning. '
    'Post the record with AddEvidence.'
)

# CSC LIBRARY (decision 8.111) ----------------------------------------------
CSC_GH_MINIMUM = '261102'
LIBRARY_PROBLEM = None
try:
    import csc_gh
    csc_gh.require(CSC_GH_MINIMUM)
    from csc_gh.build import (BuildError, MissingInput, reinforcement_layout_record)  # NOQA
    from csc_gh.layout import (bars_to_stored, layout_target, unit_warning)  # NOQA
    from csc_gh.rhino import (curve_points, mm_per_document_unit)  # NOQA
    from csc_gh.messages import (waits_for_data)  # NOQA
except ImportError:
    LIBRARY_PROBLEM = (
        'CSC library 261102 too old or missing: run CSC_Update, '
        'then restart Rhino')

# OPTIONAL HELPERS: they never block the component (decisions 8.112, 8.113) ---
try:
    from csc_gh.ports import ensure_outputs
    from csc_gh.messages import set_state
except ImportError:
    ensure_outputs = set_state = None

OUTPUTS = [
    ('Evidence', 'Evidence',
     'Evidence record JSON for AddEvidence'),
]


def empty_outputs():
    """What RunScript returns when it stops early or has no result: an empty
    Grasshopper tree per output (never '' or None)."""
    if not OUTPUTS:
        return None
    trees = tuple(Grasshopper.DataTree[System.Object]() for _ in OUTPUTS)
    return trees[0] if len(trees) == 1 else trees


def null_outputs():
    """One null per output: an item of an item-access component that has no
    result keeps its slot (decision 8.186)."""
    if len(OUTPUTS) <= 1:
        return None
    return tuple(None for _ in OUTPUTS)


class CSC_ReinforcementLayout(Grasshopper.Kernel.GH_ScriptInstance):
    """
    Author: Max Benjamin Eschenbach
    License: MIT License
    Version: 261102
    """

    _outputs_ready = True       # set by BeforeRunScript (8.112)
    _outputs_note = None

    def __init__(self):
        super().__init__()
        self.Component = ghenv.Component  # NOQA
        self.InputParams = self.Component.Params.Input
        self.OutputParams = self.Component.Params.Output

    def _addRemark(self, msg: str = ''):
        rml = self.Component.RuntimeMessageLevel.Remark
        self.AddRuntimeMessage(rml, msg)

    def _addWarning(self, msg: str = ''):
        rml = self.Component.RuntimeMessageLevel.Warning
        self.AddRuntimeMessage(rml, msg)

    def _addError(self, msg: str = ''):
        rml = self.Component.RuntimeMessageLevel.Error
        self.AddRuntimeMessage(rml, msg)

    def _state(self, text=''):
        """The one short state under the component (decision 8.113)."""
        if set_state is not None:
            set_state(self.Component, text)

    def _no_result(self, *ports):
        """The result of an iteration without one (decision 8.186): empty
        outputs when the inputs in ``ports`` carry no data at all (the
        component waits for data; no ports: a list or tree input is empty),
        else a null in the slot of this item, so the outputs stay one to one
        with the input list."""
        if not ports or (waits_for_data is not None
                         and waits_for_data(self, ports)):
            return empty_outputs()
        return null_outputs()

    def _stop(self):
        """True when RunScript has to return early: the library is missing or
        too old, or the outputs were just updated (says why)."""
        if LIBRARY_PROBLEM:
            self._addError(LIBRARY_PROBLEM)
            return True
        if self._outputs_note:
            self._addRemark(self._outputs_note)
        return not self._outputs_ready

    def _check_outputs(self):
        """Make the outputs match OUTPUTS before the script runs (8.112)."""
        self._outputs_ready, self._outputs_note = True, None
        if ensure_outputs is None:
            self._outputs_note = (
                'output check skipped: CSC library not installed')
            return
        status = ensure_outputs(self.Component, OUTPUTS)
        self._outputs_ready, self._outputs_note = status.ready, status.remark

    def BeforeRunScript(self):
        """Perform some setup actions."""
        descriptions = [
            'Bar centrelines, one curve per bar (polylines are used as '
            'they are)',
            'Steel grade per bar, e.g. BSt III (optional: one for all bars '
            'or one per bar; empty: the bars carry no grade)',
            'Bar diameter in mm (one for all bars or one per bar)',
            'Id of the snapshot whose stored coordinates the curves are in '
            '(a layout belongs to one version; empty with a '
            'ComponentPassport: its snapshot)',
            'drawing, scan or exposed: where the layout is known from',
            'When it was observed (2024-05-03, ...; empty: now)',
            'Basis drawing: title of the drawing',
            'Basis drawing: date of the drawing',
            'Basis drawing: reference of the drawing',
            'Basis scan: covermeter, radar or other',
            'Basis scan: model of the instrument',
            'Accuracy, e.g. size and cover +-20 %',
            'Free text',
            'Basis drawing: link to the drawing online (http or https; '
            'needs DocumentTitle)',
            'Basis drawing: the day the link was read (2026-10-05)',
            'Passport of the element the curves were drawn on, with its '
            'placement if it was moved (ApplyFrame, TransformComponent): '
            'the curves are mapped back to the stored coordinates and the '
            'snapshot is taken from it. An explicit SnapshotID that '
            'disagrees is an error',
        ]
        for index, text_ in enumerate(descriptions):
            self.InputParams[index].Description = text_
        self._check_outputs()
        if LIBRARY_PROBLEM is None:
            csc_gh.dev_reload(globals())

    def RunScript(self,
            Curves: list[Rhino.Geometry.Curve],
            Spec: list[object],
            Diameter: list[float],
            SnapshotID: str,
            Basis: str,
            ObservedAt: str,
            DocumentTitle: str,
            DocumentDate: str,
            DocumentReference: str,
            InstrumentKind: str,
            InstrumentModel: str,
            AccuracyNote: str,
            Notes: str,
            DocumentUrl: str,
            DocumentRetrievedAt: str,
            ComponentPassport: str):
        if self._stop():
            return empty_outputs()
        Evidence = empty_outputs()
        try:
            curves = [c for c in (Curves or []) if c is not None]
            if not curves:
                raise MissingInput('Input Curves failed to collect data')
            specs = list(Spec or [])
            diameters = list(Diameter or [])
            if not diameters:
                raise MissingInput('Input Diameter failed to collect data')
            for name, items in (('Spec', specs), ('Diameter', diameters)):
                if name == 'Spec' and not items:
                    continue          # the steel grade is optional (8.187)
                if len(items) not in (1, len(curves)):
                    raise BuildError(
                        f'give one {name} for all bars or one per bar '
                        f'({len(curves)} curves, {len(items)} values)')
            target = layout_target(ComponentPassport, SnapshotID)
            if not target['snapshot_id']:
                raise MissingInput(
                    'SnapshotID is missing: give it, or a ComponentPassport',
                    ('SnapshotID', 'ComponentPassport'))
            scale, unit_name = mm_per_document_unit()
            bars = []
            for index, curve in enumerate(curves):
                bars.append({
                    'spec': (specs[0] if len(specs) == 1 else specs[index])
                    if specs else None,
                    'diameter_mm': (diameters[0] if len(diameters) == 1
                                    else diameters[index]),
                    'points': curve_points(curve),
                })
            bars = bars_to_stored(bars, target['placement'])
            record = reinforcement_layout_record(
                target['snapshot_id'], bars, Basis, ObservedAt,
                DocumentTitle, DocumentDate, DocumentReference,
                InstrumentKind, None, InstrumentModel, AccuracyNote, None,
                Notes, DocumentUrl, DocumentRetrievedAt)
            Evidence = json.dumps(record)
            self._addRemark(target['remark'])
            note = unit_warning(scale, unit_name)
            if note:
                self._addWarning(note)
            return Evidence
        except MissingInput as error:
            self._addWarning(str(error))
            return self._no_result(*error.ports)
        except BuildError as error:
            self._addError(str(error))
            return null_outputs()
        except ValueError as error:
            self._addError(str(error))
            return null_outputs()
        except Exception as error:
            msg = f'Unexpected error: {error}'
            self._addError(msg)
            return null_outputs()
        return Evidence
# ---------- end reinforcementlayout ----------
evidence = Data(reinforcementlayout)

# ---- group: __DDU_CSC_EXAMPLE_01__
# comments & notes: We create a grid to display the components in an ordered fashion. This creates the grid based on the component bounding boxes.
# 
# NOTE: The component does NOT transform the components, it only puts out the tranformation to be applied.
# Step 3
spacing_2 = Slider(150, range=0..1000)
componentpassport_18 = Data(componentpassport_2)
insertionpoint_2 = Point(Point(0, 0, 0))
createarrangement_2 = CreateArrangement(ComponentPassport=componentpassport_18, Spacing=spacing_2, InsertionPoint=insertionpoint_2)  # -> GridCells, GridPlanes, XForms; inputs ComponentPassport: tree, Spacing: Double, InsertionPoint: Point3d; same code as createarrangement
xform_2 = Data(createarrangement_2.XForms)
curvepreviewlw_2 = CurvePreviewLW(Curves=flatten(createarrangement_2.GridCells), Thickness=1)  # inputs Curves: list of Curve, Colors: list of Color, Thickness: list of Int32; same code as curvepreviewlw

# ----
# comments & notes: Transform (Move, Rotate...) Components by modifying the iframe attribute
componentpassport_19 = Data(componentpassport_8)
xform_3 = Data(xform)
transformcomponent = TransformComponent(ComponentPassport=componentpassport_19, XForm=xform_3)  # -> XComponentPassport; inputs ComponentPassport: String, XForm: Transform
# ---------- transformcomponent: Python ----------
#! python3
# -*- coding: utf-8 -*-
# venv: DDU_CSC
print('ENV OK!')
# r: charset_normalizer
# r: requests

# PYTHON STANDARD LIBRARY IMPORTS ---------------------------------------------
import json  # NOQA

# RHINO AND GH RELATED IMPORTS ------------------------------------------------
import System  # NOQA
import Rhino  # NOQA
import Grasshopper  # NOQA

# GHENV COMPONENT SETTINGS ----------------------------------------------------
ghenv.Component.Name = 'TransformComponent'  # NOQA
ghenv.Component.NickName = 'TransformComponent'  # NOQA
ghenv.Component.Category = 'DDU_CSC'  # NOQA
ghenv.Component.SubCategory = '3 Component Operations'  # NOQA
ghenv.Component.Description = (  # NOQA
    'Applies a Rhino transformation to the client-side placement '
    '(csc_placement, the frame the stored geometry sits in) of a component '
    'snapshot in component passport JSON ({identity, snapshots[]}). The placement is '
    'never sent to the server.'
)

# OPTIONAL HELPERS: they never block the component (decisions 8.112, 8.113) ---
try:
    from csc_gh.ports import ensure_outputs
    from csc_gh.messages import set_state, waits_for_data
except ImportError:
    ensure_outputs = set_state = waits_for_data = None

OUTPUTS = [
    ('XComponentPassport', 'XComponentPassport',
     'Transformed component passport JSON string ({identity, snapshot})!'),
]


def empty_outputs():
    """What RunScript returns when it stops early or has no result: an empty
    Grasshopper tree per output (never '' or None)."""
    if not OUTPUTS:
        return None
    trees = tuple(Grasshopper.DataTree[System.Object]() for _ in OUTPUTS)
    return trees[0] if len(trees) == 1 else trees


def null_outputs():
    """One null per output: an item of an item-access component that has no
    result keeps its slot (decision 8.186)."""
    if len(OUTPUTS) <= 1:
        return None
    return tuple(None for _ in OUTPUTS)


class CSC_TransformComponent(Grasshopper.Kernel.GH_ScriptInstance):
    """
    Author: Max Benjamin Eschenbach
    License: MIT License
    Version: 261102
    """

    _outputs_ready = True       # set by BeforeRunScript (8.112)
    _outputs_note = None

    def __init__(self):
        """Initialize this component and set component parameters."""
        super().__init__()
        # initialize props
        self.Component = ghenv.Component  # NOQA
        self.InputParams = self.Component.Params.Input
        self.OutputParams = self.Component.Params.Output

    def _addRemark(self, msg: str = ''):
        """Add a remark message to the component."""
        rml = self.Component.RuntimeMessageLevel.Remark
        self.AddRuntimeMessage(rml, msg)

    def _addWarning(self, msg: str = ''):
        """Add a warning message to the component."""
        rml = self.Component.RuntimeMessageLevel.Warning
        self.AddRuntimeMessage(rml, msg)

    def _addError(self, msg: str = ''):
        """Add an error message to the component."""
        rml = self.Component.RuntimeMessageLevel.Error
        self.AddRuntimeMessage(rml, msg)

    def _state(self, text=''):
        """The one short state under the component (decision 8.113)."""
        if set_state is not None:
            set_state(self.Component, text)

    def _no_result(self, *ports):
        """The result of an iteration without one (decision 8.186): empty
        outputs when the inputs in ``ports`` carry no data at all (the
        component waits for data; no ports: a list or tree input is empty),
        else a null in the slot of this item, so the outputs stay one to one
        with the input list."""
        if not ports or (waits_for_data is not None
                         and waits_for_data(self, ports)):
            return empty_outputs()
        return null_outputs()

    def _stop(self):
        """True when RunScript has to return early: the outputs were just
        updated (says why)."""
        if self._outputs_note:
            self._addRemark(self._outputs_note)
        return not self._outputs_ready

    def _check_outputs(self):
        """Make the outputs match OUTPUTS before the script runs (8.112)."""
        self._outputs_ready, self._outputs_note = True, None
        if ensure_outputs is None:
            self._outputs_note = (
                'output check skipped: CSC library not installed')
            return
        status = ensure_outputs(self.Component, OUTPUTS)
        self._outputs_ready, self._outputs_note = status.ready, status.remark

    def BeforeRunScript(self):
        """Perform some setup actions."""
        # Initialize input param descriptions
        self.InputParams[0].Description = (
            'Component passport JSON string ({identity, snapshot}) from previous '
            'components.'
        )
        self.InputParams[1].Description = (
            'Rhino transform to apply to the snapshot placement.'
        )
        # Initialize output param descriptions
        self._check_outputs()

    def PlaneToFrameDict(self, plane: Rhino.Geometry.Plane) -> dict:
        """
        Convert a Rhino plane to a frame dictionary format.

        This method converts the plane's origin and axis vectors to the format
        expected by the component system for placements.

        Args:
            plane: Rhino.Geometry.Plane object

        Returns:
            Dictionary with 'o', 'x', 'y', 'z' keys containing coordinate lists
        """
        iframe = {
            'o': [plane.OriginX, plane.OriginY, plane.OriginZ],
            'x': [plane.XAxis.X, plane.XAxis.Y, plane.XAxis.Z],
            'y': [plane.YAxis.X, plane.YAxis.Y, plane.YAxis.Z],
            'z': [plane.ZAxis.X, plane.ZAxis.Y, plane.ZAxis.Z]
        }
        return iframe

    def RunScript(self, ComponentPassport: str, XForm: Rhino.Geometry.Transform):
        # set up output trees and results tuple
        if self._stop():
            return empty_outputs()
        XComponentPassport = System.Collections.Generic.List[System.Object]()
        # reset message
        # Validate input parameters
        if not ComponentPassport:
            msg = 'Input ComponentPassport failed to collect data!'
            self._addWarning(msg)
            return self._no_result('ComponentPassport')

        if not XForm:
            msg = 'Input XForm failed to collect data!'
            self._addWarning(msg)
            return self._no_result('XForm')

        try:
            # Load and parse passport JSON ({identity, snapshot})
            jcomp = json.loads(ComponentPassport)
            snapshots = jcomp.get('snapshots') or []
            snapshot = snapshots[0] if snapshots else None
            if not isinstance(snapshot, dict):
                msg = 'Component passport JSON has no snapshots to transform!'
                self._addError(msg)
                return null_outputs()

            # Process the placement
            try:
                # Try to extract the existing placement from snapshot
                iframe = snapshot['csc_placement']
                iplane = Rhino.Geometry.Plane(
                    Rhino.Geometry.Point3d(*iframe['o']),
                    Rhino.Geometry.Vector3d(*iframe['x']),
                    Rhino.Geometry.Vector3d(*iframe['y']),
                )
                self._addRemark(
                    'Using existing placement from snapshot'
                )
            except (KeyError, TypeError):
                # If there is no placement,
                # create world XY plane as default
                iplane = Rhino.Geometry.Plane.WorldXY
                self._addRemark(
                    'No placement found, using WorldXY plane'
                )

            # Apply the input transform to the placement plane
            iplane.Transform(XForm)

            # Replace the placement in the snapshot
            # with the transformed one
            snapshot['csc_placement'] = self.PlaneToFrameDict(iplane)

            # Convert back to JSON string for output
            XComponentPassport = json.dumps(jcomp)

            return XComponentPassport

        except json.JSONDecodeError as e:
            msg = f'Failed to parse component JSON data: {str(e)}'
            self._addError(msg)
            return null_outputs()

        except Exception as e:
            msg = f'Unexpected error during transformation: {str(e)}'
            self._addError(msg)
            return null_outputs()
# ---------- end transformcomponent ----------
componentpassport_20 = Data(transformcomponent)

# ---- group: __DDU_CSC_EXAMPLE_11__
# comments & notes: Convert the composite component data including all snapshots to a D2P in-memory Component
componentpassport_21 = Data(componentpassport_14)
passporttod2p = PassportToD2P(ComponentPassport=componentpassport_21, MeshMode="all", CloudMode="all", SnapshotScope="all")  # -> D2PComponent; inputs ComponentPassport: tree
# ---------- passporttod2p: Python ----------
#! python3
# -*- coding: utf-8 -*-
# venv: DDU_CSC
# r: charset_normalizer
# r: numpy==2.0.2
# r: d2p-core-py==0.1.2
print('ENV OK!')

# PYTHON STANDARD LIBRARY IMPORTS ---------------------------------------------
import json  # NOQA

# D2P WRAPPER IMPORTS ---------------------------------------------------------
from d2p_core import ComponentType, GHComponent, Member, Settings  # NOQA
from D2P.Core.Components.Primitives import BaseObject  # NOQA
from D2P.Core.Interfaces import IBaseObject  # NOQA

# RHINO AND GH RELATED IMPORTS ------------------------------------------------
import System  # NOQA
import Rhino  # NOQA
import Grasshopper  # NOQA
import scriptcontext as sc  # NOQA

# GHENV COMPONENT SETTINGS ----------------------------------------------------
ghenv.Component.Name = 'PassportToD2P'  # NOQA
ghenv.Component.NickName = 'PassportToD2P'  # NOQA
ghenv.Component.Category = 'DDU_CSC'  # NOQA
ghenv.Component.SubCategory = '9 D2P Components Interface'  # NOQA
ghenv.Component.Description = (  # NOQA
    'Converts component passport JSON into an in-memory D2P GHComponent. Geometry '
    'is registered as a nested Member tree via SetMember (D2P ParentMember '
    '+ : layer paths) in the canonical orientation of the element (frame '
    'applied, centred at the origin) or where its csc_placement puts it; '
    'the component plane is the plane of the canonical element. Every baked '
    'component gets id_<identity> and snap_<snapshot> shells so layer paths '
    'stay consistent for single- and multi-snapshot component passport and distinct '
    'across catalog identities. The D2P type id comes from the original '
    'function (IFC class). Optional Parent prefixes ShortName for D2P child '
    'naming. The convention user text (csc_identity_id, csc_snapshot_id, '
    'csc_placement, csc_component) is stored on the geometry objects of the '
    'component (D2P commits its label without user text): ReadFromD2P and '
    'SyncWithRhinoDoc read it back. '
    'MeshMode: best | inline | reduced | detailed | all. '
    'CloudMode: best | inline | detailed | all (optional; defaults to '
    'MeshMode, with reduced mapped to inline). '
    'SnapshotScope: current | all.'
)

# CSC LIBRARY (decision 8.111) ----------------------------------------------
CSC_GH_MINIMUM = '261005'
LIBRARY_PROBLEM = None
try:
    import csc_gh
    csc_gh.require(CSC_GH_MINIMUM)
    from csc_gh.read import (authored_only, drawable_proxies)  # NOQA
    from csc_gh.convention import (ConventionError, KEY_COMPONENT, d2p_type_id, d2p_type_name, frame_of, part_values, piece_plane, resolve_placement, tag_values)  # NOQA
    from csc_gh.rhino import (placement_transform, plane_from_frame, proxy_to_rhino)  # NOQA
    from csc_gh.doc import (marker_points)  # NOQA
except ImportError:
    LIBRARY_PROBLEM = (
        'CSC library 261005 too old or missing: run CSC_Update, '
        'then restart Rhino')


# Mesh resolution preference for MeshMode=best (highest fidelity first)
_MESH_BEST_CHAIN = ('detailed', 'reduced', 'inline')
# Point clouds have no reduced PLY; best prefers the full cloud then inline.
_CLOUD_BEST_CHAIN = ('detailed', 'inline')

# OPTIONAL HELPERS: they never block the component (decisions 8.112, 8.113) ---
try:
    from csc_gh.ports import ensure_outputs
    from csc_gh.messages import set_state
except ImportError:
    ensure_outputs = set_state = None

OUTPUTS = [
    ('D2PComponent', 'D2PComponent',
     'In-memory D2P GHComponent (.NET IComponentBase) per component passport entry. RetrieveGeometry accepts layer segments such as id_, snap_, Mesh, 00, or detailed (recursive).'),
]


def empty_outputs():
    """What RunScript returns when it stops early or has no result: an empty
    Grasshopper tree per output (never '' or None)."""
    if not OUTPUTS:
        return None
    trees = tuple(Grasshopper.DataTree[System.Object]() for _ in OUTPUTS)
    return trees[0] if len(trees) == 1 else trees


class _MemberTree:
    """
    Builds a D2P-native member hierarchy (shell parents + geometry leaves).

    Children are attached with SetMember so the wrapper can unwrap Python
    Member objects and so ParentMember / nested DynamicMembers stay in
    sync (same pattern as D2P.Core.Utility.Members.FindMembers).

    D2P writes the label of a component with fresh attributes when it
    commits, so user text set on the label is lost; the geometry objects keep
    theirs. ``text`` (the two ids) goes on every object of the leaves added
    while it is set, ``carrier`` (the full convention values) on the first
    object only; ReadFromD2P and SyncWithRhinoDoc merge the keys of a group.
    """

    def __init__(self, component, layer_color):
        self._component = component
        self._color = layer_color
        self._shells = {}
        self.has_members = False
        self.text = {}
        self.carrier = None

    def _attach(self, member, parent=None):
        if parent is not None:
            parent.SetMember(member)
        else:
            self._component.SetMember(member)
        self.has_members = True
        return member

    def _shell(self, key, layer_name, parent=None):
        if key in self._shells:
            return self._shells[key]
        member = Member(self._component, layer_name, self._color)
        self._shells[key] = member
        return self._attach(member, parent)

    def _base_object(self, geometry):
        """The geometry with attributes holding the user text."""
        attributes = Rhino.DocObjects.ObjectAttributes()
        values = dict(self.text)
        if self.carrier:
            values.update(self.carrier)
            self.carrier = None
        for key, value in values.items():
            attributes.SetUserString(key, str(value))
        return BaseObject(geometry, attributes)

    def _parent_of(self, path_segments):
        parent = None
        for i, segment in enumerate(path_segments[:-1]):
            key = tuple(path_segments[:i + 1])
            parent = self._shell(key, segment, parent)
        return parent

    def add_leaf(self, path_segments, geometry):
        if geometry is None or not path_segments:
            return
        parent = self._parent_of(path_segments)
        leaf = Member(
            self._component, path_segments[-1], self._color)
        leaf.SetObject(self._base_object(geometry))
        self._attach(leaf, parent)

    def add_leaf_many(self, path_segments, geometries):
        if not geometries or not path_segments:
            return
        parent = self._parent_of(path_segments)
        leaf = Member(
            self._component, path_segments[-1], self._color)
        objects = System.Collections.Generic.List[IBaseObject]()
        for geometry in geometries:
            objects.Add(self._base_object(geometry))
        leaf.SetObjects(objects)
        self._attach(leaf, parent)


class CSC_PassportToD2P(Grasshopper.Kernel.GH_ScriptInstance):
    """
    Author: Max Benjamin Eschenbach
    License: MIT License
    Version: 261102

    D2P member layer taxonomy (SetMember tree)
    -----------------------------------------
    Shell members group geometry; leaves hold Rhino geometry.
    Nested members are attached with SetMember (sets ParentMember).

    Every member path always starts with catalog identity, then snapshot:

        id_<8> -> snap_<8> -> Mesh -> 00 -> detailed
        id_<8> -> snap_<8> -> PointCloud -> 00 -> detailed
        id_<8> -> snap_<8> -> Proxy -> 00         (authored shapes)
        id_<8> -> snap_<8> -> Marker -> 00        (capture markers)

    id_* distinguishes catalog identities when baking (D2P shares type
    root layers across instances). snap_* is always present so single- and
    multi-snapshot passport share the same depth.

    D2P component naming (optional Parent input)
    --------------------------------------------
    ShortName = parent.ShortName + NameDelimiter + snapshot.name
    (same rule as D2P CreateComponent). Does NOT use CSC parent_identities.

    Placement (8.98)
    ----------------
    Geometry is drawn at T = placement_transform(Q), Q = the passport's
    csc_placement, else the placement that puts the piece in its frame. The
    component plane (the label) is P = Q . frame, the plane of the canonical
    piece, which is what csc_placement means in the user text. The ids go on
    every geometry object, the full convention on the first one.
    """

    _outputs_ready = True       # set by BeforeRunScript (8.112)
    _outputs_note = None

    def __init__(self):
        """Initialize this component and set component parameters."""
        super().__init__()
        self.Component = ghenv.Component  # NOQA
        self.InputParams = self.Component.Params.Input
        self.OutputParams = self.Component.Params.Output

    def _addRemark(self, msg: str = ''):
        rml = self.Component.RuntimeMessageLevel.Remark
        self.AddRuntimeMessage(rml, msg)

    def _addWarning(self, msg: str = ''):
        rml = self.Component.RuntimeMessageLevel.Warning
        self.AddRuntimeMessage(rml, msg)

    def _addError(self, msg: str = ''):
        rml = self.Component.RuntimeMessageLevel.Error
        self.AddRuntimeMessage(rml, msg)

    def _state(self, text=''):
        """The one short state under the component (decision 8.113)."""
        if set_state is not None:
            set_state(self.Component, text)

    def _stop(self):
        """True when RunScript has to return early: the library is missing or
        too old, or the outputs were just updated (says why)."""
        if LIBRARY_PROBLEM:
            self._addError(LIBRARY_PROBLEM)
            return True
        if self._outputs_note:
            self._addRemark(self._outputs_note)
        return not self._outputs_ready

    def _check_outputs(self):
        """Make the outputs match OUTPUTS before the script runs (8.112)."""
        self._outputs_ready, self._outputs_note = True, None
        if ensure_outputs is None:
            self._outputs_note = (
                'output check skipped: CSC library not installed')
            return
        status = ensure_outputs(self.Component, OUTPUTS)
        self._outputs_ready, self._outputs_note = status.ready, status.remark

    def BeforeRunScript(self):
        self.InputParams[0].Description = (
            'Component passport JSON ({identity, snapshot} or future {snapshots[]}) '
            'from CSC catalog components.'
        )
        if self.InputParams.Count > 1:
            self.InputParams[1].Description = (
                "Mesh resolution: 'best' (default), 'inline', 'reduced', "
                "'detailed', or 'all' (register every available variant "
                'as separate leaf members).'
            )
        if self.InputParams.Count > 2:
            self.InputParams[4].Description = (
                "Point-cloud resolution: 'best' (default), 'inline', "
                "'detailed', or 'all'. 'reduced' is accepted as an alias "
                'for inline (no reduced point-cloud PLY exists). Empty '
                'inherits MeshMode (reduced maps to inline).'
            )
        if self.InputParams.Count > 3:
            self.InputParams[2].Description = (
                "Snapshot scope: 'current' (default) uses snapshots[0] "
                "only; 'all' includes every passport.snapshots[] entry. "
                'Each snapshot is always under a snap_* member shell.'
            )
        if self.InputParams.Count > 4:
            delim = Settings.NameDelimiter
            self.InputParams[3].Description = (
                'Optional D2P parent component (Generic) or parent ShortName '
                f'(text). Child ShortName becomes parent{delim}name '
                'for D2P parent-child retrieval. '
                'Ignores CSC parent_identities.'
            )
        self._check_outputs()
        if LIBRARY_PROBLEM is None:
            csc_gh.dev_reload(globals())

    def _normalize_mode(self, value: str, allowed: tuple, default: str) -> str:
        key = (value or default).strip().lower()
        if key in allowed:
            return key
        self._addWarning(
            f'Unknown mode {value!r}, using {default!r}'
        )
        return default

    def _type_id(self, original_function: str) -> str:
        return d2p_type_id(original_function)

    def _type_name(self, original_function: str) -> str:
        return d2p_type_name(original_function)

    def _snapshot_id(self, snapshot: dict) -> str:
        return str(snapshot.get('_id') or snapshot.get('id') or '')

    def _snapshot_color(self, snapshot: dict) -> tuple:
        color = snapshot.get('color') or [110, 110, 110]
        try:
            return (int(color[0]), int(color[1]), int(color[2]))
        except (TypeError, ValueError, IndexError):
            return (110, 110, 110)

    def _single(self, identity: dict, snapshot: dict) -> dict:
        """A passport of one snapshot (the placement key sits on it)."""
        return {'identity': identity, 'snapshots': [snapshot]}

    def _placement(self, identity: dict, snapshot: dict) -> dict:
        """Q: the placement of the stored geometry of a snapshot (its own
        csc_placement, else the one that puts it in its frame)."""
        placed = resolve_placement(self._single(identity, snapshot))
        if placed is None:
            raise ConventionError(
                'the snapshot has no frame yet (geometry still being '
                'processed?)')
        return placed

    def _xform(self, identity: dict, snapshot: dict):
        return placement_transform(self._placement(identity, snapshot))

    def _identity_scope_label(self, identity: dict) -> str:
        iid = str(
            identity.get('_id') or identity.get('id') or ''
        ).replace('-', '')
        if not iid:
            return 'id_unknown'
        return f'id_{iid[:8]}'

    def _snapshot_scope_label(self, snapshot: dict) -> str:
        sid = self._snapshot_id(snapshot).replace('-', '')
        if not sid:
            return 'snap_unknown'
        return f'snap_{sid[:8]}'

    def _geometry_path(
            self,
            identity_label: str,
            snapshot_label: str,
            kind: str,
            index: int,
            source: str = None) -> list:
        path = [identity_label, snapshot_label, kind, f'{index:02d}']
        if source:
            path.append(source)
        return path

    def _resolve_parent_short_name(self, parent) -> str:
        if parent is None:
            return ''
        if isinstance(parent, str):
            return parent.strip()
        if hasattr(parent, 'ShortName'):
            name = parent.ShortName
            if name:
                return str(name)
        if hasattr(parent, 'NetObj'):
            net = parent.NetObj
            if hasattr(net, 'ShortName') and net.ShortName:
                return str(net.ShortName)
        text = str(parent).strip()
        return text if text and text != 'None' else ''

    def _child_short_name(self, base_name: str, parent) -> str:
        parent_name = self._resolve_parent_short_name(parent)
        if not parent_name:
            return base_name
        delimiter = Settings.NameDelimiter
        if delimiter in base_name:
            self._addRemark(
                f'ShortName {base_name!r} contains D2P name delimiter '
                f'{delimiter!r}; parent-child retrieval may be ambiguous'
            )
        return f'{parent_name}{delimiter}{base_name}'

    def _user_text(
            self,
            identity: dict,
            snapshot: dict,
            passport_json: str = None):
        """``(ids, carrier)``: the user text of every object of the piece
        (the two ids) and of the first one (the convention values and the
        descriptive keys of the identity)."""
        single = self._single(identity, snapshot)
        ids = part_values(single)
        carrier = tag_values(single)
        if passport_json:
            carrier[KEY_COMPONENT] = passport_json
        parent_identities = identity.get('parent_identities')
        if parent_identities:
            carrier['csc_parent_identities'] = json.dumps(parent_identities)
        if identity.get('original_function') is not None:
            carrier['csc_original_function'] = str(
                identity.get('original_function'))
        if identity.get('material') is not None:
            carrier['csc_material'] = str(identity.get('material'))
        if snapshot.get('fragment') is not None:
            carrier['csc_fragment'] = str(bool(snapshot['fragment']))
        return ids, carrier

    def _iter_snapshot_blocks(self, passport: dict, snapshot_scope: str):
        """Yield snapshot dicts from passport.snapshots[]."""
        snapshots = passport.get('snapshots') or []
        if not isinstance(snapshots, list):
            snapshots = []

        if snapshot_scope == 'all':
            for snap in snapshots:
                if isinstance(snap, dict):
                    yield snap
            return

        if snapshots and isinstance(snapshots[0], dict):
            yield snapshots[0]

    def _get_auth_core(self):
        return sc.sticky.get('CSC_AuthCore')

    def _build_inline_mesh(self, mesh_data: dict, default_color: tuple):
        vertices = mesh_data.get('vertices')
        faces = mesh_data.get('faces')
        if not vertices or not faces:
            return None

        mesh = Rhino.Geometry.Mesh()
        for v in vertices:
            mesh.Vertices.Add(float(v[0]), float(v[1]), float(v[2]))
        for f in faces:
            if len(f) == 3:
                mesh.Faces.AddFace(f[0], f[1], f[2])
            elif len(f) == 4:
                mesh.Faces.AddFace(f[0], f[1], f[2], f[3])

        colors = mesh_data.get('colors')
        if colors:
            for c in colors:
                mesh.VertexColors.Add(int(c[0]), int(c[1]), int(c[2]))
        else:
            r, g, b = default_color
            for _ in range(len(vertices)):
                mesh.VertexColors.Add(r, g, b)

        mesh.Normals.ComputeNormals()
        mesh.Compact()
        return mesh

    def _fetch_ply_mesh(self, auth_core, snapshot_id: str,
                        mesh_index: int, resolution: str):
        if not auth_core:
            return None
        mesh, _etag, _cached = auth_core.cached_get_snapshot_mesh(
            snapshot_id, mesh_index, resolution)
        return mesh

    def _mesh_sources_for_index(
            self,
            mesh_mode: str,
            ply_available: list,
            inline_available: bool) -> list:
        ply_set = {r.strip().lower() for r in (ply_available or [])}

        if mesh_mode == 'all':
            sources = []
            if inline_available:
                sources.append('inline')
            for res in ('reduced', 'detailed'):
                if res in ply_set:
                    sources.append(res)
            return sources

        if mesh_mode in ('reduced', 'detailed'):
            if mesh_mode in ply_set:
                return [mesh_mode]
            if inline_available and mesh_mode == 'reduced':
                return ['inline']
            return []

        if mesh_mode == 'inline':
            return ['inline'] if inline_available else []

        for res in _MESH_BEST_CHAIN:
            if res == 'inline' and inline_available:
                return ['inline']
            if res in ply_set:
                return [res]
        return ['inline'] if inline_available else []

    def _resolve_cloud_mode(self, cloud_mode, mesh_mode: str) -> str:
        """
        CloudMode when set; otherwise inherit MeshMode (reduced -> inline).
        """
        if cloud_mode is None or (
                isinstance(cloud_mode, str) and not cloud_mode.strip()):
            if mesh_mode == 'reduced':
                return 'inline'
            return mesh_mode
        return self._normalize_mode(
            str(cloud_mode),
            ('best', 'inline', 'reduced', 'detailed', 'all'),
            'best',
        )

    def _fetch_ply_point_cloud(self, auth_core, snapshot_id: str, index: int):
        if not auth_core:
            return None
        return auth_core.cached_get_snapshot_point_cloud(
            snapshot_id, index)

    def _cloud_sources_for_index(
            self,
            cloud_mode: str,
            inline_available: bool) -> list:
        if cloud_mode == 'all':
            sources = []
            if inline_available:
                sources.append('inline')
            sources.append('detailed')
            return sources
        if cloud_mode in ('inline', 'reduced'):
            return ['inline'] if inline_available else []
        if cloud_mode == 'detailed':
            return ['detailed']
        sources = []
        for res in _CLOUD_BEST_CHAIN:
            if res == 'inline' and inline_available:
                sources.append('inline')
            elif res == 'detailed':
                sources.append('detailed')
        if not sources and inline_available:
            return ['inline']
        return sources

    def _build_point_cloud(self, pc_data: dict):
        cloud = Rhino.Geometry.PointCloud()
        pts = pc_data.get('points', [])
        if not pts:
            return None
        cl = pc_data.get('colors')
        if cl and len(cl) == len(pts):
            for p, c in zip(pts, cl):
                cloud.Add(
                    Rhino.Geometry.Point3d(p[0], p[1], p[2]),
                    System.Drawing.Color.FromArgb(*c),
                )
        else:
            for p in pts:
                cloud.Add(Rhino.Geometry.Point3d(p[0], p[1], p[2]))
        return cloud

    def _build_members_for_snapshot(
            self,
            tree: _MemberTree,
            snapshot: dict,
            identity_label: str,
            snapshot_label: str,
            identity_id: str,
            mesh_mode: str,
            cloud_mode: str,
            auth_core,
            xform):
        geometry = snapshot.get('geometry', {}) or {}
        if not geometry:
            return

        snapshot_color = self._snapshot_color(snapshot)
        snapshot_id = self._snapshot_id(snapshot)
        res_map = snapshot.get('mesh_ply_resolutions', {}) or {}
        inline_meshes = geometry.get('meshes', []) or []

        # authored shapes (a web-authored box, a migrated extrusion) of a
        # piece that has no mesh and no cloud: from proxy params + placement
        if authored_only(snapshot):
            for idx, proxy in drawable_proxies(snapshot):
                if (proxy.get('fit') or {}).get('method') != 'authored':
                    continue
                shape = proxy_to_rhino(proxy)
                if shape is None:
                    continue
                shape.Transform(xform)
                tree.add_leaf(
                    self._geometry_path(
                        identity_label, snapshot_label, 'Proxy', idx),
                    shape,
                )

        for idx, mesh_data in enumerate(inline_meshes):
            ply_available = res_map.get(str(idx), []) or []
            inline_ok = bool(
                mesh_data.get('vertices') and mesh_data.get('faces'))
            for source in self._mesh_sources_for_index(
                    mesh_mode, ply_available, inline_ok):
                mesh = None
                if source == 'inline':
                    mesh = self._build_inline_mesh(mesh_data, snapshot_color)
                elif snapshot_id and auth_core:
                    mesh = self._fetch_ply_mesh(
                        auth_core, snapshot_id, idx, source)
                if mesh is None:
                    if source != 'inline':
                        self._addRemark(
                            f'PLY {source} unavailable for mesh {idx} '
                            f'({snapshot_id or identity_id})')
                    continue
                mesh.Transform(xform)
                tree.add_leaf(
                    self._geometry_path(
                        identity_label, snapshot_label,
                        'Mesh', idx, source),
                    mesh,
                )

        for idx, pc_data in enumerate(geometry.get('point_clouds', []) or []):
            inline_ok = bool(
                isinstance(pc_data, dict)
                and (pc_data.get('points') or [])
            )
            placed = False
            for source in self._cloud_sources_for_index(
                    cloud_mode, inline_ok):
                if cloud_mode == 'best' and placed:
                    break
                cloud = None
                if source == 'inline':
                    cloud = self._build_point_cloud(pc_data)
                elif snapshot_id and auth_core:
                    try:
                        cloud = self._fetch_ply_point_cloud(
                            auth_core, snapshot_id, idx)
                    except Exception as e:
                        self._addWarning(
                            'Point cloud PLY fetch failed '
                            f'for index {idx}: {str(e)}')
                if cloud is None:
                    if source != 'inline':
                        self._addRemark(
                            f'PLY detailed unavailable for point cloud '
                            f'{idx} ({snapshot_id or identity_id})')
                    continue
                cloud.Transform(xform)
                tree.add_leaf(
                    self._geometry_path(
                        identity_label, snapshot_label,
                        'PointCloud', idx, source),
                    cloud,
                )
                placed = True

        markers = [Rhino.Geometry.Point(point)
                   for _, _, point in marker_points(snapshot, xform)]
        if markers:
            tree.add_leaf_many(
                self._geometry_path(
                    identity_label, snapshot_label, 'Marker', 0),
                markers,
            )

    def _passport_to_d2p(
            self,
            passport: dict,
            mesh_mode: str,
            snapshot_scope: str,
            parent=None,
            passport_json: str = None,
            cloud_mode: str = 'best'):
        identity = passport.get('identity') or {}
        snapshots = list(self._iter_snapshot_blocks(passport, snapshot_scope))
        if not identity or not snapshots:
            raise ValueError(
                'Component passport JSON missing identity or snapshot data')

        primary = snapshots[0]
        # the placement first: a piece without a frame cannot be placed
        placement = self._placement(identity, primary)
        original_function = identity.get('original_function')
        type_id = self._type_id(original_function)
        type_name = self._type_name(original_function)
        layer_color = self._snapshot_color(primary)
        component_type = ComponentType(
            type_id,
            type_name,
            LabelSize=2.5,
            LayerColor=layer_color,
        )

        base_name = str(
            primary.get('name') or identity.get('_id') or 'Component')
        short_name = self._child_short_name(base_name, parent)
        # the plane of the canonical piece: P = Q . frame
        plane = plane_from_frame(
            piece_plane(placement, frame_of(primary)))
        component = GHComponent(component_type, short_name, plane)

        ids, carrier = self._user_text(identity, primary, passport_json)

        identity_label = self._identity_scope_label(identity)
        auth_core = self._get_auth_core()
        ply_needed = (
            mesh_mode in ('best', 'reduced', 'detailed', 'all')
            or cloud_mode in ('best', 'detailed', 'all')
        )
        if ply_needed and not auth_core:
            self._addRemark(
                'No CSC_AuthCore in sticky; PLY resolutions unavailable'
            )

        tree = _MemberTree(component, layer_color)
        for snapshot in snapshots:
            # the user text names the primary snapshot only
            tree.text, tree.carrier = (
                (ids, carrier) if snapshot is primary else ({}, None))
            self._build_members_for_snapshot(
                tree,
                snapshot,
                identity_label,
                self._snapshot_scope_label(snapshot),
                identity.get('_id') or 'unknown',
                mesh_mode,
                cloud_mode,
                auth_core,
                self._xform(identity, snapshot),
            )

        if not tree.has_members:
            self._addWarning(
                f'No geometry members created for {short_name} '
                f'({identity.get("_id")})'
            )

        return component

    def RunScript(self,
            ComponentPassport: Grasshopper.DataTree[object],
            MeshMode,
            CloudMode,
            SnapshotScope,
            Parent):
        if self._stop():
            return empty_outputs()
        Component = Grasshopper.DataTree[System.Object]()

        mesh_mode = self._normalize_mode(
            MeshMode,
            ('best', 'inline', 'reduced', 'detailed', 'all'),
            'best',
        )
        cloud_mode = self._resolve_cloud_mode(CloudMode, mesh_mode)
        snapshot_scope = self._normalize_mode(
            SnapshotScope,
            ('current', 'all'),
            'current',
        )

        if not ComponentPassport or ComponentPassport.DataCount == 0:
            msg = 'Input ComponentPassport failed to collect data!'
            self._addWarning(msg)
            return Component

        converted = 0
        try:

            for i in range(ComponentPassport.BranchCount):
                ghp = ComponentPassport.Paths[i]
                for comp_json in ComponentPassport.Branches[i]:
                    if not comp_json:
                        self._addWarning('Empty component passport entry, skipping')
                        continue
                    try:
                        passport = json.loads(comp_json)
                        d2p_component = self._passport_to_d2p(
                            passport,
                            mesh_mode,
                            snapshot_scope,
                            Parent,
                            comp_json,
                            cloud_mode,
                        )
                        Component.Add(d2p_component.NetObj, ghp)
                        converted += 1
                    except json.JSONDecodeError as e:
                        self._addError(f'Failed to parse component passport JSON: {e}')
                    except Exception as e:
                        self._addError(
                            f'Failed to convert component passport entry: {e}'
                        )

            if converted:
                self._state(f'Converted {converted}')
                self._addRemark(
                    f'Successfully converted {converted} component(s) '
                    f'(mesh={mesh_mode}, cloud={cloud_mode}, '
                    f'snapshots={snapshot_scope})'
                )
            return Component

        except Exception as e:
            msg = f'Unexpected error during conversion: {e}'
            self._addError(msg)
            return Component
# ---------- end passporttod2p ----------

# ---- group: __DDU_CSC_EXAMPLE_06__
# Step 2.1
# comments & notes: Optional: Offset the design shapes, making the "demanded" geometry larger.
# 
# This can increase the chances of finding components that are large enough to fit the entire cell.
number_slider_4 = Slider(0, range=0..500)
designshapes_2 = Data(designshapes)
offset = OffsetCurve(Curve=designshapes_2, Distance=number_slider_4, Corners=1)  # -> flatten(Curve)
designshapes_offset = Data(offset)

# ---- group: __DDU_CSC_EXAMPLE_09__
# comments & notes: Fetch all snapshots for a given identity
componentpassport_22 = Data(componentpassport_7)
fetchallsnapshots_2 = FetchAllSnapshots(Input=componentpassport_22)  # -> ComponentPassport; same code as fetchallsnapshots
componentpassport_23 = Data(fetchallsnapshots_2)

# comments & notes: Fetch a specific snapshot by ID for a given identity input
componentpassport_24 = Data(componentpassport_7)
snapshotid_4 = Data(snapshotid_2)
fetchsnapshot = FetchSnapshot(Input=componentpassport_24, SnapshotID=snapshotid_4)  # -> ComponentPassport
# ---------- fetchsnapshot: Python ----------
#! python3
# -*- coding: utf-8 -*-
# venv: DDU_CSC
print('ENV OK!')
# r: charset_normalizer
# r: requests

# PYTHON STANDARD LIBRARY IMPORTS ---------------------------------------------
import json  # NOQA

# THIRD PARTY LIBRARY IMPORTS -------------------------------------------------
import requests  # NOQA

# RHINO AND GH RELATED IMPORTS ------------------------------------------------
import System  # NOQA
import Grasshopper  # NOQA
import Rhino  # NOQA
import scriptcontext as sc  # NOQA

# GHENV COMPONENT SETTINGS ----------------------------------------------------
ghenv.Component.Name = 'FetchSnapshot'  # NOQA
ghenv.Component.NickName = 'FetchSnapshot'  # NOQA
ghenv.Component.Category = 'DDU_CSC'  # NOQA
ghenv.Component.SubCategory = '2 Catalog Interface'  # NOQA
ghenv.Component.Description = (  # NOQA
    'Fetches component passport JSON for one identity and a specific snapshot '
    '({identity, snapshots:[one]}). Identity input can be a UUID or component passport '
    'JSON.'
)

# OPTIONAL HELPERS: they never block the component (decisions 8.112, 8.113) ---
try:
    from csc_gh.ports import ensure_outputs
    from csc_gh.messages import set_state, waits_for_data
except ImportError:
    ensure_outputs = set_state = waits_for_data = None

OUTPUTS = [
    ('ComponentPassport', 'ComponentPassport',
     'Component passport JSON string: {identity, snapshots:[requested snapshot]}'),
]


def empty_outputs():
    """What RunScript returns when it stops early or has no result: an empty
    Grasshopper tree per output (never '' or None)."""
    if not OUTPUTS:
        return None
    trees = tuple(Grasshopper.DataTree[System.Object]() for _ in OUTPUTS)
    return trees[0] if len(trees) == 1 else trees


def null_outputs():
    """One null per output: an item of an item-access component that has no
    result keeps its slot (decision 8.186)."""
    if len(OUTPUTS) <= 1:
        return None
    return tuple(None for _ in OUTPUTS)


class CSC_FetchSnapshot(Grasshopper.Kernel.GH_ScriptInstance):
    """
    Author: Max Benjamin Eschenbach
    License: MIT License
    Version: 261102
    """

    _outputs_ready = True       # set by BeforeRunScript (8.112)
    _outputs_note = None

    def __init__(self):
        super().__init__()
        self.Component = ghenv.Component  # NOQA
        self.InputParams = self.Component.Params.Input
        self.OutputParams = self.Component.Params.Output

    def _addRemark(self, msg: str = ''):
        rml = self.Component.RuntimeMessageLevel.Remark
        self.AddRuntimeMessage(rml, msg)

    def _addWarning(self, msg: str = ''):
        rml = self.Component.RuntimeMessageLevel.Warning
        self.AddRuntimeMessage(rml, msg)

    def _addError(self, msg: str = ''):
        rml = self.Component.RuntimeMessageLevel.Error
        self.AddRuntimeMessage(rml, msg)

    def _state(self, text=''):
        """The one short state under the component (decision 8.113)."""
        if set_state is not None:
            set_state(self.Component, text)

    def _no_result(self, *ports):
        """The result of an iteration without one (decision 8.186): empty
        outputs when the inputs in ``ports`` carry no data at all (the
        component waits for data; no ports: a list or tree input is empty),
        else a null in the slot of this item, so the outputs stay one to one
        with the input list."""
        if not ports or (waits_for_data is not None
                         and waits_for_data(self, ports)):
            return empty_outputs()
        return null_outputs()

    def _stop(self):
        """True when RunScript has to return early: the outputs were just
        updated (says why)."""
        if self._outputs_note:
            self._addRemark(self._outputs_note)
        return not self._outputs_ready

    def _check_outputs(self):
        """Make the outputs match OUTPUTS before the script runs (8.112)."""
        self._outputs_ready, self._outputs_note = True, None
        if ensure_outputs is None:
            self._outputs_note = (
                'output check skipped: CSC library not installed')
            return
        status = ensure_outputs(self.Component, OUTPUTS)
        self._outputs_ready, self._outputs_note = status.ready, status.remark

    def BeforeRunScript(self):
        self.InputParams[0].Description = (
            'Identity UUID or component passport JSON ({identity, snapshots[]})'
        )
        self.InputParams[1].Description = 'Snapshot UUID to fetch'
        self._check_outputs()

    def get_auth_core_from_sticky(self):
        auth_core = sc.sticky.get('CSC_AuthCore')
        if auth_core is None:
            msg = ('No authentication found. Please use CSC_Session component '
                   'first.')
            self._addWarning(msg)
            return None
        return auth_core

    def RunScript(self, Input, SnapshotID):
        if self._stop():
            return empty_outputs()
        ComponentPassport = empty_outputs()

        auth_core = self.get_auth_core_from_sticky()
        if auth_core is None:
            return ComponentPassport

        if not auth_core.is_valid():
            msg = ('Authentication expired. Please use CSC_Session '
                   'component to refresh.')
            self._addWarning(msg)
            return ComponentPassport

        if Input is None or (isinstance(Input, str) and not str(Input).strip()):
            msg = 'Please provide an identity UUID or component passport JSON.'
            self._addWarning(msg)
            return self._no_result('Input')

        snapshot_id = str(SnapshotID or '').strip()
        if not snapshot_id:
            msg = 'Please provide a snapshot UUID.'
            self._addWarning(msg)
            return self._no_result('SnapshotID')
        if not auth_core.validate_uuid(snapshot_id):
            msg = 'Please provide a valid snapshot UUID.'
            self._addError(msg)
            return null_outputs()

        identity_id = auth_core.resolve_identity_id_from_input(Input)
        if not identity_id:
            msg = 'Input is not a valid identity UUID or component passport JSON.'
            self._addError(msg)
            return null_outputs()

        try:
            response = auth_core.cached_get_passport(
                identity_id,
                snapshots=[snapshot_id],
            )

            if response.status_code == 200:
                data = response.json()
                ComponentPassport = auth_core.passport_json_string(data)
                return ComponentPassport

            if response.status_code == 401:
                msg = 'Authentication failed. Please sign in again.'
            elif response.status_code == 404:
                msg = (
                    f'Identity {identity_id} or snapshot {snapshot_id} '
                    'not found.'
                )
            else:
                msg = f'Request failed with status code: {response.status_code}'
            self._addError(msg)

        except requests.exceptions.ConnectionError as e:
            msg = 'Cannot connect to server. Please check your connection.'
            self._addError(msg + f'\nFull Error: {str(e)}')
            return null_outputs()
        except requests.exceptions.Timeout as e:
            msg = 'Request timeout. Server may be slow.'
            self._addError(msg + f'\nFull Error: {str(e)}')
            return null_outputs()
        except Exception as e:
            msg = f'Unexpected error: {str(e)}'
            self._addError(msg)
            return null_outputs()

        return ComponentPassport
# ---------- end fetchsnapshot ----------
componentpassport_25 = Data(fetchsnapshot)

# ---- group: __DDU_CSC_EXAMPLE_11__
# comments & notes: Read the D2P components from the Rhino document and create ComponentPassports from it
toggle = BooleanToggle(False)
readfromd2p = ReadFromD2P(Read=toggle)  # -> ComponentPassport, Component; inputs Read: Boolean
# ---------- readfromd2p: Python ----------
#! python3
# -*- coding: utf-8 -*-
# venv: DDU_CSC
# r: charset_normalizer
# r: numpy==2.0.2
# r: d2p-core-py==0.1.2
print('ENV OK!')

# PYTHON STANDARD LIBRARY IMPORTS ---------------------------------------------
import json  # NOQA

# D2P WRAPPER IMPORTS ---------------------------------------------------------
from d2p_core.utility.instantiation import instance_from_object  # NOQA

# RHINO AND GH RELATED IMPORTS ------------------------------------------------
import System  # NOQA
import Rhino  # NOQA
import Grasshopper  # NOQA
import scriptcontext as sc  # NOQA

# GHENV COMPONENT SETTINGS ----------------------------------------------------
ghenv.Component.Name = 'ReadFromD2P'  # NOQA
ghenv.Component.NickName = 'ReadFromD2P'  # NOQA
ghenv.Component.Category = 'DDU_CSC'  # NOQA
ghenv.Component.SubCategory = '9 D2P Components Interface'  # NOQA
ghenv.Component.Description = (  # NOQA
    'Reads the elements of the active Rhino document back into component '
    'passport JSON. A D2P component (made by PassportToD2P and committed '
    'with D2P) is read from the user text of its members, with the placement '
    'from the plane of the D2P component now. An element baked by '
    'BakeComponents is read from its tag; a bake is not a D2P component, so '
    'its Component output is null. The component passport comes from the '
    'stored csc_component or by id through the Session. Nothing is written '
    'to the server.'
)

# CSC LIBRARY (decision 8.111) ----------------------------------------------
CSC_GH_MINIMUM = '261102'
LIBRARY_PROBLEM = None
try:
    import csc_gh
    csc_gh.require(CSC_GH_MINIMUM)
    from csc_gh.doc import (net_instance, net_type_name, passport_fetcher, read_document)  # NOQA
except ImportError:
    LIBRARY_PROBLEM = (
        'CSC library 261102 too old or missing: run CSC_Update, '
        'then restart Rhino')

# OPTIONAL HELPERS: they never block the component (decisions 8.112, 8.113) ---
try:
    from csc_gh.ports import ensure_outputs
    from csc_gh.messages import set_state
except ImportError:
    ensure_outputs = set_state = None

OUTPUTS = [
    ('ComponentPassport', 'ComponentPassport',
     'DataTree of component passport JSON ({identity, snapshots[]}), one per element, with csc_placement set from the plane of the D2P component (or the tag, for an element baked by BakeComponents)'),
    ('Component', 'Component',
     'The D2P component of each component passport (.NET IComponentBase), for elements made by PassportToD2P and committed with D2P. Null for an element baked by BakeComponents: a bake is a tag with its geometry, not a D2P component'),
]


def empty_outputs():
    """What RunScript returns when it stops early or has no result: an empty
    Grasshopper tree per output (never '' or None)."""
    if not OUTPUTS:
        return None
    trees = tuple(Grasshopper.DataTree[System.Object]() for _ in OUTPUTS)
    return trees[0] if len(trees) == 1 else trees


class CSC_ReadFromD2P(Grasshopper.Kernel.GH_ScriptInstance):
    """
    Author: Max Benjamin Eschenbach
    License: MIT License
    Version: 261102
    """

    _outputs_ready = True       # set by BeforeRunScript (8.112)
    _outputs_note = None

    def __init__(self):
        """Initialize this component and set component parameters."""
        super().__init__()
        self.Component = ghenv.Component  # NOQA
        self.InputParams = self.Component.Params.Input
        self.OutputParams = self.Component.Params.Output

    def _addRemark(self, msg: str = ''):
        rml = self.Component.RuntimeMessageLevel.Remark
        self.AddRuntimeMessage(rml, msg)

    def _addWarning(self, msg: str = ''):
        rml = self.Component.RuntimeMessageLevel.Warning
        self.AddRuntimeMessage(rml, msg)

    def _addError(self, msg: str = ''):
        rml = self.Component.RuntimeMessageLevel.Error
        self.AddRuntimeMessage(rml, msg)

    def _state(self, text=''):
        """The one short state under the component (decision 8.113)."""
        if set_state is not None:
            set_state(self.Component, text)

    def _stop(self):
        """True when RunScript has to return early: the library is missing or
        too old, or the outputs were just updated (says why)."""
        if LIBRARY_PROBLEM:
            self._addError(LIBRARY_PROBLEM)
            return True
        if self._outputs_note:
            self._addRemark(self._outputs_note)
        return not self._outputs_ready

    def _check_outputs(self):
        """Make the outputs match OUTPUTS before the script runs (8.112)."""
        self._outputs_ready, self._outputs_note = True, None
        if ensure_outputs is None:
            self._outputs_note = (
                'output check skipped: CSC library not installed')
            return
        status = ensure_outputs(self.Component, OUTPUTS)
        self._outputs_ready, self._outputs_note = status.ready, status.remark

    def BeforeRunScript(self):
        self.InputParams[0].Description = (
            'Trigger to read the D2P components of the Rhino document'
        )
        self._check_outputs()
        if LIBRARY_PROBLEM is None:
            csc_gh.dev_reload(globals())

    def RunScript(self, Read: bool):
        if self._stop():
            return empty_outputs()
        ComponentPassport = Grasshopper.DataTree[str]()
        Component = Grasshopper.DataTree[System.Object]()
        if not Read:
            self._state('Read is off')
            return ComponentPassport, Component
        try:
            doc = Rhino.RhinoDoc.ActiveDoc
            found = {}
            failed = []

            def d2p_plane(entry):
                """The plane of the D2P component the label belongs to."""
                # a D2P label is named like its component; a plain tag of
                # BakeComponents has no name and is not asked
                if not entry['object'].Attributes.Name:
                    return None
                try:
                    component = instance_from_object(entry['object'])
                    plane = None if component is None else component.Plane
                except Exception as error:
                    failed.append((entry['object'].Id, error))
                    return None
                if component is None:
                    return None
                # the output carries the concrete .NET object (IComponentBase)
                # that D2P and Grasshopper accept, as PassportToD2P does
                found[entry['object'].Id] = net_instance(component)
                return plane

            fetch = passport_fetcher(sc.sticky.get('CSC_AuthCore'))
            pieces = read_document(doc, fetch, d2p_plane)
            if not pieces:
                msg = 'No CSC components found in the document!'
                self._addWarning(msg)
                return ComponentPassport, Component

            errors = dict(failed)
            put_out = []
            for i, piece in enumerate(pieces):
                label = piece['identity_id'] or 'a tag without an identity'
                for problem in piece['problems']:
                    self._addWarning(f'{label}: {problem}')
                if piece['object'].Id in errors:
                    self._addWarning(
                        f'{label}: the D2P component could not be resolved '
                        f'({errors[piece["object"].Id]}); its Component is '
                        'null and the placement is read from the tag')
                if piece['passport'] is None:
                    continue
                ghp = Grasshopper.Kernel.Data.GH_Path(i)
                ComponentPassport.Add(json.dumps(piece['passport']), ghp)
                d2p_component = found.get(piece['object'].Id)
                Component.Add(d2p_component, ghp)
                if d2p_component is not None:
                    put_out.append(d2p_component)
                self._addRemark(f'Read {label}')

            types = sorted({net_type_name(c) for c in put_out})
            if types:
                self._addRemark(
                    f'Component: {len(put_out)} D2P component(s) as '
                    f'{", ".join(types)}')
            self._state(f'Read {ComponentPassport.DataCount}')
            return ComponentPassport, Component

        except Exception as error:
            msg = f'Unexpected error reading the document: {error}'
            self._addError(msg)
            return ComponentPassport, Component
# ---------- end readfromd2p ----------

# ---- group: __DDU_CSC_EXAMPLE_07__
originalfunction_6 = ValueList({"Beam (IfcBeam)": "IfcBeam", "Column (IfcColumn)": "IfcColumn", "Slab (IfcSlab)": "IfcSlab", "Plate / Panel (IfcPlate)": "IfcPlate", "Wall (IfcWall)": "IfcWall", "Member (IfcMember)": "IfcMember", "Pipe (IfcPipeSegment)": "IfcPipeSegment", "Duct (IfcDuctSegment)": "IfcDuctSegment", "Footing (IfcFooting)": "IfcFooting", "Window (IfcWindow)": "IfcWindow", "Door / gate (IfcDoor)": "IfcDoor", "Stair (IfcStair)": "IfcStair", "Railing / balustrade (IfcRailing)": "IfcRailing", "Accessory / Connector (IfcDiscreteAccessory)": "IfcDiscreteAccessory", "Element part (IfcBuildingElementPart)": "IfcBuildingElementPart", "Unknown (IfcBuildingElementProxy)": "IfcBuildingElementProxy", "Debris (CscDebris)": "CscDebris"}, selected="Debris (CscDebris)")
material_6 = ValueList({"Concrete (concrete)": "concrete", "Autoclaved aerated concrete (autoclaved_aerated_concrete)": "autoclaved_aerated_concrete", "Fired clay (fired_clay)": "fired_clay", "Calcium silicate (calcium_silicate)": "calcium_silicate", "Ceramic (ceramic)": "ceramic", "Natural stone (natural_stone)": "natural_stone", "Mixed mineral (mineral_mixture)": "mineral_mixture", "Gypsum (gypsum)": "gypsum", "Glass (glass)": "glass", "Steel (steel)": "steel"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}, selected="Concrete (concrete)")
origin_3 = Data(origin_2)
identitymetadata = IdentityMetadata(OriginalFunction=originalfunction_6, Material=material_6, TradeName="Corian", Origin=origin_3)  # -> IdentityMetadata; inputs OriginalFunction: String, Material: String, TradeName: String, Manufacturer: String, ManufacturedAt: String, Origin: String, IsPublic: Boolean, Attributes: String, MaterialClass: String, ManufacturedPrecision: String
# ---------- identitymetadata: Python ----------
#! python3
# -*- coding: utf-8 -*-
# venv: DDU_CSC
# r: charset_normalizer
# r: numpy==2.0.2
print('ENV OK!')

# PYTHON STANDARD LIBRARY IMPORTS ---------------------------------------------
import json  # NOQA

# RHINO AND GH RELATED IMPORTS ------------------------------------------------
import System  # NOQA
import Rhino  # NOQA
import Grasshopper  # NOQA

# GHENV COMPONENT SETTINGS ----------------------------------------------------
ghenv.Component.Name = 'IdentityMetadata'  # NOQA
ghenv.Component.NickName = 'IdentityMetadata'  # NOQA
ghenv.Component.Category = 'DDU_CSC'  # NOQA
ghenv.Component.SubCategory = '3 Component Operations'  # NOQA
ghenv.Component.Description = (  # NOQA
    'Builds the fields of a new component that belong to the element '
    'itself (original function, material, trade name, manufacturer, '
    'manufacture date, origin) as JSON for CreateComponentIdentity. A '
    'cut element leaves it out: everything it does not state comes from '
    'its parents.'
)

# CSC LIBRARY (decision 8.111) ----------------------------------------------
CSC_GH_MINIMUM = '261102'
LIBRARY_PROBLEM = None
try:
    import csc_gh
    csc_gh.require(CSC_GH_MINIMUM)
    from csc_gh.build import (BuildError, identity_metadata)  # NOQA
    from csc_gh.messages import (waits_for_data)  # NOQA
except ImportError:
    LIBRARY_PROBLEM = (
        'CSC library 261102 too old or missing: run CSC_Update, '
        'then restart Rhino')

# OPTIONAL HELPERS: they never block the component (decisions 8.112, 8.113) ---
try:
    from csc_gh.ports import ensure_outputs
    from csc_gh.messages import set_state
except ImportError:
    ensure_outputs = set_state = None

OUTPUTS = [
    ('IdentityMetadata', 'IdentityMetadata',
     'IdentityMetadata JSON (a fragment of the API payload)'),
]


def empty_outputs():
    """What RunScript returns when it stops early or has no result: an empty
    Grasshopper tree per output (never '' or None)."""
    if not OUTPUTS:
        return None
    trees = tuple(Grasshopper.DataTree[System.Object]() for _ in OUTPUTS)
    return trees[0] if len(trees) == 1 else trees


def null_outputs():
    """One null per output: an item of an item-access component that has no
    result keeps its slot (decision 8.186)."""
    if len(OUTPUTS) <= 1:
        return None
    return tuple(None for _ in OUTPUTS)


class CSC_IdentityMetadata(Grasshopper.Kernel.GH_ScriptInstance):
    """
    Author: Max Benjamin Eschenbach
    License: MIT License
    Version: 261102
    """

    _outputs_ready = True       # set by BeforeRunScript (8.112)
    _outputs_note = None

    def __init__(self):
        """Initialize this component and set component parameters."""
        super().__init__()
        self.Component = ghenv.Component  # NOQA
        self.InputParams = self.Component.Params.Input
        self.OutputParams = self.Component.Params.Output

    def _addRemark(self, msg: str = ''):
        rml = self.Component.RuntimeMessageLevel.Remark
        self.AddRuntimeMessage(rml, msg)

    def _addWarning(self, msg: str = ''):
        rml = self.Component.RuntimeMessageLevel.Warning
        self.AddRuntimeMessage(rml, msg)

    def _addError(self, msg: str = ''):
        rml = self.Component.RuntimeMessageLevel.Error
        self.AddRuntimeMessage(rml, msg)

    def _state(self, text=''):
        """The one short state under the component (decision 8.113)."""
        if set_state is not None:
            set_state(self.Component, text)

    def _no_result(self, *ports):
        """The result of an iteration without one (decision 8.186): empty
        outputs when the inputs in ``ports`` carry no data at all (the
        component waits for data; no ports: a list or tree input is empty),
        else a null in the slot of this item, so the outputs stay one to one
        with the input list."""
        if not ports or (waits_for_data is not None
                         and waits_for_data(self, ports)):
            return empty_outputs()
        return null_outputs()

    def _stop(self):
        """True when RunScript has to return early: the library is missing or
        too old, or the outputs were just updated (says why)."""
        if LIBRARY_PROBLEM:
            self._addError(LIBRARY_PROBLEM)
            return True
        if self._outputs_note:
            self._addRemark(self._outputs_note)
        return not self._outputs_ready

    def _check_outputs(self):
        """Make the outputs match OUTPUTS before the script runs (8.112)."""
        self._outputs_ready, self._outputs_note = True, None
        if ensure_outputs is None:
            self._outputs_note = (
                'output check skipped: CSC library not installed')
            return
        status = ensure_outputs(self.Component, OUTPUTS)
        self._outputs_ready, self._outputs_note = status.ready, status.remark

    def BeforeRunScript(self):
        """Perform some setup actions."""
        self.InputParams[0].Description = (
            'IFC class, e.g. IfcBeam, IfcColumn, IfcSlab, IfcPlate, CscDebris'
        )
        self.InputParams[1].Description = (
            'Material id from the controlled list, e.g. concrete'
        )
        self.InputParams[2].Description = (
            'Trade name, e.g. Corian'
        )
        self.InputParams[3].Description = (
            'Manufacturer'
        )
        self.InputParams[4].Description = (
            'Date of manufacture (2024, 2024-05, 2024-05-03)'
        )
        self.InputParams[5].Description = (
            'Origin JSON (from Origin)'
        )
        self.InputParams[6].Description = (
            'Public to anonymous readers (default false)'
        )
        self.InputParams[7].Description = (
            'Free attributes as a JSON object'
        )
        self.InputParams[8].Description = (
            'List of Waste code, e.g. 17 01 01 (empty: derived from the '
            'material)'
        )
        self.InputParams[9].Description = (
            'exact, day, month, year or unknown (empty: from '
            'ManufacturedAt)'
        )
        # Initialize output param descriptions
        self._check_outputs()
        if LIBRARY_PROBLEM is None:
            csc_gh.dev_reload(globals())

    def RunScript(self,
            OriginalFunction: str,
            Material: str,
            TradeName: str,
            Manufacturer: str,
            ManufacturedAt: str,
            Origin: str,
            IsPublic: bool,
            Attributes: str,
            MaterialClass: str,
            ManufacturedPrecision: str):
        if self._stop():
            return empty_outputs()
        IdentityMetadata = empty_outputs()
        if not ManufacturedPrecision or ManufacturedPrecision == '':
            ManufacturedPrecision = None
        try:
            fragment = identity_metadata(
                OriginalFunction, Material, TradeName, Manufacturer, ManufacturedAt,
                ManufacturedPrecision, Origin, IsPublic, Attributes,
                MaterialClass)
            IdentityMetadata = json.dumps(fragment)
            return IdentityMetadata
        except BuildError as error:
            self._addError(str(error))
            return null_outputs()
        except Exception as error:
            msg = f'Unexpected error: {error}'
            self._addError(msg)
            return null_outputs()
        return IdentityMetadata
# ---------- end identitymetadata ----------
identitymetadata_2 = Data(identitymetadata)

# ---- group: __DDU_CSC_EXAMPLE_08__
# Step 2
clearlocalstorage = Button()
identityid_2 = Data(steelfixture)
snapshotmetadata_3 = Data(snapshotmetadata_2)
geometry_2 = Data(steelfixture_2)
createcomponentsnapshot = CreateComponentSnapshot(
    ClearLocalStorage=clearlocalstorage,
    IdentityID=identityid_2,
    Snapshot=snapshotmetadata_3,
    Geometry=geometry_2,
    Centre=Toggle(False))  # -> SnapshotRequest; inputs ClearLocalStorage: Boolean, IdentityID: String, Snapshot: String, Capture: String, Geometry: list of GeometryBase, Supersedes: String, Centre: Boolean
# ---------- createcomponentsnapshot: Python ----------
#! python3
# -*- coding: utf-8 -*-
# venv: DDU_CSC
# r: charset_normalizer
# r: numpy==2.0.2
print('ENV OK!')

# PYTHON STANDARD LIBRARY IMPORTS ---------------------------------------------
import json  # NOQA
import os  # NOQA
import uuid  # NOQA

# RHINO AND GH RELATED IMPORTS ------------------------------------------------
import System  # NOQA
import Rhino  # NOQA
import Grasshopper  # NOQA

# GHENV COMPONENT SETTINGS ----------------------------------------------------
ghenv.Component.Name = 'CreateComponentSnapshot'  # NOQA
ghenv.Component.NickName = 'CreateComponentSnapshot'  # NOQA
ghenv.Component.Category = 'DDU_CSC'  # NOQA
ghenv.Component.SubCategory = '3 Component Operations'  # NOQA
ghenv.Component.Description = (  # NOQA
    'Builds the request that records a new state of an existing '
    'component (POST /identities/{id}/snapshots) or, with Supersedes, a '
    'correction of a published state with its new scan (POST '
    '/snapshots/{id}/supersede): the builder objects (SnapshotMetadata, '
    'Capture) and the geometry. Reduces and stages the mesh files for '
    'AddComponentSnapshot, with vertex colours from the texture of the '
    'referenced Rhino object when it has one. The frame is derived by the '
    'server.'
)

# CSC LIBRARY (decision 8.111) ----------------------------------------------
CSC_GH_MINIMUM = '261102'
LIBRARY_PROBLEM = None
try:
    import csc_gh
    csc_gh.require(CSC_GH_MINIMUM)
    from csc_gh.build import (BuildError, MissingInput, loads_fragment, problems_of_envelope, snapshot_body, snapshot_envelope, staging_key)  # NOQA
    from csc_gh.rhino import (input_references, stage_geometry)  # NOQA
    from csc_gh.upload import (clear_staging, commit_staging, staging_root)  # NOQA
    from csc_gh.messages import (waits_for_data)  # NOQA
except ImportError:
    LIBRARY_PROBLEM = (
        'CSC library 261102 too old or missing: run CSC_Update, '
        'then restart Rhino')


DEFAULT_RGB = (110, 110, 110)

# OPTIONAL HELPERS: they never block the component (decisions 8.112, 8.113) ---
try:
    from csc_gh.ports import ensure_outputs
    from csc_gh.messages import set_state
except ImportError:
    ensure_outputs = set_state = None

OUTPUTS = [
    ('SnapshotRequest', 'SnapshotRequest',
     'Request JSON for AddComponentSnapshot (the state and where it goes)'),
]


def empty_outputs():
    """What RunScript returns when it stops early or has no result: an empty
    Grasshopper tree per output (never '' or None)."""
    if not OUTPUTS:
        return None
    trees = tuple(Grasshopper.DataTree[System.Object]() for _ in OUTPUTS)
    return trees[0] if len(trees) == 1 else trees


def null_outputs():
    """One null per output: an item of an item-access component that has no
    result keeps its slot (decision 8.186)."""
    if len(OUTPUTS) <= 1:
        return None
    return tuple(None for _ in OUTPUTS)


class CSC_CreateComponentSnapshot(Grasshopper.Kernel.GH_ScriptInstance):
    """
    Author: Max Benjamin Eschenbach
    License: MIT License
    Version: 261102
    """

    _outputs_ready = True       # set by BeforeRunScript (8.112)
    _outputs_note = None

    def __init__(self):
        """Initialize this component and set component parameters."""
        super().__init__()
        self.Component = ghenv.Component  # NOQA
        self.InputParams = self.Component.Params.Input
        self.OutputParams = self.Component.Params.Output

    def _addRemark(self, msg: str = ''):
        rml = self.Component.RuntimeMessageLevel.Remark
        self.AddRuntimeMessage(rml, msg)

    def _addWarning(self, msg: str = ''):
        rml = self.Component.RuntimeMessageLevel.Warning
        self.AddRuntimeMessage(rml, msg)

    def _addError(self, msg: str = ''):
        rml = self.Component.RuntimeMessageLevel.Error
        self.AddRuntimeMessage(rml, msg)

    def _state(self, text=''):
        """The one short state under the component (decision 8.113)."""
        if set_state is not None:
            set_state(self.Component, text)

    def _no_result(self, *ports):
        """The result of an iteration without one (decision 8.186): empty
        outputs when the inputs in ``ports`` carry no data at all (the
        component waits for data; no ports: a list or tree input is empty),
        else a null in the slot of this item, so the outputs stay one to one
        with the input list."""
        if not ports or (waits_for_data is not None
                         and waits_for_data(self, ports)):
            return empty_outputs()
        return null_outputs()

    def _stop(self):
        """True when RunScript has to return early: the library is missing or
        too old, or the outputs were just updated (says why)."""
        if LIBRARY_PROBLEM:
            self._addError(LIBRARY_PROBLEM)
            return True
        if self._outputs_note:
            self._addRemark(self._outputs_note)
        return not self._outputs_ready

    def _check_outputs(self):
        """Make the outputs match OUTPUTS before the script runs (8.112)."""
        self._outputs_ready, self._outputs_note = True, None
        if ensure_outputs is None:
            self._outputs_note = (
                'output check skipped: CSC library not installed')
            return
        status = ensure_outputs(self.Component, OUTPUTS)
        self._outputs_ready, self._outputs_note = status.ready, status.remark

    def BeforeRunScript(self):
        """Perform some setup actions."""
        self.InputParams[0].Description = (
            'Empty the staging folder of files waiting for an Add component'
        )
        self.InputParams[1].Description = (
            'Id of the component'
        )
        self.InputParams[2].Description = (
            'SnapshotMetadata JSON (name, colour, location, notes ...)'
        )
        self.InputParams[3].Description = (
            'Capture JSON (how the geometry was recorded); optional'
        )
        self.InputParams[4].Description = (
            'Meshes, point clouds, extrusions (-> prism) and box-shaped breps '
            '(-> box). Meshes are reduced for the Preview and the Reduced '
            'level; the original is kept. A mesh that references a Rhino '
            'object with a base-colour texture in its material is coloured '
            'from that texture (the texture wins over vertex colours the '
            'mesh has; an internalised or Grasshopper-made mesh keeps its '
            'own colours).'
        )
        self.InputParams[5].Description = (
            'Id of the published state this one corrects (empty: a new state)'
        )
        self.InputParams[6].Description = (
            'Move the centroid of the geometry to the origin before it is '
            'stored (default false: stored coordinates are those you give)'
        )
        # Initialize output param descriptions
        self._check_outputs()
        if LIBRARY_PROBLEM is None:
            csc_gh.dev_reload(globals())

    def RunScript(self,
            ClearLocalStorage: bool,
            IdentityID: str,
            Snapshot: str,
            Capture: str,
            Geometry: list[Rhino.Geometry.GeometryBase],
            Supersedes: str,
            Centre: bool):
        if self._stop():
            return empty_outputs()
        SnapshotRequest = empty_outputs()
        tmp_dir = None
        try:
            # ClearLocalStorage empties the staging folder and stops here
            if ClearLocalStorage:
                folder = clear_staging()
                self._state('Staging folder cleared')
                self._addRemark(f'Cleared {folder}')
                return SnapshotRequest

            if not Geometry:
                raise MissingInput('Input Geometry failed to collect data')
            root = staging_root()
            os.makedirs(root, exist_ok=True)
            tmp_dir = os.path.join(root, '_tmp_' + uuid.uuid4().hex)
            meta = loads_fragment(Snapshot, 'Snapshot') or {}
            # vertex colours from the texture of the Rhino object each mesh
            # references (8.175): no input, the references come from the
            # volatile data of Geometry; the remarks say what was done
            items = list(Geometry)
            try:
                references = input_references(self.Component, 'Geometry', items)
            except Exception:
                references = None
            texture_notes = []
            geometry, mani, move = stage_geometry(
                items, tmp_dir, meta.get('color') or DEFAULT_RGB,
                bool(Centre), references=references, notes=texture_notes)
            for note in texture_notes:
                self._addRemark(note)
            snapshot_dict = snapshot_body(meta, geometry, Capture)
            body = snapshot_envelope(IdentityID, snapshot_dict, Supersedes)

            problems = problems_of_envelope(body)
            if problems:
                raise BuildError('\n'.join(problems))
            text_json = json.dumps(body, sort_keys=True)
            key = staging_key(text_json)
            folder = commit_staging(tmp_dir, key, mani)
            tmp_dir = None
            SnapshotRequest = text_json
            files = sum(len(v) for v in mani.get('meshes', {}).values()) \
                + len(mani.get('point_clouds', []))
            self._state('Request built' + (
                f' ({files} file(s) staged)' if files else ''))
            if any(move):
                self._addRemark(
                    'Centred: the geometry was moved by '
                    f'({move[0]:.3f}, {move[1]:.3f}, {move[2]:.3f})')
            if folder:
                self._addRemark(f'Staged files: {folder}')
            return SnapshotRequest
        except MissingInput as error:
            self._addWarning(str(error))
            return self._no_result(*error.ports)
        except BuildError as error:
            self._addError(str(error))
            return null_outputs()
        except ValueError as error:
            self._addError(str(error))
            return null_outputs()
        except Exception as error:
            msg = f'Unexpected error: {error}'
            self._addError(msg)
            return null_outputs()
        finally:
            if tmp_dir and os.path.isdir(tmp_dir):
                import shutil
                shutil.rmtree(tmp_dir, ignore_errors=True)
        return SnapshotRequest
# ---------- end createcomponentsnapshot ----------
snapshotrequest = Data(createcomponentsnapshot)

# ----
evidence_2 = Data(evidence)
identityid_3 = Data(identityid)
addevidence = AddEvidence(IdentityID=identityid_3, Evidence=evidence_2, Run=Toggle(False))  # -> Created; inputs IdentityID: list, Evidence: list, Run: Boolean
# ---------- addevidence: Python ----------
#! python3
# -*- coding: utf-8 -*-
# venv: DDU_CSC
# r: charset_normalizer
# r: requests==2.32.5
# r: numpy==2.0.2
print('ENV OK!')

# PYTHON STANDARD LIBRARY IMPORTS ---------------------------------------------
import json  # NOQA

# THIRD PARTY LIBRARY IMPORTS -------------------------------------------------
import requests  # NOQA

# RHINO AND GH RELATED IMPORTS ------------------------------------------------
import System  # NOQA
import Grasshopper  # NOQA
import Rhino  # NOQA
import scriptcontext as sc  # NOQA

# GHENV COMPONENT SETTINGS ----------------------------------------------------
ghenv.Component.Name = 'AddEvidence'  # NOQA
ghenv.Component.NickName = 'AddEvidence'  # NOQA
ghenv.Component.Category = 'DDU_CSC'  # NOQA
ghenv.Component.SubCategory = '2 Catalog Interface'  # NOQA
ghenv.Component.Description = (  # NOQA
    'Posts evidence records (an observation or a claim about a component, '
    'e.g. a ReinforcementLayout) with POST /evidence/bulk: all records are '
    'checked first and stored all or none. One IdentityID applies to every '
    'record; as many ids as records pair up one to one. The records land '
    'as drafts: complete them (files, checks) and submit them in the web, '
    'My work.'
)

# CSC LIBRARY (decision 8.111) ----------------------------------------------
CSC_GH_MINIMUM = '261102'
LIBRARY_PROBLEM = None
try:
    import csc_gh
    csc_gh.require(CSC_GH_MINIMUM)
    from csc_gh.build import (BuildError, MissingInput, evidence_bulk_body)  # NOQA
    from csc_gh.upload import (http_error_text)  # NOQA
except ImportError:
    LIBRARY_PROBLEM = (
        'CSC library 261102 too old or missing: run CSC_Update, '
        'then restart Rhino')

# OPTIONAL HELPERS: they never block the component (decisions 8.112, 8.113) ---
try:
    from csc_gh.ports import ensure_outputs
    from csc_gh.messages import set_state
except ImportError:
    ensure_outputs = set_state = None

OUTPUTS = [
    ('Created', 'Created',
     'The stored evidence records as the server returns them (JSON)'),
]


def empty_outputs():
    """What RunScript returns when it stops early or has no result: an empty
    Grasshopper tree per output (never '' or None)."""
    if not OUTPUTS:
        return None
    trees = tuple(Grasshopper.DataTree[System.Object]() for _ in OUTPUTS)
    return trees[0] if len(trees) == 1 else trees


class CSC_AddEvidence(Grasshopper.Kernel.GH_ScriptInstance):
    """
    Author: Max Benjamin Eschenbach
    License: MIT License
    Version: 261102
    """

    _outputs_ready = True       # set by BeforeRunScript (8.112)
    _outputs_note = None

    def __init__(self):
        super().__init__()
        self.Component = ghenv.Component  # NOQA
        self.InputParams = self.Component.Params.Input
        self.OutputParams = self.Component.Params.Output

    def _addRemark(self, msg: str = ''):
        rml = self.Component.RuntimeMessageLevel.Remark
        self.AddRuntimeMessage(rml, msg)

    def _addWarning(self, msg: str = ''):
        rml = self.Component.RuntimeMessageLevel.Warning
        self.AddRuntimeMessage(rml, msg)

    def _addError(self, msg: str = ''):
        rml = self.Component.RuntimeMessageLevel.Error
        self.AddRuntimeMessage(rml, msg)

    def _state(self, text=''):
        """The one short state under the component (decision 8.113)."""
        if set_state is not None:
            set_state(self.Component, text)

    def _stop(self):
        """True when RunScript has to return early: the library is missing or
        too old, or the outputs were just updated (says why)."""
        if LIBRARY_PROBLEM:
            self._addError(LIBRARY_PROBLEM)
            return True
        if self._outputs_note:
            self._addRemark(self._outputs_note)
        return not self._outputs_ready

    def _check_outputs(self):
        """Make the outputs match OUTPUTS before the script runs (8.112)."""
        self._outputs_ready, self._outputs_note = True, None
        if ensure_outputs is None:
            self._outputs_note = (
                'output check skipped: CSC library not installed')
            return
        status = ensure_outputs(self.Component, OUTPUTS)
        self._outputs_ready, self._outputs_note = status.ready, status.remark

    def BeforeRunScript(self):
        """Perform some setup actions."""
        self.InputParams[0].Description = (
            'Id(s) of the component(s) the records are about: one for all '
            'records or one per record'
        )
        self.InputParams[1].Description = (
            'Evidence record JSON, e.g. from ReinforcementLayout. An '
            'archival_document without a summary is a document (it never '
            'enters the properties); payload.document may carry a url '
            '(http or https) and retrieved_at, also in a '
            'reinforcement_layout'
        )
        self.InputParams[2].Description = (
            'Toggle to execute the create operation (the records land as '
            'drafts; submit them in the web)'
        )
        self._check_outputs()
        if LIBRARY_PROBLEM is None:
            csc_gh.dev_reload(globals())

    def get_auth_core_from_sticky(self):
        """Get AuthCore instance from sticky storage."""
        auth_core = sc.sticky.get('CSC_AuthCore')
        if auth_core is None:
            msg = ('No authentication found. Please use CSC_Session component '
                   'first.')
            self._addWarning(msg)
            return None
        return auth_core

    def RunScript(self, IdentityID: list[object], Evidence: list[object], Run: bool):
        if self._stop():
            return empty_outputs()
        Stored = Grasshopper.DataTree[System.Object]()

        auth_core = self.get_auth_core_from_sticky()
        if auth_core is None:
            return Stored
        if not auth_core.is_valid():
            msg = ('Authentication expired. Please use CSC_Session '
                   'component to refresh.')
            self._addWarning(msg)
            return Stored

        try:
            body = evidence_bulk_body(list(Evidence or []),
                                      list(IdentityID or []))
        except MissingInput as error:
            self._addWarning(str(error))
            return Stored
        except BuildError as error:
            self._addError(str(error))
            return Stored

        count = len(body['records'])
        if not Run:
            self._state('Run is False')
            return Stored

        try:
            response = auth_core.authorized_post('/evidence/bulk',
                                                 json_body=body)
            if response.status_code != 201:
                msg = {
                    401: 'Authentication failed. Please sign in again.',
                    403: 'Access denied: you need the contributor role in '
                         'the dataset of every component.',
                    404: 'A component was not found.',
                }.get(response.status_code) or http_error_text(
                    response, 'Add evidence')
                self._addError(msg)
                return Stored
            stored = response.json().get('records') or []
            for index, record in enumerate(stored):
                Stored.Add(json.dumps(record),
                             Grasshopper.Kernel.Data.GH_Path(index))
            self._state(f'{len(stored)} created')
            return Stored

        except requests.exceptions.ConnectionError as error:
            msg = 'Cannot connect to server. Please check your connection.'
            self._addError(msg + f'\nFull Error: {error}')
        except requests.exceptions.Timeout as error:
            msg = 'Request timeout. Server may be slow.'
            self._addError(msg + f'\nFull Error: {error}')
        except Exception as error:
            # includes CSCClientOutdated: its text names the fix
            self._addError(str(error))
        return Stored
# ---------- end addevidence ----------

# ---- group: __DDU_CSC_EXAMPLE_02__
# Step 4
# comments & notes: Get ComponentPassport from Geometry again
geometry_3 = Data(geometry)
getcomponentpassport = GetComponentPassport(Geometry=geometry_3)  # -> ComponentPassport; inputs Geometry: list of GeometryBase
# ---------- getcomponentpassport: Python ----------
#! python3
# -*- coding: utf-8 -*-
# venv: DDU_CSC
print('ENV OK!')
# r: charset_normalizer
# r: requests

# PYTHON STANDARD LIBRARY IMPORTS ---------------------------------------------
import json  # NOQA

# RHINO AND GH RELATED IMPORTS ------------------------------------------------
import System  # NOQA
import Rhino  # NOQA
import Grasshopper  # NOQA

# GHENV COMPONENT SETTINGS ----------------------------------------------------
ghenv.Component.Name = 'GetComponentPassport'  # NOQA
ghenv.Component.NickName = 'GetComponentPassport'  # NOQA
ghenv.Component.Category = 'DDU_CSC'  # NOQA
ghenv.Component.SubCategory = '3 Component Operations'  # NOQA
ghenv.Component.Description = (  # NOQA
    'Extracts the component passport ({identity, snapshot} JSON string) '
    'from the csc_component user text of Rhino geometry objects. Safely '
    'retrieves and parses the component passport stored as user text.'
)

# OPTIONAL HELPERS: they never block the component (decisions 8.112, 8.113) ---
try:
    from csc_gh.ports import ensure_outputs
    from csc_gh.messages import set_state
except ImportError:
    ensure_outputs = set_state = None

OUTPUTS = [
    ('ComponentPassport', 'ComponentPassport',
     'Component passport JSON strings ({identity, snapshot}) extracted from geometry userdata'),
]


def empty_outputs():
    """What RunScript returns when it stops early or has no result: an empty
    Grasshopper tree per output (never '' or None)."""
    if not OUTPUTS:
        return None
    trees = tuple(Grasshopper.DataTree[System.Object]() for _ in OUTPUTS)
    return trees[0] if len(trees) == 1 else trees


class CSC_GetComponentPassport(Grasshopper.Kernel.GH_ScriptInstance):
    """
    Author: Max Benjamin Eschenbach
    License: MIT License
    Version: 261102
    """

    _outputs_ready = True       # set by BeforeRunScript (8.112)
    _outputs_note = None

    def __init__(self):
        """Initialize this component and set component parameters."""
        super().__init__()
        # initialize props
        self.Component = ghenv.Component  # NOQA
        self.InputParams = self.Component.Params.Input
        self.OutputParams = self.Component.Params.Output

    def _addRemark(self, msg: str = ''):
        """Add a remark message to the component."""
        rml = self.Component.RuntimeMessageLevel.Remark
        self.AddRuntimeMessage(rml, msg)

    def _addWarning(self, msg: str = ''):
        """Add a warning message to the component."""
        rml = self.Component.RuntimeMessageLevel.Warning
        self.AddRuntimeMessage(rml, msg)

    def _addError(self, msg: str = ''):
        """Add an error message to the component."""
        rml = self.Component.RuntimeMessageLevel.Error
        self.AddRuntimeMessage(rml, msg)

    def _state(self, text=''):
        """The one short state under the component (decision 8.113)."""
        if set_state is not None:
            set_state(self.Component, text)

    def _stop(self):
        """True when RunScript has to return early: the outputs were just
        updated (says why)."""
        if self._outputs_note:
            self._addRemark(self._outputs_note)
        return not self._outputs_ready

    def _check_outputs(self):
        """Make the outputs match OUTPUTS before the script runs (8.112)."""
        self._outputs_ready, self._outputs_note = True, None
        if ensure_outputs is None:
            self._outputs_note = (
                'output check skipped: CSC library not installed')
            return
        status = ensure_outputs(self.Component, OUTPUTS)
        self._outputs_ready, self._outputs_note = status.ready, status.remark

    def BeforeRunScript(self):
        """Perform some setup actions."""
        # Initialize input param descriptions
        self.InputParams[0].Description = (
            'Geometry objects with the \'csc_component\' user text'
        )
        # Initialize output param descriptions
        self._check_outputs()

    def extract_component_data_from_geometry(self, geometry):
        """
        Extract passport data ({identity, snapshot}) from geometry userdata.

        Args:
            geometry: Rhino geometry object with userdata

        Returns:
            Passport dictionary or None
        """
        try:
            if hasattr(geometry, 'GetUserString'):
                userdata = geometry.GetUserString('csc_component')
                if userdata:
                    return json.loads(userdata)
                else:
                    self._addWarning('No csc_component userdata found')
            else:
                self._addWarning('Geometry object does not support userdata')
        except json.JSONDecodeError as e:
            self._addError(f'Invalid JSON in userdata: {str(e)}')
        except Exception as e:
            self._addError(f'Error extracting component data: {str(e)}')
        return None

    def RunScript(self, Geometry: list[Rhino.Geometry.GeometryBase]):
        # Set up output tree
        if self._stop():
            return empty_outputs()
        ComponentPassport = Grasshopper.DataTree[System.Object]()

        # Validate input
        if not Geometry:
            msg = 'Input geometry failed to collect data!'
            self._addWarning(msg)
            return ComponentPassport

        try:
            # Handle single geometry or list of geometries
            successful_extractions = 0

            for i, geo in enumerate(Geometry):
                if geo is None:
                    self._addWarning(f'Geometry at index {i} is None, '
                                     f'skipping')
                    continue

                # Extract passport data
                passport = self.extract_component_data_from_geometry(geo)
                if passport:
                    # Add to output
                    ComponentPassport.Add(
                        json.dumps(passport),
                        Grasshopper.Kernel.Data.GH_Path(i)
                    )
                    successful_extractions += 1
                    self._addRemark(f'Successfully extracted component passport data '
                                    f'from geometry {i}')
                else:
                    # Add empty string to maintain data tree structure
                    ComponentPassport.Add(
                        '',
                        Grasshopper.Kernel.Data.GH_Path(i)
                    )
                    self._addWarning(f'Failed to extract component passport data '
                                     f'from geometry {i}')

            # Update success message
            if successful_extractions == 0:
                msg = 'No component passport data found in any geometry objects'
                self._addWarning(msg)
            elif successful_extractions == len(Geometry):
                self._addRemark(f'Extracted component passport data from '
                                f'{successful_extractions} out of '
                                f'{len(Geometry)} geometry objects')
            else:
                self._addWarning('Some geometry objects did not contain '
                                 'valid component passport data')

            return ComponentPassport

        except Exception as e:
            msg = f'Unexpected error: {str(e)}'
            self._addError(msg)
            return ComponentPassport
# ---------- end getcomponentpassport ----------

# ---- group: __DDU_CSC_EXAMPLE_07__
# Step 1
# comments & notes: Here we fetch a Transmitted ID from a QR Code Scan.
# 
# Use https://ddu.uber.space/transmit-id on your smartphone to scan a QR code and transmit the ID!
button = Button()
fetchtransmittedid = FetchTransmittedID(Refresh=button)  # -> IdentityID
# ---------- fetchtransmittedid: Python ----------
#! python3
# -*- coding: utf-8 -*-
# venv: DDU_CSC
print('ENV OK!')
# r: charset_normalizer
# r: requests

# PYTHON STANDARD LIBRARY IMPORTS ---------------------------------------------
import json  # NOQA

# THIRD PARTY LIBRARY IMPORTS -------------------------------------------------
import requests  # NOQA

# RHINO AND GH RELATED IMPORTS ------------------------------------------------
import System  # NOQA
import Grasshopper  # NOQA
import Rhino  # NOQA
import scriptcontext as sc  # NOQA

# GHENV COMPONENT SETTINGS ----------------------------------------------------
ghenv.Component.Name = 'FetchTransmittedID'  # NOQA
ghenv.Component.NickName = 'FetchTransmittedID'  # NOQA
ghenv.Component.Category = 'DDU_CSC'  # NOQA
ghenv.Component.SubCategory = '2 Catalog Interface'  # NOQA
ghenv.Component.Description = (  # NOQA
    'Fetches the currently pending transmitted component ID for the signed-in '
    'user from the Catalog backend. Uses the existing CSC_Session '
    'authentication state.'
)

# OPTIONAL HELPERS: they never block the component (decisions 8.112, 8.113) ---
try:
    from csc_gh.ports import ensure_outputs
    from csc_gh.messages import set_state
except ImportError:
    ensure_outputs = set_state = None

OUTPUTS = [
    ('IdentityID', 'IdentityID',
     'The currently pending transmitted IdentityID. Empty if none is pending.'),
]


def empty_outputs():
    """What RunScript returns when it stops early or has no result: an empty
    Grasshopper tree per output (never '' or None)."""
    if not OUTPUTS:
        return None
    trees = tuple(Grasshopper.DataTree[System.Object]() for _ in OUTPUTS)
    return trees[0] if len(trees) == 1 else trees


class CSC_FetchTransmittedID(Grasshopper.Kernel.GH_ScriptInstance):
    """
    Author: Max Benjamin Eschenbach
    License: MIT License
    Version: 261102
    """

    _outputs_ready = True       # set by BeforeRunScript (8.112)
    _outputs_note = None

    def __init__(self):
        """Initialize this component and set component parameters."""
        super().__init__()
        # initialize props
        self.Component = ghenv.Component  # NOQA
        self.InputParams = self.Component.Params.Input
        self.OutputParams = self.Component.Params.Output

    def _addRemark(self, msg: str = ''):
        """Add a remark message to the component."""
        rml = self.Component.RuntimeMessageLevel.Remark
        self.AddRuntimeMessage(rml, msg)

    def _addWarning(self, msg: str = ''):
        """Add a warning message to the component."""
        rml = self.Component.RuntimeMessageLevel.Warning
        self.AddRuntimeMessage(rml, msg)

    def _addError(self, msg: str = ''):
        """Add an error message to the component."""
        rml = self.Component.RuntimeMessageLevel.Error
        self.AddRuntimeMessage(rml, msg)

    def _state(self, text=''):
        """The one short state under the component (decision 8.113)."""
        if set_state is not None:
            set_state(self.Component, text)

    def _stop(self):
        """True when RunScript has to return early: the outputs were just updated (says why)."""
        if self._outputs_note:
            self._addRemark(self._outputs_note)
        return not self._outputs_ready

    def _check_outputs(self):
        """Make the outputs match OUTPUTS before the script runs (8.112)."""
        self._outputs_ready, self._outputs_note = True, None
        if ensure_outputs is None:
            self._outputs_note = (
                'output check skipped: CSC library not installed')
            return
        status = ensure_outputs(self.Component, OUTPUTS)
        self._outputs_ready, self._outputs_note = status.ready, status.remark

    def BeforeRunScript(self):
        """Perform some setup actions."""
        # Initialize output param descriptions
        i = 0
        if self.OutputParams[0].Name == 'out':
            i += 1
        self.OutputParams[0+i].Description = (
            'The currently pending transmitted IdentityID. Empty if none is '
            'pending.'
        )
        self._check_outputs()

    def get_auth_core_from_sticky(self):
        """Get AuthCore instance from sticky storage."""
        auth_core = sc.sticky.get('CSC_AuthCore')
        if auth_core is None:
            msg = ('No authentication found. Please use CSC_Session component '
                   'first.')
            self._addError(msg)
            self._state(msg)
            return None
        return auth_core

    def RunScript(self, Refresh):
        if self._stop():
            return empty_outputs()
        component_id = Grasshopper.DataTree[object]()

        # Get AuthCore instance from sticky storage
        auth_core = self.get_auth_core_from_sticky()
        if auth_core is None:
            return component_id

        # Check if authentication is valid
        if not auth_core.is_valid():
            msg = ('Authentication expired. Please use CSC_Session '
                   'component to refresh.')
            self._addError(msg)
            self._state(msg)
            return component_id

        try:
            self._state('Fetching transmitted ID...')

            response = auth_core.authorized_get('/component_id_transmission')

            if response.status_code == 200:
                payload = response.json()
                pending = payload.get('pending')

                if pending and isinstance(pending, dict):
                    component_id = str(pending.get('identity_id', '') or '')
                    self._state('Pending transmitted ID found')
                    self._addRemark(
                        f'Fetched pending transmitted ID: {component_id}'
                    )
                else:
                    self._state('No transmitted ID pending')
                    self._addRemark(
                        'No pending transmitted component ID for this user.'
                    )

                return component_id

            elif response.status_code == 401:
                msg = 'Authentication failed. Please sign in again.'
                self._addError(msg)
                self._state(msg)

            elif response.status_code == 403:
                msg = 'Access denied. Insufficient permissions.'
                self._addError(msg)
                self._state(msg)

            elif response.status_code == 500:
                msg = 'Server error. Please try again later.'
                self._addWarning(msg)
                self._state(msg)

            else:
                msg = (f'Request failed with status code: '
                       f'{response.status_code}')
                self._addError(msg)
                self._state(msg)

        except requests.exceptions.ConnectionError as e:
            msg = 'Cannot connect to server. Please check your connection.'
            self._addError(msg + f'\nFull Error: {str(e)}')
            self._state(msg)

        except requests.exceptions.Timeout as e:
            msg = 'Request timeout. Server may be slow.'
            self._addError(msg + f'\nFull Error: {str(e)}')
            self._state(msg)

        except requests.exceptions.RequestException as e:
            msg = f'Request error: {str(e)}'
            self._addError(msg)
            self._state(msg)

        except Exception as e:
            msg = f'Unexpected error: {str(e)}'
            self._addError(msg)
            self._state(msg)

        return component_id
# ---------- end fetchtransmittedid ----------
componentid_7 = Panel(fetchtransmittedid)

# comments & notes: Create UUIDs on request
button_2 = Button()
createuuid = CreateUUID(Refresh=button_2)  # -> UUID; inputs Refresh: Boolean
# ---------- createuuid: Python ----------
#! python3
# -*- coding: utf-8 -*-
# venv: DDU_CSC
print('ENV OK!')
# r: charset_normalizer
# r: requests

# PYTHON STANDARD LIBRARY IMPORTS ---------------------------------------------
import uuid  # NOQA

# RHINO AND GH RELATED IMPORTS ------------------------------------------------
import System  # NOQA
import Rhino  # NOQA
import Grasshopper  # NOQA
from scriptcontext import sticky as st  # NOQA

# GHENV COMPONENT SETTINGS ----------------------------------------------------
ghenv.Component.Name = 'CreateUUID'  # NOQA
ghenv.Component.NickName = 'CreateUUID'  # NOQA
ghenv.Component.Category = 'DDU_CSC'  # NOQA
ghenv.Component.SubCategory = '3 Component Operations'  # NOQA
ghenv.Component.Description = (  # NOQA
    'Creates new UUIDs on request.'
)

# OPTIONAL HELPERS: they never block the component (decisions 8.112, 8.113) ---
try:
    from csc_gh.ports import ensure_outputs
    from csc_gh.messages import set_state
except ImportError:
    ensure_outputs = set_state = None

OUTPUTS = [
    ('UUID', 'UUID',
     'The current UUID'),
]


def empty_outputs():
    """What RunScript returns when it stops early or has no result: an empty
    Grasshopper tree per output (never '' or None)."""
    if not OUTPUTS:
        return None
    trees = tuple(Grasshopper.DataTree[System.Object]() for _ in OUTPUTS)
    return trees[0] if len(trees) == 1 else trees


class CSC_CreateUUID(Grasshopper.Kernel.GH_ScriptInstance):
    """
    Author: Max Benjamin Eschenbach
    License: MIT License
    Version: 261102
    """

    _outputs_ready = True       # set by BeforeRunScript (8.112)
    _outputs_note = None

    def __init__(self):
        """Initialize this component and set component parameters."""
        super().__init__()
        # initialize props
        self.Component = ghenv.Component  # NOQA
        self.InputParams = self.Component.Params.Input
        self.OutputParams = self.Component.Params.Output

    def _addRemark(self, msg: str = ''):
        """Add a remark message to the component."""
        rml = self.Component.RuntimeMessageLevel.Remark
        self.AddRuntimeMessage(rml, msg)

    def _addWarning(self, msg: str = ''):
        """Add a warning message to the component."""
        rml = self.Component.RuntimeMessageLevel.Warning
        self.AddRuntimeMessage(rml, msg)

    def _addError(self, msg: str = ''):
        """Add an error message to the component."""
        rml = self.Component.RuntimeMessageLevel.Error
        self.AddRuntimeMessage(rml, msg)

    def _state(self, text=''):
        """The one short state under the component (decision 8.113)."""
        if set_state is not None:
            set_state(self.Component, text)

    def _stop(self):
        """True when RunScript has to return early: the outputs were just updated (says why)."""
        if self._outputs_note:
            self._addRemark(self._outputs_note)
        return not self._outputs_ready

    def _check_outputs(self):
        """Make the outputs match OUTPUTS before the script runs (8.112)."""
        self._outputs_ready, self._outputs_note = True, None
        if ensure_outputs is None:
            self._outputs_note = (
                'output check skipped: CSC library not installed')
            return
        status = ensure_outputs(self.Component, OUTPUTS)
        self._outputs_ready, self._outputs_note = status.ready, status.remark

    def BeforeRunScript(self):
        """Perform some setup actions."""
        # Initialize input param descriptions
        self.InputParams[0].Description = (
            'If set to True, generates a new UUID'
        )
        self._check_outputs()

    def _updateComponent(self):
        """Updates this component using callback mechanism"""
        # Define callback action
        def callBack(e):
            st_key = f'{self.Component.InstanceGuid}__CreateUUIDComponent'
            new_uuid = uuid.uuid4()
            st[st_key] = new_uuid
            self.Component.ExpireSolution(False)  # NOQA
            return
        # Get grasshopper document
        ghDoc = ghenv.Component.OnPingDocument()  # NOQA
        # Schedule this component to expire
        ghDoc.ScheduleSolution(
            1,
            Grasshopper.Kernel.GH_Document.GH_ScheduleDelegate(callBack)
        )
        return False

    def RunScript(self, Refresh: bool):
        if self._stop():
            return empty_outputs()
        st_key = f'{self.Component.InstanceGuid}__CreateUUIDComponent'
        if Refresh or st_key not in st.keys():
            create_new_uuid = True
        else:
            create_new_uuid = False
        if create_new_uuid:
            create_new_uuid = self._updateComponent()
        return st[st_key]
# ---------- end createuuid ----------
componentid_8 = Panel(createuuid)

# Example 07:
# - Creating a new, (derived) component identity in the catalog
location_5 = Data(location_2)

component_name_2 = Panel("Reinforcement Demo 01")
fragment_7 = BooleanToggle(True)
color_2 = ColourSwatch(SwatchColor=RGB(189, 189, 189))
snapshotmetadata_4 = SnapshotMetadata(Name=component_name_2, Fragment=fragment_7, Color=color_2, Location=location_5)  # -> SnapshotMetadata; inputs Name: String, Fragment: Boolean, Quantity: Int32, Color: Color, Location: Vector3d, Notes: String, EffectiveFrom: String, ShapeClass: String, Complexity: Int32, EffectiveFromPrecision: String; same code as snapshotmetadata
snapshotmetadata_5 = Data(snapshotmetadata_4)

# ---- group: __DDU_CSC_EXAMPLE_05__
# Step 3.1
# comments & notes: Get radial shape signature distances with medium (32 rays) resolution.
panel_11 = Panel("radial_distance_32")
componentpassport_26 = Data(componentpassport_3)
getdescriptor = GetDescriptor(Input=componentpassport_26, DescriptorKey=panel_11)  # -> DescriptorValues; inputs Input: list, DescriptorKey: String
# ---------- getdescriptor: Python ----------
#! python3
# -*- coding: utf-8 -*-
# venv: DDU_CSC
print('ENV OK!')
# r: charset_normalizer
# r: requests

# PYTHON STANDARD LIBRARY IMPORTS ---------------------------------------------
import json  # NOQA

# RHINO AND GH RELATED IMPORTS ------------------------------------------------
import System  # NOQA
import Grasshopper  # NOQA
import Rhino  # NOQA

# GHENV COMPONENT SETTINGS ----------------------------------------------------
ghenv.Component.Name = 'GetDescriptor'  # NOQA
ghenv.Component.NickName = 'GetDescriptor'  # NOQA
ghenv.Component.Category = 'DDU_CSC'  # NOQA
ghenv.Component.SubCategory = '6 Data Tools'  # NOQA
ghenv.Component.Description = (  # NOQA
    'Retrieves a specific descriptor from multiple component passport inputs '
    '({identity, snapshot}). Accepts component passport JSON strings or geometries '
    'with the csc_component userdata. Returns descriptor values for the '
    'specified key from snapshot.descriptors. Handles single values, lists, '
    'and nested lists by mapping them to appropriate Grasshopper data '
    'structures with input indices as the first path level.'
)

# OPTIONAL HELPERS: they never block the component (decisions 8.112, 8.113) ---
try:
    from csc_gh.ports import ensure_outputs
    from csc_gh.messages import set_state, waits_for_data
except ImportError:
    ensure_outputs = set_state = waits_for_data = None

OUTPUTS = [
    ('DescriptorValues', 'DescriptorValues',
     'Descriptor value for the specified key, or empty if not found'),
]


def empty_outputs():
    """What RunScript returns when it stops early or has no result: an empty
    Grasshopper tree per output (never '' or None)."""
    if not OUTPUTS:
        return None
    trees = tuple(Grasshopper.DataTree[System.Object]() for _ in OUTPUTS)
    return trees[0] if len(trees) == 1 else trees


def null_outputs():
    """One null per output: an item of an item-access component that has no
    result keeps its slot (decision 8.186)."""
    if len(OUTPUTS) <= 1:
        return None
    return tuple(None for _ in OUTPUTS)


class CSC_GetDescriptor(Grasshopper.Kernel.GH_ScriptInstance):
    """
    Author: Max Benjamin Eschenbach
    License: MIT License
    Version: 261102
    """

    _outputs_ready = True       # set by BeforeRunScript (8.112)
    _outputs_note = None

    def __init__(self):
        """Initialize this component and set component parameters."""
        super().__init__()
        # initialize props
        self.Component = ghenv.Component  # NOQA
        self.InputParams = self.Component.Params.Input
        self.OutputParams = self.Component.Params.Output

    def _addRemark(self, msg: str = ''):
        """Add a remark message to the component."""
        rml = self.Component.RuntimeMessageLevel.Remark
        self.AddRuntimeMessage(rml, msg)

    def _addWarning(self, msg: str = ''):
        """Add a warning message to the component."""
        rml = self.Component.RuntimeMessageLevel.Warning
        self.AddRuntimeMessage(rml, msg)

    def _addError(self, msg: str = ''):
        """Add an error message to the component."""
        rml = self.Component.RuntimeMessageLevel.Error
        self.AddRuntimeMessage(rml, msg)

    def _state(self, text=''):
        """The one short state under the component (decision 8.113)."""
        if set_state is not None:
            set_state(self.Component, text)

    def _no_result(self, *ports):
        """The result of an iteration without one (decision 8.186): empty
        outputs when the inputs in ``ports`` carry no data at all (the
        component waits for data; no ports: a list or tree input is empty),
        else a null in the slot of this item, so the outputs stay one to one
        with the input list."""
        if not ports or (waits_for_data is not None
                         and waits_for_data(self, ports)):
            return empty_outputs()
        return null_outputs()

    def _stop(self):
        """True when RunScript has to return early: the outputs were just
        updated (says why)."""
        if self._outputs_note:
            self._addRemark(self._outputs_note)
        return not self._outputs_ready

    def _check_outputs(self):
        """Make the outputs match OUTPUTS before the script runs (8.112)."""
        self._outputs_ready, self._outputs_note = True, None
        if ensure_outputs is None:
            self._outputs_note = (
                'output check skipped: CSC library not installed')
            return
        status = ensure_outputs(self.Component, OUTPUTS)
        self._outputs_ready, self._outputs_note = status.ready, status.remark

    def BeforeRunScript(self):
        """Perform some setup actions."""
        # Set "No type hint"
        self.InputParams[0].TypeHints.Select(System.Object)
        self.Component.VariableParameterMaintenance()
        # Initialize input param descriptions
        self.InputParams[0].Description = (
            'List of component passport JSON strings ({identity, snapshot}) OR '
            'geometries with the \'csc_component\' user text'
        )
        self.InputParams[1].Description = (
            'Key string to retrieve from snapshot.descriptors'
        )
        # Initialize output param descriptions
        self._check_outputs()

    def extract_passport_from_geometry(self, geometry):
        """
        Extract passport data ({identity, snapshot}) from geometry userdata.

        Args:
            geometry: Rhino geometry object with userdata

        Returns:
            Passport dictionary or None
        """
        try:
            if hasattr(geometry, 'GetUserString'):
                userdata = geometry.GetUserString('csc_component')
                if userdata:
                    return json.loads(userdata)
        except Exception as e:
            self._addWarning(f'Could not extract component passport data: {str(e)}')
        return None

    def get_descriptor_value(self, passport, descriptor_key):
        """
        Extract descriptor value from snapshot.descriptors using the key.

        Args:
            passport: Passport dictionary ({identity, snapshot})
            descriptor_key: String key to look for in descriptors

        Returns:
            Descriptor value or None if not found
        """
        try:
            snapshots = (
                passport.get('snapshots')
                if isinstance(passport, dict)
                else None
            )
            snapshot = (
                snapshots[0]
                if isinstance(snapshots, list) and snapshots
                else None
            )
            if not isinstance(snapshot, dict):
                self._addWarning('Component passport JSON has no snapshots')
                return None

            descriptors = snapshot.get('descriptors')
            if isinstance(descriptors, dict) and descriptor_key in descriptors:
                return descriptors[descriptor_key]

            self._addWarning(
                f'Descriptor key "{descriptor_key}" not found in '
                'snapshot.descriptors')
            return None
        except Exception as e:
            self._addError(f'Error extracting descriptor: {str(e)}')
            return None

    def convert_descriptor_to_gh_data(self, descriptor_value):
        """
        Convert descriptor value to appropriate Grasshopper data structure.

        Args:
            descriptor_value: The descriptor value (always float values)

        Returns:
            Grasshopper DataTree with appropriate structure
        """
        result_tree = Grasshopper.DataTree[System.Object]()

        if descriptor_value is None:
            return result_tree

        # Single float value
        if isinstance(descriptor_value, (int, float)):
            ghp = Grasshopper.Kernel.Data.GH_Path(0)
            result_tree.Add(float(descriptor_value), ghp)

        # List of floats
        elif isinstance(descriptor_value, list):
            if len(descriptor_value) == 0:
                return result_tree

            # Check if it's a list of lists (2D)
            if all(isinstance(item, list) for item in descriptor_value):
                # Check if it's 3D (list of lists of lists)
                is_3d = all(isinstance(sublist_item, list)
                            for sublist in descriptor_value
                            for sublist_item in sublist)
                if is_3d:
                    # 3D structure: [[[1,2],[3,4]], [[5,6],[7,8]]]
                    # Paths: (0;0), (0;1), (1;0), (1;1)
                    for i, sublist in enumerate(descriptor_value):
                        for j, inner_list in enumerate(sublist):
                            ghp = Grasshopper.Kernel.Data.GH_Path(i, j)
                            for value in inner_list:
                                result_tree.Add(float(value), ghp)
                else:
                    # 2D structure: [[1,2,3], [9,8,7]]
                    # Paths: (0) for first sublist, (1) for second sublist
                    for i, sublist in enumerate(descriptor_value):
                        ghp = Grasshopper.Kernel.Data.GH_Path(i)
                        for value in sublist:
                            result_tree.Add(float(value), ghp)
            else:
                # Simple list of floats: [1,2,3]
                # Single branch: (0)
                path = Grasshopper.Kernel.Data.GH_Path(0)
                for value in descriptor_value:
                    result_tree.Add(float(value), path)
        else:
            # Fallback for other types
            ghp = Grasshopper.Kernel.Data.GH_Path(0)
            result_tree.Add(float(descriptor_value), ghp)

        return result_tree

    def RunScript(self, Input: list[object], DescriptorKey: str):
        # set up output trees and results tuple
        if self._stop():
            return empty_outputs()
        DescriptorValues = Grasshopper.DataTree[System.Object]()
        try:
            # Validate inputs
            if not Input:
                msg = 'No input provided'
                self._addWarning(msg)
                return DescriptorValues

            if not DescriptorKey:
                msg = 'No descriptor key provided'
                self._addWarning(msg)
                return self._no_result('DescriptorKey')


            # Process each input item
            input_list = list(Input)
            for input_index, input_item in enumerate(input_list):
                # Determine input type and extract passport data
                passport = None

                # Check if input is a passport JSON string
                if isinstance(input_item, str):
                    try:
                        passport = json.loads(input_item)
                        self._addRemark(
                            f'Input {input_index} detected as component passport JSON')
                    except json.JSONDecodeError:
                        msg = (f'Input {input_index} is not valid component passport '
                               'JSON!')
                        self._addError(msg)
                        continue
                else:
                    # Input is geometry - extract passport from userdata
                    passport = self.extract_passport_from_geometry(input_item)
                    if not passport:
                        msg = (f'Could not extract component passport data from '
                               f'input {input_index}!')
                        self._addError(msg)
                        continue

                    self._addRemark(
                        f'Input {input_index} detected as geometry with '
                        'component passport userdata')

                # Extract descriptor value
                try:
                    descriptor_value = self.get_descriptor_value(
                        passport, DescriptorKey)

                    if descriptor_value is not None:
                        # Convert descriptor to appropriate Grasshopper data
                        converted_tree = self.convert_descriptor_to_gh_data(
                            descriptor_value)

                        # Merge the converted tree into the output
                        for i in range(converted_tree.BranchCount):
                            original_path = converted_tree.Path(i)
                            # get runcount for first GH Tree index
                            rc = self.Component.RunCount - 1
                            # Prepend input index to the path
                            new_path = Grasshopper.Kernel.Data.GH_Path(
                                0,
                                rc,
                                input_index,
                                *original_path.Indices)
                            branch_data = converted_tree.Branch(i)
                            for item in branch_data:
                                DescriptorValues.Add(item, new_path)

                        self._addRemark(
                            f'Successfully extracted descriptor '
                            f'"{DescriptorKey}" from input {input_index}'
                        )
                    else:
                        # Descriptor not found
                        msg = (f'Descriptor "{DescriptorKey}" not found in '
                               f'input {input_index}')
                        self._addWarning(msg)

                except Exception as e:
                    msg = (f'Error extracting descriptor from input '
                           f'{input_index}: {str(e)}')
                    self._addError(msg)

            # Update success message

            # return output trees
            return DescriptorValues

        except Exception as e:
            msg = f'Unexpected error during descriptor extraction: {str(e)}'
            self._addError(msg)
            return null_outputs()
# ---------- end getdescriptor ----------
radial_distance_32 = Data(getdescriptor)

# Step 3.2
# comments & notes: Get radial shape signature tangent vectors with medium (32 rays) resolution.
panel_12 = Panel("radial_tangent_32")
componentpassport_27 = Data(componentpassport_3)
getdescriptor_2 = GetDescriptor(Input=componentpassport_27, DescriptorKey=panel_12)  # -> DescriptorValues; inputs Input: list, DescriptorKey: String; same code as getdescriptor
radial_tangent_32 = Data(getdescriptor_2)

# Step 3.3
# comments & notes: Get simple shape descriptors by their key.
# boxscore = 0 means the component is a perfect box
# boxscore = 100 means it is anything but a box
# comments & notes: Get simple shape descriptors by their key.
# linescore = 0 means the component is a perfect line
# linescore = 100 means it is anything but a line
# comments & notes: Get simple shape descriptors by their key.
# linescore = 0 means the component is a perfect line
# linescore = 100 means it is anything but a line
# comments & notes: Get simple shape descriptors by their key.
# linescore = 0 means the component is a perfect line
# linescore = 100 means it is anything but a line
panel_13 = Panel("boxscore")
componentpassport_28 = Data(componentpassport_3)
componentpassport_29 = Data(componentpassport_3)
componentpassport_30 = Data(componentpassport_3)
componentpassport_31 = Data(componentpassport_3)
getdescriptor_3 = GetDescriptor(Input=componentpassport_28, DescriptorKey=panel_13)  # -> DescriptorValues; inputs Input: list, DescriptorKey: String; same code as getdescriptor
getdescriptor_4 = GetDescriptor(Input=componentpassport_29, DescriptorKey="linescore")  # -> DescriptorValues; inputs Input: list, DescriptorKey: String; same code as getdescriptor
getdescriptor_5 = GetDescriptor(Input=componentpassport_30, DescriptorKey="spherescore")  # -> DescriptorValues; inputs Input: list, DescriptorKey: String; same code as getdescriptor
getdescriptor_6 = GetDescriptor(Input=componentpassport_31, DescriptorKey="planescore")  # -> DescriptorValues; inputs Input: list, DescriptorKey: String; same code as getdescriptor
spherescore = Data(getdescriptor_5)
boxscore = Data(getdescriptor_3)
linescore = Data(getdescriptor_4)
planescore = Data(getdescriptor_6)

# ---- group: __DDU_CSC_EXAMPLE_01__
# Step 4
# comments & notes: With this component we can apply any transformation (moving, rotating etc.) defined as a XForm (Rhino Transformation) to the components.
# 
# NOTE: This does not alter the components itself, it just tells the system where and how to place them. We do NOT change the catalogue!
componentpassport_32 = Data(componentpassport_2)
xform_4 = Data(xform_2)
transformcomponent_2 = TransformComponent(ComponentPassport=componentpassport_32, XForm=xform_4)  # -> XComponentPassport; inputs ComponentPassport: String, XForm: Transform; same code as transformcomponent
xcomponentpassport = Data(transformcomponent_2)

# ---- group: __DDU_CSC_EXAMPLE_07__
capture = Capture()  # -> Capture; inputs Method: String, Device: String, Software: String, CapturedAt: String, Notes: String, CoordinateSystem: String, CoordinateSystemNote: String, MarkerPoints: list of Point3d, MarkerLabels: list, MarkerRoles: list, Fixtures: list
# ---------- capture: Python ----------
#! python3
# -*- coding: utf-8 -*-
# venv: DDU_CSC
# r: charset_normalizer
# r: numpy==2.0.2
print('ENV OK!')

# PYTHON STANDARD LIBRARY IMPORTS ---------------------------------------------
import json  # NOQA

# RHINO AND GH RELATED IMPORTS ------------------------------------------------
import System  # NOQA
import Rhino  # NOQA
import Grasshopper  # NOQA

# GHENV COMPONENT SETTINGS ----------------------------------------------------
ghenv.Component.Name = 'Capture'  # NOQA
ghenv.Component.NickName = 'Capture'  # NOQA
ghenv.Component.Category = 'DDU_CSC'  # NOQA
ghenv.Component.SubCategory = '3 Component Operations'  # NOQA
ghenv.Component.Description = (  # NOQA
    'Builds how the geometry of a state was recorded (method, device, '
    'software, coordinate system, markers, fixtures) as JSON for '
    'CreateComponentSnapshot / CreateComponentIdentity. Markers and '
    'fixtures (a scanning rig) are never part of the geometry of the '
    'component itself.'
)

# CSC LIBRARY (decision 8.111) ----------------------------------------------
CSC_GH_MINIMUM = '261102'
LIBRARY_PROBLEM = None
try:
    import csc_gh
    csc_gh.require(CSC_GH_MINIMUM)
    from csc_gh.build import (BuildError, capture)  # NOQA
    from csc_gh.messages import (waits_for_data)  # NOQA
except ImportError:
    LIBRARY_PROBLEM = (
        'CSC library 261102 too old or missing: run CSC_Update, '
        'then restart Rhino')

# OPTIONAL HELPERS: they never block the component (decisions 8.112, 8.113) ---
try:
    from csc_gh.ports import ensure_outputs
    from csc_gh.messages import set_state
except ImportError:
    ensure_outputs = set_state = None

OUTPUTS = [
    ('Capture', 'Capture',
     'Capture JSON (a fragment of the API payload)'),
]


def empty_outputs():
    """What RunScript returns when it stops early or has no result: an empty
    Grasshopper tree per output (never '' or None)."""
    if not OUTPUTS:
        return None
    trees = tuple(Grasshopper.DataTree[System.Object]() for _ in OUTPUTS)
    return trees[0] if len(trees) == 1 else trees


def null_outputs():
    """One null per output: an item of an item-access component that has no
    result keeps its slot (decision 8.186)."""
    if len(OUTPUTS) <= 1:
        return None
    return tuple(None for _ in OUTPUTS)


class CSC_Capture(Grasshopper.Kernel.GH_ScriptInstance):
    """
    Author: Max Benjamin Eschenbach
    License: MIT License
    Version: 261102
    """

    _outputs_ready = True       # set by BeforeRunScript (8.112)
    _outputs_note = None

    def __init__(self):
        """Initialize this component and set component parameters."""
        super().__init__()
        self.Component = ghenv.Component  # NOQA
        self.InputParams = self.Component.Params.Input
        self.OutputParams = self.Component.Params.Output

    def _addRemark(self, msg: str = ''):
        rml = self.Component.RuntimeMessageLevel.Remark
        self.AddRuntimeMessage(rml, msg)

    def _addWarning(self, msg: str = ''):
        rml = self.Component.RuntimeMessageLevel.Warning
        self.AddRuntimeMessage(rml, msg)

    def _addError(self, msg: str = ''):
        rml = self.Component.RuntimeMessageLevel.Error
        self.AddRuntimeMessage(rml, msg)

    def _state(self, text=''):
        """The one short state under the component (decision 8.113)."""
        if set_state is not None:
            set_state(self.Component, text)

    def _no_result(self, *ports):
        """The result of an iteration without one (decision 8.186): empty
        outputs when the inputs in ``ports`` carry no data at all (the
        component waits for data; no ports: a list or tree input is empty),
        else a null in the slot of this item, so the outputs stay one to one
        with the input list."""
        if not ports or (waits_for_data is not None
                         and waits_for_data(self, ports)):
            return empty_outputs()
        return null_outputs()

    def _stop(self):
        """True when RunScript has to return early: the library is missing or
        too old, or the outputs were just updated (says why)."""
        if LIBRARY_PROBLEM:
            self._addError(LIBRARY_PROBLEM)
            return True
        if self._outputs_note:
            self._addRemark(self._outputs_note)
        return not self._outputs_ready

    def _check_outputs(self):
        """Make the outputs match OUTPUTS before the script runs (8.112)."""
        self._outputs_ready, self._outputs_note = True, None
        if ensure_outputs is None:
            self._outputs_note = (
                'output check skipped: CSC library not installed')
            return
        status = ensure_outputs(self.Component, OUTPUTS)
        self._outputs_ready, self._outputs_note = status.ready, status.remark

    def BeforeRunScript(self):
        """Perform some setup actions."""
        self.InputParams[0].Description = (
            'photogrammetry, lidar, structured_light or manual'
        )
        self.InputParams[1].Description = (
            'Scanner or camera'
        )
        self.InputParams[2].Description = (
            'Software that made the geometry'
        )
        self.InputParams[3].Description = (
            'When it was captured (2024-05-03, ...)'
        )
        self.InputParams[4].Description = (
            'Free text'
        )
        self.InputParams[5].Description = (
            'Name of the coordinate system the geometry is in, e.g. the gripper '
            'marker plane'
        )
        self.InputParams[6].Description = (
            'Description of that coordinate system'
        )
        self.InputParams[7].Description = (
            'Marker points'
        )
        self.InputParams[8].Description = (
            'One label per marker point'
        )
        self.InputParams[9].Description = (
            'rig or component, one per marker point (default component)'
        )
        self.InputParams[10].Description = (
            'Fixtures as label|file name'
        )
        # Initialize output param descriptions
        self._check_outputs()
        if LIBRARY_PROBLEM is None:
            csc_gh.dev_reload(globals())

    def RunScript(self,
            Method: str,
            Device: str,
            Software: str,
            CapturedAt: str,
            Notes: str,
            CoordinateSystem: str,
            CoordinateSystemNote: str,
            MarkerPoints: list[Rhino.Geometry.Point3d],
            MarkerLabels: list[object],
            MarkerRoles: list[object],
            Fixtures: list[object]):
        if self._stop():
            return empty_outputs()
        Capture = empty_outputs()
        try:
            points = list(MarkerPoints or [])
            labels = list(MarkerLabels or [])
            roles = list(MarkerRoles or [])
            if points and len(labels) not in (len(points),):
                raise BuildError('give one MarkerLabel per marker point '
                                 f'({len(points)} points, {len(labels)} labels)')
            if roles and len(roles) not in (1, len(points)):
                raise BuildError('give one MarkerRole for all points or one per '
                                 'point')
            marker_items = []
            for index, point in enumerate(points):
                role = (roles[0] if len(roles) == 1 else roles[index]) \
                    if roles else None
                marker_items.append((labels[index], role,
                                     (point.X, point.Y, point.Z)))
            fixture_items = []
            for item in Fixtures or []:
                label, _, file_name = str(item).partition('|')
                fixture_items.append((label, file_name))
            fragment = capture(Method, Device, Software, CapturedAt, Notes,
                               CoordinateSystem, CoordinateSystemNote, marker_items,
                               fixture_items)
            Capture = json.dumps(fragment)
            return Capture
        except BuildError as error:
            self._addError(str(error))
            return null_outputs()
        except Exception as error:
            msg = f'Unexpected error: {error}'
            self._addError(msg)
            return null_outputs()
        return Capture
# ---------- end capture ----------
capture_2 = Data(capture)

# ----
# comments & notes: Disassemble Component into its elements
componentpassport_33 = Data(componentpassport_20)
disassemblecomponent = DisassembleComponent(ComponentPassport=componentpassport_33)  # -> IdentityID, Name, OriginalFunction, Material, Color, Location, BoundingBox, Frame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; inputs ComponentPassport: tree
# ---------- disassemblecomponent: Python ----------
#! python3
# -*- coding: utf-8 -*-
# venv: DDU_CSC
# r: charset_normalizer
# r: numpy==2.0.2
print('ENV OK!')

# PYTHON STANDARD LIBRARY IMPORTS ---------------------------------------------
import json  # NOQA

# RHINO AND GH RELATED IMPORTS ------------------------------------------------
import System  # NOQA
import Rhino  # NOQA
import Grasshopper  # NOQA
import scriptcontext as sc  # NOQA

# GHENV COMPONENT SETTINGS ----------------------------------------------------
ghenv.Component.Name = 'DisassembleComponent'  # NOQA
ghenv.Component.NickName = 'DisassembleComponent'  # NOQA
ghenv.Component.Category = 'DDU_CSC'  # NOQA
ghenv.Component.SubCategory = '3 Component Operations'  # NOQA
ghenv.Component.Description = (  # NOQA
    'Parses component passport JSON ({identity, snapshots[]}) and outputs individual '
    'fields as Grasshopper-native types: the preview geometry (meshes, '
    'point clouds, authored shapes), the frame and the box on it, the '
    'condition grade, the origin (and whether the element is still in '
    'place), the elements left of a batch and the capture markers. Geometry is in '
    'the stored coordinates of the element, moved by its client-side '
    'csc_placement when it has one.'
)

# CSC LIBRARY (decision 8.111) ----------------------------------------------
CSC_GH_MINIMUM = '261005'
LIBRARY_PROBLEM = None
try:
    import csc_gh
    csc_gh.require(CSC_GH_MINIMUM)
    from csc_gh.read import (authored_only, box_of, capture_markers, condition_grade, drawable_proxies, load_passport, parts, placement_of)  # NOQA
    from csc_gh.rhino import (inline_cloud_to_rhino, inline_mesh_to_rhino, placement_transform, plane_from_frame, proxy_to_rhino)  # NOQA
except ImportError:
    LIBRARY_PROBLEM = (
        'CSC library 261005 too old or missing: run CSC_Update, '
        'then restart Rhino')

# OPTIONAL HELPERS: they never block the component (decisions 8.112, 8.113) ---
try:
    from csc_gh.ports import ensure_outputs
    from csc_gh.messages import set_state
except ImportError:
    ensure_outputs = set_state = None

OUTPUTS = [
    ('IdentityID', 'IdentityID',
     'Identity ID (GUID)'),
    ('Name', 'Name',
     'Snapshot name (e.g. My Component 01)'),
    ('OriginalFunction', 'OriginalFunction',
     'Original function (IFC class, e.g. IfcBeam)'),
    ('Material', 'Material',
     'Component material (id)'),
    ('Color', 'Color',
     'Snapshot color as System.Drawing.Color'),
    ('Location', 'Location',
     'Snapshot location as Point3d (X=latitude, Y=longitude, Z=0)'),
    ('BoundingBox', 'BoundingBox',
     'The box of the element on its frame (extents bbx), as a '
     'Rhino.Geometry.Box where the element sits (the stored coordinates '
     'moved by csc_placement, if the passport has one)'),
    ('Frame', 'Frame',
     'The frame of the element as a plane (centre of the box, canonical '
     'axes) where the element sits: the stored frame moved by csc_placement, '
     'if the passport has one'),
    ('Descriptors', 'Descriptors',
     'Snapshot descriptors/metadata as JSON string'),
    ('Geometry', 'Geometry',
     'Geometry of the element: Rhino geometry objects (meshes, point '
     'clouds, authored shapes). Point clouds prefer the full PLY when '
     'Session is signed in, else the inline preview.'),
    ('CaptureMarkers', 'CaptureMarkers',
     'Capture markers as Point3d objects (a scanning rig is not part of '
     'the geometry)'),
    ('Capture', 'Capture',
     'Capture block as JSON (method, device, coordinate system, markers '
     'with label and role, fixtures)'),
    ('Attributes', 'Attributes',
     'Identity attributes as JSON string'),
    ('ConditionGrade', 'ConditionGrade',
     'Overall condition grade (0=unusable as is, 1=poor, 2=average, '
     '3=good) from the evidence; empty when not assessed'),
    ('ManufacturedAt', 'ManufacturedAt',
     'Component manufacturing date as ISO-8601 UTC timestamp'),
    ('ManufacturedPrecision', 'ManufacturedPrecision',
     'Precision qualifier for ManufacturedAt (exact, day, month, year, '
     'unknown)'),
    ('Origin', 'Origin',
     'Origin block as JSON (kind, date, place, construction work, '
     'method, who ...)'),
    ('ParentIdentities', 'ParentIdentities',
     'Parent identity IDs (GUIDs) this identity was cut from'),
    ('Planned', 'Planned',
     'True while the element is still in place: identified in its works, '
     'not yet deinstalled'),
    ('Remaining', 'Remaining',
     'Elements left in a batch (recorded quantity minus the elements drawn); '
     'empty for an element that is not a batch'),
]


def empty_outputs():
    """What RunScript returns when it stops early or has no result: an empty
    Grasshopper tree per output (never '' or None)."""
    if not OUTPUTS:
        return None
    trees = tuple(Grasshopper.DataTree[System.Object]() for _ in OUTPUTS)
    return trees[0] if len(trees) == 1 else trees


class CSC_DisassembleComponent(Grasshopper.Kernel.GH_ScriptInstance):
    """
    Author: Max Benjamin Eschenbach
    License: MIT License
    Version: 261102
    """

    _outputs_ready = True       # set by BeforeRunScript (8.112)
    _outputs_note = None

    def __init__(self):
        """Initialize this component and set component parameters."""
        super().__init__()
        self.Component = ghenv.Component  # NOQA
        self.InputParams = self.Component.Params.Input
        self.OutputParams = self.Component.Params.Output

    def _addRemark(self, msg: str = ''):
        rml = self.Component.RuntimeMessageLevel.Remark
        self.AddRuntimeMessage(rml, msg)

    def _addWarning(self, msg: str = ''):
        rml = self.Component.RuntimeMessageLevel.Warning
        self.AddRuntimeMessage(rml, msg)

    def _addError(self, msg: str = ''):
        rml = self.Component.RuntimeMessageLevel.Error
        self.AddRuntimeMessage(rml, msg)

    def _state(self, text=''):
        """The one short state under the component (decision 8.113)."""
        if set_state is not None:
            set_state(self.Component, text)

    def _stop(self):
        """True when RunScript has to return early: the library is missing or
        too old, or the outputs were just updated (says why)."""
        if LIBRARY_PROBLEM:
            self._addError(LIBRARY_PROBLEM)
            return True
        if self._outputs_note:
            self._addRemark(self._outputs_note)
        return not self._outputs_ready

    def _check_outputs(self):
        """Make the outputs match OUTPUTS before the script runs (8.112)."""
        self._outputs_ready, self._outputs_note = True, None
        if ensure_outputs is None:
            self._outputs_note = (
                'output check skipped: CSC library not installed')
            return
        status = ensure_outputs(self.Component, OUTPUTS)
        self._outputs_ready, self._outputs_note = status.ready, status.remark

    def BeforeRunScript(self):
        """Perform some setup actions."""
        self.InputParams[0].Description = (
            'Component passport JSON ({identity, snapshots[]}) fetched from the server.'
        )
        self._check_outputs()
        if LIBRARY_PROBLEM is None:
            csc_gh.dev_reload(globals())

    def get_auth_core_from_sticky(self):
        """Return Session AuthCore when signed in; None otherwise."""
        return sc.sticky.get('CSC_AuthCore')

    def fetch_snapshot_point_clouds(self, auth_core, snapshot,
                                    identity_id=None):
        """Prefer the full point-cloud PLY via the Session cache, then the
        inline preview; ``[(cloud, primitive index)]``."""
        geometry = snapshot.get('geometry', {}) or {}
        inline_clouds = geometry.get('point_clouds', []) or []
        snapshot_id = snapshot.get('_id')
        results = []
        for index, entry in enumerate(inline_clouds):
            cloud = None
            if auth_core and snapshot_id:
                try:
                    cloud = auth_core.cached_get_snapshot_point_cloud(
                        snapshot_id, index)
                except Exception as error:
                    self._addWarning('Point cloud PLY fetch failed '
                                     f'for index {index}: {error}')
            if cloud is None:
                cloud = inline_cloud_to_rhino(entry)
            if cloud is not None:
                results.append((cloud, index))
            else:
                self._addWarning(
                    f'Point cloud {index} of identity {identity_id} dropped: '
                    'empty, not valid, not finite or wider than 10 km')
        return results

    def snapshot_geometry(self, auth_core, snapshot, identity_id):
        """``[(rhino geometry, kind, index)]`` of a snapshot."""
        geometry = snapshot.get('geometry', {}) or {}
        color = snapshot.get('color') or [110, 110, 110]
        items = []
        for index, entry in enumerate(geometry.get('meshes', []) or []):
            mesh = inline_mesh_to_rhino(entry, color)
            if mesh is None:
                self._addWarning(
                    f'Mesh {index} of identity {identity_id} dropped: '
                    'empty, not valid, not finite or wider than 10 km')
                continue
            items.append((mesh, 'mesh', index))
        for cloud, index in self.fetch_snapshot_point_clouds(
                auth_core, snapshot, identity_id):
            items.append((cloud, 'point_cloud', index))
        if authored_only(snapshot):
            for index, proxy in drawable_proxies(snapshot):
                if (proxy.get('fit') or {}).get('method') != 'authored':
                    continue
                shape = proxy_to_rhino(proxy)
                if shape is None:
                    self._addWarning(
                        f'Proxy {index} of identity {identity_id} dropped: '
                        'cannot be drawn, not valid, not finite or wider '
                        'than 10 km')
                    continue
                items.append((shape, 'proxy', index))
        return items

    def RunScript(self, ComponentPassport: Grasshopper.DataTree[object]):
        if self._stop():
            return empty_outputs()
        names = ('IdentityID', 'Name', 'OriginalFunction', 'Material', 'Color',
                 'Location', 'BoundingBox', 'Frame', 'Descriptors',
                 'Geometry', 'CaptureMarkers', 'Capture',
                 'Attributes', 'ConditionGrade', 'ManufacturedAt',
                 'ManufacturedPrecision', 'Origin', 'ParentIdentities',
                 'Planned', 'Remaining')
        trees = {n: Grasshopper.DataTree[System.Object]() for n in names}
        __Results = tuple(trees[n] for n in names)
        try:
            if not ComponentPassport or ComponentPassport.DataCount == 0:
                self._addWarning(
                    'Input parameter ComponentPassport failed to collect data')
                return __Results

            auth_core = self.get_auth_core_from_sticky()

            for i in range(ComponentPassport.BranchCount):
                ghp = ComponentPassport.Paths[i]
                for comp in ComponentPassport.Branches[i]:
                    try:
                        passport = load_passport(comp)
                        identity, snapshot = parts(passport)
                        if not identity or not snapshot:
                            self._addWarning('Component passport JSON missing identity/'
                                             'snapshots, skipping entry')
                            continue
                        identity_id = identity.get('_id')
                        trees['IdentityID'].Add(identity_id, ghp)
                        trees['Name'].Add(snapshot.get('name'), ghp)
                        trees['OriginalFunction'].Add(
                            identity.get('original_function'), ghp)
                        trees['Material'].Add(identity.get('material'), ghp)
                        rgb_value = snapshot.get('color') or [110, 110, 110]
                        trees['Color'].Add(System.Drawing.Color.FromArgb(
                            255, *rgb_value), ghp)
                        place = snapshot.get('location') or {}
                        if 'lat' in place and 'lon' in place:
                            trees['Location'].Add(Rhino.Geometry.Point3d(
                                place['lat'], place['lon'], 0.0), ghp)
                        else:
                            trees['Location'].Add(
                                Rhino.Geometry.Point3d(0.0, 0.0, 0.0), ghp)

                        # the client-side placement of the piece, if any
                        placed = placement_of(passport)
                        xform = placement_transform(placed) if placed \
                            else Rhino.Geometry.Transform.Identity

                        for geom, kind, index in self.snapshot_geometry(
                                auth_core, snapshot, identity_id):
                            geom.Transform(xform)
                            geom.SetUserString('csc_component', comp)
                            if kind == 'mesh':
                                geom.SetUserString('csc_mesh_index',
                                                   str(index))
                            elif kind == 'point_cloud':
                                geom.SetUserString('csc_point_cloud_index',
                                                   str(index))
                            else:
                                geom.SetUserString('csc_proxy_index',
                                                   str(index))
                            trees['Geometry'].Add(geom, ghp)

                        # the frame and the box on it
                        box = box_of(snapshot)
                        if box:
                            frame, size = box
                            plane = plane_from_frame(frame)
                            shape = Rhino.Geometry.Box(
                                plane,
                                Rhino.Geometry.Interval(-size[0] / 2,
                                                        size[0] / 2),
                                Rhino.Geometry.Interval(-size[1] / 2,
                                                        size[1] / 2),
                                Rhino.Geometry.Interval(-size[2] / 2,
                                                        size[2] / 2))
                            shape.Transform(xform)
                            plane.Transform(xform)
                            trees['BoundingBox'].Add(shape, ghp)
                            trees['Frame'].Add(plane, ghp)
                        else:
                            self._addWarning(
                                f'Identity {identity_id}: the snapshot has no '
                                'frame yet (geometry still being processed?)')

                        trees['Descriptors'].Add(json.dumps(
                            snapshot.get('descriptors', {}) or {}), ghp)

                        for label, role, point in capture_markers(snapshot):
                            marker = Rhino.Geometry.Point3d(*point)
                            marker.Transform(xform)
                            trees['CaptureMarkers'].Add(marker, ghp)
                        if snapshot.get('capture'):
                            trees['Capture'].Add(json.dumps(
                                snapshot['capture']), ghp)

                        trees['Attributes'].Add(json.dumps(
                            identity.get('attributes', {}) or {}), ghp)
                        grade = condition_grade(snapshot)
                        if grade is not None:
                            trees['ConditionGrade'].Add(grade, ghp)
                        if identity.get('manufactured_at') is not None:
                            trees['ManufacturedAt'].Add(
                                identity['manufactured_at'], ghp)
                        if identity.get('manufactured_precision') is not None:
                            trees['ManufacturedPrecision'].Add(
                                identity['manufactured_precision'], ghp)
                        if identity.get('origin'):
                            trees['Origin'].Add(json.dumps(
                                identity['origin']), ghp)
                        for parent in identity.get('parent_identities') or []:
                            trees['ParentIdentities'].Add(parent, ghp)
                        trees['Planned'].Add(bool(
                            (identity.get('origin') or {}).get('planned')),
                            ghp)
                        if identity.get('remaining') is not None:
                            trees['Remaining'].Add(
                                int(identity['remaining']), ghp)

                    except Exception as error:
                        self._addError(
                            f'Error processing component: {error}')

            return __Results

        except Exception as error:
            self._addError(f'Unexpected error during disassembly: {error}')
            return __Results
# ---------- end disassemblecomponent ----------
manufacturedprecision = Data(disassemblecomponent.ManufacturedPrecision)
manufacturedat = Data(disassemblecomponent.ManufacturedAt)
capturemarkers = Data(disassemblecomponent.CaptureMarkers)
conditiongrade = Data(disassemblecomponent.ConditionGrade)
parentidentities = Data(disassemblecomponent.ParentIdentities)
boundingbox = Data(disassemblecomponent.BoundingBox)
descriptors = Data(disassemblecomponent.Descriptors)
remaining = Data(disassemblecomponent.Remaining)
attributes = Data(disassemblecomponent.Attributes)
identityid_4 = Data(disassemblecomponent.IdentityID)
planned = Data(disassemblecomponent.Planned)
location_6 = Data(disassemblecomponent.Location)
material_7 = Data(disassemblecomponent.Material)
capture_3 = Data(disassemblecomponent.Capture)
name = Data(disassemblecomponent.Name)
type = Data(disassemblecomponent.OriginalFunction)
color_3 = Data(disassemblecomponent.Color)
frame = Data(disassemblecomponent.Frame)
proxies = Data(disassemblecomponent.Geometry)
origin_4 = Data(disassemblecomponent.Origin)

# ---- group: __DDU_CSC_EXAMPLE_03__
# Step 4
# Step 5
# comments & notes: Sync Components from Rhino document.
# 
# NOTE: If you transform the components within your Rhino document, transformations will be carried over, as long as the attached TextTag is transformed equally!
# comments & notes: Activate the Toggle to Synchornize!
toggle_2 = BooleanToggle(False)
syncwithrhinodoc = SyncWithRhinoDoc(Sync=toggle_2)  # -> DocumentComponents; inputs Sync: Boolean
# ---------- syncwithrhinodoc: Python ----------
#! python3
# -*- coding: utf-8 -*-
# venv: DDU_CSC
# r: charset_normalizer
# r: numpy==2.0.2
print('ENV OK!')

# PYTHON STANDARD LIBRARY IMPORTS ---------------------------------------------
import json  # NOQA

# RHINO AND GH RELATED IMPORTS ------------------------------------------------
import System  # NOQA
import Grasshopper  # NOQA
import Rhino  # NOQA
import scriptcontext as sc  # NOQA

# GHENV COMPONENT SETTINGS ----------------------------------------------------
ghenv.Component.Name = 'SyncWithRhinoDoc'  # NOQA
ghenv.Component.NickName = 'SyncWithRhinoDoc'  # NOQA
ghenv.Component.Category = 'DDU_CSC'  # NOQA
ghenv.Component.SubCategory = '4 RhinoDoc Interaction'  # NOQA
ghenv.Component.Description = (  # NOQA
    'Reads the elements back from the active Rhino document: every text tag '
    'with the user text csc_identity_id / csc_snapshot_id / csc_placement '
    '(an element baked by BakeComponents or by PassportToD2P) gives its '
    'component passport JSON with csc_placement set from where the tag is now, so '
    'moving or rotating an element in Rhino moves it in Grasshopper. The '
    'component passport is the tag csc_component, else read by id through the '
    'Session. Nothing is written to the server.'
)

# CSC LIBRARY (decision 8.111) ----------------------------------------------
CSC_GH_MINIMUM = '261005'
LIBRARY_PROBLEM = None
try:
    import csc_gh
    csc_gh.require(CSC_GH_MINIMUM)
    from csc_gh.doc import (passport_fetcher, read_document)  # NOQA
except ImportError:
    LIBRARY_PROBLEM = (
        'CSC library 261005 too old or missing: run CSC_Update, '
        'then restart Rhino')

# OPTIONAL HELPERS: they never block the component (decisions 8.112, 8.113) ---
try:
    from csc_gh.ports import ensure_outputs
    from csc_gh.messages import set_state
except ImportError:
    ensure_outputs = set_state = None

OUTPUTS = [
    ('DocumentComponents', 'DocumentComponents',
     'DataTree of component passport JSON ({identity, snapshots[]}) of the elements in the document, one per tag, with csc_placement set from the tag plane (feed it to Disassemble, ApplyFrame or TransformComponent)'),
]


def empty_outputs():
    """What RunScript returns when it stops early or has no result: an empty
    Grasshopper tree per output (never '' or None)."""
    if not OUTPUTS:
        return None
    trees = tuple(Grasshopper.DataTree[System.Object]() for _ in OUTPUTS)
    return trees[0] if len(trees) == 1 else trees


class CSC_SyncWithRhinoDoc(Grasshopper.Kernel.GH_ScriptInstance):
    """
    Author: Max Benjamin Eschenbach
    License: MIT License
    Version: 261102
    """

    _outputs_ready = True       # set by BeforeRunScript (8.112)
    _outputs_note = None

    def __init__(self):
        """Initialize this component and set component parameters."""
        super().__init__()
        # initialize props
        self.Component = ghenv.Component  # NOQA
        self.InputParams = self.Component.Params.Input
        self.OutputParams = self.Component.Params.Output

    def _addRemark(self, msg: str = ''):
        """Add a remark message to the component."""
        rml = self.Component.RuntimeMessageLevel.Remark
        self.AddRuntimeMessage(rml, msg)

    def _addWarning(self, msg: str = ''):
        """Add a warning message to the component."""
        rml = self.Component.RuntimeMessageLevel.Warning
        self.AddRuntimeMessage(rml, msg)

    def _addError(self, msg: str = ''):
        """Add an error message to the component."""
        rml = self.Component.RuntimeMessageLevel.Error
        self.AddRuntimeMessage(rml, msg)

    def _state(self, text=''):
        """The one short state under the component (decision 8.113)."""
        if set_state is not None:
            set_state(self.Component, text)

    def _stop(self):
        """True when RunScript has to return early: the library is missing or
        too old, or the outputs were just updated (says why)."""
        if LIBRARY_PROBLEM:
            self._addError(LIBRARY_PROBLEM)
            return True
        if self._outputs_note:
            self._addRemark(self._outputs_note)
        return not self._outputs_ready

    def _check_outputs(self):
        """Make the outputs match OUTPUTS before the script runs (8.112)."""
        self._outputs_ready, self._outputs_note = True, None
        if ensure_outputs is None:
            self._outputs_note = (
                'output check skipped: CSC library not installed')
            return
        status = ensure_outputs(self.Component, OUTPUTS)
        self._outputs_ready, self._outputs_note = status.ready, status.remark

    def BeforeRunScript(self):
        """Perform some setup actions."""
        # Initialize input param descriptions
        self.InputParams[0].Description = (
            'Trigger to sync components with Rhino document'
        )
        # Initialize output param descriptions
        self._check_outputs()
        if LIBRARY_PROBLEM is None:
            csc_gh.dev_reload(globals())

    def RunScript(self, Sync: bool):
        # init outputs
        if self._stop():
            return empty_outputs()
        DocumentComponents = Grasshopper.DataTree[str]()
        if not Sync:
            # Return empty results if not syncing
            self._state('Sync is off')
            return DocumentComponents
        try:
            doc = Rhino.RhinoDoc.ActiveDoc
            fetch = passport_fetcher(sc.sticky.get('CSC_AuthCore'))
            pieces = read_document(doc, fetch)
            if not pieces:
                msg = 'No components found in document!'
                self._addWarning(msg)
                return DocumentComponents

            for i, piece in enumerate(pieces):
                label = piece['identity_id'] or 'a tag without an identity'
                for problem in piece['problems']:
                    self._addWarning(f'{label}: {problem}')
                if piece['passport'] is None:
                    continue
                ghp = Grasshopper.Kernel.Data.GH_Path(i)
                DocumentComponents.Add(json.dumps(piece['passport']), ghp)
                self._addRemark(f'Read {label} from its tag')

            if DocumentComponents.DataCount > 0:
                self._state(f'Synced {DocumentComponents.DataCount}')
            else:
                self._addWarning('No components were successfully synced')
            return DocumentComponents

        except Exception as e:
            msg = f'Unexpected error during sync: {str(e)}'
            self._addError(msg)
            return DocumentComponents
# ---------- end syncwithrhinodoc ----------
componentpassport_34 = Data(syncwithrhinodoc)

# ---- group: __DDU_CSC_EXAMPLE_06__
# Step 2.2
# comments & notes: Compute the radial signature for the design shapes.
# 
# Algorithmically, this is exactly the same as the process that runs on the server and pre-computes this signature for the components in the catalog.
resolution = Slider(64, range=0..100)
designshapes_3 = Data(designshapes_offset)
radialsignature = RadialSignature(Curves=designshapes_3, Resolution=resolution)  # -> Distances, Tangents, IntersectionPoints, Rays, RestPositionCurve, RestPositionFrame, RestPositionAngle, RestPositionTransform; inputs Curves: list, Resolution: Int32, RestPositionAlign: Boolean, NumAngles: Int32
# ---------- radialsignature: Python ----------
#! python3
# -*- coding: utf-8 -*-
# venv: DDU_CSC_MATCH
# r: charset_normalizer
# r: numpy==2.0.2
print('ENV OK!')

# PYTHON STANDARD LIBRARY IMPORTS ---------------------------------------------

# THIRD PARTY LIBRARY IMPORTS -------------------------------------------------
import numpy as np  # NOQA

# RHINO AND GH RELATED IMPORTS ------------------------------------------------
import System  # NOQA
import Grasshopper  # NOQA
import Rhino  # NOQA

# GHENV COMPONENT SETTINGS ----------------------------------------------------
ghenv.Component.Name = 'RadialSignature'  # NOQA
ghenv.Component.NickName = 'RadialSignature'  # NOQA
ghenv.Component.Category = 'DDU_CSC'  # NOQA
ghenv.Component.SubCategory = '7 Geometry Tools'  # NOQA
ghenv.Component.Description = (  # NOQA
    'Radial shape signature for planar boundary curves: rotates each curve '
    'into its canonical rest position (min-bbox-edge orientation), casts '
    'N evenly spaced rays from the centroid, and returns the distance to '
    'the first boundary intersection together with the boundary tangent '
    'at that intersection. Mirrors the backend `radial_signature` module.'
)


# -----------------------------------------------------------------------------
# PURE GEOMETRY HELPERS (port of apps/descriptors/radial_signature.py)
# -----------------------------------------------------------------------------
# Kept as module-level functions so they can be unit-tested / reused without
# the Grasshopper component shell, and so they stay numerically identical to
# the backend reference implementation.

_COINCIDENT_EPS: float = 1e-9
_DEFAULT_REST_ANGLES: int = 180


def _as_profile_array(profile) -> np.ndarray:
    """Validate and return an (M, 2) float array of profile points."""
    P = np.asarray(profile, dtype=np.float64)
    if P.ndim != 2 or P.shape[1] != 2:
        raise ValueError(
            f'profile must be a sequence of [x, y] pairs, got shape {P.shape}'
        )
    if len(P) < 3:
        raise ValueError(
            f'profile must have at least 3 points, got {len(P)}'
        )
    # Drop a duplicate closing vertex if present; the polyline is always
    # treated as an implicit closed polygon.
    if np.allclose(P[0], P[-1]):
        P = P[:-1]
        if len(P) < 3:
            raise ValueError(
                'profile collapses to fewer than 3 unique points'
            )
    return P


def _polygon_centroid_2d(profile: np.ndarray) -> np.ndarray:
    """Shoelace area-weighted centroid of a closed 2D polygon."""
    x, y = profile[:, 0], profile[:, 1]
    xn = np.roll(x, -1)
    yn = np.roll(y, -1)
    cross = x * yn - xn * y
    area2 = cross.sum()
    if abs(area2) < _COINCIDENT_EPS:
        return profile.mean(axis=0)
    cx = ((x + xn) * cross).sum() / (3.0 * area2)
    cy = ((y + yn) * cross).sum() / (3.0 * area2)
    return np.array([cx, cy], dtype=np.float64)


def _rotation_matrix_2d(angle_rad: float) -> np.ndarray:
    c, s = np.cos(angle_rad), np.sin(angle_rad)
    return np.array([[c, -s], [s, c]], dtype=np.float64)


def _rest_position(profile: np.ndarray,
                   num_angles: int = _DEFAULT_REST_ANGLES):
    """
    Rotate a planar polygon into its canonical rest orientation.

    Faithful port of the legacy C# `RestPosition` routine: for each of
    ``num_angles`` sample angles in [0, pi), rotate the centered profile and
    measure the absolute distance from the origin to each of the four
    axis-aligned bbox edges (|ymin|, |xmax|, |ymax|, |xmin|). The sample
    that produces the smallest such distance, combined with a 90 degree
    correction indexed by which edge was closest, defines the canonical
    rotation.

    Returns:
        rotated: (M, 2) rotated & centered profile
        centroid: (2,) centroid that was subtracted from the input
        angle_deg: rotation applied to the centered profile, degrees
    """
    if num_angles < 1:
        raise ValueError(f'num_angles must be >= 1, got {num_angles}')

    centroid = _polygon_centroid_2d(profile)
    centered = profile - centroid

    step_deg = 180.0 / num_angles
    min_edge_distances = np.empty(num_angles, dtype=np.float64)
    min_edge_corners = np.empty(num_angles, dtype=np.int64)
    for i in range(num_angles):
        ang_rad = np.deg2rad(i * step_deg)
        R = _rotation_matrix_2d(ang_rad)
        Q = centered @ R.T
        xmin, ymin = Q.min(axis=0)
        xmax, ymax = Q.max(axis=0)
        edges = np.array([abs(ymin), abs(xmax), abs(ymax), abs(xmin)])
        j = int(np.argmin(edges))
        min_edge_distances[i] = edges[j]
        min_edge_corners[i] = j

    best_sample = int(np.argmin(min_edge_distances))
    corner = int(min_edge_corners[best_sample])
    angle_deg = -(corner * 90.0) + best_sample * step_deg
    angle_rad = np.deg2rad(angle_deg)
    R_final = _rotation_matrix_2d(angle_rad)
    rotated = centered @ R_final.T
    return rotated, centroid, float(angle_deg)


def _ray_polyline_distances_and_tangents(profile: np.ndarray,
                                         directions: np.ndarray):
    """
    For each ray, return (distance, unit tangent) of the first boundary hit.

    Rays originate at (0, 0). Segments are the closed polygon edges
    p_i -> p_(i+1 mod M). Returns NaN where no forward hit exists.
    """
    A = profile                       # (M, 2) segment starts
    B = np.roll(profile, -1, axis=0)  # (M, 2) segment ends
    D = B - A                         # (M, 2) segment vectors

    seg_len = np.linalg.norm(D, axis=1)
    valid_seg = seg_len > _COINCIDENT_EPS
    T = np.full_like(D, np.nan)
    T[valid_seg] = D[valid_seg] / seg_len[valid_seg, None]

    R = directions  # (N, 2)
    # denom[n, m] = R[n] x D[m]
    denom = R[:, 0:1] * D[None, :, 1] - R[:, 1:2] * D[None, :, 0]
    A_cross_D = A[:, 0] * D[:, 1] - A[:, 1] * D[:, 0]
    A_cross_R = (A[None, :, 0] * R[:, 1:2]
                 - A[None, :, 1] * R[:, 0:1])

    safe = (np.abs(denom) > _COINCIDENT_EPS) & valid_seg[None, :]
    denom_safe = np.where(safe, denom, 1.0)

    t = A_cross_D[None, :] / denom_safe
    s = A_cross_R / denom_safe

    hit = (
        safe
        & (t >= 0.0)
        & (s >= -_COINCIDENT_EPS)
        & (s <= 1.0 + _COINCIDENT_EPS)
    )

    t_masked = np.where(hit, t, np.inf)
    best_seg = np.argmin(t_masked, axis=1)
    best_t = t_masked[np.arange(len(R)), best_seg]

    miss = ~np.isfinite(best_t)
    distances = np.where(miss, np.nan, best_t)
    tangents = T[best_seg]
    tangents[miss] = np.nan
    return distances, tangents


def _compute_radial_signature(profile, num_rays: int,
                              rest_align: bool = True,
                              num_rest_angles: int = _DEFAULT_REST_ANGLES):
    """
    Compute distances & tangents for one polygon profile.

    Returns:
        distances: (N,) ndarray
        tangents: (N, 2) ndarray
        centroid: (2,) ndarray (the one that was subtracted)
        angle_deg: float rotation applied to reach rest (0.0 if not aligned)
    """
    if num_rays < 3:
        raise ValueError(f'num_rays must be >= 3, got {num_rays}')

    P = _as_profile_array(profile)
    if rest_align:
        P_rest, centroid, angle_deg = _rest_position(
            P, num_angles=num_rest_angles)
    else:
        centroid = _polygon_centroid_2d(P)
        P_rest = P - centroid
        angle_deg = 0.0

    angles = np.arange(num_rays) * (2.0 * np.pi / num_rays)
    directions = np.column_stack([np.cos(angles), np.sin(angles)])
    distances, tangents = _ray_polyline_distances_and_tangents(
        P_rest, directions)
    return distances, tangents, centroid, angle_deg

# OPTIONAL HELPERS: they never block the component (decisions 8.112, 8.113) ---
try:
    from csc_gh.ports import ensure_outputs
    from csc_gh.messages import set_state
except ImportError:
    ensure_outputs = set_state = None

OUTPUTS = [
    ('Distances', 'Distances',
     'Tree of distances from the centroid to the first boundary intersection for each ray. One branch per input curve.'),
    ('Tangents', 'Tangents',
     'Tree of unit tangent vectors of the boundary at each ray hit, expressed in world coordinates on the curve plane.'),
    ('IntersectionPoints', 'IntersectionPoints',
     'Tree of intersection points in world coordinates, one branch per input curve. Useful for visualising the signature.'),
    ('Rays', 'Rays',
     'Tree of rays (as Lines) in world coordinates, one branch per input curve. Useful for visualisation.'),
    ('RestPositionCurve', 'RestPositionCurve',
     'Input curves transformed into their rest position: centroid at world origin, canonical rest axes aligned with World XY. This is exactly the geometry the signature is computed on.'),
    ('RestPositionFrame', 'RestPositionFrame',
     'List of rest-position planes, one per input curve. Origin is the centroid on the input curve plane; X/Y are aligned with the canonical orientation used by the signature.'),
    ('RestPositionAngle', 'RestPositionAngle',
     'List of rotation angles (degrees) applied to reach rest position, one per input curve.'),
    ('RestPositionTransform', 'RestPositionTransform',
     'Transform mapping world coordinates into the rest frame (origin at centroid; World XY only if RestPositionAlign is True). Apply to any other geometry to see it in the same frame as the rest curve.'),
]


def empty_outputs():
    """What RunScript returns when it stops early or has no result: an empty
    Grasshopper tree per output (never '' or None)."""
    if not OUTPUTS:
        return None
    trees = tuple(Grasshopper.DataTree[System.Object]() for _ in OUTPUTS)
    return trees[0] if len(trees) == 1 else trees


class CSC_RadialSignature(Grasshopper.Kernel.GH_ScriptInstance):
    """
    Author: Max Benjamin Eschenbach
    License: MIT License
    Version: 261102
    """

    _outputs_ready = True       # set by BeforeRunScript (8.112)
    _outputs_note = None

    def __init__(self):
        """Initialize this component and set component parameters."""
        super().__init__()
        self.Component = ghenv.Component  # NOQA
        self.InputParams = self.Component.Params.Input
        self.OutputParams = self.Component.Params.Output

    def _addRemark(self, msg: str = ''):
        rml = self.Component.RuntimeMessageLevel.Remark
        self.AddRuntimeMessage(rml, msg)

    def _addWarning(self, msg: str = ''):
        rml = self.Component.RuntimeMessageLevel.Warning
        self.AddRuntimeMessage(rml, msg)

    def _addError(self, msg: str = ''):
        rml = self.Component.RuntimeMessageLevel.Error
        self.AddRuntimeMessage(rml, msg)

    def _state(self, text=''):
        """The one short state under the component (decision 8.113)."""
        if set_state is not None:
            set_state(self.Component, text)

    def _stop(self):
        """True when RunScript has to return early: the outputs were just
        updated (says why)."""
        if self._outputs_note:
            self._addRemark(self._outputs_note)
        return not self._outputs_ready

    def _check_outputs(self):
        """Make the outputs match OUTPUTS before the script runs (8.112)."""
        self._outputs_ready, self._outputs_note = True, None
        if ensure_outputs is None:
            self._outputs_note = (
                'output check skipped: CSC library not installed')
            return
        status = ensure_outputs(self.Component, OUTPUTS)
        self._outputs_ready, self._outputs_note = status.ready, status.remark

    def BeforeRunScript(self):
        """Describe inputs & outputs."""
        self.InputParams[0].Description = (
            'Closed planar boundary curve(s) to describe. Polylines are '
            'used verbatim; other curves are approximated to polylines '
            'using the document tolerance.'
        )
        self.InputParams[1].Description = (
            'Number of rays cast from the centroid. Default 64. '
            'Must be >= 3.'
        )
        self.InputParams[2].Description = (
            'If True (default), rotate each profile into its canonical '
            'rest position (minimum bbox edge distance) before ray '
            'casting. If False, use the curve as-is (still centered).'
        )
        self.InputParams[3].Description = (
            'Number of rotation samples used for rest-position search '
            'over [0, pi). Default 180 (1 degree steps). Must be >= 1.'
        )
        # Output descriptions -- skip the hidden "out" param if present.
        self._check_outputs()

    def _curve_to_polyline_and_plane(self, curve):
        """Return (polyline_points_3d, curve_plane) or (None, None).

        Falls back to ``Plane.WorldXY`` for non-planar or degenerate curves
        and adds a warning.
        """
        if curve is None:
            return None, None

        tol = Rhino.RhinoDoc.ActiveDoc.ModelAbsoluteTolerance
        if tol is None or tol <= 0.0:
            tol = 1e-3

        # Fetch an actual Polyline -- exact for polylines / polygons, an
        # approximation otherwise (angle-based to preserve curvature).
        ok, pl = curve.TryGetPolyline()
        if not ok or pl is None or pl.Count < 3:
            pc = curve.ToPolyline(
                0,           # mainSegmentCount (0 = auto)
                0,           # subSegmentCount
                0.1,         # maxAngleRadians (~5.7 deg chord deviation)
                0.0,         # maxChordLengthRatio
                0.0,         # maxAspectRatio
                tol,         # tolerance
                0.0,         # minEdgeLength
                0.0,         # maxEdgeLength
                True,        # keepStartPoint
            )
            if pc is None:
                return None, None
            pl = pc.ToPolyline()
            if pl is None or pl.Count < 3:
                return None, None

        ok_plane, plane = curve.TryGetPlane(tol)
        if not ok_plane:
            self._addWarning(
                'Curve is not planar within tolerance; falling back to '
                'World XY. Consider supplying a planar curve.'
            )
            plane = Rhino.Geometry.Plane.WorldXY

        return pl, plane

    def _project_polyline_to_plane(self, polyline, plane):
        """Project polyline vertices to the curve's plane. Returns (M, 2)."""
        xform = Rhino.Geometry.Transform.PlaneToPlane(
            plane, Rhino.Geometry.Plane.WorldXY)
        pts_2d = []
        for p in polyline:
            q = Rhino.Geometry.Point3d(p)
            q.Transform(xform)
            pts_2d.append([q.X, q.Y])
        return np.asarray(pts_2d, dtype=np.float64)

    def _rest_frame_in_world(self, plane, centroid_xy, rest_angle_deg):
        """Build a Rhino.Geometry.Plane placed at the rest-position origin.

        The plane's origin is the 3D centroid; its X/Y axes correspond to
        the rest-aligned 2D frame rotated back into world coordinates.
        """
        # Rest frame in curve-plane coordinates: origin is the centroid,
        # axes are rotated by ``rest_angle_deg`` around +Z relative to the
        # curve plane. Since a point ``q`` in the original 2D frame maps
        # to ``R * (q - c)`` in the rest frame, the inverse mapping back
        # to the curve plane is a rotation by ``-rest_angle_deg``.
        theta = np.deg2rad(-rest_angle_deg)
        c, s = float(np.cos(theta)), float(np.sin(theta))
        x_axis_xy = np.array([c, s, 0.0])
        y_axis_xy = np.array([-s, c, 0.0])

        origin_xy = Rhino.Geometry.Point3d(
            float(centroid_xy[0]), float(centroid_xy[1]), 0.0)
        xform = Rhino.Geometry.Transform.PlaneToPlane(
            Rhino.Geometry.Plane.WorldXY, plane)
        origin_3d = Rhino.Geometry.Point3d(origin_xy)
        origin_3d.Transform(xform)

        x_vec_3d = Rhino.Geometry.Vector3d(*x_axis_xy)
        y_vec_3d = Rhino.Geometry.Vector3d(*y_axis_xy)
        x_vec_3d.Transform(xform)
        y_vec_3d.Transform(xform)

        return Rhino.Geometry.Plane(origin_3d, x_vec_3d, y_vec_3d)

    def _xy_point_to_world(self, xform_to_plane, x, y):
        """Map a point in the curve-plane XY frame to world coordinates."""
        p = Rhino.Geometry.Point3d(float(x), float(y), 0.0)
        p.Transform(xform_to_plane)
        return p

    def _xy_vector_to_world(self, xform_to_plane, vx, vy):
        """Map a vector in the curve-plane XY frame to world coordinates."""
        v = Rhino.Geometry.Vector3d(float(vx), float(vy), 0.0)
        v.Transform(xform_to_plane)
        return v

    def RunScript(self,
            Curves: list[object],
            Resolution: int,
            RestPositionAlign: bool,
            NumAngles: int):
        # Keep list-access behavior by default. If the current input list
        # (which may represent one incoming branch) has multiple curves,
        # switch to explicit tree output keyed by run count + item index.
        if self._stop():
            return empty_outputs()
        multi_input = bool(Curves) and len(Curves) > 1
        if multi_input:
            Distances = Grasshopper.DataTree[System.Object]()
            Tangents = Grasshopper.DataTree[System.Object]()
            IntersectionPoints = Grasshopper.DataTree[System.Object]()
            Rays = Grasshopper.DataTree[System.Object]()
            RestPositionCurve = Grasshopper.DataTree[System.Object]()
            RestPositionFrame = Grasshopper.DataTree[System.Object]()
            RestPositionAngle = Grasshopper.DataTree[System.Object]()
            RestPositionTransform = Grasshopper.DataTree[System.Object]()
        else:
            Distances = []
            Tangents = []
            IntersectionPoints = []
            Rays = []
            RestPositionCurve = []
            RestPositionFrame = []
            RestPositionAngle = []
            RestPositionTransform = []
        __Results = (
            Distances, Tangents, IntersectionPoints, Rays,
            RestPositionCurve, RestPositionFrame,
            RestPositionAngle, RestPositionTransform,
        )

        # Defaults
        if Resolution is None:
            Resolution = 64
        if RestPositionAlign is None:
            RestPositionAlign = True
        if NumAngles is None:
            NumAngles = _DEFAULT_REST_ANGLES

        # Input validation
        if not Curves:
            msg = 'No curves provided'
            self._addWarning(msg)
            return __Results

        try:
            Resolution = int(Resolution)
        except (TypeError, ValueError):
            self._addError(
                f'Resolution must be an integer, got {Resolution!r}')
            return __Results
        if Resolution < 3:
            self._addError(f'Resolution must be >= 3, got {Resolution}')
            return __Results

        try:
            NumAngles = int(NumAngles)
        except (TypeError, ValueError):
            self._addError(
                f'NumAngles must be an integer, got '
                f'{NumAngles!r}')
            return __Results
        if NumAngles < 1:
            self._addError(
                f'NumAngles must be >= 1, got '
                f'{NumAngles}')
            return __Results


        successes = 0
        rc = self.Component.RunCount - 1
        for branch_idx, curve in enumerate(Curves):
            path = Grasshopper.Kernel.Data.GH_Path(rc, branch_idx)

            polyline, plane = self._curve_to_polyline_and_plane(curve)
            if polyline is None or plane is None:
                self._addWarning(
                    f'Curve #{branch_idx}: could not build polyline; skipped')
                continue

            try:
                profile_xy = self._project_polyline_to_plane(polyline, plane)
                distances, tangents, centroid_xy, angle_deg = (
                    _compute_radial_signature(
                        profile_xy,
                        num_rays=Resolution,
                        rest_align=bool(RestPositionAlign),
                        num_rest_angles=NumAngles,
                    )
                )
            except ValueError as exc:
                self._addWarning(
                    f'Curve #{branch_idx}: {exc}; skipped')
                continue

            if np.any(np.isnan(distances)):
                missed = int(np.isnan(distances).sum())
                self._addWarning(
                    f'Curve #{branch_idx}: {missed}/{Resolution} rays did '
                    f'not hit the boundary (centroid outside profile or '
                    f'non-simple polygon); skipped'
                )
                continue

            # Map results back to world coordinates.
            # In the rest frame: hit point = t * (cos a, sin a);
            # tangent = (tx, ty). The rest frame itself lives on the
            # curve plane at ``centroid_xy``, rotated by rest_angle_deg.
            # Build a combined transform 2D(rest) -> 2D(curve) -> world.
            rest_frame_curve = Rhino.Geometry.Plane(
                Rhino.Geometry.Point3d(
                    float(centroid_xy[0]), float(centroid_xy[1]), 0.0),
                Rhino.Geometry.Vector3d.XAxis,
                Rhino.Geometry.Vector3d.YAxis,
            )
            # Rotate the rest plane's X/Y by -rest_angle_deg so that a
            # point expressed in the rest frame maps back to the same
            # location in the curve-plane XY frame.
            theta = np.deg2rad(-angle_deg)
            c, s = float(np.cos(theta)), float(np.sin(theta))
            rest_x = Rhino.Geometry.Vector3d(c, s, 0.0)
            rest_y = Rhino.Geometry.Vector3d(-s, c, 0.0)
            rest_frame_curve = Rhino.Geometry.Plane(
                rest_frame_curve.Origin, rest_x, rest_y)

            xform_curve_to_world = Rhino.Geometry.Transform.PlaneToPlane(
                Rhino.Geometry.Plane.WorldXY, plane)

            # Combined mapper: 2D rest frame -> 3D world.
            def to_world_point(xr, yr):
                # Into curve XY frame first...
                px = rest_frame_curve.Origin.X + c * xr - s * yr
                py = rest_frame_curve.Origin.Y + s * xr + c * yr
                # ...then lift to world via the curve plane.
                p = Rhino.Geometry.Point3d(float(px), float(py), 0.0)
                p.Transform(xform_curve_to_world)
                return p

            def to_world_vector(vxr, vyr):
                vx = c * vxr - s * vyr
                vy = s * vxr + c * vyr
                v = Rhino.Geometry.Vector3d(float(vx), float(vy), 0.0)
                v.Transform(xform_curve_to_world)
                return v

            # Rays in the rest frame: origin (0, 0), direction (cos, sin).
            ray_angles = np.arange(Resolution) * (2.0 * np.pi / Resolution)
            ray_dirs = np.column_stack(
                [np.cos(ray_angles), np.sin(ray_angles)])

            world_origin = to_world_point(0.0, 0.0)

            distance_values = []
            tangent_values = []
            hit_points = []
            ray_lines = []
            for k in range(Resolution):
                t = float(distances[k])
                dx, dy = float(ray_dirs[k, 0]), float(ray_dirs[k, 1])
                hit_world = to_world_point(t * dx, t * dy)
                tx, ty = float(tangents[k, 0]), float(tangents[k, 1])
                tan_world = to_world_vector(tx, ty)

                distance_values.append(t)
                tangent_values.append(tan_world)
                hit_points.append(hit_world)
                ray_lines.append(
                    Rhino.Geometry.Line(world_origin, hit_world))

            if multi_input:
                Distances.AddRange(distance_values, path)
                Tangents.AddRange(tangent_values, path)
                IntersectionPoints.AddRange(hit_points, path)
                Rays.AddRange(ray_lines, path)
            else:
                Distances.extend(distance_values)
                Tangents.extend(tangent_values)
                IntersectionPoints.extend(hit_points)
                Rays.extend(ray_lines)

            # Rest-position frame expressed in world coordinates: origin
            # at the 3D centroid on the curve plane, X/Y axes aligned with
            # the canonical orientation picked by the rest-position search.
            rest_frame_world = self._rest_frame_in_world(
                plane, centroid_xy, angle_deg)

            # World -> rest-frame transform. Applying this to the input
            # curve moves it so its centroid sits at the world origin and
            # its rest-aligned axes coincide with the World XY axes -- i.e.
            # exactly what the signature "sees" internally.
            if RestPositionAlign:
                # Full rest-position transform: center + canonical orientation
                # into World XY.
                xform_world_to_rest = Rhino.Geometry.Transform.PlaneToPlane(
                    rest_frame_world, Rhino.Geometry.Plane.WorldXY)
            else:
                # No rest-position rotation: keep the curve orientation as-is
                # in world coordinates and only center it at the origin.
                xform_world_to_rest = Rhino.Geometry.Transform.Translation(
                    Rhino.Geometry.Vector3d(
                        -rest_frame_world.Origin.X,
                        -rest_frame_world.Origin.Y,
                        -rest_frame_world.Origin.Z,
                    )
                )
            rest_curve = curve.DuplicateCurve()
            rest_curve.Transform(xform_world_to_rest)

            if multi_input:
                RestPositionCurve.Add(rest_curve, path)
                RestPositionFrame.Add(rest_frame_world, path)
                RestPositionAngle.Add(float(angle_deg), path)
                RestPositionTransform.Add(xform_world_to_rest, path)
            else:
                RestPositionCurve.append(rest_curve)
                RestPositionFrame.append(rest_frame_world)
                RestPositionAngle.append(float(angle_deg))
                RestPositionTransform.append(xform_world_to_rest)

            successes += 1

        if successes == 0:
            self._addWarning('No curves produced a valid signature')
        else:
            self._addRemark(
                f'Computed radial signature for {successes} curve(s) '
                f'at resolution N={Resolution}'
            )

        return __Results
# ---------- end radialsignature ----------
designshapes_restpositiontransform = Data(radialsignature.RestPositionTransform)
designshapes_distances = Data(radialsignature.Distances)
designshapes_tangents = Data(radialsignature.Tangents)

# ---- group: __DDU_CSC_EXAMPLE_09__
componentpassport_35 = Data(componentpassport_25)
disassemblecomponent_2 = DisassembleComponent(ComponentPassport=componentpassport_35)  # -> IdentityID, Name, OriginalFunction, Material, Color, Location, BoundingBox, Frame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; inputs ComponentPassport: tree; same code as disassemblecomponent
manufacturedprecision_2 = Data(disassemblecomponent_2.ManufacturedPrecision)
manufacturedat_2 = Data(disassemblecomponent_2.ManufacturedAt)
capturemarkers_2 = Data(disassemblecomponent_2.CaptureMarkers)
conditiongrade_2 = Data(disassemblecomponent_2.ConditionGrade)
parentidentities_2 = Data(disassemblecomponent_2.ParentIdentities)
boundingbox_2 = Data(disassemblecomponent_2.BoundingBox)
descriptors_2 = Data(disassemblecomponent_2.Descriptors)
attributes_2 = Data(disassemblecomponent_2.Attributes)
remaining_2 = Data(disassemblecomponent_2.Remaining)
identityid_5 = Data(disassemblecomponent_2.IdentityID)
location_7 = Data(disassemblecomponent_2.Location)
material_8 = Data(disassemblecomponent_2.Material)
capture_4 = Data(disassemblecomponent_2.Capture)
name_2 = Data(disassemblecomponent_2.Name)
planned_2 = Data(disassemblecomponent_2.Planned)
type_2 = Data(disassemblecomponent_2.OriginalFunction)
color_4 = Data(disassemblecomponent_2.Color)
frame_2 = Data(disassemblecomponent_2.Frame)
proxies_2 = Data(disassemblecomponent_2.Geometry)
origin_5 = Data(disassemblecomponent_2.Origin)

# ---- group: __DDU_CSC_EXAMPLE_05__
# Step 4
# comments & notes: Disassemble the components to get the primitive geometry
componentpassport_36 = Data(componentpassport_3)
disassemblecomponent_3 = DisassembleComponent(ComponentPassport=componentpassport_36)  # -> IdentityID, Name, OriginalFunction, Material, Color, Location, BoundingBox, Frame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; inputs ComponentPassport: tree; same code as disassemblecomponent
manufacturedprecision_3 = Data(disassemblecomponent_3.ManufacturedPrecision)
manufacturedat_3 = Data(disassemblecomponent_3.ManufacturedAt)
capturemarkers_3 = Data(disassemblecomponent_3.CaptureMarkers)
conditiongrade_3 = Data(disassemblecomponent_3.ConditionGrade)
parentidentities_3 = Data(disassemblecomponent_3.ParentIdentities)
boundingbox_3 = Data(disassemblecomponent_3.BoundingBox)
descriptors_3 = Data(disassemblecomponent_3.Descriptors)
remaining_3 = Data(disassemblecomponent_3.Remaining)
attributes_3 = Data(disassemblecomponent_3.Attributes)
identityid_6 = Data(disassemblecomponent_3.IdentityID)
location_8 = Data(disassemblecomponent_3.Location)
planned_3 = Data(disassemblecomponent_3.Planned)
material_9 = Data(disassemblecomponent_3.Material)
capture_5 = Data(disassemblecomponent_3.Capture)
name_3 = Data(disassemblecomponent_3.Name)
type_3 = Data(disassemblecomponent_3.OriginalFunction)
color_5 = Data(disassemblecomponent_3.Color)
frame_3 = Data(disassemblecomponent_3.Frame)
proxies_3 = Data(disassemblecomponent_3.Geometry)
origin_6 = Data(disassemblecomponent_3.Origin)

# ----
fetchreinforcementlayout = FetchReinforcementLayout()  # -> Bars, Diameter, Spec, Cover, RecordID, Basis, SnapshotID, Status, Pipes; inputs Status: String, Pipes: Boolean
# ---------- fetchreinforcementlayout: Python ----------
#! python3
# -*- coding: utf-8 -*-
# venv: DDU_CSC
# r: charset_normalizer
# r: requests==2.32.5
# r: numpy==2.0.2
print('ENV OK!')

# PYTHON STANDARD LIBRARY IMPORTS ---------------------------------------------
import json  # NOQA

# THIRD PARTY LIBRARY IMPORTS -------------------------------------------------
import requests  # NOQA

# RHINO AND GH RELATED IMPORTS ------------------------------------------------
import System  # NOQA
import Rhino  # NOQA
import Grasshopper  # NOQA
import scriptcontext as sc  # NOQA

# GHENV COMPONENT SETTINGS ----------------------------------------------------
ghenv.Component.Name = 'FetchReinforcementLayout'  # NOQA
ghenv.Component.NickName = 'FetchReinforcementLayout'  # NOQA
ghenv.Component.Category = 'DDU_CSC'  # NOQA
ghenv.Component.SubCategory = '2 Catalog Interface'  # NOQA
ghenv.Component.Description = (  # NOQA
    'Fetches the reinforcement layouts recorded for a component as bars: '
    'one polyline per bar, one tree branch per layout record, the newest '
    'record first, with the diameter (mm), steel grade and cover of every '
    'bar, and the id, basis, snapshot and status of every record. '
    'Optionally the bars are made solid (Pipes).\n'
    'Input can be:\n'
    '- Geometry carrying the \'csc_component\' user text\n'
    '- A component passport JSON string ({identity, snapshots[]})\n'
    '- A raw identity_id or snapshot_id\n\n'
    'The points of a layout are stored coordinates of the snapshot it '
    'belongs to. A passport with a placement (ApplyFrame, '
    'TransformComponent) moves the layouts of its own snapshot to where '
    'the element is placed, like the Fetch geometry components do for the '
    'mesh; layouts of another version stay in their stored coordinates and '
    'are named in a warning. Document units are taken as millimetres (1:1); '
    'a document in another unit gets a warning. Status: published '
    '(default), draft, pending, rejected, withdrawn or all (adds your own '
    'unpublished records).'
)


# CSC LIBRARY (decision 8.111) ----------------------------------------------
CSC_GH_MINIMUM = '261102'
LIBRARY_PROBLEM = None
try:
    import csc_gh
    csc_gh.require(CSC_GH_MINIMUM)
    from csc_gh.build import (BuildError)  # NOQA
    from csc_gh.layout import (layout_points, layouts_of, passport_placement, status_param, unit_warning)  # NOQA
    from csc_gh.read import (load_passport)  # NOQA
    from csc_gh.rhino import (mm_per_document_unit, pipe_brep, polyline_curve)  # NOQA
    from csc_gh.upload import (http_error_text)  # NOQA
    from csc_gh.messages import (waits_for_data)  # NOQA
except ImportError:
    LIBRARY_PROBLEM = (
        'CSC library 261102 too old or missing: run CSC_Update, '
        'then restart Rhino')

# OPTIONAL HELPERS: they never block the component (decisions 8.112, 8.113) ---
try:
    from csc_gh.ports import ensure_outputs
    from csc_gh.messages import set_state
except ImportError:
    ensure_outputs = set_state = None

OUTPUTS = [
    ('Bars', 'Bars',
     'The bars as polylines, one branch per layout record (newest first)'),
    ('Diameter', 'Diameter',
     'Bar diameter in mm, same tree as Bars'),
    ('Spec', 'Spec',
     'Steel grade of each bar (null when not given), same tree as Bars'),
    ('Cover', 'Cover',
     'Measured concrete cover in mm (null when not given), same tree as '
     'Bars'),
    ('RecordID', 'RecordID',
     'Id of each layout record; the list position is the branch index'),
    ('Basis', 'Basis',
     'drawing, scan or exposed, one per branch'),
    ('SnapshotID', 'SnapshotID',
     'Snapshot whose stored coordinates the points of each layout are in, '
     'one per branch'),
    ('Status', 'Status',
     'Status of each layout record, one per branch'),
    ('Pipes', 'Pipes',
     'Solid bars (Breps at the diameter, in mm), same tree as Bars; empty '
     'unless Pipes is true'),
]

NOT_FOUND = 404


def empty_outputs():
    """What RunScript returns when it stops early or has no result: an empty
    Grasshopper tree per output (never '' or None)."""
    if not OUTPUTS:
        return None
    trees = tuple(Grasshopper.DataTree[System.Object]() for _ in OUTPUTS)
    return trees[0] if len(trees) == 1 else trees


def null_outputs():
    """One null per output: an item of an item-access component that has no
    result keeps its slot (decision 8.186)."""
    if len(OUTPUTS) <= 1:
        return None
    return tuple(None for _ in OUTPUTS)


class CSC_FetchReinforcementLayout(Grasshopper.Kernel.GH_ScriptInstance):
    """
    Author: Max Benjamin Eschenbach
    License: MIT License
    Version: 261102
    """

    _outputs_ready = True       # set by BeforeRunScript (8.112)
    _outputs_note = None

    def __init__(self):
        """Initialize this component and set component parameters."""
        super().__init__()
        self.Component = ghenv.Component  # NOQA
        self.InputParams = self.Component.Params.Input
        self.OutputParams = self.Component.Params.Output

    def _addRemark(self, msg: str = ''):
        rml = self.Component.RuntimeMessageLevel.Remark
        self.AddRuntimeMessage(rml, msg)

    def _addWarning(self, msg: str = ''):
        rml = self.Component.RuntimeMessageLevel.Warning
        self.AddRuntimeMessage(rml, msg)

    def _addError(self, msg: str = ''):
        rml = self.Component.RuntimeMessageLevel.Error
        self.AddRuntimeMessage(rml, msg)

    def _state(self, text=''):
        """The one short state under the component (decision 8.113)."""
        if set_state is not None:
            set_state(self.Component, text)

    def _no_result(self, *ports):
        """The result of an iteration without one (decision 8.186): empty
        outputs when the inputs in ``ports`` carry no data at all (the
        component waits for data; no ports: a list or tree input is empty),
        else a null in the slot of this item, so the outputs stay one to one
        with the input list."""
        if not ports or (waits_for_data is not None
                         and waits_for_data(self, ports)):
            return empty_outputs()
        return null_outputs()

    def _stop(self):
        """True when RunScript has to return early: the library is missing or
        too old, or the outputs were just updated (says why)."""
        if LIBRARY_PROBLEM:
            self._addError(LIBRARY_PROBLEM)
            return True
        if self._outputs_note:
            self._addRemark(self._outputs_note)
        return not self._outputs_ready

    def _check_outputs(self):
        """Make the outputs match OUTPUTS before the script runs (8.112)."""
        self._outputs_ready, self._outputs_note = True, None
        if ensure_outputs is None:
            self._outputs_note = (
                'output check skipped: CSC library not installed')
            return
        status = ensure_outputs(self.Component, OUTPUTS)
        self._outputs_ready, self._outputs_note = status.ready, status.remark

    def BeforeRunScript(self):
        """Perform some setup actions."""
        self.InputParams[0].Description = (
            'Input can be:\n'
            '- Geometry with the \'csc_component\' user text\n'
            '- A component passport JSON string ({identity, snapshots[]}); '
            'its placement moves the layouts of its snapshot\n'
            '- A raw identity_id or snapshot_id (points stay in stored '
            'coordinates)'
        )
        self.InputParams[1].Description = (
            'published (default), draft, pending, rejected, withdrawn or '
            'all (adds your own unpublished records)'
        )
        self.InputParams[2].Description = (
            'True: also make solid bars (Pipes output, default False)'
        )
        self._check_outputs()
        if LIBRARY_PROBLEM is None:
            csc_gh.dev_reload(globals())

    def get_auth_core_from_sticky(self):
        """Get AuthCore instance from sticky storage."""
        auth_core = sc.sticky.get('CSC_AuthCore')
        if auth_core is None:
            msg = ('No authentication found. Please use CSC_Session component '
                   'first.')
            self._addWarning(msg)
            return None
        return auth_core

    def resolve_input(self, auth_core, value):
        """``(id, snapshot_id, placement, is_snapshot)`` of the input: the
        identity (or, for a raw id that may be a snapshot, the id to try),
        the snapshot a passport names and its placement."""
        if (hasattr(value, 'UserStringCount')
                and value.UserStringCount > 0):
            raw = value.GetUserString('csc_component')
            if raw:
                value = raw
        if not isinstance(value, str):
            return None
        text_ = value.strip()
        if not text_:
            return None
        if auth_core.validate_uuid(text_):
            return text_, None, None, True
        passport = load_passport(text_)
        if passport is not None:
            snapshot_id, placement = passport_placement(passport)
            identity = passport.get('identity') or {}
            snapshot = passport['snapshots'][0]
            identity_id = (identity.get('_id') or identity.get('id')
                           or snapshot.get('identity_id'))
            if not identity_id or not auth_core.validate_uuid(
                    str(identity_id)):
                raise BuildError('the passport has no valid identity id')
            return str(identity_id), snapshot_id, placement, False
        try:
            data = json.loads(text_)
        except ValueError:
            data = None
        if (isinstance(data, dict) and data.get('_id')
                and auth_core.validate_uuid(str(data['_id']))):
            return str(data['_id']), None, None, False
        raise BuildError('the input is not a passport, an identity id or '
                         'a snapshot id')

    def fetch_rows(self, auth_core, identity_id, status):
        """``(status code, rows)`` of the layout records of an identity."""
        response = auth_core.authorized_get(
            f'/identities/{identity_id}/evidence',
            params={'method': 'reinforcement_layout', 'status': status})
        if response.status_code == 200:
            return 200, response.json()
        if response.status_code == NOT_FOUND:
            return NOT_FOUND, []
        msg = {
            401: 'Authentication failed. Please sign in again.',
            403: 'Access denied: you may not read this component.',
        }.get(response.status_code) or http_error_text(
            response, 'Fetching the layouts')
        raise BuildError(msg)

    def identity_of_snapshot(self, auth_core, snapshot_id):
        """The identity id of a snapshot id, or None."""
        response = auth_core.authorized_get(f'/snapshots/{snapshot_id}')
        if response.status_code == 200:
            return (response.json() or {}).get('identity_id')
        return None

    def RunScript(self, ComponentPassport, Status: str, Pipes: bool):
        if self._stop():
            return empty_outputs()
        auth_core = self.get_auth_core_from_sticky()
        if auth_core is None:
            return empty_outputs()
        if not auth_core.is_valid():
            msg = ('Authentication expired. Please use CSC_Session '
                   'component to refresh.')
            self._addWarning(msg)
            return empty_outputs()
        if not ComponentPassport:
            self._addWarning('Please provide input data.')
            return self._no_result('ComponentPassport')

        Bars = Grasshopper.DataTree[System.Object]()
        Diameter = Grasshopper.DataTree[System.Object]()
        Spec = Grasshopper.DataTree[System.Object]()
        Cover = Grasshopper.DataTree[System.Object]()
        PipeBreps = Grasshopper.DataTree[System.Object]()
        RecordID = System.Collections.Generic.List[str]()
        Basis = System.Collections.Generic.List[str]()
        SnapshotID = System.Collections.Generic.List[str]()
        StatusOut = System.Collections.Generic.List[str]()
        results = (Bars, Diameter, Spec, Cover, RecordID, Basis, SnapshotID,
                   StatusOut, PipeBreps)

        try:
            status = status_param(Status)
            found = self.resolve_input(auth_core, ComponentPassport)
            if found is None:
                self._addWarning('Could not resolve a component from the '
                                 'input.')
                return results
            target_id, snapshot_id, placement, maybe_snapshot = found
            code, rows = self.fetch_rows(auth_core, target_id, status)
            if code == NOT_FOUND and maybe_snapshot:
                identity_id = self.identity_of_snapshot(auth_core, target_id)
                if identity_id:
                    snapshot_id = target_id
                    code, rows = self.fetch_rows(auth_core, identity_id,
                                                 status)
            if code == NOT_FOUND:
                self._addError(f'Component or snapshot {target_id} was not '
                               'found.')
                return null_outputs()

            layouts, left_out = layouts_of(rows)
            if left_out:
                self._addWarning(
                    f'{len(left_out)} record(s) without readable bars left '
                    f'out: {", ".join(str(i) for i in left_out)}')
            if not layouts:
                self._addWarning(f'No reinforcement layout ({status}) found.')
                self._state('0 layouts')
                return results

            scale, unit_name = mm_per_document_unit()
            note = unit_warning(scale, unit_name)
            if note:
                self._addWarning(note)
            solid = bool(Pipes)
            bar_count = moved = failed = 0
            for index, layout in enumerate(layouts):
                path = Grasshopper.Kernel.Data.GH_Path(index)
                point_lists, warning = layout_points(
                    layout, placement, snapshot_id)
                if warning:
                    self._addWarning(warning)
                elif placement is not None:
                    moved += 1
                for bar, points in zip(layout['bars'], point_lists):
                    curve = polyline_curve(points)
                    Bars.Add(curve, path)
                    Diameter.Add(bar['diameter_mm'], path)
                    Spec.Add(bar['spec'], path)
                    Cover.Add(bar['cover_mm'], path)
                    if solid:
                        pipe = pipe_brep(curve, bar['diameter_mm'] / 2.0)
                        if pipe is None:
                            failed += 1
                        PipeBreps.Add(pipe, path)
                    bar_count += 1
                RecordID.Add(str(layout['id'] or ''))
                Basis.Add(str(layout['basis'] or ''))
                SnapshotID.Add(str(layout['snapshot_id'] or ''))
                StatusOut.Add(str(layout['status'] or ''))
            if moved:
                self._addRemark(
                    f'{moved} layout(s) of snapshot {snapshot_id} moved by '
                    'the placement of the passport (stored to placed)')
            if failed:
                self._addWarning(f'{failed} bar(s) could not be made solid')
            self._state(f'{len(layouts)} layouts, {bar_count} bars')
            return results

        except BuildError as error:
            self._addError(str(error))
            return null_outputs()
        except requests.exceptions.ConnectionError as e:
            msg = 'Cannot connect to server. Please check your connection.'
            self._addError(msg + f'\nFull Error: {str(e)}')
            return null_outputs()
        except requests.exceptions.Timeout as e:
            msg = 'Request timeout. Server may be slow.'
            self._addError(msg + f'\nFull Error: {str(e)}')
            return null_outputs()
        except requests.exceptions.RequestException as e:
            self._addError(f'Request error: {str(e)}')
            return null_outputs()
        except Exception as e:
            # includes CSCClientOutdated: its text names the fix
            self._addError(f'Unexpected error: {str(e)}')
            return null_outputs()
        return results
# ---------- end fetchreinforcementlayout ----------
fetchsimilarcomponents = FetchSimilarComponents()  # -> FilterDescription, ComponentPassport, Distance, Fit, DistanceKm; inputs IdentityID: String, Basis: String, Count: Int32, OriginalFunction: String, Material: String, Dataset: String, Complexity: Int32, Fragment: Boolean, MinDimensionX: Double, MaxDimensionX: Double, MinDimensionY: Double, MaxDimensionY: Double, MinDimensionZ: Double, MaxDimensionZ: Double, ShapeClass: String, MaterialClass: String, Circulation: String, FitMode: String, FitSize: list, FitTolerance: String, NearPoint: Vector3d, NearLayer: String, RadiusKm: Double
# ---------- fetchsimilarcomponents: Python ----------
#! python3
# -*- coding: utf-8 -*-
# venv: DDU_CSC
# r: charset_normalizer
# r: requests==2.32.5
# r: numpy==2.0.2
print('ENV OK!')

# PYTHON STANDARD LIBRARY IMPORTS ---------------------------------------------
import json  # NOQA

# THIRD PARTY LIBRARY IMPORTS -------------------------------------------------
import requests  # NOQA

# RHINO AND GH RELATED IMPORTS ------------------------------------------------
import System  # NOQA
import Grasshopper  # NOQA
import Rhino  # NOQA
import scriptcontext as sc  # NOQA

# GHENV COMPONENT SETTINGS ----------------------------------------------------
ghenv.Component.Name = 'FetchSimilarComponents'  # NOQA
ghenv.Component.NickName = 'FetchSimilarComponents'  # NOQA
ghenv.Component.Category = 'DDU_CSC'  # NOQA
ghenv.Component.SubCategory = '2 Catalog Interface'  # NOQA
ghenv.Component.Description = (  # NOQA
    'Fetches the components of the remote Catalog that are nearest in shape '
    'to one component by the radial signature (outline and size; not on the '
    '2D Similarity Map), nearest first, as component passport JSON '
    '({identity, snapshots[]}), each with its Distance in standardised '
    'descriptor units (smaller is more similar). Basis: radial_signature '
    '(default), scalars or hks. Takes the filters of FetchFilteredComponents '
    '(they apply before the ranking: the nearest elements that pass) and the '
    'dimension and near search. The component itself is never one of them.'
)

# CSC LIBRARY (decision 8.111) ----------------------------------------------
CSC_GH_MINIMUM = '261102'
LIBRARY_PROBLEM = None
try:
    import csc_gh
    csc_gh.require(CSC_GH_MINIMUM)
    from csc_gh.read import (fetch_filter_params, similar_params,  # NOQA
                             similar_results, similar_error_text,
                             fit_mode_of)
    from csc_gh.messages import (waits_for_data)  # NOQA
except ImportError:
    LIBRARY_PROBLEM = (
        'CSC library 261102 too old or missing: run CSC_Update, '
        'then restart Rhino')

# OPTIONAL HELPERS: they never block the component (decisions 8.112, 8.113) ---
try:
    from csc_gh.ports import ensure_outputs
    from csc_gh.messages import set_state
except ImportError:
    ensure_outputs = set_state = None

OUTPUTS = [
    ('FilterDescription', 'FilterDescription',
     'Human-readable description of the search and the filters applied'),
    ('ComponentPassport', 'ComponentPassport',
     "Component passport JSON per similar component ({identity, snapshots[]}), nearest first. Use 'DisassembleComponent' to access the individual fields ready for Grasshopper"),
    ('Distance', 'Distance',
     'Per result, the distance to the component in the descriptor space of '
     'Basis, in standardised units (each dimension in standard deviations '
     'over the catalog; smaller is more similar, 0 = the same descriptor). '
     'Same paths as ComponentPassport'),
    ('Fit', 'Fit',
     'Dimension search: per result, the deviation in per cent (FitMode '
     'about) or the waste in per cent of the element (FitMode can_hold). '
     'Empty without FitMode and FitSize. Same paths as ComponentPassport'),
    ('DistanceKm', 'DistanceKm',
     'Near search: per result, the distance in km from NearPoint to the '
     'element (on NearLayer). Empty without NearPoint. Same paths as '
     'ComponentPassport'),
]


def empty_outputs():
    """What RunScript returns when it stops early or has no result: an empty
    Grasshopper tree per output (never '' or None)."""
    if not OUTPUTS:
        return None
    trees = tuple(Grasshopper.DataTree[System.Object]() for _ in OUTPUTS)
    return trees[0] if len(trees) == 1 else trees


def null_outputs():
    """One null per output: an item of an item-access component that has no
    result keeps its slot (decision 8.186)."""
    if len(OUTPUTS) <= 1:
        return None
    return tuple(None for _ in OUTPUTS)


class CSC_FetchSimilarComponents(Grasshopper.Kernel.GH_ScriptInstance):
    """
    Author: Max Benjamin Eschenbach
    License: MIT License
    Version: 261102
    """

    _outputs_ready = True       # set by BeforeRunScript (8.112)
    _outputs_note = None

    def __init__(self):
        """Initialize this component and set component parameters."""
        super().__init__()
        # initialize props
        self.Component = ghenv.Component  # NOQA
        self.InputParams = self.Component.Params.Input
        self.OutputParams = self.Component.Params.Output

    def _addRemark(self, msg: str = ''):
        """Add a remark message to the component."""
        rml = self.Component.RuntimeMessageLevel.Remark
        self.AddRuntimeMessage(rml, msg)

    def _addWarning(self, msg: str = ''):
        """Add a warning message to the component."""
        rml = self.Component.RuntimeMessageLevel.Warning
        self.AddRuntimeMessage(rml, msg)

    def _addError(self, msg: str = ''):
        """Add an error message to the component."""
        rml = self.Component.RuntimeMessageLevel.Error
        self.AddRuntimeMessage(rml, msg)

    def _state(self, text=''):
        """The one short state under the component (decision 8.113)."""
        if set_state is not None:
            set_state(self.Component, text)

    def _no_result(self, *ports):
        """The result of an iteration without one (decision 8.186): empty
        outputs when the inputs in ``ports`` carry no data at all (the
        component waits for data; no ports: a list or tree input is empty),
        else a null in the slot of this item, so the outputs stay one to one
        with the input list."""
        if not ports or (waits_for_data is not None
                         and waits_for_data(self, ports)):
            return empty_outputs()
        return null_outputs()

    def _stop(self):
        """True when RunScript has to return early: the library is missing or
        too old, or the outputs were just updated (says why)."""
        if LIBRARY_PROBLEM:
            self._addError(LIBRARY_PROBLEM)
            return True
        if self._outputs_note:
            self._addRemark(self._outputs_note)
        return not self._outputs_ready

    def _check_outputs(self):
        """Make the outputs match OUTPUTS before the script runs (8.112)."""
        self._outputs_ready, self._outputs_note = True, None
        if ensure_outputs is None:
            self._outputs_note = (
                'output check skipped: CSC library not installed')
            return
        status = ensure_outputs(self.Component, OUTPUTS)
        self._outputs_ready, self._outputs_note = status.ready, status.remark

    def BeforeRunScript(self):
        """Perform some setup actions."""
        # Initialize input param descriptions
        descriptions = [
            'The component to find neighbours of: its identity UUID or '
            'component passport JSON',
            'Descriptor space: radial_signature (default: distances from the '
            'centre to the outline or mid-plane section, so outline and '
            'size), scalars (four box, sphere, line and plane scores) or hks '
            '(heat kernel signature)',
            'How many similar components to return (default 10, at most 50)',
            'Original function filter, an IFC class (e.g. IfcBeam, '
            'IfcColumn, IfcSlab, IfcPlate, CscDebris)',
            'Material filter, a material id (e.g. concrete, steel, timber)',
            'Dataset name filter (e.g., "beyond_debris", '
            '"mineral_composite_sheets")',
            'Complexity level filter (0-3, where 0=simple, 3=complex)',
            'Fragment status filter (True for fragments, False for complete)',
            'Minimum X dimension filter (bounding box, longest side)',
            'Maximum X dimension filter (bounding box)',
            'Minimum Y dimension filter (bounding box)',
            'Maximum Y dimension filter (bounding box)',
            'Minimum Z dimension filter (bounding box, shortest side)',
            'Maximum Z dimension filter (bounding box)',
            'Shape class filter: linear, planar, block, irregular or '
            'composite (derived by the server)',
            'Material class filter, a List of Waste code (e.g. 17 01 01)',
            'Circulation: active (default: in circulation, in place or '
            'deinstalled), in_place (still in the works), deinstalled, '
            'exited or all',
            'Dimension search: about (every side of the element within '
            'FitTolerance of FitSize) or can_hold (every side of the element '
            'at least FitSize: an element to cut your part from). Empty = no '
            'dimension search',
            'The asked size in mm, three numbers in any order (a list of '
            'three numbers, or one Point3d / Vector3d with X, Y, Z). Needs '
            'FitMode',
            'Only for about: a percentage or millimetres as text, 10% or '
            '50mm (a bare number is per cent). Default 10%. can_hold takes '
            'none',
            'Near search: a point with X = latitude and Y = longitude (a '
            'Point3d or Vector3d, as the PlaceLocation of Origin). Empty = '
            'no near search',
            'Near search: current (where the element is now, default) or '
            'origin (the building it came from)',
            'Near search: only elements within this many km. Empty = every '
            'element with a point on the layer',
        ]
        for index, text_ in enumerate(descriptions):
            if index < len(self.InputParams):
                self.InputParams[index].Description = text_
        self._check_outputs()
        if LIBRARY_PROBLEM is None:
            csc_gh.dev_reload(globals())

    def get_auth_core_from_sticky(self):
        """Get AuthCore instance from sticky storage."""
        auth_core = sc.sticky.get('CSC_AuthCore')
        if auth_core is None:
            msg = ('No authentication found. Please use CSC_Session component '
                   'first.')
            self._addWarning(msg)
            return None
        return auth_core

    def generate_description(self, identity_id, params) -> str:
        """A human-readable description of the search and its filters."""
        lines = [f'Similar to {identity_id}',
                 f'Basis: {params["basis"]}, up to {params["count"]} '
                 f'components, nearest first']
        for key, label in (('original_function', 'Original function'),
                           ('material', 'Material'),
                           ('dataset', 'Dataset'),
                           ('shape_class', 'Shape class'),
                           ('material_class', 'Material class'),
                           ('circulation', 'Circulation')):
            if params.get(key):
                lines.append(f'{label}: {params[key]}')
        if params.get('complexity') is not None:
            lines.append(f'Complexity: {params["complexity"]}')
        if params.get('fragment') is not None:
            lines.append(f'Fragment: {params["fragment"]}')
        bbx_filters = []
        for axis in 'xyz':
            for kind, sign in (('min', '>='), ('max', '<=')):
                value = params.get(f'bbx_{kind}_{axis}')
                if value is not None:
                    bbx_filters.append(
                        f'{axis.upper()} {sign} {float(value):.2f}')
        if bbx_filters:
            lines.append(f'Bounding Box: {", ".join(bbx_filters)}')
        if params.get('fit_mode') == 'about':
            lines.append(f'Fit: about {params["fit_size"]} mm, within '
                         f'{params["fit_tol"]}')
        elif params.get('fit_mode') == 'can_hold':
            lines.append(f'Fit: can hold {params["fit_size"]} mm')
        if 'near_lat' in params:
            reach = (f', within {params["radius_km"]} km'
                     if 'radius_km' in params else ', nearest first')
            lines.append(f'Near: {params["near_lat"]}, {params["near_lon"]} '
                         f'({params.get("near_layer", "current")} '
                         f'location){reach}')
        return '\n'.join(lines)

    def _refused(self, response, identity_id):
        """Say why a /similar call was refused (404, 409, 422) or failed."""
        status = response.status_code
        detail = None
        try:
            body = response.json()
            detail = body.get('detail') if isinstance(body, dict) else None
        except Exception:
            detail = None
        text = similar_error_text(status, detail)
        if text:
            self._addWarning(text)
        elif status == 401:
            self._addError('Authentication failed. Please sign in again.')
        elif status == 403:
            self._addError('Access denied. Insufficient permissions.')
        elif status == 429:
            self._addWarning('Too many requests. Please wait a moment.')
        elif status >= 500:
            self._addWarning('Server error. Please try again later.')
        else:
            self._addError(f'Request failed with status code: {status}')

    def RunScript(self,
            IdentityID: str,
            Basis: str,
            Count: int,
            OriginalFunction: str,
            Material: str,
            Dataset: str,
            Complexity: int,
            Fragment: bool,
            MinDimensionX: float,
            MaxDimensionX: float,
            MinDimensionY: float,
            MaxDimensionY: float,
            MinDimensionZ: float,
            MaxDimensionZ: float,
            ShapeClass: str,
            MaterialClass: str,
            Circulation: str,
            FitMode: str,
            FitSize: list[object],
            FitTolerance: str,
            NearPoint: Rhino.Geometry.Vector3d,
            NearLayer: str,
            RadiusKm: float):

        if self._stop():
            return empty_outputs()

        auth_core = self.get_auth_core_from_sticky()
        if auth_core is None:
            return empty_outputs()
        if not auth_core.is_valid():
            msg = ('Authentication expired. Please use CSC_Session '
                   'component to refresh.')
            self._addWarning(msg)
            return empty_outputs()

        if IdentityID is None or not str(IdentityID).strip():
            self._addWarning('Please provide the identity UUID (or '
                             'component passport JSON) of the component to '
                             'find neighbours of.')
            return self._no_result('IdentityID')
        identity_id = auth_core.resolve_identity_id_from_input(IdentityID)
        if not identity_id:
            self._addError('IdentityID is not a valid identity UUID or '
                           'component passport JSON.')
            return null_outputs()

        # the filters, the dimension and near search, the basis and the count
        try:
            filters = fetch_filter_params(
                original_function=OriginalFunction, material=Material,
                dataset=Dataset, complexity=Complexity, fragment=Fragment,
                shape_class=ShapeClass or None,
                material_class=MaterialClass or None,
                circulation=Circulation or None,
                bbx={'min_x': MinDimensionX, 'max_x': MaxDimensionX,
                     'min_y': MinDimensionY, 'max_y': MaxDimensionY,
                     'min_z': MinDimensionZ, 'max_z': MaxDimensionZ},
                fit_mode=FitMode, fit_size=FitSize,
                fit_tolerance=FitTolerance, near_point=NearPoint,
                near_layer=NearLayer, radius_km=RadiusKm)
            params, note = similar_params(filters, Basis, Count)
        except ValueError as e:
            # a basis, count, size, tolerance, point or layer that cannot
            # be used: nothing is sent
            self._addWarning(str(e))
            return empty_outputs()
        if note:
            self._addRemark(note)
        if FitTolerance and fit_mode_of(FitMode) == 'can_hold':
            self._addRemark('FitTolerance is ignored: can_hold takes none')

        try:
            response = auth_core.authorized_get(
                f'/identities/{identity_id}/similar', params, timeout=60)
            if response.status_code != 200:
                self._refused(response, identity_id)
                return empty_outputs()
            body = response.json()
            results = similar_results(body)

            FilterDescription = Grasshopper.DataTree[System.Object]()
            ComponentPassport = Grasshopper.DataTree[System.Object]()
            Distance = Grasshopper.DataTree[System.Object]()
            Fit = Grasshopper.DataTree[System.Object]()
            DistanceKm = Grasshopper.DataTree[System.Object]()
            FilterDescription.Add(
                self.generate_description(identity_id, params),
                Grasshopper.Kernel.Data.GH_Path(0))

            lost = 0
            for item in results:
                # the passport of each neighbour, as the other Fetch
                # components build them (cached by the Session)
                passport = auth_core.cached_get_passport(item['id'])
                if passport.status_code != 200:
                    lost += 1
                    continue
                # paths count the found passports only: no gap for a lost
                # one, and Distance, Fit and DistanceKm share the paths
                ghp = Grasshopper.Kernel.Data.GH_Path(
                    0, ComponentPassport.DataCount)
                ComponentPassport.Add(
                    auth_core.passport_json_string(passport.json()), ghp)
                Distance.Add(item['distance'], ghp)
                if item['fit'] is not None:
                    Fit.Add(item['fit'], ghp)
                if item['distance_km'] is not None:
                    DistanceKm.Add(item['distance_km'], ghp)

            found = ComponentPassport.DataCount
            self._state(f'{found} similar')
            self._addRemark(
                f'Found {found} similar components among '
                f'{body.get("considered", "?")} compared '
                f'({body.get("basis_label", params["basis"])})')
            if lost:
                self._addWarning(
                    f'{lost} similar components could not be fetched '
                    f'(passport not available)')
            return (FilterDescription, ComponentPassport, Distance, Fit,
                    DistanceKm)

        except requests.exceptions.ConnectionError as e:
            msg = 'Cannot connect to server. Please check your connection.'
            self._addError(msg + f'\nFull Error: {str(e)}')
            return null_outputs()

        except requests.exceptions.Timeout as e:
            msg = 'Request timeout. Server may be slow.'
            self._addError(msg + f'\nFull Error: {str(e)}')
            return null_outputs()

        except requests.exceptions.RequestException as e:
            msg = f'Request error: {str(e)}'
            self._addError(msg)
            return null_outputs()

        except Exception as e:
            msg = f'Unexpected error: {str(e)}'
            self._addError(msg)
            return null_outputs()

        # Return empty results if there was an error
        FilterDescription = Grasshopper.DataTree[System.Object]()
        ComponentPassport = Grasshopper.DataTree[System.Object]()
        Distance = Grasshopper.DataTree[System.Object]()
        Fit = Grasshopper.DataTree[System.Object]()
        DistanceKm = Grasshopper.DataTree[System.Object]()
        return (FilterDescription, ComponentPassport, Distance, Fit,
                DistanceKm)
# ---------- end fetchsimilarcomponents ----------

# ----
# comments & notes: DEVELOPMENT:
# UPDATING SCRIPTS & USEROBJECTS FROM API
# comments & notes: Check for updates and update all CSC Grasshopper components in the current document. Also download the latest version of all UserObjects and install them.
# 
# NOTE: Checking and installation can take some time!
ddu_csc_local_repo_folder = Panel("")
csc_update = Update(CheckForUpdates=Toggle(False), InstallUpdates=Toggle(False))  # -> Status; inputs CheckForUpdates: Boolean, InstallUpdates: Boolean, LocalFolder: String
# ---------- csc_update: Python ----------
#! python3
# -*- coding: utf-8 -*-
# venv: DDU_CSC
print('ENV OK!')
# r: charset_normalizer
# r: requests

# PYTHON STANDARD LIBRARY IMPORTS ---------------------------------------------
import hashlib  # NOQA
import os  # NOQA
import re  # NOQA
import glob  # NOQA
import shutil  # NOQA
import stat  # NOQA
import sys  # NOQA
import uuid  # NOQA

# THIRD PARTY LIBRARY IMPORTS -------------------------------------------------
import requests  # NOQA

# RHINO AND GH RELATED IMPORTS ------------------------------------------------
import System  # NOQA
import Grasshopper  # NOQA
import Rhino  # NOQA
import scriptcontext as sc  # NOQA
import GhPython as ghpy  # NOQA
import ScriptComponents as scomp  # NOQA
import RhinoCodePluginGH as rcpgh  # NOQA

# the one place that sets the text under the component (decision 8.113); the
# updater installs the library, so it must work without it
try:
    from csc_gh.messages import set_state
except ImportError:
    set_state = None

# GHENV COMPONENT SETTINGS ----------------------------------------------------
ghenv.Component.Name = 'Update'  # NOQA
ghenv.Component.NickName = 'CSC_Update'  # NOQA
ghenv.Component.Category = 'DDU_CSC'  # NOQA
ghenv.Component.SubCategory = '0 Development'  # NOQA
ghenv.Component.Description = (  # NOQA
    'Updates component sources, userobjects and the shared library '
    'csc_gh (installed to the Rhino scripts folder) from server.\n'
    'NOTE: CheckForUpdates must be True to check for updates AND to '
    'install updates! Switch on both to update everything.\n'
    'Updates come from the Grasshopper release that belongs to the '
    'server. UPDATE_CHANNEL (empty by default) may name a GitHub branch or '
    'tag for testing; it must match the remote name exactly.'
)

# Leave empty: the server then delivers the UserObjects of the release it runs
# (tag v<version>), so an update always matches the backend. Testers may set a
# GitHub branch or tag here; it must match the remote name exactly.
UPDATE_CHANNEL = ''

# Matches an actual version declaration - the word "version", a ":" or "=",
# then the number. The separator is required so prose such as 'creates a
# version-0 snapshot' in a component description cannot be mistaken for a
# version declaration. Keep this comment free of literal declarations, they
# would be picked up before the real one below.
VERSION_DECLARATION_RE = re.compile(
    r'version\s*[:=]\s*(\d+(?:\.\d+)?[a-zA-Z]?)')

# Components that were renamed or split. Their sources no longer exist on the
# server, so they can only be reported - not updated in place.
RENAMED_COMPONENTS = {
    'AddComponent': 'AddComponentIdentity',
    'ArrangeComponents': 'CreateArrangement',
    'CreateComponent': 'CreateComponentIdentity / CreateComponentSnapshot',
    'FetchGeometry': 'FetchReducedGeometry / FetchOriginalGeometry',
    'FetchDetailedGeometry': 'FetchOriginalGeometry',
    'ApplyPCAFrame': 'ApplyFrame',
    'CreateReinforcement': 'ReinforcementLayout',
}

# Components that were removed in 0.6 without a successor: designs are not
# part of CSC any more (decision 7.11).
REMOVED_COMPONENTS = {
    'CreateDesign': 'removed in 0.6: designs are not part of CSC',
    'AddDesign': 'removed in 0.6: designs are not part of CSC',
    'FetchDesign': 'removed in 0.6: designs are not part of CSC',
}

# THE SHARED LIBRARY csc_gh (decision 8.111) ------------------------------------
LIBRARY_NAME = 'csc_gh'
LIBRARY_VERSION_RE = re.compile(r"^__version__\s*=\s*'(\d+[a-zA-Z]?)'\s*$",
                                re.M)
LIBRARY_FILE_RE = re.compile(r'^(__init__|[a-z][a-z_]*)\.py$')


class LibraryInstallError(Exception):
    """The library was not installed; the old one is untouched."""


def scripts_folder():
    """Rhino 8's scripts folder (on sys.path of every Python 3 script): the
    entry of sys.path that ends in McNeel/Rhinoceros/8.0/scripts, else the
    default place of the platform."""
    for entry in sys.path:
        parts = os.path.normpath(entry).replace('\\', '/').split('/')
        if parts[-4:] == ['McNeel', 'Rhinoceros', '8.0', 'scripts']:
            return os.path.normpath(entry)
    if sys.platform.startswith('win'):
        base = os.path.expandvars('%APPDATA%')
        return os.path.join(base, 'McNeel', 'Rhinoceros', '8.0', 'scripts')
    return os.path.join(os.path.expanduser('~'), 'Library',
                        'Application Support', 'McNeel', 'Rhinoceros',
                        '8.0', 'scripts')


def is_link(path):
    """A symbolic link or a directory junction (the development setup of
    grasshopper_development/README.md): never replaced by an update."""
    try:
        if os.path.islink(path):
            return True
        attributes = getattr(os.lstat(path), 'st_file_attributes', 0)
        return bool(attributes & getattr(stat, 'FILE_ATTRIBUTE_REPARSE_POINT',
                                         0x400))
    except OSError:
        return False


def library_version_of(folder):
    """The __version__ text of an installed package folder, else None."""
    try:
        with open(os.path.join(folder, '__init__.py'), 'r',
                  encoding='utf-8') as handle:
            match = LIBRARY_VERSION_RE.search(handle.read())
    except OSError:
        return None
    return match.group(1) if match else None


def library_version_key(version):
    match = re.match(r'^(\d+)([a-zA-Z]?)$', str(version or ''))
    if not match:
        return (-1, '')
    return (int(match.group(1)), match.group(2).lower())


def secure_server(base_url):
    """HTTPS, or the loopback address of a local development server."""
    url = (base_url or '').lower()
    if url.startswith('https://'):
        return True
    host = url.split('://', 1)[-1].split('/')[0]
    if host.startswith('['):
        host = host.split(']')[0] + ']'
    else:
        host = host.split(':')[0]
    return url.startswith('http://') and host in (
        'localhost', '127.0.0.1', '[::1]')


def check_manifest(manifest):
    """The manifest as the installer takes it: a version, and per file a plain
    name of the package and a sha256; raises LibraryInstallError."""
    if not isinstance(manifest, dict) or not manifest.get('version'):
        raise LibraryInstallError('the library manifest has no version')
    files = manifest.get('files')
    if not files:
        raise LibraryInstallError('the library manifest lists no files')
    names = set()
    for entry in files:
        name = str(entry.get('path', ''))
        if not LIBRARY_FILE_RE.match(name) or name in names:
            raise LibraryInstallError('not a library file name: %r' % name)
        if not re.match(r'^[0-9a-f]{64}$', str(entry.get('sha256', ''))):
            raise LibraryInstallError('no sha256 for %s' % name)
        names.add(name)
    if '__init__.py' not in names:
        raise LibraryInstallError('the manifest has no __init__.py')
    return manifest


def install_library(scripts_dir, manifest, read_file):
    """Install the package ``csc_gh`` into ``scripts_dir``.

    ``manifest`` is the release manifest ({version, files: [{path, size,
    sha256}]}); ``read_file(name)`` returns the bytes of one file. Every file
    is checked against the manifest (size, sha256) and written into a
    temporary folder next to the target; the installed package is renamed to
    ``csc_gh.bak``, the new folder to ``csc_gh`` and the backup removed. Any
    failure leaves the old package in place (the backup is put back).
    Raises LibraryInstallError; returns the installed version."""
    check_manifest(manifest)
    target = os.path.join(scripts_dir, LIBRARY_NAME)
    if is_link(target):
        raise LibraryInstallError(
            '%s is a link to a repository (a development setup): not '
            'replaced' % target)
    os.makedirs(scripts_dir, exist_ok=True)
    fresh = os.path.join(scripts_dir, '.%s_new_%s' % (LIBRARY_NAME,
                                                      uuid.uuid4().hex[:8]))
    backup = target + '.bak'
    os.makedirs(fresh)
    try:
        for entry in manifest['files']:
            data = read_file(entry['path'])
            if data is None:
                raise LibraryInstallError('missing: %s' % entry['path'])
            if hashlib.sha256(data).hexdigest() != entry['sha256'] or (
                    'size' in entry and len(data) != entry['size']):
                raise LibraryInstallError(
                    'checksum mismatch: %s (not installed)' % entry['path'])
            with open(os.path.join(fresh, entry['path']), 'wb') as handle:
                handle.write(data)
        if library_version_of(fresh) != str(manifest['version']):
            raise LibraryInstallError('the files are not version %s'
                                      % manifest['version'])
        if os.path.exists(backup):
            shutil.rmtree(backup)
        had_old = os.path.isdir(target)
        if had_old:
            os.rename(target, backup)
        try:
            os.rename(fresh, target)
        except OSError:
            if had_old:
                os.rename(backup, target)
            raise
        shutil.rmtree(backup, ignore_errors=True)
    except LibraryInstallError:
        shutil.rmtree(fresh, ignore_errors=True)
        raise
    except Exception as error:
        shutil.rmtree(fresh, ignore_errors=True)
        raise LibraryInstallError('%s' % error) from error
    return str(manifest['version'])


def local_library_manifest(root, folder_name='grasshopper_lib'):
    """The manifest of the package in a local checkout, and a reader."""
    folder = os.path.join(root, folder_name, LIBRARY_NAME)
    files, data = [], {}
    for name in sorted(os.listdir(folder)):
        if not LIBRARY_FILE_RE.match(name):
            continue
        with open(os.path.join(folder, name), 'rb') as handle:
            data[name] = handle.read()
        files.append({'path': name, 'size': len(data[name]),
                      'sha256': hashlib.sha256(data[name]).hexdigest()})
    init = data.get('__init__.py', b'').decode('utf-8', 'replace')
    match = LIBRARY_VERSION_RE.search(init)
    return ({'ref': 'local', 'version': match.group(1) if match else None,
             'files': files}, data.get)


# THE USER OBJECTS (decision 8.155) ---------------------------------------------
# The server lists name, size and sha256 of every .ghuser of the release. A file
# whose installed copy has that sha256 is skipped; the others are downloaded,
# checked (size, sha256) and only then written; a failed file keeps the old one
# and does not stop the run.
USEROBJECT_NAME_RE = re.compile(r'^[A-Za-z0-9_][A-Za-z0-9_.-]*$')

STATE_INCOMPLETE = 'Update incomplete, run again'

SOURCE_REMARK = (
    'Source updated to v{version}. Save the definition, close it and open it '
    'again (until then the script editor opens read-only), then open the '
    'script editor and click Apply to update the inputs and outputs.')


class UserObjectError(Exception):
    """The user object manifest cannot be used."""


def check_userobject_manifest(manifest):
    """The manifest as the updater takes it: per file a plain name and a
    sha256; raises UserObjectError."""
    if not isinstance(manifest, dict) or not manifest.get('files'):
        raise UserObjectError('the UserObject manifest lists no files')
    names = set()
    for entry in manifest['files']:
        name = str(entry.get('name', ''))
        if not USEROBJECT_NAME_RE.match(name) or name in names:
            raise UserObjectError('not a UserObject name: %r' % name)
        if not re.match(r'^[0-9a-f]{64}$', str(entry.get('sha256', ''))):
            raise UserObjectError('no sha256 for %s' % name)
        names.add(name)
    return manifest


def file_sha256(path):
    """The sha256 of a file, None when it cannot be read."""
    try:
        digest = hashlib.sha256()
        with open(path, 'rb') as handle:
            for block in iter(lambda: handle.read(65536), b''):
                digest.update(block)
        return digest.hexdigest()
    except OSError:
        return None


def plan_userobjects(manifest, installed_paths, sha_of=file_sha256):
    """``(unchanged, to_fetch)``: the names whose installed file has the sha256
    of the manifest, and the manifest entries to download (new or changed).
    ``installed_paths`` is ``{name: path of the installed file}``."""
    unchanged, to_fetch = [], []
    for entry in manifest['files']:
        path = installed_paths.get(entry['name'])
        if path and sha_of(path) == entry['sha256']:
            unchanged.append(entry['name'])
        else:
            to_fetch.append(entry)
    return unchanged, to_fetch


def userobject_problem(entry, data):
    """Why downloaded bytes may not be written, or None: nothing came, the
    size is not the manifest's, the sha256 is not."""
    if data is None:
        return 'download failed'
    if 'size' in entry and entry['size'] is not None \
            and len(data) != entry['size']:
        return 'size mismatch'
    if hashlib.sha256(data).hexdigest() != entry['sha256']:
        return 'checksum mismatch'
    return None


def write_userobject(path, data):
    """Write a file in one step: a temporary file beside it, then a rename,
    so a failure never leaves a half-written .ghuser."""
    folder = os.path.dirname(path)
    os.makedirs(folder, exist_ok=True)
    temporary = os.path.join(folder, '.%s.%s.tmp' % (
        os.path.basename(path), uuid.uuid4().hex[:8]))
    try:
        with open(temporary, 'wb') as handle:
            handle.write(data)
        os.replace(temporary, path)
    except Exception:
        try:
            os.remove(temporary)
        except OSError:
            pass
        raise


def install_userobjects(entries, path_of, read_file, write=write_userobject):
    """Install the manifest ``entries`` (new and changed files).

    ``path_of(name)`` is where the file goes, ``read_file(name)`` returns its
    bytes (None or an exception when the download failed). Every file is
    checked before it is written; a failure (download, size, sha256, write)
    leaves the old file and goes on with the next. Returns
    ``(installed names, [(name, reason)] of the failed)``."""
    installed, failed = [], []
    for entry in entries:
        name = entry['name']
        try:
            data = read_file(name)
            problem = userobject_problem(entry, data)
            if problem is None:
                write(path_of(name), data)
        except Exception as error:
            problem = 'error: %s' % error
        if problem is None:
            installed.append(name)
        else:
            failed.append((name, problem))
    return installed, failed


def userobject_counts_text(installed, unchanged, failed):
    return 'UserObjects: %d installed, %d unchanged, %d failed.' % (
        installed, unchanged, failed)


def failed_userobjects_text(failed):
    """The error that names the failed files."""
    return 'UserObjects that failed: %s. The old files are kept.' % ', '.join(
        '%s (%s)' % item for item in failed)


def update_state(failed_files, library_failed, restart):
    """The one state under the component after an install run."""
    if failed_files or library_failed:
        return STATE_INCOMPLETE
    return 'Restart Rhino' if restart else 'Updated'


def version_text(version):
    """The text of a parsed source version: (251009, 0, 0) -> '251009',
    (251009, 1, 0) -> '251009.1', (251009, 0, 1) -> '251009a'."""
    if not version:
        return '?'
    text = str(version[0])
    if len(version) > 1 and version[1]:
        text += '.%d' % version[1]
    if len(version) > 2 and version[2]:
        text += chr(ord('a') + version[2] - 1)
    return text


def source_remark(version):
    """The remark under a component whose source was replaced."""
    return SOURCE_REMARK.format(version=version_text(version))


def replaced_summary(names):
    """The end-of-run line that lists the components with a new source."""
    return ('Replaced the source of %d components: %s. Save the definition, '
            'close it and open it again, then click Apply in the script '
            'editor of each.') % (
        len(names), ', '.join(names))


def local_userobject_manifest(root, folder_name='grasshopper_userobjects'):
    """The manifest of the user objects in a local checkout."""
    folder = os.path.join(root, folder_name)
    files = []
    for name in sorted(os.listdir(folder)):
        if not name.lower().endswith('.ghuser'):
            continue
        with open(os.path.join(folder, name), 'rb') as handle:
            data = handle.read()
        files.append({'name': name[:-len('.ghuser')], 'size': len(data),
                      'sha256': hashlib.sha256(data).hexdigest()})
    return {'ref': 'local', 'version': 'local', 'files': files}


# The two folders of the repository the updater reads from a local copy
# (decision 8.93: the bridge is tested against a local checkout).
SRC_DIR_NAME = 'grasshopper_userobjects_src'
UO_DIR_NAME = 'grasshopper_userobjects'


class CSC_Update(Grasshopper.Kernel.GH_ScriptInstance):
    """
    Author: Max Benjamin Eschenbach
    License: MIT License
    Version: 261103
    """

    def __init__(self):
        """Initialize this component and set component parameters."""
        super().__init__()
        # initialize props
        self.Component = ghenv.Component  # NOQA
        self.InputParams = self.Component.Params.Input
        self.OutputParams = self.Component.Params.Output
        # root of a local checkout while LocalFolder is set, else None
        self.local_root = None
        self._local_error = ''

    def _addRemark(self, msg: str = ''):
        """Add a remark message to the component."""
        rml = self.Component.RuntimeMessageLevel.Remark
        self.AddRuntimeMessage(rml, msg)

    def _addWarning(self, msg: str = ''):
        """Add a warning message to the component."""
        rml = self.Component.RuntimeMessageLevel.Warning
        self.AddRuntimeMessage(rml, msg)

    def _addError(self, msg: str = ''):
        """Add an error message to the component."""
        rml = self.Component.RuntimeMessageLevel.Error
        self.AddRuntimeMessage(rml, msg)

    def BeforeRunScript(self):
        """Perform some setup actions."""
        # Initialize input param descriptions
        self.InputParams[0].Description = (
            'Toggle to check for updates on the server.'
        )
        if len(self.InputParams) > 2:
            self.InputParams[2].Description = (
                'Optional: a local copy of the repository (or its '
                'grasshopper_userobjects_src / grasshopper_userobjects '
                'folder). When set, sources and UserObjects are read from '
                'disk instead of the server and no sign-in is needed.'
            )
        self.InputParams[1].Description = (
            'Toggle to install updates from server.'
        )
        # Initialize output param descriptions
        i = 0
        if self.OutputParams[0].Name == 'out':
            i += 1
        self.OutputParams[0+i].Description = (
            'Status messages about the update process.'
        )

    def _state(self, text=''):
        """The one short state under the component (decision 8.113)."""
        if set_state is not None:
            set_state(self.Component, text)

    def get_auth_core_from_sticky(self):
        """Get AuthCore instance from sticky storage."""
        auth_core = sc.sticky.get('CSC_AuthCore')
        if auth_core is None:
            # nothing to check against yet: a warning, not a failure
            self._addWarning('No authentication found. Please use the '
                             'CSC_Session component first.')
            return None
        return auth_core

    # THE LIBRARY (8.111) ---------------------------------------------------
    def get_api_library_manifest(self, auth_core):
        response = auth_core.authorized_get(
            '/ghinterface/library_manifest', params=self._channel_params(),
            timeout=90)
        if response.status_code != 200:
            raise LibraryInstallError(
                f'the server answered {response.status_code} for the '
                'library manifest')
        return response.json()

    def api_library_reader(self, auth_core):
        def read(name):
            response = auth_core.authorized_get(
                '/ghinterface/library/' + name,
                params=self._channel_params(), timeout=90)
            return response.content if response.status_code == 200 else None
        return read

    def check_library(self, auth_core):
        """What this machine and the release have of csc_gh:
        ``{text, install, manifest, reader, scripts_dir}``; ``install`` says
        whether InstallUpdates would install it."""
        scripts_dir = scripts_folder()
        target = os.path.join(scripts_dir, LIBRARY_NAME)
        result = {'text': '', 'install': False, 'manifest': None,
                  'reader': None, 'scripts_dir': scripts_dir}
        installed = library_version_of(target)
        try:
            if self.local_root:
                manifest, reader = local_library_manifest(self.local_root)
            elif not secure_server(auth_core.base_url):
                result['text'] = (
                    'csc_gh not checked: the server address is not HTTPS')
                self._addWarning(result['text'])
                return result
            else:
                manifest = self.get_api_library_manifest(auth_core)
                reader = self.api_library_reader(auth_core)
            check_manifest(manifest)
        except Exception as error:
            result['text'] = f'csc_gh not checked: {error}'
            self._addWarning(result['text'])
            return result
        wanted = str(manifest['version'])
        if is_link(target):
            result['text'] = (
                f'csc_gh {installed} is linked to a repository (development '
                'setup): not replaced')
            self._addRemark(result['text'])
            return result
        if installed is None:
            result['text'] = f'csc_gh is not installed; release has {wanted}'
        elif library_version_key(installed) < library_version_key(wanted):
            result['text'] = f'csc_gh {installed} < {wanted}: update'
        elif library_version_key(installed) > library_version_key(wanted):
            result['text'] = (
                f'csc_gh {installed} > {wanted} of the release: not '
                'replaced (a development copy?)')
            self._addWarning(result['text'])
            return result
        else:
            result['text'] = f'csc_gh {installed} is up to date'
            self._addRemark(result['text'])
            return result
        result.update(install=True, manifest=manifest, reader=reader)
        self._addRemark(result['text'])
        return result

    def install_library_now(self, library, Status):
        """Install the package; True when it was replaced (Rhino must be
        restarted: imported modules stay cached)."""
        try:
            version = install_library(library['scripts_dir'],
                                      library['manifest'], library['reader'])
        except LibraryInstallError as error:
            msg = f'csc_gh was not installed: {error}'
            self._addError(msg)
            Status.Add(msg)
            return False
        msg = (f'Installed csc_gh {version} to {library["scripts_dir"]}. '
               'Restart Rhino to use it.')
        self._addRemark(msg)
        Status.Add(msg)
        return True

    def _channel_params(self):
        """Query params selecting the GitHub update channel (branch)."""
        return {'channel': UPDATE_CHANNEL} if UPDATE_CHANNEL else {}

    def get_source_version(self, source):
        """
        Attempts to find the first version declaration in a multi line string,
        i.e. the word "version" (or, "Version") followed by ":" or "=" and a
        version number. Lines that merely mention the word "version" are
        ignored.
        Supports formats like:
            Version: 160121
            Version: 251009.1
            Version: 251009a
        """
        for line in source.lower().split('\n'):
            version_match = VERSION_DECLARATION_RE.search(line)
            if version_match:
                return self.parse_version_string(version_match.group(1))
        return None

    def parse_version_string(self, version_str):
        """
        Parse a version string into a comparable format.
        Handles formats like: 251009, 251009.1, 251009a

        Returns a tuple that can be used for comparison:
        - (251009,) for "251009"
        - (251009, 1) for "251009.1"
        - (251009, 0, 'a') for "251009a"
        """
        # Split into base number and suffix
        match = re.match(r'(\d+)(?:\.(\d+))?([a-zA-Z]*)', version_str)
        if not match:
            return None

        base_num = int(match.group(1))
        dot_num = int(match.group(2)) if match.group(2) else 0
        letter_suffix = match.group(3).lower() if match.group(3) else ''

        # Convert letter to number for comparison (a=1, b=2, etc.)
        letter_num = ord(letter_suffix) - ord('a') + 1 if letter_suffix else 0

        return (base_num, dot_num, letter_num)

    def compare_versions(self, version1, version2):
        """
        Compare two version tuples.

        Returns:
            -1 if version1 < version2
             0 if version1 == version2
             1 if version1 > version2
        """
        if version1 is None and version2 is None:
            return 0
        if version1 is None:
            return -1
        if version2 is None:
            return 1

        # Compare tuple elements in order
        for i in range(max(len(version1), len(version2))):
            v1_elem = version1[i] if i < len(version1) else 0
            v2_elem = version2[i] if i < len(version2) else 0

            if v1_elem < v2_elem:
                return -1
            elif v1_elem > v2_elem:
                return 1

        return 0

    def expand_path(self, path):
        """
        Expand environment variables in a path string.
        Handles %APPDATA%, %USERPROFILE%, %TEMP%, etc.
        """
        if not path:
            return path
        return os.path.expandvars(path)

    def replace_scriptcomp_source(
            self, old_script_comp_values, new_source, version=None):
        """
        Replaces source code of gh scriptable components. Only the source is
        set and a remark says what is left to do: the inputs and outputs
        follow when the user applies the script (decision 8.155).
        """
        # extract data
        script_type, nickname, name, obj, source = old_script_comp_values
        # check for type and decide action
        if (script_type == "PY3" or
                script_type == 'IPY2' or
                script_type == 'CS9'):
            # set the source code, nothing else
            obj.SetSource(new_source)
            obj.AddRuntimeMessage(obj.RuntimeMessageLevel.Remark,
                                  source_remark(version))
        elif script_type == 'GHPY':
            return False
        elif script_type == 'CS':
            return False
        return True

    def process_document_objects(self, ghdocument, verbose=False):
        """
        Processes GH_Document object and return a list of all script components
        """
        # get all document objects
        comps = list(ghdocument.Objects)

        # types of python components
        ghpycomp = ghpy.Component.ZuiPythonComponent
        ipycomp = rcpgh.Components.IronPython2Component
        py3comp = rcpgh.Components.Python3Component

        # types of csharp components
        cscomp = scomp.Component_CSNET_Script
        cs9comp = rcpgh.Components.CSharpComponent

        # cluster component
        clustercomp = Grasshopper.Kernel.Special.GH_Cluster

        # extract component type strings
        ghpycomp_str = str(ghpycomp).split("'")[1]
        cscomp_str = str(cscomp).split("'")[1]
        ipycomp_str = str(ipycomp).split("'")[1]
        py3comp_str = str(py3comp).split("'")[1]
        cs9comp_str = str(cs9comp).split("'")[1]
        clustercomp_str = str(clustercomp).split("'")[1]

        # define script types
        id_ghpycomp = 'GHPY'
        id_cscomp = 'CS'
        id_ipycomp = 'IPY2'
        id_py3comp = 'PY3'
        id_cs9comp = 'CS9'

        # init dict for script component storage
        script_components = {}

        # loop over all document components
        # store all component objects in a dictionary to check
        # - are all "same" scripts the same code?
        # - are there scripts without category or version attribute?
        # - separate old from new scripts, dont export old scripts!
        for obj in comps:
            # extract basic info
            name = obj.Name
            nickname = obj.NickName
            iguid = str(obj.InstanceGuid)
            # extract type string
            objtype_str = str(obj.GetType())
            # OLD GHPYTHON COMPONENT
            if objtype_str == ghpycomp_str:
                source = obj.Code
                if source:
                    if verbose:
                        print(
                            (f'Found Source for OLD GHPY Component '
                             f'"{nickname}" ({iguid})'))
                    scriptcomp = [id_ghpycomp, nickname, name, obj, source]
                    script_components[iguid] = scriptcomp
            # OLD C# COMPONENT
            elif objtype_str == cscomp_str:
                source = obj.ScriptSource.ScriptCode
                if source:
                    if verbose:
                        print(
                            (f'Found Source for OLD CS Component "{nickname}" '
                             f'({iguid})'))
                    scriptcomp = [id_cscomp, nickname, name, obj, source]
                    script_components[iguid] = scriptcomp
            # NEW C#9 COMPONENT
            elif objtype_str == cs9comp_str:
                bres, source = obj.TryGetSource()
                if bres:
                    if verbose:
                        print((f'Found Source for CS9 Component "{nickname}" '
                               f'({iguid})'))
                    scriptcomp = [id_cs9comp, nickname, name, obj, source]
                    script_components[iguid] = scriptcomp
            # NEW IRONPYTHON COMPONENT
            elif objtype_str == ipycomp_str:
                bres, source = obj.TryGetSource()
                if bres:
                    if verbose:
                        print((f'Found Source for IPY2 Component "{nickname}" '
                               f'({iguid})'))
                    scriptcomp = [id_ipycomp, nickname, name, obj, source]
                    script_components[iguid] = scriptcomp
            # NEW PYTHON3 COMPONENT
            elif objtype_str == py3comp_str:
                bres, source = obj.TryGetSource()
                if bres:
                    if verbose:
                        print((f'Found Source for PY3 Component "{nickname}" '
                               f'({iguid})'))
                    scriptcomp = [id_py3comp, nickname, name, obj, source]
                    script_components[iguid] = scriptcomp
            # CLUSTER COMPONENT
            elif objtype_str == clustercomp_str:
                # RECURSIVELY STEP THROUGH CLUSTERS AND LOOK FOR SCRIPTS ...
                if verbose:
                    print((f'Processing CLUSTER "{nickname}" ({name}, '
                           f'{iguid}) ...'))
                cluster_scripts = self.process_document_objects(
                    obj.Document(''), verbose=verbose
                )
                # add cluster script dict to main dict
                script_components.update(cluster_scripts)
        # return results
        return script_components

    def process_script_components(
            self,
            script_components: dict,
            set_category: str):
        """
        Process found script components and get matching components.
        """
        versioned_script_components = []
        for iguid, values in script_components.items():
            # extract data from dict object
            script_type, nickname, name, obj, source = values
            category = obj.Category
            version = self.get_source_version(source)
            category_match = category == set_category
            version_present = version is not None
            if category_match and version_present:
                versioned_script_components.append((iguid, values))
        return versioned_script_components

    def get_userobjects_dir(self):
        """Get platform-specific UserObjects directory."""
        dir = Grasshopper.Folders.DefaultUserObjectFolder
        return dir

    def resolve_local_root(self, value):
        """The checkout a LocalFolder input names: its root, None for an
        empty input, False (with an error) when it is not a checkout."""
        value = (value or '').strip()
        if not value:
            return None
        root = os.path.abspath(os.path.expanduser(value))
        if os.path.basename(root) in (SRC_DIR_NAME, UO_DIR_NAME):
            root = os.path.dirname(root)
        for name in (SRC_DIR_NAME, UO_DIR_NAME):
            if not os.path.isdir(os.path.join(root, name)):
                msg = (f'LocalFolder {root} has no {name} folder: give the '
                       'root of a CSC checkout.')
                self._addError(msg)
                self._local_error = msg
                return False
        return root

    def local_source_versions(self):
        """{source name: version} of the sources in the local checkout."""
        versions = {}
        folder = os.path.join(self.local_root, SRC_DIR_NAME)
        for file_name in sorted(os.listdir(folder)):
            stem, ext = os.path.splitext(file_name)
            if ext.lower() not in ('.py', '.cs'):
                continue
            with open(os.path.join(folder, file_name), 'r',
                      encoding='utf-8', errors='replace') as handle:
                version = self.get_source_version(handle.read())
            if not version:
                print(f'{stem} has no version, skipping!')
                continue
            versions[stem] = tuple(version)
        return versions

    def local_source_file_text(self, full_name):
        folder = os.path.join(self.local_root, SRC_DIR_NAME)
        for ext in ('.py', '.cs'):
            path = os.path.join(folder, full_name + ext)
            if os.path.isfile(path):
                with open(path, 'r', encoding='utf-8',
                          errors='replace') as handle:
                    return handle.read()
        msg = f'Source file {full_name} not found in {folder}.'
        self._addError(msg)
        return None

    def local_userobject_bytes(self, uo_name):
        path = os.path.join(self.local_root, UO_DIR_NAME, uo_name + '.ghuser')
        if not os.path.isfile(path):
            msg = f'UserObject {uo_name} not found in {os.path.dirname(path)}.'
            self._addError(msg)
            return None
        with open(path, 'rb') as handle:
            return handle.read()

    def get_api_source_versions(self, auth_core):
        """Get source versions from API (or the local checkout)."""
        if self.local_root:
            return self.local_source_versions()
        api_src_versions = {}
        response = auth_core.authorized_get(
            '/ghinterface/src_names',
            params=self._channel_params(),
            timeout=90
        )
        if response.status_code == 200:
            api_src_files_json = response.json()
            for file_tuple in api_src_files_json:
                name = file_tuple[0]
                version = file_tuple[1]
                if not version:
                    # Source file without a version declaration. Skip it
                    # instead of failing the whole update check.
                    print(f'{name} has no version on server, skipping!')
                    continue
                api_src_versions[name] = tuple(version)
        elif response.status_code == 404:
            msg = (
                f'Update channel "{UPDATE_CHANNEL or "server release"}" was '
                'not found on GitHub. A branch or tag name must match '
                'exactly; the server release exists once it is published.'
            )
            self._addError(msg)
            return None
        elif response.status_code == 401:
            msg = 'Authentication failed. Please sign in again.'
            self._addError(msg)
            return None
        elif response.status_code == 403:
            msg = 'Access denied. Insufficient permissions.'
            self._addError(msg)
            return None
        elif response.status_code == 500:
            msg = 'Server error. Please try again later.'
            self._addError(msg)
            return None
        else:
            msg = (f'Request failed with status code: '
                   f'{response.status_code}')
            try:
                detail = response.json().get('detail')
                if detail:
                    msg = f'{msg}: {detail}'
            except Exception:
                pass
            self._addError(msg)
            return None
        return api_src_versions

    def get_api_userobject_manifest(self, auth_core):
        """Get the userobject manifest from API (or the local checkout):
        name, size and sha256 of every .ghuser of the release (8.155)."""
        if self.local_root:
            return local_userobject_manifest(self.local_root)
        manifest = None
        response = auth_core.authorized_get(
            '/ghinterface/userobject_manifest',
            params=self._channel_params(),
            timeout=120
        )
        if response.status_code == 200:
            manifest = response.json()
            try:
                check_userobject_manifest(manifest)
            except UserObjectError as error:
                self._addError(str(error))
                return None
        elif response.status_code == 404:
            msg = (
                f'Update channel "{UPDATE_CHANNEL or "server release"}" was '
                'not found on GitHub, or the server is older than 0.6.2.0 '
                'and has no UserObject manifest. A branch or tag name must '
                'match exactly; the server release exists once it is '
                'published.'
            )
            self._addError(msg)
            return None
        elif response.status_code == 401:
            msg = 'Authentication failed. Please sign in again.'
            self._addError(msg)
            return None
        elif response.status_code == 403:
            msg = 'Access denied. Insufficient permissions.'
            self._addError(msg)
            return None
        elif response.status_code == 500:
            msg = 'Server error. Please try again later.'
            self._addError(msg)
            return None
        else:
            msg = (f'Request failed with status code: '
                   f'{response.status_code}')
            self._addError(msg)
            return None
        return manifest

    def get_api_source_file_text(self, auth_core, full_name):
        """Get source file from API (or the local checkout)."""
        if self.local_root:
            return self.local_source_file_text(full_name)
        response = auth_core.authorized_get(
            f'/ghinterface/src/{full_name}',
            params=self._channel_params(),
            timeout=60
        )
        if response.status_code == 200:
            return response.text
        elif response.status_code == 404:
            msg = 'Source file not found.'
            self._addError(msg)
            return None
        elif response.status_code == 401:
            msg = 'Authentication failed. Please sign in again.'
            self._addError(msg)
            return None
        elif response.status_code == 403:
            msg = 'Access denied. Insufficient permissions.'
            self._addError(msg)
            return None
        elif response.status_code == 500:
            msg = 'Server error. Please try again later.'
            self._addError(msg)
            return None
        else:
            msg = (f'Request failed with status code: '
                   f'{response.status_code}')
            self._addError(msg)
            return None

    def get_api_userobject_bytes(self, auth_core, uo_name):
        """Get userobject bytes from API (or the local checkout)."""
        if self.local_root:
            return self.local_userobject_bytes(uo_name)
        response = auth_core.authorized_get(
            f'/ghinterface/userobject/{uo_name}',
            params=self._channel_params(),
            timeout=60
        )
        if response.status_code == 200:
            return response.content
        elif response.status_code == 404:
            msg = 'Userobject not found.'
            self._addError(msg)
            return None
        elif response.status_code == 401:
            msg = 'Authentication failed. Please sign in again.'
            self._addError(msg)
            return None
        elif response.status_code == 403:
            msg = 'Access denied. Insufficient permissions.'
            self._addError(msg)
            return None
        elif response.status_code == 500:
            msg = 'Server error. Please try again later.'
            self._addError(msg)
            return None
        else:
            msg = (f'Request failed with status code: '
                   f'{response.status_code}')
            self._addError(msg)
            return None

    def RunScript(self,
            CheckForUpdates: bool,
            InstallUpdates: bool,
            LocalFolder: str):
        if not LocalFolder or LocalFolder == '':
            LocalFolder = None
        # hardcoded category of the components to update
        CATEGORY = 'DDU_CSC'
        # init output tree for status messages
        Status = Grasshopper.DataTree[System.Object]()
        # a local checkout replaces the server (no sign-in needed)
        local_root = self.resolve_local_root(LocalFolder)
        if local_root is False:
            Status.Add(self._local_error)
            return Status
        self.local_root = local_root
        # Get AuthCore instance from sticky storage
        auth_core = None if self.local_root else \
            self.get_auth_core_from_sticky()
        if auth_core is None and not self.local_root:
            return Status
        if UPDATE_CHANNEL and not self.local_root:
            channel_msg = (
                f'UPDATE_CHANNEL is "{UPDATE_CHANNEL}" instead of the '
                "server's release. It must match a GitHub branch or tag "
                'exactly.'
            )
            self._addWarning(channel_msg)
            Status.Add(channel_msg)
        # Check if authentication is valid
        if not self.local_root and not auth_core.is_valid():
            msg = ('Authentication expired. Please use CSC_Session '
                   'component to refresh.')
            self._addWarning(msg)
            Status.Add(msg)
            return Status
        msg = (
            'Toggle CheckForUpdates to True to check for updates on the '
            'server.'
        )
        try:
            if CheckForUpdates:
                msg = (
                    f'Using the local checkout {self.local_root}'
                    if self.local_root else
                    f'Using GitHub update channel: {UPDATE_CHANNEL}'
                    if UPDATE_CHANNEL else
                    "Using the Grasshopper release that belongs to the "
                    'server'
                )
                self._addRemark(msg)
                Status.Add(msg)
                msg = (
                    f'Searching current document for {CATEGORY} script '
                    'components...'
                )
                # loop through the document to find all script components
                doc = self.Component.OnPingDocument()
                script_components = self.process_script_components(
                    self.process_document_objects(doc),
                    CATEGORY
                )
                msg = (
                    f'Found {len(script_components)} {CATEGORY} script '
                    'components in current document (including duplicates).'
                )
                self._addRemark(msg)
                Status.Add(msg)
                # make request to fetch all source file names and versions
                msg = (
                    f'Checking Server for updates '
                    f'(channel: {UPDATE_CHANNEL or "server release"})...'
                )
                api_src_versions = self.get_api_source_versions(auth_core)
                if api_src_versions is None:
                    msg = 'Failed to get source versions from server.'
                    self._addError(msg)
                    Status.Add(msg)
                    return Status
                msg = (f'Found {len(api_src_versions)} unique script '
                       'component source files on server.')
                self._addRemark(msg)
                Status.Add(msg)

                # loop over scripts in document
                scripts_to_update = []
                unmatched_names = []
                for iguid, values in script_components:
                    script_type, nickname, name, obj, current_source = values
                    current_version = self.get_source_version(current_source)
                    full_name = CATEGORY + '_' + name
                    if full_name not in api_src_versions:
                        print(f'{full_name} not found on server!')
                        if name not in unmatched_names:
                            unmatched_names.append(name)
                        continue
                    api_version = api_src_versions[full_name]
                    vc = self.compare_versions(
                        api_version,
                        current_version
                    )
                    if vc == -1:
                        print(
                            f'!! --> {name} {api_version} '
                            f'< {current_version}!'
                        )
                        msg = (
                            f'{name} {api_version} < {current_version}! '
                            'Is this a dev file? That should '
                            'not happen otherwise! Proceed with caution!'
                        )
                        self._addWarning(msg)
                        Status.Add(msg)
                        continue
                    elif vc == 0:
                        print(f'{name} {api_version} == {current_version}')
                    elif vc == 1:
                        print(f'{name} {api_version} > {current_version}')
                        scripts_to_update.append((iguid, values))
                if unmatched_names:
                    details = ', '.join([
                        (f'{n} (replaced by {RENAMED_COMPONENTS[n]})'
                         if n in RENAMED_COMPONENTS else
                         f'{n} ({REMOVED_COMPONENTS[n]})'
                         if n in REMOVED_COMPONENTS else n)
                        for n in sorted(unmatched_names)
                    ])
                    msg = (
                        f'{len(unmatched_names)} {CATEGORY} components in '
                        'this document have no source on the server and '
                        f'cannot be updated in place: {details}. Replace '
                        'them with the current components from the toolbar.'
                    )
                    self._addWarning(msg)
                    Status.Add(msg)
                if not scripts_to_update:
                    msg = 'No scripts in document need updating!'
                    self._addRemark(msg)
                    Status.Add(msg)
                else:
                    msg = (
                        f'Found {len(scripts_to_update)} script '
                        'components that need updating.'
                    )
                    self._addRemark(msg)
                    Status.Add(msg)

                # check for installed userobjects
                uo_dir = self.get_userobjects_dir()
                uo_mask = os.path.join(uo_dir, '**', 'DDU_CSC_*.ghuser')
                installed_uos = [os.path.normpath(p) for p in glob.glob(
                    os.path.normpath(uo_mask),
                    recursive=True
                )]
                if installed_uos:
                    uo_install_dir = os.path.dirname(installed_uos[0])
                else:
                    uo_install_dir = os.path.join(uo_dir, CATEGORY)
                installed_uo_paths = {
                    os.path.splitext(os.path.basename(p))[0]: p
                    for p in installed_uos
                }
                installed_uo_names = list(installed_uo_paths.keys())
                msg = f'Found {len(installed_uos)} installed UserObjects.'
                self._addRemark(msg)
                Status.Add(msg)

                # check for userobjects on server (manifest: name, size, sha256)
                uo_manifest = self.get_api_userobject_manifest(auth_core)
                if uo_manifest is None:
                    msg = 'Failed to get the UserObject manifest from server.'
                    self._addError(msg)
                    Status.Add(msg)
                    return Status
                api_uo_names = [f['name'] for f in uo_manifest['files']]
                msg = f'Found {len(api_uo_names)} UserObjects on server.'
                self._addRemark(msg)
                Status.Add(msg)

                # the installed files that are the ones of the server are
                # skipped; the new and the changed ones are installed
                set_installed_uo_names = set(installed_uo_names)
                unchanged_uo_names, uo_to_fetch = plan_userobjects(
                    uo_manifest, installed_uo_paths)
                stale_uo_names = [
                    uo for uo in set_installed_uo_names
                    if uo not in api_uo_names
                ]
                if uo_to_fetch:
                    msg = (
                        f'Found {len(uo_to_fetch)} UserObjects that are new '
                        f'or changed ({len(unchanged_uo_names)} unchanged). '
                        'Run InstallUpdates to install them.'
                    )
                    self._addRemark(msg)
                    Status.Add(msg)
                if stale_uo_names:
                    msg = (
                        f'Found {len(stale_uo_names)} stale UserObjects not '
                        'on server (will be deleted on InstallUpdates): '
                        f'{", ".join(sorted(stale_uo_names))}'
                    )
                    self._addWarning(msg)
                    Status.Add(msg)
                library = self.check_library(auth_core)
                Status.Add(library['text'])
                if (scripts_to_update or uo_to_fetch or stale_uo_names
                        or library['install']):
                    self._state('Updates available')
                else:
                    self._state('Up to date')
            if InstallUpdates:
                if not CheckForUpdates:
                    msg = 'CheckForUpdates must be True to install updates!'
                    self._addWarning(msg)
                    Status.Add(msg)
                    return Status

                # loop over scripts that need updates
                replaced = []
                replaced_names = []
                if len(scripts_to_update) > 0:
                    for iguid, values in scripts_to_update:
                        (script_type,
                         nickname,
                         name,
                         obj,
                         current_source) = values
                        full_name = CATEGORY + '_' + name
                        new_source = self.get_api_source_file_text(
                            auth_core,
                            full_name
                        )
                        if new_source is None:
                            msg = (
                                f'Failed to get source file {full_name} '
                                'from server.'
                            )
                            self._addError(msg)
                            Status.Add(msg)
                            return Status
                        res = self.replace_scriptcomp_source(
                            values,
                            new_source,
                            api_src_versions.get(full_name)
                        )
                        if not res:
                            msg = (
                                f'Failed to replace source for {nickname} '
                                'with new version! Please contact support '
                                '(lol)'
                            )
                            self._addError(msg)
                            Status.Add(msg)
                            return Status
                        replaced.append(obj)
                        replaced_names.append(nickname)
                        msg = (
                            f'Replaced source for {nickname} with new version!'
                        )
                        self._addRemark(msg)
                        Status.Add(msg)
                    msg = replaced_summary(replaced_names)
                    self._addRemark(msg)
                    Status.Add(msg)

                # first, we delete all stale user objects, using the actual
                # path each userobject was discovered at (they may live in
                # different subfolders due to the recursive glob)
                deleted_stale = 0
                for uo_name in stale_uo_names:
                    stale_file = (
                        installed_uo_paths.get(uo_name) or
                        os.path.join(uo_install_dir, uo_name + '.ghuser')
                    )
                    try:
                        os.remove(stale_file)
                        deleted_stale += 1
                    except OSError as e:
                        msg = (
                            f'Could not delete stale UserObject {uo_name}: '
                            f'{str(e)}'
                        )
                        self._addWarning(msg)
                        Status.Add(msg)
                if stale_uo_names:
                    msg = (
                        f'Deleted {deleted_stale} of {len(stale_uo_names)} '
                        'stale UserObject files.'
                    )
                    self._addRemark(msg)
                    Status.Add(msg)
                # download the new and changed userobjects, each checked
                # (size, sha256) before it is written; a failed file keeps
                # the old one and does not stop the run
                installed_uos, failed_uos = install_userobjects(
                    uo_to_fetch,
                    lambda uo_name: installed_uo_paths.get(uo_name) or
                    os.path.join(uo_install_dir, uo_name + '.ghuser'),
                    lambda uo_name: self.get_api_userobject_bytes(
                        auth_core, uo_name)
                )
                msg = userobject_counts_text(
                    len(installed_uos), len(unchanged_uo_names),
                    len(failed_uos))
                self._addRemark(msg)
                Status.Add(msg)
                if failed_uos:
                    msg = failed_userobjects_text(failed_uos)
                    self._addError(msg)
                    Status.Add(msg)
                restart = False
                library_failed = False
                if library['install']:
                    restart = self.install_library_now(library, Status)
                    library_failed = not restart
                state = update_state(failed_uos, library_failed, restart)
                if state == STATE_INCOMPLETE:
                    msg = 'Update incomplete: run it again.'
                    self._addWarning(msg)
                else:
                    msg = 'All updates installed successfully!'
                    self._addRemark(msg)
                Status.Add(msg)
                self._state(state)

        except requests.exceptions.ConnectionError as e:
            msg = 'Cannot connect to server. Please check your connection.'
            self._addError(msg + f'\nFull Error: {str(e)}')

        except requests.exceptions.Timeout as e:
            msg = 'Request timeout. Server may be slow.'
            self._addError(msg + f'\nFull Error: {str(e)}')

        except requests.exceptions.RequestException as e:
            msg = f'Request error: {str(e)}'
            self._addError(msg)

        except Exception as e:
            msg = f'Unexpected error: {str(e)}'
            self._addError(msg)

        # return status message
        return Status
# ---------- end csc_update ----------
panel_14 = Panel(csc_update)

# ---- group: __DDU_CSC_EXAMPLE_08__
snapshotrequest_2 = Data(snapshotrequest)
addcomponentsnapshot = AddComponentSnapshot(SnapshotRequest=snapshotrequest_2, Run=Toggle(False))  # -> Created; inputs SnapshotRequest: String, Supersedes: String, Run: Boolean
# ---------- addcomponentsnapshot: Python ----------
#! python3
# -*- coding: utf-8 -*-
# venv: DDU_CSC
# r: charset_normalizer
# r: requests==2.32.5
# r: numpy==2.0.2
print('ENV OK!')

# PYTHON STANDARD LIBRARY IMPORTS ---------------------------------------------
import json  # NOQA

# THIRD PARTY LIBRARY IMPORTS -------------------------------------------------
import requests  # NOQA

# RHINO AND GH RELATED IMPORTS ------------------------------------------------
import System  # NOQA
import Grasshopper  # NOQA
import Rhino  # NOQA
import scriptcontext as sc  # NOQA

# GHENV COMPONENT SETTINGS ----------------------------------------------------
ghenv.Component.Name = 'AddComponentSnapshot'  # NOQA
ghenv.Component.NickName = 'AddComponentSnapshot'  # NOQA
ghenv.Component.Category = 'DDU_CSC'  # NOQA
ghenv.Component.SubCategory = '2 Catalog Interface'  # NOQA
ghenv.Component.Description = (  # NOQA
    'Records a new state of an existing component '
    '(POST /identities/{id}/snapshots) or, with Supersedes, a correction '
    'of a published state with its new scan (POST /snapshots/{id}/supersede), '
    'then uploads the files staged by CreateComponentSnapshot. The state '
    'lands as a draft: complete it (files, checks) and submit it in the web, '
    'My work.'
)

# CSC LIBRARY (decision 8.111) ----------------------------------------------
CSC_GH_MINIMUM = '261102'
LIBRARY_PROBLEM = None
try:
    import csc_gh
    csc_gh.require(CSC_GH_MINIMUM)
    from csc_gh.build import (is_uuid, problems_of_envelope, staging_key, text)  # NOQA
    from csc_gh.upload import (http_error_text, load_manifest, passport_after, staged_plan, staging_dir, upload_staged)  # NOQA
    from csc_gh.messages import (waits_for_data)  # NOQA
except ImportError:
    LIBRARY_PROBLEM = (
        'CSC library 261102 too old or missing: run CSC_Update, '
        'then restart Rhino')

# OPTIONAL HELPERS: they never block the component (decisions 8.112, 8.113) ---
try:
    from csc_gh.ports import ensure_outputs
    from csc_gh.messages import set_state
except ImportError:
    ensure_outputs = set_state = None

OUTPUTS = [
    ('Created', 'Created',
     'Component passport JSON ({identity, snapshots[]}) with the new state'),
]


def empty_outputs():
    """What RunScript returns when it stops early or has no result: an empty
    Grasshopper tree per output (never '' or None)."""
    if not OUTPUTS:
        return None
    trees = tuple(Grasshopper.DataTree[System.Object]() for _ in OUTPUTS)
    return trees[0] if len(trees) == 1 else trees


def null_outputs():
    """One null per output: an item of an item-access component that has no
    result keeps its slot (decision 8.186)."""
    if len(OUTPUTS) <= 1:
        return None
    return tuple(None for _ in OUTPUTS)


class CSC_AddComponentSnapshot(Grasshopper.Kernel.GH_ScriptInstance):
    """
    Author: Max Benjamin Eschenbach
    License: MIT License
    Version: 261102
    """

    _outputs_ready = True       # set by BeforeRunScript (8.112)
    _outputs_note = None

    def __init__(self):
        super().__init__()
        self.Component = ghenv.Component  # NOQA
        self.InputParams = self.Component.Params.Input
        self.OutputParams = self.Component.Params.Output

    def _addRemark(self, msg: str = ''):
        rml = self.Component.RuntimeMessageLevel.Remark
        self.AddRuntimeMessage(rml, msg)

    def _addWarning(self, msg: str = ''):
        rml = self.Component.RuntimeMessageLevel.Warning
        self.AddRuntimeMessage(rml, msg)

    def _addError(self, msg: str = ''):
        rml = self.Component.RuntimeMessageLevel.Error
        self.AddRuntimeMessage(rml, msg)

    def _state(self, text=''):
        """The one short state under the component (decision 8.113)."""
        if set_state is not None:
            set_state(self.Component, text)

    def _no_result(self, *ports):
        """The result of an iteration without one (decision 8.186): empty
        outputs when the inputs in ``ports`` carry no data at all (the
        component waits for data; no ports: a list or tree input is empty),
        else a null in the slot of this item, so the outputs stay one to one
        with the input list."""
        if not ports or (waits_for_data is not None
                         and waits_for_data(self, ports)):
            return empty_outputs()
        return null_outputs()

    def _stop(self):
        """True when RunScript has to return early: the library is missing or
        too old, or the outputs were just updated (says why)."""
        if LIBRARY_PROBLEM:
            self._addError(LIBRARY_PROBLEM)
            return True
        if self._outputs_note:
            self._addRemark(self._outputs_note)
        return not self._outputs_ready

    def _check_outputs(self):
        """Make the outputs match OUTPUTS before the script runs (8.112)."""
        self._outputs_ready, self._outputs_note = True, None
        if ensure_outputs is None:
            self._outputs_note = (
                'output check skipped: CSC library not installed')
            return
        status = ensure_outputs(self.Component, OUTPUTS)
        self._outputs_ready, self._outputs_note = status.ready, status.remark

    def BeforeRunScript(self):
        """Perform some setup actions."""
        self.InputParams[0].Description = (
            'Request JSON from CreateComponentSnapshot'
        )
        self.InputParams[1].Description = (
            'Id of the published state this one corrects (overrides the '
            'one in the request; empty: a new state)'
        )
        self.InputParams[2].Description = (
            'Toggle to execute the create operation (the new state lands '
            'as a draft; submit it in the web)'
        )
        self._check_outputs()
        if LIBRARY_PROBLEM is None:
            csc_gh.dev_reload(globals())

    def get_auth_core_from_sticky(self):
        """Get AuthCore instance from sticky storage."""
        auth_core = sc.sticky.get('CSC_AuthCore')
        if auth_core is None:
            msg = ('No authentication found. Please use CSC_Session component '
                   'first.')
            self._addWarning(msg)
            return None
        return auth_core

    def RunScript(self, SnapshotRequest: str, Supersedes: str, Run: bool):
        if self._stop():
            return empty_outputs()
        Created = Grasshopper.DataTree[System.Object]()

        auth_core = self.get_auth_core_from_sticky()
        if auth_core is None:
            return Created
        if not auth_core.is_valid():
            msg = ('Authentication expired. Please use CSC_Session '
                   'component to refresh.')
            self._addWarning(msg)
            return Created
        if not SnapshotRequest:
            msg = 'Please provide the request JSON of CreateComponentSnapshot.'
            self._addWarning(msg)
            return self._no_result('SnapshotRequest')

        try:
            envelope = json.loads(SnapshotRequest)
        except json.JSONDecodeError:
            msg = 'SnapshotRequest must be valid JSON.'
            self._addError(msg)
            return null_outputs()
        problems = problems_of_envelope(envelope)
        if problems:
            msg = 'The request is not a snapshot request:\n' + \
                '\n'.join(problems)
            self._addError(msg)
            return null_outputs()

        identity_id = envelope['identity_id']
        supersedes = text(Supersedes) or envelope.get('supersedes')
        if supersedes and not is_uuid(supersedes):
            msg = 'Supersedes is not a valid snapshot UUID.'
            self._addError(msg)
            return null_outputs()
        body = envelope['snapshot']

        directory = staging_dir(staging_key(SnapshotRequest))
        manifest_dict = load_manifest(directory)
        pending, missing = ([], [])
        geometry = body.get('geometry', {})
        if manifest_dict:
            pending, missing = staged_plan(directory, manifest_dict)
        elif geometry.get('meshes') or geometry.get('point_clouds'):
            self._addRemark('No staged files for this request: only the '
                            'inline Preview geometry is stored.')
        if missing:
            self._addWarning('Staged files are missing: ' + ', '.join(
                entry['path'] for entry in missing))

        if not Run:
            self._state('Run is False')
            return Created

        try:
            if supersedes:
                path = f'/snapshots/{supersedes}/supersede'
            else:
                path = f'/identities/{identity_id}/snapshots'
            response = auth_core.authorized_post(path, json_body=body)
            if response.status_code != 201:
                msg = {
                    401: 'Authentication failed. Please sign in again.',
                    403: 'Access denied: you need the contributor role in '
                         'this dataset.',
                    404: 'Component or state not found.',
                }.get(response.status_code) or http_error_text(
                    response, 'Create')
                self._addError(msg)
                return null_outputs()
            snapshot_doc = response.json()
            snapshot_id = snapshot_doc.get('_id')
            self._addRemark(
                f'Created state {snapshot_id} (version '
                f'{snapshot_doc.get("version")}, a draft)')

            upload_ok = True
            if pending:
                done, failed = upload_staged(
                    auth_core, snapshot_id, pending,
                    progress=self._state)
                for entry, reason in failed:
                    self._addWarning(reason)
                upload_ok = not failed
                self._addRemark(f'Uploaded {len(done)} of {len(pending)} '
                                'staged file(s).')

            if not upload_ok:
                self._addWarning('Some files failed to upload. The state is '
                                 'a draft: complete it in the web (My work) '
                                 'and submit it there.')
            self._state('draft')

            passport = passport_after(auth_core, {'_id': identity_id},
                                      snapshot_doc)
            Created.Add(json.dumps(passport),
                                  Grasshopper.Kernel.Data.GH_Path(0))
            return Created

        except requests.exceptions.ConnectionError as error:
            msg = 'Cannot connect to server. Please check your connection.'
            self._addError(msg + f'\nFull Error: {error}')
            return null_outputs()
        except requests.exceptions.Timeout as error:
            msg = 'Request timeout. Server may be slow.'
            self._addError(msg + f'\nFull Error: {error}')
            return null_outputs()
        except Exception as error:
            # includes CSCClientOutdated: its text names the fix
            self._addError(str(error))
            return null_outputs()
        return Created
# ---------- end addcomponentsnapshot ----------
created = Data(addcomponentsnapshot)

# ---- group: __DDU_CSC_EXAMPLE_06__
# Step 3.3
# comments & notes: Disassemble the components to get the primitive geometry
componentpassport_37 = Data(componentpassport_9)
disassemblecomponent_4 = DisassembleComponent(ComponentPassport=componentpassport_37)  # -> IdentityID, Name, OriginalFunction, Material, Color, Location, BoundingBox, Frame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; inputs ComponentPassport: tree; same code as disassemblecomponent
manufacturedprecision_4 = Data(disassemblecomponent_4.ManufacturedPrecision)
capturemarkers_4 = Data(disassemblecomponent_4.CaptureMarkers)
manufacturedat_4 = Data(disassemblecomponent_4.ManufacturedAt)
conditiongrade_4 = Data(disassemblecomponent_4.ConditionGrade)
parentidentities_4 = Data(disassemblecomponent_4.ParentIdentities)
boundingbox_4 = Data(disassemblecomponent_4.BoundingBox)
descriptors_4 = Data(disassemblecomponent_4.Descriptors)
attributes_4 = Data(disassemblecomponent_4.Attributes)
remaining_4 = Data(disassemblecomponent_4.Remaining)
identityid_7 = Data(disassemblecomponent_4.IdentityID)
material_10 = Data(disassemblecomponent_4.Material)
location_9 = Data(disassemblecomponent_4.Location)
planned_4 = Data(disassemblecomponent_4.Planned)
capture_6 = Data(disassemblecomponent_4.Capture)
name_4 = Data(disassemblecomponent_4.Name)
type_4 = Data(disassemblecomponent_4.OriginalFunction)
frame_4 = Data(disassemblecomponent_4.Frame)
proxies_4 = Data(disassemblecomponent_4.Geometry)
color_6 = Data(disassemblecomponent_4.Color)
origin_7 = Data(disassemblecomponent_4.Origin)

# Step 3.1
# comments & notes: Get radial shape signature distances with medium (32 rays) resolution.
panel_15 = Panel("radial_distance_64")
componentpassport_38 = Data(componentpassport_9)
getdescriptor_7 = GetDescriptor(Input=componentpassport_38, DescriptorKey=panel_15)  # -> DescriptorValues; inputs Input: list, DescriptorKey: String; same code as getdescriptor
radial_distance_64 = Data(getdescriptor_7)

# Step 3.2
# comments & notes: Get radial shape signature tangent vectors with medium (32 rays) resolution.
panel_16 = Panel("radial_tangent_64")
componentpassport_39 = Data(componentpassport_9)
getdescriptor_8 = GetDescriptor(Input=componentpassport_39, DescriptorKey=panel_16)  # -> DescriptorValues; inputs Input: list, DescriptorKey: String; same code as getdescriptor
radial_tangent_64 = Data(getdescriptor_8)

# ---- group: __DDU_CSC_EXAMPLE_04__
# Step 4
# comments & notes: Disassemble the synced components. See how the transformations from the Rhino document are applied?
componentpassport_40 = Data(componentpassport_17)
disassemblecomponent_5 = DisassembleComponent(ComponentPassport=componentpassport_40)  # -> IdentityID, Name, OriginalFunction, Material, Color, Location, BoundingBox, Frame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; inputs ComponentPassport: tree; same code as disassemblecomponent
manufacturedprecision_5 = Data(disassemblecomponent_5.ManufacturedPrecision)
manufacturedat_5 = Data(disassemblecomponent_5.ManufacturedAt)
capturemarkers_5 = Data(disassemblecomponent_5.CaptureMarkers)
conditiongrade_5 = Data(disassemblecomponent_5.ConditionGrade)
parentidentities_5 = Data(disassemblecomponent_5.ParentIdentities)
boundingbox_5 = Data(disassemblecomponent_5.BoundingBox)
descriptors_5 = Data(disassemblecomponent_5.Descriptors)
attributes_5 = Data(disassemblecomponent_5.Attributes)
identityid_8 = Data(disassemblecomponent_5.IdentityID)
location_10 = Data(disassemblecomponent_5.Location)
remaining_5 = Data(disassemblecomponent_5.Remaining)
material_11 = Data(disassemblecomponent_5.Material)
capture_7 = Data(disassemblecomponent_5.Capture)
name_5 = Data(disassemblecomponent_5.Name)
type_5 = Data(disassemblecomponent_5.OriginalFunction)
color_7 = Data(disassemblecomponent_5.Color)
frame_5 = Data(disassemblecomponent_5.Frame)
origin_8 = Data(disassemblecomponent_5.Origin)
proxies_5 = Data(disassemblecomponent_5.Geometry)
planned_5 = Data(disassemblecomponent_5.Planned)

# ---- group: __DDU_CSC_EXAMPLE_03__
# Step 6
# comments & notes: Disassemble the synced components. See how the transformations from the Rhino document are applied?
componentpassport_41 = Data(componentpassport_34)
disassemblecomponent_6 = DisassembleComponent(ComponentPassport=componentpassport_41)  # -> IdentityID, Name, OriginalFunction, Material, Color, Location, BoundingBox, Frame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; inputs ComponentPassport: tree; same code as disassemblecomponent
manufacturedprecision_6 = Data(disassemblecomponent_6.ManufacturedPrecision)
manufacturedat_6 = Data(disassemblecomponent_6.ManufacturedAt)
capturemarkers_6 = Data(disassemblecomponent_6.CaptureMarkers)
conditiongrade_6 = Data(disassemblecomponent_6.ConditionGrade)
parentidentities_6 = Data(disassemblecomponent_6.ParentIdentities)
boundingbox_6 = Data(disassemblecomponent_6.BoundingBox)
descriptors_6 = Data(disassemblecomponent_6.Descriptors)
attributes_6 = Data(disassemblecomponent_6.Attributes)
remaining_6 = Data(disassemblecomponent_6.Remaining)
identityid_9 = Data(disassemblecomponent_6.IdentityID)
planned_6 = Data(disassemblecomponent_6.Planned)
location_11 = Data(disassemblecomponent_6.Location)
geometry_4 = Data(disassemblecomponent_6.Geometry)
material_12 = Data(disassemblecomponent_6.Material)
capture_8 = Data(disassemblecomponent_6.Capture)
name_6 = Data(disassemblecomponent_6.Name)
frame_6 = Data(disassemblecomponent_6.Frame)
type_6 = Data(disassemblecomponent_6.OriginalFunction)
color_8 = Data(disassemblecomponent_6.Color)
origin_9 = Data(disassemblecomponent_6.Origin)

# ---- group: __DDU_CSC_EXAMPLE_07__
# ParentIdentity: IMPORTANT: Here goes the UUID of the parent component (the component that your new, cut to shape piece was made from!)
parentidentity = Panel("")

# comments & notes: Here we create a new component identity (locally).
# 
# Most of the fields are already pre-set for you.
# You need to adjust:
# - Name
# - Dataset
# - Color
# - Parent Identity ID if applicable(Important!)
samplemeshgeometry_2 = Mesh(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)
clearlocalstorage_2 = Button()
transmittedidentityid = Data(componentid_8)
identitymetadata_3 = Data(identitymetadata_2)
snapshotmetadata_6 = Data(snapshotmetadata_5)
capture_9 = Data(capture_2)
geometry_5 = Data(samplemeshgeometry_2)
createcomponentidentity = CreateComponentIdentity(
    ClearLocalStorage=clearlocalstorage_2,
    IdentityID=transmittedidentityid,
    Dataset="demo",
    Identity=identitymetadata_3,
    Snapshot=snapshotmetadata_6,
    Capture=capture_9,
    Geometry=geometry_5,
    ParentIdentity=parentidentity,
    Centre=Toggle(True))  # -> IdentityRequest; inputs ClearLocalStorage: Boolean, IdentityID: String, Dataset: String, Identity: String, Snapshot: String, Capture: String, Geometry: list of GeometryBase, ParentIdentity: list, Centre: Boolean
# ---------- createcomponentidentity: Python ----------
#! python3
# -*- coding: utf-8 -*-
# venv: DDU_CSC
# r: charset_normalizer
# r: numpy==2.0.2
print('ENV OK!')

# PYTHON STANDARD LIBRARY IMPORTS ---------------------------------------------
import json  # NOQA
import os  # NOQA
import uuid  # NOQA

# RHINO AND GH RELATED IMPORTS ------------------------------------------------
import System  # NOQA
import Rhino  # NOQA
import Grasshopper  # NOQA

# GHENV COMPONENT SETTINGS ----------------------------------------------------
ghenv.Component.Name = 'CreateComponentIdentity'  # NOQA
ghenv.Component.NickName = 'CreateComponentIdentity'  # NOQA
ghenv.Component.Category = 'DDU_CSC'  # NOQA
ghenv.Component.SubCategory = '3 Component Operations'  # NOQA
ghenv.Component.Description = (  # NOQA
    'Builds the request that records a new component with its first '
    'state (POST /identities): ids, dataset, the builder objects '
    '(IdentityMetadata, SnapshotMetadata, Capture), geometry and, for a '
    'cut element, its parents. Reduces and stages the mesh files for '
    'AddComponentIdentity. No orientation or box is computed here: the '
    'server derives the frame. Meshes referenced from Rhino objects with '
    'a base-colour texture get vertex colours from it.'
)

# CSC LIBRARY (decision 8.111) ----------------------------------------------
CSC_GH_MINIMUM = '261102'
LIBRARY_PROBLEM = None
try:
    import csc_gh
    csc_gh.require(CSC_GH_MINIMUM)
    from csc_gh.build import (BuildError, MissingInput, identity_body, loads_fragment, problems_of_identity, snapshot_body, staging_key, text)  # NOQA
    from csc_gh.rhino import (input_references, stage_geometry)  # NOQA
    from csc_gh.upload import (clear_staging, commit_staging, staging_root)  # NOQA
    from csc_gh.messages import (waits_for_data)  # NOQA
except ImportError:
    LIBRARY_PROBLEM = (
        'CSC library 261102 too old or missing: run CSC_Update, '
        'then restart Rhino')


DEFAULT_RGB = (110, 110, 110)

# OPTIONAL HELPERS: they never block the component (decisions 8.112, 8.113) ---
try:
    from csc_gh.ports import ensure_outputs
    from csc_gh.messages import set_state
except ImportError:
    ensure_outputs = set_state = None

OUTPUTS = [
    ('IdentityRequest', 'IdentityRequest',
     'Request JSON for AddComponentIdentity (IdentityCreateBody)'),
]


def empty_outputs():
    """What RunScript returns when it stops early or has no result: an empty
    Grasshopper tree per output (never '' or None)."""
    if not OUTPUTS:
        return None
    trees = tuple(Grasshopper.DataTree[System.Object]() for _ in OUTPUTS)
    return trees[0] if len(trees) == 1 else trees


def null_outputs():
    """One null per output: an item of an item-access component that has no
    result keeps its slot (decision 8.186)."""
    if len(OUTPUTS) <= 1:
        return None
    return tuple(None for _ in OUTPUTS)


class CSC_CreateComponentIdentity(Grasshopper.Kernel.GH_ScriptInstance):
    """
    Author: Max Benjamin Eschenbach
    License: MIT License
    Version: 261102
    """

    _outputs_ready = True       # set by BeforeRunScript (8.112)
    _outputs_note = None

    def __init__(self):
        """Initialize this component and set component parameters."""
        super().__init__()
        self.Component = ghenv.Component  # NOQA
        self.InputParams = self.Component.Params.Input
        self.OutputParams = self.Component.Params.Output

    def _addRemark(self, msg: str = ''):
        rml = self.Component.RuntimeMessageLevel.Remark
        self.AddRuntimeMessage(rml, msg)

    def _addWarning(self, msg: str = ''):
        rml = self.Component.RuntimeMessageLevel.Warning
        self.AddRuntimeMessage(rml, msg)

    def _addError(self, msg: str = ''):
        rml = self.Component.RuntimeMessageLevel.Error
        self.AddRuntimeMessage(rml, msg)

    def _state(self, text=''):
        """The one short state under the component (decision 8.113)."""
        if set_state is not None:
            set_state(self.Component, text)

    def _no_result(self, *ports):
        """The result of an iteration without one (decision 8.186): empty
        outputs when the inputs in ``ports`` carry no data at all (the
        component waits for data; no ports: a list or tree input is empty),
        else a null in the slot of this item, so the outputs stay one to one
        with the input list."""
        if not ports or (waits_for_data is not None
                         and waits_for_data(self, ports)):
            return empty_outputs()
        return null_outputs()

    def _stop(self):
        """True when RunScript has to return early: the library is missing or
        too old, or the outputs were just updated (says why)."""
        if LIBRARY_PROBLEM:
            self._addError(LIBRARY_PROBLEM)
            return True
        if self._outputs_note:
            self._addRemark(self._outputs_note)
        return not self._outputs_ready

    def _check_outputs(self):
        """Make the outputs match OUTPUTS before the script runs (8.112)."""
        self._outputs_ready, self._outputs_note = True, None
        if ensure_outputs is None:
            self._outputs_note = (
                'output check skipped: CSC library not installed')
            return
        status = ensure_outputs(self.Component, OUTPUTS)
        self._outputs_ready, self._outputs_note = status.ready, status.remark

    def BeforeRunScript(self):
        """Perform some setup actions."""
        self.InputParams[0].Description = (
            'Empty the staging folder of files waiting for an Add component'
        )
        self.InputParams[1].Description = (
            'Id of the component (the UUID of its tag; empty: the server makes '
            'one)'
        )
        self.InputParams[2].Description = (
            'Dataset the component belongs to (not inherited)'
        )
        self.InputParams[3].Description = (
            'IdentityMetadata JSON (original function, material, origin ...); '
            'leave empty for a cut element: its parents give it'
        )
        self.InputParams[4].Description = (
            'SnapshotMetadata JSON (name, colour, location, notes ...)'
        )
        self.InputParams[5].Description = (
            'Capture JSON (how the geometry was recorded); optional'
        )
        self.InputParams[6].Description = (
            'Meshes, point clouds, extrusions (-> prism) and box-shaped breps '
            '(-> box). Meshes are reduced for the Preview and the Reduced '
            'level; the original is kept. A mesh that references a Rhino '
            'object with a base-colour texture in its material is coloured '
            'from that texture (the texture wins over vertex colours the '
            'mesh has; an internalised or Grasshopper-made mesh keeps its '
            'own colours).'
        )
        self.InputParams[7].Description = (
            'Ids of the elements this one is cut from (one parent: a split, '
            'several: a merge)'
        )
        self.InputParams[8].Description = (
            'Move the centroid of the geometry to the origin before it is '
            'stored (default false: stored coordinates are those you give)'
        )
        # Initialize output param descriptions
        self._check_outputs()
        if LIBRARY_PROBLEM is None:
            csc_gh.dev_reload(globals())

    def RunScript(self,
            ClearLocalStorage: bool,
            IdentityID: str,
            Dataset: str,
            Identity: str,
            Snapshot: str,
            Capture: str,
            Geometry: list[Rhino.Geometry.GeometryBase],
            ParentIdentity: list[object],
            Centre: bool):
        if self._stop():
            return empty_outputs()
        IdentityRequest = empty_outputs()
        tmp_dir = None
        try:
            # ClearLocalStorage empties the staging folder and stops here
            if ClearLocalStorage:
                folder = clear_staging()
                self._state('Staging folder cleared')
                self._addRemark(f'Cleared {folder}')
                return IdentityRequest

            if not Geometry:
                raise MissingInput('Input Geometry failed to collect data')
            root = staging_root()
            os.makedirs(root, exist_ok=True)
            tmp_dir = os.path.join(root, '_tmp_' + uuid.uuid4().hex)
            meta = loads_fragment(Snapshot, 'Snapshot') or {}
            # vertex colours from the texture of the Rhino object each mesh
            # references (8.175): no input, the references come from the
            # volatile data of Geometry; the remarks say what was done
            items = list(Geometry)
            try:
                references = input_references(self.Component, 'Geometry', items)
            except Exception:
                references = None
            texture_notes = []
            geometry, mani, move = stage_geometry(
                items, tmp_dir, meta.get('color') or DEFAULT_RGB,
                bool(Centre), references=references, notes=texture_notes)
            for note in texture_notes:
                self._addRemark(note)
            snapshot_dict = snapshot_body(meta, geometry, Capture)
            body = identity_body(IdentityID, Dataset, Identity, snapshot_dict,
                                 list(ParentIdentity or []))
            if not text(IdentityID):
                self._addRemark('No IdentityID: the server will assign one')

            problems = problems_of_identity(body)
            if problems:
                raise BuildError('\n'.join(problems))
            text_json = json.dumps(body, sort_keys=True)
            key = staging_key(text_json)
            folder = commit_staging(tmp_dir, key, mani)
            tmp_dir = None
            IdentityRequest = text_json
            files = sum(len(v) for v in mani.get('meshes', {}).values()) \
                + len(mani.get('point_clouds', []))
            self._state('Request built' + (
                f' ({files} file(s) staged)' if files else ''))
            if any(move):
                self._addRemark(
                    'Centred: the geometry was moved by '
                    f'({move[0]:.3f}, {move[1]:.3f}, {move[2]:.3f})')
            if folder:
                self._addRemark(f'Staged files: {folder}')
            return IdentityRequest
        except MissingInput as error:
            self._addWarning(str(error))
            return self._no_result(*error.ports)
        except BuildError as error:
            self._addError(str(error))
            return null_outputs()
        except ValueError as error:
            self._addError(str(error))
            return null_outputs()
        except Exception as error:
            msg = f'Unexpected error: {error}'
            self._addError(msg)
            return null_outputs()
        finally:
            if tmp_dir and os.path.isdir(tmp_dir):
                import shutil
                shutil.rmtree(tmp_dir, ignore_errors=True)
        return IdentityRequest
# ---------- end createcomponentidentity ----------
identityrequest = Data(createcomponentidentity)

# ----
# Step 3.1
proxygeometry = Data(proxies)
txt = Text(proxygeometry)
tmatch = MatchText(Text=txt, Pattern="*Extrusion*", Case=True)
dispatch = Dispatch(List=proxygeometry, DispatchPattern=tmatch)  # -> ListA, ListB
lng = ListLength(List=flatten(dispatch.ListB))
random = Random(Range=lng, Number=1, Seed=2, Integers=True)
item_5 = ListItem(List=flatten(dispatch.ListB), Index=random, Wrap=True)
random_proxygeometry = Data(item_5)
inputdata = Data(random_proxygeometry)
fetchreducedgeometry_2 = FetchReducedGeometry(Input=inputdata)  # -> GeometryData, GeometrySource, SnapshotID; same code as fetchreducedgeometry
panel_17 = Panel(fetchreducedgeometry_2.SnapshotID)
panel_18 = Panel(fetchreducedgeometry_2.GeometrySource)
geometry_6 = Data(fetchreducedgeometry_2.GeometryData)

# ----
# comments & notes: Generic JSON Disassembly Tools to Access additional attributes (metadata from scanning, etc.)
number_slider_5 = Slider(103, range=0..500)
attributes_7 = Data(attributes)
item_6 = ListItem(List=flatten(attributes_7), Index=number_slider_5, Wrap=True)
jsonkeys = JSONKeys(JSON=item_6)  # -> Keys, KeyTypes, KeyPaths; inputs JSON: String, MaxDepth: Int32
# ---------- jsonkeys: Python ----------
#! python3
# -*- coding: utf-8 -*-
# venv: DDU_CSC
print('ENV OK!')
# r: charset_normalizer
# r: requests

# PYTHON STANDARD LIBRARY IMPORTS ---------------------------------------------
import json  # NOQA

# RHINO AND GH RELATED IMPORTS ------------------------------------------------
import System  # NOQA
import Grasshopper  # NOQA
import Rhino  # NOQA

# GHENV COMPONENT SETTINGS ----------------------------------------------------
ghenv.Component.Name = 'JSONKeys'  # NOQA
ghenv.Component.NickName = 'JSONKeys'  # NOQA
ghenv.Component.Category = 'DDU_CSC'  # NOQA
ghenv.Component.SubCategory = '6 Data Tools'  # NOQA
ghenv.Component.Description = (  # NOQA
    'Extracts all keys and their paths from a JSON string up to a specified '
    'maximum depth. Returns keys, types, and full dot-notation paths as '
    'separate data trees.'
)

# OPTIONAL HELPERS: they never block the component (decisions 8.112, 8.113) ---
try:
    from csc_gh.ports import ensure_outputs
    from csc_gh.messages import set_state, waits_for_data
except ImportError:
    ensure_outputs = set_state = waits_for_data = None

OUTPUTS = [
    ('Keys', 'Keys',
     'List of all available keys in the JSON structure'),
    ('KeyTypes', 'KeyTypes',
     'Data types for each key (object, array, string, number, boolean, null)'),
    ('KeyPaths', 'KeyPaths',
     'Full dot-notation paths for each key (e.g., "descriptors.material.type")'),
]


def empty_outputs():
    """What RunScript returns when it stops early or has no result: an empty
    Grasshopper tree per output (never '' or None)."""
    if not OUTPUTS:
        return None
    trees = tuple(Grasshopper.DataTree[System.Object]() for _ in OUTPUTS)
    return trees[0] if len(trees) == 1 else trees


def null_outputs():
    """One null per output: an item of an item-access component that has no
    result keeps its slot (decision 8.186)."""
    if len(OUTPUTS) <= 1:
        return None
    return tuple(None for _ in OUTPUTS)


class CSC_JSONKeys(Grasshopper.Kernel.GH_ScriptInstance):
    """
    Author: Max Benjamin Eschenbach
    License: MIT License
    Version: 261102
    """

    _outputs_ready = True       # set by BeforeRunScript (8.112)
    _outputs_note = None

    def __init__(self):
        """Initialize this component and set component parameters."""
        super().__init__()
        # initialize props
        self.Component = ghenv.Component  # NOQA
        self.InputParams = self.Component.Params.Input
        self.OutputParams = self.Component.Params.Output

    def _addRemark(self, msg: str = ''):
        """Add a remark message to the component."""
        rml = self.Component.RuntimeMessageLevel.Remark
        self.AddRuntimeMessage(rml, msg)

    def _addWarning(self, msg: str = ''):
        """Add a warning message to the component."""
        rml = self.Component.RuntimeMessageLevel.Warning
        self.AddRuntimeMessage(rml, msg)

    def _addError(self, msg: str = ''):
        """Add an error message to the component."""
        rml = self.Component.RuntimeMessageLevel.Error
        self.AddRuntimeMessage(rml, msg)

    def _state(self, text=''):
        """The one short state under the component (decision 8.113)."""
        if set_state is not None:
            set_state(self.Component, text)

    def _no_result(self, *ports):
        """The result of an iteration without one (decision 8.186): empty
        outputs when the inputs in ``ports`` carry no data at all (the
        component waits for data; no ports: a list or tree input is empty),
        else a null in the slot of this item, so the outputs stay one to one
        with the input list."""
        if not ports or (waits_for_data is not None
                         and waits_for_data(self, ports)):
            return empty_outputs()
        return null_outputs()

    def _stop(self):
        """True when RunScript has to return early: the outputs were just
        updated (says why)."""
        if self._outputs_note:
            self._addRemark(self._outputs_note)
        return not self._outputs_ready

    def _check_outputs(self):
        """Make the outputs match OUTPUTS before the script runs (8.112)."""
        self._outputs_ready, self._outputs_note = True, None
        if ensure_outputs is None:
            self._outputs_note = (
                'output check skipped: CSC library not installed')
            return
        status = ensure_outputs(self.Component, OUTPUTS)
        self._outputs_ready, self._outputs_note = status.ready, status.remark

    def BeforeRunScript(self):
        """Perform some setup actions."""
        # Initialize input param descriptions
        self.InputParams[0].Description = (
            'JSON string to extract keys from'
        )
        self.InputParams[1].Description = (
            'Maximum depth to traverse in the JSON structure (default: 5)'
        )
        # Initialize output param descriptions
        self._check_outputs()

    def get_json_type(self, value):
        """Get the JSON type of a value."""
        if isinstance(value, dict):
            return 'object'
        elif isinstance(value, list):
            return 'array'
        elif isinstance(value, bool):
            return 'boolean'
        elif isinstance(value, (int, float)):
            return 'number'
        elif isinstance(value, str):
            return 'string'
        elif value is None:
            return 'null'
        else:
            return 'unknown'

    def extract_keys_recursive(self, data, prefix='', max_depth=5,
                               current_depth=0):
        """Recursively extract all keys from JSON data."""
        keys = []
        key_types = []
        key_paths = []

        if current_depth >= max_depth:
            return keys, key_types, key_paths

        if isinstance(data, dict):
            for key, value in data.items():
                current_path = f'{prefix}.{key}' if prefix else key
                keys.append(key)
                key_types.append(self.get_json_type(value))
                key_paths.append(current_path)

                # Recursively process nested objects and arrays
                if (isinstance(value, (dict, list)) and
                        current_depth < max_depth - 1):
                    nested_keys, nested_types, nested_paths = (
                        self.extract_keys_recursive(
                            value, current_path, max_depth, current_depth + 1
                        )
                    )
                    keys.extend(nested_keys)
                    key_types.extend(nested_types)
                    key_paths.extend(nested_paths)

        elif isinstance(data, list):
            for i, item in enumerate(data):
                current_path = f'{prefix}[{i}]' if prefix else f'[{i}]'
                keys.append(f'[{i}]')
                key_types.append(self.get_json_type(item))
                key_paths.append(current_path)

                # Recursively process nested objects and arrays
                if (isinstance(item, (dict, list)) and
                        current_depth < max_depth - 1):
                    nested_keys, nested_types, nested_paths = (
                        self.extract_keys_recursive(
                            item, current_path, max_depth, current_depth + 1
                        )
                    )
                    keys.extend(nested_keys)
                    key_types.extend(nested_types)
                    key_paths.extend(nested_paths)

        return keys, key_types, key_paths

    def RunScript(self, JSON: str, MaxDepth: int):
        # set up output trees and results tuple
        if self._stop():
            return empty_outputs()
        Keys = Grasshopper.DataTree[System.Object]()
        KeyTypes = Grasshopper.DataTree[System.Object]()
        KeyPaths = Grasshopper.DataTree[System.Object]()
        __Results = (Keys, KeyTypes, KeyPaths)
        try:
            # Validate input
            if not JSON:
                msg = 'No JSON input provided'
                self._addWarning(msg)
                return self._no_result('JSON')

            # Set default max depth if not provided
            if MaxDepth is None or MaxDepth < 1:
                MaxDepth = 5


            # Parse JSON
            try:
                json_data = json.loads(JSON)
            except json.JSONDecodeError as e:
                msg = f'Invalid JSON format: {str(e)}'
                self._addError(msg)
                return null_outputs()

            # Extract keys recursively
            keys, key_types, key_paths = self.extract_keys_recursive(
                json_data, max_depth=MaxDepth
            )

            # Add results to data trees
            if keys:
                for i, key in enumerate(keys):
                    Keys.Add(key)
                    KeyTypes.Add(
                        key_types[i] if i < len(key_types) else 'unknown'
                    )
                    KeyPaths.Add(key_paths[i] if i < len(key_paths) else key)
            else:
                # If no keys found, add empty results
                Keys.Add('')
                KeyTypes.Add('')
                KeyPaths.Add('')

            # Update success message
            total_keys = len(keys)
            self._addRemark(
                f'Successfully extracted {total_keys} keys from JSON'
            )

            # return output trees
            return __Results

        except Exception as e:
            msg = f'Unexpected error during key extraction: {str(e)}'
            self._addError(msg)
            # Return empty results if there was an error
            return null_outputs()
# ---------- end jsonkeys ----------
jsongetvalue = JSONGetValue(JSON=item_6, KeyPath=jsonkeys.KeyPaths)  # -> Value, ValueType, Success, Error; inputs JSON: String, KeyPath: String, DefaultValue: String
# ---------- jsongetvalue: Python ----------
#! python3
# -*- coding: utf-8 -*-
# venv: DDU_CSC
print('ENV OK!')
# r: charset_normalizer
# r: requests

# PYTHON STANDARD LIBRARY IMPORTS ---------------------------------------------
import json  # NOQA

# RHINO AND GH RELATED IMPORTS ------------------------------------------------
import System  # NOQA
import Grasshopper  # NOQA
import Rhino  # NOQA

# GHENV COMPONENT SETTINGS ----------------------------------------------------
ghenv.Component.Name = 'JSONGetValue'  # NOQA
ghenv.Component.NickName = 'JSONGetValue'  # NOQA
ghenv.Component.Category = 'DDU_CSC'  # NOQA
ghenv.Component.SubCategory = '6 Data Tools'  # NOQA
ghenv.Component.Description = (  # NOQA
    'Extracts a specific value from a JSON string using dot-notation key '
    'paths (e.g., "geometry.meshes[0].v"). Converts JSON values to '
    'appropriate native Grasshopper data types where possible.'
)

# OPTIONAL HELPERS: they never block the component (decisions 8.112, 8.113) ---
try:
    from csc_gh.ports import ensure_outputs
    from csc_gh.messages import set_state
except ImportError:
    ensure_outputs = set_state = None

OUTPUTS = [
    ('Value', 'Value',
     'Extracted value converted to appropriate Grasshopper type'),
    ('ValueType', 'ValueType',
     'Data type of the extracted value (string, number, boolean, object, array, null)'),
    ('Success', 'Success',
     'True if extraction was successful, False otherwise'),
    ('Error', 'Error',
     'Error message if extraction failed, empty string if successful'),
]


def empty_outputs():
    """What RunScript returns when it stops early or has no result: an empty
    Grasshopper tree per output (never '' or None)."""
    if not OUTPUTS:
        return None
    trees = tuple(Grasshopper.DataTree[System.Object]() for _ in OUTPUTS)
    return trees[0] if len(trees) == 1 else trees


def null_outputs():
    """One null per output: an item of an item-access component that has no
    result keeps its slot (decision 8.186)."""
    if len(OUTPUTS) <= 1:
        return None
    return tuple(None for _ in OUTPUTS)


class CSC_JSONGetValue(Grasshopper.Kernel.GH_ScriptInstance):
    """
    Author: Max Benjamin Eschenbach
    License: MIT License
    Version: 261102
    """

    _outputs_ready = True       # set by BeforeRunScript (8.112)
    _outputs_note = None

    def __init__(self):
        """Initialize this component and set component parameters."""
        super().__init__()
        # initialize props
        self.Component = ghenv.Component  # NOQA
        self.InputParams = self.Component.Params.Input
        self.OutputParams = self.Component.Params.Output

    def _addRemark(self, msg: str = ''):
        """Add a remark message to the component."""
        rml = self.Component.RuntimeMessageLevel.Remark
        self.AddRuntimeMessage(rml, msg)

    def _addWarning(self, msg: str = ''):
        """Add a warning message to the component."""
        rml = self.Component.RuntimeMessageLevel.Warning
        self.AddRuntimeMessage(rml, msg)

    def _addError(self, msg: str = ''):
        """Add an error message to the component."""
        rml = self.Component.RuntimeMessageLevel.Error
        self.AddRuntimeMessage(rml, msg)

    def _state(self, text=''):
        """The one short state under the component (decision 8.113)."""
        if set_state is not None:
            set_state(self.Component, text)

    def _stop(self):
        """True when RunScript has to return early: the outputs were just
        updated (says why)."""
        if self._outputs_note:
            self._addRemark(self._outputs_note)
        return not self._outputs_ready

    def _check_outputs(self):
        """Make the outputs match OUTPUTS before the script runs (8.112)."""
        self._outputs_ready, self._outputs_note = True, None
        if ensure_outputs is None:
            self._outputs_note = (
                'output check skipped: CSC library not installed')
            return
        status = ensure_outputs(self.Component, OUTPUTS)
        self._outputs_ready, self._outputs_note = status.ready, status.remark

    def BeforeRunScript(self):
        """Perform some setup actions."""
        # Initialize input param descriptions
        self.InputParams[0].Description = (
            'JSON string to extract value from'
        )
        self.InputParams[1].Description = (
            'Dot-notation path to the desired value '
            '(e.g., "descriptors.material.type")'
        )
        self.InputParams[2].Description = (
            'Default value to return if key path is not found (optional)'
        )
        # Initialize output param descriptions
        self._check_outputs()

    def get_value_by_path(self, data, path):
        """Get value from JSON data using dot-notation path."""
        if not path:
            return data, 'root'

        # Parse path to handle both dot notation and array indices
        parts = self.parse_path(path)

        current = data
        for part in parts:
            if isinstance(part, int):
                # Array index
                if isinstance(current, list) and 0 <= part < len(current):
                    current = current[part]
                else:
                    raise IndexError(f'Array index {part} out of range')
            else:
                # Object key
                if isinstance(current, dict) and part in current:
                    current = current[part]
                else:
                    raise KeyError(f'Key "{part}" not found')

        return current, self.get_json_type(current)

    def parse_path(self, path):
        """Parse a path string into a list of keys and indices."""
        parts = []
        current_part = ''
        i = 0

        while i < len(path):
            char = path[i]

            if char == '.':
                # End of current part
                if current_part:
                    parts.append(current_part)
                    current_part = ''
            elif char == '[':
                # Start of array index
                if current_part:
                    parts.append(current_part)
                    current_part = ''
                # Find the closing bracket
                j = i + 1
                while j < len(path) and path[j] != ']':
                    j += 1
                if j < len(path):
                    # Extract the index
                    index_str = path[i+1:j]
                    try:
                        index = int(index_str)
                        parts.append(index)
                        i = j  # Skip to after the closing bracket
                    except ValueError:
                        raise ValueError(f'Invalid array index: {index_str}')
                else:
                    raise ValueError('Unclosed array bracket')
            else:
                current_part += char

            i += 1

        # Add the last part if any
        if current_part:
            parts.append(current_part)

        return parts

    def get_json_type(self, value):
        """Get the JSON type of a value."""
        if isinstance(value, dict):
            return 'object'
        elif isinstance(value, list):
            return 'array'
        elif isinstance(value, bool):
            return 'boolean'
        elif isinstance(value, (int, float)):
            return 'number'
        elif isinstance(value, str):
            return 'string'
        elif value is None:
            return 'null'
        else:
            return 'unknown'

    def convert_to_gh_type(self, value, value_type):
        """Convert value to appropriate Grasshopper type."""
        if value_type == 'boolean':
            return bool(value)
        elif value_type == 'number':
            if isinstance(value, int):
                return int(value)
            else:
                return float(value)
        elif value_type == 'string':
            return str(value)
        elif value_type == 'null':
            return None
        elif value_type == 'object':
            return json.dumps(value)
        elif value_type == 'array':
            # Convert array to Grasshopper-compatible list
            return self.convert_array_to_gh_list(value)
        else:
            return str(value)

    def convert_array_to_gh_list(self, array_value):
        """Convert JSON array to Grasshopper-compatible list."""
        if not isinstance(array_value, list):
            return array_value

        converted_list = []
        for item in array_value:
            # Recursively convert each item in the array
            item_type = self.get_json_type(item)
            converted_item = self.convert_to_gh_type(item, item_type)
            converted_list.append(converted_item)

        return converted_list

    def RunScript(self, JSON: str, KeyPath: str, DefaultValue: str):
        # set up output trees and results tuple
        if self._stop():
            return empty_outputs()
        Value = Grasshopper.DataTree[System.Object]()
        ValueType = Grasshopper.DataTree[System.Object]()
        Success = Grasshopper.DataTree[System.Object]()
        Error = Grasshopper.DataTree[System.Object]()
        __Results = (Value, ValueType, Success, Error)
        try:
            # Validate input
            if not JSON:
                msg = 'No JSON input provided'
                self._addWarning(msg)
                Value.Add('')
                ValueType.Add('')
                Success.Add(False)
                Error.Add(msg)
                return __Results

            if not KeyPath:
                msg = 'No key path provided'
                self._addWarning(msg)
                default_val = DefaultValue if DefaultValue else ''
                if isinstance(default_val, list):
                    Value.AddRange(default_val)
                else:
                    Value.Add(default_val)
                ValueType.Add('')
                Success.Add(False)
                Error.Add(msg)
                return __Results


            # Parse JSON
            try:
                json_data = json.loads(JSON)
            except json.JSONDecodeError as e:
                msg = f'Invalid JSON format: {str(e)}'
                self._addError(msg)
                default_val = DefaultValue if DefaultValue else ''
                if isinstance(default_val, list):
                    Value.AddRange(default_val)
                else:
                    Value.Add(default_val)
                ValueType.Add('')
                Success.Add(False)
                Error.Add(msg)
                return __Results

            # Extract value by path
            try:
                extracted_value, value_type = self.get_value_by_path(
                    json_data, KeyPath
                )

                # Convert to appropriate GH type
                converted_value = self.convert_to_gh_type(
                    extracted_value, value_type
                )

                # Add results - check if it's a collection for proper GH
                # handling
                if isinstance(converted_value, list):
                    Value.AddRange(converted_value)
                else:
                    Value.Add(converted_value)
                ValueType.Add(value_type)
                Success.Add(True)
                Error.Add('')

                # Update success message
                self._addRemark(
                    f'Successfully extracted {value_type} value from path: '
                    f'{KeyPath}'
                )

            except KeyError as e:
                msg = f'Key path not found: {str(e)}'
                self._addWarning(msg)
                default_val = DefaultValue if DefaultValue else ''
                if isinstance(default_val, list):
                    Value.AddRange(default_val)
                else:
                    Value.Add(default_val)
                ValueType.Add('')
                Success.Add(False)
                Error.Add(msg)

            except Exception as e:
                msg = f'Error extracting value: {str(e)}'
                self._addError(msg)
                default_val = DefaultValue if DefaultValue else ''
                if isinstance(default_val, list):
                    Value.AddRange(default_val)
                else:
                    Value.Add(default_val)
                ValueType.Add('')
                Success.Add(False)
                Error.Add(msg)

            # return output trees
            return __Results

        except Exception as e:
            msg = f'Unexpected error during value extraction: {str(e)}'
            self._addError(msg)
            # Return empty results if there was an error
            return null_outputs()
# ---------- end jsongetvalue ----------
panel_19 = Panel(jsongetvalue.Value)

# ---- group: __DDU_CSC_EXAMPLE_05__
# Step 5
# comments & notes: Concatenate all descriptor values.
# We use path shifting to align the DataTree paths.
radial_distance_32_2 = Data(radial_distance_32)
radial_tangent_32_2 = Data(radial_tangent_32)
spherescore_2 = Data(spherescore)
planescore_2 = Data(planescore)
linescore_2 = Data(linescore)
boxscore_2 = Data(boxscore)
pshift = ShiftPaths(Data=boxscore_2, Offset="-2")
pshift_2 = ShiftPaths(Data=linescore_2, Offset="-2")
pshift_3 = ShiftPaths(Data=radial_distance_32_2, Offset="-2")
pshift_4 = ShiftPaths(Data=radial_tangent_32_2, Offset="-2")
pshift_5 = ShiftPaths(Data=planescore_2, Offset="-2")
pshift_6 = ShiftPaths(Data=spherescore_2, Offset="-2")
merge_5 = Merge(Data1=pshift_3, Data2=pshift_4, Data3=pshift, Data4=pshift_2, Data5=pshift_5, Data6=pshift_6)
descriptordata = Data(merge_5)

# ---- group: __DDU_CSC_EXAMPLE_06__
# Step 4.1
# comments & notes: We also combine the values from the server-side-computed radial signature of the components in the catalog.
# 
# The data arrives in grasshopper slightly differently. This has technical reasons and explaining them here would be a bit much ;-)
# 
# Again, what matters: 192 numeric values per shape that are able to describe the form. In the same format and order (!) as the 192 numeric values for our design shapes.
radial_distance_64_2 = Data(radial_distance_64)
radial_tangent_64_2 = Data(radial_tangent_64)
item_7 = ListItem(List=radial_tangent_64_2, Index=0, Wrap=True)  # -> Item, Item1
pshift_7 = ShiftPaths(Data=item_7.Item1, Offset=-1)
pshift_8 = ShiftPaths(Data=item_7.Item, Offset=-1)
panel_20 = Panel("""0
1
2""")
weave = Weave(Pattern=panel_20, Stream0=radial_distance_64_2, Stream1=pshift_8, Stream2=pshift_7, NullGaps=False)
pshift_9 = ShiftPaths(Data=weave, Offset=-2)
catalogshapes_radialsignature = Data(pshift_9)

# Step 4.1
# comments & notes: Here we combine the values of the radial signature. This is a rather data-structure-centric operation.
# 
# You don't necessarily need to understand it fully. What matters is our result - in this case:
# 
# 192 numeric values per shape that are able to describe the form.
designshapes_tangents_2 = Data(designshapes_tangents)
designshapes_distances_2 = Data(designshapes_distances)
devec = DeconstructVector(Vector=designshapes_tangents_2)  # -> XComponent, YComponent, ZComponent
panel_21 = Panel("""0
1
2""")
weave_2 = Weave(Pattern=panel_21, Stream0=designshapes_distances_2, Stream1=devec.XComponent, Stream2=devec.YComponent, NullGaps=False)
designshapes_radialsignature = Data(weave_2)

# Step 3.4
# comments & notes: Extract Extrusion Profile curves.
proxygeometry_2 = Data(proxies_4)
extrusionprofile = ExtrusionProfile(ExtrusionGeometry=proxygeometry_2)  # -> ProfileCurve; inputs ExtrusionGeometry: Extrusion, ProfileIndex: Int32, ProfileParameter: Double
# ---------- extrusionprofile: Python ----------
#! python3
# -*- coding: utf-8 -*-
# venv: DDU_CSC
print('ENV OK!')
# r: charset_normalizer
# r: requests

# PYTHON STANDARD LIBRARY IMPORTS ---------------------------------------------

# RHINO AND GH RELATED IMPORTS ------------------------------------------------
import System  # type: ignore[reportMissingImport] # NOQA
import Grasshopper  # type: ignore[reportMissingImport] # NOQA
import Rhino  # type: ignore[reportMissingImport] # NOQA
import scriptcontext as sc  # type: ignore[reportMissingImport] # NOQA

# GHENV COMPONENT SETTINGS ----------------------------------------------------
ghenv.Component.Name = 'ExtrusionProfile'  # type: ignore[reportUnedfinedVariable] # NOQA
ghenv.Component.NickName = 'ExtrusionProfile'  # type: ignore[reportUnedfinedVariable] # NOQA
ghenv.Component.Category = 'DDU_CSC'  # type: ignore[reportUnedfinedVariable] # NOQA
ghenv.Component.SubCategory = '7 Geometry Tools'  # type: ignore[reportUnedfinedVariable] # NOQA
ghenv.Component.Description = (  # type: ignore[reportUnedfinedVariable] # NOQA
    'Extract the profile curves of an Extrusion.'
)

# OPTIONAL HELPERS: they never block the component (decisions 8.112, 8.113) ---
try:
    from csc_gh.ports import ensure_outputs
    from csc_gh.messages import set_state, waits_for_data
except ImportError:
    ensure_outputs = set_state = waits_for_data = None

OUTPUTS = [
    ('ProfileCurve', 'ProfileCurve',
     'The extracted profile curve.'),
]


def empty_outputs():
    """What RunScript returns when it stops early or has no result: an empty
    Grasshopper tree per output (never '' or None)."""
    if not OUTPUTS:
        return None
    trees = tuple(Grasshopper.DataTree[System.Object]() for _ in OUTPUTS)
    return trees[0] if len(trees) == 1 else trees


def null_outputs():
    """One null per output: an item of an item-access component that has no
    result keeps its slot (decision 8.186)."""
    if len(OUTPUTS) <= 1:
        return None
    return tuple(None for _ in OUTPUTS)


class CSC_ExtrusionProfile(Grasshopper.Kernel.GH_ScriptInstance):
    """
    Author: Max Benjamin Eschenbach
    License: MIT License
    Version: 261102
    """

    _outputs_ready = True       # set by BeforeRunScript (8.112)
    _outputs_note = None

    def __init__(self):
        """Initialize this component and set component parameters."""
        super().__init__()
        # initialize props
        self.Component = ghenv.Component  # type: ignore[reportUnedfinedVariable] # NOQA
        self.InputParams = self.Component.Params.Input
        self.OutputParams = self.Component.Params.Output

    def _addRemark(self, msg: str = ''):
        """Add a remark message to the component."""
        rml = self.Component.RuntimeMessageLevel.Remark
        self.AddRuntimeMessage(rml, msg)

    def _addWarning(self, msg: str = ''):
        """Add a warning message to the component."""
        rml = self.Component.RuntimeMessageLevel.Warning
        self.AddRuntimeMessage(rml, msg)

    def _addError(self, msg: str = ''):
        """Add an error message to the component."""
        rml = self.Component.RuntimeMessageLevel.Error
        self.AddRuntimeMessage(rml, msg)

    def _state(self, text=''):
        """The one short state under the component (decision 8.113)."""
        if set_state is not None:
            set_state(self.Component, text)

    def _no_result(self, *ports):
        """The result of an iteration without one (decision 8.186): empty
        outputs when the inputs in ``ports`` carry no data at all (the
        component waits for data; no ports: a list or tree input is empty),
        else a null in the slot of this item, so the outputs stay one to one
        with the input list."""
        if not ports or (waits_for_data is not None
                         and waits_for_data(self, ports)):
            return empty_outputs()
        return null_outputs()

    def _stop(self):
        """True when RunScript has to return early: the outputs were just
        updated (says why)."""
        if self._outputs_note:
            self._addRemark(self._outputs_note)
        return not self._outputs_ready

    def _check_outputs(self):
        """Make the outputs match OUTPUTS before the script runs (8.112)."""
        self._outputs_ready, self._outputs_note = True, None
        if ensure_outputs is None:
            self._outputs_note = (
                'output check skipped: CSC library not installed')
            return
        status = ensure_outputs(self.Component, OUTPUTS)
        self._outputs_ready, self._outputs_note = status.ready, status.remark

    def BeforeRunScript(self):
        """Perform some setup actions."""
        # Initialize input param descriptions
        self.InputParams[0].Description = (
            'A Rhino.Geometry.Extrusion to extract '
            'the profile curve from'
        )
        self.InputParams[1].Description = (
            'Index of the profile curve to extract. '
            'The outer profile has index 0.'
        )
        self.InputParams[2].Description = (
            'A relative parameter controlling which profile is returned. '
            '0 = bottom profile and 1 = top profile.'
        )
        # Initialize output param descriptions
        self._check_outputs()

    def RunScript(self,
            ExtrusionGeometry: Rhino.Geometry.Extrusion,
            ProfileIndex: int,
            ProfileParameter: float):
        # init outputs
        if self._stop():
            return empty_outputs()
        ProfileCurve = Grasshopper.DataTree[System.Object]()
        # defaults
        if not ExtrusionGeometry:
            self._addWarning(
                'Input Parameter ExtrusionGeometry failed to collect data.'
            )
            return self._no_result('ExtrusionGeometry')
        if ProfileIndex is None:
            ProfileIndex = 0
        elif ProfileIndex < ExtrusionGeometry.ProfileCount - 1:
            self._addError('Input Parameter ProfileIndex is out of range!')
            return null_outputs()
        elif ProfileIndex > ExtrusionGeometry.ProfileCount - 1:
            self._addError('Input Parameter ProfileIndex is out of range!')
            return null_outputs()
        if ProfileParameter is None:
            ProfileParameter = 0.5
        elif ProfileParameter < 0:
            self._addWarning(
                'ProfileParameter was set to 0.0! '
                'Must be >= 0.0 and <= 1.0!'
            )
            ProfileParameter = 0.0
        elif ProfileParameter > 1:
            self._addWarning(
                'ProfileParameter was set to 1.0! '
                'Must be >= 0.0 and <= 1.0!'
            )
            ProfileParameter = 0.0
        # finally extract profile curve
        ProfileCurve = ExtrusionGeometry.Profile3d(0, 0.5)
        # return results
        return ProfileCurve
# ---------- end extrusionprofile ----------
profilecurve = Data(extrusionprofile)

# ---- group: __DDU_CSC_EXAMPLE_07__
geometry_7 = Data(samplemeshgeometry_2)
computeframe = ComputeFrame(Geometry=geometry_7)  # -> Frame, Box, Extents, Transform, FrameJSON; inputs Geometry: list of GeometryBase, OriginalFunction: String
# ---------- computeframe: Python ----------
#! python3
# -*- coding: utf-8 -*-
# venv: DDU_CSC_MATCH
# r: charset_normalizer
# r: numpy==2.0.2
# r: scipy==1.13.1
# r: trimesh==4.12.2
# r: networkx==3.2.1
print('ENV OK!')

# PYTHON STANDARD LIBRARY IMPORTS ---------------------------------------------
import json  # NOQA

# RHINO AND GH RELATED IMPORTS ------------------------------------------------
import System  # NOQA
import Rhino  # NOQA
import Grasshopper  # NOQA

# GHENV COMPONENT SETTINGS ----------------------------------------------------
ghenv.Component.Name = 'ComputeFrame'  # NOQA
ghenv.Component.NickName = 'ComputeFrame'  # NOQA
ghenv.Component.Category = 'DDU_CSC'  # NOQA
ghenv.Component.SubCategory = '7 Geometry Tools'  # NOQA
ghenv.Component.Description = (  # NOQA
    'Computes the frame of an element offline, with the rules of the server: '
    'the minimum-volume oriented box of its points, longest side along X, '
    'middle along Y, shortest along Z (an IfcColumn at least twice as long '
    'as wide stands), signs and ties chosen closest to the axes you give, '
    'never upside down. An element gets the same frame here as in the catalog '
    '(tests keep the two in step).'
)

# CSC LIBRARY (decision 8.111) ----------------------------------------------
CSC_GH_MINIMUM = '261102'
LIBRARY_PROBLEM = None
try:
    import csc_gh
    csc_gh.require(CSC_GH_MINIMUM)
    from csc_gh.build import (BuildError, MissingInput, text)  # NOQA
    from csc_gh.frame import (compute_frame)  # NOQA
    from csc_gh.rhino import (canonical_transform, geometry_points, plane_from_frame)  # NOQA
    from csc_gh.messages import (waits_for_data)  # NOQA
except ImportError:
    LIBRARY_PROBLEM = (
        'CSC library 261102 too old or missing: run CSC_Update, '
        'then restart Rhino')

# OPTIONAL HELPERS: they never block the component (decisions 8.112, 8.113) ---
try:
    from csc_gh.ports import ensure_outputs
    from csc_gh.messages import set_state
except ImportError:
    ensure_outputs = set_state = None

OUTPUTS = [
    ('Frame', 'Frame',
     'The frame as a plane (centre of the box, axes x, y, z)'),
    ('Box', 'Box',
     'The oriented box of the element'),
    ('Extents', 'Extents',
     'Extents of the box along X, Y and Z'),
    ('Transform', 'Transform',
     'Transform from the geometry as given to its canonical orientation (frame to world plane)'),
    ('FrameJSON', 'FrameJSON',
     'Frame JSON ({frame, bbx, version}), as the catalog stores it'),
]


def empty_outputs():
    """What RunScript returns when it stops early or has no result: an empty
    Grasshopper tree per output (never '' or None)."""
    if not OUTPUTS:
        return None
    trees = tuple(Grasshopper.DataTree[System.Object]() for _ in OUTPUTS)
    return trees[0] if len(trees) == 1 else trees


def null_outputs():
    """One null per output: an item of an item-access component that has no
    result keeps its slot (decision 8.186)."""
    if len(OUTPUTS) <= 1:
        return None
    return tuple(None for _ in OUTPUTS)


class CSC_ComputeFrame(Grasshopper.Kernel.GH_ScriptInstance):
    """
    Author: Max Benjamin Eschenbach
    License: MIT License
    Version: 261102
    """

    _outputs_ready = True       # set by BeforeRunScript (8.112)
    _outputs_note = None

    def __init__(self):
        super().__init__()
        self.Component = ghenv.Component  # NOQA
        self.InputParams = self.Component.Params.Input
        self.OutputParams = self.Component.Params.Output

    def _addRemark(self, msg: str = ''):
        rml = self.Component.RuntimeMessageLevel.Remark
        self.AddRuntimeMessage(rml, msg)

    def _addWarning(self, msg: str = ''):
        rml = self.Component.RuntimeMessageLevel.Warning
        self.AddRuntimeMessage(rml, msg)

    def _addError(self, msg: str = ''):
        rml = self.Component.RuntimeMessageLevel.Error
        self.AddRuntimeMessage(rml, msg)

    def _state(self, text=''):
        """The one short state under the component (decision 8.113)."""
        if set_state is not None:
            set_state(self.Component, text)

    def _no_result(self, *ports):
        """The result of an iteration without one (decision 8.186): empty
        outputs when the inputs in ``ports`` carry no data at all (the
        component waits for data; no ports: a list or tree input is empty),
        else a null in the slot of this item, so the outputs stay one to one
        with the input list."""
        if not ports or (waits_for_data is not None
                         and waits_for_data(self, ports)):
            return empty_outputs()
        return null_outputs()

    def _stop(self):
        """True when RunScript has to return early: the library is missing or
        too old, or the outputs were just updated (says why)."""
        if LIBRARY_PROBLEM:
            self._addError(LIBRARY_PROBLEM)
            return True
        if self._outputs_note:
            self._addRemark(self._outputs_note)
        return not self._outputs_ready

    def _check_outputs(self):
        """Make the outputs match OUTPUTS before the script runs (8.112)."""
        self._outputs_ready, self._outputs_note = True, None
        if ensure_outputs is None:
            self._outputs_note = (
                'output check skipped: CSC library not installed')
            return
        status = ensure_outputs(self.Component, OUTPUTS)
        self._outputs_ready, self._outputs_note = status.ready, status.remark

    def BeforeRunScript(self):
        """Perform some setup actions."""
        self.InputParams[0].Description = (
            'The geometry of one element: meshes, point clouds, breps, '
            'extrusions (their vertices are used)'
        )
        self.InputParams[1].Description = (
            'Original function, e.g. IfcColumn (empty: not a column)'
        )
        self._check_outputs()
        if LIBRARY_PROBLEM is None:
            csc_gh.dev_reload(globals())

    def RunScript(self,
            Geometry: list[Rhino.Geometry.GeometryBase],
            OriginalFunction: str):
        if self._stop():
            return empty_outputs()
        Frame, Box, Extents, Transform, FrameJSON = empty_outputs()
        try:
            items = [g for g in (Geometry or []) if g is not None]
            if not items:
                raise MissingInput('Input Geometry failed to collect data')
            points = geometry_points(items)
            result = compute_frame(points, text(OriginalFunction))
            frame = result['frame']
            Frame = plane_from_frame(frame)
            sx, sy, sz = result['bbx']
            Box = Rhino.Geometry.Box(
                Frame, Rhino.Geometry.Interval(-sx / 2, sx / 2),
                Rhino.Geometry.Interval(-sy / 2, sy / 2),
                Rhino.Geometry.Interval(-sz / 2, sz / 2))
            Extents = [sx, sy, sz]
            Transform = canonical_transform(frame)
            FrameJSON = json.dumps({'frame': frame, 'bbx': list(result['bbx']),
                                    'version': result['version']})
        except MissingInput as error:
            self._addWarning(str(error))
            return self._no_result(*error.ports)
        except BuildError as error:
            self._addError(str(error))
            return null_outputs()
        except Exception as error:
            msg = f'Unexpected error: {error}'
            self._addError(msg)
            return null_outputs()
        return Frame, Box, Extents, Transform, FrameJSON
# ---------- end computeframe ----------

# Step 3
# comments & notes: Finally, if CreateComponentIdentity runs without errors, we can submit the created Component to the Catalog!
# 
# Set the Toggle to True to execute the upload.
toggle_3 = BooleanToggle(False)
identityrequest_2 = Data(identityrequest)
addcomponentidentity = AddComponentIdentity(IdentityRequest=identityrequest_2, Run=toggle_3)  # -> Created; inputs IdentityRequest: String, Run: Boolean
# ---------- addcomponentidentity: Python ----------
#! python3
# -*- coding: utf-8 -*-
# venv: DDU_CSC
# r: charset_normalizer
# r: requests==2.32.5
# r: numpy==2.0.2
print('ENV OK!')

# PYTHON STANDARD LIBRARY IMPORTS ---------------------------------------------
import json  # NOQA

# THIRD PARTY LIBRARY IMPORTS -------------------------------------------------
import requests  # NOQA

# RHINO AND GH RELATED IMPORTS ------------------------------------------------
import System  # NOQA
import Grasshopper  # NOQA
import Rhino  # NOQA
import scriptcontext as sc  # NOQA

# GHENV COMPONENT SETTINGS ----------------------------------------------------
ghenv.Component.Name = 'AddComponentIdentity'  # NOQA
ghenv.Component.NickName = 'AddComponentIdentity'  # NOQA
ghenv.Component.Category = 'DDU_CSC'  # NOQA
ghenv.Component.SubCategory = '2 Catalog Interface'  # NOQA
ghenv.Component.Description = (  # NOQA
    'Records a new component with its first state: POST /identities '
    'and uploads the files staged by CreateComponentIdentity; consumes a '
    'pending transmitted component ID. The state lands as a draft: complete '
    'it (files, checks) and submit it in the web, My work.'
)

# CSC LIBRARY (decision 8.111) ----------------------------------------------
CSC_GH_MINIMUM = '261102'
LIBRARY_PROBLEM = None
try:
    import csc_gh
    csc_gh.require(CSC_GH_MINIMUM)
    from csc_gh.build import (problems_of_identity, staging_key)  # NOQA
    from csc_gh.upload import (http_error_text, load_manifest, passport_after, staged_plan, staging_dir, upload_staged)  # NOQA
    from csc_gh.messages import (waits_for_data)  # NOQA
except ImportError:
    LIBRARY_PROBLEM = (
        'CSC library 261102 too old or missing: run CSC_Update, '
        'then restart Rhino')

# OPTIONAL HELPERS: they never block the component (decisions 8.112, 8.113) ---
try:
    from csc_gh.ports import ensure_outputs
    from csc_gh.messages import set_state
except ImportError:
    ensure_outputs = set_state = None

OUTPUTS = [
    ('Created', 'Created',
     'Component passport JSON ({identity, snapshots[]}) of the new component'),
]


def empty_outputs():
    """What RunScript returns when it stops early or has no result: an empty
    Grasshopper tree per output (never '' or None)."""
    if not OUTPUTS:
        return None
    trees = tuple(Grasshopper.DataTree[System.Object]() for _ in OUTPUTS)
    return trees[0] if len(trees) == 1 else trees


def null_outputs():
    """One null per output: an item of an item-access component that has no
    result keeps its slot (decision 8.186)."""
    if len(OUTPUTS) <= 1:
        return None
    return tuple(None for _ in OUTPUTS)


class CSC_AddComponentIdentity(Grasshopper.Kernel.GH_ScriptInstance):
    """
    Author: Max Benjamin Eschenbach
    License: MIT License
    Version: 261102
    """

    _outputs_ready = True       # set by BeforeRunScript (8.112)
    _outputs_note = None

    def __init__(self):
        """Initialize this component and set component parameters."""
        super().__init__()
        self.Component = ghenv.Component  # NOQA
        self.InputParams = self.Component.Params.Input
        self.OutputParams = self.Component.Params.Output

    def _addRemark(self, msg: str = ''):
        rml = self.Component.RuntimeMessageLevel.Remark
        self.AddRuntimeMessage(rml, msg)

    def _addWarning(self, msg: str = ''):
        rml = self.Component.RuntimeMessageLevel.Warning
        self.AddRuntimeMessage(rml, msg)

    def _addError(self, msg: str = ''):
        rml = self.Component.RuntimeMessageLevel.Error
        self.AddRuntimeMessage(rml, msg)

    def _state(self, text=''):
        """The one short state under the component (decision 8.113)."""
        if set_state is not None:
            set_state(self.Component, text)

    def _no_result(self, *ports):
        """The result of an iteration without one (decision 8.186): empty
        outputs when the inputs in ``ports`` carry no data at all (the
        component waits for data; no ports: a list or tree input is empty),
        else a null in the slot of this item, so the outputs stay one to one
        with the input list."""
        if not ports or (waits_for_data is not None
                         and waits_for_data(self, ports)):
            return empty_outputs()
        return null_outputs()

    def _stop(self):
        """True when RunScript has to return early: the library is missing or
        too old, or the outputs were just updated (says why)."""
        if LIBRARY_PROBLEM:
            self._addError(LIBRARY_PROBLEM)
            return True
        if self._outputs_note:
            self._addRemark(self._outputs_note)
        return not self._outputs_ready

    def _check_outputs(self):
        """Make the outputs match OUTPUTS before the script runs (8.112)."""
        self._outputs_ready, self._outputs_note = True, None
        if ensure_outputs is None:
            self._outputs_note = (
                'output check skipped: CSC library not installed')
            return
        status = ensure_outputs(self.Component, OUTPUTS)
        self._outputs_ready, self._outputs_note = status.ready, status.remark

    def BeforeRunScript(self):
        """Perform some setup actions."""
        self.InputParams[0].Description = (
            'Request JSON from CreateComponentIdentity'
        )
        self.InputParams[1].Description = (
            'Toggle to execute the create operation (the new state lands '
            'as a draft; submit it in the web)'
        )
        self._check_outputs()
        if LIBRARY_PROBLEM is None:
            csc_gh.dev_reload(globals())

    def get_auth_core_from_sticky(self):
        """Get AuthCore instance from sticky storage."""
        auth_core = sc.sticky.get('CSC_AuthCore')
        if auth_core is None:
            msg = ('No authentication found. Please use CSC_Session component '
                   'first.')
            self._addWarning(msg)
            return None
        return auth_core

    def consume_transmitted_id(self, auth_core, identity_id):
        """Consume a pending transmitted ID after the create; never fatal."""
        try:
            response = auth_core.authorized_post(
                '/component_id_transmission/consume',
                json_body={'identity_id': identity_id})
            if response.status_code == 200 and response.json().get(
                    'consumed', False):
                self._addRemark('Consumed pending transmitted ID.')
            elif response.status_code != 200:
                self._addWarning(
                    'Component created, but consuming the transmitted ID '
                    f'failed ({response.status_code}).')
        except Exception as error:
            self._addWarning('Component created, but consuming the '
                             f'transmitted ID failed: {error}')

    def RunScript(self, IdentityRequest: str, Run: bool):
        if self._stop():
            return empty_outputs()
        Created = Grasshopper.DataTree[System.Object]()

        auth_core = self.get_auth_core_from_sticky()
        if auth_core is None:
            return Created
        if not auth_core.is_valid():
            msg = ('Authentication expired. Please use CSC_Session '
                   'component to refresh.')
            self._addWarning(msg)
            return Created
        if not IdentityRequest:
            msg = 'Please provide the request JSON of CreateComponentIdentity.'
            self._addWarning(msg)
            return self._no_result('IdentityRequest')

        try:
            body = json.loads(IdentityRequest)
        except json.JSONDecodeError:
            msg = 'IdentityRequest must be valid JSON.'
            self._addError(msg)
            return null_outputs()
        problems = problems_of_identity(body)
        if problems:
            msg = 'The request is not a new-component request:\n' + \
                '\n'.join(problems)
            self._addError(msg)
            return null_outputs()

        directory = staging_dir(staging_key(IdentityRequest))
        manifest_dict = load_manifest(directory)
        pending, missing = ([], [])
        geometry = body['snapshot'].get('geometry', {})
        if manifest_dict:
            pending, missing = staged_plan(directory, manifest_dict)
        elif geometry.get('meshes') or geometry.get('point_clouds'):
            self._addRemark('No staged files for this request: only the '
                            'inline Preview geometry is stored.')
        if missing:
            self._addWarning('Staged files are missing: ' + ', '.join(
                entry['path'] for entry in missing))

        if not Run:
            self._state('Run is False')
            return Created

        try:
            response = auth_core.authorized_post('/identities',
                                                 json_body=body)
            if response.status_code != 201:
                msg = {
                    401: 'Authentication failed. Please sign in again.',
                    403: 'Access denied: you need the contributor role in '
                         'this dataset.',
                    409: 'A component with this IdentityID already exists.',
                }.get(response.status_code) or http_error_text(
                    response, 'Create')
                self._addError(msg)
                return null_outputs()
            created = response.json()
            identity_doc = created.get('identity') or {}
            snapshot_doc = created.get('snapshot') or {}
            identity_id = identity_doc.get('_id')
            snapshot_id = snapshot_doc.get('_id')
            self._addRemark(f'Created {identity_id} (state {snapshot_id}, '
                            'a draft)')
            self.consume_transmitted_id(auth_core, identity_id)

            upload_ok = True
            if pending:
                done, failed = upload_staged(
                    auth_core, snapshot_id, pending,
                    progress=self._state)
                for entry, reason in failed:
                    self._addWarning(reason)
                upload_ok = not failed
                self._addRemark(f'Uploaded {len(done)} of {len(pending)} '
                                'staged file(s).')

            if not upload_ok:
                self._addWarning('Some files failed to upload. The state is '
                                 'a draft: complete it in the web (My work) '
                                 'and submit it there.')
            self._state('draft')

            passport = passport_after(auth_core, identity_doc, snapshot_doc)
            Created.Add(json.dumps(passport),
                                   Grasshopper.Kernel.Data.GH_Path(0))
            return Created

        except requests.exceptions.ConnectionError as error:
            msg = 'Cannot connect to server. Please check your connection.'
            self._addError(msg + f'\nFull Error: {error}')
            return null_outputs()
        except requests.exceptions.Timeout as error:
            msg = 'Request timeout. Server may be slow.'
            self._addError(msg + f'\nFull Error: {error}')
            return null_outputs()
        except Exception as error:
            # includes CSCClientOutdated: its text names the fix
            self._addError(str(error))
            return null_outputs()
        return Created
# ---------- end addcomponentidentity ----------
created_2 = Data(addcomponentidentity)

# ---- group: __DDU_CSC_EXAMPLE_05__
embeddingdimensions = Slider(2, range=2..6)
t_sne_or_pca = ValueList({"T-SNE": 0, "PCA": 1}, selected="PCA")

# Step 6
# comments & notes: Choose between two dimension-reduction techniques: T-SNE (stochastic) or PCA (fully deterministic).
# Switch to see the difference visualized!
# 
# You may also choose the number of dimensions for the embedded space (2 - 6) and look at the visualization results.
# 
# Can you make an educated guess how we map the dimensions for visualization?
descriptordata_2 = Data(descriptordata)
gate = StreamGate(Stream=descriptordata_2, Gate=t_sne_or_pca)  # -> Target0, Target1
descriptordata_3 = Data(gate.Target0)
descriptordata_4 = Data(gate.Target1)

# ---- group: __DDU_CSC_EXAMPLE_06__
# Step 5
# comments & notes: Here we use an assignment algorithm to find the most fitting parts from our catalog (CatalogShapes) for our DesignShapes.
# 
# This algorithm works with the 192 numeric values we have acquired in the last steps.
# 
# There is a Greedy (fast) option and the famous Hungarian (optimal) version.
catalogshapes_radialsignature_2 = Data(catalogshapes_radialsignature)
designshapes_radialsignature_2 = Data(designshapes_radialsignature)
algorithm = ValueList({"Greedy": "greedy", "Hungarian": "hungarian"}, selected="Greedy")
assignmentpoints = AssignmentPoints(DesignPts=designshapes_radialsignature_2, LibraryPts=catalogshapes_radialsignature_2, Algorithm=algorithm)  # -> Assignment, Cost; inputs DesignPts: tree of Double, LibraryPts: tree of Double, Weights: list of Double, ScaleFactor: Double, Algorithm: String
# ---------- assignmentpoints: Python ----------
#! python3
# -*- coding: utf-8 -*-
# venv: DDU_CSC_MATCH
# r: charset_normalizer
# r: numpy==2.0.2
# r: scipy==1.13.1
print('ENV OK!')

# THIRD PARTY LIBRARY IMPORTS -------------------------------------------------
import numpy as np  # NOQA
from scipy.optimize import linear_sum_assignment  # NOQA

# RHINO AND GH RELATED IMPORTS ------------------------------------------------
import System  # NOQA
import Grasshopper  # NOQA
import Rhino  # NOQA

# GHENV COMPONENT SETTINGS ----------------------------------------------------
ghenv.Component.Name = 'AssignmentPoints'  # NOQA
ghenv.Component.NickName = 'AssignmentPoints'  # NOQA
ghenv.Component.Category = 'DDU_CSC'  # NOQA
ghenv.Component.SubCategory = '5 Matchmaking Tools'  # NOQA
ghenv.Component.Description = (  # NOQA
    'Solve point-to-point assignment between DesignPts and LibraryPts. '
    'Supports Greedy assignment (default, FullCircle-compatible) and '
    'Hungarian assignment (SciPy).'
)


def _weighted_euclidean_distance(pt1, pt2, weights):
    p1 = np.asarray(pt1, dtype=np.float64)
    p2 = np.asarray(pt2, dtype=np.float64)
    w = np.asarray(weights, dtype=np.float64)
    return float(np.sqrt(np.sum(w * np.square(p2 - p1))))

# OPTIONAL HELPERS: they never block the component (decisions 8.112, 8.113) ---
try:
    from csc_gh.ports import ensure_outputs
    from csc_gh.messages import set_state
except ImportError:
    ensure_outputs = set_state = None

OUTPUTS = [
    ('Assignment', 'Assignment',
     'Assignment tree. Branch i contains selected library index for design point i.'),
    ('Cost', 'Cost',
     'Assignment cost tree. Branch i contains the cost value for design point i.'),
]


def empty_outputs():
    """What RunScript returns when it stops early or has no result: an empty
    Grasshopper tree per output (never '' or None)."""
    if not OUTPUTS:
        return None
    trees = tuple(Grasshopper.DataTree[System.Object]() for _ in OUTPUTS)
    return trees[0] if len(trees) == 1 else trees


class CSC_AssignmentPoints(Grasshopper.Kernel.GH_ScriptInstance):
    """
    Author: Max Benjamin Eschenbach
    License: MIT License
    Version: 261102
    """

    _outputs_ready = True       # set by BeforeRunScript (8.112)
    _outputs_note = None

    def __init__(self):
        super().__init__()
        self.Component = ghenv.Component  # NOQA
        self.InputParams = self.Component.Params.Input
        self.OutputParams = self.Component.Params.Output

    def _addRemark(self, msg=''):
        self.AddRuntimeMessage(self.Component.RuntimeMessageLevel.Remark, msg)

    def _addWarning(self, msg=''):
        self.AddRuntimeMessage(self.Component.RuntimeMessageLevel.Warning, msg)

    def _addError(self, msg=''):
        self.AddRuntimeMessage(self.Component.RuntimeMessageLevel.Error, msg)

    def _state(self, text=''):
        """The one short state under the component (decision 8.113)."""
        if set_state is not None:
            set_state(self.Component, text)

    def _stop(self):
        """True when RunScript has to return early: the outputs were just
        updated (says why)."""
        if self._outputs_note:
            self._addRemark(self._outputs_note)
        return not self._outputs_ready

    def _check_outputs(self):
        """Make the outputs match OUTPUTS before the script runs (8.112)."""
        self._outputs_ready, self._outputs_note = True, None
        if ensure_outputs is None:
            self._outputs_note = (
                'output check skipped: CSC library not installed')
            return
        status = ensure_outputs(self.Component, OUTPUTS)
        self._outputs_ready, self._outputs_note = status.ready, status.remark

    def BeforeRunScript(self):
        self.InputParams[0].Description = (
            'Design points as DataTree of Numbers. Each branch is one point.'
        )
        self.InputParams[1].Description = (
            'Library points as DataTree of Numbers. Each branch is one point.'
        )
        self.InputParams[2].Description = (
            'Weights for weighted Euclidean distance. Optional; defaults to '
            '1.0 in each dimension.'
        )
        self.InputParams[3].Description = (
            'Scale factor used by Hungarian mode before optimization. '
            'Optional; default 1e3. Ignored by Greedy mode.'
        )
        self.InputParams[4].Description = (
            "Algorithm selector. Optional; defaults to 'greedy'. "
            "Accepted values: 'greedy', 'hungarian'."
        )

        self._check_outputs()

    def _collect_tree_branches(self, tree):
        if tree is None or tree.DataCount == 0:
            return []
        return [list(tree.Branch(path)) for path in tree.Paths]

    def _normalize_algorithm(self, algorithm):
        if algorithm is None:
            return 'greedy'
        alg = str(algorithm).strip().lower()
        if alg in ('', 'greedy', 'g'):
            return 'greedy'
        if alg in ('hungarian', 'hungary', 'h', 'scipy'):
            return 'hungarian'
        return None

    def _build_cost_matrices(self, design_branches, library_branches, weights):
        n = len(design_branches)
        m = len(library_branches)
        costs = np.zeros((m, m), dtype=np.float64)
        for i in range(m):
            if i >= n:
                continue
            for j in range(m):
                costs[i, j] = _weighted_euclidean_distance(
                    design_branches[i], library_branches[j], weights
                )
        return costs

    def _run_greedy(self, costs):
        m = int(costs.shape[0])
        selected = np.zeros(m, dtype=np.int32)
        assignment = np.full(m, -1, dtype=np.int32)

        for i in range(m):
            min_cost = float('inf')
            sel = -1
            for j in range(m):
                c = float(costs[i, j])
                if c < min_cost and selected[j] == 0:
                    min_cost = c
                    sel = j
            if sel < 0:
                raise ValueError('Greedy assignment failed to select a column')
            selected[sel] = 1
            assignment[i] = sel
        return assignment

    def _run_hungarian(self, costs, scale_factor):
        scaled = np.asarray(
            np.floor(costs * float(scale_factor)),
            dtype=np.int64,
        )
        rows, cols = linear_sum_assignment(scaled)
        assignment = np.full(scaled.shape[0], -1, dtype=np.int32)
        assignment[rows] = cols.astype(np.int32)
        if np.any(assignment < 0):
            raise ValueError('Hungarian assignment did not cover all rows')
        return assignment

    def RunScript(self,
            DesignPts: Grasshopper.DataTree[float],
            LibraryPts: Grasshopper.DataTree[float],
            Weights: list[float],
            ScaleFactor: float,
            Algorithm: str):
        if self._stop():
            return empty_outputs()
        Assignment = Grasshopper.DataTree[System.Object]()
        Cost = Grasshopper.DataTree[System.Object]()
        __Results = (Assignment, Cost)


        design_branches = self._collect_tree_branches(DesignPts)
        library_branches = self._collect_tree_branches(LibraryPts)
        n = len(design_branches)
        m = len(library_branches)

        if n == 0:
            self._addWarning('DesignPts failed to collect data!')
            return __Results
        if m == 0:
            self._addWarning('LibraryPts failed to collect data!')
            return __Results
        if n > m:
            self._addError(
                'Number of DesignPts needs to be smaller than number of '
                'LibraryPts!'
            )
            return __Results

        dim = len(design_branches[0])
        if dim == 0:
            self._addWarning('DesignPts branches are empty')
            return __Results

        for i, b in enumerate(design_branches):
            if len(b) != dim:
                self._addError(
                    f'DesignPts branch #{i} has dimension {len(b)}; '
                    f'expected {dim}.'
                )
                return __Results
        for j, b in enumerate(library_branches):
            if len(b) != dim:
                self._addError(
                    f'LibraryPts branch #{j} has dimension {len(b)}; '
                    f'expected {dim}.'
                )
                return __Results

        if not Weights or len(Weights) == 0:
            weights = np.ones(dim, dtype=np.float64)
        else:
            if len(Weights) != dim:
                self._addError(
                    f'Weights length ({len(Weights)}) does not match point '
                    f'dimension ({dim}).'
                )
                return __Results
            weights = np.asarray([float(w) for w in Weights], dtype=np.float64)

        algorithm = self._normalize_algorithm(Algorithm)
        if algorithm is None:
            self._addError(
                "Invalid Algorithm value. Use 'greedy' or 'hungarian'."
            )
            return __Results

        if ScaleFactor is None:
            ScaleFactor = 1e3
        try:
            scale_factor = float(ScaleFactor)
        except (TypeError, ValueError):
            self._addError(f'ScaleFactor must be numeric, got {ScaleFactor!r}')
            return __Results
        if not np.isfinite(scale_factor) or scale_factor <= 0.0:
            self._addError(f'ScaleFactor must be > 0, got {scale_factor}')
            return __Results

        try:
            real_costs = self._build_cost_matrices(
                design_branches, library_branches, weights
            )
            if algorithm == 'hungarian':
                assignment = self._run_hungarian(real_costs, scale_factor)
            else:
                assignment = self._run_greedy(real_costs)
        except Exception as exc:
            self._addError(f'Assignment failed: {exc}')
            return __Results

        for i in range(n):
            path = Grasshopper.Kernel.Data.GH_Path(i)
            j = int(assignment[i])
            Assignment.Add(j, path)
            Cost.Add(float(real_costs[i, j]), path)

        self._addRemark(
            f'Assigned {n} design points to {m} library points using '
            f'{algorithm}.'
        )
        return __Results
# ---------- end assignmentpoints ----------
assignment = Data(assignmentpoints.Assignment)
panel_22 = Panel(assignment)

# ----
# comments & notes: Apply (inverse) PCA Frame to Component and store the transformation in iframe aswell!
geometry_8 = Data(geometry_6)
applyframe = ApplyFrame(Input=geometry_8)  # -> Output, Frame; inputs OriginalFunction: String
# ---------- applyframe: Python ----------
#! python3
# -*- coding: utf-8 -*-
# venv: DDU_CSC_MATCH
# r: charset_normalizer
# r: numpy==2.0.2
# r: scipy==1.13.1
# r: trimesh==4.12.2
# r: networkx==3.2.1
print('ENV OK!')

# PYTHON STANDARD LIBRARY IMPORTS ---------------------------------------------
import json  # NOQA

# RHINO AND GH RELATED IMPORTS ------------------------------------------------
import System  # NOQA
import Rhino  # NOQA
import Grasshopper  # NOQA

# GHENV COMPONENT SETTINGS ----------------------------------------------------
ghenv.Component.Name = 'ApplyFrame'  # NOQA
ghenv.Component.NickName = 'ApplyFrame'  # NOQA
ghenv.Component.Category = 'DDU_CSC'  # NOQA
ghenv.Component.SubCategory = '3 Component Operations'  # NOQA
ghenv.Component.Description = (  # NOQA
    'Moves a component to its canonical orientation: longest side along X, '
    'middle along Y, shortest along Z (a column stands), centre at the '
    'origin. Takes component passport JSON or Rhino geometry fetched from the '
    'catalog and uses the frame the server stored for the state. An element '
    'without a frame (a design target, geometry not in the catalog) gets '
    'the same frame computed locally with the rules of the server. The '
    'Frame output is the frame that was used, in the stored coordinates '
    '(where the element sat before the move), not the frame of the moved '
    'element: DisassembleComponent gives the frame where the moved element '
    'sits.'
)

# CSC LIBRARY (decision 8.111) ----------------------------------------------
CSC_GH_MINIMUM = '261102'
LIBRARY_PROBLEM = None
try:
    import csc_gh
    csc_gh.require(CSC_GH_MINIMUM)
    from csc_gh.build import (BuildError, text)  # NOQA
    from csc_gh.read import (canonical_placement, frame_ok, load_passport, parts, passport_points, placement_of, with_placement)  # NOQA
    from csc_gh.frame import (compute_frame)  # NOQA
    from csc_gh.rhino import (canonical_transform, geometry_points, placement_transform, plane_from_frame)  # NOQA
    from csc_gh.messages import (waits_for_data)  # NOQA
except ImportError:
    LIBRARY_PROBLEM = (
        'CSC library 261102 too old or missing: run CSC_Update, '
        'then restart Rhino')

# OPTIONAL HELPERS: they never block the component (decisions 8.112, 8.113) ---
try:
    from csc_gh.ports import ensure_outputs
    from csc_gh.messages import set_state
except ImportError:
    ensure_outputs = set_state = None

OUTPUTS = [
    ('Output', 'Output',
     'The component passport JSON with its client-side csc_placement set, or the geometry moved to its canonical orientation'),
    ('Frame', 'Frame',
     'The frame that was used, a plane in the stored coordinates of the element (where it sat before the move), not the frame of the moved element. For the frame where the moved element sits, take the Frame output of DisassembleComponent, which applies csc_placement'),
]


def empty_outputs():
    """What RunScript returns when it stops early or has no result: an empty
    Grasshopper tree per output (never '' or None)."""
    if not OUTPUTS:
        return None
    trees = tuple(Grasshopper.DataTree[System.Object]() for _ in OUTPUTS)
    return trees[0] if len(trees) == 1 else trees


def null_outputs():
    """One null per output: an item of an item-access component that has no
    result keeps its slot (decision 8.186)."""
    if len(OUTPUTS) <= 1:
        return None
    return tuple(None for _ in OUTPUTS)


class CSC_ApplyFrame(Grasshopper.Kernel.GH_ScriptInstance):
    """
    Author: Max Benjamin Eschenbach
    License: MIT License
    Version: 261102
    """

    _outputs_ready = True       # set by BeforeRunScript (8.112)
    _outputs_note = None

    def __init__(self):
        super().__init__()
        self.Component = ghenv.Component  # NOQA
        self.InputParams = self.Component.Params.Input
        self.OutputParams = self.Component.Params.Output

    def _addRemark(self, msg: str = ''):
        rml = self.Component.RuntimeMessageLevel.Remark
        self.AddRuntimeMessage(rml, msg)

    def _addWarning(self, msg: str = ''):
        rml = self.Component.RuntimeMessageLevel.Warning
        self.AddRuntimeMessage(rml, msg)

    def _addError(self, msg: str = ''):
        rml = self.Component.RuntimeMessageLevel.Error
        self.AddRuntimeMessage(rml, msg)

    def _state(self, text=''):
        """The one short state under the component (decision 8.113)."""
        if set_state is not None:
            set_state(self.Component, text)

    def _no_result(self, *ports):
        """The result of an iteration without one (decision 8.186): empty
        outputs when the inputs in ``ports`` carry no data at all (the
        component waits for data; no ports: a list or tree input is empty),
        else a null in the slot of this item, so the outputs stay one to one
        with the input list."""
        if not ports or (waits_for_data is not None
                         and waits_for_data(self, ports)):
            return empty_outputs()
        return null_outputs()

    def _stop(self):
        """True when RunScript has to return early: the library is missing or
        too old, or the outputs were just updated (says why)."""
        if LIBRARY_PROBLEM:
            self._addError(LIBRARY_PROBLEM)
            return True
        if self._outputs_note:
            self._addRemark(self._outputs_note)
        return not self._outputs_ready

    def _check_outputs(self):
        """Make the outputs match OUTPUTS before the script runs (8.112)."""
        self._outputs_ready, self._outputs_note = True, None
        if ensure_outputs is None:
            self._outputs_note = (
                'output check skipped: CSC library not installed')
            return
        status = ensure_outputs(self.Component, OUTPUTS)
        self._outputs_ready, self._outputs_note = status.ready, status.remark

    def BeforeRunScript(self):
        """Perform some setup actions."""
        self.InputParams[0].Description = (
            'Component passport JSON ({identity, snapshots[]}) or Rhino geometry '
            'carrying one (from the Fetch components), or any geometry'
        )
        self.InputParams[1].Description = (
            'Original function (e.g. IfcColumn) for a frame computed '
            'locally; empty: taken from the component passport'
        )
        self._check_outputs()
        if LIBRARY_PROBLEM is None:
            csc_gh.dev_reload(globals())

    def passport_of(self, geometry):
        """The passport carried by a geometry's csc_component user text."""
        try:
            value = geometry.GetUserString('csc_component')
        except Exception:
            return None
        return load_passport(value) if value else None

    def frame_for(self, passport, points, original_function):
        """The stored frame of the passport's state, else a local one."""
        identity, snapshot = parts(passport) if passport else (None, None)
        frame = (snapshot or {}).get('frame')
        if frame_ok(frame):
            return frame
        function = text(original_function) or (identity or {}).get(
            'original_function')
        if points is None or len(points) < 4:
            raise BuildError('no frame in the component passport and not enough '
                             'geometry to compute one')
        result = compute_frame(points, function)
        self._addRemark(
            'No frame in the component passport: computed locally '
            f'(frame version {result["version"]}, original function '
            f'{function or "unknown"}).')
        return result['frame']

    def RunScript(self, Input, OriginalFunction: str):
        if self._stop():
            return empty_outputs()
        Output, Frame = empty_outputs()
        if Input is None or (isinstance(Input, str) and not Input.strip()):
            msg = 'Input failed to collect data!'
            self._addWarning(msg)
            return self._no_result('Input')
        try:
            if isinstance(Input, str):
                passport = load_passport(Input)
                if passport is None:
                    raise BuildError('Input is not component passport JSON')
                _, snapshot = parts(passport)
                points = passport_points(snapshot)
                frame = self.frame_for(passport, points, OriginalFunction)
                Output = json.dumps(with_placement(
                    passport, canonical_placement(frame)))
                Frame = plane_from_frame(frame)
                return Output, Frame

            geometry = Input.Duplicate()
            passport = self.passport_of(Input)
            points = None
            if not (passport and frame_ok(
                    (parts(passport)[1] or {}).get('frame'))):
                points = geometry_points([Input])
            frame = self.frame_for(passport, points, OriginalFunction)
            # undo a client-side placement first: stored -> canonical
            if passport and placement_of(passport):
                placed = placement_transform(placement_of(passport))
                ok, back = placed.TryGetInverse()
                if ok:
                    geometry.Transform(back)
            geometry.Transform(canonical_transform(frame))
            if passport:
                geometry.SetUserString('csc_component', json.dumps(
                    with_placement(passport, canonical_placement(frame))))
            Output = geometry
            Frame = plane_from_frame(frame)
            return Output, Frame
        except BuildError as error:
            self._addError(str(error))
            return null_outputs()
        except Exception as error:
            msg = f'Unexpected error: {error}'
            self._addError(msg)
            return null_outputs()
        return Output, Frame
# ---------- end applyframe ----------
preview = CustomPreview(
    Geometry=applyframe.Output,
    Material={diffuse=RGB(221, 160, 221), emission=RGB(66, 48, 66), shine=0.5, specular=RGB(255, 255, 255), transparency=0})

# ---- group: __DDU_CSC_EXAMPLE_05__
# Step 6.1
# comments & notes: Compute t-SNE (t-Stochastic Nearest Neighbor Embedding). It is primarily a dimension-reduction technique for embedding multidimensional vectors (i.e. descriptors).
# 
# We can use this to visualize similarity between components (given a multidimensional descriptor).
descriptordata_5 = Data(descriptordata_3)
embeddingdimensions_2 = Data(embeddingdimensions)
computetsne = ComputeTSNE(
    Data=descriptordata_5,
    Components=embeddingdimensions_2,
    EarlyExaggeration=Slider(12, range=0..100),
    Method=Slider(1, range=0..1),
    RandomSeed=Slider(1234, range=0..100000000))  # -> EmbedddedData; inputs Data: tree of Double, Components: Int32, Perplexity: Int32, EarlyExaggeration: Double, LearningRate: Double, Iterations: Int32, Method: Int32, Initialization: Int32, RandomSeed: Int32
# ---------- computetsne: Python ----------
#! python3
# -*- coding: utf-8 -*-
# venv: DDU_CSC_MATCH
# r: charset_normalizer
# r: numpy==2.0.2
# r: scipy==1.13.1
# r: scikit-learn==1.6.1
print('ENV OK!')

# PYTHON STANDARD LIBRARY IMPORTS ---------------------------------------------

# THIRD PARTY LIBRARY IMPORTS -------------------------------------------------
import numpy as np  # NOQA
from sklearn.manifold import TSNE  # NOQA

# RHINO AND GH RELATED IMPORTS ------------------------------------------------
import System  # NOQA
import Grasshopper  # NOQA
import Rhino  # NOQA

# GHENV COMPONENT SETTINGS ----------------------------------------------------
ghenv.Component.Name = 'ComputeTSNE'  # NOQA
ghenv.Component.NickName = 'ComputeTSNE'  # NOQA
ghenv.Component.Category = 'DDU_CSC'  # NOQA
ghenv.Component.SubCategory = '6 Data Tools'  # NOQA
ghenv.Component.Description = (  # NOQA
    'Computes T-distributed Stochastic Neighbor Embedding.'
)

# OPTIONAL HELPERS: they never block the component (decisions 8.112, 8.113) ---
try:
    from csc_gh.ports import ensure_outputs
    from csc_gh.messages import set_state
except ImportError:
    ensure_outputs = set_state = None

OUTPUTS = [
    ('EmbedddedData', 'EmbedddedData',
     'The transformed data as a DataTree, where each Branch represents one embeddedDataPoint.'),
]


def empty_outputs():
    """What RunScript returns when it stops early or has no result: an empty
    Grasshopper tree per output (never '' or None)."""
    if not OUTPUTS:
        return None
    trees = tuple(Grasshopper.DataTree[System.Object]() for _ in OUTPUTS)
    return trees[0] if len(trees) == 1 else trees


class CSC_ComputeTSNE(Grasshopper.Kernel.GH_ScriptInstance):
    """
    Author: Max Benjamin Eschenbach
    License: MIT License
    Version: 261102
    """

    _outputs_ready = True       # set by BeforeRunScript (8.112)
    _outputs_note = None

    def __init__(self):
        """Initialize this component and set component parameters."""
        super().__init__()
        # initialize props
        self.Component = ghenv.Component  # NOQA
        self.InputParams = self.Component.Params.Input
        self.OutputParams = self.Component.Params.Output

    def _addRemark(self, msg: str = ''):
        """Add a remark message to the component."""
        rml = self.Component.RuntimeMessageLevel.Remark
        self.AddRuntimeMessage(rml, msg)

    def _addWarning(self, msg: str = ''):
        """Add a warning message to the component."""
        rml = self.Component.RuntimeMessageLevel.Warning
        self.AddRuntimeMessage(rml, msg)

    def _addError(self, msg: str = ''):
        """Add an error message to the component."""
        rml = self.Component.RuntimeMessageLevel.Error
        self.AddRuntimeMessage(rml, msg)

    def _state(self, text=''):
        """The one short state under the component (decision 8.113)."""
        if set_state is not None:
            set_state(self.Component, text)

    def _stop(self):
        """True when RunScript has to return early: the outputs were just
        updated (says why)."""
        if self._outputs_note:
            self._addRemark(self._outputs_note)
        return not self._outputs_ready

    def _check_outputs(self):
        """Make the outputs match OUTPUTS before the script runs (8.112)."""
        self._outputs_ready, self._outputs_note = True, None
        if ensure_outputs is None:
            self._outputs_note = (
                'output check skipped: CSC library not installed')
            return
        status = ensure_outputs(self.Component, OUTPUTS)
        self._outputs_ready, self._outputs_note = status.ready, status.remark

    def BeforeRunScript(self):
        """Perform some setup actions."""
        # Initialize input param descriptions
        self.InputParams[0].Description = (
            'Data to be reduced using t-SNE as a DataTree, where '
            'each Branch represents one DataPoint.'
        )
        self.InputParams[1].Description = (
            'Dimension of the embedded space.'
        )
        self.InputParams[2].Description = (
            'The perplexity is related to the number of nearest neighbors '
            'that are used in other manifold learning algorithms. '
            'Consider selecting a value between 5 and 50. Defaults to 30.'
        )
        self.InputParams[3].Description = (
            'Controls how tight natural clusters in the original space '
            'are in the embedded space and how much space will be '
            'between them.'
            'Defaults to 12.'
        )
        self.InputParams[4].Description = (
            'The learning rate for t-SNE is usually in the range '
            '(10.0, 1000.0).'
            'Defaults to 200.'
        )
        self.InputParams[5].Description = (
            'Maximum number of iterations for the optimization. '
            'Should be at least 250.'
            'Defaults to 1000.'
        )
        self.InputParams[6].Description = (
            'Barnes-Hut approximation (0) runs in O(NlogN) time. '
            'Exact method (1) will run on the slower, but exact, '
            'algorithm in O(N^2) time.'
            'Defaults to 0.'
        )
        self.InputParams[7].Description = (
            'Initialization method. Random (0) or PCA (1).'
            'Defaults to 0.'
        )
        self.InputParams[8].Description = (
            'Determines the random number generator. Pass an int for '
            'reproducible results across multiple function calls. '
            'Note that different initializations might result in '
            'different local minima of the cost function.'
            'Defaults to None.'
        )
        # Initialize output param descriptions
        self._check_outputs()

    def RunScript(self,
            Data: Grasshopper.DataTree[float],
            Components: int,
            Perplexity: int,
            EarlyExaggeration: float,
            LearningRate: float,
            Iterations: int,
            Method: int,
            Initialization: int,
            RandomSeed: int):
        # set up output variables
        if self._stop():
            return empty_outputs()
        EmbedddedData = Grasshopper.DataTree[System.Object]()
        try:
            # sanitize input and abort if not present
            if not Data or Data.DataCount == 0:
                msg = 'Input Data failed to collect data!'
                self._addWarning(msg)
                return EmbedddedData

            # set defaults for parameters if not provided
            if not Components:
                Components = 2
            if not Perplexity:
                Perplexity = 30
            if not EarlyExaggeration:
                EarlyExaggeration = 12.0
            if not LearningRate:
                LearningRate = 200.0
            if not Iterations:
                Iterations = 1000
            if not Method:
                Method = 0
            if not Initialization:
                Initialization = 0
            if not RandomSeed:
                RandomSeed = 0

            # convert method string
            if Method <= 0:
                method_str = "barnes_hut"
            else:
                method_str = "exact"
            if Initialization <= 0:
                init_str = "random"
            else:
                init_str = "pca"

            # convert all datatree branches to numpy array
            np_data = np.array([np.array(Data.Branch(p)) for p in Data.Paths])

            # initialize t-SNE solver class
            tsne = TSNE(n_components=Components,
                        perplexity=Perplexity,
                        early_exaggeration=EarlyExaggeration,
                        learning_rate=LearningRate,
                        n_iter=Iterations,
                        random_state=RandomSeed,
                        method=method_str,
                        init=init_str)

            # run t-SNE solver on incoming data
            tsne_result = tsne.fit_transform(np_data)

            # loop over all branches and add embedded data to output tree
            for i in range(len(Data.Branches)):
                EmbedddedData.AddRange(
                    [float(x) for x in tsne_result[i]],
                    Data.Paths[i]
                )

            # return output
            return EmbedddedData

        except Exception as e:
            msg = f'Unexpected error during t-SNE computation: {str(e)}'
            self._addError(msg)
            return EmbedddedData
# ---------- end computetsne ----------
embedddeddata = Data(computetsne)

# Step 6.2
# comments & notes: Use PCA (Principal Component Analysis) to reduce dimensions of a multidimensional vector (i.e. descriptor).
# 
# NOTE: This algorithm is deterministic and always yields the same results on the same input data!
descriptordata_6 = Data(descriptordata_4)
embeddingdimensions_3 = Data(embeddingdimensions)
computepca = ComputePCA(Data=descriptordata_6, Components=embeddingdimensions_3)  # -> EmbedddedData; inputs Data: tree of Double, Components: Int32
# ---------- computepca: Python ----------
#! python3
# -*- coding: utf-8 -*-
# venv: DDU_CSC_MATCH
# r: charset_normalizer
# r: numpy==2.0.2
# r: scipy==1.13.1
# r: scikit-learn==1.6.1
print('ENV OK!')

# PYTHON STANDARD LIBRARY IMPORTS ---------------------------------------------

# THIRD PARTY LIBRARY IMPORTS -------------------------------------------------
import numpy as np  # NOQA
from sklearn.decomposition import PCA  # NOQA

# RHINO AND GH RELATED IMPORTS ------------------------------------------------
import System  # NOQA
import Grasshopper  # NOQA
import Rhino  # NOQA

# GHENV COMPONENT SETTINGS ----------------------------------------------------
ghenv.Component.Name = 'ComputePCA'  # NOQA
ghenv.Component.NickName = 'ComputePCA'  # NOQA
ghenv.Component.Category = 'DDU_CSC'  # NOQA
ghenv.Component.SubCategory = '6 Data Tools'  # NOQA
ghenv.Component.Description = (  # NOQA
    'Computes principal component analysis (PCA) for dimensionality reduction'
)

# OPTIONAL HELPERS: they never block the component (decisions 8.112, 8.113) ---
try:
    from csc_gh.ports import ensure_outputs
    from csc_gh.messages import set_state
except ImportError:
    ensure_outputs = set_state = None

OUTPUTS = [
    ('EmbedddedData', 'EmbedddedData',
     'The transformed data as a DataTree, where each Branch represents one embedded DataPoint.'),
]


def empty_outputs():
    """What RunScript returns when it stops early or has no result: an empty
    Grasshopper tree per output (never '' or None)."""
    if not OUTPUTS:
        return None
    trees = tuple(Grasshopper.DataTree[System.Object]() for _ in OUTPUTS)
    return trees[0] if len(trees) == 1 else trees


class CSC_ComputePCA(Grasshopper.Kernel.GH_ScriptInstance):
    """
    Author: Max Benjamin Eschenbach
    License: MIT License
    Version: 261102
    """

    _outputs_ready = True       # set by BeforeRunScript (8.112)
    _outputs_note = None

    def __init__(self):
        """Initialize this component and set component parameters."""
        super().__init__()
        # initialize props
        self.Component = ghenv.Component  # NOQA
        self.InputParams = self.Component.Params.Input
        self.OutputParams = self.Component.Params.Output

    def _addRemark(self, msg: str = ''):
        """Add a remark message to the component."""
        rml = self.Component.RuntimeMessageLevel.Remark
        self.AddRuntimeMessage(rml, msg)

    def _addWarning(self, msg: str = ''):
        """Add a warning message to the component."""
        rml = self.Component.RuntimeMessageLevel.Warning
        self.AddRuntimeMessage(rml, msg)

    def _addError(self, msg: str = ''):
        """Add an error message to the component."""
        rml = self.Component.RuntimeMessageLevel.Error
        self.AddRuntimeMessage(rml, msg)

    def _state(self, text=''):
        """The one short state under the component (decision 8.113)."""
        if set_state is not None:
            set_state(self.Component, text)

    def _stop(self):
        """True when RunScript has to return early: the outputs were just
        updated (says why)."""
        if self._outputs_note:
            self._addRemark(self._outputs_note)
        return not self._outputs_ready

    def _check_outputs(self):
        """Make the outputs match OUTPUTS before the script runs (8.112)."""
        self._outputs_ready, self._outputs_note = True, None
        if ensure_outputs is None:
            self._outputs_note = (
                'output check skipped: CSC library not installed')
            return
        status = ensure_outputs(self.Component, OUTPUTS)
        self._outputs_ready, self._outputs_note = status.ready, status.remark

    def BeforeRunScript(self):
        """Perform some setup actions."""
        # Initialize input param descriptions
        self.InputParams[0].Description = (
            'Data to be reduced using PCA as a DataTree, where '
            'each Branch represents one DataPoint.'
        )
        self.InputParams[1].Description = (
            'Dimension of the embedded space.'
        )
        # Initialize output param descriptions
        self._check_outputs()

    def RunScript(self, Data: Grasshopper.DataTree[float], Components: int):
        # set up output variables
        if self._stop():
            return empty_outputs()
        EmbedddedData = Grasshopper.DataTree[System.Object]()
        try:
            # sanitize input and abort if not present
            if not Data or Data.DataCount == 0:
                msg = 'Input Data failed to collect data!'
                self._addWarning(msg)
                return EmbedddedData

            # set defaults for parameters if not provided
            if not Components:
                Components = 2

            # convert all datatree branches to numpy array
            np_data = np.array([np.array(Data.Branch(p)) for p in Data.Paths])

            # initialize t-SNE solver class
            data_reduced = PCA(n_components=Components).fit_transform(np_data)

            # loop over all branches and add embedded data to output tree
            for i in range(len(Data.Branches)):
                EmbedddedData.AddRange(
                    [float(x) for x in data_reduced[i]],
                    Data.Paths[i]
                )

            # return output
            return EmbedddedData

        except Exception as e:
            msg = f'Unexpected error during PCA computation: {str(e)}'
            self._addError(msg)
            return EmbedddedData
# ---------- end computepca ----------
embedddeddata_2 = Data(computepca)

# ---- group: __DDU_CSC_EXAMPLE_06__
# Step 6
# comments & notes: Finally, we use the assignment indices to get the assigned data tree branches from the catalog.
# 
# Then we use the inverse of our DesignShapes RestPosition transformation to transform the catalog shapes into the "best" orientation for the respective Design Shapes.
catalogshapes_profilecurves = Data(profilecurve)
assignment_2 = Data(assignment)
id = Data(identityid_7)
tstat = TreeStatistics(Tree=catalogshapes_profilecurves)  # -> Paths, Length, Count
designshapes_restpositiontransform_2 = Data(designshapes_restpositiontransform)
tstat_2 = TreeStatistics(Tree=id)  # -> Paths, Length, Count
item_8 = ListItem(List=tstat.Paths, Index=assignment_2, Wrap=True)
item_9 = ListItem(List=tstat_2.Paths, Index=assignment_2, Wrap=True)
inverse = InverseTransform(Transform=designshapes_restpositiontransform_2)
branch = TreeBranch(Tree=catalogshapes_profilecurves, Path=item_8, MaintainPaths=True)
branch_2 = TreeBranch(Tree=id, Path=item_9, MaintainPaths=True)
ids_of_assigned_components = Panel(branch_2)
transform = Transform(Geometry=branch, Transform=inverse)
catalogshapes_atdesignshapelocation = Data(transform)
curvepreviewlw_3 = CurvePreviewLW(Curves=flatten(transform), Colors=ColourSwatch(SwatchColor=RGB(242, 0, 255)), Thickness=Slider(2, range=0..10))  # inputs Curves: list of Curve, Colors: list of Color, Thickness: list of Int32; same code as curvepreviewlw

# ---- group: __DDU_CSC_EXAMPLE_05__
# Step 6.3
# comments & notes: Here we just filter the output stream according to the user setting, then forward to visualization.
tsne_embedddeddata = Data(embedddeddata)
pca_embedddeddata = Data(embedddeddata_2)
t_sne_or_pca_2 = Data(t_sne_or_pca)
filter = StreamFilter(Gate=t_sne_or_pca_2, Stream0=tsne_embedddeddata, Stream1=pca_embedddeddata)
embedddeddata_3 = Data(filter)

# Step 7
# comments & notes: Visualize the Embeddings in 2D/3D space.
# 
# You may play with the scale factor to see different densities of clustering.
scalefactor = Slider(15000, range=1..50000)
embedddeddata_4 = Data(embedddeddata_3)
primitivegeometry = Data(proxies_3)
visualizeembedding = VisualizeEmbedding(EmbeddedData=embedddeddata_4, Geometry=primitivegeometry, ScaleFactor=scalefactor)  # -> LayoutGeometry, LayoutPoints, Colors, XForm; inputs EmbeddedData: tree of Double, Geometry: tree, ScaleFactor: Double
# ---------- visualizeembedding: Python ----------
#! python3
# -*- coding: utf-8 -*-
# venv: DDU_CSC_MATCH
# r: charset_normalizer
# r: numpy==2.0.2
print('ENV OK!')

# PYTHON STANDARD LIBRARY IMPORTS ---------------------------------------------

# THIRD PARTY LIBRARY IMPORTS -------------------------------------------------
import numpy as np  # NOQA

# RHINO AND GH RELATED IMPORTS ------------------------------------------------
import System  # NOQA
import System.Drawing  # NOQA
import Grasshopper  # NOQA
import Rhino  # NOQA

# GHENV COMPONENT SETTINGS ----------------------------------------------------
ghenv.Component.Name = 'VisualizeEmbedding'  # NOQA
ghenv.Component.NickName = 'VisualizeEmbedding'  # NOQA
ghenv.Component.Category = 'DDU_CSC'  # NOQA
ghenv.Component.SubCategory = '8 Visualization'  # NOQA
ghenv.Component.Description = (  # NOQA
    'Visualizes a low-dimensional embedding (e.g. from PCA or t-SNE) by '
    'placing the associated input geometry at its embedding coordinate. '
    'Supports 1D, 2D and 3D layouts; when the embedding has more than 3 '
    'dimensions the remaining dimensions (4, 5, 6) are mapped to RGB colour '
    'channels. Each embedding dimension is min-max normalised to '
    '[0, ScaleFactor] per axis so the whole layout fits within the given '
    'extent.'
)

_EPS: float = 1e-12


def _minmax_normalise(values: np.ndarray) -> np.ndarray:
    """Column-wise min-max normalise a (N, D) array to [0, 1].

    Columns whose range is below ``_EPS`` collapse to 0.5 (centre) so the
    layout does not explode along a constant axis.
    """
    V = np.asarray(values, dtype=np.float64)
    if V.ndim != 2:
        raise ValueError(
            f'expected a 2D (N, D) array, got shape {V.shape}'
        )
    v_min = V.min(axis=0)
    v_max = V.max(axis=0)
    v_range = v_max - v_min

    out = np.empty_like(V)
    for d in range(V.shape[1]):
        if v_range[d] < _EPS:
            out[:, d] = 0.5
        else:
            out[:, d] = (V[:, d] - v_min[d]) / v_range[d]
    return out


def _embedding_to_layout(values: np.ndarray, scale: float):
    """
    Map a (N, D) embedding to layout points and optional RGB colours.

    Returns:
        points: (N, 3) float array in world units
        colors: (N, 3) uint8 array in [0, 255] (RGB)
        dims_used_pos: int, how many embedding dims were used for position
        dims_used_col: int, how many embedding dims were used for colour
    """
    normed = _minmax_normalise(values)
    n, d = normed.shape

    points = np.zeros((n, 3), dtype=np.float64)
    dims_used_pos = min(d, 3)
    for ax in range(dims_used_pos):
        points[:, ax] = normed[:, ax] * float(scale)

    colors = np.full((n, 3), 128, dtype=np.int32)
    dims_used_col = max(0, min(d - 3, 3))
    for ch in range(dims_used_col):
        colors[:, ch] = np.clip(
            np.round(normed[:, 3 + ch] * 255.0), 0, 255
        ).astype(np.int32)

    return points, colors, dims_used_pos, dims_used_col


def _geometry_bbox(geometry):
    """
    Return the world-aligned bounding box of a piece of geometry, or
    ``None`` if one cannot be computed.
    """
    if geometry is None:
        return None

    if hasattr(geometry, 'GetBoundingBox'):
        bbox = geometry.GetBoundingBox(True)
        if bbox is not None and bbox.IsValid:
            return bbox

    if isinstance(geometry, Rhino.Geometry.Point3d):
        return Rhino.Geometry.BoundingBox(geometry, geometry)

    return None


def _branch_anchor(geometries) -> Rhino.Geometry.Point3d:
    """
    Return the combined bounding-box centre of all geometries in a branch.

    All valid items in the branch contribute to one union bounding box;
    the centre of that union is used as the shared anchor so every
    geometry in the branch receives the same translation and their
    relative arrangement is preserved.
    """
    union = Rhino.Geometry.BoundingBox.Empty
    any_valid = False
    for geo in geometries:
        bbox = _geometry_bbox(geo)
        if bbox is None:
            continue
        union.Union(bbox)
        any_valid = True

    if not any_valid or not union.IsValid:
        raise ValueError(
            'cannot determine an anchor point: no geometry in branch '
            'has a valid bounding box'
        )
    return union.Center

# OPTIONAL HELPERS: they never block the component (decisions 8.112, 8.113) ---
try:
    from csc_gh.ports import ensure_outputs
    from csc_gh.messages import set_state
except ImportError:
    ensure_outputs = set_state = None

OUTPUTS = [
    ('LayoutGeometry', 'LayoutGeometry',
     'Input geometry translated from its bounding-box centre to the corresponding embedding point in world coordinates.'),
    ('LayoutPoints', 'LayoutPoints',
     'Embedding points in world coordinates, one per datapoint. For 1D embeddings Y = Z = 0; for 2D embeddings Z = 0.'),
    ('Colors', 'Colors',
     'Per-datapoint RGB colour derived from embedding dimensions 4, 5 and 6 (if present), each normalised to [0, 255]. Missing channels default to 128 (mid-grey), so low-dimensional embeddings still produce a usable colour output.'),
    ('XForm', 'XForm',
     'The translation transform applied to each input geometry (useful to transform additional geometry into the same layout).'),
]


def empty_outputs():
    """What RunScript returns when it stops early or has no result: an empty
    Grasshopper tree per output (never '' or None)."""
    if not OUTPUTS:
        return None
    trees = tuple(Grasshopper.DataTree[System.Object]() for _ in OUTPUTS)
    return trees[0] if len(trees) == 1 else trees


class CSC_VisualizeEmbedding(Grasshopper.Kernel.GH_ScriptInstance):
    """
    Author: Max Benjamin Eschenbach
    License: MIT License
    Version: 261102
    """

    _outputs_ready = True       # set by BeforeRunScript (8.112)
    _outputs_note = None

    def __init__(self):
        """Initialize this component and set component parameters."""
        super().__init__()
        self.Component = ghenv.Component  # NOQA
        self.InputParams = self.Component.Params.Input
        self.OutputParams = self.Component.Params.Output

    def _addRemark(self, msg: str = ''):
        rml = self.Component.RuntimeMessageLevel.Remark
        self.AddRuntimeMessage(rml, msg)

    def _addWarning(self, msg: str = ''):
        rml = self.Component.RuntimeMessageLevel.Warning
        self.AddRuntimeMessage(rml, msg)

    def _addError(self, msg: str = ''):
        rml = self.Component.RuntimeMessageLevel.Error
        self.AddRuntimeMessage(rml, msg)

    def _state(self, text=''):
        """The one short state under the component (decision 8.113)."""
        if set_state is not None:
            set_state(self.Component, text)

    def _stop(self):
        """True when RunScript has to return early: the outputs were just
        updated (says why)."""
        if self._outputs_note:
            self._addRemark(self._outputs_note)
        return not self._outputs_ready

    def _check_outputs(self):
        """Make the outputs match OUTPUTS before the script runs (8.112)."""
        self._outputs_ready, self._outputs_note = True, None
        if ensure_outputs is None:
            self._outputs_note = (
                'output check skipped: CSC library not installed')
            return
        status = ensure_outputs(self.Component, OUTPUTS)
        self._outputs_ready, self._outputs_note = status.ready, status.remark

    def BeforeRunScript(self):
        """Describe inputs & outputs."""
        self.InputParams[0].Description = (
            'Embedded data as a DataTree where each branch represents one '
            'embedded datapoint and its items are the coordinates in the '
            'embedding space (e.g. output of ComputePCA or ComputeTSNE). '
            'Supports any number of dimensions; dimensions beyond the third '
            'are mapped to RGB colour channels.'
        )
        self.InputParams[1].Description = (
            'Geometry to place in the layout as a DataTree. One branch '
            'represents one datapoint; each branch may contain one or '
            'more geometries that are translated together as a rigid '
            'group (sharing a combined bounding-box anchor). Branch order '
            'must match the branch order of EmbeddedData.'
        )
        self.InputParams[2].Description = (
            'Total extent of the layout in world units. Each embedding '
            'dimension is min-max normalised to [0, ScaleFactor] before '
            'being used as a world-space coordinate. Default: 1000.0.'
        )

        # Output descriptions -- skip the hidden "out" param if present.
        self._check_outputs()

    def RunScript(self,
            EmbeddedData: Grasshopper.DataTree[float],
            Geometry: Grasshopper.DataTree[object],
            ScaleFactor: float):

        # init outputs
        if self._stop():
            return empty_outputs()
        LayoutGeometry = Grasshopper.DataTree[System.Object]()
        LayoutPoints = Grasshopper.DataTree[System.Object]()
        Colors = Grasshopper.DataTree[System.Object]()
        XForm = Grasshopper.DataTree[System.Object]()
        __Results = (LayoutGeometry, LayoutPoints, Colors, XForm)


        # input validation
        if EmbeddedData is None or EmbeddedData.DataCount == 0:
            msg = 'EmbeddedData failed to collect data!'
            self._addWarning(msg)
            return __Results

        if Geometry is None or Geometry.DataCount == 0:
            msg = 'Geometry failed to collect data!'
            self._addWarning(msg)
            return __Results

        if ScaleFactor is None:
            ScaleFactor = 1000.0
        try:
            ScaleFactor = float(ScaleFactor)
        except (TypeError, ValueError):
            self._addError(
                f'ScaleFactor must be a number, got {ScaleFactor!r}')
            return __Results
        if not np.isfinite(ScaleFactor) or ScaleFactor <= 0.0:
            self._addError(
                f'ScaleFactor must be > 0, got {ScaleFactor}')
            return __Results

        # collect embedding values into a dense (N, D) array
        paths = list(EmbeddedData.Paths)
        branches = [list(EmbeddedData.Branch(p)) for p in paths]
        n_points = len(branches)

        if n_points < 2:
            self._addError(
                f'Need at least 2 embedded datapoints to build a layout, '
                f'got {n_points}'
            )
            return __Results

        dims = [len(b) for b in branches]
        n_dims = max(dims) if dims else 0
        if n_dims < 1:
            self._addWarning('EmbeddedData branches are empty')
            return __Results
        if min(dims) != n_dims:
            self._addWarning(
                f'EmbeddedData branches have non-uniform dimensionality '
                f'(min={min(dims)}, max={n_dims}); missing values will be '
                f'treated as 0.0'
            )

        values = np.zeros((n_points, n_dims), dtype=np.float64)
        for i, b in enumerate(branches):
            for j, v in enumerate(b):
                try:
                    values[i, j] = float(v)
                except (TypeError, ValueError):
                    values[i, j] = 0.0

        # Collect geometry branches; each branch == one datapoint
        geo_paths = list(Geometry.Paths)
        geo_branches = [list(Geometry.Branch(p)) for p in geo_paths]
        n_geo = len(geo_branches)

        if n_geo != n_points:
            self._addWarning(
                f'Geometry branch count ({n_geo}) does not match '
                f'EmbeddedData branch count ({n_points}); the shorter of '
                f'the two will be used.'
            )
        n_use = min(n_points, n_geo)

        # Compute layout
        try:
            points, colors_rgb, dims_pos, dims_col = _embedding_to_layout(
                values, ScaleFactor
            )
        except ValueError as exc:
            self._addError(f'Could not compute layout: {exc}')
            return __Results

        # Emit per-datapoint results
        successes = 0
        rc = self.Component.RunCount - 1
        for i in range(n_use):
            path = Grasshopper.Kernel.Data.GH_Path(rc, i)
            branch = [g for g in geo_branches[i] if g is not None]

            if not branch:
                self._addWarning(
                    f'Datapoint #{i}: geometry branch is empty or all '
                    f'None; skipped')
                continue

            try:
                anchor = _branch_anchor(branch)
            except ValueError as exc:
                self._addWarning(
                    f'Datapoint #{i}: {exc}; skipped')
                continue

            target = Rhino.Geometry.Point3d(
                float(points[i, 0]),
                float(points[i, 1]),
                float(points[i, 2]),
            )
            translation = Rhino.Geometry.Vector3d(
                target.X - anchor.X,
                target.Y - anchor.Y,
                target.Z - anchor.Z,
            )
            xform = Rhino.Geometry.Transform.Translation(translation)

            moved_items = []
            for j, geo in enumerate(branch):
                try:
                    moved = (geo.Duplicate()
                             if hasattr(geo, 'Duplicate') else geo)
                    if hasattr(moved, 'Transform'):
                        moved.Transform(xform)
                    else:
                        self._addWarning(
                            f'Datapoint #{i}, item #{j}: geometry does '
                            f'not support Transform; emitting original '
                            f'geometry unchanged'
                        )
                    moved_items.append(moved)
                except Exception as exc:
                    self._addWarning(
                        f'Datapoint #{i}, item #{j}: transform failed '
                        f'({exc}); skipped')
                    continue

            if not moved_items:
                self._addWarning(
                    f'Datapoint #{i}: no item transformed successfully; '
                    f'skipped')
                continue

            color = System.Drawing.Color.FromArgb(
                255,
                int(colors_rgb[i, 0]),
                int(colors_rgb[i, 1]),
                int(colors_rgb[i, 2]),
            )

            LayoutGeometry.AddRange(moved_items, path)
            LayoutPoints.Add(target, path)
            Colors.Add(color, path)
            XForm.Add(xform, path)
            successes += 1

        if successes == 0:
            self._addWarning('No datapoints produced valid output')
        else:
            parts = ['']
            if dims_pos == 1:
                parts = ['1D layout']
            elif dims_pos == 2:
                parts = ['2D layout']
            elif dims_pos == 3:
                parts = ['3D layout']
            if dims_col > 0:
                parts.append(f'+{dims_col}ch colour')
            else:
                pass
            self._addRemark(
                f'Placed {successes} geometry object(s) using '
                f'{dims_pos} position dim(s) and {dims_col} colour dim(s) '
                f'out of {n_dims} embedding dim(s).'
            )

        return __Results
# ---------- end visualizeembedding ----------
preview_2 = CustomPreview(Geometry=visualizeembedding.LayoutGeometry, Material=visualizeembedding.Colors)

# ----
# comments & notes: Fetch DETAILED Geometry, either by ID, JSON String or Geometry (with userstring-attached json string)
# Step 3.2
componentpassport_42 = Data(componentpassport_20)

# ----
# comments & notes: DEVELOPMENT:
# RETRIEVING & FILTERING, VISUALIZING COMPONENTS
dispatch_2 = Dispatch(List=componentpassport_42, DispatchPattern=tmatch)  # -> ListA, ListB

lng_2 = ListLength(List=flatten(dispatch_2.ListB))
random_2 = Random(Range=lng_2, Number=1, Seed=2, Integers=True)
item_10 = ListItem(List=flatten(dispatch_2.ListB), Index=random_2, Wrap=True)
random_componentpassport = Data(item_10)
inputdata_2 = Data(random_componentpassport)
fetchoriginalgeometry = FetchOriginalGeometry(Input=inputdata_2)  # -> GeometryData, GeometrySource, SnapshotID
# ---------- fetchoriginalgeometry: Python ----------
#! python3
# -*- coding: utf-8 -*-
# venv: DDU_CSC
# r: charset_normalizer
# r: requests==2.32.5
# r: numpy==2.0.2
print('ENV OK!')

# PYTHON STANDARD LIBRARY IMPORTS ---------------------------------------------
import json  # NOQA

# THIRD PARTY LIBRARY IMPORTS -------------------------------------------------
import requests  # NOQA

# RHINO AND GH RELATED IMPORTS ------------------------------------------------
import System  # NOQA
import Grasshopper  # NOQA
import Rhino  # NOQA
import scriptcontext as sc  # NOQA
import Rhino.Geometry as rg  # NOQA

# GHENV COMPONENT SETTINGS ----------------------------------------------------
ghenv.Component.Name = 'FetchOriginalGeometry'  # NOQA
ghenv.Component.NickName = 'FetchOriginalGeometry'  # NOQA
ghenv.Component.Category = 'DDU_CSC'  # NOQA
ghenv.Component.SubCategory = '2 Catalog Interface'  # NOQA
ghenv.Component.Description = (  # NOQA
    'Fetches the original (as uploaded, full fidelity) snapshot geometry '
    'as binary PLY '
    'from the CSC API, with ETag caching.\n'
    'Input can be:\n'
    '- Geometry carrying the \'csc_component\' user text\n'
    '- A component passport JSON string ({identity, snapshots[]})\n'
    '- A raw identity_id (resolves the current snapshot)\n'
    '- A raw snapshot_id\n\n'
    'Falls back to the reduced PLY, then to the inline snapshot geometry '
    '(preview meshes), when no original PLY is available. Point clouds '
    'prefer the full PLY, then the inline preview. An element that has only an '
    'authored shape (a box or prism, no scan) is built from its parameters.'
)


# CSC LIBRARY (decision 8.111) ----------------------------------------------
CSC_GH_MINIMUM = '261102'
LIBRARY_PROBLEM = None
try:
    import csc_gh
    csc_gh.require(CSC_GH_MINIMUM)
    from csc_gh.read import (authored_only, drawable_proxies, placement_of)  # NOQA
    from csc_gh.rhino import (placement_transform, proxy_to_rhino)  # NOQA
    from csc_gh.messages import (waits_for_data)  # NOQA
except ImportError:
    LIBRARY_PROBLEM = (
        'CSC library 261102 too old or missing: run CSC_Update, '
        'then restart Rhino')



# the file names of the server are detailed / reduced; the levels are named
# Original / Reduced / Preview (decision 8.23)
LEVEL_NAMES = {'detailed': 'original', 'reduced': 'reduced'}

# OPTIONAL HELPERS: they never block the component (decisions 8.112, 8.113) ---
try:
    from csc_gh.ports import ensure_outputs
    from csc_gh.messages import set_state
except ImportError:
    ensure_outputs = set_state = None

OUTPUTS = [
    ('GeometryData', 'GeometryData',
     'Fetched original geometry as Rhino meshes and point clouds (one object per snapshot primitive)'),
    ('GeometrySource', 'GeometrySource',
     'Per-primitive source: original/reduced (mesh PLY), original (point-cloud PLY), preview (inline fallback) or authored (a shape built from its parameters)'),
    ('SnapshotID', 'SnapshotID',
     'Snapshot ID that was processed'),
]


def empty_outputs():
    """What RunScript returns when it stops early or has no result: an empty
    Grasshopper tree per output (never '' or None)."""
    if not OUTPUTS:
        return None
    trees = tuple(Grasshopper.DataTree[System.Object]() for _ in OUTPUTS)
    return trees[0] if len(trees) == 1 else trees


def null_outputs():
    """One null per output: an item of an item-access component that has no
    result keeps its slot (decision 8.186)."""
    if len(OUTPUTS) <= 1:
        return None
    return tuple(None for _ in OUTPUTS)


class CSC_FetchOriginalGeometry(Grasshopper.Kernel.GH_ScriptInstance):
    """
    Author: Max Benjamin Eschenbach
    License: MIT License
    Version: 261102
    """

    # Resolution preference chain (original, then reduced; inline otherwise)
    resolution_chain = ['detailed', 'reduced']
    # Point clouds: full PLY first, then the inline preview.
    fetch_point_cloud_ply = True

    _outputs_ready = True       # set by BeforeRunScript (8.112)
    _outputs_note = None

    def __init__(self):
        """Initialize this component and set component parameters."""
        super().__init__()
        # initialize props
        self.Component = ghenv.Component  # NOQA
        self.InputParams = self.Component.Params.Input
        self.OutputParams = self.Component.Params.Output

    def _addRemark(self, msg: str = ''):
        """Add a remark message to the component."""
        rml = self.Component.RuntimeMessageLevel.Remark
        self.AddRuntimeMessage(rml, msg)

    def _addWarning(self, msg: str = ''):
        """Add a warning message to the component."""
        rml = self.Component.RuntimeMessageLevel.Warning
        self.AddRuntimeMessage(rml, msg)

    def _addError(self, msg: str = ''):
        """Add an error message to the component."""
        rml = self.Component.RuntimeMessageLevel.Error
        self.AddRuntimeMessage(rml, msg)

    def _state(self, text=''):
        """The one short state under the component (decision 8.113)."""
        if set_state is not None:
            set_state(self.Component, text)

    def _no_result(self, *ports):
        """The result of an iteration without one (decision 8.186): empty
        outputs when the inputs in ``ports`` carry no data at all (the
        component waits for data; no ports: a list or tree input is empty),
        else a null in the slot of this item, so the outputs stay one to one
        with the input list."""
        if not ports or (waits_for_data is not None
                         and waits_for_data(self, ports)):
            return empty_outputs()
        return null_outputs()

    def _stop(self):
        """True when RunScript has to return early: the library is missing or
        too old, or the outputs were just updated (says why)."""
        if LIBRARY_PROBLEM:
            self._addError(LIBRARY_PROBLEM)
            return True
        if self._outputs_note:
            self._addRemark(self._outputs_note)
        return not self._outputs_ready

    def _check_outputs(self):
        """Make the outputs match OUTPUTS before the script runs (8.112)."""
        self._outputs_ready, self._outputs_note = True, None
        if ensure_outputs is None:
            self._outputs_note = (
                'output check skipped: CSC library not installed')
            return
        status = ensure_outputs(self.Component, OUTPUTS)
        self._outputs_ready, self._outputs_note = status.ready, status.remark

    def BeforeRunScript(self):
        """Perform some setup actions."""
        # Initialize input param descriptions
        self.InputParams[0].Description = (
            'Input can be:\n'
            '- Geometry with the \'csc_component\' user text\n'
            '- A component passport JSON string ({identity, snapshots[]})\n'
            '- A raw identity_id (resolves current snapshot)\n'
            '- A raw snapshot_id'
        )
        # Initialize output param descriptions
        self._check_outputs()
        if LIBRARY_PROBLEM is None:
            csc_gh.dev_reload(globals())

    def get_auth_core_from_sticky(self):
        """Get AuthCore instance from sticky storage."""
        auth_core = sc.sticky.get('CSC_AuthCore')
        if auth_core is None:
            msg = ('No authentication found. Please use CSC_Session component '
                   'first.')
            self._addWarning(msg)
            return None
        return auth_core

    def parse_json_safe(self, value):
        """Parse a JSON string, returning None on failure."""
        try:
            return json.loads(value)
        except (json.JSONDecodeError, TypeError):
            return None

    def normalize_passport(self, obj):
        """
        Classify a parsed JSON object into canonical passport
        {identity, snapshots[]}, or None.
        """
        if not isinstance(obj, dict):
            return None
        identity = obj.get('identity') or {}
        snaps = obj.get('snapshots') or []
        if snaps and isinstance(snaps[0], dict):
            return {'identity': identity, 'snapshots': snaps}
        snap = obj.get('snapshot')
        if isinstance(snap, dict):
            return {'identity': identity, 'snapshots': [snap]}
        # Bare snapshot document
        if 'geometry' in obj and 'identity_id' in obj:
            return {'identity': {}, 'snapshots': [obj]}
        return None

    def primary_snapshot(self, passport):
        """Return the snapshot row used for geometry fetch."""
        if not isinstance(passport, dict):
            return None
        snaps = passport.get('snapshots') or []
        if snaps and isinstance(snaps[0], dict):
            return snaps[0]
        return None

    def fetch_passport_by_identity(self, auth_core, identity_id):
        """Fetch {identity, snapshots[]} for an identity's current snapshot."""
        try:
            resp = auth_core.cached_get_passport(identity_id)
            if resp.status_code == 200:
                return auth_core.normalize_passport_output(resp.json())
        except Exception as e:
            self._addWarning(
                'Fetching the component passport of the identity failed: '
                f'{str(e)}')
        return None

    def fetch_passport_by_snapshot(self, auth_core, snapshot_id):
        """Build minimal passport from a bare snapshot document."""
        try:
            resp = auth_core.authorized_get(f'/snapshots/{snapshot_id}')
            if resp.status_code == 200:
                return {'identity': {}, 'snapshots': [resp.json()]}
        except Exception as e:
            self._addWarning(f'Snapshot fetch failed: {str(e)}')
        return None

    def resolve_passport(self, auth_core, Input):
        """
        Resolve the input into canonical passport {identity, snapshots[]}.
        Returns (passport_or_None, input_is_geometry).
        """
        input_is_geometry = isinstance(Input, rg.GeometryBase)

        # Geometry carrying the passport userstring
        if (hasattr(Input, 'UserStringCount') and
                Input.UserStringCount > 0):
            value = Input.GetUserString('csc_component')
            if value:
                passport = self.normalize_passport(
                    self.parse_json_safe(value))
                if passport:
                    return passport, input_is_geometry

        # String input: passport JSON, identity doc, or raw UUID
        if isinstance(Input, str):
            s = Input.strip()
            obj = self.parse_json_safe(s)
            if obj is not None:
                passport = self.normalize_passport(obj)
                if passport:
                    return passport, input_is_geometry
                # Identity document with a current snapshot pointer
                if (isinstance(obj, dict) and obj.get('_id') and
                        obj.get('current_snapshot_id')):
                    passport = self.fetch_passport_by_identity(
                        auth_core, obj['_id'])
                    if passport:
                        return passport, input_is_geometry
                return None, input_is_geometry
            # Not JSON: treat as a raw UUID (identity first, then snapshot)
            if auth_core.validate_uuid(s):
                passport = self.fetch_passport_by_identity(auth_core, s)
                if passport:
                    return passport, input_is_geometry
                passport = self.fetch_passport_by_snapshot(auth_core, s)
                if passport:
                    return passport, input_is_geometry

        return None, input_is_geometry

    def build_inline_mesh(self, mesh_data, default_color):
        """Build a Rhino mesh from an inline SnapshotMesh (Rhino Z-up)."""
        vertices = mesh_data.get('vertices')
        faces = mesh_data.get('faces')
        if not vertices or not faces:
            return None
        mesh = rg.Mesh()
        for v in vertices:
            mesh.Vertices.Add(float(v[0]), float(v[1]), float(v[2]))
        for f in faces:
            if len(f) == 3:
                mesh.Faces.AddFace(f[0], f[1], f[2])
            elif len(f) == 4:
                mesh.Faces.AddFace(f[0], f[1], f[2], f[3])
        colors = mesh_data.get('colors')
        if colors and len(colors) == len(vertices):
            for c in colors:
                mesh.VertexColors.Add(int(c[0]), int(c[1]), int(c[2]))
        elif default_color:
            try:
                r, g, b = default_color
                for _ in range(len(vertices)):
                    mesh.VertexColors.Add(int(r), int(g), int(b))
            except (ValueError, TypeError):
                pass
        mesh.Normals.ComputeNormals()
        mesh.Compact()
        return mesh

    def placement_xform(self, passport):
        """The client-side placement of the piece (csc_placement, set by
        TransformComponent) as a transform of the stored geometry."""
        placed = placement_of(passport)
        return placement_transform(placed) if placed else None

    def fetch_authored_proxies(self, snapshot):
        """Authored shapes of a piece that has no mesh and no point cloud
        (a web-authored box, a migrated extrusion), built from the proxy
        parameters and placement; ``[(geometry, 'authored', index)]``."""
        results = []
        if not authored_only(snapshot):
            return results
        for index, proxy in drawable_proxies(snapshot):
            if (proxy.get('fit') or {}).get('method') != 'authored':
                continue
            shape = proxy_to_rhino(proxy)
            if shape is not None:
                results.append((shape, 'authored', index))
        return results

    def fetch_primitive_meshes(self, auth_core, snapshot):
        """
        Fetch one mesh per snapshot mesh primitive, preferring the PLY
        resolution chain and falling back to inline geometry.
        Returns a list of (mesh, source) tuples.
        """
        snapshot_id = snapshot.get('_id')
        geometry = snapshot.get('geometry', {}) or {}
        inline_meshes = geometry.get('meshes', []) or []
        res_map = snapshot.get('mesh_ply_resolutions', {}) or {}
        default_color = snapshot.get('color') or [110, 110, 110]

        results = []
        for i in range(len(inline_meshes)):
            available = res_map.get(str(i), []) or []
            mesh = None
            source = None
            for resolution in self.resolution_chain:
                if resolution in available:
                    m, _etag, _from_cache = (
                        auth_core.cached_get_snapshot_mesh(
                            snapshot_id, i, resolution)
                    )
                    if m is not None:
                        mesh = m
                        source = LEVEL_NAMES.get(resolution, resolution)
                        break
            if mesh is None:
                mesh = self.build_inline_mesh(inline_meshes[i], default_color)
                source = 'preview'
            if mesh is not None:
                results.append((mesh, source))
        return results

    def build_inline_point_cloud(self, pc_data):
        """Build a Rhino point cloud from one inline SnapshotPointCloud."""
        if not isinstance(pc_data, dict):
            return None
        pts = pc_data.get('points', []) or []
        if not pts:
            return None
        cloud = rg.PointCloud()
        colors = pc_data.get('colors')
        if colors and len(colors) == len(pts):
            for p, c in zip(pts, colors):
                cloud.Add(
                    rg.Point3d(float(p[0]), float(p[1]), float(p[2])),
                    System.Drawing.Color.FromArgb(*[int(v) for v in c]),
                )
        else:
            for p in pts:
                cloud.Add(rg.Point3d(float(p[0]), float(p[1]), float(p[2])))
        return cloud if cloud.Count > 0 else None

    def fetch_primitive_point_clouds(self, auth_core, snapshot):
        """
        Fetch one point cloud per snapshot primitive.

        FetchReduced uses the inline preview only (no reduced PLY exists).
        FetchOriginal prefers the full PLY, then the inline preview.
        Returns a list of (cloud, source) tuples.
        """
        geometry = snapshot.get('geometry', {}) or {}
        inline_pcs = geometry.get('point_clouds', []) or []
        snapshot_id = snapshot.get('_id')
        results = []
        for i in range(len(inline_pcs)):
            cloud = None
            source = None
            if self.fetch_point_cloud_ply and auth_core and snapshot_id:
                try:
                    cloud = auth_core.cached_get_snapshot_point_cloud(
                        snapshot_id, i)
                    if cloud is not None:
                        source = 'original'
                except Exception as e:
                    self._addWarning(
                        'Point cloud PLY fetch failed '
                        f'for index {i}: {str(e)}')
            if cloud is None:
                cloud = self.build_inline_point_cloud(inline_pcs[i])
                source = 'preview'
            if cloud is not None:
                results.append((cloud, source))
        return results

    def collect_fetched_geometry(self, auth_core, snapshot):
        """
        Return meshes, then point clouds, then authored shapes as
        (geometry, source, kind, index) tuples.
        """
        items = []
        for i, (mesh, source) in enumerate(
                self.fetch_primitive_meshes(auth_core, snapshot)):
            items.append((mesh, source, 'mesh', i))
        for i, (cloud, source) in enumerate(
                self.fetch_primitive_point_clouds(auth_core, snapshot)):
            items.append((cloud, source, 'point_cloud', i))
        for shape, source, index in self.fetch_authored_proxies(snapshot):
            items.append((shape, source, 'proxy', index))
        return items

    def select_fetched_geometry(self, Input, input_is_geometry, items):
        """
        If the input geometry carries a primitive index, return only that
        primitive of the matching kind.
        """
        if not (input_is_geometry and hasattr(Input, 'GetUserString')):
            return items
        if isinstance(Input, rg.PointCloud):
            raw = Input.GetUserString('csc_point_cloud_index')
            if raw:
                try:
                    idx = int(raw)
                except (TypeError, ValueError):
                    return items
                filtered = [
                    item for item in items
                    if item[2] == 'point_cloud' and item[3] == idx
                ]
                return filtered or items
            return items
        raw = Input.GetUserString('csc_proxy_index')
        if raw:
            try:
                idx = int(raw)
            except (TypeError, ValueError):
                return items
            filtered = [
                item for item in items
                if item[2] == 'proxy' and item[3] == idx
            ]
            return filtered or items
        raw = Input.GetUserString('csc_mesh_index')
        if raw:
            try:
                idx = int(raw)
            except (TypeError, ValueError):
                return items
            filtered = [
                item for item in items
                if item[2] == 'mesh' and item[3] == idx
            ]
            return filtered or items
        return items

    def RunScript(self, Input):
        # Get AuthCore instance from sticky storage
        if self._stop():
            return empty_outputs()
        auth_core = self.get_auth_core_from_sticky()
        if auth_core is None:
            return empty_outputs()

        # Check if authentication is valid
        if not auth_core.is_valid():
            msg = ('Authentication expired. Please use CSC_Session '
                   'component to refresh.')
            self._addWarning(msg)
            return empty_outputs()

        # Input validation
        if not Input:
            msg = 'Please provide input data.'
            self._addWarning(msg)
            return self._no_result('Input')

        # Set up outputs
        GeometryData = System.Collections.Generic.List[System.Object]()
        GeometrySource = System.Collections.Generic.List[str]()
        SnapshotID = System.Collections.Generic.List[str]()
        __Results = (GeometryData, GeometrySource, SnapshotID)

        try:

            passport, input_is_geometry = self.resolve_passport(
                auth_core, Input)
            snapshot = self.primary_snapshot(passport)
            if not passport or not snapshot:
                msg = 'Could not resolve a snapshot from input.'
                self._addError(msg)
                return null_outputs()
            snapshot_id = snapshot.get('_id')
            if not snapshot_id or not auth_core.validate_uuid(snapshot_id):
                msg = f'Snapshot ID <{snapshot_id}> is not a valid UUID!'
                self._addError(msg)
                return null_outputs()


            items = self.collect_fetched_geometry(auth_core, snapshot)
            if not items:
                msg = f'No geometry available for snapshot {snapshot_id}'
                self._addWarning(msg)
                return __Results

            # Position the geometry by the piece's client-side placement
            xform = self.placement_xform(passport)
            if xform is not None:
                for geom, _source, _kind, _idx in items:
                    geom.Transform(xform)

            passport_json = auth_core.passport_json_string(passport)
            for geom, _source, kind, idx in items:
                if hasattr(geom, 'SetUserString'):
                    geom.SetUserString('csc_component', passport_json)
                    if kind == 'mesh':
                        geom.SetUserString('csc_mesh_index', str(idx))
                    elif kind == 'proxy':
                        geom.SetUserString('csc_proxy_index', str(idx))
                    else:
                        geom.SetUserString(
                            'csc_point_cloud_index', str(idx))

            selected = self.select_fetched_geometry(
                Input, input_is_geometry, items)
            for geom, source, _kind, _idx in selected:
                GeometryData.Add(geom)
                GeometrySource.Add(source)

            SnapshotID.Add(snapshot_id)

            mesh_count = sum(
                1 for _g, _s, kind, _i in selected if kind == 'mesh')
            pc_count = sum(
                1 for _g, _s, kind, _i in selected
                if kind == 'point_cloud')
            self._addRemark(
                f'Fetched original geometry ({mesh_count} mesh(es), '
                f'{pc_count} point cloud(s)) for snapshot {snapshot_id}'
            )

            return __Results

        except requests.exceptions.ConnectionError as e:
            msg = 'Cannot connect to server. Please check your connection.'
            self._addError(msg + f'\nFull Error: {str(e)}')
            return null_outputs()

        except requests.exceptions.Timeout as e:
            msg = 'Request timeout. Server may be slow.'
            self._addError(msg + f'\nFull Error: {str(e)}')
            return null_outputs()

        except requests.exceptions.RequestException as e:
            msg = f'Request error: {str(e)}'
            self._addError(msg)
            return null_outputs()

        except Exception as e:
            msg = f'Unexpected error: {str(e)}'
            self._addError(msg)
            return null_outputs()

        return __Results
# ---------- end fetchoriginalgeometry ----------
panel_23 = Panel(fetchoriginalgeometry.SnapshotID)
panel_24 = Panel(fetchoriginalgeometry.GeometrySource)
geometry_9 = Data(fetchoriginalgeometry.GeometryData)

# ----
# comments & notes: Get ComponentData from Geometry UserData
geometry_10 = Data(geometry_9)
getcomponentpassport_2 = GetComponentPassport(Geometry=geometry_10)  # -> ComponentPassport; inputs Geometry: list of GeometryBase; same code as getcomponentpassport
componentpassport_43 = Data(getcomponentpassport_2)
