# Grasshopper definition DDU_CSC_GrasshopperInterface_Example_01.gh (Grasshopper 1.0.8)

# ---- group: __DDU_CSC_EXAMPLE_01__
# Example 01:
# - Fetching Components
# - Arranging Components / Applying Transformations
# - Diassemble Components
# __DEVELOPMENT_CREDITS__: Authors: Max Benjamin Eschenbach
# Constributors: Alessandro Garruto
# 
# Digital Design Unit (DDU)
# Prof. Dr.-Ing. Oliver Tessmann
# Fachbereich Architektur
# Technical University of Darmstadt
# 
# CREDITS:
# ------------
# Please see: https://ddu.uber.space/credits
# Step 1
# comments & notes: Create new Session and sign in
# 
# (Add the CSC_Session component, connect the wires and add your credentials!)
ddu_csc_username = Panel("")
disablecache = BooleanToggle(False)
clearcache = Button()
refresh = Button()
image = ImageSampler(Filter="Colour", Interpolate=False, Umax=1, Umin=0, Vmax=1, Vmin=0, Wrap=1)

# comments & notes: Fetch a subset of components from the database using filters. Here we are fetching the 'spa_example_data' dataset.
# 
# NOTE: ReservedStatus = -1 means we ignore reservations entirely
# Step 2
fragment = ValueList({"Any": , "Only fragments": True, "Only non-fragmnents": False}, selected="Any")
mindimensionx = Slider(0, range=-0.1..2000)
maxdimensiony = Slider(0, range=0..2000)
maxdimensionx = Slider(0, range=0..2000)
maxdimensionz = Slider(0, range=0..500)
mindimensiony = Slider(0, range=0..2000)
mindimensionz = Slider(0, range=0..500)
reservedstatus = Slider(-1, range=-1..1)
complexity = ValueList({"Any complexity": , "0", "1", "2", "3"}, selected="Any complexity")
dataset = Panel("spa_example_data")
material = ValueList({"Any material": , "corian", "concrete", "timber", "aluminium", "steel"}, selected="Any material")
type = ValueList({"All types": , "sheet", "rubble", "beam", "column", "profile"}, selected="All types")
fetchfilteredcomponents = FetchFilteredComponents(
    Type=type,
    Material=material,
    Dataset=dataset,
    Complexity=complexity,
    Fragment=fragment,
    MinDimensionX=mindimensionx,
    MaxDimensionX=maxdimensionx,
    MinDimensionY=mindimensiony,
    MaxDimensionY=maxdimensiony,
    MinDimensionZ=mindimensionz,
    MaxDimensionZ=maxdimensionz,
    ReservedStatus=reservedstatus)  # -> FilterDescription, ComponentData; inputs Type: String, Material: String, Dataset: String, Complexity: Int32, Fragment: Boolean, MinDimensionX: Double, MaxDimensionX: Double, MinDimensionY: Double, MaxDimensionY: Double, MinDimensionZ: Double, MaxDimensionZ: Double
# ---------- fetchfilteredcomponents: Python ----------
# -*- coding: utf-8 -*-
#! python3
# venv: DDU_CSC
print('ENV OK!')
# r: charset_normalizer
# r: requests
# r: numpy
# r: scipy
# r: scikit-learn
# r: robust-laplacian
# r: potpourri3d

# PYTHON STANDARD LIBRARY IMPORTS ---------------------------------------------
import json

# THIRD PARTY LIBRARY IMPORTS -------------------------------------------------
import requests

# RHINO AND GH RELATED IMPORTS ------------------------------------------------
import System  # type: ignore[reportMissingImport] # NOQA
import Grasshopper  # type: ignore[reportMissingImport] # NOQA
import Rhino  # type: ignore[reportMissingImport] # NOQA
import scriptcontext as sc  # type: ignore[reportMissingImport] # NOQA

# GHENV COMPONENT SETTINGS ----------------------------------------------------
ghenv.Component.Name = 'FetchFilteredComponents'  # type: ignore[reportUnedfinedVariable] # NOQA
ghenv.Component.NickName = 'FetchFilteredComponents'  # type: ignore[reportUnedfinedVariable] # NOQA
ghenv.Component.Category = 'DDU_CSC'  # type: ignore[reportUnedfinedVariable] # NOQA
ghenv.Component.SubCategory = '2 Catalogue Interface'  # type: ignore[reportUnedfinedVariable] # NOQA
ghenv.Component.Description = (  # type: ignore[reportUnedfinedVariable] # NOQA
    'Fetches components from the remote catalogue based on filter criteria '
    '(type, material, dataset, complexity, dimensions, reservation status). '
    'Builds query parameters and returns filtered results.'
)


class CSC_FetchFilteredComponents(Grasshopper.Kernel.GH_ScriptInstance):
    """
    Author: Max Benjamin Eschenbach
    License: MIT License
    Version: 251030
    """

    def __init__(self):
        """Initialize this component and set component parameters."""
        super().__init__()
        # initialize props
        self.Component = ghenv.Component  # type: ignore[reportUnedfinedVariable] # NOQA
        self.InputParams = self.Component.Params.Input
        self.OutputParams = self.Component.Params.Output

    def _addRemark(self, msg: str = ''):
        """Add a remark message to the component."""
        rml = self.Component.RuntimeMessageLevel.Remark
        self.AddRuntimeMessage(rml, msg)

    def _addWarning(self, msg: str = ''):
        """Add a warning message to the component."""
        rml = self.Component.RuntimeMessageLevel.Warning
        self.AddRuntimeMessage(rml, msg)

    def _addError(self, msg: str = ''):
        """Add an error message to the component."""
        rml = self.Component.RuntimeMessageLevel.Error
        self.AddRuntimeMessage(rml, msg)
    
    def BeforeRunScript(self):
        """Perform some setup actions."""
        # Initialize input param descriptions
        self.InputParams[0].Description = (
            'Component type filter (e.g., "beam", "slab", "column")'
        )
        self.InputParams[1].Description = (
            'Material type filter (e.g., "concrete", "steel", "wood")'
        )
        self.InputParams[2].Description = (
            'Dataset name filter (e.g., "sas_cita_scans", '
            '"mineral_composite_sheets")'
        )
        self.InputParams[3].Description = (
            'Complexity level filter (0-3, where 0=simple, 3=complex)'
        )
        self.InputParams[4].Description = (
            'Fragment status filter (True for fragments, False for complete)'
        )
        self.InputParams[5].Description = (
            'Minimum X dimension filter (bounding box)'
        )
        self.InputParams[6].Description = (
            'Maximum X dimension filter (bounding box)'
        )
        self.InputParams[7].Description = (
            'Minimum Y dimension filter (bounding box)'
        )
        self.InputParams[8].Description = (
            'Maximum Y dimension filter (bounding box)'
        )
        self.InputParams[9].Description = (
            'Minimum Z dimension filter (bounding box)'
        )
        self.InputParams[10].Description = (
            'Maximum Z dimension filter (bounding box)'
        )
        self.InputParams[11].Description = (
            'Reservation status filter: -1=ignore, 0=not reserved, '
            '1=reserved by current user'
        )
        # Initialize output param descriptions
        i = 0
        if self.OutputParams[0].Name == 'out':
            i += 1
        self.OutputParams[0+i].Description = (
            'Human-readable description of the applied filters and query'
        )
        self.OutputParams[1+i].Description = (
            'The ComponentData that was fetched from the server as JSON. '
            'Use \'DisassembleComponent\' to access the individual fields '
            'ready for Grasshopper')

    def get_auth_core_from_sticky(self):
        """Get AuthCore instance from sticky storage."""
        auth_core = sc.sticky.get('CSC_AuthCore')
        if auth_core is None:
            msg = ('No authentication found. Please use CSC_Session component '
                   'first.')
            self._addError(msg)
            self.Component.Message = msg
            return None
        return auth_core

    def build_filter_query_params(
            self,
            Type,
            Material,
            Dataset,
            Complexity,
            Fragment,
            MinDimensionX,
            MaxDimensionX,
            MinDimensionY,
            MaxDimensionY,
            MinDimensionZ,
            MaxDimensionZ,
            ReservedStatus):
        """Build query parameters for filtering components."""
        params = {}

        # Add type filter if provided
        if Type and len(Type) > 0:
            # Take the first type if multiple are provided
            type_value = Type[0] if isinstance(Type, list) else str(Type)
            if type_value and type_value.strip():
                params['comptype'] = type_value.strip()

        # Add material filter if provided
        if Material and Material.strip():
            params['material'] = Material.strip()

        # Add dataset filter if provided
        if Dataset and Dataset.strip():
            params['dataset'] = Dataset.strip()

        # Add complexity filter if provided
        if Complexity is not None:
            params['complexity'] = Complexity

        # Add fragment filter if provided
        if Fragment is not None:
            params['fragment'] = Fragment

        # Add reservation status filter if provided
        if ReservedStatus is not None and ReservedStatus != -1:
            if ReservedStatus == 0:
                # Fetch components that are not reserved by anyone
                params['reserved'] = 'false'
            elif ReservedStatus == 1:
                # Fetch components reserved by current user
                params['reserved'] = 'true'

        # Add bounding box filters if provided
        if MinDimensionX is not None and MinDimensionX != 0.0:
            params['bbx_min_x'] = MinDimensionX
        if MaxDimensionX is not None and MaxDimensionX != 0.0:
            params['bbx_max_x'] = MaxDimensionX
        if MinDimensionY is not None and MinDimensionY != 0.0:
            params['bbx_min_y'] = MinDimensionY
        if MaxDimensionY is not None and MaxDimensionY != 0.0:
            params['bbx_max_y'] = MaxDimensionY
        if MinDimensionZ is not None and MinDimensionZ != 0.0:
            params['bbx_min_z'] = MinDimensionZ
        if MaxDimensionZ is not None and MaxDimensionZ != 0.0:
            params['bbx_max_z'] = MaxDimensionZ

        return params

    def generate_filter_description(self, filter_params: dict) -> str:
        """Generates a human-readable description of the applied filters."""
        description = []
        if filter_params.get('comptype'):
            description.append(f'\nType: {filter_params["comptype"]}')
        if filter_params.get('material'):
            description.append(f'\nMaterial: {filter_params["material"]}')
        if filter_params.get('dataset'):
            description.append(f'\nDataset: {filter_params["dataset"]}')
        if filter_params.get('complexity') is not None:
            description.append(f'\nComplexity: {filter_params["complexity"]}')
        if filter_params.get('fragment') is not None:
            description.append(f'\nFragment: {filter_params["fragment"]}')

        # Add reservation status filter description
        if filter_params.get('reserved') == 'false':
            description.append('\nReservation: Not reserved by anyone')
        elif filter_params.get('reserved') == 'true':
            description.append('\nReservation: Reserved by current user')

        # Handle bounding box filters with detailed information
        bbx_filters = []
        if filter_params.get('bbx_min_x') is not None:
            bbx_filters.append(f'\nX >= {filter_params["bbx_min_x"]:.2f}')
        if filter_params.get('bbx_max_x') is not None:
            bbx_filters.append(f'\nX <= {filter_params["bbx_max_x"]:.2f}')
        if filter_params.get('bbx_min_y') is not None:
            bbx_filters.append(f'\nY >= {filter_params["bbx_min_y"]:.2f}')
        if filter_params.get('bbx_max_y') is not None:
            bbx_filters.append(f'\nY <= {filter_params["bbx_max_y"]:.2f}')
        if filter_params.get('bbx_min_z') is not None:
            bbx_filters.append(f'\nZ >= {filter_params["bbx_min_z"]:.2f}')
        if filter_params.get('bbx_max_z') is not None:
            bbx_filters.append(f'\nZ <= {filter_params["bbx_max_z"]:.2f}')

        if bbx_filters:
            description.append(f'\nBounding Box: {", ".join(bbx_filters)}')

        return f'Applied filters: {", ".join(description)}'

    def RunScript(self,
            Type: str,
            Material: str,
            Dataset: str,
            Complexity: int,
            Fragment: bool,
            MinDimensionX: float,
            MaxDimensionX: float,
            MinDimensionY: float,
            MaxDimensionY: float,
            MinDimensionZ: float,
            MaxDimensionZ: float,
            ReservedStatus):

        # Get AuthCore instance from sticky storage
        auth_core = self.get_auth_core_from_sticky()
        if auth_core is None:
            return

        # Check if authentication is valid
        if not auth_core.is_valid():
            msg = ('Authentication expired. Please use CSC_Session '
                   'component to refresh.')
            self._addError(msg)
            self.Component.Message = msg
            return

        try:
            self.Component.Message = 'Building filter query...'

            # Build filter query parameters
            filter_params = self.build_filter_query_params(
                Type, Material, Dataset, Complexity, Fragment,
                MinDimensionX, MaxDimensionX, MinDimensionY,
                MaxDimensionY, MinDimensionZ, MaxDimensionZ,
                ReservedStatus
            )

            # Build the query string
            query_string = '&'.join([
                f'{k}={v}' for k, v in filter_params.items()
            ])
            endpoint = '/components'
            if query_string:
                endpoint += f'?{query_string}'

            # Generate human-readable filter description
            filter_description = self.generate_filter_description(
                filter_params
            )

            self.Component.Message = (
                'Fetching filtered components (with cache)...'
            )

            # Create cache key based on filter parameters
            cache_key = (f'filtered:{query_string}' if query_string
                         else 'filtered:all')
            # Make cached request to fetch filtered components
            response = auth_core.cached_get(endpoint, cache_key, filter_params)

            if response.status_code == 200:
                # Successfully fetched components
                json_comps = response.json()
                component_count = len(json_comps)

                # Show filter info in message
                filter_msg = f'Found {component_count} components (cached).'

                self.Component.Message = filter_msg
                self._addRemark(
                    f'Successfully fetched {component_count} components '
                    f'with applied filters'
                )

                # Set up output trees and results tuple
                FilterDescription = Grasshopper.DataTree[System.Object]()
                ComponentData = Grasshopper.DataTree[System.Object]()
                __Results = (FilterDescription, ComponentData)

                # Loop over all components and add them to the data tree
                for i, json_comp in enumerate(json_comps):
                    # Create datatree path
                    ghp = Grasshopper.Kernel.Data.GH_Path(0, i)
                    # Add component data to the datatree
                    ComponentData.Add(json.dumps(json_comp), ghp)

                # Add filter description to the filter query output
                FilterDescription.Add(
                    filter_description,
                    Grasshopper.Kernel.Data.GH_Path(0)
                )

                return __Results

            elif response.status_code == 401:
                msg = 'Authentication failed. Please sign in again.'
                self._addError(msg)
                self.Component.Message = msg

            elif response.status_code == 403:
                msg = 'Access denied. Insufficient permissions.'
                self._addError(msg)
                self.Component.Message = msg

            elif response.status_code == 500:
                msg = 'Server error. Please try again later.'
                self._addWarning(msg)
                self.Component.Message = msg

            else:
                msg = (f'Request failed with status code: '
                       f'{response.status_code}')
                self._addError(msg)
                self.Component.Message = msg

        except requests.exceptions.ConnectionError as e:
            msg = 'Cannot connect to server. Please check your connection.'
            self._addError(msg + f'\nFull Error: {str(e)}')
            self.Component.Message = msg

        except requests.exceptions.Timeout as e:
            msg = 'Request timeout. Server may be slow.'
            self._addError(msg + f'\nFull Error: {str(e)}')
            self.Component.Message = msg

        except requests.exceptions.RequestException as e:
            msg = f'Request error: {str(e)}'
            self._addError(msg)
            self.Component.Message = msg

        except Exception as e:
            msg = f'Unexpected error: {str(e)}'
            self._addError(msg)
            self.Component.Message = msg

        # Return empty results if there was an error
        ComponentData = Grasshopper.DataTree[System.Object]()
        FilterDescription = Grasshopper.DataTree[System.Object]()
        __Results = (FilterDescription, ComponentData)
        return __Results
# ---------- end fetchfilteredcomponents ----------
panel = Panel(fetchfilteredcomponents.FilterDescription)
componentdata = Data(fetchfilteredcomponents.ComponentData)

# comments & notes: We create a grid to display the components in an ordered fashion. This creates the grid based on the component bounding boxes.
# 
# NOTE: The component does NOT transform the components, it only puts out the tranformation to be applied.
# Step 3
spacing = Slider(150, range=0..1000)
componentdata_2 = Data(componentdata)
insertionpoint = Point(Point(0, 0, 0))
arrangecomponents = ArrangeComponents(ComponentData=componentdata_2, Spacing=spacing, InsertionPoint=insertionpoint)  # -> GridCells, GridPlanes, XForms; inputs ComponentData: tree
# ---------- arrangecomponents: Python ----------
# -*- coding: utf-8 -*-
# ! python3
# venv: DDU_CSC
print('ENV OK!')
# r: charset_normalizer
# r: requests
# r: numpy
# r: scipy
# r: scikit-learn
# r: robust-laplacian
# r: potpourri3d

# PYTHON STANDARD LIBRARY IMPORTS ---------------------------------------------
import json
import math

# RHINO AND GH RELATED IMPORTS ------------------------------------------------
import System  # type: ignore[reportMissingImport] # NOQA
import Rhino  # type: ignore[reportMissingImport] # NOQA
import Grasshopper  # type: ignore[reportMissingImport] # NOQA

# GHENV COMPONENT SETTINGS ----------------------------------------------------
ghenv.Component.Name = 'ArrangeComponents'  # type: ignore[reportUnedfinedVariable] # NOQA
ghenv.Component.NickName = 'ArrangeComponents'  # type: ignore[reportUnedfinedVariable] # NOQA
ghenv.Component.Category = 'DDU_CSC'  # type: ignore[reportUnedfinedVariable] # NOQA
ghenv.Component.SubCategory = '3 Component Operations'  # type: ignore[reportUnedfinedVariable] # NOQA
ghenv.Component.Description = (  # type: ignore[reportUnedfinedVariable] # NOQA
    'Arranges components in an even square grid based on their bounding '
    'boxes. Calculates grid cell size from the largest component dimension.'
)


class CSC_ArrangeComponents(Grasshopper.Kernel.GH_ScriptInstance):
    """
    Author: Max Benjamin Eschenbach
    License: MIT License
    Version: 251027
    """

    def __init__(self):
        """Initialize this component and set component parameters."""
        super().__init__()
        # initialize props
        self.Component = ghenv.Component  # type: ignore[reportUnedfinedVariable] # NOQA
        self.InputParams = self.Component.Params.Input
        self.OutputParams = self.Component.Params.Output

    def _addRemark(self, msg: str = ''):
        """Add a remark message to the component."""
        rml = self.Component.RuntimeMessageLevel.Remark
        self.AddRuntimeMessage(rml, msg)

    def _addWarning(self, msg: str = ''):
        """Add a warning message to the component."""
        rml = self.Component.RuntimeMessageLevel.Warning
        self.AddRuntimeMessage(rml, msg)

    def _addError(self, msg: str = ''):
        """Add an error message to the component."""
        rml = self.Component.RuntimeMessageLevel.Error
        self.AddRuntimeMessage(rml, msg)

    def BeforeRunScript(self):
        """Perform some setup actions."""
        # Initialize input param descriptions
        self.InputParams[0].Description = (
            'Component data as JSON strings'
        )
        self.InputParams[1].Description = (
            'Additional spacing between grid cells'
        )
        self.InputParams[2].Description = (
            'Insertion point (starting corner of grid)'
        )
        # Initialize output param descriptions
        i = 0
        if self.OutputParams[0].Name == 'out':
            i += 1
        self.OutputParams[0+i].Description = (
            'Grid cell outlines as polylines'
        )
        self.OutputParams[1+i].Description = (
            'XY planes at center of each grid cell'
        )
        self.OutputParams[2+i].Description = (
            'Transformations from world origin to grid cell planes'
        )

    def extract_bounding_box_dimensions(self, component_data: str):
        """
        Extract bounding box dimensions from component JSON.

        Args:
            component_data: Component data as JSON string

        Returns:
            Tuple of (xtx, xty, xtz) dimensions or None
        """
        try:
            json_comp = json.loads(component_data)
            bbx = json_comp.get('bbx', None)
            if bbx and len(bbx) >= 3:
                return bbx[0], bbx[1], bbx[2]
            return None
        except (json.JSONDecodeError, KeyError,
                TypeError):
            return None

    def calculate_grid_size(self, count: int):
        """
        Calculate grid dimensions for a square grid.

        Returns:
            Tuple of (grid_size_x, grid_size_y, cells_needed)
        """
        grid_size = int(math.ceil(math.sqrt(count)))
        cells_needed = grid_size * grid_size
        return grid_size, grid_size, cells_needed

    def create_grid_cell_polyline(
            self, cell_size: float,
            center_point: Rhino.Geometry.Point3d):
        """
        Create a square cell polyline centered at given point.

        Args:
            cell_size: Size of the grid cell
            center_point: Center point of the cell

        Returns:
            Polyline outlining the cell
        """
        half_size = cell_size * 0.5

        # Create corners relative to center
        x_min = center_point.X - half_size
        x_max = center_point.X + half_size
        y_min = center_point.Y - half_size
        y_max = center_point.Y + half_size
        z = center_point.Z

        corners = [
            Rhino.Geometry.Point3d(x_min, y_min, z),
            Rhino.Geometry.Point3d(x_max, y_min, z),
            Rhino.Geometry.Point3d(x_max, y_max, z),
            Rhino.Geometry.Point3d(x_min, y_max, z),
            Rhino.Geometry.Point3d(x_min, y_min, z)
        ]

        return Rhino.Geometry.Polyline(corners)

    def RunScript(self,
            ComponentData: Grasshopper.DataTree[object],
            Spacing,
            InsertionPoint):

        # Default values for optional parameters
        if Spacing is None:
            Spacing = 100.0
        if InsertionPoint is None:
            InsertionPoint = Rhino.Geometry.Point3d(0.0, 0.0, 0.0)

        # Set up output trees
        GridCells = Grasshopper.DataTree[Rhino.Geometry.Polyline]()
        GridPlanes = Grasshopper.DataTree[Rhino.Geometry.Plane]()
        XForm = Grasshopper.DataTree[Rhino.Geometry.Transform]()

        # Validate input
        if not ComponentData or ComponentData.DataCount == 0:
            msg = 'No component data provided'
            self._addWarning(msg)
            self.Component.Message = msg
            return GridCells, GridPlanes, XForm

        try:
            # Extract bounding box dimensions for all components
            all_dimensions = []
            paths = []
            for i, branch in enumerate(ComponentData.Branches):
                branch_path = ComponentData.Paths[i]
                for comp_data in branch:
                    if comp_data is None:
                        continue
                    dims = self.extract_bounding_box_dimensions(comp_data)
                    if dims:
                        all_dimensions.append(dims)
                        paths.append(branch_path)
            if not all_dimensions:
                msg = 'No valid bounding boxes in component data'
                self._addWarning(msg)
                self.Component.Message = msg
                return GridCells, GridPlanes, XForm
            # Find the largest x and y dimensions to determine grid cell size
            max_x_dim = max(dims[0] for dims in all_dimensions)
            max_y_dim = max(dims[1] for dims in all_dimensions)
            cell_size = max(max_x_dim, max_y_dim) + Spacing
            # Calculate grid layout
            comp_count = len(all_dimensions)
            grid_x, grid_y, cells_needed = self.calculate_grid_size(comp_count)
            # Adjust to fit exact number of components
            arranged_count = min(comp_count, cells_needed)
            # Create grid cells
            for i in range(arranged_count):
                # Calculate grid position (row, col)
                row = i // grid_x
                col = i % grid_x
                # Calculate center point for this cell
                center_x = InsertionPoint.X + col * cell_size + cell_size * 0.5
                center_y = InsertionPoint.Y + row * cell_size + cell_size * 0.5
                cell_center = Rhino.Geometry.Point3d(
                    center_x,
                    center_y,
                    InsertionPoint.Z
                )
                # Create grid cell outline
                grid_cell = self.create_grid_cell_polyline(
                    cell_size, cell_center)
                GridCells.Add(grid_cell, paths[i])
                # Create plane at center of grid cell
                grid_plane = Rhino.Geometry.Plane(
                    cell_center,
                    Rhino.Geometry.Vector3d.XAxis,
                    Rhino.Geometry.Vector3d.YAxis
                )
                GridPlanes.Add(grid_plane, paths[i])

                # Create transform from world origin to grid cell plane
                world_plane = Rhino.Geometry.Plane.WorldXY
                xform = Rhino.Geometry.Transform.PlaneToPlane(
                    world_plane, grid_plane)
                XForm.Add(xform, paths[i])

            # Update component message
            if arranged_count < comp_count:
                self._addWarning(
                    f'Arranged {arranged_count} of {comp_count} components')
            else:
                self._addRemark(
                    f'Arranged {arranged_count} components in '
                    f'{grid_x}x{grid_y} grid')

            return GridCells, GridPlanes, XForm

        except Exception as e:
            msg = f'Error arranging components: {str(e)}'
            self._addError(msg)
            self.Component.Message = msg
            return GridCells, GridPlanes, XForm
# ---------- end arrangecomponents ----------
xform = Data(arrangecomponents.XForms)

# Step 4
# comments & notes: With this component we can apply any transformation (moving, rotating etc.) defined as a XForm (Rhino Transformation) to the components.
# 
# NOTE: This does not alter the components itself, it just tells the system where and how to place them. We do NOT change the catalogue!
componentdata_3 = Data(componentdata)
xform_2 = Data(xform)
transformcomponent = TransformComponent(ComponentData=componentdata_3, XForm=xform_2)  # -> XComponentData; inputs ComponentData: String, XForm: Transform
# ---------- transformcomponent: Python ----------
# -*- coding: utf-8 -*-
#! python3
# venv: DDU_CSC
print('ENV OK!')
# r: charset_normalizer
# r: requests
# r: numpy
# r: scipy
# r: scikit-learn
# r: robust-laplacian
# r: potpourri3d

# PYTHON STANDARD LIBRARY IMPORTS ---------------------------------------------
import json

# RHINO AND GH RELATED IMPORTS ------------------------------------------------
import System  # type: ignore[reportMissingImport] # NOQA
import Rhino  # type: ignore[reportMissingImport] # NOQA
import Grasshopper  # type: ignore[reportMissingImport] # NOQA

# GHENV COMPONENT SETTINGS ----------------------------------------------------
ghenv.Component.Name = 'TransformComponent'  # type: ignore[reportUnedfinedVariable] # NOQA
ghenv.Component.NickName = 'TransformComponent'  # type: ignore[reportUnedfinedVariable] # NOQA
ghenv.Component.Category = 'DDU_CSC'  # type: ignore[reportUnedfinedVariable] # NOQA
ghenv.Component.SubCategory = '3 Component Operations'  # type: ignore[reportUnedfinedVariable] # NOQA
ghenv.Component.Description = (  # type: ignore[reportUnedfinedVariable] # NOQA
    'Applies a Rhino transformation to the iframe (insertion frame) of a '
    'component\'s JSON data. Updates the component\'s coordinate system '
    'based on the applied transformation.'
)


class CSC_TransformComponent(Grasshopper.Kernel.GH_ScriptInstance):
    """
    Author: Max Benjamin Eschenbach
    License: MIT License
    Version: 251023.1
    """

    def __init__(self):
        """Initialize this component and set component parameters."""
        super().__init__()
        # initialize props
        self.Component = ghenv.Component  # type: ignore[reportUnedfinedVariable] # NOQA
        self.InputParams = self.Component.Params.Input
        self.OutputParams = self.Component.Params.Output

    def _addRemark(self, msg: str = ''):
        """Add a remark message to the component."""
        rml = self.Component.RuntimeMessageLevel.Remark
        self.AddRuntimeMessage(rml, msg)

    def _addWarning(self, msg: str = ''):
        """Add a warning message to the component."""
        rml = self.Component.RuntimeMessageLevel.Warning
        self.AddRuntimeMessage(rml, msg)

    def _addError(self, msg: str = ''):
        """Add an error message to the component."""
        rml = self.Component.RuntimeMessageLevel.Error
        self.AddRuntimeMessage(rml, msg)
    
    def BeforeRunScript(self):
        """Perform some setup actions."""
        # Initialize input param descriptions
        self.InputParams[0].Description = (
            'Component data as JSON string from previous components.'
        )
        self.InputParams[1].Description = (
            'Rhino transform to apply to the component insertion frame.'
        )
        # Initialize output param descriptions
        i = 0
        if self.OutputParams[0].Name == 'out':
            i += 1
        self.OutputParams[0+i].Description = (
            'Transformed component data as JSON string!'
        )

    def PlaneToFrameDict(self, plane: Rhino.Geometry.Plane) -> dict:
        """
        Convert a Rhino plane to a frame dictionary format.

        This method converts the plane's origin and axis vectors to the format
        expected by the component system for insertion frames.

        Args:
            plane: Rhino.Geometry.Plane object

        Returns:
            Dictionary with 'o', 'x', 'y', 'z' keys containing coordinate lists
        """
        iframe = {
            'o': [plane.OriginX, plane.OriginY, plane.OriginZ],
            'x': [plane.XAxis.X, plane.XAxis.Y, plane.XAxis.Z],
            'y': [plane.YAxis.X, plane.YAxis.Y, plane.YAxis.Z],
            'z': [plane.ZAxis.X, plane.ZAxis.Y, plane.ZAxis.Z]
        }
        return iframe

    def RunScript(self, ComponentData: str, XForm: Rhino.Geometry.Transform):
        # set up output trees and results tuple
        XComponentData = System.Collections.Generic.List[System.Object]()

        # Validate input parameters
        if not ComponentData:
            msg = 'Input ComponentData failed to collect data!'
            self._addWarning(msg)
            self.Component.Message = msg
            return XComponentData

        if not XForm:
            msg = 'Input XForm failed to collect data!'
            self._addWarning(msg)
            self.Component.Message = msg
            return XComponentData

        try:
            # Load and parse component JSON data
            jcomp = json.loads(ComponentData)

            # Process insertion frame
            try:
                # Try to extract existing insertion frame from component
                iframe = jcomp['iframe']
                iplane = Rhino.Geometry.Plane(
                    Rhino.Geometry.Point3d(*iframe['o']),
                    Rhino.Geometry.Vector3d(*iframe['x']),
                    Rhino.Geometry.Vector3d(*iframe['y']),
                )
                self._addRemark(
                    'Using existing insertion frame from component'
                )
            except KeyError:
                # If there is no insertion frame,
                # create world XY plane as default
                iplane = Rhino.Geometry.Plane.WorldXY
                self._addRemark(
                    'No insertion frame found, using WorldXY plane'
                )

            # Apply the input transform to the insertion frame plane
            iplane.Transform(XForm)

            # Replace the insertion frame in the component data
            # with the transformed one
            jcomp['iframe'] = self.PlaneToFrameDict(iplane)

            # Convert back to JSON string for output
            XComponentData = json.dumps(jcomp)

            return XComponentData

        except json.JSONDecodeError as e:
            msg = f'Failed to parse component JSON data: {str(e)}'
            self._addError(msg)
            self.Component.Message = msg
            return XComponentData

        except Exception as e:
            msg = f'Unexpected error during transformation: {str(e)}'
            self._addError(msg)
            self.Component.Message = msg
            return XComponentData
# ---------- end transformcomponent ----------
componentdata_4 = Data(transformcomponent)

# Step 5
# comments & notes: To view all data about the components, we can use DisassembleComponent. This also gives us the Primitive Geometry representation.
componentdata_5 = Data(componentdata_4)
disassemblecomponent = DisassembleComponent(ComponentData=componentdata_5)  # -> ID, Type, Material, Color, Location, BoundingBox, PCAFrame, Descriptors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; inputs ComponentData: tree of String
# ---------- disassemblecomponent: Python ----------
# -*- coding: utf-8 -*-
#! python3
# venv: DDU_CSC
print('ENV OK!')
# r: charset_normalizer
# r: requests
# r: numpy
# r: scipy
# r: scikit-learn
# r: robust-laplacian
# r: potpourri3d

# PYTHON STANDARD LIBRARY IMPORTS ---------------------------------------------
import json

# RHINO AND GH RELATED IMPORTS ------------------------------------------------
import System  # type: ignore[reportMissingImport] # NOQA
import Rhino  # type: ignore[reportMissingImport] # NOQA
import Grasshopper  # type: ignore[reportMissingImport] # NOQA

# GHENV COMPONENT SETTINGS ----------------------------------------------------
ghenv.Component.Name = 'DisassembleComponent'  # type: ignore[reportUnedfinedVariable] # NOQA
ghenv.Component.NickName = 'DisassembleComponent'  # type: ignore[reportUnedfinedVariable] # NOQA
ghenv.Component.Category = 'DDU_CSC'  # type: ignore[reportUnedfinedVariable] # NOQA
ghenv.Component.SubCategory = '3 Component Operations'  # type: ignore[reportUnedfinedVariable] # NOQA
ghenv.Component.Description = (  # type: ignore[reportUnedfinedVariable] # NOQA
    'Parses component data (JSON) and outputs individual fields as '
    'Grasshopper-native types. Reconstructs geometry, bounding boxes, '
    'PCA frames, and metadata from component JSON.'
)


class CSC_DisassembleComponent(Grasshopper.Kernel.GH_ScriptInstance):
    """
    Author: Max Benjamin Eschenbach
    License: MIT License
    Version: 251023.1
    """

    def __init__(self):
        """Initialize this component and set component parameters."""
        super().__init__()
        # initialize props
        self.Component = ghenv.Component  # type: ignore[reportUnedfinedVariable] # NOQA
        self.InputParams = self.Component.Params.Input
        self.OutputParams = self.Component.Params.Output

    def _addRemark(self, msg: str = ''):
        """Add a remark message to the component."""
        rml = self.Component.RuntimeMessageLevel.Remark
        self.AddRuntimeMessage(rml, msg)

    def _addWarning(self, msg: str = ''):
        """Add a warning message to the component."""
        rml = self.Component.RuntimeMessageLevel.Warning
        self.AddRuntimeMessage(rml, msg)

    def _addError(self, msg: str = ''):
        """Add an error message to the component."""
        rml = self.Component.RuntimeMessageLevel.Error
        self.AddRuntimeMessage(rml, msg)
    
    def BeforeRunScript(self):
        """Perform some setup actions."""
        # Initialize input param descriptions
        self.InputParams[0].Description = (
            'The ComponentData that was fetched from the server as JSON.'
        )
        # Initialize output param descriptions
        i = 0
        if self.OutputParams[0].Name == 'out':
            i += 1
        self.OutputParams[0+i].Description = (
            'Component ID (GUID)'
        )
        self.OutputParams[1+i].Description = (
            'Component type (sheet, beam, slab, etc.)'
        )
        self.OutputParams[2+i].Description = (
            'Component material'
        )
        self.OutputParams[3+i].Description = (
            'Component color as System.Drawing.Color'
        )
        self.OutputParams[4+i].Description = (
            'Component location as Point3d (X=latitude, Y=longitude, Z=0)'
        )
        self.OutputParams[5+i].Description = (
            'Component bounding box as Rhino.Geometry.BoundingBox'
        )
        self.OutputParams[6+i].Description = (
            'PCA frame at world origin as Rhino.Geometry.Plane'
        )
        self.OutputParams[7+i].Description = (
            'Component descriptors/metadata as JSON string'
        )
        self.OutputParams[8+i].Description = (
            'Rhino geometry objects (extrusion, mesh, multiple meshes, '
            'polyline)'
        )
        self.OutputParams[9+i].Description = (
            'Marker points as list of Point3d objects'
        )
        self.OutputParams[10+i].Description = (
            'Component attributes as JSON string'
        )

    def ComponentExtrusionProfile(
            self,
            json_comp: dict) -> Rhino.Geometry.Polyline:
        pl = Rhino.Geometry.Polyline()
        pts = [Rhino.Geometry.Point3d(pt[0], pt[1], 0.0)
               for pt in json_comp['geometry']['extrusion']['profile']]
        pl.AddRange(pts)
        return pl

    def ComponentExtrusion(
            self,
            json_comp: dict) -> Rhino.Geometry.Extrusion:
        pl = Rhino.Geometry.Polyline()
        pts = [Rhino.Geometry.Point3d(pt[0], pt[1], 0.0)
               for pt in json_comp['geometry']['extrusion']['profile']]
        pl.AddRange(pts)
        cxt = Rhino.Geometry.Extrusion.Create(
            pl.ToPolylineCurve(),
            Rhino.Geometry.Plane.WorldXY,
            json_comp['geometry']['extrusion']['height'],
            True)
        # move extrusion downwards half material
        # thickness to center it at the origin
        cxt.Translate(Rhino.Geometry.Vector3d(
            0, 0, json_comp['geometry']['extrusion']['height'] * -0.5))
        return cxt

    def ComponentMeshes(self, json_comp: dict) -> list[Rhino.Geometry.Mesh]:
        """Create multiple meshes from geometry.meshes field."""
        meshes = []
        for i, mesh_data in enumerate(json_comp['geometry']['meshes']):
            mesh = Rhino.Geometry.Mesh()
            vl = mesh_data['v']
            fl = mesh_data['f']
            [mesh.Vertices.Add(*v) for v in vl]
            [mesh.Faces.AddFace(*f) for f in fl]
            # Try to get mesh-specific colors first
            try:
                cl = mesh_data['c']
                [mesh.VertexColors.Add(
                    System.Drawing.Color.FromArgb(*c)) for c in cl]
            except KeyError:
                # Fallback: use component color for all vertices
                try:
                    component_color = System.Drawing.Color.FromArgb(
                        255, *json_comp['color'])
                    for _ in range(len(vl)):
                        mesh.VertexColors.Add(component_color)
                except (KeyError, TypeError):
                    # If even component color fails, use a default gray
                    default_color = System.Drawing.Color.Gray
                    for _ in range(len(vl)):
                        mesh.VertexColors.Add(default_color)
                    self._addWarning(
                        f'Mesh {i} in component {json_comp["_id"]} '
                        f'using default gray color')
            mesh.RebuildNormals()
            mesh.UnifyNormals()
            mesh.Compact()
            meshes.append(mesh)
        return meshes

    def ComponentColor(self, json_comp: dict) -> System.Drawing.Color:
        return System.Drawing.Color.FromArgb(255, *json_comp['color'])

    def ComponentBoundingBox(
            self,
            json_comp: dict) -> Rhino.Geometry.BoundingBox:
        xtx = json_comp['bbx'][0]
        xty = json_comp['bbx'][1]
        xtz = json_comp['bbx'][2]

        # Get bbx_origin (center of bounding box in PCA space)
        bbx_origin = json_comp.get('bbx_origin', [0.0, 0.0, 0.0])

        # Create bounding box at bbx_origin in PCA space
        bbx = Rhino.Geometry.BoundingBox(
            bbx_origin[0] - xtx * 0.5,
            bbx_origin[1] - xty * 0.5,
            bbx_origin[2] - xtz * 0.5,
            bbx_origin[0] + xtx * 0.5,
            bbx_origin[1] + xty * 0.5,
            bbx_origin[2] + xtz * 0.5
        )

        # Convert bounding box to Box for transformation
        bbx = Rhino.Geometry.Box(bbx)

        # Transform from PCA space back to original component space
        try:
            pca_frame = json_comp.get('pca_frame', {})
            if pca_frame:
                # Create PCA frame plane at world origin
                pca_origin = Rhino.Geometry.Point3d(
                    *pca_frame.get('o', [0, 0, 0]))
                pca_x = Rhino.Geometry.Vector3d(
                    *pca_frame.get('x', [1, 0, 0]))
                pca_y = Rhino.Geometry.Vector3d(
                    *pca_frame.get('y', [0, 1, 0]))

                pca_plane = Rhino.Geometry.Plane(pca_origin, pca_x, pca_y)

                # Create forward transform (from PCA space to original space)
                pca_transform = (
                    Rhino.Geometry.Transform.PlaneToPlane(
                        Rhino.Geometry.Plane.WorldXY, pca_plane))

                bbx.Transform(pca_transform)

        except (KeyError, TypeError, ValueError) as e:
            # If PCA frame is missing or invalid, use bounding box as-is
            self._addWarning(f'Could not apply PCA frame transform: {str(e)}')

        return bbx

    def ComponentPCAPlane(self, json_comp: dict) -> Rhino.Geometry.Plane:
        """Get PCA plane at world origin from component data."""
        try:
            pca_frame = json_comp.get('pca_frame', {})
            if pca_frame:
                pca_x = Rhino.Geometry.Vector3d(
                    *pca_frame.get('x', [1, 0, 0]))
                pca_y = Rhino.Geometry.Vector3d(
                    *pca_frame.get('y', [0, 1, 0]))
                return Rhino.Geometry.Plane(
                    Rhino.Geometry.Point3d.Origin, pca_x, pca_y)
            else:
                return Rhino.Geometry.Plane.WorldXY
        except (KeyError, TypeError, ValueError):
            return Rhino.Geometry.Plane.WorldXY

    def RunScript(self, ComponentData: Grasshopper.DataTree[str]):
        # set up output trees and results tuple
        ID = Grasshopper.DataTree[System.Object]()
        Type = Grasshopper.DataTree[System.Object]()
        Material = Grasshopper.DataTree[System.Object]()
        Color = Grasshopper.DataTree[System.Object]()
        Location = Grasshopper.DataTree[System.Object]()
        BoundingBox = Grasshopper.DataTree[System.Object]()
        PCAFrame = Grasshopper.DataTree[System.Object]()
        Descriptors = Grasshopper.DataTree[System.Object]()
        PrimitiveGeometry = Grasshopper.DataTree[System.Object]()
        MarkerPoints = Grasshopper.DataTree[System.Object]()
        Attributes = Grasshopper.DataTree[System.Object]()
        __Results = (
            ID,
            Type,
            Material,
            Color,
            Location,
            BoundingBox,
            PCAFrame,
            Descriptors,
            PrimitiveGeometry,
            MarkerPoints,
            Attributes)
        try:
            # Validate input
            if not ComponentData or ComponentData.DataCount == 0:
                msg = ('Input ComponentData failed to collect Data')
                self._addWarning(msg)
                self.Component.Message = msg
                return __Results

            self.Component.Message = 'Disassembling components...'

            # loop over all branches
            for i in range(ComponentData.BranchCount):
                for j, comp in enumerate(ComponentData.Branches[i]):
                    try:
                        json_comp = json.loads(comp)
                        # create datatree path
                        ghp = ComponentData.Paths[i]
                        # add directly available metadata to the
                        # respective datatrees
                        ID.Add(json_comp['_id'], ghp)
                        Type.Add(json_comp['type'], ghp)
                        Material.Add(json_comp['material'], ghp)

                        # create system color from rgb values
                        color = self.ComponentColor(json_comp)
                        Color.Add(color, ghp)

                        # process location data
                        try:
                            location_data = json_comp.get('location', {})
                            if (location_data and 'lat' in location_data and
                                    'lon' in location_data):
                                location_point = Rhino.Geometry.Point3d(
                                    location_data['lat'],
                                    location_data['lon'],
                                    0.0
                                )
                            else:
                                location_point = Rhino.Geometry.Point3d(
                                    0.0, 0.0, 0.0)
                        except (KeyError, TypeError):
                            location_point = Rhino.Geometry.Point3d(
                                0.0, 0.0, 0.0)
                        Location.Add(location_point, ghp)

                        # process insertion frame
                        try:
                            iframe = json_comp['iframe']
                            iplane = Rhino.Geometry.Plane(
                                Rhino.Geometry.Point3d(*iframe['o']),
                                Rhino.Geometry.Vector3d(*iframe['x']),
                                Rhino.Geometry.Vector3d(*iframe['y']),
                            )
                        except KeyError:
                            iplane = Rhino.Geometry.Plane.WorldXY

                        xform = Rhino.Geometry.Transform.PlaneToPlane(
                            Rhino.Geometry.Plane.WorldXY,
                            iplane)

                        # treat geometry key in a special way because
                        # it may hold multiple geometry types
                        for key in sorted(json_comp['geometry'].keys()):
                            if key == 'extrusion':
                                xtr = self.ComponentExtrusion(json_comp)
                                # transform to iframe
                                xtr.Transform(xform)
                                # set user string
                                xtr.SetUserString('csc_component', comp)
                                # add to datatree
                                PrimitiveGeometry.Add(xtr, ghp)
                            elif key == 'meshes':
                                # Handle multiple meshes
                                meshes = self.ComponentMeshes(json_comp)
                                for i, mesh in enumerate(meshes):
                                    # transform to iframe
                                    mesh.Transform(xform)
                                    # set user string with mesh index
                                    mesh.SetUserString('csc_component', comp)
                                    mesh.SetUserString('csc_mesh_index',
                                                       str(i))
                                    # add to datatree
                                    PrimitiveGeometry.Add(mesh, ghp)
                            else:
                                msg = (f'Missing implementation for geometry '
                                       f'of type \'{key}\'!')
                                self._addWarning(msg)

                        # construct boundingbox
                        bbx = self.ComponentBoundingBox(json_comp)

                        # apply iframe transform
                        bbx.Transform(xform)
                        BoundingBox.Add(bbx, ghp)

                        # get PCA plane at world origin
                        pca_plane = self.ComponentPCAPlane(json_comp)
                        # apply iframe transform to PCA plane
                        pca_plane.Transform(xform)
                        PCAFrame.Add(pca_plane, ghp)

                        # add descriptors
                        try:
                            descriptors = json_comp.get('descriptors', {})
                            Descriptors.Add(json.dumps(descriptors), ghp)
                        except KeyError:
                            # If no descriptors, add empty dict as JSON string
                            Descriptors.Add(json.dumps({}), ghp)

                        # process marker points
                        try:
                            marker_points_data = json_comp.get(
                                'marker_points', [])
                            marker_points_list = []
                            for point_data in marker_points_data:
                                if (isinstance(point_data, list) and
                                        len(point_data) >= 3):
                                    marker_point = Rhino.Geometry.Point3d(
                                        point_data[0],
                                        point_data[1],
                                        point_data[2]
                                    )
                                    # apply iframe transform to marker point
                                    marker_point.Transform(xform)
                                    marker_points_list.append(marker_point)
                        except (KeyError, TypeError, IndexError):
                            # If no marker points or invalid format, add empty
                            # list
                            marker_points_list = []
                        if marker_points_list:
                            MarkerPoints.AddRange(marker_points_list, ghp)

                        # process attributes
                        try:
                            attributes = json_comp.get('attributes', {})
                            Attributes.Add(json.dumps(attributes), ghp)
                        except KeyError:
                            # If no attributes, add empty dict as JSON string
                            Attributes.Add(json.dumps({}), ghp)

                    except json.JSONDecodeError as e:
                        msg = f'Failed to parse component data: {str(e)}'
                        self._addError(msg)
                    except Exception as e:
                        msg = f'Error processing component: {str(e)}'
                        self._addError(msg)

            # Update success message
            total_components = sum(
                len(branch) for branch in ComponentData.Branches
            )
            self.Component.Message = (
                f'Disassembled {total_components} component(s)'
            )
            self._addRemark(
                f'Successfully disassembled {total_components} components'
            )

            # return output trees
            return __Results

        except Exception as e:
            msg = f'Unexpected error during disassembly: {str(e)}'
            self._addError(msg)
            return __Results
# ---------- end disassemblecomponent ----------
primitivegeometry = Data(disassemblecomponent.PrimitiveGeometry)
boundingbox = Data(disassemblecomponent.BoundingBox)
markerpoints = Data(disassemblecomponent.MarkerPoints)
descriptors = Data(disassemblecomponent.Descriptors)
pcaframe = Data(disassemblecomponent.PCAFrame)
attributes = Data(disassemblecomponent.Attributes)
location = Data(disassemblecomponent.Location)
material_2 = Data(disassemblecomponent.Material)
type_2 = Data(disassemblecomponent.Type)
color = Data(disassemblecomponent.Color)
id = Data(disassemblecomponent.ID)
