# Grasshopper definition DDU_CSC_GrasshopperInterface_Example_03.gh (Grasshopper 1.0.8)

# ---- group: __DDU_CSC_EXAMPLE_03__
# __DEVELOPMENT_CREDITS__: Authors: Max Benjamin Eschenbach
# Constributors: Alessandro Garruto
# 
# Digital Design Unit (DDU)
# Prof. Dr.-Ing. Oliver Tessmann
# Fachbereich Architektur
# Technical University of Darmstadt
# 
# CREDITS:
# ------------
# Please see: https://ddu.uber.space/credits
# Example 03:
# - Fetching single components
# - Baking components
# - Sync components back to GH doc
# - Diassemble components
# Step 1
# comments & notes: Create new Session and sign in
# 
# (Add the CSC_Session component, connect the wires and add your credentials!)
ddu_csc_username = Panel("")
disablecache = BooleanToggle(False)
clearcache = Button()
refresh = Button()
image = ImageSampler(Filter="Colour", Interpolate=False, Umax=1, Umin=0, Vmax=1, Vmin=0, Wrap=1)

# Step 2
# comments & notes: Fetch a single component or multiple components from the catalogue using its ID.
# 
# NOTE: Also see the web interface component detail page. You can copy the ID of any component there directly as a GH-Panel!
componentid = Panel("739d830a-abdf-437d-b505-4e89e5f07759")
fetchcomponents = FetchComponents(ComponentID=componentid)  # -> ComponentData; inputs ComponentID: list of String
# ---------- fetchcomponents: Python ----------
# -*- coding: utf-8 -*-
#! python3
# venv: DDU_CSC
print('ENV OK!')
# r: charset_normalizer
# r: requests
# r: numpy
# r: scipy
# r: scikit-learn
# r: robust-laplacian
# r: potpourri3d

# PYTHON STANDARD LIBRARY IMPORTS ---------------------------------------------
import json

# THIRD PARTY LIBRARY IMPORTS -------------------------------------------------
import requests

# RHINO AND GH RELATED IMPORTS ------------------------------------------------
import System  # type: ignore[reportMissingImport] # NOQA
import Grasshopper  # type: ignore[reportMissingImport] # NOQA
import Rhino  # type: ignore[reportMissingImport] # NOQA
import scriptcontext as sc  # type: ignore[reportMissingImport] # NOQA

# GHENV COMPONENT SETTINGS ----------------------------------------------------
ghenv.Component.Name = 'FetchComponents'  # type: ignore[reportUnedfinedVariable] # NOQA
ghenv.Component.NickName = 'FetchComponents'  # type: ignore[reportUnedfinedVariable] # NOQA
ghenv.Component.Category = 'DDU_CSC'  # type: ignore[reportUnedfinedVariable] # NOQA
ghenv.Component.SubCategory = '2 Catalogue Interface'  # type: ignore[reportUnedfinedVariable] # NOQA
ghenv.Component.Description = (  # type: ignore[reportUnedfinedVariable] # NOQA
    'Fetches specific components from the remote catalogue by their IDs. '
    'Supports caching and handles individual component retrieval with error '
    'handling for missing components.'
)


class CSC_FetchComponents(Grasshopper.Kernel.GH_ScriptInstance):
    """
    Author: Max Benjamin Eschenbach
    License: MIT License
    Version: 251030
    """

    def __init__(self):
        """Initialize this component and set component parameters."""
        super().__init__()
        # initialize props
        self.Component = ghenv.Component  # type: ignore[reportUnedfinedVariable] # NOQA
        self.InputParams = self.Component.Params.Input
        self.OutputParams = self.Component.Params.Output

    def _addRemark(self, msg: str = ''):
        """Add a remark message to the component."""
        rml = self.Component.RuntimeMessageLevel.Remark
        self.AddRuntimeMessage(rml, msg)

    def _addWarning(self, msg: str = ''):
        """Add a warning message to the component."""
        rml = self.Component.RuntimeMessageLevel.Warning
        self.AddRuntimeMessage(rml, msg)

    def _addError(self, msg: str = ''):
        """Add an error message to the component."""
        rml = self.Component.RuntimeMessageLevel.Error
        self.AddRuntimeMessage(rml, msg)
    
    def BeforeRunScript(self):
        """Perform some setup actions."""
        # Initialize input param descriptions
        self.InputParams[0].Description = 'One or many ComponentIDs to fetch'
        # Initialize output param descriptions
        i = 0
        if self.OutputParams[0].Name == 'out':
            i += 1
        self.OutputParams[0+i].Description = (
            'The ComponentData that was fetched from the server as JSON. '
            'Use \'DisassembleComponent\' to access the individual fields '
            'ready for Grasshopper'
        )

    def get_auth_core_from_sticky(self):
        """Get AuthCore instance from sticky storage."""
        auth_core = sc.sticky.get('CSC_AuthCore')
        if auth_core is None:
            msg = ('No authentication found. Please use CSC_Session component '
                   'first.')
            self._addError(msg)
            self.Component.Message = msg
            return None
        return auth_core

    def RunScript(self, ComponentID: list[str]):
        # Get AuthCore instance from sticky storage
        auth_core = self.get_auth_core_from_sticky()
        if auth_core is None:
            return

        # Check if authentication is valid
        if not auth_core.is_valid():
            msg = ('Authentication expired. Please use CSC_Session '
                   'component to refresh.')
            self._addError(msg)
            self.Component.Message = msg
            return

        # Validate ComponentID input
        if not ComponentID:
            msg = 'Please provide ComponentID(s) to fetch.'
            self._addWarning(msg)
            self.Component.Message = msg
            return

        # Convert to list and validate UUIDs
        component_ids = list(ComponentID)
        for _id in component_ids:
            if not auth_core.validate_uuid(_id):
                msg = f'ComponentID <{_id}> is not a valid UUID!'
                self._addWarning(msg)
                self.Component.Message = msg
                return

        try:
            self.Component.Message = (
                f'Fetching {len(component_ids)} component(s) (with cache)...'
            )

            # Set up output trees and results tuple
            ComponentData = Grasshopper.DataTree[System.Object]()
            __Results = (ComponentData,)

            # Fetch each component
            for i, _id in enumerate(component_ids):
                try:
                    # Make cached request to fetch specific component
                    response = auth_core.cached_get(
                        f'/components/{_id}', f'component:{_id}')

                    if response.status_code == 200:
                        # Successfully fetched component (from server or cache)
                        json_comp = response.json()

                        # Create datatree path
                        ghp = Grasshopper.Kernel.Data.GH_Path(i)
                        # Add component data to the datatree
                        ComponentData.Add(json.dumps(json_comp), ghp)

                        self._addRemark(
                            f'Successfully fetched component {_id}'
                        )

                    elif response.status_code == 404:
                        msg = f'Component {_id} not found on server.'
                        self._addWarning(msg)
                        self.Component.Message = msg

                    elif response.status_code == 401:
                        msg = 'Authentication failed. Please sign in again.'
                        self._addError(msg)
                        self.Component.Message = msg
                        return __Results

                    elif response.status_code == 403:
                        msg = 'Access denied. Insufficient permissions.'
                        self._addError(msg)
                        self.Component.Message = msg
                        return __Results

                    elif response.status_code == 500:
                        msg = 'Server error. Please try again later.'
                        self._addWarning(msg)
                        self.Component.Message = msg

                    else:
                        msg = (f'Request failed for component {_id} with '
                               f'status code: {response.status_code}')
                        self._addError(msg)
                        self.Component.Message = msg

                except Exception as e:
                    msg = f'Error fetching component {_id}: {str(e)}'
                    self._addError(msg)
                    self.Component.Message = msg

            # Update success message
            if ComponentData.DataCount > 0:
                self.Component.Message = (
                    f'Fetched {ComponentData.DataCount} component(s) (cached)'
                )
            else:
                self.Component.Message = 'No components fetched'

            return __Results

        except requests.exceptions.ConnectionError as e:
            msg = 'Cannot connect to server. Please check your connection.'
            self._addError(msg + f'\nFull Error: {str(e)}')
            self.Component.Message = msg

        except requests.exceptions.Timeout as e:
            msg = 'Request timeout. Server may be slow.'
            self._addError(msg + f'\nFull Error: {str(e)}')
            self.Component.Message = msg

        except requests.exceptions.RequestException as e:
            msg = f'Request error: {str(e)}'
            self._addError(msg)
            self.Component.Message = msg

        except Exception as e:
            msg = f'Unexpected error: {str(e)}'
            self._addError(msg)
            self.Component.Message = msg

        # Return empty results if there was an error
        ComponentData = Grasshopper.DataTree[System.Object]()
        __Results = (ComponentData,)
        return __Results
# ---------- end fetchcomponents ----------
componentdata = Data(fetchcomponents)

# Step 3
# comments & notes: Bake Components to the Rhino Document.
# 
# NOTE: If you bake using the component, the geometry will be grouped with a text tag that is used to infer the transformations happening in the Rhino document. Without text tag, this will be lost!
button = Button()
componentdata_2 = Data(componentdata)
# Step 4
# comments & notes: Transform (move, rotate) the baked component(s) in the Rhino doc!
# 
# Make sure to also transform the text tag!
bakecomponents = BakeComponents(Bake=button, ComponentData=componentdata_2)  # inputs Bake: Boolean, ComponentData: list of String
# ---------- bakecomponents: Python ----------
# -*- coding: utf-8 -*-
#! python3
# venv: DDU_CSC
print('ENV OK!')
# r: charset_normalizer
# r: requests
# r: numpy
# r: scipy
# r: scikit-learn
# r: robust-laplacian
# r: potpourri3d

# PYTHON STANDARD LIBRARY IMPORTS ---------------------------------------------
import json

# RHINO AND GH RELATED IMPORTS ------------------------------------------------
import System  # type: ignore[reportMissingImport] # NOQA
import Rhino  # type: ignore[reportMissingImport] # NOQA
import Grasshopper  # type: ignore[reportMissingImport] # NOQA
import rhinoscriptsyntax as rs  # type: ignore[reportMissingImport] # NOQA
import scriptcontext as sc  # type: ignore[reportMissingImport] # NOQA

# GHENV COMPONENT SETTINGS ----------------------------------------------------
ghenv.Component.Name = 'BakeComponents'  # type: ignore[reportUnedfinedVariable] # NOQA
ghenv.Component.NickName = 'BakeComponents'  # type: ignore[reportUnedfinedVariable] # NOQA
ghenv.Component.Category = 'DDU_CSC'  # type: ignore[reportUnedfinedVariable] # NOQA
ghenv.Component.SubCategory = '4 RhinoDoc Interaction'  # type: ignore[reportUnedfinedVariable] # NOQA
ghenv.Component.Description = (  # type: ignore[reportUnedfinedVariable] # NOQA
    'Bakes fetched components into the Rhino document as actual geometry. '
    'Creates layers, groups, and attaches component data as user text. '
    'Prioritizes cached geometry over primitive representations.'
)


class CSC_BakeComponents(Grasshopper.Kernel.GH_ScriptInstance):
    """
    Author: Max Benjamin Eschenbach
    License: MIT License
    Version: 251030
    """

    def __init__(self):
        """Initialize this component and set component parameters."""
        super().__init__()
        # initialize props
        self.Component = ghenv.Component  # type: ignore[reportUnedfinedVariable] # NOQA
        self.InputParams = self.Component.Params.Input
        self.OutputParams = self.Component.Params.Output

    def _addRemark(self, msg: str = ''):
        """Add a remark message to the component."""
        rml = self.Component.RuntimeMessageLevel.Remark
        self.AddRuntimeMessage(rml, msg)

    def _addWarning(self, msg: str = ''):
        """Add a warning message to the component."""
        rml = self.Component.RuntimeMessageLevel.Warning
        self.AddRuntimeMessage(rml, msg)

    def _addError(self, msg: str = ''):
        """Add an error message to the component."""
        rml = self.Component.RuntimeMessageLevel.Error
        self.AddRuntimeMessage(rml, msg)

    def BeforeRunScript(self):
        """Perform some setup actions."""
        # Initialize input param descriptions
        self.InputParams[0].Description = (
            'Toggle to bake components to Rhino'
        )
        self.InputParams[1].Description = (
            'Component data from FetchComponents'
        )

    def ComponentExtrusionProfile(
            self,
            json_comp: dict) -> Rhino.Geometry.Polyline:
        pl = Rhino.Geometry.Polyline()
        pts = [Rhino.Geometry.Point3d(pt[0], pt[1], 0.0)
               for pt in json_comp['geometry']['extrusion']['profile']]
        pl.AddRange(pts)
        return pl

    def ComponentExtrusion(
            self,
            json_comp: dict) -> Rhino.Geometry.Extrusion:
        pl = Rhino.Geometry.Polyline()
        pts = [Rhino.Geometry.Point3d(pt[0], pt[1], 0.0)
               for pt in json_comp['geometry']['extrusion']['profile']]
        pl.AddRange(pts)
        cxt = Rhino.Geometry.Extrusion.Create(
            pl.ToPolylineCurve(),
            Rhino.Geometry.Plane.WorldXY,
            json_comp['geometry']['extrusion']['height'],
            True)
        # move extrusion downwards half material
        # thickness to center it at the origin
        cxt.Translate(Rhino.Geometry.Vector3d(
            0, 0, json_comp['geometry']['extrusion']['height'] * -0.5))
        return cxt

    def ComponentMeshes(self, json_comp: dict) -> list:
        """Create multiple meshes from geometry.meshes field."""
        meshes = []
        for i, mesh_data in enumerate(json_comp['geometry']['meshes']):
            mesh = Rhino.Geometry.Mesh()
            vl = mesh_data['v']
            fl = mesh_data['f']
            [mesh.Vertices.Add(*v) for v in vl]
            [mesh.Faces.AddFace(*f) for f in fl]

            # Try to get mesh-specific colors first
            try:
                cl = mesh_data['c']
                [mesh.VertexColors.Add(
                    System.Drawing.Color.FromArgb(*c)) for c in cl]
            except KeyError:
                # Fallback: use component color for all vertices
                try:
                    component_color = System.Drawing.Color.FromArgb(
                        255, *json_comp['color'])
                    for _ in range(len(vl)):
                        mesh.VertexColors.Add(component_color)
                except (KeyError, TypeError):
                    # If even component color fails, use a default gray
                    default_color = System.Drawing.Color.Gray
                    for _ in range(len(vl)):
                        mesh.VertexColors.Add(default_color)
                    self._addWarning(
                        f'Mesh {i} in component {json_comp["_id"]} '
                        f'using default gray color')

            mesh.RebuildNormals()
            mesh.UnifyNormals()
            mesh.Compact()
            meshes.append(mesh)
        return meshes

    def ComponentColor(self, json_comp: dict) -> System.Drawing.Color:
        return System.Drawing.Color.FromArgb(255, *json_comp['color'])

    def get_auth_core_from_sticky(self):
        """Get AuthCore instance from sticky storage."""
        auth_core = sc.sticky.get('CSC_AuthCore')
        if auth_core is None:
            self._addWarning(
                'No authentication found. Using primitive geometry only.'
            )
            return None
        return auth_core

    def fetch_cached_geometry(self, auth_core, component_id, detailed=True):
        """Fetch cached geometry from binary cache."""
        try:
            if not auth_core or not auth_core._cache:
                return None

            geometry_type = 'detailed' if detailed else 'reduced'
            (cached_meshes,
             cached_etag,
             is_from_cache) = auth_core._cache.get_geometry_binary(
                component_id, geometry_type
            )

            # Check if we got valid meshes from cache
            if is_from_cache and cached_meshes and len(cached_meshes) > 0:
                self._addRemark(
                    f'Using cached {geometry_type} geometry '
                    f'for {component_id}'
                )
                return cached_meshes
            return None
        except Exception as e:
            self._addWarning(f'Error fetching cached geometry: {str(e)}')
            return None

    def RunScript(self,
            Bake: bool,
            ComponentData: System.Collections.Generic.List[str]):
        # bake toggle
        if Bake:
            if not ComponentData or len(ComponentData) == 0:
                msg = ('No component data provided. Please connect '
                       'FetchComponent output.')
                self._addWarning(msg)
                self.Component.Message = msg
                return

            self.Component.Message = 'Baking components...'
            baked_count = 0

            # Get AuthCore for cached geometry
            auth_core = self.get_auth_core_from_sticky()

            # set document
            sc.doc = Rhino.RhinoDoc.ActiveDoc

            for i, cd in enumerate(ComponentData):
                try:
                    # create path (not used in baking but kept for consistency)
                    _ = Grasshopper.Kernel.Data.GH_Path(i)
                    # load json component
                    json_comp = json.loads(cd)
                    # extract ID
                    comp_id = json_comp['_id']

                    # determine unique group name (groups must be unique)
                    # use suffix indexing: <uuid>_1, <uuid>_2, ...
                    base_group_name = comp_id
                    idx = 1
                    existing_names = set()
                    for grp in sc.doc.Groups:
                        try:
                            existing_names.add(grp.Name)
                        except Exception:
                            continue
                    while True:
                        candidate = f'{base_group_name}_{idx}'
                        if candidate not in existing_names:
                            group_name = candidate
                            break
                        idx += 1

                    # get insertion plane
                    try:
                        # try to extract insertion frame
                        iframe = json_comp['iframe']
                        iplane = Rhino.Geometry.Plane(
                            Rhino.Geometry.Point3d(*iframe['o']),
                            Rhino.Geometry.Vector3d(*iframe['x']),
                            Rhino.Geometry.Vector3d(*iframe['y']),
                        )
                    except KeyError:
                        # if there is no respective key, create world xy plane
                        iplane = Rhino.Geometry.Plane.WorldXY

                    xform = Rhino.Geometry.Transform.PlaneToPlane(
                        Rhino.Geometry.Plane.WorldXY,
                        iplane)

                    # Try to get cached geometry first
                    cached_meshes = self.fetch_cached_geometry(
                        auth_core,
                        comp_id,
                        detailed=True
                    )
                    if not cached_meshes:
                        # Fall back to reduced geometry
                        cached_meshes = self.fetch_cached_geometry(
                            auth_core,
                            comp_id,
                            detailed=False
                        )

                    # create component geometry
                    geo_ids = []
                    if cached_meshes:
                        # Use cached geometry
                        for j, mesh in enumerate(cached_meshes):
                            try:
                                # Create a copy to avoid modifying
                                # the cached mesh
                                mesh_copy = mesh.Duplicate()
                                if mesh_copy and mesh_copy.IsValid:
                                    mesh_copy.Transform(xform)
                                    geo_id = sc.doc.Objects.Add(mesh_copy)
                                    if geo_id != System.Guid.Empty:
                                        geo_ids.append(geo_id)
                                        # Add mesh index as user text
                                        rs.SetUserText(
                                            geo_id,
                                            'csc_mesh_index',
                                            str(j))
                                    else:
                                        self._addWarning(
                                            f'Failed to add mesh '
                                            f'{j} to document'
                                        )
                                else:
                                    self._addWarning(
                                        f'Invalid mesh {j} in cached geometry'
                                    )
                            except Exception as e:
                                self._addWarning(
                                    'Error processing cached '
                                    f'mesh {j}: {str(e)}'
                                )
                                continue
                    else:
                        # Fall back to primitive geometry
                        for key in sorted(json_comp['geometry'].keys()):
                            if key == 'extrusion':
                                xtr = self.ComponentExtrusion(json_comp)
                                xtr.Transform(xform)
                                geo_ids.append(sc.doc.Objects.Add(xtr))
                            elif key == 'meshes':
                                # Handle multiple meshes
                                meshes = self.ComponentMeshes(json_comp)
                                for j, mesh in enumerate(meshes):
                                    mesh.Transform(xform)
                                    geo_id = sc.doc.Objects.Add(mesh)
                                    geo_ids.append(geo_id)
                                    # Add mesh index as user text
                                    rs.SetUserText(geo_id, 'csc_mesh_index',
                                                   str(j))
                            else:
                                msg = (f'Missing implementation for geometry '
                                       f'of type \'{key}\'!')
                                self._addWarning(msg)
                                self.Component.Message = msg
                                continue

                    # add objects to document
                    # create layers if they are not present
                    lay_parent = 'CSC_COMPONENTS'
                    lay_name = comp_id
                    layer = '::'.join([lay_parent, lay_name])
                    if not rs.IsLayer(lay_parent):
                        rs.AddLayer(lay_parent)
                    if not rs.IsLayer(layer):
                        rs.AddLayer(layer, self.ComponentColor(json_comp))

                    # set layer and add component data as user strings
                    for gid in geo_ids:
                        rs.ObjectLayer(gid, layer)
                        # set component data as user string
                        rs.SetUserText(
                            gid,
                            'csc_component',
                            ComponentData[i])

                    # create tag
                    tag = Rhino.Geometry.TextEntity()
                    tag.Text = comp_id
                    tag.Plane = iplane
                    # specify height in millimeters
                    usf = Rhino.RhinoMath.UnitScale(
                        Rhino.UnitSystem.Millimeters,
                        sc.doc.ModelUnitSystem)
                    tag.TextHeight = 10.0 * usf
                    tag.Justification = (
                        Rhino.Geometry.TextJustification.MiddleCenter
                    )
                    id_tag = sc.doc.Objects.Add(tag)
                    # add tag to geometry IDs for grouping
                    if id_tag != System.Guid.Empty:
                        geo_ids.append(id_tag)

                    # set layer to tag
                    rs.ObjectLayer(id_tag, layer)

                    # create group with unique name
                    if len(geo_ids) > 1:
                        _ = sc.doc.Groups.Add(
                            group_name,
                            geo_ids)

                    baked_count += 1
                    mesh_count = len(geo_ids)
                    if mesh_count == 1:
                        self._addRemark(
                            f'Successfully baked component {comp_id}')
                    else:
                        self._addRemark(
                            f'Successfully baked component {comp_id} '
                            f'({mesh_count} meshes)')

                except json.JSONDecodeError as e:
                    msg = (
                        f'Failed to parse component data for {comp_id}: '
                        f'{str(e)}'
                    )
                    self._addError(msg)
                    self.Component.Message = msg
                except Exception as e:
                    msg = f'Error baking component: {str(e)}'
                    self._addError(msg)
                    self.Component.Message = msg

            # Update success message
            if baked_count > 0:
                self.Component.Message = f'Baked {baked_count} component(s)'
                self._addRemark(
                    f'Successfully baked {baked_count} components')
            else:
                self.Component.Message = 'No components were baked'
                self._addWarning('No components were baked')
            # restore document context
            sc.doc = self.Component.OnPingDocument()
        else:
            self.Component.Message = 'Bake toggle is off'
            self._addRemark('Bake toggle is off - no components baked')
# ---------- end bakecomponents ----------

# Step 5
# comments & notes: Sync Components from Rhino document.
# 
# NOTE: If you transform the components within your Rhino document, transformations will be carried over, as long as the attached TextTag is transformed equally!
# comments & notes: Activate the Toggle to Synchornize!
toggle = BooleanToggle(False)
syncwithrhinodoc = SyncWithRhinoDoc(Sync=toggle)  # -> DocumentComponents; inputs Sync: Boolean
# ---------- syncwithrhinodoc: Python ----------
# -*- coding: utf-8 -*-
#! python3
# venv: DDU_CSC
print('ENV OK!')
# r: charset_normalizer
# r: requests
# r: numpy
# r: scipy
# r: scikit-learn
# r: robust-laplacian
# r: potpourri3d

# PYTHON STANDARD LIBRARY IMPORTS ---------------------------------------------
import json

# RHINO AND GH RELATED IMPORTS ------------------------------------------------
import System  # type: ignore[reportMissingImport] # NOQA
import Grasshopper  # type: ignore[reportMissingImport] # NOQA
import Rhino  # type: ignore[reportMissingImport] # NOQA
import rhinoscriptsyntax as rs  # type: ignore[reportMissingImport] # NOQA
import scriptcontext as sc  # type: ignore[reportMissingImport] # NOQA

# GHENV COMPONENT SETTINGS ----------------------------------------------------
ghenv.Component.Name = 'SyncWithRhinoDoc'  # type: ignore[reportUnedfinedVariable] # NOQA
ghenv.Component.NickName = 'SyncWithRhinoDoc'  # type: ignore[reportUnedfinedVariable] # NOQA
ghenv.Component.Category = 'DDU_CSC'  # type: ignore[reportUnedfinedVariable] # NOQA
ghenv.Component.SubCategory = '4 RhinoDoc Interaction'  # type: ignore[reportUnedfinedVariable] # NOQA
ghenv.Component.Description = (  # type: ignore[reportUnedfinedVariable] # NOQA
    'Scans the active Rhino document for objects with csc_component user '
    'data and updates their iframe (insertion frame) based on current '
    'geometry position in Rhino.'
)


class CSC_SyncWithRhinoDoc(Grasshopper.Kernel.GH_ScriptInstance):
    """
    Author: Max Benjamin Eschenbach
    License: MIT License
    Version: 251030
    """

    def __init__(self):
        """Initialize this component and set component parameters."""
        super().__init__()
        # initialize props
        self.Component = ghenv.Component  # type: ignore[reportUnedfinedVariable] # NOQA
        self.InputParams = self.Component.Params.Input
        self.OutputParams = self.Component.Params.Output

    def _addRemark(self, msg: str = ''):
        """Add a remark message to the component."""
        rml = self.Component.RuntimeMessageLevel.Remark
        self.AddRuntimeMessage(rml, msg)

    def _addWarning(self, msg: str = ''):
        """Add a warning message to the component."""
        rml = self.Component.RuntimeMessageLevel.Warning
        self.AddRuntimeMessage(rml, msg)

    def _addError(self, msg: str = ''):
        """Add an error message to the component."""
        rml = self.Component.RuntimeMessageLevel.Error
        self.AddRuntimeMessage(rml, msg)
    
    def BeforeRunScript(self):
        """Perform some setup actions."""
        # Initialize input param descriptions
        self.InputParams[0].Description = (
            'Trigger to sync components with Rhino document'
        )
        # Initialize output param descriptions
        i = 0
        if self.OutputParams[0].Name == 'out':
            i += 1
        self.OutputParams[0+i].Description = (
            'DataTree containing all component data found in the document, '
            'with updated iframe information based on current object positions'
        )

    def find_objects_with_csc_component(self, doc):
        """
        Find all objects in the document that have the 'csc_component' userkey.
        Also find text tags that are grouped with these components.
        Groups objects by component ID to handle multiple meshes correctly.
        Returns a list of tuples: (component_id, component_data, objects_list,
                                   combined_path)
        """
        components_dict = {}
        try:
            # Get all objects in the document
            all_objects = doc.Objects
            for obj in all_objects:
                if obj is None:
                    continue
                # Check if object has user strings
                usr_txt_type = rs.IsUserText(obj)
                if usr_txt_type > 0:
                    # Look for 'csc_component' userkey
                    component_data = None
                    if usr_txt_type == 1:
                        component_data = rs.GetUserText(
                            obj, 'csc_component', False)
                    elif usr_txt_type == 2:
                        component_data = rs.GetUserText(
                            obj, 'csc_component', True)
                    elif usr_txt_type == 3:
                        component_data = rs.GetUserText(
                            obj, 'csc_component', False)
                        if not component_data:
                            component_data = rs.GetUserText(
                                obj, 'csc_component', True)
                    if component_data:
                        try:
                            # Parse the JSON data
                            parsed_data = json.loads(component_data)
                            component_id = parsed_data.get('_id', 'unknown')
                            # Group objects by component ID
                            if component_id not in components_dict:
                                components_dict[component_id] = {
                                    'component_data': parsed_data,
                                    'objects': [],
                                    'paths': []
                                }
                            # Add object to the component group
                            obj_path = self.get_object_path(obj, doc)
                            components_dict[component_id]['objects'].append(
                                obj
                            )
                            components_dict[component_id]['paths'].append(
                                obj_path)
                        except json.JSONDecodeError as e:
                            self._addWarning(
                                f'Invalid JSON in csc_component userstring '
                                f'for object {obj.Id}: {str(e)}'
                            )
                            continue

            for component_id, data in components_dict.items():
                # Find all groups whose name starts with the component_id
                groups = doc.Groups
                for i in range(groups.Count):
                    group = groups[i]
                    if (group and isinstance(group.Name, str) and
                            group.Name.startswith(component_id)):
                        # Get all objects in this specific group instance
                        group_objects = rs.ObjectsByGroup(group.Name)
                        for obj_id in group_objects:
                            obj = rs.coercegeometry(obj_id)
                            if obj and rs.IsText(obj):
                                # This is a text tag for our component
                                obj_path = self.get_object_path(obj, doc)
                                data['objects'].append(obj)
                                data['paths'].append(obj_path)
                                self._addRemark(
                                    'Found text tag for component '
                                    f'{component_id}'
                                )

        except Exception as e:
            self._addError(
                f'Error searching for objects with csc_component: {str(e)}'
            )

        # Convert to list format for compatibility
        components_list = []
        for component_id, data in components_dict.items():
            combined_path = ' | '.join(data['paths'])  # Combine all paths
            components_list.append((
                component_id,
                data['component_data'],
                data['objects'],
                combined_path
            ))

        return components_list

    def get_object_path(self, obj, doc):
        """
        Get a descriptive path for the object (layer hierarchy, etc.)
        """
        try:
            # Try to get the layer name
            layer_index = obj.Attributes.LayerIndex
            if layer_index >= 0:
                layer = doc.Layers[layer_index]
                if layer:
                    return layer.FullPath
        except Exception:
            pass
        # Fallback to object name or type
        try:
            if hasattr(obj, 'Name') and obj.Name:
                return obj.Name
        except Exception:
            pass
        return f"Object_{obj}"

    def update_component_frame(self, objects_list, component_data):
        """
        Update the component's iframe based on text tag plane if available,
        otherwise fall back to combined bounding box of all objects.
        Returns updated component data.
        """
        try:
            if not objects_list:
                return component_data

            # First, try to find a text object (tag) and use its plane
            for obj in objects_list:
                if rs.IsText(obj):
                    try:
                        tagplane = rs.TextObjectPlane(obj)
                        tagframe = {
                            'o': [tagplane.OriginX,
                                  tagplane.OriginY,
                                  tagplane.OriginZ],
                            'x': [tagplane.XAxis.X,
                                  tagplane.XAxis.Y,
                                  tagplane.XAxis.Z],
                            'y': [tagplane.YAxis.X,
                                  tagplane.YAxis.Y,
                                  tagplane.YAxis.Z],
                            'z': [tagplane.ZAxis.X,
                                  tagplane.ZAxis.Y,
                                  tagplane.ZAxis.Z]
                        }
                        # Update the iframe in component data
                        if 'iframe' not in component_data:
                            component_data['iframe'] = {}
                        component_data['iframe'].update(tagframe)
                        return component_data
                    except Exception as e:
                        self._addWarning(
                            f'Error extracting plane from text tag: {str(e)}'
                        )
                        continue

            # Fallback: Calculate combined bounding box for all objects
            combined_bbox = None
            for obj in objects_list:
                if hasattr(obj, 'Geometry'):
                    geometry = obj.Geometry
                    if hasattr(geometry, 'GetBoundingBox'):
                        bbox = geometry.GetBoundingBox(True)
                        if bbox.IsValid:
                            if combined_bbox is None:
                                combined_bbox = bbox
                            else:
                                combined_bbox = (
                                    Rhino.Geometry.BoundingBox.Union(
                                        combined_bbox, bbox))
            # convert to box
            combined_bbox = Rhino.Geometry.Box(combined_bbox)

            if combined_bbox and combined_bbox.IsValid:
                # Create frame based on combined bounding box
                center = combined_bbox.Center
                x_axis = combined_bbox.Plane.XAxis
                y_axis = combined_bbox.Plane.YAxis
                z_axis = combined_bbox.Plane.ZAxis

                # Update the iframe in component data
                if 'iframe' not in component_data:
                    component_data['iframe'] = {}
                component_data['iframe'].update({
                    'o': [center.X, center.Y, center.Z],
                    'x': [x_axis.X, x_axis.Y, x_axis.Z],
                    'y': [y_axis.X, y_axis.Y, y_axis.Z],
                    'z': [z_axis.X, z_axis.Y, z_axis.Z]
                })
                return component_data
        except Exception as e:
            self._addWarning(
                f'Error updating frame for component: {str(e)}'
            )
        return component_data

    def RunScript(self, Sync: bool):
        # init outputs
        DocumentComponents = Grasshopper.DataTree[str]()
        if not Sync:
            # Return empty results if not syncing
            self.Component.Message = 'Sync Toggle is False'
            return DocumentComponents
        try:
            # Set scriptcontext to Rhino document
            sc.doc = Rhino.RhinoDoc.ActiveDoc

            self.Component.Message = 'Searching for components in document...'
            # Find all objects with csc_component userkey
            objects_with_component = self.find_objects_with_csc_component(
                sc.doc
            )
            if not objects_with_component:
                msg = 'No components found in document!'
                self._addWarning(msg)
                self.Component.Message = msg
                # Return empty results
                return DocumentComponents
            # Create output datatree
            # Process each component (now grouped by component ID)
            for i, (component_id, component_data, objects_list,
                    combined_path) in enumerate(objects_with_component):
                try:
                    # Update the component's frame based on combined
                    # bounding box of all objects from the same component
                    updated_data = self.update_component_frame(
                        objects_list, component_data
                    )
                    # Create datatree path
                    ghp = Grasshopper.Kernel.Data.GH_Path(i)
                    # Add updated component data to datatree
                    DocumentComponents.Add(json.dumps(updated_data), ghp)

                    # Log success message with object count
                    object_count = len(objects_list)
                    if object_count == 1:
                        self._addRemark(
                            f'Updated component {component_id} '
                            f'from {combined_path}'
                        )
                    else:
                        self._addRemark(
                            f'Updated component {component_id} '
                            f'({object_count} meshes) from {combined_path}'
                        )
                except Exception as e:
                    msg = (
                        f'Error processing component {component_id} '
                        f'from {combined_path}: {str(e)}'
                    )
                    self._addWarning(msg)
                    continue

            # Update success message
            if DocumentComponents.DataCount > 0:
                self.Component.Message = (
                    f'Synced {DocumentComponents.DataCount} component(s)'
                )
                self._addRemark(
                    f'Successfully synced {DocumentComponents.DataCount} '
                    'components with document'
                )
            else:
                self.Component.Message = 'No components synced'
                self._addWarning('No components were successfully synced')

            # Return results
            return DocumentComponents

        except Exception as e:
            msg = f'Unexpected error during sync: {str(e)}'
            self._addError(msg)
            self.Component.Message = msg

            # Return empty results if there was an error
            return DocumentComponents

        finally:
            # Restore scriptcontext to Grasshopper document
            sc.doc = self.Component.OnPingDocument()
# ---------- end syncwithrhinodoc ----------
componentdata_3 = Data(syncwithrhinodoc)

# Step 6
# comments & notes: Disassemble the synced components. See how the transformations from the Rhino document are applied?
componentdata_4 = Data(componentdata_3)
disassemblecomponent = DisassembleComponent(ComponentData=componentdata_4)  # -> ID, Type, Material, Color, Location, BoundingBox, PCAFrame, Descriptors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; inputs ComponentData: tree of String
# ---------- disassemblecomponent: Python ----------
# -*- coding: utf-8 -*-
#! python3
# venv: DDU_CSC
print('ENV OK!')
# r: charset_normalizer
# r: requests
# r: numpy
# r: scipy
# r: scikit-learn
# r: robust-laplacian
# r: potpourri3d

# PYTHON STANDARD LIBRARY IMPORTS ---------------------------------------------
import json

# RHINO AND GH RELATED IMPORTS ------------------------------------------------
import System  # type: ignore[reportMissingImport] # NOQA
import Rhino  # type: ignore[reportMissingImport] # NOQA
import Grasshopper  # type: ignore[reportMissingImport] # NOQA

# GHENV COMPONENT SETTINGS ----------------------------------------------------
ghenv.Component.Name = 'DisassembleComponent'  # type: ignore[reportUnedfinedVariable] # NOQA
ghenv.Component.NickName = 'DisassembleComponent'  # type: ignore[reportUnedfinedVariable] # NOQA
ghenv.Component.Category = 'DDU_CSC'  # type: ignore[reportUnedfinedVariable] # NOQA
ghenv.Component.SubCategory = '3 Component Operations'  # type: ignore[reportUnedfinedVariable] # NOQA
ghenv.Component.Description = (  # type: ignore[reportUnedfinedVariable] # NOQA
    'Parses component data (JSON) and outputs individual fields as '
    'Grasshopper-native types. Reconstructs geometry, bounding boxes, '
    'PCA frames, and metadata from component JSON.'
)


class CSC_DisassembleComponent(Grasshopper.Kernel.GH_ScriptInstance):
    """
    Author: Max Benjamin Eschenbach
    License: MIT License
    Version: 251023.1
    """

    def __init__(self):
        """Initialize this component and set component parameters."""
        super().__init__()
        # initialize props
        self.Component = ghenv.Component  # type: ignore[reportUnedfinedVariable] # NOQA
        self.InputParams = self.Component.Params.Input
        self.OutputParams = self.Component.Params.Output

    def _addRemark(self, msg: str = ''):
        """Add a remark message to the component."""
        rml = self.Component.RuntimeMessageLevel.Remark
        self.AddRuntimeMessage(rml, msg)

    def _addWarning(self, msg: str = ''):
        """Add a warning message to the component."""
        rml = self.Component.RuntimeMessageLevel.Warning
        self.AddRuntimeMessage(rml, msg)

    def _addError(self, msg: str = ''):
        """Add an error message to the component."""
        rml = self.Component.RuntimeMessageLevel.Error
        self.AddRuntimeMessage(rml, msg)
    
    def BeforeRunScript(self):
        """Perform some setup actions."""
        # Initialize input param descriptions
        self.InputParams[0].Description = (
            'The ComponentData that was fetched from the server as JSON.'
        )
        # Initialize output param descriptions
        i = 0
        if self.OutputParams[0].Name == 'out':
            i += 1
        self.OutputParams[0+i].Description = (
            'Component ID (GUID)'
        )
        self.OutputParams[1+i].Description = (
            'Component type (sheet, beam, slab, etc.)'
        )
        self.OutputParams[2+i].Description = (
            'Component material'
        )
        self.OutputParams[3+i].Description = (
            'Component color as System.Drawing.Color'
        )
        self.OutputParams[4+i].Description = (
            'Component location as Point3d (X=latitude, Y=longitude, Z=0)'
        )
        self.OutputParams[5+i].Description = (
            'Component bounding box as Rhino.Geometry.BoundingBox'
        )
        self.OutputParams[6+i].Description = (
            'PCA frame at world origin as Rhino.Geometry.Plane'
        )
        self.OutputParams[7+i].Description = (
            'Component descriptors/metadata as JSON string'
        )
        self.OutputParams[8+i].Description = (
            'Rhino geometry objects (extrusion, mesh, multiple meshes, '
            'polyline)'
        )
        self.OutputParams[9+i].Description = (
            'Marker points as list of Point3d objects'
        )
        self.OutputParams[10+i].Description = (
            'Component attributes as JSON string'
        )

    def ComponentExtrusionProfile(
            self,
            json_comp: dict) -> Rhino.Geometry.Polyline:
        pl = Rhino.Geometry.Polyline()
        pts = [Rhino.Geometry.Point3d(pt[0], pt[1], 0.0)
               for pt in json_comp['geometry']['extrusion']['profile']]
        pl.AddRange(pts)
        return pl

    def ComponentExtrusion(
            self,
            json_comp: dict) -> Rhino.Geometry.Extrusion:
        pl = Rhino.Geometry.Polyline()
        pts = [Rhino.Geometry.Point3d(pt[0], pt[1], 0.0)
               for pt in json_comp['geometry']['extrusion']['profile']]
        pl.AddRange(pts)
        cxt = Rhino.Geometry.Extrusion.Create(
            pl.ToPolylineCurve(),
            Rhino.Geometry.Plane.WorldXY,
            json_comp['geometry']['extrusion']['height'],
            True)
        # move extrusion downwards half material
        # thickness to center it at the origin
        cxt.Translate(Rhino.Geometry.Vector3d(
            0, 0, json_comp['geometry']['extrusion']['height'] * -0.5))
        return cxt

    def ComponentMeshes(self, json_comp: dict) -> list[Rhino.Geometry.Mesh]:
        """Create multiple meshes from geometry.meshes field."""
        meshes = []
        for i, mesh_data in enumerate(json_comp['geometry']['meshes']):
            mesh = Rhino.Geometry.Mesh()
            vl = mesh_data['v']
            fl = mesh_data['f']
            [mesh.Vertices.Add(*v) for v in vl]
            [mesh.Faces.AddFace(*f) for f in fl]
            # Try to get mesh-specific colors first
            try:
                cl = mesh_data['c']
                [mesh.VertexColors.Add(
                    System.Drawing.Color.FromArgb(*c)) for c in cl]
            except KeyError:
                # Fallback: use component color for all vertices
                try:
                    component_color = System.Drawing.Color.FromArgb(
                        255, *json_comp['color'])
                    for _ in range(len(vl)):
                        mesh.VertexColors.Add(component_color)
                except (KeyError, TypeError):
                    # If even component color fails, use a default gray
                    default_color = System.Drawing.Color.Gray
                    for _ in range(len(vl)):
                        mesh.VertexColors.Add(default_color)
                    self._addWarning(
                        f'Mesh {i} in component {json_comp["_id"]} '
                        f'using default gray color')
            mesh.RebuildNormals()
            mesh.UnifyNormals()
            mesh.Compact()
            meshes.append(mesh)
        return meshes

    def ComponentColor(self, json_comp: dict) -> System.Drawing.Color:
        return System.Drawing.Color.FromArgb(255, *json_comp['color'])

    def ComponentBoundingBox(
            self,
            json_comp: dict) -> Rhino.Geometry.BoundingBox:
        xtx = json_comp['bbx'][0]
        xty = json_comp['bbx'][1]
        xtz = json_comp['bbx'][2]

        # Get bbx_origin (center of bounding box in PCA space)
        bbx_origin = json_comp.get('bbx_origin', [0.0, 0.0, 0.0])

        # Create bounding box at bbx_origin in PCA space
        bbx = Rhino.Geometry.BoundingBox(
            bbx_origin[0] - xtx * 0.5,
            bbx_origin[1] - xty * 0.5,
            bbx_origin[2] - xtz * 0.5,
            bbx_origin[0] + xtx * 0.5,
            bbx_origin[1] + xty * 0.5,
            bbx_origin[2] + xtz * 0.5
        )

        # Convert bounding box to Box for transformation
        bbx = Rhino.Geometry.Box(bbx)

        # Transform from PCA space back to original component space
        try:
            pca_frame = json_comp.get('pca_frame', {})
            if pca_frame:
                # Create PCA frame plane at world origin
                pca_origin = Rhino.Geometry.Point3d(
                    *pca_frame.get('o', [0, 0, 0]))
                pca_x = Rhino.Geometry.Vector3d(
                    *pca_frame.get('x', [1, 0, 0]))
                pca_y = Rhino.Geometry.Vector3d(
                    *pca_frame.get('y', [0, 1, 0]))

                pca_plane = Rhino.Geometry.Plane(pca_origin, pca_x, pca_y)

                # Create forward transform (from PCA space to original space)
                pca_transform = (
                    Rhino.Geometry.Transform.PlaneToPlane(
                        Rhino.Geometry.Plane.WorldXY, pca_plane))

                bbx.Transform(pca_transform)

        except (KeyError, TypeError, ValueError) as e:
            # If PCA frame is missing or invalid, use bounding box as-is
            self._addWarning(f'Could not apply PCA frame transform: {str(e)}')

        return bbx

    def ComponentPCAPlane(self, json_comp: dict) -> Rhino.Geometry.Plane:
        """Get PCA plane at world origin from component data."""
        try:
            pca_frame = json_comp.get('pca_frame', {})
            if pca_frame:
                pca_x = Rhino.Geometry.Vector3d(
                    *pca_frame.get('x', [1, 0, 0]))
                pca_y = Rhino.Geometry.Vector3d(
                    *pca_frame.get('y', [0, 1, 0]))
                return Rhino.Geometry.Plane(
                    Rhino.Geometry.Point3d.Origin, pca_x, pca_y)
            else:
                return Rhino.Geometry.Plane.WorldXY
        except (KeyError, TypeError, ValueError):
            return Rhino.Geometry.Plane.WorldXY

    def RunScript(self, ComponentData: Grasshopper.DataTree[str]):
        # set up output trees and results tuple
        ID = Grasshopper.DataTree[System.Object]()
        Type = Grasshopper.DataTree[System.Object]()
        Material = Grasshopper.DataTree[System.Object]()
        Color = Grasshopper.DataTree[System.Object]()
        Location = Grasshopper.DataTree[System.Object]()
        BoundingBox = Grasshopper.DataTree[System.Object]()
        PCAFrame = Grasshopper.DataTree[System.Object]()
        Descriptors = Grasshopper.DataTree[System.Object]()
        PrimitiveGeometry = Grasshopper.DataTree[System.Object]()
        MarkerPoints = Grasshopper.DataTree[System.Object]()
        Attributes = Grasshopper.DataTree[System.Object]()
        __Results = (
            ID,
            Type,
            Material,
            Color,
            Location,
            BoundingBox,
            PCAFrame,
            Descriptors,
            PrimitiveGeometry,
            MarkerPoints,
            Attributes)
        try:
            # Validate input
            if not ComponentData or ComponentData.DataCount == 0:
                msg = ('Input ComponentData failed to collect Data')
                self._addWarning(msg)
                self.Component.Message = msg
                return __Results

            self.Component.Message = 'Disassembling components...'

            # loop over all branches
            for i in range(ComponentData.BranchCount):
                for j, comp in enumerate(ComponentData.Branches[i]):
                    try:
                        json_comp = json.loads(comp)
                        # create datatree path
                        ghp = ComponentData.Paths[i]
                        # add directly available metadata to the
                        # respective datatrees
                        ID.Add(json_comp['_id'], ghp)
                        Type.Add(json_comp['type'], ghp)
                        Material.Add(json_comp['material'], ghp)

                        # create system color from rgb values
                        color = self.ComponentColor(json_comp)
                        Color.Add(color, ghp)

                        # process location data
                        try:
                            location_data = json_comp.get('location', {})
                            if (location_data and 'lat' in location_data and
                                    'lon' in location_data):
                                location_point = Rhino.Geometry.Point3d(
                                    location_data['lat'],
                                    location_data['lon'],
                                    0.0
                                )
                            else:
                                location_point = Rhino.Geometry.Point3d(
                                    0.0, 0.0, 0.0)
                        except (KeyError, TypeError):
                            location_point = Rhino.Geometry.Point3d(
                                0.0, 0.0, 0.0)
                        Location.Add(location_point, ghp)

                        # process insertion frame
                        try:
                            iframe = json_comp['iframe']
                            iplane = Rhino.Geometry.Plane(
                                Rhino.Geometry.Point3d(*iframe['o']),
                                Rhino.Geometry.Vector3d(*iframe['x']),
                                Rhino.Geometry.Vector3d(*iframe['y']),
                            )
                        except KeyError:
                            iplane = Rhino.Geometry.Plane.WorldXY

                        xform = Rhino.Geometry.Transform.PlaneToPlane(
                            Rhino.Geometry.Plane.WorldXY,
                            iplane)

                        # treat geometry key in a special way because
                        # it may hold multiple geometry types
                        for key in sorted(json_comp['geometry'].keys()):
                            if key == 'extrusion':
                                xtr = self.ComponentExtrusion(json_comp)
                                # transform to iframe
                                xtr.Transform(xform)
                                # set user string
                                xtr.SetUserString('csc_component', comp)
                                # add to datatree
                                PrimitiveGeometry.Add(xtr, ghp)
                            elif key == 'meshes':
                                # Handle multiple meshes
                                meshes = self.ComponentMeshes(json_comp)
                                for i, mesh in enumerate(meshes):
                                    # transform to iframe
                                    mesh.Transform(xform)
                                    # set user string with mesh index
                                    mesh.SetUserString('csc_component', comp)
                                    mesh.SetUserString('csc_mesh_index',
                                                       str(i))
                                    # add to datatree
                                    PrimitiveGeometry.Add(mesh, ghp)
                            else:
                                msg = (f'Missing implementation for geometry '
                                       f'of type \'{key}\'!')
                                self._addWarning(msg)

                        # construct boundingbox
                        bbx = self.ComponentBoundingBox(json_comp)

                        # apply iframe transform
                        bbx.Transform(xform)
                        BoundingBox.Add(bbx, ghp)

                        # get PCA plane at world origin
                        pca_plane = self.ComponentPCAPlane(json_comp)
                        # apply iframe transform to PCA plane
                        pca_plane.Transform(xform)
                        PCAFrame.Add(pca_plane, ghp)

                        # add descriptors
                        try:
                            descriptors = json_comp.get('descriptors', {})
                            Descriptors.Add(json.dumps(descriptors), ghp)
                        except KeyError:
                            # If no descriptors, add empty dict as JSON string
                            Descriptors.Add(json.dumps({}), ghp)

                        # process marker points
                        try:
                            marker_points_data = json_comp.get(
                                'marker_points', [])
                            marker_points_list = []
                            for point_data in marker_points_data:
                                if (isinstance(point_data, list) and
                                        len(point_data) >= 3):
                                    marker_point = Rhino.Geometry.Point3d(
                                        point_data[0],
                                        point_data[1],
                                        point_data[2]
                                    )
                                    # apply iframe transform to marker point
                                    marker_point.Transform(xform)
                                    marker_points_list.append(marker_point)
                        except (KeyError, TypeError, IndexError):
                            # If no marker points or invalid format, add empty
                            # list
                            marker_points_list = []
                        if marker_points_list:
                            MarkerPoints.AddRange(marker_points_list, ghp)

                        # process attributes
                        try:
                            attributes = json_comp.get('attributes', {})
                            Attributes.Add(json.dumps(attributes), ghp)
                        except KeyError:
                            # If no attributes, add empty dict as JSON string
                            Attributes.Add(json.dumps({}), ghp)

                    except json.JSONDecodeError as e:
                        msg = f'Failed to parse component data: {str(e)}'
                        self._addError(msg)
                    except Exception as e:
                        msg = f'Error processing component: {str(e)}'
                        self._addError(msg)

            # Update success message
            total_components = sum(
                len(branch) for branch in ComponentData.Branches
            )
            self.Component.Message = (
                f'Disassembled {total_components} component(s)'
            )
            self._addRemark(
                f'Successfully disassembled {total_components} components'
            )

            # return output trees
            return __Results

        except Exception as e:
            msg = f'Unexpected error during disassembly: {str(e)}'
            self._addError(msg)
            return __Results
# ---------- end disassemblecomponent ----------
primitivegeometry = Data(disassemblecomponent.PrimitiveGeometry)
boundingbox = Data(disassemblecomponent.BoundingBox)
markerpoints = Data(disassemblecomponent.MarkerPoints)
descriptors = Data(disassemblecomponent.Descriptors)
pcaframe = Data(disassemblecomponent.PCAFrame)
attributes = Data(disassemblecomponent.Attributes)
location = Data(disassemblecomponent.Location)
material = Data(disassemblecomponent.Material)
id = Data(disassemblecomponent.ID)
type = Data(disassemblecomponent.Type)
color = Data(disassemblecomponent.Color)
