# Grasshopper definition DDU_CSC_GrasshopperInterface_Example_05.gh (Grasshopper 1.0.8)

# ---- group: __DDU_CSC_EXAMPLE_05__
# __DEVELOPMENT_CREDITS__: Authors: Max Benjamin Eschenbach
# Constributors: Alessandro Garruto
# 
# Digital Design Unit (DDU)
# Prof. Dr.-Ing. Oliver Tessmann
# Fachbereich Architektur
# Technical University of Darmstadt
# 
# CREDITS:
# ------------
# Please see: https://2ndchances.build/credits
# Example 05:
# - Fetch all corian sheet components
# - Get radial signature descriptors
# - Concatenate with simple descriptors to get a 100-dimensional vector
# - Embed into 2 or 3 dimensional space using dimensionality reduction
# - Visualize the embeddings in 2D / 3D space
# Step 1
# comments & notes: Create new User Session and sign in
# 
# (Add your credentials!)
ddu_csc_username = Panel("")
ddu_csc_password = Panel("")
disablecache = BooleanToggle(False)
clearcache = Button()
refresh = Button()
csc_session = Session(Username=ddu_csc_username, Password=ddu_csc_password, Refresh=refresh, DisableCache=disablecache, ClearCache=clearcache)  # -> Status; inputs Username: String, Password: String, Refresh: Boolean, DisableCache: Boolean, ClearCache: Boolean
# ---------- csc_session: Python ----------
#! python3
# -*- coding: utf-8 -*-
# venv: DDU_CSC
print('ENV OK!')
# r: charset_normalizer
# r: requests

# PYTHON STANDARD LIBRARY IMPORTS ---------------------------------------------
import time  # NOQA
import json  # NOQA
import base64  # NOQA
import os  # NOQA
import hashlib  # NOQA
import pickle  # NOQA
import math  # NOQA
import struct  # NOQA
from threading import RLock  # NOQA
import uuid  # NOQA
from datetime import datetime, timedelta  # NOQA

# THIRD PARTY LIBRARY IMPORTS -------------------------------------------------
import requests  # NOQA

# RHINO AND GH RELATED IMPORTS ------------------------------------------------
import System  # NOQA
import Rhino  # NOQA
import Grasshopper  # NOQA
import scriptcontext as sc  # NOQA

# GHENV COMPONENT SETTINGS ----------------------------------------------------
ghenv.Component.Name = 'Session'  # NOQA
ghenv.Component.NickName = 'CSC_Session'  # NOQA
ghenv.Component.Category = 'DDU_CSC'  # NOQA
ghenv.Component.SubCategory = '1 User'  # NOQA
ghenv.Component.Description = (  # NOQA
    'Handles user authentication with the remote API, manages access '
    'tokens, and provides a unified catalog cache (identities and '
    'snapshots stored independently, mesh PLY geometry cached per '
    'snapshot). Stores authentication state in scriptcontext.sticky.'
)

"""
Author: Max Benjamin Eschenbach
License: MIT License
Version: 260908
"""


def _compute_passport_etag(identity_doc, snapshot_docs):
    """Match backend ``_compute_passport_etag`` (identity + snapshot rows)."""
    parts = [identity_doc.get('lastmodified', '')]
    for doc in sorted(
            snapshot_docs or [],
            key=lambda row: str(row.get('_id', ''))):
        parts.append(str(doc.get('etag', '')))
    return hashlib.sha256('::'.join(parts).encode('utf-8')).hexdigest()


def _passport_cache_key(identity_id, snapshots=None):
    """Stable cache key for a passport GET variant."""
    if not snapshots or snapshots == 'current':
        return f'passport:{identity_id}:current'
    if snapshots == 'all':
        return f'passport:{identity_id}:all'
    if isinstance(snapshots, (list, tuple)):
        joined = ','.join(sorted(str(item) for item in snapshots))
        digest = hashlib.md5(joined.encode('utf-8')).hexdigest()[:16]
        return f'passport:{identity_id}:ids:{digest}'
    return f'passport:{identity_id}:custom'


def primary_snapshot_from_passport(passport):
    """Return the first snapshot from a passport payload."""
    if not isinstance(passport, dict):
        return None
    snapshots = passport.get('snapshots') or []
    if snapshots and isinstance(snapshots[0], dict):
        return snapshots[0]
    legacy = passport.get('snapshot')
    if isinstance(legacy, dict):
        return legacy
    return None


def normalize_passport_payload(passport):
    """
    Ensure passport-shaped dicts use {identity, snapshots[]}.

    Accepts legacy {identity, snapshot} list rows and normalizes them.
    """
    if not isinstance(passport, dict):
        return passport
    identity = passport.get('identity')
    if not isinstance(identity, dict):
        return passport

    snapshots = passport.get('snapshots')
    if isinstance(snapshots, list) and snapshots:
        out = {'identity': identity, 'snapshots': snapshots}
    else:
        legacy = passport.get('snapshot')
        if isinstance(legacy, dict):
            out = {'identity': identity, 'snapshots': [legacy]}
        else:
            return passport

    if 'reserved_by_username' in passport:
        out['reserved_by_username'] = passport['reserved_by_username']
    return out


def _query_cache_key(params):
    """Stable cache key for a GET /identities query parameter dict."""
    if not params:
        return 'query:identities'
    items = sorted((str(k), str(v)) for k, v in params.items())
    payload = '&'.join(f'{k}={v}' for k, v in items)
    return 'query:' + hashlib.md5(payload.encode('utf-8')).hexdigest()


class _CachedResponse(object):
    """Minimal response wrapper for cache hits (status 200 + JSON body)."""

    def __init__(self, data, etag=None, status_code=200):
        self.status_code = status_code
        self._data = data
        self._etag = etag

    def json(self):
        return self._data

    @property
    def headers(self):
        return {'ETag': self._etag} if self._etag else {}


# ComponentCache - Embedded ---------------------------------------------------

class _ComponentCache(object):
    """
    Component cache manager for efficient local storage and retrieval.

    Author: Max Benjamin Eschenbach
    License: MIT License
    """

    def __init__(self, cache_dir=None, ttl_hours=24):
        self.ttl_hours = ttl_hours
        self.cache_dir = cache_dir or self._get_default_cache_dir()
        self.components_dir = os.path.join(self.cache_dir, 'components')
        self.identities_dir = os.path.join(self.cache_dir, 'identities')
        self.snapshots_dir = os.path.join(self.cache_dir, 'snapshots')
        self.designs_dir = os.path.join(self.cache_dir, 'designs')
        self.metadata_dir = os.path.join(self.cache_dir, 'metadata')
        self.geometry_dir = os.path.join(self.cache_dir, 'component_geometry')
        self._lock = RLock()

        # Ensure cache directories exist
        self._ensure_cache_dirs()

    def _get_default_cache_dir(self):
        """Get platform-specific cache directory."""
        if os.name == 'nt':  # Windows
            appdata = os.environ.get('APPDATA', '')
            return os.path.join(appdata, 'DDU_CSC', 'cache')
        else:  # macOS/Linux
            home = os.path.expanduser('~')
            return os.path.join(
                home, 'Library', 'Application Support', 'DDU_CSC', 'cache'
            )

    def _ensure_cache_dirs(self):
        """Create cache directories if they don't exist."""
        dirs = [
            self.cache_dir, self.components_dir, self.identities_dir,
            self.snapshots_dir, self.designs_dir, self.metadata_dir,
            self.geometry_dir
        ]
        for directory in dirs:
            if not os.path.exists(directory):
                os.makedirs(directory, exist_ok=True)

    def _get_cache_key_hash(self, cache_key):
        """Generate a safe filename from cache key."""
        return hashlib.md5(cache_key.encode('utf-8')).hexdigest()

    def _is_expired(self, timestamp_str):
        """Check if cache entry is expired based on TTL."""
        try:
            timestamp = datetime.fromisoformat(
                timestamp_str.replace('Z', '+00:00'))
            expiry = timestamp + timedelta(hours=self.ttl_hours)
            return datetime.now(timestamp.tzinfo) > expiry
        except (ValueError, TypeError):
            return True  # If we can't parse timestamp, consider expired

    def get(self, cache_key, filters=None):
        """
        Get cached data for a cache key.

        Args:
            cache_key: Cache key (e.g., 'all_components', 'component:uuid')
            filters: Optional filter parameters for metadata cache

        Returns:
            Tuple of (data, etag, is_from_cache) or
            (None, None, False) if not found
        """
        # Try binary cache first
        return self.get_binary(cache_key)

    def set(self, cache_key, data, etag=None, filters=None):
        """
        Store data in cache.

        Args:
            cache_key: Cache key
            data: Data to cache
            etag: ETag for the data
            filters: Optional filter parameters
        """
        # Use binary cache
        self.set_binary(cache_key, data, etag, filters)

    def _write_metadata(self, cache_key, metadata):
        metadata_file = os.path.join(
            self.metadata_dir,
            f"{self._get_cache_key_hash(cache_key)}.json"
        )
        with open(metadata_file, 'w', encoding='utf-8') as f:
            json.dump(metadata, f, indent=2, ensure_ascii=False)

    def _read_metadata(self, cache_key):
        metadata_file = os.path.join(
            self.metadata_dir,
            f"{self._get_cache_key_hash(cache_key)}.json"
        )
        if not os.path.exists(metadata_file):
            return None
        with open(metadata_file, 'r', encoding='utf-8') as f:
            metadata = json.load(f)
        if self._is_expired(metadata.get('cached_at', '')):
            return None
        return metadata

    # Identity / snapshot catalog cache (v0.5) -------------------------------

    def set_identity(self, identity_id, identity_doc):
        """Store one identity document (keyed by identity id)."""
        with self._lock:
            try:
                cache_key = f'identity:{identity_id}'
                identity_file = os.path.join(
                    self.identities_dir, f'{identity_id}.pkl'
                )
                with open(identity_file, 'wb') as f:
                    pickle.dump(identity_doc, f)
                self._write_metadata(cache_key, {
                    'cache_key': cache_key,
                    'cached_at': datetime.now().isoformat(),
                    'etag': identity_doc.get('lastmodified'),
                    'type': 'identity',
                    'current_snapshot_id': identity_doc.get(
                        'current_snapshot_id'),
                })
            except (IOError, pickle.PickleError):
                pass

    def get_identity(self, identity_id):
        """Return (identity_doc, etag, is_cached)."""
        with self._lock:
            try:
                cache_key = f'identity:{identity_id}'
                metadata = self._read_metadata(cache_key)
                if metadata is None:
                    return None, None, False
                identity_file = os.path.join(
                    self.identities_dir, f'{identity_id}.pkl'
                )
                if not os.path.exists(identity_file):
                    return None, None, False
                with open(identity_file, 'rb') as f:
                    identity_doc = pickle.load(f)
                return identity_doc, metadata.get('etag'), True
            except (IOError, pickle.PickleError, KeyError):
                return None, None, False

    def set_snapshot(self, snapshot_id, snapshot_doc):
        """Store one snapshot document (keyed by snapshot id)."""
        with self._lock:
            try:
                cache_key = f'snapshot:{snapshot_id}'
                snapshot_file = os.path.join(
                    self.snapshots_dir, f'{snapshot_id}.pkl'
                )
                with open(snapshot_file, 'wb') as f:
                    pickle.dump(snapshot_doc, f)
                self._write_metadata(cache_key, {
                    'cache_key': cache_key,
                    'cached_at': datetime.now().isoformat(),
                    'etag': snapshot_doc.get('etag'),
                    'type': 'snapshot',
                    'identity_id': snapshot_doc.get('identity_id'),
                })
            except (IOError, pickle.PickleError):
                pass

    def get_snapshot(self, snapshot_id):
        """Return (snapshot_doc, etag, is_cached)."""
        with self._lock:
            try:
                cache_key = f'snapshot:{snapshot_id}'
                metadata = self._read_metadata(cache_key)
                if metadata is None:
                    return None, None, False
                snapshot_file = os.path.join(
                    self.snapshots_dir, f'{snapshot_id}.pkl'
                )
                if not os.path.exists(snapshot_file):
                    return None, None, False
                with open(snapshot_file, 'rb') as f:
                    snapshot_doc = pickle.load(f)
                return snapshot_doc, metadata.get('etag'), True
            except (IOError, pickle.PickleError, KeyError):
                return None, None, False

    def ingest_passport_row(self, row):
        """
        Store identity + snapshot(s) from one passport row.

        Accepts {identity, snapshots[]} and list rows {identity, snapshot}.
        Returns the identity id when stored, else None.
        """
        if not isinstance(row, dict):
            return None
        identity = row.get('identity')
        if not isinstance(identity, dict):
            return None
        identity_id = identity.get('_id') or identity.get('id')
        if not identity_id:
            return None

        stored_any = False
        snapshots = row.get('snapshots') or []
        if isinstance(snapshots, list) and snapshots:
            for snapshot in snapshots:
                if not isinstance(snapshot, dict):
                    continue
                snapshot_id = snapshot.get('_id') or snapshot.get('id')
                if not snapshot_id:
                    continue
                self.set_snapshot(snapshot_id, snapshot)
                stored_any = True
        else:
            snapshot = row.get('snapshot')
            if isinstance(snapshot, dict):
                snapshot_id = snapshot.get('_id') or snapshot.get('id')
                if snapshot_id:
                    self.set_snapshot(snapshot_id, snapshot)
                    stored_any = True

        if not stored_any:
            return None

        self.set_identity(identity_id, identity)
        return identity_id

    def ingest_passport_rows(self, rows):
        """Store many passport rows; return ordered identity ids."""
        identity_ids = []
        for row in rows or []:
            identity_id = self.ingest_passport_row(row)
            if identity_id:
                identity_ids.append(identity_id)
        return identity_ids

    def assemble_passport(self, identity_id):
        """
        Build {identity, snapshots:[current]} from cached documents.

        Uses identity.current_snapshot_id to pick the snapshot.
        """
        identity_doc, _, identity_ok = self.get_identity(identity_id)
        if not identity_ok or not identity_doc:
            return None
        snapshot_id = identity_doc.get('current_snapshot_id')
        if not snapshot_id:
            return None
        snapshot_doc, _, snapshot_ok = self.get_snapshot(snapshot_id)
        if not snapshot_ok or not snapshot_doc:
            return None
        return {
            'identity': identity_doc,
            'snapshots': [snapshot_doc],
        }

    def set_query(self, query_key, identity_ids, etag=None, params=None):
        """Store list-query metadata (identity id index + list ETag)."""
        with self._lock:
            try:
                self._write_metadata(query_key, {
                    'cache_key': query_key,
                    'cached_at': datetime.now().isoformat(),
                    'etag': etag,
                    'type': 'query',
                    'identity_ids': list(identity_ids),
                    'params': params,
                })
            except (IOError, TypeError):
                pass

    def get_query(self, query_key):
        """Return (identity_ids, etag, is_cached) for a list query."""
        with self._lock:
            try:
                metadata = self._read_metadata(query_key)
                if metadata is None:
                    return None, None, False
                return (
                    metadata.get('identity_ids') or [],
                    metadata.get('etag'),
                    True,
                )
            except (IOError, KeyError):
                return None, None, False

    def assemble_passport_list(self, identity_ids):
        """Build passport rows from cached identity/snapshot documents."""
        rows = []
        for identity_id in identity_ids or []:
            passport = self.assemble_passport(identity_id)
            if passport:
                rows.append(passport)
        return rows

    def invalidate(self, pattern=None):
        """
        Invalidate cache entries.

        Args:
            pattern: Optional pattern to match cache keys (None = clear all)
        """
        with self._lock:
            try:
                if pattern is None:
                    # Clear all cache
                    for directory in [
                            self.components_dir,
                            self.identities_dir,
                            self.snapshots_dir,
                            self.metadata_dir,
                            self.geometry_dir
                    ]:
                        if os.path.exists(directory):
                            for filename in os.listdir(directory):
                                file_path = os.path.join(directory, filename)
                                if os.path.isfile(file_path):
                                    os.remove(file_path)
                                elif os.path.isdir(file_path):
                                    # Remove subdirectories
                                    # (geometry type folders)
                                    import shutil
                                    shutil.rmtree(
                                        file_path,
                                        ignore_errors=True
                                    )
                else:
                    # Clear specific pattern
                    pattern_hash = self._get_cache_key_hash(pattern)
                    metadata_file = os.path.join(
                        self.metadata_dir, f"{pattern_hash}.json"
                    )
                    if os.path.exists(metadata_file):
                        os.remove(metadata_file)

            except (IOError, OSError):
                pass

    def get_cache_stats(self):
        """Get cache statistics."""
        with self._lock:
            try:
                component_count = len(
                    [f for f in os.listdir(self.components_dir)
                     if f.endswith('.pkl')]
                )
                identity_count = len(
                    [f for f in os.listdir(self.identities_dir)
                     if f.endswith('.pkl')]
                )
                snapshot_count = len(
                    [f for f in os.listdir(self.snapshots_dir)
                     if f.endswith('.pkl')]
                )
                metadata_count = len(
                    [f for f in os.listdir(self.metadata_dir)
                     if f.endswith('.json')]
                )

                # Calculate total cache size
                total_size = 0
                for directory in [
                        self.components_dir, self.identities_dir,
                        self.snapshots_dir, self.metadata_dir
                ]:
                    for filename in os.listdir(directory):
                        file_path = os.path.join(directory, filename)
                        if os.path.isfile(file_path):
                            total_size += os.path.getsize(file_path)

                # Calculate geometry cache stats
                geometry_count = 0
                geometry_size = 0
                if os.path.exists(self.geometry_dir):
                    for root, dirs, files in os.walk(self.geometry_dir):
                        for file in files:
                            if file.endswith('.pkl'):
                                geometry_count += 1
                                file_path = os.path.join(root, file)
                                if os.path.isfile(file_path):
                                    geometry_size += os.path.getsize(file_path)

                # Calculate design cache stats
                design_count = 0
                design_size = 0
                if os.path.exists(self.designs_dir):
                    for filename in os.listdir(self.designs_dir):
                        if filename.endswith('.pkl'):
                            design_count += 1
                            file_path = os.path.join(
                                self.designs_dir, filename)
                            if os.path.isfile(file_path):
                                design_size += os.path.getsize(file_path)

                return {
                    'component_count': component_count,
                    'identity_count': identity_count,
                    'snapshot_count': snapshot_count,
                    'metadata_count': metadata_count,
                    'geometry_count': geometry_count,
                    'design_count': design_count,
                    'total_size_bytes': (total_size + geometry_size +
                                         design_size),
                    'geometry_size_bytes': geometry_size,
                    'design_size_bytes': design_size,
                    'cache_dir': self.cache_dir
                }
            except (IOError, OSError):
                return {
                    'component_count': 0,
                    'identity_count': 0,
                    'snapshot_count': 0,
                    'metadata_count': 0,
                    'geometry_count': 0,
                    'design_count': 0,
                    'total_size_bytes': 0,
                    'geometry_size_bytes': 0,
                    'design_size_bytes': 0,
                    'cache_dir': self.cache_dir
                }

    def get_binary(self, cache_key):
        """
        Get cached data from binary cache.

        Args:
            cache_key: Cache key (e.g., 'component:uuid')

        Returns:
            Tuple of (data, etag, is_from_cache) or
            (None, None, False) if not found
        """
        with self._lock:
            try:
                # Check metadata cache first
                metadata_file = os.path.join(
                    self.metadata_dir,
                    f"{self._get_cache_key_hash(cache_key)}.json"
                )

                if not os.path.exists(metadata_file):
                    return None, None, False

                with open(metadata_file, 'r', encoding='utf-8') as f:
                    metadata = json.load(f)

                # Check if expired
                if self._is_expired(metadata.get('cached_at', '')):
                    return None, None, False

                # Handle different cache key types
                if cache_key.startswith('component:'):
                    # Individual component
                    component_id = cache_key.split(':', 1)[1]
                    component_file = os.path.join(
                        self.components_dir, f"{component_id}.pkl"
                    )

                    if os.path.exists(component_file):
                        with open(component_file, 'rb') as f:
                            component_data = pickle.load(f)
                        return component_data, metadata.get('etag'), True

                elif cache_key.startswith('design:'):
                    # Individual design
                    design_id = cache_key.split(':', 1)[1]
                    design_file = os.path.join(
                        self.designs_dir, f"{design_id}.pkl"
                    )

                    if os.path.exists(design_file):
                        with open(design_file, 'rb') as f:
                            design_data = pickle.load(f)
                        return design_data, metadata.get('etag'), True

                elif cache_key == 'schema:create_identity':
                    # Schema data is stored directly in metadata
                    return metadata.get('data'), metadata.get('etag'), True

                elif cache_key == 'schema:design':
                    # Schema data is stored directly in metadata
                    return metadata.get('data'), metadata.get('etag'), True

                return None, None, False

            except (IOError, pickle.PickleError, KeyError):
                return None, None, False

    def set_binary(self, cache_key, data, etag=None, filters=None):
        """
        Store data in binary cache.

        Args:
            cache_key: Cache key
            data: Data to cache
            etag: ETag for the data
            filters: Optional filter parameters
        """
        with self._lock:
            try:
                current_time = datetime.now().isoformat()
                # Guards against unhandled cache keys (avoids referencing an
                # unassigned ``metadata`` at the write step below).
                metadata = None

                if cache_key.startswith('component:'):
                    # Individual component
                    component_id = cache_key.split(':', 1)[1]
                    component_file = os.path.join(
                        self.components_dir, f"{component_id}.pkl"
                    )

                    # Store component data as pickle
                    with open(component_file, 'wb') as f:
                        pickle.dump(data, f)

                    # Store metadata
                    metadata = {
                        'cache_key': cache_key,
                        'cached_at': current_time,
                        'etag': etag,
                        'type': 'component'
                    }

                elif cache_key.startswith('design:'):
                    # Individual design
                    design_id = cache_key.split(':', 1)[1]
                    design_file = os.path.join(
                        self.designs_dir, f"{design_id}.pkl"
                    )

                    # Store design data as pickle
                    with open(design_file, 'wb') as f:
                        pickle.dump(data, f)

                    # Store metadata
                    metadata = {
                        'cache_key': cache_key,
                        'cached_at': current_time,
                        'etag': etag,
                        'type': 'design'
                    }

                elif cache_key == 'schema:create_identity':
                    # Schema data - store directly in metadata
                    metadata = {
                        'cache_key': cache_key,
                        'cached_at': current_time,
                        'etag': etag,
                        'type': 'schema',
                        'data': data
                    }

                elif cache_key == 'schema:design':
                    # Schema data - store directly in metadata
                    metadata = {
                        'cache_key': cache_key,
                        'cached_at': current_time,
                        'etag': etag,
                        'type': 'schema',
                        'data': data
                    }

                # Unhandled cache key: nothing to persist, bail out safely
                if metadata is None:
                    return

                # Write metadata file
                metadata_file = os.path.join(
                    self.metadata_dir,
                    f"{self._get_cache_key_hash(cache_key)}.json"
                )
                with open(metadata_file, 'w', encoding='utf-8') as f:
                    json.dump(metadata, f, indent=2, ensure_ascii=False)

            except (IOError, pickle.PickleError, KeyError):
                # Silently fail cache writes to not break main functionality
                pass

    def get_mesh_binary(self, snapshot_id, primitive_index, resolution):
        """
        Get one cached snapshot-primitive mesh from binary cache.

        Args:
            snapshot_id: Snapshot UUID
            primitive_index: Index into the snapshot geometry.meshes array
            resolution: 'reduced' or 'detailed'

        Returns:
            Tuple of (mesh, etag, is_from_cache) or (None, None, False)
        """
        with self._lock:
            try:
                cache_key = (
                    f'mesh:{resolution}:{snapshot_id}:{primitive_index}'
                )
                metadata_file = os.path.join(
                    self.metadata_dir,
                    f"{self._get_cache_key_hash(cache_key)}.json"
                )

                if not os.path.exists(metadata_file):
                    return None, None, False

                with open(metadata_file, 'r', encoding='utf-8') as f:
                    metadata = json.load(f)

                # Check if expired
                if self._is_expired(metadata.get('cached_at', '')):
                    return None, None, False

                # Get mesh file path
                mesh_file = os.path.join(
                    self.geometry_dir,
                    resolution,
                    f"{snapshot_id}_{primitive_index}.pkl"
                )

                if os.path.exists(mesh_file):
                    with open(mesh_file, 'rb') as f:
                        mesh_json = pickle.load(f)
                    mesh = Rhino.Geometry.Mesh.FromJSON(mesh_json)
                    if mesh:
                        return mesh, metadata.get('etag'), True

                return None, None, False

            except (IOError, pickle.PickleError, KeyError):
                return None, None, False

    def set_mesh_binary(
            self, snapshot_id, primitive_index, resolution, mesh, etag):
        """
        Cache one snapshot-primitive mesh as binary (mesh ToJSON pickle).

        Args:
            snapshot_id: Snapshot UUID
            primitive_index: Index into the snapshot geometry.meshes array
            resolution: 'reduced' or 'detailed'
            mesh: Rhino.Geometry.Mesh object (already parsed from PLY)
            etag: ETag from server response
        """
        with self._lock:
            try:
                current_time = datetime.now().isoformat()
                cache_key = (
                    f'mesh:{resolution}:{snapshot_id}:{primitive_index}'
                )

                # Create geometry subdirectory
                geometry_subdir = os.path.join(
                    self.geometry_dir, resolution
                )
                os.makedirs(geometry_subdir, exist_ok=True)

                # Convert mesh to JSON string using ToJSON
                options = Rhino.FileIO.SerializationOptions()
                options.WriteUserData = True
                options.WriteRenderMeshes = True
                options.WriteAnalysisMeshes = True
                mesh_json = mesh.ToJSON(options)

                # Store JSON string as pickle
                mesh_file = os.path.join(
                    geometry_subdir,
                    f"{snapshot_id}_{primitive_index}.pkl"
                )
                with open(mesh_file, 'wb') as f:
                    pickle.dump(mesh_json, f)

                # Store metadata
                metadata = {
                    'cache_key': cache_key,
                    'cached_at': current_time,
                    'etag': etag,
                    'type': 'mesh',
                    'resolution': resolution,
                    'snapshot_id': snapshot_id,
                    'primitive_index': primitive_index
                }

                metadata_file = os.path.join(
                    self.metadata_dir,
                    f"{self._get_cache_key_hash(cache_key)}.json"
                )
                with open(metadata_file, 'w', encoding='utf-8') as f:
                    json.dump(metadata, f, indent=2, ensure_ascii=False)

            except (IOError, pickle.PickleError, KeyError):
                # Silently fail cache writes to not break main functionality
                pass

    def get_point_cloud_binary(self, snapshot_id, primitive_index):
        """
        Get one cached snapshot point cloud from binary cache.

        Returns:
            Tuple of (point_cloud, etag, is_from_cache) or
            (None, None, False)
        """
        with self._lock:
            try:
                cache_key = (
                    f'point_cloud:{snapshot_id}:{primitive_index}'
                )
                metadata_file = os.path.join(
                    self.metadata_dir,
                    f"{self._get_cache_key_hash(cache_key)}.json"
                )

                if not os.path.exists(metadata_file):
                    return None, None, False

                with open(metadata_file, 'r', encoding='utf-8') as f:
                    metadata = json.load(f)

                if self._is_expired(metadata.get('cached_at', '')):
                    return None, None, False

                cloud_file = os.path.join(
                    self.geometry_dir,
                    'point_cloud',
                    f"{snapshot_id}_{primitive_index}.pkl"
                )

                if os.path.exists(cloud_file):
                    with open(cloud_file, 'rb') as f:
                        cloud_json = pickle.load(f)
                    loaded = Rhino.Runtime.CommonObject.FromJSON(cloud_json)
                    if isinstance(loaded, Rhino.Geometry.PointCloud):
                        return loaded, metadata.get('etag'), True

                return None, None, False

            except (IOError, pickle.PickleError, KeyError, TypeError):
                return None, None, False

    def set_point_cloud_binary(
            self, snapshot_id, primitive_index, cloud, etag):
        """
        Cache one snapshot point cloud as binary (ToJSON pickle).
        """
        with self._lock:
            try:
                current_time = datetime.now().isoformat()
                cache_key = (
                    f'point_cloud:{snapshot_id}:{primitive_index}'
                )

                geometry_subdir = os.path.join(
                    self.geometry_dir, 'point_cloud'
                )
                os.makedirs(geometry_subdir, exist_ok=True)

                options = Rhino.FileIO.SerializationOptions()
                options.WriteUserData = True
                cloud_json = cloud.ToJSON(options)

                cloud_file = os.path.join(
                    geometry_subdir,
                    f"{snapshot_id}_{primitive_index}.pkl"
                )
                with open(cloud_file, 'wb') as f:
                    pickle.dump(cloud_json, f)

                metadata = {
                    'cache_key': cache_key,
                    'cached_at': current_time,
                    'etag': etag,
                    'type': 'point_cloud',
                    'snapshot_id': snapshot_id,
                    'primitive_index': primitive_index
                }

                metadata_file = os.path.join(
                    self.metadata_dir,
                    f"{self._get_cache_key_hash(cache_key)}.json"
                )
                with open(metadata_file, 'w', encoding='utf-8') as f:
                    json.dump(metadata, f, indent=2, ensure_ascii=False)

            except (IOError, pickle.PickleError, KeyError):
                pass


def _parse_ply_binary_to_mesh(ply_bytes):
    """
    Parse a binary_little_endian PLY (CSC canonical, Rhino Z-up) into a
    single Rhino.Geometry.Mesh. Supports float/double vertex coords,
    optional uchar red/green/blue, and a face list (uchar count + int
    indices). No coordinate rotation is applied (PLY is already Z-up).
    Returns the mesh or None on failure.
    """
    try:
        if not ply_bytes:
            return None

        # Locate end of (ascii) header
        marker = b'end_header\n'
        header_end = ply_bytes.find(marker)
        if header_end == -1:
            print('PLY: missing end_header')
            return None
        header_text = ply_bytes[:header_end].decode('ascii', 'ignore')
        body = ply_bytes[header_end + len(marker):]

        if 'binary_little_endian' not in header_text:
            print('PLY: only binary_little_endian supported')
            return None

        # Parse header elements/properties
        _type_fmt = {
            'char': 'b', 'int8': 'b',
            'uchar': 'B', 'uint8': 'B',
            'short': 'h', 'int16': 'h',
            'ushort': 'H', 'uint16': 'H',
            'int': 'i', 'int32': 'i',
            'uint': 'I', 'uint32': 'I',
            'float': 'f', 'float32': 'f',
            'double': 'd', 'float64': 'd',
        }
        _type_size = {
            'b': 1, 'B': 1, 'h': 2, 'H': 2,
            'i': 4, 'I': 4, 'f': 4, 'd': 8,
        }

        vertex_count = 0
        face_count = 0
        vertex_props = []  # list of (fmt_char, name)
        face_list = None  # (count_fmt, index_fmt)
        current = None
        for raw_line in header_text.splitlines():
            line = raw_line.strip()
            if not line:
                continue
            tok = line.split()
            if tok[0] == 'element':
                current = tok[1]
                if current == 'vertex':
                    vertex_count = int(tok[2])
                elif current == 'face':
                    face_count = int(tok[2])
            elif tok[0] == 'property':
                if tok[1] == 'list':
                    count_fmt = _type_fmt.get(tok[2], 'B')
                    index_fmt = _type_fmt.get(tok[3], 'i')
                    face_list = (count_fmt, index_fmt)
                elif current == 'vertex':
                    fmt = _type_fmt.get(tok[1])
                    if fmt:
                        vertex_props.append((fmt, tok[2]))

        if face_list is None:
            face_list = ('B', 'i')

        # Read vertices
        vertex_struct = struct.Struct(
            '<' + ''.join(f for f, _ in vertex_props)
        )
        names = [n for _, n in vertex_props]
        ix = names.index('x') if 'x' in names else 0
        iy = names.index('y') if 'y' in names else 1
        iz = names.index('z') if 'z' in names else 2
        has_color = ('red' in names and 'green' in names and
                     'blue' in names)
        if has_color:
            ir = names.index('red')
            ig = names.index('green')
            ib = names.index('blue')

        mesh = Rhino.Geometry.Mesh()
        offset = 0
        vsize = vertex_struct.size
        colors = []
        for _ in range(vertex_count):
            vals = vertex_struct.unpack_from(body, offset)
            offset += vsize
            mesh.Vertices.Add(
                float(vals[ix]), float(vals[iy]), float(vals[iz])
            )
            if has_color:
                colors.append(
                    (int(vals[ir]), int(vals[ig]), int(vals[ib]))
                )

        # Read faces
        count_fmt, index_fmt = face_list
        count_struct = struct.Struct('<' + count_fmt)
        count_size = _type_size[count_fmt]
        index_size = _type_size[index_fmt]
        for _ in range(face_count):
            (n,) = count_struct.unpack_from(body, offset)
            offset += count_size
            idx_struct = struct.Struct('<' + index_fmt * n)
            indices = idx_struct.unpack_from(body, offset)
            offset += index_size * n
            if n == 3:
                mesh.Faces.AddFace(indices[0], indices[1], indices[2])
            elif n == 4:
                mesh.Faces.AddFace(
                    indices[0], indices[1], indices[2], indices[3]
                )
            elif n > 4:
                for k in range(1, n - 1):
                    mesh.Faces.AddFace(
                        indices[0], indices[k], indices[k + 1]
                    )

        if has_color and len(colors) == mesh.Vertices.Count:
            for r, g, b in colors:
                mesh.VertexColors.Add(r, g, b)

        mesh.Normals.ComputeNormals()
        mesh.Compact()
        return mesh

    except Exception as e:
        print(f'Error parsing PLY: {str(e)}')
        return None


def _parse_ply_binary_to_point_cloud(ply_bytes):
    """
    Parse a binary_little_endian point-cloud PLY (vertices only, optional
    uchar rgb) into a Rhino.Geometry.PointCloud.
    """
    try:
        if not ply_bytes:
            return None

        marker = b'end_header\n'
        header_end = ply_bytes.find(marker)
        if header_end == -1:
            print('PLY point cloud: missing end_header')
            return None
        header_text = ply_bytes[:header_end].decode('ascii', 'ignore')
        body = ply_bytes[header_end + len(marker):]

        if 'binary_little_endian' not in header_text:
            print('PLY point cloud: only binary_little_endian supported')
            return None

        _type_fmt = {
            'char': 'b', 'int8': 'b',
            'uchar': 'B', 'uint8': 'B',
            'short': 'h', 'int16': 'h',
            'ushort': 'H', 'uint16': 'H',
            'int': 'i', 'int32': 'i',
            'uint': 'I', 'uint32': 'I',
            'float': 'f', 'float32': 'f',
            'double': 'd', 'float64': 'd',
        }

        vertex_count = 0
        vertex_props = []
        current = None
        for raw_line in header_text.splitlines():
            line = raw_line.strip()
            if not line:
                continue
            tok = line.split()
            if tok[0] == 'element':
                current = tok[1]
                if current == 'vertex':
                    vertex_count = int(tok[2])
            elif tok[0] == 'property' and current == 'vertex':
                if tok[1] != 'list':
                    fmt = _type_fmt.get(tok[1])
                    if fmt:
                        vertex_props.append((fmt, tok[2]))

        if vertex_count <= 0 or not vertex_props:
            return None

        vertex_struct = struct.Struct(
            '<' + ''.join(f for f, _ in vertex_props)
        )
        names = [n for _, n in vertex_props]
        ix = names.index('x') if 'x' in names else 0
        iy = names.index('y') if 'y' in names else 1
        iz = names.index('z') if 'z' in names else 2
        has_color = ('red' in names and 'green' in names and
                     'blue' in names)
        if has_color:
            ir = names.index('red')
            ig = names.index('green')
            ib = names.index('blue')

        cloud = Rhino.Geometry.PointCloud()
        offset = 0
        vsize = vertex_struct.size
        for _ in range(vertex_count):
            vals = vertex_struct.unpack_from(body, offset)
            offset += vsize
            point = Rhino.Geometry.Point3d(
                float(vals[ix]), float(vals[iy]), float(vals[iz]))
            if has_color:
                cloud.Add(
                    point,
                    System.Drawing.Color.FromArgb(
                        int(vals[ir]), int(vals[ig]), int(vals[ib])))
            else:
                cloud.Add(point)

        return cloud if cloud.Count > 0 else None

    except Exception as e:
        print(f'Error parsing point cloud PLY: {str(e)}')
        return None


# AuthCore - Embedded ---------------------------------------------------------

class _AuthCore(object):
    """
    Authorization and cache management tool that gets stored in sticky to be
    used by other CSC Grasshopper Components.

    Author: Max Benjamin Eschenbach
    License: MIT License
    """

    def __init__(self, base_url, leeway=30, disable_cache=False):
        self.base_url = (base_url or 'https://api.2ndchances.build').rstrip('/')
        self.leeway = int(leeway) if leeway is not None else 30
        self.disable_cache = disable_cache
        self._lock = RLock()
        self._token = None
        self._exp = 0
        self._username = None
        self._cache = None if disable_cache else _ComponentCache()

    @staticmethod
    def _now():
        return int(time.time())

    @staticmethod
    def _b64url_decode(seg):
        rem = len(seg) % 4
        if rem:
            seg += '=' * (4 - rem)
        return base64.urlsafe_b64decode(seg.encode('utf-8'))

    @classmethod
    def _jwt_payload(cls, token):
        try:
            parts = token.split('.')
            if len(parts) != 3:
                return {}
            return json.loads(cls._b64url_decode(parts[1]).decode('utf-8'))
        except Exception:
            return {}

    def set_access_token(self, token, username=None):
        payload = self._jwt_payload(token)
        exp = int(payload.get('exp', 0))
        if exp <= 0:
            exp = self._now() + 3600  # 1h fallback if no exp claim
        with self._lock:
            self._token = token
            self._exp = exp
            if username:
                self._username = username

    def clear(self):
        with self._lock:
            self._token = None
            self._exp = 0
            self._username = None

    def is_valid(self):
        with self._lock:
            if not self._token or self._exp <= 0:
                return False
            return (self._now() + self.leeway) < self._exp

    def get_username(self):
        with self._lock:
            return self._username

    def auth_header(self):
        with self._lock:
            return ({'Authorization': 'Bearer ' + self._token}
                    if self._token else {})

    def authorized_get(
            self,
            path,
            params=None,
            extra_headers=None,
            timeout=20):
        if not self.is_valid():
            raise RuntimeError(
                'Access token missing or expired. Please sign in again.'
            )
        headers = self.auth_header()
        if extra_headers:
            headers.update(extra_headers)
        return requests.get(
            self.base_url + path,
            params=params,
            headers=headers,
            timeout=timeout
        )

    def authorized_post(
            self,
            path,
            json_body=None,
            files=None,
            extra_headers=None,
            timeout=60):
        if not self.is_valid():
            raise RuntimeError(
                'Access token missing or expired. Please sign in again.'
            )
        headers = self.auth_header()
        if extra_headers:
            headers.update(extra_headers)
        # Handle file uploads vs JSON requests
        if files is not None:
            # For file uploads, don't set Content-Type header
            # (let requests handle it)
            # and use data instead of json
            return requests.post(
                self.base_url + path,
                files=files,
                headers=headers,
                timeout=timeout
            )
        else:
            # For JSON requests, use json parameter
            return requests.post(
                self.base_url + path,
                json=json_body,
                headers=headers,
                timeout=timeout
            )

    def validate_uuid(self, uuid_to_test: str, version: int = 4):
        """
        Check if uuid_to_test is a valid UUID.
        Returns True if uuid_to_test is a valid UUID, otherwise False.
        """
        try:
            uuid_obj = uuid.UUID(uuid_to_test, version=version)
        except ValueError:
            return False
        return str(uuid_obj) == uuid_to_test

    def resolve_identity_id_from_input(self, value):
        """
        Resolve an identity UUID from a raw UUID string or passport JSON.
        """
        if value is None:
            return None
        text = str(value).strip()
        if not text:
            return None
        if self.validate_uuid(text):
            return text
        try:
            data = value if isinstance(value, dict) else json.loads(text)
        except (TypeError, ValueError, json.JSONDecodeError):
            return None
        if not isinstance(data, dict):
            return None
        identity = data.get('identity')
        if not isinstance(identity, dict):
            return None
        identity_id = identity.get('_id') or identity.get('id')
        if identity_id and self.validate_uuid(str(identity_id)):
            return str(identity_id)
        return None

    def primary_snapshot(self, passport):
        """Return the first snapshot from a passport payload."""
        return primary_snapshot_from_passport(passport)

    def normalize_passport_output(self, passport):
        """Return {identity, snapshots[]} for downstream GH components."""
        return normalize_passport_payload(passport)

    def passport_json_string(self, passport):
        """
        Serialize one passport row in the canonical
        {identity, snapshots[]} shape.
        """
        return json.dumps(self.normalize_passport_output(passport))

    # Cache Management Methods ------------------------------------------------

    def get_cache(self):
        """Get the cache instance."""
        return self._cache

    def set_cache_enabled(self, enabled):
        """Enable or disable caching."""
        with self._lock:
            self.disable_cache = not enabled
            if enabled and self._cache is None:
                self._cache = _ComponentCache()
            elif not enabled:
                self._cache = None

    def is_cache_enabled(self):
        """Check if caching is enabled."""
        return self._cache is not None

    def sync_cache(self):
        """Force cache synchronization (clear cache)."""
        if self._cache:
            self._cache.invalidate()

    def get_cache_stats(self):
        """Get cache statistics."""
        if self._cache:
            return self._cache.get_cache_stats()
        return {
            'component_count': 0,
            'metadata_count': 0,
            'total_size_bytes': 0,
            'cache_dir': 'Cache disabled'
        }

    def cached_get(
            self,
            path,
            cache_key,
            params=None,
            extra_headers=None,
            timeout=20):
        """
        Make a cached GET request with ETag support.

        Args:
            path: API path
            cache_key: Cache key for this request
            params: Query parameters
            extra_headers: Additional headers
            timeout: Request timeout

        Returns:
            Response object
        """
        if not self.is_valid():
            raise RuntimeError(
                'Access token missing or expired. Please sign in again.'
            )

        # If cache is disabled, make regular request
        if not self._cache:
            return self.authorized_get(path, params, extra_headers, timeout)

        # Check cache first
        cached_data, cached_etag, is_from_cache = self._cache.get(cache_key)

        # Prepare headers
        headers = self.auth_header()
        if extra_headers:
            headers.update(extra_headers)

        # Add conditional request header if we have cached data
        if is_from_cache and cached_etag:
            headers['If-None-Match'] = cached_etag

        # Make request
        response = requests.get(
            self.base_url + path,
            params=params,
            headers=headers,
            timeout=timeout
        )

        # Handle response
        if response.status_code == 304 and is_from_cache:
            return _CachedResponse(cached_data, cached_etag)

        elif response.status_code == 200:
            # Data changed or first request - cache the response.
            # Cache writes must never break the fetch, so swallow any
            # parse/serialise/IO error and just return the live response.
            try:
                data = response.json()
                etag = response.headers.get('ETag')
                self._cache.set(cache_key, data, etag, params)
            except Exception:
                pass

        return response

    def cached_list_identities(
            self,
            params=None,
            extra_headers=None,
            timeout=60):
        """
        Fetch GET /identities with unified identity/snapshot caching.

        List responses store per-identity and per-snapshot documents plus a
        lightweight query index (identity ids + list ETag). A 304 reassembles
        passport rows from the individual caches.
        """
        if not self.is_valid():
            raise RuntimeError(
                'Access token missing or expired. Please sign in again.'
            )

        params = dict(params or {})
        query_key = _query_cache_key(params)

        if not self._cache:
            return self.authorized_get(
                '/identities', params, extra_headers, timeout)

        identity_ids, query_etag, has_query = self._cache.get_query(
            query_key)

        headers = self.auth_header()
        if extra_headers:
            headers.update(extra_headers)
        if has_query and query_etag:
            headers['If-None-Match'] = query_etag

        response = requests.get(
            self.base_url + '/identities',
            params=params,
            headers=headers,
            timeout=timeout
        )

        if response.status_code == 304:
            if has_query and identity_ids:
                rows = self._cache.assemble_passport_list(identity_ids)
                if rows:
                    return _CachedResponse(rows, query_etag)
            # Stale query index ? refetch without conditional header
            headers = self.auth_header()
            if extra_headers:
                headers.update(extra_headers)
            response = requests.get(
                self.base_url + '/identities',
                params=params,
                headers=headers,
                timeout=timeout
            )

        if response.status_code == 200:
            try:
                data = response.json()
                if isinstance(data, list):
                    stored_ids = self._cache.ingest_passport_rows(data)
                    list_etag = response.headers.get('ETag')
                    self._cache.set_query(
                        query_key, stored_ids, list_etag, params)
            except Exception:
                pass

        return response

    def cached_get_passport(
            self,
            identity_id,
            snapshots=None,
            extra_headers=None,
            timeout=20):
        """
        Fetch GET /identities/{id}/compose with caching.

        ``snapshots``: None/'current' (default), 'all', or a list of snapshot
        UUID strings. Passport ETag matches the backend; 304 returns cached
        body when available.
        """
        if not self.is_valid():
            raise RuntimeError(
                'Access token missing or expired. Please sign in again.'
            )

        params = {}
        if snapshots == 'all':
            params['snapshots'] = 'all'
        elif isinstance(snapshots, (list, tuple)) and snapshots:
            params['snapshots'] = ','.join(str(item) for item in snapshots)

        path = f'/identities/{identity_id}/compose'
        cache_key = _passport_cache_key(identity_id, snapshots)
        use_current_assembly = (
            not snapshots or snapshots == 'current'
        )

        cached_body = None
        cached_etag = None
        if self._cache:
            if use_current_assembly:
                cached_body = self._cache.assemble_passport(identity_id)
            else:
                cached_body, cached_etag, cached_ok = self._cache.get(
                    cache_key,
                )
                if not cached_ok:
                    cached_body = None
                    cached_etag = None

            if cached_body and isinstance(cached_body.get('identity'), dict):
                snapshot_docs = cached_body.get('snapshots') or []
                cached_etag = _compute_passport_etag(
                    cached_body['identity'],
                    snapshot_docs,
                )

        if not self._cache:
            return self.authorized_get(
                path, params or None, extra_headers, timeout)

        headers = self.auth_header()
        if extra_headers:
            headers.update(extra_headers)
        if cached_etag:
            headers['If-None-Match'] = cached_etag

        response = requests.get(
            self.base_url + path,
            headers=headers,
            params=params or None,
            timeout=timeout,
        )

        if response.status_code == 304:
            if cached_body:
                return _CachedResponse(cached_body, cached_etag)
            headers = self.auth_header()
            if extra_headers:
                headers.update(extra_headers)
            response = requests.get(
                self.base_url + path,
                headers=headers,
                params=params or None,
                timeout=timeout,
            )

        if response.status_code == 200:
            try:
                data = response.json()
                if self._cache:
                    etag = response.headers.get('ETag')
                    if not etag and isinstance(data.get('identity'), dict):
                        etag = _compute_passport_etag(
                            data['identity'],
                            data.get('snapshots') or [],
                        )
                    if not use_current_assembly:
                        self._cache.set(cache_key, data, etag)
                    self._cache.ingest_passport_row(data)
            except Exception:
                pass

        return response

    def cached_get_snapshot_mesh(self, snapshot_id, primitive_index,
                                 resolution, timeout=60):
        """
        Fetch one snapshot-primitive mesh PLY with ETag caching.

        Args:
            snapshot_id: Snapshot UUID
            primitive_index: Index into the snapshot geometry.meshes array
            resolution: 'reduced' or 'detailed'
            timeout: Request timeout

        Returns:
            Tuple of (mesh, etag, is_from_cache). ``mesh`` is None when the
            requested resolution is unavailable (404) or on parse/transport
            error, signalling the caller to fall back to inline geometry.
        """
        if not self.is_valid():
            raise RuntimeError(
                'Access token missing or expired. Please sign in again.'
            )

        path = (
            f'/snapshots/{snapshot_id}/meshes/'
            f'{primitive_index}/{resolution}'
        )

        # If cache is disabled, fetch + parse without caching
        if not self._cache:
            response = self.authorized_get(path, timeout=timeout)
            if response.status_code == 200:
                mesh = _parse_ply_binary_to_mesh(response.content)
                etag = response.headers.get('ETag')
                return mesh, etag, False
            return None, None, False

        # Check binary cache first
        (cached_mesh,
         cached_etag,
         is_from_cache) = self._cache.get_mesh_binary(
            snapshot_id, primitive_index, resolution)

        # Prepare headers (conditional request when we have cached data)
        headers = self.auth_header()
        if is_from_cache and cached_etag:
            headers['If-None-Match'] = cached_etag

        response = requests.get(
            self.base_url + path,
            headers=headers,
            timeout=timeout
        )

        if response.status_code == 304 and is_from_cache:
            # Not modified - return cached mesh
            return cached_mesh, cached_etag, True

        if response.status_code == 200:
            mesh = _parse_ply_binary_to_mesh(response.content)
            etag = response.headers.get('ETag')
            if mesh is not None:
                try:
                    self._cache.set_mesh_binary(
                        snapshot_id, primitive_index, resolution, mesh, etag
                    )
                except (ValueError, KeyError):
                    pass
            return mesh, etag, False

        # 404 / other -> unavailable; caller falls back to inline geometry
        return None, None, False

    def cached_get_snapshot_point_cloud(self, snapshot_id, primitive_index,
                                        timeout=60):
        """
        Fetch one snapshot point-cloud PLY with ETag caching.

        Returns a Rhino PointCloud or None when unavailable. Callers keep
        the object return (unlike cached_get_snapshot_mesh) so Bake /
        Fetch / PassportToD2P stay unchanged.
        """
        if not self.is_valid():
            raise RuntimeError(
                'Access token missing or expired. Please sign in again.'
            )

        path = (
            f'/snapshots/{snapshot_id}/point_clouds/'
            f'{primitive_index}.ply'
        )

        if not self._cache:
            response = self.authorized_get(path, timeout=timeout)
            if response.status_code == 200:
                return _parse_ply_binary_to_point_cloud(response.content)
            return None

        (cached_cloud,
         cached_etag,
         is_from_cache) = self._cache.get_point_cloud_binary(
            snapshot_id, primitive_index)

        headers = self.auth_header()
        if is_from_cache and cached_etag:
            headers['If-None-Match'] = cached_etag

        response = requests.get(
            self.base_url + path,
            headers=headers,
            timeout=timeout
        )

        if response.status_code == 304 and is_from_cache:
            return cached_cloud

        if response.status_code == 200:
            cloud = _parse_ply_binary_to_point_cloud(response.content)
            etag = response.headers.get('ETag')
            if cloud is not None:
                try:
                    self._cache.set_point_cloud_binary(
                        snapshot_id, primitive_index, cloud, etag
                    )
                except (ValueError, KeyError):
                    pass
            return cloud

        return None

    def get_create_identity_schema(self, force_refresh=False):
        """
        Get CreateComponentRequest JSON Schema (POST /identities).

        Args:
            force_refresh: Force refresh of schema even if cached

        Returns:
            Schema dictionary or None if failed
        """
        cache_key = 'schema:create_identity'
        endpoint = '/schema/create-identity'

        if not self.base_url:
            raise RuntimeError(
                'Base URL not configured. Please sign in first.')

        if not self._cache:
            try:
                response = requests.get(f'{self.base_url}{endpoint}')
                if response.status_code == 200:
                    return response.json()
                return None
            except Exception:
                return None

        if not force_refresh:
            cached_schema, cached_etag, is_from_cache = self._cache.get(
                cache_key)
            if is_from_cache:
                return cached_schema

        try:
            headers = {}
            if not force_refresh:
                cached_schema, cached_etag, is_from_cache = self._cache.get(
                    cache_key)
                if is_from_cache and cached_etag:
                    headers['If-None-Match'] = cached_etag

            response = requests.get(
                f'{self.base_url}{endpoint}',
                headers=headers,
            )

            if response.status_code == 304 and not force_refresh:
                cached_schema, _, is_from_cache = self._cache.get(cache_key)
                if is_from_cache:
                    return cached_schema

            elif response.status_code == 200:
                try:
                    data = response.json()
                    etag = response.headers.get('ETag')
                    self._cache.set(cache_key, data, etag)
                    return data
                except (ValueError, KeyError):
                    return None

            return None
        except Exception:
            if not force_refresh:
                cached_schema, _, is_from_cache = self._cache.get(cache_key)
                if is_from_cache:
                    return cached_schema
            return None

    def get_design_schema(self, force_refresh=False):
        """
        Get design schema with caching support.

        Args:
            force_refresh: Force refresh of schema even if cached

        Returns:
            Design schema dictionary or None if failed
        """
        # Schema endpoints are unprotected, so we can access without auth
        # But we still need to check if we have a valid base_url
        if not self.base_url:
            raise RuntimeError(
                'Base URL not configured. Please sign in first.')

        # If cache is disabled, make regular request
        # (schema endpoint is unprotected)
        if not self._cache:
            try:
                response = requests.get(f'{self.base_url}/schema/design')
                if response.status_code == 200:
                    return response.json()
                return None
            except Exception:
                return None

        # Check cache first (unless force refresh)
        if not force_refresh:
            cached_schema, cached_etag, is_from_cache = self._cache.get(
                'schema:design')
            if is_from_cache:
                return cached_schema

        # Make request to get schema (unprotected endpoint)
        try:
            # Prepare headers for conditional request
            headers = {}
            if not force_refresh:
                cached_schema, cached_etag, is_from_cache = self._cache.get(
                    'schema:design')
                if is_from_cache and cached_etag:
                    headers['If-None-Match'] = cached_etag

            response = requests.get(f'{self.base_url}/schema/design',
                                    headers=headers)

            if response.status_code == 304 and not force_refresh:
                # Not modified - return cached data
                cached_schema, _, is_from_cache = self._cache.get(
                    'schema:design')
                if is_from_cache:
                    return cached_schema

            elif response.status_code == 200:
                # Data changed or first request - cache the response
                try:
                    data = response.json()
                    etag = response.headers.get('ETag')
                    self._cache.set('schema:design', data, etag)
                    return data
                except (ValueError, KeyError):
                    return None

            return None
        except Exception:
            # If request fails and we have cached schema, return cached version
            if not force_refresh:
                cached_schema, _, is_from_cache = self._cache.get(
                    'schema:design')
                if is_from_cache:
                    return cached_schema
            return None


class CSC_Session(Grasshopper.Kernel.GH_ScriptInstance):
    """
    Author: Max Benjamin Eschenbach
    License: MIT License
    """

    # Development setting - do not change!
    __HARD_RESET = False

    def __init__(self):
        """Initialize this component and set component parameters."""
        super().__init__()
        # initialize props
        self.Component = ghenv.Component  # type: ignore[reportUnedfinedVariable] # NOQA
        self.InputParams = self.Component.Params.Input
        self.OutputParams = self.Component.Params.Output

    def _addRemark(self, msg: str = ''):
        """Add a remark message to the component."""
        rml = self.Component.RuntimeMessageLevel.Remark
        self.AddRuntimeMessage(rml, msg)

    def _addWarning(self, msg: str = ''):
        """Add a warning message to the component."""
        rml = self.Component.RuntimeMessageLevel.Warning
        self.AddRuntimeMessage(rml, msg)

    def _addError(self, msg: str = ''):
        """Add an error message to the component."""
        rml = self.Component.RuntimeMessageLevel.Error
        self.AddRuntimeMessage(rml, msg)

    def BeforeRunScript(self):
        """Perform some setup actions."""
        # Initialize input param descriptions
        self.InputParams[0].Description = 'Your Username or E-Mail'
        self.InputParams[1].Description = 'Your password'
        self.InputParams[2].Description = (
            'Refresh toggle, press when your token expired'
        )
        self.InputParams[3].Description = (
            'Disable caching (default: False - caching enabled)'
        )
        self.InputParams[4].Description = (
            'Clear cache (default: False)'
        )
        # Initialize output param descriptions
        i = 0
        if self.OutputParams[0].Name == 'out':
            i += 1
        self.OutputParams[0+i].Description = (
            'Status Message'
        )

    def get_auth_core_from_sticky(self):
        """Get AuthCore instance from sticky storage or create new one."""
        if not self.__HARD_RESET:
            auth_core = sc.sticky.get('CSC_AuthCore')
        else:
            auth_core = None
        if auth_core is None:
            # Create new AuthCore instance with default settings
            auth_core = _AuthCore(
                base_url='https://api.2ndchances.build'
            )
            sc.sticky['CSC_AuthCore'] = auth_core
        return auth_core

    def RunScript(self,
            Username: str,
            Password: str,
            Refresh: bool,
            DisableCache: bool,
            ClearCache: bool):
        # Initialize status messages list
        status_messages = []

        # Sanitize input parameters (defaults don't work in function signature)
        if DisableCache is None:
            DisableCache = False
        if ClearCache is None:
            ClearCache = False

        # Get or create AuthCore instance
        auth_core = self.get_auth_core_from_sticky()

        # Handle cache management
        if ClearCache:
            auth_core.sync_cache()
            status_messages.append('Cache cleared')
            self.Component.Message = 'Cache cleared'
            # Return status messages
            Status = status_messages
            return (Status,)

        # Set cache enabled/disabled
        auth_core.set_cache_enabled(not DisableCache)

        # Input validation
        if not Username or not Username.strip():
            status_messages.append('Please provide username/email')
            self.Component.Message = 'Please provide username/email'
            Status = status_messages
            return (Status,)

        if not Password or not Password.strip():
            status_messages.append('Please provide password')
            self.Component.Message = 'Please provide password'
            Status = status_messages
            return (Status,)

        username = Username.strip()
        password = Password.strip()

        try:
            if Refresh:
                # Refresh authentication - clear existing token and re-auth
                auth_core.clear()
                self.Component.Message = 'Refreshing authentication...'
            else:
                # Check if we already have a valid token
                if auth_core.is_valid():
                    current_user = auth_core.get_username()
                    self.Component.Message = (
                        f'Already signed in as: {current_user}'
                    )

                    # Fetch and cache create-identity schema
                    try:
                        schema = auth_core.get_create_identity_schema()
                        if schema:
                            status_messages.append(
                                'Create-identity schema cached')
                            self._addRemark(
                                'Create-identity schema cached successfully'
                            )
                        else:
                            status_messages.append('Failed to cache schema')
                            self._addWarning(
                                'Failed to cache create-identity schema'
                            )
                    except Exception as e:
                        status_messages.append(
                            f'Schema caching failed: {str(e)}')
                        self._addWarning(f'Schema cache failed: {str(e)}')

                    # Get cache status for output
                    cache_stats = auth_core.get_cache_stats()
                    cache_enabled = auth_core.is_cache_enabled()
                    comp_count = cache_stats["component_count"]
                    geometry_count = cache_stats["geometry_count"]
                    design_count = cache_stats["design_count"]
                    size_kb = cache_stats["total_size_bytes"] // 1024
                    geometry_size_kb = (
                        cache_stats["geometry_size_bytes"] // 1024
                    )
                    design_size_kb = (
                        cache_stats["design_size_bytes"] // 1024
                    )

                    # Add cache status to messages
                    cache_status = (
                        'Cache: '
                        f'{"Enabled" if cache_enabled else "Disabled"}\n'
                        f' | Components: {comp_count}\n'
                        f' | Geometry: {geometry_count} files\n'
                        f' | Designs: {design_count} files\n'
                        f' | Size: {size_kb} kB\n'
                        f' | Geometry: {geometry_size_kb} kB\n'
                        f' | Designs: {design_size_kb} kB\n')
                    status_messages.append(cache_status)
                    Status = status_messages
                    return (Status,)

                self.Component.Message = 'Signing in...'

            # Prepare login data
            login_data = {
                'username': username,
                'password': password
            }

            # Make login request
            response = requests.post(
                f'{auth_core.base_url}/auth/token',
                data=login_data,
                headers={
                    'Content-Type': 'application/x-www-form-urlencoded'
                },
                timeout=20
            )

            if response.status_code == 200:
                # Login successful
                token_data = response.json()
                access_token = token_data.get('access_token')

                if access_token:
                    # Store token in AuthCore
                    auth_core.set_access_token(access_token, username)

                    # Update sticky storage
                    sc.sticky['CSC_AuthCore'] = auth_core

                    # Fetch and cache create-identity schema
                    try:
                        schema = auth_core.get_create_identity_schema()
                        if schema:
                            status_messages.append(
                                'Create-identity schema cached')
                            self._addRemark(
                                'Create-identity schema cached successfully'
                            )
                        else:
                            status_messages.append('Failed to cache schema')
                            self._addWarning(
                                'Failed to cache create-identity schema'
                            )
                    except Exception as e:
                        status_messages.append(
                            f'Schema caching failed: {str(e)}')
                        self._addWarning(f'Schema cache failed: {str(e)}')

                    # Get cache status for output
                    cache_stats = auth_core.get_cache_stats()
                    cache_enabled = auth_core.is_cache_enabled()
                    comp_count = cache_stats["component_count"]
                    geometry_count = cache_stats["geometry_count"]
                    design_count = cache_stats["design_count"]
                    size_kb = cache_stats["total_size_bytes"] // 1024
                    geometry_size_kb = (
                        cache_stats["geometry_size_bytes"] // 1024
                    )
                    design_size_kb = (
                        cache_stats["design_size_bytes"] // 1024
                    )

                    # Add cache status to messages
                    cache_status = (
                        f'Cache: '
                        f'{"Enabled" if cache_enabled else "Disabled"}\n'
                        f' | Components: {comp_count}\n'
                        f' | Geometry: {geometry_count} files\n'
                        f' | Designs: {design_count} files\n'
                        f' | Size: {size_kb} kB\n'
                        f' | Geometry: {geometry_size_kb} kB\n'
                        f' | Designs: {design_size_kb} kB\n')
                    status_messages.append(cache_status)

                    self.Component.Message = f'Signed in as: {username}'

                    # Return status messages
                    Status = status_messages
                    return (Status,)

                else:
                    msg = 'Login failed: No token received'
                    status_messages.append(msg)
                    self._addWarning(msg)
                    self.Component.Message = msg
                    Status = status_messages
                    return (Status,)

            elif response.status_code == 401:
                msg = 'Invalid username or password'
                status_messages.append(msg)
                self._addError(msg)
                self.Component.Message = msg
                Status = status_messages
                return (Status,)

            elif response.status_code == 422:
                msg = 'Invalid input data'
                status_messages.append(msg)
                self._addError(msg)
                self.Component.Message = msg
                Status = status_messages
                return (Status,)

            elif response.status_code == 500:
                msg = 'Server error - please try again'
                status_messages.append(msg)
                self._addWarning(msg)
                self.Component.Message = msg
                Status = status_messages
                return (Status,)

            else:
                msg = f'Login failed with status code: {response.status_code}'
                status_messages.append(msg)
                self._addError(msg)
                self.Component.Message = msg
                Status = status_messages
                return (Status,)

        except requests.exceptions.ConnectionError as e:
            msg = 'Cannot connect to server - check URL'
            status_messages.append(msg)
            self._addError(msg + f'\nFull Error: {str(e)}')
            self.Component.Message = msg
            Status = status_messages
            return (Status,)

        except requests.exceptions.Timeout as e:
            msg = 'Request timeout - server may be slow'
            status_messages.append(msg)
            self._addError(msg + f'\nFull Error: {str(e)}')
            self.Component.Message = msg
            Status = status_messages
            return (Status,)

        except requests.exceptions.RequestException as e:
            msg = f'Request error: {str(e)}'
            status_messages.append(msg)
            self._addError(msg)
            self.Component.Message = msg
            Status = status_messages
            return (Status,)

        except Exception as e:
            msg = f'Unexpected error: {str(e)}'
            status_messages.append(msg)
            self.Component.Message = msg
            Status = status_messages
            return (Status,)
# ---------- end csc_session ----------
status_messages = Panel(csc_session)

# comments & notes: Fetch a subset of components from the database using filters. Here we are fetching the 'mineral_composite_panels' dataset.
# 
# NOTE: ReservedStatus = -1 means we ignore reservations entirely
# Step 2
fragment = ValueList({"Any": , "Only fragments": True, "Only non-fragmnents": False}, selected="Any")
dataset = Panel("mineral_composite_panels")
maxdimensiony = Slider(0, range=0..2000)
mindimensionx = Slider(0, range=-0.1..2000)
maxdimensionx = Slider(0, range=0..2000)
maxdimensionz = Slider(0, range=0..500)
mindimensiony = Slider(0, range=0..2000)
mindimensionz = Slider(0, range=0..500)
reservedstatus = Slider(-1, range=-1..1)
complexity = ValueList({"Any complexity": , "0", "1", "2", "3"}, selected="Any complexity")
material = ValueList({"Any material": , "corian", "concrete", "timber", "aluminium", "steel"}, selected="Any material")
type = ValueList({"All types": , "panel", "beam", "column", "slab", "rubble", "brick", "pipe", "profile", "connector", "other"}, selected="All types")
fetchfilteredcomponents = FetchFilteredComponents(
    Type=type,
    Material=material,
    Dataset=dataset,
    Complexity=complexity,
    Fragment=fragment,
    MinDimensionX=mindimensionx,
    MaxDimensionX=maxdimensionx,
    MinDimensionY=mindimensiony,
    MaxDimensionY=maxdimensiony,
    MinDimensionZ=mindimensionz,
    MaxDimensionZ=maxdimensionz,
    ReservedStatus=reservedstatus)  # -> FilterDescription, ComponentData; inputs Type: String, Material: String, Dataset: String, Complexity: Int32, Fragment: Boolean, MinDimensionX: Double, MaxDimensionX: Double, MinDimensionY: Double, MaxDimensionY: Double, MinDimensionZ: Double, MaxDimensionZ: Double
# ---------- fetchfilteredcomponents: Python ----------
#! python3
# -*- coding: utf-8 -*-
# venv: DDU_CSC
print('ENV OK!')
# r: charset_normalizer
# r: requests

# PYTHON STANDARD LIBRARY IMPORTS ---------------------------------------------
import json  # NOQA

# THIRD PARTY LIBRARY IMPORTS -------------------------------------------------
import requests  # NOQA

# RHINO AND GH RELATED IMPORTS ------------------------------------------------
import System  # NOQA
import Grasshopper  # NOQA
import Rhino  # NOQA
import scriptcontext as sc  # NOQA

# GHENV COMPONENT SETTINGS ----------------------------------------------------
ghenv.Component.Name = 'FetchFilteredComponents'  # NOQA
ghenv.Component.NickName = 'FetchFilteredComponents'  # NOQA
ghenv.Component.Category = 'DDU_CSC'  # NOQA
ghenv.Component.SubCategory = '2 Catalog Interface'  # NOQA
ghenv.Component.Description = (  # NOQA
    'Fetches identities (with their current snapshot) from the remote '
    'Catalog based on filter criteria (type, material, dataset, complexity, '
    'fragment, bounding box dimensions). Mirrors the web catalog filter '
    'menu and returns passport JSON ({identity, snapshots[]}) results.'
)


class CSC_FetchFilteredComponents(Grasshopper.Kernel.GH_ScriptInstance):
    """
    Author: Max Benjamin Eschenbach
    License: MIT License
    Version: 260908
    """

    def __init__(self):
        """Initialize this component and set component parameters."""
        super().__init__()
        # initialize props
        self.Component = ghenv.Component  # NOQA
        self.InputParams = self.Component.Params.Input
        self.OutputParams = self.Component.Params.Output

    def _addRemark(self, msg: str = ''):
        """Add a remark message to the component."""
        rml = self.Component.RuntimeMessageLevel.Remark
        self.AddRuntimeMessage(rml, msg)

    def _addWarning(self, msg: str = ''):
        """Add a warning message to the component."""
        rml = self.Component.RuntimeMessageLevel.Warning
        self.AddRuntimeMessage(rml, msg)

    def _addError(self, msg: str = ''):
        """Add an error message to the component."""
        rml = self.Component.RuntimeMessageLevel.Error
        self.AddRuntimeMessage(rml, msg)

    def BeforeRunScript(self):
        """Perform some setup actions."""
        # Initialize input param descriptions
        self.InputParams[0].Description = (
            'Component type filter (e.g., "beam", "slab", "column")'
        )
        self.InputParams[1].Description = (
            'Material type filter (e.g., "concrete", "steel", "wood")'
        )
        self.InputParams[2].Description = (
            'Dataset name filter (e.g., "sas_cita_scans", '
            '"mineral_composite_sheets")'
        )
        self.InputParams[3].Description = (
            'Complexity level filter (0-3, where 0=simple, 3=complex)'
        )
        self.InputParams[4].Description = (
            'Fragment status filter (True for fragments, False for complete)'
        )
        self.InputParams[5].Description = (
            'Minimum X dimension filter (bounding box)'
        )
        self.InputParams[6].Description = (
            'Maximum X dimension filter (bounding box)'
        )
        self.InputParams[7].Description = (
            'Minimum Y dimension filter (bounding box)'
        )
        self.InputParams[8].Description = (
            'Maximum Y dimension filter (bounding box)'
        )
        self.InputParams[9].Description = (
            'Minimum Z dimension filter (bounding box)'
        )
        self.InputParams[10].Description = (
            'Maximum Z dimension filter (bounding box)'
        )
        self.InputParams[11].Description = (
            'Reservation status filter: -1=ignore, 0=not reserved, '
            '1=reserved by current user'
        )
        # Initialize output param descriptions
        i = 0
        if self.OutputParams[0].Name == 'out':
            i += 1
        self.OutputParams[0+i].Description = (
            'Human-readable description of the applied filters and query'
        )
        self.OutputParams[1+i].Description = (
            'Passport JSON per entry ({identity, snapshots[]}) fetched from '
            'the server. Use \'DisassembleComponent\' to access the individual '
            'fields ready for Grasshopper')

    def get_auth_core_from_sticky(self):
        """Get AuthCore instance from sticky storage."""
        auth_core = sc.sticky.get('CSC_AuthCore')
        if auth_core is None:
            msg = ('No authentication found. Please use CSC_Session component '
                   'first.')
            self._addError(msg)
            self.Component.Message = msg
            return None
        return auth_core

    def build_filter_query_params(
            self,
            Type,
            Material,
            Dataset,
            Complexity,
            Fragment,
            MinDimensionX,
            MaxDimensionX,
            MinDimensionY,
            MaxDimensionY,
            MinDimensionZ,
            MaxDimensionZ,
            ReservedStatus):
        """
        Build query parameters for filtering identities.

        Mirrors the web catalog filter menu
        (ComponentOverviewFilterMenu): comptype, material, dataset,
        complexity, fragment, and bounding box dimensions. ``validated``
        is left to the server default (validated-only), matching the web.
        Adds a reservation-status filter on top (not part of the web
        catalog filter menu): 1=reserved by current user, 0=not reserved.
        """
        params = {}

        # Add type filter if provided
        if Type and len(Type) > 0:
            # Take the first type if multiple are provided
            type_value = Type[0] if isinstance(Type, list) else str(Type)
            if type_value and type_value.strip():
                params['comptype'] = type_value.strip()

        # Add material filter if provided
        if Material and Material.strip():
            params['material'] = Material.strip()

        # Add dataset filter if provided
        if Dataset and Dataset.strip():
            params['dataset'] = Dataset.strip()

        # Add complexity filter if provided
        if Complexity is not None:
            params['complexity'] = Complexity

        # Add fragment filter if provided (web sends 'true'/'false')
        if Fragment is not None:
            params['fragment'] = 'true' if Fragment else 'false'

        # Add reservation status filter if provided
        # (backend: reserved=true -> reserved by current user,
        #  reserved=false -> not reserved by anyone)
        if ReservedStatus is not None and ReservedStatus != -1:
            if ReservedStatus == 0:
                params['reserved'] = 'false'
            elif ReservedStatus == 1:
                params['reserved'] = 'true'

        # Add bounding box filters if provided
        if MinDimensionX is not None and MinDimensionX != 0.0:
            params['bbx_min_x'] = MinDimensionX
        if MaxDimensionX is not None and MaxDimensionX != 0.0:
            params['bbx_max_x'] = MaxDimensionX
        if MinDimensionY is not None and MinDimensionY != 0.0:
            params['bbx_min_y'] = MinDimensionY
        if MaxDimensionY is not None and MaxDimensionY != 0.0:
            params['bbx_max_y'] = MaxDimensionY
        if MinDimensionZ is not None and MinDimensionZ != 0.0:
            params['bbx_min_z'] = MinDimensionZ
        if MaxDimensionZ is not None and MaxDimensionZ != 0.0:
            params['bbx_max_z'] = MaxDimensionZ

        return params

    def generate_filter_description(self, filter_params: dict) -> str:
        """Generates a human-readable description of the applied filters."""
        description = []
        if filter_params.get('comptype'):
            description.append(f'\nType: {filter_params["comptype"]}')
        if filter_params.get('material'):
            description.append(f'\nMaterial: {filter_params["material"]}')
        if filter_params.get('dataset'):
            description.append(f'\nDataset: {filter_params["dataset"]}')
        if filter_params.get('complexity') is not None:
            description.append(f'\nComplexity: {filter_params["complexity"]}')
        if filter_params.get('fragment') is not None:
            description.append(f'\nFragment: {filter_params["fragment"]}')

        # Add reservation status filter description
        if filter_params.get('reserved') == 'false':
            description.append('\nReservation: Not reserved by anyone')
        elif filter_params.get('reserved') == 'true':
            description.append('\nReservation: Reserved by current user')

        # Handle bounding box filters with detailed information
        bbx_filters = []
        if filter_params.get('bbx_min_x') is not None:
            bbx_filters.append(f'\nX >= {filter_params["bbx_min_x"]:.2f}')
        if filter_params.get('bbx_max_x') is not None:
            bbx_filters.append(f'\nX <= {filter_params["bbx_max_x"]:.2f}')
        if filter_params.get('bbx_min_y') is not None:
            bbx_filters.append(f'\nY >= {filter_params["bbx_min_y"]:.2f}')
        if filter_params.get('bbx_max_y') is not None:
            bbx_filters.append(f'\nY <= {filter_params["bbx_max_y"]:.2f}')
        if filter_params.get('bbx_min_z') is not None:
            bbx_filters.append(f'\nZ >= {filter_params["bbx_min_z"]:.2f}')
        if filter_params.get('bbx_max_z') is not None:
            bbx_filters.append(f'\nZ <= {filter_params["bbx_max_z"]:.2f}')

        if bbx_filters:
            description.append(f'\nBounding Box: {", ".join(bbx_filters)}')

        return f'Applied filters: {", ".join(description)}'

    def RunScript(self,
            Type: str,
            Material: str,
            Dataset: str,
            Complexity: int,
            Fragment: bool,
            MinDimensionX: float,
            MaxDimensionX: float,
            MinDimensionY: float,
            MaxDimensionY: float,
            MinDimensionZ: float,
            MaxDimensionZ: float,
            ReservedStatus):

        # Get AuthCore instance from sticky storage
        auth_core = self.get_auth_core_from_sticky()
        if auth_core is None:
            return

        # Check if authentication is valid
        if not auth_core.is_valid():
            msg = ('Authentication expired. Please use CSC_Session '
                   'component to refresh.')
            self._addError(msg)
            self.Component.Message = msg
            return

        try:
            self.Component.Message = 'Building filter query...'

            # Build filter query parameters (parity with web filter menu)
            filter_params = self.build_filter_query_params(
                Type, Material, Dataset, Complexity, Fragment,
                MinDimensionX, MaxDimensionX, MinDimensionY,
                MaxDimensionY, MinDimensionZ, MaxDimensionZ,
                ReservedStatus
            )

            # Request params: filters + passport expansion (identity+snapshot)
            request_params = dict(filter_params)
            request_params['expand'] = 'current_snapshot'

            # Generate human-readable filter description
            filter_description = self.generate_filter_description(
                filter_params
            )

            self.Component.Message = (
                'Fetching filtered identities (with cache)...'
            )

            # Unified catalog cache (same identity/snapshot store as
            # FetchAllComponents and FetchComponents).
            response = auth_core.cached_list_identities(request_params)

            if response.status_code == 200:
                # Successfully fetched passport entries
                json_comps = response.json()
                component_count = len(json_comps)

                # Show filter info in message
                filter_msg = f'Found {component_count} components (cached).'

                self.Component.Message = filter_msg
                self._addRemark(
                    f'Successfully fetched {component_count} components '
                    f'with applied filters'
                )

                # Set up output trees and results tuple
                FilterDescription = Grasshopper.DataTree[System.Object]()
                ComponentData = Grasshopper.DataTree[System.Object]()
                __Results = (FilterDescription, ComponentData)

                # Loop over all passport entries and add them to the data tree
                for i, json_comp in enumerate(json_comps):
                    # Create datatree path
                    ghp = Grasshopper.Kernel.Data.GH_Path(0, i)
                    # Add passport JSON to the datatree
                    ComponentData.Add(
                        auth_core.passport_json_string(json_comp), ghp)

                # Add filter description to the filter query output
                FilterDescription.Add(
                    filter_description,
                    Grasshopper.Kernel.Data.GH_Path(0)
                )

                return __Results

            elif response.status_code == 401:
                msg = 'Authentication failed. Please sign in again.'
                self._addError(msg)
                self.Component.Message = msg

            elif response.status_code == 403:
                msg = 'Access denied. Insufficient permissions.'
                self._addError(msg)
                self.Component.Message = msg

            elif response.status_code == 500:
                msg = 'Server error. Please try again later.'
                self._addWarning(msg)
                self.Component.Message = msg

            else:
                msg = (f'Request failed with status code: '
                       f'{response.status_code}')
                self._addError(msg)
                self.Component.Message = msg

        except requests.exceptions.ConnectionError as e:
            msg = 'Cannot connect to server. Please check your connection.'
            self._addError(msg + f'\nFull Error: {str(e)}')
            self.Component.Message = msg

        except requests.exceptions.Timeout as e:
            msg = 'Request timeout. Server may be slow.'
            self._addError(msg + f'\nFull Error: {str(e)}')
            self.Component.Message = msg

        except requests.exceptions.RequestException as e:
            msg = f'Request error: {str(e)}'
            self._addError(msg)
            self.Component.Message = msg

        except Exception as e:
            msg = f'Unexpected error: {str(e)}'
            self._addError(msg)
            self.Component.Message = msg

        # Return empty results if there was an error
        ComponentData = Grasshopper.DataTree[System.Object]()
        FilterDescription = Grasshopper.DataTree[System.Object]()
        __Results = (FilterDescription, ComponentData)
        return __Results
# ---------- end fetchfilteredcomponents ----------
panel = Panel(fetchfilteredcomponents.FilterDescription)
componentdata = Data(fetchfilteredcomponents.ComponentData)

# Step 3.1
# comments & notes: Get radial shape signature distances with medium (32 rays) resolution.
panel_2 = Panel("radial_distance_32")
componentdata_2 = Data(componentdata)
getdescriptor = GetDescriptor(Input=componentdata_2, DescriptorKey=panel_2)  # -> DescriptorValues; inputs Input: list, DescriptorKey: String
# ---------- getdescriptor: Python ----------
#! python3
# -*- coding: utf-8 -*-
# venv: DDU_CSC
print('ENV OK!')
# r: charset_normalizer
# r: requests

# PYTHON STANDARD LIBRARY IMPORTS ---------------------------------------------
import json  # NOQA

# RHINO AND GH RELATED IMPORTS ------------------------------------------------
import System  # NOQA
import Grasshopper  # NOQA
import Rhino  # NOQA

# GHENV COMPONENT SETTINGS ----------------------------------------------------
ghenv.Component.Name = 'GetDescriptor'  # NOQA
ghenv.Component.NickName = 'GetDescriptor'  # NOQA
ghenv.Component.Category = 'DDU_CSC'  # NOQA
ghenv.Component.SubCategory = '6 Data Tools'  # NOQA
ghenv.Component.Description = (  # NOQA
    'Retrieves a specific descriptor from multiple passport inputs '
    '({identity, snapshot}). Accepts passport JSON strings or geometries '
    'with the csc_component userdata. Returns descriptor values for the '
    'specified key from snapshot.descriptors. Handles single values, lists, '
    'and nested lists by mapping them to appropriate Grasshopper data '
    'structures with input indices as the first path level.'
)


class CSC_GetDescriptor(Grasshopper.Kernel.GH_ScriptInstance):
    """
    Author: Max Benjamin Eschenbach
    License: MIT License
    Version: 260908
    """

    def __init__(self):
        """Initialize this component and set component parameters."""
        super().__init__()
        # initialize props
        self.Component = ghenv.Component  # NOQA
        self.InputParams = self.Component.Params.Input
        self.OutputParams = self.Component.Params.Output

    def _addRemark(self, msg: str = ''):
        """Add a remark message to the component."""
        rml = self.Component.RuntimeMessageLevel.Remark
        self.AddRuntimeMessage(rml, msg)

    def _addWarning(self, msg: str = ''):
        """Add a warning message to the component."""
        rml = self.Component.RuntimeMessageLevel.Warning
        self.AddRuntimeMessage(rml, msg)

    def _addError(self, msg: str = ''):
        """Add an error message to the component."""
        rml = self.Component.RuntimeMessageLevel.Error
        self.AddRuntimeMessage(rml, msg)

    def BeforeRunScript(self):
        """Perform some setup actions."""
        # Set "No type hint"
        self.InputParams[0].TypeHints.Select(System.Object)
        self.Component.VariableParameterMaintenance()
        # Initialize input param descriptions
        self.InputParams[0].Description = (
            'List of passport JSON strings ({identity, snapshot}) OR '
            'geometries with the \'csc_component\' passport userdata'
        )
        self.InputParams[1].Description = (
            'Key string to retrieve from snapshot.descriptors'
        )
        # Initialize output param descriptions
        i = 0
        if self.OutputParams[0].Name == 'out':
            i += 1
        self.OutputParams[0+i].Description = (
            'Descriptor value for the specified key, or empty if not found'
        )

    def extract_passport_from_geometry(self, geometry):
        """
        Extract passport data ({identity, snapshot}) from geometry userdata.

        Args:
            geometry: Rhino geometry object with userdata

        Returns:
            Passport dictionary or None
        """
        try:
            if hasattr(geometry, 'GetUserString'):
                userdata = geometry.GetUserString('csc_component')
                if userdata:
                    return json.loads(userdata)
        except Exception as e:
            self._addWarning(f'Could not extract passport data: {str(e)}')
        return None

    def get_descriptor_value(self, passport, descriptor_key):
        """
        Extract descriptor value from snapshot.descriptors using the key.

        Args:
            passport: Passport dictionary ({identity, snapshot})
            descriptor_key: String key to look for in descriptors

        Returns:
            Descriptor value or None if not found
        """
        try:
            snapshots = (
                passport.get('snapshots')
                if isinstance(passport, dict)
                else None
            )
            snapshot = (
                snapshots[0]
                if isinstance(snapshots, list) and snapshots
                else None
            )
            if not isinstance(snapshot, dict):
                self._addWarning('Passport JSON has no snapshots')
                return None

            descriptors = snapshot.get('descriptors')
            if isinstance(descriptors, dict) and descriptor_key in descriptors:
                return descriptors[descriptor_key]

            self._addWarning(
                f'Descriptor key "{descriptor_key}" not found in '
                'snapshot.descriptors')
            return None
        except Exception as e:
            self._addError(f'Error extracting descriptor: {str(e)}')
            return None

    def convert_descriptor_to_gh_data(self, descriptor_value):
        """
        Convert descriptor value to appropriate Grasshopper data structure.

        Args:
            descriptor_value: The descriptor value (always float values)

        Returns:
            Grasshopper DataTree with appropriate structure
        """
        result_tree = Grasshopper.DataTree[System.Object]()

        if descriptor_value is None:
            return result_tree

        # Single float value
        if isinstance(descriptor_value, (int, float)):
            ghp = Grasshopper.Kernel.Data.GH_Path(0)
            result_tree.Add(float(descriptor_value), ghp)

        # List of floats
        elif isinstance(descriptor_value, list):
            if len(descriptor_value) == 0:
                return result_tree

            # Check if it's a list of lists (2D)
            if all(isinstance(item, list) for item in descriptor_value):
                # Check if it's 3D (list of lists of lists)
                is_3d = all(isinstance(sublist_item, list)
                            for sublist in descriptor_value
                            for sublist_item in sublist)
                if is_3d:
                    # 3D structure: [[[1,2],[3,4]], [[5,6],[7,8]]]
                    # Paths: (0;0), (0;1), (1;0), (1;1)
                    for i, sublist in enumerate(descriptor_value):
                        for j, inner_list in enumerate(sublist):
                            ghp = Grasshopper.Kernel.Data.GH_Path(i, j)
                            for value in inner_list:
                                result_tree.Add(float(value), ghp)
                else:
                    # 2D structure: [[1,2,3], [9,8,7]]
                    # Paths: (0) for first sublist, (1) for second sublist
                    for i, sublist in enumerate(descriptor_value):
                        ghp = Grasshopper.Kernel.Data.GH_Path(i)
                        for value in sublist:
                            result_tree.Add(float(value), ghp)
            else:
                # Simple list of floats: [1,2,3]
                # Single branch: (0)
                path = Grasshopper.Kernel.Data.GH_Path(0)
                for value in descriptor_value:
                    result_tree.Add(float(value), path)
        else:
            # Fallback for other types
            ghp = Grasshopper.Kernel.Data.GH_Path(0)
            result_tree.Add(float(descriptor_value), ghp)

        return result_tree

    def RunScript(self,
            Input: System.Collections.Generic.List[object],
            DescriptorKey: str):
        # set up output trees and results tuple
        DescriptorValues = Grasshopper.DataTree[System.Object]()
        try:
            # Validate inputs
            if not Input:
                msg = 'No input provided'
                self._addWarning(msg)
                self.Component.Message = msg
                return DescriptorValues

            if not DescriptorKey:
                msg = 'No descriptor key provided'
                self._addWarning(msg)
                self.Component.Message = msg
                return DescriptorValues

            self.Component.Message = 'Processing inputs...'

            # Process each input item
            input_list = list(Input)
            for input_index, input_item in enumerate(input_list):
                # Determine input type and extract passport data
                passport = None

                # Check if input is a passport JSON string
                if isinstance(input_item, str):
                    try:
                        passport = json.loads(input_item)
                        self._addRemark(
                            f'Input {input_index} detected as passport JSON')
                    except json.JSONDecodeError:
                        msg = (f'Input {input_index} is not valid passport '
                               'JSON!')
                        self._addError(msg)
                        continue
                else:
                    # Input is geometry - extract passport from userdata
                    passport = self.extract_passport_from_geometry(input_item)
                    if not passport:
                        msg = (f'Could not extract passport data from '
                               f'input {input_index}!')
                        self._addError(msg)
                        continue

                    self._addRemark(
                        f'Input {input_index} detected as geometry with '
                        'passport userdata')

                # Extract descriptor value
                try:
                    descriptor_value = self.get_descriptor_value(
                        passport, DescriptorKey)

                    if descriptor_value is not None:
                        # Convert descriptor to appropriate Grasshopper data
                        converted_tree = self.convert_descriptor_to_gh_data(
                            descriptor_value)

                        # Merge the converted tree into the output
                        for i in range(converted_tree.BranchCount):
                            original_path = converted_tree.Path(i)
                            # get runcount for first GH Tree index
                            rc = self.Component.RunCount - 1
                            # Prepend input index to the path
                            new_path = Grasshopper.Kernel.Data.GH_Path(
                                0,
                                rc,
                                input_index,
                                *original_path.Indices)
                            branch_data = converted_tree.Branch(i)
                            for item in branch_data:
                                DescriptorValues.Add(item, new_path)

                        self._addRemark(
                            f'Successfully extracted descriptor '
                            f'"{DescriptorKey}" from input {input_index}'
                        )
                    else:
                        # Descriptor not found
                        msg = (f'Descriptor "{DescriptorKey}" not found in '
                               f'input {input_index}')
                        self._addWarning(msg)

                except Exception as e:
                    msg = (f'Error extracting descriptor from input '
                           f'{input_index}: {str(e)}')
                    self._addError(msg)

            # Update success message
            self.Component.Message = f'Processed {len(input_list)} input(s)'

            # return output trees
            return DescriptorValues

        except Exception as e:
            msg = f'Unexpected error during descriptor extraction: {str(e)}'
            self._addError(msg)
            return DescriptorValues
# ---------- end getdescriptor ----------
radial_distance_32 = Data(getdescriptor)

# Step 3.2
# comments & notes: Get radial shape signature tangent vectors with medium (32 rays) resolution.
panel_3 = Panel("radial_tangent_32")
componentdata_3 = Data(componentdata)
getdescriptor_2 = GetDescriptor(Input=componentdata_3, DescriptorKey=panel_3)  # -> DescriptorValues; inputs Input: list, DescriptorKey: String
# ---------- getdescriptor_2: Python ----------
#! python3
# -*- coding: utf-8 -*-
# venv: DDU_CSC
print('ENV OK!')
# r: charset_normalizer
# r: requests

# PYTHON STANDARD LIBRARY IMPORTS ---------------------------------------------
import json  # NOQA

# RHINO AND GH RELATED IMPORTS ------------------------------------------------
import System  # NOQA
import Grasshopper  # NOQA
import Rhino  # NOQA

# GHENV COMPONENT SETTINGS ----------------------------------------------------
ghenv.Component.Name = 'GetDescriptor'  # NOQA
ghenv.Component.NickName = 'GetDescriptor'  # NOQA
ghenv.Component.Category = 'DDU_CSC'  # NOQA
ghenv.Component.SubCategory = '6 Data Tools'  # NOQA
ghenv.Component.Description = (  # NOQA
    'Retrieves a specific descriptor from multiple passport inputs '
    '({identity, snapshot}). Accepts passport JSON strings or geometries '
    'with the csc_component userdata. Returns descriptor values for the '
    'specified key from snapshot.descriptors. Handles single values, lists, '
    'and nested lists by mapping them to appropriate Grasshopper data '
    'structures with input indices as the first path level.'
)


class CSC_GetDescriptor(Grasshopper.Kernel.GH_ScriptInstance):
    """
    Author: Max Benjamin Eschenbach
    License: MIT License
    Version: 260908
    """

    def __init__(self):
        """Initialize this component and set component parameters."""
        super().__init__()
        # initialize props
        self.Component = ghenv.Component  # NOQA
        self.InputParams = self.Component.Params.Input
        self.OutputParams = self.Component.Params.Output

    def _addRemark(self, msg: str = ''):
        """Add a remark message to the component."""
        rml = self.Component.RuntimeMessageLevel.Remark
        self.AddRuntimeMessage(rml, msg)

    def _addWarning(self, msg: str = ''):
        """Add a warning message to the component."""
        rml = self.Component.RuntimeMessageLevel.Warning
        self.AddRuntimeMessage(rml, msg)

    def _addError(self, msg: str = ''):
        """Add an error message to the component."""
        rml = self.Component.RuntimeMessageLevel.Error
        self.AddRuntimeMessage(rml, msg)

    def BeforeRunScript(self):
        """Perform some setup actions."""
        # Set "No type hint"
        self.InputParams[0].TypeHints.Select(System.Object)
        self.Component.VariableParameterMaintenance()
        # Initialize input param descriptions
        self.InputParams[0].Description = (
            'List of passport JSON strings ({identity, snapshot}) OR '
            'geometries with the \'csc_component\' passport userdata'
        )
        self.InputParams[1].Description = (
            'Key string to retrieve from snapshot.descriptors'
        )
        # Initialize output param descriptions
        i = 0
        if self.OutputParams[0].Name == 'out':
            i += 1
        self.OutputParams[0+i].Description = (
            'Descriptor value for the specified key, or empty if not found'
        )

    def extract_passport_from_geometry(self, geometry):
        """
        Extract passport data ({identity, snapshot}) from geometry userdata.

        Args:
            geometry: Rhino geometry object with userdata

        Returns:
            Passport dictionary or None
        """
        try:
            if hasattr(geometry, 'GetUserString'):
                userdata = geometry.GetUserString('csc_component')
                if userdata:
                    return json.loads(userdata)
        except Exception as e:
            self._addWarning(f'Could not extract passport data: {str(e)}')
        return None

    def get_descriptor_value(self, passport, descriptor_key):
        """
        Extract descriptor value from snapshot.descriptors using the key.

        Args:
            passport: Passport dictionary ({identity, snapshot})
            descriptor_key: String key to look for in descriptors

        Returns:
            Descriptor value or None if not found
        """
        try:
            snapshots = (
                passport.get('snapshots')
                if isinstance(passport, dict)
                else None
            )
            snapshot = (
                snapshots[0]
                if isinstance(snapshots, list) and snapshots
                else None
            )
            if not isinstance(snapshot, dict):
                self._addWarning('Passport JSON has no snapshots')
                return None

            descriptors = snapshot.get('descriptors')
            if isinstance(descriptors, dict) and descriptor_key in descriptors:
                return descriptors[descriptor_key]

            self._addWarning(
                f'Descriptor key "{descriptor_key}" not found in '
                'snapshot.descriptors')
            return None
        except Exception as e:
            self._addError(f'Error extracting descriptor: {str(e)}')
            return None

    def convert_descriptor_to_gh_data(self, descriptor_value):
        """
        Convert descriptor value to appropriate Grasshopper data structure.

        Args:
            descriptor_value: The descriptor value (always float values)

        Returns:
            Grasshopper DataTree with appropriate structure
        """
        result_tree = Grasshopper.DataTree[System.Object]()

        if descriptor_value is None:
            return result_tree

        # Single float value
        if isinstance(descriptor_value, (int, float)):
            ghp = Grasshopper.Kernel.Data.GH_Path(0)
            result_tree.Add(float(descriptor_value), ghp)

        # List of floats
        elif isinstance(descriptor_value, list):
            if len(descriptor_value) == 0:
                return result_tree

            # Check if it's a list of lists (2D)
            if all(isinstance(item, list) for item in descriptor_value):
                # Check if it's 3D (list of lists of lists)
                is_3d = all(isinstance(sublist_item, list)
                            for sublist in descriptor_value
                            for sublist_item in sublist)
                if is_3d:
                    # 3D structure: [[[1,2],[3,4]], [[5,6],[7,8]]]
                    # Paths: (0;0), (0;1), (1;0), (1;1)
                    for i, sublist in enumerate(descriptor_value):
                        for j, inner_list in enumerate(sublist):
                            ghp = Grasshopper.Kernel.Data.GH_Path(i, j)
                            for value in inner_list:
                                result_tree.Add(float(value), ghp)
                else:
                    # 2D structure: [[1,2,3], [9,8,7]]
                    # Paths: (0) for first sublist, (1) for second sublist
                    for i, sublist in enumerate(descriptor_value):
                        ghp = Grasshopper.Kernel.Data.GH_Path(i)
                        for value in sublist:
                            result_tree.Add(float(value), ghp)
            else:
                # Simple list of floats: [1,2,3]
                # Single branch: (0)
                path = Grasshopper.Kernel.Data.GH_Path(0)
                for value in descriptor_value:
                    result_tree.Add(float(value), path)
        else:
            # Fallback for other types
            ghp = Grasshopper.Kernel.Data.GH_Path(0)
            result_tree.Add(float(descriptor_value), ghp)

        return result_tree

    def RunScript(self, Input: list[object], DescriptorKey: str):
        # set up output trees and results tuple
        DescriptorValues = Grasshopper.DataTree[System.Object]()
        try:
            # Validate inputs
            if not Input:
                msg = 'No input provided'
                self._addWarning(msg)
                self.Component.Message = msg
                return DescriptorValues

            if not DescriptorKey:
                msg = 'No descriptor key provided'
                self._addWarning(msg)
                self.Component.Message = msg
                return DescriptorValues

            self.Component.Message = 'Processing inputs...'

            # Process each input item
            input_list = list(Input)
            for input_index, input_item in enumerate(input_list):
                # Determine input type and extract passport data
                passport = None

                # Check if input is a passport JSON string
                if isinstance(input_item, str):
                    try:
                        passport = json.loads(input_item)
                        self._addRemark(
                            f'Input {input_index} detected as passport JSON')
                    except json.JSONDecodeError:
                        msg = (f'Input {input_index} is not valid passport '
                               'JSON!')
                        self._addError(msg)
                        continue
                else:
                    # Input is geometry - extract passport from userdata
                    passport = self.extract_passport_from_geometry(input_item)
                    if not passport:
                        msg = (f'Could not extract passport data from '
                               f'input {input_index}!')
                        self._addError(msg)
                        continue

                    self._addRemark(
                        f'Input {input_index} detected as geometry with '
                        'passport userdata')

                # Extract descriptor value
                try:
                    descriptor_value = self.get_descriptor_value(
                        passport, DescriptorKey)

                    if descriptor_value is not None:
                        # Convert descriptor to appropriate Grasshopper data
                        converted_tree = self.convert_descriptor_to_gh_data(
                            descriptor_value)

                        # Merge the converted tree into the output
                        for i in range(converted_tree.BranchCount):
                            original_path = converted_tree.Path(i)
                            # get runcount for first GH Tree index
                            rc = self.Component.RunCount - 1
                            # Prepend input index to the path
                            new_path = Grasshopper.Kernel.Data.GH_Path(
                                0,
                                rc,
                                input_index,
                                *original_path.Indices)
                            branch_data = converted_tree.Branch(i)
                            for item in branch_data:
                                DescriptorValues.Add(item, new_path)

                        self._addRemark(
                            f'Successfully extracted descriptor '
                            f'"{DescriptorKey}" from input {input_index}'
                        )
                    else:
                        # Descriptor not found
                        msg = (f'Descriptor "{DescriptorKey}" not found in '
                               f'input {input_index}')
                        self._addWarning(msg)

                except Exception as e:
                    msg = (f'Error extracting descriptor from input '
                           f'{input_index}: {str(e)}')
                    self._addError(msg)

            # Update success message
            self.Component.Message = f'Processed {len(input_list)} input(s)'

            # return output trees
            return DescriptorValues

        except Exception as e:
            msg = f'Unexpected error during descriptor extraction: {str(e)}'
            self._addError(msg)
            return DescriptorValues
# ---------- end getdescriptor_2 ----------
radial_tangent_32 = Data(getdescriptor_2)

# Step 3.3
# comments & notes: Get simple shape descriptors by their key.
# boxscore = 0 means the component is a perfect box
# boxscore = 100 means it is anything but a box
# comments & notes: Get simple shape descriptors by their key.
# linescore = 0 means the component is a perfect line
# linescore = 100 means it is anything but a line
# comments & notes: Get simple shape descriptors by their key.
# linescore = 0 means the component is a perfect line
# linescore = 100 means it is anything but a line
# comments & notes: Get simple shape descriptors by their key.
# linescore = 0 means the component is a perfect line
# linescore = 100 means it is anything but a line
panel_4 = Panel("boxscore")
componentdata_4 = Data(componentdata)
componentdata_5 = Data(componentdata)
componentdata_6 = Data(componentdata)
componentdata_7 = Data(componentdata)
getdescriptor_3 = GetDescriptor(Input=componentdata_4, DescriptorKey=panel_4)  # -> DescriptorValues; inputs Input: list, DescriptorKey: String; same code as getdescriptor_2
getdescriptor_4 = GetDescriptor(Input=componentdata_5, DescriptorKey="linescore")  # -> DescriptorValues; inputs Input: list, DescriptorKey: String; same code as getdescriptor_2
getdescriptor_5 = GetDescriptor(Input=componentdata_6, DescriptorKey="spherescore")  # -> DescriptorValues; inputs Input: list, DescriptorKey: String; same code as getdescriptor_2
getdescriptor_6 = GetDescriptor(Input=componentdata_7, DescriptorKey="planescore")  # -> DescriptorValues; inputs Input: list, DescriptorKey: String; same code as getdescriptor_2
spherescore = Data(getdescriptor_5)
boxscore = Data(getdescriptor_3)
linescore = Data(getdescriptor_4)
planescore = Data(getdescriptor_6)

# Step 4
# comments & notes: Disassemble the components to get the primitive geometry
componentdata_8 = Data(componentdata)
disassemblecomponent = DisassembleComponent(ComponentData=componentdata_8)  # -> ID, Name, Type, Material, Color, Location, BoundingBox, PCAFrame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; inputs ComponentData: tree of String
# ---------- disassemblecomponent: Python ----------
#! python3
# -*- coding: utf-8 -*-
# venv: DDU_CSC
print('ENV OK!')
# r: charset_normalizer
# r: requests

# PYTHON STANDARD LIBRARY IMPORTS ---------------------------------------------
import json  # NOQA

# RHINO AND GH RELATED IMPORTS ------------------------------------------------
import System  # NOQA
import Rhino  # NOQA
import Grasshopper  # NOQA
import scriptcontext as sc  # NOQA

# GHENV COMPONENT SETTINGS ----------------------------------------------------
ghenv.Component.Name = 'DisassembleComponent'  # NOQA
ghenv.Component.NickName = 'DisassembleComponent'  # NOQA
ghenv.Component.Category = 'DDU_CSC'  # NOQA
ghenv.Component.SubCategory = '3 Component Operations'  # NOQA
ghenv.Component.Description = (  # NOQA
    'Parses passport JSON ({identity, snapshots[]}) and outputs individual '
    'fields as Grasshopper-native types. Reconstructs geometry, bounding '
    'boxes, PCA frames, and metadata from the identity/snapshot pair. '
    'Point clouds prefer the full PLY via Session cache, then the inline '
    'preview.'
)


class CSC_DisassembleComponent(Grasshopper.Kernel.GH_ScriptInstance):
    """
    Author: Max Benjamin Eschenbach
    License: MIT License
    Version: 260908
    """

    def __init__(self):
        """Initialize this component and set component parameters."""
        super().__init__()
        # initialize props
        self.Component = ghenv.Component  # NOQA
        self.InputParams = self.Component.Params.Input
        self.OutputParams = self.Component.Params.Output

    def _addRemark(self, msg: str = ''):
        """Add a remark message to the component."""
        rml = self.Component.RuntimeMessageLevel.Remark
        self.AddRuntimeMessage(rml, msg)

    def _addWarning(self, msg: str = ''):
        """Add a warning message to the component."""
        rml = self.Component.RuntimeMessageLevel.Warning
        self.AddRuntimeMessage(rml, msg)

    def _addError(self, msg: str = ''):
        """Add an error message to the component."""
        rml = self.Component.RuntimeMessageLevel.Error
        self.AddRuntimeMessage(rml, msg)

    def BeforeRunScript(self):
        """Perform some setup actions."""
        # Initialize input param descriptions
        self.InputParams[0].Description = (
            'Passport JSON ({identity, snapshots[]}) fetched from the server.'
        )
        # Initialize output param descriptions
        i = 0
        if self.OutputParams[0].Name == 'out':
            i += 1
        self.OutputParams[0+i].Description = (
            'Identity ID (GUID)'
        )
        self.OutputParams[1+i].Description = (
            'Snapshot name (e.g. My Component 01)'
        )
        self.OutputParams[2+i].Description = (
            'Component type (panel, beam, slab, etc.)'
        )
        self.OutputParams[3+i].Description = (
            'Component material'
        )
        self.OutputParams[4+i].Description = (
            'Snapshot color as System.Drawing.Color'
        )
        self.OutputParams[5+i].Description = (
            'Snapshot location as Point3d (X=latitude, Y=longitude, Z=0)'
        )
        self.OutputParams[6+i].Description = (
            'Snapshot bounding box as Rhino.Geometry.BoundingBox'
        )
        self.OutputParams[7+i].Description = (
            'Snapshot PCA frame at world origin as Rhino.Geometry.Plane'
        )
        self.OutputParams[8+i].Description = (
            'Snapshot descriptors/metadata as JSON string'
        )
        self.OutputParams[9+i].Description = (
            'Rhino geometry objects (extrusions, meshes, point clouds). '
            'Point clouds prefer full PLY when Session is signed in, '
            'else the inline preview.'
        )
        self.OutputParams[10+i].Description = (
            'Marker points as list of Point3d objects'
        )
        self.OutputParams[11+i].Description = (
            'Identity attributes as JSON string'
        )
        self.OutputParams[12+i].Description = (
            'Snapshot condition grade (0=destroyed/retired, 1=poor, '
            '2=average, 3=good)'
        )
        self.OutputParams[13+i].Description = (
            'Component manufacturing date as ISO-8601 UTC timestamp'
        )
        self.OutputParams[14+i].Description = (
            'Precision qualifier for ManufacturedAt (exact, month, year, '
            'unknown)'
        )
        self.OutputParams[15+i].Description = (
            'Component salvage source (e.g. building name, site)'
        )
        self.OutputParams[16+i].Description = (
            'Component salvage date as ISO-8601 UTC timestamp'
        )
        self.OutputParams[17+i].Description = (
            'Parent identity IDs (GUIDs) this identity was derived from'
        )
        if len(self.OutputParams) > 18 + i:
            self.OutputParams[18+i].Description = (
                'Reinforcement JSON strings ({spec, diameter, points}) in '
                'iframe space; one per bar, same format as CreateReinforcement'
            )

    def ComponentExtrusions(
            self,
            geometry: dict) -> list[Rhino.Geometry.Extrusion]:
        """Create capped extrusions from geometry.extrusions list."""
        extrusions = []
        tol = Rhino.RhinoMath.SqrtEpsilon
        for extr in geometry.get('extrusions', []) or []:
            profile = extr.get('profile') or []
            if len(profile) < 3:
                continue

            pts = [Rhino.Geometry.Point3d(pt[0], pt[1], 0.0)
                   for pt in profile]
            # Stored profiles are open; drop a duplicate closing vertex
            if len(pts) >= 2 and pts[0].DistanceTo(pts[-1]) <= tol:
                pts = pts[:-1]
            if len(pts) < 3:
                continue

            pl = Rhino.Geometry.Polyline()
            pl.AddRange(pts)
            if not pl.IsClosed:
                pl.Add(pl[0])

            height = float(extr.get('height', 0))
            if height <= 0:
                continue

            cxt = Rhino.Geometry.Extrusion.Create(
                pl.ToPolylineCurve(),
                Rhino.Geometry.Plane.WorldXY,
                height,
                True)
            if cxt is None:
                continue

            # move extrusion downwards half material
            # thickness to center it at the origin
            cxt.Translate(Rhino.Geometry.Vector3d(0, 0, height * -0.5))
            extrusions.append(cxt)
        return extrusions

    def ComponentMeshes(
            self,
            geometry: dict,
            snapshot_color,
            identity_id: str) -> list[Rhino.Geometry.Mesh]:
        """Create multiple meshes from geometry.meshes field."""
        meshes = []
        for idx, mesh_data in enumerate(geometry.get('meshes', []) or []):
            mesh = Rhino.Geometry.Mesh()
            vl = mesh_data['vertices']
            fl = mesh_data['faces']
            [mesh.Vertices.Add(*v) for v in vl]
            [mesh.Faces.AddFace(*f) for f in fl]
            # Try to get mesh-specific colors first
            cl = mesh_data.get('colors')
            if cl:
                [mesh.VertexColors.Add(
                    System.Drawing.Color.FromArgb(*c)) for c in cl]
            else:
                # Fallback: use snapshot color for all vertices
                try:
                    component_color = System.Drawing.Color.FromArgb(
                        255, *snapshot_color)
                    for _ in range(len(vl)):
                        mesh.VertexColors.Add(component_color)
                except (KeyError, TypeError):
                    # If even snapshot color fails, use a default gray
                    default_color = System.Drawing.Color.Gray
                    for _ in range(len(vl)):
                        mesh.VertexColors.Add(default_color)
                    self._addWarning(
                        f'Mesh {idx} in identity {identity_id} '
                        f'using default gray color')
            mesh.RebuildNormals()
            mesh.UnifyNormals()
            mesh.Compact()
            meshes.append(mesh)
        return meshes

    def get_auth_core_from_sticky(self):
        """Return Session AuthCore when signed in; None otherwise."""
        return sc.sticky.get('CSC_AuthCore')

    def build_inline_point_cloud(self, pc_data):
        """Build a Rhino point cloud from one inline SnapshotPointCloud."""
        if not isinstance(pc_data, dict):
            return None
        pts = pc_data.get('points', []) or []
        if not pts:
            return None
        cloud = Rhino.Geometry.PointCloud()
        colors = pc_data.get('colors')
        if colors and len(colors) == len(pts):
            for p, c in zip(pts, colors):
                cloud.Add(
                    Rhino.Geometry.Point3d(p[0], p[1], p[2]),
                    System.Drawing.Color.FromArgb(*c))
        else:
            for p in pts:
                cloud.Add(Rhino.Geometry.Point3d(p[0], p[1], p[2]))
        return cloud if cloud.Count > 0 else None

    def fetch_snapshot_point_clouds(self, auth_core, snapshot):
        """
        Prefer full point-cloud PLY via Session cache, then inline preview.

        Returns a list of (cloud, primitive_index) tuples so
        csc_point_cloud_index stays aligned with snapshot.geometry.
        """
        geometry = snapshot.get('geometry', {}) or {}
        inline_pcs = geometry.get('point_clouds', []) or []
        snapshot_id = snapshot.get('_id')
        results = []
        for i in range(len(inline_pcs)):
            cloud = None
            if auth_core and snapshot_id:
                try:
                    cloud = auth_core.cached_get_snapshot_point_cloud(
                        snapshot_id, i)
                except Exception as e:
                    self._addWarning(
                        'Point cloud PLY fetch failed '
                        f'for index {i}: {str(e)}')
            if cloud is None:
                cloud = self.build_inline_point_cloud(inline_pcs[i])
            if cloud is not None:
                results.append((cloud, i))
            else:
                self._addWarning(
                    f'Point cloud {i} is invalid or empty')
        return results

    def ComponentReinforcementJson(
            self,
            geometry: dict,
            identity_id: str,
            xform: Rhino.Geometry.Transform) -> list[str]:
        """Parse geometry.reinforcements into CreateReinforcement JSON strings."""
        json_strings = []
        for idx, bar in enumerate(geometry.get('reinforcements', []) or []):
            if not isinstance(bar, dict):
                self._addWarning(
                    f'Reinforcement {idx} in identity {identity_id}: '
                    'expected object'
                )
                continue

            spec = str(bar.get('spec', '')).strip()
            if not spec:
                self._addWarning(
                    f'Reinforcement {idx} in identity {identity_id}: '
                    'missing spec'
                )
                continue

            try:
                diameter = float(bar.get('diameter', 0))
            except (TypeError, ValueError):
                self._addWarning(
                    f'Reinforcement {idx} in identity {identity_id}: '
                    'invalid diameter'
                )
                continue
            if diameter <= 0:
                self._addWarning(
                    f'Reinforcement {idx} in identity {identity_id}: '
                    'diameter must be > 0'
                )
                continue

            points = bar.get('points') or []
            if not isinstance(points, list) or len(points) < 2:
                self._addWarning(
                    f'Reinforcement {idx} in identity {identity_id}: '
                    'needs at least 2 points'
                )
                continue

            iframe_points = []
            valid = True
            for pt in points:
                if (not isinstance(pt, (list, tuple))
                        or len(pt) != 3):
                    self._addWarning(
                        f'Reinforcement {idx} in identity {identity_id}: '
                        f'invalid point {pt}'
                    )
                    valid = False
                    break
                point = Rhino.Geometry.Point3d(
                    float(pt[0]), float(pt[1]), float(pt[2]))
                point.Transform(xform)
                iframe_points.append([point.X, point.Y, point.Z])
            if not valid or len(iframe_points) < 2:
                continue

            json_strings.append(json.dumps({
                'spec': spec,
                'diameter': diameter,
                'points': iframe_points,
            }))
        return json_strings

    def ComponentColor(self, snapshot: dict) -> System.Drawing.Color:
        color = snapshot.get('color') or [110, 110, 110]
        return System.Drawing.Color.FromArgb(255, *color)

    def ComponentBoundingBox(
            self,
            snapshot: dict) -> Rhino.Geometry.BoundingBox:
        xtx = snapshot['bbx'][0]
        xty = snapshot['bbx'][1]
        xtz = snapshot['bbx'][2]

        # Get bbx_origin (center of bounding box in PCA space)
        bbx_origin = snapshot.get('bbx_origin', [0.0, 0.0, 0.0])

        # Create bounding box at bbx_origin in PCA space
        bbx = Rhino.Geometry.BoundingBox(
            bbx_origin[0] - xtx * 0.5,
            bbx_origin[1] - xty * 0.5,
            bbx_origin[2] - xtz * 0.5,
            bbx_origin[0] + xtx * 0.5,
            bbx_origin[1] + xty * 0.5,
            bbx_origin[2] + xtz * 0.5
        )

        # Convert bounding box to Box for transformation
        bbx = Rhino.Geometry.Box(bbx)

        # Transform from PCA space back to original component space
        try:
            pca_frame = snapshot.get('pca_frame', {})
            if pca_frame:
                # Create PCA frame plane at world origin
                pca_origin = Rhino.Geometry.Point3d(
                    *pca_frame.get('o', [0, 0, 0]))
                pca_x = Rhino.Geometry.Vector3d(
                    *pca_frame.get('x', [1, 0, 0]))
                pca_y = Rhino.Geometry.Vector3d(
                    *pca_frame.get('y', [0, 1, 0]))

                pca_plane = Rhino.Geometry.Plane(pca_origin, pca_x, pca_y)

                # Create forward transform (from PCA space to original space)
                pca_transform = (
                    Rhino.Geometry.Transform.PlaneToPlane(
                        Rhino.Geometry.Plane.WorldXY, pca_plane))

                bbx.Transform(pca_transform)

        except (KeyError, TypeError, ValueError) as e:
            # If PCA frame is missing or invalid, use bounding box as-is
            self._addWarning(f'Could not apply PCA frame transform: {str(e)}')

        return bbx

    def ComponentPCAPlane(self, snapshot: dict) -> Rhino.Geometry.Plane:
        """Get PCA plane at world origin from snapshot data."""
        try:
            pca_frame = snapshot.get('pca_frame', {})
            if pca_frame:
                pca_x = Rhino.Geometry.Vector3d(
                    *pca_frame.get('x', [1, 0, 0]))
                pca_y = Rhino.Geometry.Vector3d(
                    *pca_frame.get('y', [0, 1, 0]))
                return Rhino.Geometry.Plane(
                    Rhino.Geometry.Point3d.Origin, pca_x, pca_y)
            else:
                return Rhino.Geometry.Plane.WorldXY
        except (KeyError, TypeError, ValueError):
            return Rhino.Geometry.Plane.WorldXY

    def RunScript(self, ComponentData: Grasshopper.DataTree[str]):
        # set up output trees and results tuple
        ID = Grasshopper.DataTree[System.Object]()
        Name = Grasshopper.DataTree[System.Object]()
        Type = Grasshopper.DataTree[System.Object]()
        Material = Grasshopper.DataTree[System.Object]()
        Color = Grasshopper.DataTree[System.Object]()
        Location = Grasshopper.DataTree[System.Object]()
        BoundingBox = Grasshopper.DataTree[System.Object]()
        PCAFrame = Grasshopper.DataTree[System.Object]()
        Descriptors = Grasshopper.DataTree[System.Object]()
        PrimitiveGeometry = Grasshopper.DataTree[System.Object]()
        MarkerPoints = Grasshopper.DataTree[System.Object]()
        Attributes = Grasshopper.DataTree[System.Object]()
        Condition = Grasshopper.DataTree[System.Object]()
        ManufacturedAt = Grasshopper.DataTree[System.Object]()
        ManufacturedPrecision = Grasshopper.DataTree[System.Object]()
        SalvageSource = Grasshopper.DataTree[System.Object]()
        SalvagedAt = Grasshopper.DataTree[System.Object]()
        ParentComponent = Grasshopper.DataTree[System.Object]()
        ReinforcementJson = Grasshopper.DataTree[System.Object]()
        __Results = (
            ID,
            Name,
            Type,
            Material,
            Color,
            Location,
            BoundingBox,
            PCAFrame,
            Descriptors,
            PrimitiveGeometry,
            MarkerPoints,
            Attributes,
            Condition,
            ManufacturedAt,
            ManufacturedPrecision,
            SalvageSource,
            SalvagedAt,
            ParentComponent,
            ReinforcementJson)
        try:
            # Validate input
            if not ComponentData or ComponentData.DataCount == 0:
                msg = ('Input ComponentData failed to collect Data')
                self._addWarning(msg)
                self.Component.Message = msg
                return __Results

            self.Component.Message = 'Disassembling components...'
            auth_core = self.get_auth_core_from_sticky()

            # loop over all branches
            for i in range(ComponentData.BranchCount):
                ghp = ComponentData.Paths[i]
                for j, comp in enumerate(ComponentData.Branches[i]):
                    try:
                        passport = json.loads(comp)
                        identity = passport.get('identity') or {}
                        snapshots = passport.get('snapshots') or []
                        snapshot = (
                            snapshots[0] if snapshots else {}
                        )
                        if not identity or not snapshot:
                            self._addWarning(
                                'Passport JSON missing identity/snapshots, '
                                'skipping entry')
                            continue

                        identity_id = identity.get('_id')

                        # add directly available metadata to the
                        # respective datatrees
                        ID.Add(identity_id, ghp)
                        Name.Add(snapshot.get('name'), ghp)
                        Type.Add(identity.get('type'), ghp)
                        Material.Add(identity.get('material'), ghp)

                        # create system color from snapshot rgb values
                        color = self.ComponentColor(snapshot)
                        Color.Add(color, ghp)

                        # process location data
                        try:
                            location_data = snapshot.get('location', {}) or {}
                            if ('lat' in location_data and
                                    'lon' in location_data):
                                location_point = Rhino.Geometry.Point3d(
                                    location_data['lat'],
                                    location_data['lon'],
                                    0.0
                                )
                            else:
                                location_point = Rhino.Geometry.Point3d(
                                    0.0, 0.0, 0.0)
                        except (KeyError, TypeError):
                            location_point = Rhino.Geometry.Point3d(
                                0.0, 0.0, 0.0)
                        Location.Add(location_point, ghp)

                        # process insertion frame
                        try:
                            iframe = snapshot['iframe']
                            iplane = Rhino.Geometry.Plane(
                                Rhino.Geometry.Point3d(*iframe['o']),
                                Rhino.Geometry.Vector3d(*iframe['x']),
                                Rhino.Geometry.Vector3d(*iframe['y']),
                            )
                        except (KeyError, TypeError):
                            iplane = Rhino.Geometry.Plane.WorldXY

                        xform = Rhino.Geometry.Transform.PlaneToPlane(
                            Rhino.Geometry.Plane.WorldXY,
                            iplane)

                        # treat geometry block in a special way because
                        # it may hold multiple representations
                        geometry = snapshot.get('geometry', {}) or {}
                        for key in sorted(geometry.keys()):
                            if key == 'extrusions':
                                for xtr in self.ComponentExtrusions(geometry):
                                    # transform to iframe
                                    xtr.Transform(xform)
                                    # set user string
                                    xtr.SetUserString('csc_component', comp)
                                    # add to datatree
                                    PrimitiveGeometry.Add(xtr, ghp)
                            elif key == 'meshes':
                                # Handle multiple meshes
                                meshes = self.ComponentMeshes(
                                    geometry,
                                    snapshot.get('color'),
                                    identity_id)
                                for mesh_idx, mesh in enumerate(meshes):
                                    # transform to iframe
                                    mesh.Transform(xform)
                                    # set user string with mesh index
                                    mesh.SetUserString('csc_component', comp)
                                    mesh.SetUserString('csc_mesh_index',
                                                       str(mesh_idx))
                                    # add to datatree
                                    PrimitiveGeometry.Add(mesh, ghp)
                            elif key == 'point_clouds':
                                clouds = self.fetch_snapshot_point_clouds(
                                    auth_core, snapshot)
                                for cloud, cloud_idx in clouds:
                                    cloud.Transform(xform)
                                    cloud.SetUserString(
                                        'csc_component', comp)
                                    cloud.SetUserString(
                                        'csc_point_cloud_index',
                                        str(cloud_idx))
                                    PrimitiveGeometry.Add(cloud, ghp)
                            elif key in ('marker_points', 'reinforcements'):
                                # handled separately below
                                continue
                            else:
                                msg = (f'Missing implementation for geometry '
                                       f'of type \'{key}\'!')
                                self._addWarning(msg)

                        # construct boundingbox
                        bbx = self.ComponentBoundingBox(snapshot)

                        # apply iframe transform
                        bbx.Transform(xform)
                        BoundingBox.Add(bbx, ghp)

                        # get PCA plane at world origin
                        pca_plane = self.ComponentPCAPlane(snapshot)
                        # apply iframe transform to PCA plane
                        pca_plane.Transform(xform)
                        PCAFrame.Add(pca_plane, ghp)

                        # add descriptors
                        descriptors = snapshot.get('descriptors', {}) or {}
                        Descriptors.Add(json.dumps(descriptors), ghp)

                        # process marker points (now nested under geometry)
                        try:
                            marker_points_data = geometry.get(
                                'marker_points', []) or []
                            marker_points_list = []
                            for point_data in marker_points_data:
                                if (isinstance(point_data, list) and
                                        len(point_data) >= 3):
                                    marker_point = Rhino.Geometry.Point3d(
                                        point_data[0],
                                        point_data[1],
                                        point_data[2]
                                    )
                                    # apply iframe transform to marker point
                                    marker_point.Transform(xform)
                                    marker_points_list.append(marker_point)
                        except (KeyError, TypeError, IndexError):
                            # If no marker points or invalid format, add empty
                            # list
                            marker_points_list = []
                        if marker_points_list:
                            MarkerPoints.AddRange(marker_points_list, ghp)

                        for bar_json in self.ComponentReinforcementJson(
                                geometry, identity_id, xform):
                            ReinforcementJson.Add(bar_json, ghp)

                        # process attributes (identity-level)
                        attributes = identity.get('attributes', {}) or {}
                        Attributes.Add(json.dumps(attributes), ghp)

                        # snapshot-level state
                        if snapshot.get('condition') is not None:
                            Condition.Add(snapshot['condition'], ghp)

                        # identity-level provenance
                        if identity.get('manufactured_at') is not None:
                            ManufacturedAt.Add(
                                identity['manufactured_at'], ghp)
                        if identity.get('manufactured_precision') is not None:
                            ManufacturedPrecision.Add(
                                identity['manufactured_precision'], ghp)
                        if identity.get('salvage_source') is not None:
                            SalvageSource.Add(identity['salvage_source'], ghp)
                        if identity.get('salvaged_at') is not None:
                            SalvagedAt.Add(identity['salvaged_at'], ghp)
                        parent_identities = identity.get('parent_identities')
                        if parent_identities:
                            ParentComponent.AddRange(parent_identities, ghp)

                    except json.JSONDecodeError as e:
                        msg = f'Failed to parse passport data: {str(e)}'
                        self._addError(msg)
                    except Exception as e:
                        msg = f'Error processing component: {str(e)}'
                        self._addError(msg)

            # Update success message
            total_components = sum(
                len(branch) for branch in ComponentData.Branches
            )
            self.Component.Message = (
                f'Disassembled {total_components} component(s)'
            )
            self._addRemark(
                f'Successfully disassembled {total_components} components'
            )

            # return output trees
            return __Results

        except Exception as e:
            msg = f'Unexpected error during disassembly: {str(e)}'
            self._addError(msg)
            return __Results
# ---------- end disassemblecomponent ----------
manufacturedprecision = Data(disassemblecomponent.ManufacturedPrecision)
primitivegeometry = Data(disassemblecomponent.PrimitiveGeometry)
parentcomponent = Data(disassemblecomponent.ParentComponent)
manufacturedat = Data(disassemblecomponent.ManufacturedAt)
salvagesource = Data(disassemblecomponent.SalvageSource)
boundingbox = Data(disassemblecomponent.BoundingBox)
markerpoints = Data(disassemblecomponent.MarkerPoints)
descriptors = Data(disassemblecomponent.Descriptors)
salvagedat = Data(disassemblecomponent.SalvagedAt)
pcaframe = Data(disassemblecomponent.PCAFrame)
attributes = Data(disassemblecomponent.Attributes)
condition = Data(disassemblecomponent.Condition)
location = Data(disassemblecomponent.Location)
material_2 = Data(disassemblecomponent.Material)
id = Data(disassemblecomponent.ID)
name = Data(disassemblecomponent.Name)
type_2 = Data(disassemblecomponent.Type)
color = Data(disassemblecomponent.Color)

# Step 5
# comments & notes: Concatenate all descriptor values.
# We use path shifting to align the DataTree paths.
radial_tangent_32_2 = Data(radial_tangent_32)
radial_distance_32_2 = Data(radial_distance_32)
spherescore_2 = Data(spherescore)
planescore_2 = Data(planescore)
linescore_2 = Data(linescore)
boxscore_2 = Data(boxscore)
pshift = ShiftPaths(Data=boxscore_2, Offset="-2")
pshift_2 = ShiftPaths(Data=linescore_2, Offset="-2")
pshift_3 = ShiftPaths(Data=radial_distance_32_2, Offset="-2")
pshift_4 = ShiftPaths(Data=radial_tangent_32_2, Offset="-2")
pshift_5 = ShiftPaths(Data=planescore_2, Offset="-2")
pshift_6 = ShiftPaths(Data=spherescore_2, Offset="-2")
merge = Merge(Data1=pshift_3, Data2=pshift_4, Data3=pshift, Data4=pshift_2, Data5=pshift_5, Data6=pshift_6)
descriptordata = Data(merge)

embeddingdimensions = Slider(2, range=2..6)
t_sne_or_pca = ValueList({"T-SNE": 0, "PCA": 1}, selected="T-SNE")

# Step 6
# comments & notes: Choose between two dimension-reduction techniques: T-SNE (stochastic) or PCA (fully deterministic).
# Switch to see the difference visualized!
# 
# You may also choose the number of dimensions for the embedded space (2 - 6) and look at the visualization results.
# 
# Can you make an educated guess how we map the dimensions for visualization?
descriptordata_2 = Data(descriptordata)
gate = StreamGate(Stream=descriptordata_2, Gate=t_sne_or_pca)  # -> Target0, Target1
descriptordata_3 = Data(gate.Target0)
descriptordata_4 = Data(gate.Target1)

# Step 6.1
# comments & notes: Compute t-SNE (t-Stochastic Nearest Neighbor Embedding). It is primarily a dimension-reduction technique for embedding multidimensional vectors (i.e. descriptors).
# 
# We can use this to visualize similarity between components (given a multidimensional descriptor).
descriptordata_5 = Data(descriptordata_3)
embeddingdimensions_2 = Data(embeddingdimensions)
computetsne = ComputeTSNE(
    Data=descriptordata_5,
    Components=embeddingdimensions_2,
    EarlyExaggeration=Slider(12, range=0..100),
    Method=Slider(1, range=0..1),
    RandomSeed=Slider(1234, range=0..100000000))  # -> EmbedddedData; inputs Data: tree of Double, Components: Int32, Perplexity: Int32, EarlyExaggeration: Double, LearningRate: Double, Iterations: Int32, Method: Int32, Initialization: Int32, RandomSeed: Int32
# ---------- computetsne: Python ----------
#! python3
# -*- coding: utf-8 -*-
# venv: DDU_CSC
print('ENV OK!')
# r: charset_normalizer
# r: requests
# r: numpy
# r: scipy
# r: scikit-learn

# PYTHON STANDARD LIBRARY IMPORTS ---------------------------------------------

# THIRD PARTY LIBRARY IMPORTS -------------------------------------------------
import numpy as np  # NOQA
from sklearn.manifold import TSNE  # NOQA

# RHINO AND GH RELATED IMPORTS ------------------------------------------------
import System  # NOQA
import Grasshopper  # NOQA
import Rhino  # NOQA

# GHENV COMPONENT SETTINGS ----------------------------------------------------
ghenv.Component.Name = 'ComputeTSNE'  # NOQA
ghenv.Component.NickName = 'ComputeTSNE'  # NOQA
ghenv.Component.Category = 'DDU_CSC'  # NOQA
ghenv.Component.SubCategory = '6 Data Tools'  # NOQA
ghenv.Component.Description = (  # NOQA
    'Computes T-distributed Stochastic Neighbor Embedding.'
)


class CSC_ComputeTSNE(Grasshopper.Kernel.GH_ScriptInstance):
    """
    Author: Max Benjamin Eschenbach
    License: MIT License
    Version: 260609
    """

    def __init__(self):
        """Initialize this component and set component parameters."""
        super().__init__()
        # initialize props
        self.Component = ghenv.Component  # NOQA
        self.InputParams = self.Component.Params.Input
        self.OutputParams = self.Component.Params.Output

    def _addRemark(self, msg: str = ''):
        """Add a remark message to the component."""
        rml = self.Component.RuntimeMessageLevel.Remark
        self.AddRuntimeMessage(rml, msg)

    def _addWarning(self, msg: str = ''):
        """Add a warning message to the component."""
        rml = self.Component.RuntimeMessageLevel.Warning
        self.AddRuntimeMessage(rml, msg)

    def _addError(self, msg: str = ''):
        """Add an error message to the component."""
        rml = self.Component.RuntimeMessageLevel.Error
        self.AddRuntimeMessage(rml, msg)

    def BeforeRunScript(self):
        """Perform some setup actions."""
        # Initialize input param descriptions
        self.InputParams[0].Description = (
            'Data to be reduced using t-SNE as a DataTree, where '
            'each Branch represents one DataPoint.'
        )
        self.InputParams[1].Description = (
            'Dimension of the embedded space.'
        )
        self.InputParams[2].Description = (
            'The perplexity is related to the number of nearest neighbors '
            'that are used in other manifold learning algorithms. '
            'Consider selecting a value between 5 and 50. Defaults to 30.'
        )
        self.InputParams[3].Description = (
            'Controls how tight natural clusters in the original space '
            'are in the embedded space and how much space will be '
            'between them.'
            'Defaults to 12.'
        )
        self.InputParams[4].Description = (
            'The learning rate for t-SNE is usually in the range '
            '(10.0, 1000.0).'
            'Defaults to 200.'
        )
        self.InputParams[5].Description = (
            'Maximum number of iterations for the optimization. '
            'Should be at least 250.'
            'Defaults to 1000.'
        )
        self.InputParams[6].Description = (
            'Barnes-Hut approximation (0) runs in O(NlogN) time. '
            'Exact method (1) will run on the slower, but exact, '
            'algorithm in O(N^2) time.'
            'Defaults to 0.'
        )
        self.InputParams[7].Description = (
            'Initialization method. Random (0) or PCA (1).'
            'Defaults to 0.'
        )
        self.InputParams[8].Description = (
            'Determines the random number generator. Pass an int for '
            'reproducible results across multiple function calls. '
            'Note that different initializations might result in '
            'different local minima of the cost function.'
            'Defaults to None.'
        )
        # Initialize output param descriptions
        i = 0
        if self.OutputParams[0].Name == 'out':
            i += 1
        self.OutputParams[0+i].Description = (
                'The transformed data as a DataTree, where each Branch '
                'represents one embeddedDataPoint.'
            )

    def RunScript(self,
            Data: Grasshopper.DataTree[float],
            Components: int,
            Perplexity: int,
            EarlyExaggeration: float,
            LearningRate: float,
            Iterations: int,
            Method: int,
            Initialization: int,
            RandomSeed: int):
        # set up output variables
        EmbedddedData = Grasshopper.DataTree[System.Object]()
        try:
            # sanitize input and abort if not present
            self.Component.Message = None
            if not Data or Data.DataCount == 0:
                msg = 'Input Data failed to collect data!'
                self._addWarning(msg)
                return EmbedddedData

            # set defaults for parameters if not provided
            if not Components:
                Components = 2
            if not Perplexity:
                Perplexity = 30
            if not EarlyExaggeration:
                EarlyExaggeration = 12.0
            if not LearningRate:
                LearningRate = 200.0
            if not Iterations:
                Iterations = 1000
            if not Method:
                Method = 0
            if not Initialization:
                Initialization = 0
            if not RandomSeed:
                RandomSeed = 0

            # convert method string
            if Method <= 0:
                method_str = "barnes_hut"
            else:
                method_str = "exact"
            if Initialization <= 0:
                init_str = "random"
            else:
                init_str = "pca"

            # convert all datatree branches to numpy array
            np_data = np.array([np.array(Data.Branch(p)) for p in Data.Paths])

            # initialize t-SNE solver class
            tsne = TSNE(n_components=Components,
                        perplexity=Perplexity,
                        early_exaggeration=EarlyExaggeration,
                        learning_rate=LearningRate,
                        n_iter=Iterations,
                        random_state=RandomSeed,
                        method=method_str,
                        init=init_str)

            # run t-SNE solver on incoming data
            tsne_result = tsne.fit_transform(np_data)

            # loop over all branches and add embedded data to output tree
            for i in range(len(Data.Branches)):
                EmbedddedData.AddRange(
                    [float(x) for x in tsne_result[i]],
                    Data.Paths[i]
                )

            # return output
            return EmbedddedData

        except Exception as e:
            msg = f'Unexpected error during t-SNE computation: {str(e)}'
            self._addError(msg)
            return EmbedddedData
# ---------- end computetsne ----------
embedddeddata = Data(computetsne)

# Step 6.2
# comments & notes: Use PCA (Principal Component Analysis) to reduce dimensions of a multidimensional vector (i.e. descriptor).
# 
# NOTE: This algorithm is deterministic and always yields the same results on the same input data!
descriptordata_6 = Data(descriptordata_4)
embeddingdimensions_3 = Data(embeddingdimensions)
computepca = ComputePCA(Data=descriptordata_6, Components=embeddingdimensions_3)  # -> EmbedddedData; inputs Data: tree of Double, Components: Int32
# ---------- computepca: Python ----------
#! python3
# -*- coding: utf-8 -*-
# venv: DDU_CSC
print('ENV OK!')
# r: charset_normalizer
# r: requests
# r: numpy
# r: scipy
# r: scikit-learn

# PYTHON STANDARD LIBRARY IMPORTS ---------------------------------------------

# THIRD PARTY LIBRARY IMPORTS -------------------------------------------------
import numpy as np  # NOQA
from sklearn.decomposition import PCA  # NOQA

# RHINO AND GH RELATED IMPORTS ------------------------------------------------
import System  # NOQA
import Grasshopper  # NOQA
import Rhino  # NOQA

# GHENV COMPONENT SETTINGS ----------------------------------------------------
ghenv.Component.Name = 'ComputePCA'  # NOQA
ghenv.Component.NickName = 'ComputePCA'  # NOQA
ghenv.Component.Category = 'DDU_CSC'  # NOQA
ghenv.Component.SubCategory = '6 Data Tools'  # NOQA
ghenv.Component.Description = (  # NOQA
    'Computes principal component analysis (PCA) for dimensionality reduction'
)


class CSC_ComputePCA(Grasshopper.Kernel.GH_ScriptInstance):
    """
    Author: Max Benjamin Eschenbach
    License: MIT License
    Version: 260609
    """

    def __init__(self):
        """Initialize this component and set component parameters."""
        super().__init__()
        # initialize props
        self.Component = ghenv.Component  # NOQA
        self.InputParams = self.Component.Params.Input
        self.OutputParams = self.Component.Params.Output

    def _addRemark(self, msg: str = ''):
        """Add a remark message to the component."""
        rml = self.Component.RuntimeMessageLevel.Remark
        self.AddRuntimeMessage(rml, msg)

    def _addWarning(self, msg: str = ''):
        """Add a warning message to the component."""
        rml = self.Component.RuntimeMessageLevel.Warning
        self.AddRuntimeMessage(rml, msg)

    def _addError(self, msg: str = ''):
        """Add an error message to the component."""
        rml = self.Component.RuntimeMessageLevel.Error
        self.AddRuntimeMessage(rml, msg)

    def BeforeRunScript(self):
        """Perform some setup actions."""
        # Initialize input param descriptions
        self.InputParams[0].Description = (
            'Data to be reduced using PCA as a DataTree, where '
            'each Branch represents one DataPoint.'
        )
        self.InputParams[1].Description = (
            'Dimension of the embedded space.'
        )
        # Initialize output param descriptions
        i = 0
        if self.OutputParams[0].Name == 'out':
            i += 1
        self.OutputParams[0+i].Description = (
                'The transformed data as a DataTree, where each Branch '
                'represents one embedded DataPoint.'
            )

    def RunScript(self, Data: Grasshopper.DataTree[float], Components: int):
        # set up output variables
        EmbedddedData = Grasshopper.DataTree[System.Object]()
        try:
            # sanitize input and abort if not present
            self.Component.Message = None
            if not Data or Data.DataCount == 0:
                msg = 'Input Data failed to collect data!'
                self._addWarning(msg)
                return EmbedddedData

            # set defaults for parameters if not provided
            if not Components:
                Components = 2

            # convert all datatree branches to numpy array
            np_data = np.array([np.array(Data.Branch(p)) for p in Data.Paths])

            # initialize t-SNE solver class
            data_reduced = PCA(n_components=Components).fit_transform(np_data)

            # loop over all branches and add embedded data to output tree
            for i in range(len(Data.Branches)):
                EmbedddedData.AddRange(
                    [float(x) for x in data_reduced[i]],
                    Data.Paths[i]
                )

            # return output
            return EmbedddedData

        except Exception as e:
            msg = f'Unexpected error during PCA computation: {str(e)}'
            self._addError(msg)
            return EmbedddedData
# ---------- end computepca ----------
embedddeddata_2 = Data(computepca)

# Step 6.3
# comments & notes: Here we just filter the output stream according to the user setting, then forward to visualization.
tsne_embedddeddata = Data(embedddeddata)
pca_embedddeddata = Data(embedddeddata_2)
t_sne_or_pca_2 = Data(t_sne_or_pca)
filter = StreamFilter(Gate=t_sne_or_pca_2, Stream0=tsne_embedddeddata, Stream1=pca_embedddeddata)
embedddeddata_3 = Data(filter)

# Step 7
# comments & notes: Visualize the Embeddings in 2D/3D space.
# 
# You may play with the scale factor to see different densities of clustering.
scalefactor = Slider(15000, range=1..50000)
embedddeddata_4 = Data(embedddeddata_3)
primitivegeometry_2 = Data(primitivegeometry)
visualizeembedding = VisualizeEmbedding(EmbeddedData=embedddeddata_4, Geometry=primitivegeometry_2, ScaleFactor=scalefactor)  # -> LayoutGeometry, LayoutPoints, Colors, XForm; inputs EmbeddedData: tree of Double, Geometry: tree, ScaleFactor: Double
# ---------- visualizeembedding: Python ----------
#! python3
# -*- coding: utf-8 -*-
# venv: DDU_CSC
print('ENV OK!')
# r: charset_normalizer
# r: requests
# r: numpy

# PYTHON STANDARD LIBRARY IMPORTS ---------------------------------------------

# THIRD PARTY LIBRARY IMPORTS -------------------------------------------------
import numpy as np  # NOQA

# RHINO AND GH RELATED IMPORTS ------------------------------------------------
import System  # NOQA
import System.Drawing  # NOQA
import Grasshopper  # NOQA
import Rhino  # NOQA

# GHENV COMPONENT SETTINGS ----------------------------------------------------
ghenv.Component.Name = 'VisualizeEmbedding'  # NOQA
ghenv.Component.NickName = 'VisualizeEmbedding'  # NOQA
ghenv.Component.Category = 'DDU_CSC'  # NOQA
ghenv.Component.SubCategory = '8 Visualization'  # NOQA
ghenv.Component.Description = (  # NOQA
    'Visualizes a low-dimensional embedding (e.g. from PCA or t-SNE) by '
    'placing the associated input geometry at its embedding coordinate. '
    'Supports 1D, 2D and 3D layouts; when the embedding has more than 3 '
    'dimensions the remaining dimensions (4, 5, 6) are mapped to RGB colour '
    'channels. Each embedding dimension is min-max normalised to '
    '[0, ScaleFactor] per axis so the whole layout fits within the given '
    'extent.'
)

_EPS: float = 1e-12


def _minmax_normalise(values: np.ndarray) -> np.ndarray:
    """Column-wise min-max normalise a (N, D) array to [0, 1].

    Columns whose range is below ``_EPS`` collapse to 0.5 (centre) so the
    layout does not explode along a constant axis.
    """
    V = np.asarray(values, dtype=np.float64)
    if V.ndim != 2:
        raise ValueError(
            f'expected a 2D (N, D) array, got shape {V.shape}'
        )
    v_min = V.min(axis=0)
    v_max = V.max(axis=0)
    v_range = v_max - v_min

    out = np.empty_like(V)
    for d in range(V.shape[1]):
        if v_range[d] < _EPS:
            out[:, d] = 0.5
        else:
            out[:, d] = (V[:, d] - v_min[d]) / v_range[d]
    return out


def _embedding_to_layout(values: np.ndarray, scale: float):
    """
    Map a (N, D) embedding to layout points and optional RGB colours.

    Returns:
        points: (N, 3) float array in world units
        colors: (N, 3) uint8 array in [0, 255] (RGB)
        dims_used_pos: int, how many embedding dims were used for position
        dims_used_col: int, how many embedding dims were used for colour
    """
    normed = _minmax_normalise(values)
    n, d = normed.shape

    points = np.zeros((n, 3), dtype=np.float64)
    dims_used_pos = min(d, 3)
    for ax in range(dims_used_pos):
        points[:, ax] = normed[:, ax] * float(scale)

    colors = np.full((n, 3), 128, dtype=np.int32)
    dims_used_col = max(0, min(d - 3, 3))
    for ch in range(dims_used_col):
        colors[:, ch] = np.clip(
            np.round(normed[:, 3 + ch] * 255.0), 0, 255
        ).astype(np.int32)

    return points, colors, dims_used_pos, dims_used_col


def _geometry_bbox(geometry):
    """
    Return the world-aligned bounding box of a piece of geometry, or
    ``None`` if one cannot be computed.
    """
    if geometry is None:
        return None

    if hasattr(geometry, 'GetBoundingBox'):
        bbox = geometry.GetBoundingBox(True)
        if bbox is not None and bbox.IsValid:
            return bbox

    if isinstance(geometry, Rhino.Geometry.Point3d):
        return Rhino.Geometry.BoundingBox(geometry, geometry)

    return None


def _branch_anchor(geometries) -> Rhino.Geometry.Point3d:
    """
    Return the combined bounding-box centre of all geometries in a branch.

    All valid items in the branch contribute to one union bounding box;
    the centre of that union is used as the shared anchor so every
    geometry in the branch receives the same translation and their
    relative arrangement is preserved.
    """
    union = Rhino.Geometry.BoundingBox.Empty
    any_valid = False
    for geo in geometries:
        bbox = _geometry_bbox(geo)
        if bbox is None:
            continue
        union.Union(bbox)
        any_valid = True

    if not any_valid or not union.IsValid:
        raise ValueError(
            'cannot determine an anchor point: no geometry in branch '
            'has a valid bounding box'
        )
    return union.Center


class CSC_VisualizeEmbedding(Grasshopper.Kernel.GH_ScriptInstance):
    """
    Author: Max Benjamin Eschenbach
    License: MIT License
    Version: 260609
    """

    def __init__(self):
        """Initialize this component and set component parameters."""
        super().__init__()
        self.Component = ghenv.Component  # NOQA
        self.InputParams = self.Component.Params.Input
        self.OutputParams = self.Component.Params.Output

    def _addRemark(self, msg: str = ''):
        rml = self.Component.RuntimeMessageLevel.Remark
        self.AddRuntimeMessage(rml, msg)

    def _addWarning(self, msg: str = ''):
        rml = self.Component.RuntimeMessageLevel.Warning
        self.AddRuntimeMessage(rml, msg)

    def _addError(self, msg: str = ''):
        rml = self.Component.RuntimeMessageLevel.Error
        self.AddRuntimeMessage(rml, msg)

    def BeforeRunScript(self):
        """Describe inputs & outputs."""
        self.InputParams[0].Description = (
            'Embedded data as a DataTree where each branch represents one '
            'embedded datapoint and its items are the coordinates in the '
            'embedding space (e.g. output of ComputePCA or ComputeTSNE). '
            'Supports any number of dimensions; dimensions beyond the third '
            'are mapped to RGB colour channels.'
        )
        self.InputParams[1].Description = (
            'Geometry to place in the layout as a DataTree. One branch '
            'represents one datapoint; each branch may contain one or '
            'more geometries that are translated together as a rigid '
            'group (sharing a combined bounding-box anchor). Branch order '
            'must match the branch order of EmbeddedData.'
        )
        self.InputParams[2].Description = (
            'Total extent of the layout in world units. Each embedding '
            'dimension is min-max normalised to [0, ScaleFactor] before '
            'being used as a world-space coordinate. Default: 1000.0.'
        )

        # Output descriptions -- skip the hidden "out" param if present.
        i = 1 if self.OutputParams[0].Name == 'out' else 0
        self.OutputParams[0 + i].Description = (
            'Input geometry translated from its bounding-box centre to the '
            'corresponding embedding point in world coordinates.'
        )
        self.OutputParams[1 + i].Description = (
            'Embedding points in world coordinates, one per datapoint. '
            'For 1D embeddings Y = Z = 0; for 2D embeddings Z = 0.'
        )
        self.OutputParams[2 + i].Description = (
            'Per-datapoint RGB colour derived from embedding dimensions '
            '4, 5 and 6 (if present), each normalised to [0, 255]. Missing '
            'channels default to 128 (mid-grey), so low-dimensional '
            'embeddings still produce a usable colour output.'
        )
        self.OutputParams[3 + i].Description = (
            'The translation transform applied to each input geometry '
            '(useful to transform additional geometry into the same layout).'
        )

    def RunScript(self,
            EmbeddedData: Grasshopper.DataTree[float],
            Geometry: Grasshopper.DataTree[object],
            ScaleFactor: float):

        # init outputs
        LayoutGeometry = Grasshopper.DataTree[System.Object]()
        LayoutPoints = Grasshopper.DataTree[System.Object]()
        Colors = Grasshopper.DataTree[System.Object]()
        XForm = Grasshopper.DataTree[System.Object]()
        __Results = (LayoutGeometry, LayoutPoints, Colors, XForm)

        self.Component.Message = None

        # input validation
        if EmbeddedData is None or EmbeddedData.DataCount == 0:
            msg = 'EmbeddedData failed to collect data!'
            self._addWarning(msg)
            self.Component.Message = msg
            return __Results

        if Geometry is None or Geometry.DataCount == 0:
            msg = 'Geometry failed to collect data!'
            self._addWarning(msg)
            self.Component.Message = msg
            return __Results

        if ScaleFactor is None:
            ScaleFactor = 1000.0
        try:
            ScaleFactor = float(ScaleFactor)
        except (TypeError, ValueError):
            self._addError(
                f'ScaleFactor must be a number, got {ScaleFactor!r}')
            return __Results
        if not np.isfinite(ScaleFactor) or ScaleFactor <= 0.0:
            self._addError(
                f'ScaleFactor must be > 0, got {ScaleFactor}')
            return __Results

        # collect embedding values into a dense (N, D) array
        paths = list(EmbeddedData.Paths)
        branches = [list(EmbeddedData.Branch(p)) for p in paths]
        n_points = len(branches)

        if n_points < 2:
            self._addError(
                f'Need at least 2 embedded datapoints to build a layout, '
                f'got {n_points}'
            )
            return __Results

        dims = [len(b) for b in branches]
        n_dims = max(dims) if dims else 0
        if n_dims < 1:
            self._addError('EmbeddedData branches are empty')
            return __Results
        if min(dims) != n_dims:
            self._addWarning(
                f'EmbeddedData branches have non-uniform dimensionality '
                f'(min={min(dims)}, max={n_dims}); missing values will be '
                f'treated as 0.0'
            )

        values = np.zeros((n_points, n_dims), dtype=np.float64)
        for i, b in enumerate(branches):
            for j, v in enumerate(b):
                try:
                    values[i, j] = float(v)
                except (TypeError, ValueError):
                    values[i, j] = 0.0

        # Collect geometry branches; each branch == one datapoint
        geo_paths = list(Geometry.Paths)
        geo_branches = [list(Geometry.Branch(p)) for p in geo_paths]
        n_geo = len(geo_branches)

        if n_geo != n_points:
            self._addWarning(
                f'Geometry branch count ({n_geo}) does not match '
                f'EmbeddedData branch count ({n_points}); the shorter of '
                f'the two will be used.'
            )
        n_use = min(n_points, n_geo)

        # Compute layout
        try:
            points, colors_rgb, dims_pos, dims_col = _embedding_to_layout(
                values, ScaleFactor
            )
        except ValueError as exc:
            self._addError(f'Could not compute layout: {exc}')
            return __Results

        # Emit per-datapoint results
        successes = 0
        rc = self.Component.RunCount - 1
        for i in range(n_use):
            path = Grasshopper.Kernel.Data.GH_Path(rc, i)
            branch = [g for g in geo_branches[i] if g is not None]

            if not branch:
                self._addWarning(
                    f'Datapoint #{i}: geometry branch is empty or all '
                    f'None; skipped')
                continue

            try:
                anchor = _branch_anchor(branch)
            except ValueError as exc:
                self._addWarning(
                    f'Datapoint #{i}: {exc}; skipped')
                continue

            target = Rhino.Geometry.Point3d(
                float(points[i, 0]),
                float(points[i, 1]),
                float(points[i, 2]),
            )
            translation = Rhino.Geometry.Vector3d(
                target.X - anchor.X,
                target.Y - anchor.Y,
                target.Z - anchor.Z,
            )
            xform = Rhino.Geometry.Transform.Translation(translation)

            moved_items = []
            for j, geo in enumerate(branch):
                try:
                    moved = (geo.Duplicate()
                             if hasattr(geo, 'Duplicate') else geo)
                    if hasattr(moved, 'Transform'):
                        moved.Transform(xform)
                    else:
                        self._addWarning(
                            f'Datapoint #{i}, item #{j}: geometry does '
                            f'not support Transform; emitting original '
                            f'geometry unchanged'
                        )
                    moved_items.append(moved)
                except Exception as exc:
                    self._addWarning(
                        f'Datapoint #{i}, item #{j}: transform failed '
                        f'({exc}); skipped')
                    continue

            if not moved_items:
                self._addWarning(
                    f'Datapoint #{i}: no item transformed successfully; '
                    f'skipped')
                continue

            color = System.Drawing.Color.FromArgb(
                255,
                int(colors_rgb[i, 0]),
                int(colors_rgb[i, 1]),
                int(colors_rgb[i, 2]),
            )

            LayoutGeometry.AddRange(moved_items, path)
            LayoutPoints.Add(target, path)
            Colors.Add(color, path)
            XForm.Add(xform, path)
            successes += 1

        if successes == 0:
            self._addWarning('No datapoints produced valid output')
            self.Component.Message = 'no output'
        else:
            parts = ['']
            if dims_pos == 1:
                parts = ['1D layout']
            elif dims_pos == 2:
                parts = ['2D layout']
            elif dims_pos == 3:
                parts = ['3D layout']
            if dims_col > 0:
                parts.append(f'+{dims_col}ch colour')
                self.Component.Message = ' | '.join(parts)
            else:
                self.Component.Message = parts[0]
            self._addRemark(
                f'Placed {successes} geometry object(s) using '
                f'{dims_pos} position dim(s) and {dims_col} colour dim(s) '
                f'out of {n_dims} embedding dim(s).'
            )

        return __Results
# ---------- end visualizeembedding ----------
preview = CustomPreview(Geometry=visualizeembedding.LayoutGeometry, Material=visualizeembedding.Colors)
