# Grasshopper definition DDU_CSC_GrasshopperInterface_Example_06.gh (Grasshopper 1.0.8)
# Copyright: 2025

# ---- group: __DDU_CSC_EXAMPLE_06__
# comments & notes: Fetch a subset of components from the database using filters. Here we are fetching the 'mineral_composite_panels' dataset.
# 
# NOTE: ReservedStatus = -1 means we ignore reservations entirely
# Step 3
originalfunction = ValueList({"Any function": , "Beam (IfcBeam)": "IfcBeam", "Column (IfcColumn)": "IfcColumn", "Slab (IfcSlab)": "IfcSlab", "Plate / Panel (IfcPlate)": "IfcPlate", "Wall (IfcWall)": "IfcWall", "Member (IfcMember)": "IfcMember", "Pipe (IfcPipeSegment)": "IfcPipeSegment", "Duct (IfcDuctSegment)": "IfcDuctSegment", "Footing (IfcFooting)": "IfcFooting", "Window (IfcWindow)": "IfcWindow", "Door / gate (IfcDoor)": "IfcDoor", "Stair (IfcStair)": "IfcStair", "Railing / balustrade (IfcRailing)": "IfcRailing", "Accessory / Connector (IfcDiscreteAccessory)": "IfcDiscreteAccessory", "Element part (IfcBuildingElementPart)": "IfcBuildingElementPart", "Unknown (IfcBuildingElementProxy)": "IfcBuildingElementProxy", "Debris (CscDebris)": "CscDebris"}, selected="Any function")
material = ValueList({"Any material": , "Concrete (concrete)": "concrete", "Autoclaved aerated concrete (autoclaved_aerated_concrete)": "autoclaved_aerated_concrete", "Fired clay (fired_clay)": "fired_clay", "Calcium silicate (calcium_silicate)": "calcium_silicate", "Ceramic (ceramic)": "ceramic", "Natural stone (natural_stone)": "natural_stone", "Mixed mineral (mineral_mixture)": "mineral_mixture", "Gypsum (gypsum)": "gypsum", "Glass (glass)": "glass"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}, selected="Any material")
complexity = ValueList({"Any complexity": , "0", "1", "2", "3"}, selected="Any complexity")
fragment = ValueList({"Any": , "Only fragments": True, "Only non-fragmnents": False}, selected="Any")
shapeclass = ValueList({"Any shape": , "Linear (linear)": "linear", "Planar (planar)": "planar", "Block (block)": "block", "Irregular (irregular)": "irregular", "Composite (composite)": "composite"}, selected="Any shape")
materialclass = ValueList({"Any MaterialClass": , "Concrete (17 01 01)": "17 01 01", "Bricks (17 01 02)": "17 01 02", "Tiles and ceramics (17 01 03)": "17 01 03", "Mineral mixtures, hazardous (17 01 06*)": "17 01 06*", "Mineral mixtures (17 01 07)": "17 01 07", "Wood (17 02 01)": "17 02 01", "Glass (17 02 02)": "17 02 02", "Plastic (17 02 03)": "17 02 03", "Glass, plastic, wood, hazardous (17 02 04*)": "17 02 04*"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}, selected="Any MaterialClass")
circulation = ValueList({"Active (default)": "active", "Exited": "exited", "All \"all": "All "all""}, selected="Active (default)")
mindimensionx = Slider(0, range=-0.1..2000)
maxdimensiony = Slider(0, range=0..2000)
mindimensionz = Slider(0, range=0..500)
dataset = Panel("mineral_composite_panels")
maxdimensionx = Slider(0, range=0..2000)
mindimensiony = Slider(0, range=0..2000)
maxdimensionz = Slider(0, range=0..500)
reservedstatus = Slider(-1, range=-1..1)
fetchfilteredcomponents = FetchFilteredComponents(
    OriginalFunction=originalfunction,
    Material=material,
    Dataset=dataset,
    Complexity=complexity,
    Fragment=fragment,
    MinDimensionX=mindimensionx,
    MaxDimensionX=maxdimensionx,
    MinDimensionY=mindimensiony,
    MaxDimensionY=maxdimensiony,
    MinDimensionZ=mindimensionz,
    MaxDimensionZ=maxdimensionz,
    ReservedStatus=reservedstatus,
    ShapeClass=shapeclass,
    MaterialClass=materialclass,
    Circulation=circulation)  # -> FilterDescription, ComponentPassport; inputs OriginalFunction: String, Material: String, Dataset: String, Complexity: Int32, Fragment: Boolean, MinDimensionX: Double, MaxDimensionX: Double, MinDimensionY: Double, MaxDimensionY: Double, MinDimensionZ: Double, MaxDimensionZ: Double, ShapeClass: String, MaterialClass: String, Circulation: String
# ---------- fetchfilteredcomponents: Python ----------
#! python3
# -*- coding: utf-8 -*-
# venv: DDU_CSC
# r: charset_normalizer
# r: requests==2.32.5
# r: numpy==2.0.2
print('ENV OK!')

# PYTHON STANDARD LIBRARY IMPORTS ---------------------------------------------
import json  # NOQA

# THIRD PARTY LIBRARY IMPORTS -------------------------------------------------
import requests  # NOQA

# RHINO AND GH RELATED IMPORTS ------------------------------------------------
import System  # NOQA
import Grasshopper  # NOQA
import Rhino  # NOQA
import scriptcontext as sc  # NOQA

# GHENV COMPONENT SETTINGS ----------------------------------------------------
ghenv.Component.Name = 'FetchFilteredComponents'  # NOQA
ghenv.Component.NickName = 'FetchFilteredComponents'  # NOQA
ghenv.Component.Category = 'DDU_CSC'  # NOQA
ghenv.Component.SubCategory = '2 Catalog Interface'  # NOQA
ghenv.Component.Description = (  # NOQA
    'Fetches identities (with their current snapshot) from the remote '
    'Catalog based on filter criteria (original function, material, '
    'dataset, complexity, fragment, bounding box dimensions, shape class, '
    'material class, circulation). Mirrors the web catalog filter menu and '
    'returns component passport JSON ({identity, snapshots[]}) results.'
)

# CSC LIBRARY (decision 8.111) ----------------------------------------------
CSC_GH_MINIMUM = '261005'
LIBRARY_PROBLEM = None
try:
    import csc_gh
    csc_gh.require(CSC_GH_MINIMUM)
    from csc_gh.read import (fetch_filter_params)  # NOQA
except ImportError:
    LIBRARY_PROBLEM = (
        'CSC library 261005 too old or missing: run CSC_Update, '
        'then restart Rhino')

# OPTIONAL HELPERS: they never block the component (decisions 8.112, 8.113) ---
try:
    from csc_gh.ports import ensure_outputs
    from csc_gh.messages import set_state
except ImportError:
    ensure_outputs = set_state = None

OUTPUTS = [
    ('FilterDescription', 'FilterDescription',
     'Human-readable description of the applied filters and query'),
    ('ComponentPassport', 'ComponentPassport',
     "Component passport JSON per entry ({identity, snapshots[]}) fetched from the server. Use 'DisassembleComponent' to access the individual fields ready for Grasshopper"),
]


def empty_outputs():
    """What RunScript returns when it stops early."""
    if len(OUTPUTS) <= 1:
        return None
    return tuple(None for _ in OUTPUTS)


class CSC_FetchFilteredComponents(Grasshopper.Kernel.GH_ScriptInstance):
    """
    Author: Max Benjamin Eschenbach
    License: MIT License
    Version: 261005a
    """

    _outputs_ready = True       # set by BeforeRunScript (8.112)
    _outputs_note = None

    def __init__(self):
        """Initialize this component and set component parameters."""
        super().__init__()
        # initialize props
        self.Component = ghenv.Component  # NOQA
        self.InputParams = self.Component.Params.Input
        self.OutputParams = self.Component.Params.Output

    def _addRemark(self, msg: str = ''):
        """Add a remark message to the component."""
        rml = self.Component.RuntimeMessageLevel.Remark
        self.AddRuntimeMessage(rml, msg)

    def _addWarning(self, msg: str = ''):
        """Add a warning message to the component."""
        rml = self.Component.RuntimeMessageLevel.Warning
        self.AddRuntimeMessage(rml, msg)

    def _addError(self, msg: str = ''):
        """Add an error message to the component."""
        rml = self.Component.RuntimeMessageLevel.Error
        self.AddRuntimeMessage(rml, msg)

    def _state(self, text=''):
        """The one short state under the component (decision 8.113)."""
        if set_state is not None:
            set_state(self.Component, text)

    def _stop(self):
        """True when RunScript has to return early: the library is missing or
        too old, or the outputs were just updated (says why)."""
        if LIBRARY_PROBLEM:
            self._addError(LIBRARY_PROBLEM)
            return True
        if self._outputs_note:
            self._addRemark(self._outputs_note)
        return not self._outputs_ready

    def _check_outputs(self):
        """Make the outputs match OUTPUTS before the script runs (8.112)."""
        self._outputs_ready, self._outputs_note = True, None
        if ensure_outputs is None:
            self._outputs_note = (
                'output check skipped: CSC library not installed')
            return
        status = ensure_outputs(self.Component, OUTPUTS)
        self._outputs_ready, self._outputs_note = status.ready, status.remark

    def BeforeRunScript(self):
        """Perform some setup actions."""
        # Initialize input param descriptions
        descriptions = [
            'Original function filter, an IFC class (e.g. IfcBeam, '
            'IfcColumn, IfcSlab, IfcPlate, CscDebris)',
            'Material filter, a material id (e.g. concrete, steel, timber)',
            'Dataset name filter (e.g., "beyond_debris", '
            '"mineral_composite_sheets")',
            'Complexity level filter (0-3, where 0=simple, 3=complex)',
            'Fragment status filter (True for fragments, False for complete)',
            'Minimum X dimension filter (bounding box, longest side)',
            'Maximum X dimension filter (bounding box)',
            'Minimum Y dimension filter (bounding box)',
            'Maximum Y dimension filter (bounding box)',
            'Minimum Z dimension filter (bounding box, shortest side)',
            'Maximum Z dimension filter (bounding box)',
            'Reservation status filter: -1=ignore, 0=not reserved, '
            '1=reserved by current user',
            'Shape class filter: linear, planar, block, irregular or '
            'composite (derived by the server)',
            'Material class filter, a List of Waste code (e.g. 17 01 01)',
            'Circulation: active (default: in circulation, in place or '
            'deinstalled), in_place (still in the works), deinstalled, '
            'exited or all',
        ]
        for index, text_ in enumerate(descriptions):
            if index < len(self.InputParams):
                self.InputParams[index].Description = text_
        # Initialize output param descriptions
        self._check_outputs()
        if LIBRARY_PROBLEM is None:
            csc_gh.dev_reload(globals())

    def get_auth_core_from_sticky(self):
        """Get AuthCore instance from sticky storage."""
        auth_core = sc.sticky.get('CSC_AuthCore')
        if auth_core is None:
            msg = ('No authentication found. Please use CSC_Session component '
                   'first.')
            self._addWarning(msg)
            return None
        return auth_core

    def build_filter_query_params(
            self,
            OriginalFunction,
            Material,
            Dataset,
            Complexity,
            Fragment,
            MinDimensionX,
            MaxDimensionX,
            MinDimensionY,
            MaxDimensionY,
            MinDimensionZ,
            MaxDimensionZ,
            ReservedStatus,
            ShapeClass,
            MaterialClass,
            Circulation):
        """
        Build query parameters for GET /identities (csc_read).

        Mirrors the web catalog filter menu: original function, material,
        dataset, complexity, fragment, bounding box, shape class, material
        class and circulation. ``status`` is left to the server default
        (published only), matching the web. Adds a reservation-status filter
        on top: 1=reserved by current user, 0=not reserved.
        """
        function = OriginalFunction
        if isinstance(function, (list, tuple)):
            function = function[0] if function else None
        return fetch_filter_params(
            original_function=function,
            material=Material, dataset=Dataset, complexity=Complexity,
            fragment=Fragment, reserved=ReservedStatus,
            shape_class=ShapeClass, material_class=MaterialClass,
            circulation=Circulation,
            bbx={'min_x': MinDimensionX, 'max_x': MaxDimensionX,
                 'min_y': MinDimensionY, 'max_y': MaxDimensionY,
                 'min_z': MinDimensionZ, 'max_z': MaxDimensionZ})

    def generate_filter_description(self, filter_params: dict) -> str:
        """Generates a human-readable description of the applied filters."""
        description = []
        for key, label in (('original_function', 'Original function'),
                           ('material', 'Material'),
                           ('dataset', 'Dataset'),
                           ('shape_class', 'Shape class'),
                           ('material_class', 'Material class'),
                           ('circulation', 'Circulation')):
            if filter_params.get(key):
                description.append(f'\n{label}: {filter_params[key]}')
        if filter_params.get('complexity') is not None:
            description.append(f'\nComplexity: {filter_params["complexity"]}')
        if filter_params.get('fragment') is not None:
            description.append(f'\nFragment: {filter_params["fragment"]}')
        if filter_params.get('reserved') == 'false':
            description.append('\nReservation: Not reserved by anyone')
        elif filter_params.get('reserved') == 'true':
            description.append('\nReservation: Reserved by current user')
        bbx_filters = []
        for axis in 'xyz':
            for kind, sign in (('min', '>='), ('max', '<=')):
                value = filter_params.get(f'bbx_{kind}_{axis}')
                if value is not None:
                    bbx_filters.append(
                        f'\n{axis.upper()} {sign} {float(value):.2f}')
        if bbx_filters:
            description.append(f'\nBounding Box: {", ".join(bbx_filters)}')
        return f'Applied filters: {", ".join(description)}'

    def RunScript(self,
            OriginalFunction: str,
            Material: str,
            Dataset: str,
            Complexity: int,
            Fragment: bool,
            MinDimensionX: float,
            MaxDimensionX: float,
            MinDimensionY: float,
            MaxDimensionY: float,
            MinDimensionZ: float,
            MaxDimensionZ: float,
            ReservedStatus,
            ShapeClass: str,
            MaterialClass: str,
            Circulation: str):

        if self._stop():
            return empty_outputs()
        if not ShapeClass or ShapeClass == '':
            ShapeClass = None
        if not MaterialClass or MaterialClass == '':
            MaterialClass = None
        if not Circulation or Circulation == '':
            Circulation = None

        # Get AuthCore instance from sticky storage
        auth_core = self.get_auth_core_from_sticky()
        if auth_core is None:
            return empty_outputs()

        # Check if authentication is valid
        if not auth_core.is_valid():
            msg = ('Authentication expired. Please use CSC_Session '
                   'component to refresh.')
            self._addWarning(msg)
            return empty_outputs()

        try:

            # Build filter query parameters (parity with web filter menu)
            filter_params = self.build_filter_query_params(
                OriginalFunction, Material, Dataset, Complexity, Fragment,
                MinDimensionX, MaxDimensionX, MinDimensionY,
                MaxDimensionY, MinDimensionZ, MaxDimensionZ,
                ReservedStatus, ShapeClass, MaterialClass, Circulation
            )

            # Request params: filters + passport expansion (identity+snapshot)
            request_params = dict(filter_params)
            request_params['expand'] = 'current_snapshot'

            # Generate human-readable filter description
            filter_description = self.generate_filter_description(
                filter_params
            )


            # Unified catalog cache (same identity/snapshot store as
            # FetchAllComponents and FetchComponents).
            response = auth_core.cached_list_identities(request_params)

            if response.status_code == 200:
                # Successfully fetched passport entries
                json_comps = response.json()
                component_count = len(json_comps)

                self._state(f'{component_count} found')

                self._addRemark(
                    f'Successfully fetched {component_count} components '
                    f'with applied filters'
                )

                # Set up output trees and results tuple
                FilterDescription = Grasshopper.DataTree[System.Object]()
                ComponentPassport = Grasshopper.DataTree[System.Object]()
                __Results = (FilterDescription, ComponentPassport)

                # Loop over all passport entries and add them to the data tree
                for i, json_comp in enumerate(json_comps):
                    # Create datatree path
                    ghp = Grasshopper.Kernel.Data.GH_Path(0, i)
                    # Add passport JSON to the datatree
                    ComponentPassport.Add(
                        auth_core.passport_json_string(json_comp), ghp)

                # Add filter description to the filter query output
                FilterDescription.Add(
                    filter_description,
                    Grasshopper.Kernel.Data.GH_Path(0)
                )

                return __Results

            elif response.status_code == 401:
                msg = 'Authentication failed. Please sign in again.'
                self._addError(msg)

            elif response.status_code == 403:
                msg = 'Access denied. Insufficient permissions.'
                self._addError(msg)

            elif response.status_code == 500:
                msg = 'Server error. Please try again later.'
                self._addWarning(msg)

            else:
                msg = (f'Request failed with status code: '
                       f'{response.status_code}')
                self._addError(msg)

        except requests.exceptions.ConnectionError as e:
            msg = 'Cannot connect to server. Please check your connection.'
            self._addError(msg + f'\nFull Error: {str(e)}')

        except requests.exceptions.Timeout as e:
            msg = 'Request timeout. Server may be slow.'
            self._addError(msg + f'\nFull Error: {str(e)}')

        except requests.exceptions.RequestException as e:
            msg = f'Request error: {str(e)}'
            self._addError(msg)

        except Exception as e:
            msg = f'Unexpected error: {str(e)}'
            self._addError(msg)

        # Return empty results if there was an error
        ComponentPassport = Grasshopper.DataTree[System.Object]()
        FilterDescription = Grasshopper.DataTree[System.Object]()
        __Results = (FilterDescription, ComponentPassport)
        return __Results
# ---------- end fetchfilteredcomponents ----------
panel = Panel(fetchfilteredcomponents.FilterDescription)
componentpassport = Data(fetchfilteredcomponents.ComponentPassport)

# Step 2
# comments & notes: Create some Voronoi Cells that we will use as our target "Design Shapes".
# 
# You can play with the Random Seed to get different cell arrangements (randomized).
x_extents = Slider(2500, range=100..3000)
y_extents = Slider(1000, range=100..3000)
dom = ConstructDomain(DomainStart="0", DomainEnd=x_extents)
dom_2 = ConstructDomain(DomainStart="0", DomainEnd=y_extents)
cellcount = Slider(16, range=10..1000)
randomseed = Slider(2637, range=0..10000)
rectangle = Rectangle(Plane=PlaneXY(0, 0, 0), XSize=dom, YSize=dom_2, Radius=0)  # -> Rectangle, Length
boundary = BoundarySurfaces(Edges=rectangle.Rectangle)
popgeo = PopulateGeometry(Geometry=boundary, Count=cellcount, Seed=randomseed)
voronoi = Voronoi(Points=popgeo, BruteForceOverride=False)
rint = RegionIntersection(CurvesA=voronoi, CurvesB=graft(rectangle.Rectangle))  # -> flatten(Result)
curvepreviewlw = CurvePreviewLW(Curves=flatten(rint), Thickness="2")  # inputs Curves: list of Curve, Colors: list of Color, Thickness: list of Int32
# ---------- curvepreviewlw: C# ----------
#region Usings
using System;
using System.Linq;
using System.Collections;
using System.Collections.Generic;
using System.Drawing;

using Rhino;
using Rhino.Geometry;

using Grasshopper;
using Grasshopper.Kernel;
using Grasshopper.Kernel.Data;
using Grasshopper.Kernel.Types;
#endregion

public class Script_Instance : GH_ScriptInstance
{
    #region Notes
    /* 
      Members:
        RhinoDoc RhinoDocument
        GH_Document GrasshopperDocument
        IGH_Component Component
        int Iteration

      Methods (Virtual & overridable):
        Print(string text)
        Print(string format, params object[] args)
        Reflect(object obj)
        Reflect(object obj, string method_name)

        Author: Max Benjamin Eschenbach
        License: MIT License
        Version: 260609
    */
    #endregion

    List<Curve> drawCurves;
    List<Color> drawColors;
    List<int> drawThickness;

    private void RunScript(
		List<Curve> Curves,
		List<Color> Colors,
		List<int> Thickness)
    {
        // set component params
        this.Component.Name = "CurvePreviewLW";
        this.Component.NickName = "CurvePreviewLW";
        this.Component.Category = "DDU_CSC";
        this.Component.SubCategory = "8 Visualization";
        this.Component.Description = (
            "Render curves with custom LineWeights."
        );

        this.drawCurves = new List<Curve>();   
        this.drawColors = new List<Color>();
        this.drawThickness = new List<int>();

        if (Curves == null) return;
        if (Colors == null) this.drawColors = new List<Color>{Color.Black};
        else this.drawColors = Colors;

        if (Thickness == null) this.drawThickness = new List<int>{1};
        else this.drawThickness = Thickness;

        for (int i = 0; i < Curves.Count; i++)
        {
            if (Curves[i] != null)
            {
                this.drawCurves.Add(Curves[i]);
            }
            else
            {
                continue;
            }
            if (Colors == null || i >= Colors.Count || Colors[i] == null)
            {
                this.drawColors.Add(drawColors.Last());
            }
            else
            {
                this.drawColors.Add(Colors[i]);
            }
            if (Thickness == null || i >= Thickness.Count || Thickness[i] == null)
            {
                this.drawThickness.Add(drawThickness.Last());
            }
            else
            {
                this.drawThickness.Add(Thickness[i]);
            }
        }
    }

    override public void DrawViewportWires(IGH_PreviewArgs args)
    {
        if (this.drawCurves != null)
        {
            try
            {
                for (int i = 0; i < this.drawCurves.Count; i++)
                {
                    args.Display.DrawCurve(
                        this.drawCurves[i],
                        this.drawColors[i],
                        this.drawThickness[i]
                    );
                }
                
            }
            catch (Exception e)
            {
                this.AddRuntimeMessage(GH_RuntimeMessageLevel.Warning, "Error while drawing Preview!");
                this.Print(e.ToString());
            }
        }
        else
        {
            return;
        }
    }
}
# ---------- end curvepreviewlw ----------
designshapes = Data(rint)

# __DEVELOPMENT_CREDITS__: Authors: Max Benjamin Eschenbach
# Constributors: Alessandro Garruto
# 
# Digital Design Unit (DDU)
# Prof. Dr.-Ing. Oliver Tessmann
# Fachbereich Architektur
# Technical University of Darmstadt
# 
# CREDITS:
# ------------
# Please see: https://2ndchances.build/credits
# Example 06:
# - Fetch all corian sheet components
# - Get radial signature descriptors
# - Create voronoi cells as an example "demand" of design shapes
# - Compute radial signature descriptors for design shapes
# - Match catalog to design shapes either with greedy or optimal assignment
# Step 1
# comments & notes: Create new User Session and sign in
# 
# (Add your credentials!)
ddu_csc_username = Panel("")
ddu_csc_password = Panel("")
disablecache = BooleanToggle(False)
clearcache = Button()
refresh = Button()
csc_session = Session(Username=ddu_csc_username, Password=ddu_csc_password, Refresh=refresh, DisableCache=disablecache, ClearCache=clearcache)  # -> Status; inputs Username: String, Password: String, Refresh: Boolean, DisableCache: Boolean, ClearCache: Boolean
# ---------- csc_session: Python ----------
#! python3
# -*- coding: utf-8 -*-
# venv: DDU_CSC
# r: charset_normalizer
# r: requests==2.32.5
# r: numpy==2.0.2
print('ENV OK!')

# PYTHON STANDARD LIBRARY IMPORTS ---------------------------------------------
import time  # NOQA
import json  # NOQA
import base64  # NOQA
import os  # NOQA
import hashlib  # NOQA
import pickle  # NOQA
import math  # NOQA
import struct  # NOQA
from threading import RLock  # NOQA
import uuid  # NOQA
from datetime import datetime, timedelta  # NOQA

# THIRD PARTY LIBRARY IMPORTS -------------------------------------------------
import requests  # NOQA

# RHINO AND GH RELATED IMPORTS ------------------------------------------------
import System  # NOQA
import Rhino  # NOQA
import Grasshopper  # NOQA
import scriptcontext as sc  # NOQA

# GHENV COMPONENT SETTINGS ----------------------------------------------------
ghenv.Component.Name = 'Session'  # NOQA
ghenv.Component.NickName = 'CSC_Session'  # NOQA
ghenv.Component.Category = 'DDU_CSC'  # NOQA
ghenv.Component.SubCategory = '1 User'  # NOQA
ghenv.Component.Description = (  # NOQA
    'Handles user authentication with the remote API (server address '
    'input), manages access tokens, keeps one connection alive for all '
    'requests and provides a unified catalog cache (identities and '
    'snapshots stored independently, mesh PLY geometry cached per '
    'snapshot). Stores authentication state in scriptcontext.sticky.'
)

"""
Author: Max Benjamin Eschenbach
License: MIT License
Version: 261005a
"""

# Sent as X-CSC-Client on every request so the backend can tell which
# UserObjects release is calling (spec 7.4).
CSC_CLIENT = 'gh-userobjects/0.6.0.0'

# The server of a fresh session; the Server input of this component changes it.
DEFAULT_SERVER = 'https://api.2ndchances.build'

# CSC LIBRARY (decision 8.111) ----------------------------------------------
CSC_GH_MINIMUM = '261005'
LIBRARY_PROBLEM = None
try:
    import csc_gh
    csc_gh.require(CSC_GH_MINIMUM)
    from csc_gh.rhino import (mesh_from_ply, point_cloud_from_ply)  # NOQA
except ImportError:
    LIBRARY_PROBLEM = (
        'CSC library 261005 too old or missing: run CSC_Update, '
        'then restart Rhino')

# OPTIONAL HELPERS: they never block the component (decisions 8.112, 8.113) ---
try:
    from csc_gh.ports import ensure_outputs
    from csc_gh.messages import set_state
except ImportError:
    ensure_outputs = set_state = None

OUTPUTS = [
    ('Status', 'Status',
     'Status Message'),
]


def empty_outputs():
    """What RunScript returns when it stops early."""
    if len(OUTPUTS) <= 1:
        return None
    return tuple(None for _ in OUTPUTS)


class CSCClientOutdated(RuntimeError):
    """The server answered 426: this UserObjects release is too old."""


def server_url(value):
    """A server address as typed (``localhost:8010``, a full URL, empty =
    the default) as a URL without a trailing slash."""
    value = (value or '').strip()
    if not value:
        return DEFAULT_SERVER
    if '://' not in value:
        host = value.split('/')[0].lower()
        host = (host.split(']')[0] + ']' if host.startswith('[')
                else host.split(':')[0])
        local = host in ('localhost', '127.0.0.1', '[::1]')
        value = ('http://' if local else 'https://') + value
    return value.rstrip('/')


def outdated_message(response):
    """The sentence of a 426 answer: the server's reason and the fix."""
    try:
        detail = response.json().get('detail')
    except Exception:
        detail = None
    detail = detail or 'this UserObjects release is older than the server needs'
    if 'CSC_Update' not in str(detail):
        detail = f'{detail}: update the UserObjects with CSC_Update'
    return f'Server refused this client (426): {detail}'


def _compute_passport_etag(identity_doc, snapshot_docs):
    """Match backend ``_compute_passport_etag`` (identity + snapshot rows)."""
    parts = [identity_doc.get('lastmodified', '')]
    for doc in sorted(
            snapshot_docs or [],
            key=lambda row: str(row.get('_id', ''))):
        parts.append(str(doc.get('etag', '')))
    return hashlib.sha256('::'.join(parts).encode('utf-8')).hexdigest()


def _passport_cache_key(identity_id, snapshots=None):
    """Stable cache key for a passport GET variant."""
    if not snapshots or snapshots == 'current':
        return f'passport:{identity_id}:current'
    if snapshots == 'all':
        return f'passport:{identity_id}:all'
    if isinstance(snapshots, (list, tuple)):
        joined = ','.join(sorted(str(item) for item in snapshots))
        digest = hashlib.md5(joined.encode('utf-8')).hexdigest()[:16]
        return f'passport:{identity_id}:ids:{digest}'
    return f'passport:{identity_id}:custom'


def primary_snapshot_from_passport(passport):
    """Return the first snapshot from a passport payload."""
    if not isinstance(passport, dict):
        return None
    snapshots = passport.get('snapshots') or []
    if snapshots and isinstance(snapshots[0], dict):
        return snapshots[0]
    legacy = passport.get('snapshot')
    if isinstance(legacy, dict):
        return legacy
    return None


def normalize_passport_payload(passport):
    """
    Ensure passport-shaped dicts use {identity, snapshots[]}.

    Accepts legacy {identity, snapshot} list rows and normalizes them.
    """
    if not isinstance(passport, dict):
        return passport
    identity = passport.get('identity')
    if not isinstance(identity, dict):
        return passport

    snapshots = passport.get('snapshots')
    if isinstance(snapshots, list) and snapshots:
        out = {'identity': identity, 'snapshots': snapshots}
    else:
        legacy = passport.get('snapshot')
        if isinstance(legacy, dict):
            out = {'identity': identity, 'snapshots': [legacy]}
        else:
            return passport

    if 'reserved_by_username' in passport:
        out['reserved_by_username'] = passport['reserved_by_username']
    return out


def _query_cache_key(params):
    """Stable cache key for a GET /identities query parameter dict."""
    if not params:
        return 'query:identities'
    items = sorted((str(k), str(v)) for k, v in params.items())
    payload = '&'.join(f'{k}={v}' for k, v in items)
    return 'query:' + hashlib.md5(payload.encode('utf-8')).hexdigest()


class _CachedResponse(object):
    """Minimal response wrapper for cache hits (status 200 + JSON body)."""

    def __init__(self, data, etag=None, status_code=200):
        self.status_code = status_code
        self._data = data
        self._etag = etag

    def json(self):
        return self._data

    @property
    def headers(self):
        return {'ETag': self._etag} if self._etag else {}


# ComponentCache - Embedded ---------------------------------------------------

class _ComponentCache(object):
    """
    Component cache manager for efficient local storage and retrieval.

    Author: Max Benjamin Eschenbach
    License: MIT License
    """

    def __init__(self, cache_dir=None, ttl_hours=24):
        self.ttl_hours = ttl_hours
        self.cache_dir = cache_dir or self._get_default_cache_dir()
        self.components_dir = os.path.join(self.cache_dir, 'components')
        self.identities_dir = os.path.join(self.cache_dir, 'identities')
        self.snapshots_dir = os.path.join(self.cache_dir, 'snapshots')
        self.metadata_dir = os.path.join(self.cache_dir, 'metadata')
        self.geometry_dir = os.path.join(self.cache_dir, 'component_geometry')
        self._lock = RLock()

        # Ensure cache directories exist
        self._ensure_cache_dirs()
        # A cache written by another client release is not trusted: purge
        # it once when the release changes (0.5 documents differ from 0.6)
        self._purge_on_client_change()

    def _get_default_cache_dir(self):
        """Get platform-specific cache directory."""
        if os.name == 'nt':  # Windows
            appdata = os.environ.get('APPDATA', '')
            return os.path.join(appdata, 'DDU_CSC', 'cache')
        else:  # macOS/Linux
            home = os.path.expanduser('~')
            return os.path.join(
                home, 'Library', 'Application Support', 'DDU_CSC', 'cache'
            )

    def _ensure_cache_dirs(self):
        """Create cache directories if they don't exist."""
        dirs = [
            self.cache_dir, self.components_dir, self.identities_dir,
            self.snapshots_dir, self.metadata_dir, self.geometry_dir
        ]
        for directory in dirs:
            if not os.path.exists(directory):
                os.makedirs(directory, exist_ok=True)

    def _purge_on_client_change(self):
        """Empty the cache once when CSC_CLIENT changed since it was written."""
        stamp = os.path.join(self.cache_dir, 'client_release.txt')
        try:
            with open(stamp, 'r', encoding='utf-8') as f:
                written_by = f.read().strip()
        except (IOError, OSError):
            written_by = ''
        if written_by == CSC_CLIENT:
            return
        if written_by or os.listdir(self.metadata_dir):
            self.invalidate()
        try:
            with open(stamp, 'w', encoding='utf-8') as f:
                f.write(CSC_CLIENT)
        except (IOError, OSError):
            pass

    def _get_cache_key_hash(self, cache_key):
        """Generate a safe filename from cache key."""
        return hashlib.md5(cache_key.encode('utf-8')).hexdigest()

    def _is_expired(self, timestamp_str):
        """Check if cache entry is expired based on TTL."""
        try:
            timestamp = datetime.fromisoformat(
                timestamp_str.replace('Z', '+00:00'))
            expiry = timestamp + timedelta(hours=self.ttl_hours)
            return datetime.now(timestamp.tzinfo) > expiry
        except (ValueError, TypeError):
            return True  # If we can't parse timestamp, consider expired

    def get(self, cache_key, filters=None):
        """
        Get cached data for a cache key.

        Args:
            cache_key: Cache key (e.g., 'all_components', 'component:uuid')
            filters: Optional filter parameters for metadata cache

        Returns:
            Tuple of (data, etag, is_from_cache) or
            (None, None, False) if not found
        """
        # Try binary cache first
        return self.get_binary(cache_key)

    def set(self, cache_key, data, etag=None, filters=None):
        """
        Store data in cache.

        Args:
            cache_key: Cache key
            data: Data to cache
            etag: ETag for the data
            filters: Optional filter parameters
        """
        # Use binary cache
        self.set_binary(cache_key, data, etag, filters)

    def _write_metadata(self, cache_key, metadata):
        metadata_file = os.path.join(
            self.metadata_dir,
            f"{self._get_cache_key_hash(cache_key)}.json"
        )
        with open(metadata_file, 'w', encoding='utf-8') as f:
            json.dump(metadata, f, indent=2, ensure_ascii=False)

    def _read_metadata(self, cache_key):
        metadata_file = os.path.join(
            self.metadata_dir,
            f"{self._get_cache_key_hash(cache_key)}.json"
        )
        if not os.path.exists(metadata_file):
            return None
        with open(metadata_file, 'r', encoding='utf-8') as f:
            metadata = json.load(f)
        if self._is_expired(metadata.get('cached_at', '')):
            return None
        return metadata

    # Identity / snapshot catalog cache (v0.5) -------------------------------

    def set_identity(self, identity_id, identity_doc):
        """Store one identity document (keyed by identity id)."""
        with self._lock:
            try:
                cache_key = f'identity:{identity_id}'
                identity_file = os.path.join(
                    self.identities_dir, f'{identity_id}.pkl'
                )
                with open(identity_file, 'wb') as f:
                    pickle.dump(identity_doc, f)
                self._write_metadata(cache_key, {
                    'cache_key': cache_key,
                    'cached_at': datetime.now().isoformat(),
                    'etag': identity_doc.get('lastmodified'),
                    'type': 'identity',
                    'current_snapshot_id': identity_doc.get(
                        'current_snapshot_id'),
                })
            except (IOError, pickle.PickleError):
                pass

    def get_identity(self, identity_id):
        """Return (identity_doc, etag, is_cached)."""
        with self._lock:
            try:
                cache_key = f'identity:{identity_id}'
                metadata = self._read_metadata(cache_key)
                if metadata is None:
                    return None, None, False
                identity_file = os.path.join(
                    self.identities_dir, f'{identity_id}.pkl'
                )
                if not os.path.exists(identity_file):
                    return None, None, False
                with open(identity_file, 'rb') as f:
                    identity_doc = pickle.load(f)
                return identity_doc, metadata.get('etag'), True
            except (IOError, pickle.PickleError, KeyError):
                return None, None, False

    def set_snapshot(self, snapshot_id, snapshot_doc):
        """Store one snapshot document (keyed by snapshot id)."""
        with self._lock:
            try:
                cache_key = f'snapshot:{snapshot_id}'
                snapshot_file = os.path.join(
                    self.snapshots_dir, f'{snapshot_id}.pkl'
                )
                with open(snapshot_file, 'wb') as f:
                    pickle.dump(snapshot_doc, f)
                self._write_metadata(cache_key, {
                    'cache_key': cache_key,
                    'cached_at': datetime.now().isoformat(),
                    'etag': snapshot_doc.get('etag'),
                    'type': 'snapshot',
                    'identity_id': snapshot_doc.get('identity_id'),
                })
            except (IOError, pickle.PickleError):
                pass

    def get_snapshot(self, snapshot_id):
        """Return (snapshot_doc, etag, is_cached)."""
        with self._lock:
            try:
                cache_key = f'snapshot:{snapshot_id}'
                metadata = self._read_metadata(cache_key)
                if metadata is None:
                    return None, None, False
                snapshot_file = os.path.join(
                    self.snapshots_dir, f'{snapshot_id}.pkl'
                )
                if not os.path.exists(snapshot_file):
                    return None, None, False
                with open(snapshot_file, 'rb') as f:
                    snapshot_doc = pickle.load(f)
                return snapshot_doc, metadata.get('etag'), True
            except (IOError, pickle.PickleError, KeyError):
                return None, None, False

    def ingest_passport_row(self, row):
        """
        Store identity + snapshot(s) from one passport row.

        Accepts {identity, snapshots[]} and list rows {identity, snapshot}.
        Returns the identity id when stored, else None.
        """
        if not isinstance(row, dict):
            return None
        identity = row.get('identity')
        if not isinstance(identity, dict):
            return None
        identity_id = identity.get('_id') or identity.get('id')
        if not identity_id:
            return None

        stored_any = False
        snapshots = row.get('snapshots') or []
        if isinstance(snapshots, list) and snapshots:
            for snapshot in snapshots:
                if not isinstance(snapshot, dict):
                    continue
                snapshot_id = snapshot.get('_id') or snapshot.get('id')
                if not snapshot_id:
                    continue
                self.set_snapshot(snapshot_id, snapshot)
                stored_any = True
        else:
            snapshot = row.get('snapshot')
            if isinstance(snapshot, dict):
                snapshot_id = snapshot.get('_id') or snapshot.get('id')
                if snapshot_id:
                    self.set_snapshot(snapshot_id, snapshot)
                    stored_any = True

        if not stored_any:
            return None

        self.set_identity(identity_id, identity)
        return identity_id

    def ingest_passport_rows(self, rows):
        """Store many passport rows; return ordered identity ids."""
        identity_ids = []
        for row in rows or []:
            identity_id = self.ingest_passport_row(row)
            if identity_id:
                identity_ids.append(identity_id)
        return identity_ids

    def assemble_passport(self, identity_id):
        """
        Build {identity, snapshots:[current]} from cached documents.

        Uses identity.current_snapshot_id to pick the snapshot.
        """
        identity_doc, _, identity_ok = self.get_identity(identity_id)
        if not identity_ok or not identity_doc:
            return None
        snapshot_id = identity_doc.get('current_snapshot_id')
        if not snapshot_id:
            return None
        snapshot_doc, _, snapshot_ok = self.get_snapshot(snapshot_id)
        if not snapshot_ok or not snapshot_doc:
            return None
        return {
            'identity': identity_doc,
            'snapshots': [snapshot_doc],
        }

    def set_query(self, query_key, identity_ids, etag=None, params=None):
        """Store list-query metadata (identity id index + list ETag)."""
        with self._lock:
            try:
                self._write_metadata(query_key, {
                    'cache_key': query_key,
                    'cached_at': datetime.now().isoformat(),
                    'etag': etag,
                    'type': 'query',
                    'identity_ids': list(identity_ids),
                    'params': params,
                })
            except (IOError, TypeError):
                pass

    def get_query(self, query_key):
        """Return (identity_ids, etag, is_cached) for a list query."""
        with self._lock:
            try:
                metadata = self._read_metadata(query_key)
                if metadata is None:
                    return None, None, False
                return (
                    metadata.get('identity_ids') or [],
                    metadata.get('etag'),
                    True,
                )
            except (IOError, KeyError):
                return None, None, False

    def assemble_passport_list(self, identity_ids):
        """Build passport rows from cached identity/snapshot documents."""
        rows = []
        for identity_id in identity_ids or []:
            passport = self.assemble_passport(identity_id)
            if passport:
                rows.append(passport)
        return rows

    def invalidate(self, pattern=None):
        """
        Invalidate cache entries.

        Args:
            pattern: Optional pattern to match cache keys (None = clear all)
        """
        with self._lock:
            try:
                if pattern is None:
                    # Clear all cache
                    for directory in [
                            self.components_dir,
                            self.identities_dir,
                            self.snapshots_dir,
                            self.metadata_dir,
                            self.geometry_dir
                    ]:
                        if os.path.exists(directory):
                            for filename in os.listdir(directory):
                                file_path = os.path.join(directory, filename)
                                if os.path.isfile(file_path):
                                    os.remove(file_path)
                                elif os.path.isdir(file_path):
                                    # Remove subdirectories
                                    # (geometry type folders)
                                    import shutil
                                    shutil.rmtree(
                                        file_path,
                                        ignore_errors=True
                                    )
                else:
                    # Clear specific pattern
                    pattern_hash = self._get_cache_key_hash(pattern)
                    metadata_file = os.path.join(
                        self.metadata_dir, f"{pattern_hash}.json"
                    )
                    if os.path.exists(metadata_file):
                        os.remove(metadata_file)

            except (IOError, OSError):
                pass

    def get_cache_stats(self):
        """Get cache statistics."""
        with self._lock:
            try:
                component_count = len(
                    [f for f in os.listdir(self.components_dir)
                     if f.endswith('.pkl')]
                )
                identity_count = len(
                    [f for f in os.listdir(self.identities_dir)
                     if f.endswith('.pkl')]
                )
                snapshot_count = len(
                    [f for f in os.listdir(self.snapshots_dir)
                     if f.endswith('.pkl')]
                )
                metadata_count = len(
                    [f for f in os.listdir(self.metadata_dir)
                     if f.endswith('.json')]
                )

                # Calculate total cache size
                total_size = 0
                for directory in [
                        self.components_dir, self.identities_dir,
                        self.snapshots_dir, self.metadata_dir
                ]:
                    for filename in os.listdir(directory):
                        file_path = os.path.join(directory, filename)
                        if os.path.isfile(file_path):
                            total_size += os.path.getsize(file_path)

                # Calculate geometry cache stats
                geometry_count = 0
                geometry_size = 0
                if os.path.exists(self.geometry_dir):
                    for root, dirs, files in os.walk(self.geometry_dir):
                        for file in files:
                            if file.endswith('.pkl'):
                                geometry_count += 1
                                file_path = os.path.join(root, file)
                                if os.path.isfile(file_path):
                                    geometry_size += os.path.getsize(file_path)

                return {
                    'component_count': component_count,
                    'identity_count': identity_count,
                    'snapshot_count': snapshot_count,
                    'metadata_count': metadata_count,
                    'geometry_count': geometry_count,
                    'total_size_bytes': total_size + geometry_size,
                    'geometry_size_bytes': geometry_size,
                    'cache_dir': self.cache_dir
                }
            except (IOError, OSError):
                return {
                    'component_count': 0,
                    'identity_count': 0,
                    'snapshot_count': 0,
                    'metadata_count': 0,
                    'geometry_count': 0,
                    'total_size_bytes': 0,
                    'geometry_size_bytes': 0,
                    'cache_dir': self.cache_dir
                }

    def get_binary(self, cache_key):
        """
        Get cached data from binary cache.

        Args:
            cache_key: Cache key (e.g., 'component:uuid')

        Returns:
            Tuple of (data, etag, is_from_cache) or
            (None, None, False) if not found
        """
        with self._lock:
            try:
                # Check metadata cache first
                metadata_file = os.path.join(
                    self.metadata_dir,
                    f"{self._get_cache_key_hash(cache_key)}.json"
                )

                if not os.path.exists(metadata_file):
                    return None, None, False

                with open(metadata_file, 'r', encoding='utf-8') as f:
                    metadata = json.load(f)

                # Check if expired
                if self._is_expired(metadata.get('cached_at', '')):
                    return None, None, False

                # Handle different cache key types
                if cache_key.startswith('component:'):
                    # Individual component
                    component_id = cache_key.split(':', 1)[1]
                    component_file = os.path.join(
                        self.components_dir, f"{component_id}.pkl"
                    )

                    if os.path.exists(component_file):
                        with open(component_file, 'rb') as f:
                            component_data = pickle.load(f)
                        return component_data, metadata.get('etag'), True

                elif cache_key == 'schema:create_identity':
                    # Schema data is stored directly in metadata
                    return metadata.get('data'), metadata.get('etag'), True

                return None, None, False

            except (IOError, pickle.PickleError, KeyError):
                return None, None, False

    def set_binary(self, cache_key, data, etag=None, filters=None):
        """
        Store data in binary cache.

        Args:
            cache_key: Cache key
            data: Data to cache
            etag: ETag for the data
            filters: Optional filter parameters
        """
        with self._lock:
            try:
                current_time = datetime.now().isoformat()
                # Guards against unhandled cache keys (avoids referencing an
                # unassigned ``metadata`` at the write step below).
                metadata = None

                if cache_key.startswith('component:'):
                    # Individual component
                    component_id = cache_key.split(':', 1)[1]
                    component_file = os.path.join(
                        self.components_dir, f"{component_id}.pkl"
                    )

                    # Store component data as pickle
                    with open(component_file, 'wb') as f:
                        pickle.dump(data, f)

                    # Store metadata
                    metadata = {
                        'cache_key': cache_key,
                        'cached_at': current_time,
                        'etag': etag,
                        'type': 'component'
                    }

                elif cache_key == 'schema:create_identity':
                    # Schema data - store directly in metadata
                    metadata = {
                        'cache_key': cache_key,
                        'cached_at': current_time,
                        'etag': etag,
                        'type': 'schema',
                        'data': data
                    }

                # Unhandled cache key: nothing to persist, bail out safely
                if metadata is None:
                    return

                # Write metadata file
                metadata_file = os.path.join(
                    self.metadata_dir,
                    f"{self._get_cache_key_hash(cache_key)}.json"
                )
                with open(metadata_file, 'w', encoding='utf-8') as f:
                    json.dump(metadata, f, indent=2, ensure_ascii=False)

            except (IOError, pickle.PickleError, KeyError):
                # Silently fail cache writes to not break main functionality
                pass

    def get_mesh_binary(self, snapshot_id, primitive_index, resolution):
        """
        Get one cached snapshot-primitive mesh from binary cache.

        Args:
            snapshot_id: Snapshot UUID
            primitive_index: Index into the snapshot geometry.meshes array
            resolution: 'reduced' or 'detailed'

        Returns:
            Tuple of (mesh, etag, is_from_cache) or (None, None, False)
        """
        with self._lock:
            try:
                cache_key = (
                    f'mesh:{resolution}:{snapshot_id}:{primitive_index}'
                )
                metadata_file = os.path.join(
                    self.metadata_dir,
                    f"{self._get_cache_key_hash(cache_key)}.json"
                )

                if not os.path.exists(metadata_file):
                    return None, None, False

                with open(metadata_file, 'r', encoding='utf-8') as f:
                    metadata = json.load(f)

                # Check if expired
                if self._is_expired(metadata.get('cached_at', '')):
                    return None, None, False

                # Get mesh file path
                mesh_file = os.path.join(
                    self.geometry_dir,
                    resolution,
                    f"{snapshot_id}_{primitive_index}.pkl"
                )

                if os.path.exists(mesh_file):
                    with open(mesh_file, 'rb') as f:
                        mesh_json = pickle.load(f)
                    mesh = Rhino.Geometry.Mesh.FromJSON(mesh_json)
                    if mesh:
                        return mesh, metadata.get('etag'), True

                return None, None, False

            except (IOError, pickle.PickleError, KeyError):
                return None, None, False

    def set_mesh_binary(
            self, snapshot_id, primitive_index, resolution, mesh, etag):
        """
        Cache one snapshot-primitive mesh as binary (mesh ToJSON pickle).

        Args:
            snapshot_id: Snapshot UUID
            primitive_index: Index into the snapshot geometry.meshes array
            resolution: 'reduced' or 'detailed'
            mesh: Rhino.Geometry.Mesh object (already parsed from PLY)
            etag: ETag from server response
        """
        with self._lock:
            try:
                current_time = datetime.now().isoformat()
                cache_key = (
                    f'mesh:{resolution}:{snapshot_id}:{primitive_index}'
                )

                # Create geometry subdirectory
                geometry_subdir = os.path.join(
                    self.geometry_dir, resolution
                )
                os.makedirs(geometry_subdir, exist_ok=True)

                # Convert mesh to JSON string using ToJSON
                options = Rhino.FileIO.SerializationOptions()
                options.WriteUserData = True
                options.WriteRenderMeshes = True
                options.WriteAnalysisMeshes = True
                mesh_json = mesh.ToJSON(options)

                # Store JSON string as pickle
                mesh_file = os.path.join(
                    geometry_subdir,
                    f"{snapshot_id}_{primitive_index}.pkl"
                )
                with open(mesh_file, 'wb') as f:
                    pickle.dump(mesh_json, f)

                # Store metadata
                metadata = {
                    'cache_key': cache_key,
                    'cached_at': current_time,
                    'etag': etag,
                    'type': 'mesh',
                    'resolution': resolution,
                    'snapshot_id': snapshot_id,
                    'primitive_index': primitive_index
                }

                metadata_file = os.path.join(
                    self.metadata_dir,
                    f"{self._get_cache_key_hash(cache_key)}.json"
                )
                with open(metadata_file, 'w', encoding='utf-8') as f:
                    json.dump(metadata, f, indent=2, ensure_ascii=False)

            except (IOError, pickle.PickleError, KeyError):
                # Silently fail cache writes to not break main functionality
                pass

    def get_point_cloud_binary(self, snapshot_id, primitive_index):
        """
        Get one cached snapshot point cloud from binary cache.

        Returns:
            Tuple of (point_cloud, etag, is_from_cache) or
            (None, None, False)
        """
        with self._lock:
            try:
                cache_key = (
                    f'point_cloud:{snapshot_id}:{primitive_index}'
                )
                metadata_file = os.path.join(
                    self.metadata_dir,
                    f"{self._get_cache_key_hash(cache_key)}.json"
                )

                if not os.path.exists(metadata_file):
                    return None, None, False

                with open(metadata_file, 'r', encoding='utf-8') as f:
                    metadata = json.load(f)

                if self._is_expired(metadata.get('cached_at', '')):
                    return None, None, False

                cloud_file = os.path.join(
                    self.geometry_dir,
                    'point_cloud',
                    f"{snapshot_id}_{primitive_index}.pkl"
                )

                if os.path.exists(cloud_file):
                    with open(cloud_file, 'rb') as f:
                        cloud_json = pickle.load(f)
                    loaded = Rhino.Runtime.CommonObject.FromJSON(cloud_json)
                    if isinstance(loaded, Rhino.Geometry.PointCloud):
                        return loaded, metadata.get('etag'), True

                return None, None, False

            except (IOError, pickle.PickleError, KeyError, TypeError):
                return None, None, False

    def set_point_cloud_binary(
            self, snapshot_id, primitive_index, cloud, etag):
        """
        Cache one snapshot point cloud as binary (ToJSON pickle).
        """
        with self._lock:
            try:
                current_time = datetime.now().isoformat()
                cache_key = (
                    f'point_cloud:{snapshot_id}:{primitive_index}'
                )

                geometry_subdir = os.path.join(
                    self.geometry_dir, 'point_cloud'
                )
                os.makedirs(geometry_subdir, exist_ok=True)

                options = Rhino.FileIO.SerializationOptions()
                options.WriteUserData = True
                cloud_json = cloud.ToJSON(options)

                cloud_file = os.path.join(
                    geometry_subdir,
                    f"{snapshot_id}_{primitive_index}.pkl"
                )
                with open(cloud_file, 'wb') as f:
                    pickle.dump(cloud_json, f)

                metadata = {
                    'cache_key': cache_key,
                    'cached_at': current_time,
                    'etag': etag,
                    'type': 'point_cloud',
                    'snapshot_id': snapshot_id,
                    'primitive_index': primitive_index
                }

                metadata_file = os.path.join(
                    self.metadata_dir,
                    f"{self._get_cache_key_hash(cache_key)}.json"
                )
                with open(metadata_file, 'w', encoding='utf-8') as f:
                    json.dump(metadata, f, indent=2, ensure_ascii=False)

            except (IOError, pickle.PickleError, KeyError):
                pass


def _parse_ply_binary_to_mesh(ply_bytes):
    """
    Parse a binary_little_endian PLY (CSC canonical, Rhino Z-up) into a
    single Rhino.Geometry.Mesh: numpy parse (csc_ply), then the Rhino build
    chosen by MESH_BUILD_MODE (csc_rhino). No coordinate rotation is applied.
    Returns the mesh or None on failure.
    """
    try:
        if not ply_bytes:
            return None
        return mesh_from_ply(ply_bytes)
    except Exception as e:
        print(f'Error parsing PLY: {str(e)}')
        return None


def _parse_ply_binary_to_point_cloud(ply_bytes):
    """
    Parse a binary_little_endian point-cloud PLY (vertices only, optional
    uchar rgb) into a Rhino.Geometry.PointCloud.
    """
    try:
        if not ply_bytes:
            return None
        return point_cloud_from_ply(ply_bytes)
    except Exception as e:
        print(f'Error parsing point cloud PLY: {str(e)}')
        return None


# AuthCore - Embedded ---------------------------------------------------------

class _AuthCore(object):
    """
    Authorization and cache management tool that gets stored in sticky to be
    used by other CSC Grasshopper Components.

    Author: Max Benjamin Eschenbach
    License: MIT License
    """

    CLIENT = CSC_CLIENT

    def __init__(self, base_url, leeway=30, disable_cache=False):
        self.base_url = server_url(base_url)
        self.leeway = int(leeway) if leeway is not None else 30
        # one connection pool for every request of the session (8.92)
        self._http = requests.Session()
        self.disable_cache = disable_cache
        self._lock = RLock()
        self._token = None
        self._exp = 0
        self._username = None
        self._cache = None if disable_cache else _ComponentCache()

    @staticmethod
    def _now():
        return int(time.time())

    def _send(self, method, url, **kwargs):
        """One request over the shared connection. A 426 (this release is
        too old for the server) raises CSCClientOutdated with the server's
        sentence, so every component shows the fix and not a bare status."""
        response = self._http.request(method, url, **kwargs)
        if response.status_code == 426:
            raise CSCClientOutdated(outdated_message(response))
        return response

    def set_base_url(self, url):
        """Point the session at another server: login and cache of the old
        one are dropped. Returns True when the address changed."""
        url = server_url(url)
        with self._lock:
            if url == self.base_url:
                return False
            self.base_url = url
            self._token = None
            self._exp = 0
            self._username = None
        self.sync_cache()
        return True

    @staticmethod
    def _b64url_decode(seg):
        rem = len(seg) % 4
        if rem:
            seg += '=' * (4 - rem)
        return base64.urlsafe_b64decode(seg.encode('utf-8'))

    @classmethod
    def _jwt_payload(cls, token):
        try:
            parts = token.split('.')
            if len(parts) != 3:
                return {}
            return json.loads(cls._b64url_decode(parts[1]).decode('utf-8'))
        except Exception:
            return {}

    def set_access_token(self, token, username=None):
        payload = self._jwt_payload(token)
        exp = int(payload.get('exp', 0))
        if exp <= 0:
            exp = self._now() + 3600  # 1h fallback if no exp claim
        with self._lock:
            self._token = token
            self._exp = exp
            if username:
                self._username = username

    def clear(self):
        with self._lock:
            self._token = None
            self._exp = 0
            self._username = None

    def is_valid(self):
        with self._lock:
            if not self._token or self._exp <= 0:
                return False
            return (self._now() + self.leeway) < self._exp

    def get_username(self):
        with self._lock:
            return self._username

    def client_header(self):
        return {'X-CSC-Client': self.CLIENT}

    def auth_header(self):
        headers = self.client_header()
        with self._lock:
            if self._token:
                headers['Authorization'] = 'Bearer ' + self._token
        return headers

    def authorized_get(
            self,
            path,
            params=None,
            extra_headers=None,
            timeout=20):
        return self._authorized(
            'GET', path, params=params, extra_headers=extra_headers,
            timeout=timeout)

    def authorized_post(
            self,
            path,
            json_body=None,
            files=None,
            extra_headers=None,
            timeout=60,
            params=None,
            data=None):
        return self._authorized(
            'POST', path, json_body=json_body, files=files, data=data,
            params=params, extra_headers=extra_headers, timeout=timeout)

    def authorized_put(
            self,
            path,
            files=None,
            json_body=None,
            extra_headers=None,
            timeout=300,
            params=None,
            data=None):
        """PUT, e.g. a mesh PLY as multipart ``files``: the uploads of the
        Add components use the shared connection too."""
        return self._authorized(
            'PUT', path, json_body=json_body, files=files, data=data,
            params=params, extra_headers=extra_headers, timeout=timeout)

    def _authorized(
            self,
            method,
            path,
            params=None,
            json_body=None,
            files=None,
            data=None,
            extra_headers=None,
            timeout=60):
        if not self.is_valid():
            raise RuntimeError(
                'Access token missing or expired. Please sign in again.'
            )
        headers = self.auth_header()
        if extra_headers:
            headers.update(extra_headers)
        kwargs = {'headers': headers, 'timeout': timeout}
        if params is not None:
            kwargs['params'] = params
        if files is not None:
            # multipart: requests sets the Content-Type with its boundary
            kwargs['files'] = files
            if data is not None:
                kwargs['data'] = data
        elif json_body is not None:
            kwargs['json'] = json_body
        elif data is not None:
            kwargs['data'] = data
        return self._send(method, self.base_url + path, **kwargs)

    def validate_uuid(self, uuid_to_test: str, version: int = 4):
        """
        Check if uuid_to_test is a valid UUID.
        Returns True if uuid_to_test is a valid UUID, otherwise False.
        """
        try:
            uuid_obj = uuid.UUID(uuid_to_test, version=version)
        except ValueError:
            return False
        return str(uuid_obj) == uuid_to_test

    def resolve_identity_id_from_input(self, value):
        """
        Resolve an identity UUID from a raw UUID string or passport JSON.
        """
        if value is None:
            return None
        text = str(value).strip()
        if not text:
            return None
        if self.validate_uuid(text):
            return text
        try:
            data = value if isinstance(value, dict) else json.loads(text)
        except (TypeError, ValueError, json.JSONDecodeError):
            return None
        if not isinstance(data, dict):
            return None
        identity = data.get('identity')
        if not isinstance(identity, dict):
            return None
        identity_id = identity.get('_id') or identity.get('id')
        if identity_id and self.validate_uuid(str(identity_id)):
            return str(identity_id)
        return None

    def primary_snapshot(self, passport):
        """Return the first snapshot from a passport payload."""
        return primary_snapshot_from_passport(passport)

    def normalize_passport_output(self, passport):
        """Return {identity, snapshots[]} for downstream GH components."""
        return normalize_passport_payload(passport)

    def passport_json_string(self, passport):
        """
        Serialize one passport row in the canonical
        {identity, snapshots[]} shape.
        """
        return json.dumps(self.normalize_passport_output(passport))

    # Cache Management Methods ------------------------------------------------

    def get_cache(self):
        """Get the cache instance."""
        return self._cache

    def set_cache_enabled(self, enabled):
        """Enable or disable caching."""
        with self._lock:
            self.disable_cache = not enabled
            if enabled and self._cache is None:
                self._cache = _ComponentCache()
            elif not enabled:
                self._cache = None

    def is_cache_enabled(self):
        """Check if caching is enabled."""
        return self._cache is not None

    def sync_cache(self):
        """Force cache synchronization (clear cache)."""
        if self._cache:
            self._cache.invalidate()

    def get_cache_stats(self):
        """Get cache statistics."""
        if self._cache:
            return self._cache.get_cache_stats()
        return {
            'component_count': 0,
            'metadata_count': 0,
            'total_size_bytes': 0,
            'cache_dir': 'Cache disabled'
        }

    def cached_get(
            self,
            path,
            cache_key,
            params=None,
            extra_headers=None,
            timeout=20):
        """
        Make a cached GET request with ETag support.

        Args:
            path: API path
            cache_key: Cache key for this request
            params: Query parameters
            extra_headers: Additional headers
            timeout: Request timeout

        Returns:
            Response object
        """
        if not self.is_valid():
            raise RuntimeError(
                'Access token missing or expired. Please sign in again.'
            )

        # If cache is disabled, make regular request
        if not self._cache:
            return self.authorized_get(path, params, extra_headers, timeout)

        # Check cache first
        cached_data, cached_etag, is_from_cache = self._cache.get(cache_key)

        # Prepare headers
        headers = self.auth_header()
        if extra_headers:
            headers.update(extra_headers)

        # Add conditional request header if we have cached data
        if is_from_cache and cached_etag:
            headers['If-None-Match'] = cached_etag

        # Make request
        response = self._send('GET', 
            self.base_url + path,
            params=params,
            headers=headers,
            timeout=timeout
        )

        # Handle response
        if response.status_code == 304 and is_from_cache:
            return _CachedResponse(cached_data, cached_etag)

        elif response.status_code == 200:
            # Data changed or first request - cache the response.
            # Cache writes must never break the fetch, so swallow any
            # parse/serialise/IO error and just return the live response.
            try:
                data = response.json()
                etag = response.headers.get('ETag')
                self._cache.set(cache_key, data, etag, params)
            except Exception:
                pass

        return response

    def cached_list_identities(
            self,
            params=None,
            extra_headers=None,
            timeout=60):
        """
        Fetch GET /identities with unified identity/snapshot caching.

        List responses store per-identity and per-snapshot documents plus a
        lightweight query index (identity ids + list ETag). A 304 reassembles
        passport rows from the individual caches.
        """
        if not self.is_valid():
            raise RuntimeError(
                'Access token missing or expired. Please sign in again.'
            )

        params = dict(params or {})
        query_key = _query_cache_key(params)

        if not self._cache:
            return self.authorized_get(
                '/identities', params, extra_headers, timeout)

        identity_ids, query_etag, has_query = self._cache.get_query(
            query_key)

        headers = self.auth_header()
        if extra_headers:
            headers.update(extra_headers)
        if has_query and query_etag:
            headers['If-None-Match'] = query_etag

        response = self._send('GET', 
            self.base_url + '/identities',
            params=params,
            headers=headers,
            timeout=timeout
        )

        if response.status_code == 304:
            if has_query and identity_ids:
                rows = self._cache.assemble_passport_list(identity_ids)
                if rows:
                    return _CachedResponse(rows, query_etag)
            # Stale query index ? refetch without conditional header
            headers = self.auth_header()
            if extra_headers:
                headers.update(extra_headers)
            response = self._send('GET', 
                self.base_url + '/identities',
                params=params,
                headers=headers,
                timeout=timeout
            )

        if response.status_code == 200:
            try:
                data = response.json()
                if isinstance(data, list):
                    stored_ids = self._cache.ingest_passport_rows(data)
                    list_etag = response.headers.get('ETag')
                    self._cache.set_query(
                        query_key, stored_ids, list_etag, params)
            except Exception:
                pass

        return response

    def cached_get_passport(
            self,
            identity_id,
            snapshots=None,
            extra_headers=None,
            timeout=20):
        """
        Fetch GET /identities/{id}/compose with caching.

        ``snapshots``: None/'current' (default), 'all', or a list of snapshot
        UUID strings. Passport ETag matches the backend; 304 returns cached
        body when available.
        """
        if not self.is_valid():
            raise RuntimeError(
                'Access token missing or expired. Please sign in again.'
            )

        params = {}
        if snapshots == 'all':
            params['snapshots'] = 'all'
        elif isinstance(snapshots, (list, tuple)) and snapshots:
            params['snapshots'] = ','.join(str(item) for item in snapshots)

        path = f'/identities/{identity_id}/compose'
        cache_key = _passport_cache_key(identity_id, snapshots)
        use_current_assembly = (
            not snapshots or snapshots == 'current'
        )

        cached_body = None
        cached_etag = None
        if self._cache:
            if use_current_assembly:
                cached_body = self._cache.assemble_passport(identity_id)
            else:
                cached_body, cached_etag, cached_ok = self._cache.get(
                    cache_key,
                )
                if not cached_ok:
                    cached_body = None
                    cached_etag = None

            if cached_body and isinstance(cached_body.get('identity'), dict):
                snapshot_docs = cached_body.get('snapshots') or []
                cached_etag = _compute_passport_etag(
                    cached_body['identity'],
                    snapshot_docs,
                )

        if not self._cache:
            return self.authorized_get(
                path, params or None, extra_headers, timeout)

        headers = self.auth_header()
        if extra_headers:
            headers.update(extra_headers)
        if cached_etag:
            headers['If-None-Match'] = cached_etag

        response = self._send('GET', 
            self.base_url + path,
            headers=headers,
            params=params or None,
            timeout=timeout,
        )

        if response.status_code == 304:
            if cached_body:
                return _CachedResponse(cached_body, cached_etag)
            headers = self.auth_header()
            if extra_headers:
                headers.update(extra_headers)
            response = self._send('GET', 
                self.base_url + path,
                headers=headers,
                params=params or None,
                timeout=timeout,
            )

        if response.status_code == 200:
            try:
                data = response.json()
                if self._cache:
                    etag = response.headers.get('ETag')
                    if not etag and isinstance(data.get('identity'), dict):
                        etag = _compute_passport_etag(
                            data['identity'],
                            data.get('snapshots') or [],
                        )
                    if not use_current_assembly:
                        self._cache.set(cache_key, data, etag)
                    self._cache.ingest_passport_row(data)
            except Exception:
                pass

        return response

    def cached_get_snapshot_mesh(self, snapshot_id, primitive_index,
                                 resolution, timeout=60):
        """
        Fetch one snapshot-primitive mesh PLY with ETag caching.

        Args:
            snapshot_id: Snapshot UUID
            primitive_index: Index into the snapshot geometry.meshes array
            resolution: 'reduced' or 'detailed'
            timeout: Request timeout

        Returns:
            Tuple of (mesh, etag, is_from_cache). ``mesh`` is None when the
            requested resolution is unavailable (404) or on parse/transport
            error, signalling the caller to fall back to inline geometry.
        """
        if not self.is_valid():
            raise RuntimeError(
                'Access token missing or expired. Please sign in again.'
            )

        path = (
            f'/snapshots/{snapshot_id}/meshes/'
            f'{primitive_index}/{resolution}'
        )

        # If cache is disabled, fetch + parse without caching
        if not self._cache:
            response = self.authorized_get(path, timeout=timeout)
            if response.status_code == 200:
                mesh = _parse_ply_binary_to_mesh(response.content)
                etag = response.headers.get('ETag')
                return mesh, etag, False
            return None, None, False

        # Check binary cache first
        (cached_mesh,
         cached_etag,
         is_from_cache) = self._cache.get_mesh_binary(
            snapshot_id, primitive_index, resolution)

        # Prepare headers (conditional request when we have cached data)
        headers = self.auth_header()
        if is_from_cache and cached_etag:
            headers['If-None-Match'] = cached_etag

        response = self._send('GET', 
            self.base_url + path,
            headers=headers,
            timeout=timeout
        )

        if response.status_code == 304 and is_from_cache:
            # Not modified - return cached mesh
            return cached_mesh, cached_etag, True

        if response.status_code == 200:
            mesh = _parse_ply_binary_to_mesh(response.content)
            etag = response.headers.get('ETag')
            if mesh is not None:
                try:
                    self._cache.set_mesh_binary(
                        snapshot_id, primitive_index, resolution, mesh, etag
                    )
                except (ValueError, KeyError):
                    pass
            return mesh, etag, False

        # 404 / other -> unavailable; caller falls back to inline geometry
        return None, None, False

    def cached_get_snapshot_point_cloud(self, snapshot_id, primitive_index,
                                        timeout=60):
        """
        Fetch one snapshot point-cloud PLY with ETag caching.

        Returns a Rhino PointCloud or None when unavailable. Callers keep
        the object return (unlike cached_get_snapshot_mesh) so Bake /
        Fetch / PassportToD2P stay unchanged.
        """
        if not self.is_valid():
            raise RuntimeError(
                'Access token missing or expired. Please sign in again.'
            )

        path = (
            f'/snapshots/{snapshot_id}/point_clouds/'
            f'{primitive_index}.ply'
        )

        if not self._cache:
            response = self.authorized_get(path, timeout=timeout)
            if response.status_code == 200:
                return _parse_ply_binary_to_point_cloud(response.content)
            return None

        (cached_cloud,
         cached_etag,
         is_from_cache) = self._cache.get_point_cloud_binary(
            snapshot_id, primitive_index)

        headers = self.auth_header()
        if is_from_cache and cached_etag:
            headers['If-None-Match'] = cached_etag

        response = self._send('GET', 
            self.base_url + path,
            headers=headers,
            timeout=timeout
        )

        if response.status_code == 304 and is_from_cache:
            return cached_cloud

        if response.status_code == 200:
            cloud = _parse_ply_binary_to_point_cloud(response.content)
            etag = response.headers.get('ETag')
            if cloud is not None:
                try:
                    self._cache.set_point_cloud_binary(
                        snapshot_id, primitive_index, cloud, etag
                    )
                except (ValueError, KeyError):
                    pass
            return cloud

        return None

    def get_create_identity_schema(self, force_refresh=False):
        """
        Get CreateComponentRequest JSON Schema (POST /identities).

        Args:
            force_refresh: Force refresh of schema even if cached

        Returns:
            Schema dictionary or None if failed
        """
        cache_key = 'schema:create_identity'
        endpoint = '/schema/create-identity'

        if not self.base_url:
            raise RuntimeError(
                'Base URL not configured. Please sign in first.')

        if not self._cache:
            try:
                response = self._send('GET', f'{self.base_url}{endpoint}',
                                        headers=self.client_header())
                if response.status_code == 200:
                    return response.json()
                return None
            except Exception:
                return None

        if not force_refresh:
            cached_schema, cached_etag, is_from_cache = self._cache.get(
                cache_key)
            if is_from_cache:
                return cached_schema

        try:
            headers = self.client_header()
            if not force_refresh:
                cached_schema, cached_etag, is_from_cache = self._cache.get(
                    cache_key)
                if is_from_cache and cached_etag:
                    headers['If-None-Match'] = cached_etag

            response = self._send('GET', 
                f'{self.base_url}{endpoint}',
                headers=headers,
            )

            if response.status_code == 304 and not force_refresh:
                cached_schema, _, is_from_cache = self._cache.get(cache_key)
                if is_from_cache:
                    return cached_schema

            elif response.status_code == 200:
                try:
                    data = response.json()
                    etag = response.headers.get('ETag')
                    self._cache.set(cache_key, data, etag)
                    return data
                except (ValueError, KeyError):
                    return None

            return None
        except Exception:
            if not force_refresh:
                cached_schema, _, is_from_cache = self._cache.get(cache_key)
                if is_from_cache:
                    return cached_schema
            return None

class CSC_Session(Grasshopper.Kernel.GH_ScriptInstance):
    """
    Author: Max Benjamin Eschenbach
    License: MIT License
    """

    # Development setting - do not change!
    __HARD_RESET = False

    def __init__(self):
        """Initialize this component and set component parameters."""
        super().__init__()
        # initialize props
        self.Component = ghenv.Component  # type: ignore[reportUnedfinedVariable] # NOQA
        self.InputParams = self.Component.Params.Input
        self.OutputParams = self.Component.Params.Output

    def _addRemark(self, msg: str = ''):
        """Add a remark message to the component."""
        rml = self.Component.RuntimeMessageLevel.Remark
        self.AddRuntimeMessage(rml, msg)

    def _addWarning(self, msg: str = ''):
        """Add a warning message to the component."""
        rml = self.Component.RuntimeMessageLevel.Warning
        self.AddRuntimeMessage(rml, msg)

    def _addError(self, msg: str = ''):
        """Add an error message to the component."""
        rml = self.Component.RuntimeMessageLevel.Error
        self.AddRuntimeMessage(rml, msg)

    _outputs_ready = True       # set by BeforeRunScript (8.112)
    _outputs_note = None

    def _state(self, text=''):
        """The one short state under the component (decision 8.113)."""
        if set_state is not None:
            set_state(self.Component, text)

    def _stop(self):
        """True when RunScript has to return early: the library is missing or
        too old, or the outputs were just updated (says why)."""
        if LIBRARY_PROBLEM:
            self._addError(LIBRARY_PROBLEM)
            return True
        if self._outputs_note:
            self._addRemark(self._outputs_note)
        return not self._outputs_ready

    def _check_outputs(self):
        """Make the outputs match OUTPUTS before the script runs (8.112)."""
        self._outputs_ready, self._outputs_note = True, None
        if ensure_outputs is None:
            self._outputs_note = (
                'output check skipped: CSC library not installed')
            return
        status = ensure_outputs(self.Component, OUTPUTS)
        self._outputs_ready, self._outputs_note = status.ready, status.remark

    def BeforeRunScript(self):
        """Perform some setup actions."""
        # Initialize input param descriptions
        self.InputParams[0].Description = 'Your Username or E-Mail'
        self.InputParams[1].Description = 'Your password'
        self.InputParams[2].Description = (
            'Refresh toggle, press when your token expired'
        )
        self.InputParams[3].Description = (
            'Disable caching (default: False - caching enabled)'
        )
        self.InputParams[4].Description = (
            'Clear cache (default: False)'
        )
        if len(self.InputParams) > 5:
            self.InputParams[5].Description = (
                'Server address, e.g. https://api.2ndchances.build or '
                'localhost:8010 (default: the CSC server; changing it signs '
                'you out and clears the cache)'
            )
        # Initialize output param descriptions
        self._check_outputs()
        if LIBRARY_PROBLEM is None:
            csc_gh.dev_reload(globals())

    def get_auth_core_from_sticky(self):
        """Get AuthCore instance from sticky storage or create new one."""
        if not self.__HARD_RESET:
            auth_core = sc.sticky.get('CSC_AuthCore')
        else:
            auth_core = None
        if auth_core is not None and \
                getattr(auth_core, 'CLIENT', None) != CSC_CLIENT:
            # Left in sticky by an older release: its methods do not send
            # X-CSC-Client. Replace it, keeping the login and settings.
            old = auth_core
            auth_core = _AuthCore(
                base_url=getattr(old, 'base_url', None),
                leeway=getattr(old, 'leeway', 30),
                disable_cache=getattr(old, 'disable_cache', False),
            )
            auth_core._token = getattr(old, '_token', None)
            auth_core._exp = getattr(old, '_exp', 0)
            auth_core._username = getattr(old, '_username', None)
            sc.sticky['CSC_AuthCore'] = auth_core
        if auth_core is None:
            # Create new AuthCore instance with default settings
            auth_core = _AuthCore(
                base_url='https://api.2ndchances.build'
            )
            sc.sticky['CSC_AuthCore'] = auth_core
        return auth_core

    def RunScript(self,
            Username: str,
            Password: str,
            Refresh: bool,
            DisableCache: bool,
            ClearCache: bool,
            Server):
        # Initialize status messages list
        if self._stop():
            return empty_outputs()
        status_messages = []

        # Sanitize input parameters (defaults don't work in function signature)
        if DisableCache is None:
            DisableCache = False
        if ClearCache is None:
            ClearCache = False

        # Get or create AuthCore instance
        auth_core = self.get_auth_core_from_sticky()

        # The server of this session (8.93): a new address drops the login
        if Server is not None and str(Server).strip():
            if auth_core.set_base_url(Server):
                status_messages.append(
                    f'Server changed to {auth_core.base_url}: signed out')

        # Handle cache management
        if ClearCache:
            auth_core.sync_cache()
            status_messages.append('Cache cleared')
            # Return status messages
            Status = status_messages
            return (Status,)

        # Set cache enabled/disabled
        auth_core.set_cache_enabled(not DisableCache)

        # Input validation
        if not Username or not Username.strip():
            status_messages.append('Please provide username/email')
            Status = status_messages
            return (Status,)

        if not Password or not Password.strip():
            status_messages.append('Please provide password')
            Status = status_messages
            return (Status,)

        username = Username.strip()
        password = Password.strip()

        try:
            if Refresh:
                # Refresh authentication - clear existing token and re-auth
                auth_core.clear()
            else:
                # Check if we already have a valid token
                if auth_core.is_valid():
                    current_user = auth_core.get_username()

                    # Fetch and cache create-identity schema
                    try:
                        schema = auth_core.get_create_identity_schema()
                        if schema:
                            status_messages.append(
                                'Create-identity schema cached')
                            self._addRemark(
                                'Create-identity schema cached successfully'
                            )
                        else:
                            status_messages.append('Failed to cache schema')
                            self._addWarning(
                                'Failed to cache create-identity schema'
                            )
                    except Exception as e:
                        status_messages.append(
                            f'Schema caching failed: {str(e)}')
                        self._addWarning(f'Schema cache failed: {str(e)}')

                    # Get cache status for output
                    cache_stats = auth_core.get_cache_stats()
                    cache_enabled = auth_core.is_cache_enabled()
                    comp_count = cache_stats["component_count"]
                    geometry_count = cache_stats["geometry_count"]
                    size_kb = cache_stats["total_size_bytes"] // 1024
                    geometry_size_kb = (
                        cache_stats["geometry_size_bytes"] // 1024
                    )

                    # Add cache status to messages
                    cache_status = (
                        'Cache: '
                        f'{"Enabled" if cache_enabled else "Disabled"}\n'
                        f' | Components: {comp_count}\n'
                        f' | Geometry: {geometry_count} files\n'
                        f' | Size: {size_kb} kB\n'
                        f' | Geometry: {geometry_size_kb} kB\n'
                        f' | Server: {auth_core.base_url}\n')
                    status_messages.append(cache_status)
                    Status = status_messages
                    return (Status,)


            # Prepare login data
            login_data = {
                'username': username,
                'password': password
            }

            # Make login request
            response = auth_core._send(
                'POST',
                f'{auth_core.base_url}/auth/token',
                data=login_data,
                headers={
                    'Content-Type': 'application/x-www-form-urlencoded',
                    **auth_core.client_header(),
                },
                timeout=20
            )

            if response.status_code == 200:
                # Login successful
                token_data = response.json()
                access_token = token_data.get('access_token')

                if access_token:
                    # Store token in AuthCore
                    auth_core.set_access_token(access_token, username)

                    # Update sticky storage
                    sc.sticky['CSC_AuthCore'] = auth_core

                    # Fetch and cache create-identity schema
                    try:
                        schema = auth_core.get_create_identity_schema()
                        if schema:
                            status_messages.append(
                                'Create-identity schema cached')
                            self._addRemark(
                                'Create-identity schema cached successfully'
                            )
                        else:
                            status_messages.append('Failed to cache schema')
                            self._addWarning(
                                'Failed to cache create-identity schema'
                            )
                    except Exception as e:
                        status_messages.append(
                            f'Schema caching failed: {str(e)}')
                        self._addWarning(f'Schema cache failed: {str(e)}')

                    # Get cache status for output
                    cache_stats = auth_core.get_cache_stats()
                    cache_enabled = auth_core.is_cache_enabled()
                    comp_count = cache_stats["component_count"]
                    geometry_count = cache_stats["geometry_count"]
                    size_kb = cache_stats["total_size_bytes"] // 1024
                    geometry_size_kb = (
                        cache_stats["geometry_size_bytes"] // 1024
                    )

                    # Add cache status to messages
                    cache_status = (
                        f'Cache: '
                        f'{"Enabled" if cache_enabled else "Disabled"}\n'
                        f' | Components: {comp_count}\n'
                        f' | Geometry: {geometry_count} files\n'
                        f' | Size: {size_kb} kB\n'
                        f' | Geometry: {geometry_size_kb} kB\n'
                        f' | Server: {auth_core.base_url}\n')
                    status_messages.append(cache_status)


                    # Return status messages
                    Status = status_messages
                    return (Status,)

                else:
                    msg = 'Login failed: No token received'
                    status_messages.append(msg)
                    self._addWarning(msg)
                    Status = status_messages
                    return (Status,)

            elif response.status_code == 401:
                msg = 'Invalid username or password'
                status_messages.append(msg)
                self._addError(msg)
                Status = status_messages
                return (Status,)

            elif response.status_code == 422:
                msg = 'Invalid input data'
                status_messages.append(msg)
                self._addError(msg)
                Status = status_messages
                return (Status,)

            elif response.status_code == 500:
                msg = 'Server error - please try again'
                status_messages.append(msg)
                self._addWarning(msg)
                Status = status_messages
                return (Status,)

            else:
                msg = f'Login failed with status code: {response.status_code}'
                status_messages.append(msg)
                self._addError(msg)
                Status = status_messages
                return (Status,)

        except CSCClientOutdated as e:
            msg = str(e)
            status_messages.append(msg)
            self._addError(msg)
            Status = status_messages
            return (Status,)

        except requests.exceptions.ConnectionError as e:
            msg = 'Cannot connect to server - check URL'
            status_messages.append(msg)
            self._addError(msg + f'\nFull Error: {str(e)}')
            Status = status_messages
            return (Status,)

        except requests.exceptions.Timeout as e:
            msg = 'Request timeout - server may be slow'
            status_messages.append(msg)
            self._addError(msg + f'\nFull Error: {str(e)}')
            Status = status_messages
            return (Status,)

        except requests.exceptions.RequestException as e:
            msg = f'Request error: {str(e)}'
            status_messages.append(msg)
            self._addError(msg)
            Status = status_messages
            return (Status,)

        except Exception as e:
            msg = f'Unexpected error: {str(e)}'
            status_messages.append(msg)
            Status = status_messages
            return (Status,)
# ---------- end csc_session ----------
status_messages = Panel(csc_session)

# Step 2.1
# comments & notes: Optional: Offset the design shapes, making the "demanded" geometry larger.
# 
# This can increase the chances of finding components that are large enough to fit the entire cell.
number_slider = Slider(0, range=0..500)
designshapes_2 = Data(designshapes)
offset = OffsetCurve(Curve=designshapes_2, Distance=number_slider, Corners=1)  # -> flatten(Curve)
designshapes_offset = Data(offset)

# Step 2.2
# comments & notes: Compute the radial signature for the design shapes.
# 
# Algorithmically, this is exactly the same as the process that runs on the server and pre-computes this signature for the components in the catalog.
resolution = Slider(64, range=0..100)
designshapes_3 = Data(designshapes_offset)
radialsignature = RadialSignature(Curves=designshapes_3, Resolution=resolution)  # -> Distances, Tangents, IntersectionPoints, Rays, RestPositionCurve, RestPositionFrame, RestPositionAngle, RestPositionTransform; inputs Curves: list, Resolution: Int32, RestPositionAlign: Boolean, NumAngles: Int32
# ---------- radialsignature: Python ----------
#! python3
# -*- coding: utf-8 -*-
# venv: DDU_CSC_MATCH
# r: charset_normalizer
# r: numpy==2.0.2
print('ENV OK!')

# PYTHON STANDARD LIBRARY IMPORTS ---------------------------------------------

# THIRD PARTY LIBRARY IMPORTS -------------------------------------------------
import numpy as np  # NOQA

# RHINO AND GH RELATED IMPORTS ------------------------------------------------
import System  # NOQA
import Grasshopper  # NOQA
import Rhino  # NOQA

# GHENV COMPONENT SETTINGS ----------------------------------------------------
ghenv.Component.Name = 'RadialSignature'  # NOQA
ghenv.Component.NickName = 'RadialSignature'  # NOQA
ghenv.Component.Category = 'DDU_CSC'  # NOQA
ghenv.Component.SubCategory = '7 Geometry Tools'  # NOQA
ghenv.Component.Description = (  # NOQA
    'Radial shape signature for planar boundary curves: rotates each curve '
    'into its canonical rest position (min-bbox-edge orientation), casts '
    'N evenly spaced rays from the centroid, and returns the distance to '
    'the first boundary intersection together with the boundary tangent '
    'at that intersection. Mirrors the backend `radial_signature` module.'
)


# -----------------------------------------------------------------------------
# PURE GEOMETRY HELPERS (port of apps/descriptors/radial_signature.py)
# -----------------------------------------------------------------------------
# Kept as module-level functions so they can be unit-tested / reused without
# the Grasshopper component shell, and so they stay numerically identical to
# the backend reference implementation.

_COINCIDENT_EPS: float = 1e-9
_DEFAULT_REST_ANGLES: int = 180


def _as_profile_array(profile) -> np.ndarray:
    """Validate and return an (M, 2) float array of profile points."""
    P = np.asarray(profile, dtype=np.float64)
    if P.ndim != 2 or P.shape[1] != 2:
        raise ValueError(
            f'profile must be a sequence of [x, y] pairs, got shape {P.shape}'
        )
    if len(P) < 3:
        raise ValueError(
            f'profile must have at least 3 points, got {len(P)}'
        )
    # Drop a duplicate closing vertex if present; the polyline is always
    # treated as an implicit closed polygon.
    if np.allclose(P[0], P[-1]):
        P = P[:-1]
        if len(P) < 3:
            raise ValueError(
                'profile collapses to fewer than 3 unique points'
            )
    return P


def _polygon_centroid_2d(profile: np.ndarray) -> np.ndarray:
    """Shoelace area-weighted centroid of a closed 2D polygon."""
    x, y = profile[:, 0], profile[:, 1]
    xn = np.roll(x, -1)
    yn = np.roll(y, -1)
    cross = x * yn - xn * y
    area2 = cross.sum()
    if abs(area2) < _COINCIDENT_EPS:
        return profile.mean(axis=0)
    cx = ((x + xn) * cross).sum() / (3.0 * area2)
    cy = ((y + yn) * cross).sum() / (3.0 * area2)
    return np.array([cx, cy], dtype=np.float64)


def _rotation_matrix_2d(angle_rad: float) -> np.ndarray:
    c, s = np.cos(angle_rad), np.sin(angle_rad)
    return np.array([[c, -s], [s, c]], dtype=np.float64)


def _rest_position(profile: np.ndarray,
                   num_angles: int = _DEFAULT_REST_ANGLES):
    """
    Rotate a planar polygon into its canonical rest orientation.

    Faithful port of the legacy C# `RestPosition` routine: for each of
    ``num_angles`` sample angles in [0, pi), rotate the centered profile and
    measure the absolute distance from the origin to each of the four
    axis-aligned bbox edges (|ymin|, |xmax|, |ymax|, |xmin|). The sample
    that produces the smallest such distance, combined with a 90 degree
    correction indexed by which edge was closest, defines the canonical
    rotation.

    Returns:
        rotated: (M, 2) rotated & centered profile
        centroid: (2,) centroid that was subtracted from the input
        angle_deg: rotation applied to the centered profile, degrees
    """
    if num_angles < 1:
        raise ValueError(f'num_angles must be >= 1, got {num_angles}')

    centroid = _polygon_centroid_2d(profile)
    centered = profile - centroid

    step_deg = 180.0 / num_angles
    min_edge_distances = np.empty(num_angles, dtype=np.float64)
    min_edge_corners = np.empty(num_angles, dtype=np.int64)
    for i in range(num_angles):
        ang_rad = np.deg2rad(i * step_deg)
        R = _rotation_matrix_2d(ang_rad)
        Q = centered @ R.T
        xmin, ymin = Q.min(axis=0)
        xmax, ymax = Q.max(axis=0)
        edges = np.array([abs(ymin), abs(xmax), abs(ymax), abs(xmin)])
        j = int(np.argmin(edges))
        min_edge_distances[i] = edges[j]
        min_edge_corners[i] = j

    best_sample = int(np.argmin(min_edge_distances))
    corner = int(min_edge_corners[best_sample])
    angle_deg = -(corner * 90.0) + best_sample * step_deg
    angle_rad = np.deg2rad(angle_deg)
    R_final = _rotation_matrix_2d(angle_rad)
    rotated = centered @ R_final.T
    return rotated, centroid, float(angle_deg)


def _ray_polyline_distances_and_tangents(profile: np.ndarray,
                                         directions: np.ndarray):
    """
    For each ray, return (distance, unit tangent) of the first boundary hit.

    Rays originate at (0, 0). Segments are the closed polygon edges
    p_i -> p_(i+1 mod M). Returns NaN where no forward hit exists.
    """
    A = profile                       # (M, 2) segment starts
    B = np.roll(profile, -1, axis=0)  # (M, 2) segment ends
    D = B - A                         # (M, 2) segment vectors

    seg_len = np.linalg.norm(D, axis=1)
    valid_seg = seg_len > _COINCIDENT_EPS
    T = np.full_like(D, np.nan)
    T[valid_seg] = D[valid_seg] / seg_len[valid_seg, None]

    R = directions  # (N, 2)
    # denom[n, m] = R[n] x D[m]
    denom = R[:, 0:1] * D[None, :, 1] - R[:, 1:2] * D[None, :, 0]
    A_cross_D = A[:, 0] * D[:, 1] - A[:, 1] * D[:, 0]
    A_cross_R = (A[None, :, 0] * R[:, 1:2]
                 - A[None, :, 1] * R[:, 0:1])

    safe = (np.abs(denom) > _COINCIDENT_EPS) & valid_seg[None, :]
    denom_safe = np.where(safe, denom, 1.0)

    t = A_cross_D[None, :] / denom_safe
    s = A_cross_R / denom_safe

    hit = (
        safe
        & (t >= 0.0)
        & (s >= -_COINCIDENT_EPS)
        & (s <= 1.0 + _COINCIDENT_EPS)
    )

    t_masked = np.where(hit, t, np.inf)
    best_seg = np.argmin(t_masked, axis=1)
    best_t = t_masked[np.arange(len(R)), best_seg]

    miss = ~np.isfinite(best_t)
    distances = np.where(miss, np.nan, best_t)
    tangents = T[best_seg]
    tangents[miss] = np.nan
    return distances, tangents


def _compute_radial_signature(profile, num_rays: int,
                              rest_align: bool = True,
                              num_rest_angles: int = _DEFAULT_REST_ANGLES):
    """
    Compute distances & tangents for one polygon profile.

    Returns:
        distances: (N,) ndarray
        tangents: (N, 2) ndarray
        centroid: (2,) ndarray (the one that was subtracted)
        angle_deg: float rotation applied to reach rest (0.0 if not aligned)
    """
    if num_rays < 3:
        raise ValueError(f'num_rays must be >= 3, got {num_rays}')

    P = _as_profile_array(profile)
    if rest_align:
        P_rest, centroid, angle_deg = _rest_position(
            P, num_angles=num_rest_angles)
    else:
        centroid = _polygon_centroid_2d(P)
        P_rest = P - centroid
        angle_deg = 0.0

    angles = np.arange(num_rays) * (2.0 * np.pi / num_rays)
    directions = np.column_stack([np.cos(angles), np.sin(angles)])
    distances, tangents = _ray_polyline_distances_and_tangents(
        P_rest, directions)
    return distances, tangents, centroid, angle_deg

# OPTIONAL HELPERS: they never block the component (decisions 8.112, 8.113) ---
try:
    from csc_gh.ports import ensure_outputs
    from csc_gh.messages import set_state
except ImportError:
    ensure_outputs = set_state = None

OUTPUTS = [
    ('Distances', 'Distances',
     'Tree of distances from the centroid to the first boundary intersection for each ray. One branch per input curve.'),
    ('Tangents', 'Tangents',
     'Tree of unit tangent vectors of the boundary at each ray hit, expressed in world coordinates on the curve plane.'),
    ('IntersectionPoints', 'IntersectionPoints',
     'Tree of intersection points in world coordinates, one branch per input curve. Useful for visualising the signature.'),
    ('Rays', 'Rays',
     'Tree of rays (as Lines) in world coordinates, one branch per input curve. Useful for visualisation.'),
    ('RestPositionCurve', 'RestPositionCurve',
     'Input curves transformed into their rest position: centroid at world origin, canonical rest axes aligned with World XY. This is exactly the geometry the signature is computed on.'),
    ('RestPositionFrame', 'RestPositionFrame',
     'List of rest-position planes, one per input curve. Origin is the centroid on the input curve plane; X/Y are aligned with the canonical orientation used by the signature.'),
    ('RestPositionAngle', 'RestPositionAngle',
     'List of rotation angles (degrees) applied to reach rest position, one per input curve.'),
    ('RestPositionTransform', 'RestPositionTransform',
     'Transform mapping world coordinates into the rest frame (origin at centroid; World XY only if RestPositionAlign is True). Apply to any other geometry to see it in the same frame as the rest curve.'),
]


def empty_outputs():
    """What RunScript returns when it stops early."""
    if len(OUTPUTS) <= 1:
        return None
    return tuple(None for _ in OUTPUTS)


class CSC_RadialSignature(Grasshopper.Kernel.GH_ScriptInstance):
    """
    Author: Max Benjamin Eschenbach
    License: MIT License
    Version: 261005
    """

    _outputs_ready = True       # set by BeforeRunScript (8.112)
    _outputs_note = None

    def __init__(self):
        """Initialize this component and set component parameters."""
        super().__init__()
        self.Component = ghenv.Component  # NOQA
        self.InputParams = self.Component.Params.Input
        self.OutputParams = self.Component.Params.Output

    def _addRemark(self, msg: str = ''):
        rml = self.Component.RuntimeMessageLevel.Remark
        self.AddRuntimeMessage(rml, msg)

    def _addWarning(self, msg: str = ''):
        rml = self.Component.RuntimeMessageLevel.Warning
        self.AddRuntimeMessage(rml, msg)

    def _addError(self, msg: str = ''):
        rml = self.Component.RuntimeMessageLevel.Error
        self.AddRuntimeMessage(rml, msg)

    def _state(self, text=''):
        """The one short state under the component (decision 8.113)."""
        if set_state is not None:
            set_state(self.Component, text)

    def _stop(self):
        """True when RunScript has to return early: the outputs were just
        updated (says why)."""
        if self._outputs_note:
            self._addRemark(self._outputs_note)
        return not self._outputs_ready

    def _check_outputs(self):
        """Make the outputs match OUTPUTS before the script runs (8.112)."""
        self._outputs_ready, self._outputs_note = True, None
        if ensure_outputs is None:
            self._outputs_note = (
                'output check skipped: CSC library not installed')
            return
        status = ensure_outputs(self.Component, OUTPUTS)
        self._outputs_ready, self._outputs_note = status.ready, status.remark

    def BeforeRunScript(self):
        """Describe inputs & outputs."""
        self.InputParams[0].Description = (
            'Closed planar boundary curve(s) to describe. Polylines are '
            'used verbatim; other curves are approximated to polylines '
            'using the document tolerance.'
        )
        self.InputParams[1].Description = (
            'Number of rays cast from the centroid. Default 64. '
            'Must be >= 3.'
        )
        self.InputParams[2].Description = (
            'If True (default), rotate each profile into its canonical '
            'rest position (minimum bbox edge distance) before ray '
            'casting. If False, use the curve as-is (still centered).'
        )
        self.InputParams[3].Description = (
            'Number of rotation samples used for rest-position search '
            'over [0, pi). Default 180 (1 degree steps). Must be >= 1.'
        )
        # Output descriptions -- skip the hidden "out" param if present.
        self._check_outputs()

    def _curve_to_polyline_and_plane(self, curve):
        """Return (polyline_points_3d, curve_plane) or (None, None).

        Falls back to ``Plane.WorldXY`` for non-planar or degenerate curves
        and adds a warning.
        """
        if curve is None:
            return None, None

        tol = Rhino.RhinoDoc.ActiveDoc.ModelAbsoluteTolerance
        if tol is None or tol <= 0.0:
            tol = 1e-3

        # Fetch an actual Polyline -- exact for polylines / polygons, an
        # approximation otherwise (angle-based to preserve curvature).
        ok, pl = curve.TryGetPolyline()
        if not ok or pl is None or pl.Count < 3:
            pc = curve.ToPolyline(
                0,           # mainSegmentCount (0 = auto)
                0,           # subSegmentCount
                0.1,         # maxAngleRadians (~5.7 deg chord deviation)
                0.0,         # maxChordLengthRatio
                0.0,         # maxAspectRatio
                tol,         # tolerance
                0.0,         # minEdgeLength
                0.0,         # maxEdgeLength
                True,        # keepStartPoint
            )
            if pc is None:
                return None, None
            pl = pc.ToPolyline()
            if pl is None or pl.Count < 3:
                return None, None

        ok_plane, plane = curve.TryGetPlane(tol)
        if not ok_plane:
            self._addWarning(
                'Curve is not planar within tolerance; falling back to '
                'World XY. Consider supplying a planar curve.'
            )
            plane = Rhino.Geometry.Plane.WorldXY

        return pl, plane

    def _project_polyline_to_plane(self, polyline, plane):
        """Project polyline vertices to the curve's plane. Returns (M, 2)."""
        xform = Rhino.Geometry.Transform.PlaneToPlane(
            plane, Rhino.Geometry.Plane.WorldXY)
        pts_2d = []
        for p in polyline:
            q = Rhino.Geometry.Point3d(p)
            q.Transform(xform)
            pts_2d.append([q.X, q.Y])
        return np.asarray(pts_2d, dtype=np.float64)

    def _rest_frame_in_world(self, plane, centroid_xy, rest_angle_deg):
        """Build a Rhino.Geometry.Plane placed at the rest-position origin.

        The plane's origin is the 3D centroid; its X/Y axes correspond to
        the rest-aligned 2D frame rotated back into world coordinates.
        """
        # Rest frame in curve-plane coordinates: origin is the centroid,
        # axes are rotated by ``rest_angle_deg`` around +Z relative to the
        # curve plane. Since a point ``q`` in the original 2D frame maps
        # to ``R * (q - c)`` in the rest frame, the inverse mapping back
        # to the curve plane is a rotation by ``-rest_angle_deg``.
        theta = np.deg2rad(-rest_angle_deg)
        c, s = float(np.cos(theta)), float(np.sin(theta))
        x_axis_xy = np.array([c, s, 0.0])
        y_axis_xy = np.array([-s, c, 0.0])

        origin_xy = Rhino.Geometry.Point3d(
            float(centroid_xy[0]), float(centroid_xy[1]), 0.0)
        xform = Rhino.Geometry.Transform.PlaneToPlane(
            Rhino.Geometry.Plane.WorldXY, plane)
        origin_3d = Rhino.Geometry.Point3d(origin_xy)
        origin_3d.Transform(xform)

        x_vec_3d = Rhino.Geometry.Vector3d(*x_axis_xy)
        y_vec_3d = Rhino.Geometry.Vector3d(*y_axis_xy)
        x_vec_3d.Transform(xform)
        y_vec_3d.Transform(xform)

        return Rhino.Geometry.Plane(origin_3d, x_vec_3d, y_vec_3d)

    def _xy_point_to_world(self, xform_to_plane, x, y):
        """Map a point in the curve-plane XY frame to world coordinates."""
        p = Rhino.Geometry.Point3d(float(x), float(y), 0.0)
        p.Transform(xform_to_plane)
        return p

    def _xy_vector_to_world(self, xform_to_plane, vx, vy):
        """Map a vector in the curve-plane XY frame to world coordinates."""
        v = Rhino.Geometry.Vector3d(float(vx), float(vy), 0.0)
        v.Transform(xform_to_plane)
        return v

    def RunScript(self,
            Curves: list[object],
            Resolution: int,
            RestPositionAlign: bool,
            NumAngles: int):
        # Keep list-access behavior by default. If the current input list
        # (which may represent one incoming branch) has multiple curves,
        # switch to explicit tree output keyed by run count + item index.
        if self._stop():
            return empty_outputs()
        multi_input = bool(Curves) and len(Curves) > 1
        if multi_input:
            Distances = Grasshopper.DataTree[System.Object]()
            Tangents = Grasshopper.DataTree[System.Object]()
            IntersectionPoints = Grasshopper.DataTree[System.Object]()
            Rays = Grasshopper.DataTree[System.Object]()
            RestPositionCurve = Grasshopper.DataTree[System.Object]()
            RestPositionFrame = Grasshopper.DataTree[System.Object]()
            RestPositionAngle = Grasshopper.DataTree[System.Object]()
            RestPositionTransform = Grasshopper.DataTree[System.Object]()
        else:
            Distances = []
            Tangents = []
            IntersectionPoints = []
            Rays = []
            RestPositionCurve = []
            RestPositionFrame = []
            RestPositionAngle = []
            RestPositionTransform = []
        __Results = (
            Distances, Tangents, IntersectionPoints, Rays,
            RestPositionCurve, RestPositionFrame,
            RestPositionAngle, RestPositionTransform,
        )

        # Defaults
        if Resolution is None:
            Resolution = 64
        if RestPositionAlign is None:
            RestPositionAlign = True
        if NumAngles is None:
            NumAngles = _DEFAULT_REST_ANGLES

        # Input validation
        if not Curves:
            msg = 'No curves provided'
            self._addWarning(msg)
            return __Results

        try:
            Resolution = int(Resolution)
        except (TypeError, ValueError):
            self._addError(
                f'Resolution must be an integer, got {Resolution!r}')
            return __Results
        if Resolution < 3:
            self._addError(f'Resolution must be >= 3, got {Resolution}')
            return __Results

        try:
            NumAngles = int(NumAngles)
        except (TypeError, ValueError):
            self._addError(
                f'NumAngles must be an integer, got '
                f'{NumAngles!r}')
            return __Results
        if NumAngles < 1:
            self._addError(
                f'NumAngles must be >= 1, got '
                f'{NumAngles}')
            return __Results


        successes = 0
        rc = self.Component.RunCount - 1
        for branch_idx, curve in enumerate(Curves):
            path = Grasshopper.Kernel.Data.GH_Path(rc, branch_idx)

            polyline, plane = self._curve_to_polyline_and_plane(curve)
            if polyline is None or plane is None:
                self._addWarning(
                    f'Curve #{branch_idx}: could not build polyline; skipped')
                continue

            try:
                profile_xy = self._project_polyline_to_plane(polyline, plane)
                distances, tangents, centroid_xy, angle_deg = (
                    _compute_radial_signature(
                        profile_xy,
                        num_rays=Resolution,
                        rest_align=bool(RestPositionAlign),
                        num_rest_angles=NumAngles,
                    )
                )
            except ValueError as exc:
                self._addWarning(
                    f'Curve #{branch_idx}: {exc}; skipped')
                continue

            if np.any(np.isnan(distances)):
                missed = int(np.isnan(distances).sum())
                self._addWarning(
                    f'Curve #{branch_idx}: {missed}/{Resolution} rays did '
                    f'not hit the boundary (centroid outside profile or '
                    f'non-simple polygon); skipped'
                )
                continue

            # Map results back to world coordinates.
            # In the rest frame: hit point = t * (cos a, sin a);
            # tangent = (tx, ty). The rest frame itself lives on the
            # curve plane at ``centroid_xy``, rotated by rest_angle_deg.
            # Build a combined transform 2D(rest) -> 2D(curve) -> world.
            rest_frame_curve = Rhino.Geometry.Plane(
                Rhino.Geometry.Point3d(
                    float(centroid_xy[0]), float(centroid_xy[1]), 0.0),
                Rhino.Geometry.Vector3d.XAxis,
                Rhino.Geometry.Vector3d.YAxis,
            )
            # Rotate the rest plane's X/Y by -rest_angle_deg so that a
            # point expressed in the rest frame maps back to the same
            # location in the curve-plane XY frame.
            theta = np.deg2rad(-angle_deg)
            c, s = float(np.cos(theta)), float(np.sin(theta))
            rest_x = Rhino.Geometry.Vector3d(c, s, 0.0)
            rest_y = Rhino.Geometry.Vector3d(-s, c, 0.0)
            rest_frame_curve = Rhino.Geometry.Plane(
                rest_frame_curve.Origin, rest_x, rest_y)

            xform_curve_to_world = Rhino.Geometry.Transform.PlaneToPlane(
                Rhino.Geometry.Plane.WorldXY, plane)

            # Combined mapper: 2D rest frame -> 3D world.
            def to_world_point(xr, yr):
                # Into curve XY frame first...
                px = rest_frame_curve.Origin.X + c * xr - s * yr
                py = rest_frame_curve.Origin.Y + s * xr + c * yr
                # ...then lift to world via the curve plane.
                p = Rhino.Geometry.Point3d(float(px), float(py), 0.0)
                p.Transform(xform_curve_to_world)
                return p

            def to_world_vector(vxr, vyr):
                vx = c * vxr - s * vyr
                vy = s * vxr + c * vyr
                v = Rhino.Geometry.Vector3d(float(vx), float(vy), 0.0)
                v.Transform(xform_curve_to_world)
                return v

            # Rays in the rest frame: origin (0, 0), direction (cos, sin).
            ray_angles = np.arange(Resolution) * (2.0 * np.pi / Resolution)
            ray_dirs = np.column_stack(
                [np.cos(ray_angles), np.sin(ray_angles)])

            world_origin = to_world_point(0.0, 0.0)

            distance_values = []
            tangent_values = []
            hit_points = []
            ray_lines = []
            for k in range(Resolution):
                t = float(distances[k])
                dx, dy = float(ray_dirs[k, 0]), float(ray_dirs[k, 1])
                hit_world = to_world_point(t * dx, t * dy)
                tx, ty = float(tangents[k, 0]), float(tangents[k, 1])
                tan_world = to_world_vector(tx, ty)

                distance_values.append(t)
                tangent_values.append(tan_world)
                hit_points.append(hit_world)
                ray_lines.append(
                    Rhino.Geometry.Line(world_origin, hit_world))

            if multi_input:
                Distances.AddRange(distance_values, path)
                Tangents.AddRange(tangent_values, path)
                IntersectionPoints.AddRange(hit_points, path)
                Rays.AddRange(ray_lines, path)
            else:
                Distances.extend(distance_values)
                Tangents.extend(tangent_values)
                IntersectionPoints.extend(hit_points)
                Rays.extend(ray_lines)

            # Rest-position frame expressed in world coordinates: origin
            # at the 3D centroid on the curve plane, X/Y axes aligned with
            # the canonical orientation picked by the rest-position search.
            rest_frame_world = self._rest_frame_in_world(
                plane, centroid_xy, angle_deg)

            # World -> rest-frame transform. Applying this to the input
            # curve moves it so its centroid sits at the world origin and
            # its rest-aligned axes coincide with the World XY axes -- i.e.
            # exactly what the signature "sees" internally.
            if RestPositionAlign:
                # Full rest-position transform: center + canonical orientation
                # into World XY.
                xform_world_to_rest = Rhino.Geometry.Transform.PlaneToPlane(
                    rest_frame_world, Rhino.Geometry.Plane.WorldXY)
            else:
                # No rest-position rotation: keep the curve orientation as-is
                # in world coordinates and only center it at the origin.
                xform_world_to_rest = Rhino.Geometry.Transform.Translation(
                    Rhino.Geometry.Vector3d(
                        -rest_frame_world.Origin.X,
                        -rest_frame_world.Origin.Y,
                        -rest_frame_world.Origin.Z,
                    )
                )
            rest_curve = curve.DuplicateCurve()
            rest_curve.Transform(xform_world_to_rest)

            if multi_input:
                RestPositionCurve.Add(rest_curve, path)
                RestPositionFrame.Add(rest_frame_world, path)
                RestPositionAngle.Add(float(angle_deg), path)
                RestPositionTransform.Add(xform_world_to_rest, path)
            else:
                RestPositionCurve.append(rest_curve)
                RestPositionFrame.append(rest_frame_world)
                RestPositionAngle.append(float(angle_deg))
                RestPositionTransform.append(xform_world_to_rest)

            successes += 1

        if successes == 0:
            self._addWarning('No curves produced a valid signature')
        else:
            self._addRemark(
                f'Computed radial signature for {successes} curve(s) '
                f'at resolution N={Resolution}'
            )

        return __Results
# ---------- end radialsignature ----------
designshapes_restpositiontransform = Data(radialsignature.RestPositionTransform)
designshapes_distances = Data(radialsignature.Distances)
designshapes_tangents = Data(radialsignature.Tangents)

# Step 3.3
# comments & notes: Disassemble the components to get the primitive geometry
componentpassport_2 = Data(componentpassport)
disassemblecomponent = DisassembleComponent(ComponentPassport=componentpassport_2)  # -> IdentityID, Name, OriginalFunction, Material, Color, Location, BoundingBox, Frame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; inputs ComponentPassport: tree
# ---------- disassemblecomponent: Python ----------
#! python3
# -*- coding: utf-8 -*-
# venv: DDU_CSC
# r: charset_normalizer
# r: numpy==2.0.2
print('ENV OK!')

# PYTHON STANDARD LIBRARY IMPORTS ---------------------------------------------
import json  # NOQA

# RHINO AND GH RELATED IMPORTS ------------------------------------------------
import System  # NOQA
import Rhino  # NOQA
import Grasshopper  # NOQA
import scriptcontext as sc  # NOQA

# GHENV COMPONENT SETTINGS ----------------------------------------------------
ghenv.Component.Name = 'DisassembleComponent'  # NOQA
ghenv.Component.NickName = 'DisassembleComponent'  # NOQA
ghenv.Component.Category = 'DDU_CSC'  # NOQA
ghenv.Component.SubCategory = '3 Component Operations'  # NOQA
ghenv.Component.Description = (  # NOQA
    'Parses component passport JSON ({identity, snapshots[]}) and outputs individual '
    'fields as Grasshopper-native types: the preview geometry (meshes, '
    'point clouds, authored shapes), the frame and the box on it, the '
    'condition grade, the origin (and whether the piece is still in '
    'place), the pieces left of a batch and the capture markers. Geometry is in '
    'the stored coordinates of the piece, moved by its client-side '
    'csc_placement when it has one.'
)

# CSC LIBRARY (decision 8.111) ----------------------------------------------
CSC_GH_MINIMUM = '261005'
LIBRARY_PROBLEM = None
try:
    import csc_gh
    csc_gh.require(CSC_GH_MINIMUM)
    from csc_gh.read import (authored_only, box_of, capture_markers, condition_grade, drawable_proxies, load_passport, parts, placement_of)  # NOQA
    from csc_gh.rhino import (inline_cloud_to_rhino, inline_mesh_to_rhino, placement_transform, plane_from_frame, proxy_to_rhino)  # NOQA
except ImportError:
    LIBRARY_PROBLEM = (
        'CSC library 261005 too old or missing: run CSC_Update, '
        'then restart Rhino')

# OPTIONAL HELPERS: they never block the component (decisions 8.112, 8.113) ---
try:
    from csc_gh.ports import ensure_outputs
    from csc_gh.messages import set_state
except ImportError:
    ensure_outputs = set_state = None

OUTPUTS = [
    ('IdentityID', 'IdentityID',
     'Identity ID (GUID)'),
    ('Name', 'Name',
     'Snapshot name (e.g. My Component 01)'),
    ('OriginalFunction', 'OriginalFunction',
     'Original function (IFC class, e.g. IfcBeam)'),
    ('Material', 'Material',
     'Component material (id)'),
    ('Color', 'Color',
     'Snapshot color as System.Drawing.Color'),
    ('Location', 'Location',
     'Snapshot location as Point3d (X=latitude, Y=longitude, Z=0)'),
    ('BoundingBox', 'BoundingBox',
     'The box of the piece on its frame (extents bbx), as a '
     'Rhino.Geometry.Box in the stored coordinates'),
    ('Frame', 'Frame',
     'The frame of the piece as a plane (centre of the box, canonical '
     'axes) in the stored coordinates'),
    ('Descriptors', 'Descriptors',
     'Snapshot descriptors/metadata as JSON string'),
    ('Geometry', 'Geometry',
     'Geometry of the piece: Rhino geometry objects (meshes, point '
     'clouds, authored shapes). Point clouds prefer the full PLY when '
     'Session is signed in, else the inline preview.'),
    ('CaptureMarkers', 'CaptureMarkers',
     'Capture markers as Point3d objects (a scanning rig is not part of '
     'the geometry)'),
    ('Capture', 'Capture',
     'Capture block as JSON (method, device, coordinate system, markers '
     'with label and role, fixtures)'),
    ('Attributes', 'Attributes',
     'Identity attributes as JSON string'),
    ('ConditionGrade', 'ConditionGrade',
     'Overall condition grade (0=unusable as is, 1=poor, 2=average, '
     '3=good) from the evidence; empty when not assessed'),
    ('ManufacturedAt', 'ManufacturedAt',
     'Component manufacturing date as ISO-8601 UTC timestamp'),
    ('ManufacturedPrecision', 'ManufacturedPrecision',
     'Precision qualifier for ManufacturedAt (exact, day, month, year, '
     'unknown)'),
    ('Origin', 'Origin',
     'Origin block as JSON (kind, date, place, construction work, '
     'method, who ...)'),
    ('ParentIdentities', 'ParentIdentities',
     'Parent identity IDs (GUIDs) this identity was cut from'),
    ('Planned', 'Planned',
     'True while the piece is still in place: identified in its works, '
     'not yet deinstalled'),
    ('Remaining', 'Remaining',
     'Pieces left in a batch (recorded quantity minus the pieces drawn); '
     'empty for a piece that is not a batch'),
]


def empty_outputs():
    """What RunScript returns when it stops early."""
    if len(OUTPUTS) == 1:
        return None
    return tuple(None for _ in OUTPUTS)


class CSC_DisassembleComponent(Grasshopper.Kernel.GH_ScriptInstance):
    """
    Author: Max Benjamin Eschenbach
    License: MIT License
    Version: 261005a
    """

    _outputs_ready = True       # set by BeforeRunScript (8.112)
    _outputs_note = None

    def __init__(self):
        """Initialize this component and set component parameters."""
        super().__init__()
        self.Component = ghenv.Component  # NOQA
        self.InputParams = self.Component.Params.Input
        self.OutputParams = self.Component.Params.Output

    def _addRemark(self, msg: str = ''):
        rml = self.Component.RuntimeMessageLevel.Remark
        self.AddRuntimeMessage(rml, msg)

    def _addWarning(self, msg: str = ''):
        rml = self.Component.RuntimeMessageLevel.Warning
        self.AddRuntimeMessage(rml, msg)

    def _addError(self, msg: str = ''):
        rml = self.Component.RuntimeMessageLevel.Error
        self.AddRuntimeMessage(rml, msg)

    def _state(self, text=''):
        """The one short state under the component (decision 8.113)."""
        if set_state is not None:
            set_state(self.Component, text)

    def _stop(self):
        """True when RunScript has to return early: the library is missing or
        too old, or the outputs were just updated (says why)."""
        if LIBRARY_PROBLEM:
            self._addError(LIBRARY_PROBLEM)
            return True
        if self._outputs_note:
            self._addRemark(self._outputs_note)
        return not self._outputs_ready

    def _check_outputs(self):
        """Make the outputs match OUTPUTS before the script runs (8.112)."""
        self._outputs_ready, self._outputs_note = True, None
        if ensure_outputs is None:
            self._outputs_note = (
                'output check skipped: CSC library not installed')
            return
        status = ensure_outputs(self.Component, OUTPUTS)
        self._outputs_ready, self._outputs_note = status.ready, status.remark

    def BeforeRunScript(self):
        """Perform some setup actions."""
        self.InputParams[0].Description = (
            'Component passport JSON ({identity, snapshots[]}) fetched from the server.'
        )
        self._check_outputs()
        if LIBRARY_PROBLEM is None:
            csc_gh.dev_reload(globals())

    def get_auth_core_from_sticky(self):
        """Return Session AuthCore when signed in; None otherwise."""
        return sc.sticky.get('CSC_AuthCore')

    def fetch_snapshot_point_clouds(self, auth_core, snapshot,
                                    identity_id=None):
        """Prefer the full point-cloud PLY via the Session cache, then the
        inline preview; ``[(cloud, primitive index)]``."""
        geometry = snapshot.get('geometry', {}) or {}
        inline_clouds = geometry.get('point_clouds', []) or []
        snapshot_id = snapshot.get('_id')
        results = []
        for index, entry in enumerate(inline_clouds):
            cloud = None
            if auth_core and snapshot_id:
                try:
                    cloud = auth_core.cached_get_snapshot_point_cloud(
                        snapshot_id, index)
                except Exception as error:
                    self._addWarning('Point cloud PLY fetch failed '
                                     f'for index {index}: {error}')
            if cloud is None:
                cloud = inline_cloud_to_rhino(entry)
            if cloud is not None:
                results.append((cloud, index))
            else:
                self._addWarning(
                    f'Point cloud {index} of identity {identity_id} dropped: '
                    'empty, not valid, not finite or wider than 10 km')
        return results

    def snapshot_geometry(self, auth_core, snapshot, identity_id):
        """``[(rhino geometry, kind, index)]`` of a snapshot."""
        geometry = snapshot.get('geometry', {}) or {}
        color = snapshot.get('color') or [110, 110, 110]
        items = []
        for index, entry in enumerate(geometry.get('meshes', []) or []):
            mesh = inline_mesh_to_rhino(entry, color)
            if mesh is None:
                self._addWarning(
                    f'Mesh {index} of identity {identity_id} dropped: '
                    'empty, not valid, not finite or wider than 10 km')
                continue
            items.append((mesh, 'mesh', index))
        for cloud, index in self.fetch_snapshot_point_clouds(
                auth_core, snapshot, identity_id):
            items.append((cloud, 'point_cloud', index))
        if authored_only(snapshot):
            for index, proxy in drawable_proxies(snapshot):
                if (proxy.get('fit') or {}).get('method') != 'authored':
                    continue
                shape = proxy_to_rhino(proxy)
                if shape is None:
                    self._addWarning(
                        f'Proxy {index} of identity {identity_id} dropped: '
                        'cannot be drawn, not valid, not finite or wider '
                        'than 10 km')
                    continue
                items.append((shape, 'proxy', index))
        return items

    def RunScript(self, ComponentPassport: Grasshopper.DataTree[object]):
        if self._stop():
            return empty_outputs()
        names = ('IdentityID', 'Name', 'OriginalFunction', 'Material', 'Color',
                 'Location', 'BoundingBox', 'Frame', 'Descriptors',
                 'Geometry', 'CaptureMarkers', 'Capture',
                 'Attributes', 'ConditionGrade', 'ManufacturedAt',
                 'ManufacturedPrecision', 'Origin', 'ParentIdentities',
                 'Planned', 'Remaining')
        trees = {n: Grasshopper.DataTree[System.Object]() for n in names}
        __Results = tuple(trees[n] for n in names)
        try:
            if not ComponentPassport or ComponentPassport.DataCount == 0:
                self._addWarning(
                    'Input parameter ComponentPassport failed to collect data')
                return __Results

            auth_core = self.get_auth_core_from_sticky()

            for i in range(ComponentPassport.BranchCount):
                ghp = ComponentPassport.Paths[i]
                for comp in ComponentPassport.Branches[i]:
                    try:
                        passport = load_passport(comp)
                        identity, snapshot = parts(passport)
                        if not identity or not snapshot:
                            self._addWarning('Component passport JSON missing identity/'
                                             'snapshots, skipping entry')
                            continue
                        identity_id = identity.get('_id')
                        trees['IdentityID'].Add(identity_id, ghp)
                        trees['Name'].Add(snapshot.get('name'), ghp)
                        trees['OriginalFunction'].Add(
                            identity.get('original_function'), ghp)
                        trees['Material'].Add(identity.get('material'), ghp)
                        rgb_value = snapshot.get('color') or [110, 110, 110]
                        trees['Color'].Add(System.Drawing.Color.FromArgb(
                            255, *rgb_value), ghp)
                        place = snapshot.get('location') or {}
                        if 'lat' in place and 'lon' in place:
                            trees['Location'].Add(Rhino.Geometry.Point3d(
                                place['lat'], place['lon'], 0.0), ghp)
                        else:
                            trees['Location'].Add(
                                Rhino.Geometry.Point3d(0.0, 0.0, 0.0), ghp)

                        # the client-side placement of the piece, if any
                        placed = placement_of(passport)
                        xform = placement_transform(placed) if placed \
                            else Rhino.Geometry.Transform.Identity

                        for geom, kind, index in self.snapshot_geometry(
                                auth_core, snapshot, identity_id):
                            geom.Transform(xform)
                            geom.SetUserString('csc_component', comp)
                            if kind == 'mesh':
                                geom.SetUserString('csc_mesh_index',
                                                   str(index))
                            elif kind == 'point_cloud':
                                geom.SetUserString('csc_point_cloud_index',
                                                   str(index))
                            else:
                                geom.SetUserString('csc_proxy_index',
                                                   str(index))
                            trees['Geometry'].Add(geom, ghp)

                        # the frame and the box on it
                        box = box_of(snapshot)
                        if box:
                            frame, size = box
                            plane = plane_from_frame(frame)
                            shape = Rhino.Geometry.Box(
                                plane,
                                Rhino.Geometry.Interval(-size[0] / 2,
                                                        size[0] / 2),
                                Rhino.Geometry.Interval(-size[1] / 2,
                                                        size[1] / 2),
                                Rhino.Geometry.Interval(-size[2] / 2,
                                                        size[2] / 2))
                            shape.Transform(xform)
                            plane.Transform(xform)
                            trees['BoundingBox'].Add(shape, ghp)
                            trees['Frame'].Add(plane, ghp)
                        else:
                            self._addWarning(
                                f'Identity {identity_id}: the snapshot has no '
                                'frame yet (geometry still being processed?)')

                        trees['Descriptors'].Add(json.dumps(
                            snapshot.get('descriptors', {}) or {}), ghp)

                        for label, role, point in capture_markers(snapshot):
                            marker = Rhino.Geometry.Point3d(*point)
                            marker.Transform(xform)
                            trees['CaptureMarkers'].Add(marker, ghp)
                        if snapshot.get('capture'):
                            trees['Capture'].Add(json.dumps(
                                snapshot['capture']), ghp)

                        trees['Attributes'].Add(json.dumps(
                            identity.get('attributes', {}) or {}), ghp)
                        grade = condition_grade(snapshot)
                        if grade is not None:
                            trees['ConditionGrade'].Add(grade, ghp)
                        if identity.get('manufactured_at') is not None:
                            trees['ManufacturedAt'].Add(
                                identity['manufactured_at'], ghp)
                        if identity.get('manufactured_precision') is not None:
                            trees['ManufacturedPrecision'].Add(
                                identity['manufactured_precision'], ghp)
                        if identity.get('origin'):
                            trees['Origin'].Add(json.dumps(
                                identity['origin']), ghp)
                        for parent in identity.get('parent_identities') or []:
                            trees['ParentIdentities'].Add(parent, ghp)
                        trees['Planned'].Add(bool(
                            (identity.get('origin') or {}).get('planned')),
                            ghp)
                        if identity.get('remaining') is not None:
                            trees['Remaining'].Add(
                                int(identity['remaining']), ghp)

                    except Exception as error:
                        self._addError(
                            f'Error processing component: {error}')

            return __Results

        except Exception as error:
            self._addError(f'Unexpected error during disassembly: {error}')
            return __Results
# ---------- end disassemblecomponent ----------
manufacturedprecision = Data(disassemblecomponent.ManufacturedPrecision)
capturemarkers = Data(disassemblecomponent.CaptureMarkers)
manufacturedat = Data(disassemblecomponent.ManufacturedAt)
conditiongrade = Data(disassemblecomponent.ConditionGrade)
parentidentities = Data(disassemblecomponent.ParentIdentities)
boundingbox = Data(disassemblecomponent.BoundingBox)
descriptors = Data(disassemblecomponent.Descriptors)
attributes = Data(disassemblecomponent.Attributes)
identityid = Data(disassemblecomponent.IdentityID)
material_2 = Data(disassemblecomponent.Material)
location = Data(disassemblecomponent.Location)
capture = Data(disassemblecomponent.Capture)
name = Data(disassemblecomponent.Name)
type = Data(disassemblecomponent.OriginalFunction)
frame = Data(disassemblecomponent.Frame)
proxies = Data(disassemblecomponent.Geometry)
color = Data(disassemblecomponent.Color)
origin = Data(disassemblecomponent.Origin)

# Step 3.1
# comments & notes: Get radial shape signature distances with medium (32 rays) resolution.
panel_2 = Panel("radial_distance_64")
componentpassport_3 = Data(componentpassport)
getdescriptor = GetDescriptor(Input=componentpassport_3, DescriptorKey=panel_2)  # -> DescriptorValues; inputs Input: list, DescriptorKey: String
# ---------- getdescriptor: Python ----------
#! python3
# -*- coding: utf-8 -*-
# venv: DDU_CSC
print('ENV OK!')
# r: charset_normalizer
# r: requests

# PYTHON STANDARD LIBRARY IMPORTS ---------------------------------------------
import json  # NOQA

# RHINO AND GH RELATED IMPORTS ------------------------------------------------
import System  # NOQA
import Grasshopper  # NOQA
import Rhino  # NOQA

# GHENV COMPONENT SETTINGS ----------------------------------------------------
ghenv.Component.Name = 'GetDescriptor'  # NOQA
ghenv.Component.NickName = 'GetDescriptor'  # NOQA
ghenv.Component.Category = 'DDU_CSC'  # NOQA
ghenv.Component.SubCategory = '6 Data Tools'  # NOQA
ghenv.Component.Description = (  # NOQA
    'Retrieves a specific descriptor from multiple component passport inputs '
    '({identity, snapshot}). Accepts component passport JSON strings or geometries '
    'with the csc_component userdata. Returns descriptor values for the '
    'specified key from snapshot.descriptors. Handles single values, lists, '
    'and nested lists by mapping them to appropriate Grasshopper data '
    'structures with input indices as the first path level.'
)

# OPTIONAL HELPERS: they never block the component (decisions 8.112, 8.113) ---
try:
    from csc_gh.ports import ensure_outputs
    from csc_gh.messages import set_state
except ImportError:
    ensure_outputs = set_state = None

OUTPUTS = [
    ('DescriptorValues', 'DescriptorValues',
     'Descriptor value for the specified key, or empty if not found'),
]


def empty_outputs():
    """What RunScript returns when it stops early."""
    if len(OUTPUTS) <= 1:
        return None
    return tuple(None for _ in OUTPUTS)


class CSC_GetDescriptor(Grasshopper.Kernel.GH_ScriptInstance):
    """
    Author: Max Benjamin Eschenbach
    License: MIT License
    Version: 261005
    """

    _outputs_ready = True       # set by BeforeRunScript (8.112)
    _outputs_note = None

    def __init__(self):
        """Initialize this component and set component parameters."""
        super().__init__()
        # initialize props
        self.Component = ghenv.Component  # NOQA
        self.InputParams = self.Component.Params.Input
        self.OutputParams = self.Component.Params.Output

    def _addRemark(self, msg: str = ''):
        """Add a remark message to the component."""
        rml = self.Component.RuntimeMessageLevel.Remark
        self.AddRuntimeMessage(rml, msg)

    def _addWarning(self, msg: str = ''):
        """Add a warning message to the component."""
        rml = self.Component.RuntimeMessageLevel.Warning
        self.AddRuntimeMessage(rml, msg)

    def _addError(self, msg: str = ''):
        """Add an error message to the component."""
        rml = self.Component.RuntimeMessageLevel.Error
        self.AddRuntimeMessage(rml, msg)

    def _state(self, text=''):
        """The one short state under the component (decision 8.113)."""
        if set_state is not None:
            set_state(self.Component, text)

    def _stop(self):
        """True when RunScript has to return early: the outputs were just
        updated (says why)."""
        if self._outputs_note:
            self._addRemark(self._outputs_note)
        return not self._outputs_ready

    def _check_outputs(self):
        """Make the outputs match OUTPUTS before the script runs (8.112)."""
        self._outputs_ready, self._outputs_note = True, None
        if ensure_outputs is None:
            self._outputs_note = (
                'output check skipped: CSC library not installed')
            return
        status = ensure_outputs(self.Component, OUTPUTS)
        self._outputs_ready, self._outputs_note = status.ready, status.remark

    def BeforeRunScript(self):
        """Perform some setup actions."""
        # Set "No type hint"
        self.InputParams[0].TypeHints.Select(System.Object)
        self.Component.VariableParameterMaintenance()
        # Initialize input param descriptions
        self.InputParams[0].Description = (
            'List of component passport JSON strings ({identity, snapshot}) OR '
            'geometries with the \'csc_component\' user text'
        )
        self.InputParams[1].Description = (
            'Key string to retrieve from snapshot.descriptors'
        )
        # Initialize output param descriptions
        self._check_outputs()

    def extract_passport_from_geometry(self, geometry):
        """
        Extract passport data ({identity, snapshot}) from geometry userdata.

        Args:
            geometry: Rhino geometry object with userdata

        Returns:
            Passport dictionary or None
        """
        try:
            if hasattr(geometry, 'GetUserString'):
                userdata = geometry.GetUserString('csc_component')
                if userdata:
                    return json.loads(userdata)
        except Exception as e:
            self._addWarning(f'Could not extract component passport data: {str(e)}')
        return None

    def get_descriptor_value(self, passport, descriptor_key):
        """
        Extract descriptor value from snapshot.descriptors using the key.

        Args:
            passport: Passport dictionary ({identity, snapshot})
            descriptor_key: String key to look for in descriptors

        Returns:
            Descriptor value or None if not found
        """
        try:
            snapshots = (
                passport.get('snapshots')
                if isinstance(passport, dict)
                else None
            )
            snapshot = (
                snapshots[0]
                if isinstance(snapshots, list) and snapshots
                else None
            )
            if not isinstance(snapshot, dict):
                self._addWarning('Component passport JSON has no snapshots')
                return None

            descriptors = snapshot.get('descriptors')
            if isinstance(descriptors, dict) and descriptor_key in descriptors:
                return descriptors[descriptor_key]

            self._addWarning(
                f'Descriptor key "{descriptor_key}" not found in '
                'snapshot.descriptors')
            return None
        except Exception as e:
            self._addError(f'Error extracting descriptor: {str(e)}')
            return None

    def convert_descriptor_to_gh_data(self, descriptor_value):
        """
        Convert descriptor value to appropriate Grasshopper data structure.

        Args:
            descriptor_value: The descriptor value (always float values)

        Returns:
            Grasshopper DataTree with appropriate structure
        """
        result_tree = Grasshopper.DataTree[System.Object]()

        if descriptor_value is None:
            return result_tree

        # Single float value
        if isinstance(descriptor_value, (int, float)):
            ghp = Grasshopper.Kernel.Data.GH_Path(0)
            result_tree.Add(float(descriptor_value), ghp)

        # List of floats
        elif isinstance(descriptor_value, list):
            if len(descriptor_value) == 0:
                return result_tree

            # Check if it's a list of lists (2D)
            if all(isinstance(item, list) for item in descriptor_value):
                # Check if it's 3D (list of lists of lists)
                is_3d = all(isinstance(sublist_item, list)
                            for sublist in descriptor_value
                            for sublist_item in sublist)
                if is_3d:
                    # 3D structure: [[[1,2],[3,4]], [[5,6],[7,8]]]
                    # Paths: (0;0), (0;1), (1;0), (1;1)
                    for i, sublist in enumerate(descriptor_value):
                        for j, inner_list in enumerate(sublist):
                            ghp = Grasshopper.Kernel.Data.GH_Path(i, j)
                            for value in inner_list:
                                result_tree.Add(float(value), ghp)
                else:
                    # 2D structure: [[1,2,3], [9,8,7]]
                    # Paths: (0) for first sublist, (1) for second sublist
                    for i, sublist in enumerate(descriptor_value):
                        ghp = Grasshopper.Kernel.Data.GH_Path(i)
                        for value in sublist:
                            result_tree.Add(float(value), ghp)
            else:
                # Simple list of floats: [1,2,3]
                # Single branch: (0)
                path = Grasshopper.Kernel.Data.GH_Path(0)
                for value in descriptor_value:
                    result_tree.Add(float(value), path)
        else:
            # Fallback for other types
            ghp = Grasshopper.Kernel.Data.GH_Path(0)
            result_tree.Add(float(descriptor_value), ghp)

        return result_tree

    def RunScript(self, Input: list[object], DescriptorKey: str):
        # set up output trees and results tuple
        if self._stop():
            return empty_outputs()
        DescriptorValues = Grasshopper.DataTree[System.Object]()
        try:
            # Validate inputs
            if not Input:
                msg = 'No input provided'
                self._addWarning(msg)
                return DescriptorValues

            if not DescriptorKey:
                msg = 'No descriptor key provided'
                self._addWarning(msg)
                return DescriptorValues


            # Process each input item
            input_list = list(Input)
            for input_index, input_item in enumerate(input_list):
                # Determine input type and extract passport data
                passport = None

                # Check if input is a passport JSON string
                if isinstance(input_item, str):
                    try:
                        passport = json.loads(input_item)
                        self._addRemark(
                            f'Input {input_index} detected as component passport JSON')
                    except json.JSONDecodeError:
                        msg = (f'Input {input_index} is not valid component passport '
                               'JSON!')
                        self._addError(msg)
                        continue
                else:
                    # Input is geometry - extract passport from userdata
                    passport = self.extract_passport_from_geometry(input_item)
                    if not passport:
                        msg = (f'Could not extract component passport data from '
                               f'input {input_index}!')
                        self._addError(msg)
                        continue

                    self._addRemark(
                        f'Input {input_index} detected as geometry with '
                        'component passport userdata')

                # Extract descriptor value
                try:
                    descriptor_value = self.get_descriptor_value(
                        passport, DescriptorKey)

                    if descriptor_value is not None:
                        # Convert descriptor to appropriate Grasshopper data
                        converted_tree = self.convert_descriptor_to_gh_data(
                            descriptor_value)

                        # Merge the converted tree into the output
                        for i in range(converted_tree.BranchCount):
                            original_path = converted_tree.Path(i)
                            # get runcount for first GH Tree index
                            rc = self.Component.RunCount - 1
                            # Prepend input index to the path
                            new_path = Grasshopper.Kernel.Data.GH_Path(
                                0,
                                rc,
                                input_index,
                                *original_path.Indices)
                            branch_data = converted_tree.Branch(i)
                            for item in branch_data:
                                DescriptorValues.Add(item, new_path)

                        self._addRemark(
                            f'Successfully extracted descriptor '
                            f'"{DescriptorKey}" from input {input_index}'
                        )
                    else:
                        # Descriptor not found
                        msg = (f'Descriptor "{DescriptorKey}" not found in '
                               f'input {input_index}')
                        self._addWarning(msg)

                except Exception as e:
                    msg = (f'Error extracting descriptor from input '
                           f'{input_index}: {str(e)}')
                    self._addError(msg)

            # Update success message

            # return output trees
            return DescriptorValues

        except Exception as e:
            msg = f'Unexpected error during descriptor extraction: {str(e)}'
            self._addError(msg)
            return DescriptorValues
# ---------- end getdescriptor ----------
radial_distance_64 = Data(getdescriptor)

# Step 3.2
# comments & notes: Get radial shape signature tangent vectors with medium (32 rays) resolution.
panel_3 = Panel("radial_tangent_64")
componentpassport_4 = Data(componentpassport)
getdescriptor_2 = GetDescriptor(Input=componentpassport_4, DescriptorKey=panel_3)  # -> DescriptorValues; inputs Input: list, DescriptorKey: String; same code as getdescriptor
radial_tangent_64 = Data(getdescriptor_2)

# Step 4.1
# comments & notes: We also combine the values from the server-side-computed radial signature of the components in the catalog.
# 
# The data arrives in grasshopper slightly differently. This has technical reasons and explaining them here would be a bit much ;-)
# 
# Again, what matters: 192 numeric values per shape that are able to describe the form. In the same format and order (!) as the 192 numeric values for our design shapes.
radial_distance_64_2 = Data(radial_distance_64)
radial_tangent_64_2 = Data(radial_tangent_64)
item = ListItem(List=radial_tangent_64_2, Index=0, Wrap=True)  # -> Item, Item1
pshift = ShiftPaths(Data=item.Item1, Offset=-1)
pshift_2 = ShiftPaths(Data=item.Item, Offset=-1)
panel_4 = Panel("""0
1
2""")
weave = Weave(Pattern=panel_4, Stream0=radial_distance_64_2, Stream1=pshift_2, Stream2=pshift, NullGaps=False)
pshift_3 = ShiftPaths(Data=weave, Offset=-2)
catalogshapes_radialsignature = Data(pshift_3)

# Step 4.1
# comments & notes: Here we combine the values of the radial signature. This is a rather data-structure-centric operation.
# 
# You don't necessarily need to understand it fully. What matters is our result - in this case:
# 
# 192 numeric values per shape that are able to describe the form.
designshapes_tangents_2 = Data(designshapes_tangents)
designshapes_distances_2 = Data(designshapes_distances)
devec = DeconstructVector(Vector=designshapes_tangents_2)  # -> XComponent, YComponent, ZComponent
panel_5 = Panel("""0
1
2""")
weave_2 = Weave(Pattern=panel_5, Stream0=designshapes_distances_2, Stream1=devec.XComponent, Stream2=devec.YComponent, NullGaps=False)
designshapes_radialsignature = Data(weave_2)

# Step 3.4
# comments & notes: Extract Extrusion Profile curves.
proxygeometry = Data(proxies)
extrusionprofile = ExtrusionProfile(ExtrusionGeometry=proxygeometry)  # -> ProfileCurve; inputs ExtrusionGeometry: Extrusion, ProfileIndex: Int32, ProfileParameter: Double
# ---------- extrusionprofile: Python ----------
#! python3
# -*- coding: utf-8 -*-
# venv: DDU_CSC
print('ENV OK!')
# r: charset_normalizer
# r: requests

# PYTHON STANDARD LIBRARY IMPORTS ---------------------------------------------

# RHINO AND GH RELATED IMPORTS ------------------------------------------------
import System  # type: ignore[reportMissingImport] # NOQA
import Grasshopper  # type: ignore[reportMissingImport] # NOQA
import Rhino  # type: ignore[reportMissingImport] # NOQA
import scriptcontext as sc  # type: ignore[reportMissingImport] # NOQA

# GHENV COMPONENT SETTINGS ----------------------------------------------------
ghenv.Component.Name = 'ExtrusionProfile'  # type: ignore[reportUnedfinedVariable] # NOQA
ghenv.Component.NickName = 'ExtrusionProfile'  # type: ignore[reportUnedfinedVariable] # NOQA
ghenv.Component.Category = 'DDU_CSC'  # type: ignore[reportUnedfinedVariable] # NOQA
ghenv.Component.SubCategory = '7 Geometry Tools'  # type: ignore[reportUnedfinedVariable] # NOQA
ghenv.Component.Description = (  # type: ignore[reportUnedfinedVariable] # NOQA
    'Extract the profile curves of an Extrusion.'
)

# OPTIONAL HELPERS: they never block the component (decisions 8.112, 8.113) ---
try:
    from csc_gh.ports import ensure_outputs
    from csc_gh.messages import set_state
except ImportError:
    ensure_outputs = set_state = None

OUTPUTS = [
    ('ProfileCurve', 'ProfileCurve',
     'The extracted profile curve.'),
]


def empty_outputs():
    """What RunScript returns when it stops early."""
    if len(OUTPUTS) <= 1:
        return None
    return tuple(None for _ in OUTPUTS)


class CSC_ExtrusionProfile(Grasshopper.Kernel.GH_ScriptInstance):
    """
    Author: Max Benjamin Eschenbach
    License: MIT License
    Version: 261005
    """

    _outputs_ready = True       # set by BeforeRunScript (8.112)
    _outputs_note = None

    def __init__(self):
        """Initialize this component and set component parameters."""
        super().__init__()
        # initialize props
        self.Component = ghenv.Component  # type: ignore[reportUnedfinedVariable] # NOQA
        self.InputParams = self.Component.Params.Input
        self.OutputParams = self.Component.Params.Output

    def _addRemark(self, msg: str = ''):
        """Add a remark message to the component."""
        rml = self.Component.RuntimeMessageLevel.Remark
        self.AddRuntimeMessage(rml, msg)

    def _addWarning(self, msg: str = ''):
        """Add a warning message to the component."""
        rml = self.Component.RuntimeMessageLevel.Warning
        self.AddRuntimeMessage(rml, msg)

    def _addError(self, msg: str = ''):
        """Add an error message to the component."""
        rml = self.Component.RuntimeMessageLevel.Error
        self.AddRuntimeMessage(rml, msg)

    def _state(self, text=''):
        """The one short state under the component (decision 8.113)."""
        if set_state is not None:
            set_state(self.Component, text)

    def _stop(self):
        """True when RunScript has to return early: the outputs were just
        updated (says why)."""
        if self._outputs_note:
            self._addRemark(self._outputs_note)
        return not self._outputs_ready

    def _check_outputs(self):
        """Make the outputs match OUTPUTS before the script runs (8.112)."""
        self._outputs_ready, self._outputs_note = True, None
        if ensure_outputs is None:
            self._outputs_note = (
                'output check skipped: CSC library not installed')
            return
        status = ensure_outputs(self.Component, OUTPUTS)
        self._outputs_ready, self._outputs_note = status.ready, status.remark

    def BeforeRunScript(self):
        """Perform some setup actions."""
        # Initialize input param descriptions
        self.InputParams[0].Description = (
            'A Rhino.Geometry.Extrusion to extract '
            'the profile curve from'
        )
        self.InputParams[1].Description = (
            'Index of the profile curve to extract. '
            'The outer profile has index 0.'
        )
        self.InputParams[2].Description = (
            'A relative parameter controlling which profile is returned. '
            '0 = bottom profile and 1 = top profile.'
        )
        # Initialize output param descriptions
        self._check_outputs()

    def RunScript(self,
            ExtrusionGeometry: Rhino.Geometry.Extrusion,
            ProfileIndex: int,
            ProfileParameter: float):
        # init outputs
        if self._stop():
            return empty_outputs()
        ProfileCurve = Grasshopper.DataTree[System.Object]()
        # defaults
        if not ExtrusionGeometry:
            self._addWarning(
                'Input Parameter ExtrusionGeometry failed to collect data.'
            )
            return ProfileCurve
        if ProfileIndex is None:
            ProfileIndex = 0
        elif ProfileIndex < ExtrusionGeometry.ProfileCount - 1:
            self._addError('Input Parameter ProfileIndex is out of range!')
            return ProfileCurve
        elif ProfileIndex > ExtrusionGeometry.ProfileCount - 1:
            self._addError('Input Parameter ProfileIndex is out of range!')
            return ProfileCurve
        if ProfileParameter is None:
            ProfileParameter = 0.5
        elif ProfileParameter < 0:
            self._addWarning(
                'ProfileParameter was set to 0.0! '
                'Must be >= 0.0 and <= 1.0!'
            )
            ProfileParameter = 0.0
        elif ProfileParameter > 1:
            self._addWarning(
                'ProfileParameter was set to 1.0! '
                'Must be >= 0.0 and <= 1.0!'
            )
            ProfileParameter = 0.0
        # finally extract profile curve
        ProfileCurve = ExtrusionGeometry.Profile3d(0, 0.5)
        # return results
        return ProfileCurve
# ---------- end extrusionprofile ----------
profilecurve = Data(extrusionprofile)

# Step 5
# comments & notes: Here we use an assignment algorithm to find the most fitting parts from our catalog (CatalogShapes) for our DesignShapes.
# 
# This algorithm works with the 192 numeric values we have acquired in the last steps.
# 
# There is a Greedy (fast) option and the famous Hungarian (optimal) version.
catalogshapes_radialsignature_2 = Data(catalogshapes_radialsignature)
designshapes_radialsignature_2 = Data(designshapes_radialsignature)
algorithm = ValueList({"Greedy": "greedy", "Hungarian": "hungarian"}, selected="Greedy")
assignmentpoints = AssignmentPoints(DesignPts=designshapes_radialsignature_2, LibraryPts=catalogshapes_radialsignature_2, Algorithm=algorithm)  # -> Assignment, Cost; inputs DesignPts: tree of Double, LibraryPts: tree of Double, Weights: list of Double, ScaleFactor: Double, Algorithm: String
# ---------- assignmentpoints: Python ----------
#! python3
# -*- coding: utf-8 -*-
# venv: DDU_CSC_MATCH
# r: charset_normalizer
# r: numpy==2.0.2
# r: scipy==1.13.1
print('ENV OK!')

# THIRD PARTY LIBRARY IMPORTS -------------------------------------------------
import numpy as np  # NOQA
from scipy.optimize import linear_sum_assignment  # NOQA

# RHINO AND GH RELATED IMPORTS ------------------------------------------------
import System  # NOQA
import Grasshopper  # NOQA
import Rhino  # NOQA

# GHENV COMPONENT SETTINGS ----------------------------------------------------
ghenv.Component.Name = 'AssignmentPoints'  # NOQA
ghenv.Component.NickName = 'AssignmentPoints'  # NOQA
ghenv.Component.Category = 'DDU_CSC'  # NOQA
ghenv.Component.SubCategory = '5 Matchmaking Tools'  # NOQA
ghenv.Component.Description = (  # NOQA
    'Solve point-to-point assignment between DesignPts and LibraryPts. '
    'Supports Greedy assignment (default, FullCircle-compatible) and '
    'Hungarian assignment (SciPy).'
)


def _weighted_euclidean_distance(pt1, pt2, weights):
    p1 = np.asarray(pt1, dtype=np.float64)
    p2 = np.asarray(pt2, dtype=np.float64)
    w = np.asarray(weights, dtype=np.float64)
    return float(np.sqrt(np.sum(w * np.square(p2 - p1))))

# OPTIONAL HELPERS: they never block the component (decisions 8.112, 8.113) ---
try:
    from csc_gh.ports import ensure_outputs
    from csc_gh.messages import set_state
except ImportError:
    ensure_outputs = set_state = None

OUTPUTS = [
    ('Assignment', 'Assignment',
     'Assignment tree. Branch i contains selected library index for design point i.'),
    ('Cost', 'Cost',
     'Assignment cost tree. Branch i contains the cost value for design point i.'),
]


def empty_outputs():
    """What RunScript returns when it stops early."""
    if len(OUTPUTS) <= 1:
        return None
    return tuple(None for _ in OUTPUTS)


class CSC_AssignmentPoints(Grasshopper.Kernel.GH_ScriptInstance):
    """
    Author: Max Benjamin Eschenbach
    License: MIT License
    Version: 261005
    """

    _outputs_ready = True       # set by BeforeRunScript (8.112)
    _outputs_note = None

    def __init__(self):
        super().__init__()
        self.Component = ghenv.Component  # NOQA
        self.InputParams = self.Component.Params.Input
        self.OutputParams = self.Component.Params.Output

    def _addRemark(self, msg=''):
        self.AddRuntimeMessage(self.Component.RuntimeMessageLevel.Remark, msg)

    def _addWarning(self, msg=''):
        self.AddRuntimeMessage(self.Component.RuntimeMessageLevel.Warning, msg)

    def _addError(self, msg=''):
        self.AddRuntimeMessage(self.Component.RuntimeMessageLevel.Error, msg)

    def _state(self, text=''):
        """The one short state under the component (decision 8.113)."""
        if set_state is not None:
            set_state(self.Component, text)

    def _stop(self):
        """True when RunScript has to return early: the outputs were just
        updated (says why)."""
        if self._outputs_note:
            self._addRemark(self._outputs_note)
        return not self._outputs_ready

    def _check_outputs(self):
        """Make the outputs match OUTPUTS before the script runs (8.112)."""
        self._outputs_ready, self._outputs_note = True, None
        if ensure_outputs is None:
            self._outputs_note = (
                'output check skipped: CSC library not installed')
            return
        status = ensure_outputs(self.Component, OUTPUTS)
        self._outputs_ready, self._outputs_note = status.ready, status.remark

    def BeforeRunScript(self):
        self.InputParams[0].Description = (
            'Design points as DataTree of Numbers. Each branch is one point.'
        )
        self.InputParams[1].Description = (
            'Library points as DataTree of Numbers. Each branch is one point.'
        )
        self.InputParams[2].Description = (
            'Weights for weighted Euclidean distance. Optional; defaults to '
            '1.0 in each dimension.'
        )
        self.InputParams[3].Description = (
            'Scale factor used by Hungarian mode before optimization. '
            'Optional; default 1e3. Ignored by Greedy mode.'
        )
        self.InputParams[4].Description = (
            "Algorithm selector. Optional; defaults to 'greedy'. "
            "Accepted values: 'greedy', 'hungarian'."
        )

        self._check_outputs()

    def _collect_tree_branches(self, tree):
        if tree is None or tree.DataCount == 0:
            return []
        return [list(tree.Branch(path)) for path in tree.Paths]

    def _normalize_algorithm(self, algorithm):
        if algorithm is None:
            return 'greedy'
        alg = str(algorithm).strip().lower()
        if alg in ('', 'greedy', 'g'):
            return 'greedy'
        if alg in ('hungarian', 'hungary', 'h', 'scipy'):
            return 'hungarian'
        return None

    def _build_cost_matrices(self, design_branches, library_branches, weights):
        n = len(design_branches)
        m = len(library_branches)
        costs = np.zeros((m, m), dtype=np.float64)
        for i in range(m):
            if i >= n:
                continue
            for j in range(m):
                costs[i, j] = _weighted_euclidean_distance(
                    design_branches[i], library_branches[j], weights
                )
        return costs

    def _run_greedy(self, costs):
        m = int(costs.shape[0])
        selected = np.zeros(m, dtype=np.int32)
        assignment = np.full(m, -1, dtype=np.int32)

        for i in range(m):
            min_cost = float('inf')
            sel = -1
            for j in range(m):
                c = float(costs[i, j])
                if c < min_cost and selected[j] == 0:
                    min_cost = c
                    sel = j
            if sel < 0:
                raise ValueError('Greedy assignment failed to select a column')
            selected[sel] = 1
            assignment[i] = sel
        return assignment

    def _run_hungarian(self, costs, scale_factor):
        scaled = np.asarray(
            np.floor(costs * float(scale_factor)),
            dtype=np.int64,
        )
        rows, cols = linear_sum_assignment(scaled)
        assignment = np.full(scaled.shape[0], -1, dtype=np.int32)
        assignment[rows] = cols.astype(np.int32)
        if np.any(assignment < 0):
            raise ValueError('Hungarian assignment did not cover all rows')
        return assignment

    def RunScript(self,
            DesignPts: Grasshopper.DataTree[float],
            LibraryPts: Grasshopper.DataTree[float],
            Weights: list[float],
            ScaleFactor: float,
            Algorithm: str):
        if self._stop():
            return empty_outputs()
        Assignment = Grasshopper.DataTree[System.Object]()
        Cost = Grasshopper.DataTree[System.Object]()
        __Results = (Assignment, Cost)


        design_branches = self._collect_tree_branches(DesignPts)
        library_branches = self._collect_tree_branches(LibraryPts)
        n = len(design_branches)
        m = len(library_branches)

        if n == 0:
            self._addWarning('DesignPts failed to collect data!')
            return __Results
        if m == 0:
            self._addWarning('LibraryPts failed to collect data!')
            return __Results
        if n > m:
            self._addError(
                'Number of DesignPts needs to be smaller than number of '
                'LibraryPts!'
            )
            return __Results

        dim = len(design_branches[0])
        if dim == 0:
            self._addWarning('DesignPts branches are empty')
            return __Results

        for i, b in enumerate(design_branches):
            if len(b) != dim:
                self._addError(
                    f'DesignPts branch #{i} has dimension {len(b)}; '
                    f'expected {dim}.'
                )
                return __Results
        for j, b in enumerate(library_branches):
            if len(b) != dim:
                self._addError(
                    f'LibraryPts branch #{j} has dimension {len(b)}; '
                    f'expected {dim}.'
                )
                return __Results

        if not Weights or len(Weights) == 0:
            weights = np.ones(dim, dtype=np.float64)
        else:
            if len(Weights) != dim:
                self._addError(
                    f'Weights length ({len(Weights)}) does not match point '
                    f'dimension ({dim}).'
                )
                return __Results
            weights = np.asarray([float(w) for w in Weights], dtype=np.float64)

        algorithm = self._normalize_algorithm(Algorithm)
        if algorithm is None:
            self._addError(
                "Invalid Algorithm value. Use 'greedy' or 'hungarian'."
            )
            return __Results

        if ScaleFactor is None:
            ScaleFactor = 1e3
        try:
            scale_factor = float(ScaleFactor)
        except (TypeError, ValueError):
            self._addError(f'ScaleFactor must be numeric, got {ScaleFactor!r}')
            return __Results
        if not np.isfinite(scale_factor) or scale_factor <= 0.0:
            self._addError(f'ScaleFactor must be > 0, got {scale_factor}')
            return __Results

        try:
            real_costs = self._build_cost_matrices(
                design_branches, library_branches, weights
            )
            if algorithm == 'hungarian':
                assignment = self._run_hungarian(real_costs, scale_factor)
            else:
                assignment = self._run_greedy(real_costs)
        except Exception as exc:
            self._addError(f'Assignment failed: {exc}')
            return __Results

        for i in range(n):
            path = Grasshopper.Kernel.Data.GH_Path(i)
            j = int(assignment[i])
            Assignment.Add(j, path)
            Cost.Add(float(real_costs[i, j]), path)

        self._addRemark(
            f'Assigned {n} design points to {m} library points using '
            f'{algorithm}.'
        )
        return __Results
# ---------- end assignmentpoints ----------
assignment = Data(assignmentpoints.Assignment)
panel_6 = Panel(assignment)

# Step 6
# comments & notes: Finally, we use the assignment indices to get the assigned data tree branches from the catalog.
# 
# Then we use the inverse of our DesignShapes RestPosition transformation to transform the catalog shapes into the "best" orientation for the respective Design Shapes.
catalogshapes_profilecurves = Data(profilecurve)
assignment_2 = Data(assignment)
id = Data(identityid)
tstat = TreeStatistics(Tree=catalogshapes_profilecurves)  # -> Paths, Length, Count
designshapes_restpositiontransform_2 = Data(designshapes_restpositiontransform)
tstat_2 = TreeStatistics(Tree=id)  # -> Paths, Length, Count
item_2 = ListItem(List=tstat.Paths, Index=assignment_2, Wrap=True)
item_3 = ListItem(List=tstat_2.Paths, Index=assignment_2, Wrap=True)
inverse = InverseTransform(Transform=designshapes_restpositiontransform_2)
branch = TreeBranch(Tree=catalogshapes_profilecurves, Path=item_2, MaintainPaths=True)
branch_2 = TreeBranch(Tree=id, Path=item_3, MaintainPaths=True)
ids_of_assigned_components = Panel(branch_2)
transform = Transform(Geometry=branch, Transform=inverse)
catalogshapes_atdesignshapelocation = Data(transform)
curvepreviewlw_2 = CurvePreviewLW(Curves=flatten(transform), Colors=ColourSwatch(SwatchColor=RGB(242, 0, 255)), Thickness=Slider(2, range=0..10))  # inputs Curves: list of Curve, Colors: list of Color, Thickness: list of Int32; same code as curvepreviewlw
